# Dynamo graph ClockworkDeprecation.dyn (Dynamo 1.0.0.1180)

byElement = Custom[BoundingBox.ByElement]()  # Gets the bounding box of a Revit element
boundingBox = Element.BoundingBox()
fromDynamoBoundingBox = Custom[RevitBoundingBox.FromDynamoBoundingBox](DynamoBoundingBox=boundingBox)  # Turns a Dynamo bounding box into a Revit bounding box.
byFace = Custom[CurtainSystem.ByFace]()  # Creates a curtain system on top of a face. The face typically needs to be the face of a mass surface in Revit.
fine = Custom[DetailLevel.Fine]()  # Returns the fine detail level
medium = Custom[DetailLevel.Medium]()  # Returns the medium detail level
coarse = Custom[DetailLevel.Coarse]()  # Returns the coarse detail level
fromCurve = Custom[DetailLine.FromCurve]()  # Creates a detail line based on a given curve
style = Custom[DimensionType.Style]()  # Gets the style of a given Revit dimension type
linksAndImports = Custom[Document.LinksAndImports]()  # Gets all linked and imported files in the document. NOTE: Does *not* retrieve linked Revit files.
element_types = ElementTypes("ImportInstance")
all_elements_of_type = ElementsOfType(element_types)
parameterIsReadOnly = Custom[Element.ParameterIsReadOnly]()  # Checks if a parameter of a given element is read-only
type = Custom[Element.Type]()  # Gets the family type of a given element (if applicable).
getValue = Custom[GlobalParameter.GetValue]()  # Gets the value of a global parameter (only in Revit 2016 R2 or later).
repeatItemsByLengths = Custom[List.RepeatItemsByLengths]()  # Repeats a list of items into sublists of given lengths
ofRepeatedItem = List.OfRepeatedItem()
sublistLengths = Custom[List.SublistLengths]()  # Gets the lengths of all sublists in a given list of lists.
count = List.Count()
sublistsContain = Custom[List.SublistsContain]()  # Looks for an item in each sublist of a given list and returns true/false for each sublist.
containsItem = List.ContainsItem()
fromCurves = Custom[RevisionCloud.FromCurves]()  # Creates a revision cloud from a list of geometry curves.
text = Custom[TextElement.Text]()  # Gets the text stored in a text element (i.e. text note or model text)
isInsidePolygon = Custom[UV.IsInsidePolygon]()  # Determines if a point is inside the space enclosed by a polygon
containmentTest = Polygon.ContainmentTest()
isViewTemplate = Custom[View.IsViewTemplate]()  # Checks if a given view is a view template
byFace_2 = Custom[Wall.ByFace]()  # Creates a wall on top of a face. The face typically needs to be the face of a mass surface in Revit.
coreInterior = Custom[WallLocationLine.CoreInterior]()  # Returns the WallLocationLine option for CoreInterior
coreExterior = Custom[WallLocationLine.CoreExterior]()  # Returns the WallLocationLine option for CoreExterior
coreCenterline = Custom[WallLocationLine.CoreCenterline]()  # Returns the WallLocationLine option for CoreCenterLine
wallCenterline = Custom[WallLocationLine.WallCenterline]()  # Returns the WallLocationLine option for WallCenterLine
finishFaceExterior = Custom[WallLocationLine.FinishFaceExterior]()  # Returns the WallLocationLine option for FinishFaceExterior
finishFaceInterior = Custom[WallLocationLine.FinishFaceInterior]()  # Returns the WallLocationLine option for FinishFaceInterior
