# Dynamo graph RegularExpressions.dyn (Dynamo 0.7.1.30377)

string = StringInput("[a-zA-Z]*berry")
string_2 = StringInput("Strawberry")
string_3 = StringInput("Raspberry")
string_4 = StringInput("Banana")
create_list = List.Create(string_2, string_3, string_4)
filter_list_by_regular = Custom[Filter List by Regular Expression Matches](regex=string, list=create_list)  # Filters out all items from a list of strings that don't begin with the regular expression. The syntax for regular expressions is explained at http://ironpython-test.readthedocs.org/en/latest/howto/regex.html
# note: Both custom nodes return null
watch = Watch(filter_list_by_regular.in)
match_regular_expression = Custom[Match Regular Expression](regex=string, string_s=create_list)  # Determines if a regular expression matches a string (or a list of strings) and returns a boolean value (or a list, depending on the input). The syntax for regular expressions is explained at http://ironpython-test.readthedocs.org/en/latest/howto/regex.html
# note: The content of Match Regular Expression returns the correct values
watch_2 = Watch(match_regular_expression)
watch_3 = Watch(filter_list_by_regular.out)
turn_into_list = Custom[Turn Into List](item=create_list)  # Turns an element (or a nested list) into a flat list
python_script = Python(IN[0]=string, IN[1]=turn_into_list)
# ---------- python_script.python (13 lines) ----------
import clr
import re

regexstring = IN[0]
regexlist = IN[1]
elementlist = list()
thisexp = re.compile(regexstring)
for item in regexlist:
	if (str(thisexp.match(item)) == 'None'):
		elementlist.append(False)
	else:
		elementlist.append(True)
OUT = elementlist
# ----------------------------------------
return_list_or_single_value = Custom[Return List Or Single Value](list_1=turn_into_list, list_2=python_script)  # If the list in input #1 only contains one item, only the first item of the list in input #2 will be returned.
watch_4 = Watch(return_list_or_single_value)
turn_into_list_2 = Custom[Turn Into List](item=create_list)
match_regular_expression_2 = Custom[Match Regular Expression](regex=string, string_s=turn_into_list_2)
turn_into_list_3 = Custom[Turn Into List](item=match_regular_expression_2)
# note: The content of Filter List by Regular Expression Matches returns null - because the nested custom node returns null.
filterByBoolMask = List.FilterByBoolMask(turn_into_list_2, turn_into_list_3)
watch_5 = Watch(filterByBoolMask.out0)
watch_6 = Watch(filterByBoolMask.out1)
turn_into_list_4 = Custom[Turn Into List](item=create_list)
turn_into_list_5 = Custom[Turn Into List](item=return_list_or_single_value)
# note: The content of Filter List by Regular Expression Matches returns the correct values - but only without a nested custom node.
filterByBoolMask_2 = List.FilterByBoolMask(turn_into_list_4, turn_into_list_5)
watch_7 = Watch(filterByBoolMask_2.out1)
watch_8 = Watch(filterByBoolMask_2.out0)
