# Dynamo graph 2006_AutoLayoutCrash.dyn (Dynamo 0.7.1.29946)

code_block = CodeBlock()
# ---------- code_block.designscript (4 lines) ----------
{Point.ByCoordinates(0,0,0),
Point.ByCoordinates(0,1,0),
Point.ByCoordinates(0,1,1)};
0..1..#8;
# ----------------------------------------
byPerimeterPoints = Surface.ByPerimeterPoints(code_block.out0)
pointAtParameter = Surface.PointAtParameter(byPerimeterPoints, code_block.out1, code_block.out1, lacing=CrossProduct)
normalAtParameter = Surface.NormalAtParameter(byPerimeterPoints, code_block.out1, code_block.out1, lacing=CrossProduct)
project = Point.Project(pointAtParameter, byPerimeterPoints, normalAtParameter)
watch = Watch(project)
byCoordinates = UV.ByCoordinates(code_block.out1, code_block.out1, lacing=CrossProduct)
isNull = Object.IsNull(project)
isEmpty = List.IsEmpty()
map = List.Map(isNull, isEmpty)
filterByBoolMask = List.FilterByBoolMask(byCoordinates, map)
watch_2 = Watch(filterByBoolMask)
