# Dynamo graph 2396_CBNBackslashIssues.dyn (Dynamo 0.8.3.2514)

code_block = CodeBlock { parts1 = String.Split(fullpath,"\"); parts2 = List.TakeItems(parts1,(List.Count(parts)-1)); String.Join("\\",parts2); }
