# Dynamo graph 2506_ListIsEmptyReturnsNullForRevitTypes.dyn (Dynamo 0.7.2.26223)

select_model_elements = DSModelElementsSelection()  # 3 picked in the model
code_block = CodeBlock(seq=select_model_elements) { {seq[0],seq[1],List.Empty,seq[2],List.Empty}; }
isEmpty = List.IsEmpty()
map = List.Map(code_block, isEmpty)
code_block_2 = CodeBlock { 1..5; }
code_block_3 = CodeBlock(seq=code_block_2) { {seq[0],seq[1],List.Empty,seq[2],List.Empty}; }
map_2 = List.Map(code_block_3, isEmpty)
