# Dynamo graph SortNestedList.dyn (Dynamo 0.7.2.2114)

categories = Categories(index=894)
all_elements_of_category = ElementsOfCategory(categories)
watch = Watch(all_elements_of_category)
level = Custom[Element.Level](element_s=all_elements_of_category)  # Gets an element's level
elevation = Level.Elevation(level)
watch_2 = Watch(elevation)
create = List.Create(elevation, all_elements_of_category)
code_block = CodeBlock { 0; }
boolean = BoolSelector(false)
sortListOfLists = Custom[List.SortListOfLists](List_of_lists=create, Sort_index=code_block, Case_insensitive=boolean, Order_Descending=boolean)  # Sorts a list of lists by one of its sublists
firstItem = List.FirstItem(sortListOfLists)
watch_3 = Watch(firstItem)
lastItem = List.LastItem(sortListOfLists)
watch_4 = Watch(lastItem)
