# Dynamo graph 2970_AllElementsOfCategoryViewsFails.dyn (Dynamo 0.7.6.4070)

categories = Categories("Views")
all_elements_of_category = ElementsOfCategory(categories)
watch = Watch(all_elements_of_category)
