# Dynamo graph 3015_CrashWhenRunningGraph.dyn (Dynamo 0.7.2.2114)

categories = Categories(index=894)
all_elements_of_category = ElementsOfCategory(categories)
boolean = BoolSelector(true)
inserts = Custom[Element.Inserts](Element_s=all_elements_of_category, Include_Openings=boolean, Include_Shadows=boolean, Include_Embedded_Walls=boolean, Include_Shared_Embedded_Inserts=boolean)  # Gets all the objects inserted into a given element.
watch = Watch(inserts)
