# Dynamo graph 3058_GroupByKeyFails.dyn (Dynamo 0.7.3.3034)

categories = Categories("Walls")
all_elements_of_category = ElementsOfCategory(categories)
watch = Watch(all_elements_of_category)
name = Element.Name()
groupByKey = GroupByKey(all_elements_of_category, name)
watch_2 = Watch(groupByKey)
name_2 = Element.Name(all_elements_of_category)
watch_3 = Watch(name_2)
name_3 = Element.Name(groupByKey)
watch_4 = Watch(name_3)
