# Dynamo graph 3083_AllElementsOfTypeFailsForDimensionTypes.dyn (Dynamo 0.7.6.4070)

element_types = ElementTypes("DimensionType")
all_elements_of_type = ElementsOfType(element_types)
watch = Watch(all_elements_of_type)
