# Dynamo graph 3100_Python_dictionaries.dyn (Dynamo 0.7.3.3034)

code_block = CodeBlock { "1"; "2"; "3"; "4"; }
create_list = List.Create(code_block.out0, code_block.out1)
create_list_2 = List.Create(code_block.out1, code_block.out2)
create_list_3 = List.Create(code_block.out2, code_block.out3)
create_list_4 = List.Create(code_block.out0, code_block.out3)
create_list_5 = List.Create(code_block.out1, code_block.out3)
create_list_6 = List.Create(create_list, create_list_2, create_list_3, create_list_4, create_list_5)
flatten = Flatten(create_list_6)
uniqueItems = List.UniqueItems(flatten)
reverse = List.Reverse()
map = List.Map(create_list_6, reverse)
join = List.Join(create_list_6, map)
python_script = Python(IN[0]=uniqueItems, IN[1]=join)
# ---------- python_script.python (11 lines) ----------
indices = IN[0]
flatlist = IN[1]
pathgraph = dict()

for index in indices:
	indexlist = list()
	for item in flatlist:
		if index == item[0]:
			indexlist.append(item[1])
	pathgraph[index] = indexlist	
OUT = pathgraph
# ----------------------------------------
