# Dynamo graph 3106_CBNConditionsDontProcessLists.dyn (Dynamo 0.9.0.3067)

code_block = CodeBlock()
# ---------- code_block.designscript (15 lines) ----------
booleans = {true,false};
singleboolean1 = true;
singleboolean2 = false;
singlevar = "ABC";
vars1 = 2..3;
vars2 = {"A","B"};
booleans ? vars1 : List.Empty;
booleans ? vars1 : vars2;
booleans ? vars1 : singlevar;
singleboolean1 ? vars1 : List.Empty;
singleboolean2 ? vars1 : List.Empty;
singleboolean1 ? vars1 : vars2;
singleboolean2 ? vars1 : vars2;
singleboolean1 ? vars1 : singlevar;
singleboolean2 ? vars1 : singlevar;
# ----------------------------------------
# note: Expected result:
# [0] 2
# [1] Empty List
watch = Watch(code_block.out6)
watch_2 = Watch(code_block.out7)
watch_3 = Watch(code_block.out8)
# note: Expected result:
# [0] 2
# [1] 3
watch_4 = Watch(code_block.out9)
watch_5 = Watch(code_block.out10)
watch_6 = Watch(code_block.out11)
# note: Expected result:
# ABC
watch_7 = Watch(code_block.out14)
watch_8 = Watch(code_block.out13)
watch_9 = Watch(code_block.out12)
