# Dynamo graph 3234_AddingListsNotPossible.dyn (Dynamo 0.7.6.4070)

code_block = CodeBlock { {1..4,1..6,1..3}; {2,4,8}; }
add = code_block.out0 + code_block.out1
watch = Watch(add)
code_block_2 = CodeBlock(a=code_block.out0, b=code_block.out1) { a+b; }
watch_2 = Watch(code_block_2)
