# Dynamo graph Paneling.Patterns.Quadrilateral.dyn (Dynamo 0.8.3.2514)

# note: Run this graph on the Paneling_Sample model in the extra folder.
select_face = DSFaceSelection()  # 1 picked in the model
firstItem = List.FirstItem(select_face)
integer_slider = IntegerSlider(9, range=0..20 step 1)
integer_slider_2 = IntegerSlider(11, range=0..20 step 1)
gridFromFace = Custom[Paneling.GridFromFace](surface=firstItem, U=integer_slider, V=integer_slider_2)  # Returns UV coordinates, XYZ coordinates and normals for a face with UV subdivision
boolean = BoolSelector(false)
integer_slider_3 = IntegerSlider(0, range=0..3 step 1)
quadrilateral = Custom[Paneling.Quadrilateral](list=gridFromFace.UVs, V=integer_slider_2, reverse=boolean, shift_placement=integer_slider_3)  # Creates groups of points from a list of UVs or XYZs for the placement of quadrilateral panels. The placement pattern can be reversed (boolean) and shifted (integer).
watch = Watch(quadrilateral)
family_types = FamilyTypes("4PointACByOffset_VarA:Type 1")
byParametersOnFace = AdaptiveComponent.ByParametersOnFace(watch, firstItem, family_types)
