# Dynamo graph FEC-deletes.dyn (Dynamo 0.7.5.3437)

categories = Categories("Cornices")
all_elements_of_category = ElementsOfCategory(categories)
watch = Watch(all_elements_of_category)
categories_2 = Categories("Reveals")
categories_3 = Categories("Walls")
