# Dynamo graph 3436_IncompatibleBooleans.dyn (Dynamo 0.7.6.4070)

categories = Categories("Walls")
all_elements_of_category = ElementsOfCategory(categories)
code_block = CodeBlock { "Room Bounding"; }
getParameterValueByName = Element.GetParameterValueByName(all_elements_of_category, code_block)
filterByBoolMask = List.FilterByBoolMask(all_elements_of_category, getParameterValueByName)
watch = Watch(filterByBoolMask)
