# Dynamo graph 3446_StringSplitLinebreakSeparators.dyn (Dynamo 0.7.6.4070)

string = StringInput("""a
b
c""")
string_2 = StringInput("\n")
split = String.Split(string, string_2)
watch = Watch(split)
code_block = CodeBlock()
# ---------- code_block.designscript (2 lines) ----------
"
";
# ----------------------------------------
split_2 = String.Split(string, code_block)
watch_2 = Watch(split_2)
