# Dynamo graph 3749_MeshConversion.dyn (Dynamo 0.8.2.2392)

categories = Categories("Topography")
all_elements_of_category = ElementsOfCategory(categories)
firstItem = List.FirstItem(all_elements_of_category)
watch = Watch(firstItem)
mesh = Topography.Mesh(watch)
vertexPositions = Mesh.VertexPositions(mesh)
faceIndices = Mesh.FaceIndices(mesh)
python_script = Python(IN[0]=faceIndices)
# ---------- python_script.python (28 lines) ----------
import clr
clr.AddReference('ProtoGeometry')
from Autodesk.DesignScript.Geometry import *
#The inputs to this node will be stored as a list in the IN variable.
indexGroups = IN[0]

outerList = []

for i in range(len(indexGroups)):
    ig = indexGroups[i]
    innerList = []
    innerList.append(ig.A)
    innerList.append(ig.B)
    innerList.append(ig.C)

    outerList.append(innerList)

    if ig.Count == 3:
        continue

    innerList = []
    innerList.append(ig.A)
    innerList.append(ig.C)
    innerList.append(ig.D)

    outerList.append(innerList)

OUT = outerList
# ----------------------------------------
byVerticesAndIndices = Autodesk.Dynamo.MeshToolkit.Mesh.ByVerticesAndIndices(vertexPositions, python_script)
