# Dynamo graph CWP_Limitations.dyn (Dynamo 0.8.0.856)

categories = Categories("Walls")
all_elements_of_category = ElementsOfCategory(categories)
byElement = CurtainPanel.ByElement(all_elements_of_category)
watch = Watch(byElement)
