# Dynamo graph MissingPanelGeometry.dyn (Dynamo 0.7.5.3566)

select_model_element = DSModelElementSelection()  # 1 picked in the model
byElement = CurtainPanel.ByElement(select_model_element)
boundaries = CurtainPanel.Boundaries(byElement)
string_from_array = FromArray()
map = List.Map(boundaries, string_from_array)
code_block = CodeBlock { "null"; }
ne = map != code_block
filterByBoolMask = List.FilterByBoolMask(byElement, ne)
count = List.Count(filterByBoolMask.out0)
count_2 = List.Count(byElement)
geometry = Element.Geometry(filterByBoolMask.out1)
