# Dynamo graph 5074_ReplaceByConditionAndListEmpty.dyn (Dynamo 0.8.3.2514)

code_block = CodeBlock { {1,2,List.Empty,3,4,null,5,6}; }
code_block_2 = CodeBlock { "REPLACED"; }
code_block_3 = CodeBlock { 1; }
eq = _ == code_block_3
replaceByCondition = Replace(code_block, code_block_2, eq)
