# Dynamo graph 6067_ConcatenationErrorWhenAdding VarToItself.dyn (Dynamo 0.9.0.3067)

code_block = CodeBlock { "Test1"; }
code_block_2 = CodeBlock { "Test3"; }
code_block_3 = CodeBlock(t1=code_block, t2=code_block_2) { teststring = "1234" + t1 + "\n"; teststring = teststring + "abcd" + t2 + "\n"; }
watch = Watch(code_block_3)
