# Dynamo graph 7116_ListMapFlatten.dyn (Dynamo 0.9.0.3067)

code_block = CodeBlock { {{List.Empty,List.Empty},{List.Empty,List.Empty},1..2}; }
flatten = Flatten()
map = List.Map(list=code_block, f_x=flatten)
watch = Watch(map)
code_block_2 = CodeBlock { {{List.Empty,List.Empty,0},{List.Empty,List.Empty},1..2}; }
flatten_2 = Flatten()
map_2 = List.Map(list=code_block_2, f_x=flatten_2)
watch_2 = Watch(map_2)
