# Dynamo graph CreateNodeDocumentation.dyn (Dynamo 1.3.2.2480)

# group: Create Node Documentation
# note: This graph parses each *.dyf file in a given directory and creates a Markdown-formatted documentation of all nodes.
# I am using this in order to create my node documentation for the Clockwork wiki on GitHub.

# group: INPUTS
directory_path_documentation = Directory("C:\Users\andreas\Desktop")
file_name_documentation = StringInput("NodeDocumentation10")
directory_path_nodes = Directory("C:\Users\andreas\Documents\GitHub\ClockworkForDynamo\nodes\1.x")
string_to_be_removed_from = StringInput("Clockwork.")  # "String to be Removed from Category Name"
directory_path_samples = Directory("C:\Users\andreas\Documents\GitHub\ClockworkForDynamo\package_samples\1.x\dynamo")
samples_base_url = StringInput("https://github.com/andydandy74/ClockworkForDynamo/tree/master/package_samples/1.x/dynamo/")
repository_base_url = StringInput("https://github.com/andydandy74/ClockworkForDynamo/tree/master/nodes/1.x/")

# group: Browse node directory
fromPath = DirectoryObject(directory_path_nodes)  # "Directory.FromPath"
file_extension = CodeBlock { "*.dyf"; }
contents = Directory.Contents(fromPath, file_extension)

# group: Retrieve node properties
info = Custom[CustomNode.Info](path=contents)  # Extracts information from a custom node.
code_block = CodeBlock(inputlabel=info.Inputs, datatype=info.InputDataTypes, defaultval=info.InputDefaultVals) { inputlabel +  " (" + datatype + " - " + defaultval + ")"; " - )"; ")"; " ()"; ""; }
replace = String.Replace(str=code_block.out0, searchFor=code_block.out1, replaceWith=code_block.out2)
replace_2 = String.Replace(str=replace, searchFor=code_block.out3, replaceWith=code_block.out4)
isNotEmpty = Custom[List.IsNotEmpty](seq=info.PythonScripts@L2)  # Just the inversion of the built-in Is Empty List node.
string = StringInput("\")
split = String.Split(contents, string)
lastItem = List.LastItem(split@L2)

# group: Aggregate and sort list
# note: 1. Category
# 2. Name
# 3. Description
# 4. Inputs
# 5. Outputs
# 6. Contains Python scripts
# 7. Nested custom nodes
# 8. File name
create = List.Create(info.Category, info.Name, info.Description, replace_2, info.Outputs, isNotEmpty, info.NestedCustomNodes, lastItem)
code_block_2 = CodeBlock { 1; }
# note: Sort node list by category and name
sortListOfLists = Custom[List.SortListOfLists](seq=create, sortIndex=code_block_2)  # Sorts a list of lists by one of its sublists
sortListOfLists_2 = Custom[List.SortListOfLists](seq=sortListOfLists)

# group: Browse samples directory and retrieve file names
fromPath_2 = DirectoryObject(directory_path_samples)  # "Directory.FromPath"
file_extension_2 = CodeBlock { "*.dyn"; }
contents_2 = Directory.Contents(fromPath_2, file_extension_2)
boolean = BoolSelector(false)
fileName = FilePath.FileName(contents_2, boolean)

# group: Create table of contents, headings and links to sample files (Markdown)
firstItem = List.FirstItem(sortListOfLists_2)
code_block_3 = CodeBlock { ""; }
replace_3 = String.Replace(str=firstItem, searchFor=string_to_be_removed_from, replaceWith=code_block_3)
countOccurences = Custom[List.CountOccurences](seq=replace_3)  # Counts the number of occurences of each unique element in a given list
python_script = Python(IN[0]=countOccurences.uniqueElements, IN[1]=countOccurences.count, IN[2]=fileName, IN[3]=samples_base_url)
# ---------- python_script.python (40 lines) ----------
cats = IN[0]
catcount = IN[1]
samples = IN[2]
sample_base_url = IN[3]
headings = list()
toc = ""
i = 0
for cat in cats:
	# split category name by delimiter (.)
	parts = cat.split(".")
	j = 2
	heading = ""
	for part in parts:
		# concatenate full category name
		fullcat = '.'.join(parts[:j-1])
		if i == 0:
			heading += "#"*j + ' <a name="' + fullcat.lower().replace('.','_') + '">' + part + "</a>\n"
			if part != "Create" and part != "Actions" and part != "Query":
				toc += "  "*(j-2) + "- " + '<a href="#' + fullcat.lower().replace('.','_') + '">' + part + "</a>\n"
			# add link to sample file
			if fullcat in samples: 
				heading += 'Sample file: <a href="' + sample_base_url + fullcat + '.dyn">' + sample_base_url + fullcat + '.dyn</a><br>\n'
		else:
			prev_parts = cats[i-1].split(".")
			if len(prev_parts) >= j-1 and (part != prev_parts[j-2] or heading != ""):
				heading += "#"*j + ' <a name="' + fullcat.lower().replace('.','_') + '">' + part + "</a>\n"
				if part != "Create" and part != "Actions" and part != "Query":
					toc += "  "*(j-2) + "- " + '<a href="#' + fullcat.lower().replace('.','_') + '">' + part + "</a>\n"
				# add link to sample file
				if fullcat in samples: 
					heading += 'Sample file: <a href="' + sample_base_url + fullcat + '.dyn">' + sample_base_url + fullcat + '.dyn</a><br><br>\n'
		j += 1
	headings.append(heading)
	if catcount[i] > 1:
		k = 0
		while k < catcount[i]-1:
			headings.append("")
			k += 1
	i += 1
OUT = (toc,headings)
# ----------------------------------------
code_block_4 = CodeBlock(seq=python_script) { seq[0]; seq[1]; }

# group: Process & format data (Markdown)
string_2 = StringInput("\\\"")
code_block_5 = CodeBlock(seq=sortListOfLists_2) { seq[1]; seq[2]; seq[3]; seq[4]; seq[5]; seq[6]; seq[7]; }
code_block_6 = CodeBlock(quot=string_2, nname=code_block_5.out0) { "**<a name=" + quot + String.ToLower(nname) + quot + ">" + nname + "</a>**<br>"; }
string_3 = StringInput("\")
string_4 = StringInput("")
replace_4 = String.Replace(str=code_block_6, searchFor=string_3, replaceWith=string_4)
code_block_7 = CodeBlock(desc=code_block_5.out1) { desc + "<br>"; }
code_block_8 = CodeBlock { ", "; }
join = String.Join(code_block_8)  # unwired: arg1
map = List.Map(list=code_block_5.out2, f_x=join)
flatten = Flatten(map)
code_block_9 = CodeBlock(input=flatten) { input == "" ? input : "*Input(s):* " + input + "<br>"; }
map_2 = List.Map(list=code_block_5.out3, f_x=join)
flatten_2 = Flatten(map_2)
code_block_10 = CodeBlock(outputs=flatten_2) { "*Output(s):* " + outputs + "<br>"; }
code_block_11 = CodeBlock(haspython=code_block_5.out4) { haspython ? "*Contains Python code!*<br>" : ""; }
code_block_12 = CodeBlock(quot=string_2, nestednode=code_block_5.out5) { "<a href=" + quot + "#" + String.ToLower(nestednode) + quot + ">" + nestednode + "</a>"; }
replace_5 = String.Replace(str=code_block_12, searchFor=string_3, replaceWith=string_4)
map_3 = List.Map(list=replace_5, f_x=join)
flatten_3 = Flatten(map_3)
code_block_13 = CodeBlock(customnodes=flatten_3)
# ---------- code_block_13.designscript (2 lines) ----------
customnodes_formatted = "*Nested Custom Node(s):* " + customnodes + "<br>";
customnodes == "" ? customnodes : customnodes_formatted;
# ----------------------------------------
code_block_14 = CodeBlock { " "; "%20"; }
replace_6 = String.Replace(str=code_block_5.out6, searchFor=code_block_14.out0, replaceWith=code_block_14.out1)
code_block_15 = CodeBlock(quot=string_2, repo_base_url=repository_base_url, filename=replace_6) { "*Link to file:* <a href=" + quot + repo_base_url + filename + quot + ">" + repo_base_url + filename + "</a><br>"; }
replace_7 = String.Replace(str=code_block_15, searchFor=string_3, replaceWith=string_4)

# group: Write to file
code_block_16 = CodeBlock(filename=file_name_documentation) { filename + ".TXT"; }
string_5 = StringInput("")
code_block_17 = CodeBlock { "\n\n"; }
count = List.Count(replace_4)
ofRepeatedItem = List.OfRepeatedItem(item=code_block_17, amount=count)
create_2 = List.Create(code_block_4.out1, replace_4, code_block_7, code_block_9, code_block_10, code_block_11, code_block_13.out1, replace_7, ofRepeatedItem)
transpose = List.Transpose(create_2)
flatten_4 = Flatten(transpose)
join_2 = String.Join(string_5, flatten_4)
firstItem_2 = List.FirstItem(join_2)
code_block_18 = CodeBlock(toc=code_block_4.out0, body=firstItem_2) { toc + "\n" + body; }

combine = FilePath.Combine(directory_path_documentation, code_block_16)

# group (continued): Write to file
writeText = File.WriteText(combine, code_block_18)
