# Dynamo graph ExtractNodeDependencies.dyn (Dynamo 1.3.1.1736)

# group: Extract Node Dependencies
# note: This graph parses each *.dyf file in a given directory and finds their respective dependencies.
# I am using this when doing major package upgrades in order to first upgrade those nodes that are dependencies of other nodes.

# group: INPUTS
directory_path_results = Directory("C:\Users\adieckmann\Desktop")
file_name_results = StringInput("NodeDependencies")
directory_path_nodes = Directory("U:\repos\ClockworkForDynamo\nodes\1.x")

# group: Browse directory
fromPath = DirectoryObject(directory_path_nodes)  # "Directory.FromPath"
file_extension = CodeBlock { "*.dyf"; }
contents = Directory.Contents(fromPath, file_extension)

# group: Find nodes that contain nested nodes
info = Custom[CustomNode.Info](path=contents)  # Extracts information from a custom node.
isNotEmpty = Custom[List.IsNotEmpty](seq=info.NestedCustomNodes@L2)  # Just the inversion of the built-in Is Empty List node.
filterByBoolMask = List.FilterByBoolMask(list=info.Name, mask=isNotEmpty)
filterByBoolMask_2 = List.FilterByBoolMask(list=info.NestedCustomNodes, mask=isNotEmpty)

# group: Format results
count = List.Count(filterByBoolMask_2.in@L2)
ofRepeatedItem = List.OfRepeatedItem(item=filterByBoolMask.in@L1, amount=count@L1)
flatten = Flatten(ofRepeatedItem)
flatten_2 = Flatten(filterByBoolMask_2.in)
create = List.Create(flatten, flatten_2)
code_block = CodeBlock { 1; }
sortListOfLists = Custom[List.SortListOfLists](seq=create, sortIndex=code_block)  # Sorts a list of lists by one of its sublists
sortListOfLists_2 = Custom[List.SortListOfLists](seq=sortListOfLists)

# group: Write results to file
code_block_2 = CodeBlock(filename=file_name_results) { filename + ".CSV"; }
combine = FilePath.Combine(directory_path_results, code_block_2)
code_block_3 = CodeBlock { "Parents"; "Children"; }
code_block_4 = CodeBlock(seq=sortListOfLists_2) { seq[0]; seq[1]; }
join = List.Join(code_block_3.out0, code_block_4.out0)
join_2 = List.Join(code_block_3.out1, code_block_4.out1)
create_2 = List.Create(join, join_2)
transpose = List.Transpose(create_2)
writeToFile = CSV.WriteToFile(combine, transpose)
