# Dynamo graph ExtractNodeIDs.dyn (Dynamo 1.3.1.1736)

# group: Extract Node IDs
# note: This graph parses each *.dyf file in a given directory and extracts each node's ID.
# This could be useful for creating a custom iconset as described here:
# https://github.com/DynamoDS/Dynamo/wiki/HowTo:-Add-icon-for-custom-node

# group: INPUTS
directory_path_results = Directory("C:\Users\adieckmann\Desktop")
file_name_results = StringInput("NodeIDs")
directory_path_nodes = Directory("U:\repos\ClockworkForDynamo\nodes\1.x")

# group: Browse directory
fromPath = DirectoryObject(directory_path_nodes)  # "Directory.FromPath"
file_extension = CodeBlock { "*.dyf"; }
contents = Directory.Contents(fromPath, file_extension)

# group: Extract data
info = Custom[CustomNode.Info](path=contents)  # Extracts information from a custom node.
create = List.Create(info.Name, info.ID)
transpose = List.Transpose(create)

# group: Write to file
code_block = CodeBlock(filename=file_name_results) { filename + ".CSV"; }
combine = FilePath.Combine(directory_path_results, code_block)
writeToFile = CSV.WriteToFile(combine, transpose)
