# Dynamo graph FindMiscategorizedNodes.dyn (Dynamo 1.3.1.1736)

# group: Find Miscategorized Nodes
# note: This graph parses each *.dyf file in a given directory and checks the category name against the given requirements.
# I am using this to identify miscategorized nodes.

# group: INPUTS
directory_path_nodes = Directory("U:\repos\ClockworkForDynamo\nodes\1.x")
main_category = StringInput("Clockwork")
permitted_category_suffixes = StringInput("""Create
Actions
Query
Selection.ByCollector
Selection.ByFace
Selection.Filters
Selection.Miscellaneous
Paneling.DataPreparation
Paneling.Helpers
Paneling.Patterns""")

# group: Browse directory
fromPath = DirectoryObject(directory_path_nodes)  # "Directory.FromPath"
file_extension = CodeBlock { "*.dyf"; }
contents = Directory.Contents(fromPath, file_extension)

# group: Extract data and evaluate category names
info = Custom[CustomNode.Info](path=contents)  # Extracts information from a custom node.
code_block = CodeBlock(cat=main_category) { cat + "."; }
startsWith = String.StartsWith(str=info.Category, searchFor=code_block)
filterByBoolMask = List.FilterByBoolMask(list=info.Name, mask=startsWith)
string = StringInput("\n")
split = String.Split(permitted_category_suffixes, string)
endsWith = String.EndsWith(info.Category)  # unwired: arg1
map = List.Map(list=split, f_x=endsWith)
transpose = List.Transpose(map)
anyTrue = Custom[List.AnyTrue](seq=transpose@L2)  # Returns true if any item in a list of booleans is true.
filterByBoolMask_2 = List.FilterByBoolMask(list=info.Name, mask=anyTrue)
filterByBoolMask_3 = List.FilterByBoolMask(list=info.Category, mask=startsWith)
filterByBoolMask_4 = List.FilterByBoolMask(list=info.Category, mask=anyTrue)

# group: OUTPUTS
nodes_that_do_not_have_the = Watch(filterByBoolMask.out)  # "Nodes that do not have the correct main category"
nodes_whose_category_lacks_a = Watch(filterByBoolMask_2.out)  # "Nodes whose category lacks a permitted suffix"
category_names = Watch(filterByBoolMask_3.out)
category_names_2 = Watch(filterByBoolMask_4.out)
