# Dynamo graph FindNodesWithDisabledLacing.dyn (Dynamo 1.3.1.1736)

# group: Find Nodes With Disabled Lacing
# note: This graph searches through all graphs in a given directory and identifies which custom nodes have their lacing disabled.

# group: INPUTS
directory_path = Directory("C:\Users\andreas\Documents\GitHub\ClockworkForDynamo\package_samples\1.x\dynamo")
filename_of_csv_file_to_export = StringInput("NodesWithDisabledLacing")

# group: Read directory
fromPath = DirectoryObject(directory_path)  # "Directory.FromPath"
contents = Directory.Contents(fromPath)

# group: Identify all custom nodes that have their lacing disabled
readText = File.ReadText(contents)
string = StringInput("\n")
split = String.Split(readText, string)
string_2 = StringInput("type=\"Dynamo.Graph.Nodes.CustomNodes.Function\"")
contains = String.Contains(str=split, searchFor=string_2)
filterByBoolMask = List.FilterByBoolMask(list=split, mask=contains)
string_3 = StringInput("lacing=\"Disabled\"")
contains_2 = String.Contains(str=filterByBoolMask.in, searchFor=string_3)
filterByBoolMask_2 = List.FilterByBoolMask(list=filterByBoolMask.in, mask=contains_2)

# group: Filter out graphs without issues
count = List.Count(filterByBoolMask_2.in@L2)
code_block = CodeBlock(n=count) { n > 0; }
filterByBoolMask_3 = List.FilterByBoolMask(list=contents, mask=code_block)
filterByBoolMask_4 = List.FilterByBoolMask(list=count, mask=code_block)
filterByBoolMask_5 = List.FilterByBoolMask(list=filterByBoolMask_2.in, mask=code_block)

# group: Prepare data for export
code_block_2 = CodeBlock { {{"Graph","Node"}}; }
boolean = BoolSelector(false)
fileName = FilePath.FileName(filterByBoolMask_3.in, boolean)
ofRepeatedItem = List.OfRepeatedItem(item=fileName@L1, amount=filterByBoolMask_4.in@L1)
string_4 = StringInput("nickname=\"")
split_2 = String.Split(filterByBoolMask_5.in, string_4)
code_block_3 = CodeBlock { 1; }
getItemAtIndex = List.GetItemAtIndex(list=split_2@@L2, index=code_block_3)
string_5 = StringInput("\"")
split_3 = String.Split(getItemAtIndex, string_5)
firstItem = List.FirstItem(split_3@@L2)
create = List.Create(ofRepeatedItem, firstItem)
flatten = Flatten(create@L3)
transpose = List.Transpose(flatten)
join = List.Join(code_block_2, transpose)

# group: Export CSV
combine = FilePath.Combine(directory_path)
code_block_4 = CodeBlock(filename=filename_of_csv_file_to_export) { filename + ".csv"; }
combine_2 = FilePath.Combine(combine, code_block_4)
writeToFile = CSV.WriteToFile(combine_2, join)
