# Dynamo graph CompareNodeListWithNodeDir.dyn (Dynamo 2.12.1.8246)
# packages: Clockwork for Dynamo 2.x 2.3.0

# group: Compare Node List With Node Directory
# note: This graph compares all the package nodes with the list of nodes in order to identify any discrepancies.

# group: INPUTS
directory_path = Directory("C:\Users\adsk\Documents\andreas\repos\ClockworkForDynamo\nodes\2.x")  # graph input
file_path = Filename("..\..\..\..\..\..\Desktop\NodeList.csv")  # graph input
index_of_name_column = DoubleInput(1)  # graph input
ignore = StringInput("---")

# group: Get node names from directory
fromPath = DirectoryObject(path=directory_path)  # "Directory.FromPath"
string = StringInput("*.dyf")  # graph input
getDirectoryContents = FileSystem.GetDirectoryContents(directory=fromPath, searchString=string)

# group: Get node names from list
string_2 = StringInput(",")  # graph input
fromPath_2 = FileObject(path=file_path)  # "File.FromPath"
readText = FileSystem.ReadText(file=fromPath_2)
boolean = BoolSelector(true)  # graph input
fromCSV = Custom[List.FromCSV](delimiter=string_2, CSVstring=readText, ignoreFirstRow=boolean)  # package Clockwork for Dynamo 2.x; Converts the content of a given CSV file to a list
transpose = List.Transpose(lists=fromCSV)
getItemAtIndex = List.GetItemAtIndex(list=transpose, index=index_of_name_column)
code_block = CodeBlock(name=getItemAtIndex, ignore=ignore) { name != ignore; }
filterByBoolMask = List.FilterByBoolMask(list=getItemAtIndex, mask=code_block)
code_block_2 = CodeBlock(dir=directory_path, name=filterByBoolMask.in)
# ---------- code_block_2.designscript (2 lines) ----------
// Filename
dir + "\\" + name + ".dyf";
# ----------------------------------------

# group: Identify discrepancies
contains = List.Contains(list=code_block_2, item=getDirectoryContents.files@L1)
filterByBoolMask_2 = List.FilterByBoolMask(list=getDirectoryContents.files, mask=contains)
contains_2 = List.Contains(list=getDirectoryContents.files, item=code_block_2@L1)
filterByBoolMask_3 = List.FilterByBoolMask(list=code_block_2, mask=contains_2)

# group: OUTPUT
existing_files_not_in_the_list = Watch(filterByBoolMask_2.out)
listed_files_not_in_the = Watch(filterByBoolMask_3.out)  # "Listed files not in the directory"
