# Dynamo graph CreateNodeChecklist.dyn (Dynamo 2.17.0.3472)
# packages: Clockwork for Dynamo 2.x 2.4.0

# group: Create Node Checklist
# note: This graph creates a markdown checklist for all nodes, ordered by sample file.

# group: INPUTS
file_path = Filename("..\..\..\..\..\..\..\..\temp\NodeList.csv")  # graph input
index_of_name_column = DoubleInput(1)  # graph input
ignore = StringInput("---")
index_of_sample_column = DoubleInput(2)  # graph input

# group: Get node names and samples from list
string = StringInput(",")  # graph input
fromPath = FileObject(path=file_path)  # "File.FromPath"
readText = FileSystem.ReadText(file=fromPath)
boolean = BoolSelector(true)  # graph input
fromCSV = Custom[List.FromCSV](delimiter=string, CSVstring=readText, ignoreFirstRow=boolean)  # package Clockwork for Dynamo 2.x; Converts the content of a given CSV file to a list
transpose = List.Transpose(lists=fromCSV)
getItemAtIndex = List.GetItemAtIndex(list=transpose, index=index_of_name_column)
code_block = CodeBlock(name=getItemAtIndex, ignore=ignore) { name != ignore; }
filterByBoolMask = List.FilterByBoolMask(list=getItemAtIndex, mask=code_block)
getItemAtIndex_2 = List.GetItemAtIndex(list=transpose, index=index_of_sample_column)
filterByBoolMask_2 = List.FilterByBoolMask(list=getItemAtIndex_2, mask=code_block)

# group: Create checklist
string_2 = StringInput("\n")
groupByKey = List.GroupByKey(list=filterByBoolMask.in, keys=filterByBoolMask_2.in)
sortByKey = List.SortByKey(list=groupByKey.groups, keys=groupByKey.uniqueKeys)
code_block_2 = CodeBlock(sample=sortByKey.sortedKeys, node=sortByKey.sortedList) { "- [ ] " + sample; "   - [ ] " + node; }
join = String.Join(separator=string_2, string0=code_block_2.out1)
firstItem = List.FirstItem(list=join)
code_block_3 = CodeBlock(sample=code_block_2.out0, linebreak=string_2, nodes=firstItem) { sample + linebreak + nodes; }
join_2 = String.Join(separator=string_2, string0=code_block_3)
firstItem_2 = List.FirstItem(list=join_2)

# group: Send to clipboard
sendTo = Custom[Clipboard.SendTo](str=firstItem_2)  # package Clockwork for Dynamo 2.x; Copies a string to the clipboard.
