# Dynamo graph CreateNodeDocumentation.dyn (Dynamo 2.12.1.8246)
# packages: Clockwork for Dynamo 2.x 2.6.0

# group: Create Node Documentation
# note: This graph parses each *.dyf file in a given directory and creates a Markdown-formatted documentation of all nodes.
# I am using this in order to create my node documentation for the Clockwork wiki on GitHub.

# group: INPUTS
directory_path_documentation = Directory("C:\temp")  # graph input
file_name_documentation = StringInput("NodeDocumentation20")  # graph input
directory_path_nodes = Directory("C:\Users\adsk\Documents\andreas\repos\ClockworkForDynamo\nodes\2.x")  # graph input
samples_base_url = StringInput("https://github.com/andydandy74/ClockworkForDynamo/tree/master/package_samples/2.x/dynamo/")  # graph input
file_path_node_list_csv = Filename("..\..\..\..\..\..\..\..\temp\NodeList.csv")
string_to_be_removed_from = StringInput("Clockwork.")  # "String to be Removed from Category Name"; graph input
repository_base_url = StringInput("https://github.com/andydandy74/ClockworkForDynamo/tree/master/nodes/2.x/")  # graph input

# group: Browse node directory
fromPath = DirectoryObject(path=directory_path_nodes)  # "Directory.FromPath"
file_extension = CodeBlock { "*.dyf"; }
getDirectoryContents = FileSystem.GetDirectoryContents(directory=fromPath, searchString=file_extension)

# group: Retrieve node properties
info = Custom[CustomNode.Info](path=getDirectoryContents.files)  # package Clockwork for Dynamo 2.x; Extracts information from a custom node.
python_script = Python(IN[0]=info.Category, IN[1]=info.Name)  # IronPython2
# ---------- python_script.python (14 lines) ----------
import clr
cats = IN[0]
names = IN[1]
OUT = []

for cat, name in zip(cats, names):
	nameParts = name.split(".")
	if len(nameParts) > 1:
		catParts = cat.split(".")
		newCatParts = catParts[0:-1]
		newCatParts.append(nameParts[0])
		newCatParts.append(catParts[-1])
		OUT.append(".".join(newCatParts))
	else: OUT.append(cat)
# ----------------------------------------
code_block = CodeBlock(inputlabel=info.Inputs, datatype=info.InputDataTypes, defaultval=info.InputDefaultVals) { inputlabel +  " (" + datatype + " - " + defaultval + ")"; " - )"; ")"; " ()"; ""; }
replace = String.Replace(string=code_block.out0, searchFor=code_block.out1, replaceWith=code_block.out2)
replace_2 = String.Replace(string=replace, searchFor=code_block.out3, replaceWith=code_block.out4)
isNotEmpty = Custom[List.IsNotEmpty](seq=info.PythonScripts@L2)  # package Clockwork for Dynamo 2.x; Just the inversion of the built-in Is Empty List node.
string = StringInput("\")  # graph input
split = String.Split(string=getDirectoryContents.files, separator0=string)
lastItem = List.LastItem(list=split@L2)

# group: Read node samples
string_2 = StringInput(",")
readText = FileSystem.ReadText(file=file_path_node_list_csv)
boolean = BoolSelector(true)
importCSV = Custom[Data.ImportCSV+](delimiter=string_2, CSVstring=readText, ignoreFirstRow=boolean)  # package Clockwork for Dynamo 2.x; Converts the content of a given CSV file to a list
code_block_2 = CodeBlock { 2; 3; }
getItemAtIndex = List.GetItemAtIndex(list=importCSV@L2, index=code_block_2.out1)
code_block_3 = CodeBlock(val=getItemAtIndex) { val != "---"; }
filterByBoolMask = List.FilterByBoolMask(list=getItemAtIndex, mask=code_block_3)
code_block_4 = CodeBlock(baseURL=samples_base_url, sample=filterByBoolMask.in) { baseURL + sample + ".dyn"; }
getItemAtIndex_2 = List.GetItemAtIndex(list=importCSV@L2, index=code_block_2.out0)
filterByBoolMask_2 = List.FilterByBoolMask(list=getItemAtIndex_2, mask=code_block_3)
indexOf = List.IndexOf(list=filterByBoolMask_2.in, element=info.Name)
getItemAtIndex_3 = List.GetItemAtIndex(list=code_block_4, index=indexOf)

# group: Aggregate and sort list
# note: [0] Category
# [1] Name
# [2] Description
# [3] Inputs
# [4] Outputs
# [5] Contains Python scripts
# [6] Nested custom nodes
# [7] File name
# [8] Sample file
create = List.Create(item0=python_script, item1=info.Name, item2=info.Description, item3=replace_2, item4=info.Outputs, item5=isNotEmpty, item6=info.NestedCustomNodes, item7=lastItem, item8=getItemAtIndex_3)
code_block_5 = CodeBlock { 1; }
# note: Sort node list by category and name
sortListOfLists = Custom[List.SortListOfLists](seq=create, sortIndex=code_block_5)  # package Clockwork for Dynamo 2.x; Sorts a list of lists by one of its sublists
sortListOfLists_2 = Custom[List.SortListOfLists](seq=sortListOfLists)

# group: Create table of contents, headings and links to sample files (Markdown)
firstItem = List.FirstItem(list=sortListOfLists_2)
code_block_6 = CodeBlock { ""; }
replace_3 = String.Replace(string=firstItem, searchFor=string_to_be_removed_from, replaceWith=code_block_6)
countOccurences = Custom[List.CountOccurences](seq=replace_3)  # package Clockwork for Dynamo 2.x; Counts the number of occurences of each unique element in a given list
python_script_2 = Python(IN[0]=countOccurences.uniqueElements, IN[1]=countOccurences.count)  # IronPython2
# ---------- python_script_2.python (32 lines) ----------
cats = IN[0]
catcount = IN[1]
headings = list()
toc = ""
i = 0
for cat in cats:
	# split category name by delimiter (.)
	parts = cat.split(".")
	j = 2
	heading = ""
	for part in parts:
		# concatenate full category name
		fullcat = '.'.join(parts[:j-1])
		if i == 0:
			heading += "#"*j + ' <a name="' + fullcat.lower().replace('.','_') + '">' + part + "</a>\n"
			if part != "Create" and part != "Actions" and part != "Query":
				toc += "  "*(j-2) + "- " + '<a href="#' + fullcat.lower().replace('.','_') + '">' + part + "</a>\n"
		else:
			prev_parts = cats[i-1].split(".")
			if len(prev_parts) >= j-1 and (part != prev_parts[j-2] or heading != ""):
				heading += "#"*j + ' <a name="' + fullcat.lower().replace('.','_') + '">' + part + "</a>\n"
				if part != "Create" and part != "Actions" and part != "Query":
					toc += "  "*(j-2) + "- " + '<a href="#' + fullcat.lower().replace('.','_') + '">' + part + "</a>\n"
		j += 1
	headings.append(heading)
	if catcount[i] > 1:
		k = 0
		while k < catcount[i]-1:
			headings.append("")
			k += 1
	i += 1
OUT = (toc,headings)
# ----------------------------------------
code_block_7 = CodeBlock(seq=python_script_2) { seq[0]; seq[1]; }

# group: Process & format data (Markdown)
string_3 = StringInput("\\\"")  # graph input
code_block_8 = CodeBlock(seq=sortListOfLists_2) { seq[1]; seq[2]; seq[3]; seq[4]; seq[5]; seq[6]; seq[7]; seq[8]; }
code_block_9 = CodeBlock(quot=string_3, nname=code_block_8.out0) { "**<a name=" + quot + String.ToLower(nname) + quot + ">" + nname + "</a>**<br>"; }
string_4 = StringInput("\")  # graph input
string_5 = StringInput("")  # graph input
replace_4 = String.Replace(string=code_block_9, searchFor=string_4, replaceWith=string_5)
code_block_10 = CodeBlock(desc=code_block_8.out1) { desc + "<br>"; }
code_block_11 = CodeBlock { ", "; }
join = String.Join(separator=code_block_11)  # unwired: string0
map = List.Map(list=code_block_8.out2, f_x=join)
flatten = List.Flatten(list=map)
code_block_12 = CodeBlock(input=flatten) { input == "" ? input : "*Input(s):* " + input + "<br>"; }
map_2 = List.Map(list=code_block_8.out3, f_x=join)
flatten_2 = List.Flatten(list=map_2)
code_block_13 = CodeBlock(outputs=flatten_2) { "*Output(s):* " + outputs + "<br>"; }
code_block_14 = CodeBlock(haspython=code_block_8.out4) { haspython ? "*Contains Python code!*<br>" : ""; }
code_block_15 = CodeBlock(quot=string_3, nestednode=code_block_8.out5) { "<a href=" + quot + "#" + String.ToLower(nestednode) + quot + ">" + nestednode + "</a>"; }
replace_5 = String.Replace(string=code_block_15, searchFor=string_4, replaceWith=string_5)
map_3 = List.Map(list=replace_5, f_x=join)
flatten_3 = List.Flatten(list=map_3)
code_block_16 = CodeBlock(customnodes=flatten_3)
# ---------- code_block_16.designscript (2 lines) ----------
customnodes_formatted = "*Nested Custom Node(s):* " + customnodes + "<br>";
customnodes == "" ? customnodes : customnodes_formatted;
# ----------------------------------------
code_block_17 = CodeBlock { " "; "%20"; }
replace_6 = String.Replace(string=code_block_8.out6, searchFor=code_block_17.out0, replaceWith=code_block_17.out1)
code_block_18 = CodeBlock(quot=string_3, repo_base_url=repository_base_url, filename=replace_6) { "*Link to file:* <a href=" + quot + repo_base_url + filename + quot + ">" + repo_base_url + filename + "</a><br>"; }
replace_7 = String.Replace(string=code_block_18, searchFor=string_4, replaceWith=string_5)
isNull = Object.IsNull(object=code_block_8.out7)
not_ = Not(x=isNull)
code_block_19 = CodeBlock(HasSample=not_, sample=code_block_8.out7) { HasSample ? "Sample file: <a href=\"" + sample + "\">" + sample + "</a><br><br>\n" : ""; }
replace_8 = String.Replace(string=code_block_19, searchFor=string_4, replaceWith=string_5)

# group: Write to file
code_block_20 = CodeBlock(filename=file_name_documentation) { filename + ".TXT"; }
combinePath = FileSystem.CombinePath(string0=directory_path_documentation, string1=code_block_20)
string_6 = StringInput("")  # graph input
code_block_21 = CodeBlock { "\n\n"; }
count = List.Count(list=replace_4)
ofRepeatedItem = List.OfRepeatedItem(item=code_block_21, amount=count)
create_2 = List.Create(item0=code_block_7.out1, item1=replace_4, item2=code_block_10, item3=code_block_12, item4=code_block_13, item5=code_block_14, item6=code_block_16.out1, item7=replace_7, item8=replace_8, item9=ofRepeatedItem)
transpose = List.Transpose(lists=create_2)
flatten_4 = List.Flatten(list=transpose)
join_2 = String.Join(separator=string_6, string0=flatten_4)
firstItem_2 = List.FirstItem(list=join_2)
code_block_22 = CodeBlock(toc=code_block_7.out0, body=firstItem_2) { toc + "\n" + body; }
writeText = FileSystem.WriteText(filePath=combinePath, text=code_block_22)
