# Dynamo graph ExtractNodeDependencies.dyn (Dynamo 2.12.0.5650)
# packages: Clockwork for Dynamo 2.x 2.3.0

# group: Extract Node Dependencies
# note: This graph parses each *.dyf file in a given directory and finds their respective dependencies.
# I am using this when doing major package upgrades in order to first upgrade those nodes that are dependencies of other nodes.

# group: INPUTS
directory_path_results = Directory("C:\Users\andreas\Desktop")  # graph input
file_name_results = StringInput("NodeDependencies")  # graph input
directory_path_nodes = Directory("C:\Users\andreas\Documents\GitHub\ClockworkForDynamo\nodes\2.x")  # graph input

# group: Browse directory
fromPath = DirectoryObject(path=directory_path_nodes)  # "Directory.FromPath"
file_extension = CodeBlock { "*.dyf"; }
getDirectoryContents = FileSystem.GetDirectoryContents(directory=fromPath, searchString=file_extension)

# group: Find nodes that contain nested nodes
info = Custom[CustomNode.Info](path=getDirectoryContents.files)  # package Clockwork for Dynamo 2.x; Extracts information from a custom node.
isNotEmpty = Custom[List.IsNotEmpty](seq=info.NestedCustomNodes@L2)  # package Clockwork for Dynamo 2.x; Just the inversion of the built-in Is Empty List node.
filterByBoolMask = List.FilterByBoolMask(list=info.Name, mask=isNotEmpty)
filterByBoolMask_2 = List.FilterByBoolMask(list=info.NestedCustomNodes, mask=isNotEmpty)

# group: Format results
count = List.Count(list=filterByBoolMask_2.in@L2)
ofRepeatedItem = List.OfRepeatedItem(item=filterByBoolMask.in@L1, amount=count@L1)
flatten = List.Flatten(list=ofRepeatedItem)
flatten_2 = List.Flatten(list=filterByBoolMask_2.in)
create = List.Create(item0=flatten, item1=flatten_2)
code_block = CodeBlock { 1; }
sortListOfLists = Custom[List.SortListOfLists](seq=create, sortIndex=code_block)  # package Clockwork for Dynamo 2.x; Sorts a list of lists by one of its sublists
sortListOfLists_2 = Custom[List.SortListOfLists](seq=sortListOfLists)

# group: Write results to file
code_block_2 = CodeBlock(filename=file_name_results) { filename + ".CSV"; }
combinePath = FileSystem.CombinePath(string0=directory_path_results, string1=code_block_2)
code_block_3 = CodeBlock { "Parents"; "Children"; }
code_block_4 = CodeBlock(seq=sortListOfLists_2) { seq[0]; seq[1]; }
join = List.Join(list0=code_block_3.out0, list1=code_block_4.out0)
join_2 = List.Join(list0=code_block_3.out1, list1=code_block_4.out1)
create_2 = List.Create(item0=join, item1=join_2)
transpose = List.Transpose(lists=create_2)
exportCSV = Data.ExportCSV(filePath=combinePath, data=transpose)
