# Dynamo graph ExtractNodeIDs.dyn (Dynamo 2.12.0.5650)
# packages: Clockwork for Dynamo 2.x 2.3.0

# group: Extract Node IDs
# note: This graph parses each *.dyf file in a given directory and extracts each node's ID.
# This could be useful for creating a custom iconset as described here:
# https://github.com/DynamoDS/Dynamo/wiki/HowTo:-Add-icon-for-custom-node

# group: INPUTS
directory_path_results = Directory("C:\Users\andreas\Desktop")  # graph input
file_name_results = StringInput("NodeIDs")  # graph input
directory_path_nodes = Directory("C:\Users\andreas\Documents\GitHub\ClockworkForDynamo\nodes\2.x")  # graph input

# group: Browse directory
fromPath = DirectoryObject(path=directory_path_nodes)  # "Directory.FromPath"
file_extension = CodeBlock { "*.dyf"; }
getDirectoryContents = FileSystem.GetDirectoryContents(directory=fromPath, searchString=file_extension)

# group: Extract data
info = Custom[CustomNode.Info](path=getDirectoryContents.files)  # package Clockwork for Dynamo 2.x; Extracts information from a custom node.
create = List.Create(item0=info.Name, item1=info.ID)
transpose = List.Transpose(lists=create)

# group: Write to file
code_block = CodeBlock(filename=file_name_results) { filename + ".CSV"; }
combinePath = FileSystem.CombinePath(string0=directory_path_results, string1=code_block)
exportCSV = Data.ExportCSV(filePath=combinePath, data=transpose)
