# Dynamo graph FindMiscategorizedNodes.dyn (Dynamo 2.12.1.8246)
# packages: Clockwork for Dynamo 2.x 2.3.0

# group: Find Miscategorized Nodes
# note: This graph parses each *.dyf file in a given directory and checks the category name against the given requirements.
# I am using this to identify miscategorized nodes.

# group: INPUTS
directory_path_nodes = Directory("C:\Users\adsk\Documents\andreas\repos\ClockworkForDynamo\nodes\2.x")  # graph input
main_category = StringInput("Clockwork")  # graph input
permitted_category_suffixes = StringInput("""Create
Actions
Query""")  # graph input

# group: Browse directory
fromPath = DirectoryObject(path=directory_path_nodes)  # "Directory.FromPath"
file_extension = CodeBlock { "*.dyf"; }
getDirectoryContents = FileSystem.GetDirectoryContents(directory=fromPath, searchString=file_extension)

# group: Extract data and evaluate category names
info = Custom[CustomNode.Info](path=getDirectoryContents.files)  # package Clockwork for Dynamo 2.x; Extracts information from a custom node.
code_block = CodeBlock(cat=main_category) { cat + "."; }
startsWith = String.StartsWith(string=info.Category, searchFor=code_block)
filterByBoolMask = List.FilterByBoolMask(list=info.Name, mask=startsWith)
string = StringInput("\n")  # graph input
split = String.Split(string=permitted_category_suffixes, separator0=string)
endsWith = String.EndsWith(string=info.Category)  # unwired: searchFor
map = List.Map(list=split, function=endsWith)
transpose = List.Transpose(lists=map)
anyTrue = Custom[List.AnyTrue](seq=transpose@L2)  # package Clockwork for Dynamo 2.x; Returns true if any item in a list of booleans is true.
filterByBoolMask_2 = List.FilterByBoolMask(list=info.Name, mask=anyTrue)
filterByBoolMask_3 = List.FilterByBoolMask(list=info.Category, mask=startsWith)
filterByBoolMask_4 = List.FilterByBoolMask(list=info.Category, mask=anyTrue)

# group: OUTPUTS
nodes_that_do_not_have_the = Watch(filterByBoolMask.out)  # "Nodes that do not have the correct main category"
nodes_whose_category_lacks_a = Watch(filterByBoolMask_2.out)  # "Nodes whose category lacks a permitted suffix"
category_names = Watch(filterByBoolMask_3.out)
category_names_2 = Watch(filterByBoolMask_4.out)
