# Dynamo graph FindMissingNodeDescriptions.dyn (Dynamo 2.12.1.8246)
# packages: Clockwork for Dynamo 2.x 2.3.0

# group: Find Missing Node Descriptions
# note: This graph parses each *.dyf file in a given directory and checks if the node has a description text.
# I am using this to identify poorly documented nodes.

# group: INPUTS
directory_path_nodes = Directory("C:\Users\adsk\Documents\andreas\repos\ClockworkForDynamo\nodes\2.x")  # graph input

# group: Browse directory
fromPath = DirectoryObject(path=directory_path_nodes)  # "Directory.FromPath"
file_extension = CodeBlock { "*.dyf"; }
getDirectoryContents = FileSystem.GetDirectoryContents(directory=fromPath, searchString=file_extension)

# group: Extract data and evaluate category names
info = Custom[CustomNode.Info](path=getDirectoryContents.files)  # package Clockwork for Dynamo 2.x; Extracts information from a custom node.

code_block = CodeBlock(desc=info.Description) { desc == ""; }

# group (continued): Extract data and evaluate category names
filterByBoolMask = List.FilterByBoolMask(list=info.Name, mask=code_block)

# group: OUTPUTS
nodes_that_do_not_have_a = Watch(filterByBoolMask.in)  # "Nodes that do not have a description"
