# Dynamo graph FindNestedNodeNameMismatches.dyn (Dynamo 2.12.0.5650)
# packages: Clockwork for Dynamo 2.x 2.3.0

# group: Find Nested Node Name Mismatches
# note: This graph parses each *.dyf file in a given directory and finds names of nested custom nodes that do not match the list of node names extracted from the directory.
# I am using this in order to find nested nodes that either do not originate from my own package or that have been renamed at some point.

# group: INPUTS
directory_path_nodes = Directory("C:\Users\andreas\Documents\GitHub\ClockworkForDynamo\nodes\2.x")  # graph input
directory_path_results = Directory("C:\Users\andreas\Desktop")  # graph input
file_name_results = StringInput("NodeNameMismatches")  # graph input

# group: Browse directory
fromPath = DirectoryObject(path=directory_path_nodes)  # "Directory.FromPath"
file_extension = CodeBlock { "*.dyf"; }
getDirectoryContents = FileSystem.GetDirectoryContents(directory=fromPath, searchString=file_extension)

# group: Find nodes that contain nested nodes
info = Custom[CustomNode.Info](path=getDirectoryContents.files)  # package Clockwork for Dynamo 2.x; Extracts information from a custom node.
isNotEmpty = Custom[List.IsNotEmpty](seq=info.NestedCustomNodes@L2)  # package Clockwork for Dynamo 2.x; Just the inversion of the built-in Is Empty List node.
filterByBoolMask = List.FilterByBoolMask(list=info.Name, mask=isNotEmpty)
filterByBoolMask_2 = List.FilterByBoolMask(list=info.NestedCustomNodes, mask=isNotEmpty)

# group: Find mismatches
contains = List.Contains(list=info.Name, item=filterByBoolMask_2.in@@L1)
anyFalse = Custom[List.AnyFalse](seq=contains@L2)  # package Clockwork for Dynamo 2.x; Returns true if any item in a list of booleans is false.
filterByBoolMask_3 = List.FilterByBoolMask(list=filterByBoolMask.in, mask=anyFalse)
code_block = CodeBlock { ", "; }
filterByBoolMask_4 = List.FilterByBoolMask(list=filterByBoolMask_2.in, mask=contains)
filterByBoolMask_5 = List.FilterByBoolMask(list=filterByBoolMask_4.out, mask=anyFalse)
join = String.Join(separator=code_block, string0=filterByBoolMask_5.in)
flatten = List.Flatten(list=join)

# group: OUTPUTS
NODES = Watch(filterByBoolMask_3.in)
nested_nodes = Watch(flatten)

# group: Write data to file
code_block_2 = CodeBlock(filename=file_name_results) { filename + ".CSV"; }
combinePath = FileSystem.CombinePath(string0=directory_path_results, string1=code_block_2)
create = List.Create(item0=filterByBoolMask_3.in, item1=flatten)
transpose = List.Transpose(lists=create)
exportCSV = Data.ExportCSV(filePath=combinePath, data=transpose)
