# Dynamo graph FindNodesByVersion.dyn (Dynamo 2.12.0.5650)
# packages: Clockwork for Dynamo 2.x 2.3.0

# group: Find Nodes By Version
# note: This graph parses each *.dyf file in a given directory and compares their version numbers to a given version number.
# I am using this in order to find nodes that need up- or downgrading in a package.

# group: INPUTS
directory_path = Directory("C:\Users\andreas\Documents\GitHub\ClockworkForDynamo\nodes\2.x")  # graph input
version_number = StringInput("2.12.0.0")  # graph input

# group: Browse directory
fromPath = DirectoryObject(path=directory_path)  # "Directory.FromPath"
file_extension = CodeBlock { "*.dyf"; }
getDirectoryContents = FileSystem.GetDirectoryContents(directory=fromPath, searchString=file_extension)

# group: Extract node names & version numbers
info = Custom[CustomNode.Info](path=getDirectoryContents.files)  # package Clockwork for Dynamo 2.x; Extracts information from a custom node.
code_block = CodeBlock(nname=info.Name, nversion=info.Version) { nname + " (" + nversion + ")"; }
toInteger = Custom[VersionNumber.ToInteger](str=info.Version)  # package Clockwork for Dynamo 2.x; Converts a version number (e.g. a Dynamo version number) to an integer.

# group: Compare versions
filterByBoolMask = List.FilterByBoolMask()  # unwired: list, mask
toInteger_2 = Custom[VersionNumber.ToInteger](str=version_number)
code_block_2 = CodeBlock(nodeV=toInteger, compareV=toInteger_2) { nodeV < compareV; nodeV <= compareV; nodeV == compareV; nodeV >= compareV; nodeV > compareV; }
create = List.Create(item0=code_block_2.out0, item1=code_block_2.out1, item2=code_block_2.out2, item3=code_block_2.out3, item4=code_block_2.out4)
count = List.Count(list=create)
ofRepeatedItem = List.OfRepeatedItem(item=code_block, amount=count)
combine = List.Combine(combineFunction=filterByBoolMask.in, list0=ofRepeatedItem, list1=create)
code_block_3 = CodeBlock(seq=combine) { seq[0]; seq[1]; seq[2]; seq[3]; seq[4]; }

# group: OUTPUTS
GREATER = Watch(code_block_3.out4)
LOWER = Watch(code_block_3.out0)
lower_or_equal = Watch(code_block_3.out1)
EQUAL = Watch(code_block_3.out2)
equal_or_greater = Watch(code_block_3.out3)
