# Dynamo graph GenerateNodeDocumentationMarkdownFiles.dyn (Dynamo 2.12.1.8246)
# packages: Clockwork for Dynamo 2.x 2.4.0, Clockwork for Dynamo 2.x 2.6.0

# group: Generate Node Documentation Markdown Files
# note: This graph generates a markdown node documentation file for the doc folder.

# group: INPUTS
doc_directory_path = Directory("C:\Users\adsk\Documents\andreas\repos\ClockworkForDynamo\doc\2.x")
package_name = StringInput("Clockwork")
file_path = Filename("..\..\..\..\..\..\..\..\temp\NodeList.csv")  # graph input
index_of_name_column = DoubleInput(2)  # graph input
node_directory_path = Directory("C:\Users\adsk\Documents\andreas\repos\ClockworkForDynamo\nodes\2.x")  # graph input
no_sample = StringInput("---")
sample_missing = StringInput("""## Sample file
There is no sample file available for this node.""")
sample_exists = StringInput("""## Sample file
There is a sample file available for this node:<br>
[Download sample file](https://raw.githubusercontent.com/andydandy74/ClockworkForDynamo/master/package_samples/{VERSION}/dynamo/{0}.dyn)""")
version_2_x_3_x = BoolSelector(true)
x = StringInput("2.x")  # "2.x"
x_2 = StringInput("3.x")  # "3.x"
placeholder = StringInput("{0}")
text_template = StringInput("""

## Dependencies
As of Revit 2023 you will need to install the package DynamoIronPython 2.7 (version 2.5 of that package for Revit 2023/24, version 3.2 for Revit 2025).

## Useful links
- [Clockwork repository on GitHub](https://github.com/andydandy74/ClockworkForDynamo)
- [Report an issue](https://github.com/andydandy74/ClockworkForDynamo/issues)
- [Version history](https://github.com/andydandy74/ClockworkForDynamo/wiki/{VERSION}-version-History)
- [Documentation of all nodes](https://github.com/andydandy74/ClockworkForDynamo/wiki/{VERSION}-node-documentation)
- [Deprecated nodes](https://github.com/andydandy74/ClockworkForDynamo/wiki/Deprecated-Nodes-&-Packages)

![Clockwork logo](https://raw.githubusercontent.com/andydandy74/ClockworkForDynamo/master/icons/raw/clockwork-logo-docs.png)""")
local_sample_directory_path = StringInput("C:\Users\adsk\Documents\andreas\repos\ClockworkForDynamo\package_samples\{VERSION}\dynamo")

# group: Delete old Markdown files
fromPath = DirectoryObject(path=doc_directory_path)  # "Directory.FromPath"
string = StringInput("*.md")  # graph input
getDirectoryContents = FileSystem.GetDirectoryContents(directory=fromPath, searchString=string)
deleteFile = FileSystem.DeleteFile(path=getDirectoryContents.files)

# group: Get node names from list
string_2 = StringInput(",")  # graph input
fromPath_2 = FileObject(path=file_path)  # "File.FromPath"
readText = FileSystem.ReadText(file=fromPath_2)
boolean = BoolSelector(true)  # graph input
fromCSV = Custom[List.FromCSV](delimiter=string_2, CSVstring=readText, ignoreFirstRow=boolean)  # package Clockwork for Dynamo 2.x; Converts the content of a given CSV file to a list
transpose = List.Transpose(lists=fromCSV)
getItemAtIndex = List.GetItemAtIndex(list=transpose, index=index_of_name_column)

# group: Get node names from directory
fromPath_3 = DirectoryObject(path=node_directory_path)  # "Directory.FromPath"
string_3 = StringInput("*.dyf")  # graph input
getDirectoryContents_2 = FileSystem.GetDirectoryContents(directory=fromPath_3, searchString=string_3)
boolean_2 = BoolSelector(false)
fileName = FileSystem.FileName(path=getDirectoryContents_2.files, withExtension=boolean_2)

version_placeholder = StringInput("{VERSION}")
if_ = RefactoredIf(test=version_2_x_3_x, true=x, false=x_2)
replace = String.Replace(string=sample_exists, searchFor=version_placeholder, replaceWith=if_)
replace_2 = String.Replace(string=text_template, searchFor=version_placeholder, replaceWith=if_)

# group: Generate node docs
passthrough = Custom[Passthrough](passThrough=doc_directory_path, waitFor=deleteFile)  # package Clockwork for Dynamo 2.x; Forces a sequential order of execution. The node wired into the output of the Passthrough node will be executed *after* the node wired into the waitFor input (e.g. important for some Revit operations). The value of the passThrough input will be passed on to the node wired into the output port of the Passthrough node.
indexOf = List.IndexOf(list=getItemAtIndex, element=fileName@L1)
getItemAtIndex_2 = List.GetItemAtIndex(list=fromCSV, index=indexOf)
code_block = CodeBlock { 1; 2; 3; }
getItemAtIndex_3 = List.GetItemAtIndex(list=getItemAtIndex_2@L2, index=code_block.out0)
getItemAtIndex_4 = List.GetItemAtIndex(list=getItemAtIndex_2@L2, index=code_block.out1)
getItemAtIndex_5 = List.GetItemAtIndex(list=getItemAtIndex_2@L2, index=code_block.out2)
replace_3 = String.Replace(string=replace, searchFor=placeholder, replaceWith=getItemAtIndex_5)
code_block_2 = CodeBlock(path=passthrough, packageName=package_name, p1=getItemAtIndex_3, p2=getItemAtIndex_4, sample=getItemAtIndex_5, nosample=no_sample, missing=sample_missing, exists=replace_3, pkgInfo=replace_2)
# ---------- code_block_2.designscript (4 lines) ----------
// filename
path + "\\" + packageName + "." + p1 + "." + p2 + ".md";
// content
(sample == nosample ? missing : exists) + pkgInfo;
# ----------------------------------------
writeText = FileSystem.WriteText(filePath=code_block_2.out0, text=code_block_2.out1)

replace_4 = String.Replace(string=local_sample_directory_path, searchFor=version_placeholder, replaceWith=if_)

# group: Identify missing local sample files
uniqueItems = List.UniqueItems(list=getItemAtIndex_5)
code_block_3 = CodeBlock(dir=replace_4, dyn=uniqueItems) { dir + "\\" + dyn + ".dyn"; }
boolean_3 = BoolSelector(false)
clean = List.Clean(list=code_block_3, preserveIndices=boolean_3)
fileExists = FileSystem.FileExists(path=clean)
filterByBoolMask = List.FilterByBoolMask(list=clean, mask=fileExists)

missing_samle_files = Watch(filterByBoolMask.out)
