# Dynamo graph ComparePythonFiles.dyn (Dynamo 2.12.1.8246)
# packages: Clockwork for Dynamo 2.x 2.12.2

string = StringInput("\n")
directory_path = Directory("C:\Users\adsk\Documents\andreas\repos\ClockworkForDynamo\nodes\3.x\python")
directory_from_path = DirectoryObject(path=directory_path)
string_2 = StringInput("*.py")
getDirectoryContents = FileSystem.GetDirectoryContents(directory=directory_from_path, searchString=string_2)
fileName = FileSystem.FileName(path=getDirectoryContents.files)
directory_path_2 = Directory("C:\Users\adsk\Documents\andreas\repos\ClockworkForDynamo\nodes\2.x\python")
directory_from_path_2 = DirectoryObject(path=directory_path_2)
getDirectoryContents_2 = FileSystem.GetDirectoryContents(directory=directory_from_path_2, searchString=string_2)
fileName_2 = FileSystem.FileName(path=getDirectoryContents_2.files)
indexOf = List.IndexOf(list=fileName_2, element=fileName@L1)
getItemAtIndex = List.GetItemAtIndex(list=getDirectoryContents_2.files, index=indexOf)
readText = FileSystem.ReadText(file=getItemAtIndex)
readText_2 = FileSystem.ReadText(file=getDirectoryContents.files)
code_block = CodeBlock(old=readText, new=readText_2) { old == new; }
filterByBoolMask = List.FilterByBoolMask(list=fileName, mask=code_block)
string_3 = StringInput(".py")
string_4 = StringInput("")
replace = String.Replace(string=filterByBoolMask.out, searchFor=string_3, replaceWith=string_4)
code_block_2 = CodeBlock(str=replace) { "- " + str; }
join = String.Join(separator=string, string0=code_block_2)
firstItem = List.FirstItem(list=join)
sendTo = Custom[Clipboard.SendTo](str=firstItem)  # package Clockwork for Dynamo 2.x; Copies a string to the clipboard.
