# Dynamo graph ExtractPythonScripts.dyn (Dynamo 2.12.1.8246)
# packages: Clockwork for Dynamo 2.x 2.3.0

# group: Extract Python Scripts
# note: This graph parses each *.dyf file in a given directory and extracts all Python scripts within that file into a subdirectory. Previous Pythons script files in that directory will be deleted.
# I am using this in order to keep the Python documentation of my custom nodes more accessible.

# group: INPUTS
directory_path = Directory("C:\Users\adsk\Documents\andreas\repos\ClockworkForDynamo\nodes\3.x")  # graph input
subdirectory_name = StringInput("python")  # graph input

# group: Delete previous *.py files
combinePath = FileSystem.CombinePath(string0=directory_path, string1=subdirectory_name)
fromPath = DirectoryObject(path=combinePath)  # "Directory.FromPath"
file_extension = CodeBlock { "*.py"; }
getDirectoryContents = FileSystem.GetDirectoryContents(directory=fromPath, searchString=file_extension)
deleteFile = FileSystem.DeleteFile(path=getDirectoryContents.files)
passthrough = Custom[Passthrough](passThrough=combinePath, waitFor=deleteFile)  # package Clockwork for Dynamo 2.x; Forces a sequential order of execution. The node wired into the output of the Passthrough node will be executed *after* the node wired into the waitFor input (e.g. important for some Revit operations). The value of the passThrough input will be passed on to the node wired into the output port of the Passthrough node.

# group: Browse directory
fromPath_2 = DirectoryObject(path=directory_path)  # "Directory.FromPath"
file_extension_2 = CodeBlock { "*.dyf"; }
getDirectoryContents_2 = FileSystem.GetDirectoryContents(directory=fromPath_2, searchString=file_extension_2)

# group: Extract Python scripts
info = Custom[CustomNode.Info](path=getDirectoryContents_2.files)  # package Clockwork for Dynamo 2.x; Extracts information from a custom node.
isNotEmpty = Custom[List.IsNotEmpty](seq=info.PythonScripts@L2)  # package Clockwork for Dynamo 2.x; Just the inversion of the built-in Is Empty List node.
filterByBoolMask = List.FilterByBoolMask(list=info.PythonScripts, mask=isNotEmpty)
string = StringInput("&gt;")  # graph input
string_2 = StringInput(">")  # graph input
replace = String.Replace(string=filterByBoolMask.in, searchFor=string, replaceWith=string_2)
string_3 = StringInput("&lt;")  # graph input
string_4 = StringInput("<")  # graph input
# note: Angle brackets: Replace HTML notation with normal characters
replace_2 = String.Replace(string=replace, searchFor=string_3, replaceWith=string_4)
string_5 = StringInput("\n\n##### NEXT PYTHON NODE #####\n\n")  # graph input
# note: If a custom node contains more than one Python script, concatenate them with a custom delimiter
join = String.Join(separator=string_5)  # unwired: string0
map = List.Map(list=replace_2, function=join)
flatten = List.Flatten(list=map)

# group: Create new *.py files
# note: Filter out all files that do not contain Python scripts
filterByBoolMask_2 = List.FilterByBoolMask(list=getDirectoryContents_2.files, mask=isNotEmpty)
boolean = BoolSelector(false)  # graph input
fileName = FileSystem.FileName(path=filterByBoolMask_2.in, withExtension=boolean)
code_block = CodeBlock(dir=passthrough, filename=fileName) { dir + "\\" + filename + ".py"; }
writeText = FileSystem.WriteText(filePath=code_block, text=flatten)
