# Dynamo graph FindScriptsWithBindings.dyn (Dynamo 3.3.0.6316)

# group: Find Scripts with Bindings
# note: This graph identifies all scripts in a given directory that contain element bindings

# group: INPUTS
directory_path = Directory("C:\Users\adsk\Documents\andreas\repos\ClockworkForDynamo\package_samples\3.x\dynamo")  # graph input

# group: Browse directory
fromPath = DirectoryObject(path=directory_path)  # "Directory.FromPath"
file_extension = CodeBlock { "*.dyn"; }
getDirectoryContents = FileSystem.GetDirectoryContents(directory=fromPath, searchString=file_extension)

# group: Check for element bindings
file_from_path = FileObject(path=getDirectoryContents.files)
readText = FileSystem.ReadText(file=file_from_path)
string = StringInput("\"Bindings\": [],")
contains = String.Contains(string=readText, searchFor=string)
filterByBoolMask = List.FilterByBoolMask(list=getDirectoryContents.files, mask=contains)
fileName = FileSystem.FileName(path=filterByBoolMask.out)

scripts_with_bindings = Watch(fileName)
