# Dynamo graph GenerateNodeDocumentationMarkdownFiles.dyn (Dynamo 2.12.1.8246)
# packages: Clockwork for Dynamo 2.x 2.4.0, Clockwork for Dynamo 2.x 2.6.0

# group: Generate Node Documentation Markdown Files
# note: This graph generates a markdown node documentation file for the doc folder.

# group: INPUTS
doc_directory_path = Directory("C:\Users\adsk\Documents\andreas\repos\ClockworkForDynamo\doc")
version_2_x_3_x = BoolSelector(false)
x = StringInput("2.x")  # "2.x"
x_2 = StringInput("3.x")  # "3.x"
package_name = StringInput("Clockwork")
file_path = Filename("..\..\..\..\..\..\..\..\temp\NodeList.csv")  # graph input
index_of_name_column = DoubleInput(2)  # graph input
node_directory_path = Directory("C:\Users\adsk\Documents\andreas\repos\ClockworkForDynamo\nodes")  # graph input
no_sample = StringInput("---")
sample_missing = StringInput("""## Sample file
There is no sample file available for this node.""")
sample_exists = StringInput("""## Sample file
There is a sample file available for this node:<br>
[Download sample file](https://raw.githubusercontent.com/andydandy74/ClockworkForDynamo/master/package_samples/{VERSION}/dynamo/{0}.dyn)""")
placeholder = StringInput("{0}")
text_template = StringInput("""

{DEPENDENCIES}
## Useful links
- [Clockwork repository on GitHub](https://github.com/andydandy74/ClockworkForDynamo)
- [Report an issue](https://github.com/andydandy74/ClockworkForDynamo/issues)
- [Version history](https://github.com/andydandy74/ClockworkForDynamo/wiki/{VERSION}-version-History)
- [Documentation of all nodes](https://github.com/andydandy74/ClockworkForDynamo/wiki/{VERSION}-node-documentation)
- [Deprecated nodes](https://github.com/andydandy74/ClockworkForDynamo/wiki/Deprecated-Nodes-&-Packages)

![Clockwork logo](https://raw.githubusercontent.com/andydandy74/ClockworkForDynamo/master/icons/raw/clockwork-logo-docs.png)""")
placeholder_dependencies = StringInput("{DEPENDENCIES}")
n2_x_dependencies = StringInput("""## Dependencies
As of Revit 2023 you will need to install the package DynamoIronPython 2.7 (version 2.5 of that package for Revit 2023/24, version 3.2 for Revit 2025).
""")  # "2.x dependencies"
local_sample_directory_path = StringInput("C:\Users\adsk\Documents\andreas\repos\ClockworkForDynamo\package_samples\{VERSION}\dynamo")

# group: Get node names from list
string = StringInput(",")  # graph input
fromPath = FileObject(path=file_path)  # "File.FromPath"
readText = FileSystem.ReadText(file=fromPath)
boolean = BoolSelector(true)  # graph input
importCSV = Custom[Data.ImportCSV+](delimiter=string, CSVstring=readText, ignoreFirstRow=boolean)  # package Clockwork for Dynamo 2.x; Converts the content of a given CSV file to a list
transpose = List.Transpose(lists=importCSV)
getItemAtIndex = List.GetItemAtIndex(list=transpose, index=index_of_name_column)

version_placeholder = StringInput("{VERSION}")

# group: Version-specific changes
if_ = RefactoredIf(test=version_2_x_3_x, true=x, false=x_2)
replace = String.Replace(string=sample_exists, searchFor=version_placeholder, replaceWith=if_)
string_2 = StringInput("")
if_2 = RefactoredIf(test=version_2_x_3_x, true=n2_x_dependencies, false=string_2)
replace_2 = String.Replace(string=text_template, searchFor=placeholder_dependencies, replaceWith=if_2)
replace_3 = String.Replace(string=replace_2, searchFor=version_placeholder, replaceWith=if_)
replace_4 = String.Replace(string=local_sample_directory_path, searchFor=version_placeholder, replaceWith=if_)

code_block = CodeBlock(dir=doc_directory_path, version=if_) { dir + "\\" + version; }

# group: Delete old Markdown files
fromPath_2 = DirectoryObject(path=code_block)  # "Directory.FromPath"
string_3 = StringInput("*.md")  # graph input
getDirectoryContents = FileSystem.GetDirectoryContents(directory=fromPath_2, searchString=string_3)
deleteFile = FileSystem.DeleteFile(path=getDirectoryContents.files)

code_block_2 = CodeBlock(dir=node_directory_path, version=if_) { dir + "\\" + version; }

# group: Get node names from directory
fromPath_3 = DirectoryObject(path=code_block_2)  # "Directory.FromPath"
string_4 = StringInput("*.dyf")  # graph input
getDirectoryContents_2 = FileSystem.GetDirectoryContents(directory=fromPath_3, searchString=string_4)
boolean_2 = BoolSelector(false)
fileName = FileSystem.FileName(path=getDirectoryContents_2.files, withExtension=boolean_2)

# group: Generate node docs
passthrough = Custom[Passthrough](passThrough=code_block, waitFor=deleteFile)  # package Clockwork for Dynamo 2.x; Forces a sequential order of execution. The node wired into the output of the Passthrough node will be executed *after* the node wired into the waitFor input (e.g. important for some Revit operations). The value of the passThrough input will be passed on to the node wired into the output port of the Passthrough node.
indexOf = List.IndexOf(list=getItemAtIndex, element=fileName@L1)
getItemAtIndex_2 = List.GetItemAtIndex(list=importCSV, index=indexOf)
code_block_3 = CodeBlock { 1; 2; 3; }
getItemAtIndex_3 = List.GetItemAtIndex(list=getItemAtIndex_2@L2, index=code_block_3.out0)
getItemAtIndex_4 = List.GetItemAtIndex(list=getItemAtIndex_2@L2, index=code_block_3.out1)
getItemAtIndex_5 = List.GetItemAtIndex(list=getItemAtIndex_2@L2, index=code_block_3.out2)
replace_5 = String.Replace(string=replace, searchFor=placeholder, replaceWith=getItemAtIndex_5)
code_block_4 = CodeBlock(path=passthrough, packageName=package_name, p1=getItemAtIndex_3, p2=getItemAtIndex_4, sample=getItemAtIndex_5, nosample=no_sample, missing=sample_missing, exists=replace_5, pkgInfo=replace_3)
# ---------- code_block_4.designscript (4 lines) ----------
// filename
path + "\\" + packageName + "." + p1 + "." + p2 + ".md";
// content
(sample == nosample ? missing : exists) + pkgInfo;
# ----------------------------------------
writeText = FileSystem.WriteText(filePath=code_block_4.out0, text=code_block_4.out1)

# group: Identify missing local sample files
uniqueItems = List.UniqueItems(list=getItemAtIndex_5)
code_block_5 = CodeBlock(dir=replace_4, dyn=uniqueItems) { dir + "\\" + dyn + ".dyn"; }
boolean_3 = BoolSelector(false)
clean = List.Clean(list=code_block_5, preserveIndices=boolean_3)
fileExists = FileSystem.FileExists(path=clean)
filterByBoolMask = List.FilterByBoolMask(list=clean, mask=fileExists)

missing_samle_files = Watch(filterByBoolMask.out)
