# Dynamo graph CompareNodeListWithNodeDir.dyn (Dynamo 1.3.1.1736)

# group: INPUTS
directory_path = Directory("C:\temp\conversion-test\2.x")
file_path = Filename("C:\Users\andreas\Documents\GitHub\ClockworkForDynamo\recat.csv")
index_name_old = DoubleInput(3)

# group: Get node names from file
fromPath = DirectoryObject(directory_path)  # "Directory.FromPath"
string = StringInput("*.dyf")
contents = Directory.Contents(fromPath, string)

# group: Get node names from directory
string_2 = StringInput(";")
fromPath_2 = FileObject(file_path)  # "File.FromPath"
readText = File.ReadText(fromPath_2)
boolean = BoolSelector(true)
fromCSV = Custom[List.FromCSV](delimiter=string_2, CSVstring=readText, ignoreFirstRow=boolean)  # Converts the content of a given CSV file to a list
transpose = List.Transpose(fromCSV)
code_block = CodeBlock(dir=directory_path, seq=transpose, name_old=index_name_old)
# ---------- code_block.designscript (2 lines) ----------
// Filename
dir + "\\" + seq[name_old] + ".dyf";
# ----------------------------------------

# group: Identify discrepancies
containsItem = List.ContainsItem(list=code_block, item=contents)
filterByBoolMask = List.FilterByBoolMask(list=contents, mask=containsItem)
containsItem_2 = List.ContainsItem(list=contents, item=code_block)
filterByBoolMask_2 = List.FilterByBoolMask(list=code_block, mask=containsItem_2)

# group: OUTPUT
existing_files_not_in_the_list = Watch(filterByBoolMask.out)
listed_files_not_in_the = Watch(filterByBoolMask_2.out)  # "Listed files not in the directory"
