# Dynamo graph ExtractPythonScripts.dyn (Dynamo 1.3.1.1736)

# group: Extract Python Scripts
# note: This graph parses each *.dyf file in a given directory and extracts all Python scripts within that file into a subdirectory. Previous Pythons script files in that directory will be deleted.
# I am using this in order to keep the Python documentation of my custom nodes more accessible.

# group: INPUTS
directory_path = Directory("C:\Users\andreas\Documents\GitHub\ClockworkForDynamo\nodes\1.x")
subdirectory_name = StringInput("python")

# group: Delete previous *.py files
combine = FilePath.Combine(directory_path, subdirectory_name)
fromPath = DirectoryObject(combine)  # "Directory.FromPath"
file_extension = CodeBlock { "*.py"; }
contents = Directory.Contents(fromPath, file_extension)
delete = File.Delete(contents)
passthrough = Custom[Passthrough](passThrough=combine, waitFor=delete)  # Forces a sequential order of execution. The node wired into the output of the Passthrough node will be executed *after* the node wired into the waitFor input (e.g. important for some Revit operations). The value of the passThrough input will be passed on to the node wired into the output port of the Passthrough node.

# group: Browse directory
fromPath_2 = DirectoryObject(directory_path)  # "Directory.FromPath"
file_extension_2 = CodeBlock { "*.dyf"; }
contents_2 = Directory.Contents(fromPath_2, file_extension_2)

# group: Extract Python scripts
info = Custom[CustomNode.Info](path=contents_2)  # Extracts information from a custom node.
isNotEmpty = Custom[List.IsNotEmpty](seq=info.PythonScripts@L2)  # Just the inversion of the built-in Is Empty List node.
filterByBoolMask = List.FilterByBoolMask(list=info.PythonScripts, mask=isNotEmpty)
string = StringInput("&gt;")
string_2 = StringInput(">")
replace = String.Replace(str=filterByBoolMask.in, searchFor=string, replaceWith=string_2)
string_3 = StringInput("&lt;")
string_4 = StringInput("<")
# note: Angle brackets: Replace HTML notation with normal characters
replace_2 = String.Replace(str=replace, searchFor=string_3, replaceWith=string_4)
string_5 = StringInput("\n\n##### NEXT PYTHON NODE #####\n\n")
# note: If a custom node contains more than one Python script, concatenate them with a custom delimiter
join = String.Join(string_5)  # unwired: arg1
map = List.Map(list=replace_2, f_x=join)
flatten = Flatten(map)

# group: Create new *.py files
# note: Filter out all files that do not contain Python scripts
filterByBoolMask_2 = List.FilterByBoolMask(list=contents_2, mask=isNotEmpty)
boolean = BoolSelector(false)
fileName = FilePath.FileName(filterByBoolMask_2.in, boolean)
code_block = CodeBlock(filename=fileName) { filename + ".py"; }
combine_2 = FilePath.Combine(passthrough, code_block)
writeText = File.WriteText(combine_2, flatten)
