# Dynamo graph FindNestedNodeNameMismatches.dyn (Dynamo 0.9.0.3067)

# group: Find Nested Node Name Mismatches
# note: This graph parses each *.dyf file in a given directory and finds names of nested custom nodes that do not match the list of node names extracted from the directory.
# I am using this in order to find nested nodes that either do not originate from my own package or that have been renamed at some point.

# group: INPUTS
directory_path_nodes = Directory("C:\Users\adieckmann\Documents\GitHub\ClockworkForDynamo\nodes\0.9.x")
directory_path_results = Directory("C:\Users\adieckmann\Desktop")
file_name_results = StringInput("NodeNameMismatches")

# group: Browse directory
fromPath = DirectoryObject(directory_path_nodes)  # "Directory.FromPath"
file_extension = CodeBlock { "*.dyf"; }
contents = Directory.Contents(fromPath, file_extension)

# group: Find nodes that contain nested nodes
info = Custom[CustomNode.Info](path=contents)  # Extracts information from a custom node.
isNotEmpty = Custom[List.IsNotEmpty]()  # Just the inversion of the built-in Is Empty List node.
map = List.Map(list=info.NestedCustomNodes, f_x=isNotEmpty)
filterByBoolMask = List.FilterByBoolMask(list=info.Name, mask=map)
filterByBoolMask_2 = List.FilterByBoolMask(list=info.NestedCustomNodes, mask=map)

# group: Find mismatches
containsItem = List.ContainsItem(list=info.Name)
map_2 = List.Map(list=filterByBoolMask_2.in, f_x=containsItem)
anyFalse = Custom[List.AnyFalse]()  # Returns true if any item in a list of booleans is false.
map_3 = List.Map(list=map_2, f_x=anyFalse)
filterByBoolMask_3 = List.FilterByBoolMask(list=filterByBoolMask.in, mask=map_3)
filterByBoolMask_4 = List.FilterByBoolMask(list=filterByBoolMask_2.in, mask=map_2)
filterByBoolMask_5 = List.FilterByBoolMask(list=filterByBoolMask_4.out, mask=map_3)
code_block = CodeBlock { ", "; }
join = String.Join(code_block)
map_4 = List.Map(list=filterByBoolMask_5.in, f_x=join)
flatten = Flatten(map_4)

# group: OUTPUTS
NODES = Watch(filterByBoolMask_3.in)
nested_nodes = Watch(flatten)

# group: Write data to file
string = StringInput("\")
code_block_2 = CodeBlock(dir=directory_path_results, delimiter=string, filename=file_name_results) { dir + delimiter + filename + ".CSV"; }
create = List.Create(filterByBoolMask_3.in, flatten)
transpose = List.Transpose(create)
writeToFile = CSV.WriteToFile(code_block_2, transpose)
