# Dynamo graph RecategorizeNodes.dyn (Dynamo 1.3.1.1736)

# group: INPUTS
file_path = Filename("C:\Users\andreas\Documents\GitHub\ClockworkForDynamo\recat.csv")
index_category_old = DoubleInput(2)
index_category_new = DoubleInput(0)
directory_path = Directory("C:\Users\andreas\Documents\GitHub\ClockworkForDynamo\nodes\2.x")
index_name_old = DoubleInput(3)

# group: Identify nodes that need to be recategorized
string = StringInput(";")
fromPath = FileObject(file_path)  # "File.FromPath"
readText = File.ReadText(fromPath)
boolean = BoolSelector(true)
fromCSV = Custom[List.FromCSV](delimiter=string, CSVstring=readText, ignoreFirstRow=boolean)  # Converts the content of a given CSV file to a list
transpose = List.Transpose(fromCSV)
code_block = CodeBlock(seq=transpose, cat_old=index_category_old, cat_new=index_category_new, dir=directory_path, name_old=index_name_old)
# ---------- code_block.designscript (4 lines) ----------
// Does the node need to be recategorized?
seq[cat_old] != seq[cat_new];
// Filename
dir + "\\" + seq[name_old] + ".dyf";
# ----------------------------------------
exists = File.Exists(code_block.out1)
create = List.Create(code_block.out0, exists)
transpose_2 = List.Transpose(create)
allTrue = AllTrue(transpose_2@L2)
filterByBoolMask = List.FilterByBoolMask(list=code_block.out1, mask=allTrue)
filterByBoolMask_2 = List.FilterByBoolMask(list=fromCSV, mask=allTrue)

# group: Replace category name
readText_2 = File.ReadText(filterByBoolMask.in)
string_2 = StringInput("\n")
python_script = Python(IN[0]=readText_2, IN[1]=string_2)
# ---------- python_script.python (3 lines) ----------
import clr

OUT = map(list, zip(*[x.split(IN[1],1) for x in IN[0]]))
# ----------------------------------------
firstItem = List.FirstItem(python_script)
transpose_3 = List.Transpose(filterByBoolMask_2.in)
getItemAtIndex = List.GetItemAtIndex(list=transpose_3, index=index_category_old)
getItemAtIndex_2 = List.GetItemAtIndex(list=transpose_3, index=index_category_new)
replace = String.Replace(str=firstItem, searchFor=getItemAtIndex, replaceWith=getItemAtIndex_2)
lastItem = List.LastItem(python_script)
code_block_2 = CodeBlock(firstline=replace, br=string_2, rest=lastItem) { firstline + br + rest; }
writeText = File.WriteText(filterByBoolMask.in, code_block_2)
