# Dynamo graph RenameNodes.dyn (Dynamo 1.3.1.1736)

# group: INPUTS
file_path = Filename("C:\Users\andreas\Documents\GitHub\ClockworkForDynamo\recat.csv")
index_name_old = DoubleInput(3)
index_name_new = DoubleInput(1)
directory_path = Directory("C:\Users\andreas\Documents\GitHub\ClockworkForDynamo\nodes\2.x")

# group: Identify nodes that need to be recategorized
string = StringInput(";")
fromPath = FileObject(file_path)  # "File.FromPath"
readText = File.ReadText(fromPath)
boolean = BoolSelector(true)
fromCSV = Custom[List.FromCSV](delimiter=string, CSVstring=readText, ignoreFirstRow=boolean)  # Converts the content of a given CSV file to a list
transpose = List.Transpose(fromCSV)
code_block = CodeBlock(seq=transpose, name_old=index_name_old, name_new=index_name_new, dir=directory_path)
# ---------- code_block.designscript (4 lines) ----------
// Does the node need to be renamed?
seq[name_old] != seq[name_new];
// Filename
dir + "\\" + seq[name_old] + ".dyf";
# ----------------------------------------
exists = File.Exists(code_block.out1)
create = List.Create(code_block.out0, exists)
transpose_2 = List.Transpose(create)
allTrue = AllTrue(transpose_2@L2)
filterByBoolMask = List.FilterByBoolMask(list=code_block.out1, mask=allTrue)
filterByBoolMask_2 = List.FilterByBoolMask(list=fromCSV, mask=allTrue)

# group: Replace node name
readText_2 = File.ReadText(filterByBoolMask.in)
string_2 = StringInput("\n")
python_script = Python(IN[0]=readText_2, IN[1]=string_2)
# ---------- python_script.python (3 lines) ----------
import clr

OUT = map(list, zip(*[x.split(IN[1],1) for x in IN[0]]))
# ----------------------------------------
firstItem = List.FirstItem(python_script)
transpose_3 = List.Transpose(filterByBoolMask_2.in)
getItemAtIndex = List.GetItemAtIndex(list=transpose_3, index=index_name_old)
getItemAtIndex_2 = List.GetItemAtIndex(list=transpose_3, index=index_name_new)
replace = String.Replace(str=firstItem, searchFor=getItemAtIndex, replaceWith=getItemAtIndex_2)
lastItem = List.LastItem(python_script)
code_block_2 = CodeBlock(firstline=replace, br=string_2, rest=lastItem) { firstline + br + rest; }
writeText = File.WriteText(filterByBoolMask.in, code_block_2)

# group: Rename files
passthrough = Custom[Passthrough](passThrough=filterByBoolMask.in, waitFor=writeText)  # Forces a sequential order of execution. The node wired into the output of the Passthrough node will be executed *after* the node wired into the waitFor input (e.g. important for some Revit operations). The value of the passThrough input will be passed on to the node wired into the output port of the Passthrough node.
code_block_3 = CodeBlock(dir=directory_path, name_new=getItemAtIndex_2) { dir + "\\" + name_new + ".dyf"; }
boolean_2 = BoolSelector(true)
move = File.Move(passthrough, code_block_3, boolean_2)
