# Dynamo graph AccumulateList.dyn (Dynamo 0.7.0.6448)

number = DoubleInput(1..10)
watch = Watch(number)
turn_into_list = Custom[Turn Into List](item=watch)  # Turns an element into a (flat) list
python_script = Python(IN[0]=turn_into_list)
# ---------- python_script.python (11 lines) ----------
items = IN[0]
elementlist = list()
counter = 0
while counter < len(items):
	if counter == 0:
		lastval = items[0]
	else:
		lastval = items[counter]+lastval
	elementlist.append(lastval)
	counter += 1
OUT = elementlist
# ----------------------------------------
watch_2 = Watch(python_script)
accumulate_list = Custom[Accumulate List](list=watch)  # Accumulates the values of a given list and returns a list of the accumulated values
watch_3 = Watch(accumulate_list)
