# Dynamo graph AlphabeticalSequence.dyn (Dynamo 0.7.0.6448)

integer_slider = IntegerSlider(79, range=1..500)
boolean = BoolSelector(false)
alphabetical_sequence = Custom[Alphabetical Sequence](n=integer_slider, uppercase=boolean)  # Creates a list of the first N letters of the alphabet (where 1 = A, 2 = B, ... , 27 = AA, 28 = AB etc.).
watch = Watch(alphabetical_sequence)
number_to_character = Custom[Number To Character](n=integer_slider, upper=boolean)  # Converts a number into a character (where 1 = A, 2 = B, ... , 27 = AA, 28 = AB etc.).
watch_2 = Watch(number_to_character)
number = DoubleInput(1..n, integer_slider, lacing=Longest)
number_to_character_2 = Custom[Number To Character](upper=boolean)
map = List.Map(number, number_to_character_2)
watch_3 = Watch(map)
