# Dynamo custom node Number To Character.dyf (Dynamo 0.7.0.6448)
# category: CAAD_RWTH.Strings
# Converts a number into a character (where 1 = A, 2 = B, ... , 27 = AA, 28 = AB etc.).

string = StringInput("*A*B*C*D*E*F*G*H*I*J*K*L*M*N*O*P*Q*R*S*T*U*V*W*X*Y*Z")
upper = Input()  # "upper?"
changeCase = String.ChangeCase(string, upper)
string_2 = StringInput("*")
split = String.Split(changeCase, string_2)
n = Input()
formula = Formula("(n-1)/26", n=n, lacing=Longest)
floor = Math.Floor(formula, lacing=Longest)
getItemAtIndex = List.GetItemAtIndex(split, floor)
number = DoubleInput(26)
mod = n % number  # lacing=Longest
formula_2 = Formula("if(x=0,26,x)", x=mod, lacing=Longest)
getItemAtIndex_2 = List.GetItemAtIndex(split, formula_2)
concat = String.Concat(getItemAtIndex, getItemAtIndex_2)
combined = Output(concat)
