# Dynamo graph MeshStuff.dyn (Dynamo 0.7.0.6448)

select_face = DSFaceSelection()  # 1 picked in the model
mesh_from_face = Custom[Mesh From Face](Face_s=select_face)  # Triangulates a given face into a mesh
triangles_from_mesh = Custom[Triangles From Mesh](Mesh_es=mesh_from_face)  # Retrieves all triangles from a mesh
xyzs_from_meshtriangle = Custom[XYZs From MeshTriangle](MeshTriangle_s=triangles_from_mesh)  # Retrieves XYZs from MeshTriangles
watch = Watch(xyzs_from_meshtriangle)
watch_2 = Watch(mesh_from_face)
watch_3 = Watch(triangles_from_mesh)
number = DoubleInput(0)
getItemAtIndex = List.GetItemAtIndex(xyzs_from_meshtriangle, number)
byPoint = ReferencePoint.ByPoint(getItemAtIndex, lacing=Longest)
identity = CoordinateSystem.Identity()
ZXPlane = CoordinateSystem.ZXPlane(identity, lacing=Longest)
mesh_plane_intersection = Custom[Mesh-Plane Intersection](Plane=ZXPlane, Mesh=mesh_from_face)  # Calculates the intersection of a mesh and a plane
byCurve = ModelCurve.ByCurve(mesh_plane_intersection.Nurbs_Spline, lacing=Longest)
watch_4 = Watch(mesh_plane_intersection.XYZ)
