# Dynamo graph PlaneProperties.dyn (Dynamo 0.7.0.6448)

identity = CoordinateSystem.Identity()
XYPlane = CoordinateSystem.XYPlane(identity, lacing=Longest)
plane_properties = Custom[Plane Properties](Plane_s=XYPlane)  # Returns the normal and origin of a given plane as well as its X and Y vectors.
watch = Watch(plane_properties.Normal_s)
watch_2 = Watch(plane_properties.Origin_s)
watch_3 = Watch(plane_properties.X_Vector_s)
watch_4 = Watch(plane_properties.Y_Vector_s)
watch_5 = Watch(XYPlane)
YAxis = Plane.YAxis(XYPlane)
watch_6 = Watch(YAxis)
XAxis = Plane.XAxis(XYPlane)
watch_7 = Watch(XAxis)
origin = Plane.Origin(XYPlane)
watch_8 = Watch(origin)
normal = Plane.Normal(XYPlane)
watch_9 = Watch(normal)
