# Dynamo custom node Plane Properties.dyf (Dynamo 0.7.0.6448)
# category: CAAD_RWTH.XYZ
# Returns the normal and origin of a given plane as well as its X and Y vectors.

Plane_s = Input()  # "Plane(s)"
normal = Plane.Normal(Plane_s)
Normal_s = Output(normal)  # "Normal(s)"
origin = Plane.Origin(Plane_s)
Origin_s = Output(origin)  # "Origin(s)"
XAxis = Plane.XAxis(Plane_s)
X_Vector_s = Output(XAxis)  # "X Vector(s)"
YAxis = Plane.YAxis(Plane_s)
Y_Vector_s = Output(YAxis)  # "Y Vector(s)"
