# Dynamo graph TopoStuff.dyn (Dynamo 0.7.0.6448)

select_model_elements = DSModelElementsSelection()  # 1 picked in the model
get_family_instances_by_category = Custom[Get Family Instances By Category]()
watch = Watch(get_family_instances_by_category)
filter_for_topo_subregions = Custom[Filter For Topo Subregions](Toposurface_s=watch)  # Filters out everything that is *not* a topo subregion. Needs Revit 2014 or newer to work.
watch_2 = Watch(filter_for_topo_subregions.Subregions)
watch_3 = Watch(filter_for_topo_subregions.bool)
# note: Ths example also requires the package Select By Category to be installed.
categories = Categories(index=852)
watch_4 = Watch(filter_for_topo_subregions.No_Subregions)
firstItem = List.FirstItem(watch_4)
topo_to_mesh = Custom[Topo To Mesh](Topo=firstItem)  # Extracts the mesh of a toposurface
watch_5 = Watch(topo_to_mesh)
identity = CoordinateSystem.Identity()
ZXPlane = CoordinateSystem.ZXPlane(identity, lacing=Longest)
identity_2 = CoordinateSystem.Identity()
YZPlane = CoordinateSystem.YZPlane(identity_2, lacing=Longest)
topo_plane_intersection = Custom[Topo-Plane Intersection](Plane=YZPlane, Topo=firstItem)  # Calculates the intersection of a toposurface and a plane
watch_6 = Watch(topo_plane_intersection.XYZs)
byCurve = ModelCurve.ByCurve(topo_plane_intersection.Nurbs_Spline, lacing=Longest)
