# Dynamo graph XYZAxisFromVector.dyn (Dynamo 0.7.0.6448)

double_slider = DoubleSlider(41.053, range=0..100)
double_slider_2 = DoubleSlider(55.311, range=0..100)
double_slider_3 = DoubleSlider(69.01, range=0..100)
byCoordinates = Vector.ByCoordinates(double_slider, double_slider_2, double_slider_3)
xyz_axis_from_vector = Custom[XYZ Axis From Vector](vector=byCoordinates)  # Returns whichever main axis (X, Y or Z) is closest to a given vector
watch = Watch(xyz_axis_from_vector)
components = Custom[Vector.Components](vector=byCoordinates)
watch_2 = Watch(components.Z)
watch_3 = Watch(components.Y)
watch_4 = Watch(components.X)
