# Dynamo custom node Vector.Components.dyf (Dynamo 0.7.0.6448)
# category: Geometry.Vector.Query

vector = Input()
X = Vector.X(vector)
X_2 = Output(X)  # "X"
Y = Vector.Y(vector)
Y_2 = Output(Y)  # "Y"
Z = Vector.Z(vector)
Z_2 = Output(Z)  # "Z"
