# Dynamo custom node XYZ Axis From Vector.dyf (Dynamo 0.7.0.6448)
# category: CAAD_RWTH.XYZ
# Returns whichever main axis (X, Y or Z) is closest to a given vector

XAxis = Vector.XAxis()
YAxis = Vector.YAxis()
ZAxis = Vector.ZAxis()
vector = Input()
asVector = Point.AsVector(vector)
normalized = Vector.Normalized(asVector)
components = Custom[Vector.Components](vector=vector)
formula = Formula("Abs(x)>Abs(y) && Abs(x)>Abs(z)", x=components.X, y=components.Y, z=components.Z, lacing=Longest)
XAxis_2 = Vector.XAxis()
formula_2 = Formula("Abs(y)>Abs(x) && Abs(y)>Abs(z)", y=components.Y, x=components.X, z=components.Z, lacing=Longest)
YAxis_2 = Vector.YAxis()
ZAxis_2 = Vector.ZAxis()
if_ = If(formula_2, YAxis_2, ZAxis_2)
if_2 = If(formula, XAxis_2, if_)
vector_2 = Output(if_2)  # "vector"
