# Dynamo custom node Elements to IDs.dyf (Dynamo 0.7.0.31047)
# category: CAAD_RWTH.Revit
# Gets the ID(s) for a list of Revit elements (or a single element)

Element_s = Input()  # "Element(s)"
turn_into_list = Custom[Turn Into List](item=Element_s)  # Turns an element into a (flat) list
python_script = Python(IN[0]=turn_into_list)
# ---------- python_script.python (18 lines) ----------
import clr
import sys
clr.AddReference('ProtoGeometry')
clr.AddReference('RevitAPI')
clr.AddReference('RevitAPIUI')
from Autodesk.DesignScript.Geometry import *
import Autodesk
from Autodesk.Revit.DB import *

elementlist = list()
unmatched = list()
for item in IN[0]:
	item = item.InternalElement
	try:
		elementlist.append(item.Id)
	except:
		unmatched.append(item)
OUT = (elementlist, unmatched)
# ----------------------------------------
firstItem = List.FirstItem(python_script)
return_list_or_single_value = Custom[Return List Or Single Value](list_1=turn_into_list, list_2=firstItem)  # If the list in input #1 has only one item, only the first item of the list in input #2 will be returned.
ID_s = Output(return_list_or_single_value)  # "ID(s)"
formula = Formula("1", lacing=Longest)
getItemAtIndex = List.GetItemAtIndex(python_script, formula)
unmatched = Output(getItemAtIndex)
