# Dynamo custom node IDs to Elements.dyf (Dynamo 0.7.0.31047)
# category: CAAD_RWTH.Revit
# Gets the Revit element(s) for a list of IDs (or a single ID)

ID_s = Input()  # "ID(s)"
turn_into_list = Custom[Turn Into List](item=ID_s)  # Turns an element into a (flat) list
current = Document.Current(lacing=Longest)
python_script = Python(IN[0]=current, IN[1]=turn_into_list)
# ---------- python_script.python (20 lines) ----------
import clr
import sys
clr.AddReference('ProtoGeometry')
clr.AddReference('RevitAPI')
clr.AddReference('RevitAPIUI')
from Autodesk.DesignScript.Geometry import *
import Autodesk
from Autodesk.Revit.DB import *

doc = IN[0].InternalDocument
items = IN[1]

elementlist = list()
unmatched = list()
for item in items:
	try: 
		elementlist.append(doc.GetElement(item))
	except:
		unmatched.append(item)
OUT = (elementlist, unmatched)
# ----------------------------------------
firstItem = List.FirstItem(python_script)
return_list_or_single_value = Custom[Return List Or Single Value](list_1=turn_into_list, list_2=firstItem)  # If the list in input #1 has only one item, only the first item of the list in input #2 will be returned.
Element_s = Output(return_list_or_single_value)  # "Element(s)"
formula = Formula("1", lacing=Longest)
getItemAtIndex = List.GetItemAtIndex(python_script, formula)
unmatched = Output(getItemAtIndex)
