# Dynamo graph IncrementDecrementByOne.dyn (Dynamo 0.7.0.31047)

number = DoubleInput(2)
n1 = Custom[-1](number)  # Decrements a value by 1
watch = Watch(n1)
n1_2 = Custom[+1](number)  # Increments a value by 1
watch_2 = Watch(n1_2)
