# Dynamo custom node Plus1.dyf (Dynamo 0.7.0.31047)
# category: CAAD_RWTH.Math
# Increments a value by 1

Input = Input()
formula = Formula("N+1", N=Input, lacing=Longest)
Output = Output(formula)  # ""
