# Dynamo graph LinesThroughPointsClosedLoop.dyn (Dynamo 0.7.0.6448)

number = DoubleInput(0)
byCoordinates = Point.ByCoordinates(number, number, number, lacing=Longest)
number_2 = DoubleInput(7)
byCoordinates_2 = Point.ByCoordinates(number_2, number, number, lacing=Longest)
byCoordinates_3 = Point.ByCoordinates(number_2, number_2, number, lacing=Longest)
byCoordinates_4 = Point.ByCoordinates(number, number_2, number, lacing=Longest)
create_list = List.Create(byCoordinates, byCoordinates_2, byCoordinates_3, byCoordinates_4)
lines_through_points_closed_loop = Custom[Lines Through Points (Closed Loop)](list=create_list)  # Works just like the built-in node Lines Through Points (creates a series of lines through a list of points) - except that it creates a *closed* loop of lines.
watch_3d = Watch3D(lines_through_points_closed_loop)
reverse = List.Reverse(create_list)
restOfItems = List.RestOfItems(reverse)
byStartPointEndPoint = Line.ByStartPointEndPoint(reverse, restOfItems)
watch_3d_2 = Watch3D(byStartPointEndPoint)
