# Dynamo custom node Lines Through Points (Closed Loop).dyf (Dynamo 0.7.0.6448)
# category: CAAD_RWTH.Revit
# Works just like the built-in node Lines Through Points (creates a series of lines through a list of points) - except that it creates a *closed* loop of lines.

reverse = List.Reverse()
restOfItems = List.RestOfItems(reverse)
list = Input()
number = DoubleInput(1)
shiftIndices = List.ShiftIndices(list, number)
byStartPointEndPoint = Line.ByStartPointEndPoint(list, shiftIndices)
lines = Output(byStartPointEndPoint)
