# Dynamo graph ListNotEmpty.dyn (Dynamo 0.7.0.31047)

empty = List.Empty()
list_not_empty = Custom[List Not Empty](list=empty)  # Just the inversion of the built-in Is Empty List node.
watch = Watch(list_not_empty)
number = DoubleInput(1..10)
list_not_empty_2 = Custom[List Not Empty](list=number)
watch_2 = Watch(list_not_empty_2)
