# Dynamo custom node List Not Empty.dyf (Dynamo 0.7.0.31047)
# category: CAAD_RWTH.Lists
# Just the inversion of the built-in Is Empty List node.

list = Input()
isEmpty = List.IsEmpty(list)
not_ = Not(isEmpty)
bool = Output(not_)
