# Dynamo graph ReturnListOrSingleValue.dyn (Dynamo 0.7.0.6448)

number = DoubleInput(1)
create_list = List.Create(number)
number_2 = DoubleInput(4)
create_list_2 = List.Create(number_2)
return_list_or_single_value = Custom[Return List Or Single Value](list_1=create_list, list_2=create_list_2)  # If the list in input #1 has only one item, only the first item of the list in input #2 will be returned.
watch = Watch(return_list_or_single_value)
number_3 = DoubleInput(1)
number_4 = DoubleInput(3)
create_list_3 = List.Create(number_3, number_4)
number_5 = DoubleInput(4)
number_6 = DoubleInput(2)
create_list_4 = List.Create(number_5, number_6)
return_list_or_single_value_2 = Custom[Return List Or Single Value](list_1=create_list_3, list_2=create_list_4)
watch_2 = Watch(return_list_or_single_value_2)
