# Dynamo custom node Return List Or Single Value.dyf (Dynamo 0.7.0.6448)
# category: CAAD_RWTH.Lists
# If the list in input #1 has only one item, only the first item of the list in input #2 will be returned.

list_1 = Input()  # "list #1"
count = List.Count(list_1)
formula = Formula("n>1", n=count, lacing=Longest)
list_2 = Input()  # "list #2"
isEmpty = List.IsEmpty(list_2)
empty = List.Empty()
firstItem = List.FirstItem(list_2)
if_ = If(isEmpty, empty, firstItem)
if_2 = If(formula, list_2, if_)
Output = Output(if_2)  # ""
