# Dynamo custom node Turn Into List.dyf (Dynamo 0.7.0.6448)
# category: CAAD_RWTH.Lists
# Turns an element into a (flat) list

item = Input()
empty = List.Empty()
addItemToFront = List.AddItemToFront(item, empty)
flatten = Flatten(addItemToFront)
