# Dynamo graph 1704-SelectRevitFace.dyn (Dynamo 0.7.0.6448)

select_model_element = DSModelElementSelection()  # 1 picked in the model
faces = Element.Faces(select_model_element)
deconstruct = List.Deconstruct(faces)
watch = Watch(deconstruct)
type_name = Custom[Type Name](watch)  # Gets the type of the given data as a string.
watch_2 = Watch(type_name)
select_face = DSFaceSelection()  # 1 picked in the model
watch_3 = Watch(select_face)
type_name_2 = Custom[Type Name](watch_3)
watch_4 = Watch(type_name_2)
