# Dynamo custom node Accumulate List.dyf (Dynamo 0.6.3.5256)
# category: Clockwork.Lists
# Accumulates the values of a given list and returns a list of the accumulated values

list = Input()
turn_into_list = Custom[Turn Into List](item=list)  # Turns an element into a list
python_script = Python(turn_into_list)
# ---------- python_script.python (11 lines) ----------
items = IN
elementlist = list()
counter = 0
while counter < len(items):
	if counter == 0:
		lastval = items[0]
	else:
		lastval = items[counter]+lastval
	elementlist.append(lastval)
	counter += 1
OUT = elementlist
# ----------------------------------------
list_2 = Output(python_script)  # "list"
