# Dynamo custom node Add Intersect To Divided Surface.dyf (Dynamo 0.6.3.5262)
# category: Clockwork.Revit.DividedSurfaces
# Adds an intersect to a divided surface

DivSurf = Input()
Element_s = Input()  # "Element(s)"
turn_into_list = Custom[Turn Into List](item=Element_s)  # Turns an element into a (flat) list
python_script_with_variable = Python(DivSurf, turn_into_list)  # "Python Script With Variable Number of Inputs"
# ---------- python_script_with_variable.python (11 lines) ----------
import clr
clr.AddReference('RevitAPI')
clr.AddReference('RevitAPIUI')
from Autodesk.Revit.DB import *
import Autodesk

divsurf = IN0
intersects = IN1
for item in intersects:
	divsurf.AddIntersectionElement(item.Id)
OUT = divsurf
# ----------------------------------------
DivSurf_2 = Output(python_script_with_variable)  # "DivSurf"
