# Dynamo custom node Alphabetical Sequence.dyf (Dynamo 0.6.3.31051)
# category: Clockwork.Strings
# Creates a list of the first N letters of the alphabet  (where 1 = A, 2 = B, ... , 27 = AA, 28 = AB etc.).

uppercase = Input()  # "uppercase?"
number_to_character = Custom[Number To Character](upper=uppercase)  # Converts a number into a character (where 1 = A, 2 = B, ... , 27 = AA, 28 = AB etc.).
n = Input()
number = DoubleInput(1..n, n, lacing=Longest)
map = Map(number_to_character, number)
letters = Output(map)
