# Dynamo custom node Altitude And Azimuth From Vector.dyf (Dynamo 0.6.3.22045)
# category: Clockwork.XYZ
# Computes the altitude and azimuth of a given vector

Deg_Rad = Input()  # "Deg/Rad"
z_axis = XyzBasisZ(lacing=Longest)
XYZ = Input()
unitize_xyz = XyzNormalize(XYZ, lacing=Longest)
turn_into_list = Custom[Turn Into List](item=unitize_xyz)  # Turns an element into a (flat) list
xyzs_almost_equal = Custom[XYZs Almost Equal](XYZ=z_axis, list=turn_into_list)  # Checks if any XYzs in a given list are almost equal (within a reasonable computational tolerance) to a specified XYZ.
first_of_list = First(xyzs_almost_equal)
z_axis_negative = Custom[Z Axis (Negative)]()  # Returns an XYZ of 0,0,-1
xyzs_almost_equal_2 = Custom[XYZs Almost Equal](XYZ=z_axis_negative, list=turn_into_list)
first_of_list_2 = First(xyzs_almost_equal_2)
xyz_z = XyzGetZ(unitize_xyz, lacing=Longest)
XYZ_2 = Xyz(lacing=Longest)
project_xyz_to_xy_plane = Custom[Project XYZ To XY Plane](xyz=unitize_xyz)  # Given an XYZ, make the Z value 0 - effectively projecting the XYZ to the XY plane.
solve_triangle_by_xyzs = Custom[Solve Triangle By XYZs](XYZ_A=unitize_xyz, XYZ_B=XYZ_2, XYZ_C=project_xyz_to_xy_plane)  # Solves a triangle based on the XYZ coordinates of its vertices.
formula = Formula("if(z<0,-x,x)", z=xyz_z, x=solve_triangle_by_xyzs.beta, lacing=Longest)
formula_2 = Formula("if(x=1,-pi/2,[else])", first_of_list_2, formula, lacing=Longest)
formula_3 = Formula("if(x=1,pi/2,[else])", first_of_list, formula_2, lacing=Longest)
radians_to_degrees = Custom[Radians To Degrees](rad=formula_3)  # Converts radians into degrees
if_ = Conditional(Deg_Rad, radians_to_degrees, formula_3)
Altitude = Output(if_)
xyz_x = XyzGetX(unitize_xyz, lacing=Longest)
y_axis = XyzBasisY(lacing=Longest)
solve_triangle_by_xyzs_2 = Custom[Solve Triangle By XYZs](XYZ_A=project_xyz_to_xy_plane, XYZ_B=XYZ_2, XYZ_C=y_axis)
formula_4 = Formula("if(x<0,2*pi-a,a)", x=xyz_x, a=solve_triangle_by_xyzs_2.beta, lacing=Longest)
radians_to_degrees_2 = Custom[Radians To Degrees](rad=formula_4)
if_2 = Conditional(Deg_Rad, radians_to_degrees_2, formula_4)
Azimuth = Output(if_2)
