# Dynamo custom node Angle Between Vectors.dyf (Dynamo 0.6.3.22045)
# category: Clockwork.XYZ
# Computes the angle between two vectors

Vector_1 = Input()  # "Vector #1"
Vector_2 = Input()  # "Vector #2"
xyz_dot_product = XyzDotProduct(Vector_1, Vector_2, lacing=Longest)
inverse_cosine = Acos(xyz_dot_product, lacing=Longest)
rad = Output(inverse_cosine)
