# Dynamo custom node Angle Bisector.dyf (Dynamo 0.6.2.279)
# category: Clockwork.XYZ
# Retrieves the vector of an angle bisector at point B based on three points (A, B, C) that define the angle.

XYZ_B = Input()  # "XYZ (B)"
XYZ_A = Input()  # "XYZ (A)"
xyz_start_end_vector = XyzStartEndVector(XYZ_B, XYZ_A, lacing=Longest)
XYZ_C = Input()  # "XYZ (C)"
xyz_start_end_vector_2 = XyzStartEndVector(XYZ_B, XYZ_C, lacing=Longest)
list = NewList(index0=xyz_start_end_vector, index1=xyz_start_end_vector_2)
average_xyz = XyzAverage(list)
add_xyz = XyzAdd(XYZ_B, average_xyz, lacing=Longest)
xyz_start_end_vector_3 = XyzStartEndVector(XYZ_B, add_xyz, lacing=Longest)
