# Dynamo custom node Angle By Angle Sum.dyf (Dynamo 0.6.3.5260)
# category: Clockwork.Math.Formulas
# Computes the missing interior angle of a *planar* polygon based on a given list of all other interior angles.

list = Input()
list_length = Length(list)
formula = Formula("n>1", n=list_length, lacing=Longest)
sum_list = Custom[Sum List](nums=list)
formula_2 = Formula("(n-1)*Pi-angles", n=list_length, angles=sum_list, lacing=Longest)
string = StringInput("The list needs to consist of at least two angles.")
if_ = Conditional(formula, formula_2, string)
angle = Output(if_)
