# Dynamo custom node Angle By Law Of Cosines.dyf (Dynamo 0.6.3.35252)
# category: Clockwork.Math.Formulas
# Computes an angle of a triangle using the law of cosines. A is the opposite side of the triangle while B and C are the sides forming the angle.

B = Input()
C = Input()
A = Input()
formula = Formula("Acos((Pow(b,2)+Pow(c,2)-Pow(a,2))/(2*b*c))", b=B, c=C, a=A, lacing=Longest)
alpha = Output(formula)
