# Dynamo custom node Angle By Law Of Sines.dyf (Dynamo 0.6.3.35252)
# category: Clockwork.Math.Formulas
# Determines the angle of a triangle based on the law of sines. (Alpha is the angle opposite side A and beta is the angle opposite side B...)

A = Input()
B = Input()
beta = Input()
formula = Formula("Asin(a/b*Sin(beta))", a=A, b=B, beta=beta, lacing=Longest)
alpha = Output(formula)
