# Dynamo custom node Aqua.dyf (Dynamo 0.6.3.5262)
# category: Clockwork.Colours
# Returns the colour aqua.

number = DoubleInput(0)
number_2 = DoubleInput(255)
color = Color(number, number, number_2, number_2, lacing=Longest)
n0_255_255 = Output(color)  # "0,255,255"
