# Dynamo custom node Binary To Decimal.dyf (Dynamo 0.6.2.279)
# category: Clockwork.Lists
# Converts a list of binary (boolean) values into a decimal value

list = Input()
list_length = Length(list)
formula = Formula("n-1", n=list_length, lacing=Longest)
number = DoubleInput(0..n, formula, lacing=Longest)
formula_2 = Formula("x*Pow(2,n)", x=list, n=number, lacing=Longest)
sum_list = Custom[Sum List](nums=formula_2)
decimal = Output(sum_list)
