# Dynamo custom node Black.dyf (Dynamo 0.6.3.5262)
# category: Clockwork.Colours
# Returns the colour black.

number = DoubleInput(0)
color = Color(number, number, number, number, lacing=Longest)
n0_0_0 = Output(color)  # "0,0,0"
