# Dynamo custom node Blue.dyf (Dynamo 0.6.3.5262)
# category: Clockwork.Colours
# Returns the colour blue.

number = DoubleInput(0)
number_2 = DoubleInput(255)
color = Color(number, number, number, number_2, lacing=Longest)
n0_0_255 = Output(color)  # "0,0,255"
