# Dynamo custom node Buckyball Coordinates.dyf (Dynamo 0.6.3.22045)
# category: Clockwork.Math.Buckyball
# Returns the coordinates of all the vertices of an (unscaled) truncated icosahedron.

number = DoubleInput(0)
list = NewList(index0=number)
number_2 = DoubleInput(1)
number_3 = DoubleInput(-1)
list_2 = NewList(index0=number_2, index1=number_3)
phi = Custom[phi]()  # The golden ratio, also known as the divine proportion, golden mean, or golden section, is a number often encountered when taking the ratios of distances in simple geometric figures such as the pentagon, pentagram, decagon and dodecahedron. It is denoted as phi. source: Wolfram - http://mathworld.wolfram.com/GoldenRatio.html
formula = Formula("3*phi", phi=phi, lacing=Longest)
formula_2 = Formula("-x", x=formula, lacing=Longest)
list_3 = NewList(index0=formula, index1=formula_2)
XYZ = Xyz(list, list_2, list_3, lacing=CrossProduct)
XYZ_2 = Xyz(list_2, list_3, list, lacing=CrossProduct)
XYZ_3 = Xyz(list_3, list, list_2, lacing=CrossProduct)
number_4 = DoubleInput(2)
number_5 = DoubleInput(-2)
list_4 = NewList(index0=number_4, index1=number_5)
formula_3 = Formula("1+2*phi", phi=phi, lacing=Longest)
formula_4 = Formula("-x", x=formula_3, lacing=Longest)
list_5 = NewList(index0=formula_3, index1=formula_4)
formula_5 = Formula("-x", x=phi, lacing=Longest)
list_6 = NewList(index0=phi, index1=formula_5)
XYZ_4 = Xyz(list_4, list_5, list_6, lacing=CrossProduct)
XYZ_5 = Xyz(list_5, list_6, list_4, lacing=CrossProduct)
XYZ_6 = Xyz(list_6, list_4, list_5, lacing=CrossProduct)
number_6 = DoubleInput(1)
number_7 = DoubleInput(-1)
list_7 = NewList(index0=number_6, index1=number_7)
formula_6 = Formula("2+phi", phi=phi, lacing=Longest)
formula_7 = Formula("-x", x=formula_6, lacing=Longest)
list_8 = NewList(index0=formula_6, index1=formula_7)
formula_8 = Formula("2*phi", phi=phi, lacing=Longest)
formula_9 = Formula("-x", x=formula_8, lacing=Longest)
list_9 = NewList(index0=formula_8, index1=formula_9)
XYZ_7 = Xyz(list_7, list_8, list_9, lacing=CrossProduct)
XYZ_8 = Xyz(list_8, list_9, list_7, lacing=CrossProduct)
XYZ_9 = Xyz(list_9, list_7, list_8, lacing=CrossProduct)
# note: The important thing in this node is to set the lacing options of all XYZ nodes to cross product.
list_10 = NewList(index0=XYZ, index1=XYZ_2, index2=XYZ_3, index3=XYZ_4, index4=XYZ_5, index5=XYZ_6, index6=XYZ_7, index7=XYZ_8, index8=XYZ_9)
flatten_completely = FlattenList(list_10)
XYZs = Output(flatten_completely)
