# Dynamo custom node Buckyball.dyf (Dynamo 0.6.3.22045)
# category: Clockwork.Math.Buckyball
# Returns all the data necessary for modeling a truncated icosahedron (vertices and struts) as well as the surface area and volume. Radius and origin of the object can be specified.

Origin = Input()
buckyball_coordinates = Custom[Buckyball Coordinates]()  # Returns the coordinates of all the vertices of an (unscaled) truncated icosahedron.
Radius = Input()
formula = Formula("1/4*sqrt(58+18*sqrt(5))", lacing=Longest)
# note: Determine scale factor based on radius
formula_2 = Formula("r/2/factor", r=Radius, factor=formula, lacing=Longest)
scale_xyz = XyzScale(buckyball_coordinates, formula_2, lacing=Longest)
# note: Add scale and origin for struts and vertices
add_xyzs = XyzAdd(Origin, scale_xyz, lacing=Longest)
# note: Find average XYZ for each strut and determine up vector from buckyball center for possible use in structural framing
Vertices = Output(add_xyzs)
average_xyzs = XyzAverage(lacing=Longest)
empty_list = Empty()
get_buckyball_struts = Custom[Get Buckyball Struts](list=buckyball_coordinates, struts=empty_list)  # Parses the vertices of an (unscaled) truncated icosahedron and returns a pair of XYZs for each strut.
scale_xyz_2 = XyzScale(get_buckyball_struts.struts, formula_2, lacing=Longest)
add_xyzs_2 = XyzAdd(Origin, scale_xyz_2, lacing=Longest)
map = Map(average_xyzs, add_xyzs_2)
direction_to_xyz = XyzStartEndVector(Origin, map, lacing=Longest)
Struts_Up_Vector = Output(direction_to_xyz)  # "Struts (Up Vector)"
transpose_lists = Transpose(add_xyzs_2)
first_of_list = First(transpose_lists)
number = DoubleInput(1)
get_from_list = GetFromList(number, transpose_lists)
# note: Create lines for the struts
line_by_endpoints = LineBound(first_of_list, get_from_list, lacing=Longest)
Struts_Lines = Output(line_by_endpoints)  # "Struts (Lines)"
Struts_XYZs = Output(add_xyzs_2)  # "Struts (XYZs)"
first_of_list_2 = First(first_of_list)
first_of_list_3 = First(get_from_list)
xyz_distance = XyzDistance(first_of_list_2, first_of_list_3, lacing=Longest)
formula_3 = Formula("(20*3/2*sqrt(3)+12*5/4*sqrt(1+2/sqrt(5)))*Pow(a,2)", a=xyz_distance, lacing=Longest)
area_from_number = AreaFromNumber(formula_3, lacing=Longest)
Surface_Area = Output(area_from_number)
# note: Compute surface area and volume based on strut length
formula_4 = Formula("1/4*(125+43*sqrt(5))*Pow(a,3)", a=xyz_distance, lacing=Longest)
volume_from_number = VolumeFromNumber(formula_4, lacing=Longest)
Volume = Output(volume_from_number)
