# Dynamo custom node Build Irregular Sublists.dyf (Dynamo 0.6.3.5260)
# category: Clockwork.Lists.Sublists
# Turns a list into a list of lists with sublists of varying lengths.

list = Input()
lengths = Input()
python_script_with_variable = Python(list, lengths)  # "Python Script With Variable Number of Inputs"
# ---------- python_script_with_variable.python (13 lines) ----------
inputlist = IN0
listlengths = IN1
rowcounter = 0
elementlist = list()
for item in listlengths:
	itemcounter = 0
	itemlist = list()
	while itemcounter < item:
		itemlist.append(inputlist[rowcounter])
		rowcounter += 1
		itemcounter += 1
	elementlist.append(itemlist)
OUT = elementlist
# ----------------------------------------
list_2 = Output(python_script_with_variable)  # "list"
