# Dynamo custom node Build Path Graph.dyf (Dynamo 0.6.3.7375)
# category: Clockwork.Math.Graphs
# Builds a path graph (Python dictionary) from a list of value pairs.

first_of_list = First()
connections_str = Input()  # "connections (str)"
map = Map(first_of_list, connections_str)
number = DoubleInput(1)
get_from_list = GetFromList(number)
map_2 = Map(get_from_list, connections_str)
join_lists = Append(map, map_2)
# note: Get a list of distinct indices
remove_duplicates = Custom[remove duplicates](list=join_lists)  # removes duplicate data from a list
reverse = Reverse()
map_3 = Map(reverse, connections_str)
# note: Get a flat list of paths
join_lists_2 = Append(connections_str, map_3)
python_script_with_variable = Python(remove_duplicates, join_lists_2)  # "Python Script With Variable Number of Inputs"
# ---------- python_script_with_variable.python (14 lines) ----------
indices = IN0
flatlist = IN1
pathgraph = dict()

# script found here:
# https://www.python.org/doc/essays/graphs/

for index in indices:
	indexlist = list()
	for item in flatlist:
		if index == item[0]:
			indexlist.append(item[1])
	pathgraph[index] = indexlist	
OUT = pathgraph
# ----------------------------------------
pathgraph = Output(python_script_with_variable)
