# Dynamo custom node Build Triangular Sublists.dyf (Dynamo 0.6.3.7375)
# category: Clockwork.Patterning.Helpers
# Creates sublists of three items each from a list based on given indices, shift and reverse settings and offset.

list = Input()
offset = Input()
index0 = Input()
index1 = Input()
index2 = Input()
# note: Create default placement patterns (counter-clockwise)
list_2 = NewList(index0=index0, index1=index1, index2=index2)
shift = Input()
reverse = Input()
shift_placement_and_reverse = Custom[Shift Placement And Reverse](list=list_2, shift=shift, reverse=reverse)  # Shifts (integer) and reverses (bool) a given list
get_first_three_indices = Custom[Get First Three Indices](list=shift_placement_and_reverse)  # Gets the first three indices of a given list
# note: Create sublists using placement pattern
build_sublists = Sublists("a,b,c", list, offset, get_first_three_indices.0, get_first_three_indices.1, get_first_three_indices.2, lacing=Longest)
list_3 = Output(build_sublists)  # "list"
