# Dynamo custom node CSV To List.dyf (Dynamo 0.6.3.7375)
# category: Clockwork.Strings
# Converts the content of a given CSV file to a list

ignore_last_column = Input()
take_from_list = TakeList()
ignore_last_row = Input()
ignore_first_row = Input()
delimiter = Input()
split_string = SplitString(arg1=delimiter)
CSV_string = Input()
string = StringInput("\n")
split_string_2 = SplitString(CSV_string, string)
map = Map(split_string, split_string_2)
rest_of_list = Rest(map)
if_ = Conditional(ignore_first_row, rest_of_list, map)
list_length = Length(if_)
n1 = Custom[-1](list_length)  # Decrements a value by 1
take_from_list_2 = TakeList(n1, if_)
if_2 = Conditional(ignore_last_row, take_from_list_2, if_)
get_sublist_lengths = Custom[Get Sublist Lengths](list=if_2)  # Gets the lengths of all sublists in a given list of lists.
n1_2 = Custom[-1](get_sublist_lengths)
combine = Combine(take_from_list, n1_2, if_2)
if_3 = Conditional(ignore_last_column, combine, if_2)
list = Output(if_3)
