# Dynamo custom node Category Is Visible In View.dyf (Dynamo 0.6.3.5263)
# category: Clockwork.Revit.Views
# Checks if a given category is visible in a given view

revit_document = RevitDocument(lacing=Longest)
BuiltInCategories = Input()
turn_into_list = Custom[Turn Into List](item=BuiltInCategories)  # Turns an element into a list
View_s = Input()  # "View(s)"
turn_into_list_2 = Custom[Turn Into List](item=View_s)
python_script_with_variable = Python(revit_document, turn_into_list, turn_into_list_2)  # "Python Script With Variable Number of Inputs"
# ---------- python_script_with_variable.python (26 lines) ----------
import clr
clr.AddReference('RevitAPI')
clr.AddReference('RevitAPIUI')
from Autodesk.Revit.DB import *
import Autodesk

doc = IN0
cats = IN1
views = IN2
cats2 = doc.Settings.Categories

elementlist = list()
for cat in cats:
	catlist = list()
	for view in views:
		try:
			if view.GetVisibility(cats2.get_Item(cat)):
				catlist.append(1)
			else:
				catlist.append(0)
		# some view types (like images, for example) will throw an exception.
		# if we're not sure let's return false		
		except:
			catlist.append(0)
	elementlist.append(catlist)
OUT = elementlist
# ----------------------------------------
bool = Output(python_script_with_variable)
