# Dynamo custom node Central Projection On Face.dyf (Dynamo 0.6.3.7375)
# category: Clockwork.XYZ
# Projects a list of points onto a given face

# note: Only keep first intersection (surface might be shaped in such a way that multiple intersections occur)
first_of_list = First()
Central_Projection_Point = Input()
number = DoubleInput(1)
# note: Find the face/plane of the bounding box the normal of which is closest to the general direction of projection - this plane will be more orthogonal to the projection than any other plane. (Nice side-effect: of two parallel planes, it will always be the one that's further away from the point of projection)
first_of_list_2 = First()
Face = Input()
get_element_by_face = Custom[Get Element By Face](Face_s=Face)  # Returns the underlying Revit element of a given face
# note: Get the bounding box of the element and create a solid from it
get_bounding_box = Custom[Get Bounding Box](Element_s=get_element_by_face)  # Gets the bounding box of a Revit element
box_by_two_corners = SolidBoxByTwoCorners(get_bounding_box.bottom_left_rear_corner, get_bounding_box.top_right_front_corner, lacing=Longest)
get_faces_from_solid = Custom[Get Faces From Solid](Solid_s=box_by_two_corners)  # Retrieves a list of faces from a given solid
plane_from_planar_face = Custom[Plane From Planar Face](Planar_face_s=get_faces_from_solid)  # Creates a plane from a planar face
Points_to_be_projected = Input()
xyzs_almost_equal = Custom[XYZs Almost Equal](XYZ=Central_Projection_Point, list=Points_to_be_projected)  # Checks if any XYzs in a given list are almost equal (within a reasonable computational tolerance) to a specified XYZ.
# note: Filter out XYZs that coincide with the point of projection
filter_by_boolean_mask = FilterMask(Points_to_be_projected, xyzs_almost_equal)
# note: Determine the average direction of the projection
average_xyzs = XyzAverage(filter_by_boolean_mask.out1, lacing=Longest)
direction_to_xyz = XyzStartEndVector(Central_Projection_Point, average_xyzs, lacing=Longest)
angle_between_vectors = Custom[Angle Between Vectors](Vector_1=plane_from_planar_face.Normal_s, Vector_2=direction_to_xyz)  # Computes the angle between two vectors
list = NewList(index0=plane_from_planar_face.Plane_s, index1=plane_from_planar_face.Origin_s, index2=plane_from_planar_face.Normal_s, index3=angle_between_vectors)
number_2 = DoubleInput(3)
boolean = BoolSelector(false)
sort_list_of_lists = Custom[Sort List Of Lists](List_of_lists=list, Sort_index=number_2, Case_insensitive=boolean, Order_Descending=boolean)  # Sorts a list of lists by one of its sublists
map = Map(first_of_list_2, sort_list_of_lists)
get_from_list = GetFromList(number, map)
number_3 = DoubleInput(2)
get_from_list_2 = GetFromList(number_3, map)
# note: Find intersection points between projections and the bounding box plane
plane_vector_intersection = Custom[Plane-Vector Intersection](Vector_Basepoint=Central_Projection_Point, Plane_Origin=get_from_list, Plane_Normal=get_from_list_2)  # Finds the intersection point between a plane and a vector
direction_to_xyz_2 = XyzStartEndVector(Central_Projection_Point, filter_by_boolean_mask.out1, lacing=Longest)
map_2 = Map(plane_vector_intersection.XYZ, direction_to_xyz_2)
# note: Create lines between bounding box plane and point of projection
line_by_endpoints = LineBound(Central_Projection_Point, map_2, lacing=Longest)
# note: Find intersections on surface
curve_face_intersection = CurveFaceIntersection(line_by_endpoints, Face, lacing=Longest)
map_3 = Map(first_of_list, curve_face_intersection.out1)
is_null = IsNull()
# note: Remove non-intersections from list (depending on location of point of projection there may not be an intersection for each projected point)
map_4 = Map(is_null, map_3)
filter_by_boolean_mask_2 = FilterMask(map_3, map_4)
XYZs = Output(filter_by_boolean_mask_2.out1)
