# Dynamo custom node Central Projection On Plane.dyf (Dynamo 0.6.3.7375)
# category: Clockwork.XYZ
# Projects a list of points onto a given plane

Central_Projection_Point = Input()
Points_to_be_projected = Input()
direction_to_xyz = XyzStartEndVector(Central_Projection_Point, Points_to_be_projected, lacing=Longest)
Plane_Origin = Input()
Plane_Normal = Input()
plane_vector_intersection = Custom[Plane-Vector Intersection](Vector_Basepoint=Central_Projection_Point, Vector_Normalized=direction_to_xyz, Plane_Origin=Plane_Origin, Plane_Normal=Plane_Normal)  # Finds the intersection point between a plane and a vector
XYZs = Output(plane_vector_intersection.XYZ)
