# Dynamo custom node Combine List With Nested List.dyf (Dynamo 0.6.3.7375)
# category: Clockwork.Lists.Sublists
# Works like the built-in Combine node, but for functions that would expect a single element as the first input and a list as the second input.

f_x_y = Input()  # "f(x,y)"
list = Input()
nested_list = Input()
list_2 = NewList(index0=list, index1=nested_list)
equal_list_lengths = Custom[Equal List Lengths](lists=list_2)  # Trims all given lists to the length of the shortest list
first_of_list = First(equal_list_lengths)
number = DoubleInput(1)
get_from_list = GetFromList(number, equal_list_lengths)
python_script_with_variable = Python(f_x_y, first_of_list, get_from_list)  # "Python Script With Variable Number of Inputs"
# ---------- python_script_with_variable.python (15 lines) ----------
import clr

func = IN0
items = IN1
nesteditems = IN2
i = 0
elementlist = list()

for item in items:
	nestedlist = list()
	for nesteditem in nesteditems[i]:
		nestedlist.append(func(item,nesteditem))
	elementlist.append(nestedlist)
	i += 1
OUT = elementlist
# ----------------------------------------
result = Output(python_script_with_variable)
