# Dynamo custom node Combine Two Nested Lists.dyf (Dynamo 0.6.3.7375)
# category: Clockwork.Lists.Sublists
# In some cases I have found the built-in Combine node to struggle with nested lists. In cases like these, this node should do the trick.

f_x_y = Input()  # "f(x,y)"
nested_list_1 = Input()  # "nested list #1"
nested_list_2 = Input()  # "nested list #2"
list = NewList(index0=nested_list_1, index1=nested_list_2)
equal_list_lengths = Custom[Equal List Lengths](lists=list)  # Trims all given lists to the length of the shortest list
first_of_list = First(equal_list_lengths)
number = DoubleInput(1)
get_from_list = GetFromList(number, equal_list_lengths)
python_script_with_variable = Python(f_x_y, first_of_list, get_from_list)  # "Python Script With Variable Number of Inputs"
# ---------- python_script_with_variable.python (12 lines) ----------
import clr

func = IN0
nestedseq = IN1
nestedbool = IN2
i = 0
elementlist = list()

for item in nestedseq:
	elementlist.append(func(item,nestedbool[i]))
	i += 1
OUT = elementlist
# ----------------------------------------
result = Output(python_script_with_variable)
