# Dynamo custom node Compound Structure Has Variable Layer.dyf (Dynamo 0.6.3.5262)
# category: Clockwork.Revit.Roof & Floor
# Checks if the compound structure of a given floor or roof instance contains a variable layer.

Element_Type_s = Input()  # "Element Type(s)"
turn_into_list = Custom[Turn Into List](item=Element_Type_s)  # Turns an element into a list
python_script = Python(turn_into_list)
# ---------- python_script.python (17 lines) ----------
import clr
clr.AddReference('RevitAPI')
clr.AddReference('RevitAPIUI')
from Autodesk.Revit.DB import *
import Autodesk

elemtypes = IN
elementlist = list()
for item in elemtypes:
	try:
		if item.GetCompoundStructure().VariableLayerIndex == -1:
			elementlist.append(0)
		else:
			elementlist.append(1)
	except:
		elementlist.append(0)
OUT = elementlist
# ----------------------------------------
return_list_or_single_value = Custom[Return List Or Single Value](list_1=turn_into_list, list_2=python_script)  # If the list in input #1 has only one item, only the first item of the list in input #2 will be returned.
bool = Output(return_list_or_single_value)
