# Dynamo custom node Convex Hull 2D.dyf (Dynamo 0.6.3.7375)
# category: Clockwork.XYZ
# Computes the convex hull of a given set of UV coordinates based on the monotone chain algorithm

UVs = Input()
uv_components = Custom[UV Components](UV_s=UVs)  # Get the components of a UV
list = NewList(index0=uv_components.U, index1=uv_components.V)
transpose_lists = Transpose(list)
python_script = Python(transpose_lists)
# ---------- python_script.python (43 lines) ----------
# Default imports
import clr
clr.AddReference('RevitAPI')
clr.AddReference('RevitAPIUI')
from Autodesk.Revit.DB import *
import Autodesk
import sys
import clr
path = r'C:\Autodesk\Dynamo\Core'
exec_path = r'C:\Autodesk\Dynamo\Core\dll'
sys.path.append(path)
sys.path.append(exec_path)
clr.AddReference('LibGNet')
from Autodesk.LibG import *

# based on a script found here:
# http://en.wikibooks.org/wiki/Algorithm_Implementation/Geometry/Convex_hull/Monotone_chain#Python

points = IN
#reformat points list
newpoints = list()
for pair in points:
	newpoint = (pair[0],pair[1])
	newpoints.append(newpoint)
points = sorted(set(newpoints))

def cross(o, a, b):
	return (a[0] - o[0]) * (b[1] - o[1]) - (a[1] - o[1]) * (b[0] - o[0])
 
if len(points) <= 1:
	OUT = points
else:
	lower = []
	for p in points:
		while len(lower) >= 2 and cross(lower[-2], lower[-1], p) <= 0:
			lower.pop()
		lower.append(p)
	upper = []
	for p in reversed(points):
		while len(upper) >= 2 and cross(upper[-2], upper[-1], p) <= 0:
			upper.pop()
		upper.append(p)
	OUT = lower[:-1] + upper[:-1]
# ----------------------------------------
transpose_lists_2 = Transpose(python_script)
first_of_list = First(transpose_lists_2)
number = DoubleInput(1)
get_from_list = GetFromList(number, transpose_lists_2)
UV = Uv(first_of_list, get_from_list, lacing=Longest)
UVs_2 = Output(UV)  # "UVs"
