# Dynamo custom node Correct Normal Orientation.dyf (Dynamo 0.6.3.22045)
# category: Clockwork.XYZ
# Inverts normal A if its inversion is closer to normal B

a = Input()
unitize_xyz = XyzNormalize(a, lacing=Longest)
b = Input()
unitize_xyz_2 = XyzNormalize(b, lacing=Longest)
xyz_dot_product = XyzDotProduct(unitize_xyz, unitize_xyz_2, lacing=Longest)
formula = Formula("x>0", x=xyz_dot_product, lacing=Longest)
negate_xyz = XyzNegate(unitize_xyz, lacing=Longest)
if_ = Conditional(formula, unitize_xyz, negate_xyz)
normal = Output(if_)
