# Dynamo custom node Count Sequences Of True Or False.dyf (Dynamo 0.6.3.7375)
# category: Clockwork.Lists
# Retrieves the lengths of uninterrupted sequences of booleans (true or false) in a given list.

formula = Formula("n>0", lacing=Longest)
True_False = Input()  # "True/False"
booleans = Input()
turn_into_list = Custom[Turn Into List](item=booleans)  # Turns an element into a (flat) list
invert_normalized_value = Custom[Invert Normalized Value](turn_into_list)  # Inverts a value between 0 and 1 or a boolean to its opposite (1-x)
if_ = Conditional(True_False, turn_into_list, invert_normalized_value)
python_script = Python(if_)
# ---------- python_script.python (27 lines) ----------
# Default imports
import clr
clr.AddReference('RevitAPI')
clr.AddReference('RevitAPIUI')
from Autodesk.Revit.DB import *
import Autodesk
import sys
import clr
path = r'C:\Autodesk\Dynamo\Core'
exec_path = r'C:\Autodesk\Dynamo\Core\dll'
sys.path.append(path)
sys.path.append(exec_path)
clr.AddReference('LibGNet')
from Autodesk.LibG import *

booleans = IN
elementlist = list()
elementlist.append(0)
counter = 0

for item in booleans:
	if item == 1:
		elementlist[counter] += 1
	elif item == 0:
		counter += 1
		elementlist.append(0)
OUT = elementlist
# ----------------------------------------
filter = FilterInAndOut(formula, python_script)
lengths = Output(filter)
