# Dynamo custom node Count True And False.dyf (Dynamo 0.6.3.31052)
# category: Clockwork.Lists
# Counts the occurences of True and False in a list of booleans

booleans = Input()
filter_by_boolean_mask = FilterMask(booleans, booleans)
list_length = Length(filter_by_boolean_mask.out0)
true = Output(list_length)
list_length_2 = Length(filter_by_boolean_mask.out1)
false = Output(list_length_2)
