# Dynamo custom node Create New Subcategory.dyf (Dynamo 0.6.3.5262)
# category: Clockwork.Revit.Subcategories
# Creates a new subcategory for a given element category (unless a subcategory of that name already exists - in that case it returns the existing subcategory)

revit_document = RevitDocument(lacing=Longest)
BuiltInCategory = Input()
Name = Input()
python_script_with_variable = Python(revit_document, BuiltInCategory, Name)  # "Python Script With Variable Number of Inputs"
# ---------- python_script_with_variable.python (15 lines) ----------
import clr
clr.AddReference('RevitAPI')
clr.AddReference('RevitAPIUI')
from Autodesk.Revit.DB import *
import Autodesk

doc = IN0
builtincat = IN1
subcatname = IN2

cat = doc.Settings.Categories.get_Item(builtincat)
try:
	OUT = cat.SubCategories.get_Item(subcatname)
except:
	OUT = doc.Settings.Categories.NewSubcategory(cat, subcatname)
# ----------------------------------------
transaction = Transaction(python_script_with_variable)
Subcategory = Output(transaction)
