# Dynamo custom node Create Placeholder Sheets.dyf (Dynamo 0.6.3.7375)
# category: Clockwork.Revit
# Creates placeholder sheets

Sheet_Number_s = Input()  # "Sheet Number(s)"
turn_into_list = Custom[Turn Into List](item=Sheet_Number_s)  # Turns an element into a list
Sheet_Name_s = Input()  # "Sheet Name(s)"
turn_into_list_2 = Custom[Turn Into List](item=Sheet_Name_s)
list = NewList(index0=turn_into_list, index1=turn_into_list_2)
equal_list_lengths = Custom[Equal List Lengths](lists=list)  # Trims all given lists to the length of the shortest list
first_of_list = First(equal_list_lengths)
last_of_list = Last(equal_list_lengths)
revit_document = RevitDocument(lacing=Longest)
python_script_with_variable = Python(first_of_list, last_of_list, revit_document)  # "Python Script With Variable Number of Inputs"
# ---------- python_script_with_variable.python (19 lines) ----------
import clr
clr.AddReference('RevitAPI')
clr.AddReference('RevitAPIUI')
from Autodesk.Revit.DB import *
import Autodesk

sheetnums = IN0
sheetnames = IN1
doc = IN2
elementlist = list()
counter = 0

for num in sheetnums:
	newsheet = ViewSheet.CreatePlaceholder(doc)
	newsheet.SheetNumber = num
	newsheet.Name = sheetnames[counter]
	elementlist.append(newsheet)
	counter += 1
OUT = elementlist
# ----------------------------------------
return_list_or_single_value = Custom[Return List Or Single Value](list_1=first_of_list, list_2=python_script_with_variable)  # If the list in input #1 has only one item, only the first item of the list in input #2 will be returned.
Sheet_s = Output(return_list_or_single_value)  # "Sheet(s)"
