# Dynamo custom node Cubic Feet To Cubic Meters.dyf (Dynamo 0.6.3.5263)
# category: Clockwork.Conversion.Volume
# Converts cubic feet into cubic meters

cu_ft = Input()
formula = Formula("cuft*0.028316846592", cuft=cu_ft, lacing=Longest)
m3 = Output(formula)
