# Dynamo custom node Cubic Meters To Cubic Feet.dyf (Dynamo 0.6.3.5263)
# category: Clockwork.Conversion.Volume
# Converts cubic meters into cubic feet

m3 = Input()
formula = Formula("m3/0.028316846592", m3=m3, lacing=Longest)
cu_ft = Output(formula)
