# Dynamo custom node Curve Array.dyf (Dynamo 0.6.3.7375)
# category: Clockwork.Revit.Curves
# Creates a curve array from a list of curves

Curve_s = Input()  # "Curve(s)"
turn_into_list = Custom[Turn Into List](item=Curve_s)  # Turns an element into a (flat) list
python_script = Python(turn_into_list)
# ---------- python_script.python (11 lines) ----------
import clr
clr.AddReference('RevitAPI')
clr.AddReference('RevitAPIUI')
from Autodesk.Revit.DB import *
import Autodesk

curves = IN
curvearray = CurveArray()
for curve in curves:
	curvearray.Append(curve)
OUT = curvearray
# ----------------------------------------
Curve_Array = Output(python_script)
