# Dynamo custom node Degrees To Radians.dyf (Dynamo 0.6.3.5260)
# category: Clockwork.Conversion.Angle
# Converts degrees into radians

deg = Input()
formula = Formula("degrees*Pi/180", degrees=deg, lacing=Longest)
rad = Output(formula)
