# Dynamo custom node Dispatch.dyf
# category: Clockwork.Conditional
# Dispatches a value to one of two output ports (true/false) depending on a condition. The other output  port will return an empty list.

test = Input()
value = Input()
empty_list = Empty()
if_ = Conditional(test, value, empty_list)
true = Output(if_)
if_2 = Conditional(test, empty_list, value)
false = Output(if_2)
