# Dynamo custom node Distance From Point Sequence.dyf (Dynamo 0.6.3.7375)
# category: Clockwork.XYZ
# Retrieves the accumulated distances of a sequence of points

XYZs = Input()
list_length = Length(XYZs)
formula = Formula("n<2", n=list_length, lacing=Longest)
number = DoubleInput(0)
formula_2 = Formula("n-1", n=list_length, lacing=Longest)
take_from_list = TakeList(formula_2, XYZs)
rest_of_list = Rest(XYZs)
xyz_distance = XyzDistance(take_from_list, rest_of_list, lacing=Longest)
sum_list = Custom[Sum List](nums=xyz_distance)
if_ = Conditional(formula, number, sum_list)
distance = Output(if_)
