# Dynamo custom node Door Sequence From Room Sequence.dyf (Dynamo 0.6.3.7375)
# category: Clockwork.Revit.Rooms
# Retrieves a sequence of doors connecting a given sequence of rooms (if possible)

Rooms = Input()
turn_into_list = Custom[Turn Into List](item=Rooms)  # Turns an element into a (flat) list
elements_to_ids = Custom[Elements to IDs](Element_s=turn_into_list)  # Gets the ID(s) for a list of Revit elements (or a single element)
Doors = Input()
turn_into_list_2 = Custom[Turn Into List](item=Doors)
elements_to_ids_2 = Custom[Elements to IDs](Element_s=turn_into_list_2)
turn_into_list_3 = Custom[Turn Into List](item=elements_to_ids_2.UniqueID)
Phase = Input()
rooms_from_doors_and_windows = Custom[Rooms From Doors And Windows](Door_s_Window_s=turn_into_list_2, Phase=Phase)  # Gets the rooms that are connected by a given door or a window
elements_to_ids_3 = Custom[Elements to IDs](Element_s=rooms_from_doors_and_windows.From_Room_s)
turn_into_list_4 = Custom[Turn Into List](item=elements_to_ids_3.UniqueID)
elements_to_ids_4 = Custom[Elements to IDs](Element_s=rooms_from_doors_and_windows.To_Room_s)
turn_into_list_5 = Custom[Turn Into List](item=elements_to_ids_4.UniqueID)
python_script_with_variable = Python(elements_to_ids.UniqueID, turn_into_list_3, turn_into_list_4, turn_into_list_5)  # "Python Script With Variable Number of Inputs"
# ---------- python_script_with_variable.python (17 lines) ----------
import clr

rooms = IN0
doors = IN1
fromroom = IN2
toroom = IN3
elementlist = list()

i = 0
while i < (len(rooms)-1):
	j = 0
	while j < len(doors):
		if (rooms[i] == fromroom[j] and rooms[i+1] == toroom[j]) or (rooms[i+1] == fromroom[j] and rooms[i] == toroom[j]):
			elementlist.append(doors[j])
		j += 1
	i += 1
OUT = elementlist
# ----------------------------------------
ids_to_elements = Custom[IDs to Elements](ID_s=python_script_with_variable)  # Gets the Revit element(s) for a list of IDs (or a single ID)
turn_into_list_6 = Custom[Turn Into List](item=ids_to_elements.Element_s)
Doors_2 = Output(turn_into_list_6)  # "Doors"
