# Dynamo custom node Drop Last Row And Column From UV Field.dyf (Dynamo 0.6.3.7375)
# category: Clockwork.Panelling.Helpers
# Drops the last row and column from a UV field

V = Input()
list = Input()
list_length = Length(list)
formula = Formula("All-V", All=list_length, V=V, lacing=Longest)
take_from_list = TakeList(formula, list)
number = DoubleInput(0)
drop_every_nth = RemoveEveryNth(V, take_from_list, number)
