# Dynamo custom node Duplicate View.dyf (Dynamo 0.6.3.7375)
# category: Clockwork.Revit.Views
# Duplicates a given view. Duplication options: 0 = Duplicate, 1 = Duplicate with Detailing, 2 = Duplicate as Dependent View. Probably needs to be used in conjunction with a Transaction node.

view_s = Input()  # "view(s)"
turn_into_list = Custom[Turn Into List](item=view_s)  # Turns an element into a (flat) list
duplication_option = Input()
python_script_with_variable = Python(turn_into_list, duplication_option)  # "Python Script With Variable Number of Inputs"
# ---------- python_script_with_variable.python (19 lines) ----------
import clr
clr.AddReference('RevitAPI')
clr.AddReference('RevitAPIUI')
from Autodesk.Revit.DB import *
import Autodesk

views = IN0
option = IN1
elementlist = list()
if option == 1:
	dupopt = Autodesk.Revit.DB.ViewDuplicateOption.WithDetailing
elif option == 2:
	dupopt = Autodesk.Revit.DB.ViewDuplicateOption.AsDependent
else:
	dupopt = Autodesk.Revit.DB.ViewDuplicateOption.Duplicate
for view in views:
	newview = view.Duplicate(dupopt)
	elementlist.append(newview)
OUT = elementlist
# ----------------------------------------
ids_to_elements = Custom[IDs to Elements](ID_s=python_script_with_variable)  # Gets the Revit element(s) for a list of IDs (or a single ID)
view_s_2 = Output(ids_to_elements.Element_s)  # "view(s)"
