# Dynamo custom node Element Has Transparent Materials.dyf (Dynamo 0.6.3.7375)
# category: Clockwork.Revit.Material
# Checks if a given element contains transparent materials.

true_for_any_boolean = Custom[True For Any (Boolean)]()  # Returns true if any item in a list of booleans is true.
Min_Transparency = Input()  # "Min. Transparency (%)"
formula = Formula("x>y", y=Min_Transparency, lacing=Longest)
get_material_properties = Custom[Get Material Properties]()  # Retrieves a number of properties froma given material
Element_s = Input()  # "Element(s)"
turn_into_list = Custom[Turn Into List](item=Element_s)  # Turns an element into a (flat) list
boolean = BoolSelector(false)
get_materials_from_element = Custom[Get Materials From Element](Element_s=turn_into_list, Include_paint_materials=boolean)  # Retrieves all materials froma given element
map = Map(get_material_properties.Transparency, get_materials_from_element.Materials)
map_2 = Map(formula, map)
map_3 = Map(true_for_any_boolean, map_2)
bool = Output(map_3)
