# Dynamo custom node Elements to IDs.dyf (Dynamo 0.6.3.7375)
# category: Clockwork.Revit
# Gets the ID(s) for a list of Revit elements (or a single element)

Element_s = Input()  # "Element(s)"
turn_into_list = Custom[Turn Into List](item=Element_s)  # Turns an element into a list
python_script = Python(turn_into_list)
# ---------- python_script.python (17 lines) ----------
# Default imports
import clr
clr.AddReference('RevitAPI')
clr.AddReference('RevitAPIUI')
from Autodesk.Revit.DB import *
import Autodesk

elementlist = list()
uniquelist = list()
unmatched = list()
for item in IN:
	try:
		elementlist.append(item.Id)
		uniquelist.append(item.UniqueId)
	except:
		unmatched.append(item)
OUT = (elementlist, uniquelist, unmatched)
# ----------------------------------------
first_of_list = First(python_script)
return_list_or_single_value = Custom[Return List Or Single Value](list_1=turn_into_list, list_2=first_of_list)  # If the list in input #1 has only one item, only the first item of the list in input #2 will be returned.
ID_s = Output(return_list_or_single_value)  # "ID(s)"
formula = Formula("1", lacing=Longest)
get_from_list = GetFromList(formula, python_script)
return_list_or_single_value_2 = Custom[Return List Or Single Value](list_1=turn_into_list, list_2=get_from_list)
UniqueID = Output(return_list_or_single_value_2)
formula_2 = Formula("2", lacing=Longest)
get_from_list_2 = GetFromList(formula_2, python_script)
unmatched = Output(get_from_list_2)
