# Dynamo custom node Equal List Lengths.dyf (Dynamo 0.6.3.7375)
# category: Clockwork.Lists.Sublists
# Trims all given lists to the length of the shortest list

lists = Input()
get_sublist_lengths = Custom[Get Sublist Lengths](list=lists)  # Gets the lengths of all sublists in a given list of lists.
get_highest_and_lowest_from_list = Custom[Get Highest And Lowest From List](list=get_sublist_lengths)  # Gets the highest and lowest value from a given list
take_from_list = TakeList(get_highest_and_lowest_from_list.lowest)
map = Map(take_from_list, lists)
lists_2 = Output(map)  # "lists"
