# Dynamo custom node Evaluate Divided Surface Grid Nodes.dyf (Dynamo 0.6.3.7375)
# category: Clockwork.Revit.DividedSurfaces
# Returns UV and XYZ coordinates as well as surface normals for all grid nodes of a given divided surface. Also returns the underlying face and the UV count. PLEASE NOTE: Does not run in Revit version prior to 2014.

DS = Input()
include_overhanging_nodes = Input()  # "include overhanging nodes?"
python_script_with_variable = Python(DS, include_overhanging_nodes)  # "Python Script With Variable Number of Inputs"
# ---------- python_script_with_variable.python (39 lines) ----------
import clr
clr.AddReference('RevitAPI')
clr.AddReference('RevitAPIUI')
from Autodesk.Revit.DB import *
import Autodesk

ds = IN0
overhanging = int(IN1)
uvlist = list()
uvnormals = list()
uvxyzs = list()

face = ds.Host.GetGeometryObjectFromReference(ds.HostReference)
gn = GridNode()
if overhanging == 1:
	i = 0
	j = 1
else:
	i = 1
	j = 3
u = i
while (u < (ds.NumberOfUGridlines-i)):
	gn.UIndex = u
	v = i
	vlist = list()
	vnormals = list()
	vxyzs = list()
	while (v < (ds.NumberOfVGridlines-i)):
		gn.VIndex = v
		uv = ds.GetGridNodeUV(gn)
 		vlist.append(uv)
 		vnormals.append(face.ComputeNormal(uv))
 		vxyzs.append(face.Evaluate(uv))
 		v += 1
 	uvlist.append(vlist)
 	uvnormals.append(vnormals)
 	uvxyzs.append(vxyzs)
 	u += 1
OUT = (uvlist,uvnormals,uvxyzs,face,(ds.NumberOfUGridlines-j),(ds.NumberOfVGridlines-j))
# ----------------------------------------
first_of_list = First(python_script_with_variable)
UVs = Output(first_of_list)
number = DoubleInput(2)
get_from_list = GetFromList(number, python_script_with_variable)
XYZs = Output(get_from_list)
number_2 = DoubleInput(1)
get_from_list_2 = GetFromList(number_2, python_script_with_variable)
Normals = Output(get_from_list_2)
number_3 = DoubleInput(3)
get_from_list_3 = GetFromList(number_3, python_script_with_variable)
Face = Output(get_from_list_3)
number_4 = DoubleInput(4)
get_from_list_4 = GetFromList(number_4, python_script_with_variable)
U = Output(get_from_list_4)
number_5 = DoubleInput(5)
get_from_list_5 = GetFromList(number_5, python_script_with_variable)
V = Output(get_from_list_5)
