# Dynamo custom node Feet To Centimeters.dyf (Dynamo 0.6.3.5260)
# category: Clockwork.Conversion.Length
# Converts feet into centimeters

ft = Input()
formula = Formula("feet*0.3048*100", feet=ft, lacing=Longest)
cm = Output(formula)
