# Dynamo custom node Fill Sublists.dyf (Dynamo 0.6.3.5260)
# category: Clockwork.Lists.Sublists
# Repeats a list of items into sublists of given lengths

repeat = Repeat(lacing=Longest)
list = Input()
lengths = Input()
combine = Combine(repeat, list, lengths)
sublists = Output(combine)
