# Dynamo custom node Filter For Topo Subregions.dyf (Dynamo 0.6.3.7375)
# category: Clockwork.Revit.Topo
# Filters out everything that is *not* a topo subregion. Needs Revit 2014 or newer to work.

Toposurface_s = Input()  # "Toposurface(s)"
turn_into_list = Custom[Turn Into List](item=Toposurface_s)  # Turns an element into a (flat) list
python_script = Python(turn_into_list)
# ---------- python_script.python (22 lines) ----------
import clr
clr.AddReference('RevitAPI')
clr.AddReference('RevitAPIUI')
from Autodesk.Revit.DB import *
import Autodesk

topos = IN
subregions = list()
justtopos = list()
booleans = list()
for item in topos:
	try:
		if item.IsSiteSubRegion:
			subregions.append(item)
			booleans.append(1)
		else:
			justtopos.append(item)
			booleans.append(0)
	except:
		justtopos.append(item)
		booleans.append(0)
OUT = (subregions,justtopos,booleans)
# ----------------------------------------
first_of_list = First(python_script)
Subregions = Output(first_of_list)
formula = Formula("1", lacing=Longest)
get_from_list = GetFromList(formula, python_script)
No_Subregions = Output(get_from_list)
formula_2 = Formula("2", lacing=Longest)
get_from_list_2 = GetFromList(formula_2, python_script)
bool = Output(get_from_list_2)
