# Dynamo custom node Filter List By Category.dyf (Dynamo 0.6.3.22045)
# category: Clockwork.Revit.Categories
# Filters out all elements that are not of a specified category

element_s = Input()  # "element(s)"
turn_into_list = Custom[Turn Into List](item=element_s)  # Turns an element into a (flat) list
BuiltInCategory = Input()
is_of_category = Custom[Is Of Category](element_s=turn_into_list, BuiltInCategory=BuiltInCategory)  # Checks whether an element is of a specified category
turn_into_list_2 = Custom[Turn Into List](item=is_of_category)
filter_by_boolean_mask = FilterMask(turn_into_list, turn_into_list_2)
in_ = Output(filter_by_boolean_mask.out0)  # "in"
out = Output(filter_by_boolean_mask.out1)
