# Dynamo custom node Filter List by Regular Expression Matches.dyf (Dynamo 0.6.3.7375)
# category: Clockwork.Strings
# Filters out all items from a list of strings that don't begin with the regular expression.  The syntax for regular expressions is explained at
# http://ironpython-test.readthedocs.org/en/latest/howto/regex.html

list = Input()
turn_into_list = Custom[Turn Into List](item=list)  # Turns an element into a list
regex = Input()
match_regular_expression = Custom[Match Regular Expression](regex=regex, string_s=turn_into_list)  # Determines if a regular expression matches a string (or a list of strings) and returns a boolean value (or a list, depending on the input). The syntax for regular expressions is explained at http://ironpython-test.readthedocs.org/en/latest/howto/regex.html
turn_into_list_2 = Custom[Turn Into List](item=match_regular_expression)
filter_by_boolean_mask = FilterMask(turn_into_list, turn_into_list_2)
in_ = Output(filter_by_boolean_mask.out0)  # "in"
out = Output(filter_by_boolean_mask.out1)
