# Dynamo custom node Filter Roofs By Creation Method.dyf (Dynamo 0.6.3.5262)
# category: Clockwork.Revit.Roof & Floor
# Filters a list of roofs by their method of creation.

Roof_Instance_s = Input()  # "Roof Instance(s)"
turn_into_list = Custom[Turn Into List](item=Roof_Instance_s)  # Turns an element into a list
python_script = Python(turn_into_list)
# ---------- python_script.python (25 lines) ----------
import clr
clr.AddReference('RevitAPI')
clr.AddReference('RevitAPIUI')
from Autodesk.Revit.DB import *
import Autodesk

roofinstances = IN
footprintlist = list()
extrusionlist = list()
baselist = list()
inplacelist = list()
noroofs = list()
for item in roofinstances:
	try:
		if item.GetType().Name == 'FootPrintRoof':
			footprintlist.append(item)
		elif item.GetType().Name == 'ExtrusionRoof':
			extrusionlist.append(item)
		elif item.GetType().Name == 'RoofBase':
			baselist.append(item)
		elif item.GetType().Name == 'FamilyInstance':
			inplacelist.append(item)
	except:
		noroofs.append(item)
OUT = (footprintlist,extrusionlist,baselist,inplacelist,noroofs)
# ----------------------------------------
first_of_list = First(python_script)
By_Footprint = Output(first_of_list)
formula = Formula("1", lacing=Longest)
get_from_list = GetFromList(formula, python_script)
By_Extrusion = Output(get_from_list)
formula_2 = Formula("2", lacing=Longest)
get_from_list_2 = GetFromList(formula_2, python_script)
By_Face = Output(get_from_list_2)
formula_3 = Formula("3", lacing=Longest)
get_from_list_3 = GetFromList(formula_3, python_script)
In_Place = Output(get_from_list_3)  # "In-Place"
formula_4 = Formula("4", lacing=Longest)
get_from_list_4 = GetFromList(formula_4, python_script)
No_Roofs = Output(get_from_list_4)
