# Dynamo custom node Filter Roofs By Kind.dyf (Dynamo 0.6.3.5259)
# category: Clockwork.Revit.Roof & Floor
# Filters a list of roofs by their kind (basic or glazed).

Roof_Instance_s = Input()  # "Roof Instance(s)"
turn_into_list = Custom[Turn Into List](item=Roof_Instance_s)  # Turns an element into a list
python_script = Python(turn_into_list)
# ---------- python_script.python (15 lines) ----------
import clr
clr.AddReference('RevitAPI')
clr.AddReference('RevitAPIUI')
from Autodesk.Revit.DB import *
import Autodesk

items = IN
normallist = list()
glazedlist = list()
for item in items:
	if item.CurtainGrids:
		glazedlist.append(item)
	else:
		normallist.append(item)
OUT = (normallist,glazedlist)
# ----------------------------------------
first_of_list = First(python_script)
Basic = Output(first_of_list)
formula = Formula("1", lacing=Longest)
get_from_list = GetFromList(formula, python_script)
Glazed = Output(get_from_list)
