# Dynamo custom node Filter Structural Foundations By Kind.dyf (Dynamo 0.6.2.29585)
# category: Clockwork.Revit.Structural
# Filters a list of structural foundations by their kind (isolated, wall, slab).

Struct_Found_Instance_s = Input()  # "Struct. Found. Instance(s)"
turn_into_list = Custom[Turn Into List](item=Struct_Found_Instance_s)  # Turns an element into a list
python_script = Python(turn_into_list)
# ---------- python_script.python (22 lines) ----------
import clr
clr.AddReference('RevitAPI')
clr.AddReference('RevitAPIUI')
from Autodesk.Revit.DB import *
import Autodesk

foundinstances = IN
isolatedlist = list()
walllist = list()
slablist = list()
nofounds = list()
for item in foundinstances:
	try:
		if item.GetType().Name == 'FamilyInstance':
			isolatedlist.append(item)
		elif item.GetType().Name == 'ContFooting':
			walllist.append(item)
		elif item.GetType().Name == 'Floor':
			slablist.append(item)
	except:
		nofounds.append(item)
OUT = (isolatedlist,walllist,slablist,nofounds)
# ----------------------------------------
first_of_list = First(python_script)
Isolated = Output(first_of_list)
formula = Formula("1", lacing=Longest)
get_from_list = GetFromList(formula, python_script)
Wall = Output(get_from_list)
formula_2 = Formula("2", lacing=Longest)
get_from_list_2 = GetFromList(formula_2, python_script)
Slab = Output(get_from_list_2)
formula_3 = Formula("3", lacing=Longest)
get_from_list_3 = GetFromList(formula_3, python_script)
No_Foundations = Output(get_from_list_3)
