# Dynamo custom node Filter Sublists By Length.dyf (Dynamo 0.6.3.7375)
# category: Clockwork.Lists.Sublists
# Filters out all sublists that do not have the specified length

list = Input()
list_length = Length()
map = Map(list_length, list)
length = Input()
formula = Formula("n=x", map, length, lacing=Longest)
filter_by_boolean_mask = FilterMask(list, formula)
in_ = Output(filter_by_boolean_mask.out0)  # "in"
out = Output(filter_by_boolean_mask.out1)
