# Dynamo custom node Filter Views By Detail Level.dyf (Dynamo 0.6.3.5263)
# category: Clockwork.Revit.Views
# Filters a list of views by their respective detail levels.

View_s = Input()  # "View(s)"
turn_into_list = Custom[Turn Into List](item=View_s)  # Turns an element into a list
python_script = Python(turn_into_list)
# ---------- python_script.python (25 lines) ----------
import clr
clr.AddReference('RevitAPI')
clr.AddReference('RevitAPIUI')
from Autodesk.Revit.DB import *
import Autodesk

views = IN
coarselist = list()
mediumlist = list()
finelist = list()
undefinedlist = list()
elementlist = list()
for view in views:
	try:
		if str(view.DetailLevel) == 'Coarse':
			coarselist.append(view)
		elif str(view.DetailLevel) == 'Medium':
			mediumlist.append(view)
		elif str(view.DetailLevel) == 'Fine':
			finelist.append(view)
		else:
			undefinedlist.append(view)
	except:
		undefinedlist.append(view)
OUT = (coarselist,mediumlist,finelist,undefinedlist)
# ----------------------------------------
first_of_list = First(python_script)
Coarse = Output(first_of_list)
formula = Formula("1", lacing=Longest)
get_from_list = GetFromList(formula, python_script)
Medium = Output(get_from_list)
formula_2 = Formula("2", lacing=Longest)
get_from_list_2 = GetFromList(formula_2, python_script)
Fine = Output(get_from_list_2)
formula_3 = Formula("3", lacing=Longest)
get_from_list_3 = GetFromList(formula_3, python_script)
Undefined = Output(get_from_list_3)
