# Dynamo custom node Filter Views By Type.dyf (Dynamo 0.6.3.5270)
# category: Clockwork.Revit.Views
# Filters a list of views by their respective types.

View_s = Input()  # "View(s)"
turn_into_list = Custom[Turn Into List](item=View_s)  # Turns an element into a list
python_script = Python(turn_into_list)
# ---------- python_script.python (57 lines) ----------
import clr
clr.AddReference('RevitAPI')
clr.AddReference('RevitAPIUI')
from Autodesk.Revit.DB import *
import Autodesk

views = IN
floorplanlist = list()
ceilingplanlist = list()
elevationlist = list()
axolist = list()
perspectivelist = list()
schedulelist = list()
draftinglist = list()
legendlist = list()
areaplanlist = list()
sectionlist = list()
detaillist = list()
walkthroughlist = list()
renderinglist = list()
others = list()

for view in views:
	if str(view.ViewType) == 'FloorPlan':
		floorplanlist.append(view)
	elif str(view.ViewType) == 'CeilingPlan':
		ceilingplanlist.append(view)
	elif str(view.ViewType) == 'Elevation':
		elevationlist.append(view)
	elif str(view.ViewType) == 'ThreeD':
		# view templates and perspective views don't mix well (exception!), so let's ask for view templates first
		if view.IsTemplate:
			axolist.append(view)
		elif view.IsPerspective:
			perspectivelist.append(view)
		else:
			axolist.append(view)
	# maybe also include column and panel schedules here...
	elif str(view.ViewType) == 'Schedule':
		schedulelist.append(view)
	elif str(view.ViewType) == 'DraftingView':
		draftinglist.append(view)
	elif str(view.ViewType) == 'Legend':
		legendlist.append(view)
	elif str(view.ViewType) == 'AreaPlan':
		areaplanlist.append(view)
	elif str(view.ViewType) == 'Section':
		sectionlist.append(view)
	elif str(view.ViewType) == 'Detail':
		detaillist.append(view)
	elif str(view.ViewType) == 'Walkthrough':
		walkthroughlist.append(view)
	elif str(view.ViewType) == 'Rendering':
		renderinglist.append(view)
	else:
		others.append(view)
OUT = (floorplanlist,ceilingplanlist,elevationlist,axolist,perspectivelist,schedulelist,draftinglist,legendlist,areaplanlist,sectionlist,detaillist,walkthroughlist,renderinglist,others)
# ----------------------------------------
first_of_list = First(python_script)
Floor_Plans = Output(first_of_list)
formula = Formula("1", lacing=Longest)
get_from_list = GetFromList(formula, python_script)
Ceiling_Plans = Output(get_from_list)
formula_2 = Formula("2", lacing=Longest)
get_from_list_2 = GetFromList(formula_2, python_script)
Elevations = Output(get_from_list_2)
formula_3 = Formula("3", lacing=Longest)
get_from_list_3 = GetFromList(formula_3, python_script)
Axonometric_Views = Output(get_from_list_3)
formula_4 = Formula("4", lacing=Longest)
get_from_list_4 = GetFromList(formula_4, python_script)
Perspective_Views = Output(get_from_list_4)
formula_5 = Formula("5", lacing=Longest)
get_from_list_5 = GetFromList(formula_5, python_script)
Schedules = Output(get_from_list_5)
formula_6 = Formula("6", lacing=Longest)
get_from_list_6 = GetFromList(formula_6, python_script)
Drafting_Views = Output(get_from_list_6)
formula_7 = Formula("7", lacing=Longest)
get_from_list_7 = GetFromList(formula_7, python_script)
Legends = Output(get_from_list_7)
formula_8 = Formula("8", lacing=Longest)
get_from_list_8 = GetFromList(formula_8, python_script)
Area_Plans = Output(get_from_list_8)
formula_9 = Formula("9", lacing=Longest)
get_from_list_9 = GetFromList(formula_9, python_script)
Sections = Output(get_from_list_9)
formula_10 = Formula("10", lacing=Longest)
get_from_list_10 = GetFromList(formula_10, python_script)
Details = Output(get_from_list_10)
formula_11 = Formula("11", lacing=Longest)
get_from_list_11 = GetFromList(formula_11, python_script)
Walkthroughs = Output(get_from_list_11)
formula_12 = Formula("12", lacing=Longest)
get_from_list_12 = GetFromList(formula_12, python_script)
Renderings = Output(get_from_list_12)
formula_13 = Formula("13", lacing=Longest)
get_from_list_13 = GetFromList(formula_13, python_script)
Other = Output(get_from_list_13)
