# Dynamo custom node Filter Wall Type By Kind.dyf (Dynamo 0.6.3.5259)
# category: Clockwork.Revit.Wall
# Separates a list of wall types into several lists according to wall kind

revit_document = RevitDocument(lacing=Longest)
Wall_Type_s = Input()  # "Wall Type(s)"
turn_into_list = Custom[Turn Into List](item=Wall_Type_s)  # Turns an element into a list
python_script_with_variable = Python(revit_document, turn_into_list)  # "Python Script With Variable Number of Inputs"
# ---------- python_script_with_variable.python (26 lines) ----------
import clr
clr.AddReference('RevitAPI')
clr.AddReference('RevitAPIUI')
from Autodesk.Revit.DB import *
import Autodesk

doc = IN0
walltypes = IN1
nowalls = list()
basiclist = list()
curtainlist = list()
stackedlist = list()
unknownlist = list()
for item in walltypes:
	try: 
		if str(item.Kind) == 'Basic':
			basiclist.append(item)
		elif str(item.Kind) == 'Curtain':
			curtainlist.append(item)
		elif str(item.Kind) == 'Stacked':
			stackedlist.append(item)
		elif str(item.Kind) == 'Unknown':
			unknownlist.append(item)
	except:
		nowalls.append(item)
OUT = (basiclist,curtainlist,stackedlist,unknownlist,nowalls)
# ----------------------------------------
first_of_list = First(python_script_with_variable)
Basic_Walls = Output(first_of_list)
formula = Formula("1", lacing=Longest)
get_from_list = GetFromList(formula, python_script_with_variable)
Curtain_Walls = Output(get_from_list)
formula_2 = Formula("2", lacing=Longest)
get_from_list_2 = GetFromList(formula_2, python_script_with_variable)
Stacked_Walls = Output(get_from_list_2)
formula_3 = Formula("3", lacing=Longest)
get_from_list_3 = GetFromList(formula_3, python_script_with_variable)
Unknown = Output(get_from_list_3)
formula_4 = Formula("4", lacing=Longest)
get_from_list_4 = GetFromList(formula_4, python_script_with_variable)
No_Wall_s = Output(get_from_list_4)  # "No Wall(s)"
