# Dynamo custom node Filter Wall Types By Function.dyf (Dynamo 0.6.2.29585)
# category: Clockwork.Revit.Wall
# Separates a list of wall types into several lists according to wall function

Wall_Type_s = Input()  # "Wall Type(s)"
turn_into_list = Custom[Turn Into List](item=Wall_Type_s)  # Turns an element into a list
python_script = Python(turn_into_list)
# ---------- python_script.python (33 lines) ----------
import clr
clr.AddReference('RevitAPI')
clr.AddReference('RevitAPIUI')
from Autodesk.Revit.DB import *
import Autodesk

walltypes = IN
interiorlist = list()
exteriorlist = list()
foundationlist = list()
retaininglist = list()
soffitlist = list()
shaftlist = list()
nowalls = list()

for item in walltypes:
	try:
		wallfunction = item.get_Parameter(BuiltInParameter.FUNCTION_PARAM).AsInteger()
		if wallfunction == 0:
			interiorlist.append(item)
		elif wallfunction == 1:
			exteriorlist.append(item)
		elif wallfunction == 2:
			foundationlist.append(item)
		elif wallfunction == 3:
			retaininglist.append(item)
		elif wallfunction == 4:
			soffitlist.append(item)
		elif wallfunction == 5:
			shaftlist.append(item)
	except:
		nowalls.append(item)
OUT = (interiorlist,exteriorlist,foundationlist,retaininglist,soffitlist,shaftlist,nowalls)
# ----------------------------------------
first_of_list = First(python_script)
Interior = Output(first_of_list)
formula = Formula("1", lacing=Longest)
get_from_list = GetFromList(formula, python_script)
Exterior = Output(get_from_list)
formula_2 = Formula("2", lacing=Longest)
get_from_list_2 = GetFromList(formula_2, python_script)
Foundation = Output(get_from_list_2)
formula_3 = Formula("3", lacing=Longest)
get_from_list_3 = GetFromList(formula_3, python_script)
Retaining = Output(get_from_list_3)
formula_4 = Formula("4", lacing=Longest)
get_from_list_4 = GetFromList(formula_4, python_script)
Soffit = Output(get_from_list_4)
formula_5 = Formula("5", lacing=Longest)
get_from_list_5 = GetFromList(formula_5, python_script)
Core_Shaft = Output(get_from_list_5)
formula_6 = Formula("6", lacing=Longest)
get_from_list_6 = GetFromList(formula_6, python_script)
No_Wall_s = Output(get_from_list_6)  # "No Wall(s)"
