# Dynamo custom node Filter Walls By Creation Method.dyf (Dynamo 0.6.2.29585)
# category: Clockwork.Revit.Wall
# Filters a list of walls by their method of creation.

Wall_Instance_s = Input()  # "Wall Instance(s)"
turn_into_list = Custom[Turn Into List](item=Wall_Instance_s)  # Turns an element into a list
python_script = Python(turn_into_list)
# ---------- python_script.python (22 lines) ----------
import clr
clr.AddReference('RevitAPI')
clr.AddReference('RevitAPIUI')
from Autodesk.Revit.DB import *
import Autodesk

wallinstances = IN
standardlist = list()
facelist = list()
inplacelist = list()
nowalls = list()
for item in wallinstances:
	try:
		if item.GetType().Name == 'Wall':
			standardlist.append(item)
		elif item.GetType().Name == 'FaceWall':
			facelist.append(item)
		elif item.GetType().Name == 'FamilyInstance':
			inplacelist.append(item)
	except:
		nowalls.append(item)
OUT = (standardlist,facelist,inplacelist,nowalls)
# ----------------------------------------
first_of_list = First(python_script)
Standard = Output(first_of_list)
formula = Formula("1", lacing=Longest)
get_from_list = GetFromList(formula, python_script)
By_Face = Output(get_from_list)
formula_2 = Formula("2", lacing=Longest)
get_from_list_2 = GetFromList(formula_2, python_script)
In_Place = Output(get_from_list_2)  # "In-Place"
formula_3 = Formula("3", lacing=Longest)
get_from_list_3 = GetFromList(formula_3, python_script)
No_Wall_s = Output(get_from_list_3)  # "No Wall(s)"
