# Dynamo custom node Find All Paths.dyf (Dynamo 0.6.3.7375)
# category: Clockwork.Math.Graphs
# Finds all possible paths between two nodes.  The connections input expects a list of value pairs.

connections_str = Input()  # "connections (str)"
build_path_graph = Custom[Build Path Graph](connections_str=connections_str)  # Builds a path graph (Python dictionary) from a list of value pairs.
start_str = Input()  # "start (str)"
end_str = Input()  # "end (str)"
python_script_with_variable = Python(build_path_graph, start_str, end_str)  # "Python Script With Variable Number of Inputs"
# ---------- python_script_with_variable.python (22 lines) ----------
pathgraph = IN0
start = IN1
end = IN2

# script found here:
# https://www.python.org/doc/essays/graphs/

def find_all_paths(graph, start, end, path=[]):
	path = path + [start]
	if start == end:
		return [path]
	if not graph.has_key(start):
		return []
	paths = []
	for node in graph[start]:
		if node not in path:
			newpaths = find_all_paths(graph, node, end, path)
			for newpath in newpaths:
				paths.append(newpath)
	return paths

OUT = find_all_paths(pathgraph,start,end)
# ----------------------------------------
paths = Output(python_script_with_variable)
