# Dynamo custom node Find In Sublists.dyf (Dynamo 0.6.3.5260)
# category: Clockwork.Lists.Sublists
# Looks for an item in each sublist of a given list and returns true/false for each sublist.

item = Input()
list_contains = Custom[List Contains](item=item)  # Returns true if the given item is found in the given list, and false otherwise.
list = Input()
map = Map(list_contains, list)
booleans = Output(map)
