# Dynamo custom node Footing Type Breaks At Inserts.dyf (Dynamo 0.6.3.5256)
# category: Clockwork.Revit.Structural
# Determines whether a list of wall footing types break at inserts in their attached walls

Footing_Type_s = Input()  # "Footing Type(s)"
turn_into_list = Custom[Turn Into List](item=Footing_Type_s)  # Turns an element into a (flat) list
python_script = Python(turn_into_list)
# ---------- python_script.python (23 lines) ----------
import clr
clr.AddReference('RevitAPI')
clr.AddReference('RevitAPIUI')
from Autodesk.Revit.DB import *
import Autodesk

footingtypes = IN
truelist = list()
falselist = list()
booleans = list()
for item in footingtypes:
	try:
		footingbreaks = item.get_Parameter(BuiltInParameter.CONTINUOUS_FOOTING_BREAK_AT_INSERTS_DISABLE).AsInteger()
		if footingbreaks == 0:
			truelist.append(item)
			booleans.append(1)
		elif footingbreaks == 1:
			falselist.append(item)
			booleans.append(0)
	except:
		falselist.append(item)
		booleans.append(0)
OUT = (truelist,falselist,booleans)
# ----------------------------------------
first_of_list = First(python_script)
true = Output(first_of_list)
formula = Formula("1", lacing=Longest)
get_from_list = GetFromList(formula, python_script)
false = Output(get_from_list)
formula_2 = Formula("2", lacing=Longest)
get_from_list_2 = GetFromList(formula_2, python_script)
booleans = Output(get_from_list_2)
