# Dynamo custom node Fuchsia.dyf (Dynamo 0.6.3.5262)
# category: Clockwork.Colours
# Returns the colour fuchsia a.k.a. magenta.

number = DoubleInput(0)
number_2 = DoubleInput(255)
color = Color(number, number_2, number, number_2, lacing=Longest)
n255_0_255 = Output(color)  # "255,0,255"
