# Dynamo custom node Get Buckyball Struts.dyf (Dynamo 0.6.3.22045)
# category: Clockwork.Math.Buckyball
# Parses the vertices of an (unscaled) truncated icosahedron and returns a pair of XYZs for each strut.

list = Input()
rest_of_list = Rest(list)
list_length = Length(rest_of_list)
formula = Formula("x>1", x=list_length, lacing=Longest)
first_of_list = First(list)
# note: Measure distance between first point in list and all other points
xyz_distance = XyzDistance(first_of_list, rest_of_list, lacing=Longest)
z_axis = XyzBasisZ(lacing=Longest)
number = DoubleInput(2)
# note: Create a reference strut length
scale_xyz = XyzScale(z_axis, number, lacing=Longest)
XYZ = Xyz(lacing=Longest)
xyz_distance_2 = XyzDistance(scale_xyz, XYZ, lacing=Longest)
# note: Filter out all points that do not have a distnace of 2 to the first point.
formula_2 = Formula("x=y", xyz_distance, xyz_distance_2, lacing=Longest)
filter_by_boolean_mask = FilterMask(rest_of_list, formula_2)
is_empty_list = IsEmpty(filter_by_boolean_mask)
struts = Input()
list_2 = NewList(index0=first_of_list)
map = Map(list_2, filter_by_boolean_mask)
# note: If there are any points that are directly adjacent (i.e. distance = 2), add them to the list
join_lists = Append(struts, map)
if_ = Conditional(is_empty_list, struts, join_lists)
get_buckyball_struts = Custom[Get Buckyball Struts](list=rest_of_list, struts=if_)  # Parses the vertices of an (unscaled) truncated icosahedron and returns a pair of XYZs for each strut.
if_2 = Conditional(formula, get_buckyball_struts.struts, if_)
struts_2 = Output(if_2)  # "struts"
empty_list = Empty()
# note: Continue processing the list recursively until there's only one point left. By always removing the first point from the list, we ensure that no duplicate struts are computed.
if_3 = Conditional(formula, get_buckyball_struts.list, empty_list)
list_3 = Output(if_3)  # "list"
