# Dynamo custom node Get Current Revit Document Path.dyf (Dynamo 0.6.3.7375)
# category: Clockwork.Revit
# Gets the path and directory of the current Revit document

revit_document = RevitDocument(lacing=Longest)
python_script = Python(revit_document)
# ---------- python_script.python (16 lines) ----------
# Default imports
import clr
clr.AddReference('RevitAPI')
clr.AddReference('RevitAPIUI')
from Autodesk.Revit.DB import *
import Autodesk
import sys
import clr
path = r'C:\Autodesk\Dynamo\Core'
exec_path = r'C:\Autodesk\Dynamo\Core\dll'
sys.path.append(path)
sys.path.append(exec_path)
clr.AddReference('LibGNet')
from Autodesk.LibG import *

OUT = IN.PathName
# ----------------------------------------
path = Output(python_script)
get_directory_from_file_path = Custom[Get Directory From File Path](path=python_script)  # Gets the directory from a given file path
directory = Output(get_directory_from_file_path)
