# Dynamo custom node Get Curtain System Type.dyf (Dynamo 0.6.3.5260)
# category: Clockwork.Revit.Wall
# Retrieves the family type for a given curtain system instance.

Curtain_System_Instance_s = Input()  # "Curtain System Instance(s)"
turn_into_list = Custom[Turn Into List](item=Curtain_System_Instance_s)  # Turns an element into a list
python_script = Python(turn_into_list)
# ---------- python_script.python (14 lines) ----------
import clr
clr.AddReference('RevitAPI')
clr.AddReference('RevitAPIUI')
from Autodesk.Revit.DB import *
import Autodesk

csinstances = IN
elementlist = list()
for item in csinstances:
	try:
		elementlist.append(item.CurtainSystemType)
	except:
		emptylist = list()
OUT = elementlist
# ----------------------------------------
return_list_or_single_value = Custom[Return List Or Single Value](list_1=turn_into_list, list_2=python_script)  # If the list in input #1 has only one item, only the first item of the list in input #2 will be returned.
Curtain_System_Type_s = Output(return_list_or_single_value)  # "Curtain System Type(s)"
