# Dynamo custom node Get Directory From File Path.dyf (Dynamo 0.6.3.7375)
# category: Clockwork.Strings
# Gets the directory from a given file path

path = Input()
string = StringInput("\")
split_string = SplitString(path, string)
list_length = Length(split_string)
n1 = Custom[-1](list_length)  # Decrements a value by 1
take_from_list = TakeList(n1, split_string)
join_strings = JoinStrings(take_from_list, string)
dir = Output(join_strings)
