# Dynamo custom node Get Doors Or Windows From Room.dyf (Dynamo 0.6.3.7375)
# category: Clockwork.Revit.Rooms
# Retrieves all doors or windows that are associated with a room (hosted in walls and roofs).

Doors_Windows_Category = Input()  # "Doors/Windows (Category)"
get_family_instances_by_category = Custom[Get Family Instances By Category](BuiltInCategories=Doors_Windows_Category)  # Gets all family instances in the model for a given list of categories
flatten_completely = FlattenList(get_family_instances_by_category)
is_empty_list = IsEmpty()
Phase = Input()
rooms_from_doors_and_windows = Custom[Rooms From Doors And Windows](Door_s_Window_s=flatten_completely, Phase=Phase)  # Gets the rooms that are connected by a given door or a window
map = Map(is_empty_list, rooms_from_doors_and_windows.From_Room_s)
is_empty = Custom[Is Empty](item_s=map)  # Checks if the input items are <empty>
filter_by_boolean_mask = FilterMask(flatten_completely, is_empty)
Room = Input()
elements_to_ids = Custom[Elements to IDs](Element_s=Room)  # Gets the ID(s) for a list of Revit elements (or a single element)
equal = Equal(elements_to_ids.UniqueID)
rooms_from_doors_and_windows_2 = Custom[Rooms From Doors And Windows](Door_s_Window_s=filter_by_boolean_mask, Phase=Phase)
elements_to_ids_2 = Custom[Elements to IDs](Element_s=rooms_from_doors_and_windows_2.From_Room_s)
turn_into_list = Custom[Turn Into List](item=elements_to_ids_2.UniqueID)  # Turns an element into a (flat) list
map_2 = Map(equal, turn_into_list)
filter_by_boolean_mask_2 = FilterMask(filter_by_boolean_mask, map_2)
map_3 = Map(is_empty_list, rooms_from_doors_and_windows.To_Room_s)
is_empty_2 = Custom[Is Empty](item_s=map_3)
filter_by_boolean_mask_3 = FilterMask(flatten_completely, is_empty_2)
rooms_from_doors_and_windows_3 = Custom[Rooms From Doors And Windows](Door_s_Window_s=filter_by_boolean_mask_3, Phase=Phase)
elements_to_ids_3 = Custom[Elements to IDs](Element_s=rooms_from_doors_and_windows_3.To_Room_s)
turn_into_list_2 = Custom[Turn Into List](item=elements_to_ids_3.UniqueID)
map_4 = Map(equal, turn_into_list_2)
filter_by_boolean_mask_4 = FilterMask(filter_by_boolean_mask_3, map_4)
list = NewList(index0=filter_by_boolean_mask_2, index1=filter_by_boolean_mask_4)
flatten_completely_2 = FlattenList(list)
Doors_Windows = Output(flatten_completely_2)  # "Doors/Windows"
