# Dynamo custom node Get Element By Face.dyf (Dynamo 0.6.3.22045)
# category: Clockwork.Revit
# Returns the underlying Revit element of a given face

Face_s = Input()  # "Face(s)"
turn_into_list = Custom[Turn Into List](item=Face_s)  # Turns an element into a (flat) list
revit_document = RevitDocument(lacing=Longest)
python_script_with_variable = Python(turn_into_list, revit_document)  # "Python Script With Variable Number of Inputs"
# ---------- python_script_with_variable.python (16 lines) ----------
import clr
clr.AddReference('RevitAPI')
clr.AddReference('RevitAPIUI')
from Autodesk.Revit.DB import *
import Autodesk

items = IN0
doc = IN1
elementlist = list()

for item in items:
	try:
		elementlist.append(doc.GetElement(item.Reference.ElementId))
	except:
		donothing = 1
OUT = elementlist
# ----------------------------------------
return_list_or_single_value = Custom[Return List Or Single Value](list_1=turn_into_list, list_2=python_script_with_variable)  # If the list in input #1 has only one item, only the first item of the list in input #2 will be returned.
Element_s = Output(return_list_or_single_value)  # "Element(s)"
