# Dynamo custom node Get Element Location.dyf (Dynamo 0.6.3.7375)
# category: Clockwork.Revit
# Returns the location of an element as an XYZ (or if it's line-based the start and end point of the line), along with some booleans to help filtering the results. Use this for some element types (e.g. walls or lines) that do not work with the built-in Get Family Instance Location node.

Element_s = Input()  # "Element(s)"
turn_into_list = Custom[Turn Into List](item=Element_s)  # Turns an element into a (flat) list
python_script = Python(turn_into_list)
# ---------- python_script.python (45 lines) ----------
import clr
clr.AddReference('RevitAPI')
clr.AddReference('RevitAPIUI')
from Autodesk.Revit.DB import *
import Autodesk

items = IN
elementlist = list()
ispoint = list()
iscurve = list()
curves = list()
haslocation = list()

for item in items:
	try:
		loc = item.Location
		if loc.ToString() == 'Autodesk.Revit.DB.LocationCurve':
			# line-based elements (e.g. walls)
			curvepoints = (loc.Curve.GetEndPoint(0),loc.Curve.GetEndPoint(1))
			elementlist.append(curvepoints)
			curves.append(loc.Curve)
			ispoint.append(0)
			iscurve.append(1)
			haslocation.append(1)
		else:
			# other elements
			elementlist.append(loc.Point)
			ispoint.append(1)
			iscurve.append(0)
			haslocation.append(1)
	except:
		try:
			# curves
			curvepoints = (item.GetEndPoint(0),item.GetEndPoint(1))
			elementlist.append(curvepoints)
			curves.append(item)
			ispoint.append(0)
			iscurve.append(1)
			haslocation.append(1)
		except:
			donothing = 1
			ispoint.append(0)
			iscurve.append(0)
			haslocation.append(0)
OUT = (elementlist,curves,ispoint,iscurve,haslocation)
# ----------------------------------------
first_of_list = First(python_script)
Location_s = Output(first_of_list)  # "Location(s)"
number = DoubleInput(1)
get_from_list = GetFromList(number, python_script)
Curve_s = Output(get_from_list)  # "Curve(s)"
number_2 = DoubleInput(2)
get_from_list_2 = GetFromList(number_2, python_script)
Is_Point_bool = Output(get_from_list_2)  # "Is Point (bool)"
number_3 = DoubleInput(3)
get_from_list_3 = GetFromList(number_3, python_script)
Is_Curve_bool = Output(get_from_list_3)  # "Is Curve (bool)"
number_4 = DoubleInput(4)
get_from_list_4 = GetFromList(number_4, python_script)
Has_Location_bool = Output(get_from_list_4)  # "Has Location (bool)"
