# Dynamo custom node Get Faces From Solid.dyf (Dynamo 0.6.3.22045)
# category: Clockwork.Revit
# Retrieves a list of faces from a given solid

Solid_s = Input()  # "Solid(s)"
turn_into_list = Custom[Turn Into List](item=Solid_s)  # Turns an element into a (flat) list
python_script = Python(turn_into_list)
# ---------- python_script.python (15 lines) ----------
import clr
clr.AddReference('RevitAPI')
clr.AddReference('RevitAPIUI')
from Autodesk.Revit.DB import *
import Autodesk

items = IN
elementlist = list()

for item in items:
	facelist = list()
	for face in item.Faces:
		facelist.append(face)
	elementlist.append(facelist)
OUT = elementlist
# ----------------------------------------
return_list_or_single_value = Custom[Return List Or Single Value](list_1=turn_into_list, list_2=python_script)  # If the list in input #1 has only one item, only the first item of the list in input #2 will be returned.
Faces = Output(return_list_or_single_value)
