# Dynamo custom node Get Families By Category.dyf (Dynamo 0.6.3.7375)
# category: Clockwork.Revit.Categories
# Gets all famiies of a given category in the model  (does *not *work for system families)

BuiltInCategories = Input()
get_family_symbols_by_category = Custom[Get Family Symbols By Category](BuiltInCategories=BuiltInCategories)  # Gets all family symbols of a given category in the model (does *not *work for system families)
get_family_from_family_type = Custom[Get Family From Family Type](Family_Type_s=get_family_symbols_by_category)  # Retrieves the family of a given family type
remove_duplicate_revit_elements = Custom[Remove Duplicate Revit Elements From List](list=get_family_from_family_type)  # Removes all duplicates of Revit elements from a given list. (Will also remove any other duplicates from a list...)
families = Output(remove_duplicate_revit_elements.elements)
