# Dynamo custom node Get Family From Family Type.dyf (Dynamo 0.6.3.7375)
# category: Clockwork.Revit
# Retrieves the family of a given family type

Family_Type_s = Input()  # "Family Type(s)"
turn_into_list = Custom[Turn Into List](item=Family_Type_s)  # Turns an element into a (flat) list
python_script = Python(turn_into_list)
# ---------- python_script.python (11 lines) ----------
import clr
clr.AddReference('RevitAPI')
clr.AddReference('RevitAPIUI')
from Autodesk.Revit.DB import *
import Autodesk

famtypes = IN
elementlist = list()
for item in famtypes:
	elementlist.append(item.Family)
OUT = elementlist
# ----------------------------------------
return_list_or_single_value = Custom[Return List Or Single Value](list_1=turn_into_list, list_2=python_script)  # If the list in input #1 has only one item, only the first item of the list in input #2 will be returned.
Family_ies = Output(return_list_or_single_value)  # "Family/ies"
