# Dynamo custom node Get Family Instances By Category And Name.dyf (Dynamo 0.6.3.31052)
# category: Clockwork.Revit.Categories
# Gets all family instances in the model for a given list of categories and a specified name. Use '*' as a wildcard.

BuiltInCategories = Input()
get_family_instances_by_category = Custom[Get Family Instances By Category](BuiltInCategories=BuiltInCategories)  # Gets all family instances in the model for a given list of categories
Name = Input()
string = StringInput("*")
string_2 = StringInput("\w*")
replace_substring = Custom[Replace Substring](string_s=Name, search=string, replace=string_2)  # Replaces a specified part (substring) of a string by another string
get_name = Custom[Get Name](element_s=get_family_instances_by_category)  # Gets the name of a given Revit element (if possible)
match_regular_expression = Custom[Match Regular Expression](regex=replace_substring, string_s=get_name)  # Determines if a regular expression matches a string (or a list of strings) and returns a boolean value (or a list, depending on the input). The syntax for regular expressions is explained at http://ironpython-test.readthedocs.org/en/latest/howto/regex.html
filter_by_boolean_mask = FilterMask(get_family_instances_by_category, match_regular_expression)
list = Output(filter_by_boolean_mask)
