# Dynamo custom node Get Family Symbols By Category.dyf (Dynamo 0.6.3.7375)
# category: Clockwork.Revit.Categories
# Gets all family symbols of a given category in the model  (does *not *work for system families)

revit_document = RevitDocument(lacing=Longest)
BuiltInCategories = Input()
turn_into_list = Custom[Turn Into List](item=BuiltInCategories)  # Turns an element into a (flat) list
python_script_with_variable = Python(revit_document, turn_into_list)  # "Python Script With Variable Number of Inputs"
# ---------- python_script_with_variable.python (17 lines) ----------
import clr
clr.AddReference('RevitAPI')
clr.AddReference('RevitAPIUI')
from Autodesk.Revit.DB import *
import Autodesk

doc = IN0
cats = IN1

elementlist = list()
# This could be more elegant if only I knew how to implement a Multicategory filter in Python....
for item in cats:
	collector = FilteredElementCollector(doc)
	collector.OfClass(FamilySymbol)
	collector.OfCategory(item)
	elementlist.append(collector.ToElements())
OUT = elementlist
# ----------------------------------------
list = Output(python_script_with_variable)
