# Dynamo custom node Get Family Symbols From Family.dyf (Dynamo 0.6.3.7375)
# category: Clockwork.Revit
# Gets all family symbols of a given category in the model  (does *not *work for system families)

revit_document = RevitDocument(lacing=Longest)
Family_ies = Input()  # "Family/ies"
turn_into_list = Custom[Turn Into List](item=Family_ies)  # Turns an element into a (flat) list
python_script_with_variable = Python(revit_document, turn_into_list)  # "Python Script With Variable Number of Inputs"
# ---------- python_script_with_variable.python (16 lines) ----------
import clr
clr.AddReference('RevitAPI')
clr.AddReference('RevitAPIUI')
from Autodesk.Revit.DB import *
import Autodesk

doc = IN0
fams = IN1

elementlist = list()
for item in fams:
	famfilter = FamilySymbolFilter(item.Id)
	collector = FilteredElementCollector(doc)
	collector.WherePasses(famfilter)
	elementlist.append(collector.ToElements())
OUT = elementlist
# ----------------------------------------
list = Output(python_script_with_variable)
