# Dynamo custom node Get Family Type.dyf (Dynamo 0.6.3.5244)
# category: Clockwork.Revit.Properties
# Returns the familyt type of a given family instance

Family_Instance_s = Input()  # "Family Instance(s)"
turn_into_list = Custom[Turn Into List](item=Family_Instance_s)  # Turns an element into a (flat) list
python_script = Python(turn_into_list)
# ---------- python_script.python (14 lines) ----------
import clr
clr.AddReference('RevitAPI')
clr.AddReference('RevitAPIUI')
from Autodesk.Revit.DB import *
import Autodesk

items = IN
elementlist = list()
for item in items:
	try:
		elementlist.append(item.Symbol)
	except:
		emptylist = list()
OUT = elementlist
# ----------------------------------------
return_list_or_single_value = Custom[Return List Or Single Value](list_1=turn_into_list, list_2=python_script)  # If the list in input #1 has only one item, only the first item of the list in input #2 will be returned.
Family_Type_s = Output(return_list_or_single_value)  # "Family Type(s)"
