# Dynamo custom node Get First Three Indices.dyf (Dynamo 0.6.3.7375)
# category: Clockwork.Patterning.Helpers
# Gets the first three indices of a given list

list = Input()
first_of_list = First(list)
n0 = Output(first_of_list)  # "0"
formula = Formula("1", lacing=Longest)
get_from_list = GetFromList(formula, list)
n1 = Output(get_from_list)  # "1"
formula_2 = Formula("2", lacing=Longest)
get_from_list_2 = GetFromList(formula_2, list)
n2 = Output(get_from_list_2)  # "2"
