# Dynamo custom node Get Floor Type.dyf (Dynamo 0.6.3.5262)
# category: Clockwork.Revit.Roof & Floor
# Retrieves the floor type for a given floor instance

Floor_Instance_s = Input()  # "Floor Instance(s)"
turn_into_list = Custom[Turn Into List](item=Floor_Instance_s)  # Turns an element into a list
python_script = Python(turn_into_list)
# ---------- python_script.python (14 lines) ----------
import clr
clr.AddReference('RevitAPI')
clr.AddReference('RevitAPIUI')
from Autodesk.Revit.DB import *
import Autodesk

floorinstances = IN
elementlist = list()
for item in floorinstances:
	try:
		elementlist.append(item.FloorType)
	except:
		emptylist = list()
OUT = elementlist
# ----------------------------------------
return_list_or_single_value = Custom[Return List Or Single Value](list_1=turn_into_list, list_2=python_script)  # If the list in input #1 has only one item, only the first item of the list in input #2 will be returned.
Floor_Type_s = Output(return_list_or_single_value)  # "Floor Type(s)"
