# Dynamo custom node Get Footing Type.dyf (Dynamo 0.6.3.5256)
# category: Clockwork.Revit.Structural
# Retrieves the footing type for a given wall footing instance

Footing_Instance_s = Input()  # "Footing Instance(s)"
turn_into_list = Custom[Turn Into List](item=Footing_Instance_s)  # Turns an element into a (flat) list
python_script = Python(turn_into_list)
# ---------- python_script.python (14 lines) ----------
import clr
clr.AddReference('RevitAPI')
clr.AddReference('RevitAPIUI')
from Autodesk.Revit.DB import *
import Autodesk

footinginstances = IN
elementlist = list()
for item in footinginstances:
	try:
		elementlist.append(item.FootingType)
	except:
		emptylist = list()
OUT = elementlist
# ----------------------------------------
return_list_or_single_value = Custom[Return List Or Single Value](list_1=turn_into_list, list_2=python_script)  # If the list in input #1 has only one item, only the first item of the list in input #2 will be returned.
Footing_Type_s = Output(return_list_or_single_value)  # "Footing Type(s)"
