# Dynamo custom node Get Highest And Lowest From List.dyf (Dynamo 0.6.2.279)
# category: Clockwork.Lists
# Gets the highest and lowest value from a given list

list = Input()
sort = Sort(list)
reverse = Reverse(sort)
first_of_list = First(reverse)
highest = Output(first_of_list)
first_of_list_2 = First(sort)
lowest = Output(first_of_list_2)
