# Dynamo custom node Get Host.dyf (Dynamo 0.6.3.22045)
# category: Clockwork.Revit.HostedObjects
# Gets an element's host

element_s = Input()  # "element(s)"
turn_into_list = Custom[Turn Into List](item=element_s)  # Turns an element into a (flat) list
python_script = Python(turn_into_list)
# ---------- python_script.python (16 lines) ----------
import clr
clr.AddReference('RevitAPI')
clr.AddReference('RevitAPIUI')
from Autodesk.Revit.DB import *
import Autodesk

faminsts = IN
elementlist = list()
emptylist = list()
boollist = list()
for item in faminsts:
	try:
		elementlist.append(item.Host)
	except:
		elementlist.append(emptylist)
OUT = elementlist
# ----------------------------------------
return_list_or_single_value = Custom[Return List Or Single Value](list_1=turn_into_list, list_2=python_script)  # If the list in input #1 has only one item, only the first item of the list in input #2 will be returned.
host_s = Output(return_list_or_single_value)  # "host(s)"
