# Dynamo custom node Get Hosted Object Orientation.dyf (Dynamo 0.6.3.5244)
# category: Clockwork.Revit.HostedObjects
# Gets the orientation of a hosted object (e.g. a window or a door - orientation always facing towards exterior)

element_s = Input()  # "element(s)"
turn_into_list = Custom[Turn Into List](item=element_s)  # Turns an element into a (flat) list
python_script = Python(turn_into_list)
# ---------- python_script.python (14 lines) ----------
import clr
clr.AddReference('RevitAPI')
clr.AddReference('RevitAPIUI')
from Autodesk.Revit.DB import *
import Autodesk

objinstances = IN
vectorlist = list()
for item in objinstances:
	try:
		vectorlist.append(item.FacingOrientation)
	except:
		vectorlist.append(list())
OUT = vectorlist
# ----------------------------------------
return_list_or_single_value = Custom[Return List Or Single Value](list_1=turn_into_list, list_2=python_script)  # If the list in input #1 has only one item, only the first item of the list in input #2 will be returned.
xyz = Output(return_list_or_single_value)
