# Dynamo custom node Get Inserts Of Room Boundaries By Category.dyf (Dynamo 0.6.3.7375)
# category: Clockwork.Revit.Rooms
# Retrieves the inserts of the bounding elements of a given room - filtered by a given category.

BuiltInCategory = Input()
filter_list_by_category = Custom[Filter List By Category](BuiltInCategory=BuiltInCategory)  # Filters out all elements that are not of a specified category
Room_s = Input()  # "Room(s)"
Include_Openings = Input()  # "Include Openings?"
Include_Shadows = Input()  # "Include Shadows?"
Include_Embedded_Walls = Input()  # "Include Embedded Walls?"
Include_Shared_Embedded_Inserts = Input()  # "Include Shared Embedded Inserts?"
get_inserts_of_room_boundaries = Custom[Get Inserts Of Room Boundaries](Room_s=Room_s, Include_Openings=Include_Openings, Include_Shadows=Include_Shadows, Include_Embedded_Walls=Include_Embedded_Walls, Include_Shared_Embedded_Inserts=Include_Shared_Embedded_Inserts)  # Retrieves the inserts of the bounding elements of a given room.
map = Map(filter_list_by_category.in, get_inserts_of_room_boundaries)
Inserts = Output(map)
