# Dynamo custom node Get Inserts Of Room Boundaries.dyf (Dynamo 0.6.3.7375)
# category: Clockwork.Revit.Rooms
# Retrieves the inserts of the bounding elements of a given room.

flatten_completely = FlattenList()
Include_Openings = Input()  # "Include Openings?"
Include_Shadows = Input()  # "Include Shadows?"
Include_Embedded_Walls = Input()  # "Include Embedded Walls?"
Include_Shared_Embedded_Inserts = Input()  # "Include Shared Embedded Inserts?"
get_inserts = Custom[Get Inserts](Include_Openings=Include_Openings, Include_Shadows=Include_Shadows, Include_Embedded_Walls=Include_Embedded_Walls, Include_Shared_Embedded_Inserts=Include_Shared_Embedded_Inserts)  # Gets all the objects inserted into a given element.
Room_s = Input()  # "Room(s)"
get_room_boundaries = Custom[Get Room Boundaries](Room_s=Room_s)  # Gets a list of all boundary elements of a given room
map = Map(get_inserts, get_room_boundaries.Elements)
map_2 = Map(flatten_completely, map)
Insert_s = Output(map_2)  # "Insert(s)"
