# Dynamo custom node Get Inserts.dyf (Dynamo 0.6.3.5244)
# category: Clockwork.Revit.HostedObjects
# Gets all the objects inserted into a given element.

Element_s = Input()  # "Element(s)"
turn_into_list = Custom[Turn Into List](item=Element_s)  # Turns an element into a (flat) list
Include_Openings = Input()  # "Include Openings?"
Include_Shadows = Input()  # "Include Shadows?"
Include_Embedded_Walls = Input()  # "Include Embedded Walls?"
Include_Shared_Embedded_Inserts = Input()  # "Include Shared Embedded Inserts?"
revit_document = RevitDocument(lacing=Longest)
python_script_with_variable = Python(turn_into_list, Include_Openings, Include_Shadows, Include_Embedded_Walls, Include_Shared_Embedded_Inserts, revit_document)  # "Python Script With Variable Number of Inputs"
# ---------- python_script_with_variable.python (20 lines) ----------
import clr
clr.AddReference('RevitAPI')
clr.AddReference('RevitAPIUI')
from Autodesk.Revit.DB import *
import Autodesk

items = IN0
incopenings = IN1
incshadows = IN2
incwalls = IN3
incshared = IN4
doc = IN5
elementlist = list()

for item in items:
	itemlist = list()
	for insert in item.FindInserts(incopenings,incshadows,incwalls,incshared):
		itemlist.append(doc.GetElement(insert))
	elementlist.append(itemlist)
OUT = elementlist
# ----------------------------------------
return_list_or_single_value = Custom[Return List Or Single Value](list_1=turn_into_list, list_2=python_script_with_variable)  # If the list in input #1 has only one item, only the first item of the list in input #2 will be returned.
Inserts = Output(return_list_or_single_value)
