# Dynamo custom node Get Links And Imports.dyf (Dynamo 0.6.2.29585)
# category: Clockwork.Revit.Project
# Gets all linked and imported files in the document

revit_document = RevitDocument(lacing=Longest)
python_script = Python(revit_document)
# ---------- python_script.python (19 lines) ----------
import clr
clr.AddReference('RevitAPI')
clr.AddReference('RevitAPIUI')
from Autodesk.Revit.DB import *
import Autodesk

doc = IN

# need to learn how to implement LINQ here...
collector = FilteredElementCollector(doc)
impinst = collector.OfClass(ImportInstance).ToElements()
linkedlist = list()
importlist = list()
for item in impinst:
	if item.IsLinked:
		linkedlist.append(item)
	else:
		importlist.append(item)
OUT = (linkedlist,importlist)
# ----------------------------------------
first_of_list = First(python_script)
links = Output(first_of_list)
formula = Formula("1", lacing=Longest)
get_from_list = GetFromList(formula, python_script)
imports = Output(get_from_list)
