# Dynamo custom node Get Material Properties.dyf (Dynamo 0.6.3.7375)
# category: Clockwork.Revit.Material
# Retrieves a number of properties froma given material

Material_s = Input()  # "Material(s)"
turn_into_list = Custom[Turn Into List](item=Material_s)  # Turns an element into a (flat) list
python_script = Python(turn_into_list)
# ---------- python_script.python (26 lines) ----------
import clr
clr.AddReference('RevitAPI')
clr.AddReference('RevitAPIUI')
from Autodesk.Revit.DB import *
import Autodesk

mats = IN
colorlist = list()
glowlist = list()
classlist = list()
shinylist = list()
smoothlist = list()
translist = list()


for mat in mats:
	colorlist.append(mat.Color)
	if mat.Glow:
		glowlist.append(1)
	else:
		glowlist.append(0)
	classlist.append(mat.MaterialClass)
	shinylist.append(mat.Shininess)
	smoothlist.append(mat.Smoothness)
	translist.append(mat.Transparency)
OUT = (classlist,colorlist,glowlist,shinylist,smoothlist,translist)
# ----------------------------------------
first_of_list = First(python_script)
Class = Output(first_of_list)
number = DoubleInput(1)
get_from_list = GetFromList(number, python_script)
Color = Output(get_from_list)
number_2 = DoubleInput(2)
get_from_list_2 = GetFromList(number_2, python_script)
Glow_bool = Output(get_from_list_2)  # "Glow (bool)"
number_3 = DoubleInput(3)
get_from_list_3 = GetFromList(number_3, python_script)
Shininess = Output(get_from_list_3)  # "Shininess (%)"
number_4 = DoubleInput(4)
get_from_list_4 = GetFromList(number_4, python_script)
Smoothness = Output(get_from_list_4)  # "Smoothness (%)"
number_5 = DoubleInput(5)
get_from_list_5 = GetFromList(number_5, python_script)
Transparency = Output(get_from_list_5)  # "Transparency (%)"
