# Dynamo custom node Get Materials From Element.dyf (Dynamo 0.6.3.7375)
# category: Clockwork.Revit.Material
# Retrieves all materials froma given element

revit_document = RevitDocument(lacing=Longest)
Element_s = Input()  # "Element(s)"
turn_into_list = Custom[Turn Into List](item=Element_s)  # Turns an element into a (flat) list
Include_paint_materials = Input()  # "Include paint materials?"
python_script_with_variable = Python(revit_document, turn_into_list, Include_paint_materials)  # "Python Script With Variable Number of Inputs"
# ---------- python_script_with_variable.python (25 lines) ----------
import clr
clr.AddReference('RevitAPI')
clr.AddReference('RevitAPIUI')
from Autodesk.Revit.DB import *
import Autodesk

doc = IN0
items = IN1
paintedmats = IN2
elementmats = list()
elementareas = list()
elementvols = list()

for item in items:
	matlist = list()
	arealist = list()
	vollist = list()
	for matid in item.GetMaterialIds(paintedmats):
		matlist.append(doc.GetElement(matid))
		arealist.append(item.GetMaterialArea(matid,paintedmats))
		vollist.append(item.GetMaterialVolume(matid))
	elementmats.append(matlist)
	elementareas.append(arealist)
	elementvols.append(vollist)
OUT = (elementmats,elementareas,elementvols)
# ----------------------------------------
first_of_list = First(python_script_with_variable)
Materials = Output(first_of_list)
number = DoubleInput(1)
get_from_list = GetFromList(number, python_script_with_variable)
Material_Areas_sqft = Output(get_from_list)  # "Material Areas (sqft)"
number_2 = DoubleInput(2)
get_from_list_2 = GetFromList(number_2, python_script_with_variable)
Material_Volumes_cbft = Output(get_from_list_2)  # "Material Volumes (cbft)"
