# Dynamo custom node Get Members.dyf (Dynamo 0.6.3.5259)
# category: Clockwork.Scripting
# Gets a list of all members (properties and methods) of a selected element

element_s = Input()  # "element(s)"
turn_into_list = Custom[Turn Into List](item=element_s)  # Turns an element into a list
python_script = Python(turn_into_list)
# ---------- python_script.python (12 lines) ----------
import clr
clr.AddReference('RevitAPI')
clr.AddReference('RevitAPIUI')
from Autodesk.Revit.DB import *
import Autodesk

items = IN
elementlist = list()

for item in items:
	elementlist.append(dir(item))
OUT = elementlist
# ----------------------------------------
return_list_or_single_value = Custom[Return List Or Single Value](list_1=turn_into_list, list_2=python_script)  # If the list in input #1 has only one item, only the first item of the list in input #2 will be returned.
members = Output(return_list_or_single_value)
