# Dynamo custom node Get Name.dyf (Dynamo 0.6.3.5244)
# category: Clockwork.Revit.Properties
# Gets the name of a given Revit element (if possible)

element_s = Input()  # "element(s)"
turn_into_list = Custom[Turn Into List](item=element_s)  # Turns an element into a (flat) list
python_script = Python(turn_into_list)
# ---------- python_script.python (17 lines) ----------
import clr
clr.AddReference('RevitAPI')
clr.AddReference('RevitAPIUI')
from Autodesk.Revit.DB import *
import Autodesk

items = IN
elementlist = list()
for item in items:
	try:
		elementlist.append(item.Name)
	except:
		try:
			elementlist.append(item.get_Parameter(BuiltInParameter.SYMBOL_NAME_PARAM).AsString())
		except:
			donothing = 1
OUT = elementlist
# ----------------------------------------
return_list_or_single_value = Custom[Return List Or Single Value](list_1=turn_into_list, list_2=python_script)  # If the list in input #1 has only one item, only the first item of the list in input #2 will be returned.
name_s = Output(return_list_or_single_value)  # "name(s)"
