# Dynamo custom node Get Owner View.dyf (Dynamo 0.6.3.7375)
# category: Clockwork.Revit.Properties
# Gets the owner view of a given Revit element (if possible)

element_s = Input()  # "element(s)"
turn_into_list = Custom[Turn Into List](item=element_s)  # Turns an element into a (flat) list
revit_document = RevitDocument(lacing=Longest)
python_script_with_variable = Python(turn_into_list, revit_document)  # "Python Script With Variable Number of Inputs"
# ---------- python_script_with_variable.python (15 lines) ----------
import clr
clr.AddReference('RevitAPI')
clr.AddReference('RevitAPIUI')
from Autodesk.Revit.DB import *
import Autodesk

items = IN0
doc = IN1
elementlist = list()
for item in items:
	try:
		elementlist.append(doc.GetElement(item.OwnerViewId))
	except:
		elementlist.append(list())
OUT = elementlist
# ----------------------------------------
return_list_or_single_value = Custom[Return List Or Single Value](list_1=turn_into_list, list_2=python_script_with_variable)  # If the list in input #1 has only one item, only the first item of the list in input #2 will be returned.
view_s = Output(return_list_or_single_value)  # "view(s)"
