# Dynamo custom node Get Phase by Name.dyf (Dynamo 0.6.3.31052)
# category: Clockwork.Revit.Phases
# Returns the phase of a given name (if it exists)

list_phases = Custom[List Phases]()  # Lists all phases in the active document
str = Input()
equal = Equal(arg1=str)
get_name = Custom[Get Name](element_s=list_phases)  # Gets the name of a given Revit element (if possible)
turn_into_list = Custom[Turn Into List](item=get_name)  # Turns an element into a (flat) list
map = Map(equal, turn_into_list)
filter_by_boolean_mask = FilterMask(list_phases, map)
is_empty_list = IsEmpty(filter_by_boolean_mask)
first_of_list = First(filter_by_boolean_mask)
if_ = Conditional(is_empty_list, filter_by_boolean_mask, first_of_list)
phase = Output(if_)
