# Dynamo custom node Get Phases.dyf (Dynamo 0.6.3.5291)
# category: Clockwork.Revit.Phases
# Gets the created and demolished phases of an element

revit_document = RevitDocument(lacing=Longest)
Element_s = Input()  # "Element(s)"
turn_into_list = Custom[Turn Into List](item=Element_s)  # Turns an element into a (flat) list
python_script_with_variable = Python(revit_document, turn_into_list)  # "Python Script With Variable Number of Inputs"
# ---------- python_script_with_variable.python (25 lines) ----------
import clr
clr.AddReference('RevitAPI')
clr.AddReference('RevitAPIUI')
from Autodesk.Revit.DB import *
import Autodesk

doc = IN0
items = IN1
createdlist = list()
demolist = list()

for item in items:
	try:
		if item.CreatedPhaseId.IntegerValue == -1:
			createdlist.append(list())
		else:
			createdlist.append(doc.GetElement(item.CreatedPhaseId))
		if item.DemolishedPhaseId.IntegerValue == -1:
			demolist.append(list())
		else:
			demolist.append(doc.GetElement(item.DemolishedPhaseId))
	except:
		createdlist.append(list())
		demolist.append(list())
OUT = (createdlist,demolist)
# ----------------------------------------
first_of_list = First(python_script_with_variable)
Created = Output(first_of_list)
number = DoubleInput(1)
get_from_list = GetFromList(number, python_script_with_variable)
Demolished = Output(get_from_list)
