# Dynamo custom node Get Project Info.dyf (Dynamo 0.6.2.29585)
# category: Clockwork.Revit.Project
# Gets the project information.

revit_document = RevitDocument(lacing=Longest)
python_script = Python(revit_document)
# ---------- python_script.python (24 lines) ----------
import clr
clr.AddReference('RevitAPI')
clr.AddReference('RevitAPIUI')
from Autodesk.Revit.DB import *
import Autodesk

doc = IN
elementlist = list()
projinfo = doc.ProjectInformation
elementlist.append(projinfo.OrganizationName)
elementlist.append(projinfo.OrganizationDescription)
elementlist.append(projinfo.BuildingName)
# this property seems to be missing in some files - weird...
try:
	elementlist.append(projinfo.Author)
except:
	elementlist.append('')
elementlist.append(projinfo.IssueDate)
elementlist.append(projinfo.Status)
elementlist.append(projinfo.ClientName)
elementlist.append(projinfo.Address)
elementlist.append(projinfo.Name)
elementlist.append(projinfo.Number)
OUT = elementlist
# ----------------------------------------
first_of_list = First(python_script)
OrganizationName = Output(first_of_list)
formula = Formula("1", lacing=Longest)
get_from_list = GetFromList(formula, python_script)
OrganizationDescription = Output(get_from_list)
formula_2 = Formula("2", lacing=Longest)
get_from_list_2 = GetFromList(formula_2, python_script)
BuildingName = Output(get_from_list_2)
formula_3 = Formula("3", lacing=Longest)
get_from_list_3 = GetFromList(formula_3, python_script)
Author = Output(get_from_list_3)
formula_4 = Formula("4", lacing=Longest)
get_from_list_4 = GetFromList(formula_4, python_script)
IssueDate = Output(get_from_list_4)
formula_5 = Formula("5", lacing=Longest)
get_from_list_5 = GetFromList(formula_5, python_script)
Status = Output(get_from_list_5)
formula_6 = Formula("6", lacing=Longest)
get_from_list_6 = GetFromList(formula_6, python_script)
ClientName = Output(get_from_list_6)
formula_7 = Formula("7", lacing=Longest)
get_from_list_7 = GetFromList(formula_7, python_script)
Address = Output(get_from_list_7)
formula_8 = Formula("8", lacing=Longest)
get_from_list_8 = GetFromList(formula_8, python_script)
Name = Output(get_from_list_8)
formula_9 = Formula("9", lacing=Longest)
get_from_list_9 = GetFromList(formula_9, python_script)
Number = Output(get_from_list_9)
