# Dynamo custom node Get Project Position.dyf (Dynamo 0.6.2.29585)
# category: Clockwork.Revit.Project
# Gets the project's position data relative to XYZ.Zero.

revit_document = RevitDocument(lacing=Longest)
python_script = Python(revit_document)
# ---------- python_script.python (12 lines) ----------
import clr
clr.AddReference('RevitAPI')
clr.AddReference('RevitAPIUI')
from Autodesk.Revit.DB import *
import Autodesk

doc = IN

projloc = doc.ActiveProjectLocation
position_data = projloc.ProjectPosition[XYZ.Zero]
location_data = projloc.SiteLocation
OUT = (position_data.Angle,position_data.Elevation,position_data.EastWest,position_data.NorthSouth, location_data.Latitude, location_data.Longitude)
# ----------------------------------------
first_of_list = First(python_script)
Angle = Output(first_of_list)
formula = Formula("1", lacing=Longest)
get_from_list = GetFromList(formula, python_script)
Elevation = Output(get_from_list)
formula_2 = Formula("2", lacing=Longest)
get_from_list_2 = GetFromList(formula_2, python_script)
EastWest = Output(get_from_list_2)
formula_3 = Formula("3", lacing=Longest)
get_from_list_3 = GetFromList(formula_3, python_script)
NorthSouth = Output(get_from_list_3)
formula_4 = Formula("4", lacing=Longest)
get_from_list_4 = GetFromList(formula_4, python_script)
Latitude = Output(get_from_list_4)
formula_5 = Formula("5", lacing=Longest)
get_from_list_5 = GetFromList(formula_5, python_script)
Longitude = Output(get_from_list_5)
