# Dynamo custom node Get Roof Type.dyf (Dynamo 0.6.3.5262)
# category: Clockwork.Revit.Roof & Floor
# Retrieves the roof type for  a given roof instance

Roof_Instance_s = Input()  # "Roof Instance(s)"
turn_into_list = Custom[Turn Into List](item=Roof_Instance_s)  # Turns an element into a list
python_script = Python(turn_into_list)
# ---------- python_script.python (14 lines) ----------
import clr
clr.AddReference('RevitAPI')
clr.AddReference('RevitAPIUI')
from Autodesk.Revit.DB import *
import Autodesk

roofinstances = IN
elementlist = list()
for item in roofinstances:
	try:
		elementlist.append(item.RoofType)
	except:
		emptylist = list()
OUT = elementlist
# ----------------------------------------
return_list_or_single_value = Custom[Return List Or Single Value](list_1=turn_into_list, list_2=python_script)  # If the list in input #1 has only one item, only the first item of the list in input #2 will be returned.
Roof_Type_s = Output(return_list_or_single_value)  # "Roof Type(s)"
