# Dynamo custom node Get Room Boundaries.dyf (Dynamo 0.6.3.7375)
# category: Clockwork.Revit.Rooms
# Gets a list of all boundary elements of a given room

Room_s = Input()  # "Room(s)"
turn_into_list = Custom[Turn Into List](item=Room_s)  # Turns an element into a list
remove_duplicate_revit_elements = Custom[Remove Duplicate Revit Elements From List]()  # Removes all duplicates of Revit elements from a given list. (Will also remove any other duplicates from a list...)
revit_document = RevitDocument(lacing=Longest)
python_script_with_variable = Python(revit_document, turn_into_list)  # "Python Script With Variable Number of Inputs"
# ---------- python_script_with_variable.python (38 lines) ----------
import clr
clr.AddReference('RevitAPI')
clr.AddReference('RevitAPIUI')
from Autodesk.Revit.DB import *
import Autodesk

doc = IN0
items = IN1
elementlist = list()
curvelist = list()

calculator = SpatialElementGeometryCalculator(doc)
options = Autodesk.Revit.DB.SpatialElementBoundaryOptions()
for item in items:
	# method #1 - get boundary segments
	# this will get all bounding items in floor plan
	blist = list()
	clist = list()
	try:
		for boundarylist in item.GetBoundarySegments(options):
			for boundary in boundarylist:
				blist.append(boundary.Element)
				clist.append(boundary.Curve)
	except:
		donothing = 1
	# method #2 - spatial element geometry calculator
	# this will get other bounding items like roofs and floors, too
	try:
		results = calculator.CalculateSpatialElementGeometry(item)
		for face in results.GetGeometry().Faces:
			for bface in results.GetBoundaryFaceInfo(face):
				blist.append(doc.GetElement(bface.SpatialBoundaryElement.HostElementId))
	except:
		donothing = 1
	# write results to list
	elementlist.append(blist)
	curvelist.append(clist)
OUT = (elementlist,curvelist)
# ----------------------------------------
first_of_list = First(python_script_with_variable)
map = Map(remove_duplicate_revit_elements.elements, first_of_list)
return_list_or_single_value = Custom[Return List Or Single Value](list_1=turn_into_list, list_2=map)  # If the list in input #1 has only one item, only the first item of the list in input #2 will be returned.
Elements = Output(return_list_or_single_value)
number = DoubleInput(1)
get_from_list = GetFromList(number, python_script_with_variable)
return_list_or_single_value_2 = Custom[Return List Or Single Value](list_1=turn_into_list, list_2=get_from_list)
Curves = Output(return_list_or_single_value_2)
