# Dynamo custom node Get Third XYZ Axis.dyf (Dynamo 0.6.3.7375)
# category: Clockwork.XYZ
# Given two main XYZ axes (or vectors pointing more or less in thei general direction), this node will find the third axis.

XYZ = Xyz(lacing=Longest)
xyz_axis_1 = Input()  # "xyz (axis 1)"
xyz_axis_from_vector = Custom[XYZ Axis From Vector](xyz=xyz_axis_1)  # Returns whichever main axis (X, Y or Z) is closest to a given vector
xyz_axis_2 = Input()  # "xyz (axis 2)"
xyz_axis_from_vector_2 = Custom[XYZ Axis From Vector](xyz=xyz_axis_2)
list = NewList(index0=XYZ, index1=xyz_axis_from_vector.xyz, index2=xyz_axis_from_vector_2.xyz)
best_fit_plane = BestFitPlane(list, lacing=Longest)
xyz = Output(best_fit_plane.out1)
xyz_components = XyzComponents(best_fit_plane.out1, lacing=Longest)
formula = Formula("Abs(x)>Abs(y) && Abs(x)>Abs(z)", x=xyz_components.out0, y=xyz_components.out1, z=xyz_components.out2, lacing=Longest)
string = StringInput("X")
formula_2 = Formula("Abs(y)>Abs(x) && Abs(y)>Abs(z)", y=xyz_components.out1, x=xyz_components.out0, z=xyz_components.out2, lacing=Longest)
string_2 = StringInput("Y")
string_3 = StringInput("Z")
if_ = Conditional(formula_2, string_2, string_3)
if_2 = Conditional(formula, string, if_)
string_4 = Output(if_2)  # "string"
