# Dynamo custom node Get Underlay From Plan View.dyf (Dynamo 0.6.3.5263)
# category: Clockwork.Revit.Views
# Returns the view template assigned to a given view (if one is assigned)

Plan_s = Input()  # "Plan(s)"
turn_into_list = Custom[Turn Into List](item=Plan_s)  # Turns an element into a list
revit_document = RevitDocument(lacing=Longest)
python_script_with_variable = Python(revit_document, turn_into_list)  # "Python Script With Variable Number of Inputs"
# ---------- python_script_with_variable.python (19 lines) ----------
import clr
clr.AddReference('RevitAPI')
clr.AddReference('RevitAPIUI')
from Autodesk.Revit.DB import *
import Autodesk

doc = IN0
views = IN1
elementlist = list()

for view in views:
	try:
		if view.get_Parameter(BuiltInParameter.VIEW_UNDERLAY_ID).AsElementId().IntegerValue == -1:
			elementlist.append(list())
		else:
			elementlist.append(doc.GetElement(view.get_Parameter(BuiltInParameter.VIEW_UNDERLAY_ID).AsElementId()))
	except:
		elementlist.append(list())
OUT = elementlist
# ----------------------------------------
return_list_or_single_value = Custom[Return List Or Single Value](list_1=turn_into_list, list_2=python_script_with_variable)  # If the list in input #1 has only one item, only the first item of the list in input #2 will be returned.
Level_s = Output(return_list_or_single_value)  # "Level(s)"
