# Dynamo custom node Get View Scale.dyf (Dynamo 0.6.3.5263)
# category: Clockwork.Revit.Views
# Returns the scale of a given view

View_s = Input()  # "View(s)"
turn_into_list = Custom[Turn Into List](item=View_s)  # Turns an element into a list
python_script = Python(turn_into_list)
# ---------- python_script.python (14 lines) ----------
import clr
clr.AddReference('RevitAPI')
clr.AddReference('RevitAPIUI')
from Autodesk.Revit.DB import *
import Autodesk

views = IN
elementlist = list()
for view in views:
	try:
		elementlist.append(view.Scale)
	except:
		elementlist.append(list())
OUT = elementlist
# ----------------------------------------
Scale_s_1 = Output(python_script)  # "Scale(s) 1:X"
