# Dynamo custom node Get View-Dependent Family Instances By Category.dyf (Dynamo 0.6.3.5244)
# category: Clockwork.Revit.Categories
# Gets all view-dependent family instances in a given view for a given list of categories - useful for finding annotation elements

revit_document = RevitDocument(lacing=Longest)
BuiltInCategories = Input()
turn_into_list = Custom[Turn Into List](item=BuiltInCategories)  # Turns an element into a (flat) list
View_s = Input()  # "View(s)"
turn_into_list_2 = Custom[Turn Into List](item=View_s)
python_script_with_variable = Python(revit_document, turn_into_list, turn_into_list_2)  # "Python Script With Variable Number of Inputs"
# ---------- python_script_with_variable.python (20 lines) ----------
import clr
clr.AddReference('RevitAPI')
clr.AddReference('RevitAPIUI')
from Autodesk.Revit.DB import *
import Autodesk

doc = IN0
cats = IN1
views = IN2

elementlist = list()
# This could be more elegant if only I knew how to implement a Multicategory filter in Python....
for cat in cats:
	catlist = list()
	for view in views:
		collector = FilteredElementCollector(doc)
		filter = ElementOwnerViewFilter(view.Id)
		catlist.append(collector.WherePasses(filter).OfCategory(cat).ToElements())
	elementlist.append(catlist)
OUT = elementlist
# ----------------------------------------
list = Output(python_script_with_variable)
