# Dynamo custom node Get Views On Sheet.dyf (Dynamo 0.6.3.5260)
# category: Clockwork.Revit.Views
# Returns all views placed on a specified sheet

Sheet_s = Input()  # "Sheet(s)"
turn_into_list = Custom[Turn Into List](item=Sheet_s)  # Turns an element into a list
revit_document = RevitDocument(lacing=Longest)
python_script_with_variable = Python(revit_document, turn_into_list)  # "Python Script With Variable Number of Inputs"
# ---------- python_script_with_variable.python (23 lines) ----------
import clr
clr.AddReference('RevitAPI')
clr.AddReference('RevitAPIUI')
from Autodesk.Revit.DB import *
import Autodesk

doc = IN0
sheets = IN1
elementlist = list()

for sheet in sheets:
	try:
		viewlist = list()
		for item in sheet.Views:
			viewlist.append(item)
		# schedules need to be collected separately...
		collector = FilteredElementCollector(doc, sheet.Id).OfClass(ScheduleSheetInstance)
		for item in collector:
			viewlist.append(doc.GetElement(item.ScheduleId))
		elementlist.append(viewlist)
	except:
		elementlist.append(list())
OUT = elementlist
# ----------------------------------------
return_list_or_single_value = Custom[Return List Or Single Value](list_1=turn_into_list, list_2=python_script_with_variable)  # If the list in input #1 has only one item, only the first item of the list in input #2 will be returned.
Views = Output(return_list_or_single_value)
