# Dynamo custom node Get Wall Orientation.dyf (Dynamo 0.6.3.5256)
# category: Clockwork.Revit.Wall
# Gets the orientation of a given wall instance (normal of the exterior face of the wall). Will *not* work for walls hosted on mass faces or in-place walls.

Wall_Instance_s = Input()  # "Wall Instance(s)"
turn_into_list = Custom[Turn Into List](item=Wall_Instance_s)  # Turns an element into a (flat) list
python_script = Python(turn_into_list)
# ---------- python_script.python (14 lines) ----------
import clr
clr.AddReference('RevitAPI')
clr.AddReference('RevitAPIUI')
from Autodesk.Revit.DB import *
import Autodesk

wallinstances = IN
vectorlist = list()
for item in wallinstances:
	try:
		vectorlist.append(item.Orientation)
	except:
		vectorlist.append(list())
OUT = vectorlist
# ----------------------------------------
xyz = Output(python_script)
