# Dynamo custom node Get Wall Type.dyf (Dynamo 0.6.3.5259)
# category: Clockwork.Revit.Wall
# Gets the wall type of a given wall instance.

Wall_Instance_s = Input()  # "Wall Instance(s)"
turn_into_list = Custom[Turn Into List](item=Wall_Instance_s)  # Turns an element into a list
revit_document = RevitDocument(lacing=Longest)
python_script_with_variable = Python(revit_document, turn_into_list)  # "Python Script With Variable Number of Inputs"
# ---------- python_script_with_variable.python (15 lines) ----------
import clr
clr.AddReference('RevitAPI')
clr.AddReference('RevitAPIUI')
from Autodesk.Revit.DB import *
import Autodesk

doc = IN0
wallinstances = IN1
typelist = list()
for item in wallinstances:
	try: 
		typelist.append(doc.GetElement(item.GetTypeId()))
	except:
		donothing = 1
OUT = typelist
# ----------------------------------------
return_list_or_single_value = Custom[Return List Or Single Value](list_1=turn_into_list, list_2=python_script_with_variable)  # If the list in input #1 has only one item, only the first item of the list in input #2 will be returned.
Wall_Type_s = Output(return_list_or_single_value)  # "Wall Type(s)"
