# Dynamo custom node Grey.dyf (Dynamo 0.6.3.5262)
# category: Clockwork.Colours
# Returns the colour grey.

number = DoubleInput(0)
number_2 = DoubleInput(128)
color = Color(number, number_2, number_2, number_2, lacing=Longest)
n128_128_128 = Output(color)  # "128,128,128"
