# Dynamo custom node Group Elements By Host.dyf (Dynamo 0.6.3.22045)
# category: Clockwork.Revit.HostedObjects
# Groups a list of Revit elements by their respective hosts (if they have any)

number = DoubleInput(1)
get_from_list = GetFromList(number)
transpose_lists = Transpose()
Element_s = Input()  # "Element(s)"
get_host = Custom[Get Host](element_s=Element_s)  # Gets an element's host
turn_into_list = Custom[Turn Into List](item=get_host)  # Turns an element into a (flat) list
is_null = IsNull()
map = Map(is_null, turn_into_list)
filter_by_boolean_mask = FilterMask(turn_into_list, map)
elements_to_ids = Custom[Elements to IDs](Element_s=filter_by_boolean_mask.out1)  # Gets the ID(s) for a list of Revit elements (or a single element)
turn_into_list_2 = Custom[Turn Into List](item=Element_s)
filter_by_boolean_mask_2 = FilterMask(turn_into_list_2, map)
list = NewList(index0=elements_to_ids.ID_s, index1=filter_by_boolean_mask_2.out1)
number_2 = DoubleInput(0)
boolean = BoolSelector(false)
sort_list_of_lists = Custom[Sort List Of Lists](List_of_lists=list, Sort_index=number_2, Case_insensitive=boolean, Order_Descending=boolean)  # Sorts a list of lists by one of its sublists
group_list_of_lists_by_key = Custom[Group List of Lists By Key](list=sort_list_of_lists, key_index=number_2)  # Groups a list of lists by one of its keys
map_2 = Map(transpose_lists, group_list_of_lists_by_key)
map_3 = Map(get_from_list, map_2)
Hosted = Output(map_3)
first_of_list = First()
first_of_list_2 = First()
map_4 = Map(first_of_list_2, map_2)
map_5 = Map(first_of_list, map_4)
ids_to_elements = Custom[IDs to Elements](ID_s=map_5)  # Gets the Revit element(s) for a list of IDs (or a single ID)
Host_s = Output(ids_to_elements.Element_s)  # "Host(s)"
Unhosted = Output(filter_by_boolean_mask_2.out0)
