# Dynamo custom node Group List of Lists By Key.dyf (Dynamo 0.6.3.5263)
# category: Clockwork.Lists.Sublists
# Groups a list of lists by one of its keys

list = Input()
transpose_lists = Transpose(list)
key_index = Input()
python_script_with_variable = Python(transpose_lists, key_index)  # "Python Script With Variable Number of Inputs"
# ---------- python_script_with_variable.python (11 lines) ----------
from itertools import groupby
items = IN0
groupindex = int(IN1)
listlist = list()

for key, group in groupby(items, lambda x: x[groupindex]):
	elementlist = list()
	for thing in group:
		elementlist.append(thing)
	listlist.append(elementlist)
OUT = listlist
# ----------------------------------------
list_2 = Output(python_script_with_variable)  # "list"
