# Dynamo custom node Has Instances of Categories.dyf (Dynamo 0.6.3.5244)
# category: Clockwork.Revit.Categories
# Checks if family instances of specified categories are present in the model.

list_not_empty = Custom[List Not Empty]()  # Just the inversion of the built-in Is Empty List node.
BuiltInCategories = Input()
get_family_instances_by_category = Custom[Get Family Instances By Category](BuiltInCategories=BuiltInCategories)  # Gets all family instances in the model for a given list of categories
map = Map(list_not_empty, get_family_instances_by_category)
true_for_any_boolean = Custom[True For Any (Boolean)](seq=map)  # Returns true if any item in a list of booleans is true.
any = Output(true_for_any_boolean)  # "any?"
true_for_all_boolean = Custom[True For All (Boolean)](seq=map)  # Returns true if all items in a list of booleans are true.
all = Output(true_for_all_boolean)  # "all?"
per_category = Output(map)
instances = Output(get_family_instances_by_category)
