# Dynamo custom node Has Out-Of-Plane XYZs.dyf (Dynamo 0.6.3.5256)
# category: Clockwork.XYZ
# Checks a list for XYZs that are not located on a given plane

face_plane = Input()  # "face/plane"
tolerance = Input()
xyz_is_out_of_plane = Custom[XYZ Is Out-Of-Plane](face_plane=face_plane, tolerance=tolerance)  # Checks a list for XYZs that are not located on a given plane
list = Input()
map = Map(xyz_is_out_of_plane, list)
true_for_any_boolean = Custom[True For Any (Boolean)](seq=map)  # Returns true if any item in a list of booleans is true.
bool = Output(true_for_any_boolean)
