# Dynamo custom node Horizontal Intersects For Divided Surface by Endpoints and Function.dyf (Dynamo 0.6.3.5262)
# category: Clockwork.Revit.DividedSurfaces
# Creates a number of horizontal intersects (levels)for a divided surface based on the path between two points. The spacing of the intersects can be controlled by a function.

DivSurf = Input()
f_x = Input()  # "f(x)"
Subdivisions = Input()
n1 = Custom[+1](Subdivisions)  # Increments a value by 1
normalized_sequence_by_function = Custom[Normalized Sequence by Function](f_x=f_x, N=n1)  # Creates a sequence of N values between 0 and 1 driven by a function
XYZ_Start = Input()  # "XYZ (Start)"
xyz_z = XyzGetZ(XYZ_Start, lacing=Longest)
XYZ_End = Input()  # "XYZ (End)"
xyz_z_2 = XyzGetZ(XYZ_End, lacing=Longest)
scale_normalized_value = Custom[Scale Normalized Value](val=normalized_sequence_by_function, Min=xyz_z, Max=xyz_z_2)  # Scales a normalized value according to a given minimum and maximum
rest_of_list = Rest(scale_normalized_value)
reverse = Reverse(rest_of_list)
rest_of_list_2 = Rest(reverse)
reverse_2 = Reverse(rest_of_list_2)
Intersect_Name = Input()
concat_strings = ConcatStrings(Intersect_Name)
n1_2 = Custom[-1](Subdivisions)  # Decrements a value by 1
number = DoubleInput(1..N, n1_2, lacing=Longest)
number_to_string = Num2String(number, lacing=Longest)
map = Map(concat_strings, number_to_string)
level = Level(reverse_2, map, lacing=Longest)
add_intersect_to_divided_surface = Custom[Add Intersect To Divided Surface](DivSurf=DivSurf, Element_s=level)  # Adds an intersect to a divided surface
DivSurf_2 = Output(add_intersect_to_divided_surface)  # "DivSurf"
Intersects = Output(level)
