# Dynamo custom node Horizontal Intersects For Divided Surface by Endpoints.dyf (Dynamo 0.6.3.7375)
# category: Clockwork.Revit.DividedSurfaces
# Creates a number of equally spaced horizontal intersects for a divided surface based on the path between between two points. PLEASE NOTE: This node will currently (v 0.6.3) only work correctly if Dynamo project units are set to metric feet.

DivSurf = Input()
Subdivisions = Input()
n1 = Custom[+1](Subdivisions)  # Increments a value by 1
normalized_sequence = Custom[Normalized Sequence](N=n1)  # Creates a sequence of N values between 0 and 1
XYZ_Start = Input()  # "XYZ (Start)"
xyz_z = XyzGetZ(XYZ_Start, lacing=Longest)
XYZ_End = Input()  # "XYZ (End)"
xyz_z_2 = XyzGetZ(XYZ_End, lacing=Longest)
scale_normalized_value = Custom[Scale Normalized Value](val=normalized_sequence, Min=xyz_z, Max=xyz_z_2)  # Scales a normalized value according to a given minimum and maximum
rest_of_list = Rest(scale_normalized_value)
reverse = Reverse(rest_of_list)
rest_of_list_2 = Rest(reverse)
reverse_2 = Reverse(rest_of_list_2)
Intersect_Name = Input()
concat_strings = ConcatStrings(Intersect_Name)
n1_2 = Custom[-1](Subdivisions)  # Decrements a value by 1
number = DoubleInput(1..N, n1_2, lacing=Longest)
number_to_string = Num2String(number, lacing=Longest)
map = Map(concat_strings, number_to_string)
level = Level(reverse_2, map, lacing=Longest)
add_intersect_to_divided_surface = Custom[Add Intersect To Divided Surface](DivSurf=DivSurf, Element_s=level)  # Adds an intersect to a divided surface
DivSurf_2 = Output(add_intersect_to_divided_surface)  # "DivSurf"
Intersects = Output(level)
