# Dynamo custom node Hypotenuse By Pythagoras.dyf (Dynamo 0.6.3.5260)
# category: Clockwork.Math.Formulas
# Computes the length of the hypotenuse of a right triangle using the Pythagorean Theorem. A and B are the legs / catheti of the triangle.

A = Input()
B = Input()
formula = Formula("Sqrt(Pow(a,2)+Pow(b,2))", a=A, b=B, lacing=Longest)
C = Output(formula)
