# Dynamo custom node IDs to Elements.dyf (Dynamo 0.6.3.5262)
# category: Clockwork.Revit
# Gets the Revit element(s) for a list of IDs (or a single ID)

ID_s = Input()  # "ID(s)"
turn_into_list = Custom[Turn Into List](item=ID_s)  # Turns an element into a list
revit_document = RevitDocument(lacing=Longest)
python_script_with_variable = Python(revit_document, turn_into_list)  # "Python Script With Variable Number of Inputs"
# ---------- python_script_with_variable.python (18 lines) ----------
# Default imports
import clr
clr.AddReference('RevitAPI')
clr.AddReference('RevitAPIUI')
from Autodesk.Revit.DB import *
import Autodesk

doc = IN0
items = IN1

elementlist = list()
unmatched = list()
for item in items:
	try: 
		elementlist.append(doc.GetElement(item))
	except:
		unmatched.append(item)
OUT = (elementlist, unmatched)
# ----------------------------------------
first_of_list = First(python_script_with_variable)
return_list_or_single_value = Custom[Return List Or Single Value](list_1=turn_into_list, list_2=first_of_list)  # If the list in input #1 has only one item, only the first item of the list in input #2 will be returned.
Element_s = Output(return_list_or_single_value)  # "Element(s)"
formula = Formula("1", lacing=Longest)
get_from_list = GetFromList(formula, python_script_with_variable)
unmatched = Output(get_from_list)
