# Dynamo custom node If Empty Replace With New Value.dyf (Dynamo 0.6.3.7375)
# category: Clockwork.Conditional
# Replaces an <empty> item with a specified value.  Use with Map for lists

item = Input()
is_empty = Custom[Is Empty](item_s=item)  # Checks if the input items are <empty>
replacement = Input()
if_ = Conditional(is_empty, replacement, item)
cleaned = Output(if_)
