# Dynamo custom node If X Greater Than Or Equal.dyf (Dynamo 0.6.3.7375)
# category: Clockwork.Conditional.Mappable
# If X >= Y as a mappable function

x = Input()
y = Input()
greater_than_or_equal = GreaterThanEquals(x, y)
true = Input()
# note: Why is this a custom node?
# So it can be used in conjunction with a Map node.
false = Input()
if_ = Conditional(greater_than_or_equal, true, false)
