# Dynamo custom node If X Less Than Or Equal.dyf (Dynamo 0.6.3.7375)
# category: Clockwork.Conditional.Mappable
# If X <= Y as a mappable function

x = Input()
y = Input()
less_than_or_equal = LessThanEquals(x, y)
true = Input()
false = Input()
# note: Why is this a custom node?
# So it can be used in conjunction with a Map node.
if_ = Conditional(less_than_or_equal, true, false)
