# Dynamo custom node Invert And Mirror Normalized Values.dyf (Dynamo 0.6.2.29585)
# category: Clockwork.Lists
# Inverts and mirrors (horizontally & vertically) a list of normalized values.

Mirror_Horizontally = Input()
reverse = Reverse()
Mirror_Vertically = Input()
Invert = Input()
invert_normalized_value = Custom[Invert Normalized Value]()  # Inverts a value between 0 and 1 or a boolean to its opposite (1-x)
# note: For questions email me at dieckmann@caad.arch.rwth-aachen.de
list = Input()
map = Map(invert_normalized_value, list)
# note: Invert the values (if applicable)
if_ = Conditional(Invert, map, list)
reverse_2 = Reverse(if_)
# note: Mirror the values vertically (if applicable)
if_2 = Conditional(Mirror_Vertically, reverse_2, if_)
X = Input()
n1 = Custom[-1](X)  # Decrements a value by 1
# note: We first have to partition the list in sublists - which then can be reversed
build_sublists = Sublists("0..n", if_2, X, n1, lacing=Longest)
map_2 = Map(reverse, build_sublists)
flatten_completely = FlattenList(map_2)
# note: Mirror the values horizontally (if applicable)
if_3 = Conditional(Mirror_Horizontally, flatten_completely, if_2)
