# Dynamo custom node Is Empty.dyf (Dynamo 0.6.3.7375)
# category: Clockwork.Conditional
# Checks if the input items are <empty>

item_s = Input()  # "item(s)"
turn_into_list = Custom[Turn Into List](item=item_s)  # Turns an element into a list
string = StringInput("<empty>")
equal = Equal(string)
to_string = ToString()
map = Map(to_string, turn_into_list)
map_2 = Map(equal, map)
return_list_or_single_value = Custom[Return List Or Single Value](list_1=turn_into_list, list_2=map_2)  # If the list in input #1 has only one item, only the first item of the list in input #2 will be returned.
bool = Output(return_list_or_single_value)
