# Dynamo custom node Is Even Number.dyf (Dynamo 0.6.3.5256)
# category: Clockwork.Math
# Checks if a number is even.

val = Input()
formula = Formula("Round(n,0)/2=Round(Round(n,0)/2,0)", n=val, lacing=Longest)
bool = Output(formula)
