# Dynamo custom node Is Multiple.dyf (Dynamo 0.6.2.26646)
# category: Clockwork.Math
# Checks if A is a multiple of B.

A = Input()
B = Input()
modulo = Modulo(A, B, lacing=Longest)
formula = Formula("x=0", modulo, lacing=Longest)
bool = Output(formula)
