# Dynamo custom node Is Of Category.dyf (Dynamo 0.6.3.5244)
# category: Clockwork.Revit.Categories
# Checks whether an element is of a specified category

element_s = Input()  # "element(s)"
turn_into_list = Custom[Turn Into List](item=element_s)  # Turns an element into a (flat) list
BuiltInCategory = Input()
python_script_with_variable = Python(turn_into_list, BuiltInCategory)  # "Python Script With Variable Number of Inputs"
# ---------- python_script_with_variable.python (15 lines) ----------
import clr
clr.AddReference('RevitAPI')
clr.AddReference('RevitAPIUI')
from Autodesk.Revit.DB import *
import Autodesk

elements = IN0
cat = IN1
elementlist = list()
for item in elements:
	if item.Category.Id.IntegerValue == int(cat):
		elementlist.append(1)
	else:
		elementlist.append(0)
OUT = (elementlist)
# ----------------------------------------
return_list_or_single_value = Custom[Return List Or Single Value](list_1=turn_into_list, list_2=python_script_with_variable)  # If the list in input #1 has only one item, only the first item of the list in input #2 will be returned.
bool = Output(return_list_or_single_value)
