# Dynamo custom node Is Point In Room.dyf (Dynamo 0.6.3.7375)
# category: Clockwork.Revit.Rooms
# Evaluates if an XYZ is located inside a given room.

XYZ_s = Input()  # "XYZ(s)"
turn_into_list = Custom[Turn Into List](item=XYZ_s)  # Turns an element into a (flat) list
Room = Input()
python_script_with_variable = Python(Room, turn_into_list)  # "Python Script With Variable Number of Inputs"
# ---------- python_script_with_variable.python (18 lines) ----------
import clr
clr.AddReference('RevitAPI')
clr.AddReference('RevitAPIUI')
from Autodesk.Revit.DB import *
import Autodesk

room = IN0
points = IN1
booleans = list()
for point in points:
	try:
		if room.IsPointInRoom(point):
			booleans.append(1)
		else:
			booleans.append(0)
	except:
		booleans.append(list())
OUT = booleans
# ----------------------------------------
return_list_or_single_value = Custom[Return List Or Single Value](list_1=turn_into_list, list_2=python_script_with_variable)  # If the list in input #1 has only one item, only the first item of the list in input #2 will be returned.
bool = Output(return_list_or_single_value)
