# Dynamo custom node Is Point Inside Polygon.dyf (Dynamo 0.6.3.7375)
# category: Clockwork.XYZ
# Determines if a point is inside the space enclosed by a polygon

Point_UV_s = Input()  # "Point UV(s)"
uv_components = Custom[UV Components](UV_s=Point_UV_s)  # Get the components of a UV
list = NewList(index0=uv_components.U, index1=uv_components.V)
transpose_lists = Transpose(list)
Polygon_UVs = Input()
uv_components_2 = Custom[UV Components](UV_s=Polygon_UVs)
list_2 = NewList(index0=uv_components_2.U, index1=uv_components_2.V)
transpose_lists_2 = Transpose(list_2)
python_script_with_variable = Python(transpose_lists_2, transpose_lists)  # "Python Script With Variable Number of Inputs"
# ---------- python_script_with_variable.python (32 lines) ----------
import clr
clr.AddReference('RevitAPI')
clr.AddReference('RevitAPIUI')
from Autodesk.Revit.DB import *
import Autodesk

# script found here:
# http://www.ariel.com.au/a/python-point-int-poly.html
# (with sight alterations for booleans)

def point_inside_polygon(x,y,poly):
    n = len(poly)
    inside = 0
    p1x,p1y = poly[0]
    for i in range(n+1):
        p2x,p2y = poly[i % n]
        if y > min(p1y,p2y):
            if y <= max(p1y,p2y):
                if x <= max(p1x,p2x):
                    if p1y != p2y:
                        xinters = (y-p1y)*(p2x-p1x)/(p2y-p1y)+p1x
                    if p1x == p2x or x <= xinters:
                        inside = 1 - inside
        p1x,p1y = p2x,p2y
    return inside
    
poly = IN0
points = IN1
elementlist = list()
for point in points:
	elementlist.append(point_inside_polygon(point[0],point[1],poly))
OUT = elementlist
# ----------------------------------------
return_list_or_single_value = Custom[Return List Or Single Value](list_1=transpose_lists, list_2=python_script_with_variable)  # If the list in input #1 has only one item, only the first item of the list in input #2 will be returned.
bool = Output(return_list_or_single_value)
