# Dynamo custom node Is Related To Mass.dyf (Dynamo 0.6.3.35252)
# category: Clockwork.Revit
# Returns true if an object (wall, roof, floor or curtain system) has been modelled by face and the underlying mass still exists in the project.

Element_s = Input()  # "Element(s)"
turn_into_list = Custom[Turn Into List](item=Element_s)  # Turns an element into a (flat) list
python_script = Python(turn_into_list)
# ---------- python_script.python (14 lines) ----------
import clr
clr.AddReference('RevitAPI')
clr.AddReference('RevitAPIUI')
from Autodesk.Revit.DB import *
import Autodesk

items = IN
booleans = list()
for item in items:
	try:
		booleans.append(item.get_Parameter(BuiltInParameter.RELATED_TO_MASS).AsInteger())
	except:
		booleans.append(0)
OUT = booleans
# ----------------------------------------
return_list_or_single_value = Custom[Return List Or Single Value](list_1=turn_into_list, list_2=python_script)  # If the list in input #1 has only one item, only the first item of the list in input #2 will be returned.
bool = Output(return_list_or_single_value)
