# Dynamo custom node Is View Template.dyf (Dynamo 0.6.3.5263)
# category: Clockwork.Revit.Views
# Checks if a given view is a view template

View_s = Input()  # "View(s)"
turn_into_list = Custom[Turn Into List](item=View_s)  # Turns an element into a list
python_script = Python(turn_into_list)
# ---------- python_script.python (18 lines) ----------
import clr
clr.AddReference('RevitAPI')
clr.AddReference('RevitAPIUI')
from Autodesk.Revit.DB import *
import Autodesk

views = IN
elementlist = list()
notaview = list()
for view in views:
	try:
		if view.IsTemplate:
			elementlist.append(1)
		else:
			elementlist.append(0)
	except:
		elementlist.append(0)
OUT = elementlist
# ----------------------------------------
return_list_or_single_value = Custom[Return List Or Single Value](list_1=turn_into_list, list_2=python_script)  # If the list in input #1 has only one item, only the first item of the list in input #2 will be returned.
bool = Output(return_list_or_single_value)
