# Dynamo custom node LibG Vector Components.dyf (Dynamo 0.6.3.7375)
# category: Clockwork.XYZ
# Gets the X, Y and Z of a LibG vector

LibG_Vector = Input()
python_script = Python(LibG_Vector)
# ---------- python_script.python (16 lines) ----------
# Default imports
import clr
clr.AddReference('RevitAPI')
clr.AddReference('RevitAPIUI')
from Autodesk.Revit.DB import *
import Autodesk
import sys
import clr
path = r'C:\Autodesk\Dynamo\Core'
exec_path = r'C:\Autodesk\Dynamo\Core\dll'
sys.path.append(path)
sys.path.append(exec_path)
clr.AddReference('LibGNet')
from Autodesk.LibG import *

OUT = IN.X, IN.Y, IN.Z
# ----------------------------------------
first_of_list = First(python_script)
X = Output(first_of_list)
number = DoubleInput(1)
get_from_list = GetFromList(number, python_script)
Y = Output(get_from_list)
number_2 = DoubleInput(2)
get_from_list_2 = GetFromList(number_2, python_script)
Z = Output(get_from_list_2)
