# Dynamo custom node Lines Through Points (Closed Loop).dyf (Dynamo 0.6.3.7375)
# category: Clockwork.Revit
# Works just like the built-in node Lines Through Points (creates a series of lines through a list of points) - except that it creates a *closed* loop of lines.

list = Input()
last_of_list = Last(list)
add_to_list = List(last_of_list, list)
lines_through_points = CurvesThroughPoints(add_to_list, lacing=Longest)
lines = Output(lines_through_points)
