# Dynamo custom node List Not Empty.dyf (Dynamo 0.6.3.22045)
# category: Clockwork.Lists
# Just the inversion of the built-in Is Empty List node.

list = Input()
is_empty_list = IsEmpty(list)
not_ = Not(is_empty_list)
bool = Output(not_)
