# Dynamo custom node List Phases.dyf (Dynamo 0.6.3.5291)
# category: Clockwork.Revit.Phases
# Lists all phases in the active document

revit_document = RevitDocument(lacing=Longest)
python_script = Python(revit_document)
# ---------- python_script.python (13 lines) ----------
import clr
clr.AddReference('RevitAPI')
clr.AddReference('RevitAPIUI')
from Autodesk.Revit.DB import *
import Autodesk

doc = IN
elementlist = list()

for phase in doc.Phases:
	elementlist.append(phase)

OUT = elementlist
# ----------------------------------------
Phases = Output(python_script)
