# Dynamo custom node Match List With Key Values.dyf (Dynamo 0.6.2.29585)
# category: Clockwork.Lists
# Matches a list with a given set of keys and returns the values corresponding to the keys

list = Input()
keys = Input()
values = Input()
python_script_with_variable = Python(list, keys, values)  # "Python Script With Variable Number of Inputs"
# ---------- python_script_with_variable.python (11 lines) ----------
items = IN0
keys = IN1
values = IN2
elementlist = list()
for item in items:
	counter = 0
	for key in keys:
		if (item == key):
			elementlist.append(values[counter])
		counter += 1
OUT = elementlist
# ----------------------------------------
matched_values = Output(python_script_with_variable)
