# Dynamo custom node Match Regular Expression.dyf (Dynamo 0.6.3.5260)
# category: Clockwork.Strings
# Determines if a regular expression matches a string (or a list of strings) and returns a boolean value (or a list, depending on the input). The syntax for regular expressions is explained at
# http://ironpython-test.readthedocs.org/en/latest/howto/regex.html

string_s = Input()  # "string(s)"
turn_into_list = Custom[Turn Into List](item=string_s)  # Turns an element into a list
regex = Input()
python_script_with_variable = Python(regex, turn_into_list)  # "Python Script With Variable Number of Inputs"
# ---------- python_script_with_variable.python (12 lines) ----------
import re

regexstring = IN0
regexlist = IN1
elementlist = list()
thisexp = re.compile(regexstring)
for item in regexlist:
	if (str(thisexp.match(item)) == 'None'):
		elementlist.append(0)
	else:
		elementlist.append(1)
OUT = elementlist
# ----------------------------------------
return_list_or_single_value = Custom[Return List Or Single Value](list_1=turn_into_list, list_2=python_script_with_variable)  # If the list in input #1 has only one item, only the first item of the list in input #2 will be returned.
bool = Output(return_list_or_single_value)
