# Dynamo custom node Mesh From Face.dyf (Dynamo 0.6.3.7375)
# category: Clockwork.Revit.Meshes
# Triangulates a given face into a mesh

Face_s = Input()  # "Face(s)"
turn_into_list = Custom[Turn Into List](item=Face_s)  # Turns an element into a (flat) list
python_script = Python(turn_into_list)
# ---------- python_script.python (11 lines) ----------
import clr
clr.AddReference('RevitAPI')
clr.AddReference('RevitAPIUI')
from Autodesk.Revit.DB import *
import Autodesk

faces = IN
elementlist = list()
for face in faces:
	elementlist.append(face.Triangulate())
OUT = elementlist
# ----------------------------------------
return_list_or_single_value = Custom[Return List Or Single Value](list_1=turn_into_list, list_2=python_script)  # If the list in input #1 has only one item, only the first item of the list in input #2 will be returned.
Mesh_es = Output(return_list_or_single_value)  # "Mesh(es)"
