# Dynamo custom node Mesh-Plane Intersection.dyf (Dynamo 0.6.3.7375)
# category: Clockwork.Revit.Meshes
# Calculates the intersection of a mesh and a plane

string = StringInput("X")
Plane = Input()
# note: Determine general orientation of cutting plane
plane_properties = Custom[Plane Properties](Plane_s=Plane)  # Returns the normal and origin of a given plane as well as its X and Y vectors.
best_fit_plane = BestFitPlane(lacing=Longest)
Mesh = Input()
# note: From Mesh to Curves
triangles_from_mesh = Custom[Triangles From Mesh](Mesh_es=Mesh)  # Retrieves all triangles from a mesh
xyzs_from_meshtriangle = Custom[XYZs From MeshTriangle](MeshTriangle_s=triangles_from_mesh)  # Retrieves XYZs from MeshTriangles
# note: Determine general orientation of mesh
map = Map(best_fit_plane.out1, xyzs_from_meshtriangle)
average_xyzs = XyzAverage(map, lacing=Longest)
get_third_xyz_axis = Custom[Get Third XYZ Axis](xyz_axis_1=plane_properties.Normal_s, xyz_axis_2=average_xyzs)  # Given two main XYZ axes (or vectors pointing more or less in thei general direction), this node will find the third axis.
# note: Determine which axis should be used for sorting the points
equal = Equal(string, get_third_xyz_axis.string)
xyz_x = XyzGetX(lacing=Longest)
lines_through_points_closed_loop = Custom[Lines Through Points (Closed Loop)]()  # Works just like the built-in node Lines Through Points (creates a series of lines through a list of points) - except that it creates a *closed* loop of lines.
map_2 = Map(lines_through_points_closed_loop, xyzs_from_meshtriangle)
curve_plane_intersection = CurvePlaneIntersection(map_2, Plane, lacing=Longest)
flatten_completely = FlattenList(curve_plane_intersection)
# note: Sorting of intersection points
sort_by_key = SortBy(xyz_x, flatten_completely)
string_2 = StringInput("Y")
equal_2 = Equal(get_third_xyz_axis.string, string_2)
xyz_y = XyzGetY(lacing=Longest)
sort_by_key_2 = SortBy(xyz_y, flatten_completely)
xyz_z = XyzGetZ(lacing=Longest)
sort_by_key_3 = SortBy(xyz_z, flatten_completely)
if_ = Conditional(equal_2, sort_by_key_2, sort_by_key_3)
if_2 = Conditional(equal, sort_by_key, if_)
first_of_list = First(if_2)
list = NewList(index0=first_of_list)
number = DoubleInput(2)
rest_of_list = Rest(if_2)
number_2 = DoubleInput(0)
take_every_nth = TakeEveryNth(number, rest_of_list, number_2)
join_lists = Append(list, take_every_nth)
last_of_list = Last(if_2)
list_2 = NewList(index0=last_of_list)
# note: Create list of unique, ordered intersection points
join_lists_2 = Append(join_lists, list_2)
XYZ = Output(join_lists_2)
lines_through_points = CurvesThroughPoints(join_lists_2, lacing=Longest)
Lines = Output(lines_through_points)
nurbs_spline = GeometryCurveNurbSpline(join_lists_2, lacing=Longest)
Nurbs_Spline = Output(nurbs_spline)
hermite_spline = HermiteSpline(join_lists_2, lacing=Longest)
Hermite_Spline = Output(hermite_spline)
