# Dynamo custom node Move XYZ From Plane To Plane.dyf (Dynamo 0.6.3.22045)
# category: Clockwork.XYZ
# Moves an XYZ from one plane to another

# note: Subtract origin plane XYZ from destination plane XYZ.
# This gives us the vector for moving each point.

Dest_Plane_Origin = Input()  # "Dest. Plane Origin"
Orig_Plane_Normal = Input()  # "Orig. Plane Normal"
unitize_xyz = XyzNormalize(Orig_Plane_Normal, lacing=Longest)
Dest_Plane_Normal = Input()  # "Dest. Plane Normal"
unitize_xyz_2 = XyzNormalize(Dest_Plane_Normal, lacing=Longest)
# note: Use an imaginary triangle between 0,0,0 and the two normals to specify the rotation
list = NewList(index0=unitize_xyz, index1=unitize_xyz_2)
# note: Find rotation axis
best_fit_plane = BestFitPlane(list, lacing=Longest)
xyz_distance = XyzDistance(unitize_xyz, unitize_xyz_2, lacing=Longest)
XYZ = Xyz(lacing=Longest)
z_axis = XyzBasisZ(lacing=Longest)
xyz_distance_2 = XyzDistance(XYZ, z_axis, lacing=Longest)
# note: Compute the angle between origin plane and destination plane (both normals will always have a length of 1, so we only need the distance between their end points)
angle_by_law_of_cosines = Custom[Angle By Law Of Cosines](A=xyz_distance, B=xyz_distance_2, C=xyz_distance_2)  # Computes an angle of a triangle using the law of cosines. A is the opposite side of the triangle while B and C are the sides forming the angle.
rotate_transform = TransformRotation(Dest_Plane_Origin, best_fit_plane.out1, angle_by_law_of_cosines, lacing=Longest)
# note: For questions email me at dieckmann@caad.arch.rwth-aachen.de
XYZ_2 = Input(XYZ)
Orig_Plane_Origin = Input()  # "Orig. Plane Origin"
# note: Compute vector of movement
subtract_xyz = XyzSubtract(Dest_Plane_Origin, Orig_Plane_Origin, lacing=Longest)
# note: Move XYZ
add_xyz = XyzAdd(XYZ_2, subtract_xyz, lacing=Longest)
# note: Rotate XYZ - Positive Angle
transform_point = TransformPoint(rotate_transform, add_xyz, lacing=Longest)
plane = Plane(unitize_xyz_2, Dest_Plane_Origin, lacing=Longest)
# note: Since we don't know the correct direction for the rotation, we need to test here which rotation (positive vs. negative) fits best...
project_point_on_face_plane = ProjectPointOnFace(transform_point, plane, lacing=Longest)
Tolerance = Input()
formula = Formula("d<t", d=project_point_on_face_plane.out2, t=Tolerance, lacing=Longest)
formula_2 = Formula("-alpha", alpha=angle_by_law_of_cosines, lacing=Longest)
rotate_transform_2 = TransformRotation(Dest_Plane_Origin, best_fit_plane.out1, formula_2, lacing=Longest)
# note: Rotate XYZ - Negative Angle
transform_point_2 = TransformPoint(rotate_transform_2, add_xyz, lacing=Longest)
if_ = Conditional(formula, transform_point, transform_point_2)
XYZ_3 = Output(if_)  # "XYZ"
