# Dynamo custom node Navy.dyf (Dynamo 0.6.3.5262)
# category: Clockwork.Colours
# Returns the colour navy.

number = DoubleInput(0)
number_2 = DoubleInput(128)
color = Color(number, number, number, number_2, lacing=Longest)
n0_0_128 = Output(color)  # "0,0,128"
