# Dynamo custom node Normalized Sequence by Function.dyf (Dynamo 0.6.2.279)
# category: Clockwork.Lists
# Creates a sequence of N values between 0 and 1 driven by a function

f_x = Input()  # "f(x)"
N = Input()
number = DoubleInput(0..1..#N, N, lacing=Longest)
map = Map(f_x, number)
Sequence = Output(map)
