# Dynamo custom node Normalized Sequence.dyf (Dynamo 0.6.2.279)
# category: Clockwork.Lists
# Creates a sequence of N values between 0 and 1

N = Input()
number = DoubleInput(0..1..#N, N, lacing=Longest)
Sequence = Output(number)
