# Dynamo custom node Number To Character.dyf (Dynamo 0.6.3.31051)
# category: Clockwork.Strings
# Converts a number into a character (where 1 = A, 2 = B, ... , 27 = AA, 28 = AB etc.).

n = Input()
formula = Formula("(n-1)/26", n=n, lacing=Longest)
floor = Floor(formula, lacing=Longest)
string = StringInput("*A*B*C*D*E*F*G*H*I*J*K*L*M*N*O*P*Q*R*S*T*U*V*W*X*Y*Z")
upper = Input()  # "upper?"
string_case = StringCase(string, upper)
string_2 = StringInput("*")
split_string = SplitString(string_case, string_2)
get_from_list = GetFromList(floor, split_string)
number = DoubleInput(26)
modulo = Modulo(n, number, lacing=Longest)
formula_2 = Formula("if(x=0,26,x)", x=modulo, lacing=Longest)
get_from_list_2 = GetFromList(formula_2, split_string)
concat_strings = ConcatStrings(get_from_list, get_from_list_2)
combined = Output(concat_strings)
