# Dynamo custom node Olive.dyf (Dynamo 0.6.3.5262)
# category: Clockwork.Colours
# Returns the colour olive.

number = DoubleInput(0)
number_2 = DoubleInput(128)
color = Color(number, number_2, number_2, number, lacing=Longest)
n128_128_0 = Output(color)  # "128,128,0"
