# Dynamo custom node Only ToRoom OR FromRoom Is Set.dyf (Dynamo 0.6.3.7375)
# category: CAAD_RWTH.Revit.Rooms
# Evaluates if a door or window has only set one of the ToRoom / FromRoom properties. This may help to determine whether a door/window is external.

number = DoubleInput(0)
if_null_replace_with_new_value = Custom[If Null Replace With New Value](newValue=number)  # replaces a null with a specified value. Use with Map for lists
is_empty_list = IsEmpty()
Doors_Windows = Input()  # "Doors/Windows"
turn_into_list = Custom[Turn Into List](item=Doors_Windows)  # Turns an element into a list
Phase = Input()
rooms_from_doors_and_windows = Custom[Rooms From Doors And Windows](Door_s_Window_s=turn_into_list, Phase=Phase)  # Gets the rooms that are connected by a given door or a window
map = Map(is_empty_list, rooms_from_doors_and_windows.From_Room_s)
map_2 = Map(if_null_replace_with_new_value, map)
map_3 = Map(is_empty_list, rooms_from_doors_and_windows.To_Room_s)
map_4 = Map(if_null_replace_with_new_value, map_3)
formula = Formula("x+y=1", x=map_2, y=map_4, lacing=Longest)
bool = Output(formula)
