# Dynamo custom node Opposite Side By Law Of Cosines.dyf (Dynamo 0.6.3.35252)
# category: Clockwork.Math.Formulas
# Computes the length of the missing side of a triangle using the law of cosines. Gamma is the angle between sides A and B.

A = Input()
B = Input()
gamma = Input()
formula = Formula("Sqrt(Pow(a,2)+Pow(b,2)-2*a*b*Cos(gamma))", a=A, b=B, gamma=gamma, lacing=Longest)
C = Output(formula)
