# Dynamo custom node Parameter Exists.dyf (Dynamo 0.6.3.5244)
# category: Clockwork.Revit.Properties
# Checks if an element contains a parameter of a given name

Element_s = Input()  # "Element(s)"
turn_into_list = Custom[Turn Into List](item=Element_s)  # Turns an element into a (flat) list
param = Input()
python_script_with_variable = Python(turn_into_list, param)  # "Python Script With Variable Number of Inputs"
# ---------- python_script_with_variable.python (18 lines) ----------
import clr
clr.AddReference('RevitAPI')
clr.AddReference('RevitAPIUI')
from Autodesk.Revit.DB import *
import Autodesk

items = IN0
param = IN1
elementlist = list()
for item in items:
	try:
		if item.Parameter[param].GetType().Name == 'Parameter':
			elementlist.append(1)
		else:
			elementlist.append(0)
	except:
		elementlist.append(0)
OUT = elementlist
# ----------------------------------------
return_list_or_single_value = Custom[Return List Or Single Value](list_1=turn_into_list, list_2=python_script_with_variable)  # If the list in input #1 has only one item, only the first item of the list in input #2 will be returned.
bool = Output(return_list_or_single_value)
