# Dynamo custom node Parse Solar Radiation CSV.dyf (Dynamo 0.6.3.7375)
# category: CAAD_RWTH.Analysis
# Parses a Vasari solar radiation analysis CSV file and returns lists of absolute and normalized radiation values, their XYZ coordinates and their normals as well as the highest and lowest radiation value and a the total of all radiation samples

number = DoubleInput(1)
get_from_list = GetFromList(number)
formula = Formula("4", lacing=Longest)
# note: For questions email me at dieckmann@caad.arch.rwth-aachen.de
path = Input()
read_text_file = FileReader(path)
string = StringInput("\n")
# note: Split into lines
split_string = SplitString(read_text_file, string)
# note: Try to split the first line by using a semicolon delimiter
first_of_list = First(split_string)
string_2 = StringInput(";")
split_string_2 = SplitString(first_of_list, string_2)
list_length = Length(split_string_2)
formula_2 = Formula("n>1", n=list_length, lacing=Longest)
# note: If the first line hasn't split use a comma delimiter instead. (The delimiter Vasari uses when creating a CSV file depends on regional settings...)
string_3 = StringInput(",")
if_ = Conditional(formula_2, string_2, string_3)
boolean = BoolSelector(false)
boolean_2 = BoolSelector(true)
csv_to_list = Custom[CSV To List](delimiter=if_, CSV_string=read_text_file, ignore_last_column=boolean, ignore_first_row=boolean, ignore_last_row=boolean_2)  # Converts the content of a given CSV file to a list
# note: Disregard the first four lines
drop_from_list = DropList(formula, csv_to_list)
map = Map(get_from_list, drop_from_list)
string_to_number = String2Num(map, lacing=Longest)
Radiation = Output(string_to_number)
number_2 = DoubleInput(2)
get_from_list_2 = GetFromList(number_2)
map_2 = Map(get_from_list_2, drop_from_list)
string_to_number_2 = String2Num(map_2, lacing=Longest)
number_3 = DoubleInput(3)
get_from_list_3 = GetFromList(number_3)
map_3 = Map(get_from_list_3, drop_from_list)
string_to_number_3 = String2Num(map_3, lacing=Longest)
number_4 = DoubleInput(4)
get_from_list_4 = GetFromList(number_4)
map_4 = Map(get_from_list_4, drop_from_list)
string_to_number_4 = String2Num(map_4, lacing=Longest)
XYZ = Xyz(string_to_number_2, string_to_number_3, string_to_number_4, lacing=Longest)
XYZs = Output(XYZ)
number_5 = DoubleInput(5)
get_from_list_5 = GetFromList(number_5)
map_5 = Map(get_from_list_5, drop_from_list)
string_to_number_5 = String2Num(map_5, lacing=Longest)
number_6 = DoubleInput(6)
get_from_list_6 = GetFromList(number_6)
map_6 = Map(get_from_list_6, drop_from_list)
string_to_number_6 = String2Num(map_6, lacing=Longest)
number_7 = DoubleInput(7)
get_from_list_7 = GetFromList(number_7)
map_7 = Map(get_from_list_7, drop_from_list)
string_to_number_7 = String2Num(map_7, lacing=Longest)
XYZ_2 = Xyz(string_to_number_5, string_to_number_6, string_to_number_7, lacing=Longest)
Normals = Output(XYZ_2)
get_highest_and_lowest_from_list = Custom[Get Highest And Lowest From List](list=string_to_number)  # Gets the highest and lowest value from a given list
normalizeValue = Custom[NormalizeValue](Value=string_to_number, MinRange=get_highest_and_lowest_from_list.lowest, MaxRange=get_highest_and_lowest_from_list.highest)  # Converts a value into a normalized value according to a value range
RadiationNormalized = Output(normalizeValue)
RadiationMax = Output(get_highest_and_lowest_from_list.highest)
RadiationMin = Output(get_highest_and_lowest_from_list.lowest)
sum_list = Custom[Sum List](nums=string_to_number)
RadiationTotal = Output(sum_list)
