# Dynamo custom node Plane By Reference Or Sketch Plane.dyf (Dynamo 0.6.3.7375)
# category: Clockwork.XYZ
# Retrieves the plane of a reference or sketch plane.

Ref_Sketch_Plane_s = Input()  # "Ref./Sketch Plane(s)"
turn_into_list = Custom[Turn Into List](item=Ref_Sketch_Plane_s)  # Turns an element into a (flat) list
python_script = Python(turn_into_list)
# ---------- python_script.python (11 lines) ----------
import clr
clr.AddReference('RevitAPI')
clr.AddReference('RevitAPIUI')
from Autodesk.Revit.DB import *
import Autodesk

refplanes = IN
elementlist = list()
for refplane in refplanes:
	elementlist.append(refplane.Plane)
OUT = elementlist
# ----------------------------------------
return_list_or_single_value = Custom[Return List Or Single Value](list_1=turn_into_list, list_2=python_script)  # If the list in input #1 has only one item, only the first item of the list in input #2 will be returned.
Plane_s = Output(return_list_or_single_value)  # "Plane(s)"
