# Dynamo custom node Plane From Planar Face.dyf (Dynamo 0.6.3.22045)
# category: Clockwork.Revit
# Creates a plane from a planar face

Planar_face_s = Input()  # "Planar face(s)"
turn_into_list = Custom[Turn Into List](item=Planar_face_s)  # Turns an element into a (flat) list
python_script = Python(turn_into_list)
# ---------- python_script.python (14 lines) ----------
import clr
clr.AddReference('RevitAPI')
clr.AddReference('RevitAPIUI')
from Autodesk.Revit.DB import *
import Autodesk

items = IN
normallist = list()
originlist = list()

for item in items:
	normallist.append(item.Normal)
	originlist.append(item.Origin)
OUT = (normallist,originlist)
# ----------------------------------------
first_of_list = First(python_script)
number = DoubleInput(1)
get_from_list = GetFromList(number, python_script)
plane_by_normal_origin = Plane(first_of_list, get_from_list, lacing=Longest)
Plane_s = Output(plane_by_normal_origin)  # "Plane(s)"
Origin_s = Output(get_from_list)  # "Origin(s)"
Normal_s = Output(first_of_list)  # "Normal(s)"
