# Dynamo custom node Plane Properties.dyf (Dynamo 0.6.3.7375)
# category: Clockwork.XYZ
# Returns the normal and origin of a given plane as well as its X and Y vectors.

Plane_s = Input()  # "Plane(s)"
turn_into_list = Custom[Turn Into List](item=Plane_s)  # Turns an element into a (flat) list
number = DoubleInput(0)
python_script = Python(turn_into_list)
# ---------- python_script.python (17 lines) ----------
import clr
clr.AddReference('RevitAPI')
clr.AddReference('RevitAPIUI')
from Autodesk.Revit.DB import *
import Autodesk

planes = IN
normallist = list()
originlist = list()
xlist = list()
ylist = list()
for plane in planes:
	normallist.append(plane.Normal)
	originlist.append(plane.Origin)
	xlist.append(plane.XVec)
	ylist.append(plane.YVec)
OUT = (normallist,originlist,xlist,ylist)
# ----------------------------------------
get_from_list = GetFromList(number, python_script)
return_list_or_single_value = Custom[Return List Or Single Value](list_1=turn_into_list, list_2=get_from_list)  # If the list in input #1 has only one item, only the first item of the list in input #2 will be returned.
Normal_s = Output(return_list_or_single_value)  # "Normal(s)"
number_2 = DoubleInput(1)
get_from_list_2 = GetFromList(number_2, python_script)
return_list_or_single_value_2 = Custom[Return List Or Single Value](list_1=turn_into_list, list_2=get_from_list_2)
Origin_s = Output(return_list_or_single_value_2)  # "Origin(s)"
number_3 = DoubleInput(2)
get_from_list_3 = GetFromList(number_3, python_script)
return_list_or_single_value_3 = Custom[Return List Or Single Value](list_1=turn_into_list, list_2=get_from_list_3)
X_Vector_s = Output(return_list_or_single_value_3)  # "X Vector(s)"
number_4 = DoubleInput(3)
get_from_list_4 = GetFromList(number_4, python_script)
return_list_or_single_value_4 = Custom[Return List Or Single Value](list_1=turn_into_list, list_2=get_from_list_4)
Y_Vector_s = Output(return_list_or_single_value_4)  # "Y Vector(s)"
