# Dynamo custom node Plane-Vector Intersection.dyf (Dynamo 0.6.3.7375)
# category: Clockwork.XYZ
# Finds the intersection point between a plane and a vector

# note: Based on:
# http://stackoverflow.com/questions/5666222/3d-line-plane-intersection
Vector_Basepoint = Input()
Vector_Normalized = Input()  # "Vector (Normalized)"
unitize_xyz = XyzNormalize(Vector_Normalized, lacing=Longest)
Plane_Normal = Input()
Plane_Origin = Input()
plane_by_normal_origin = Plane(Plane_Normal, Plane_Origin, lacing=Longest)
unitize_xyz_2 = XyzNormalize(Plane_Normal, lacing=Longest)
vector_is_in_plane = Custom[Vector Is In Plane](Vector_Basepoint=Vector_Basepoint, Vector_Normalized=unitize_xyz, Plane=plane_by_normal_origin, Plane_Normal=unitize_xyz_2)  # Checks if a given vector is located on a given plane
vector_and_plane_are_parallel = Custom[Vector And Plane Are Parallel](Vector=unitize_xyz, Plane_Normal=unitize_xyz_2)  # Checks if a given vector is parallel to a given plane
list = NewList(index0=vector_is_in_plane, index1=vector_and_plane_are_parallel)
true_for_any_boolean = Custom[True For Any (Boolean)](seq=list)  # Returns true if any item in a list of booleans is true.
empty_list = Empty()
subtract_xyzs = XyzSubtract(Vector_Basepoint, Plane_Origin, lacing=Longest)
xyz_dot_product = XyzDotProduct(unitize_xyz_2, subtract_xyzs, lacing=Longest)
xyz_dot_product_2 = XyzDotProduct(unitize_xyz_2, unitize_xyz, lacing=Longest)
formula = Formula("-x/dot", x=xyz_dot_product, dot=xyz_dot_product_2, lacing=Longest)
scale_xyz = XyzScale(unitize_xyz, formula, lacing=Longest)
add_xyzs = XyzAdd(Vector_Basepoint, scale_xyz, lacing=Longest)
if_ = Conditional(true_for_any_boolean, empty_list, add_xyzs)
XYZ = Output(if_)
Vector_In_Plane = Output(vector_is_in_plane)
if_2 = Conditional(vector_is_in_plane, vector_is_in_plane, vector_and_plane_are_parallel)
Vector_Is_Parallel = Output(if_2)
