# Dynamo custom node Project Is Workshared.dyf (Dynamo 0.6.2.29585)
# category: Clockwork.Revit.Project
# Returns true if the current project is workshared

revit_document = RevitDocument(lacing=Longest)
python_script = Python(revit_document)
# ---------- python_script.python (11 lines) ----------
import clr
clr.AddReference('RevitAPI')
clr.AddReference('RevitAPIUI')
from Autodesk.Revit.DB import *
import Autodesk

doc = IN
if doc.IsWorkshared:
	OUT = 1
else:
	OUT = 0
# ----------------------------------------
bool = Output(python_script)
