# Dynamo custom node Quadrilateral Pattern (Checkerboard).dyf (Dynamo 0.6.3.5259)
# category: Clockwork.Patterning
# Creates groups of points from a list of UVs or XYZs for the placement of quadrilateral panels in a checkerboard pattern. The placement pattern can be reversed (boolean) and shifted (integer).

number = DoubleInput(2)
number_2 = DoubleInput(0)
drop_every_nth = RemoveEveryNth(number, arg2=number_2)
list = Input()
V = Input()
reverse = Input()  # "reverse?"
shift_placement = Input()
quadrilateral_pattern_from_grid = Custom[Quadrilateral Pattern From Grid](list=list, V=V, reverse=reverse, shift_placement=shift_placement)  # Creates groups of points from a list of UVs or XYZs for the placement of quadrilateral panels. The placement pattern can be reversed (boolean) and shifted (integer).
partition_list = Slice(quadrilateral_pattern_from_grid, V)
drop_every_nth_2 = RemoveEveryNth(number, partition_list, number_2)
map = Map(drop_every_nth, drop_every_nth_2)
take_every_nth = TakeEveryNth(number, arg2=number_2)
take_every_nth_2 = TakeEveryNth(number, partition_list, number_2)
map_2 = Map(take_every_nth, take_every_nth_2)
list_2 = NewList(index0=map, index1=map_2)
number_3 = DoubleInput(2)
flatten = FlattenListAmt(list_2, number_3)
list_type_A = Output(flatten)  # "list (type A)"
take_every_nth_3 = TakeEveryNth(number, arg2=number_2)
map_3 = Map(take_every_nth_3, drop_every_nth_2)
drop_every_nth_3 = RemoveEveryNth(number, arg2=number_2)
map_4 = Map(drop_every_nth_3, take_every_nth_2)
list_3 = NewList(index0=map_3, index1=map_4)
flatten_2 = FlattenListAmt(list_3, number_3)
list_type_B = Output(flatten_2)  # "list (type B)"
