# Dynamo custom node Quadrilateral Pattern From Grid.dyf (Dynamo 0.6.3.7375)
# category: Clockwork.Panelling
# Creates groups of points from a list of UVs or XYZs for the placement of quadrilateral panels. The placement pattern can be reversed (boolean) and shifted (integer).

list = Input()
formula = Formula("1", lacing=Longest)
number = DoubleInput(0)
V = Input()
n1 = Custom[+1](V)  # Increments a value by 1
n1_2 = Custom[+1](n1)
# note: Create default placement pattern (counter-clockwise)
list_2 = NewList(index0=number, index1=n1, index2=n1_2, index3=formula)
shift_placement = Input()
reverse = Input()  # "reverse?"
shift_placement_and_reverse = Custom[Shift Placement And Reverse](list=list_2, shift=shift_placement, reverse=reverse)  # Shifts (integer) and reverses (bool) a given list
get_first_four_indices = Custom[Get First Four Indices](list=shift_placement_and_reverse)  # Gets the first four indices of a given list
# note: Create sublists using placement pattern
build_sublists = Sublists("a,b,c,d", list, formula, get_first_four_indices.0, get_first_four_indices.1, get_first_four_indices.2, get_first_four_indices.3, lacing=Longest)
# note: For questions email me at dieckmann@caad.arch.rwth-aachen.de
n1_3 = Custom[+1](V)
# note: Unclutter
drop_last_row_column_from_uv = Custom[Drop Last Row & Column From UV Field](list=build_sublists, V=n1_3)  # Drops the last row and column from a UV field
list_3 = Output(drop_last_row_column_from_uv)  # "list"
