# Dynamo custom node Radians To Degrees.dyf (Dynamo 0.6.3.5260)
# category: Clockwork.Conversion.Angle
# Converts radians into degrees

rad = Input()
formula = Formula("radians*180/Pi", radians=rad, lacing=Longest)
deg = Output(formula)
