# Dynamo custom node Recursive Boolean Difference.dyf (Dynamo 0.6.3.7375)
# category: Clockwork.Modeling
# This node recursively applies the boolean difference node to a solid for each item in a given list of solids.

First_Solid = Input()
List_of_Solids = Input()
turn_into_list = Custom[Turn Into List](item=List_of_Solids)  # Turns an element into a list
boolean_difference = SolidDifference(lacing=Longest)
python_script_with_variable = Python(First_Solid, turn_into_list, boolean_difference)  # "Python Script With Variable Number of Inputs"
# ---------- python_script_with_variable.python (19 lines) ----------
# Default imports
import sys
import clr
path = r'C:\Autodesk\Dynamo\Core'
exec_path = r'C:\Autodesk\Dynamo\Core\dll'
sys.path.append(path)
sys.path.append(exec_path)
clr.AddReference('LibGNet')
from Autodesk.LibG import *

solid = IN0
diff_solids = IN1
diff_function = IN2
elementlist = list()

for item in diff_solids:
	solid = diff_function(solid,item)

OUT = solid
# ----------------------------------------
Processed_Solid = Output(python_script_with_variable)
