# Dynamo custom node Red.dyf (Dynamo 0.6.3.5262)
# category: Clockwork.Colours
# Returns the colour red.

number = DoubleInput(0)
number_2 = DoubleInput(255)
color = Color(number, number_2, number, number, lacing=Longest)
n255_0_0 = Output(color)  # "255,0,0"
