# Dynamo custom node Reference Intersector By Category.dyf (Dynamo 0.6.3.7375)
# category: Clockwork.Revit.Categories
# Finds all elements of a specified category that intersect with a list of vectors

n3D_View = Input(3D View)
BuiltInCategory = Input()
VectorStart = Input()
turn_into_list = Custom[Turn Into List](item=VectorStart)  # Turns an element into a list
VectorEnd = Input()
turn_into_list_2 = Custom[Turn Into List](item=VectorEnd)
revit_document = RevitDocument(lacing=Longest)
python_script_with_variable = Python(n3D_View, BuiltInCategory, turn_into_list, turn_into_list_2, revit_document)  # "Python Script With Variable Number of Inputs"
# ---------- python_script_with_variable.python (25 lines) ----------
import clr
clr.AddReference('RevitAPI') 
clr.AddReference('RevitAPIUI')  
from Autodesk.Revit.DB import * 
import Autodesk

theview = IN0
cat = IN1
vstart = IN2
vend = IN3
doc = IN4

intersectorlist = list()
counter = 0
filter = ElementCategoryFilter(cat)

while counter < len(vstart):
	ThisReferenceArr = ReferenceIntersector(filter, FindReferenceTarget.All, theview)
	found = ThisReferenceArr.Find(vstart[counter], vend[counter])
	foundreferences = list()
	for item in found:
		foundreferences.append(doc.GetElement(item.GetReference()))
	intersectorlist.append(foundreferences)
	counter += 1
OUT = intersectorlist
# ----------------------------------------
list = Output(python_script_with_variable)
