# Dynamo custom node Remove Duplicate Revit Elements From List.dyf (Dynamo 0.6.3.5291)
# category: Clockwork.Revit
# Removes all duplicates of Revit elements from a given list. (Will also remove any other duplicates from a list...)

list = Input()
elements_to_ids = Custom[Elements to IDs](Element_s=list)  # Gets the ID(s) for a list of Revit elements (or a single element)
remove_duplicates_from_list = Custom[Remove Duplicates From List](list=elements_to_ids.ID_s)  # Removes duplicate items from a given list. Will *not* work for Revit elements!
ids_to_elements = Custom[IDs to Elements](ID_s=remove_duplicates_from_list)  # Gets the Revit element(s) for a list of IDs (or a single ID)
elements = Output(ids_to_elements.Element_s)
is_empty_list = IsEmpty(elements_to_ids.unmatched)
remove_duplicates_from_list_2 = Custom[Remove Duplicates From List](list=elements_to_ids.unmatched)
if_ = Conditional(is_empty_list, elements_to_ids.unmatched, remove_duplicates_from_list_2)
other = Output(if_)
