# Dynamo custom node Remove Duplicates From List.dyf (Dynamo 0.6.3.5291)
# category: Clockwork.Lists
# Removes duplicate items from a given list. Will *not* work for Revit elements!

list = Input()
turn_into_list = Custom[Turn Into List](item=list)  # Turns an element into a (flat) list
python_script = Python(turn_into_list)
# ---------- python_script.python (8 lines) ----------
import clr
clr.AddReference('RevitAPI')
clr.AddReference('RevitAPIUI')
from Autodesk.Revit.DB import *
import Autodesk

items = IN
OUT = list(set(items))
# ----------------------------------------
list_2 = Output(python_script)  # "list"
