# Dynamo custom node Remove Duplicates UVs Or XYZs From List.dyf (Dynamo 0.6.3.7375)
# category: Clockwork.Lists
# Removes duplicate UVs or XYZs from a given list. May work for Revit Elements as well.

UVs_XYZs = Input()  # "UVs / XYZs"
to_string = ToString()
turn_into_list = Custom[Turn Into List](item=UVs_XYZs)  # Turns an element into a (flat) list
map = Map(to_string, turn_into_list)
python_script = Python(map)
# ---------- python_script.python (16 lines) ----------
import clr
clr.AddReference('RevitAPI')
clr.AddReference('RevitAPIUI')
from Autodesk.Revit.DB import *
import Autodesk

items = IN
uniquelist = list()
booleans = list()
for item in items:
	if item not in uniquelist:
		uniquelist.append(item)
		booleans.append(1)
	else:
		booleans.append(0)
OUT = booleans
# ----------------------------------------
filter_by_boolean_mask = FilterMask(UVs_XYZs, python_script)
UVs_XYZs_2 = Output(filter_by_boolean_mask)  # "UVs / XYZs"
