# Dynamo custom node Replace Substring.dyf (Dynamo 0.6.3.5259)
# category: Clockwork.Strings
# Replaces a specified part (substring) of a string by another string

string_s = Input()  # "string(s)"
turn_into_list = Custom[Turn Into List](item=string_s)  # Turns an element into a list
search = Input()
replace = Input()
python_script_with_variable = Python(turn_into_list, search, replace)  # "Python Script With Variable Number of Inputs"
# ---------- python_script_with_variable.python (8 lines) ----------
items = IN0
searchstring = IN1
replacestring = IN2
elementlist = list()
for item in items:
	repitem = item.replace(searchstring,replacestring)
	elementlist.append(repitem)
OUT = elementlist
# ----------------------------------------
return_list_or_single_value = Custom[Return List Or Single Value](list_1=turn_into_list, list_2=python_script_with_variable)  # If the list in input #1 has only one item, only the first item of the list in input #2 will be returned.
string_s_2 = Output(return_list_or_single_value)  # "string(s)"
