# Dynamo custom node Resize View Crop Box.dyf (Dynamo 0.6.3.31052)
# category: Clockwork.Revit.Views
# Resizes the bounding box of a given Revit element by the specified amount in X, Y and Z direction. May need to be used in conjunction with a Transaction node.

View_s = Input()  # "View(s)"
turn_into_list = Custom[Turn Into List](item=View_s)  # Turns an element into a (flat) list
amt = Input()
python_script_with_variable = Python(turn_into_list, amt)  # "Python Script With Variable Number of Inputs"
# ---------- python_script_with_variable.python (22 lines) ----------
import clr
clr.AddReference('RevitAPI')
clr.AddReference('RevitAPIUI')
from Autodesk.Revit.DB import *
import Autodesk

views = IN0
margin = IN1
elementlist = list()
failedlist = list()
for item in views:
	try:
		newmax = item.CropBox.Max.Add(XYZ(margin,margin,margin))
		newmin = item.CropBox.Min.Subtract(XYZ(margin,margin,margin))
		newbox = BoundingBoxXYZ()
		newbox.Max = newmax
		newbox.Min = newmin
		item.CropBox = newbox
		elementlist.append(item)
	except:
		do_nothing = 1
OUT = elementlist
# ----------------------------------------
return_list_or_single_value = Custom[Return List Or Single Value](list_1=turn_into_list, list_2=python_script_with_variable)  # If the list in input #1 has only one item, only the first item of the list in input #2 will be returned.
View_s_2 = Output(return_list_or_single_value)  # "View(s)"
