# Dynamo custom node Return List Or Single Value.dyf (Dynamo 0.6.3.7375)
# category: Clockwork.Conditional
# If the list in input #1 has only one item, only the first item of the list in input #2 will be returned.

list_1 = Input()  # "list #1"
list_length = Length(list_1)
formula = Formula("n>1", n=list_length, lacing=Longest)
list_2 = Input()  # "list #2"
is_empty_list = IsEmpty(list_2)
empty_list = Empty()
first_of_list = First(list_2)
if_ = Conditional(is_empty_list, empty_list, first_of_list)
if_2 = Conditional(formula, list_2, if_)
Output = Output(if_2)  # ""
