# Dynamo custom node Revit App Version Info.dyf (Dynamo 0.6.3.7375)
# category: Clockwork.Revit
# Retrieves the name, version and build of the current Revit application.

string = StringInput("")
python_script = Python(string)
# ---------- python_script.python (8 lines) ----------
import clr
clr.AddReference('RevitAPI')
clr.AddReference('RevitAPIUI')
from Autodesk.Revit.DB import *
import Autodesk

app = Autodesk.Revit.ApplicationServices.Application()
OUT = app.VersionName, app.VersionNumber, app.VersionBuild
# ----------------------------------------
first_of_list = First(python_script)
Name = Output(first_of_list)
number = DoubleInput(1)
get_from_list = GetFromList(number, python_script)
string_to_number = String2Num(get_from_list, lacing=Longest)
Version_int = Output(string_to_number)  # "Version (int)"
last_of_list = Last(python_script)
Build = Output(last_of_list)
