# Dynamo custom node Room Separators From Curves.dyf (Dynamo 0.6.3.22045)
# category: Clockwork.Revit.Rooms
# Creates room separation lines from geometry curves. PLEASE NOTE: Might need a transaction node to work.

Curve_s = Input()  # "Curve(s)"
curve_array = Custom[Curve Array](Curve_s=Curve_s)  # Creates a curve array from a list of curves
Sketch_plane = Input()
View = Input()
revit_document = RevitDocument(lacing=Longest)
python_script_with_variable = Python(curve_array, Sketch_plane, View, revit_document)  # "Python Script With Variable Number of Inputs"
# ---------- python_script_with_variable.python (16 lines) ----------
import clr
clr.AddReference('RevitAPI')
clr.AddReference('RevitAPIUI')
from Autodesk.Revit.DB import *
import Autodesk

curvearray = IN0
sketchplane = IN1
view = IN2
doc = IN3
doccreation = doc.Create
separatorarray = doccreation.NewRoomBoundaryLines(sketchplane, curvearray, view)
elementlist = list()
for item in separatorarray:
	elementlist.append(item)
OUT = elementlist
# ----------------------------------------
Room_Separator_s = Output(python_script_with_variable)  # "Room Separator(s)"
