# Dynamo custom node Rooms From Doors And Windows.dyf (Dynamo 0.6.3.7375)
# category: Clockwork.Revit.Rooms
# Gets the rooms that are connected by a given door or a window

Door_s_Window_s = Input()  # "Door(s) / Window(s)"
turn_into_list = Custom[Turn Into List](item=Door_s_Window_s)  # Turns an element into a list
Phase = Input()
python_script_with_variable = Python(turn_into_list, Phase)  # "Python Script With Variable Number of Inputs"
# ---------- python_script_with_variable.python (25 lines) ----------
import clr
clr.AddReference('RevitAPI')
clr.AddReference('RevitAPIUI')
from Autodesk.Revit.DB import *
import Autodesk

items = IN0
phase = IN1
fromlist = list()
tolist = list()

for item in items:
	try:
		if item.FromRoom[phase]:
			fromlist.append(item.FromRoom[phase])
		else:
			fromlist.append(list())
		if item.ToRoom[phase]:
			tolist.append(item.ToRoom[phase])
		else:
			tolist.append(list())
	except:
		fromlist.append(list())
		tolist.append(list())
OUT = (fromlist,tolist)
# ----------------------------------------
first_of_list = First(python_script_with_variable)
From_Room_s = Output(first_of_list)  # "From Room(s)"
number = DoubleInput(1)
get_from_list = GetFromList(number, python_script_with_variable)
To_Room_s = Output(get_from_list)  # "To Room(s)"
