# Dynamo custom node Round Down To Precision.dyf (Dynamo 0.6.3.5260)
# category: Clockwork.Math.Rounding
# Rounds a number *down* to a specified precision

Number = Input()
Precision = Input()
formula = Formula("floor(a/b)*b", a=Number, b=Precision, lacing=Longest)
Floor = Output(formula)
