# Dynamo custom node Search In Members.dyf (Dynamo 0.6.3.31052)
# category: Clockwork.Scripting
# Lets you search in an element's members. Search is case-sensitive. Use * as a wildcard.

search_term = Input()
string = StringInput("*")
string_2 = StringInput("\w*")
replace_substring = Custom[Replace Substring](string_s=search_term, search=string, replace=string_2)  # Replaces a specified part (substring) of a string by another string
Element = Input()
turn_into_list = Custom[Turn Into List](item=Element)  # Turns an element into a (flat) list
first_of_list = First(turn_into_list)
get_members = Custom[Get Members](element_s=first_of_list)  # Gets a list of all members (properties and methods) of a selected element
filter_list_by_regular = Custom[Filter List by Regular Expression Matches](regex=replace_substring, list=get_members)  # Filters out all items from a list of strings that don't begin with the regular expression. The syntax for regular expressions is explained at http://ironpython-test.readthedocs.org/en/latest/howto/regex.html
results = Output(filter_list_by_regular.in)
