# Dynamo custom node Select Subcategory By Name.dyf (Dynamo 0.6.3.5260)
# category: Clockwork.Revit.Subcategories
# Selects a subcategory for a given element category by name

revit_document = RevitDocument(lacing=Longest)
BuiltInCategory = Input()
Name = Input()
python_script_with_variable = Python(revit_document, BuiltInCategory, Name)  # "Python Script With Variable Number of Inputs"
# ---------- python_script_with_variable.python (15 lines) ----------
import clr
clr.AddReference('RevitAPI')
clr.AddReference('RevitAPIUI')
from Autodesk.Revit.DB import *
import Autodesk

doc = IN0
builtincat = IN1
subcatname = IN2

cat = doc.Settings.Categories.get_Item(builtincat)
try:
	OUT = cat.SubCategories.get_Item(subcatname)
except:
	OUT = list()
# ----------------------------------------
transaction = Transaction(python_script_with_variable)
Subcategory = Output(transaction)
