# Dynamo custom node Sequence With Leading Zeros.dyf (Dynamo 0.6.3.5262)
# category: Clockwork.Strings
# Adds leading zeros to a sequence of numbers

number_to_string = Num2String(lacing=Longest)
seq = Input()
turn_into_list = Custom[Turn Into List](item=seq)  # Turns an element into a list
map = Map(number_to_string, turn_into_list)
n = Input()
python_script_with_variable = Python(map, n)  # "Python Script With Variable Number of Inputs"
# ---------- python_script_with_variable.python (6 lines) ----------
stringlist = IN0
stringlength = IN1
elementlist = list()
for item in stringlist:
	elementlist.append(item.zfill(stringlength))
OUT = elementlist
# ----------------------------------------
strings = Output(python_script_with_variable)
