# Dynamo custom node Set Dimension Type.dyf (Dynamo 0.6.3.7375)
# category: Clockwork.Revit.Dimensions
# Changes the dimension type of a given dimension instance to the specified type

Dimension_Instance_s = Input()  # "Dimension Instance(s)"
turn_into_list = Custom[Turn Into List](item=Dimension_Instance_s)  # Turns an element into a (flat) list
Dimension_Type = Input()
python_script_with_variable = Python(turn_into_list, Dimension_Type)  # "Python Script With Variable Number of Inputs"
# ---------- python_script_with_variable.python (16 lines) ----------
import clr
clr.AddReference('RevitAPI')
clr.AddReference('RevitAPIUI')
from Autodesk.Revit.DB import *
import Autodesk

diminsts = IN0
dimtype = IN1
elementlist = list()
for item in diminsts:
	try:
		item.DimensionType = dimtype
		elementlist.append(item)
	except:
		emptylist = list()
OUT = elementlist
# ----------------------------------------
return_list_or_single_value = Custom[Return List Or Single Value](list_1=turn_into_list, list_2=python_script_with_variable)  # If the list in input #1 has only one item, only the first item of the list in input #2 will be returned.
transaction = Transaction(return_list_or_single_value)
Output = Output(transaction)  # ""
