# Dynamo custom node Set Element Subcategory.dyf (Dynamo 0.6.3.5262)
# category: Clockwork.Revit.Subcategories
# Assigns the given element(s) to the specified subcategory (0 for Cut, 1 for Projection).

Element_s = Input()  # "Element(s)"
turn_into_list = Custom[Turn Into List](item=Element_s)  # Turns an element into a (flat) list
Subcategory = Input()
Cut_Projection = Input()  # "Cut/Projection"
python_script_with_variable = Python(turn_into_list, Subcategory, Cut_Projection)  # "Python Script With Variable Number of Inputs"
# ---------- python_script_with_variable.python (28 lines) ----------
import clr
clr.AddReference('RevitAPI')
clr.AddReference('RevitAPIUI')
from Autodesk.Revit.DB import *
import Autodesk

items = IN0
subcat = IN1
gstyletype = IN2

if gstyletype == 0:
	gstyletype = GraphicsStyleType.Projection
else:
	gstyletype = GraphicsStyleType.Cut

elementlist = list()
faillist = list()
try:
	gstyle = subcat.GetGraphicsStyle(gstyletype)
	for item in items:
		try:
			item.Subcategory = gstyle
			elementlist.append(item)
		except:
			faillist.append(item)
	OUT = (elementlist,faillist)
except:
	OUT = 'Subcategory not found...'
# ----------------------------------------
transaction = Transaction(python_script_with_variable)
first_of_list = First(transaction)
Success = Output(first_of_list)
formula = Formula("1", lacing=Longest)
get_from_list = GetFromList(formula, transaction)
Fail = Output(get_from_list)
