# Dynamo custom node Set Family Type.dyf (Dynamo 0.6.3.5244)
# category: Clockwork.Revit.Properties
# Changes the family type of a given famiyl instance to the specified type

Family_Instance_s = Input()  # "Family Instance(s)"
turn_into_list = Custom[Turn Into List](item=Family_Instance_s)  # Turns an element into a (flat) list
Family_Type = Input()
python_script_with_variable = Python(turn_into_list, Family_Type)  # "Python Script With Variable Number of Inputs"
# ---------- python_script_with_variable.python (16 lines) ----------
import clr
clr.AddReference('RevitAPI')
clr.AddReference('RevitAPIUI')
from Autodesk.Revit.DB import *
import Autodesk

faminsts = IN0
famsymb = IN1
elementlist = list()
for item in faminsts:
	try:
		item.Symbol = famsymb
		elementlist.append(item)
	except:
		emptylist = list()
OUT = elementlist
# ----------------------------------------
return_list_or_single_value = Custom[Return List Or Single Value](list_1=turn_into_list, list_2=python_script_with_variable)  # If the list in input #1 has only one item, only the first item of the list in input #2 will be returned.
transaction = Transaction(return_list_or_single_value)
Output = Output(transaction)  # ""
