# Dynamo custom node Set Name.dyf (Dynamo 0.6.3.5244)
# category: Clockwork.Revit.Properties
# Gets the name of a given Revit element

element_s = Input()  # "element(s)"
turn_into_list = Custom[Turn Into List](item=element_s)  # Turns an element into a (flat) list
name = Input()
turn_into_list_2 = Custom[Turn Into List](item=name)
list_length = Length(turn_into_list_2)
list_length_2 = Length(turn_into_list)
formula = Formula("na<2 && nb>1", na=list_length, nb=list_length_2, lacing=Longest)
first_of_list = First(turn_into_list_2)
repeat = Repeat(first_of_list, list_length_2, lacing=Longest)
if_ = Conditional(formula, repeat, turn_into_list_2)
python_script_with_variable = Python(turn_into_list, if_)  # "Python Script With Variable Number of Inputs"
# ---------- python_script_with_variable.python (19 lines) ----------
import clr
clr.AddReference('RevitAPI')
clr.AddReference('RevitAPIUI')
from Autodesk.Revit.DB import *
import Autodesk

items = IN0
names = IN1
goodlist = list()
badlist = list()
counter = 0
while counter < len(items):
	try:
		items[counter].Name = names[counter]
		goodlist.append(items[counter])
	except:
		badlist.append(items[counter])
	counter += 1
OUT = (goodlist,badlist)
# ----------------------------------------
transaction = Transaction(python_script_with_variable)
first_of_list_2 = First(transaction)
Success = Output(first_of_list_2)
rest_of_list = Rest(transaction)
Fail = Output(rest_of_list)
