# Dynamo custom node Shift Placement And Reverse.dyf (Dynamo 0.6.3.7375)
# category: Clockwork.Patterning.Helpers
# Shifts (integer) and reverses (bool) a given list

shift = Input()
round = Round(shift, lacing=Longest)
reverse = Input()
list = Input()
reverse_2 = Reverse(list)
if_ = Conditional(reverse, reverse_2, list)
shift_list_indeces = ShiftList(round, if_)
list_2 = Output(shift_list_indeces)  # "list"
