# Dynamo custom node Shortest Path From Point Sequences.dyf (Dynamo 0.6.3.7375)
# category: Clockwork.XYZ
# Retrieves the shortest path from a number of point sequences

distance_from_point_sequence = Custom[Distance From Point Sequence]()  # Retrieves the accumulated distances of a sequence of points
seq = Input()
map = Map(distance_from_point_sequence, seq)
get_highest_and_lowest_from_list = Custom[Get Highest And Lowest From List](list=map)  # Gets the highest and lowest value from a given list
distance = Output(get_highest_and_lowest_from_list.lowest)
formula = Formula("x=y", get_highest_and_lowest_from_list.lowest, map, lacing=Longest)
bool = Output(formula)
