# Dynamo custom node Side By Law Of Sines.dyf (Dynamo 0.6.3.35252)
# category: Clockwork.Math.Formulas
# Determines the length of a side based on the law of sines. (Alpha is the angle opposite side A and beta is the angle opposite side B...)

B = Input()
beta = Input()
alpha = Input()
formula = Formula("b/Sin(beta)*Sin(alpha)", b=B, beta=beta, alpha=alpha, lacing=Longest)
A = Output(formula)
