# Dynamo custom node Similar.dyf (Dynamo 0.6.3.5256)
# category: Clockwork.Conditional
# Computes the difference between two values and whether that difference is within a given tolerance percentage

A = Input()
B = Input()
Tolerance = Input()
formula = Formula("Abs(1-A/B)<=T", A=A, B=B, T=Tolerance, lacing=Longest)
IsSimilar = Output(formula)
formula_2 = Formula("Abs(A-B)", A=A, B=B, lacing=Longest)
Difference = Output(formula_2)
