# Dynamo custom node Slab Shape By XYZs.dyf (Dynamo 0.6.3.22045)
# category: Clockwork.Revit.Roof & Floor
# Transform a slab shape based on a list of XYZs. PLEASE NOTE: Will reset any previous edits on the slab shape. May likely need to be used in conjunction with a Transaction node.

XYZs = Input()
turn_into_list = Custom[Turn Into List](item=XYZs)  # Turns an element into a (flat) list
Floor_Roof = Input()  # "Floor/Roof"
python_script_with_variable = Python(turn_into_list, Floor_Roof)  # "Python Script With Variable Number of Inputs"
# ---------- python_script_with_variable.python (16 lines) ----------
import clr
clr.AddReference('RevitAPI')
clr.AddReference('RevitAPIUI')
from Autodesk.Revit.DB import *
import Autodesk

xyzs = IN0
slabshape = IN1
successlist = list()
faillist = list()

slabshape.SlabShapeEditor.ResetSlabShape()
for item in xyzs:
	slabshape.SlabShapeEditor.DrawPoint(item)

OUT = slabshape
# ----------------------------------------
Floor_Roof_2 = Output(python_script_with_variable)  # "Floor/Roof"
