# Dynamo custom node Slab Shape Has Been Modified.dyf (Dynamo 0.6.3.5262)
# category: Clockwork.Revit.Roof & Floor
# Checks if the shape of a roof or floor slab has been modified with the shape editing tools

Element_s = Input()  # "Element(s)"
turn_into_list = Custom[Turn Into List](item=Element_s)  # Turns an element into a list
python_script = Python(turn_into_list)
# ---------- python_script.python (19 lines) ----------
import clr
clr.AddReference('RevitAPI')
clr.AddReference('RevitAPIUI')
from Autodesk.Revit.DB import *
import Autodesk

items = IN

elementlist = list()

for item in items:
	try: 
		if item.SlabShapeEditor.SlabShapeCreases.IsEmpty == True or item.SlabShapeEditor.SlabShapeVertices.IsEmpty == True:
			elementlist.append(0)
		else:
			elementlist.append(1)
	except:
		elementlist.append(0)
OUT = elementlist
# ----------------------------------------
return_list_or_single_value = Custom[Return List Or Single Value](list_1=turn_into_list, list_2=python_script)  # If the list in input #1 has only one item, only the first item of the list in input #2 will be returned.
bool = Output(return_list_or_single_value)
