# Dynamo custom node Solve Triangle By XYZs.dyf (Dynamo 0.6.3.35252)
# category: Clockwork.Math.Formulas
# Solves a triangle based on the XYZ coordinates of its vertices.

XYZ_B = Input()  # "XYZ (B)"
XYZ_C = Input()  # "XYZ (C)"
xyz_distance = XyzDistance(XYZ_B, XYZ_C, lacing=Longest)
a = Output(xyz_distance)
# note: TODO:
# - Circumcenter (center and radius)
# - Orthocenter
XYZ_A = Input()  # "XYZ (A)"
xyz_distance_2 = XyzDistance(XYZ_A, XYZ_C, lacing=Longest)
b = Output(xyz_distance_2)
xyz_distance_3 = XyzDistance(XYZ_A, XYZ_B, lacing=Longest)
c = Output(xyz_distance_3)
angle_by_law_of_cosines = Custom[Angle By Law Of Cosines](A=xyz_distance, B=xyz_distance_2, C=xyz_distance_3)  # Computes an angle of a triangle using the law of cosines. A is the opposite side of the triangle while B and C are the sides forming the angle.
alpha = Output(angle_by_law_of_cosines)
angle_by_law_of_cosines_2 = Custom[Angle By Law Of Cosines](A=xyz_distance_2, B=xyz_distance_3, C=xyz_distance)
beta = Output(angle_by_law_of_cosines_2)
angle_by_law_of_cosines_3 = Custom[Angle By Law Of Cosines](A=xyz_distance_3, B=xyz_distance, C=xyz_distance_2)
gamma = Output(angle_by_law_of_cosines_3)
formula = Formula("b*sin(gamma)", b=xyz_distance_2, gamma=angle_by_law_of_cosines_3, lacing=Longest)
length_from_number = LengthFromNumber(formula)
Ha = Output(length_from_number)
formula_2 = Formula("c*sin(alpha)", c=xyz_distance_3, alpha=angle_by_law_of_cosines, lacing=Longest)
length_from_number_2 = LengthFromNumber(formula_2)
Hb = Output(length_from_number_2)
formula_3 = Formula("a*sin(beta)", a=xyz_distance, beta=angle_by_law_of_cosines_2, lacing=Longest)
length_from_number_3 = LengthFromNumber(formula_3)
Hc = Output(length_from_number_3)
formula_4 = Formula("c*Hc/2", c=xyz_distance_3, Hc=formula_3, lacing=Longest)
area_from_number = AreaFromNumber(formula_4)
Area = Output(area_from_number)
list = NewList(index0=XYZ_A, index1=XYZ_B, index2=XYZ_C)
best_fit_plane = BestFitPlane(list, lacing=Longest)
Plane = Output(best_fit_plane.out0)
Normal = Output(best_fit_plane.out1)
Origin_Centroid = Output(best_fit_plane.out2)  # "Origin/Centroid"
angle_bisector = Custom[Angle Bisector](XYZ_A=XYZ_A, XYZ_B=XYZ_B, XYZ_C=XYZ_C)  # Retrieves the vector of an angle bisector at point B based on three points (A, B, C) that define the angle.
angle_bisector_2 = Custom[Angle Bisector](XYZ_A=XYZ_B, XYZ_B=XYZ_C, XYZ_C=XYZ_A)
vector_vector_intersection = Custom[Vector-Vector Intersection](Basepoint_1=XYZ_B, Vector_1=angle_bisector, Basepoint_2=XYZ_C, Vector_2=angle_bisector_2)  # Determines if two vectors intersect and returns the closest points of intersection on both vectors.
Incircle_center = Output(vector_vector_intersection.Average_XYZ)
formula_5 = Formula("2*Area/(a+b+c)", Area=area_from_number, a=xyz_distance, b=xyz_distance_2, c=xyz_distance_3, lacing=Longest)
length_from_number_4 = LengthFromNumber(formula_5)
Incircle_radius = Output(length_from_number_4)
