# Dynamo custom node Sort List Of Lists.dyf (Dynamo 0.6.3.5263)
# category: Clockwork.Lists.Sublists
# Sorts a list of lists by one of its sublists

List_of_lists = Input()
transpose_lists = Transpose(List_of_lists)
Sort_index = Input()
Case_insensitive = Input()  # "Case-insensitive?"
Order_Descending = Input()  # "Order Descending?"
python_script_with_variable = Python(transpose_lists, Sort_index, Case_insensitive, Order_Descending)  # "Python Script With Variable Number of Inputs"
# ---------- python_script_with_variable.python (18 lines) ----------
lists = IN0
sortindex = int(IN1)
caseinsensitive = IN2
sortdescending = IN3

# make sure that case-insensitive is turned of if it is not strings we're sorting
if caseinsensitive == 1 and isinstance(lists[0][sortindex], basestring) == False:
	caseinsensitive = 0
if caseinsensitive == 1:
	if sortdescending == 1:
		OUT = sorted(lists, key=lambda lists:lists[sortindex].lower(), reverse=True)
	else:
		OUT = sorted(lists, key=lambda lists:lists[sortindex].lower())
else:
	if sortdescending == 1:
		OUT = sorted(lists, key=lambda lists:lists[sortindex], reverse=True)
	else:
		OUT = sorted(lists, key=lambda lists:lists[sortindex])
# ----------------------------------------
transpose_lists_2 = Transpose(python_script_with_variable)
Sorted = Output(transpose_lists_2)
