# Dynamo custom node Square Feet To Square Meters.dyf (Dynamo 0.6.3.5263)
# category: Clockwork.Conversion.Area
# Converts square feet into square meters

sq_ft = Input()
formula = Formula("sqft*0.09290304", sqft=sq_ft, lacing=Longest)
m2 = Output(formula)
