# Dynamo custom node Square Meters To Square Feet.dyf (Dynamo 0.6.3.5263)
# category: Clockwork.Conversion.Area
# Converts square meters into square feet

m2 = Input()
formula = Formula("m2/0.09290304", m2=m2, lacing=Longest)
sq_ft = Output(formula)
