# Dynamo custom node Swap UV.dyf (Dynamo 0.6.3.7375)
# category: Clockwork.Patterning.Helpers
# Swaps U and V coordinates

UV_s = Input()  # "UV(s)"
uv_components = Custom[UV Components](UV_s=UV_s)  # Get the components of a UV
lunchbox_get_domain = Custom[LunchBox Get Domain](Numbers=uv_components.U)  # Gets the domain from a list of numbers.
lunchbox_remap_numbers = Custom[LunchBox Remap Numbers](Numbers=uv_components.V, Domain=lunchbox_get_domain)  # Remaps a list of numbers to a new domain.
lunchbox_get_domain_2 = Custom[LunchBox Get Domain](Numbers=uv_components.V)
lunchbox_remap_numbers_2 = Custom[LunchBox Remap Numbers](Numbers=uv_components.U, Domain=lunchbox_get_domain_2)
UV = Uv(lunchbox_remap_numbers, lunchbox_remap_numbers_2, lacing=Longest)
UV_s_2 = Output(UV)  # "UV(s)"
