# Dynamo custom node Switch.dyf (Dynamo 0.6.3.31052)
# category: Clockwork.Conditional
# Emulates the Switch/Case statement that is  available in multiple programming languages.

check = Input()
cases = Input()
list_contains = Custom[List Contains](item=check, list=cases)  # Returns true if the given item is found in the given list, and false otherwise.
turn_into_list = Custom[Turn Into List](item=check)  # Turns an element into a (flat) list
values = Input()
match_list_with_key_values = Custom[Match List With Key Values](list=turn_into_list, keys=cases, values=values)  # Matches a list with a given set of keys and returns the values corresponding to the keys
first_of_list = First(match_list_with_key_values)
default = Input()
if_ = Conditional(list_contains, first_of_list, default)
result = Output(if_)
