# Dynamo custom node Topo To Mesh.dyf (Dynamo 0.6.3.7375)
# category: Clockwork.Revit.Topo
# Extracts the mesh of a toposurface

Topo = Input()
python_script = Python(Topo)
# ---------- python_script.python (8 lines) ----------
import clr
clr.AddReference('RevitAPI')
clr.AddReference('RevitAPIUI')
from Autodesk.Revit.DB import *
import Autodesk

topo = IN
OUT = topo.Geometry[Autodesk.Revit.DB.Options()]
# ----------------------------------------
# note: For the sake of compatibility with Dynamo 0.7.x I am using a Python script here - in 0.6.3 the Geometry Objects node would suffice...
string = StringInput("Autodesk.Revit.DB.Mesh")
equal = Equal(string)
type_name = Custom[Type Name]()  # Gets the type of the given data as a string.
map = Map(type_name, python_script)
map_2 = Map(equal, map)
filter_by_boolean_mask = FilterMask(python_script, map_2)
return_list_or_single_value = Custom[Return List Or Single Value](list_1=filter_by_boolean_mask, list_2=filter_by_boolean_mask)  # If the list in input #1 has only one item, only the first item of the list in input #2 will be returned.
Mesh = Output(return_list_or_single_value)
