# Dynamo custom node Topo-Plane Intersection.dyf (Dynamo 0.6.3.7375)
# category: Clockwork.Revit.Topo
# Calculates the intersection of a toposurface and a plane

Plane = Input()
# note: Based on an idea of Marcello Sgambelluri
Topo = Input()
topo_to_mesh = Custom[Topo To Mesh](Topo=Topo)  # Extracts the mesh of a toposurface
mesh_plane_intersection = Custom[Mesh-Plane Intersection](Plane=Plane, Mesh=topo_to_mesh)  # Calculates the intersection of a mesh and a plane
XYZs = Output(mesh_plane_intersection.XYZ)
Lines = Output(mesh_plane_intersection.Lines)
Nurbs_Spline = Output(mesh_plane_intersection.Nurbs_Spline)
Hermite_Spline = Output(mesh_plane_intersection.Hermite_Spline)
