# Dynamo custom node Transform Curve Loop.dyf (Dynamo 0.6.3.7375)
# category: Clockwork.Revit.Curves
# Returns the curve loop transformed by the transform

CurveLoop = Input()
curve_loop_components = ListCurveLoop(CurveLoop, lacing=Longest)
Transform = Input()
transform_curve = CurveTransformed(curve_loop_components, Transform, lacing=Longest)
curve_loop = CurveLoop(transform_curve, lacing=Longest)
CurveLoop_2 = Output(curve_loop)  # "CurveLoop"
