# Dynamo custom node Triangles From Mesh.dyf (Dynamo 0.6.3.7375)
# category: Clockwork.Revit.Meshes
# Retrieves all triangles from a mesh

Mesh_es = Input()  # "Mesh(es)"
turn_into_list = Custom[Turn Into List](item=Mesh_es)  # Turns an element into a (flat) list
python_script = Python(turn_into_list)
# ---------- python_script.python (16 lines) ----------
import clr
clr.AddReference('RevitAPI')
clr.AddReference('RevitAPIUI')
from Autodesk.Revit.DB import *
import Autodesk

meshes = IN
elementlist = list()
for mesh in meshes:
	i = 0
	trilist = list()
	while i < mesh.NumTriangles:
		trilist.append(mesh.Triangle[i])
		i += 1
	elementlist.append(trilist)
OUT = elementlist
# ----------------------------------------
return_list_or_single_value = Custom[Return List Or Single Value](list_1=turn_into_list, list_2=python_script)  # If the list in input #1 has only one item, only the first item of the list in input #2 will be returned.
Mesh_Triangles = Output(return_list_or_single_value)
