# Dynamo custom node Triangular Pattern (Flat, Diagonal) From Grid.dyf (Dynamo 0.6.3.7375)
# category: Clockwork.Patterning
# Creates groups of points from a list of UVs or XYZs for the placement of triangular panels. The placement pattern can be reversed (boolean) and shifted (integer).

rotate_grid_by_90 = Input()  # "rotate grid by 90°"
list = Input()
swap_uv = Custom[Swap UV](UV_s=list)  # Swaps U and V coordinates
if_ = Conditional(rotate_grid_by_90, swap_uv, list)
V = Input()
n1 = Custom[+1](V)  # Increments a value by 1
reverse_triangle_A = Input()  # "reverse (triangle A)"
shift_placement_triangle_A = Input()  # "shift placement (triangle A)"
shift_overall_placement = Input()
# note: For questions email me at dieckmann@caad.arch.rwth-aachen.de
number = DoubleInput(0)
n1_2 = Custom[+1](n1)
formula = Formula("1", lacing=Longest)
list_2 = NewList(index0=number, index1=n1, index2=n1_2, index3=formula)
# note: Shift overall placement pattern
shift_list_indeces = ShiftList(shift_overall_placement, list_2)
get_first_four_indices = Custom[Get First Four Indices](list=shift_list_indeces)  # Gets the first four indices of a given list
triangular_subpattern = Custom[Triangular Subpattern](list=if_, V=n1, Reverse_Pattern=reverse_triangle_A, Shift_Pattern=shift_placement_triangle_A, Point1=get_first_four_indices.0, Point2=get_first_four_indices.1, Point3=get_first_four_indices.2)  # Subcomponent of the Triangular Pattern From Grid node.
list_triangle_A = Output(triangular_subpattern)  # "list (triangle A)"
reverse_triangle_B = Input()  # "reverse (triangle B)"
shift_placement_triangle_B = Input()  # "shift placement (triangle B)"
triangular_subpattern_2 = Custom[Triangular Subpattern](list=if_, V=n1, Reverse_Pattern=reverse_triangle_B, Shift_Pattern=shift_placement_triangle_B, Point1=get_first_four_indices.2, Point2=get_first_four_indices.3, Point3=get_first_four_indices.0)
list_triangle_B = Output(triangular_subpattern_2)  # "list (triangle B)"
