# Dynamo custom node Triangular Pattern (Flat, Mirrored) From Grid.dyf (Dynamo 0.6.3.7375)
# category: Clockwork.Patterning
# Creates groups of points from a list of UVs or XYZs for the placement of triangular panels. The placement pattern can be reversed (boolean) and shifted (integer).

number = DoubleInput(2)
Shift_placement_rows_lying = Input()  # "Shift placement (rows, lying)"
Reverse_rows_lying = Input()  # "Reverse (rows, lying)"
V = Input()
n1 = Custom[+1](V)  # Increments a value by 1
n1_2 = Custom[+1](n1)
n1_3 = Custom[+1](n1_2)
number_2 = DoubleInput(1)
build_triangular_sublists = Custom[Build Triangular Sublists](offset=number, shift=Shift_placement_rows_lying, reverse=Reverse_rows_lying, index0=n1_3, index1=number_2, index2=n1)  # Creates sublists of three items each from a list based on given indices, shift and reverse settings and offset.
Shift_Rows_bool = Input()  # "Shift Rows (bool)"
Rotate_grid_by_90 = Input()  # "Rotate grid by 90??"
list = Input()
swap_uv = Custom[Swap UV](UV_s=list)  # Swaps U and V coordinates
if_ = Conditional(Rotate_grid_by_90, swap_uv, list)
formula = Formula("2*v+1", v=V, lacing=Longest)
build_sublists = Sublists("0..n", if_, n1, formula, lacing=Longest)
number_3 = DoubleInput(0)
# note: Even rows
take_every_nth = TakeEveryNth(number, build_sublists, number_3)
# note: Odd rows
drop_every_nth = RemoveEveryNth(number, build_sublists, number_3)
if_2 = Conditional(Shift_Rows_bool, take_every_nth, drop_every_nth)
map = Map(build_triangular_sublists, if_2)
n1_4 = Custom[+1](n1_3)
build_triangular_sublists_2 = Custom[Build Triangular Sublists](offset=number, shift=Shift_placement_rows_lying, reverse=Reverse_rows_lying, index0=n1_4, index1=number, index2=n1_2)
if_3 = Conditional(Shift_Rows_bool, drop_every_nth, take_every_nth)
map_2 = Map(build_triangular_sublists_2, if_3)
join_lists = Append(map, map_2)
number_4 = DoubleInput(1)
flatten = FlattenListAmt(join_lists, number_4)
number_5 = DoubleInput(3)
filter_sublists_by_length = Custom[Filter Sublists By Length](list=flatten, length=number_5)  # Filters out all sublists that do not have the specified length
Rows_lying = Output(filter_sublists_by_length.in)  # "Rows, lying"
is_even_number = Custom[Is Even Number](val=V)  # Checks if a number is even.
take_from_list = TakeList()
Shift_placement_rows_standing = Input()  # "Shift placement (rows, standing)"
Reverse_rows_standing = Input()  # "Reverse (rows, standing)"
number_6 = DoubleInput(3)
build_triangular_sublists_3 = Custom[Build Triangular Sublists](offset=number, shift=Shift_placement_rows_standing, reverse=Reverse_rows_standing, index0=number_2, index1=n1_3, index2=number_6)
map_3 = Map(build_triangular_sublists_3, if_2)
get_sublist_lengths = Custom[Get Sublist Lengths](list=map_3)  # Gets the lengths of all sublists in a given list of lists.
formula_2 = Formula("n-5", n=get_sublist_lengths, lacing=Longest)
combine = Combine(take_from_list, formula_2, map_3)
if_4 = Conditional(is_even_number, combine, map_3)
is_odd_number = Custom[Is Odd Number](val=V)  # Checks if a number is odd.
# note: Necessary cleanup:
# In some cases there are groups of three points that we don't want...
take_from_list_2 = TakeList()
build_triangular_sublists_4 = Custom[Build Triangular Sublists](offset=number, shift=Shift_placement_rows_standing, reverse=Reverse_rows_standing, index0=number_3, index1=n1_2, index2=number)
map_4 = Map(build_triangular_sublists_4, if_3)
get_sublist_lengths_2 = Custom[Get Sublist Lengths](list=map_4)
formula_3 = Formula("n-4", n=get_sublist_lengths_2, lacing=Longest)
combine_2 = Combine(take_from_list_2, formula_3, map_4)
if_5 = Conditional(is_odd_number, combine_2, map_4)
join_lists_2 = Append(if_4, if_5)
number_7 = DoubleInput(1)
flatten_2 = FlattenListAmt(join_lists_2, number_7)
filter_sublists_by_length_2 = Custom[Filter Sublists By Length](list=flatten_2, length=number_5)
Rows_standing = Output(filter_sublists_by_length_2.in)  # "Rows, standing"
list_2 = NewList(index0=n1_2, index1=number_3, index2=n1)
Shift_placement_left_corners_lying = Input()  # "Shift placement (left corners, lying)"
Reverse_left_corners_lying = Input()  # "Reverse (left corners, lying)"
shift_placement_and_reverse = Custom[Shift Placement And Reverse](list=list_2, shift=Shift_placement_left_corners_lying, reverse=Reverse_left_corners_lying)  # Shifts (integer) and reverses (bool) a given list
get_first_three_indices = Custom[Get First Three Indices](list=shift_placement_and_reverse)  # Gets the first three indices of a given list
get_from_list = GetFromList(get_first_three_indices.0)
if_6 = Conditional(Shift_Rows_bool, drop_every_nth, take_every_nth)
map_5 = Map(get_from_list, if_6)
get_from_list_2 = GetFromList(get_first_three_indices.1)
map_6 = Map(get_from_list_2, if_6)
get_from_list_3 = GetFromList(get_first_three_indices.2)
map_7 = Map(get_from_list_3, if_6)
list_3 = NewList(index0=map_5, index1=map_6, index2=map_7)
transpose_lists = Transpose(list_3)
Left_corners_lying = Output(transpose_lists)  # "Left corners, lying"
list_4 = NewList(index0=number_3, index1=n1, index2=number_2)
Shift_placement_left_corners_standing = Input()  # "Shift placement (left corners, standing)"
Reverse_left_corners_standing = Input()  # "Reverse (left corners, standing)"
shift_placement_and_reverse_2 = Custom[Shift Placement And Reverse](list=list_4, shift=Shift_placement_left_corners_standing, reverse=Reverse_left_corners_standing)
get_first_three_indices_2 = Custom[Get First Three Indices](list=shift_placement_and_reverse_2)
get_from_list_4 = GetFromList(get_first_three_indices_2.0)
if_7 = Conditional(Shift_Rows_bool, take_every_nth, drop_every_nth)
map_8 = Map(get_from_list_4, if_7)
get_from_list_5 = GetFromList(get_first_three_indices_2.1)
map_9 = Map(get_from_list_5, if_7)
get_from_list_6 = GetFromList(get_first_three_indices_2.2)
map_10 = Map(get_from_list_6, if_7)
list_5 = NewList(index0=map_8, index1=map_9, index2=map_10)
transpose_lists_2 = Transpose(list_5)
Left_corners_standing = Output(transpose_lists_2)  # "Left corners, standing"
formula_4 = Formula("2*v", v=V, lacing=Longest)
list_6 = NewList(index0=formula, index1=V, index2=formula_4)
Shift_placement_right_corners_lying = Input()  # "Shift placement (right corners, lying)"
Reverse_right_corners_lying = Input()  # "Reverse (right corners, lying)"
shift_placement_and_reverse_3 = Custom[Shift Placement And Reverse](list=list_6, shift=Shift_placement_right_corners_lying, reverse=Reverse_right_corners_lying)
get_first_three_indices_3 = Custom[Get First Three Indices](list=shift_placement_and_reverse_3)
get_from_list_7 = GetFromList(get_first_three_indices_3.0)
and_ = And(is_even_number, Shift_Rows_bool)
not_ = Not(Shift_Rows_bool)
and_2 = And(is_odd_number, not_)
or_ = Or(and_, and_2)
if_8 = Conditional(or_, drop_every_nth, take_every_nth)
map_11 = Map(get_from_list_7, if_8)
get_from_list_8 = GetFromList(get_first_three_indices_3.1)
map_12 = Map(get_from_list_8, if_8)
get_from_list_9 = GetFromList(get_first_three_indices_3.2)
map_13 = Map(get_from_list_9, if_8)
list_7 = NewList(index0=map_11, index1=map_12, index2=map_13)
transpose_lists_3 = Transpose(list_7)
Right_corners_lying = Output(transpose_lists_3)  # "Right corners, lying"
n1_5 = Custom[-1](V)  # Decrements a value by 1
list_8 = NewList(index0=n1_5, index1=formula, index2=V)
Shift_placement_right_corners_standing = Input()  # "Shift placement (right corners, standing)"
Reverse_right_corners_standing = Input()  # "Reverse (right corners, standing)"
shift_placement_and_reverse_4 = Custom[Shift Placement And Reverse](list=list_8, shift=Shift_placement_right_corners_standing, reverse=Reverse_right_corners_standing)
get_first_three_indices_4 = Custom[Get First Three Indices](list=shift_placement_and_reverse_4)
get_from_list_10 = GetFromList(get_first_three_indices_4.0)
and_3 = And(is_even_number, not_)
and_4 = And(is_odd_number, Shift_Rows_bool)
or_2 = Or(and_3, and_4)
if_9 = Conditional(or_2, drop_every_nth, take_every_nth)
map_14 = Map(get_from_list_10, if_9)
get_from_list_11 = GetFromList(get_first_three_indices_4.1)
map_15 = Map(get_from_list_11, if_9)
get_from_list_12 = GetFromList(get_first_three_indices_4.2)
map_16 = Map(get_from_list_12, if_9)
list_9 = NewList(index0=map_14, index1=map_15, index2=map_16)
transpose_lists_4 = Transpose(list_9)
Right_corners_standing = Output(transpose_lists_4)  # "Right corners, standing"
