# Dynamo custom node Turn Into List.dyf (Dynamo 0.6.3.5256)
# category: CAAD_RWTH.Lists
# Turns an element into a (flat) list

item = Input()
empty_list = Empty()
add_to_list = List(item, empty_list)
flatten_completely = FlattenList(add_to_list)
