# Dynamo custom node UV Components.dyf (Dynamo 0.6.3.7375)
# category: Clockwork.XYZ
# Get the components of a UV

UV_s = Input()  # "UV(s)"
turn_into_list = Custom[Turn Into List](item=UV_s)  # Turns an element into a (flat) list
python_script = Python(turn_into_list)
# ---------- python_script.python (14 lines) ----------
import clr
clr.AddReference('RevitAPI')
clr.AddReference('RevitAPIUI')
from Autodesk.Revit.DB import *
import Autodesk

UVs = IN

ulist = list()
vlist = list()
for uv in UVs:
	ulist.append(uv.U)
	vlist.append(uv.V)
OUT = (ulist,vlist)
# ----------------------------------------
first_of_list = First(python_script)
U = Output(first_of_list)
last_of_list = Last(python_script)
V = Output(last_of_list)
