# Dynamo custom node Vector Is In Plane.dyf (Dynamo 0.6.3.22045)
# category: Clockwork.XYZ
# Checks if a given vector is located on a given plane

Plane = Input()
Vector_Basepoint = Input()
almost_zero = Custom[Almost Zero]()  # Returns a feasable computational tolerance to zero (1.0e-9 or a billionth of 1) for use in calculations. More background info: https://github.com/ikeough/Dynamo/issues/879
xyz_is_out_of_plane = Custom[XYZ Is Out-Of-Plane](face_plane=Plane, XYZ=Vector_Basepoint, tolerance=almost_zero)  # Checks a list for XYZs that are not located on a given plane
not_ = Not(xyz_is_out_of_plane.bool)
Vector_Normalized = Input()  # "Vector (Normalized)"
Plane_Normal = Input()
vector_and_plane_are_parallel = Custom[Vector And Plane Are Parallel](Vector=Vector_Normalized, Plane_Normal=Plane_Normal)  # Checks if a given vector is parallel to a given plane
list = NewList(index0=not_, index1=vector_and_plane_are_parallel)
true_for_all_boolean = Custom[True For All (Boolean)](seq=list)  # Returns true if all items in a list of booleans are true.
bool = Output(true_for_all_boolean)
