# Dynamo custom node Vector-Vector Intersection.dyf (Dynamo 0.6.3.22045)
# category: CAAD_RWTH.XYZ
# Determines if two vectors intersect and returns the closest points of intersection on both vectors.

Vector_1 = Input()  # "Vector #1"
unitize_xyz = XyzNormalize(Vector_1, lacing=Longest)
Vector_2 = Input()  # "Vector #2"
unitize_xyz_2 = XyzNormalize(Vector_2, lacing=Longest)
vectors_are_parallel = Custom[Vectors Are Parallel](Vector_1=unitize_xyz, Vector_2=unitize_xyz_2)  # Checks if two vectors are parallel to each other
Vectors_parallel = Output(vectors_are_parallel)
boolean = BoolSelector(false)
# note: Based on:
# http://stackoverflow.com/questions/10551555/need-an-algorithm-for-3d-vectors-intersection
Basepoint_1 = Input()  # "Basepoint #1"
Basepoint_2 = Input()  # "Basepoint #2"
subtract_xyzs = XyzSubtract(Basepoint_2, Basepoint_1, lacing=Longest)
xyz_dot_product = XyzDotProduct(subtract_xyzs, unitize_xyz, lacing=Longest)
# note: Direction projection
xyz_dot_product_2 = XyzDotProduct(unitize_xyz, unitize_xyz_2, lacing=Longest)
# note: Separation projections
xyz_dot_product_3 = XyzDotProduct(subtract_xyzs, unitize_xyz_2, lacing=Longest)
formula = Formula("(t1-u*t2)/(1-u*u)", t1=xyz_dot_product, u=xyz_dot_product_2, t2=xyz_dot_product_3, lacing=Longest)
scale_xyz = XyzScale(unitize_xyz, formula, lacing=Longest)
add_xyzs = XyzAdd(Basepoint_1, scale_xyz, lacing=Longest)
# note: Distances along lines
formula_2 = Formula("(t2-u*t1)/(u*u-1)", t2=xyz_dot_product_3, u=xyz_dot_product_2, t1=xyz_dot_product, lacing=Longest)
scale_xyz_2 = XyzScale(unitize_xyz_2, formula_2, lacing=Longest)
add_xyzs_2 = XyzAdd(Basepoint_2, scale_xyz_2, lacing=Longest)
xyz_distance = XyzDistance(add_xyzs, add_xyzs_2, lacing=Longest)
almost_zero = Custom[Almost Zero]()  # Returns a feasable computational tolerance to zero (1.0e-9 or a billionth of 1) for use in calculations. More background info: https://github.com/ikeough/Dynamo/issues/879
formula_3 = Formula("x<almost and x>-almost", x=xyz_distance, almost=almost_zero, lacing=Longest)
if_ = Conditional(vectors_are_parallel, boolean, formula_3)
Vectors_intersect = Output(if_)
empty_list = Empty()
if_2 = Conditional(vectors_are_parallel, empty_list, add_xyzs)
Closest_point_on_Vector_1 = Output(if_2)  # "Closest point on Vector #1"
if_3 = Conditional(vectors_are_parallel, empty_list, add_xyzs_2)
Closest_point_on_Vector_2 = Output(if_3)  # "Closest point on Vector #2"
list = NewList(index0=add_xyzs, index1=add_xyzs_2)
average_xyzs = XyzAverage(list, lacing=Longest)
if_4 = Conditional(vectors_are_parallel, empty_list, average_xyzs)
Average_XYZ = Output(if_4)
