# Dynamo custom node Vectors Are Orthogonal.dyf (Dynamo 0.6.3.22045)
# category: Clockwork.XYZ
# Checks if two vectors are orthogonal to each other

Vector_1 = Input()  # "Vector #1"
unitize_xyz = XyzNormalize(Vector_1, lacing=Longest)
Vector_2 = Input()  # "Vector #2"
unitize_xyz_2 = XyzNormalize(Vector_2, lacing=Longest)
xyz_dot_product = XyzDotProduct(unitize_xyz, unitize_xyz_2, lacing=Longest)
almost_zero = Custom[Almost Zero]()  # Returns a feasable computational tolerance to zero (1.0e-9 or a billionth of 1) for use in calculations. More background info: https://github.com/ikeough/Dynamo/issues/879
formula = Formula("x<almost and x>-almost", x=xyz_dot_product, almost=almost_zero, lacing=Longest)
bool = Output(formula)
