# Dynamo custom node Vectors Are Parallel.dyf (Dynamo 0.6.3.22045)
# category: Clockwork.XYZ
# Checks if two vectors are parallel to each other

Vector_1 = Input()  # "Vector #1"
unitize_xyz = XyzNormalize(Vector_1, lacing=Longest)
Vector_2 = Input()  # "Vector #2"
unitize_xyz_2 = XyzNormalize(Vector_2, lacing=Longest)
xyz_dot_product = XyzDotProduct(unitize_xyz, unitize_xyz_2, lacing=Longest)
formula = Formula("x=1 or x=-1", x=xyz_dot_product, lacing=Longest)
bool = Output(formula)
