# Dynamo custom node Vertical Intersects for Divided Surface by Endpoints and Function.dyf (Dynamo 0.6.3.22045)
# category: Clockwork.Revit.DividedSurfaces
# Creates a number of vertical intersects (reference planes) for a divided surface based on the path between between two points. The spacing can be controlled by a function.

DivSurf = Input()
f_x = Input()  # "f(x)"
Subdivisions = Input()
n1 = Custom[+1](Subdivisions)  # Increments a value by 1
normalized_sequence_by_function = Custom[Normalized Sequence by Function](f_x=f_x, N=n1)  # Creates a sequence of N values between 0 and 1 driven by a function
XYZ_Start = Input()  # "XYZ (Start)"
project_xyz_to_xy_plane = Custom[Project XYZ To XY Plane](xyz=XYZ_Start)  # Given an XYZ, make the Z value 0 - effectively projecting the XYZ to the XY plane.
XYZ_End = Input()  # "XYZ (End)"
project_xyz_to_xy_plane_2 = Custom[Project XYZ To XY Plane](xyz=XYZ_End)
line_by_endpoints = LineBound(project_xyz_to_xy_plane, project_xyz_to_xy_plane_2, lacing=Longest)
evaluate_curve = XyzOnCurveOrEdge(normalized_sequence_by_function, line_by_endpoints, lacing=Longest)
z_axis = XyzBasisZ(lacing=Longest)
direction_to_xyz = XyzStartEndVector(project_xyz_to_xy_plane, project_xyz_to_xy_plane_2, lacing=Longest)
xyz_cross_product = XyzCrossProduct(z_axis, direction_to_xyz, lacing=Longest)
Scale = Input()
scale_xyz = XyzScale(xyz_cross_product, Scale, lacing=Longest)
add_xyzs = XyzAdd(evaluate_curve, scale_xyz, lacing=Longest)
subtract_xyzs = XyzSubtract(evaluate_curve, scale_xyz, lacing=Longest)
line_by_endpoints_2 = LineBound(add_xyzs, subtract_xyzs, lacing=Longest)
rest_of_list = Rest(line_by_endpoints_2)
reverse = Reverse(rest_of_list)
rest_of_list_2 = Rest(reverse)
reverse_2 = Reverse(rest_of_list_2)
Intersect_Name = Input()
concat_strings = ConcatStrings(Intersect_Name)
n1_2 = Custom[-1](Subdivisions)  # Decrements a value by 1
number = DoubleInput(1..N, n1_2, lacing=Longest)
number_to_string = Num2String(number, lacing=Longest)
map = Map(concat_strings, number_to_string)
reference_plane = ReferencePlane(reverse_2, map, lacing=Longest)
add_intersect_to_divided_surface = Custom[Add Intersect To Divided Surface](DivSurf=DivSurf, Element_s=reference_plane)  # Adds an intersect to a divided surface
DivSurf_2 = Output(add_intersect_to_divided_surface)  # "DivSurf"
Intersects = Output(reference_plane)
