# Dynamo custom node XYZ Axis From Vector.dyf (Dynamo 0.6.3.7375)
# category: Clockwork.XYZ
# Returns whichever main axis (X, Y or Z) is closest to a given vector

xyz = Input()
unitize_xyz = XyzNormalize(xyz, lacing=Longest)
xyz_components = XyzComponents(unitize_xyz, lacing=Longest)
formula = Formula("Abs(x)>Abs(y) && Abs(x)>Abs(z)", x=xyz_components.out0, y=xyz_components.out1, z=xyz_components.out2, lacing=Longest)
x_axis = XyzBasisX(lacing=Longest)
formula_2 = Formula("Abs(y)>Abs(x) && Abs(y)>Abs(z)", y=xyz_components.out1, x=xyz_components.out0, z=xyz_components.out2, lacing=Longest)
y_axis = XyzBasisY(lacing=Longest)
z_axis = XyzBasisZ(lacing=Longest)
if_ = Conditional(formula_2, y_axis, z_axis)
if_2 = Conditional(formula, x_axis, if_)
xyz_2 = Output(if_2)  # "xyz"
string = StringInput("X")
string_2 = StringInput("Y")
string_3 = StringInput("Z")
if_3 = Conditional(formula_2, string_2, string_3)
if_4 = Conditional(formula, string, if_3)
string_4 = Output(if_4)  # "string"
