# Dynamo custom node XYZ Is Out-Of-Plane.dyf (Dynamo 0.6.3.5256)
# category: Clockwork.XYZ
# Checks a list for XYZs that are not located on a given plane

XYZ = Input()
face_plane = Input()  # "face/plane"
project_point_on_face_plane = ProjectPointOnFace(XYZ, face_plane, lacing=Longest)
tolerance = Input()
formula = Formula("x>t", x=project_point_on_face_plane.out2, t=tolerance, lacing=Longest)
bool = Output(formula)
