# Dynamo custom node XYZs Almost Equal.dyf (Dynamo 0.6.3.7375)
# category: Clockwork.XYZ
# Checks if any XYzs in a given list are almost equal (within a reasonable computational tolerance) to a specified XYZ.

XYZ = Input()
list = Input()
turn_into_list = Custom[Turn Into List](item=list)  # Turns an element into a (flat) list
xyz_distance = XyzDistance(XYZ, turn_into_list, lacing=Longest)
almost_zero = Custom[Almost Zero]()  # Returns a feasable computational tolerance to zero (1.0e-9 or a billionth of 1) for use in calculations. More background info: https://github.com/ikeough/Dynamo/issues/879
formula = Formula("not(a > b)", a=xyz_distance, b=almost_zero, lacing=Longest)
bool = Output(formula)
