# Dynamo custom node XYZs From MeshTriangle.dyf (Dynamo 0.6.3.7375)
# category: Clockwork.Revit.Meshes
# Retrieves XYZs from MeshTriangles

MeshTriangle_s = Input()  # "MeshTriangle(s)"
turn_into_list = Custom[Turn Into List](item=MeshTriangle_s)  # Turns an element into a (flat) list
python_script = Python(turn_into_list)
# ---------- python_script.python (15 lines) ----------
import clr
clr.AddReference('RevitAPI')
clr.AddReference('RevitAPIUI')
from Autodesk.Revit.DB import *
import Autodesk

triangles = IN
elementlist = list()
for tri in triangles:
	trilist = list()
	trilist.append(tri.Vertex.__getitem__(0))
	trilist.append(tri.Vertex.__getitem__(1))
	trilist.append(tri.Vertex.__getitem__(2))
	elementlist.append(trilist)
OUT = elementlist
# ----------------------------------------
return_list_or_single_value = Custom[Return List Or Single Value](list_1=turn_into_list, list_2=python_script)  # If the list in input #1 has only one item, only the first item of the list in input #2 will be returned.
XYZs = Output(return_list_or_single_value)
