# Dynamo custom node Y Axis (Negative).dyf (Dynamo 0.6.3.5256)
# category: Clockwork.XYZ
# Returns an XYZ of 0,-1,0

y_axis = XyzBasisY(lacing=Longest)
negate_xyz = XyzNegate(y_axis, lacing=Longest)
n0_1_0 = Output(negate_xyz)  # "0,-1,0"
