# Dynamo custom node Create Text Note.dyf (Dynamo 0.6.3.7375)
# category: CAAD_RWTH.Revit
# Creates a text note at a given location

revit_document = RevitDocument(lacing=Longest)
View = Input()
XYZ_s = Input()  # "XYZ(s)"
turn_into_list = Custom[Turn Into List](item=XYZ_s)  # Turns an element into a (flat) list
BaseVector_s = Input()  # "BaseVector(s)"
turn_into_list_2 = Custom[Turn Into List](item=BaseVector_s)
UpVector_s = Input()  # "UpVector(s)"
turn_into_list_3 = Custom[Turn Into List](item=UpVector_s)
String_s = Input()  # "String(s)"
turn_into_list_4 = Custom[Turn Into List](item=String_s)
python_script_with_variable = Python(revit_document, View, turn_into_list, turn_into_list_2, turn_into_list_3, turn_into_list_4)  # "Python Script With Variable Number of Inputs"
# ---------- python_script_with_variable.python (23 lines) ----------
import clr
clr.AddReference('RevitAPI')
clr.AddReference('RevitAPIUI')
from Autodesk.Revit.DB import *
import Autodesk

doc = IN0
view = IN1
xyzlist = IN2
basevecs = IN3
upvecs = IN4
text = IN5
doccreation = doc.Create
counter = 0
textalign = Autodesk.Revit.DB.TextAlignFlags.TEF_ALIGN_LEFT
elementlist = list()

for xyz in xyzlist:
	newtextnote = doccreation.NewTextNote(view,xyz,basevecs[counter],upvecs[counter],0,textalign,text[counter])
	elementlist.append(newtextnote)
	counter += 1

OUT = elementlist
# ----------------------------------------
transaction = Transaction(python_script_with_variable)
Text_Note_s = Output(transaction)  # "Text Note(s)"
