# Dynamo custom node Detail Curve.dyf (Dynamo 0.6.3.7375)
# category: CAAD_RWTH.Revit
# Creates a new detail line in the specified view, based on the given curve

revit_document = RevitDocument(lacing=Longest)
Curve_s = Input()  # "Curve(s)"
View = Input()
python_script_with_variable = Python(revit_document, Curve_s, View)  # "Python Script With Variable Number of Inputs"
# ---------- python_script_with_variable.python (16 lines) ----------
import clr
clr.AddReference('RevitAPI')
clr.AddReference('RevitAPIUI')
from Autodesk.Revit.DB import *
import Autodesk

doc = IN0
curves = IN1
view = IN2

doccreation = doc.Create
elementlist = list()
for item in curves:
	detcurve = doccreation.NewDetailCurve(view, item)
	elementlist.append(detcurve)
OUT = elementlist
# ----------------------------------------
transaction = Transaction(python_script_with_variable)
Detail_Curve_s = Output(transaction)  # "Detail Curve(s)"
