# Dynamo custom node Element Has Transparent Materials.dyf (Dynamo 0.6.3.7375)
# category: CAAD_RWTH.Revit
# Checks if a given element contains transparent materials.

boolean = BoolSelector(false)
Element_s = Input()  # "Element(s)"
true_for_any_boolean = Custom[True For Any (Boolean)]()  # Returns true if any item in a list of booleans is true.
Min_Transparency = Input()  # "Min. Transparency (%)"
formula = Formula("x>y", y=Min_Transparency, lacing=Longest)
get_material_properties = Custom[Get Material Properties]()  # Retrieves a number of properties froma given material
map = Map(get_material_properties.Transparency)
map_2 = Map(formula, map)
map_3 = Map(true_for_any_boolean, map_2)
bool = Output(map_3)
