# Dynamo custom node Find Shortest Path.dyf (Dynamo 0.6.3.7375)
# category: CAAD_RWTH.Math
# Finds the shortest path (fewest steps) between two nodes. Connections need to input as a list of value pairs.

connections_str = Input()  # "connections (str)"
build_path_graph = Custom[Build Path Graph](connections_str=connections_str)  # Finds all possible paths between two nodes
start_str = Input()  # "start (str)"
end_str = Input()  # "end (str)"
python_script_with_variable = Python(build_path_graph, start_str, end_str)  # "Python Script With Variable Number of Inputs"
# ---------- python_script_with_variable.python (23 lines) ----------
pathgraph = IN0
start = IN1
end = IN2

# script found here:
# https://www.python.org/doc/essays/graphs/

def find_shortest_path(graph, start, end, path=[]):
	path = path + [start]
	if start == end:
		return path
	if not graph.has_key(start):
		return None
	shortest = None
	for node in graph[start]:
		if node not in path:
			newpath = find_shortest_path(graph, node, end, path)
			if newpath:
				if not shortest or len(newpath) < len(shortest):
					shortest = newpath
	return shortest

OUT = find_shortest_path(pathgraph,start,end)
# ----------------------------------------
paths = Output(python_script_with_variable)
