# Dynamo custom node Get Filtered List of Curve-Curve Intersections.dyf (Dynamo 0.6.3.22045)
# category: CAAD_RWTH.Revit

list_not_empty = Custom[List Not Empty]()  # Just the inversion of the built-in Is Empty List node.
Curves = Input()
XYZ_Start = Input()  # "XYZ (Start)"
XYZ_End = Input()  # "XYZ (End)"
line_by_endpoints = LineBound(XYZ_Start, XYZ_End, lacing=Longest)
curve_curve_intersection = CurveCurveIntersection(Curves, line_by_endpoints, lacing=Longest)
# note: Disregard non-intersections
filter = FilterInAndOut(list_not_empty, curve_curve_intersection.out1)
flatten_completely = FlattenList(filter)
xyzs_almost_equal = Custom[XYZs Almost Equal](XYZ=XYZ_End, list=flatten_completely)  # Checks if any XYzs in a given list are almost equal (within a reasonable computational tolerance) to a specified XYZ.
# note: Filter out endpoint
filter_by_boolean_mask = FilterMask(flatten_completely, xyzs_almost_equal)
xyzs_almost_equal_2 = Custom[XYZs Almost Equal](XYZ=XYZ_Start, list=filter_by_boolean_mask.out1)
# note: Filter out door location
filter_by_boolean_mask_2 = FilterMask(filter_by_boolean_mask.out1, xyzs_almost_equal_2)
XYZs = Output(filter_by_boolean_mask_2.out1)
