# Dynamo custom node Get Inserts Of Room Boundaries By Category.dyf (Dynamo 0.6.3.7375)
# category: CAAD_RWTH.Revit.Rooms

BuiltInCategory = Input()
filter_list_by_category = Custom[Filter List By Category](BuiltInCategory=BuiltInCategory)  # Filters out all elements that are not of a specified category
Room_s = Input()  # "Room(s)"
get_inserts_of_room_boundaries = Custom[Get Inserts Of Room Boundaries](Room_s=Room_s)
map = Map(filter_list_by_category.in, get_inserts_of_room_boundaries)
Inserts = Output(map)
