# Dynamo custom node Get Inserts Of Room Boundaries.dyf (Dynamo 0.6.3.7375)
# category: CAAD_RWTH.Revit.Rooms
# Retrieves the inserts of the bounding elements of a given room.

boolean = BoolSelector(true)
Room_s = Input()  # "Room(s)"
flatten_completely = FlattenList()
map = Map()
map_2 = Map(flatten_completely, map)
Insert_s = Output(map_2)  # "Insert(s)"
