# Dynamo custom node Get Source Elements From Parts.dyf (Dynamo 0.6.3.22045)
# category: CAAD_RWTH.Revit
# Retrieves the element a given part was made from

Part_s = Input()  # "Part(s)"
turn_into_list = Custom[Turn Into List](item=Part_s)  # Turns an element into a (flat) list
revit_document = RevitDocument(lacing=Longest)
python_script_with_variable = Python(revit_document, turn_into_list)  # "Python Script With Variable Number of Inputs"
# ---------- python_script_with_variable.python (18 lines) ----------
import clr
clr.AddReference('RevitAPI')
clr.AddReference('RevitAPIUI')
from Autodesk.Revit.DB import *
import Autodesk

doc = IN0
items = IN1
elementlist = list()
for item in items:
    sourcelist = list()
    for source in item.GetSourceElementIds():
        sourcelist.append(doc.GetElement(source.HostElementId))
    if len(sourcelist) < 2:
        elementlist.append(sourcelist[0])
    else:
        elementlist.append(sourcelist)
OUT = elementlist
# ----------------------------------------
return_list_or_single_value = Custom[Return List Or Single Value](list_1=turn_into_list, list_2=python_script_with_variable)  # If the list in input #1 has only one item, only the first item of the list in input #2 will be returned.
Source_Element_s = Output(return_list_or_single_value)  # "Source Element(s)"
