# Dynamo custom node Greatest Distance in Point Sequence.dyf (Dynamo 0.6.3.7375)
# category: CAAD_RWTH.XYZ
# Retrieves the fursthest point in a sequence of points

XYZ_s = Input()  # "XYZ(s)"
XYZ = Input()
xyz_distance = XyzDistance(XYZ_s, XYZ, lacing=Longest)
get_highest_and_lowest_from_list = Custom[Get Highest And Lowest From List](list=xyz_distance)  # Gets the highest and lowest value from a given list
distance = Output(get_highest_and_lowest_from_list.highest)
formula = Formula("x=y", get_highest_and_lowest_from_list.highest, xyz_distance, lacing=Longest)
bool = Output(formula)
