# Dynamo custom node Offset Quadrilateral Pattern V-Edge Along Angle Bisectors.dyf (Dynamo 0.6.3.5259)
# category: CAAD_RWTH._WIP_
# Offsets the points of a quadrilateral pattern along their angle bisectors in V direction. The offset points are located at the intersection of the angle bisectors and the offset base plane of each quad.

V = Input()
n1 = Custom[+1](V)  # Increments a value by 1
n1_2 = Custom[-1](V)  # Decrements a value by 1
Point_Index_1 = Input()
Quad_Patterns = Input()
transpose_lists = Transpose(Quad_Patterns)
get_from_list = GetFromList(Point_Index_1, transpose_lists)
shift_list_indices = ShiftList(n1_2, get_from_list)
number = DoubleInput(0)
take_every_nth = TakeEveryNth(V, shift_list_indices, number)
plane_from_first_3_xyzs = Custom[Plane From First 3 XYZs]()  # Returns a plane, its origin and its normal based on the first three XYZs in a given list
Plane_Index_First_Column = Input()  # "Plane Index (First Column)"
shift_list_indices_2 = ShiftList(Plane_Index_First_Column)
shift_list_indices_3 = ShiftList(n1_2, Quad_Patterns)
take_every_nth_2 = TakeEveryNth(V, shift_list_indices_3, number)
map = Map(shift_list_indices_2, take_every_nth_2)
map_2 = Map(plane_from_first_3_xyzs.normal, map)
Flip_Offset = Input()
Offset = Input()
formula = Formula("-x", x=Offset, lacing=Longest)
if_ = Conditional(Flip_Offset, formula, Offset)
scale_xyz = XyzScale(map_2, if_, lacing=Longest)
add_xyzs = XyzAdd(take_every_nth, scale_xyz, lacing=Longest)
list = NewList(index0=add_xyzs)
Point_Index_2 = Input()
get_from_list_2 = GetFromList(Point_Index_2, transpose_lists)
drop_every_nth = RemoveEveryNth(V, get_from_list_2, number)
angle_bisector = Custom[Angle Bisector]()  # Retrieves the vector of an angle bisector at point B based on three points (A, B, C) that define the angle.
drop_every_nth_2 = RemoveEveryNth(V, get_from_list, number)
rest_of_list = Rest(get_from_list_2)
drop_every_nth_3 = RemoveEveryNth(V, rest_of_list, number)
combine = Combine(angle_bisector, drop_every_nth_2, drop_every_nth, drop_every_nth_3)
plane_from_first_3_xyzs_2 = Custom[Plane From First 3 XYZs]()
Plane_Index_Field = Input()  # "Plane Index (Field)"
shift_list_indices_4 = ShiftList(Plane_Index_Field)
map_3 = Map(shift_list_indices_4, Quad_Patterns)
map_4 = Map(plane_from_first_3_xyzs_2.normal, map_3)
scale_xyz_2 = XyzScale(map_4, if_, lacing=Longest)
drop_every_nth_4 = RemoveEveryNth(V, scale_xyz_2, number)
add_xyzs_2 = XyzAdd(drop_every_nth, drop_every_nth_4, lacing=Longest)
drop_every_nth_5 = RemoveEveryNth(V, map_4, number)
plane_vector_intersection = Custom[Plane-Vector Intersection](Vector_Basepoint=drop_every_nth, Vector_Normalized=combine, Plane_Origin=add_xyzs_2, Plane_Normal=drop_every_nth_5)  # Finds the intersection point between a plane and a vector
partition_list = Slice(plane_vector_intersection, n1_2)
transpose_lists_2 = Transpose(partition_list)
take_every_nth_3 = TakeEveryNth(V, get_from_list_2, number)
take_every_nth_4 = TakeEveryNth(V, scale_xyz_2, number)
add_xyzs_3 = XyzAdd(take_every_nth_3, take_every_nth_4, lacing=Longest)
list_2 = NewList(index0=add_xyzs_3)
list_3 = NewList(index0=list, index1=transpose_lists_2, index2=list_2)
number_2 = DoubleInput(1)
flatten = FlattenListAmt(list_3, number_2)
transpose_lists_3 = Transpose(flatten)
flatten_completely = FlattenList(transpose_lists_3)
number_3 = DoubleInput(1)
build_sublists = Sublists("0,1", flatten_completely, number_3, lacing=Longest)
list_length = Length(build_sublists)
formula_2 = Formula("n-1", n=list_length, lacing=Longest)
take_from_list = TakeList(formula_2, build_sublists)
number_4 = DoubleInput(0)
drop_every_nth_6 = RemoveEveryNth(n1, take_from_list, number_4)
XYZs = Output(drop_every_nth_6)
