# Dynamo custom node Perform Action And Save File.dyf (Dynamo 0.6.3.5244)
# category: CAAD_RWTH._WIP_
# Performs the specified function and saves the current Revit model under a new name.

# note: Based on a post by Michael Kirschner:
# http://autodeskvasari.com/profiles/blogs/part-1-changing-a-family-instance-and-saving-an-image
f_x = Input()  # "f(x)"
x = Input()
apply_function = Apply1(arg1=f_x, x)
transaction = Transaction(apply_function)
path = Input()
string = StringInput("\")
filename = Input()
string_2 = StringInput("_")
to_string = ToString(x)
concat_strings = ConcatStrings(s3=path, s4=string, s5=filename, string_2, to_string)
save_as = Custom[Save As](filename=concat_strings)  # Saves the active Revit document under the given name.
transaction_2 = Transaction(save_as)
perform_all = Begin(expr1=transaction, expr2=transaction_2)
result = Output(perform_all)
