# Dynamo custom node Quadrilateral Pattern By Thickness (U).dyf (Dynamo 0.6.3.5259)
# category: CAAD_RWTH._WIP_
# Creates a quadrilateral pattern with a thickness (2 sets of 4 points). Will produce clean miter joints in U direction and panels of uniform thickness.
# PLEASE NOTE:
# New quads will join along angle bisectors in U direction *only*. Offsets in V direction do *not* run along surface normals and will likely produce *gaps* on doubly curved surfaces.

XYZs = Input()
V = Input()
reverse = Input()  # "reverse?"
shift_placement = Input()  # "shift placement?"
quadrilateral_pattern_from_grid = Custom[Quadrilateral Pattern From Grid](list=XYZs, V=V, reverse=reverse, shift_placement=shift_placement)  # Creates groups of points from a list of UVs or XYZs for the placement of quadrilateral panels. The placement pattern can be reversed (boolean) and shifted (integer).
transpose_lists = Transpose(quadrilateral_pattern_from_grid)
Thickness = Input()
Flip_Offset = Input()
quadrilateral_pattern_offset = Custom[Quadrilateral Pattern Offset Along Angle Bisectors (U)](Quad_Patterns=quadrilateral_pattern_from_grid, V=V, Offset=Thickness, Flip_Offset=Flip_Offset)  # Offsets a quadrilateral pattern from its original position. PLEASE NOTE: New quads will join along angle bisectors in U direction *only*. Offsets in V direction do *not* run along surface normals and will likely produce *gaps* on doubly curved surfaces.
transpose_lists_2 = Transpose(quadrilateral_pattern_offset)
list = NewList(index0=transpose_lists, index1=transpose_lists_2)
number = DoubleInput(1)
flatten = FlattenListAmt(list, number)
transpose_lists_3 = Transpose(flatten)
XYZs_2 = Output(transpose_lists_3)  # "XYZs"
