# Dynamo custom node Room Is Unbounded.dyf (Dynamo 0.6.3.7375)
# category: CAAD_RWTH.Revit.Rooms

is_empty_list = IsEmpty()
Room_s = Input()  # "Room(s)"
get_room_boundaries = Custom[Get Room Boundaries](Room_s=Room_s)  # Gets a list of all boundary elements of a given room
map = Map(is_empty_list, get_room_boundaries.Elements)
bool = Output(map)
