# Dynamo custom node UV Or XYZ Is In List.dyf (Dynamo 0.6.3.7375)
# category: CAAD_RWTH.Lists
# Checks if a given UV or XYZ coordinate is present in a given list

UV_s_XYZ_s = Input()  # "UV(s) / XYZ(s)"
to_string = ToString()
list = Input()
turn_into_list = Custom[Turn Into List](item=list)  # Turns an element into a (flat) list
map = Map(to_string, turn_into_list)
to_string_2 = ToString()
turn_into_list_2 = Custom[Turn Into List](item=UV_s_XYZ_s)
map_2 = Map(to_string_2, turn_into_list_2)
python_script_with_variable = Python(map, map_2)  # "Python Script With Variable Number of Inputs"
# ---------- python_script_with_variable.python (9 lines) ----------
list1 = IN0
list2 = IN1
booleans = list()
for item in list2:
	if item in list1:
		booleans.append(1)
	else:
		booleans.append(0)
OUT = booleans
# ----------------------------------------
filter_by_boolean_mask = FilterMask(UV_s_XYZ_s, python_script_with_variable)
in_ = Output(filter_by_boolean_mask.out0)  # "in"
out = Output(filter_by_boolean_mask.out1)
booleans = Output(python_script_with_variable)
