# Dynamo custom node Wall Type Is Curtain Wall.dyf (Dynamo 0.6.3.7375)
# category: CAAD_RWTH.Revit.Wall
# Separates a list of wall types into several lists according to wall kind

revit_document = RevitDocument(lacing=Longest)
Wall_Type_s = Input()  # "Wall Type(s)"
turn_into_list = Custom[Turn Into List](item=Wall_Type_s)  # Turns an element into a list
python_script_with_variable = Python(revit_document, turn_into_list)  # "Python Script With Variable Number of Inputs"
# ---------- python_script_with_variable.python (18 lines) ----------
import clr
clr.AddReference('RevitAPI')
clr.AddReference('RevitAPIUI')
from Autodesk.Revit.DB import *
import Autodesk

doc = IN0
walltypes = IN1
booleans = list()
for item in walltypes:
	try: 
		if str(item.Kind) == 'Curtain':
			booleans.append(1)
		else:
			booleans.append(0)
	except:
		booleans.append(0)
OUT = booleans
# ----------------------------------------
bool = Output(python_script_with_variable)
