# Dynamo custom node X by 2 Pattern From Grid.dyf (Dynamo 0.6.3.5262)
# category: CAAD_RWTH._WIP_
# Creates a pattern of X by 2 items from a list

list = Input()
list_length = Length(list)
V = Input()
n1 = Custom[+1](V)  # Increments a value by 1
formula = Formula("n>v", n=list_length, v=n1, lacing=Longest)
X = Input()
n1_2 = Custom[-1](X)  # Decrements a value by 1
is_multiple = Custom[Is Multiple](A=V, B=n1_2)  # Checks if A is a multiple of B.
shift = Input()
shift_list_indeces = ShiftList(shift)
reverse = Input()
reverse_2 = Reverse()
formula_2 = Formula("V+X", V=n1, X=n1_2, lacing=Longest)
build_sublists = Sublists("0..x,v1..v2", arg1=n1_2, arg2=n1_2, arg3=n1, arg4=formula_2, lacing=Longest)
formula_3 = Formula("2", lacing=Longest)
formula_4 = Formula("V*Y-1", V=n1, Y=formula_3, lacing=Longest)
# note: Create double rows
build_sublists_2 = Sublists("0..n", list, n1, formula_4, lacing=Longest)
# note: Create groups of X by 2 elements
map = Map(build_sublists, build_sublists_2)
formula_5 = Formula("1", lacing=Longest)
flatten = FlattenListAmt(map, formula_5)
formula_6 = Formula("n=X*Y", arg1=X, arg2=formula_3, lacing=Longest)
list_length_2 = Length()
map_2 = Map(list_length_2, flatten)
map_3 = Map(formula_6, map_2)
# note: Filter out all groups that don't contain X by 2 elements
filter_list_by_booleans = Custom[Filter List By Booleans](list=flatten, booleans=map_3)  # Filters a list by a list of booleans and filters out those elements that correspond to a boolean False.
map_4 = Map(reverse_2, filter_list_by_booleans)
# note: Reverse placement point order
# (if applicable)
if_ = Conditional(reverse, map_4, filter_list_by_booleans)
# note: Shift placement point order
map_5 = Map(shift_list_indeces, if_)
string = StringInput("V needs to be a multiple of ")
to_string = ToString(n1_2)
string_2 = StringInput(" (X-1)")
concat_strings = ConcatStrings(s3=string, to_string, string_2)
# note: Make sure that there are no empty cells left at the end of each row
if_2 = Conditional(is_multiple, map_5, concat_strings)
string_3 = StringInput("U needs to be at least 2 ")
# note: Make sure there are at least 2 rows of points
if_3 = Conditional(formula, if_2, string_3)
list_2 = Output(if_3)  # "list"
