# Dynamo custom node X by 3 Pattern From Grid.dyf (Dynamo 0.6.3.5262)
# category: CAAD_RWTH._WIP_
# Creates a pattern of X by 3 items from a list

list = Input()
list_length = Length(list)
V = Input()
pattern_y = Formula("3", lacing=Longest)
X = Input()
boolean = BoolSelector(false)
mirror_vertically = Input()
mirror_horizontally = Input()
invert_and_mirror_normalized = Custom[Invert And Mirror Normalized Values](Invert=boolean, Mirror_Vertically=mirror_vertically, Mirror_Horizontally=mirror_horizontally, X=X)  # Inverts and mirrors (horizontally & vertically) a list of normalized values.
n1 = Custom[-1](X)  # Decrements a value by 1
formula = Formula("V+X-1", V=V, X=X, lacing=Longest)
formula_2 = Formula("2*V", V=V, lacing=Longest)
formula_3 = Formula("2*V+X-1", V=V, X=X, lacing=Longest)
build_sublists = Sublists("0..x,v1..v2,v3..v4", arg1=X, arg2=n1, arg3=V, arg4=formula, arg5=formula_2, arg6=formula_3, lacing=Longest)
formula_4 = Formula("V*Y", V=V, Y=pattern_y, lacing=Longest)
partition_list = Slice(list, formula_4)
map = Map(build_sublists, partition_list)
formula_5 = Formula("1", lacing=Longest)
flatten = FlattenListAmt(map, formula_5)
formula_6 = Formula("n=X*Y", arg1=X, arg2=pattern_y, lacing=Longest)
list_length_2 = Length()
map_2 = Map(list_length_2, flatten)
map_3 = Map(formula_6, map_2)
filter_list_by_booleans = Custom[Filter List By Booleans](list=flatten, booleans=map_3)  # Filters a list by a list of booleans and filters out those elements that correspond to a boolean False.
map_4 = Map(invert_and_mirror_normalized, filter_list_by_booleans)
string = StringInput("V needs to be a multiple of ")
to_string = ToString(X)
concat_strings = ConcatStrings(string, to_string)
formula_7 = Formula("if(V/X=Round(V/X,0),[true],[false])", V, X, map_4, concat_strings, lacing=Longest)
string_2 = StringInput("U needs to be a multiple of ")
to_string_2 = ToString(pattern_y)
concat_strings_2 = ConcatStrings(string_2, to_string_2)
formula_8 = Formula("if(N/V/Y=Round(N/V/Y,0),[true],[false])", list_length, V, pattern_y, formula_7, concat_strings_2, lacing=Longest)
list_2 = Output(formula_8)  # "list"
