# Dynamo custom node All Elements Of Name.dyf (Dynamo 0.7.4.3180)
# category: Clockwork.Revit.Selection
# Retrieves those elements from a collection whose names match the search string

Elements = Input()
turn_into_list = Custom[Turn Into List](item=Elements)  # Turns an element (or a nested list) into a flat list
name = Element.Name(turn_into_list)
Search_string = Input()
Ignore_case = Input()  # "Ignore case ?"
contains = String.Contains(name, Search_string, Ignore_case)
filterByBoolMask = List.FilterByBoolMask(turn_into_list, contains)
in_ = Output(filterByBoolMask.out0)  # "in"
out = Output(filterByBoolMask.out1)
