# Dynamo custom node All Intersecting Elements Of Category.dyf (Dynamo 0.7.5.3566)
# category: Clockwork.Revit.Selection.ByCollector
# Finds all elements of a specified category that intersect with a list of vectors

Vector_Basepoint_s = Input()  # "Vector Basepoint(s)"
n3D_View = Input(3D View)
Category = Input()
turn_into_list = Custom[Turn Into List](item=Vector_Basepoint_s)  # Turns an element (or a nested list) into a flat list
Vector_s = Input()  # "Vector(s)"
turn_into_list_2 = Custom[Turn Into List](item=Vector_s)
add = Point.Add(turn_into_list, turn_into_list_2)
python_script = Python(IN[0]=n3D_View, IN[1]=Category, IN[2]=turn_into_list, IN[3]=add)
# ---------- python_script.python (33 lines) ----------
import System
import clr
clr.AddReference('RevitAPI')
from Autodesk.Revit.DB import *

clr.AddReference("RevitNodes")
import Revit
clr.ImportExtensions(Revit.Elements)
clr.ImportExtensions(Revit.GeometryConversion)

clr.AddReference("RevitServices")
import RevitServices
from RevitServices.Persistence import DocumentManager

doc = DocumentManager.Instance.CurrentDBDocument
theview = UnwrapElement(IN[0])
cat = System.Enum.ToObject(BuiltInCategory, IN[1].Id)
vstart = [x.ToXyz() for x in IN[2]]
vend = [x.ToXyz() for x in IN[3]]

intersectorlist = list()
counter = 0
filter = ElementCategoryFilter(cat)

while counter < len(vstart):
	ThisReferenceArr = ReferenceIntersector(filter, FindReferenceTarget.All, theview)
	found = ThisReferenceArr.Find(vstart[counter], vend[counter])
	foundreferences = list()
	for item in found:
		foundreferences.append(doc.GetElement(item.GetReference()))
	intersectorlist.append(foundreferences)
	counter += 1
OUT = intersectorlist
# ----------------------------------------
uniqueItems = List.UniqueItems()
map = List.Map(python_script, uniqueItems)
returnListOrSingleValue = Custom[ReturnListOrSingleValue](item_1_unknown=Vector_Basepoint_s, item_2_list=map)  # If the item in input #1 is not a list, only the first item of the list in input #2 will be returned.
Element_s = Output(returnListOrSingleValue)  # "Element(s)"
