# Dynamo custom node All Placed Family Types of Category.dyf (Dynamo 0.7.5.3566)
# category: Clockwork.Revit.Selection.ByCollector
# Retrieves all family types of a given category that have *placed* instances

Category = Input()
all_elements_of_category = ElementsOfCategory(Category)
type = Custom[Element.Type](Element_s=all_elements_of_category)  # Gets the family type of a given element (if applicable).
code_block = CodeBlock(seq=type) { List.UniqueItems(seq); }
Family_Types = Output(code_block)
