# Dynamo custom node All Placed Loadable Family Types of Category.dyf (Dynamo 0.7.5.3566)
# category: Clockwork.Revit.Selection.ByCollector
# Retrieves all *loadable* family types of a given category that have *placed* instances

Category = Input()
all_elements_of_category = ElementsOfCategory(Category)
symbol = FamilyInstance.Symbol(all_elements_of_category)
uniqueItems = List.UniqueItems(symbol)
Family_Types = Output(uniqueItems)
