# Dynamo custom node All Placed System Family Types of Category.dyf (Dynamo 0.7.5.3566)
# category: Clockwork.Revit.Selection.ByCollector
# Retrieves all *system* family types of a given category that have *placed* instances

Category = Input()
all_elements_of_category = ElementsOfCategory(Category)
type = Custom[Element.Type](Element_s=all_elements_of_category)  # Gets the family type of a given element (if applicable).
uniqueItems = List.UniqueItems(type)
Family_Types = Output(uniqueItems)
