# Dynamo custom node Angle.ByAngleSum.dyf (Dynamo 0.7.2.3911)
# category: Clockwork.Core.Math.Formulas.Angles
# Computes the missing interior angle of a *planar* polygon based on a given list of all other interior angles.

list_of_angles_degr = Input()  # "list of angles (degr.)"
code_block = CodeBlock(angles=list_of_angles_degr)
# ---------- code_block.designscript (4 lines) ----------
n = List.Count(angles);
trueval = (n-1)*180-Math.Sum(angles);
falseval = "The list needs to consist of at least two angles.";
n > 1 ? trueval : falseval;
# ----------------------------------------
angle = Output(code_block.out3)
