# Dynamo custom node Angle.ByLawOfCosines.dyf (Dynamo 0.7.2.6209)
# category: CAAD_RWTH.Core.Math.Formulas.LawOfCosines
# Computes an angle of a triangle using the law of cosines. A is the opposite side of the triangle while B and C are the sides forming the angle.

B = Input()
C = Input()
A = Input()
code_block = CodeBlock(b=B, c=C, a=A) { Math.Acos((Math.Pow(b,2)+Math.Pow(c,2)-Math.Pow(a,2))/(2*b*c)); }
alpha_degr = Output(code_block)  # "alpha (degr.)"
