# Dynamo custom node Angle.ByLawOfSines.dyf (Dynamo 0.7.2.6209)
# category: CAAD_RWTH.Core.Math.Formulas.LawOfSines
# Determines the angle of a triangle based on the law of sines. (Alpha is the angle opposite side A and beta is the angle opposite side B...)

A = Input()
B = Input()
beta_degr = Input()  # "beta (degr.)"
code_block = CodeBlock(a=A, b=B, beta=beta_degr) { Math.Asin(a/b*Math.Sin(beta)); }
alpha = Output(code_block)
