# Dynamo custom node AngleBisector.ByPoints.dyf (Dynamo 0.7.2.3911)
# category: CAAD_RWTH.Geometry.Vector.Create
# Retrieves the vector of an angle bisector at point B based on three points (A, B, C) that define the angle.

Point_A = Input()  # "Point (A)"
Point_C = Input()  # "Point (C)"
Point_B = Input()  # "Point (B)"
code_block = CodeBlock(a=Point_A, c=Point_C, b=Point_B)
# ---------- code_block.designscript (8 lines) ----------
plist = {a,c};
px = Math.Average(plist.X);
py = Math.Average(plist.Y);
pz = Math.Average(plist.Z);
// Find midpoint between points A & C
midpoint = Point.ByCoordinates(px,py,pz);
// Create vector between point B & midpoint
vec = Vector.ByTwoPoints(b,midpoint).Normalized();
# ----------------------------------------
vector = Output(code_block.vec)
