# Dynamo custom node Application.Version.dyf (Dynamo 0.7.2.6209)
# category: CAAD_RWTH.Revit.Application.Query
# Retrieves the name, version and build of the current Revit application.

python_script = Python()
# ---------- python_script.python (10 lines) ----------
import clr
clr.AddReference("RevitServices")
import RevitServices
from RevitServices.Persistence import DocumentManager

doc = DocumentManager.Instance.CurrentDBDocument
uiapp = DocumentManager.Instance.CurrentUIApplication
app = uiapp.Application

OUT = app.VersionName, app.VersionNumber, app.VersionBuild
# ----------------------------------------
code_block = CodeBlock(seq=python_script) { seq[0]; seq[1]; seq[2]; }
Name = Output(code_block.out0)
Version_int = Output(code_block.out1)  # "Version (int)"
Build = Output(code_block.out2)
