# Dynamo custom node AreaSeparator.FromCurve.dyf (Dynamo 0.7.5.3566)
# category: Clockwork.Revit.Elements.ModelCurve.Create
# Creates area separation lines from geometry curves.

Curve_s = Input()  # "Curve(s)"
turn_into_list = Custom[Turn Into List](item=Curve_s)  # Turns an element (or a nested list) into a flat list
Sketch_plane = Input()
AreaPlan_view = Input()
python_script = Python(IN[0]=turn_into_list, IN[1]=Sketch_plane, IN[2]=AreaPlan_view)
# ---------- python_script.python (29 lines) ----------
import clr
clr.AddReference('RevitAPI')
from Autodesk.Revit.DB import *

clr.AddReference("RevitNodes")
import Revit
clr.ImportExtensions(Revit.GeometryConversion)

clr.AddReference("RevitServices")
import RevitServices
from RevitServices.Persistence import DocumentManager
from RevitServices.Transactions import TransactionManager

doc = DocumentManager.Instance.CurrentDBDocument
curves = UnwrapElement(IN[0])
sketchplane = UnwrapElement(IN[1])
view = UnwrapElement(IN[2])
elementlist = list()

if str(view.ViewType) == "AreaPlan":
	TransactionManager.Instance.EnsureInTransaction(doc)
	doccreation = doc.Create
	for curve in curves:
		separator = doccreation.NewAreaBoundaryLine(sketchplane, curve.ToRevitType(), view)
		elementlist.append(separator)
	TransactionManager.Instance.TransactionTaskDone()
else:
	elementlist = "The active view needs to be an area plan..."
OUT = elementlist
# ----------------------------------------
returnListOrSingleValue = Custom[ReturnListOrSingleValue](item_1_unknown=Curve_s, item_2_list=python_script)  # If the item in input #1 is not a list, only the first item of the list in input #2 will be returned.
Area_Separator_s = Output(returnListOrSingleValue)  # "Area Separator(s)"
