# Dynamo custom node Binary.ToDecimal.dyf (Dynamo 0.7.2.3911)
# category: Clockwork.Core.List.Actions
# Converts a list of binary (boolean) values into a decimal value

list = Input()
code_block = CodeBlock(binlist=list) { n = 0..(List.Count(binlist)-1); x = binlist==true ? 1 : 0; Math.Sum(x*Math.Pow(2,n)); }
decimal = Output(code_block.out2)
