# Dynamo custom node BoundingBox.ByNestedListOfElements.dyf (Dynamo 0.7.5.3566)
# category: Clockwork.Revit.Elements.BoundingBox.Create
# Retrieves a bounding box for each sublist of elements

Element_s = Input()  # "Element(s)"
sublistLengths = Custom[List.SublistLengths](list=Element_s)  # Gets the lengths of all sublists in a given list of lists.
View = Input()
byElement = Custom[BoundingBox.ByElement](Element_s=Element_s, View=View)  # Gets the bounding box of a Revit element
X = Point.X(byElement.Bottom_left_rear_corner)
sublistByLengths = Custom[List.SublistByLengths](lengths=sublistLengths, list=X)  # Turns a list into a list of lists with sublists of varying lengths.
minimumItem = List.MinimumItem(sublistByLengths)
Y = Point.Y(byElement.Bottom_left_rear_corner)
sublistByLengths_2 = Custom[List.SublistByLengths](lengths=sublistLengths, list=Y)
minimumItem_2 = List.MinimumItem(sublistByLengths_2)
Z = Point.Z(byElement.Bottom_left_rear_corner)
sublistByLengths_3 = Custom[List.SublistByLengths](lengths=sublistLengths, list=Z)
minimumItem_3 = List.MinimumItem(sublistByLengths_3)
byCoordinates = Point.ByCoordinates(minimumItem, minimumItem_2, minimumItem_3)
X_2 = Point.X(byElement.Top_right_front_corner)
sublistByLengths_4 = Custom[List.SublistByLengths](lengths=sublistLengths, list=X_2)
maximumItem = List.MaximumItem(sublistByLengths_4)
Y_2 = Point.Y(byElement.Top_right_front_corner)
sublistByLengths_5 = Custom[List.SublistByLengths](lengths=sublistLengths, list=Y_2)
maximumItem_2 = List.MaximumItem(sublistByLengths_5)
Z_2 = Point.Z(byElement.Top_right_front_corner)
sublistByLengths_6 = Custom[List.SublistByLengths](lengths=sublistLengths, list=Z_2)
maximumItem_3 = List.MaximumItem(sublistByLengths_6)
byCoordinates_2 = Point.ByCoordinates(maximumItem, maximumItem_2, maximumItem_3)
byCorners = BoundingBox.ByCorners(byCoordinates, byCoordinates_2)
fromDynamoBoundingBox = Custom[RevitBoundingBox.FromDynamoBoundingBox](Dynamo_Bounding_Box_es=byCorners)  # Turns a Dynamo bounding box into a Revit bounding box.
Revit_Bounding_Box_es = Output(fromDynamoBoundingBox)  # "Revit Bounding Box(es)"
Dynamo_Bounding_Box_es = Output(byCorners)  # "Dynamo Bounding Box(es)"
Bottom_left_rear_corners = Output(byCoordinates)
Top_right_front_corners = Output(byCoordinates_2)
