# Dynamo custom node BoundingBox.PerimeterCurvesByNormal.dyf (Dynamo 0.7.5.3566)
# category: Clockwork.Geometry.BoundingBox.Query
# Returns the perimeter curve of a bounding box on a plane determined by a given normal and the centroid of the bounding box

Bounding_Box_es = Input()  # "Bounding Box(es)"
code_block = CodeBlock(bbox=Bounding_Box_es) { List.Transpose({bbox.MaxPoint,bbox.MinPoint}); }
average = Custom[Point.Average](Points=code_block)  # Determines the average of a list of points
Normal_s = Input()  # "Normal(s)"
code_block_2 = CodeBlock(ori=average, norm=Normal_s, bbox=Bounding_Box_es)
# ---------- code_block_2.designscript (4 lines) ----------
pl = Plane.ByOriginNormal(ori,norm);
cub = bbox.ToCuboid();
surf = Flatten(pl.Intersect(cub));
pcur = surf.PerimeterCurves();
# ----------------------------------------
Curves = Output(code_block_2.pcur)
