# Dynamo custom node BoundingBox.PerimeterCurvesOnPlane.dyf (Dynamo 0.7.5.3566)
# category: Clockwork.Geometry.BoundingBox.Query
# Returns the perimeter curve of a bounding box on a given plane (assuming that the bounding box and plane intersect)

Bounding_Box_es = Input()  # "Bounding Box(es)"
Plane_s = Input()  # "Plane(s)"
code_block = CodeBlock(bbox=Bounding_Box_es, pl=Plane_s) { cub = bbox.ToCuboid(); surf = Flatten(pl.Intersect(cub)); pcur = surf.PerimeterCurves(); }
Curves = Output(code_block.pcur)
