# Dynamo custom node Buckyball.ByOriginAndRadius.dyf (Dynamo 0.7.5.3566)
# category: Clockwork.Geometry.Buckyball
# Returns all the data necessary for modeling a truncated icosahedron (vertices and struts) as well as the surface area and volume.

Radius = Input()
coordinates = Custom[Buckyball.Coordinates]()  # Returns the coordinates of all the vertices of an (unscaled) truncated icosahedron.
Origin = Input()
struts = Custom[Buckyball.Struts](Points=coordinates)  # Parses the vertices of an (unscaled) truncated icosahedron and returns a pair of points for each strut.
surfaces = Custom[Buckyball.Surfaces](Struts=struts, Points=coordinates)  # Parses the vertices and struts of an (unscaled) truncated icosahedron and returns a list of vrtices for each surface.
code_block = CodeBlock(radius=Radius, points=coordinates, ori=Origin, struts=struts, surfs=surfaces)
# ---------- code_block.designscript (24 lines) ----------
// Determine scale factor based on radius
factor = 1/4*Math.Sqrt(58+18*Math.Sqrt(5));
scaling = radius/2/factor;
// Add scale and origin for vertices
p2 = points.Scale(scaling);
p3 = List.Transpose(ori.Add(p2.AsVector()));
// Add scale and origin for struts
s2 = struts.Scale(scaling);
s3 = ori.Add(s2.AsVector());
s4 = List.Transpose(s3);
// Create lines for the struts
Line.ByStartPointEndPoint(s4[0],s4[1]);
// Add scale and origin for surfaces
f2 = surfs.Scale(scaling);
f3 = ori.Add(f2.AsVector());
6;
// Create surfaces
f4 = Surface.ByPatch(Polygon.ByPoints(f3));
// Compute surface area and volume based on strut length
strutlength = s4[0][0].DistanceTo(s4[1][0]);
buckyarea = (20*3/2*Math.Sqrt(3)+12*5/4*Math.Sqrt(1+2/Math.Sqrt(5)))*Math.Pow(strutlength,2);
Area.FromDouble(buckyarea);
buckyvol = 1/4*(125+43*Math.Sqrt(5))*Math.Pow(strutlength,3);
Volume.FromDouble(buckyvol);
# ----------------------------------------
Vertices = Output(code_block.p3)
average = Custom[Point.Average](Points=code_block.s3)  # Determines the average of a list of points
code_block_2 = CodeBlock(ori=Origin, avg=average)
# ---------- code_block_2.designscript (2 lines) ----------
// Determine up vector from buckyball center for possible use in structural framing
Vector.ByTwoPoints(ori,avg).Normalized();
# ----------------------------------------
Struts_Up_Vectors = Output(code_block_2)  # "Struts (Up Vectors)"
Struts_Geom = Output(code_block.out7)  # "Struts (Geom.)"
Struts_Points = Output(code_block.s3)  # "Struts (Points)"
filterBySublistLength = Custom[List.FilterSublistsByLength](list=code_block.f3, length=code_block.out10)  # "List.FilterBySublistLength"; Filters out all sublists that do not have the specified length
Hexagons_Points = Output(filterBySublistLength.in)  # "Hexagons (Points)"
Pentagons_Points = Output(filterBySublistLength.out)  # "Pentagons (Points)"
Surfaces_Geom = Output(code_block.f4)  # "Surfaces (Geom.)"
Surface_Area = Output(code_block.out14)
Volume = Output(code_block.out16)
