# Dynamo custom node Buckyball.Coordinates.dyf (Dynamo 0.7.5.3566)
# category: Clockwork.Geometry.Buckyball.Helpers
# Returns the coordinates of all the vertices of an (unscaled) truncated icosahedron.

code_block = CodeBlock()
# ---------- code_block.designscript (10 lines) ----------
// The important thing in this node is to set the lacing options of all Point nodes to cross product.
phi = Math.GoldenRatio;
{0};
{1,-1};
{3*phi,-3*phi};
{2,-2};
{1+2*phi,-(1+2*phi)};
{phi,-phi};
{2+phi,-(2+phi)};
{2*phi,-2*phi};
# ----------------------------------------
byCoordinates = Point.ByCoordinates(code_block.out1, code_block.out2, code_block.out3, lacing=CrossProduct)
byCoordinates_2 = Point.ByCoordinates(code_block.out2, code_block.out3, code_block.out1, lacing=CrossProduct)
byCoordinates_3 = Point.ByCoordinates(code_block.out3, code_block.out1, code_block.out2, lacing=CrossProduct)
byCoordinates_4 = Point.ByCoordinates(code_block.out4, code_block.out5, code_block.out6, lacing=CrossProduct)
byCoordinates_5 = Point.ByCoordinates(code_block.out5, code_block.out6, code_block.out4, lacing=CrossProduct)
byCoordinates_6 = Point.ByCoordinates(code_block.out6, code_block.out4, code_block.out5, lacing=CrossProduct)
byCoordinates_7 = Point.ByCoordinates(code_block.out2, code_block.out7, code_block.out8, lacing=CrossProduct)
byCoordinates_8 = Point.ByCoordinates(code_block.out7, code_block.out8, code_block.out2, lacing=CrossProduct)
byCoordinates_9 = Point.ByCoordinates(code_block.out8, code_block.out2, code_block.out7, lacing=CrossProduct)
code_block_2 = CodeBlock(p1=byCoordinates, p2=byCoordinates_2, p3=byCoordinates_3, p4=byCoordinates_4, p5=byCoordinates_5, p6=byCoordinates_6, p7=byCoordinates_7, p8=byCoordinates_8, p9=byCoordinates_9) { Flatten({p1,p2,p3,p4,p5,p6,p7,p8,p9}); }
Points = Output(code_block_2)
