# Dynamo custom node Buckyball.Surfaces.dyf (Dynamo 0.7.5.3437)
# category: Clockwork.Geometry.Buckyball.Helpers
# Parses the vertices and struts of an (unscaled) truncated icosahedron and returns a list of vrtices for each surface.

Struts = Input()
Points = Input()
almostZero = Custom[Math.AlmostZero]()  # Returns a feasable computational tolerance to zero (1.0e-9 or a billionth of 1) for use in calculations. More background info: https://github.com/ikeough/Dynamo/issues/879
python_script = Python(IN[0]=Struts, IN[1]=Points, IN[2]=almostZero)
# ---------- python_script.python (70 lines) ----------
import clr
clr.AddReference('ProtoGeometry')
from Autodesk.DesignScript.Geometry import *

struts = IN[0]
points = IN[1]
almostzero = IN[2]

def BuckyballFaces(struts,points,planes,almostzero,vertices):
	firststrut = struts[0]
	struts.pop(0)
	# find the two adjacent struts
	adjacent = list()
	for strut in struts:
		for point in strut:
			if point.IsAlmostEqualTo(firststrut[0]):
				adjacent.append(strut)
				break
		if len(adjacent) == 2:
			break
	# identify planes and find all vertices on planes		
	vlist = list()		
	for item in adjacent:
		triangle = (firststrut[1],item[0],item[1])
		pl = Plane.ByBestFitThroughPoints(triangle)	
		vlist = list()
		for point in points:
			dist = pl.DistanceTo(point)
			if dist < almostzero and dist > -almostzero:
				vlist.append(point)
		newplane = (Plane.ByBestFitThroughPoints(vlist))
		append_vertices = True
		for pl in planes:
			if newplane.IsAlmostEqualTo(pl):
				append_vertices = False
		if append_vertices: 
			vertices.append(vlist)
			planes.append(newplane)
	# let this function recursively call itself until it finds all planes
	if len(planes) < 32:
		return BuckyballFaces(struts,points,planes,almostzero,vertices)
	else:
		return (struts,points,planes,almostzero,vertices)

def OrderFaceIndices(p_ordered,p_unordered,almostzero):
	i = 0;
	for p in p_unordered:
		dist = p_ordered[(len(p_ordered)-1)].DistanceTo(p)
		if dist > 2-almostzero and dist < 2+almostzero:
			p_ordered.append(p)
			p_unordered.pop(i)
			break
		i += 1
	if len(p_unordered) > 0:
		return OrderFaceIndices(p_ordered,p_unordered,almostzero)
	else:
		return (p_ordered,p_unordered,almostzero)

vlist_unordered = BuckyballFaces(struts,points,list(),almostzero,list())[4]

vset_ordered = list()
for vset in vlist_unordered:
	p_ordered = [vset[0]]
	vset.pop(0)
	vset_ordered.append(OrderFaceIndices(p_ordered,vset,almostzero))

vset_out = list()
for vset in vset_ordered:
	vset_out.append(vset[0])
OUT = vset_out
# ----------------------------------------
Surfaces = Output(python_script)
