# Dynamo custom node Cathetus.ByPythagoras.dyf (Dynamo 0.7.2.6209)
# category: CAAD_RWTH.Core.Math.Formulas.Pythagoras
# Computes the length of one of the catheti / legs of a right triangle using the Pythagorean Theorem. B is the other leg / cathetus of the triangle while C is the hypotenuse.

C = Input()
B = Input()
code_block = CodeBlock(c=C, b=B) { Math.Sqrt(Math.Pow(c,2)-Math.Pow(b,2)); }
A = Output(code_block)
