# Dynamo custom node Centimeters.ToFeet.dyf (Dynamo 0.7.2.3911)
# category: CAAD_RWTH.Units.Length
# Converts centimeters into feet

cm = Input()
code_block = CodeBlock(cm=cm) { cm/100/0.3048; }
ft = Output(code_block)
