# Dynamo custom node Clipboard.GetFrom.dyf (Dynamo 0.7.5.3566)
# category: Clockwork.Core.Clipboard.Query
# Gets the content of the clipboard. ATTENTION: Will only work with strings and on top of Revit (not in sandbox mode).

python_script = Python()
# ---------- python_script.python (7 lines) ----------
import clr
clr.AddReference('System.Windows.Forms')
from System.Windows.Forms import Clipboard
try:
	OUT = Clipboard.GetText()
except:
	OUT = 'Clipboard contents could not be retrieved'
# ----------------------------------------
str = Output(python_script)
