# Dynamo custom node Clipboard.SendTo.dyf (Dynamo 0.7.5.3566)
# category: Clockwork.Core.Clipboard.Actions
# Copies a string to the clipboard. ATTENTION: Will only work with strings and on top of Revit (not in sandbox mode).

str = Input()
python_script = Python(IN[0]=str)
# ---------- python_script.python (8 lines) ----------
import clr
clr.AddReference('System.Windows.Forms')
from System.Windows.Forms import Clipboard
try:
	Clipboard.SetText(IN[0])
	OUT = IN[0]
except:
	OUT = 'Data could not be copied to clipboard'
# ----------------------------------------
str_2 = Output(python_script)  # "str"
