# Dynamo custom node Color.ByWebColor.dyf (Dynamo 0.7.5.3566)
# category: Clockwork.Core.Color.Create
# Creates a color from a given web color (a hex triplet like #FF9900)

Hex = Input()
code_block = CodeBlock { "#"; ""; }
replace = String.Replace(Hex, code_block.out0, code_block.out1)
turn_into_list = Custom[Turn Into List](item=replace)  # Turns an element (or a nested list) into a flat list
code_block_2 = CodeBlock { {0,2,4}; 2; }
substring = String.Substring(arg1=code_block_2.out0, arg2=code_block_2.out1)
map = List.Map(turn_into_list, substring)
transpose = List.Transpose(map)
code_block_3 = CodeBlock(seq=transpose) { seq[0]; seq[1]; seq[2]; }
hexToDecimal = Custom[String.HexToDecimal](Hex=code_block_3.out0)  # Converts a string of a hexadecimal value to a number
hexToDecimal_2 = Custom[String.HexToDecimal](Hex=code_block_3.out1)
hexToDecimal_3 = Custom[String.HexToDecimal](Hex=code_block_3.out2)
byARGB = Color.ByARGB(arg1=hexToDecimal, arg2=hexToDecimal_2, arg3=hexToDecimal_3)
returnListOrSingleValue = Custom[ReturnListOrSingleValue](item_1_unknown=Hex, item_2_list=byARGB)  # If the item in input #1 is not a list, only the first item of the list in input #2 will be returned.
Color = Output(returnListOrSingleValue)
