# Dynamo custom node Color.GreyscaleByNormalizedValue.dyf (Dynamo 0.7.5.3566)
# category: Clockwork.Core.Color.Create
# Creates a greyscale color based on a normalized value (0 = black, 1 = white)

dbl = Input()
code_block = CodeBlock(x=dbl) { x*255; }
byARGB = Color.ByARGB(arg1=code_block, arg2=code_block, arg3=code_block)
Color = Output(byARGB)
