# Dynamo custom node CubicFeet.ToCubicMeters.dyf (Dynamo 0.7.5.3566)
# category: Clockwork.Units.Volume
# Converts cubic feet into cubic meters

cu_ft = Input()
code_block = CodeBlock(cuft=cu_ft) { cuft*0.028316846592; }
m3 = Output(code_block)
