# Dynamo custom node Curve.ClosedLoopThroughPoints.dyf (Dynamo 0.7.5.3566)
# category: Clockwork.Geometry.Curve.Create
# Creates a *closed* loop of curves based on a given list of points

Points = Input()
code_block = CodeBlock(plist=Points) { PolyCurve.ByPoints(plist,true).Curves(); }
Curves = Output(code_block)
