# Dynamo custom node DesignOption.DesignOptionSet.dyf (Dynamo 0.7.5.3566)
# category: Clockwork.Revit.Elements.DesignOption.Query
# Returns the design option set of a given design option

DesignOption_s = Input()  # "DesignOption(s)"
turn_into_list = Custom[Turn Into List](item=DesignOption_s)  # Turns an element (or a nested list) into a flat list
python_script = Python(IN[0]=turn_into_list)
# ---------- python_script.python (14 lines) ----------
import clr
clr.AddReference('RevitAPI')
from Autodesk.Revit.DB import *

clr.AddReference("RevitServices")
import RevitServices
from RevitServices.Persistence import DocumentManager

doc = DocumentManager.Instance.CurrentDBDocument
desopts = UnwrapElement(IN[0])
elementlist = list()
for item in desopts:
	elementlist.append(doc.GetElement(item.get_Parameter(BuiltInParameter.OPTION_SET_ID).AsElementId()))
OUT = elementlist
# ----------------------------------------
returnListOrSingleValue = Custom[ReturnListOrSingleValue](item_1_unknown=DesignOption_s, item_2_list=python_script)  # If the item in input #1 is not a list, only the first item of the list in input #2 will be returned.
DesignOptionSet_s = Output(returnListOrSingleValue)  # "DesignOptionSet(s)"
