# Dynamo custom node DetailCurve.FromCurve.dyf (Dynamo 0.7.5.3566)
# category: Clockwork.Revit.Elements.DetailCurve.Create
# Creates a detail line based on a given curve

Curve_s = Input()  # "Curve(s)"
turn_into_list = Custom[Turn Into List](item=Curve_s)  # Turns an element (or a nested list) into a flat list
View = Input()
python_script = Python(IN[0]=turn_into_list, IN[1]=View)
# ---------- python_script.python (24 lines) ----------
import clr
clr.AddReference('RevitAPI')
from Autodesk.Revit.DB import *

clr.AddReference("RevitNodes")
import Revit
clr.ImportExtensions(Revit.GeometryConversion)

clr.AddReference("RevitServices")
import RevitServices
from RevitServices.Persistence import DocumentManager
from RevitServices.Transactions import TransactionManager

doc = DocumentManager.Instance.CurrentDBDocument
curves = UnwrapElement(IN[0])
view = UnwrapElement(IN[1])
elementlist = []

TransactionManager.Instance.EnsureInTransaction(doc)
for curve in curves:
	detcurve = doc.Create.NewDetailCurve(view, curve.ToRevitType())
	elementlist.append(detcurve)
TransactionManager.Instance.TransactionTaskDone()
OUT = elementlist
# ----------------------------------------
returnListOrSingleValue = Custom[ReturnListOrSingleValue](item_1_unknown=Curve_s, item_2_list=python_script)  # If the item in input #1 is not a list, only the first item of the list in input #2 will be returned.
DetailCurve_s = Output(returnListOrSingleValue)  # "DetailCurve(s)"
