# Dynamo custom node Dimension.Type.dyf (Dynamo 0.7.2.2921)
# category: Clockwork.Revit.Elements.Dimension.Query
# Gets the type of a given Revit dimension

Dimension_s = Input()  # "Dimension(s)"
turn_into_list = Custom[Turn Into List](item=Dimension_s)  # Turns an element (or a nested list) into a flat list
python_script = Python(IN[0]=turn_into_list)
# ---------- python_script.python (16 lines) ----------
import clr
clr.AddReference('RevitAPI')
from Autodesk.Revit.DB import *

clr.AddReference("RevitNodes")
import Revit
clr.ImportExtensions(Revit.Elements)

items = UnwrapElement(IN[0])
elementlist = list()
for item in items:
	try:
		elementlist.append(item.DimensionType.ToDSType(True))
	except:
		elementlist.append(list())
OUT = elementlist
# ----------------------------------------
returnListOrSingleValue = Custom[ReturnListOrSingleValue](item_1_unknown=Dimension_s, item_2_list=python_script)  # If the item in input #1 is not a list, only the first item of the list in input #2 will be returned.
Dimension_Type_s = Output(returnListOrSingleValue)  # "Dimension Type(s)"
