# Dynamo custom node DimensionType.Style.dyf (Dynamo 0.7.2.2921)
# category: Clockwork.Revit.Elements.DimensionType.Query
# Gets the style of a given Revit dimension type

Dimension_Type_s = Input()  # "Dimension Type(s)"
turn_into_list = Custom[Turn Into List](item=Dimension_Type_s)  # Turns an element (or a nested list) into a flat list
python_script = Python(IN[0]=turn_into_list)
# ---------- python_script.python (12 lines) ----------
import clr
clr.AddReference('RevitAPI')
from Autodesk.Revit.DB import *

items = UnwrapElement(IN[0])
elementlist = list()
for item in items:
	try:
		elementlist.append(item.StyleType.ToString())
	except:
		elementlist.append(list())
OUT = elementlist
# ----------------------------------------
returnListOrSingleValue = Custom[ReturnListOrSingleValue](item_1_unknown=Dimension_Type_s, item_2_list=python_script)  # If the item in input #1 is not a list, only the first item of the list in input #2 will be returned.
Dimension_Style_Type_s = Output(returnListOrSingleValue)  # "Dimension Style Type(s)"
