# Dynamo custom node Directory.FromFilePath.dyf (Dynamo 0.7.2.3911)
# category: Clockwork.Core.String.Actions
# Gets the directory from a given file path

path = Input()
code_block = CodeBlock(fullpath=path) { parts1 = String.Split(fullpath,"\"); parts2 = List.TakeItems(parts1,(List.Count(parts1)-1)); }
code_block_2 = CodeBlock(parts2=code_block.parts2)
# ---------- code_block_2.designscript (3 lines) ----------
// This currently needs to be in a separate CBN
// because of issue #2396
String.Join("\",parts2);
# ----------------------------------------
dir = Output(code_block_2)
