# Dynamo custom node Dispatch.dyf (Dynamo 0.7.2.38829)
# category: Clockwork.Core.Logic.Conditional
# Dispatches a value to one of two output ports (true/false) depending on a condition. The other output  port will return an empty list.

test = Input()
value = Input()
code_block = CodeBlock(test=test, val=value) { test ? val : List.Empty; test ? List.Empty : val; }
true = Output(code_block.out0)
false = Output(code_block.out1)
