# Dynamo custom node DisplayUnit.ToInternalUnit.dyf (Dynamo 0.7.5.3566)
# category: Clockwork.Revit.Units.Actions
# Converts a value from a given display unit to Revit's internal unit

val_s = Input()  # "val(s)"
turn_into_list = Custom[Turn Into List](item=val_s)  # Turns an element (or a nested list) into a flat list
DisplayUnitType = Input()
python_script = Python(IN[0]=turn_into_list, IN[1]=DisplayUnitType)
# ---------- python_script.python (10 lines) ----------
import clr
clr.AddReference('RevitAPI')
from Autodesk.Revit.DB import *

vals = IN[0]
dispunit = IN[1]
elementlist = []
for val in vals:
	elementlist.append(UnitUtils.ConvertToInternalUnits(val,dispunit))
OUT = elementlist
# ----------------------------------------
returnListOrSingleValue = Custom[ReturnListOrSingleValue](item_1_unknown=val_s, item_2_list=python_script)  # If the item in input #1 is not a list, only the first item of the list in input #2 will be returned.
val_s_2 = Output(returnListOrSingleValue)  # "val(s)"
