# Dynamo custom node DividedSurface.AddIntersect.dyf (Dynamo 0.7.2.6209)
# category: CAAD_RWTH.Revit.Elements.DividedSurface.Actions
# Adds an intersect to a divided surface

DivSurf = Input()
Element_s = Input()  # "Element(s)"
turn_into_list = Custom[Turn Into List](item=Element_s)  # Turns an element (or a nested list) into a flat list
python_script = Python(IN[0]=DivSurf, IN[1]=turn_into_list)
# ---------- python_script.python (19 lines) ----------
import clr
clr.AddReference('RevitAPI')
from Autodesk.Revit.DB import *

clr.AddReference("RevitServices")
import RevitServices
from RevitServices.Persistence import DocumentManager
from RevitServices.Transactions import TransactionManager

doc = DocumentManager.Instance.CurrentDBDocument
divsurf = UnwrapElement(IN[0])
intersects = UnwrapElement(IN[1])

TransactionManager.Instance.EnsureInTransaction(doc)
for item in intersects:
	divsurf.AddIntersectionElement(item.Id)
TransactionManager.Instance.TransactionTaskDone()

OUT = divsurf
# ----------------------------------------
DivSurf_2 = Output(python_script)  # "DivSurf"
