# Dynamo custom node DividedSurface.EvaluateGridNodes.dyf (Dynamo 0.7.5.3566)
# category: Clockwork.Revit.Elements.DividedSurface.Query
# Returns UV and XYZ coordinates as well as surface normals for all grid nodes of a given divided surface. Also returns the underlying face.

DivSurf = Input()
Include_overhanging_nodes = Input()  # "Include overhanging nodes?"
python_script = Python(IN[0]=DivSurf, IN[1]=Include_overhanging_nodes)
# ---------- python_script.python (42 lines) ----------
import clr
clr.AddReference('RevitAPI')
from Autodesk.Revit.DB import *

clr.AddReference("RevitNodes")
import Revit
clr.ImportExtensions(Revit.Elements)
clr.ImportExtensions(Revit.GeometryConversion)

ds = UnwrapElement(IN[0])
overhanging = IN[1]
uvlist = list()
uvnormals = list()
uvxyzs = list()

face = ds.Host.GetGeometryObjectFromReference(ds.HostReference)
gn = GridNode()
if overhanging == True:
	i = 0
	j = 1
else:
	i = 1
	j = 3
u = i
while (u < (ds.NumberOfUGridlines-i)):
	gn.UIndex = u
	v = i
	vlist = list()
	vnormals = list()
	vxyzs = list()
	while (v < (ds.NumberOfVGridlines-i)):
		gn.VIndex = v
		uv = ds.GetGridNodeUV(gn)
 		vlist.append(uv)
 		vnormals.append(face.ComputeNormal(uv).ToVector())
 		vxyzs.append(face.Evaluate(uv).ToPoint())
 		v += 1
 	uvlist.append(vlist)
 	uvnormals.append(vnormals)
 	uvxyzs.append(vxyzs)
 	u += 1
OUT = (uvnormals,uvxyzs,face.ToProtoType(),uvlist)
# ----------------------------------------
code_block = CodeBlock(seq=python_script) { seq[0]; seq[1]; seq[2]; seq[3]; }
sublistLengths = Custom[List.SublistLengths](list=code_block.out3)  # Gets the lengths of all sublists in a given list of lists.
toDynamoUV = Custom[RevitUV.ToDynamoUV](Revit_UV_s=code_block.out3)  # Converts Revit UV coordinates to Dynamo UV coordinates
chopByLengths = Custom[List.SublistByLengths](lengths=sublistLengths, list=toDynamoUV)  # "List.ChopByLengths"; Turns a list into a list of lists with sublists of varying lengths.
UVs = Output(chopByLengths)
XYZs = Output(code_block.out1)
Normals = Output(code_block.out0)
Face = Output(code_block.out2)
