# Dynamo custom node DividedSurface.HorizontalIntersectsByEndpointsAndFunction.dyf (Dynamo 0.7.4.3192)
# category: Clockwork.Revit.Elements.DividedSurface.Actions
# Creates a number of horizontal intersects (levels)for a divided surface based on the path between two points. The spacing of the intersects can be controlled by a function.

DivSurf = Input()
f_x = Input()  # "f(x)"
Subdivisions = Input()
Startpoint = Input()
Endpoint = Input()
code_block = CodeBlock(n=Subdivisions, p1=Startpoint, p2=Endpoint) { n+1; p1.Z; p2.Z; }
normalizedSequenceByFunction = Custom[Normalized Sequence by Function](f_x=f_x, N=code_block.out0)  # "List.NormalizedSequenceByFunction"; Creates a sequence of N values between 0 and 1 driven by a function
scaleNormalized = Custom[Scale Normalized Value](val=normalizedSequenceByFunction, Min=code_block.out1, Max=code_block.out2)  # "Math.ScaleNormalized"; Scales a normalized value according to a given minimum and maximum
code_block_2 = CodeBlock(seq=scaleNormalized) { seq2 = List.RestOfItems(seq); seq3 = List.TakeItems(seq2,List.Count(seq2)-1); String.FromObject(1..List.Count(seq3)); }
Intersect_Name = Input()
concat = String.Concat(Intersect_Name)
map = List.Map(code_block_2.out2, concat)
byElevationAndName = Level.ByElevationAndName(code_block_2.seq3, map, lacing=Longest)
addIntersect = Custom[Add Intersect To Divided Surface](DivSurf=DivSurf, Element_s=byElevationAndName)  # "DividedSurface.AddIntersect"; Adds an intersect to a divided surface
DivSurf_2 = Output(addIntersect)  # "DivSurf"
Intersects = Output(byElevationAndName)
