# Dynamo custom node DividedSurface.VerticalIntersectsByEndpoints.dyf (Dynamo 0.7.4.3180)
# category: ___WIP___.Revit.Elements.DividedSurface.Actions
# Creates a number of equally spaced vertical intersects for a divided surface based on the path between between two points

DivSurf = Input()
XYZ_Start = Input()  # "XYZ (Start)"
XYZ_End = Input()  # "XYZ (End)"
Subdivisions = Input()
code_block = CodeBlock(startp=XYZ_Start, endp=XYZ_End, subdiv=Subdivisions)
# ---------- code_block.designscript (14 lines) ----------
// Project the points to the XY plane and create a line between them
p1 = Point.ByCoordinates(startp.X,startp.Y);
p2 = Point.ByCoordinates(endp.X,endp.Y);
curve1 = Line.ByStartPointEndPoint(p1,p2);
// Create points for subdivisions
cpoints = curve1.PointAtParameter(0..1..#(subdiv+1));
// Find vector orthogonal to line
vec1 = Vector.ByTwoPoints(p1,p2).Normalized();
vec2 = vec1.Cross(Vector.ZAxis());
vec3 = vec2.Scale(curve1.Length/10);
// Create a set of orthogonal lines to curve 1
seq1 = Line.ByStartPointEndPoint(cpoints.Add(vec3),cpoints.Subtract(vec3));
seq2 = List.RestOfItems(seq1);
seq3 = List.TakeItems(seq2,List.Count(seq2)-1);
# ----------------------------------------
byLine = ReferencePlane.ByLine(code_block.seq3)
addIntersect = Custom[Add Intersect To Divided Surface](DivSurf=DivSurf, Element_s=byLine)  # "DividedSurface.AddIntersect"; Adds an intersect to a divided surface
DivSurf_2 = Output(addIntersect)  # "DivSurf"
Intersects = Output(byLine)
