# Dynamo custom node DividedSurface.VerticalIntersectsByEndpointsAndFunction.dyf (Dynamo 0.7.4.3192)
# category: Clockwork.Revit.Elements.DividedSurface.Actions
# Creates a number of vertical intersects (reference planes) for a divided surface based on the path between between two points. The spacing can be controlled by a function.

DivSurf = Input()
XYZ_Start = Input()  # "XYZ (Start)"
XYZ_End = Input()  # "XYZ (End)"
Subdivisions = Input()
code_block = CodeBlock(startp=XYZ_Start, endp=XYZ_End, subdiv=Subdivisions)
# ---------- code_block.designscript (9 lines) ----------
// Project the points to the XY plane and create a line between them
p1 = Point.ByCoordinates(startp.X,startp.Y);
p2 = Point.ByCoordinates(endp.X,endp.Y);
curve1 = Line.ByStartPointEndPoint(p1,p2);
// Find vector orthogonal to line
vec1 = Vector.ByTwoPoints(p1,p2).Normalized();
vec2 = vec1.Cross(Vector.ZAxis());
vec3 = vec2.Scale(curve1.Length/10);
subdiv+1;
# ----------------------------------------
f_x = Input()  # "f(x)"
normalizedSequenceByFunction = Custom[Normalized Sequence by Function](f_x=f_x, N=code_block.out6)  # "List.NormalizedSequenceByFunction"; Creates a sequence of N values between 0 and 1 driven by a function
code_block_2 = CodeBlock(curve1=code_block.curve1, seq=normalizedSequenceByFunction, vec3=code_block.vec3)
# ---------- code_block_2.designscript (6 lines) ----------
// Create points for subdivisions
cpoints = curve1.PointAtParameter(seq);
// Create a set of orthogonal lines to curve 1
seq1 = Line.ByStartPointEndPoint(cpoints.Add(vec3),cpoints.Subtract(vec3));
seq2 = List.RestOfItems(seq1);
seq3 = List.TakeItems(seq2,List.Count(seq2)-1);
# ----------------------------------------
byLine = ReferencePlane.ByLine(code_block_2.seq3, lacing=Longest)
addIntersect = Custom[Add Intersect To Divided Surface](DivSurf=DivSurf, Element_s=byLine)  # "DividedSurface.AddIntersect"; Adds an intersect to a divided surface
DivSurf_2 = Output(addIntersect)  # "DivSurf"
Intersects = Output(byLine)
