# Dynamo custom node Document.ActiveViewFromCurrentDocument.dyf (Dynamo 0.7.2.2921)
# category: Clockwork.Revit.Document.Query
# Gets the active view of the current document

current = Document.Current()
activeView = Document.ActiveView(current)
View = Output(activeView)
