# Dynamo custom node Document.DesignOptions.dyf (Dynamo 0.7.5.3566)
# category: Clockwork.Revit.Document.Query
# Returns all design options in the model, grouped by design option set

python_script = Python()
# ---------- python_script.python (13 lines) ----------
import clr
clr.AddReference('RevitAPI')
from Autodesk.Revit.DB import *
import Autodesk

clr.AddReference("RevitServices")
import RevitServices
from RevitServices.Persistence import DocumentManager

doc = DocumentManager.Instance.CurrentDBDocument
collector = FilteredElementCollector(doc)
desopts = collector.OfClass(DesignOption).ToElements()
OUT = desopts
# ----------------------------------------
designOptionSet = Custom[DesignOption.DesignOptionSet](DesignOption_s=python_script)  # Returns the design option set of a given design option
isEmpty = List.IsEmpty(designOptionSet)
uniqueId = Element.UniqueId(designOptionSet)
if_ = If(isEmpty, designOptionSet, uniqueId)
create = List.Create(python_script, if_)
code_block = CodeBlock { 1; }
groupListOfListsByKey = Custom[List.GroupListOfListsByKey](list=create, key_index=code_block)  # Groups a list of lists by one of its keys
transpose = List.Transpose(groupListOfListsByKey)
code_block_2 = CodeBlock(seq=transpose) { seq[1]; }
flatten = Flatten(code_block_2)
uniqueItems = List.UniqueItems(flatten)
byID = Custom[Element.ByID](ID_s_or_UniqueId_s=uniqueItems)  # Gets the Revit element(s) for a list of IDs (or a single ID)
DesignOptionSets = Output(byID.Element_s)
firstItem = List.FirstItem(transpose)
DesignOptions = Output(firstItem)
