# Dynamo custom node Document.DimensionTypes.dyf (Dynamo 0.7.3.3034)
# category: Clockwork.Revit.Document.Query
# Retrieves all dimension types from the document

python_script = Python()
# ---------- python_script.python (15 lines) ----------
import System
import clr
clr.AddReference('RevitAPI')
from Autodesk.Revit.DB import *

clr.AddReference("RevitServices")
import RevitServices
from RevitServices.Persistence import DocumentManager

doc = DocumentManager.Instance.CurrentDBDocument

elementlist = list()
collector = FilteredElementCollector(doc)
collector.OfClass(DimensionType)
OUT = collector.ToElements()
# ----------------------------------------
DimensionTypes = Output(python_script)
