# Dynamo custom node Document.IsWorkshared.dyf (Dynamo 0.7.2.6209)
# category: Clockwork.Revit.Document.Query
# Returns true if the current project is workshared

python_script = Python()
# ---------- python_script.python (10 lines) ----------
import clr
clr.AddReference("RevitServices")
import RevitServices
from RevitServices.Persistence import DocumentManager

doc = DocumentManager.Instance.CurrentDBDocument
if doc.IsWorkshared:
	OUT = True
else:
	OUT = False
# ----------------------------------------
bool = Output(python_script)
