# Dynamo custom node Document.ListBuiltInCategories.dyf (Dynamo 0.7.5.3566)
# category: Clockwork.Revit.Document.Query
# List all the available BuiltInCategories

python_script = Python()
# ---------- python_script.python (7 lines) ----------
import clr
clr.AddReference('RevitAPI')
clr.AddReference('RevitAPIUI')
from Autodesk.Revit.DB import *
import Autodesk

OUT = dir(BuiltInCategory)
# ----------------------------------------
code_block = CodeBlock { "OST_"; false; }
contains = String.Contains(arg1=code_block.out0, arg2=code_block.out1)
filter = List.Filter(python_script, contains)
list = Output(filter)
