# Dynamo custom node Document.ListBuiltInCategoriesByName.dyf (Dynamo 0.7.5.3566)
# category: Clockwork.Revit.Document.Query
# Looks up all the built-in categories based on a given name (or part of a name) of the category. Search is case-insensitive.

listBuiltInCategories = Custom[List BuiltInCategories]()  # "Document.ListBuiltInCategories"; List all the available BuiltInCategories
search_term = Input()
boolean = BoolSelector(true)
contains = String.Contains(arg1=search_term, arg2=boolean)
filter = List.Filter(listBuiltInCategories, contains)
results = Output(filter)
