# Dynamo custom node Document.ListBuiltInParametersByName.dyf (Dynamo 0.7.5.3566)
# category: Clockwork.Revit.Document.Query
# Looks up all the built-in parameters based on a given name (or part of a name) of the parameters. Search is case-insensitive.

listBuiltInParameters = Custom[List BuiltInParameters]()  # "Document.ListBuiltInParameters"; List all the available BuiltInParameters
search_term = Input()
boolean = BoolSelector(true)
contains = String.Contains(arg1=search_term, arg2=boolean)
filter = List.Filter(listBuiltInParameters, contains)
results = Output(filter)
