# Dynamo custom node Document.Phases.dyf (Dynamo 0.7.2.6209)
# category: CAAD_RWTH.Revit.Document.Query
# Lists all phases in the active document

python_script = Python()
# ---------- python_script.python (15 lines) ----------
import clr
clr.AddReference('RevitAPI')
from Autodesk.Revit.DB import *

clr.AddReference("RevitServices")
import RevitServices
from RevitServices.Persistence import DocumentManager

doc = DocumentManager.Instance.CurrentDBDocument
elementlist = list()

for phase in doc.Phases:
	elementlist.append(phase)

OUT = elementlist
# ----------------------------------------
Phases = Output(python_script)
