# Dynamo custom node Document.ProjectPosition.dyf (Dynamo 0.7.5.3566)
# category: Clockwork.Revit.Document.Query
# Gets the project's position data relative to the origin. Use the built-in nodes Location.Latitude & Location.Longitude to retrieve latitude and longitude.

python_script = Python()
# ---------- python_script.python (15 lines) ----------
import clr
clr.AddReference('RevitAPI')
from Autodesk.Revit.DB import *
import Autodesk

clr.AddReference("RevitServices")
import RevitServices
from RevitServices.Persistence import DocumentManager

doc = DocumentManager.Instance.CurrentDBDocument

projloc = doc.ActiveProjectLocation
position_data = projloc.ProjectPosition[XYZ.Zero]
location_data = projloc.SiteLocation
OUT = (position_data.Angle,position_data.Elevation,position_data.EastWest,position_data.NorthSouth)
# ----------------------------------------
code_block = CodeBlock(seq=python_script) { seq[0]; seq[1]; seq[2]; seq[3]; }
radiansToDegrees = Math.RadiansToDegrees(code_block.out0)
Angle_degr = Output(radiansToDegrees)  # "Angle (degr.)"
fromDouble = DynamoUnits.Length.FromDouble(code_block.out1)
Elevation = Output(fromDouble)
fromDouble_2 = DynamoUnits.Length.FromDouble(code_block.out2)
EastWest = Output(fromDouble_2)
fromDouble_3 = DynamoUnits.Length.FromDouble(code_block.out3)
NorthSouth = Output(fromDouble_3)
