# Dynamo custom node Document.SaveAs.dyf (Dynamo 0.7.4.3180)
# category: Clockwork.Revit.Document.Actions
# Saves the active Revit document under the given name.

filename = Input()
python_script = Python(IN[0]=filename)
# ---------- python_script.python (16 lines) ----------
import clr
clr.AddReference('RevitAPI')
from Autodesk.Revit.DB import *

clr.AddReference("RevitServices")
import RevitServices
from RevitServices.Persistence import DocumentManager

doc = DocumentManager.Instance.CurrentDBDocument
path = IN[0]

if doc.IsFamilyDocument:
	path += '.rfa'
else:
	path += '.rvt'
OUT = doc.SaveAs(path)
# ----------------------------------------
result = Output(python_script)
