# Dynamo custom node Element.AllInstances.dyf (Dynamo 0.7.5.3566)
# category: Clockwork.Revit.Elements.Element.Query
# Retrieves all instances of a given element

Element_s = Input()  # "Element(s)"
turn_into_list = Custom[Turn Into List](item=Element_s)  # Turns an element (or a nested list) into a flat list
python_script = Python(IN[0]=turn_into_list)
# ---------- python_script.python (26 lines) ----------
import System
import clr
clr.AddReference('RevitAPI')
from Autodesk.Revit.DB import *

clr.AddReference("RevitServices")
import RevitServices
from RevitServices.Persistence import DocumentManager

doc = DocumentManager.Instance.CurrentDBDocument
elements = UnwrapElement(IN[0])

elementlist = list()
for e in elements:
	collector = FilteredElementCollector(doc)
	bic = System.Enum.ToObject(BuiltInCategory, e.Category.Id.IntegerValue)
	collector.OfCategory(bic)
	# This is a workaround
	# because I was to lazy to learn
	# how to implement LINQ in Python
	elist =  list()
	for item in collector.ToElements():
		if item.GetTypeId().IntegerValue == e.GetTypeId().IntegerValue:
			elist.append(item)
	elementlist.append(elist)
OUT = elementlist
# ----------------------------------------
returnListOrSingleValue = Custom[ReturnListOrSingleValue](item_1_unknown=Element_s, item_2_list=python_script)  # If the item in input #1 is not a list, only the first item of the list in input #2 will be returned.
Elements = Output(returnListOrSingleValue)
