# Dynamo custom node Element.AllInstancesAtLevel.dyf (Dynamo 0.7.5.3566)
# category: Clockwork.Revit.Elements.Element.Query
# Retrieves all instances of an element on a given level

Element_s = Input()  # "Element(s)"
turn_into_list = Custom[Turn Into List](item=Element_s)  # Turns an element (or a nested list) into a flat list
Level = Input()
all_elements_at_level = ElementsAtLevel(Level)
turn_into_list_2 = Custom[Turn Into List](item=all_elements_at_level)
python_script = Python(IN[0]=turn_into_list, IN[1]=turn_into_list_2)
# ---------- python_script.python (21 lines) ----------
import System
import clr
clr.AddReference('RevitAPI')
from Autodesk.Revit.DB import *

clr.AddReference("RevitServices")
import RevitServices
from RevitServices.Persistence import DocumentManager

doc = DocumentManager.Instance.CurrentDBDocument
elements = UnwrapElement(IN[0])
selection = UnwrapElement(IN[1])

elementlist = list()
for e in elements:
	elist =  list()
	for item in selection:
		if item.GetTypeId().IntegerValue == e.GetTypeId().IntegerValue:
			elist.append(item)
	elementlist.append(elist)
OUT = elementlist
# ----------------------------------------
returnListOrSingleValue = Custom[ReturnListOrSingleValue](item_1_unknown=Element_s, item_2_list=python_script)  # If the item in input #1 is not a list, only the first item of the list in input #2 will be returned.
Elements = Output(returnListOrSingleValue)
