# Dynamo custom node Element.AllViewDependentInstances.dyf (Dynamo 0.7.5.3566)
# category: Clockwork.Revit.Elements.Element.Query
# Retrieves all instances of a view-dependent element in a given view

Element_s = Input()  # "Element(s)"
turn_into_list = Custom[Turn Into List](item=Element_s)  # Turns an element (or a nested list) into a flat list
View_s = Input()  # "View(s)"
turn_into_list_2 = Custom[Turn Into List](item=View_s)
python_script = Python(IN[0]=turn_into_list, IN[1]=turn_into_list_2)
# ---------- python_script.python (28 lines) ----------
import System
import clr
clr.AddReference('RevitAPI')
from Autodesk.Revit.DB import *

clr.AddReference("RevitServices")
import RevitServices
from RevitServices.Persistence import DocumentManager

doc = DocumentManager.Instance.CurrentDBDocument
elements = UnwrapElement(IN[0])
views = UnwrapElement(IN[1])

elementlist = list()
# This could be more elegant if only I knew how to implement a Multicategory filter in Python....
for e in elements:
	elist = list()
	for view in views:
		vlist = list()
		collector = FilteredElementCollector(doc)
		filter = ElementOwnerViewFilter(view.Id)
		bic = System.Enum.ToObject(BuiltInCategory, e.Category.Id.IntegerValue)
		for item in collector.WherePasses(filter).OfCategory(bic).ToElements():
			if item.GetTypeId().IntegerValue == e.GetTypeId().IntegerValue:
				vlist.append(item)
		elist.append(vlist)
	elementlist.append(elist)
OUT = elementlist
# ----------------------------------------
returnListOrSingleValue = Custom[ReturnListOrSingleValue](item_1_unknown=Element_s, item_2_list=python_script)  # If the item in input #1 is not a list, only the first item of the list in input #2 will be returned.
Elements = Output(returnListOrSingleValue)
