# Dynamo custom node Element.Area.dyf (Dynamo 0.7.2.2921)
# category: Clockwork.Revit.Elements.Element.Query
# Returns the area property of a given element (if that element has such a property)

element_s = Input()  # "element(s)"
turn_into_list = Custom[Turn Into List](item=element_s)  # Turns an element (or a nested list) into a flat list
python_script = Python(IN[0]=turn_into_list)
# ---------- python_script.python (12 lines) ----------
import clr
clr.AddReference('RevitAPI')
from Autodesk.Revit.DB import *

faminsts = UnwrapElement(IN[0])
elementlist = list()
for item in faminsts:
	try:
		elementlist.append(item.Area)
	except:
		elementlist.append(list())
OUT = elementlist
# ----------------------------------------
fromSquareFeet = DynamoUnits.Area.FromSquareFeet(python_script)
value = DynamoUnits.SIUnit.Value(fromSquareFeet)
returnListOrSingleValue = Custom[ReturnListOrSingleValue](item_1_unknown=element_s, item_2_list=value)  # If the item in input #1 is not a list, only the first item of the list in input #2 will be returned.
area_s = Output(returnListOrSingleValue)  # "area(s)"
