# Dynamo custom node Element.ByID.dyf (Dynamo 0.7.5.3566)
# category: Clockwork.Revit.Selection.Miscellaneous
# Gets the Revit element(s) for a list of IDs (or a single ID)

ID_s_or_UniqueId_s = Input()  # "ID(s) or UniqueId(s)"
turn_into_list = Custom[Turn Into List](item=ID_s_or_UniqueId_s)  # Turns an element (or a nested list) into a flat list
python_script = Python(IN[0]=turn_into_list)
# ---------- python_script.python (23 lines) ----------
import clr
clr.AddReference('RevitAPI')
from Autodesk.Revit.DB import *

clr.AddReference("RevitNodes")
import Revit
clr.ImportExtensions(Revit.Elements)

clr.AddReference("RevitServices")
import RevitServices
from RevitServices.Persistence import DocumentManager

doc = DocumentManager.Instance.CurrentDBDocument
items = UnwrapElement(IN[0])

elementlist = list()
unmatched = list()
for item in items:
	try: 
		elementlist.append(doc.GetElement(item).ToDSType(True))
	except:
		unmatched.append(item)
OUT = (elementlist, unmatched)
# ----------------------------------------
code_block = CodeBlock(seq=python_script) { seq[0]; seq[1]; }
returnListOrSingleValue = Custom[ReturnListOrSingleValue](item_1_unknown=ID_s_or_UniqueId_s, item_2_list=code_block.out0)  # If the item in input #1 is not a list, only the first item of the list in input #2 will be returned.
Element_s = Output(returnListOrSingleValue)  # "Element(s)"
unmatched = Output(code_block.out1)
