# Dynamo custom node Element.ContainsTransparentMaterials.dyf (Dynamo 0.7.3.3034)
# category: Clockwork.Revit.Elements.Element.Query
# Checks if a given element contains transparent materials.

Element_s = Input()  # "Element(s)"
turn_into_list = Custom[Turn Into List](item=Element_s)  # Turns an element (or a nested list) into a flat list
boolean = BoolSelector(false)
materials = Custom[Element.Materials](Element_s=turn_into_list, Include_paint_materials=boolean)  # Retrieves all materials froma given element
properties = Custom[Material.Properties]()  # Retrieves a number of properties froma given material
map = List.Map(materials.Materials, properties.Transparency)
Min_Transparency = Input()  # "Min. Transparency (%)"
formula = Formula("x>y", y=Min_Transparency)
map_2 = List.Map(map, formula)
true_for_any_booleans = Custom[True For Any (Boolean)]()  # Returns true if any item in a list of booleans is true.
map_3 = List.Map(map_2, true_for_any_booleans)
returnListOrSingleValue = Custom[ReturnListOrSingleValue](item_1_unknown=Element_s, item_2_list=map_3)  # If the item in input #1 is not a list, only the first item of the list in input #2 will be returned.
bool = Output(returnListOrSingleValue)
