# Dynamo custom node Element.ElevationOfHostLevel.dyf (Dynamo 0.7.5.3566)
# category: Clockwork.Revit.Elements.Element.Query
# Returns the elevation of the level a given element is associated with

element_s = Input()  # "element(s)"
level = Custom[Element.Level](Element_s=element_s)  # Gets an element's level
code_block = CodeBlock(lvl=level) { lvl.Elevation; }
double = Output(code_block)
