# Dynamo custom node Element.ID.dyf (Dynamo 0.7.2.2921)
# category: Clockwork.Revit.Elements.Element.Query
# Gets the ID(s) for a list of Revit elements (or a single element) - unlike the built-in Element.Id node, this node returns an actual Revit Element ID and *not* a number

Element_s = Input()  # "Element(s)"
turn_into_list = Custom[Turn Into List](item=Element_s)  # Turns an element (or a nested list) into a flat list
python_script = Python(IN[0]=turn_into_list)
# ---------- python_script.python (17 lines) ----------
import clr
clr.AddReference('RevitAPI')
from Autodesk.Revit.DB import *

clr.AddReference("RevitNodes")
import Revit
clr.ImportExtensions(Revit.Elements)

items = UnwrapElement(IN[0])
elementlist = list()
unmatched = list()
for item in items:
	try:
		elementlist.append(item.Id)
	except:
		unmatched.append(item)
OUT = (elementlist, unmatched)
# ----------------------------------------
code_block = CodeBlock(seq=python_script) { seq[0]; seq[1]; }
returnListOrSingleValue = Custom[ReturnListOrSingleValue](item_1_unknown=Element_s, item_2_list=code_block.out0)  # If the item in input #1 is not a list, only the first item of the list in input #2 will be returned.
ID_s = Output(returnListOrSingleValue)  # "ID(s)"
unmatched = Output(code_block.out1)
