# Dynamo custom node Element.IsRelatedToMass.dyf (Dynamo 0.7.2.2921)
# category: Clockwork.Revit.Elements.Element.Query
# Returns true if an object (wall, roof, floor or curtain system) has been modelled by face and the underlying mass still exists in the project.

Element_s = Input()  # "Element(s)"
turn_into_list = Custom[Turn Into List](item=Element_s)  # Turns an element (or a nested list) into a flat list
python_script = Python(IN[0]=turn_into_list)
# ---------- python_script.python (15 lines) ----------
import clr
clr.AddReference('RevitAPI')
from Autodesk.Revit.DB import *

items = UnwrapElement(IN[0])
booleans = list()
for item in items:
	try:
		if item.get_Parameter(BuiltInParameter.RELATED_TO_MASS).AsInteger() == 1:
			booleans.append(True)
		else:
			booleans.append(False)
	except:
		booleans.append(False)
OUT = booleans
# ----------------------------------------
returnListOrSingleValue = Custom[ReturnListOrSingleValue](item_1_unknown=Element_s, item_2_list=python_script)  # If the item in input #1 is not a list, only the first item of the list in input #2 will be returned.
bool = Output(returnListOrSingleValue)
