# Dynamo custom node Element.Materials.dyf (Dynamo 0.7.2.6209)
# category: Clockwork.Revit.Elements.Element.Query
# Retrieves all materials froma given element

Element_s = Input()  # "Element(s)"
turn_into_list = Custom[Turn Into List](item=Element_s)  # Turns an element (or a nested list) into a flat list
Include_paint_materials = Input()  # "Include paint materials?"
python_script = Python(IN[0]=turn_into_list, IN[1]=Include_paint_materials)
# ---------- python_script.python (27 lines) ----------
import clr
clr.AddReference('RevitAPI')
from Autodesk.Revit.DB import *

clr.AddReference("RevitServices")
import RevitServices
from RevitServices.Persistence import DocumentManager

doc = DocumentManager.Instance.CurrentDBDocument
items = UnwrapElement(IN[0])
paintedmats = IN[1]
elementmats = list()
elementareas = list()
elementvols = list()

for item in items:
	matlist = list()
	arealist = list()
	vollist = list()
	for matid in item.GetMaterialIds(paintedmats):
		matlist.append(doc.GetElement(matid))
		arealist.append(item.GetMaterialArea(matid,paintedmats))
		vollist.append(item.GetMaterialVolume(matid))
	elementmats.append(matlist)
	elementareas.append(arealist)
	elementvols.append(vollist)
OUT = (elementmats,elementareas,elementvols)
# ----------------------------------------
code_block = CodeBlock(seq=python_script) { seq[0]; seq[1]; seq[2]; }
isEmpty = List.IsEmpty()
map = List.Map(code_block.out0, isEmpty)
not_ = Not(map)
filterByBoolMask = List.FilterByBoolMask(code_block.out0, not_)
Materials = Output(filterByBoolMask)
filterByBoolMask_2 = List.FilterByBoolMask(code_block.out1, not_)
fromSquareFeet = DynamoUnits.Area.FromSquareFeet(filterByBoolMask_2)
value = DynamoUnits.SIUnit.Value(fromSquareFeet)
Material_Areas = Output(value)
filterByBoolMask_3 = List.FilterByBoolMask(code_block.out2, not_)
fromCubicFeet = DynamoUnits.Volume.FromCubicFeet(filterByBoolMask_3)
value_2 = DynamoUnits.SIUnit.Value(fromCubicFeet)
Material_Volumes = Output(value_2)
Has_Material = Output(not_)
