# Dynamo custom node Element.Panels.dyf (Dynamo 0.7.5.3566)
# category: Clockwork.Revit.Elements.Element.Query
# Retrieves the panels nested in a curtain wall, curtain system or glazed roof.

Host_Element_s = Input()  # "Host Element(s)"
turn_into_list = Custom[Turn Into List](item=Host_Element_s)  # Turns an element (or a nested list) into a flat list
python_script = Python(IN[0]=turn_into_list)
# ---------- python_script.python (27 lines) ----------
import clr
clr.AddReference('RevitAPI')
from Autodesk.Revit.DB import *

clr.AddReference("RevitNodes")
import Revit
clr.ImportExtensions(Revit.Elements)

clr.AddReference("RevitServices")
import RevitServices
from RevitServices.Persistence import DocumentManager

doc = DocumentManager.Instance.CurrentDBDocument
items = UnwrapElement(IN[0])
elementlist = list()
for item in items:
	try:
		if item.CurtainGrid is None:
			elementlist.append(list())
		else:
			panellist = list()
			for panel in item.CurtainGrid.GetPanelIds():
				panellist.append(doc.GetElement(panel).ToDSType(True))
			elementlist.append(panellist)
	except:
		elementlist.append(list())
OUT = elementlist
# ----------------------------------------
returnListOrSingleValue = Custom[ReturnListOrSingleValue](item_1_unknown=Host_Element_s, item_2_list=python_script)  # If the item in input #1 is not a list, only the first item of the list in input #2 will be returned.
Panels = Output(returnListOrSingleValue)
