# Dynamo custom node Element.ParameterExists.dyf (Dynamo 0.8.2.2166)
# category: Clockwork.Revit.Elements.Element.Query
# Checks if an element contains a parameter of a given name

Element_s = Input()  # "Element(s)"
param = Input()
python_script = Python(IN[0]=Element_s, IN[1]=param)
# ---------- python_script.python (50 lines) ----------
# This node was originally created by Andreas Dieckmann
# and only updated by Konrad K Sobon to work with Revit 2016

# Copyright(c) 2015, Konrad K Sobon
# @arch_laboratory, http://archi-lab.net

import clr
clr.AddReference('RevitAPI')
from Autodesk.Revit.DB import *

import sys
pyt_path = r'C:\Program Files (x86)\IronPython 2.7\Lib'
sys.path.append(pyt_path)

if isinstance(IN[0], list):
	items = []
	for i in IN[0]:
		items.append(UnwrapElement(i))
else:
	items = UnwrapElement(IN[0])
param = IN[1]

try:
	errorReport = None
	if isinstance(items, list):
		elementList = []
		for index, item in enumerate(items):
			params = item.Parameters
			paramNames = [i.Definition.Name for i in params]
			if param in paramNames:
				elementList.append(True)
			else:
				elementList.append(False)
	else:
		params = items.Parameters
		paramNames = [i.Definition.Name for i in params]
		if param in paramNames:
			elementList = True
		else:
			elementList = False
except:
	# if error accurs anywhere in the process catch it
	import traceback
	errorReport = traceback.format_exc()

#Assign your output to the OUT variable
if errorReport == None:
	OUT = elementList
else:
	OUT = errorReport
# ----------------------------------------
bool = Output(python_script)
