# Dynamo custom node Element.ParameterIsReadOnly.dyf (Dynamo 0.7.5.3566)
# category: Clockwork.Revit.Elements.Element.Query
# Checks if a parameter of a given element is read-only

Parameter_s = Input()  # "Parameter(s)"
Element = Input()
turn_into_list = Custom[Turn Into List](item=Parameter_s)  # Turns an element (or a nested list) into a flat list
python_script = Python(IN[0]=Element, IN[1]=turn_into_list)
# ---------- python_script.python (16 lines) ----------
import clr
clr.AddReference('RevitAPI')
from Autodesk.Revit.DB import *

element = UnwrapElement(IN[0])
params = IN[1]
elementlist = list()
for param in params:
	try:
		if element.Parameter[param].IsReadOnly:
			elementlist.append(True)
		else:
			elementlist.append(False)
	except:
		elementlist.append(False)
OUT = elementlist
# ----------------------------------------
returnListOrSingleValue = Custom[ReturnListOrSingleValue](item_1_unknown=Parameter_s, item_2_list=python_script)  # If the item in input #1 is not a list, only the first item of the list in input #2 will be returned.
bool = Output(returnListOrSingleValue)
