# Dynamo custom node Element.PermanentlyIsolateInView.dyf (Dynamo 0.7.5.3566)
# category: Clockwork.Revit.Elements.Element.Actions
# (Permanently) isolates elements in the given view

View = Input()
Element_s = Input()  # "Element(s)"
turn_into_list = Custom[Turn Into List](item=Element_s)  # Turns an element (or a nested list) into a flat list
temporarilyIsolateInView = Custom[View.TemporarilyIsolateElement](View=View, Element_s=turn_into_list)  # "Element.TemporarilyIsolateInView"; (Temporarily) isolates elements in the given view
convertTemporaryHideIsolateToPermanent = Custom[View.ConvertTemporaryHideIsolateToPermanent](View=temporarilyIsolateInView.View)  # Convert all temporary hidden elements or categories to permanently hidden in the given view.
View_2 = Output(convertTemporaryHideIsolateToPermanent)  # "View"
returnListOrSingleValue = Custom[ReturnListOrSingleValue](item_1_unknown=Element_s, item_2_list=temporarilyIsolateInView.Element_s)  # If the item in input #1 is not a list, only the first item of the list in input #2 will be returned.
Element_s_2 = Output(returnListOrSingleValue)  # "Element(s)"
