# Dynamo custom node Element.Phases.dyf (Dynamo 0.7.2.2921)
# category: Clockwork.Revit.Elements.Element.Query
# Gets the created and demolished phases of an element

Element_s = Input()  # "Element(s)"
turn_into_list = Custom[Turn Into List](item=Element_s)  # Turns an element (or a nested list) into a flat list
python_script = Python(IN[0]=turn_into_list)
# ---------- python_script.python (27 lines) ----------
import clr
clr.AddReference('RevitAPI')
from Autodesk.Revit.DB import *

clr.AddReference("RevitServices")
import RevitServices
from RevitServices.Persistence import DocumentManager

doc = DocumentManager.Instance.CurrentDBDocument
items = UnwrapElement(IN[0])
createdlist = list()
demolist = list()

for item in items:
	try:
		if item.CreatedPhaseId.IntegerValue == -1:
			createdlist.append(list())
		else:
			createdlist.append(doc.GetElement(item.CreatedPhaseId))
		if item.DemolishedPhaseId.IntegerValue == -1:
			demolist.append(list())
		else:
			demolist.append(doc.GetElement(item.DemolishedPhaseId))
	except:
		createdlist.append(list())
		demolist.append(list())
OUT = (createdlist,demolist)
# ----------------------------------------
code_block = CodeBlock(seq=python_script) { seq[0]; seq[1]; }
returnListOrSingleValue = Custom[ReturnListOrSingleValue](item_1_unknown=Element_s, item_2_list=code_block.out0)  # If the item in input #1 is not a list, only the first item of the list in input #2 will be returned.
Created = Output(returnListOrSingleValue)
returnListOrSingleValue_2 = Custom[ReturnListOrSingleValue](item_1_unknown=Element_s, item_2_list=code_block.out1)
Demolished = Output(returnListOrSingleValue_2)
