# Dynamo custom node Element.ResetOverridesInView.dyf (Dynamo 0.7.5.3566)
# category: Clockwork.Revit.Elements.Element.Actions
# Resets all overrides for an element in a given view

Element_s = Input()  # "Element(s)"
turn_into_list = Custom[Turn Into List](item=Element_s)  # Turns an element (or a nested list) into a flat list
View = Input()
python_script = Python(IN[0]=turn_into_list, IN[1]=View)
# ---------- python_script.python (25 lines) ----------
import clr
clr.AddReference('RevitAPI')
from Autodesk.Revit.DB import *

clr.AddReference("RevitNodes")
import Revit
clr.ImportExtensions(Revit.Elements)

clr.AddReference("RevitServices")
import RevitServices
from RevitServices.Persistence import DocumentManager
from RevitServices.Transactions import TransactionManager

doc = DocumentManager.Instance.CurrentDBDocument
items = UnwrapElement(IN[0])
view = UnwrapElement(IN[1])
elementlist = list()

override = OverrideGraphicSettings()

TransactionManager.Instance.EnsureInTransaction(doc)
for item in items:
	view.SetElementOverrides(item.Id, override)
TransactionManager.Instance.TransactionTaskDone()
OUT = items
# ----------------------------------------
returnListOrSingleValue = Custom[ReturnListOrSingleValue](item_1_unknown=Element_s, item_2_list=python_script)  # If the item in input #1 is not a list, only the first item of the list in input #2 will be returned.
Element_s_2 = Output(returnListOrSingleValue)  # "Element(s)"
