# Dynamo custom node Element.SetMaterialParameterByCategory.dyf (Dynamo 0.7.5.3566)
# category: Clockwork.Revit.Elements.Element.Actions
# Sets a material parameter of a given element to <By Category>

Elements_s = Input()  # "Elements(s)"
turn_into_list = Custom[Turn Into List](item=Elements_s)  # Turns an element (or a nested list) into a flat list
Material_Parameter_Name = Input()
python_script = Python(IN[0]=turn_into_list, IN[1]=Material_Parameter_Name)
# ---------- python_script.python (25 lines) ----------
import clr
clr.AddReference('RevitAPI')
from Autodesk.Revit.DB import *

clr.AddReference("RevitServices")
import RevitServices
from RevitServices.Persistence import DocumentManager
from RevitServices.Transactions import TransactionManager

doc = DocumentManager.Instance.CurrentDBDocument
elements = UnwrapElement(IN[0])
param = IN[1]
elementlist = list()
failedlist = list()

TransactionManager.Instance.EnsureInTransaction(doc)
for item in elements:
	try:
		item.Parameter[param].Set(ElementId(-1))
		elementlist.append(item)
	except:
		failedlist.append(item)
TransactionManager.Instance.TransactionTaskDone()

OUT = (elementlist,failedlist)
# ----------------------------------------
code_block = CodeBlock(seq=python_script) { seq[0]; seq[1]; }
returnListOrSingleValue = Custom[ReturnListOrSingleValue](item_1_unknown=Elements_s, item_2_list=code_block.out0)  # If the item in input #1 is not a list, only the first item of the list in input #2 will be returned.
Changed_Element_s = Output(returnListOrSingleValue)  # "Changed Element(s)"
Unchanged_Element_s = Output(code_block.out1)  # "Unchanged Element(s)"
