# Dynamo custom node Element.SetName.dyf (Dynamo 0.7.2.3911)
# category: Clockwork.Revit.Elements.Element.Actions
# Gets the name of a given Revit element

element_s = Input()  # "element(s)"
turn_into_list = Custom[Turn Into List](item=element_s)  # Turns an element (or a nested list) into a flat list
name = Input()
turn_into_list_2 = Custom[Turn Into List](item=name)
code_block = CodeBlock(seq1=turn_into_list, seq2=turn_into_list_2)
# ---------- code_block.designscript (4 lines) ----------
num = List.Count(seq1);
cond = List.Count(seq2) < 2 && num > 1;
repseq = List.OfRepeatedItem(seq2[0],num);
cond ? repseq : seq2;
# ----------------------------------------
python_script = Python(IN[0]=turn_into_list, IN[1]=code_block.out3)
# ---------- python_script.python (31 lines) ----------
import clr
clr.AddReference('RevitAPI')
from Autodesk.Revit.DB import *

clr.AddReference("RevitNodes")
import Revit
clr.ImportExtensions(Revit.Elements)

clr.AddReference("RevitServices")
import RevitServices
from RevitServices.Persistence import DocumentManager
from RevitServices.Transactions import TransactionManager

doc = DocumentManager.Instance.CurrentDBDocument
items = UnwrapElement(IN[0])
names = IN[1]
goodlist = list()
badlist = list()
counter = 0

TransactionManager.Instance.EnsureInTransaction(doc)
while counter < len(items):
	try:
		items[counter].Name = names[counter]
		goodlist.append(items[counter].ToDSType(True))
	except:
		badlist.append(items[counter].ToDSType(True))
	counter += 1
TransactionManager.Instance.TransactionTaskDone()

OUT = (goodlist,badlist)
# ----------------------------------------
code_block_2 = CodeBlock(seq=python_script) { seq[0]; seq[1]; }
Success = Output(code_block_2.out0)
Fail = Output(code_block_2.out1)
