# Dynamo custom node Element.Type (LinkedFile).dyf (Dynamo 0.7.5.3566)
# category: Clockwork.Revit.Elements.Element.Query
# Gets the family type of a given element (if applicable) that is located in a linked project file.

Element_s = Input()  # "Element(s)"
turn_into_list = Custom[Turn Into List](item=Element_s)  # Turns an element (or a nested list) into a flat list
Link_Document = Input()
python_script = Python(IN[0]=turn_into_list, IN[1]=Link_Document)
# ---------- python_script.python (13 lines) ----------
import clr
clr.AddReference('RevitAPI')
from Autodesk.Revit.DB import *

items = UnwrapElement(IN[0])
doc = UnwrapElement(IN[1])
typelist = list()
for item in items:
	try: 
		typelist.append(doc.GetElement(item.GetTypeId()))
	except:
		typelist.append(list())
OUT = typelist
# ----------------------------------------
returnListOrSingleValue = Custom[ReturnListOrSingleValue](item_1_unknown=Element_s, item_2_list=python_script)  # If the item in input #1 is not a list, only the first item of the list in input #2 will be returned.
Type_s = Output(returnListOrSingleValue)  # "Type(s)"
