# Dynamo custom node Element.Workset.dyf (Dynamo 0.7.5.3566)
# category: Clockwork.Revit.Elements.Element.Query
# Retrieves the workset of a given element

Element_s = Input()  # "Element(s)"
turn_into_list = Custom[Turn Into List](item=Element_s)  # Turns an element (or a nested list) into a flat list
python_script = Python(IN[0]=turn_into_list)
# ---------- python_script.python (17 lines) ----------
import clr
clr.AddReference('RevitAPI')
from Autodesk.Revit.DB import *

clr.AddReference("RevitServices")
import RevitServices
from RevitServices.Persistence import DocumentManager

doc = DocumentManager.Instance.CurrentDBDocument
faminsts = UnwrapElement(IN[0])
elementlist = list()
for item in faminsts:
	try:
		elementlist.append(doc.GetWorksetTable().GetWorkset(item.WorksetId))
	except:
		elementlist.append(list())
OUT = elementlist
# ----------------------------------------
returnListOrSingleValue = Custom[ReturnListOrSingleValue](item_1_unknown=Element_s, item_2_list=python_script)  # If the item in input #1 is not a list, only the first item of the list in input #2 will be returned.
Workset_s = Output(returnListOrSingleValue)  # "Workset(s)"
