# Dynamo custom node Elements.FilterByName.dyf (Dynamo 0.7.5.3566)
# category: Clockwork.Revit.Selection.Filters
# Retrieves those elements from a collection whose names match the search string

Elements = Input()
turn_into_list = Custom[Turn Into List](item=Elements)  # Turns an element (or a nested list) into a flat list
element_name_universal = Custom[Element.Name (Universal)](Element_s=turn_into_list)  # Gets an element's name (Dynamo's built-in Name nodes don't work for all element types, e.g. worksets...)
Search_string = Input()
Ignore_case = Input()  # "Ignore case ?"
code_block = CodeBlock(str=element_name_universal, search=Search_string, igncase=Ignore_case, list=turn_into_list)
# ---------- code_block.designscript (5 lines) ----------
mask = String.Contains(str,search,igncase);
filter = List.FilterByBoolMask(list,mask);
filter["in"][0];
filter["in"];
filter["out"];
# ----------------------------------------
first = Output(code_block.out2)
in_ = Output(code_block.out3)  # "in"
out = Output(code_block.out4)
