# Dynamo custom node Elements.FilterByParameterValueAndCondition.dyf (Dynamo 0.7.5.3566)
# category: Clockwork.Revit.Selection.Filters

Elements = Input()
parameterName = Input()
parameterExists = Custom[Element.ParameterExists](param=parameterName)  # Checks if an element contains a parameter of a given name
filter = List.Filter(Elements, parameterExists)
code_block = CodeBlock(elem=filter.out0, param=parameterName) { elem.GetParameterValueByName(param); }
f_x = Input()  # "f(x)"
map = List.Map(code_block, f_x)
code_block_2 = CodeBlock(list=filter.out0, mask=map) { filter = List.FilterByBoolMask(list,mask); filter["in"]; filter["out"]; }
in_ = Output(code_block_2.out1)  # "in"
join = List.Join(filter.out1, code_block_2.out2)
out = Output(join)
