# Dynamo custom node Elements.GroupByHost.dyf (Dynamo 0.7.5.3566)
# category: Clockwork.Revit.Elements.Element.Actions
# Groups a list of Revit elements by their respective hosts (if they have any)

Element_s = Input()  # "Element(s)"
turn_into_list = Custom[Turn Into List](item=Element_s)  # Turns an element (or a nested list) into a flat list
host = Custom[Get Host](element_s=Element_s)  # "Element.Host"; Gets an element's host
turn_into_list_2 = Custom[Turn Into List](item=host)
isNull = Object.IsNull()
map = List.Map(turn_into_list_2, isNull)
code_block = CodeBlock(elems=turn_into_list, mask=map, hosts=turn_into_list_2)
# ---------- code_block.designscript (8 lines) ----------
filter1 = List.FilterByBoolMask(elems,mask);
filter1["in"];
filter2 = List.FilterByBoolMask(hosts,mask);
uniqueids = filter2["out"].UniqueId;
{uniqueids,filter1["out"]};
0;
false;
1;
# ----------------------------------------
sortListOfLists = Custom[Sort List Of Lists](List_of_lists=code_block.out4, Sort_index=code_block.out5, Case_insensitive=code_block.out6, Order_Descending=code_block.out6)  # "List.SortListOfLists"; Sorts a list of lists by one of its sublists
groupListOfListsByKey = Custom[Group List of Lists By Key](list=sortListOfLists, key_index=code_block.out5)  # "List.GroupListOfListsByKey"; Groups a list of lists by one of its keys
transpose = List.Transpose()
map_2 = List.Map(groupListOfListsByKey, transpose)
getItemAtIndex = List.GetItemAtIndex(arg1=code_block.out7)
map_3 = List.Map(map_2, getItemAtIndex)
Hosted = Output(map_3)
firstItem = List.FirstItem()
map_4 = List.Map(map_2, firstItem)
firstItem_2 = List.FirstItem()
map_5 = List.Map(map_4, firstItem_2)
byID = Custom[IDs to Elements](ID_s_or_UniqueId_s=map_5)  # "Element.ByID"; Gets the Revit element(s) for a list of IDs (or a single ID)
Host_s = Output(byID.Element_s)  # "Host(s)"
Unhosted = Output(code_block.out1)
