# Dynamo custom node Elements.RemoveDuplicates.dyf (Dynamo 0.7.2.2921)
# category: Clockwork.Revit.Elements.Element.Actions
# Removes all duplicates of Revit elements from a given list.

list = Input()
uniqueId = Element.UniqueId(list)
uniqueItems = List.UniqueItems(uniqueId)
byID = Custom[IDs to Elements](ID_s_or_UniqueId_s=uniqueItems)  # "Element.ByID"; Gets the Revit element(s) for a list of IDs (or a single ID)
elements = Output(byID.Element_s)
