# Dynamo custom node FamilyInstance.ByPointInView.dyf (Dynamo 0.7.5.3566)
# category: Clockwork.Revit.Elements.FamilyInstance.Create
# Places a family instance at a given point in a given view (e.g. a detail component).

Point_s = Input()  # "Point(s)"
turn_into_list = Custom[Turn Into List](item=Point_s)  # Turns an element (or a nested list) into a flat list
Family_Type = Input()
View = Input()
python_script = Python(IN[0]=turn_into_list, IN[1]=Family_Type, IN[2]=View)
# ---------- python_script.python (27 lines) ----------
import clr
clr.AddReference('RevitAPI')
from Autodesk.Revit.DB import *

clr.AddReference("RevitNodes")
import Revit
clr.ImportExtensions(Revit.Elements)
clr.ImportExtensions(Revit.GeometryConversion)

clr.AddReference("RevitServices")
import RevitServices
from RevitServices.Persistence import DocumentManager
from RevitServices.Transactions import TransactionManager

doc = DocumentManager.Instance.CurrentDBDocument
points = UnwrapElement(IN[0])
famtype = UnwrapElement(IN[1])
lvl = UnwrapElement(IN[2])
elementlist = list()
counter = 0

TransactionManager.Instance.EnsureInTransaction(doc)
for point in points:
	newobj = doc.Create.NewFamilyInstance(point.ToXyz(),famtype,lvl)
	elementlist.append(newobj.ToDSType(False))
TransactionManager.Instance.TransactionTaskDone()
OUT = elementlist
# ----------------------------------------
returnListOrSingleValue = Custom[ReturnListOrSingleValue](item_1_unknown=Point_s, item_2_list=python_script)  # If the item in input #1 is not a list, only the first item of the list in input #2 will be returned.
Family_Instance_s = Output(returnListOrSingleValue)  # "Family Instance(s)"
