# Dynamo custom node FamilyInstance.RemoveCoping.dyf (Dynamo 0.7.4.3192)
# category: Clockwork.Revit.Elements.FamilyInstance.Actions
# Removes a coping (cut) from a steel beam

Element_s = Input()  # "Element(s)"
turn_into_list = Custom[Turn Into List](item=Element_s)  # Turns an element (or a nested list) into a flat list
Cutting_element_s_to_be_removed = Input()  # "Cutting element(s) to be removed"
turn_into_list_2 = Custom[Turn Into List](item=Cutting_element_s_to_be_removed)
python_script = Python(IN[0]=turn_into_list, IN[1]=turn_into_list_2)
# ---------- python_script.python (26 lines) ----------
import clr
import System
clr.AddReference('RevitAPI')
from Autodesk.Revit.DB import *

clr.AddReference("RevitServices")
import RevitServices
from RevitServices.Persistence import DocumentManager
from RevitServices.Transactions import TransactionManager

doc = DocumentManager.Instance.CurrentDBDocument
fams = UnwrapElement(IN[0])
cutters = UnwrapElement(IN[1])
booleans = list()
counter = 0

TransactionManager.Instance.EnsureInTransaction(doc)
for fam in fams:
	try:
		fam.RemoveCoping(cutters[counter])
		booleans.append(True)
	except:	booleans.append(False)
	counter += 1
TransactionManager.Instance.TransactionTaskDone()

OUT = booleans
# ----------------------------------------
returnListOrSingleValue = Custom[ReturnListOrSingleValue](item_1_unknown=Element_s, item_2_list=python_script)  # If the item in input #1 is not a list, only the first item of the list in input #2 will be returned.
Success = Output(returnListOrSingleValue)
