# Dynamo custom node FamilyType.SetCompoundLayerMaterial.dyf (Dynamo 0.7.5.3566)
# category: Clockwork.Revit.Elements.FamilyType.Actions
# Sets the material of a specified compound layer of a given family type (only applies to family types that have a compound structure, e.g. walls, floors etc.).

Family_Type = Input()
turn_into_list = Custom[Turn Into List](item=Family_Type)  # Turns an element (or a nested list) into a flat list
Layer_Index = Input()
turn_into_list_2 = Custom[Turn Into List](item=Layer_Index)
Material = Input()
turn_into_list_3 = Custom[Turn Into List](item=Material)
code_block = CodeBlock(famtype=turn_into_list, layerindex=turn_into_list_2, material=turn_into_list_3) { {famtype,layerindex,material}; }
equalSublistLengths = Custom[List.EqualSublistLengths](lists=code_block)  # Trims all given lists to the length of the shortest list
code_block_2 = CodeBlock(seq=equalSublistLengths) { seq[0]; seq[1]; seq[2]; }
python_script = Python(IN[0]=code_block_2.out0, IN[1]=code_block_2.out1, IN[2]=code_block_2.out2)
# ---------- python_script.python (29 lines) ----------
import clr
clr.AddReference('RevitAPI')
from Autodesk.Revit.DB import *

clr.AddReference("RevitServices")
import RevitServices
from RevitServices.Persistence import DocumentManager
from RevitServices.Transactions import TransactionManager

doc = DocumentManager.Instance.CurrentDBDocument
famtypes = UnwrapElement(IN[0])
indices = IN[1]
mats = UnwrapElement(IN[2])
booleans = list()
counter = 0

TransactionManager.Instance.EnsureInTransaction(doc)
for ft in famtypes:
	try:
		cs = ft.GetCompoundStructure()
		cs.SetMaterialId(indices[counter],mats[counter].Id)
		ft.SetCompoundStructure(cs)
		booleans.append(True)
	except:
		booleans.append(False)
	counter += 1	
TransactionManager.Instance.TransactionTaskDone()

OUT = (famtypes,booleans)
# ----------------------------------------
code_block_3 = CodeBlock(seq=python_script) { seq[0]; seq[1]; }
returnListOrSingleValue = Custom[ReturnListOrSingleValue](item_1_unknown=Family_Type, item_2_list=code_block_3.out0)  # If the item in input #1 is not a list, only the first item of the list in input #2 will be returned.
Family_Type_2 = Output(returnListOrSingleValue)  # "Family Type"
returnListOrSingleValue_2 = Custom[ReturnListOrSingleValue](item_1_unknown=Family_Type, item_2_list=code_block_3.out1)
Success = Output(returnListOrSingleValue_2)  # "Success?"
