# Dynamo custom node Feet.ToCentimeters.dyf (Dynamo 0.7.2.3911)
# category: CAAD_RWTH.Units.Length
# Converts feet into centimeters

ft = Input()
code_block = CodeBlock(feet=ft) { feet*0.3048*100; }
cm = Output(code_block)
