# Dynamo custom node Feet.ToMeters.dyf (Dynamo 0.7.5.3566)
# category: Clockwork.Units.Length
# Converts feet into meters

ft = Input()
code_block = CodeBlock(feet=ft) { feet*0.3048; }
m = Output(code_block)
