# Dynamo custom node Feet.ToMillimeters.dyf (Dynamo 0.7.5.3566)
# category: Clockwork.Units.Length
# Converts feet into millimeters

ft = Input()
code_block = CodeBlock(feet=ft) { feet*0.3048*1000; }
mm = Output(code_block)
