# Dynamo custom node Floor.Type.dyf (Dynamo 0.7.2.2921)
# category: Clockwork.Revit.Elements.Floor.Query
# Retrieves the floor type for a given floor instance

Floor_Instance_s = Input()  # "Floor Instance(s)"
turn_into_list = Custom[Turn Into List](item=Floor_Instance_s)  # Turns an element (or a nested list) into a flat list
python_script = Python(IN[0]=turn_into_list)
# ---------- python_script.python (12 lines) ----------
import clr
clr.AddReference('RevitAPI')
from Autodesk.Revit.DB import *

floorinstances = UnwrapElement(IN[0])
elementlist = list()
for item in floorinstances:
	try:
		elementlist.append(item.FloorType)
	except:
		emptylist = list()
OUT = elementlist
# ----------------------------------------
returnListOrSingleValue = Custom[ReturnListOrSingleValue](item_1_unknown=Floor_Instance_s, item_2_list=python_script)  # If the item in input #1 is not a list, only the first item of the list in input #2 will be returned.
Floor_Type_s = Output(returnListOrSingleValue)  # "Floor Type(s)"
