# Dynamo custom node HostedObject.FacingOrientation.dyf (Dynamo 0.7.5.3566)
# category: Clockwork.Revit.Elements.FamilyInstance.Query
# Gets the facing orientation of a hosted object (e.g. a window or a door)

element_s = Input()  # "element(s)"
turn_into_list = Custom[Turn Into List](item=element_s)  # Turns an element (or a nested list) into a flat list
python_script = Python(IN[0]=turn_into_list)
# ---------- python_script.python (17 lines) ----------
import clr
clr.AddReference('RevitAPI')
from Autodesk.Revit.DB import *

clr.AddReference("RevitNodes")
import Revit
clr.ImportExtensions(Revit.Elements)
clr.ImportExtensions(Revit.GeometryConversion)

objinstances = UnwrapElement(IN[0])
vectorlist = list()
for item in objinstances:
	try:
		vectorlist.append(item.FacingOrientation.ToVector())
	except:
		vectorlist.append(list())
OUT = vectorlist
# ----------------------------------------
returnListOrSingleValue = Custom[ReturnListOrSingleValue](item_1_unknown=element_s, item_2_list=python_script)  # If the item in input #1 is not a list, only the first item of the list in input #2 will be returned.
Vector_s = Output(returnListOrSingleValue)  # "Vector(s)"
