# Dynamo custom node Level.Plane.dyf (Dynamo 0.7.5.3566)
# category: Clockwork.Revit.Elements.Level.Query
# Retrieves the plane of a given level

Level_s = Input()  # "Level(s)"
code_block = CodeBlock(l=Level_s) { o = Point.ByCoordinates(0,0,l.Elevation); pl = Plane.ByOriginNormal(o,Vector.ZAxis()); }
Plane_s = Output(code_block.pl)  # "Plane(s)"
