# Dynamo custom node Line.ClosedLoopThroughPoints.dyf (Dynamo 0.7.2.6209)
# category: CAAD_RWTH.Geometry.Line.Create
# Works just like the built-in node Lines Through Points (creates a series of lines through a list of points) - except that it creates a *closed* loop of lines.

list = Input()
code_block = CodeBlock(seq1=list) { seq2 = List.ShiftIndices(seq1,1); Line.ByStartPointEndPoint(seq1,seq2); }
lines = Output(code_block.out1)
