# Dynamo custom node List.AlphabeticalSequence.dyf (Dynamo 0.7.2.3911)
# category: CAAD_RWTH.Core.List.Create.Strings
# Creates a list of the first N letters of the alphabet  (where 1 = A, 2 = B, ... , 27 = AA, 28 = AB etc.).

n = Input()
code_block = CodeBlock(n=n) { 1..n; }
uppercase = Input()  # "uppercase?"
fromNumber = Custom[Number To Character](upper=uppercase)  # "Character.FromNumber"; Converts a number into a character (where 1 = A, 2 = B, ... , 27 = AA, 28 = AB etc.).
map = List.Map(code_block, fromNumber)
letters = Output(map)
