# Dynamo custom node List.BinaryToDecimal.dyf (Dynamo 0.7.5.3566)
# category: Clockwork.Core.List.Actions
# Converts a list of binary (boolean) values into a decimal value

list = Input()
turn_into_list = Custom[Turn Into List](item=list)  # Turns an element (or a nested list) into a flat list
code_block = CodeBlock(binlist=turn_into_list) { n = 0..(List.Count(binlist)-1); x = binlist==true ? 1 : 0; Math.Sum(x*Math.Pow(2,n)); }
decimal = Output(code_block.out2)
