# Dynamo custom node List.ContainsOutOfPlanePoints.dyf "Has Out-Of-Plane XYZs" (Dynamo 0.7.2.3911)
# category: CAAD_RWTH.Geometry.Point.Query
# Checks a list for XYZs that are not located on a given plane

list = Input()
face_plane = Input()  # "face/plane"
xyz_is_out_of_plane = Custom[XYZ Is Out-Of-Plane](Face_Plane=face_plane)  # Checks a list for XYZs that are not located on a given plane
map = List.Map(list, xyz_is_out_of_plane.bool)
true_for_any_boolean = Custom[True For Any (Boolean)](seq=map)  # Returns true if any item in a list of booleans is true.
bool = Output(true_for_any_boolean)
map_2 = List.Map(list, xyz_is_out_of_plane.amount)
maximumItem = List.MaximumItem(map_2)
max = Output(maximumItem)
