# Dynamo custom node List.CountBooleanSequences.dyf (Dynamo 0.7.5.3566)
# category: Clockwork.Core.List.Actions
# Retrieves the lengths of uninterrupted sequences of booleans (true or false) in a given list.

Booleans = Input()
turn_into_list = Custom[Turn Into List](item=Booleans)  # Turns an element (or a nested list) into a flat list
python_script = Python(IN[0]=turn_into_list)
# ---------- python_script.python (20 lines) ----------
import clr

booleans = IN[0]
truelist = list()
truelist.append(0)
truecounter = 0
falselist = list()
falselist.append(0)
falsecounter = 0

for item in booleans:
	if item == True:
		truelist[truecounter] += 1
		falsecounter += 1
		falselist.append(0)
	elif item == False:
		falselist[falsecounter] += 1
		truecounter += 1
		truelist.append(0)
OUT = (truelist,falselist)
# ----------------------------------------
code_block = CodeBlock(seq=python_script) { seq[0]; seq[1]; }
formula = Formula("x=0")
filter = List.Filter(code_block.out0, formula)
true = Output(filter.out1)
filter_2 = List.Filter(code_block.out1, formula)
false = Output(filter_2.out1)
