# Dynamo custom node List.EqualSublistLengths.dyf (Dynamo 0.7.5.3566)
# category: Clockwork.Core.List.Actions
# Trims all given lists to the length of the shortest list

lists = Input()
sublistLengths = Custom[Get Sublist Lengths](list=lists)  # "List.SublistLengths"; Gets the lengths of all sublists in a given list of lists.
code_block = CodeBlock(seq=sublistLengths) { List.MinimumItem(seq); }
takeItems = List.TakeItems(arg1=code_block)
map = List.Map(lists, takeItems)
lists_2 = Output(map)  # "lists"
