# Dynamo custom node List.FalseForAny (Booleans).dyf "False For Any (Booleans)" (Dynamo 0.7.2.6209)
# category: Clockwork.Core.List.Query.Booleans
# Returns true if any item in a list of booleans is false.

seq = Input()
turn_into_list = Custom[Turn Into List](item=seq)  # Turns an element (or a nested list) into a flat list
formula = Formula("x=0")
trueForAny = TrueForAny(turn_into_list, formula)
any = Output(trueForAny)  # "any?"
