# Dynamo custom node List.FibonacciFromList.dyf (Dynamo 0.7.3.3034)
# category: Clockwork.Core.List.Create
# Creates a Fibonacci row from a starting list (last two values) of a given length

initialList = Input()
count = List.Count(initialList)
length = Input()
eq = count == length
count_2 = List.Count(initialList)
code_block = CodeBlock { 2; }
sub = count_2 - code_block
getItemAtIndex = List.GetItemAtIndex(initialList, sub)
lastItem = List.LastItem(initialList)
add = getItemAtIndex + lastItem
addItemToEnd = List.AddItemToEnd(add, initialList)
fibonacci = Custom[Fibonacci](initialList=addItemToEnd, length=length)
scopeIf = ScopedIf(eq, initialList, fibonacci)
Output = Output(scopeIf)  # ""
