# Dynamo custom node List.FibonacciFromValues.dyf (Dynamo 0.7.3.3034)
# category: Clockwork.Core.List.Create
# Creates a Fibonacci row from two starting values of a given length

length = Input()
number = DoubleInput(1)
sub = length - number
lt = sub < number
empty = List.Empty()
a = Input()
create = List.Create(a)
watch = Watch(create)
b = Input()
add = a + b
fibonacci_new = Custom[Fibonacci_new](a=b, b=add, length=sub)
join = List.Join(watch, fibonacci_new)
scopeIf = ScopedIf(lt, empty, join)
var = Output(scopeIf)  # "var[]..[]"
