# Dynamo custom node List.FillSublists.dyf "Fill Sublists" (Dynamo 0.7.2.38829)
# category: CAAD_RWTH.Core.List.Create
# Repeats a list of items into sublists of given lengths

ofRepeatedItem = List.OfRepeatedItem()
list = Input()
lengths = Input()
combine = List.Combine(ofRepeatedItem, list, lengths)
sublists = Output(combine)
