# Dynamo custom node List.FilterBySublistLength.dyf (Dynamo 0.7.5.3566)
# category: Clockwork.Core.List.Actions
# Filters out all sublists that do not have the specified length

list = Input()
count = List.Count()
map = List.Map(list, count)
length = Input()
code_block = CodeBlock(n=map, x=length, seq=list) { mask = n == x; filter = List.FilterByBoolMask(seq,mask); filter["in"]; filter["out"]; }
in_ = Output(code_block.out2)  # "in"
out = Output(code_block.out3)
