# Dynamo custom node List.FindInSublists.dyf (Dynamo 0.7.2.6209)
# category: CAAD_RWTH.Core.List.Query.Sublists
# Looks for an item in each sublist of a given list and returns true/false for each sublist.

list = Input()
item = Input()
containsItem = List.ContainsItem(arg1=item)
map = List.Map(list, containsItem)
booleans = Output(map)
