# Dynamo custom node List.FromCSV.dyf (Dynamo 0.7.5.3566)
# category: Clockwork.Core.List.Create
# Converts the content of a given CSV file to a list

ignore_last_column = Input()
ignore_first_row = Input()
CSV_string = Input()
code_block = CodeBlock(csv=CSV_string)
# ---------- code_block.designscript (5 lines) ----------
// Define separator as line break
sep = "
";
// Make a list of lines
String.Split(csv,sep);
# ----------------------------------------
delimiter = Input()
split = String.Split(arg1=delimiter)
map = List.Map(code_block.out1, split)
ignore_last_row = Input()
code_block_2 = CodeBlock(ifr=ignore_first_row, seq1=map, ilr=ignore_last_row)
# ---------- code_block_2.designscript (6 lines) ----------
// Ignore the first row?
seq2 = ifr ? List.RestOfItems(seq1) : seq1;
// Ignore the last row?
ilr ? List.TakeItems(seq2,(List.Count(seq2)-1)) : seq2;
// Number of columns to keep (if last column should be ignored)
List.Count(List.FirstItem(seq1))-1;
# ----------------------------------------
takeItems = List.TakeItems(arg1=code_block_2.out2)
map_2 = List.Map(code_block_2.out1, takeItems)
code_block_3 = CodeBlock(ilc=ignore_last_column, seq4=map_2, seq3=code_block_2.out1)
# ---------- code_block_3.designscript (3 lines) ----------
// Ignore the last column?
strings = ilc ? seq4 : seq3;
String.TrimWhitespace(strings);
# ----------------------------------------
list = Output(code_block_3.out1)
