# Dynamo custom node List.FromString.dyf (Dynamo 0.7.5.3566)
# category: Clockwork.Core.String.Create
# Chops up a string into a list of characters

str = Input()
length = String.Length(str)
code_block = CodeBlock(n=length) { 0..(n-1); 1; }
substring = String.Substring(str, code_block.out0, code_block.out1)
list = Output(substring)
