# Dynamo custom node List.GroupListOfListsByKey.dyf (Dynamo 0.7.5.3566)
# category: Clockwork.Core.List.Actions
# Groups a list of lists by one of its keys

list = Input()
key_index = Input()
boolean = BoolSelector(false)
sortListOfLists = Custom[List.SortListOfLists](List_of_lists=list, Sort_index=key_index, Case_insensitive=boolean, Order_Descending=boolean)  # Sorts a list of lists by one of its sublists
code_block = CodeBlock(seq=sortListOfLists) { List.Transpose(seq); }
python_script = Python(IN[0]=code_block, IN[1]=key_index)
# ---------- python_script.python (13 lines) ----------
import clr
from itertools import groupby

items = IN[0]
groupindex = int(IN[1])
listlist = list()

for key, group in groupby(items, lambda x: x[groupindex]):
	elementlist = list()
	for thing in group:
		elementlist.append(thing)
	listlist.append(elementlist)
OUT = listlist
# ----------------------------------------
transpose = List.Transpose()
map = List.Map(python_script, transpose)
list_2 = Output(map)  # "list"
