# Dynamo custom node List.IsNotEmpty.dyf (Dynamo 0.7.2.6209)
# category: CAAD_RWTH.Core.List.Query
# Just the inversion of the built-in Is Empty List node.

list = Input()
isEmpty = List.IsEmpty(list)
not_ = Not(isEmpty)
bool = Output(not_)
