# Dynamo custom node List.NormalizedSequence.dyf "Normalized Sequence" (Dynamo 0.7.2.38829)
# category: CAAD_RWTH.Core.List.Create
# Creates a sequence of N values between 0 and 1

N = Input()
code_block = CodeBlock(n=N) { 0..1..#n; }
Sequence = Output(code_block)
