# Dynamo custom node List.NormalizedSequenceByFunction.dyf "Normalized Sequence by Function" (Dynamo 0.7.2.38829)
# category: CAAD_RWTH.Core.List.Create
# Creates a sequence of N values between 0 and 1 driven by a function

N = Input()
code_block = CodeBlock(n=N) { 0..1..#n; }
f_x = Input()  # "f(x)"
map = List.Map(code_block, f_x)
Sequence = Output(map)
