# Dynamo custom node List.RandomElements.dyf (Dynamo 0.7.5.3566)
# category: Clockwork.Core.List.Create
# Creates a list of random elements based on a given list of elements

Base_elements = Input()
turn_into_list = Custom[Turn Into List](item=Base_elements)  # Turns an element (or a nested list) into a flat list
code_block = CodeBlock(seq=turn_into_list) { Count(seq)-1; }
Amount = Input()
randomIntegerList = Custom[Math.RandomIntegerList](Max=code_block, Amount=Amount)  # Creates a list of random integers between 0 and a given maximum value
code_block_2 = CodeBlock(seq=turn_into_list, n=randomIntegerList) { seq[n]; }
list = Output(code_block_2)
