# Dynamo custom node List.RepeatItemsByLengths.dyf (Dynamo 0.7.5.3566)
# category: Clockwork.Core.List.Create
# Repeats a list of items into sublists of given lengths

ofRepeatedItem = List.OfRepeatedItem()
list = Input()
lengths = Input()
combine = List.Combine(ofRepeatedItem, list, lengths)
sublists = Output(combine)
