# Dynamo custom node List.ReplaceItemAtIndex.dyf (Dynamo 0.7.5.3566)
# category: Clockwork.Core.List.Actions
# Replaces the item at a given index (or list of indices) of a list by another item

list = Input()
index_indices = Input()  # "index/indices"
turn_into_list = Custom[Turn Into List](item=index_indices)  # Turns an element (or a nested list) into a flat list
replacement_s = Input()  # "replacement(s)"
turn_into_list_2 = Custom[Turn Into List](item=replacement_s)
code_block = CodeBlock(ind=turn_into_list, rep=turn_into_list_2) { List.Count(ind) > 1 && List.Count(rep) == 1 ? List.OfRepeatedItem(rep[0], List.Count(ind)) : rep; }
python_script = Python(IN[0]=list, IN[1]=code_block, IN[2]=turn_into_list)
# ---------- python_script.python (6 lines) ----------
_list = IN[0]
rValues = IN[1]
iValues = IN[2]
for (index, value) in zip(iValues, rValues):
	_list[index] = value
OUT = _list
# ----------------------------------------
list_2 = Output(python_script)  # "list"
