# Dynamo custom node List.ReplaceNull.dyf (Dynamo 0.7.5.3566)
# category: Clockwork.Core.List.Actions
# Replaces all null values within a given list with a substitute

list = Input()
isNull = Object.IsNull()
map = List.Map(list, isNull)
code_block = CodeBlock(seq=map) { 0..List.Count(seq)-1; }
filterByBoolMask = List.FilterByBoolMask(code_block, map)
replacement = Input()
replaceItemAtIndex = Custom[List.ReplaceItemAtIndex](list=list, index_indices=filterByBoolMask, replacement=replacement)  # Replaces the item at a given index (or list of indices) of a list by another item
list_2 = Output(replaceItemAtIndex)  # "list"
