# Dynamo custom node List.SortListOfLists.dyf (Dynamo 0.7.5.3566)
# category: Clockwork.Core.List.Actions
# Sorts a list of lists by one of its sublists

List_of_lists = Input()
code_block = CodeBlock(seq=List_of_lists) { List.Transpose(seq); }
Sort_index = Input()
Case_insensitive = Input()  # "Case-insensitive?"
Order_Descending = Input()  # "Order Descending?"
python_script = Python(IN[0]=code_block, IN[1]=Sort_index, IN[2]=Case_insensitive, IN[3]=Order_Descending)
# ---------- python_script.python (20 lines) ----------
import clr

lists = IN[0]
sortindex = int(IN[1])
caseinsensitive = IN[2]
sortdescending = IN[3]

# make sure that case-insensitive is turned of if it is not strings we're sorting
if caseinsensitive == True and isinstance(lists[0][sortindex], basestring) == False:
	caseinsensitive = False
if caseinsensitive == True:
	if sortdescending == True:
		OUT = sorted(lists, key=lambda lists:lists[sortindex].lower(), reverse=True)
	else:
		OUT = sorted(lists, key=lambda lists:lists[sortindex].lower())
else:
	if sortdescending == True:
		OUT = sorted(lists, key=lambda lists:lists[sortindex], reverse=True)
	else:
		OUT = sorted(lists, key=lambda lists:lists[sortindex])
# ----------------------------------------
code_block_2 = CodeBlock(seq=python_script) { List.Transpose(seq); }
Sorted = Output(code_block_2)
