# Dynamo custom node List.SublistByLengths.dyf "Build Irregular Sublists" (Dynamo 0.7.2.38829)
# category: CAAD_RWTH.Core.List.Create
# Turns a list into a list of lists with sublists of varying lengths.

list = Input()
lengths = Input()
python_script = Python(IN[0]=list, IN[1]=lengths)
# ---------- python_script.python (15 lines) ----------
import clr

inputlist = IN[0]
listlengths = IN[1]
rowcounter = 0
elementlist = list()
for item in listlengths:
	itemcounter = 0
	itemlist = list()
	while itemcounter < item:
		itemlist.append(inputlist[rowcounter])
		rowcounter += 1
		itemcounter += 1
	elementlist.append(itemlist)
OUT = elementlist
# ----------------------------------------
list_2 = Output(python_script)  # "list"
