# Dynamo custom node List.SublistLengths.dyf "List.GetSublistLengths" (Dynamo 0.7.2.6209)
# category: CAAD_RWTH.Core.List.Query.Sublists
# Gets the lengths of all sublists in a given list of lists.

list = Input()
count = List.Count()
map = List.Map(list, count)
lengths = Output(map)
