# Dynamo custom node List.SublistsContain.dyf (Dynamo 0.7.5.3566)
# category: Clockwork.Core.List.Query.Sublists
# Looks for an item in each sublist of a given list and returns true/false for each sublist.

list = Input()
item = Input()
containsItem = List.ContainsItem(arg1=item)
map = List.Map(list, containsItem)
booleans = Output(map)
