# Dynamo custom node List.TrueForAll (Booleans).dyf "True For All (Booleans)" (Dynamo 0.7.2.6209)
# category: Clockwork.Core.List.Query.Booleans
# Returns true if all items in a list of booleans are true.

seq = Input()
turn_into_list = Custom[Turn Into List](item=seq)  # Turns an element (or a nested list) into a flat list
formula = Formula("x=1")
trueForAll = TrueForAll(turn_into_list, formula)
all = Output(trueForAll)  # "all?"
