# Dynamo custom node List.WithLeadingZeroes.dyf (Dynamo 0.7.2.6209)
# category: CAAD_RWTH.Core.List.Create.Strings
# Adds leading zeros to a sequence of numbers

seq = Input()
turn_into_list = Custom[Turn Into List](item=seq)  # Turns an element (or a nested list) into a flat list
fromObject = String.FromObject()
map = List.Map(turn_into_list, fromObject)
n = Input()
python_script = Python(IN[0]=map, IN[1]=n)
# ---------- python_script.python (8 lines) ----------
import clr

stringlist = IN[0]
stringlength = IN[1]
elementlist = list()
for item in stringlist:
	elementlist.append(item.zfill(stringlength))
OUT = elementlist
# ----------------------------------------
strings = Output(python_script)
