# Dynamo custom node MassFloor.Mass.dyf (Dynamo 0.7.5.3566)
# category: Clockwork.Revit.Elements.MassFloor.Query
# Gets the mass a given mass floor belongs to

Element_s = Input()  # "Element(s)"
turn_into_list = Custom[Turn Into List](item=Element_s)  # Turns an element (or a nested list) into a flat list
python_script = Python(IN[0]=turn_into_list)
# ---------- python_script.python (21 lines) ----------
import clr
clr.AddReference('RevitAPI')
from Autodesk.Revit.DB import *

clr.AddReference("RevitNodes")
import Revit
clr.ImportExtensions(Revit.Elements)

clr.AddReference("RevitServices")
import RevitServices
from RevitServices.Persistence import DocumentManager

doc = DocumentManager.Instance.CurrentDBDocument
massfloors = UnwrapElement(IN[0])
elementlist = list()
for item in massfloors:
	try:
		elementlist.append(doc.GetElement(item.OwningMassId).ToDSType(True))
	except:
		elementlist.append(list())
OUT = elementlist
# ----------------------------------------
returnListOrSingleValue = Custom[ReturnListOrSingleValue](item_1_unknown=Element_s, item_2_list=python_script)  # If the item in input #1 is not a list, only the first item of the list in input #2 will be returned.
Host_s = Output(returnListOrSingleValue)  # "Host(s)"
