# Dynamo custom node Material.Duplicate.dyf (Dynamo 0.7.5.3342)
# category: Clockwork.Revit.Elements.Material.Actions
# Duplicates a material

Material_s = Input()  # "Material(s)"
Name_s = Input()  # "Name(s)"
duplicate = Custom[ElementType.Duplicate](Element_Type_s=Material_s, Name_s=Name_s)  # Duplicates an element type
Duplicate_s = Output(duplicate)  # "Duplicate(s)"
