# Dynamo custom node Material.Properties.dyf (Dynamo 0.7.5.3566)
# category: Clockwork.Revit.Elements.Material.Query
# Retrieves a number of properties froma given material

Material_s = Input()  # "Material(s)"
turn_into_list = Custom[Turn Into List](item=Material_s)  # Turns an element (or a nested list) into a flat list
python_script = Python(IN[0]=turn_into_list)
# ---------- python_script.python (23 lines) ----------
import clr
clr.AddReference('RevitAPI')
from Autodesk.Revit.DB import *

mats = UnwrapElement(IN[0])
colorlist = list()
glowlist = list()
classlist = list()
shinylist = list()
smoothlist = list()
translist = list()

for mat in mats:
	colorlist.append(mat.Color)
	if mat.Glow:
		glowlist.append(True)
	else:
		glowlist.append(False)
	classlist.append(mat.MaterialClass)
	shinylist.append(mat.Shininess)
	smoothlist.append(mat.Smoothness)
	translist.append(mat.Transparency)
OUT = (classlist,colorlist,glowlist,shinylist,smoothlist,translist)
# ----------------------------------------
code_block = CodeBlock(seq=python_script) { seq[0]; seq[1]; seq[2]; seq[3]; seq[4]; seq[5]; }
returnListOrSingleValue = Custom[ReturnListOrSingleValue](item_1_unknown=Material_s, item_2_list=code_block.out0)  # If the item in input #1 is not a list, only the first item of the list in input #2 will be returned.
Class = Output(returnListOrSingleValue)
toDynamoColor = Custom[RevitColor.ToDynamoColor](Color_Revit=code_block.out1)  # Converts Revit colors into Dynamo colors
returnListOrSingleValue_2 = Custom[ReturnListOrSingleValue](item_1_unknown=Material_s, item_2_list=toDynamoColor)
Color = Output(returnListOrSingleValue_2)
returnListOrSingleValue_3 = Custom[ReturnListOrSingleValue](item_1_unknown=Material_s, item_2_list=code_block.out2)
Glow_bool = Output(returnListOrSingleValue_3)  # "Glow (bool)"
returnListOrSingleValue_4 = Custom[ReturnListOrSingleValue](item_1_unknown=Material_s, item_2_list=code_block.out3)
Shininess = Output(returnListOrSingleValue_4)  # "Shininess (%)"
returnListOrSingleValue_5 = Custom[ReturnListOrSingleValue](item_1_unknown=Material_s, item_2_list=code_block.out4)
Smoothness = Output(returnListOrSingleValue_5)  # "Smoothness (%)"
returnListOrSingleValue_6 = Custom[ReturnListOrSingleValue](item_1_unknown=Material_s, item_2_list=code_block.out5)
Transparency = Output(returnListOrSingleValue_6)  # "Transparency (%)"
