# Dynamo custom node Math.DecimalToBinary.dyf (Dynamo 0.7.5.3566)
# category: Clockwork.Core.String.Actions
# Converts a number to a string of its binary value

Decimal = Input()
turn_into_list = Custom[Turn Into List](item=Decimal)  # Turns an element (or a nested list) into a flat list
python_script = Python(IN[0]=turn_into_list)
# ---------- python_script.python (5 lines) ----------
vals = IN[0]
elementlist = []
for val in vals:
	elementlist.append(bin(val))
OUT = elementlist
# ----------------------------------------
returnListOrSingleValue = Custom[ReturnListOrSingleValue](item_1_unknown=Decimal, item_2_list=python_script)  # If the item in input #1 is not a list, only the first item of the list in input #2 will be returned.
Binary = Output(returnListOrSingleValue)
