# Dynamo custom node Math.IsEvenNumber.dyf (Dynamo 0.7.2.6209)
# category: CAAD_RWTH.Core.Math.Query
# Checks if a number is even.

val = Input()
is_odd_number = Custom[Is Odd Number](val=val)  # Checks if a number is odd.
not_ = Not(is_odd_number)
bool = Output(not_)
