# Dynamo custom node Math.IsMultipleOf.dyf (Dynamo 0.7.2.6209)
# category: CAAD_RWTH.Core.Math.Query
# Checks if A is a multiple of B.

A = Input()
B = Input()
code_block = CodeBlock(a=A, b=B) { !(a%b > 0); }
bool = Output(code_block)
