# Dynamo custom node Math.IsOddNumber.dyf (Dynamo 0.7.2.6209)
# category: CAAD_RWTH.Core.Math.Query
# Checks if a number is odd.

val = Input()
code_block = CodeBlock(n=val) { Math.Round(n)/2 != Math.Round(Math.Round(n)/2); }
bool = Output(code_block)
