# Dynamo custom node Math.Normalize.dyf "Normalize Value" (Dynamo 0.7.2.38829)
# category: CAAD_RWTH.Core.Math.Actions.Normalization
# Converts a value into a normalized value according to a value range

val = Input()
Min = Input()
Max = Input()
code_block = CodeBlock(value=val, min=Min, max=Max) { (value-min)/(max-min); }
