# Dynamo custom node Math.RandomIntegerList.dyf (Dynamo 0.7.3.3034)
# category: Clockwork.Core.Math.Create
# Creates a list of random integers between 0 and a given maximum value

Amount = Input()
randomList = Math.RandomList(Amount)
Max = Input()
code_block = CodeBlock(n=Max) { -0.499; n+0.499; }
remapRange = Math.RemapRange(randomList, code_block.out0, code_block.out1)
round = Math.Round(remapRange)
list = Output(round)
