# Dynamo custom node Math.RoundDownToPrecision.dyf "Round Down To Precision" (Dynamo 0.7.2.38829)
# category: CAAD_RWTH.Core.Math.Actions.Rounding
# Rounds a number *down* to a specified precision

Number = Input()
Precision = Input()
code_block = CodeBlock(a=Number, b=Precision) { Math.Floor(a/b)*b; }
Floor = Output(code_block)
