# Dynamo custom node Math.RoundToPrecision.dyf "Round To Precision" (Dynamo 0.7.2.38829)
# category: CAAD_RWTH.Core.Math.Actions.Rounding
# Rounds a number to a specified precision

Number = Input()
Precision = Input()
code_block = CodeBlock(a=Number, b=Precision) { Math.Round(a/b)*b; }
round = Output(code_block)
