# Dynamo custom node Math.RoundUpToPrecision.dyf "Round Up To Precision" (Dynamo 0.7.2.38829)
# category: CAAD_RWTH.Core.Math.Actions.Rounding
# Rounds a number *up* to a specified precision

Number = Input()
Precision = Input()
code_block = CodeBlock(a=Number, b=Precision) { Math.Ceiling(a/b)*b; }
Ceiling = Output(code_block)
