# Dynamo custom node Math.ScaleNormalized.dyf (Dynamo 0.7.4.3180)
# category: Clockwork.Core.Math.Actions.Normalization
# Scales a normalized value according to a given minimum and maximum

Min = Input()
Max = Input()
val = Input()
code_block = CodeBlock(min=Min, max=Max, value=val) { min+(max-min)*value; }
Output = Output(code_block)  # ""
