# Dynamo custom node Math.Similar.dyf (Dynamo 0.7.5.3566)
# category: Clockwork.Core.Math.Actions
# Computes the difference between two values and whether that difference is within a given tolerance factor

A = Input()
B = Input()
Tolerance = Input()
code_block = CodeBlock(a=A, b=B, t=Tolerance) { Math.Abs(a-b); Math.Abs(1-a/b) <= t; }
IsSimilar = Output(code_block.out1)
Difference = Output(code_block.out0)
