# Dynamo custom node Mesh.FaceVertices.dyf (Dynamo 0.7.2.3911)
# category: CAAD_RWTH.Geometry.Mesh.Query
# Gets the vertices of each face of a given mesh

Mesh = Input()
vertexPositions = Mesh.VertexPositions(Mesh)
faceIndices = Mesh.FaceIndices(Mesh)
A = IndexGroup.A(faceIndices)
getItemAtIndex = List.GetItemAtIndex(vertexPositions, A)
B = IndexGroup.B(faceIndices)
getItemAtIndex_2 = List.GetItemAtIndex(vertexPositions, B)
C = IndexGroup.C(faceIndices)
getItemAtIndex_3 = List.GetItemAtIndex(vertexPositions, C)
code_block = CodeBlock(a=getItemAtIndex, b=getItemAtIndex_2, c=getItemAtIndex_3) { List.Transpose({a,b,c}); }
Vertices = Output(code_block)
