# Dynamo custom node Mesh.IntersectionWithPlane.dyf (Dynamo 0.7.3.3034)
# category: Clockwork.Geometry.Mesh.Actions
# Calculates the intersection of a mesh and a plane

code_block = CodeBlock { "X"; "Y"; }
Plane = Input()
# note: Establish sorting direction based on general plane and mesh orientation
normal = Plane.Normal(Plane)
Mesh = Input()
faceVertices = Custom[Mesh.FaceVertices](Mesh=Mesh)  # Gets the vertices of each face of a given mesh
flatten = Flatten(faceVertices)
byBestFitThroughPoints = Plane.ByBestFitThroughPoints(flatten)
normal_2 = Plane.Normal(byBestFitThroughPoints)
byTwoVectors = Custom[ThirdXYZAxis.ByTwoVectors](Axis_1=normal, Axis_2=normal_2)  # Given two main XYZ axes (or vectors pointing more or less in thei general direction), this node will find the third axis.
eq = code_block.out0 == byTwoVectors.string
closedLoopThroughPoints = Custom[Lines Through Points (Closed Loop)]()  # "Line.ClosedLoopThroughPoints"; Works just like the built-in node Lines Through Points (creates a series of lines through a list of points) - except that it creates a *closed* loop of lines.
# note: From Mesh to Curves
map = List.Map(faceVertices, closedLoopThroughPoints)
intersect = Geometry.Intersect(map, Plane, lacing=Longest)
# note: Find intersection points with plane
flatten_2 = Flatten(intersect)
X = Point.X(lacing=Longest)
sortByKey = SortByKey(flatten_2, X)
eq_2 = byTwoVectors.string == code_block.out1
Y = Point.Y(lacing=Longest)
sortByKey_2 = SortByKey(flatten_2, Y)
Z = Point.Z(lacing=Longest)
sortByKey_3 = SortByKey(flatten_2, Z)
# note: Sort points according to computed sorting direction
if_ = If(eq_2, sortByKey_2, sortByKey_3)
if_2 = If(eq, sortByKey, if_)
almostZero = Custom[Math.AlmostZero]()  # Returns a feasable computational tolerance to zero (1.0e-9 or a billionth of 1) for use in calculations. More background info: https://github.com/ikeough/Dynamo/issues/879
pruneDuplicates = Point.PruneDuplicates(if_2, almostZero)
Points = Output(pruneDuplicates)
boolean = BoolSelector(false)
byPoints = PolyCurve.ByPoints(pruneDuplicates, boolean)
PolyCurve = Output(byPoints)
byPoints_2 = NurbsCurve.ByPoints(pruneDuplicates, lacing=Longest)
NurbsCurve_by_points = Output(byPoints_2)  # "NurbsCurve (by points)"
byControlPoints = NurbsCurve.ByControlPoints(pruneDuplicates, lacing=Longest)
NurbsCurve_by_control_points = Output(byControlPoints)  # "NurbsCurve (by control points)"
