# Dynamo custom node Millimeters.ToFeet.dyf (Dynamo 0.7.2.3911)
# category: CAAD_RWTH.Units.Length
# Converts millimeters into feet

mm = Input()
code_block = CodeBlock(mm=mm) { mm/1000/0.3048; }
ft = Output(code_block)
