# Dynamo custom node Normal.CorrectOrientation.dyf (Dynamo 0.7.5.3566)
# category: Clockwork.Geometry.Vector.Actions
# Inverts normal A if its inversion is closer to normal B

a = Input()
b = Input()
code_block = CodeBlock(a=a, b=b)
# ---------- code_block.designscript (5 lines) ----------
VecA=a.Normalized();
cond = VecA.Dot(b.Normalized()) > 0;
// If the dot product of the vectors is greater than 0,
// they are pointing in the same general direction.
cond ? VecA : VecA.Scale(-1);
# ----------------------------------------
normal = Output(code_block.out2)
