# Dynamo custom node Object.MembersByName.dyf (Dynamo 0.7.5.3566)
# category: Clockwork.Revit.Application.Query
# Looks up all the members of a given element based on a given name (or part of a name) of the property or method. Search is case-insensitive.

Element_s = Input()  # "Element(s)"
filterByBoolMask = List.FilterByBoolMask()
turn_into_list = Custom[Turn Into List](item=Element_s)  # Turns an element (or a nested list) into a flat list
members = Custom[Object.Members](element_s=turn_into_list)  # Gets a list of all members (properties and methods) of a selected element
search_term = Input()
code_block = CodeBlock(str=members, search=search_term) { String.Contains(str,search,true); }
combine = List.Combine(filterByBoolMask, members, code_block)
returnListOrSingleValue = Custom[ReturnListOrSingleValue](item_1_unknown=Element_s, item_2_list=combine)  # If the item in input #1 is not a list, only the first item of the list in input #2 will be returned.
results = Output(returnListOrSingleValue)
