# Dynamo custom node OppositeSide.ByLawOfCosines.dyf (Dynamo 0.7.2.6209)
# category: CAAD_RWTH.Core.Math.Formulas.LawOfCosines
# Computes the length of the missing side of a triangle using the law of cosines. Gamma is the angle between sides A and B.

A = Input()
B = Input()
gamma_degr = Input()  # "gamma (degr.)"
code_block = CodeBlock(a=A, b=B, gamma=gamma_degr) { Math.Sqrt(Math.Pow(a,2)+Math.Pow(b,2)-2*a*b*Math.Cos(gamma)); }
C = Output(code_block)
