# Dynamo custom node Paneling.BuildTriangularSublists.dyf (Dynamo 0.7.2.2921)
# category: Clockwork.Paneling.Helpers
# Creates sublists of three items each from a list based on given indices, shift and reverse settings and offset.

list = Input()
index0 = Input()
index1 = Input()
index2 = Input()
code_block = CodeBlock(a=index0, b=index1, c=index2)
# ---------- code_block.designscript (2 lines) ----------
// Create default placement patterns (counter-clockwise)
{a,b,c};
# ----------------------------------------
shift = Input()
reverse = Input()
shiftPlacementAndReverse = Custom[Shift Placement And Reverse](list=code_block, shift=shift, reverse=reverse)  # "Panelling.ShiftPlacementAndReverse"; Shifts (integer) and reverses (bool) a given list
offset = Input()
code_block_2 = CodeBlock(seq=list, pat=shiftPlacementAndReverse, offset=offset)
# ---------- code_block_2.designscript (2 lines) ----------
// Create sublists using placement pattern
List.Sublists(seq,{pat[0],pat[1],pat[2]},offset);
# ----------------------------------------
list_2 = Output(code_block_2)  # "list"
