# Dynamo custom node Paneling.GridFromFace.dyf (Dynamo 0.7.4.3180)
# category: Clockwork.Paneling.DataPreparation
# Returns UV coordinates, XYZ coordinates and normals for a face with UV subdivision

face = Input()
U = Input()
V = Input()
code_block = CodeBlock(u=U, v=V) { uvlist = UV.ByCoordinates((0..1..#u+1)<1>,(0..1..#v+1)<2>); UVs = Flatten(uvlist); UVs.U; UVs.V; }
pointAtParameter = Surface.PointAtParameter(face, code_block.out2, code_block.out3, lacing=Longest)
Points = Output(pointAtParameter)
normalAtParameter = Surface.NormalAtParameter(face, code_block.out2, code_block.out3, lacing=Longest)
Normals = Output(normalAtParameter)
UVs = Output(code_block.UVs)
