# Dynamo custom node Paneling.Hexagonal.dyf (Dynamo 0.7.5.3566)
# category: Clockwork.Paneling.Patterns
# Creates groups of points from a list of UVs or XYZs for the placement of hexagonal panels. The placement pattern can be reversed (boolean) and shifted (integer).

RotateGridBy90Degrees = Input()
V = Input()
list = Input()
code_block = CodeBlock(rotate_grid=RotateGridBy90Degrees, v=V, seq=list)
# ---------- code_block.designscript (14 lines) ----------
// Sublist lengths rows
sublength = rotate_grid ? (v+1)*3 : (v+1)*4;
rotate_grid ? List.Sublists(seq,0..sublength-1,(v+1)*2) : List.Chop(seq,sublength);
// Remove elements for even rows
drop_even = rotate_grid ? (v+1)*1 : (v+1)*2;
rotate_grid ? List.Sublists(List.DropItems(seq,drop_even),0..sublength-1,(v+1)*2) : List.Chop(List.DropItems(seq,drop_even),sublength);
// Default placement pattern (counter-clockwise)
pat_odd = rotate_grid ? {1,2,v+4,2*(v+1)+2,2*(v+1)+1,v+1} : {1,v+3,2*(v+1)+2,3*(v+1)+1,2*(v+1),v+1};
pat_even = pat_odd + (rotate_grid ? 2 : 1);
// Determine panel offset
offset = rotate_grid ? 4 : 2;
// Prepare check for multiples
v+2;
4;
# ----------------------------------------
ShiftPlacementOddRows = Input()
ReverseOddRows = Input()
shiftPlacementAndReverse = Custom[Shift Placement And Reverse](list=code_block.pat_odd, shift=ShiftPlacementOddRows, reverse=ReverseOddRows)  # "Paneling.ShiftPlacementAndReverse"; Shifts (integer) and reverses (bool) a given list
sublists = List.Sublists(arg1=shiftPlacementAndReverse, arg2=code_block.offset)
map = List.Map(code_block.out1, sublists)
code_block_2 = CodeBlock { 1; 6; }
flatten = List.Flatten(map, code_block_2.out0)
filterBySublistLength = Custom[List.FilterBySublistLength](list=flatten, length=code_block_2.out1)  # Filters out all sublists that do not have the specified length
isMultipleOf = Custom[Math.IsMultipleOf](A=code_block.out7, B=code_block.out8)  # Checks if A is a multiple of B.
isEvenNumber = Custom[Math.IsEvenNumber](val=V)  # Checks if a number is even.
ShiftPlacementEvenRows = Input()
ReverseEvenRows = Input()
shiftPlacementAndReverse_2 = Custom[Shift Placement And Reverse](list=code_block.pat_even, shift=ShiftPlacementEvenRows, reverse=ReverseEvenRows)  # "Paneling.ShiftPlacementAndReverse"
sublists_2 = List.Sublists(arg1=shiftPlacementAndReverse_2, arg2=code_block.offset)
map_2 = List.Map(code_block.out3, sublists_2)
flatten_2 = List.Flatten(map_2, code_block_2.out0)
filterBySublistLength_2 = Custom[List.FilterBySublistLength](list=flatten_2, length=code_block_2.out1)
isMultipleOf_2 = Custom[Math.IsMultipleOf](A=V, B=code_block.out8)
code_block_3 = CodeBlock(seq1=filterBySublistLength.in, v=V, ismultipleof4plus2=isMultipleOf, rotate_grid=RotateGridBy90Degrees, iseven=isEvenNumber, seq2=filterBySublistLength_2.in, ismultipleof4=isMultipleOf_2)
# ---------- code_block_3.designscript (9 lines) ----------
// Get rid of excess panel coordinates
// Odd rows
num_rows1 = List.Count(seq1)/(v+2)*4;
seq1a = (ismultipleof4plus2 && rotate_grid == true) ? List.DropEveryNthItem(seq1,List.Count(seq1)/num_rows1) : seq1;
(!iseven && rotate_grid == false) ? List.DropEveryNthItem(seq1a,(v+1)/2) : seq1a;
// Even rows
num_rows2 = List.Count(seq2)/v*4;
seq2a = (ismultipleof4 && rotate_grid == true) ? List.DropEveryNthItem(seq2,List.Count(seq2)/num_rows2) : seq2;
(iseven && rotate_grid == false) ? List.DropEveryNthItem(seq2a,v/2) : seq2a;
# ----------------------------------------
Odd_Rows = Output(code_block_3.out2)
Even_Rows = Output(code_block_3.out5)
