# Dynamo custom node Paneling.InvertAndMirrorNormalizedValues.dyf (Dynamo 0.7.5.3566)
# category: Clockwork.Paneling.DataPreparation
# Inverts and mirrors (horizontally & vertically) a nested list of normalized values.

Mirror_Horizontally = Input()
Invert = Input()
list = Input()
invertNormalized = Custom[Invert Normalized Value]()  # "Math.InvertNormalized"; Inverts a value between 0 and 1 to its opposite (1-x)
map = List.Map(list, invertNormalized)
Mirror_Vertically = Input()
code_block = CodeBlock(inv=Invert, seq1_inv=map, seq1=list, mir_ver=Mirror_Vertically)
# ---------- code_block.designscript (4 lines) ----------
// Invert values (if applicable)
seq2 = inv ? seq1_inv : seq1;
// Mirror values vertically (if applicable)
seq3 = mir_ver ? List.Reverse(seq2) : seq2;
# ----------------------------------------
reverse = List.Reverse()
map_2 = List.Map(code_block.seq3, reverse)
code_block_2 = CodeBlock(mir_hor=Mirror_Horizontally, seq4=map_2, seq3=code_block.seq3)
# ---------- code_block_2.designscript (2 lines) ----------
// Mirror horizontally if applicable
mir_hor ? seq4 : seq3;
# ----------------------------------------
Output = Output(code_block_2)  # ""
