# Dynamo custom node Paneling.Quadrilateral.dyf (Dynamo 0.7.2.2921)
# category: Clockwork.Paneling.Patterns
# Creates groups of points from a list of UVs or XYZs for the placement of quadrilateral panels. The placement pattern can be reversed (boolean) and shifted (integer).

list = Input()
V = Input()
code_block = CodeBlock(v=V)
# ---------- code_block.designscript (2 lines) ----------
// Default placement pattern (counter-clockwise)
pat = {0,v+1,v+2,1};
# ----------------------------------------
shift_placement = Input()
reverse = Input()  # "reverse?"
shiftPlacementAndReverse = Custom[Shift Placement And Reverse](list=code_block, shift=shift_placement, reverse=reverse)  # "Panelling.ShiftPlacementAndReverse"; Shifts (integer) and reverses (bool) a given list
code_block_2 = CodeBlock(seq=list, pat=shiftPlacementAndReverse)
# ---------- code_block_2.designscript (2 lines) ----------
// Create sublists using placement pattern
List.Sublists(seq,{pat[0],pat[1],pat[2],pat[3]},1);
# ----------------------------------------
n1 = Custom[+1](V)  # Increments a value by 1
# note: Unclutter
dropLastRowAndColumn = Custom[Drop Last Row & Column From UV Field](list=code_block_2, V=n1)  # "Panelling.DropLastRowAndColumn"; Drops the last row and column from a UV field
list_2 = Output(dropLastRowAndColumn)  # "list"
