# Dynamo custom node Paneling.Quadrilateral2byX.dyf (Dynamo 0.7.5.3566)
# category: Clockwork.Paneling.Patterns

reversePattern = Input()
rotateGridby90Degrees = Input()
seq = Input()
swap = Custom[UV.Swap](UV_s=seq)  # Swaps U and V coordinates
V = Input()
n1 = Custom[+1](V)  # Increments a value by 1
X = Input()
n1_2 = Custom[-1](X)  # Decrements a value by 1
code_block = CodeBlock(rotategrid=rotateGridby90Degrees, seq_swapped=swap, seq=seq, V=n1, X=n1_2)
# ---------- code_block.designscript (7 lines) ----------
// rotate grid?
seq2 = rotategrid ? seq_swapped : seq;
// create rows
range1 = {0..V*2-1};
List.Sublists(seq2,range1,V);
// range for patterns
range2 = {0..X,V..V+X};
# ----------------------------------------
sublists = List.Sublists(arg1=code_block.range2, arg2=n1_2)
map = List.Map(code_block.out2, sublists)
code_block_2 = CodeBlock(seq=map, X=X)
# ---------- code_block_2.designscript (3 lines) ----------
// prepare panel coordinate sets for filtering
List.Flatten(seq,1);
X*2;
# ----------------------------------------
filterBySublistLength = Custom[List.FilterBySublistLength](list=code_block_2.out0, length=code_block_2.out1)  # Filters out all sublists that do not have the specified length
reverse = List.Reverse()
map_2 = List.Map(filterBySublistLength.in, reverse)
code_block_3 = CodeBlock(reverse=reversePattern, seq=filterBySublistLength.in, seq_reversed=map_2)
# ---------- code_block_3.designscript (2 lines) ----------
// reverse placement point order?
seq2 = reverse ? seq : seq_reversed;
# ----------------------------------------
shiftPattern = Input()
shiftIndices = List.ShiftIndices(arg1=shiftPattern)
map_3 = List.Map(code_block_3, shiftIndices)
seq_2 = Output(map_3)  # "seq"
