# Dynamo custom node Paneling.TriangularFlatMirrored.dyf (Dynamo 0.7.5.3566)
# category: Clockwork.Paneling.Patterns
# Creates groups of points from a list of UVs or XYZs for the placement of triangular (diagrid) panels. The placement pattern can be reversed (boolean) and shifted (integer).

code_block = CodeBlock { {0..n}; }
RotateGridBy90Deg = Input()
seq = Input()
swap = Custom[Swap UV](UV_s=seq)  # "UV.Swap"; Swaps U and V coordinates
V = Input()
ShiftRows = Input()
isEvenNumber = Custom[Is Even Number](val=V)  # "Math.IsEvenNumber"; Checks if a number is even.
isOddNumber = Custom[Is Odd Number](val=V)  # "Math.IsOddNumber"; Checks if a number is odd.
code_block_2 = CodeBlock(rotate=RotateGridBy90Deg, seq1_swapped=swap, seq1=seq, V=V, shiftrows=ShiftRows, is_even=isEvenNumber, is_odd=isOddNumber)
# ---------- code_block_2.designscript (19 lines) ----------
// DATA
// Rotate entire grid by 90°?
seq2 = rotate ? seq1_swapped : seq1;
// Make rows
rows = List.Sublists(seq2,{0..(2*V+1)},V+1);
// Odd rows
odd = List.DropEveryNthItem(rows,2,0);
// Even rows
even = List.TakeEveryNthItem(rows,2,0);
// Left corners, standing & Rows, standing
shiftrows ? even : odd;
// Left corners, lying & Rows, lying
shiftrows ? odd : even;
// Right corners, standing
cond_rcs = (is_even && !(shiftrows)) || (is_odd && shiftrows);
cond_rcs ? odd : even;
// Right corners, lying
cond_rcl = (is_even && shiftrows) || (is_odd && !(shiftrows));
cond_rcl ? odd : even;
# ----------------------------------------
code_block_3 = CodeBlock(V=V)
# ---------- code_block_3.designscript (9 lines) ----------
// INDICES
0;
1;
2;
3;
V+1;
V+2;
V+3;
V+4;
# ----------------------------------------
ShiftPlacementRowsLying = Input()
ReverseRowsLying = Input()
buildTriangularSublists = Custom[Build Triangular Sublists](offset=code_block_3.out2, shift=ShiftPlacementRowsLying, reverse=ReverseRowsLying, index0=code_block_3.out6, index1=code_block_3.out1, index2=code_block_3.out4)  # "Paneling.BuildTriangularSublists"; Creates sublists of three items each from a list based on given indices, shift and reverse settings and offset.
map = List.Map(code_block_2.out4, buildTriangularSublists)
buildTriangularSublists_2 = Custom[Build Triangular Sublists](offset=code_block_3.out2, shift=ShiftPlacementRowsLying, reverse=ReverseRowsLying, index0=code_block_3.out7, index1=code_block_3.out2, index2=code_block_3.out5)  # "Paneling.BuildTriangularSublists"
map_2 = List.Map(code_block_2.out5, buildTriangularSublists_2)
join = List.Join(map, map_2)
code_block_4 = CodeBlock { 1; 3; }
flatten = List.Flatten(join, code_block_4.out0)
filterBySublistLength = Custom[Filter Sublists By Length](list=flatten, length=code_block_4.out1)  # "List.FilterBySublistLength"; Filters out all sublists that do not have the specified length
RowsLying = Output(filterBySublistLength.in)
takeItems = List.TakeItems()
ShiftPlacementRowsStanding = Input()
ReverseRowsStanding = Input()
buildTriangularSublists_3 = Custom[Build Triangular Sublists](offset=code_block_3.out2, shift=ShiftPlacementRowsStanding, reverse=ReverseRowsStanding, index0=code_block_3.out1, index1=code_block_3.out6, index2=code_block_3.out3)  # "Paneling.BuildTriangularSublists"
map_3 = List.Map(code_block_2.out4, buildTriangularSublists_3)
filterBySublistLength_2 = Custom[Filter Sublists By Length](length=code_block_4.out1)  # "List.FilterBySublistLength"
map_4 = List.Map(map_3, filterBySublistLength_2.in)
sublistLengths = Custom[List.SublistLengths](list=map_4)  # Gets the lengths of all sublists in a given list of lists.
code_block_5 = CodeBlock(n=sublistLengths) { n-1; }
combine = List.Combine(takeItems, map_4, code_block_5)
buildTriangularSublists_4 = Custom[Build Triangular Sublists](offset=code_block_3.out2, shift=ShiftPlacementRowsStanding, reverse=ReverseRowsStanding, index0=code_block_3.out0, index1=code_block_3.out5, index2=code_block_3.out2)  # "Paneling.BuildTriangularSublists"
map_5 = List.Map(code_block_2.out5, buildTriangularSublists_4)
filterBySublistLength_3 = Custom[Filter Sublists By Length](length=code_block_4.out1)  # "List.FilterBySublistLength"
# note: Necessary cleanup:
# In some cases there are groups of three points that we don't want...
map_6 = List.Map(map_5, filterBySublistLength_3.in)
join_2 = List.Join(combine, map_6)
takeItems_2 = List.TakeItems()
sublistLengths_2 = Custom[List.SublistLengths](list=map_6)
code_block_6 = CodeBlock(n=sublistLengths_2) { n-1; }
combine_2 = List.Combine(takeItems_2, map_6, code_block_6)
join_3 = List.Join(map_4, combine_2)
if_ = If(isEvenNumber, join_2, join_3)
flatten_2 = List.Flatten(if_, code_block_4.out0)
RowsStanding = Output(flatten_2)
code_block_7 = CodeBlock(V=V)
# ---------- code_block_7.designscript (9 lines) ----------
// PATTERNS
// Left corners, standing
{0,V+1,1};
// Left corners, lying
{V+2,0,V+1};
// Right corners, standing
{V-1,2*V+1,V};
// Right corners, flying
{2*V+1,V,2*V};
# ----------------------------------------
ShiftPlacementLeftCornersLying = Input()
ReverseLeftCornersLying = Input()
shiftPlacementAndReverse = Custom[Shift Placement And Reverse](list=code_block_7.out1, shift=ShiftPlacementLeftCornersLying, reverse=ReverseLeftCornersLying)  # "Paneling.ShiftPlacementAndReverse"; Shifts (integer) and reverses (bool) a given list
makeTriangles = Custom[Paneling.MakeTriangles](seq=code_block_2.out5, pat=shiftPlacementAndReverse)  # Reduces each sublist to a list of three items specified by the indices in the pattern.
filterBySublistLength_4 = Custom[Filter Sublists By Length](list=makeTriangles, length=code_block_4.out1)  # "List.FilterBySublistLength"
LeftCornersLying = Output(filterBySublistLength_4.in)
ShiftPlacementLeftCornersStanding = Input()
ReverseLeftCornersStanding = Input()
shiftPlacementAndReverse_2 = Custom[Shift Placement And Reverse](list=code_block_7.out0, shift=ShiftPlacementLeftCornersStanding, reverse=ReverseLeftCornersStanding)  # "Paneling.ShiftPlacementAndReverse"
makeTriangles_2 = Custom[Paneling.MakeTriangles](seq=code_block_2.out4, pat=shiftPlacementAndReverse_2)
filterBySublistLength_5 = Custom[Filter Sublists By Length](list=makeTriangles_2, length=code_block_4.out1)  # "List.FilterBySublistLength"
LeftCornersStanding = Output(filterBySublistLength_5.in)
ShiftPlacementRightCornersLying = Input()
ReverseRightCornersLying = Input()
shiftPlacementAndReverse_3 = Custom[Shift Placement And Reverse](list=code_block_7.out3, shift=ShiftPlacementRightCornersLying, reverse=ReverseRightCornersLying)  # "Paneling.ShiftPlacementAndReverse"
makeTriangles_3 = Custom[Paneling.MakeTriangles](seq=code_block_2.out9, pat=shiftPlacementAndReverse_3)
filterBySublistLength_6 = Custom[Filter Sublists By Length](list=makeTriangles_3, length=code_block_4.out1)  # "List.FilterBySublistLength"
RightCornersLying = Output(filterBySublistLength_6.in)
ShiftPlacementRightCornersStanding = Input()
ReverseRightCornersStanding = Input()
shiftPlacementAndReverse_4 = Custom[Shift Placement And Reverse](list=code_block_7.out2, shift=ShiftPlacementRightCornersStanding, reverse=ReverseRightCornersStanding)  # "Paneling.ShiftPlacementAndReverse"
makeTriangles_4 = Custom[Paneling.MakeTriangles](seq=code_block_2.out7, pat=shiftPlacementAndReverse_4)
filterBySublistLength_7 = Custom[Filter Sublists By Length](list=makeTriangles_4, length=code_block_4.out1)  # "List.FilterBySublistLength"
RightCornersStanding = Output(filterBySublistLength_7.in)
