# Dynamo custom node Panelling.InvertAndMirrorNormalizedValues.dyf "Invert And Mirror Normalized Values" (Dynamo 0.7.2.26223)
# category: CAAD_RWTH.Paneling.DataPreparation
# Inverts and mirrors (horizontally & vertically) a list of normalized values.

Mirror_Horizontally = Input()
Invert = Input()
list = Input()
invert_normalized_value = Custom[Invert Normalized Value]()  # Inverts a value between 0 and 1 or a boolean to its opposite (1-x)
map = List.Map(list, invert_normalized_value)
Mirror_Vertically = Input()
X = Input()
code_block = CodeBlock(inv=Invert, seq1_inv=map, seq1=list, mir_ver=Mirror_Vertically, n=X)
# ---------- code_block.designscript (6 lines) ----------
// Invert values (if applicable)
seq2 = inv ? seq1_inv : seq1;
// Mirror values vertically (if applicable)
seq3 = mir_ver ? List.Reverse(seq2) : seq2;
// Create nested list of *n* items each
seq3_nested = List.Sublists(seq3,{0..(n-1)},n);
# ----------------------------------------
reverse = List.Reverse()
map_2 = List.Map(code_block.seq3_nested, reverse)
code_block_2 = CodeBlock(mir_hor=Mirror_Horizontally, seq4=map_2, seq3=code_block.seq3)
# ---------- code_block_2.designscript (2 lines) ----------
// Mirror horizontally if applicable
mir_hor ? Flatten(seq4) : seq3;
# ----------------------------------------
Output = Output(code_block_2)  # ""
