# Dynamo custom node Panelling.ShiftPlacementAndReverse.dyf "Shift Placement And Reverse" (Dynamo 0.7.2.3911)
# category: CAAD_RWTH.Paneling.Helpers
# Shifts (integer) and reverses (bool) a given list

reverse = Input()
list = Input()
shift = Input()
code_block = CodeBlock(reverse=reverse, seq1=list, shift=shift) { seq2 = reverse ? List.Reverse(seq1) : seq1; List.ShiftIndices(seq2,Math.Round(shift)); }
list_2 = Output(code_block.out1)  # "list"
