# Dynamo custom node Panelling.TriangularSubpattern.dyf "Triangular Subpattern" (Dynamo 0.7.2.3911)
# category: CAAD_RWTH.Paneling.Helpers
# Subcomponent of the Triangular Pattern From Grid node.

list = Input()
code_block = CodeBlock { 1; }
Shift_Pattern = Input()
Reverse_Pattern = Input()
Point1 = Input()
Point2 = Input()
Point3 = Input()
build_triangular_sublists = Custom[Build Triangular Sublists](list=list, offset=code_block, shift=Shift_Pattern, reverse=Reverse_Pattern, index0=Point1, index1=Point2, index2=Point3)  # Creates sublists of three items each from a list based on given indices, shift and reverse settings and offset.
V = Input()
# note: Unclutter
drop_last_row_and_column_from_uv = Custom[Drop Last Row & Column From UV Field](list=build_triangular_sublists, V=V)  # "Drop Last Row And Column From UV Field"; Drops the last row and column from a UV field
list_2 = Output(drop_last_row_and_column_from_uv)  # "list"
