# Dynamo custom node PerspectiveView.OrientToEyeAndTargetPosition.dyf "PerspectiveView.SetOrientationByEyeAndTargetPosition" (Dynamo 0.7.5.3342)
# category: Clockwork.Revit.Views.PerspectiveView.Actions
# Sets the orientation of a given perspective view based on a given eye and target position

View = Input()
isLocked = Custom[View3D.IsLocked](View_s=View)  # Checks if a given view is locked
code_block = CodeBlock { "The view is locked..."; }
Eye_Position = Input()
Target_Position = Input()
byTwoPoints = Vector.ByTwoPoints(Eye_Position, Target_Position)
normalized = Vector.Normalized(byTwoPoints)
ZAxis = Vector.ZAxis()
add = Point.Add(Target_Position, ZAxis)
byThreePoints = Plane.ByThreePoints(Eye_Position, Target_Position, add)
normal = Plane.Normal(byThreePoints)
code_block_2 = CodeBlock { 90; }
rotate = Vector.Rotate(normalized, normal, code_block_2)
correctOrientation = Custom[Normal.CorrectOrientation](a=rotate, b=ZAxis)  # Inverts normal A if its inversion is closer to normal B
python_script = Python(IN[0]=View, IN[1]=Eye_Position, IN[2]=correctOrientation, IN[3]=normalized)
# ---------- python_script.python (27 lines) ----------
import clr
clr.AddReference('RevitAPI')
from Autodesk.Revit.DB import *

clr.AddReference("RevitNodes")
import Revit
clr.ImportExtensions(Revit.Elements)
clr.ImportExtensions(Revit.GeometryConversion)

clr.AddReference("RevitServices")
import RevitServices
from RevitServices.Persistence import DocumentManager
from RevitServices.Transactions import TransactionManager

doc = DocumentManager.Instance.CurrentDBDocument
view = UnwrapElement(IN[0])
eyeposition = IN[1].ToXyz()
updirection = IN[2].ToXyz()
forwarddirection = IN[3].ToXyz()

TransactionManager.Instance.EnsureInTransaction(doc)
newVO = ViewOrientation3D(eyeposition, updirection, forwarddirection)
view.SetOrientation(newVO)
view.SaveOrientation()
TransactionManager.Instance.TransactionTaskDone()

OUT = view
# ----------------------------------------
if_ = If(isLocked, code_block, python_script)
View_2 = Output(if_)  # "View"
