# Dynamo custom node Phase.ByName.dyf (Dynamo 0.7.2.2921)
# category: Clockwork.Revit.Elements.Phase.Selection
# Returns the phase of a given name (if it exists)

phases = Custom[List Phases]()  # "Document.Phases"; Lists all phases in the active document
name = Element.Name(phases)
turn_into_list = Custom[Turn Into List](item=name)  # Turns an element (or a nested list) into a flat list
str = Input()
eq = _ == str
map = List.Map(turn_into_list, eq)
filterByBoolMask = List.FilterByBoolMask(phases, map)
code_block = CodeBlock(result=filterByBoolMask) { first = List.FirstItem(result); cond = List.IsEmpty(result); cond ? result : first; }
phase = Output(code_block.out2)
