# Dynamo custom node PlaceholderSheet.ByNumberAndName.dyf (Dynamo 0.7.5.3566)
# category: Clockwork.Revit.Views.Sheet.Create
# Creates placeholder sheets

Sheet_Number_s = Input()  # "Sheet Number(s)"
turn_into_list = Custom[Turn Into List](item=Sheet_Number_s)  # Turns an element (or a nested list) into a flat list
Sheet_Name_s = Input()  # "Sheet Name(s)"
turn_into_list_2 = Custom[Turn Into List](item=Sheet_Name_s)
code_block = CodeBlock(nums=turn_into_list, names=turn_into_list_2) { {nums,names}; }
equalSublistLengths = Custom[Equal List Lengths](lists=code_block)  # "List.EqualSublistLengths"; Trims all given lists to the length of the shortest list
code_block_2 = CodeBlock(seq=equalSublistLengths) { seq[0]; seq[1]; }
python_script = Python(IN[0]=code_block_2.out0, IN[1]=code_block_2.out1)
# ---------- python_script.python (28 lines) ----------
import clr
clr.AddReference('RevitAPI')
from Autodesk.Revit.DB import *

clr.AddReference("RevitNodes")
import Revit
clr.ImportExtensions(Revit.Elements)

clr.AddReference("RevitServices")
import RevitServices
from RevitServices.Persistence import DocumentManager
from RevitServices.Transactions import TransactionManager

doc = DocumentManager.Instance.CurrentDBDocument
sheetnums = IN[0]
sheetnames = IN[1]
elementlist = list()
counter = 0

TransactionManager.Instance.EnsureInTransaction(doc)
for num in sheetnums:
	newsheet = ViewSheet.CreatePlaceholder(doc)
	newsheet.SheetNumber = str(num)
	newsheet.Name = sheetnames[counter]
	elementlist.append(newsheet.ToDSType(False))
	counter += 1
TransactionManager.Instance.TransactionTaskDone()
OUT = elementlist
# ----------------------------------------
returnListOrSingleValue = Custom[ReturnListOrSingleValue](item_1_unknown=code_block_2.out0, item_2_list=python_script)  # If the item in input #1 is not a list, only the first item of the list in input #2 will be returned.
Sheet_s = Output(returnListOrSingleValue)  # "Sheet(s)"
