# Dynamo custom node PlanView.Underlay.dyf (Dynamo 0.7.5.3566)
# category: Clockwork.Revit.Views.PlanView.Query
# Returns the view template assigned to a given view (if one is assigned)

Plan_s = Input()  # "Plan(s)"
turn_into_list = Custom[Turn Into List](item=Plan_s)  # Turns an element (or a nested list) into a flat list
python_script = Python(IN[0]=turn_into_list)
# ---------- python_script.python (21 lines) ----------
import clr
clr.AddReference('RevitAPI')
from Autodesk.Revit.DB import *

clr.AddReference("RevitServices")
import RevitServices
from RevitServices.Persistence import DocumentManager

doc = DocumentManager.Instance.CurrentDBDocument
views = UnwrapElement(IN[0])
elementlist = list()

for view in views:
	try:
		if view.get_Parameter(BuiltInParameter.VIEW_UNDERLAY_ID).AsElementId().IntegerValue == -1:
			elementlist.append(list())
		else:
			elementlist.append(doc.GetElement(view.get_Parameter(BuiltInParameter.VIEW_UNDERLAY_ID).AsElementId()))
	except:
		elementlist.append(list())
OUT = elementlist
# ----------------------------------------
returnListOrSingleValue = Custom[ReturnListOrSingleValue](item_1_unknown=Plan_s, item_2_list=python_script)  # If the item in input #1 is not a list, only the first item of the list in input #2 will be returned.
Level_s = Output(returnListOrSingleValue)  # "Level(s)"
