# Dynamo custom node Plane.ByBestFitFromFace.dyf (Dynamo 0.7.5.3566)
# category: Clockwork.Geometry.Plane.Create
# Creates a plane from face

Face_s = Input()  # "Face(s)"
vertices = Custom[Surface.Vertices](Surface_s=Face_s)  # Returns all vertices of a given surface
byBestFitThroughPoints = Plane.ByBestFitThroughPoints(vertices)
Plane_s = Output(byBestFitThroughPoints)  # "Plane(s)"
