# Dynamo custom node Point.Average.dyf (Dynamo 0.7.5.3566)
# category: Clockwork.Geometry.Point.Query
# Determines the average of a list of points

Points = Input()
X = Point.X(Points)
average = Math.Average(X)
Y = Point.Y(Points)
average_2 = Math.Average(Y)
Z = Point.Z(Points)
average_3 = Math.Average(Z)
byCoordinates = Point.ByCoordinates(average, average_2, average_3)
Point = Output(byCoordinates)
