# Dynamo custom node Point.CentralProjectionOnFace.dyf (Dynamo 0.7.3.3034)
# category: Clockwork.Geometry.Point.Actions
# Projects a list of points onto a given face

Face = Input()
Points_to_be_projected = Input()
Central_Projection_Point = Input()
byTwoPoints = Vector.ByTwoPoints(Central_Projection_Point, Points_to_be_projected)
projectInputOnto = Surface.ProjectInputOnto(Face, Points_to_be_projected, byTwoPoints, lacing=Longest)
Projected_points = Output(projectInputOnto)
