# Dynamo custom node Point.CentralProjectionOnPlane.dyf (Dynamo 0.7.3.3034)
# category: Clockwork.Geometry.Point.Actions
# Projects a list of points onto a given plane

Central_projection_point = Input()
Point_s_to_be_projected = Input()  # "Point(s) to be projected"
byTwoPoints = Vector.ByTwoPoints(Central_projection_point, Point_s_to_be_projected)
normalized = Vector.Normalized(byTwoPoints)
Plane = Input()
intersectionWithPlane = Custom[Vector.IntersectionWithPlane](Vector_Basepoint=Central_projection_point, Vector_Normalized=normalized, Plane=Plane)  # Finds the intersection point between a plane and a vector
Projected_point_s = Output(intersectionWithPlane)  # "Projected point(s)"
