# Dynamo custom node Point.GreatestDistanceInSequence.dyf (Dynamo 0.7.3.3034)
# category: Clockwork.Geometry.Point.Query
# Retrieves the furthest point in a sequence of points

Point = Input()
Point_Sequence = Input()
distanceTo = Geometry.DistanceTo(Point, Point_Sequence, lacing=Longest)
flatten = Flatten(distanceTo)
maximumItem = List.MaximumItem(flatten)
distance = Output(maximumItem)
formula = Formula("x=y", maximumItem, flatten, lacing=Longest)
bool = Output(formula)
