# Dynamo custom node Point.IsOutOfPlane.dyf (Dynamo 0.7.5.3566)
# category: Clockwork.Geometry.Point.Query
# Checks a list for XYZs that are not located on a given plane

Face_Plane = Input()  # "Face/Plane"
Point = Input()
code_block = CodeBlock(plane=Face_Plane, point=Point) { closest = plane.ClosestPointTo(point); !(closest.IsAlmostEqualTo(point)); closest.DistanceTo(point); }
bool = Output(code_block.out1)
amount = Output(code_block.out2)
