# Dynamo custom node Point.RoundUpToPrecision.dyf (Dynamo 0.7.5.3566)
# category: Clockwork.Geometry.Point.Actions.Rounding
# Rounds a point coordinate *up* to a specified precision

Point_s = Input()  # "Point(s)"
Precision = Input()
code_block = CodeBlock(po=Point_s, pr=Precision) { a = {po.X,po.Y,po.Z}; ar = Math.Ceiling(a/pr)*pr; Point.ByCoordinates(ar[0],ar[1],ar[2]); }
Point_s_2 = Output(code_block.out2)  # "Point(s)"
