# Dynamo custom node PointSequence.AccumulatedDistance.dyf (Dynamo 0.7.3.3034)
# category: Clockwork.Geometry.Point.Query
# Retrieves the accumulated distances of a sequence of points

Points = Input()
flatten = Flatten(Points)
count = List.Count(flatten)
code_block = CodeBlock(n=count) { n<2; 0; n-1; }
takeItems = List.TakeItems(flatten, code_block.out2)
restOfItems = List.RestOfItems(flatten)
distanceTo = Geometry.DistanceTo(takeItems, restOfItems, lacing=Longest)
sum = Math.Sum(distanceTo)
if_ = If(code_block.out0, code_block.out1, sum)
Distance = Output(if_)
