# Dynamo custom node PointSequence.GreatestDistanceToPoint.dyf (Dynamo 0.7.5.3566)
# category: Clockwork.Geometry.PointSequence.Query
# Retrieves the furthest point in a sequence of points

Point = Input()
Point_Sequence = Input()
code_block = CodeBlock(p=Point, plist=Point_Sequence) { distlist = Flatten(p.DistanceTo(plist)); max = List.MaximumItem(distlist); }
distance = Output(code_block.max)
formula = Formula("x=y", code_block.distlist, code_block.max, lacing=Longest)
bool = Output(formula)
