# Dynamo custom node PointSequences.ShortestPath.dyf (Dynamo 0.7.5.3566)
# category: Clockwork.Geometry.PointSequence.Query
# Retrieves the shortest path from a number of point sequences

seq = Input()
accumulatedDistance = Custom[PointSequence.AccumulatedDistance]()  # Retrieves the accumulated distances of a sequence of points
map = List.Map(seq, accumulatedDistance)
code_block = CodeBlock(seq=map) { List.MinimumItem(seq); }
distance = Output(code_block)
formula = Formula("x=y", code_block, map, lacing=Longest)
bool = Output(formula)
