# Dynamo custom node RevisionCloud.FromNestedListOfElements.dyf (Dynamo 0.7.5.3566)
# category: Clockwork.Revit.Elements.RevisionCloud.Create
# Create a revision cloud for each nested list of Revit elements

Element_s = Input()  # "Element(s)"
View = Input()
byNestedListOfElements = Custom[BoundingBox.ByNestedListOfElements](Element_s=Element_s, View=View)  # Retrieves a bounding box for each sublist of elements
plane = Custom[View.Plane](View_s=View)  # Retrieves the plane of a given view
code_block = CodeBlock(pl=plane) { pl.Normal; }
perimeterCurvesByNormal = Custom[BoundingBox.PerimeterCurvesByNormal](Bounding_Box_es=byNestedListOfElements.Dynamo_Bounding_Box_es, Normal_s=code_block)  # Returns the perimeter curve of a bounding box on a plane determined by a given normal and the centroid of the bounding box
Revision = Input()
fromCurves = Custom[RevisionCloud.FromCurves](Curves=perimeterCurvesByNormal, Revision=Revision, View=View)  # Creates revision clouds from nested lists of geometry curves.
RevisionCloud_s = Output(fromCurves)  # "RevisionCloud(s)"
