# Dynamo custom node RevitFaceReference.FromDynamoSurface.dyf (Dynamo 0.7.5.3566)
# category: Clockwork.Revit.Selection.ByFace
# Returns the underlying Revit face reference of a given surface

Dynamo_surface_s = Input()  # "Dynamo surface(s)"
turn_into_list = Custom[Turn Into List](item=Dynamo_surface_s)  # Turns an element (or a nested list) into a flat list
python_script = Python(IN[0]=turn_into_list)
# ---------- python_script.python (13 lines) ----------
import clr
clr.AddReference('RevitAPI')
from Autodesk.Revit.DB import *

faces = UnwrapElement(IN[0])
elementlist = list()
for face in faces:
	try:
		ref = face.Tags.LookupTag("RevitFaceReference")
		elementlist.append(ref)
	except:
		elementlist.append(list())
OUT = elementlist
# ----------------------------------------
returnListOrSingleValue = Custom[ReturnListOrSingleValue](item_1_unknown=Dynamo_surface_s, item_2_list=python_script)  # If the item in input #1 is not a list, only the first item of the list in input #2 will be returned.
Revit_face_reference_s = Output(returnListOrSingleValue)  # "Revit face reference(s)"
