# Dynamo custom node RevitUV.ToDynamoUV.dyf (Dynamo 0.7.5.3566)
# category: Clockwork.Revit.Elements.UV.Query
# Converts Revit UV coordinates to Dynamo UV coordinates

Revit_UV_s = Input()  # "Revit UV(s)"
turn_into_list = Custom[Turn Into List](item=Revit_UV_s)  # Turns an element (or a nested list) into a flat list
python_script = Python(IN[0]=turn_into_list)
# ---------- python_script.python (11 lines) ----------
import clr
clr.AddReference('RevitAPI')
from Autodesk.Revit.DB import *

UVs = UnwrapElement(IN[0])
ulist = list()
vlist = list()
for uv in UVs:
	ulist.append(uv.U)
	vlist.append(uv.V)
OUT = (ulist,vlist)
# ----------------------------------------
code_block = CodeBlock(seq=python_script) { useq = Math.RemapRange(seq[0],0,1); vseq = Math.RemapRange(seq[1],0,1); uvseq = UV.ByCoordinates(useq,vseq); }
returnListOrSingleValue = Custom[ReturnListOrSingleValue](item_1_unknown=Revit_UV_s, item_2_list=code_block.uvseq)  # If the item in input #1 is not a list, only the first item of the list in input #2 will be returned.
Dynamo_UV_s = Output(returnListOrSingleValue)  # "Dynamo UV(s)"
