# Dynamo custom node Roof.CreationMethodIsByFootprint.dyf (Dynamo 0.7.2.2921)
# category: Clockwork.Revit.Elements.Roof.Query.CreationMethod
# Checks whether the creation method of a given roof is 'By Footprint'

Roof_Instance_s = Input()  # "Roof Instance(s)"
turn_into_list = Custom[Turn Into List](item=Roof_Instance_s)  # Turns an element (or a nested list) into a flat list
python_script = Python(IN[0]=turn_into_list)
# ---------- python_script.python (15 lines) ----------
import clr
clr.AddReference('RevitAPI')
from Autodesk.Revit.DB import *

roofinstances = UnwrapElement(IN[0])
booleans = list()
for item in roofinstances:
	try:
		if item.GetType().Name == 'FootPrintRoof':
			booleans.append(True)
		else:
			booleans.append(False)
	except:
		booleans.append(False)
OUT = booleans
# ----------------------------------------
returnListOrSingleValue = Custom[ReturnListOrSingleValue](item_1_unknown=Roof_Instance_s, item_2_list=python_script)  # If the item in input #1 is not a list, only the first item of the list in input #2 will be returned.
bool = Output(returnListOrSingleValue)
