# Dynamo custom node Roof.Kind.dyf (Dynamo 0.7.5.3566)
# category: Clockwork.Revit.Elements.Roof.Query
# Retrieves the roof kind (Basic, Glazed, Other). PLEASE NOTE: Roofs that were created by face will be identified as 'Other'

Roof_Instance_s = Input()  # "Roof Instance(s)"
turn_into_list = Custom[Turn Into List](item=Roof_Instance_s)  # Turns an element (or a nested list) into a flat list
python_script = Python(IN[0]=turn_into_list)
# ---------- python_script.python (15 lines) ----------
import clr
clr.AddReference('RevitAPI')
from Autodesk.Revit.DB import *

items = UnwrapElement(IN[0])
elementlist = list()
for item in items:
	try:
		if item.CurtainGrids:
			elementlist.append('Glazed')
		else:
			elementlist.append('Basic')
	except:
		elementlist.append('Other / No Roof')
OUT = elementlist
# ----------------------------------------
returnListOrSingleValue = Custom[ReturnListOrSingleValue](item_1_unknown=Roof_Instance_s, item_2_list=python_script)  # If the item in input #1 is not a list, only the first item of the list in input #2 will be returned.
Kind_s = Output(returnListOrSingleValue)  # "Kind(s)"
