# Dynamo custom node RoofOrFloor.CompoundStructureHasVariableLayer.dyf (Dynamo 0.7.2.6209)
# category: CAAD_RWTH.Revit.Elements.Element.Query
# Checks if the compound structure of a given floor or roof instance contains a variable layer.

Element_Type_s = Input()  # "Element Type(s)"
turn_into_list = Custom[Turn Into List](item=Element_Type_s)  # Turns an element (or a nested list) into a flat list
python_script = Python(IN[0]=turn_into_list)
# ---------- python_script.python (15 lines) ----------
import clr
clr.AddReference('RevitAPI')
from Autodesk.Revit.DB import *

elemtypes = UnwrapElement(IN[0])
elementlist = list()
for item in elemtypes:
	try:
		if item.GetCompoundStructure().VariableLayerIndex == -1:
			elementlist.append(False)
		else:
			elementlist.append(True)
	except:
		elementlist.append(False)
OUT = elementlist
# ----------------------------------------
return_list_or_single_value = Custom[Return List Or Single Value](list_1=turn_into_list, list_2=python_script)  # If the list in input #1 only contains one item, only the first item of the list in input #2 will be returned.
bool = Output(return_list_or_single_value)
