# Dynamo custom node RoofOrFloor.SlabShapeByPoints.dyf (Dynamo 0.7.5.3566)
# category: Clockwork.Revit.Elements.RoofOrFloor.Actions
# Transform a slab shape based on a list of XYZs. PLEASE NOTE: Will reset any previous edits on the slab shape.

Point_s = Input()  # "Point(s)"
turn_into_list = Custom[Turn Into List](item=Point_s)  # Turns an element (or a nested list) into a flat list
Floor_Roof = Input()  # "Floor/Roof"
python_script = Python(IN[0]=turn_into_list, IN[1]=Floor_Roof)
# ---------- python_script.python (26 lines) ----------
import clr
clr.AddReference('RevitAPI')
from Autodesk.Revit.DB import *

clr.AddReference("RevitNodes")
import Revit
clr.ImportExtensions(Revit.GeometryConversion)

clr.AddReference("RevitServices")
import RevitServices
from RevitServices.Persistence import DocumentManager
from RevitServices.Transactions import TransactionManager

doc = DocumentManager.Instance.CurrentDBDocument
xyzs = IN[0]
slabshape = UnwrapElement(IN[1])
successlist = list()
faillist = list()

TransactionManager.Instance.EnsureInTransaction(doc)
slabshape.SlabShapeEditor.ResetSlabShape()
for item in xyzs:
	slabshape.SlabShapeEditor.DrawPoint(item.ToXyz())
TransactionManager.Instance.TransactionTaskDone()

OUT = slabshape
# ----------------------------------------
Floor_Roof_2 = Output(python_script)  # "Floor/Roof"
