# Dynamo custom node RoofOrFloorType.CompoundStructureHasVariableLayer.dyf (Dynamo 0.7.5.3437)
# category: Clockwork.Revit.Elements.RoofOrFloorType.Query
# Checks if the compound structure of a given floor or roof instance contains a variable layer.

Element_Type_s = Input()  # "Element Type(s)"
turn_into_list = Custom[Turn Into List](item=Element_Type_s)  # Turns an element (or a nested list) into a flat list
python_script = Python(IN[0]=turn_into_list)
# ---------- python_script.python (15 lines) ----------
import clr
clr.AddReference('RevitAPI')
from Autodesk.Revit.DB import *

elemtypes = UnwrapElement(IN[0])
elementlist = list()
for item in elemtypes:
	try:
		if item.GetCompoundStructure().VariableLayerIndex == -1:
			elementlist.append(False)
		else:
			elementlist.append(True)
	except:
		elementlist.append(False)
OUT = elementlist
# ----------------------------------------
returnListOrSingleValue = Custom[ReturnListOrSingleValue](item_1_unknown=Element_Type_s, item_2_list=python_script)  # If the item in input #1 is not a list, only the first item of the list in input #2 will be returned.
bool = Output(returnListOrSingleValue)
