# Dynamo custom node Room.Boundaries.dyf (Dynamo 0.8.2.2223)
# category: Clockwork.Revit.Elements.Room.Query
# Gets a list of all boundary elements of a given room or area

Room_s = Input()  # "Room(s)"
python_script = Python(IN[0]=Room_s)
# ---------- python_script.python (75 lines) ----------
# Copyright(c) 2015, Andreas Dieckmann
# @a_dieckmann, https://github.com/CAAD-RWTH/ClockworkForDynamo
# Copyright(c) 2015, Konrad K Sobon
# @arch_laboratory, http://archi-lab.net
# This node was originally created by Andreas. Thank you!

import clr
clr.AddReference('RevitAPI')
from Autodesk.Revit.DB import *
import Autodesk

clr.AddReference("RevitNodes")
import Revit
clr.ImportExtensions(Revit.GeometryConversion)

clr.AddReference("RevitServices")
import RevitServices
from RevitServices.Persistence import DocumentManager

doc = DocumentManager.Instance.CurrentDBDocument

import sys
pyt_path = r'C:\Program Files (x86)\IronPython 2.7\Lib'
sys.path.append(pyt_path)

if isinstance(IN[0], list):
	items = []
	for i in IN[0]:
		items.append(UnwrapElement(i))
else:
	items = UnwrapElement(IN[0])

def GetRoomBoundary(doc, item, options):
	eList = []
	cList = []
	try:
		for i in item.GetBoundarySegments(options):
			for j in i:
				eList.append(doc.GetElement(j.ElementId))
				cList.append(j.Curve.ToProtoType())
	except:
		try:
			results = calculator.CalculateSpatialElementGeometry(item)
			for face in results.GetGeometry().Faces:
				for bface in results.GetBoundaryFaceInfo(face):
					eList.append(doc.GetElement(bface.SpatialBoundaryElement.HostElementId))
		except:
			pass
	return [eList, cList]

try:
	errorReport = None
	calculator = SpatialElementGeometryCalculator(doc)
	options = Autodesk.Revit.DB.SpatialElementBoundaryOptions()
	# get boundary location from area computation settings
	boundloc = Autodesk.Revit.DB.AreaVolumeSettings.GetAreaVolumeSettings(doc).GetSpatialElementBoundaryLocation(SpatialElementType.Room)
	options.SpatialElementBoundaryLocation = boundloc
	elementlist, curvelist = [], []
	if isinstance(items, list):
		for item in items:
			elementlist.append(GetRoomBoundary(doc, item, options)[0])
			curvelist.append(GetRoomBoundary(doc, item, options)[1])
	else:
		elementlist = GetRoomBoundary(doc, items, options)[0]
		curvelist = GetRoomBoundary(doc, items, options)[1]
except:
	# if error accurs anywhere in the process catch it
	import traceback
	errorReport = traceback.format_exc()
		
#Assign your output to the OUT variable
if errorReport == None:
	OUT = [elementlist,curvelist]
else:
	OUT = errorReport
# ----------------------------------------
Elements = Output(python_script)
Curves = Output(python_script)
