# Dynamo custom node Room.DoorsOrWindows.dyf (Dynamo 0.7.5.3566)
# category: Clockwork.Revit.Elements.Room.Query
# Retrieves all doors or windows that are associated with a room (hosted in walls and roofs).

Room_s = Input()  # "Room(s)"
join = List.Join()
turn_into_list = Custom[Turn Into List](item=Room_s)  # Turns an element (or a nested list) into a flat list
Doors_Windows_Category = Input()  # "Doors/Windows (Category)"
all_elements_of_category = ElementsOfCategory(Doors_Windows_Category)
code_block = CodeBlock(seq=all_elements_of_category) { Flatten(seq); }
Phase = Input()
fromRoomAndToRoom = Custom[Room.FromDoorOrWindow](Door_s_Window_s=code_block, Phase=Phase)  # "DoorOrWindow.FromRoomAndToRoom"; Gets the rooms that are connected by a given door or a window
isEmpty = List.IsEmpty()
map = List.Map(fromRoomAndToRoom.From_Room_s, isEmpty)
isNull = Object.IsNull(map)
map_2 = List.Map(fromRoomAndToRoom.To_Room_s, isEmpty)
isNull_2 = Object.IsNull(map_2)
code_block_2 = CodeBlock(elems=code_block, mask1=isNull, mask2=isNull_2) { List.FilterByBoolMask(elems,mask1)["in"]; List.FilterByBoolMask(elems,mask2)["in"]; }
fromRoomAndToRoom_2 = Custom[Room.FromDoorOrWindow](Door_s_Window_s=code_block_2.out0, Phase=Phase)  # "DoorOrWindow.FromRoomAndToRoom"
fromRoomAndToRoom_3 = Custom[Room.FromDoorOrWindow](Door_s_Window_s=code_block_2.out1, Phase=Phase)  # "DoorOrWindow.FromRoomAndToRoom"
code_block_3 = CodeBlock(rooms=turn_into_list, elems1=fromRoomAndToRoom_2.From_Room_s, elems2=fromRoomAndToRoom_3.To_Room_s) { uids = ({rooms,elems1,elems2}).UniqueId; uids[0]; uids[1]; uids[2]; }
eq = code_block_3.out1 == code_block_3.out2  # lacing=CrossProduct
eq_2 = code_block_3.out1 == code_block_3.out3  # lacing=CrossProduct
code_block_4 = CodeBlock(rooms=turn_into_list, elems1=code_block_2.out0, mask1=eq, elems2=code_block_2.out1, mask2=eq_2)
# ---------- code_block_4.designscript (5 lines) ----------
numrooms = List.Count(rooms);
rep1 = List.OfRepeatedItem(elems1,numrooms);
List.FilterByBoolMask(rep1,mask1)["in"];
rep2 = List.OfRepeatedItem(elems2,numrooms);
List.FilterByBoolMask(rep2,mask2)["in"];
# ----------------------------------------
combine = List.Combine(join, code_block_4.out2, code_block_4.out4)
returnListOrSingleValue = Custom[ReturnListOrSingleValue](item_1_unknown=Room_s, item_2_list=combine)  # If the item in input #1 is not a list, only the first item of the list in input #2 will be returned.
Doors_Windows = Output(returnListOrSingleValue)  # "Doors/Windows"
