# Dynamo custom node Room.FromDoorOrWindow.dyf (Dynamo 0.7.2.2921)
# category: Clockwork.Revit.Elements.Room.Selection
# Gets the rooms that are connected by a given door or a window

Door_s_Window_s = Input()  # "Door(s) / Window(s)"
turn_into_list = Custom[Turn Into List](item=Door_s_Window_s)  # Turns an element (or a nested list) into a flat list
Phase = Input()
python_script = Python(IN[0]=turn_into_list, IN[1]=Phase)
# ---------- python_script.python (23 lines) ----------
import clr
clr.AddReference('RevitAPI')
from Autodesk.Revit.DB import *

items = UnwrapElement(IN[0])
phase = UnwrapElement(IN[1])
fromlist = list()
tolist = list()

for item in items:
	try:
		if item.FromRoom[phase]:
			fromlist.append(item.FromRoom[phase])
		else:
			fromlist.append(list())
		if item.ToRoom[phase]:
			tolist.append(item.ToRoom[phase])
		else:
			tolist.append(list())
	except:
		fromlist.append(list())
		tolist.append(list())
OUT = (fromlist,tolist)
# ----------------------------------------
code_block = CodeBlock(seq=python_script) { seq[0]; seq[1]; }
From_Room_s = Output(code_block.out0)  # "From Room(s)"
To_Room_s = Output(code_block.out1)  # "To Room(s)"
