# Dynamo custom node Room.InsertsOfBoundaries.dyf (Dynamo 0.7.5.3566)
# category: Clockwork.Revit.Elements.Room.Query
# Retrieves the inserts of the bounding elements of a given room.

Room_s = Input()  # "Room(s)"
boundaries = Custom[Room.Boundaries](Room_s=Room_s)  # Gets a list of all boundary elements of a given room or area
Include_Openings = Input()  # "Include Openings?"
Include_Shadows = Input()  # "Include Shadows?"
Include_Embedded_Walls = Input()  # "Include Embedded Walls?"
Include_Shared_Embedded_Inserts = Input()  # "Include Shared Embedded Inserts?"
inserts = Custom[Element.Inserts](Include_Openings=Include_Openings, Include_Shadows=Include_Shadows, Include_Embedded_Walls=Include_Embedded_Walls, Include_Shared_Embedded_Inserts=Include_Shared_Embedded_Inserts)  # Gets all the objects inserted into a given element.
map = List.Map(boundaries.Elements, inserts)
flatten = Flatten()
map_2 = List.Map(map, flatten)
Insert_s = Output(map_2)  # "Insert(s)"
