# Dynamo custom node Room.InsertsOfBoundariesByCategory.dyf (Dynamo 0.7.3.3034)
# category: Clockwork.Revit.Elements.Room.Query
# Retrieves the inserts of the bounding elements of a given room - filtered by a given category.

filterByBoolMask = List.FilterByBoolMask()
Room_s = Input()  # "Room(s)"
Include_Openings = Input()  # "Include Openings?"
Include_Shadows = Input()  # "Include Shadows?"
Include_Embedded_Walls = Input()  # "Include Embedded Walls?"
Include_Shared_Embedded_Inserts = Input()  # "Include Shared Embedded Inserts?"
insertsOfBoundaries = Custom[Room.InsertsOfBoundaries](Room_s=Room_s, Include_Openings=Include_Openings, Include_Shadows=Include_Shadows, Include_Embedded_Walls=Include_Embedded_Walls, Include_Shared_Embedded_Inserts=Include_Shared_Embedded_Inserts)  # Retrieves the inserts of the bounding elements of a given room.
Category = Input()
isOfCategory = Custom[Element.IsOfCategory](Category=Category)  # Checks whether an element is of a specified category
map = List.Map(insertsOfBoundaries, isOfCategory)
combine = List.Combine(filterByBoolMask, insertsOfBoundaries, map)
Inserts = Output(combine)
