# Dynamo custom node Room.IsPointInside.dyf (Dynamo 0.7.3.3034)
# category: Clockwork.Revit.Elements.Room.Query
# Evaluates if a ponti is located inside a given room.

Room = Input()
turn_into_list = Custom[Turn Into List](item=Room)  # Turns an element (or a nested list) into a flat list
Point_s = Input()  # "Point(s)"
turn_into_list_2 = Custom[Turn Into List](item=Point_s)
python_script = Python(IN[0]=turn_into_list, IN[1]=turn_into_list_2)
# ---------- python_script.python (23 lines) ----------
import clr
clr.AddReference('RevitAPI')
from Autodesk.Revit.DB import *

clr.AddReference("RevitNodes")
import Revit
clr.ImportExtensions(Revit.GeometryConversion)

rooms = UnwrapElement(IN[0])
points = [x.ToXyz() for x in IN[1]]
roomlist = list()
for room in rooms:
	for point in points:
		booleans = list()
		try:
			if room.IsPointInRoom(point):
				booleans.append(True)
			else:
				booleans.append(False)
		except:
			booleans.append(False)
	roomlist.append(booleans)
OUT = roomlist
# ----------------------------------------
returnListOrSingleValue = Custom[ReturnListOrSingleValue](item_1_unknown=Room, item_2_list=python_script)  # If the item in input #1 is not a list, only the first item of the list in input #2 will be returned.
bool = Output(returnListOrSingleValue)
