# Dynamo custom node Room.IsUnbounded.dyf (Dynamo 0.7.3.3034)
# category: Clockwork.Revit.Elements.Room.Query
# Checks whether a room is unbounded.

Room_s = Input()  # "Room(s)"
turn_into_list = Custom[Turn Into List](item=Room_s)  # Turns an element (or a nested list) into a flat list
boundaries = Custom[Room.Boundaries](Room_s=turn_into_list)  # Gets a list of all boundary elements of a given room
isEmpty = List.IsEmpty()
map = List.Map(boundaries.Elements, isEmpty)
returnListOrSingleValue = Custom[ReturnListOrSingleValue](item_1_unknown=Room_s, item_2_list=map)  # If the item in input #1 is not a list, only the first item of the list in input #2 will be returned.
bool = Output(returnListOrSingleValue)
