# Dynamo custom node Room.UnplacedByNameAndNumber.dyf (Dynamo 0.7.5.3566)
# category: Clockwork.Revit.Elements.Room.Create
# Creates an unplaced room

Name_s = Input()  # "Name(s)"
turn_into_list = Custom[Turn Into List](item=Name_s)  # Turns an element (or a nested list) into a flat list
Number_s = Input()  # "Number(s)"
turn_into_list_2 = Custom[Turn Into List](item=Number_s)
code_block = CodeBlock(names=turn_into_list, numbers=turn_into_list_2) { {names,numbers}; }
equalSublistLengths = Custom[List.EqualSublistLengths](lists=code_block)  # Trims all given lists to the length of the shortest list
code_block_2 = CodeBlock(seq=equalSublistLengths) { seq[0]; seq[1]; }
Phase = Input()
python_script = Python(IN[0]=code_block_2.out0, IN[1]=code_block_2.out1, IN[2]=Phase)
# ---------- python_script.python (27 lines) ----------
import clr
clr.AddReference('RevitAPI')
from Autodesk.Revit.DB import *

clr.AddReference("RevitServices")
import RevitServices
from RevitServices.Persistence import DocumentManager
from RevitServices.Transactions import TransactionManager

doc = DocumentManager.Instance.CurrentDBDocument
doccreation = doc.Create
names = IN[0]
numbers = IN[1]
phase = UnwrapElement(IN[2])
counter = 0
elementlist = list()

TransactionManager.Instance.EnsureInTransaction(doc)
for name in names:
	newroom = doccreation.NewRoom(phase)
	newroom.Name = name
	newroom.Number = numbers[counter]
	elementlist.append(newroom)
	counter += 1
TransactionManager.Instance.TransactionTaskDone()

OUT = elementlist
# ----------------------------------------
returnListOrSingleValue = Custom[ReturnListOrSingleValue](item_1_unknown=Name_s, item_2_list=python_script)  # If the item in input #1 is not a list, only the first item of the list in input #2 will be returned.
Room_s = Output(returnListOrSingleValue)  # "Room(s)"
