# Dynamo custom node RoomSeparator.FromCurve.dyf (Dynamo 0.7.2.2921)
# category: Clockwork.Revit.Elements.ModelCurve.Create
# Creates room separation lines from geometry curves. PLEASE NOTE: Might need a transaction node to work.

Curve_s = Input()  # "Curve(s)"
turn_into_list = Custom[Turn Into List](item=Curve_s)  # Turns an element (or a nested list) into a flat list
Sketch_plane = Input()
View = Input()
python_script = Python(IN[0]=turn_into_list, IN[1]=Sketch_plane, IN[2]=View)
# ---------- python_script.python (30 lines) ----------
import clr
clr.AddReference('RevitAPI')
from Autodesk.Revit.DB import *

clr.AddReference("RevitNodes")
import Revit
clr.ImportExtensions(Revit.GeometryConversion)

clr.AddReference("RevitServices")
import RevitServices
from RevitServices.Persistence import DocumentManager
from RevitServices.Transactions import TransactionManager

doc = DocumentManager.Instance.CurrentDBDocument
curves = UnwrapElement(IN[0])
sketchplane = UnwrapElement(IN[1])
view = UnwrapElement(IN[2])

TransactionManager.Instance.EnsureInTransaction(doc)
curvearray = CurveArray()
for curve in curves:
	curvearray.Append(curve.ToRevitType())
doccreation = doc.Create
separatorarray = doccreation.NewRoomBoundaryLines(sketchplane, curvearray, view)
TransactionManager.Instance.TransactionTaskDone()

elementlist = list()
for item in separatorarray:
	elementlist.append(item)
OUT = elementlist
# ----------------------------------------
returnListOrSingleValue = Custom[ReturnListOrSingleValue](item_1_unknown=Curve_s, item_2_list=python_script)  # If the item in input #1 is not a list, only the first item of the list in input #2 will be returned.
Room_Separator_s = Output(returnListOrSingleValue)  # "Room Separator(s)"
