# Dynamo custom node RoomSequence.ToDoorSequence.dyf (Dynamo 0.7.5.3566)
# category: Clockwork.Revit.Elements.Room.Query
# Retrieves a sequence of doors connecting a given sequence of rooms (if possible)

Rooms = Input()
turn_into_list = Custom[Turn Into List](item=Rooms)  # Turns an element (or a nested list) into a flat list
Doors = Input()
turn_into_list_2 = Custom[Turn Into List](item=Doors)
Phase = Input()
fromRoomAndToRoom = Custom[Rooms From Doors And Windows](Door_s_Window_s=turn_into_list_2, Phase=Phase)  # "DoorOrWindow.FromRoomAndToRoom"; Gets the rooms that are connected by a given door or a window
code_block = CodeBlock(a=turn_into_list, b=turn_into_list_2, c=fromRoomAndToRoom.From_Room_s, d=fromRoomAndToRoom.To_Room_s) { ids = ({a,b,c,d}).UniqueId; ids[0]; ids[1]; ids[2]; ids[3]; }
python_script = Python(IN[0]=code_block.out1, IN[1]=code_block.out2, IN[2]=code_block.out3, IN[3]=code_block.out4)
# ---------- python_script.python (17 lines) ----------
import clr

rooms = IN[0]
doors = IN[1]
fromroom = IN[2]
toroom = IN[3]
elementlist = list()

i = 0
while i < (len(rooms)-1):
	j = 0
	while j < len(doors):
		if (rooms[i] == fromroom[j] and rooms[i+1] == toroom[j]) or (rooms[i+1] == fromroom[j] and rooms[i] == toroom[j]):
			elementlist.append(doors[j])
		j += 1
	i += 1
OUT = elementlist
# ----------------------------------------
byID = Custom[Element.ByID](ID_s_or_UniqueId_s=python_script)  # Gets the Revit element(s) for a list of IDs (or a single ID)
Doors_2 = Output(byID.Element_s)  # "Doors"
