# Dynamo custom node SelectionSet.ByElements.dyf (Dynamo 0.7.5.3566)
# category: Clockwork.Revit.Elements.SelectionSet.Create
# Creates a selection set of the given elements. Note that if a selection set of the given name already exists in the model, its contents will be replaced. Also, if the selection set is already applied as a view filter, the view filter will have to be manually updated in the visibility / graphic overrides.

Element_s = Input()  # "Element(s)"
turn_into_list = Custom[Turn Into List](item=Element_s)  # Turns an element (or a nested list) into a flat list
Name = Input()
python_script = Python(IN[0]=turn_into_list, IN[1]=Name)
# ---------- python_script.python (43 lines) ----------
import clr
clr.AddReference('RevitAPI')
from Autodesk.Revit.DB import *
from System.Collections.Generic import *

clr.AddReference("RevitNodes")
import Revit
clr.ImportExtensions(Revit.Elements)

clr.AddReference("RevitServices")
import RevitServices
from RevitServices.Persistence import DocumentManager
from RevitServices.Transactions import TransactionManager

doc = DocumentManager.Instance.CurrentDBDocument
name = IN[1]

# create itemset
items = UnwrapElement(IN[0])
ids = list()
for item in items:
	ids.append(item.Id)
itemset = List[ElementId](ids)

# collect all existing filters from the model 
names = list()
collector = FilteredElementCollector(doc)
filters = collector.OfClass(FilterElement).ToElements();

selset = False
TransactionManager.Instance.EnsureInTransaction(doc)
# if a filter of that name already exists, delete its content
for filter in filters:
	if str(filter.Name) == name:
		filter.Clear()
		selset = filter
# create a new selection set if it doesn't already exist
if selset == False:
	selset = SelectionFilterElement.Create(doc,name)
# add the items to the selection set
selset.AddSet(itemset)
TransactionManager.Instance.TransactionTaskDone()
OUT = selset.ToDSType(False)
# ----------------------------------------
SelectionSet = Output(python_script)
