# Dynamo custom node SelectionSet.Elements.dyf (Dynamo 0.7.5.3566)
# category: Clockwork.Revit.Elements.SelectionSet.Query
# Retrieves all elements stored in a selection set

SelectionSet_s = Input()  # "SelectionSet(s)"
turn_into_list = Custom[Turn Into List](item=SelectionSet_s)  # Turns an element (or a nested list) into a flat list
python_script = Python(IN[0]=turn_into_list)
# ---------- python_script.python (17 lines) ----------
import clr
clr.AddReference('RevitAPI')
from Autodesk.Revit.DB import *

clr.AddReference("RevitServices")
import RevitServices
from RevitServices.Persistence import DocumentManager

doc = DocumentManager.Instance.CurrentDBDocument
items = UnwrapElement(IN[0])
elementlist = list()
for item in items:
	selsetmembers = list()
	for member in item.GetElementIds():
		selsetmembers.append(doc.GetElement(member))
	elementlist.append(selsetmembers)
OUT = elementlist
# ----------------------------------------
returnListOrSingleValue = Custom[ReturnListOrSingleValue](item_1_unknown=SelectionSet_s, item_2_list=python_script)  # If the item in input #1 is not a list, only the first item of the list in input #2 will be returned.
Elements = Output(returnListOrSingleValue)
