# Dynamo custom node Side.ByLawOfSines.dyf (Dynamo 0.7.2.6209)
# category: CAAD_RWTH.Core.Math.Formulas.LawOfSines
# Determines the length of a side based on the law of sines. (Alpha is the angle opposite side A and beta is the angle opposite side B...)

B = Input()
beta_degr = Input()  # "beta (degr.)"
alpha_degr = Input()  # "alpha (degr.)"
code_block = CodeBlock(b=B, beta=beta_degr, alpha=alpha_degr) { b/Math.Sin(beta)*Math.Sin(alpha); }
A = Output(code_block)
