# Dynamo custom node SolarRadiationCSV.Parse.dyf (Dynamo 0.7.2.6209)
# category: CAAD_RWTH.Analyze
# Parses a Vasari solar radiation analysis CSV file and returns lists of absolute and normalized radiation values, their XYZ coordinates and their normals as well as the highest and lowest radiation value and a the total of all radiation samples

path = Input()
string = StringInput(";")
code_block = CodeBlock(path=path, sc=string)
# ---------- code_block.designscript (11 lines) ----------
csv = File.ReadText(path);
// Define separator as line break
sep = "
";
// Split into lines
seq1 = String.Split(csv,sep);
// Try separating by semicolon
items = List.Count(String.Split(List.FirstItem(seq1),sc));
// If successful, use that as a separator, else use a comma
// This is necessary because Vasari will use delimiters according to the locale set on the computer running the solar radiation analysis
items > 1 ? sc : ",";
# ----------------------------------------
boolean = BoolSelector(false)
boolean_2 = BoolSelector(true)
fromCSV = Custom[CSV To List](delimiter=code_block.out4, CSV_string=code_block.csv, ignore_last_column=boolean, ignore_first_row=boolean, ignore_last_row=boolean_2)  # "List.FromCSV"; Converts the content of a given CSV file to a list
code_block_2 = CodeBlock(seq2=fromCSV)
# ---------- code_block_2.designscript (17 lines) ----------
// Disregard the first four lines and transpose the list
data = List.Transpose(List.DropItems(seq2,4));
// Collect samples
samples = String.ToNumber(List.GetItemAtIndex(data,1));
List.MaximumItem(samples);
List.MinimumItem(samples);
Math.Sum(samples);
// Collect points
px = String.ToNumber(List.GetItemAtIndex(data,2));
py = String.ToNumber(List.GetItemAtIndex(data,3));
pz = String.ToNumber(List.GetItemAtIndex(data,4));
Point.ByCoordinates(px,py,pz);
// Collect normals
vx = String.ToNumber(List.GetItemAtIndex(data,5));
vy = String.ToNumber(List.GetItemAtIndex(data,6));
vz = String.ToNumber(List.GetItemAtIndex(data,7));
Vector.ByCoordinates(vx,vy,vz);
# ----------------------------------------
Radiation = Output(code_block_2.samples)
XYZs = Output(code_block_2.out8)
Normals = Output(code_block_2.out12)
normalize_value = Custom[Normalize Value](val=code_block_2.samples, Min=code_block_2.out3, Max=code_block_2.out2)  # Converts a value into a normalized value according to a value range
RadiationNormalized = Output(normalize_value)
RadiationMax = Output(code_block_2.out2)
RadiationMin = Output(code_block_2.out3)
RadiationTotal = Output(code_block_2.out4)
