# Dynamo custom node SquareFeet.ToSquareMeters.dyf (Dynamo 0.7.2.3911)
# category: CAAD_RWTH.Units.Area
# Converts square feet into square meters

sq_ft = Input()
code_block = CodeBlock(sqft=sq_ft) { sqft*0.09290304; }
m2 = Output(code_block)
