# Dynamo custom node String.AlphanumericToMorse.dyf (Dynamo 0.7.5.3566)
# category: Clockwork.Core.String.Actions
# Converts an alphanumeric string to Morse code

code_block = CodeBlock { " "; "   "; }
str = Input()
code_block_2 = CodeBlock { " "; }
split = String.Split(str, code_block_2)
length = String.Length(split)
toUpper = String.ToUpper(str)
fromString = Custom[List.FromString](str=toUpper)  # Chops up a string into a list of characters
code_block_3 = CodeBlock()
# ---------- code_block_3.designscript (3 lines) ----------
alphastring = "A*B*C*D*E*F*G*H*I*J*K*L*M*N*O*P*Q*R*S*T*U*V*W*X*Y*Z*0*1*2*3*4*5*6*7*8*9";
alphanumeric = String.Split(alphastring,"*");
morse = {".-","-...","-.-.","-..",".","..-.","--.","....","..",".---","-.-",".-..","--","-.","---",".--.","--.-",".-.","...","-","..-","...-",".--","-..-","-.--","--..","-----",".----","..---","...--","....-",".....","-....","--...","---..","----."};
# ----------------------------------------
matchWithKeyValues = Custom[List.MatchWithKeyValues](list=fromString, keys=code_block_3.alphanumeric, values=code_block_3.morse)  # Matches a list with a given set of keys and returns the values corresponding to the keys
flatten = Flatten(matchWithKeyValues)
chopByLengths = Custom[List.ChopByLengths](lengths=length, list=flatten)  # Turns a list into a list of lists with sublists of varying lengths.
join = String.Join(code_block.out0, chopByLengths)
firstItem = List.FirstItem(join)
join_2 = String.Join(code_block.out1, firstItem)
firstItem_2 = List.FirstItem(join_2)
str_2 = Output(firstItem_2)  # "str"
