# Dynamo custom node String.MorseToAlphanumeric.dyf (Dynamo 0.7.5.3566)
# category: Clockwork.Core.String.Actions
# Converts a string in Morse code to alphanumeric

code_block = CodeBlock { ""; " "; }
str = Input()
code_block_2 = CodeBlock(inputstring=str)
# ---------- code_block_2.designscript (5 lines) ----------
words = String.Split(inputstring,"   ");
chars = String.Split(words," ");
alphastring = "A*B*C*D*E*F*G*H*I*J*K*L*M*N*O*P*Q*R*S*T*U*V*W*X*Y*Z*0*1*2*3*4*5*6*7*8*9";
alphanumeric = String.Split(alphastring,"*");
morse = {".-","-...","-.-.","-..",".","..-.","--.","....","..",".---","-.-",".-..","--","-.","---",".--.","--.-",".-.","...","-","..-","...-",".--","-..-","-.--","--..","-----",".----","..---","...--","....-",".....","-....","--...","---..","----."};
# ----------------------------------------
sublistLengths = Custom[List.SublistLengths](list=code_block_2.chars)  # Gets the lengths of all sublists in a given list of lists.
matchWithKeyValues = Custom[List.MatchWithKeyValues](list=code_block_2.chars, keys=code_block_2.morse, values=code_block_2.alphanumeric)  # Matches a list with a given set of keys and returns the values corresponding to the keys
chopByLengths = Custom[List.ChopByLengths](lengths=sublistLengths, list=matchWithKeyValues)  # Turns a list into a list of lists with sublists of varying lengths.
join = String.Join(code_block.out0, chopByLengths)
firstItem = List.FirstItem(join)
join_2 = String.Join(code_block.out1, firstItem)
firstItem_2 = List.FirstItem(join_2)
str_2 = Output(firstItem_2)  # "str"
