# Dynamo custom node String.ReplaceRegularExpression.dyf (Dynamo 0.7.5.3566)
# category: Clockwork.Core.String.Actions
# Replaces all occurences of a regular expression within a given string (or list of strings) with another string. The syntax for regular expressions is explained at
# http://ironpython-test.readthedocs.org/en/latest/howto/regex.html

string_s = Input()  # "string(s)"
regex = Input()
turn_into_list = Custom[Turn Into List](item=string_s)  # Turns an element (or a nested list) into a flat list
replacement = Input()
python_script = Python(IN[0]=regex, IN[1]=turn_into_list, IN[2]=replacement)
# ---------- python_script.python (14 lines) ----------
import clr
import re

regexstring = IN[0]
regexlist = IN[1]
replacement = IN[2]
elementlist = list()
thisexp = re.compile(regexstring)
for item in regexlist:
	try:
		elementlist.append(thisexp.sub(replacement,item))
	except:
		elementlist.append(list())
OUT = elementlist
# ----------------------------------------
returnListOrSingleValue = Custom[ReturnListOrSingleValue](item_1_unknown=string_s, item_2_list=python_script)  # If the item in input #1 is not a list, only the first item of the list in input #2 will be returned.
bool = Output(returnListOrSingleValue)
