# Dynamo custom node StructuralFoundation.FootingType.dyf (Dynamo 0.7.2.2921)
# category: Clockwork.Revit.Elements.StructuralFoundation.Query
# Retrieves the footing type for a given wall footing instance

Footing_Instance_s = Input()  # "Footing Instance(s)"
turn_into_list = Custom[Turn Into List](item=Footing_Instance_s)  # Turns an element (or a nested list) into a flat list
python_script = Python(IN[0]=turn_into_list)
# ---------- python_script.python (16 lines) ----------
import clr
clr.AddReference('RevitAPI')
from Autodesk.Revit.DB import *

clr.AddReference("RevitNodes")
import Revit
clr.ImportExtensions(Revit.Elements)

footinginstances = UnwrapElement(IN[0])
elementlist = list()
for item in footinginstances:
	try:
		elementlist.append(item.FootingType.ToDSType(True))
	except:
		emptylist = list()
OUT = elementlist
# ----------------------------------------
returnListOrSingleValue = Custom[ReturnListOrSingleValue](item_1_unknown=Footing_Instance_s, item_2_list=python_script)  # If the item in input #1 is not a list, only the first item of the list in input #2 will be returned.
Footing_Type_s = Output(returnListOrSingleValue)  # "Footing Type(s)"
