# Dynamo custom node StructuralFoundation.Kind.dyf (Dynamo 0.7.2.3911)
# category: CAAD_RWTH.Revit.Elements.StructuralFoundation.Query.Kind
# Retrievs the kind of a given structural foundation (isolated, wall, slab).

Struct_Found_Instance_s = Input()  # "Struct. Found. Instance(s)"
turn_into_list = Custom[Turn Into List](item=Struct_Found_Instance_s)  # Turns an element (or a nested list) into a flat list
python_script = Python(IN[0]=turn_into_list)
# ---------- python_script.python (17 lines) ----------
import clr
clr.AddReference('RevitAPI')
from Autodesk.Revit.DB import *

foundinstances = UnwrapElement(IN[0])
kindlist = list()
for item in foundinstances:
	try:
		if item.GetType().Name == 'FamilyInstance':
			kindlist.append('Isolated')
		elif item.GetType().Name == 'ContFooting':
			kindlist.append('Wall Footing')
		elif item.GetType().Name == 'Floor':
			kindlist.append('Slab')
	except:
		kindlist.append('No Foundation')
OUT = kindlist
# ----------------------------------------
return_list_or_single_value = Custom[Return List Or Single Value](list_1=turn_into_list, list_2=python_script)  # If the list in input #1 only contains one item, only the first item of the list in input #2 will be returned.
Kind_s = Output(return_list_or_single_value)  # "Kind(s)"
