# Dynamo custom node Subcategory.ByName.dyf (Dynamo 0.7.3.3034)
# category: Clockwork.Revit.Elements.Subcategory.Create
# Creates a new subcategory for a given element category (unless a subcategory of that name already exists - in that case it returns the existing subcategory)

Category = Input()
Name = Input()
python_script = Python(IN[0]=Category, IN[1]=Name)
# ---------- python_script.python (19 lines) ----------
import clr
clr.AddReference('RevitAPI')
from Autodesk.Revit.DB import *

clr.AddReference("RevitServices")
import RevitServices
from RevitServices.Persistence import DocumentManager
from RevitServices.Transactions import TransactionManager

doc = DocumentManager.Instance.CurrentDBDocument
cat = UnwrapElement(IN[0])
subcatname = IN[1]

try:
	OUT = cat.SubCategories.get_Item(subcatname)
except:
	TransactionManager.Instance.EnsureInTransaction(doc)
	OUT = doc.Settings.Categories.NewSubcategory(cat, subcatname)
	TransactionManager.Instance.TransactionTaskDone()
# ----------------------------------------
Subcategory = Output(python_script)
