# Dynamo custom node Surface.FilterByOrientation.dyf (Dynamo 0.7.5.3566)
# category: Clockwork.Geometry.Surface.Actions
# Sorts surfaces in three lists based on their orientation (vertical, horizontal up & horizontal down) and also returns three corresponding lists of booleans.

Face_s = Input()  # "Face(s)"
turn_into_list = Custom[Turn Into List](item=Face_s)  # Turns an element (or a nested list) into a flat list
code_block = CodeBlock { 0.5; }
normalAtParameter = Surface.NormalAtParameter(turn_into_list, code_block, code_block)
Z = Vector.Z(normalAtParameter)
almostZero = Custom[Math.AlmostZero]()  # Returns a feasable computational tolerance to zero (1.0e-9 or a billionth of 1) for use in calculations. More background info: https://github.com/ikeough/Dynamo/issues/879
formula = Formula("z > (0-almostzero) && z < (0+almostzero)", z=Z, almostzero=almostZero)
filterByBoolMask = List.FilterByBoolMask(turn_into_list, formula)
returnListOrSingleValue = Custom[ReturnListOrSingleValue](item_1_unknown=Face_s, item_2_list=filterByBoolMask)  # If the item in input #1 is not a list, only the first item of the list in input #2 will be returned.
Vertical = Output(returnListOrSingleValue)
ZAxis = Vector.ZAxis()
isAlmostEqualTo = Vector.IsAlmostEqualTo(normalAtParameter, ZAxis)
filterByBoolMask_2 = List.FilterByBoolMask(turn_into_list, isAlmostEqualTo)
returnListOrSingleValue_2 = Custom[ReturnListOrSingleValue](item_1_unknown=Face_s, item_2_list=filterByBoolMask_2)
Horizontal_Up = Output(returnListOrSingleValue_2)
ZAxisNegative = Custom[Vector.ZAxisNegative]()  # Returns an XYZ of 0,0,-1
isAlmostEqualTo_2 = Vector.IsAlmostEqualTo(normalAtParameter, ZAxisNegative)
filterByBoolMask_3 = List.FilterByBoolMask(turn_into_list, isAlmostEqualTo_2)
returnListOrSingleValue_3 = Custom[ReturnListOrSingleValue](item_1_unknown=Face_s, item_2_list=filterByBoolMask_3)
Horizontal_Down = Output(returnListOrSingleValue_3)
returnListOrSingleValue_4 = Custom[ReturnListOrSingleValue](item_1_unknown=Face_s, item_2_list=formula)
IsVertical = Output(returnListOrSingleValue_4)
returnListOrSingleValue_5 = Custom[ReturnListOrSingleValue](item_1_unknown=Face_s, item_2_list=isAlmostEqualTo)
IsHorizontalUp = Output(returnListOrSingleValue_5)
returnListOrSingleValue_6 = Custom[ReturnListOrSingleValue](item_1_unknown=Face_s, item_2_list=isAlmostEqualTo_2)
IsHorizontalDown = Output(returnListOrSingleValue_6)
