# Dynamo custom node Surface.IsPlanar.dyf (Dynamo 0.7.4.3180)
# category: Clockwork.Geometry.Surface.Query
# Checks whether a face is planar

Surface = Input()
intersect = Geometry.Intersect()
turn_into_list = Custom[Turn Into List](item=Surface)  # Turns an element (or a nested list) into a flat list
code_block = CodeBlock { 2; }
gridFromFace = Custom[Paneling.GridFromFace](U=code_block, V=code_block)  # Returns UV coordinates, XYZ coordinates and normals for a face with UV subdivision
map = List.Map(turn_into_list, gridFromFace.Points)
byBestFitThroughPoints = Plane.ByBestFitThroughPoints()
map_2 = List.Map(map, byBestFitThroughPoints)
combine = List.Combine(intersect, map_2, map)
isEmpty = List.IsEmpty()
map_3 = List.Map(arg1=isEmpty)
map_4 = List.Map(combine, map_3)
false_for_all_booleans = Custom[False For All (Booleans)]()  # Returns true if all items in a list of booleans are false.
map_5 = List.Map(map_4, false_for_all_booleans)
returnListOrSingleValue = Custom[ReturnListOrSingleValue](item_1_unknown=Surface, item_2_list=map_5)  # If the item in input #1 is not a list, only the first item of the list in input #2 will be returned.
bool = Output(returnListOrSingleValue)
