# Dynamo custom node Surface.SortByOrientation(normalZ).dyf (Dynamo 0.7.5.3566)
# category: Clockwork.Geometry.Surface.Actions
# Sorts (Sur)Faces in three lists each containing the (Sur)Faces with normals pointing up (z=1), down (z=-1) or horizontal (z=0).

Face = Input()  # "Face[]"
normalAtParameter = Surface.NormalAtParameter(Face)
Z = Vector.Z(normalAtParameter)
code_block = CodeBlock { 1; }
python_script = Python(IN[0]=Z, IN[1]=code_block)
# ---------- python_script.python (15 lines) ----------
import clr
clr.AddReference('ProtoGeometry')
from Autodesk.DesignScript.Geometry import *
#The inputs to this node will be stored as a list in the IN variable.
list = IN[0]
key = IN[1]

bools = []
#Assign your output to the OUT variable
for item in list:
	if item == key:
		bools += [True]
	else:
		bools += [False]
OUT = bools
# ----------------------------------------
filterByBoolMask = List.FilterByBoolMask(Face, python_script)
normalAtParameter_2 = Surface.NormalAtParameter(filterByBoolMask.out1)
Z_2 = Vector.Z(normalAtParameter_2)
code_block_2 = CodeBlock { -1; }
python_script_2 = Python(IN[0]=Z_2, IN[1]=code_block_2)  # same code as python_script
filterByBoolMask_2 = List.FilterByBoolMask(Face, python_script_2)
vertical = Output(filterByBoolMask_2.out1)
horizontalUp = Output(filterByBoolMask.out0)
horizontalDown = Output(filterByBoolMask_2.out0)
