# Dynamo custom node Switch.dyf (Dynamo 0.7.5.3566)
# category: Clockwork.Core.Logic.Conditional.Actions
# Emulates the Switch/Case statement that is  available in multiple programming languages.

cases = Input()
check = Input()
turn_into_list = Custom[Turn Into List](item=check)  # Turns an element (or a nested list) into a flat list
values = Input()
matchWithKeyValues = Custom[Match List With Key Values](list=turn_into_list, keys=cases, values=values)  # "List.MatchWithKeyValues"; Matches a list with a given set of keys and returns the values corresponding to the keys
default = Input()
code_block = CodeBlock(cases=cases, check=check, matchedvals=matchWithKeyValues, default=default) { cond = List.ContainsItem(cases,check); cond ? List.FirstItem(matchedvals) : default; }
result = Output(code_block.out1)
