# Dynamo custom node TextElement.Text.dyf (Dynamo 0.7.5.3566)
# category: Clockwork.Revit.Elements.TextElement.Query
# Gets the text stored in a text element (i.e. text node or model text)

Element_s = Input()  # "Element(s)"
turn_into_list = Custom[Turn Into List](item=Element_s)  # Turns an element (or a nested list) into a flat list
python_script = Python(IN[0]=turn_into_list)
# ---------- python_script.python (12 lines) ----------
import clr
clr.AddReference('RevitAPI')
from Autodesk.Revit.DB import *

textnotes = UnwrapElement(IN[0])
elementlist = list()
for item in textnotes:
	try:
		elementlist.append(item.Text)
	except:
		elementlist.append(list())
OUT = elementlist
# ----------------------------------------
returnListOrSingleValue = Custom[ReturnListOrSingleValue](item_1_unknown=Element_s, item_2_list=python_script)  # If the item in input #1 is not a list, only the first item of the list in input #2 will be returned.
Text_s = Output(returnListOrSingleValue)  # "Text(s)"
