# Dynamo custom node TextNote.ByStringAndPosition.dyf (Dynamo 0.7.5.3566)
# category: Clockwork.Revit.Elements.TextNote.Create
# Creates a text note at a given location

Point_s = Input()  # "Point(s)"
View = Input()
turn_into_list = Custom[Turn Into List](item=Point_s)  # Turns an element (or a nested list) into a flat list
BaseVector_s = Input()  # "BaseVector(s)"
turn_into_list_2 = Custom[Turn Into List](item=BaseVector_s)
UpVector_s = Input()  # "UpVector(s)"
turn_into_list_3 = Custom[Turn Into List](item=UpVector_s)
String_s = Input()  # "String(s)"
turn_into_list_4 = Custom[Turn Into List](item=String_s)
code_block = CodeBlock(points=turn_into_list, basevecs=turn_into_list_2, upvecs=turn_into_list_3, strings=turn_into_list_4) { {points,basevecs,upvecs,strings}; }
equalSublistLengths = Custom[List.EqualSublistLengths](lists=code_block)  # Trims all given lists to the length of the shortest list
code_block_2 = CodeBlock(seq=equalSublistLengths) { seq[0]; seq[1]; seq[2]; seq[3]; }
python_script = Python(IN[0]=View, IN[1]=code_block_2.out0, IN[2]=code_block_2.out1, IN[3]=code_block_2.out2, IN[4]=code_block_2.out3)
# ---------- python_script.python (32 lines) ----------
import clr
clr.AddReference('RevitAPI')
from Autodesk.Revit.DB import *

clr.AddReference("RevitNodes")
import Revit
clr.ImportExtensions(Revit.GeometryConversion)

clr.AddReference("RevitServices")
import RevitServices
from RevitServices.Persistence import DocumentManager
from RevitServices.Transactions import TransactionManager

doc = DocumentManager.Instance.CurrentDBDocument
view = UnwrapElement(IN[0])
xyzlist = [x.ToXyz() for x in IN[1]]
basevecs = [x.ToXyz() for x in IN[2]]
upvecs = [x.ToXyz() for x in IN[3]]
text = IN[4]
doccreation = doc.Create
counter = 0
textalign = TextAlignFlags.TEF_ALIGN_LEFT
elementlist = list()

TransactionManager.Instance.EnsureInTransaction(doc)
for xyz in xyzlist:
	newtextnote = doccreation.NewTextNote(view,xyz,basevecs[counter],upvecs[counter],0,textalign,text[counter])
	elementlist.append(newtextnote)
	counter += 1
TransactionManager.Instance.TransactionTaskDone()

OUT = elementlist
# ----------------------------------------
returnListOrSingleValue = Custom[ReturnListOrSingleValue](item_1_unknown=Point_s, item_2_list=python_script)  # If the item in input #1 is not a list, only the first item of the list in input #2 will be returned.
Text_Note_s = Output(returnListOrSingleValue)  # "Text Note(s)"
