# Dynamo custom node Time.EvaluateLapTimes.dyf (Dynamo 0.7.5.3566)
# category: Clockwork.Core.Time.Query
# Evaluates a list of lap times and returns the overall time

Lap_times = Input()
code_block = CodeBlock(seq=Lap_times) { seq2 = List.TakeItems(seq,List.Count(seq)-1); seq3 = List.RestOfItems(seq)-seq2; Math.Sum(seq3); }
Net_lap_times = Output(code_block.seq3)
Overall_time = Output(code_block.out2)
