# Dynamo custom node Time.LapTime.dyf (Dynamo 0.7.5.3566)
# category: Clockwork.Core.Time.Query
# Records a timestamp and adds it to a given list of lap times. Also passes through an arbitrary variable for integration into a graph.

Lap_times = Input()
Passthrough = Input()
python_script = Python(IN[0]=Lap_times, IN[1]=Passthrough)
# ---------- python_script.python (8 lines) ----------
import time

times = IN[0]
passthrough = IN[1]

times.append(time.time())

OUT = (times,passthrough)
# ----------------------------------------
code_block = CodeBlock(seq=python_script) { seq[0]; seq[1]; }
Lap_times_2 = Output(code_block.out0)  # "Lap times"
Passthrough_2 = Output(code_block.out1)  # "Passthrough"
