# Dynamo custom node Triangle.SolveByPoints.dyf "Solve Triangle By XYZs" (Dynamo 0.7.2.26223)
# category: CAAD_RWTH.Core.Math.Actions
# Solves a triangle based on the XYZ coordinates of its vertices.

XYZ_B = Input()  # "XYZ (B)"
XYZ_C = Input()  # "XYZ (C)"
# note: TODO:
# - Circumcenter (center and radius)
# - Orthocenter
XYZ_A = Input()  # "XYZ (A)"
code_block = CodeBlock(pb=XYZ_B, pc=XYZ_C, pa=XYZ_A)
# ---------- code_block.designscript (8 lines) ----------
// Side lengths
a = pb.DistanceTo(pc);
b = pa.DistanceTo(pc);
c = pa.DistanceTo(pb);
// Plane, normal & origin
p = Plane.ByBestFitThroughPoints({pa,pb,pc});
p.Normal;
p.Origin;
# ----------------------------------------
a = Output(code_block.a)
b = Output(code_block.b)
c = Output(code_block.c)
byLawOfCosines = Custom[Angle By Law Of Cosines](A=code_block.a, B=code_block.b, C=code_block.c)  # Computes an angle of a triangle using the law of cosines. A is the opposite side of the triangle while B and C are the sides forming the angle.
alpha = Output(byLawOfCosines)
byLawOfCosines_2 = Custom[Angle By Law Of Cosines](A=code_block.b, B=code_block.c, C=code_block.a)
beta = Output(byLawOfCosines_2)
byLawOfCosines_3 = Custom[Angle By Law Of Cosines](A=code_block.c, B=code_block.a, C=code_block.b)
gamma = Output(byLawOfCosines_3)
code_block_2 = CodeBlock(b=code_block.b, gamma=byLawOfCosines_3, c=code_block.c, alpha=byLawOfCosines, a=code_block.a, beta=byLawOfCosines_2)
# ---------- code_block_2.designscript (8 lines) ----------
// Heights
b*Math.Sin(gamma);
c*Math.Sin(alpha);
Hc = a*Math.Sin(beta);
// Area
tri_area = c*Hc/2;
// Incircle radius
2*tri_area/(a+b+c);
# ----------------------------------------
Ha = Output(code_block_2.out0)
Hb = Output(code_block_2.out1)
Hc = Output(code_block_2.Hc)
Area = Output(code_block_2.tri_area)
Plane = Output(code_block.p)
Normal = Output(code_block.out4)
Origin_Centroid = Output(code_block.out5)  # "Origin/Centroid"
byPoints = Custom[AngleBisector.ByPoints](Point_A=XYZ_A, Point_B=XYZ_B, Point_C=XYZ_C)  # Retrieves the vector of an angle bisector at point B based on three points (A, B, C) that define the angle.
byPoints_2 = Custom[AngleBisector.ByPoints](Point_A=XYZ_B, Point_B=XYZ_C, Point_C=XYZ_A)
intersectionWithVector = Custom[Vector-Vector Intersection](Basepoint_1=XYZ_B, Vector_1=byPoints, Basepoint_2=XYZ_C, Vector_2=byPoints_2)  # "Vector.IntersectionWithVector"; Determines if two vectors intersect and returns the closest points of intersection on both vectors.
Incircle_center = Output(intersectionWithVector.Average_XYZ)
Incircle_radius = Output(code_block_2.out4)
