# Dynamo custom node UV.Average.dyf (Dynamo 0.7.4.3245)
# category: Clockwork.Geometry.UV.Query
# Determines the average of a list of UVs

UVs = Input()
U = UV.U(UVs)
average = Math.Average(U)
V = UV.V(UVs)
average_2 = Math.Average(V)
byCoordinates = UV.ByCoordinates(average, average_2)
UV = Output(byCoordinates)
