# Dynamo custom node UV.IsInsidePolygon.dyf (Dynamo 0.7.4.3245)
# category: Clockwork.Geometry.UV.Query
# Determines if a point is inside the space enclosed by a polygon

Point_UV_s = Input()  # "Point UV(s)"
Polygon_UVs = Input()
turn_into_list = Custom[Turn Into List](item=Point_UV_s)  # Turns an element (or a nested list) into a flat list
code_block = CodeBlock(poly=Polygon_UVs, points=turn_into_list) { List.Transpose({poly.U,poly.V}); List.Transpose({points.U,points.V}); }
python_script = Python(IN[0]=code_block.out0, IN[1]=code_block.out1)
# ---------- python_script.python (29 lines) ----------
import clr

# script found here:
# http://www.ariel.com.au/a/python-point-int-poly.html
# (with sight alterations for booleans)

def point_inside_polygon(x,y,poly):
    n = len(poly)
    inside = 0
    p1x,p1y = poly[0]
    for i in range(n+1):
        p2x,p2y = poly[i % n]
        if y > min(p1y,p2y):
            if y <= max(p1y,p2y):
                if x <= max(p1x,p2x):
                    if p1y != p2y:
                        xinters = (y-p1y)*(p2x-p1x)/(p2y-p1y)+p1x
                    if p1x == p2x or x <= xinters:
                        inside = 1 - inside
        p1x,p1y = p2x,p2y
    if inside == 1: return True
    else: return False
    
poly = IN[0]
points = IN[1]
elementlist = list()
for point in points:
	elementlist.append(point_inside_polygon(point[0],point[1],poly))
OUT = elementlist
# ----------------------------------------
returnListOrSingleValue = Custom[ReturnListOrSingleValue](item_1_unknown=Point_UV_s, item_2_list=python_script)  # If the item in input #1 is not a list, only the first item of the list in input #2 will be returned.
bool = Output(returnListOrSingleValue)
