# Dynamo custom node UV.PruneDuplicates.dyf (Dynamo 0.7.5.3566)
# category: Clockwork.Geometry.UV.Actions
# Prune UVs to exclude duplicates within a given tolerance

UVs = Input()
Tolerance = Input()
code_block = CodeBlock(uvlist=UVs, tol=Tolerance)
# ---------- code_block.designscript (3 lines) ----------
plist1 = Point.ByCoordinates(uvlist.U,uvlist.V);
plist2 = Point.PruneDuplicates(plist1,tol);
UV.ByCoordinates(plist2.X,plist2.Y);
# ----------------------------------------
UVs_2 = Output(code_block.out2)  # "UVs"
