# Dynamo custom node UV.RoundUpToPrecision.dyf (Dynamo 0.7.5.3566)
# category: Clockwork.Geometry.UV.Actions.Rounding
# Rounds a UV coordinate *up* to a specified precision

UV_s = Input()  # "UV(s)"
Precision = Input()
code_block = CodeBlock(uc=UV_s, pr=Precision) { a = {uc.U,uc.V}; ar = Math.Ceiling(a/pr)*pr; UV.ByCoordinates(ar[0],ar[1]); }
UV_s_2 = Output(code_block.out2)  # "UV(s)"
