# Dynamo custom node UV.Swap.dyf (Dynamo 0.7.2.6209)
# category: CAAD_RWTH.Geometry.UV.Actions
# Swaps U and V coordinates

UV_s = Input()  # "UV(s)"
turn_into_list = Custom[Turn Into List](item=UV_s)  # Turns an element (or a nested list) into a flat list
code_block = CodeBlock(seq=turn_into_list) { UV.ByCoordinates(seq.V,seq.U); }
UV_s_2 = Output(code_block)  # "UV(s)"
