# Dynamo custom node UnitType.DisplayUnitType.dyf (Dynamo 0.7.5.3566)
# category: Clockwork.Revit.Elements.UnitType.Query
# Retrieves the display unit type for a given unit type. NOTE: Input does *not* work with built-in Unit Types dropdown node.

UnitType = Input()
fromDynamoUnitType = Custom[UnitType.FromDynamoUnitType](Dynamo_UnitType=UnitType)  # Retrieves the corresponding Revit UnitType from a Dynamo UnitType
python_script = Python(IN[0]=fromDynamoUnitType)
# ---------- python_script.python (18 lines) ----------
import clr
clr.AddReference('RevitAPI')
from Autodesk.Revit.DB import *

clr.AddReference("RevitServices")
import RevitServices
from RevitServices.Persistence import DocumentManager

unittype = IN[0]
doc = DocumentManager.Instance.CurrentDBDocument
formatoptions = doc.GetUnits().GetFormatOptions(unittype)
dispunits = formatoptions.DisplayUnits
symtype = formatoptions.UnitSymbol
if symtype == UnitSymbolType.UST_NONE:
	dispsym = 'None'
else:
	dispsym = LabelUtils.GetLabelFor(symtype)
OUT = (dispunits,dispsym)
# ----------------------------------------
code_block = CodeBlock(seq=python_script) { seq[0]; seq[1]; }
DisplayUnitType = Output(code_block.out0)
Unit_Symbol = Output(code_block.out1)
