# Dynamo custom node UnitType.FromDynamoUnitType.dyf (Dynamo 0.7.5.3566)
# category: Clockwork.Revit.Elements.UnitType.Create
# Retrieves the corresponding Revit UnitType from a Dynamo UnitType

Dynamo_UnitType = Input()
python_script = Python(IN[0]=Dynamo_UnitType)
# ---------- python_script.python (14 lines) ----------
import clr
clr.AddReference('RevitAPI')
from Autodesk.Revit.DB import *

dynunittype = IN[0]
if str(dynunittype) == 'DynamoUnits.Area':
	ut = UnitType.UT_Area
elif str(dynunittype) == 'DynamoUnits.Length':
	ut = UnitType.UT_Length
elif str(dynunittype) == 'DynamoUnits.Volume':
	ut = UnitType.UT_Volume
else:
	ut = null
OUT = ut
# ----------------------------------------
Revit_UnitType = Output(python_script)
