# Dynamo custom node Vector.AltitudeAndAzimuth.dyf (Dynamo 0.7.5.3566)
# category: Clockwork.Geometry.Vector.Query
# Computes the altitude and azimuth of a given vector

Vector = Input()
code_block = CodeBlock(sundir=Vector)
# ---------- code_block.designscript (6 lines) ----------
// Turn normalized vector into point
vec = sundir.Normalized().AsPoint();
Point.Origin();
Vector.YAxis().AsPoint();
// Project point to XY plane
Point.ByCoordinates(vec.X,vec.Y);
# ----------------------------------------
ZAxisNegative = Custom[Z Axis (Negative)]()  # "Vector.ZAxisNegative"; Returns an XYZ of 0,0,-1
code_block_2 = CodeBlock(vec=code_block.vec, zan=ZAxisNegative)
# ---------- code_block_2.designscript (4 lines) ----------
vecz = vec.Z;
cond1 = zan.AsPoint().IsAlmostEqualTo(vec);
cond2 = Vector.ZAxis().AsPoint().IsAlmostEqualTo(vec);
vecx = vec.X;
# ----------------------------------------
solveByPoints = Custom[Solve Triangle By XYZs](XYZ_A=code_block.vec, XYZ_B=code_block.out1, XYZ_C=code_block.out3)  # "Triangle.SolveByPoints"; Solves a triangle based on the XYZ coordinates of its vertices.
formula_zdir = Formula("if(vecz < 0,-x,x)", vecz=code_block_2.vecz, x=solveByPoints.beta)
formula_res1 = Formula("if(cond1,-90,zdir)", cond1=code_block_2.cond1, zdir=formula_zdir)
formula_alt = Formula("if(cond2,90,res1)", cond2=code_block_2.cond2, res1=formula_res1)
Altitude = Output(formula_alt)
solveByPoints_2 = Custom[Solve Triangle By XYZs](XYZ_A=code_block.out3, XYZ_B=code_block.out1, XYZ_C=code_block.out2)  # "Triangle.SolveByPoints"
formula_azi = Formula("if(vecx < 0,360-a,a)", vecx=code_block_2.vecx, a=solveByPoints_2.beta)
Azimuth = Output(formula_azi)
