# Dynamo custom node Vector.Average.dyf (Dynamo 0.7.4.3192)
# category: Clockwork.Geometry.Vector.Query
# Determines the average vector of a list of vectors

Vectors = Input()
normalized = Vector.Normalized(Vectors)
X = Vector.X(normalized)
average = Math.Average(X)
Y = Vector.Y(normalized)
average_2 = Math.Average(Y)
Z = Vector.Z(normalized)
average_3 = Math.Average(Z)
boolean = BoolSelector(true)
byCoordinates = Vector.ByCoordinates(average, average_2, average_3, boolean)
Vector = Output(byCoordinates)
