# Dynamo custom node Vector.IntersectionWithPlane.dyf (Dynamo 0.7.5.3566)
# category: Clockwork.Geometry.Vector.Actions
# Finds the intersection point between a plane and a vector

Vector_Basepoint_s = Input()  # "Vector Basepoint(s)"
Vector_s = Input()  # "Vector(s)"
Plane = Input()
code_block = CodeBlock(vecn=Vector_s, vecb=Vector_Basepoint_s, plx=Plane)
# ---------- code_block.designscript (8 lines) ----------
// Based on: http://stackoverflow.com/questions/5666222/3d-line-plane-intersection
v0 = vecn.Normalized();
v1 = vecb.Subtract(plx.Origin.AsVector()).AsVector();
d1 = plx.Normal.Dot(v1);
d2 = plx.Normal.Dot(v0);
sc1 = -d1/d2;
v2 = v0.Scale(sc1);
p = vecb.Add(v2);
# ----------------------------------------
isInPlane = Custom[Vector.IsInPlane](Vector_Basepoint=Vector_Basepoint_s, Vector=code_block.v0, Plane=Plane)  # Checks if a given vector is located on a given plane
isParallelToPlane = Custom[Vector.IsParallelToPlane](Vector=code_block.v0, Plane=Plane)  # Checks if a given vector is parallel to a given plane
code_block_2 = CodeBlock(a=isInPlane, b=isParallelToPlane) { {a,b}; }
anyTrue = Custom[True For Any (Boolean)](seq=code_block_2)  # "List.AnyTrue"; Returns true if any item in a list of booleans is true.
code_block_3 = CodeBlock(cond=anyTrue, p=code_block.p) { cond ? List.Empty : p; }
Intersection_Point_s = Output(code_block_3)  # "Intersection Point(s)"
