# Dynamo custom node Vector.IntersectionWithVector.dyf (Dynamo 0.7.4.3245)
# category: Clockwork.Geometry.Vector.Actions
# Determines if two vectors intersect and returns the closest points of intersection on both vectors.

Vector_1 = Input()  # "Vector #1"
Vector_2 = Input()  # "Vector #2"
Basepoint_2 = Input()  # "Basepoint #2"
Basepoint_1 = Input()  # "Basepoint #1"
almostZero = Custom[Almost Zero]()  # "Math.AlmostZero"; Returns a feasable computational tolerance to zero (1.0e-9 or a billionth of 1) for use in calculations. More background info: https://github.com/ikeough/Dynamo/issues/879
code_block = CodeBlock(v1=Vector_1, v2=Vector_2, p2=Basepoint_2, p1=Basepoint_1, az=almostZero)
# ---------- code_block.designscript (27 lines) ----------
// Based on: http://stackoverflow.com/questions/10551555/need-an-algorithm-for-3d-vectors-intersection;
vec1 = v1.Normalized();
vec2 = v2.Normalized();
// Find the direction projection
u = vec1.Dot(vec2);
// If vectors are parallel, no intersection exists
para = vec1.IsParallel(vec2);
// Find the separation projections
pointvec = p2.Subtract(p1.AsVector()).AsVector();
t1 = pointvec.Dot(vec1);
t2 = pointvec.Dot(vec2);
// Find distance along line1
d1 = (t1-u*t2)/(1-u*u);
// Find distance along line2
d2 = (t2-u*t1)/(u*u-1);
// Find the point on line1
p1_new = p1.Add(vec1.Scale(d1));
para ? List.Empty : p1_new;
// Find the point on line2
p2_new = p2.Add(vec2.Scale(d2));
para ? List.Empty : p2_new;
// Do vectors intersect?
para ? false : p1_new.DistanceTo(p2_new) < az;
// Average XYZ
pts = {p1_new,p2_new};
avpts = Point.ByCoordinates(Math.Average(pts.X), Math.Average(pts.Y), Math.Average(pts.Z));
para ? List.Empty : avpts;
# ----------------------------------------
Vectors_intersect = Output(code_block.out13)
Closest_point_on_Vector_1 = Output(code_block.out10)  # "Closest point on Vector #1"
Closest_point_on_Vector_2 = Output(code_block.out12)  # "Closest point on Vector #2"
Average_Point = Output(code_block.out16)
