# Dynamo custom node Vector.IsInPlane.dyf (Dynamo 0.7.2.2921)
# category: Clockwork.Geometry.Vector.Query
# Checks if a given vector is located on a given plane

Vector_Normalized = Input()  # "Vector (Normalized)"
Plane = Input()
isParallelToPlane = Custom[Vector.IsParallelToPlane](Vector=Vector_Normalized, Plane=Plane)  # Checks if a given vector is parallel to a given plane
Vector_Basepoint = Input()
isOutOfPlane = Custom[Point.IsOutOfPlane](Face_Plane=Plane, Point=Vector_Basepoint)  # Checks a list for XYZs that are not located on a given plane
not_ = Not(isOutOfPlane.bool)
create_list = List.Create(isParallelToPlane, not_)
true_for_all_booleans = Custom[True For All (Boolean)](seq=create_list)  # Returns true if all items in a list of booleans are true.
bool = Output(true_for_all_booleans)
