# Dynamo custom node Vector.IsOrthogonalToVector.dyf (Dynamo 0.7.2.2921)
# category: Clockwork.Geometry.Vector.Query
# Checks if two vectors are orthogonal to each other

Vector_1 = Input()  # "Vector #1"
Vector_2 = Input()  # "Vector #2"
almostZero = Custom[Almost Zero]()  # "Math.AlmostZero"; Returns a feasable computational tolerance to zero (1.0e-9 or a billionth of 1) for use in calculations. More background info: https://github.com/ikeough/Dynamo/issues/879
code_block = CodeBlock(vec1=Vector_1, vec2=Vector_2, zero=almostZero)
# ---------- code_block.designscript (4 lines) ----------
dotprod = vec1.Normalized().Dot(vec2.Normalized());
// Orthogonal vectors have a dot product of zero
// We're adding a bit of tolerance, just to be on the safe side...
isortho = !(dotprod>zero) && !(dotprod < -zero);
# ----------------------------------------
bool = Output(code_block.isortho)
