# Dynamo custom node Vector.IsParallelToPlane.dyf (Dynamo 0.7.5.3566)
# category: Clockwork.Geometry.Vector.Query
# Checks if a given vector is parallel to a given plane

Vector = Input()
Plane = Input()
code_block = CodeBlock(pl=Plane) { pl.Normal; }
isOrthogonalToVector = Custom[Vector.IsOrthogonalToVector](Vector_1=Vector, Vector_2=code_block)  # Checks if two vectors are orthogonal to each other
bool = Output(isOrthogonalToVector)
