# Dynamo custom node Vector.PruneDuplicates.dyf (Dynamo 0.7.4.3180)
# category: Clockwork.Geometry.Vector.Actions
# Prune vectors to exclude duplicates within a given tolerance

Vectors = Input()
asPoint = Vector.AsPoint(Vectors)
Tolerance = Input()
pruneDuplicates = Point.PruneDuplicates(asPoint, Tolerance)
asVector = Point.AsVector(pruneDuplicates)
Vectors_2 = Output(asVector)  # "Vectors"
