# Dynamo custom node Vector.XAxis (Negative).dyf (Dynamo 0.7.2.6209)
# category: CAAD_RWTH.Geometry.Vector.Create.Axes
# Returns an XYZ of -1,0,0

XAxis = Vector.XAxis()
reverse = Vector.Reverse(XAxis)
n1_0_0 = Output(reverse)  # "-1,0,0"
