# Dynamo custom node Vector.YAxis (Negative).dyf (Dynamo 0.7.2.6209)
# category: CAAD_RWTH.Geometry.Vector.Create.Axes
# Returns an XYZ of 0,-1,0

YAxis = Vector.YAxis()
reverse = Vector.Reverse(YAxis)
n0_1_0 = Output(reverse)  # "0,-1,0"
