# Dynamo custom node Vector.ZAxis (Negative).dyf (Dynamo 0.7.2.6209)
# category: CAAD_RWTH.Geometry.Vector.Create.Axes
# Returns an XYZ of 0,0,-1

ZAxis = Vector.ZAxis()
reverse = Vector.Reverse(ZAxis)
n0_0_1 = Output(reverse)  # "0,0,-1"
