# Dynamo custom node View.CategoryIsVisible.dyf (Dynamo 0.7.2.2921)
# category: Clockwork.Revit.Views.View.Query
# Checks if a given category is visible in a given view

View_s = Input()  # "View(s)"
Category_ies = Input()  # "Category/ies"
turn_into_list = Custom[Turn Into List](item=Category_ies)  # Turns an element (or a nested list) into a flat list
turn_into_list_2 = Custom[Turn Into List](item=View_s)
python_script = Python(IN[0]=turn_into_list, IN[1]=turn_into_list_2)
# ---------- python_script.python (20 lines) ----------
import clr
clr.AddReference('RevitAPI')
from Autodesk.Revit.DB import *

cats = UnwrapElement(IN[0])
views = UnwrapElement(IN[1])

elementlist = list()
for cat in cats:
	catlist = list()
	for view in views:
		try:
			if view.GetVisibility(cat):
				catlist.append(True)
			else:
				catlist.append(False)	
		except:
			catlist.append(False)
	elementlist.append(catlist)
OUT = elementlist
# ----------------------------------------
returnListOrSingleValue = Custom[ReturnListOrSingleValue](item_1_unknown=View_s, item_2_list=python_script)  # If the item in input #1 is not a list, only the first item of the list in input #2 will be returned.
bool = Output(returnListOrSingleValue)
