# Dynamo custom node View.ConvertTemporaryHideIsolateToPermanent.dyf (Dynamo 0.7.2.3911)
# category: Clockwork.Revit.Views.View.Actions
# Convert all temporary hidden elements or categories to permanently hidden in the given view.

View = Input()
python_script = Python(IN[0]=View)
# ---------- python_script.python (16 lines) ----------
import clr
clr.AddReference('RevitAPI')
from Autodesk.Revit.DB import *

clr.AddReference("RevitServices")
import RevitServices
from RevitServices.Persistence import DocumentManager
from RevitServices.Transactions import TransactionManager

doc = DocumentManager.Instance.CurrentDBDocument
view = UnwrapElement(IN[0])

TransactionManager.Instance.EnsureInTransaction(doc)
view.ConvertTemporaryHideIsolateToPermanent()
TransactionManager.Instance.TransactionTaskDone()
OUT = (view,elements)
# ----------------------------------------
View_2 = Output(python_script)  # "View"
