# Dynamo custom node View.DetailLevel.dyf (Dynamo 0.7.2.26223)
# category: CAAD_RWTH.Revit.Views.View.Query.DetailLevel
# Retrieves the detail level of a given view

View_s = Input()  # "View(s)"
turn_into_list = Custom[Turn Into List](item=View_s)  # Turns an element (or a nested list) into a flat list
python_script = Python(IN[0]=turn_into_list)
# ---------- python_script.python (12 lines) ----------
import clr
clr.AddReference('RevitAPI')
from Autodesk.Revit.DB import *

views = UnwrapElement(IN[0])
elementlist = list()
for view in views:
	try:
		elementlist.append(str(view.DetailLevel))
	except:
		elementlist.append('Undefined')
OUT = elementlist
# ----------------------------------------
return_list_or_single_value = Custom[Return List Or Single Value](list_1=turn_into_list, list_2=python_script)  # If the list in input #1 only contains one item, only the first item of the list in input #2 will be returned.
Detail_Level_s = Output(return_list_or_single_value)  # "Detail Level(s)"
