# Dynamo custom node View.PermanentlyIsolateElement.dyf (Dynamo 0.7.2.2921)
# category: Clockwork.Revit.Views.View.Actions
# (Permanently) isolates elements in the given view

View = Input()
Element_s = Input()  # "Element(s)"
turn_into_list = Custom[Turn Into List](item=Element_s)  # Turns an element (or a nested list) into a flat list
temporarilyIsolateElement = Custom[View.TemporarilyIsolateElement](View=View, Element_s=turn_into_list)  # (Temporarily) isolates elements in the given view
convertTemporaryHideIsolateToPermanent = Custom[View.ConvertTemporaryHideIsolateToPermanent](View=temporarilyIsolateElement.View)  # Convert all temporary hidden elements or categories to permanently hidden in the given view.
View_2 = Output(convertTemporaryHideIsolateToPermanent)  # "View"
returnListOrSingleValue = Custom[ReturnListOrSingleValue](item_1_unknown=Element_s, item_2_list=temporarilyIsolateElement.Element_s)  # If the item in input #1 is not a list, only the first item of the list in input #2 will be returned.
Element_s_2 = Output(returnListOrSingleValue)  # "Element(s)"
