# Dynamo custom node View.Scale.dyf (Dynamo 0.7.2.2921)
# category: Clockwork.Revit.Views.View.Query
# Returns the scale of a given view

View_s = Input()  # "View(s)"
turn_into_list = Custom[Turn Into List](item=View_s)  # Turns an element (or a nested list) into a flat list
python_script = Python(IN[0]=turn_into_list)
# ---------- python_script.python (12 lines) ----------
import clr
clr.AddReference('RevitAPI')
from Autodesk.Revit.DB import *

views = UnwrapElement(IN[0])
elementlist = list()
for view in views:
	try:
		elementlist.append(view.Scale)
	except:
		elementlist.append(list())
OUT = elementlist
# ----------------------------------------
returnListOrSingleValue = Custom[ReturnListOrSingleValue](item_1_unknown=View_s, item_2_list=python_script)  # If the item in input #1 is not a list, only the first item of the list in input #2 will be returned.
Scale_s_1 = Output(returnListOrSingleValue)  # "Scale(s) 1:X"
