# Dynamo custom node View.SetPhase.dyf (Dynamo 0.7.5.3566)
# category: Clockwork.Revit.Views.View.Actions
# Sets the phase of a given view

View_s = Input()  # "View(s)"
turn_into_list = Custom[Turn Into List](item=View_s)  # Turns an element (or a nested list) into a flat list
Phase = Input()
python_script = Python(IN[0]=turn_into_list, IN[1]=Phase)
# ---------- python_script.python (28 lines) ----------
import clr
clr.AddReference('RevitAPI')
from Autodesk.Revit.DB import *

clr.AddReference("RevitNodes")
import Revit
clr.ImportExtensions(Revit.Elements)

clr.AddReference("RevitServices")
import RevitServices
from RevitServices.Persistence import DocumentManager
from RevitServices.Transactions import TransactionManager

doc = DocumentManager.Instance.CurrentDBDocument
views = UnwrapElement(IN[0])
phase = UnwrapElement(IN[1])
booleans = list()

TransactionManager.Instance.EnsureInTransaction(doc)
for view in views:
	try:
		view.get_Parameter(BuiltInParameter.VIEW_PHASE).Set(phase.Id)
		booleans.append(True)
	except:
		booleans.append(False)
TransactionManager.Instance.TransactionTaskDone()

OUT = (views,booleans)
# ----------------------------------------
code_block = CodeBlock(seq=python_script) { seq[0]; seq[1]; }
returnListOrSingleValue = Custom[ReturnListOrSingleValue](item_1_unknown=View_s, item_2_list=code_block.out0)  # If the item in input #1 is not a list, only the first item of the list in input #2 will be returned.
View_s_2 = Output(returnListOrSingleValue)  # "View(s)"
returnListOrSingleValue_2 = Custom[ReturnListOrSingleValue](item_1_unknown=View_s, item_2_list=code_block.out1)
Success = Output(returnListOrSingleValue_2)
