# Dynamo custom node View.SetSolarStudyActiveFrameNumber.dyf (Dynamo 0.7.5.3566)
# category: Clockwork.Revit.Views.View.Actions
# Sets the active frame number of the solar study in a given view

View = Input()
Frame_number = Input()
python_script = Python(IN[0]=View, IN[1]=Frame_number)
# ---------- python_script.python (20 lines) ----------
import clr
clr.AddReference('RevitAPI')
from Autodesk.Revit.DB import *

clr.AddReference("RevitServices")
import RevitServices
from RevitServices.Persistence import DocumentManager
from RevitServices.Transactions import TransactionManager

doc = DocumentManager.Instance.CurrentDBDocument
view = UnwrapElement(IN[0])
frame = IN[1]
TransactionManager.Instance.EnsureInTransaction(doc)
try:
	view.SunAndShadowSettings.ActiveFrame = frame
	success = True
except:
	success = False
TransactionManager.Instance.TransactionTaskDone()
OUT = (view,success)
# ----------------------------------------
code_block = CodeBlock(seq=python_script) { seq[0]; seq[1]; }
View_2 = Output(code_block.out0)  # "View"
Success = Output(code_block.out1)  # "Success?"
