# Dynamo custom node View.SolarStudyTotalFrames.dyf (Dynamo 0.7.5.3566)
# category: Clockwork.Revit.Views.View.Query
# Retrieves the number of frames of a solar study for a given view (if the view's sun and shadow settings are indeed set to single or multi day study)

View_s = Input()  # "View(s)"
turn_into_list = Custom[Turn Into List](item=View_s)  # Turns an element (or a nested list) into a flat list
python_script = Python(IN[0]=turn_into_list)
# ---------- python_script.python (12 lines) ----------
import clr
clr.AddReference('RevitAPI')
from Autodesk.Revit.DB import *

views = UnwrapElement(IN[0])
elementlist = []
for view in views:
	try:
		elementlist.append(view.SunAndShadowSettings.NumberOfFrames)
	except:
		elementlist.append(0)
OUT = elementlist
# ----------------------------------------
returnListOrSingleValue = Custom[ReturnListOrSingleValue](item_1_unknown=View_s, item_2_list=python_script)  # If the item in input #1 is not a list, only the first item of the list in input #2 will be returned.
dbl = Output(returnListOrSingleValue)
