# Dynamo custom node View.TemporarilyIsolateElement.dyf (Dynamo 0.7.2.3911)
# category: Clockwork.Revit.Views.View.Actions
# (Temporarily) isolates elements in the given view

Element_s = Input()  # "Element(s)"
turn_into_list = Custom[Turn Into List](item=Element_s)  # Turns an element (or a nested list) into a flat list
View = Input()
python_script = Python(IN[0]=turn_into_list, IN[1]=View)
# ---------- python_script.python (23 lines) ----------
import clr
clr.AddReference('RevitAPI')
from Autodesk.Revit.DB import *
from System.Collections.Generic import *

clr.AddReference("RevitServices")
import RevitServices
from RevitServices.Persistence import DocumentManager
from RevitServices.Transactions import TransactionManager

doc = DocumentManager.Instance.CurrentDBDocument
elements = UnwrapElement(IN[0])
view = UnwrapElement(IN[1])
ids = list()
elementlist = list()
for item in elements:
	ids.append(item.Id)
ielements = List[ElementId](ids)

TransactionManager.Instance.EnsureInTransaction(doc)
view.IsolateElementsTemporary(ielements)
TransactionManager.Instance.TransactionTaskDone()
OUT = (view,elements)
# ----------------------------------------
code_block = CodeBlock(seq=python_script) { seq[0]; seq[1]; }
View_2 = Output(code_block.out0)  # "View"
Element_s_2 = Output(code_block.out1)  # "Element(s)"
