# Dynamo custom node View.TypeIsDraftingView.dyf (Dynamo 0.7.3.3034)
# category: Clockwork.Revit.Views.View.Query.Type
# Checks whether a given view is a drafting view.

View_s = Input()  # "View(s)"
turn_into_list = Custom[Turn Into List](item=View_s)  # Turns an element (or a nested list) into a flat list
python_script = Python(IN[0]=turn_into_list)
# ---------- python_script.python (13 lines) ----------
import clr
clr.AddReference('RevitAPI')
from Autodesk.Revit.DB import *

views = UnwrapElement(IN[0])
booleans = list()

for view in views:
	if str(view.ViewType) == 'DraftingView':
		booleans.append(True)
	else:
		booleans.append(False)
OUT = booleans		
# ----------------------------------------
returnListOrSingleValue = Custom[ReturnListOrSingleValue](item_1_unknown=View_s, item_2_list=python_script)  # If the item in input #1 is not a list, only the first item of the list in input #2 will be returned.
bool = Output(returnListOrSingleValue)
