# Dynamo custom node View.UsesViewFilters.dyf (Dynamo 0.7.5.3566)
# category: Clockwork.Revit.Views.View.Query
# Checks if a given view has any view filters applied to it.

View_s = Input()  # "View(s)"
turn_into_list = Custom[Turn Into List](item=View_s)  # Turns an element (or a nested list) into a flat list
python_script = Python(IN[0]=turn_into_list)
# ---------- python_script.python (28 lines) ----------
import clr
clr.AddReference('RevitAPI')
from Autodesk.Revit.DB import *

clr.AddReference("RevitServices")
import RevitServices
from RevitServices.Persistence import DocumentManager

doc = DocumentManager.Instance.CurrentDBDocument
views = UnwrapElement(IN[0])
elementlist = list()

collector = FilteredElementCollector(doc)
filters = collector.OfClass(FilterElement).ToElements()

for view in views:
	try:
		thisfilter = False
		for filter in filters:
			if view.IsFilterApplied(filter.Id):
				thisfilter = True
		if thisfilter:
			elementlist.append(True)
		else:
			elementlist.append(False)
	except:
		elementlist.append(False)
OUT = elementlist
# ----------------------------------------
returnListOrSingleValue = Custom[ReturnListOrSingleValue](item_1_unknown=View_s, item_2_list=python_script)  # If the item in input #1 is not a list, only the first item of the list in input #2 will be returned.
bool = Output(returnListOrSingleValue)
