# Dynamo custom node Wall.Orientation.dyf (Dynamo 0.7.2.2921)
# category: Clockwork.Revit.Elements.Wall.Query
# Gets the orientation of a given wall instance (normal of the exterior face of the wall). Will *not* work for walls hosted on mass faces or in-place walls.

Wall_Instance_s = Input()  # "Wall Instance(s)"
turn_into_list = Custom[Turn Into List](item=Wall_Instance_s)  # Turns an element (or a nested list) into a flat list
python_script = Python(IN[0]=turn_into_list)
# ---------- python_script.python (17 lines) ----------
import clr
clr.AddReference('RevitAPI')
from Autodesk.Revit.DB import *

clr.AddReference("RevitNodes")
import Revit
clr.ImportExtensions(Revit.Elements)
clr.ImportExtensions(Revit.GeometryConversion)

wallinstances = UnwrapElement(IN[0])
vectorlist = list()
for item in wallinstances:
	try:
		vectorlist.append(item.Orientation.ToVector())
	except:
		vectorlist.append(list())
OUT = vectorlist
# ----------------------------------------
returnListOrSingleValue = Custom[ReturnListOrSingleValue](item_1_unknown=Wall_Instance_s, item_2_list=python_script)  # If the item in input #1 is not a list, only the first item of the list in input #2 will be returned.
Normal_s = Output(returnListOrSingleValue)  # "Normal(s)"
