# Dynamo custom node WallLocationLine.CoreExterior.dyf (Dynamo 0.7.5.3437)
# category: Clockwork.Revit.Elements.WallLocationLine.Query
# Returns the WallLocationLine option for CoreExterior

python_script = Python()
# ---------- python_script.python (5 lines) ----------
import clr
clr.AddReference('RevitAPI')
from Autodesk.Revit.DB import *

OUT = WallLocationLine.CoreExterior
# ----------------------------------------
CoreExterior = Output(python_script)
