# Dynamo custom node WallLocationLine.WallCenterline.dyf (Dynamo 0.7.5.3437)
# category: Clockwork.Revit.Elements.WallLocationLine.Query
# Returns the WallLocationLine option for WallCenterLine

python_script = Python()
# ---------- python_script.python (5 lines) ----------
import clr
clr.AddReference('RevitAPI')
from Autodesk.Revit.DB import *

OUT = WallLocationLine.WallCenterline
# ----------------------------------------
WallCenterline = Output(python_script)
