# Dynamo custom node WallType.Function.dyf (Dynamo 0.7.2.2921)
# category: Clockwork.Revit.Elements.WallType.Query.Function
# Retrieves the Function property of a given wall type

Wall_Type_s = Input()  # "Wall Type(s)"
turn_into_list = Custom[Turn Into List](item=Wall_Type_s)  # Turns an element (or a nested list) into a flat list
python_script = Python(IN[0]=turn_into_list)
# ---------- python_script.python (17 lines) ----------
import clr
clr.AddReference('RevitAPI')
from Autodesk.Revit.DB import *

clr.AddReference("RevitNodes")
import Revit
clr.ImportExtensions(Revit.Elements)

walltypes = UnwrapElement(IN[0])
functionlist = list()

for item in walltypes:
	try:
		functionlist.append(item.get_Parameter(BuiltInParameter.FUNCTION_PARAM).AsValueString())
	except:
		functionlist.append('No Wall/Function')
OUT = functionlist
# ----------------------------------------
returnListOrSingleValue = Custom[ReturnListOrSingleValue](item_1_unknown=Wall_Type_s, item_2_list=python_script)  # If the item in input #1 is not a list, only the first item of the list in input #2 will be returned.
Function_s = Output(returnListOrSingleValue)  # "Function(s)"
