# Dynamo custom node WallType.Kind.dyf (Dynamo 0.7.2.2921)
# category: Clockwork.Revit.Elements.WallType.Query.Kind
# Retrieves the wall kind of a given wall type

Wall_Type_s = Input()  # "Wall Type(s)"
turn_into_list = Custom[Turn Into List](item=Wall_Type_s)  # Turns an element (or a nested list) into a flat list
python_script = Python(IN[0]=turn_into_list)
# ---------- python_script.python (12 lines) ----------
import clr
clr.AddReference('RevitAPI')
from Autodesk.Revit.DB import *

walltypes = UnwrapElement(IN[0])
kindlist = list()
for item in walltypes:
	try: 
		kindlist.append(str(item.Kind))
	except:
		kindlist.append('No Wall')
OUT = kindlist
# ----------------------------------------
returnListOrSingleValue = Custom[ReturnListOrSingleValue](item_1_unknown=Wall_Type_s, item_2_list=python_script)  # If the item in input #1 is not a list, only the first item of the list in input #2 will be returned.
Kind_s = Output(returnListOrSingleValue)  # "Kind(s)"
