# Dynamo custom node WallType.KindIsCurtainWall.dyf (Dynamo 0.7.2.3911)
# category: Clockwork.Revit.Elements.WallType.Query.Kind
# Checks whether a given walltype is a curtain wall

Wall_Type_s = Input()  # "Wall Type(s)"
turn_into_list = Custom[Turn Into List](item=Wall_Type_s)  # Turns an element (or a nested list) into a flat list
python_script = Python(IN[0]=turn_into_list)
# ---------- python_script.python (15 lines) ----------
import clr
clr.AddReference('RevitAPI')
from Autodesk.Revit.DB import *

walltypes = UnwrapElement(IN[0])
booleans = list()
for item in walltypes:
	try: 
		if str(item.Kind) == 'Curtain':
			booleans.append(True)
		else:
			booleans.append(False)
	except:
		booleans.append(False)
OUT = booleans
# ----------------------------------------
return_list_or_single_value = Custom[Return List Or Single Value](list_1=turn_into_list, list_2=python_script)  # If the list in input #1 only contains one item, only the first item of the list in input #2 will be returned.
Kind_s = Output(return_list_or_single_value)  # "Kind(s)"
