# Dynamo custom node WallType.KindIsStackedWall.dyf (Dynamo 0.7.2.2921)
# category: Clockwork.Revit.Elements.WallType.Query.Kind
# Checks whether a given walltype is a stacked wall

Wall_Type_s = Input()  # "Wall Type(s)"
turn_into_list = Custom[Turn Into List](item=Wall_Type_s)  # Turns an element (or a nested list) into a flat list
python_script = Python(IN[0]=turn_into_list)
# ---------- python_script.python (15 lines) ----------
import clr
clr.AddReference('RevitAPI')
from Autodesk.Revit.DB import *

walltypes = UnwrapElement(IN[0])
booleans = list()
for item in walltypes:
	try: 
		if str(item.Kind) == 'Stacked':
			booleans.append(True)
		else:
			booleans.append(False)
	except:
		booleans.append(False)
OUT = booleans
# ----------------------------------------
returnListOrSingleValue = Custom[ReturnListOrSingleValue](item_1_unknown=Wall_Type_s, item_2_list=python_script)  # If the item in input #1 is not a list, only the first item of the list in input #2 will be returned.
Kind_s = Output(returnListOrSingleValue)  # "Kind(s)"
