# Dynamo custom node XYZAxis.FromVector.dyf (Dynamo 0.7.5.3566)
# category: Clockwork.Geometry.Vector.Create
# Returns whichever main axis (X, Y or Z) is closest to a given vector

Vector = Input()
code_block = CodeBlock(vec=Vector)
# ---------- code_block.designscript (2 lines) ----------
cond1 = Math.Abs(vec.Y) > Math.Abs(vec.X) && Math.Abs(vec.Y) > Math.Abs(vec.Z);
cond2 = Math.Abs(vec.X) > Math.Abs(vec.Y) && Math.Abs(vec.X) > Math.Abs(vec.Z);
# ----------------------------------------
XAxis = Vector.XAxis()
YAxis = Vector.YAxis()
ZAxis = Vector.ZAxis()
formula = Formula("if(cond1,[trueval],[falseval])", cond1=code_block.cond1, trueval=YAxis, falseval=ZAxis)
formula_2 = Formula("if(cond2,[trueval],[falseval])", cond2=code_block.cond2, trueval=XAxis, falseval=formula)
XYZ_Axis = Output(formula_2)
