# Dynamo custom node Buckyball Coordinates.dyf (Dynamo 0.7.2.3911)
# category: CAAD_RWTH.Geometry.Buckyball.Helpers
# Returns the coordinates of all the vertices of an (unscaled) truncated icosahedron.

code_block = CodeBlock()
# ---------- code_block.designscript (9 lines) ----------
phi = (1 + Math.Sqrt(5)) / 2;
{0};
{1,-1};
{3*phi,-3*phi};
{2,-2};
{1+2*phi,-(1+2*phi)};
{phi,-phi};
{2+phi,-(2+phi)};
{2*phi,-2*phi};
# ----------------------------------------
byCoordinates = Point.ByCoordinates(code_block.out1, code_block.out2, code_block.out3, lacing=CrossProduct)
byCoordinates_2 = Point.ByCoordinates(code_block.out2, code_block.out3, code_block.out1, lacing=CrossProduct)
byCoordinates_3 = Point.ByCoordinates(code_block.out3, code_block.out1, code_block.out2, lacing=CrossProduct)
byCoordinates_4 = Point.ByCoordinates(code_block.out4, code_block.out5, code_block.out6, lacing=CrossProduct)
byCoordinates_5 = Point.ByCoordinates(code_block.out5, code_block.out6, code_block.out4, lacing=CrossProduct)
byCoordinates_6 = Point.ByCoordinates(code_block.out6, code_block.out4, code_block.out5, lacing=CrossProduct)
byCoordinates_7 = Point.ByCoordinates(code_block.out2, code_block.out7, code_block.out8, lacing=CrossProduct)
byCoordinates_8 = Point.ByCoordinates(code_block.out7, code_block.out8, code_block.out2, lacing=CrossProduct)
byCoordinates_9 = Point.ByCoordinates(code_block.out8, code_block.out2, code_block.out7, lacing=CrossProduct)
# note: The important thing in this node is to set the lacing options of all XYZ nodes to cross product.
create_list = List.Create(byCoordinates, byCoordinates_2, byCoordinates_3, byCoordinates_4, byCoordinates_5, byCoordinates_6, byCoordinates_7, byCoordinates_8, byCoordinates_9)
flatten = Flatten(create_list)
XYZs = Output(flatten)
