# Dynamo custom node Buckyball.dyf (Dynamo 0.7.2.3911)
# category: CAAD_RWTH.Geometry.Buckyball
# Returns all the data necessary for modeling a truncated icosahedron (vertices and struts) as well as the surface area and volume. Radius and origin of the object can be specified.

Origin = Input()
buckyball_coordinates = Custom[Buckyball Coordinates]()  # Returns the coordinates of all the vertices of an (unscaled) truncated icosahedron.
Radius = Input()
formula = Formula("1/4*sqrt(58+18*sqrt(5))", lacing=Longest)
# note: Determine scale factor based on radius
formula_2 = Formula("r/2/factor", r=Radius, factor=formula, lacing=Longest)
scale = Geometry.Scale(buckyball_coordinates, formula_2, lacing=Longest)
asVector = Point.AsVector(scale)
# note: Add scale and origin for struts and vertices
add = Point.Add(Origin, asVector, lacing=Longest)
# note: Find average XYZ for each strut and determine up vector from buckyball center for possible use in structural framing
Vertices = Output(add)
empty = List.Empty()
get_buckyball_struts = Custom[Get Buckyball Struts](list=buckyball_coordinates, struts=empty)  # Parses the vertices of an (unscaled) truncated icosahedron and returns a pair of XYZs for each strut.
scale_2 = Geometry.Scale(get_buckyball_struts.struts, formula_2, lacing=Longest)
asVector_2 = Point.AsVector(scale_2)
add_2 = Point.Add(Origin, asVector_2, lacing=Longest)
code_block = CodeBlock { Math.Average(pts.X); Math.Average(pts.Y); Math.Average(pts.Z); }
byCoordinates = Point.ByCoordinates(code_block.out0, code_block.out1, code_block.out2, lacing=Longest)
map = List.Map(add_2, byCoordinates)
byTwoPoints = Vector.ByTwoPoints(Origin, map)
normalized = Vector.Normalized(byTwoPoints)
asPoint = Vector.AsPoint(normalized, lacing=Longest)
Struts_Up_Vector = Output(asPoint)  # "Struts (Up Vector)"
transpose = List.Transpose(add_2)
firstItem = List.FirstItem(transpose)
number = DoubleInput(1)
getItemAtIndex = List.GetItemAtIndex(transpose, number)
# note: Create lines for the struts
byStartPointEndPoint = Line.ByStartPointEndPoint(firstItem, getItemAtIndex, lacing=Longest)
Struts_Lines = Output(byStartPointEndPoint)  # "Struts (Lines)"
Struts_XYZs = Output(add_2)  # "Struts (XYZs)"
firstItem_2 = List.FirstItem(firstItem)
firstItem_3 = List.FirstItem(getItemAtIndex)
distanceTo = Geometry.DistanceTo(firstItem_2, firstItem_3, lacing=Longest)
formula_3 = Formula("(20*3/2*sqrt(3)+12*5/4*sqrt(1+2/sqrt(5)))*Pow(a,2)", a=distanceTo, lacing=Longest)
fromDouble = DynamoUnits.Area.FromDouble(formula_3, lacing=Longest)
Surface_Area = Output(fromDouble)
# note: Compute surface area and volume based on strut length
formula_4 = Formula("1/4*(125+43*sqrt(5))*Pow(a,3)", a=distanceTo, lacing=Longest)
fromDouble_2 = DynamoUnits.Volume.FromDouble(formula_4, lacing=Longest)
Volume = Output(fromDouble_2)
