# Dynamo custom node Element.Inserts.dyf (Dynamo 0.7.2.2114)
# category: CAAD_RWTH.Revit.Elements.Element.Query
# Gets all the objects inserted into a given element.

Element_s = Input()  # "Element(s)"
turn_into_list = Custom[Turn Into List](item=Element_s)  # Turns an element (or a nested list) into a flat list
Include_Openings = Input()  # "Include Openings?"
Include_Shadows = Input()  # "Include Shadows?"
Include_Embedded_Walls = Input()  # "Include Embedded Walls?"
Include_Shared_Embedded_Inserts = Input()  # "Include Shared Embedded Inserts?"
python_script = Python(IN[0]=turn_into_list, IN[1]=Include_Openings, IN[2]=Include_Shadows, IN[3]=Include_Embedded_Walls, IN[4]=Include_Shared_Embedded_Inserts)
# ---------- python_script.python (29 lines) ----------
import clr
clr.AddReference('RevitAPI')
from Autodesk.Revit.DB import *

clr.AddReference("RevitNodes")
import Revit
clr.ImportExtensions(Revit.Elements)

clr.AddReference("RevitServices")
import RevitServices
from RevitServices.Persistence import DocumentManager

doc = DocumentManager.Instance.CurrentDBDocument
items = UnwrapElement(IN[0])
incopenings = IN[1]
incshadows = IN[2]
incwalls = IN[3]
incshared = IN[4]
elementlist = list()

for item in items:
	itemlist = list()
	try:
		for insert in item.FindInserts(incopenings,incshadows,incwalls,incshared):
			itemlist.append(doc.GetElement(insert).ToDSType(True))
	except:
		itemlist.append(list())
	elementlist.append(itemlist)
OUT = elementlist
# ----------------------------------------
return_list_or_single_value = Custom[Return List Or Single Value](list_1=turn_into_list, list_2=python_script)  # If the list in input #1 only contains one item, only the first item of the list in input #2 will be returned.
Inserts = Output(return_list_or_single_value)
