# Dynamo custom node Element.Level.dyf (Dynamo 0.7.2.2114)
# category: CAAD_RWTH.Revit.Elements.Element.Query
# Gets an element's level

element_s = Input()  # "element(s)"
turn_into_list = Custom[Turn Into List](item=element_s)  # Turns an element (or a nested list) into a flat list
python_script = Python(IN[0]=turn_into_list)
# ---------- python_script.python (24 lines) ----------
import clr
clr.AddReference('RevitAPI')
from Autodesk.Revit.DB import *

clr.AddReference("RevitNodes")
import Revit
clr.ImportExtensions(Revit.Elements)

clr.AddReference("RevitServices")
import RevitServices
from RevitServices.Persistence import DocumentManager

doc = DocumentManager.Instance.CurrentDBDocument
faminsts = UnwrapElement(IN[0])
elementlist = list()
for item in faminsts:
	try:	
		elementlist.append(doc.GetElement(item.LevelId).ToDSType(True))
	except:
		try:
			elementlist.append(item.Level.ToDSType(True))
		except:
			elementlist.append(list())
OUT = elementlist
# ----------------------------------------
return_list_or_single_value = Custom[Return List Or Single Value](list_1=turn_into_list, list_2=python_script)  # If the list in input #1 only contains one item, only the first item of the list in input #2 will be returned.
host_s = Output(return_list_or_single_value)  # "host(s)"
