# Dynamo custom node Filter Views By Type.dyf (Dynamo 0.7.2.3911)
# category: CAAD_RWTH.Revit.Views.View.Actions
# Filters a list of views by their respective types.

View_s = Input()  # "View(s)"
turn_into_list = Custom[Turn Into List](item=View_s)  # Turns an element (or a nested list) into a flat list
python_script = Python(IN[0]=turn_into_list)
# ---------- python_script.python (59 lines) ----------
import clr
clr.AddReference('RevitAPI')
from Autodesk.Revit.DB import *

clr.AddReference("RevitNodes")
import Revit
clr.ImportExtensions(Revit.Elements)

views = UnwrapElement(IN[0])
floorplanlist = list()
ceilingplanlist = list()
elevationlist = list()
axolist = list()
perspectivelist = list()
schedulelist = list()
draftinglist = list()
legendlist = list()
areaplanlist = list()
sectionlist = list()
detaillist = list()
walkthroughlist = list()
renderinglist = list()
others = list()

for view in views:
	if str(view.ViewType) == 'FloorPlan':
		floorplanlist.append(view.ToDSType(True))
	elif str(view.ViewType) == 'CeilingPlan':
		ceilingplanlist.append(view.ToDSType(True))
	elif str(view.ViewType) == 'Elevation':
		elevationlist.append(view.ToDSType(True))
	elif str(view.ViewType) == 'ThreeD':
		# view templates and perspective views don't mix well (exception!), so let's ask for view templates first
		if view.IsTemplate:
			axolist.append(view.ToDSType(True))
		elif view.IsPerspective:
			perspectivelist.append(view.ToDSType(True))
		else:
			axolist.append(view.ToDSType(True))
	# maybe also include column and panel schedules here in the future...
	elif str(view.ViewType) == 'Schedule':
		schedulelist.append(view.ToDSType(True))
	elif str(view.ViewType) == 'DraftingView':
		draftinglist.append(view.ToDSType(True))
	elif str(view.ViewType) == 'Legend':
		legendlist.append(view.ToDSType(True))
	elif str(view.ViewType) == 'AreaPlan':
		areaplanlist.append(view.ToDSType(True))
	elif str(view.ViewType) == 'Section':
		sectionlist.append(view.ToDSType(True))
	elif str(view.ViewType) == 'Detail':
		detaillist.append(view.ToDSType(True))
	elif str(view.ViewType) == 'Walkthrough':
		walkthroughlist.append(view.ToDSType(True))
	elif str(view.ViewType) == 'Rendering':
		renderinglist.append(view.ToDSType(True))
	else:
		others.append(view.ToDSType(True))
OUT = (floorplanlist,ceilingplanlist,elevationlist,axolist,perspectivelist,schedulelist,draftinglist,legendlist,areaplanlist,sectionlist,detaillist,walkthroughlist,renderinglist,others)
# ----------------------------------------
code_block = CodeBlock(seq=python_script) { seq[0]; seq[1]; seq[2]; seq[3]; seq[4]; seq[5]; seq[6]; seq[7]; seq[8]; seq[9]; seq[10]; seq[11]; seq[12]; seq[13]; }
Floor_Plans = Output(code_block.out0)
Ceiling_Plans = Output(code_block.out1)
Elevations = Output(code_block.out2)
Axonometric_Views = Output(code_block.out3)
Perspective_Views = Output(code_block.out4)
Schedules = Output(code_block.out5)
Drafting_Views = Output(code_block.out6)
Legends = Output(code_block.out7)
Area_Plans = Output(code_block.out8)
Sections = Output(code_block.out9)
Details = Output(code_block.out10)
Walkthroughs = Output(code_block.out11)
Renderings = Output(code_block.out12)
Other = Output(code_block.out13)
