# Dynamo custom node Geometry.ClosestTo.dyf (Dynamo 0.7.2.26383)
# category: CAAD_RWTH.Geometry.Geometry.Query

geometry = Input()
other = Input()
code_block = CodeBlock(seq1=geometry, p=other) { seq2 = seq1.DistanceTo(p); mind = List.MinimumItem(seq2); }
formula = Formula("a=b", code_block.seq2, code_block.mind)
filterByBoolMask = List.FilterByBoolMask(geometry, formula)
Closest_object = Output(filterByBoolMask)
closestPointTo = Geometry.ClosestPointTo(filterByBoolMask, other)
Closest_point = Output(closestPointTo)
