# Dynamo custom node Geometry.FaceVerticesByIndex.dyf (Dynamo 0.7.2.26383)
# category: CAAD_RWTH.Geometry.Geometry.Query
# Retrieves the vertices of an objects face (face specified by index).

geometry = Input()
turn_into_list = Custom[Turn Into List](item=geometry)  # Turns an element (or a nested list) into a flat list
index = Input()
code_block = CodeBlock(obj=turn_into_list, index=index)
# ---------- code_block.designscript (3 lines) ----------
faces = List.Transpose(obj.Faces);
// get the curves of the specified face of each solid
curvelist = faces[index].PerimeterCurves().StartPoint;
# ----------------------------------------
return_list_or_single_value = Custom[Return List Or Single Value](list_1=turn_into_list, list_2=code_block.curvelist)  # If the list in input #1 only contains one item, only the first item of the list in input #2 will be returned.
vertices = Output(return_list_or_single_value)
