# Dynamo custom node Geometry.FurthestFrom.dyf (Dynamo 0.7.2.26383)
# category: CAAD_RWTH.Geometry.Geometry.Query
# Finds the furthest entity in a list of geometric entities from another given entity

geometry = Input()
other = Input()
code_block = CodeBlock(seq1=geometry, p=other) { seq2 = seq1.DistanceTo(p); maxd = List.MaximumItem(seq2); }
formula = Formula("a=b", code_block.seq2, code_block.maxd)
filterByBoolMask = List.FilterByBoolMask(geometry, formula)
Furthest_object = Output(filterByBoolMask)
