# Dynamo custom node Get Buckyball Struts.dyf (Dynamo 0.7.2.3911)
# category: CAAD_RWTH.Geometry.Buckyball.Helpers
# Parses the vertices of an (unscaled) truncated icosahedron and returns a pair of XYZs for each strut.

list = Input()
restOfItems = List.RestOfItems(list)
count = List.Count(restOfItems)
formula = Formula("x>1", x=count, lacing=Longest)
firstItem = List.FirstItem(list)
# note: Measure distance between first point in list and all other points
distanceTo = Geometry.DistanceTo(firstItem, restOfItems, lacing=Longest)
ZAxis = Vector.ZAxis()
asPoint = Vector.AsPoint(ZAxis, lacing=Longest)
number = DoubleInput(2)
# note: Create a reference strut length
scale = Geometry.Scale(asPoint, number, lacing=Longest)
byCoordinates = Point.ByCoordinates(lacing=Longest)
distanceTo_2 = Geometry.DistanceTo(scale, byCoordinates, lacing=Longest)
# note: Filter out all points that do not have a distnace of 2 to the first point.
formula_2 = Formula("x=y", distanceTo, distanceTo_2, lacing=Longest)
filterByBoolMask = List.FilterByBoolMask(restOfItems, formula_2)
isEmpty = List.IsEmpty(filterByBoolMask)
struts = Input()
create_list = List.Create(firstItem)
map = List.Map(filterByBoolMask, create_list)
# note: If there are any points that are directly adjacent (i.e. distance = 2), add them to the list
join = List.Join(struts, map)
if_ = If(isEmpty, struts, join)
get_buckyball_struts = Custom[Get Buckyball Struts](list=restOfItems, struts=if_)  # Parses the vertices of an (unscaled) truncated icosahedron and returns a pair of XYZs for each strut.
if_2 = If(formula, get_buckyball_struts.struts, if_)
struts_2 = Output(if_2)  # "struts"
empty = List.Empty()
# note: Continue processing the list recursively until there's only one point left. By always removing the first point from the list, we ensure that no duplicate struts are computed.
if_3 = If(formula, get_buckyball_struts.list, empty)
list_2 = Output(if_3)  # "list"
