# Dynamo custom node Get Phase by Name.dyf (Dynamo 0.7.2.3911)
# category: CAAD_RWTH.Revit.Elements.Phase.Create
# Returns the phase of a given name (if it exists)

list_phases = Custom[List Phases]()  # Lists all phases in the active document
name = Element.Name(list_phases)
turn_into_list = Custom[Turn Into List](item=name)  # Turns an element (or a nested list) into a flat list
str = Input()
eq = _ == str
map = List.Map(turn_into_list, eq)
filterByBoolMask = List.FilterByBoolMask(list_phases, map)
code_block = CodeBlock(result=filterByBoolMask) { first = List.FirstItem(result); cond = List.IsEmpty(result); cond ? result : first; }
phase = Output(code_block.out2)
