# Dynamo custom node Get Third XYZ Axis.dyf (Dynamo 0.7.2.6209)
# category: CAAD_RWTH.Geometry.Vector.Create
# Given two main XYZ axes (or vectors pointing more or less in thei general direction), this node will find the third axis.

xyz_axis_1 = Input()  # "xyz (axis 1)"
fromVector = Custom[XYZAxis.FromVector](Vector=xyz_axis_1)  # Returns whichever main axis (X, Y or Z) is closest to a given vector
xyz_axis_2 = Input()  # "xyz (axis 2)"
fromVector_2 = Custom[XYZAxis.FromVector](Vector=xyz_axis_2)
best_fit_plane = CodeBlock(axis1=fromVector, axis2=fromVector_2)
# ---------- best_fit_plane.designscript (10 lines) ----------
XYZs = {Point.Origin(),axis1.AsPoint(),axis2.AsPoint()};
// Make a plane based on the given axes and the origin
pl = Plane.ByBestFitThroughPoints(XYZs);
// The normal of that plane is the vector of the third axis
vec = pl.Normal();
Vector.ByCoordinates(1,1,1).Normalized();
// Set up a nested condition and find the main direction of the vector
cond1 = Math.Abs(vec.Y) > Math.Abs(vec.X) && Math.Abs(vec.Y) > Math.Abs(vec.Z);
cond2 = Math.Abs(vec.X) > Math.Abs(vec.Y) && Math.Abs(vec.X) > Math.Abs(vec.Z);
cond2 ? "X" : (cond1 ? "Y" : "Z");
# ----------------------------------------
correctOrientation = Custom[Correct Normal Orientation](a=best_fit_plane.vec, b=best_fit_plane.out3)  # "Normal.CorrectOrientation"; Inverts normal A if its inversion is closer to normal B
xyz = Output(correctOrientation)
string = Output(best_fit_plane.out6)
