# Dynamo custom node Horizontal Intersects For Divided Surface by Endpoints and Function.dyf (Dynamo 0.7.2.3911)
# category: CAAD_RWTH.Revit.Elements.DividedSurface.Actions
# Creates a number of horizontal intersects (levels)for a divided surface based on the path between two points. The spacing of the intersects can be controlled by a function.

DivSurf = Input()
f_x = Input()  # "f(x)"
Subdivisions = Input()
Startpoint = Input()
Endpoint = Input()
code_block = CodeBlock(sd=Subdivisions, p1=Startpoint, p2=Endpoint) { sd+1; String.FromObject(1..sd); p1.Z; p2.Z; }
normalized_sequence_by_function = Custom[Normalized Sequence by Function](f_x=f_x, N=code_block.out0)  # Creates a sequence of N values between 0 and 1 driven by a function
scale_normalized_value = Custom[Scale Normalized Value](val=normalized_sequence_by_function, Min=code_block.out2, Max=code_block.out3)  # Scales a normalized value according to a given minimum and maximum
code_block_2 = CodeBlock(seq=scale_normalized_value) { seq2 = List.RestOfItems(seq); List.TakeItems(seq2,List.Count(seq2)-1); }
Intersect_Name = Input()
concat = String.Concat(Intersect_Name)
map = List.Map(code_block.out1, concat)
byElevationAndName = Level.ByElevationAndName(code_block_2.out1, map, lacing=Longest)
add_intersect_to_divided_surface = Custom[Add Intersect To Divided Surface](DivSurf=DivSurf, Element_s=byElevationAndName)  # Adds an intersect to a divided surface
DivSurf_2 = Output(add_intersect_to_divided_surface)  # "DivSurf"
Intersects = Output(byElevationAndName)
