# Dynamo custom node Horizontal Intersects For Divided Surface by Endpoints.dyf (Dynamo 0.7.2.3911)
# category: CAAD_RWTH.Revit.Elements.DividedSurface.Actions
# Creates a number of equally spaced horizontal intersects for a divided surface based on the path between between two points. PLEASE NOTE: This node will currently (v 0.6.3) only work correctly if Dynamo project units are set to metric feet.

DivSurf = Input()
Subdivisions = Input()
normalized_sequence = Custom[Normalized Sequence](N=Subdivisions)  # Creates a sequence of N values between 0 and 1
Startpoint = Input()
Endpoint = Input()
code_block = CodeBlock(sd=Subdivisions, p1=Startpoint, p2=Endpoint) { String.FromObject(1..sd); p1.Z; p2.Z; }
scale_normalized_value = Custom[Scale Normalized Value](val=normalized_sequence, Min=code_block.out1, Max=code_block.out2)  # Scales a normalized value according to a given minimum and maximum
code_block_2 = CodeBlock(seq=scale_normalized_value) { seq2 = List.RestOfItems(seq); List.TakeItems(seq2,List.Count(seq2)-1); }
Intersect_Name = Input()
concat = String.Concat(Intersect_Name)
map = List.Map(code_block.out0, concat)
byElevationAndName = Level.ByElevationAndName(code_block_2.out1, map)
add_intersect_to_divided_surface = Custom[Add Intersect To Divided Surface](DivSurf=DivSurf, Element_s=byElevationAndName)  # Adds an intersect to a divided surface
DivSurf_2 = Output(add_intersect_to_divided_surface)  # "DivSurf"
Intersects = Output(byElevationAndName)
