# Dynamo custom node List BuiltInParameters.dyf (Dynamo 0.7.2.3911)
# category: CAAD_RWTH.Revit.Document.Query
# List all the BuiltInCategories available

string = StringInput("\w*__\w*")
python_script = Python(IN[0]=string)
# ---------- python_script.python (7 lines) ----------
import clr
clr.AddReference('RevitAPI')
clr.AddReference('RevitAPIUI')
from Autodesk.Revit.DB import *
import Autodesk

OUT = dir(BuiltInParameter)
# ----------------------------------------
filter_list_by_regular = Custom[Filter List by Regular Expression Matches](regex=string, list=python_script)  # Filters out all items from a list of strings that don't begin with the regular expression. The syntax for regular expressions is explained at http://ironpython-test.readthedocs.org/en/latest/howto/regex.html
list = Output(filter_list_by_regular.out)
