# Dynamo custom node Match Regular Expression.dyf (Dynamo 0.7.2.38829)
# category: CAAD_RWTH.Core.String.Actions
# Determines if a regular expression matches a string (or a list of strings) and returns a boolean value (or a list, depending on the input). The syntax for regular expressions is explained at
# http://ironpython-test.readthedocs.org/en/latest/howto/regex.html

string_s = Input()  # "string(s)"
turn_into_list = Custom[Turn Into List](item=string_s)  # Turns an element (or a nested list) into a flat list
regex = Input()
python_script = Python(IN[0]=regex, IN[1]=turn_into_list)
# ---------- python_script.python (13 lines) ----------
import clr
import re

regexstring = IN[0]
regexlist = IN[1]
elementlist = list()
thisexp = re.compile(regexstring)
for item in regexlist:
	if (str(thisexp.match(item)) == 'None'):
		elementlist.append(False)
	else:
		elementlist.append(True)
OUT = elementlist
# ----------------------------------------
return_list_or_single_value = Custom[Return List Or Single Value](list_1=turn_into_list, list_2=python_script)  # If the list in input #1 only contains one item, only the first item of the list in input #2 will be returned.
bool = Output(return_list_or_single_value)
