# Dynamo custom node Mesh-Plane Intersection.dyf (Dynamo 0.7.2.3911)
# category: CAAD_RWTH.Geometry.Mesh.Actions
# Calculates the intersection of a mesh and a plane

string = StringInput("X")
Plane = Input()
# note: Determine general orientation of cutting plane
plane_properties = Custom[Plane Properties](Plane_s=Plane)
best_fit_plane = CodeBlock { p = Plane.ByBestFitThroughPoints(XYZs); p.Normal.AsPoint(); p.Origin; }
# note: Determine general orientation of mesh
map = List.Map(arg1=best_fit_plane.out1)
code_block = CodeBlock(pts=map) { Math.Average(pts.X); Math.Average(pts.Y); Math.Average(pts.Z); }
byCoordinates = Point.ByCoordinates(code_block.out0, code_block.out1, code_block.out2, lacing=Longest)
get_third_xyz_axis = Custom[Get Third XYZ Axis](xyz_axis_1=plane_properties.Normal_s, xyz_axis_2=byCoordinates)  # Given two main XYZ axes (or vectors pointing more or less in thei general direction), this node will find the third axis.
# note: Determine which axis should be used for sorting the points
eq = string == get_third_xyz_axis.string
Mesh = Input()
faceVertices = Custom[Mesh.FaceVertices](Mesh=Mesh)  # Gets the vertices of each face of a given mesh
lines_through_points_closed_loop = Custom[Lines Through Points (Closed Loop)]()  # Works just like the built-in node Lines Through Points (creates a series of lines through a list of points) - except that it creates a *closed* loop of lines.
# note: From Mesh to Curves
map_2 = List.Map(faceVertices, lines_through_points_closed_loop)
intersect = Geometry.Intersect(map_2, Plane, lacing=Longest)
flatten = Flatten(intersect)
X = Point.X(lacing=Longest)
# note: Sorting of intersection points
sortByKey = SortByKey(flatten, X)
string_2 = StringInput("Y")
eq_2 = get_third_xyz_axis.string == string_2
Y = Point.Y(lacing=Longest)
sortByKey_2 = SortByKey(flatten, Y)
Z = Point.Z(lacing=Longest)
sortByKey_3 = SortByKey(flatten, Z)
if_ = If(eq_2, sortByKey_2, sortByKey_3)
if_2 = If(eq, sortByKey, if_)
firstItem = List.FirstItem(if_2)
create_list = List.Create(firstItem)
restOfItems = List.RestOfItems(if_2)
number = DoubleInput(2)
number_2 = DoubleInput(0)
takeEveryNthItem = List.TakeEveryNthItem(restOfItems, number, number_2)
join = List.Join(create_list, takeEveryNthItem)
lastItem = List.LastItem(if_2)
create_list_2 = List.Create(lastItem)
# note: Create list of unique, ordered intersection points
join_2 = List.Join(join, create_list_2)
XYZ = Output(join_2)
reverse = List.Reverse(join_2)
restOfItems_2 = List.RestOfItems(reverse)
byStartPointEndPoint = Line.ByStartPointEndPoint(reverse, restOfItems_2)
Lines = Output(byStartPointEndPoint)
byControlPoints = NurbsCurve.ByControlPoints(join_2, lacing=Longest)
Nurbs_Spline = Output(byControlPoints)
byPoints = NurbsCurve.ByPoints(join_2, lacing=Longest)
Hermite_Spline = Output(byPoints)
