# Dynamo custom node Offset Quadrilateral Pattern U-Edge Along Angle Bisectors.dyf (Dynamo 0.6.3.5259)
# category: CAAD_RWTH._WIP_
# Offsets the points of a quadrilateral pattern along their angle bisectors in U direction. The offset points are located at the intersection of the angle bisectors and the offset base plane of each quad.

Point_Index_1 = Input()
Quad_Patterns = Input()
transpose_lists = Transpose(Quad_Patterns)
get_from_list = GetFromList(Point_Index_1, transpose_lists)
list_length = Length(get_from_list)
V = Input()
# note: Take first V points from first index and offset them orthogonally
take_from_list = TakeList(V, get_from_list)
plane_from_first_3_xyzs = Custom[Plane From First 3 XYZs]()  # Returns a plane, its origin and its normal based on the first three XYZs in a given list
Plane_Index_First_Row = Input()  # "Plane Index (First Row)"
# note: Take three different points to form the planes for the first row in case we run into non-planar panels
shift_list_indices = ShiftList(Plane_Index_First_Row)
take_from_list_2 = TakeList(V, Quad_Patterns)
map = Map(shift_list_indices, take_from_list_2)
map_2 = Map(plane_from_first_3_xyzs.normal, map)
Flip_Offset = Input()
Offset = Input()
formula = Formula("-x", x=Offset, lacing=Longest)
# note: Flip offset (if applicable)
if_ = Conditional(Flip_Offset, formula, Offset)
scale_xyz = XyzScale(map_2, if_, lacing=Longest)
add_xyzs = XyzAdd(take_from_list, scale_xyz, lacing=Longest)
formula_2 = Formula("n-v", n=list_length, v=V, lacing=Longest)
Point_Index_2 = Input()
# note: Get points for both indices
get_from_list_2 = GetFromList(Point_Index_2, transpose_lists)
# note: Drop last V points of second index
take_from_list_3 = TakeList(formula_2, get_from_list_2)
angle_bisector = Custom[Angle Bisector]()  # Retrieves the vector of an angle bisector at point B based on three points (A, B, C) that define the angle.
# note: Drop last V points of first index
take_from_list_4 = TakeList(formula_2, get_from_list)
# note: Drop first V points of second index
drop_from_list = DropList(V, get_from_list_2)
# note: Compute angle bisector vectors for all points in each row except the first and the last.
combine = Combine(angle_bisector, take_from_list_4, take_from_list_3, drop_from_list)
plane_from_first_3_xyzs_2 = Custom[Plane From First 3 XYZs]()
Plane_Index_Field = Input()  # "Plane Index (Field)"
shift_list_indices_2 = ShiftList(Plane_Index_Field)
map_3 = Map(shift_list_indices_2, Quad_Patterns)
# note: Get surface normals for all panels (use the three points closest to the bisector in case we run into non-planar panels)
map_4 = Map(plane_from_first_3_xyzs_2.normal, map_3)
scale_xyz_2 = XyzScale(map_4, if_, lacing=Longest)
take_from_list_5 = TakeList(formula_2, scale_xyz_2)
add_xyzs_2 = XyzAdd(take_from_list_3, take_from_list_5, lacing=Longest)
# note: Scale surface normal by panel thickness and add to basepoint to get an origin for the offset plane
take_from_list_6 = TakeList(formula_2, map_4)
# note: Find intersection of offset plane and angle bisector
plane_vector_intersection = Custom[Plane-Vector Intersection](Vector_Basepoint=take_from_list_3, Vector_Normalized=combine, Plane_Origin=add_xyzs_2, Plane_Normal=take_from_list_6)  # Finds the intersection point between a plane and a vector
# note: Take last V points from second index and offset them orthogonally
drop_from_list_2 = DropList(formula_2, get_from_list_2)
drop_from_list_3 = DropList(formula_2, scale_xyz_2)
add_xyzs_3 = XyzAdd(drop_from_list_2, drop_from_list_3, lacing=Longest)
# note: Put the first row, all the computed intersections and the last row into a single list
list = NewList(index0=add_xyzs, index1=plane_vector_intersection, index2=add_xyzs_3)
flatten_completely = FlattenList(list)
number = DoubleInput(1)
build_sublists = Sublists("0,v", flatten_completely, number, V, lacing=Longest)
take_from_list_7 = TakeList(list_length, build_sublists)
XYZs = Output(take_from_list_7)
