# Dynamo custom node Only ToRoom OR FromRoom Is Set.dyf (Dynamo 0.7.2.26223)
# category: CAAD_RWTH.Revit.Elements.DoorOrWindow.Query
# Evaluates if a door or window has only set one of the ToRoom / FromRoom properties. This may help to determine whether a door/window is external.

Doors_Windows = Input()  # "Doors/Windows"
turn_into_list = Custom[Turn Into List](item=Doors_Windows)  # Turns an element (or a nested list) into a flat list
Phase = Input()
fromDoorOrWindow = Custom[Rooms From Doors And Windows](Door_s_Window_s=turn_into_list, Phase=Phase)  # "Room.FromDoorOrWindow"; Gets the rooms that are connected by a given door or a window
isEmpty = List.IsEmpty()
map = List.Map(fromDoorOrWindow.From_Room_s, isEmpty)
isNull = Object.IsNull(map)
map_2 = List.Map(fromDoorOrWindow.To_Room_s, isEmpty)
isNull_2 = Object.IsNull(map_2)
code_block = CodeBlock(a=isNull, b=isNull_2) { List.Transpose({a,b}); }
true_for_all_booleans = Custom[True For All (Boolean)]()  # Returns true if all items in a list of booleans are true.
map_3 = List.Map(code_block, true_for_all_booleans)
bool = Output(map_3)
