# Dynamo custom node Perform Action And Save Image.dyf (Dynamo 0.6.3.5244)
# category: CAAD_RWTH._WIP_
# Performs the specified function and saves an image of the active view.

# note: Based on a post by Michael Kirschner:
# http://autodeskvasari.com/profiles/blogs/part-1-changing-a-family-instance-and-saving-an-image
f_x = Input()  # "f(x)"
x = Input()
apply_function = Apply1(arg1=f_x, x)
transaction = Transaction(apply_function)
get_active_view = ActiveRevitView(lacing=Longest)
path = Input()
string = StringInput("\")
filename = Input()
string_2 = StringInput("_")
to_string = ToString(x)
concat_strings = ConcatStrings(s3=path, s4=string, s5=filename, string_2, to_string)
save_image_of_view = SaveImageFromRevitView(get_active_view, concat_strings, lacing=Longest)
transaction_2 = Transaction(save_image_of_view)
perform_all = Begin(expr1=transaction, expr2=transaction_2)
result = Output(perform_all)
