# Dynamo custom node Plane From Planar Face.dyf (Dynamo 0.7.2.38829)
# category: CAAD_RWTH.Geometry.Plane.Create
# Creates a plane from a planar face

Planar_face_s = Input()  # "Planar face(s)"
turn_into_list = Custom[Turn Into List](item=Planar_face_s)  # Turns an element (or a nested list) into a flat list
python_script = Python(IN[0]=turn_into_list)
# ---------- python_script.python (14 lines) ----------
import clr
clr.AddReference('RevitAPI')
clr.AddReference('RevitAPIUI')
from Autodesk.Revit.DB import *
import Autodesk

items = IN[0]
normallist = list()
originlist = list()

for item in items:
	normallist.append(item.Normal)
	originlist.append(item.Origin)
OUT = (normallist,originlist)
# ----------------------------------------
number = DoubleInput(1)
getItemAtIndex = List.GetItemAtIndex(python_script, number)
firstItem = List.FirstItem(python_script)
asVector = Point.AsVector(firstItem)
byOriginNormal = Plane.ByOriginNormal(getItemAtIndex, asVector, lacing=Longest)
Plane_s = Output(byOriginNormal)  # "Plane(s)"
Origin_s = Output(getItemAtIndex)  # "Origin(s)"
Normal_s = Output(firstItem)  # "Normal(s)"
