# Dynamo custom node Quadrilateral Pattern (Alternating Rows).dyf (Dynamo 0.7.2.26223)
# category: CAAD_RWTH.Paneling.Patterns
# Creates groups of points from a list of UVs or XYZs for the placement of quadrilateral panels in alternating rows. The placement pattern can be reversed (boolean) and shifted (integer).

Rotate_grid_by_90 = Input()  # "Rotate grid by 90°"
list = Input()
swap = Custom[Swap UV](UV_s=list)  # "UV.Swap"; Swaps U and V coordinates
code_block = CodeBlock(gridrotation=Rotate_grid_by_90, UVswapped=swap, UVs=list) { gridrotation ? UVswapped : UVs; }
V = Input()
reverse = Input()  # "reverse?"
shift_placement = Input()
quadrilateral_pattern_from_grid = Custom[Quadrilateral Pattern From Grid](list=code_block, V=V, reverse=reverse, shift_placement=shift_placement)  # Creates groups of points from a list of UVs or XYZs for the placement of quadrilateral panels. The placement pattern can be reversed (boolean) and shifted (integer).
code_block_2 = CodeBlock(seq=quadrilateral_pattern_from_grid, V=V)
# ---------- code_block_2.designscript (6 lines) ----------
// Make rows
nested = List.Chop(seq,V);
// Odd rows
List.Flatten(List.DropEveryNthItem(nested,2,0),1);
// Even rows
List.Flatten(List.TakeEveryNthItem(nested,2,0),1);
# ----------------------------------------
Odd_rows = Output(code_block_2.out1)
Even_rows = Output(code_block_2.out2)
