# Dynamo custom node Quadrilateral Pattern (Checkerboard).dyf (Dynamo 0.7.2.26223)
# category: CAAD_RWTH.Paneling.Patterns
# Creates groups of points from a list of UVs or XYZs for the placement of quadrilateral panels in a checkerboard pattern. The placement pattern can be reversed (boolean) and shifted (integer).

list = Input()
V = Input()
reverse = Input()  # "reverse?"
shift_placement = Input()
quadrilateral_pattern_from_grid = Custom[Quadrilateral Pattern From Grid](list=list, V=V, reverse=reverse, shift_placement=shift_placement)  # Creates groups of points from a list of UVs or XYZs for the placement of quadrilateral panels. The placement pattern can be reversed (boolean) and shifted (integer).
code_block = CodeBlock(seq=quadrilateral_pattern_from_grid, V=V)
# ---------- code_block.designscript (8 lines) ----------
// Make rows
nested = List.Chop(seq,V);
// Odd rows
List.Flatten(List.DropEveryNthItem(nested,2,0),1);
// Even rows
List.Flatten(List.TakeEveryNthItem(nested,2,0),1);
0;
2;
# ----------------------------------------
dropEveryNthItem = List.DropEveryNthItem(arg1=code_block.out4, arg2=code_block.out3)
map = List.Map(code_block.out1, dropEveryNthItem)
takeEveryNthItem = List.TakeEveryNthItem(arg1=code_block.out4, arg2=code_block.out3)
map_2 = List.Map(code_block.out2, takeEveryNthItem)
map_3 = List.Map(code_block.out1, takeEveryNthItem)
map_4 = List.Map(code_block.out2, dropEveryNthItem)
code_block_2 = CodeBlock(a1=map, a2=map_2, b1=map_3, b2=map_4) { List.Flatten({a1,a2},2); List.Flatten({b1,b2},2); }
list_type_A = Output(code_block_2.out0)  # "list (type A)"
list_type_B = Output(code_block_2.out1)  # "list (type B)"
