# Dynamo custom node Quadrilateral Pattern From Grid.dyf (Dynamo 0.7.2.26223)
# category: CAAD_RWTH.Paneling.Patterns
# Creates groups of points from a list of UVs or XYZs for the placement of quadrilateral panels. The placement pattern can be reversed (boolean) and shifted (integer).

list = Input()
V = Input()
code_block = CodeBlock(v=V)
# ---------- code_block.designscript (2 lines) ----------
// Default placement pattern (counter-clockwise)
pat = {0,v+1,v+2,1};
# ----------------------------------------
shift_placement = Input()
reverse = Input()  # "reverse?"
shift_placement_and_reverse = Custom[Shift Placement And Reverse](list=code_block, shift=shift_placement, reverse=reverse)  # Shifts (integer) and reverses (bool) a given list
code_block_2 = CodeBlock(seq=list, pat=shift_placement_and_reverse)
# ---------- code_block_2.designscript (2 lines) ----------
// Create sublists using placement pattern
List.Sublists(seq,{pat[0],pat[1],pat[2],pat[3]},1);
# ----------------------------------------
n1 = Custom[+1](V)  # Increments a value by 1
# note: Unclutter
drop_last_row_and_column_from_uv = Custom[Drop Last Row & Column From UV Field](list=code_block_2, V=n1)  # "Drop Last Row And Column From UV Field"; Drops the last row and column from a UV field
list_2 = Output(drop_last_row_and_column_from_uv)  # "list"
