# Dynamo custom node Quadrilateral Pattern Offset Along Angle Bisectors (U).dyf (Dynamo 0.6.3.5259)
# category: CAAD_RWTH._WIP_
# Offsets a quadrilateral pattern from its original position.
# PLEASE NOTE:
# New quads will join along angle bisectors in U direction *only*. Offsets in V direction do *not* run along surface normals and will likely produce *gaps* on doubly curved surfaces.

Quad_Patterns = Input()
number = DoubleInput(0)
number_2 = DoubleInput(1)
V = Input()
Offset = Input()
Flip_Offset = Input()
offset_quadrilateral_pattern_u = Custom[Offset Quadrilateral Pattern U-Edge Along Angle Bisectors](Quad_Patterns=Quad_Patterns, Index_1=number, Index_2=number_2, V=V, Offset=Offset, Flip_Offset=Flip_Offset)  # Offsets the points of a quadrilateral pattern along their angle bisectors in U direction. The offset points are located at the intersection of the angle bisectors and the offset base plane of each quad.
list_length = Length(offset_quadrilateral_pattern_u)
formula = Formula("N-V", N=list_length, V=V, lacing=Longest)
number_3 = DoubleInput(1)
build_sublists = Sublists("0,3", offset_quadrilateral_pattern_u, number_3, lacing=Longest)
take_from_list = TakeList(formula, build_sublists)
transpose_lists = Transpose(take_from_list)
# note: Reformat lists to sublist of 4 XYZs each
reverse = Reverse()
number_4 = DoubleInput(3)
number_5 = DoubleInput(2)
# note: Find offset XYZs for two opposite sides of the panel (in U direction)
offset_quadrilateral_pattern_u_2 = Custom[Offset Quadrilateral Pattern U-Edge Along Angle Bisectors](Quad_Patterns=Quad_Patterns, Index_1=number_4, Index_2=number_5, V=V, Offset=Offset, Flip_Offset=Flip_Offset)
build_sublists_2 = Sublists("0,3", offset_quadrilateral_pattern_u_2, number_3, lacing=Longest)
take_from_list_2 = TakeList(formula, build_sublists_2)
map = Map(reverse, take_from_list_2)
transpose_lists_2 = Transpose(map)
list = NewList(index0=transpose_lists, index1=transpose_lists_2)
number_6 = DoubleInput(1)
flatten = FlattenListAmt(list, number_6)
transpose_lists_3 = Transpose(flatten)
XYZs = Output(transpose_lists_3)
