# Dynamo custom node Remove Duplicate Revit Elements From List.dyf (Dynamo 0.7.2.3911)
# category: CAAD_RWTH.Revit.Elements.Element.Actions
# Removes all duplicates of Revit elements from a given list. (Will also remove any other duplicates from a list...)

list = Input()
elements_to_ids = Custom[Elements to IDs](Element_s=list)  # Gets the ID(s) for a list of Revit elements (or a single element)
code_block = CodeBlock(ids=elements_to_ids.ID_s, unmatched=elements_to_ids.unmatched)
# ---------- code_block.designscript (4 lines) ----------
List.UniqueItems(ids);
cond = List.IsEmpty(unmatched);
unique_unmatched = List.UniqueItems(unmatched);
cond ? unmatched : unique_unmatched;
# ----------------------------------------
ids_to_elements = Custom[IDs to Elements](ID_s_or_UniqueId_s=code_block.out0)  # Gets the Revit element(s) for a list of IDs (or a single ID)
elements = Output(ids_to_elements.Element_s)
other = Output(code_block.out3)
