# Dynamo custom node Save As.dyf (Dynamo 0.6.3.22045)
# category: CAAD_RWTH.Revit
# Saves the active Revit document under the given name.

revit_document = RevitDocument(lacing=Longest)
filename = Input()
python_script_with_variable = Python(revit_document, filename)  # "Python Script With Variable Number of Inputs"
# ---------- python_script_with_variable.python (14 lines) ----------
import clr
clr.AddReference('RevitAPI')
clr.AddReference('RevitAPIUI')
from Autodesk.Revit.DB import *
import Autodesk

doc = IN0
path = IN1

if doc.IsFamilyDocument:
	path += '.rfa'
else:
	path += '.rvt'
OUT = doc.SaveAs(path)
# ----------------------------------------
result = Output(python_script_with_variable)
