# Dynamo custom node Search In Members.dyf (Dynamo 0.7.2.3911)
# category: CAAD_RWTH.Core.Object.Query
# Lets you search in an element's members. Search is case-sensitive. Use * as a wildcard.

search_term = Input()
string = StringInput("*")
string_2 = StringInput("\w*")
replace = String.Replace(search_term, string, string_2)
Element = Input()
turn_into_list = Custom[Turn Into List](item=Element)  # Turns an element (or a nested list) into a flat list
firstItem = List.FirstItem(turn_into_list)
get_members = Custom[Get Members](element_s=firstItem)  # Gets a list of all members (properties and methods) of a selected element
filter_list_by_regular = Custom[Filter List by Regular Expression Matches](regex=replace, list=get_members)  # Filters out all items from a list of strings that don't begin with the regular expression. The syntax for regular expressions is explained at http://ironpython-test.readthedocs.org/en/latest/howto/regex.html
results = Output(filter_list_by_regular.in)
