# Dynamo custom node Select Subcategory By Name.dyf (Dynamo 0.7.2.3911)
# category: CAAD_RWTH.Revit.Elements.Subcategory.Query
# Selects a subcategory for a given element category by name

current = Document.Current(lacing=Longest)
BuiltInCategory = Input()
Name = Input()
python_script = Python(IN[0]=current, IN[1]=BuiltInCategory, IN[2]=Name)
# ---------- python_script.python (15 lines) ----------
import clr
clr.AddReference('RevitAPI')
clr.AddReference('RevitAPIUI')
from Autodesk.Revit.DB import *
import Autodesk

doc = IN[0]
builtincat = IN[1]
subcatname = IN[2]

cat = doc.Settings.Categories.get_Item(builtincat)
try:
	OUT = cat.SubCategories.get_Item(subcatname)
except:
	OUT = list()
# ----------------------------------------
end = Revit.Transaction.Transaction.End(python_script)
Subcategory = Output(end)
