# Dynamo custom node SelectionSet.ByElements.dyf (Dynamo 0.7.2.3911)
# category: CAAD_RWTH.Revit.Selection
# Creates a selections set of the given elements

Element_s = Input()  # "Element(s)"
turn_into_list = Custom[Turn Into List](item=Element_s)  # Turns an element (or a nested list) into a flat list
Name = Input()
python_script = Python(IN[0]=turn_into_list, IN[1]=Name)
# ---------- python_script.python (48 lines) ----------
import clr
clr.AddReference('RevitAPI')
from Autodesk.Revit.DB import *
from System.Collections.Generic import *

clr.AddReference("RevitServices")
import RevitServices
from RevitServices.Persistence import DocumentManager
from RevitServices.Transactions import TransactionManager

doc = DocumentManager.Instance.CurrentDBDocument

# create itemset
items = UnwrapElement(IN[0])
ids = list()
for item in items:
	ids.append(item.Id)
itemset = List[ElementId](ids)

# test unique name for filter
# there is actually a method IsUniqueName provided with the filters
# but I'm having trouble calling it correctly
# so we use a workaround...
name = IN[1]
names = list()
counter = 2
uniquename = False
collector = FilteredElementCollector(doc)
filters = collector.OfClass(FilterElement).ToElements();
for filter in filters:
	names.append(str(filter.Name))
if name in names:
	while uniquename == False:
		tryname = name + str(counter)
		if tryname in names:
			counter += 1
		else:
			uniquename = tryname
else:
	uniquename = name

# now create the selection set with a unique name
TransactionManager.Instance.EnsureInTransaction(doc)
selset = SelectionFilterElement.Create(doc,uniquename)
for item in items:
	selset.AddSet(itemset)
TransactionManager.Instance.TransactionTaskDone()
OUT = selset
# ----------------------------------------
SelectionSet = Output(python_script)
