# Dynamo custom node Set Element Subcategory.dyf (Dynamo 0.7.2.3911)
# category: CAAD_RWTH.Revit.Elements.Element.Actions
# Assigns the given element(s) to the specified subcategory (0 for Cut, 1 for Projection).

Element_s = Input()  # "Element(s)"
turn_into_list = Custom[Turn Into List](item=Element_s)  # Turns an element (or a nested list) into a flat list
Subcategory = Input()
Cut_Projection = Input()  # "Cut/Projection"
python_script = Python(IN[0]=turn_into_list, IN[1]=Subcategory, IN[2]=Cut_Projection)
# ---------- python_script.python (28 lines) ----------
import clr
clr.AddReference('RevitAPI')
clr.AddReference('RevitAPIUI')
from Autodesk.Revit.DB import *
import Autodesk

items = IN[0]
subcat = IN[1]
gstyletype = IN[2]

if gstyletype == 0:
	gstyletype = GraphicsStyleType.Projection
else:
	gstyletype = GraphicsStyleType.Cut

elementlist = list()
faillist = list()
try:
	gstyle = subcat.GetGraphicsStyle(gstyletype)
	for item in items:
		try:
			item.Subcategory = gstyle
			elementlist.append(item)
		except:
			faillist.append(item)
	OUT = (elementlist,faillist)
except:
	OUT = 'Subcategory not found...'
# ----------------------------------------
end = Revit.Transaction.Transaction.End(python_script)
firstItem = List.FirstItem(end)
Success = Output(firstItem)
formula = Formula("1", lacing=Longest)
getItemAtIndex = List.GetItemAtIndex(end, formula)
Fail = Output(getItemAtIndex)
