# Dynamo custom node Surface.OrderedListOfVertices.dyf (Dynamo 0.7.2.26383)
# category: CAAD_RWTH.Geometry.Surface.Query
# Retrieves an ordered list of vertices from a given surface

Surface_s = Input()  # "Surface(s)"
perimeterCurves = Surface.PerimeterCurves(Surface_s)
byJoinedCurves = PolyCurve.ByJoinedCurves(perimeterCurves)
curves = PolyCurve.Curves(byJoinedCurves)
startPoint = Curve.StartPoint(curves)
Points = Output(startPoint)
