# Dynamo custom node Topography.IntersectionWithPlane.dyf "Topo-Plane Intersection" (Dynamo 0.7.2.3911)
# category: CAAD_RWTH.Revit.Elements.Topography.Actions
# Calculates the intersection of a toposurface and a plane

Plane = Input()
Topo = Input()
# note: Based on an idea of Marcello Sgambelluri
mesh = Topography.Mesh(Topo)
mesh_plane_intersection = Custom[Mesh-Plane Intersection](Plane=Plane, Mesh=mesh)  # Calculates the intersection of a mesh and a plane
XYZs = Output(mesh_plane_intersection.XYZ)
Lines = Output(mesh_plane_intersection.Lines)
Nurbs_Spline = Output(mesh_plane_intersection.Nurbs_Spline)
Hermite_Spline = Output(mesh_plane_intersection.Hermite_Spline)
