# Dynamo custom node Triangular Pattern (Flat, Diagonal) From Grid.dyf (Dynamo 0.7.2.26223)
# category: CAAD_RWTH.Paneling.Patterns
# Creates groups of points from a list of UVs or XYZs for the placement of triangular panels. The placement pattern can be reversed (boolean) and shifted (integer).

V = Input()
shift_overall_placement = Input()
rotate_grid_by_90 = Input()  # "rotate grid by 90°"
list = Input()
swap = Custom[Swap UV](UV_s=list)  # "UV.Swap"; Swaps U and V coordinates
code_block = CodeBlock(V=V, shift=shift_overall_placement, rotate=rotate_grid_by_90, seq_swapped=swap, seq=list)
# ---------- code_block.designscript (10 lines) ----------
// Create placement pattern
pat1 = {0,V+1,V+2,1};
// Shift overall placement pattern
pat2 = List.ShiftIndices(pat1,shift);
pat2[0];
pat2[1];
pat2[2];
pat2[3];
// Rotate coordinates (if applicable)
rotate ? seq_swapped : seq;
# ----------------------------------------
n1 = Custom[+1](V)  # Increments a value by 1
reverse_triangle_A = Input()  # "reverse (triangle A)"
shift_placement_triangle_A = Input()  # "shift placement (triangle A)"
triangular_subpattern = Custom[Triangular Subpattern](list=code_block.out6, V=n1, Reverse_Pattern=reverse_triangle_A, Shift_Pattern=shift_placement_triangle_A, Point1=code_block.out4, Point2=code_block.out5, Point3=code_block.out2)  # Subcomponent of the Triangular Pattern From Grid node.
list_triangle_A = Output(triangular_subpattern)  # "list (triangle A)"
reverse_triangle_B = Input()  # "reverse (triangle B)"
shift_placement_triangle_B = Input()  # "shift placement (triangle B)"
triangular_subpattern_2 = Custom[Triangular Subpattern](list=code_block.out6, V=n1, Reverse_Pattern=reverse_triangle_B, Shift_Pattern=shift_placement_triangle_B, Point1=code_block.out2, Point2=code_block.out3, Point3=code_block.out4)
list_triangle_B = Output(triangular_subpattern_2)  # "list (triangle B)"
