# Dynamo custom node Triangular Pattern (Flat, Mirrored) From Grid.dyf (Dynamo 0.7.2.26223)
# category: CAAD_RWTH.Paneling.Patterns
# Creates groups of points from a list of UVs or XYZs for the placement of triangular panels. The placement pattern can be reversed (boolean) and shifted (integer).

code_block = CodeBlock { {0..n}; }
Rotate_grid_by_90 = Input()  # "Rotate grid by 90°"
list = Input()
swap = Custom[Swap UV](UV_s=list)  # "UV.Swap"; Swaps U and V coordinates
V = Input()
Shift_Rows_bool = Input()  # "Shift Rows (bool)"
isEvenNumber = Custom[Is Even Number](val=V)  # "Math.IsEvenNumber"; Checks if a number is even.
isOddNumber = Custom[Is Odd Number](val=V)  # "Math.IsOddNumber"; Checks if a number is odd.
code_block_2 = CodeBlock(rotate=Rotate_grid_by_90, seq1_swapped=swap, seq1=list, V=V, shiftrows=Shift_Rows_bool, is_even=isEvenNumber, shift_rows=Shift_Rows_bool, is_odd=isOddNumber)
# ---------- code_block_2.designscript (19 lines) ----------
// DATA
// Rotate entire grid by 90°?
seq2 = rotate ? seq1_swapped : seq1;
// Make rows
rows = List.Sublists(seq2,{0..(2*V+1)},V+1);
// Odd rows
odd = List.DropEveryNthItem(rows,2,0);
// Even rows
even = List.TakeEveryNthItem(rows,2,0);
// Left corners, standing & Rows, standing
shiftrows ? even : odd;
// Left corners, lying & Rows, lying
shiftrows ? odd : even;
// Right corners, standing
cond_rcs = (is_even && !(shift_rows)) || (is_odd && shift_rows);
cond_rcs ? odd : even;
// Right corners, lying
cond_rcl = (is_even && shift_rows) || (is_odd && !(shift_rows));
cond_rcl ? odd : even;
# ----------------------------------------
code_block_3 = CodeBlock(V=V)
# ---------- code_block_3.designscript (9 lines) ----------
// INDICES
0;
1;
2;
3;
V+1;
V+2;
V+3;
V+4;
# ----------------------------------------
Shift_placement_rows_lying = Input()  # "Shift placement (rows, lying)"
Reverse_rows_lying = Input()  # "Reverse (rows, lying)"
build_triangular_sublists = Custom[Build Triangular Sublists](offset=code_block_3.out2, shift=Shift_placement_rows_lying, reverse=Reverse_rows_lying, index0=code_block_3.out6, index1=code_block_3.out1, index2=code_block_3.out4)  # Creates sublists of three items each from a list based on given indices, shift and reverse settings and offset.
map = List.Map(code_block_2.out4, build_triangular_sublists)
build_triangular_sublists_2 = Custom[Build Triangular Sublists](offset=code_block_3.out2, shift=Shift_placement_rows_lying, reverse=Reverse_rows_lying, index0=code_block_3.out7, index1=code_block_3.out2, index2=code_block_3.out5)
map_2 = List.Map(code_block_2.out5, build_triangular_sublists_2)
join = List.Join(map, map_2)
number = DoubleInput(1)
flatten = List.Flatten(join, number)
number_2 = DoubleInput(3)
# note: Rows, lying
filterSublistsByLength = Custom[Filter Sublists By Length](list=flatten, length=number_2)  # "List.FilterSublistsByLength"; Filters out all sublists that do not have the specified length
Rows_lying = Output(filterSublistsByLength.in)  # "Rows, lying"
takeItems = List.TakeItems()
Shift_placement_rows_standing = Input()  # "Shift placement (rows, standing)"
Reverse_rows_standing = Input()  # "Reverse (rows, standing)"
build_triangular_sublists_3 = Custom[Build Triangular Sublists](offset=code_block_3.out2, shift=Shift_placement_rows_standing, reverse=Reverse_rows_standing, index0=code_block_3.out1, index1=code_block_3.out6, index2=code_block_3.out3)
map_3 = List.Map(code_block_2.out4, build_triangular_sublists_3)
getSublistLengths = Custom[Get Sublist Lengths](list=map_3)  # "List.GetSublistLengths"; Gets the lengths of all sublists in a given list of lists.
formula = Formula("n-5", n=getSublistLengths, lacing=Longest)
combine = List.Combine(takeItems, formula, map_3)
if_ = If(isEvenNumber, combine, map_3)
# note: Necessary cleanup:
# In some cases there are groups of three points that we don't want...
takeItems_2 = List.TakeItems()
build_triangular_sublists_4 = Custom[Build Triangular Sublists](offset=code_block_3.out2, shift=Shift_placement_rows_standing, reverse=Reverse_rows_standing, index0=code_block_3.out0, index1=code_block_3.out5, index2=code_block_3.out2)
map_4 = List.Map(code_block_2.out5, build_triangular_sublists_4)
getSublistLengths_2 = Custom[Get Sublist Lengths](list=map_4)  # "List.GetSublistLengths"
formula_2 = Formula("n-4", n=getSublistLengths_2, lacing=Longest)
combine_2 = List.Combine(takeItems_2, formula_2, map_4)
if_2 = If(isOddNumber, combine_2, map_4)
join_2 = List.Join(if_, if_2)
number_3 = DoubleInput(1)
flatten_2 = List.Flatten(join_2, number_3)
# note: Rows, standing
filterSublistsByLength_2 = Custom[Filter Sublists By Length](list=flatten_2, length=number_2)  # "List.FilterSublistsByLength"
Rows_standing = Output(filterSublistsByLength_2.in)  # "Rows, standing"
code_block_4 = CodeBlock(V=V)
# ---------- code_block_4.designscript (9 lines) ----------
// PATTERNS
// Left corners, standing
{0,V+1,1};
// Left corners, lying
{V+2,0,V+1};
// Right corners, standing
{V-1,2*V+1,V};
// Right corners, flying
{2*V+1,V,2*V};
# ----------------------------------------
Shift_placement_left_corners_lying = Input()  # "Shift placement (left corners, lying)"
Reverse_left_corners_lying = Input()  # "Reverse (left corners, lying)"
shift_placement_and_reverse = Custom[Shift Placement And Reverse](list=code_block_4.out1, shift=Shift_placement_left_corners_lying, reverse=Reverse_left_corners_lying)  # Shifts (integer) and reverses (bool) a given list
code_block_5 = CodeBlock(seq=code_block_2.out5, pat=shift_placement_and_reverse) { make_triangles(seq,pat); }
Left_corners_lying = Output(code_block_5)  # "Left corners, lying"
Shift_placement_left_corners_standing = Input()  # "Shift placement (left corners, standing)"
Reverse_left_corners_standing = Input()  # "Reverse (left corners, standing)"
shift_placement_and_reverse_2 = Custom[Shift Placement And Reverse](list=code_block_4.out0, shift=Shift_placement_left_corners_standing, reverse=Reverse_left_corners_standing)
code_block_6 = CodeBlock(seq=code_block_2.out4, pat=shift_placement_and_reverse_2) { make_triangles(seq,pat); }
Left_corners_standing = Output(code_block_6)  # "Left corners, standing"
Shift_placement_right_corners_lying = Input()  # "Shift placement (right corners, lying)"
Reverse_right_corners_lying = Input()  # "Reverse (right corners, lying)"
shift_placement_and_reverse_3 = Custom[Shift Placement And Reverse](list=code_block_4.out3, shift=Shift_placement_right_corners_lying, reverse=Reverse_right_corners_lying)
code_block_7 = CodeBlock(seq=code_block_2.out9, pat=shift_placement_and_reverse_3) { make_triangles(seq,pat); }
Right_corners_lying = Output(code_block_7)  # "Right corners, lying"
Shift_placement_right_corners_standing = Input()  # "Shift placement (right corners, standing)"
Reverse_right_corners_standing = Input()  # "Reverse (right corners, standing)"
shift_placement_and_reverse_4 = Custom[Shift Placement And Reverse](list=code_block_4.out2, shift=Shift_placement_right_corners_standing, reverse=Reverse_right_corners_standing)
code_block_8 = CodeBlock(seq=code_block_2.out7, pat=shift_placement_and_reverse_4) { make_triangles(seq,pat); }
Right_corners_standing = Output(code_block_8)  # "Right corners, standing"
code_block_9 = CodeBlock()
# ---------- code_block_9.designscript (6 lines) ----------
def make_triangles(seq,pat)
{
seq2 = List.Transpose(seq);
seq3 = {seq2[pat[0]],seq2[pat[1]],seq2[pat[2]]};
return = List.Transpose(seq3);
}
# ----------------------------------------
