# Dynamo custom node UV.ByXY.dyf (Dynamo 0.7.2.26383)
# category: CAAD_RWTH.Geometry.UV.Create
# Creates UV from the XY components of point coordinates

Point_s = Input()  # "Point(s)"
code_block = CodeBlock(seq=Point_s) { UV.ByCoordinates(seq.X,seq.Y); }
UV_s = Output(code_block)  # "UV(s)"
