# Dynamo custom node Vector And Plane Are Parallel.dyf (Dynamo 0.7.2.3911)
# category: CAAD_RWTH.Geometry.Vector.Query
# Checks if a given vector is parallel to a given plane

Vector = Input()
Plane_Normal = Input()
vectors_are_orthogonal = Custom[Vectors Are Orthogonal](Vector_1=Vector, Vector_2=Plane_Normal)  # Checks if two vectors are orthogonal to each other
bool = Output(vectors_are_orthogonal)
