# Dynamo custom node View.CategoryIsVisible.dyf "Category Is Visible In View" (Dynamo 0.7.2.3911)
# category: CAAD_RWTH.Revit.Views.View.Query
# Checks if a given category is visible in a given view

current = Document.Current(lacing=Longest)
BuiltInCategories = Input()
turn_into_list = Custom[Turn Into List](item=BuiltInCategories)  # Turns an element (or a nested list) into a flat list
View_s = Input()  # "View(s)"
turn_into_list_2 = Custom[Turn Into List](item=View_s)
python_script = Python(IN[0]=current, IN[1]=turn_into_list, IN[2]=turn_into_list_2)
# ---------- python_script.python (26 lines) ----------
import clr
clr.AddReference('RevitAPI')
clr.AddReference('RevitAPIUI')
from Autodesk.Revit.DB import *
import Autodesk

doc = IN[0]
cats = IN[1]
views = IN[2]
cats2 = doc.Settings.Categories

elementlist = list()
for cat in cats:
	catlist = list()
	for view in views:
		try:
			if view.GetVisibility(cats2.get_Item(cat)):
				catlist.append(1)
			else:
				catlist.append(0)
		# some view types (like images, for example) will throw an exception.
		# if we're not sure let's return false		
		except:
			catlist.append(0)
	elementlist.append(catlist)
OUT = elementlist
# ----------------------------------------
bool = Output(python_script)
