# Dynamo custom node View.Duplicate.dyf (Dynamo 0.7.2.3911)
# category: CAAD_RWTH.Revit.Views.View.Actions
# Duplicates a given view. Duplication options: 0 = Duplicate, 1 = Duplicate with Detailing, 2 = Duplicate as Dependent View. Probably needs to be used in conjunction with a Transaction node.

View_s = Input()  # "View(s)"
turn_into_list = Custom[Turn Into List](item=View_s)  # Turns an element (or a nested list) into a flat list
duplication_option = Input()
python_script = Python(IN[0]=turn_into_list, IN[1]=duplication_option)
# ---------- python_script.python (28 lines) ----------
import clr
clr.AddReference('RevitAPI')
from Autodesk.Revit.DB import *
import Autodesk

clr.AddReference("RevitServices")
import RevitServices
from RevitServices.Persistence import DocumentManager
from RevitServices.Transactions import TransactionManager

doc = DocumentManager.Instance.CurrentDBDocument
views = UnwrapElement(IN[0])
option = IN[1]
elementlist = list()
if option == 1:
	dupopt = Autodesk.Revit.DB.ViewDuplicateOption.WithDetailing
elif option == 2:
	dupopt = Autodesk.Revit.DB.ViewDuplicateOption.AsDependent
else:
	dupopt = Autodesk.Revit.DB.ViewDuplicateOption.Duplicate

TransactionManager.Instance.EnsureInTransaction(doc)
for view in views:
	newview = view.Duplicate(dupopt)
	elementlist.append(doc.GetElement(newview))
TransactionManager.Instance.TransactionTaskDone()
	
OUT = elementlist
# ----------------------------------------
view_s = Output(python_script)  # "view(s)"
