# Dynamo custom node -1.dyf (Dynamo 0.8.1.1693)
# category: Clockwork.Core.Math.Actions
# Decrements a value by 1

Input = Input()
code_block = CodeBlock(n=Input) { n-1; }
Output = Output(code_block)  # ""
