# Dynamo custom node All Placed Family Types of Category.dyf (Dynamo 0.8.2.2392)
# category: Clockwork.Revit.Selection.ByCollector
# Retrieves all family types of a given category that have *placed* instances

category = Input(category : Category)
all_elements_of_category = ElementsOfCategory(category)
type = Custom[Element.Type](element=all_elements_of_category)  # Gets the family type of a given element (if applicable).
code_block = CodeBlock(seq=type) { List.UniqueItems(seq); }
familyTypes = Output(code_block)
