# Dynamo custom node All View-Dependent Family Instances Of Category.dyf (Dynamo 0.8.3.2580)
# category: Clockwork.Revit.Selection.ByCollector
# Gets all view-dependent family instances in a given view for a given list of categories - useful for finding annotation elements

category = Input(category : Category)
turn_into_list = Custom[Turn Into List](category)  # Turns an element (or a nested list) into a flat list
view = Input(view : View)
turn_into_list_2 = Custom[Turn Into List](view)
python_script = Python(IN[0]=turn_into_list, IN[1]=turn_into_list_2)
# ---------- python_script.python (24 lines) ----------
import System
import clr
clr.AddReference('RevitAPI')
from Autodesk.Revit.DB import *

clr.AddReference("RevitServices")
import RevitServices
from RevitServices.Persistence import DocumentManager

doc = DocumentManager.Instance.CurrentDBDocument
cats = IN[0]
views = UnwrapElement(IN[1])

elementlist = list()
# This could be more elegant if only I knew how to implement a Multicategory filter in Python....
for cat in cats:
	catlist = list()
	for view in views:
		collector = FilteredElementCollector(doc)
		filter = ElementOwnerViewFilter(view.Id)
		bic = System.Enum.ToObject(BuiltInCategory, cat.Id)
		catlist.append(collector.WherePasses(filter).OfCategory(bic).ToElements())
	elementlist.append(catlist)
OUT = elementlist
# ----------------------------------------
returnListOrSingleValue = Custom[ReturnListOrSingleValue](unknownItem=category, seq=python_script)  # If the item in input #1 is not a list, only the first item of the list in input #2 will be returned.
elements = Output(returnListOrSingleValue)
