# Dynamo custom node Angle.ByAngleSum.dyf (Dynamo 0.8.1.1693)
# category: Clockwork.Core.Formulas.Query
# Computes the missing interior angle of a *planar* polygon based on a given list of all other interior angles.

Angles = Input(Angles : double[])
code_block = CodeBlock(angles=Angles)
# ---------- code_block.designscript (4 lines) ----------
n = List.Count(angles);
trueval = (n-1)*180-Math.Sum(angles);
falseval = "The list needs to consist of at least two angles.";
n > 1 ? trueval : falseval;
# ----------------------------------------
Angle = Output(code_block.out3)
