# Dynamo custom node Angle.ByLawOfCosines.dyf (Dynamo 0.8.1.1693)
# category: Clockwork.Core.Formulas.Query
# Computes an angle of a triangle using the law of cosines. A is the opposite side of the triangle while B and C are the sides forming the angle.

SideB = Input(SideB : double)
SideC = Input(SideC : double)
SideA = Input(SideA : double)
code_block = CodeBlock(b=SideB, c=SideC, a=SideA) { Math.Acos((Math.Pow(b,2)+Math.Pow(c,2)-Math.Pow(a,2))/(2*b*c)); }
Alpha = Output(code_block)
