# Dynamo custom node Angle.ByLawOfSines.dyf (Dynamo 0.8.1.1693)
# category: Clockwork.Core.Formulas.Query
# Determines the angle of a triangle based on the law of sines. (Alpha is the angle opposite side A and beta is the angle opposite side B...)

SideA = Input(SideA : double)
SideB = Input(SideB : double)
Beta = Input(Beta : double)
code_block = CodeBlock(a=SideA, b=SideB, beta=Beta) { Math.Asin(a/b*Math.Sin(beta)); }
Alpha = Output(code_block)
