# Dynamo custom node Angle.ExteriorAngle.dyf (Dynamo 0.8.1.1823)
# category: Clockwork.Core.Formulas.Query
# Computes the exterior angle of a given angle.

Angle = Input(Angle : double)
code_block = CodeBlock(angle=Angle) { 360-angle; 180-angle; }
n360_Angle = Output(code_block.out0)  # "360°-Angle"
n180_Angle = Output(code_block.out1)  # "180°-Angle"
