# Dynamo custom node AreaSeparator.FromCurve.dyf (Dynamo 0.8.2.2392)
# category: Clockwork.Revit.Elements.ModelCurve.Create
# Creates area separation lines from geometry curves.

curve = Input(curve : Autodesk.Curve)
turn_into_list = Custom[Turn Into List](curve)  # Turns an element (or a nested list) into a flat list
sketchPlane = Input(sketchPlane : SketchPlane)
areaPlanView = Input()
python_script = Python(IN[0]=turn_into_list, IN[1]=sketchPlane, IN[2]=areaPlanView)
# ---------- python_script.python (29 lines) ----------
import clr
clr.AddReference('RevitAPI')
from Autodesk.Revit.DB import *

clr.AddReference("RevitNodes")
import Revit
clr.ImportExtensions(Revit.GeometryConversion)

clr.AddReference("RevitServices")
import RevitServices
from RevitServices.Persistence import DocumentManager
from RevitServices.Transactions import TransactionManager

doc = DocumentManager.Instance.CurrentDBDocument
curves = UnwrapElement(IN[0])
sketchplane = UnwrapElement(IN[1])
view = UnwrapElement(IN[2])
elementlist = list()

if str(view.ViewType) == "AreaPlan":
	TransactionManager.Instance.EnsureInTransaction(doc)
	doccreation = doc.Create
	for curve in curves:
		separator = doccreation.NewAreaBoundaryLine(sketchplane, curve.ToRevitType(), view)
		elementlist.append(separator)
	TransactionManager.Instance.TransactionTaskDone()
else:
	elementlist = list("The active view needs to be an area plan...")
OUT = elementlist
# ----------------------------------------
returnListOrSingleValue = Custom[ReturnListOrSingleValue](unknownItem=curve, seq=python_script)  # If the item in input #1 is not a list, only the first item of the list in input #2 will be returned.
areaSeparator = Output(returnListOrSingleValue)
