# Dynamo custom node Assembly.RemoveMembers.dyf (Dynamo 0.8.2.2392)
# category: Clockwork.Revit.Elements.Assembly.Actions
# Removes any given elements to a given assembly.

assembly = Input()
elements = Input()
turnIntoList = Custom[TurnIntoList](unknownItem=elements)  # Turns an element (or a nested list) into a flat list
python_script = Python(IN[0]=assembly, IN[1]=turnIntoList)
# ---------- python_script.python (31 lines) ----------
import clr
from System.Collections.Generic import *
clr.AddReference('RevitAPI')
from Autodesk.Revit.DB import *

clr.AddReference("RevitNodes")
import Revit
clr.ImportExtensions(Revit.GeometryConversion)

clr.AddReference("RevitServices")
import RevitServices
from RevitServices.Persistence import DocumentManager
from RevitServices.Transactions import TransactionManager

doc = DocumentManager.Instance.CurrentDBDocument
assembly = UnwrapElement(IN[0])
element_array = UnwrapElement(IN[1])

# add items to assembly
TransactionManager.Instance.EnsureInTransaction(doc)
# create a Revit-compatible list of IDs
ids = list()
for elem in element_array:
	ids.append(elem.Id)	
idlist = List[ElementId](ids)
try:
	assembly.RemoveMemberIds(idlist)
	OUT = assembly
except:
	OUT = None
TransactionManager.Instance.TransactionTaskDone()
# ----------------------------------------
assembly_2 = Output(python_script)  # "assembly"
