# Dynamo custom node BoundingBox.ByElements.dyf (Dynamo 0.8.3.2580)
# category: Clockwork.Revit.Elements.BoundingBox.Create
# Retrieves a bounding box for a list of elements

elements = Input()
view = Input(view : View)
byElement = Custom[BoundingBox.ByElement](element=elements, view=view)  # Gets the bounding box of a Revit element
code_block = CodeBlock(bl=byElement.BottomLeftRearCorner, tr=byElement.TopRightFrontCorner) { bl.X; bl.Y; bl.Z; tr.X; tr.Y; tr.Z; }
sublistLengths = Custom[List.SublistLengths](seq=elements)  # Gets the lengths of all sublists in a given list of lists.
chopByLengths = Custom[List.SublistByLengths](list=code_block.out5, subLengthList=sublistLengths)  # "List.ChopByLengths"; Turns a list into a list of lists with sublists of varying lengths.
chopByLengths_2 = Custom[List.SublistByLengths](list=code_block.out4, subLengthList=sublistLengths)  # "List.ChopByLengths"
chopByLengths_3 = Custom[List.SublistByLengths](list=code_block.out3, subLengthList=sublistLengths)  # "List.ChopByLengths"
chopByLengths_4 = Custom[List.SublistByLengths](list=code_block.out2, subLengthList=sublistLengths)  # "List.ChopByLengths"
chopByLengths_5 = Custom[List.SublistByLengths](list=code_block.out1, subLengthList=sublistLengths)  # "List.ChopByLengths"
chopByLengths_6 = Custom[List.SublistByLengths](list=code_block.out0, subLengthList=sublistLengths)  # "List.ChopByLengths"
code_block_2 = CodeBlock(a=code_block.out0, b=code_block.out1, c=code_block.out2, d=code_block.out3, e=code_block.out4, f=code_block.out5)
# ---------- code_block_2.designscript (3 lines) ----------
p1 = Autodesk.Point.ByCoordinates(List.MinimumItem(a),List.MinimumItem(b),List.MinimumItem(c));
p2 = Autodesk.Point.ByCoordinates(List.MaximumItem(d),List.MaximumItem(e),List.MaximumItem(f));
BoundingBox.ByCorners(p1,p2);
# ----------------------------------------
fromDynamoBoundingBox = Custom[RevitBoundingBox.FromDynamoBoundingBox](DynamoBoundingBox=code_block_2.out2)  # Turns a Dynamo bounding box into a Revit bounding box.
RevitBoundingBox = Output(fromDynamoBoundingBox)
DynamoBoundingBox = Output(code_block_2.out2)
BottomLeftRearCorner = Output(code_block_2.p2)
TopRightFrontCorner = Output(code_block_2.p1)
