# Dynamo custom node Category.Subcategories.dyf (Dynamo 0.8.3.2580)
# category: ___WIP___.Revit.Elements.Category.Query
# Retrieves all the subcategories for a given category

category = Input()
turn_into_list = Custom[Turn Into List](category)  # Turns an element (or a nested list) into a flat list
python_script = Python(IN[0]=turn_into_list)
# ---------- python_script.python (13 lines) ----------
import clr
clr.AddReference('RevitAPI')
from Autodesk.Revit.DB import *

cats = UnwrapElement(IN[0])
elementlist = list()

for cat in cats:
	try:
		elementlist.append(cat.SubCategories)
	except:
		elementlist.append(list())
OUT = elementlist
# ----------------------------------------
returnListOrSingleValue = Custom[ReturnListOrSingleValue](unknownItem=category, seq=python_script)  # If the item in input #1 is not a list, only the first item of the list in input #2 will be returned.
subcategories = Output(returnListOrSingleValue)
