# Dynamo custom node Cathetus.ByPythagoras.dyf (Dynamo 0.8.1.1693)
# category: Clockwork.Core.Formulas.Query
# Computes the length of one of the catheti / legs of a right triangle using the Pythagorean Theorem. B is the other leg / cathetus of the triangle while C is the hypotenuse.

SideC = Input(SideC : double)
SideB = Input(SideB : double)
code_block = CodeBlock(c=SideC, b=SideB) { Math.Sqrt(Math.Pow(c,2)-Math.Pow(b,2)); }
SideA = Output(code_block)
