# Dynamo custom node Character.FromNumber.dyf (Dynamo 0.8.1.1823)
# category: Clockwork.Core.String.Create
# Converts a number into a character (where 1 = A, 2 = B, ... , 27 = AA, 28 = AB etc.).

upperCase = Input(upperCase : bool = false)
n = Input(n : int)
code_block = CodeBlock(uppercase=upperCase, n=n)
# ---------- code_block.designscript (12 lines) ----------
// Build a lowercase/uppercase alphabet with an empty string at the beginning
alpha1 = "A*B*C*D*E*F*G*H*I*J*K*L*M*N*O*P*Q*R*S*T*U*V*W*X*Y*Z";
alpha2 = String.ChangeCase(alpha1,uppercase);
alpha3 = String.Split(alpha2,"*");
alpha4 = List.AddItemToFront("",alpha3);
// First digit
string1 = List.GetItemAtIndex(alpha4,Math.Floor((n-1)/26));
// Second digit
rest = n%26;
string2 = List.GetItemAtIndex(alpha4,(rest>0 ? rest : 26));
// Entire string
string1 + string2;
# ----------------------------------------
str = Output(code_block.out7)
