# Dynamo custom node Character.ToNumber.dyf (Dynamo 0.8.2.2392)
# category: Clockwork.Core.String.Query
# Converts an Excel-style character to a number (e.g. A = 1, AA = 27 etc.).

str = Input(str : string)
turnIntoList = Custom[TurnIntoList](unknownItem=str)  # Turns an element (or a nested list) into a flat list
toLower = String.ToLower(turnIntoList)
fromString = Custom[List.FromString]()  # Chops up a string into a list of characters
map = List.Map(list=toLower, f_x=fromString)
count = List.Count()
map_2 = List.Map(list=map, f_x=count)
code_block = CodeBlock(n=map_2) { 0..#n..26; }
reverse = List.Reverse()
map_3 = List.Map(list=code_block, f_x=reverse)
code_block_2 = CodeBlock { 26; }
alphabeticalSequence = Custom[List.AlphabeticalSequence](n=code_block_2)  # Creates a list of the first N letters of the alphabet (where 1 = A, 2 = B, ... , 27 = AA, 28 = AB etc.).
indexOf = IndexOf(alphabeticalSequence)
map_4 = List.Map(f_x=indexOf)
map_5 = List.Map(list=map, f_x=map_4)
code_block_3 = CodeBlock(level=map_3, n=map_5) { level == 0 ? n + 1 : level * (n + 1); }
sum = Math.Sum()
map_6 = List.Map(list=code_block_3, f_x=sum)
returnListOrSingleValue = Custom[ReturnListOrSingleValue](unknownItem=str, seq=map_6)  # If the unknown item is not a list but rather a single item, only the first item of the list (input "seq") will be returned.
int = Output(returnListOrSingleValue)
