# Dynamo custom node Clipboard.SendTo.dyf (Dynamo 0.8.2.2392)
# category: Clockwork.Core.Clipboard.Actions
# Copies a string to the clipboard. ATTENTION: Will only work with strings and on top of Revit (not in sandbox mode).

str = Input(str : string)
python_script = Python(IN[0]=str)
# ---------- python_script.python (17 lines) ----------
import clr
import System
from System.Threading import Thread, ThreadStart
clr.AddReference("System.Windows.Forms")

def SetText(text):
    def thread_proc():
        System.Windows.Forms.Clipboard.SetText(text)
    t = Thread(ThreadStart(thread_proc))
    t.ApartmentState = System.Threading.ApartmentState.STA
    t.Start()
    
try:
	SetText(IN[0])
	OUT = IN[0]
except:
	OUT = 'Data could not be copied to clipboard'
# ----------------------------------------
str_2 = Output(python_script)  # "str"
