# Dynamo custom node Color.GreyscaleByNormalizedValue.dyf (Dynamo 0.8.1.1823)
# category: Clockwork.Core.Color.Create
# Creates a greyscale color based on a normalized value (0 = black, 1 = white)

dbl = Input(dbl : double = 1)
code_block = CodeBlock(x=dbl) { DSCore.Color.ByARGB(255,x*255,x*255,x*255); }
Color = Output(code_block)
