# Dynamo custom node CurtainPanel.HostPanel.dyf (Dynamo 0.8.3.2580)
# category: Clockwork.Revit.Elements.CurtainPanel.Query
# Retrieves the host panel of a given curtain panel. This is typcially needed when wanting to access wall elements used as curtain panels.

curtainPanel = Input()
turn_into_list = Custom[Turn Into List](curtainPanel)  # Turns an element (or a nested list) into a flat list
python_script = Python(IN[0]=turn_into_list)
# ---------- python_script.python (21 lines) ----------
import clr
clr.AddReference('RevitAPI')
from Autodesk.Revit.DB import *

clr.AddReference("RevitNodes")
import Revit
clr.ImportExtensions(Revit.Elements)

clr.AddReference("RevitServices")
import RevitServices
from RevitServices.Persistence import DocumentManager

doc = DocumentManager.Instance.CurrentDBDocument
faminsts = UnwrapElement(IN[0])
elementlist = list()
for item in faminsts:
	try:
		elementlist.append(doc.GetElement(item.FindHostPanel()).ToDSType(True))
	except:
		elementlist.append(list())
OUT = elementlist
# ----------------------------------------
returnListOrSingleValue = Custom[ReturnListOrSingleValue](unknownItem=curtainPanel, seq=python_script)  # If the item in input #1 is not a list, only the first item of the list in input #2 will be returned.
hostPanel = Output(returnListOrSingleValue)
