# Dynamo custom node CurtainSystem.ByFace.dyf (Dynamo 0.8.3.2580)
# category: Clockwork.Revit.Elements.CurtainSystem.Create
# Creates a curtain system on top of a face. The face typically needs to be the face of a mass surface in Revit.

surface = Input(surface : Surface)
curtainSystemType = Input()
turn_into_list = Custom[Turn Into List](surface)  # Turns an element (or a nested list) into a flat list
fromDynamoSurface = Custom[RevitFaceReference.FromDynamoSurface](DynamoSurface=turn_into_list)  # Returns the underlying Revit face reference of a given surface
python_script = Python(IN[0]=curtainSystemType, IN[1]=fromDynamoSurface)
# ---------- python_script.python (31 lines) ----------
import clr
clr.AddReference('RevitAPI')
from Autodesk.Revit.DB import *

clr.AddReference("RevitNodes")
import Revit
clr.ImportExtensions(Revit.Elements)

clr.AddReference("RevitServices")
import RevitServices
from RevitServices.Persistence import DocumentManager
from RevitServices.Transactions import TransactionManager

doc = DocumentManager.Instance.CurrentDBDocument
cstype = UnwrapElement(IN[0])
facerefs = IN[1]
elementlist = list()
refarr = ReferenceArray()
for ref in facerefs:
	refarr.Append(ref)
TransactionManager.Instance.EnsureInTransaction(doc)
doccreation = doc.Create
newcs = doccreation.NewCurtainSystem2(refarr,cstype)
try:
	newcs = doccreation.NewCurtainSystem2(refarr,cstype)
	for item in newcs:
		elementlist.append(doc.GetElement(item))
except:
	donothing = 1
TransactionManager.Instance.TransactionTaskDone()
OUT = elementlist
# ----------------------------------------
returnListOrSingleValue = Custom[ReturnListOrSingleValue](unknownItem=surface, seq=python_script)  # If the item in input #1 is not a list, only the first item of the list in input #2 will be returned.
curtainSystem = Output(returnListOrSingleValue)
