# Dynamo custom node DetailComponent.ByCurve.dyf (Dynamo 0.8.3.2580)
# category: Clockwork.Revit.Elements.DetailComponent.Create
# Places a line-based detail component in a given view

curve = Input(curve : Autodesk.Curve)
turn_into_list = Custom[Turn Into List](curve)  # Turns an element (or a nested list) into a flat list
familyType = Input()
view = Input(view : View)
version = Custom[Application.Version]()  # Retrieves the name, version and build of the current Revit application.
python_script = Python(IN[0]=turn_into_list, IN[1]=familyType, IN[2]=view, IN[3]=version.Version_int)
# ---------- python_script.python (30 lines) ----------
import clr
clr.AddReference('RevitAPI')
from Autodesk.Revit.DB import *

clr.AddReference("RevitNodes")
import Revit
clr.ImportExtensions(Revit.Elements)
clr.ImportExtensions(Revit.GeometryConversion)

clr.AddReference("RevitServices")
import RevitServices
from RevitServices.Persistence import DocumentManager
from RevitServices.Transactions import TransactionManager

doc = DocumentManager.Instance.CurrentDBDocument
curves = UnwrapElement(IN[0])
famtype = UnwrapElement(IN[1])
view = UnwrapElement(IN[2])
version = IN[3]
elementlist = list()
counter = 0

TransactionManager.Instance.EnsureInTransaction(doc)
for curve in curves:
	if version > 2015:
		if not(famtype.IsActive): famtype.Activate()
	newobj = doc.Create.NewFamilyInstance(curve.ToRevitType(),famtype,view)
	elementlist.append(newobj.ToDSType(False))
TransactionManager.Instance.TransactionTaskDone()
OUT = elementlist
# ----------------------------------------
returnListOrSingleValue = Custom[ReturnListOrSingleValue](unknownItem=curve, seq=python_script)  # If the item in input #1 is not a list, only the first item of the list in input #2 will be returned.
element = Output(returnListOrSingleValue)
