# Dynamo custom node Dimension.SetType.dyf (Dynamo 0.8.3.2580)
# category: Clockwork.Revit.Elements.Dimension.Actions
# Changes the dimension type of a given dimension instance to the specified type

dimensionInstance = Input()
turn_into_list = Custom[Turn Into List](dimensionInstance)  # Turns an element (or a nested list) into a flat list
dimensionType = Input()
python_script = Python(IN[0]=turn_into_list, IN[1]=dimensionType)
# ---------- python_script.python (24 lines) ----------
import clr
clr.AddReference('RevitAPI')
from Autodesk.Revit.DB import *

clr.AddReference("RevitServices")
import RevitServices
from RevitServices.Persistence import DocumentManager
from RevitServices.Transactions import TransactionManager

doc = DocumentManager.Instance.CurrentDBDocument
diminsts = UnwrapElement(IN[0])
dimtype = UnwrapElement(IN[1])
successlist = list()
faillist = list()

TransactionManager.Instance.EnsureInTransaction(doc)
for item in diminsts:
	try:
		item.DimensionType = dimtype
		successlist.append(item)
	except:
		faillist.append(item)
TransactionManager.Instance.TransactionTaskDone()
OUT = (successlist,faillist)
# ----------------------------------------
code_block = CodeBlock(seq=python_script) { seq[0]; seq[1]; }
success = Output(code_block.out0)
failed = Output(code_block.out1)
