# Dynamo custom node DimensionType.Style.dyf (Dynamo 0.8.3.2580)
# category: Clockwork.Revit.Elements.DimensionType.Query
# Gets the style of a given Revit dimension type

dimensionType = Input()
turn_into_list = Custom[Turn Into List](dimensionType)  # Turns an element (or a nested list) into a flat list
python_script = Python(IN[0]=turn_into_list)
# ---------- python_script.python (12 lines) ----------
import clr
clr.AddReference('RevitAPI')
from Autodesk.Revit.DB import *

items = UnwrapElement(IN[0])
elementlist = list()
for item in items:
	try:
		elementlist.append(item.StyleType.ToString())
	except:
		elementlist.append(list())
OUT = elementlist
# ----------------------------------------
returnListOrSingleValue = Custom[ReturnListOrSingleValue](unknownItem=dimensionType, seq=python_script)  # If the item in input #1 is not a list, only the first item of the list in input #2 will be returned.
dimensionStyleType = Output(returnListOrSingleValue)
