# Dynamo custom node Directory.ContentsAll.dyf (Dynamo 0.8.3.2580)
# category: Clockwork.Core.Directory.Query
# Unlike the built-in node Directory.Contents, this node browses a directory recursively and returns all relevant files contained in subfolders as well.

dir = Input(dir : string)
searchString = Input(searchString : string = "*")
python_script = Python(IN[0]=dir, IN[1]=searchString)
# ---------- python_script.python (7 lines) ----------
from System.IO import Directory, SearchOption
dir = IN[0]
searchstring = IN[1]
if Directory.Exists(dir):
	OUT = Directory.GetFiles(dir, searchstring, SearchOption.AllDirectories)
else:
	OUT = list()
# ----------------------------------------
files = Output(python_script)
