# Dynamo custom node DividedSurface.AddIntersect.dyf (Dynamo 0.8.2.2392)
# category: Clockwork.Revit.Elements.DividedSurface.Actions
# Adds an intersect to a divided surface

dividedSurface = Input(dividedSurface : DividedSurface)
element = Input()
turn_into_list = Custom[Turn Into List](element)  # Turns an element (or a nested list) into a flat list
python_script = Python(IN[0]=dividedSurface, IN[1]=turn_into_list)
# ---------- python_script.python (19 lines) ----------
import clr
clr.AddReference('RevitAPI')
from Autodesk.Revit.DB import *

clr.AddReference("RevitServices")
import RevitServices
from RevitServices.Persistence import DocumentManager
from RevitServices.Transactions import TransactionManager

doc = DocumentManager.Instance.CurrentDBDocument
divsurf = UnwrapElement(IN[0])
intersects = UnwrapElement(IN[1])

TransactionManager.Instance.EnsureInTransaction(doc)
for item in intersects:
	divsurf.AddIntersectionElement(item.Id)
TransactionManager.Instance.TransactionTaskDone()

OUT = divsurf
# ----------------------------------------
dividedSurface_2 = Output(python_script)  # "dividedSurface"
