# Dynamo custom node DividedSurface.EvaluateGridNodes.dyf (Dynamo 0.8.3.2580)
# category: Clockwork.Revit.Elements.DividedSurface.Query
# Returns UV and XYZ coordinates as well as surface normals for all grid nodes of a given divided surface. Also returns the underlying face.

dividedSurface = Input()
includeOverhangingNodes = Input(includeOverhangingNodes : bool = false)
python_script = Python(IN[0]=dividedSurface, IN[1]=includeOverhangingNodes)
# ---------- python_script.python (42 lines) ----------
import clr
clr.AddReference('RevitAPI')
from Autodesk.Revit.DB import *

clr.AddReference("RevitNodes")
import Revit
clr.ImportExtensions(Revit.Elements)
clr.ImportExtensions(Revit.GeometryConversion)

ds = UnwrapElement(IN[0])
overhanging = IN[1]
uvlist = list()
uvnormals = list()
uvxyzs = list()

face = ds.Host.GetGeometryObjectFromReference(ds.HostReference)
gn = GridNode()
if overhanging == True:
	i = 0
	j = 1
else:
	i = 1
	j = 3
u = i
while (u < (ds.NumberOfUGridlines-i)):
	gn.UIndex = u
	v = i
	vlist = list()
	vnormals = list()
	vxyzs = list()
	while (v < (ds.NumberOfVGridlines-i)):
		gn.VIndex = v
		uv = ds.GetGridNodeUV(gn)
 		vlist.append(uv)
 		vnormals.append(face.ComputeNormal(uv).ToVector())
 		vxyzs.append(face.Evaluate(uv).ToPoint())
 		v += 1
 	uvlist.append(vlist)
 	uvnormals.append(vnormals)
 	uvxyzs.append(vxyzs)
 	u += 1
OUT = (uvnormals,uvxyzs,face.ToProtoType(),uvlist)
# ----------------------------------------
code_block = CodeBlock(seq=python_script) { seq[0]; seq[1]; seq[2]; seq[3]; }
toDynamoUV = Custom[RevitUV.ToDynamoUV](RevitUV=code_block.out3)  # Converts Revit UV coordinates to Dynamo UV coordinates
sublistLengths = Custom[List.SublistLengths](seq=code_block.out3)  # Gets the lengths of all sublists in a given list of lists.
chopByLengths = Custom[List.SublistByLengths](list=toDynamoUV, subLengthList=sublistLengths)  # "List.ChopByLengths"; Turns a list into a list of lists with sublists of varying lengths.
UVs = Output(chopByLengths)
points = Output(code_block.out1)
normals = Output(code_block.out0)
surface = Output(code_block.out2)
