# Dynamo custom node Document.ContainsElementsOfCategory.dyf (Dynamo 0.8.3.2553)
# category: Clockwork.Revit.Document.Query
# Checks if family instances of specified categories are present in the model.

category = Input()
turn_into_list = Custom[Turn Into List](category)  # Turns an element (or a nested list) into a flat list
all_elements_of_category = ElementsOfCategory(turn_into_list)
isNotEmpty = Custom[List Not Empty]()  # "List.IsNotEmpty"; Just the inversion of the built-in Is Empty List node.
map = List.Map(list=all_elements_of_category, f_x=isNotEmpty)
anyTrue = Custom[List.AnyTrue](seq=map)  # Returns true if any item in a list of booleans is true.
any = Output(anyTrue)  # "any?"
code_block = CodeBlock(seq=map) { AllTrue(seq); }
all = Output(code_block)  # "all?"
returnListOrSingleValue = Custom[ReturnListOrSingleValue](unknownItem=category, seq=map)  # If the item in input #1 is not a list, only the first item of the list in input #2 will be returned.
per_category = Output(returnListOrSingleValue)
returnListOrSingleValue_2 = Custom[ReturnListOrSingleValue](unknownItem=category, seq=all_elements_of_category)
instances = Output(returnListOrSingleValue_2)
