# Dynamo custom node Document.ListBuiltInCategoriesByName.dyf (Dynamo 0.8.2.2392)
# category: Clockwork.Revit.Document.Query
# Looks up all the built-in categories based on a given name (or part of a name) of the category. Search is case-insensitive.

listBuiltInCategories = Custom[Document.ListBuiltInCategories]()  # List all the available BuiltInCategories
searchFor = Input(searchFor : string)
ignoreCase = Input(ignoreCase : bool = true)
contains = String.Contains(searchFor=searchFor, ignoreCase=ignoreCase)
filter = List.Filter(listBuiltInCategories, contains)
BuiltInCategories = Output(filter)
