# Dynamo custom node Document.ListBuiltInParameters.dyf (Dynamo 0.8.3.2553)
# category: Clockwork.Revit.Document.Query
# List all the available BuiltInParameters

python_script = Python()
# ---------- python_script.python (7 lines) ----------
import clr
clr.AddReference('RevitAPI')
clr.AddReference('RevitAPIUI')
from Autodesk.Revit.DB import *
import Autodesk

OUT = dir(BuiltInParameter)
# ----------------------------------------
code_block = CodeBlock { "__"; false; }
contains = String.Contains(searchFor=code_block.out0, ignoreCase=code_block.out1)
filter = List.Filter(python_script, contains)
BuiltInParameters = Output(filter.out1)
