# Dynamo custom node Document.ListBuiltInParametersByName.dyf (Dynamo 0.8.3.2553)
# category: Clockwork.Revit.Document.Query
# Looks up all the built-in parameters based on a given name (or part of a name) of the parameters. Search is case-insensitive.

listBuiltInParameters = Custom[Document.ListBuiltInParameters]()  # List all the available BuiltInParameters
searchFor = Input(searchFor : string)
ignoreCase = Input(ignoreCase : bool = true)
contains = String.Contains(searchFor=searchFor, ignoreCase=ignoreCase)
filter = List.Filter(listBuiltInParameters, contains)
BuiltInParameters = Output(filter)
