# Dynamo custom node Document.ProjectPosition.dyf (Dynamo 0.8.2.2392)
# category: Clockwork.Revit.Document.Query
# Gets the project's position data relative to the origin. Use the built-in nodes Location.Latitude & Location.Longitude to retrieve latitude and longitude.

toggle = Input(toggle : bool = true)
python_script = Python(IN[0]=toggle)
# ---------- python_script.python (15 lines) ----------
import clr
clr.AddReference('RevitAPI')
from Autodesk.Revit.DB import *
import Autodesk

clr.AddReference("RevitServices")
import RevitServices
from RevitServices.Persistence import DocumentManager

doc = DocumentManager.Instance.CurrentDBDocument

projloc = doc.ActiveProjectLocation
position_data = projloc.ProjectPosition[XYZ.Zero]
location_data = projloc.SiteLocation
OUT = (position_data.Angle,position_data.Elevation,position_data.EastWest,position_data.NorthSouth)
# ----------------------------------------
code_block = CodeBlock(seq=python_script) { seq[0]; seq[1]; seq[2]; seq[3]; }
radiansToDegrees = Math.RadiansToDegrees(code_block.out0)
Angle_degr = Output(radiansToDegrees)  # "Angle (degr.)"
unit_types = UnitTypes("Length")
displayUnitType = Custom[UnitType.DisplayUnitType](unitType=unit_types)  # Retrieves the display unit type for a given unit type.
toDisplayUnit = Custom[InternalUnit.ToDisplayUnit](val=code_block.out1, displayUnitType=displayUnitType.displayUnitType)  # Converts a value from Revit's internal unit to a given display unit
Elevation = Output(toDisplayUnit)
toDisplayUnit_2 = Custom[InternalUnit.ToDisplayUnit](val=code_block.out2, displayUnitType=displayUnitType.displayUnitType)
EastWest = Output(toDisplayUnit_2)
toDisplayUnit_3 = Custom[InternalUnit.ToDisplayUnit](val=code_block.out3, displayUnitType=displayUnitType.displayUnitType)
NorthSouth = Output(toDisplayUnit_3)
