# Dynamo custom node Document.SaveAs.dyf (Dynamo 0.8.2.2392)
# category: Clockwork.Revit.Document.Actions
# Saves the active Revit document under the given name.

filePath = Input(filePath : string)
code_block = CodeBlock(path1=filePath)
# ---------- code_block.designscript (4 lines) ----------
// Delete filetype (if present in string)
// Filetype will automatically be added by Python script
path2 = String.Replace(path1,".rvt","");
String.Replace(path2,".rfa","");
# ----------------------------------------
python_script = Python(IN[0]=code_block.out1)
# ---------- python_script.python (16 lines) ----------
import clr
clr.AddReference('RevitAPI')
from Autodesk.Revit.DB import *

clr.AddReference("RevitServices")
import RevitServices
from RevitServices.Persistence import DocumentManager

doc = DocumentManager.Instance.CurrentDBDocument
path = IN[0]

if doc.IsFamilyDocument:
	path += '.rfa'
else:
	path += '.rvt'
OUT = doc.SaveAs(path)
# ----------------------------------------
result = Output(python_script)
