# Dynamo custom node Document.SynchronizeWithCentral.dyf (Dynamo 0.8.2.2392)
# category: Clockwork.Revit.Document.Actions
# Synchronizes a workshared model with the central model.

relinquishProjectStandardWorksets = Input(relinquishProjectStandardWorksets : bool = false)
relinquishViewWorksets = Input(relinquishViewWorksets : bool = false)
relinquishFamilyWorksets = Input(relinquishFamilyWorksets : bool = false)
relinquishUserCreatedWorksets = Input(relinquishUserCreatedWorksets : bool = false)
relinquishBorrowedElements = Input(relinquishBorrowedElements : bool = false)
compactCentralModel = Input(compactCentralModel : bool = false)
saveLocalFileBeforeSync = Input(saveLocalFileBeforeSync : bool = true)
saveLocalFileAfterSync = Input(saveLocalFileAfterSync : bool = true)
comment = Input(comment : string = "")
python_script = Python(IN[0]=relinquishProjectStandardWorksets, IN[1]=relinquishViewWorksets, IN[2]=relinquishFamilyWorksets, IN[3]=relinquishUserCreatedWorksets, IN[4]=relinquishBorrowedElements, IN[5]=compactCentralModel, IN[6]=saveLocalFileBeforeSync, IN[7]=saveLocalFileAfterSync, IN[8]=comment)
# ---------- python_script.python (33 lines) ----------
import clr
clr.AddReference('RevitAPI')
from Autodesk.Revit.DB import *

clr.AddReference("RevitServices")
import RevitServices
from RevitServices.Persistence import DocumentManager

relStandardWS = IN[0]
relViewWS = IN[1]
relFamWS = IN[2]
relUserWS = IN[3]
relCheckedOutElems = IN[4]
compact = IN[5]
saveLocalBefore = IN[6]
saveLocalAfter = IN[7]
comment = IN[8]

doc = DocumentManager.Instance.CurrentDBDocument
tOptions = TransactWithCentralOptions()
rOptions = RelinquishOptions(False)
rOptions.StandardWorksets = relStandardWS
rOptions.ViewWorksets = relViewWS
rOptions.FamilyWorksets = relFamWS
rOptions.UserWorksets = relUserWS
rOptions.CheckedOutElements = relCheckedOutElems
sOptions = SynchronizeWithCentralOptions()
sOptions.SetRelinquishOptions(rOptions)
sOptions.Compact = compact
sOptions.SaveLocalBefore = saveLocalBefore
sOptions.SaveLocalAfter = saveLocalAfter
sOptions.Comment = comment
out = doc.SynchronizeWithCentral(tOptions, sOptions)
# ----------------------------------------
Output = Output(python_script)  # ""
