# Dynamo custom node Element.ExternalFileReferencePath.dyf (Dynamo 0.8.3.2580)
# category: Clockwork.Revit.Elements.Element.Query
# Returns the full path of an element's external file reference as as string

element = Input()
turn_into_list = Custom[Turn Into List](element)  # Turns an element (or a nested list) into a flat list
python_script = Python(IN[0]=turn_into_list)
# ---------- python_script.python (19 lines) ----------
import clr
clr.AddReference('RevitAPI')
from Autodesk.Revit.DB import *

clr.AddReference("RevitServices")
import RevitServices
from RevitServices.Persistence import DocumentManager

doc = DocumentManager.Instance.CurrentDBDocument

items = UnwrapElement(IN[0])
elementlist = []
for item in items:
	try:
		exref = ModelPathUtils.ConvertModelPathToUserVisiblePath(item.GetExternalFileReference().GetAbsolutePath())
		elementlist.append(exref)
	except:
		elementlist.append(list())
OUT = elementlist
# ----------------------------------------
returnListOrSingleValue = Custom[ReturnListOrSingleValue](unknownItem=element, seq=python_script)  # If the item in input #1 is not a list, only the first item of the list in input #2 will be returned.
path = Output(returnListOrSingleValue)
