# Dynamo custom node Element.Inserts.dyf (Dynamo 0.8.3.2553)
# category: Clockwork.Revit.Elements.Element.Query
# Gets all the objects inserted into a given element.

element = Input()
turn_into_list = Custom[Turn Into List](element)  # Turns an element (or a nested list) into a flat list
includeOpenings = Input(includeOpenings : bool = false)
includeShadows = Input(includeShadows : bool = false)
includeEmbeddedWalls = Input(includeEmbeddedWalls : bool = false)
includeSharedEmbeddedInserts = Input(includeSharedEmbeddedInserts : bool = false)
python_script = Python(IN[0]=turn_into_list, IN[1]=includeOpenings, IN[2]=includeShadows, IN[3]=includeEmbeddedWalls, IN[4]=includeSharedEmbeddedInserts)
# ---------- python_script.python (29 lines) ----------
import clr
clr.AddReference('RevitAPI')
from Autodesk.Revit.DB import *

clr.AddReference("RevitNodes")
import Revit
clr.ImportExtensions(Revit.Elements)

clr.AddReference("RevitServices")
import RevitServices
from RevitServices.Persistence import DocumentManager

doc = DocumentManager.Instance.CurrentDBDocument
items = UnwrapElement(IN[0])
incopenings = IN[1]
incshadows = IN[2]
incwalls = IN[3]
incshared = IN[4]
elementlist = list()

for item in items:
	itemlist = list()
	try:
		for insert in item.FindInserts(incopenings,incshadows,incwalls,incshared):
			itemlist.append(doc.GetElement(insert).ToDSType(True))
	except:
		donothing = 1
	elementlist.append(itemlist)
OUT = elementlist
# ----------------------------------------
returnListOrSingleValue = Custom[ReturnListOrSingleValue](unknownItem=element, seq=python_script)  # If the item in input #1 is not a list, only the first item of the list in input #2 will be returned.
inserts = Output(returnListOrSingleValue)
