# Dynamo custom node Element.IsOfCategory.dyf (Dynamo 0.8.3.2553)
# category: Clockwork.Revit.Elements.Element.Query
# Checks whether an element is of a specified category

element = Input()
turn_into_list = Custom[Turn Into List](element)  # Turns an element (or a nested list) into a flat list
category = Input()
python_script = Python(IN[0]=turn_into_list, IN[1]=category)
# ---------- python_script.python (13 lines) ----------
import clr
clr.AddReference('RevitAPI')
from Autodesk.Revit.DB import *

elements = UnwrapElement(IN[0])
cat = UnwrapElement(IN[1])
elementlist = list()
for item in elements:
	if item.Category.Id==cat.Id:
		elementlist.append(True)
	else:
		elementlist.append(False)
OUT = elementlist
# ----------------------------------------
returnListOrSingleValue = Custom[ReturnListOrSingleValue](unknownItem=element, seq=python_script)  # If the item in input #1 is not a list, only the first item of the list in input #2 will be returned.
bool = Output(returnListOrSingleValue)
