# Dynamo custom node Element.Materials.dyf (Dynamo 0.8.3.2553)
# category: Clockwork.Revit.Elements.Element.Query
# Retrieves all materials froma given element

element = Input()
turn_into_list = Custom[Turn Into List](element)  # Turns an element (or a nested list) into a flat list
includePaintMaterials = Input(includePaintMaterials : bool = false)
python_script = Python(IN[0]=turn_into_list, IN[1]=includePaintMaterials)
# ---------- python_script.python (27 lines) ----------
import clr
clr.AddReference('RevitAPI')
from Autodesk.Revit.DB import *

clr.AddReference("RevitServices")
import RevitServices
from RevitServices.Persistence import DocumentManager

doc = DocumentManager.Instance.CurrentDBDocument
items = UnwrapElement(IN[0])
paintedmats = IN[1]
elementmats = list()
elementareas = list()
elementvols = list()

for item in items:
	matlist = list()
	arealist = list()
	vollist = list()
	for matid in item.GetMaterialIds(paintedmats):
		matlist.append(doc.GetElement(matid))
		arealist.append(item.GetMaterialArea(matid,paintedmats))
		vollist.append(item.GetMaterialVolume(matid))
	elementmats.append(matlist)
	elementareas.append(arealist)
	elementvols.append(vollist)
OUT = (elementmats,elementareas,elementvols)
# ----------------------------------------
code_block = CodeBlock(seq=python_script) { seq[0]; seq[1]; seq[2]; }
returnListOrSingleValue = Custom[ReturnListOrSingleValue](unknownItem=element, seq=code_block.out0)  # If the unknown item is not a list but rather a single item, only the first item of the list (input "seq") will be returned.
materials = Output(returnListOrSingleValue)
unit_types = UnitTypes("Area")
displayUnitType = Custom[UnitType.DisplayUnitType](unitType=unit_types)  # Retrieves the display unit type for a given unit type.
toDisplayUnit = Custom[InternalUnit.ToDisplayUnit](val=code_block.out1, displayUnitType=displayUnitType.displayUnitType)  # Converts a value from Revit's internal unit to a given display unit
returnListOrSingleValue_2 = Custom[ReturnListOrSingleValue](unknownItem=element, seq=toDisplayUnit)
materialAreas = Output(returnListOrSingleValue_2)
unit_types_2 = UnitTypes("Volume")
displayUnitType_2 = Custom[UnitType.DisplayUnitType](unitType=unit_types_2)
toDisplayUnit_2 = Custom[InternalUnit.ToDisplayUnit](val=code_block.out2, displayUnitType=displayUnitType_2.displayUnitType)
returnListOrSingleValue_3 = Custom[ReturnListOrSingleValue](unknownItem=element, seq=toDisplayUnit_2)
materialVolumes = Output(returnListOrSingleValue_3)
isEmpty = List.IsEmpty()
map = List.Map(list=code_block.out0, f_x=isEmpty)
not_ = Not(map)
returnListOrSingleValue_4 = Custom[ReturnListOrSingleValue](unknownItem=element, seq=not_)
hasMaterial = Output(returnListOrSingleValue_4)
