# Dynamo custom node Element.OverrideTransparencyInView.dyf (Dynamo 0.8.2.2392)
# category: Clockwork.Revit.Elements.Element.Actions
# Overrides the transparency of an element in a given view

element = Input()
turn_into_list = Custom[Turn Into List](element)  # Turns an element (or a nested list) into a flat list
view = Input(view : View)
transparencyPercentage = Input()
python_script = Python(IN[0]=turn_into_list, IN[1]=view, IN[2]=transparencyPercentage)
# ---------- python_script.python (27 lines) ----------
import clr
clr.AddReference('RevitAPI')
from Autodesk.Revit.DB import *

clr.AddReference("RevitNodes")
import Revit
clr.ImportExtensions(Revit.Elements)

clr.AddReference("RevitServices")
import RevitServices
from RevitServices.Persistence import DocumentManager
from RevitServices.Transactions import TransactionManager

doc = DocumentManager.Instance.CurrentDBDocument
items = UnwrapElement(IN[0])
view = UnwrapElement(IN[1])
trans = IN[2]
elementlist = list()

override = OverrideGraphicSettings()
override.SetSurfaceTransparency(trans)

TransactionManager.Instance.EnsureInTransaction(doc)
for item in items:
	view.SetElementOverrides(item.Id, override)
TransactionManager.Instance.TransactionTaskDone()
OUT = items
# ----------------------------------------
returnListOrSingleValue = Custom[ReturnListOrSingleValue](unknownItem=element, seq=python_script)  # If the item in input #1 is not a list, only the first item of the list in input #2 will be returned.
element_2 = Output(returnListOrSingleValue)  # "element"
