# Dynamo custom node Element.ParameterExists.dyf (Dynamo 0.8.3.2580)
# category: Clockwork.Revit.Elements.Element.Query
# Checks if an element contains a parameter of a given name

element = Input()
turn_into_list = Custom[Turn Into List](element)  # Turns an element (or a nested list) into a flat list
param = Input(param : string)
python_script = Python(IN[0]=turn_into_list, IN[1]=param)
# ---------- python_script.python (28 lines) ----------
# This node was originally created by Andreas Dieckmann
# and only updated by Konrad K Sobon to work with Revit 2016

# Copyright(c) 2015, Konrad K Sobon
# @arch_laboratory, http://archi-lab.net

# Modified to Clockwork coding style by Andreas Dieckmann

import clr
clr.AddReference('RevitAPI')
from Autodesk.Revit.DB import *

items = UnwrapElement(IN[0])
param = IN[1]
elementList = []

for item in items:
	try:
		params = item.Parameters
		paramNames = [i.Definition.Name for i in params]
		if param in paramNames:
			elementList.append(True)
		else:
			elementList.append(False)
	except:
		elementList.append(False)

OUT = elementList
# ----------------------------------------
returnListOrSingleValue = Custom[ReturnListOrSingleValue](unknownItem=element, seq=python_script)  # If the item in input #1 is not a list, only the first item of the list in input #2 will be returned.
bool = Output(returnListOrSingleValue)
