# Dynamo custom node Element.SetWorkset.dyf (Dynamo 0.8.3.2580)
# category: Clockwork.Revit.Elements.Element.Actions
# Sets the workset of a given element

element = Input()
turn_into_list = Custom[Turn Into List](element)  # Turns an element (or a nested list) into a flat list
workset = Input()
python_script = Python(IN[0]=turn_into_list, IN[1]=workset)
# ---------- python_script.python (24 lines) ----------
import clr
clr.AddReference('RevitAPI')
from Autodesk.Revit.DB import *

clr.AddReference("RevitServices")
import RevitServices
from RevitServices.Persistence import DocumentManager
from RevitServices.Transactions import TransactionManager

doc = DocumentManager.Instance.CurrentDBDocument
faminsts = UnwrapElement(IN[0])
ws = UnwrapElement(IN[1])
elementlist = list()
faillist = list()
TransactionManager.Instance.EnsureInTransaction(doc)
for item in faminsts:
	try:
		param = item.get_Parameter(BuiltInParameter.ELEM_PARTITION_PARAM)
		param.Set(ws.Id.IntegerValue)
		elementlist.append(item)
	except:
		faillist.append(item)
TransactionManager.Instance.TransactionTaskDone()
OUT = (elementlist,faillist)
# ----------------------------------------
code_block = CodeBlock(seq=python_script) { seq[0]; seq[1]; }
changedElements = Output(code_block.out0)
unchangedElements = Output(code_block.out1)
