# Dynamo custom node Elements.FilterByName.dyf (Dynamo 0.8.3.2580)
# category: Clockwork.Revit.Selection.Filters
# Retrieves those elements from a collection whose names match the search string

elements = Input()
turn_into_list = Custom[Turn Into List](elements)  # Turns an element (or a nested list) into a flat list
element_name_universal = Custom[Element.Name (Universal)](element=turn_into_list)  # Gets an element's name (Dynamo's built-in Name nodes don't work for all element types, e.g. worksets...)
searchString = Input(searchString : string)
ignoreCase = Input(ignoreCase : bool = true)
code_block = CodeBlock(str=element_name_universal, search=searchString, igncase=ignoreCase, list=turn_into_list)
# ---------- code_block.designscript (5 lines) ----------
mask = String.Contains(str,search,igncase);
filter = List.FilterByBoolMask(list,mask);
filter["in"][0];
filter["in"];
filter["out"];
# ----------------------------------------
first = Output(code_block.out2)
in_ = Output(code_block.out3)  # "in"
out = Output(code_block.out4)
