# Dynamo custom node Elements.FilterByParameterValueAndCondition.dyf (Dynamo 0.8.3.2580)
# category: Clockwork.Revit.Selection.Filters

elements = Input()
param = Input(param : string)
parameterExists = Custom[Element.ParameterExists](param=param)  # Checks if an element contains a parameter of a given name
filter = List.Filter(elements, parameterExists)
code_block = CodeBlock(elem=filter.out0, param=param) { elem.GetParameterValueByName(param); }
func = Input()
map = List.Map(list=code_block, f_x=func)
code_block_2 = CodeBlock(list=filter.out0, mask=map) { filter = List.FilterByBoolMask(list,mask); filter["in"]; filter["out"]; }
in_ = Output(code_block_2.out1)  # "in"
join = List.Join(filter.out1, code_block_2.out2)
out = Output(join)
