# Dynamo custom node FamilyInstance.CopingElements.dyf (Dynamo 0.8.3.2580)
# category: Clockwork.Revit.Elements.FamilyInstance.Query
# Returns all elements used as coping cutters for a given element.

familyInstance = Input()
turn_into_list = Custom[Turn Into List](familyInstance)  # Turns an element (or a nested list) into a flat list
python_script = Python(IN[0]=turn_into_list)
# ---------- python_script.python (22 lines) ----------
import clr
import System
clr.AddReference('RevitAPI')
from Autodesk.Revit.DB import *

clr.AddReference("RevitServices")
import RevitServices
from RevitServices.Persistence import DocumentManager

doc = DocumentManager.Instance.CurrentDBDocument
fams = UnwrapElement(IN[0])
elementlist = list()

for fam in fams:
	try:
		copinglist = list()
		for id in fam.GetCopingIds():
			copinglist.append(doc.GetElement(id))
		elementlist.append(copinglist)
	except:	elementlist.append(list())

OUT = elementlist
# ----------------------------------------
returnListOrSingleValue = Custom[ReturnListOrSingleValue](unknownItem=familyInstance, seq=python_script)  # If the item in input #1 is not a list, only the first item of the list in input #2 will be returned.
copingElements = Output(returnListOrSingleValue)
