# Dynamo custom node FamilyInstance.SubComponents.dyf (Dynamo 0.8.3.2580)
# category: Clockwork.Revit.Elements.FamilyInstance.Query
# Retrieves all subcomponents of a given family instance

familyInstance = Input()
turn_into_list = Custom[Turn Into List](familyInstance)  # Turns an element (or a nested list) into a flat list
python_script = Python(IN[0]=turn_into_list)
# ---------- python_script.python (25 lines) ----------
import clr
clr.AddReference('RevitAPI')
from Autodesk.Revit.DB import *

clr.AddReference("RevitNodes")
import Revit
clr.ImportExtensions(Revit.Elements)

clr.AddReference("RevitServices")
import RevitServices
from RevitServices.Persistence import DocumentManager

doc = DocumentManager.Instance.CurrentDBDocument
items = UnwrapElement(IN[0])
elementlist = list()

for item in items:
	itemlist = list()
	try:
		for subcomp in item.GetSubComponentIds():
			itemlist.append(doc.GetElement(subcomp).ToDSType(True))
	except:
		donothing = 1
	elementlist.append(itemlist)
OUT = elementlist
# ----------------------------------------
returnListOrSingleValue = Custom[ReturnListOrSingleValue](unknownItem=familyInstance, seq=python_script)  # If the item in input #1 is not a list, only the first item of the list in input #2 will be returned.
subComponents = Output(returnListOrSingleValue)
