# Dynamo custom node FamilyInstance.SuperComponent.dyf (Dynamo 0.8.3.2580)
# category: Clockwork.Revit.Elements.FamilyInstance.Query
# Retrieves the supercomponent of a given family instance

familyInstance = Input()
turn_into_list = Custom[Turn Into List](familyInstance)  # Turns an element (or a nested list) into a flat list
python_script = Python(IN[0]=turn_into_list)
# ---------- python_script.python (17 lines) ----------
import clr
clr.AddReference('RevitAPI')
from Autodesk.Revit.DB import *

clr.AddReference("RevitNodes")
import Revit
clr.ImportExtensions(Revit.Elements)

items = UnwrapElement(IN[0])
elementlist = list()

for item in items:
	try:
		elementlist.append(item.SuperComponent.ToDSType(True))
	except:
		elementlist.append(list())
OUT = elementlist
# ----------------------------------------
returnListOrSingleValue = Custom[ReturnListOrSingleValue](unknownItem=familyInstance, seq=python_script)  # If the item in input #1 is not a list, only the first item of the list in input #2 will be returned.
superComponent = Output(returnListOrSingleValue)
