# Dynamo custom node FamilyParameter.Properties.dyf (Dynamo 0.8.2.2392)
# category: Clockwork.Revit.Elements.FamilyParameter
# Retrieves all properties of a given family parameter. PLEASE NOTE: This node will only work in a family document!

familyParameter = Input()
turnIntoList = Custom[TurnIntoList](unknownItem=familyParameter)  # Turns an element (or a nested list) into a flat list
python_script = Python(IN[0]=turnIntoList)
# ---------- python_script.python (59 lines) ----------
import clr
clr.AddReference('RevitAPI')
from Autodesk.Revit.DB import *

clr.AddReference("RevitNodes")
import Revit
clr.ImportExtensions(Revit.Elements)

params = UnwrapElement(IN[0])
pname = list()
guid = list()
pgroup = list()
ptype = list()
utype = list()
dutype = list()
stype = list()
isinstance = list()
isreporting = list()
isshared = list()
isreadonly = list()
usermodifiable = list()
formula = list()
determinedbyformula = list()
associatedparams = list()
associatedelements = list()
canassignformula = list()
for param in params:
	pname.append(param.Definition.Name)
	try:
		guid.append(param.GUID)
	except:
		guid.append('')
	pgroup.append(param.Definition.ParameterGroup)
	ptype.append(param.Definition.ParameterType)
	utype.append(param.Definition.UnitType)
	try:
		dutype.append(param.DisplayUnitType)
	except:
		dutype.append('')
	stype.append(param.StorageType)
	isinstance.append(param.IsInstance)
	isreporting.append(param.IsReporting)
	isshared.append(param.IsShared)
	isreadonly.append(param.IsReadOnly)
	usermodifiable.append(param.UserModifiable)
	if param.Formula == None:
		formula.append('')
	else:
		formula.append(param.Formula)
	determinedbyformula.append(param.IsDeterminedByFormula)
	assocparams = param.AssociatedParameters
	associatedparams.append(assocparams)
	assocelems = list()
	for assoc in assocparams:
		assocelems.append(assoc.Element)
	associatedelements.append(assocelems)
	canassignformula.append(param.CanAssignFormula)
	
OUT = (pname,guid,pgroup,ptype,utype,dutype,stype,isinstance,isreporting,isshared,isreadonly,usermodifiable,formula,determinedbyformula,associatedparams,canassignformula,associatedelements)
# ----------------------------------------
code_block = CodeBlock(seq=python_script)
# ---------- code_block.designscript (17 lines) ----------
seq[0];
seq[1];
seq[2];
seq[3];
seq[4];
seq[5];
seq[6];
seq[7];
seq[8];
seq[9];
seq[10];
seq[11];
seq[12];
seq[13];
seq[14];
seq[15];
seq[16];
# ----------------------------------------
returnListOrSingleValue = Custom[ReturnListOrSingleValue](unknownItem=familyParameter, seq=code_block.out0)  # If the unknown item is not a list but rather a single item, only the first item of the list (input "seq") will be returned.
Name = Output(returnListOrSingleValue)
returnListOrSingleValue_2 = Custom[ReturnListOrSingleValue](unknownItem=familyParameter, seq=code_block.out1)
GUID = Output(returnListOrSingleValue_2)
returnListOrSingleValue_3 = Custom[ReturnListOrSingleValue](unknownItem=familyParameter, seq=code_block.out2)
Group = Output(returnListOrSingleValue_3)
returnListOrSingleValue_4 = Custom[ReturnListOrSingleValue](unknownItem=familyParameter, seq=code_block.out3)
Type = Output(returnListOrSingleValue_4)
returnListOrSingleValue_5 = Custom[ReturnListOrSingleValue](unknownItem=familyParameter, seq=code_block.out4)
UnitType = Output(returnListOrSingleValue_5)
returnListOrSingleValue_6 = Custom[ReturnListOrSingleValue](unknownItem=familyParameter, seq=code_block.out5)
DisplayUnitType = Output(returnListOrSingleValue_6)
returnListOrSingleValue_7 = Custom[ReturnListOrSingleValue](unknownItem=familyParameter, seq=code_block.out6)
StorageType = Output(returnListOrSingleValue_7)
returnListOrSingleValue_8 = Custom[ReturnListOrSingleValue](unknownItem=familyParameter, seq=code_block.out7)
IsInstanceParameter = Output(returnListOrSingleValue_8)
returnListOrSingleValue_9 = Custom[ReturnListOrSingleValue](unknownItem=familyParameter, seq=code_block.out8)
IsReportingParameter = Output(returnListOrSingleValue_9)
returnListOrSingleValue_10 = Custom[ReturnListOrSingleValue](unknownItem=familyParameter, seq=code_block.out9)
IsSharedParameter = Output(returnListOrSingleValue_10)
returnListOrSingleValue_11 = Custom[ReturnListOrSingleValue](unknownItem=familyParameter, seq=code_block.out10)
IsReadOnly = Output(returnListOrSingleValue_11)
returnListOrSingleValue_12 = Custom[ReturnListOrSingleValue](unknownItem=familyParameter, seq=code_block.out15)
IsUserModfiable = Output(returnListOrSingleValue_12)
returnListOrSingleValue_13 = Custom[ReturnListOrSingleValue](unknownItem=familyParameter, seq=code_block.out13)
CanBeAssignedAFormula = Output(returnListOrSingleValue_13)
returnListOrSingleValue_14 = Custom[ReturnListOrSingleValue](unknownItem=familyParameter, seq=code_block.out11)
IsDeterminedByFormula = Output(returnListOrSingleValue_14)
returnListOrSingleValue_15 = Custom[ReturnListOrSingleValue](unknownItem=familyParameter, seq=code_block.out12)
Formula = Output(returnListOrSingleValue_15)
returnListOrSingleValue_16 = Custom[ReturnListOrSingleValue](unknownItem=familyParameter, seq=code_block.out14)
AssociatedParameters = Output(returnListOrSingleValue_16)
returnListOrSingleValue_17 = Custom[ReturnListOrSingleValue](unknownItem=familyParameter, seq=code_block.out16)
AssociatedElements = Output(returnListOrSingleValue_17)
