# Dynamo custom node FamilyType.CompoundStructureLayers.dyf (Dynamo 0.8.3.2580)
# category: Clockwork.Revit.Elements.FamilyType.Query
# Retrieves the compound layers of any layered family type (wall types, roof types, floor types etc.)

elementType = Input()
turn_into_list = Custom[Turn Into List](elementType)  # Turns an element (or a nested list) into a flat list
python_script = Python(IN[0]=turn_into_list)
# ---------- python_script.python (61 lines) ----------
import clr
clr.AddReference('RevitAPI')
from Autodesk.Revit.DB import *

clr.AddReference("RevitNodes")
import Revit
clr.ImportExtensions(Revit.Elements)

clr.AddReference("RevitServices")
import RevitServices
from RevitServices.Persistence import DocumentManager

doc = DocumentManager.Instance.CurrentDBDocument
items = UnwrapElement(IN[0])
elemlayers = list()
elemmat = list()
elemfunc = list()
elemwidth = list()
elemcore = list()
elemwraps = list()
elemvar = list()
elemdeck = list()

for item in items:
	try:
		counter = 0
		layers = list()
		layermat = list()
		layerfunc = list()
		layerwidth = list()
		layercore = list()
		layerwraps = list()
		layervar = list()
		layerdeck = list()
		compstruc = item.GetCompoundStructure()
		num = compstruc.LayerCount
		vertcomp = compstruc.IsVerticallyCompound
		varlayer = compstruc.VariableLayerIndex
		while counter < num:
			layers.append(compstruc.GetLayers()[counter])
			layermat.append(doc.GetElement(compstruc.GetMaterialId(counter)))
			layerfunc.append(compstruc.GetLayerFunction(counter))
			layerwidth.append(compstruc.GetLayerWidth(counter))
			layercore.append(compstruc.IsCoreLayer(counter))
			if compstruc.IsCoreLayer(counter): layerwraps.append(False)
			else: layerwraps.append(compstruc.ParticipatesInWrapping(counter))
			if varlayer == counter: layervar.append(True)
			else: layervar.append(False)
			layerdeck.append(compstruc.IsStructuralDeck(counter))
			counter += 1
	except:
		donothing = 1
	elemlayers.append(layers)
	elemmat.append(layermat)
	elemfunc.append(layerfunc)
	elemwidth.append(layerwidth)
	elemcore.append(layercore)
	elemwraps.append(layerwraps)
	elemvar.append(layervar)
	elemdeck.append(layerdeck)
OUT = (elemlayers, elemmat, elemfunc, elemwidth, elemcore, elemwraps, elemvar, elemdeck)
# ----------------------------------------
code_block = CodeBlock(seq=python_script) { seq[0]; seq[1]; seq[2]; seq[3]; seq[4]; seq[5]; seq[6]; seq[7]; }
returnListOrSingleValue = Custom[ReturnListOrSingleValue](unknownItem=elementType, seq=code_block.out1)  # If the item in input #1 is not a list, only the first item of the list in input #2 will be returned.
materials = Output(returnListOrSingleValue)
returnListOrSingleValue_2 = Custom[ReturnListOrSingleValue](unknownItem=elementType, seq=code_block.out2)
functions = Output(returnListOrSingleValue_2)
unit_types = UnitTypes("Length")
displayUnitType = Custom[UnitType.DisplayUnitType](unitType=unit_types)  # Retrieves the display unit type for a given unit type.
toDisplayUnit = Custom[InternalUnit.ToDisplayUnit](val=code_block.out3, displayUnitType=displayUnitType.displayUnitType)  # Converts a value from Revit's internal unit to a given display unit
returnListOrSingleValue_3 = Custom[ReturnListOrSingleValue](unknownItem=elementType, seq=toDisplayUnit)
widths = Output(returnListOrSingleValue_3)
returnListOrSingleValue_4 = Custom[ReturnListOrSingleValue](unknownItem=elementType, seq=code_block.out4)
isCore = Output(returnListOrSingleValue_4)
returnListOrSingleValue_5 = Custom[ReturnListOrSingleValue](unknownItem=elementType, seq=code_block.out5)
wraps = Output(returnListOrSingleValue_5)
returnListOrSingleValue_6 = Custom[ReturnListOrSingleValue](unknownItem=elementType, seq=code_block.out6)
isVariable = Output(returnListOrSingleValue_6)
returnListOrSingleValue_7 = Custom[ReturnListOrSingleValue](unknownItem=elementType, seq=code_block.out7)
isStructuralDeck = Output(returnListOrSingleValue_7)
returnListOrSingleValue_8 = Custom[ReturnListOrSingleValue](unknownItem=elementType, seq=code_block.out0)
layers = Output(returnListOrSingleValue_8)
