# Dynamo custom node File.WriteToCSV.dyf (Dynamo 0.8.3.2553)
# category: Clockwork.Core.File.Actions
# Writes data to a CSV file with a custom delimiter. Data inputs needs to contain strings only!

path = Input(path : string)
code_block = CodeBlock(path=path)
# ---------- code_block.designscript (4 lines) ----------
// Make sure the filetype is set to CSV
path2 = String.Replace(path,".csv","");
path3 = String.Replace(path2,".CSV","");
path3 + ".csv";
# ----------------------------------------
string = StringInput("\n")
delimiter = Input(delimiter : string = ",")
data = Input()
join = String.Join(delimiter, data)
code_block_2 = CodeBlock(seq=join) { Flatten(seq); }
join_2 = String.Join(string, code_block_2)
code_block_3 = CodeBlock(seq=join_2) { seq[0]; }
writeText = File.WriteText(code_block.out2, code_block_3)
void = Output(writeText)
