# Dynamo custom node Group.Members.dyf (Dynamo 0.8.3.2580)
# category: Clockwork.Revit.Elements.Group.Query
# Retrieves the members of a group

group = Input()
turn_into_list = Custom[Turn Into List](group)  # Turns an element (or a nested list) into a flat list
python_script = Python(IN[0]=turn_into_list)
# ---------- python_script.python (24 lines) ----------
import clr
clr.AddReference('RevitAPI')
from Autodesk.Revit.DB import *

clr.AddReference("RevitNodes")
import Revit
clr.ImportExtensions(Revit.Elements)

clr.AddReference("RevitServices")
import RevitServices
from RevitServices.Persistence import DocumentManager

doc = DocumentManager.Instance.CurrentDBDocument
groups = UnwrapElement(IN[0])
elementlist = list()
for item in groups:
	try:
		memberlist = list()
		for member in item.GetMemberIds():
			memberlist.append(doc.GetElement(member))
		elementlist.append(memberlist)
	except:
		elementlist.append(list())
OUT = elementlist
# ----------------------------------------
returnListOrSingleValue = Custom[ReturnListOrSingleValue](unknownItem=group, seq=python_script)  # If the item in input #1 is not a list, only the first item of the list in input #2 will be returned.
memberElements = Output(returnListOrSingleValue)
