# Dynamo custom node Hypotenuse.ByPythagoras.dyf (Dynamo 0.8.1.1693)
# category: Clockwork.Core.Formulas.Query
# Computes the length of the hypotenuse of a right triangle using the Pythagorean Theorem. A and B are the legs / catheti of the triangle.

SideA = Input(SideA : double)
SideB = Input(SideB : double)
code_block = CodeBlock(a=SideA, b=SideB) { Math.Sqrt(Math.Pow(a,2)+Math.Pow(b,2)); }
SideC = Output(code_block)
