# Dynamo custom node List.AnyFalse.dyf (Dynamo 0.8.2.2392)
# category: Clockwork.Core.List.Query
# Returns true if any item in a list of booleans is false.

seq = Input(seq : bool[])
code_block = CodeBlock(seq=seq) { !(AllTrue(seq)); }
bool = Output(code_block)
