# Dynamo custom node List.AnyTrue.dyf (Dynamo 0.8.1.1693)
# category: Clockwork.Core.List.Query
# Returns true if any item in a list of booleans is true.

seq = Input(seq : bool[])
formula = Formula("x=1")
code_block = CodeBlock(seq=seq, predicate=formula) { List.IsEmpty(seq) ? false : TrueForAny(seq,predicate); }
any = Output(code_block)  # "any?"
