# Dynamo custom node List.CountOccurences.dyf (Dynamo 0.8.1.1693)
# category: Clockwork.Core.List.Query
# Counts the number of occurences of each unique element in a given list

seq = Input()
turn_into_list = Custom[Turn Into List](seq)  # Turns an element (or a nested list) into a flat list
identity = Object.Identity()
code_block = CodeBlock(seq=turn_into_list, keyprojector=identity) { GroupByKey(seq,keyprojector); }
firstItem = List.FirstItem()
map = List.Map(list=code_block, f_x=firstItem)
UniqueElements = Output(map)
sublistLengths = Custom[List.SublistLengths](list=code_block)  # Gets the lengths of all sublists in a given list of lists.
Count = Output(sublistLengths)
