# Dynamo custom node List.FromCSV.dyf (Dynamo 0.8.3.2553)
# category: Clockwork.Core.List.Create
# Converts the content of a given CSV file to a list

ignoreFirstRow = Input(ignoreFirstRow : bool = false)
CSVstring = Input(CSVstring : string)
code_block = CodeBlock(csv=CSVstring)
# ---------- code_block.designscript (5 lines) ----------
// Define separator as line break
sep = "
";
// Make a list of lines
String.Split(csv,sep);
# ----------------------------------------
delimiter = Input(delimiter : string = ",")
split = String.Split(arg1=delimiter)
map = List.Map(list=code_block.out1, f_x=split)
ignoreLastRow = Input(ignoreLastRow : bool = false)
code_block_2 = CodeBlock(ifr=ignoreFirstRow, seq1=map, ilr=ignoreLastRow)
# ---------- code_block_2.designscript (4 lines) ----------
// Ignore the first row?
seq2 = ifr ? List.RestOfItems(seq1) : seq1;
// Ignore the last row?
String.TrimWhitespace(ilr ? List.TakeItems(seq2,(List.Count(seq2)-1)) : seq2);
# ----------------------------------------
seq = Output(code_block_2.out1)
