# Dynamo custom node List.MatchWithKeyValues.dyf (Dynamo 0.8.1.1693)
# category: Clockwork.Core.List.Actions
# Matches a list with a given set of keys and returns the values corresponding to the keys

seq = Input()
turn_into_list = Custom[Turn Into List](item=seq)  # Turns an element (or a nested list) into a flat list
Keys = Input()
turn_into_list_2 = Custom[Turn Into List](item=Keys)
Values = Input()
turn_into_list_3 = Custom[Turn Into List](item=Values)
python_script = Python(IN[0]=turn_into_list, IN[1]=turn_into_list_2, IN[2]=turn_into_list_3)
# ---------- python_script.python (17 lines) ----------
import clr

items = IN[0]
keys = IN[1]
values = IN[2]
elementlist = list()
for item in items:
	counter = 0
	hasmatch = False
	for key in keys:
		if (item == key):
			elementlist.append(values[counter])
			hasmatch = True
		counter += 1
	if hasmatch == False:
		elementlist.append(list())
OUT = elementlist
# ----------------------------------------
Matched_Values = Output(python_script)
