# Dynamo custom node List.RepeatItemsByLengths.dyf (Dynamo 0.8.1.1693)
# category: Clockwork.Core.List.Create
# Repeats a list of items into sublists of given lengths

ofRepeatedItem = List.OfRepeatedItem()
seq = Input()
Lengths = Input(Lengths : int[])
combine = List.Combine(ofRepeatedItem, seq, Lengths)
seq_2 = Output(combine)  # "seq"
