# Dynamo custom node List.ReplaceItemAtIndex.dyf (Dynamo 0.8.1.1823)
# category: Clockwork.Core.List.Actions
# Replaces the item at a given index (or list of indices) of a list by another item

seq = Input()
replacement = Input()
turn_into_list = Custom[Turn Into List](replacement)  # Turns an element (or a nested list) into a flat list
index = Input(index : int)
turn_into_list_2 = Custom[Turn Into List](index)
python_script = Python(IN[0]=seq, IN[1]=turn_into_list, IN[2]=turn_into_list_2)
# ---------- python_script.python (8 lines) ----------
_list = IN[0]
rValues = IN[1]
iValues = IN[2]
if len(iValues) > 1 and len(rValues) == 1:
	rValues = [rValues[0]] * len(iValues)
for (index, value) in zip(iValues, rValues):
	_list[index] = value
OUT = _list
# ----------------------------------------
seq_2 = Output(python_script)  # "seq"
