# Dynamo custom node List.SortListOfLists.dyf (Dynamo 0.8.1.1693)
# category: Clockwork.Core.List.Actions
# Sorts a list of lists by one of its sublists

seq = Input()
code_block = CodeBlock(seq=seq) { List.Transpose(seq); }
SortIndex = Input(SortIndex : int)
CaseInsensitive = Input(CaseInsensitive : bool = false)
OrderDescending = Input(OrderDescending : bool = false)
python_script = Python(IN[0]=code_block, IN[1]=SortIndex, IN[2]=CaseInsensitive, IN[3]=OrderDescending)
# ---------- python_script.python (20 lines) ----------
import clr

lists = IN[0]
sortindex = int(IN[1])
caseinsensitive = IN[2]
sortdescending = IN[3]

# make sure that case-insensitive is turned of if it is not strings we're sorting
if caseinsensitive == True and isinstance(lists[0][sortindex], basestring) == False:
	caseinsensitive = False
if caseinsensitive == True:
	if sortdescending == True:
		OUT = sorted(lists, key=lambda lists:lists[sortindex].lower(), reverse=True)
	else:
		OUT = sorted(lists, key=lambda lists:lists[sortindex].lower())
else:
	if sortdescending == True:
		OUT = sorted(lists, key=lambda lists:lists[sortindex], reverse=True)
	else:
		OUT = sorted(lists, key=lambda lists:lists[sortindex])
# ----------------------------------------
code_block_2 = CodeBlock(seq=python_script) { List.Transpose(seq); }
seq_2 = Output(code_block_2)  # "seq"
