# Dynamo custom node List.SublistLengths.dyf (Dynamo 0.8.1.1693)
# category: Clockwork.Core.List.Query
# Gets the lengths of all sublists in a given list of lists.

seq = Input()
count = List.Count()
map = List.Map(list=seq, f_x=count)
Lengths = Output(map)
