# Dynamo custom node List.SublistsContain.dyf (Dynamo 0.8.1.1693)
# category: Clockwork.Core.List.Query
# Looks for an item in each sublist of a given list and returns true/false for each sublist.

seq = Input()
Item = Input()
containsItem = List.ContainsItem(item=Item)
map = List.Map(list=seq, f_x=containsItem)
bool = Output(map)
