# Dynamo custom node MassFloor.Mass.dyf (Dynamo 0.8.3.2580)
# category: Clockwork.Revit.Elements.MassFloor.Query
# Gets the mass a given mass floor belongs to

massFloor = Input()
turn_into_list = Custom[Turn Into List](massFloor)  # Turns an element (or a nested list) into a flat list
python_script = Python(IN[0]=turn_into_list)
# ---------- python_script.python (21 lines) ----------
import clr
clr.AddReference('RevitAPI')
from Autodesk.Revit.DB import *

clr.AddReference("RevitNodes")
import Revit
clr.ImportExtensions(Revit.Elements)

clr.AddReference("RevitServices")
import RevitServices
from RevitServices.Persistence import DocumentManager

doc = DocumentManager.Instance.CurrentDBDocument
massfloors = UnwrapElement(IN[0])
elementlist = list()
for item in massfloors:
	try:
		elementlist.append(doc.GetElement(item.OwningMassId).ToDSType(True))
	except:
		elementlist.append(list())
OUT = elementlist
# ----------------------------------------
returnListOrSingleValue = Custom[ReturnListOrSingleValue](unknownItem=massFloor, seq=python_script)  # If the item in input #1 is not a list, only the first item of the list in input #2 will be returned.
mass = Output(returnListOrSingleValue)
