# Dynamo custom node Math.IsEvenNumber.dyf (Dynamo 0.8.1.1693)
# category: Clockwork.Core.Math.Query
# Checks if a number is even.

Value = Input(Value : int)
isOddNumber = Custom[Math.IsOddNumber](Value=Value)  # Checks if a number is odd.
not_ = Not(isOddNumber)
bool = Output(not_)
