# Dynamo custom node Math.IsOddNumber.dyf (Dynamo 0.8.1.1693)
# category: Clockwork.Core.Math.Query
# Checks if a number is odd.

Value = Input(Value : int)
code_block = CodeBlock(n=Value) { Math.Round(n)/2 != Math.Round(Math.Round(n)/2); }
bool = Output(code_block)
