# Dynamo custom node Math.Normalize.dyf (Dynamo 0.8.1.1693)
# category: Clockwork.Core.Math.Actions
# Converts a value into a normalized value according to a value range

Value = Input(Value : double)
Min = Input(Min : double)
Max = Input(Max : double)
code_block = CodeBlock(value=Value, min=Min, max=Max) { (value-min)/(max-min); }
