# Dynamo custom node Math.RoundDownToPrecision.dyf (Dynamo 0.8.1.1823)
# category: Clockwork.Core.Math.Actions
# Rounds a number *down* to a specified precision

dbl = Input(dbl : double)
precision = Input(precision : double = 1)
code_block = CodeBlock(a=dbl, b=precision) { Math.Floor(a/b)*b; }
dbl_2 = Output(code_block)  # "dbl"
