# Dynamo custom node Math.RoundToPrecision.dyf (Dynamo 0.8.1.1693)
# category: Clockwork.Core.Math.Actions
# Rounds a number to a specified precision

Number = Input(Number : double)
Precision = Input(Precision : double = 1)
code_block = CodeBlock(a=Number, b=Precision) { Math.Round(a/b)*b; }
round = Output(code_block)
