# Dynamo custom node Math.RoundUpToPrecision.dyf (Dynamo 0.8.1.1693)
# category: Clockwork.Core.Math.Actions
# Rounds a number *up* to a specified precision

Number = Input(Number : double)
Precision = Input(Precision : double = 1)
code_block = CodeBlock(a=Number, b=Precision) { Math.Ceiling(a/b)*b; }
Ceiling = Output(code_block)
