# Dynamo custom node Math.ScaleNormalized.dyf (Dynamo 0.8.1.1693)
# category: Clockwork.Core.Math.Actions
# Scales a normalized value according to a given minimum and maximum

Min = Input(Min : double)
Max = Input(Max : double)
Value = Input(Value : double)
code_block = CodeBlock(min=Min, max=Max, value=Value) { min+(max-min)*value; }
Output = Output(code_block)  # ""
