# Dynamo custom node Object.Members.dyf (Dynamo 0.8.2.2392)
# category: Clockwork.Core.Object.Query
# Gets a list of all members (properties and methods) of a selected element

element = Input()
turnIntoList = Custom[Turn Into List](element)  # Turns an element (or a nested list) into a flat list
python_script = Python(IN[0]=turnIntoList)
# ---------- python_script.python (10 lines) ----------
import clr
clr.AddReference('RevitAPI')
from Autodesk.Revit.DB import *

items = UnwrapElement(IN[0])
elementlist = list()

for item in items:
	elementlist.append(dir(item))
OUT = elementlist
# ----------------------------------------
returnListOrSingleValue = Custom[ReturnListOrSingleValue](unknownItem=element, seq=python_script)  # If the item in input #1 is not a list, only the first item of the list in input #2 will be returned.
members = Output(returnListOrSingleValue)
