# Dynamo custom node Object.MembersByName.dyf (Dynamo 0.8.3.2553)
# category: Clockwork.Core.Object.Query
# Looks up all the members of a given element based on a given name (or part of a name) of the property or method. Search is case-insensitive.

element = Input()
filterByBoolMask = List.FilterByBoolMask()
turn_into_list = Custom[Turn Into List](element)  # Turns an element (or a nested list) into a flat list
members = Custom[Object.Members](element=turn_into_list)  # Gets a list of all members (properties and methods) of a selected element
searchFor = Input(searchFor : string)
ignoreCase = Input(ignoreCase : bool = true)
code_block = CodeBlock(str=members, search=searchFor, ignoreCase=ignoreCase) { String.Contains(str,search,ignoreCase); }
combine = List.Combine(filterByBoolMask.in, members, code_block)
returnListOrSingleValue = Custom[ReturnListOrSingleValue](unknownItem=element, seq=combine)  # If the item in input #1 is not a list, only the first item of the list in input #2 will be returned.
elements = Output(returnListOrSingleValue)
