# Dynamo custom node OppositeSide.ByLawOfCosines.dyf (Dynamo 0.8.1.1693)
# category: Clockwork.Core.Formulas.Query
# Computes the length of the missing side of a triangle using the law of cosines. Gamma is the angle between sides A and B.

SideA = Input(SideA : double)
SideB = Input(SideB : double)
Gamma = Input(Gamma : double)
code_block = CodeBlock(a=SideA, b=SideB, gamma=Gamma) { Math.Sqrt(Math.Pow(a,2)+Math.Pow(b,2)-2*a*b*Math.Cos(gamma)); }
SideC = Output(code_block)
