# Dynamo custom node Paneling.MakeTriangles.dyf (Dynamo 0.8.2.2392)
# category: Clockwork.Paneling.Helpers
# Reduces each sublist to a list of three items specified by the indices in the pattern.

seq = Input()
pat = Input()
code_block = CodeBlock(seq=seq, pat=pat) { seq2 = List.Transpose(seq); seq3 = {seq2[pat[0]],seq2[pat[1]],seq2[pat[2]]}; List.Transpose(seq3); }
isNull = Object.IsNull()
map = List.Map(list=code_block.out2, f_x=isNull)
# note: Filter out null values
filterByBoolMask = List.FilterByBoolMask(list=code_block.out2, mask=map)
seq_2 = Output(filterByBoolMask.out)  # "seq"
