# Dynamo custom node Paneling.TriangularFlatMirrored.dyf (Dynamo 0.8.2.2392)
# category: Clockwork.Paneling.Patterns
# Creates groups of points from a list of UVs or XYZs for the placement of triangular (diagrid) panels. The placement pattern can be reversed (boolean) and shifted (integer).

code_block = CodeBlock { {0..n}; }
rotateGridBy90Degrees = Input(rotateGridBy90Degrees : bool = false)
seq = Input()
swap = Custom[Swap UV](uv=seq)  # "UV.Swap"; Swaps U and V coordinates
V = Input(V : int)
shiftRows = Input(shiftRows : bool = false)
isEvenNumber = Custom[Is Even Number](val=V)  # "Math.IsEvenNumber"; Checks if a number is even.
isOddNumber = Custom[Is Odd Number](val=V)  # "Math.IsOddNumber"; Checks if a number is odd.
code_block_2 = CodeBlock(rotateGridBy90Degrees, swap, seq, V, shiftRows, isEvenNumber, isOddNumber)
# ---------- code_block_2.designscript (19 lines) ----------
// DATA
// Rotate entire grid by 90°?
seq2 = rotate ? seq1_swapped : seq1;
// Make rows
rows = List.Sublists(seq2,{0..(2*V+1)},V+1);
// Odd rows
evenodd[0] = List.DropEveryNthItem(rows,2,0);
// Even rows
evenodd[1] = List.TakeEveryNthItem(rows,2,0);
// Left corners, standing & Rows, standing
evenodd[shiftrows ? 1 : 0];
// Left corners, lying & Rows, lying
evenodd[shiftrows ? 0 : 1];
// Right corners, standing
cond_rcs = (is_even && !(shiftrows)) || (is_odd && shiftrows);
evenodd[cond_rcs ? 0 : 1];
// Right corners, lying
cond_rcl = (is_even && shiftrows) || (is_odd && !(shiftrows));
evenodd[cond_rcl ? 0 : 1];
# ----------------------------------------
code_block_3 = CodeBlock(V=V)
# ---------- code_block_3.designscript (9 lines) ----------
// INDICES
0;
1;
2;
3;
V+1;
V+2;
V+3;
V+4;
# ----------------------------------------
shiftPlacementRowsLying = Input(shiftPlacementRowsLying : int = 0)
reverseRowsLying = Input(reverseRowsLying : bool = false)
buildTriangularSublists = Custom[Build Triangular Sublists](offset=code_block_3.out2, shift=shiftPlacementRowsLying, reverse=reverseRowsLying, index0=code_block_3.out6, index1=code_block_3.out1, index2=code_block_3.out4)  # "Paneling.BuildTriangularSublists"; Creates sublists of three items each from a list based on given indices, shift and reverse settings and offset.
map = List.Map(list=code_block_2.out4, f_x=buildTriangularSublists)
buildTriangularSublists_2 = Custom[Build Triangular Sublists](offset=code_block_3.out2, shift=shiftPlacementRowsLying, reverse=reverseRowsLying, index0=code_block_3.out7, index1=code_block_3.out2, index2=code_block_3.out5)  # "Paneling.BuildTriangularSublists"
map_2 = List.Map(list=code_block_2.out5, f_x=buildTriangularSublists_2)
join = List.Join(map, map_2)
code_block_4 = CodeBlock { 1; 3; }
flatten = List.Flatten(list=join, amt=code_block_4.out0)
filterBySublistLength = Custom[Filter Sublists By Length](seq=flatten, length=code_block_4.out1)  # "List.FilterBySublistLength"; Filters out all sublists that do not have the specified length
rowsLying = Output(filterBySublistLength.in)
takeItems = List.TakeItems()
shiftPlacementRowsStanding = Input(shiftPlacementRowsStanding : int = 0)
reverseRowsStanding = Input(reverseRowsStanding : bool = false)
buildTriangularSublists_3 = Custom[Build Triangular Sublists](offset=code_block_3.out2, shift=shiftPlacementRowsStanding, reverse=reverseRowsStanding, index0=code_block_3.out1, index1=code_block_3.out6, index2=code_block_3.out3)  # "Paneling.BuildTriangularSublists"
map_3 = List.Map(list=code_block_2.out4, f_x=buildTriangularSublists_3)
filterBySublistLength_2 = Custom[Filter Sublists By Length](length=code_block_4.out1)  # "List.FilterBySublistLength"
map_4 = List.Map(list=map_3, f_x=filterBySublistLength_2.in)
sublistLengths = Custom[List.SublistLengths](seq=map_4)  # Gets the lengths of all sublists in a given list of lists.
code_block_5 = CodeBlock(n=sublistLengths) { n-1; }
combine = List.Combine(takeItems, map_4, code_block_5)
buildTriangularSublists_4 = Custom[Build Triangular Sublists](offset=code_block_3.out2, shift=shiftPlacementRowsStanding, reverse=reverseRowsStanding, index0=code_block_3.out0, index1=code_block_3.out5, index2=code_block_3.out2)  # "Paneling.BuildTriangularSublists"
map_5 = List.Map(list=code_block_2.out5, f_x=buildTriangularSublists_4)
filterBySublistLength_3 = Custom[Filter Sublists By Length](length=code_block_4.out1)  # "List.FilterBySublistLength"
# note: Necessary cleanup:
# In some cases there are groups of three points that we don't want...
map_6 = List.Map(list=map_5, f_x=filterBySublistLength_3.in)
join_2 = List.Join(combine, map_6)
takeItems_2 = List.TakeItems()
sublistLengths_2 = Custom[List.SublistLengths](seq=map_6)
code_block_6 = CodeBlock(n=sublistLengths_2) { n-1; }
combine_2 = List.Combine(takeItems_2, map_6, code_block_6)
join_3 = List.Join(map_4, combine_2)
code_block_7 = CodeBlock(join_2, join_3, isEvenNumber) { rows_standing[0] = list1; rows_standing[1] = list2; rows_standing[is_even ? 0 : 1]; }
flatten_2 = List.Flatten(list=code_block_7.out2, amt=code_block_4.out0)
rowsStanding = Output(flatten_2)
code_block_8 = CodeBlock(V=V)
# ---------- code_block_8.designscript (9 lines) ----------
// PATTERNS
// Left corners, standing
{0,V+1,1};
// Left corners, lying
{V+2,0,V+1};
// Right corners, standing
{V-1,2*V+1,V};
// Right corners, flying
{2*V+1,V,2*V};
# ----------------------------------------
shiftPlacementLeftCornersLying = Input(shiftPlacementLeftCornersLying : int = 0)
reverseLeftCornersLying = Input(reverseLeftCornersLying : bool = false)
shiftPlacementAndReverse = Custom[Shift Placement And Reverse](seq=code_block_8.out1, shift=shiftPlacementLeftCornersLying, reverse=reverseLeftCornersLying)  # "Paneling.ShiftPlacementAndReverse"; Shifts (integer) and reverses (bool) a given list
makeTriangles = Custom[Paneling.MakeTriangles](seq=code_block_2.out5, pat=shiftPlacementAndReverse)  # Reduces each sublist to a list of three items specified by the indices in the pattern.
filterBySublistLength_4 = Custom[Filter Sublists By Length](seq=makeTriangles, length=code_block_4.out1)  # "List.FilterBySublistLength"
leftCornersLying = Output(filterBySublistLength_4.in)
shiftPlacementLeftCornersStanding = Input(shiftPlacementLeftCornersStanding : int = 0)
reverseLeftCornersStanding = Input(reverseLeftCornersStanding : bool = false)
shiftPlacementAndReverse_2 = Custom[Shift Placement And Reverse](seq=code_block_8.out0, shift=shiftPlacementLeftCornersStanding, reverse=reverseLeftCornersStanding)  # "Paneling.ShiftPlacementAndReverse"
makeTriangles_2 = Custom[Paneling.MakeTriangles](seq=code_block_2.out4, pat=shiftPlacementAndReverse_2)
filterBySublistLength_5 = Custom[Filter Sublists By Length](seq=makeTriangles_2, length=code_block_4.out1)  # "List.FilterBySublistLength"
leftCornersStanding = Output(filterBySublistLength_5.in)
shiftPlacementRightCornersLying = Input(shiftPlacementRightCornersLying : int = 0)
reverseRightCornersLying = Input(reverseRightCornersLying : bool = false)
shiftPlacementAndReverse_3 = Custom[Shift Placement And Reverse](seq=code_block_8.out3, shift=shiftPlacementRightCornersLying, reverse=reverseRightCornersLying)  # "Paneling.ShiftPlacementAndReverse"
makeTriangles_3 = Custom[Paneling.MakeTriangles](seq=code_block_2.out9, pat=shiftPlacementAndReverse_3)
filterBySublistLength_6 = Custom[Filter Sublists By Length](seq=makeTriangles_3, length=code_block_4.out1)  # "List.FilterBySublistLength"
rightCornersLying = Output(filterBySublistLength_6.in)
shiftPlacementRightCornersStanding = Input(shiftPlacementRightCornersStanding : int = 0)
reverseRightCornersStanding = Input(reverseRightCornersStanding : bool = false)
shiftPlacementAndReverse_4 = Custom[Shift Placement And Reverse](seq=code_block_8.out2, shift=shiftPlacementRightCornersStanding, reverse=reverseRightCornersStanding)  # "Paneling.ShiftPlacementAndReverse"
makeTriangles_4 = Custom[Paneling.MakeTriangles](seq=code_block_2.out7, pat=shiftPlacementAndReverse_4)
filterBySublistLength_7 = Custom[Filter Sublists By Length](seq=makeTriangles_4, length=code_block_4.out1)  # "List.FilterBySublistLength"
rightCornersStanding = Output(filterBySublistLength_7.in)
