# Dynamo custom node Part.SourceElement.dyf (Dynamo 0.8.3.2580)
# category: Clockwork.Revit.Elements.Part.Query
# Retrieves the element a given part was made from

part = Input()
turn_into_list = Custom[Turn Into List](part)  # Turns an element (or a nested list) into a flat list
python_script = Python(IN[0]=turn_into_list)
# ---------- python_script.python (25 lines) ----------
import clr
clr.AddReference('RevitAPI')
from Autodesk.Revit.DB import *

clr.AddReference("RevitNodes")
import Revit
clr.ImportExtensions(Revit.Elements)

clr.AddReference("RevitServices")
import RevitServices
from RevitServices.Persistence import DocumentManager
from RevitServices.Transactions import TransactionManager

doc = DocumentManager.Instance.CurrentDBDocument
items = UnwrapElement(IN[0])
elementlist = list()
for item in items:
    sourcelist = list()
    for source in item.GetSourceElementIds():
        sourcelist.append(doc.GetElement(source.HostElementId).ToDSType(True))
    if len(sourcelist) < 2:
        elementlist.append(sourcelist[0])
    else:
        elementlist.append(sourcelist)
OUT = elementlist
# ----------------------------------------
returnListOrSingleValue = Custom[ReturnListOrSingleValue](unknownItem=part, seq=python_script)  # If the item in input #1 is not a list, only the first item of the list in input #2 will be returned.
sourceElement = Output(returnListOrSingleValue)
