# Dynamo custom node PlanView.Underlay.dyf (Dynamo 0.8.2.2392)
# category: Clockwork.Revit.Views.PlanView.Query
# Returns the view template assigned to a given view (if one is assigned)

planView = Input()
turnIntoList = Custom[Turn Into List](planView)  # Turns an element (or a nested list) into a flat list
python_script = Python(IN[0]=turnIntoList)
# ---------- python_script.python (24 lines) ----------
import clr
clr.AddReference('RevitAPI')
from Autodesk.Revit.DB import *

views = UnwrapElement(IN[0])
elementlist = list()

for view in views:
	# Revit 2016 R2 and later
	try:
		if view.GetUnderlayBaseLevel().IntegerValue == -1:
			elementlist.append(list())
		else:
			elementlist.append(view.Document.GetElement(view.GetUnderlayBaseLevel()))
	# anything before
	except:
		try:
			if view.get_Parameter(BuiltInParameter.VIEW_UNDERLAY_ID).AsElementId().IntegerValue == -1:
				elementlist.append(list())
			else:
				elementlist.append(view.Document.GetElement(view.get_Parameter(BuiltInParameter.VIEW_UNDERLAY_ID).AsElementId()))
		except:
			elementlist.append(list())
OUT = elementlist
# ----------------------------------------
returnListOrSingleValue = Custom[ReturnListOrSingleValue](unknownItem=planView, seq=python_script)  # If the item in input #1 is not a list, only the first item of the list in input #2 will be returned.
underlay = Output(returnListOrSingleValue)
