# Dynamo custom node Point.Average.dyf (Dynamo 0.8.1.1823)
# category: Clockwork.Geometry.Point.Query
# Determines the average of a list of points

points = Input(points : Autodesk.Point[])
code_block = CodeBlock(pts=points) { Autodesk.Point.ByCoordinates(Math.Average(pts.X),Math.Average(pts.Y),Math.Average(pts.Z)); }
Point = Output(code_block)
