# Dynamo custom node Point.CentralProjectionOnFace.dyf (Dynamo 0.8.2.2392)
# category: Clockwork.Geometry.Point.Actions
# Projects a list of points onto a given face

centralProjectionPoint = Input(centralProjectionPoint : Autodesk.Point)
projectionPoints = Input(projectionPoints : Autodesk.Point[])
surface = Input(surface : Surface)
code_block = CodeBlock(center=centralProjectionPoint, plist=projectionPoints, surf=surface) { dir = Vector.ByTwoPoints(center,plist); surf.ProjectInputOnto(plist,dir); }
projectedPoints = Output(code_block.out1)
