# Dynamo custom node Point.IsOutOfPlane.dyf (Dynamo 0.8.2.2392)
# category: Clockwork.Geometry.Point.Query
# Checks a list for XYZs that are not located on a given plane

face_plane = Input()  # "face/plane"
point = Input(point : Autodesk.Point)
code_block = CodeBlock(plane=face_plane, point=point) { closest = plane.ClosestPointTo(point); !(closest.IsAlmostEqualTo(point)); closest.DistanceTo(point); }
bool = Output(code_block.out1)
amount = Output(code_block.out2)
