# Dynamo custom node Point.RoundUpToPrecision.dyf (Dynamo 0.8.2.2392)
# category: Clockwork.Geometry.Point.Actions
# Rounds a point coordinate *up* to a specified precision

pointp = Input()
precision = Input()
code_block = CodeBlock(po=pointp, pr=precision) { a = {po.X,po.Y,po.Z}; ar = Math.Ceiling(a/pr)*pr; Autodesk.Point.ByCoordinates(ar[0],ar[1],ar[2]); }
point = Output(code_block.out2)
