# Dynamo custom node PointSequence.AccumulatedDistance.dyf (Dynamo 0.8.2.2392)
# category: Clockwork.Geometry.PointSequence.Query
# Retrieves the accumulated distances of a sequence of points

seq = Input(seq : Autodesk.Point[])
code_block = CodeBlock(plist=seq)
# ---------- code_block.designscript (6 lines) ----------
plist2 = Flatten(plist);
n = List.Count(plist2);
pseq1 = List.TakeItems(plist2,n-1);
pseq2 = List.RestOfItems(plist2);
dist = Math.Sum(pseq1.DistanceTo(pseq2));
n < 2 ? 0 : dist;
# ----------------------------------------
distance = Output(code_block.out5)
