# Dynamo custom node PointSequence.GreatestDistanceToPoint.dyf (Dynamo 0.8.2.2392)
# category: Clockwork.Geometry.PointSequence.Query
# Retrieves the furthest point in a sequence of points

point = Input(point : Autodesk.Point)
seq = Input()
turn_into_list = Custom[Turn Into List](seq)  # Turns an element (or a nested list) into a flat list
code_block = CodeBlock(p=point, plist=turn_into_list) { distlist = p.DistanceTo(plist); max = List.MaximumItem(distlist); max == distlist; }
distance = Output(code_block.max)
bool = Output(code_block.out2)
