# Dynamo custom node ReturnListOrSingleValue.dyf (Dynamo 0.8.1.1693)
# category: Clockwork.Core.Logic.Actions
# If the item in input #1 is not a list, only the first item of the list in input #2 will be returned.

Item_1_unknown = Input()  # "Item #1 (unknown)"
Item_2_list = Input()  # "Item #2 (list)"
python_script = Python(IN[0]=Item_1_unknown, IN[1]=Item_2_list)
# ---------- python_script.python (4 lines) ----------
check = IN[0]
items = IN[1]
if isinstance(check, (list)): OUT = items
else: OUT = items[0]
# ----------------------------------------
Output = Output(python_script)  # ""
