# Dynamo custom node RevitColor.FromDynamoColor.dyf (Dynamo 0.8.3.2580)
# category: Clockwork.Revit.Elements.Color.Create
# Creates a Revit color from a Dynamo color

DynamoColor = Input(DynamoColor : DSCore.Color)
turn_into_list = Custom[Turn Into List](DynamoColor)  # Turns an element (or a nested list) into a flat list
code_block = CodeBlock(col=turn_into_list) { col.Red; col.Green; col.Blue; }
python_script = Python(IN[0]=code_block.out0, IN[1]=code_block.out1, IN[2]=code_block.out2)
# ---------- python_script.python (28 lines) ----------
import clr
clr.AddReference('RevitAPI')
from Autodesk.Revit.DB import *
from Autodesk.Revit import *

clr.AddReference("RevitServices")
import RevitServices
from RevitServices.Persistence import DocumentManager
from RevitServices.Transactions import TransactionManager

doc = DocumentManager.Instance.CurrentDBDocument
#uiapp = DocumentManager.Instance.CurrentUIApplication
#app = uiapp.Application
appcreation = Creation.Application
r = IN[0]
g = IN[1]
b = IN[2]
counter = 0
elementlist = list()

TransactionManager.Instance.EnsureInTransaction(doc)
for red in r:
	newcolor = Color(red,g[counter],b[counter])
	elementlist.append(newcolor)
	counter += 1
TransactionManager.Instance.TransactionTaskDone()

OUT = elementlist
# ----------------------------------------
returnListOrSingleValue = Custom[ReturnListOrSingleValue](unknownItem=DynamoColor, seq=python_script)  # If the item in input #1 is not a list, only the first item of the list in input #2 will be returned.
RevitColor = Output(returnListOrSingleValue)
