# Dynamo custom node RevitColor.ToDynamoColor.dyf (Dynamo 0.8.3.2553)
# category: Clockwork.Revit.Elements.Color.Query
# Converts Revit colors into Dynamo colors

RevitColor = Input()
turn_into_list = Custom[Turn Into List](RevitColor)  # Turns an element (or a nested list) into a flat list
python_script = Python(IN[0]=turn_into_list)
# ---------- python_script.python (14 lines) ----------
import clr
clr.AddReference('RevitAPI')
from Autodesk.Revit.DB import *

colors = UnwrapElement(IN[0])
rlist = list()
glist = list()
blist = list()

for color in colors:
	rlist.append(color.Red)
	glist.append(color.Green)
	blist.append(color.Blue)
OUT = (rlist,glist,blist)
# ----------------------------------------
code_block = CodeBlock(seq=python_script) { DSCore.Color.ByARGB(255,seq[0],seq[1],seq[2]); }
returnListOrSingleValue = Custom[ReturnListOrSingleValue](unknownItem=RevitColor, seq=code_block)  # If the item in input #1 is not a list, only the first item of the list in input #2 will be returned.
DynamoColor = Output(returnListOrSingleValue)
