# Dynamo custom node RevitUV.ToDynamoUV.dyf (Dynamo 0.8.3.2580)
# category: Clockwork.Revit.Elements.UV.Query
# Converts Revit UV coordinates to Dynamo UV coordinates

RevitUV = Input()
turn_into_list = Custom[Turn Into List](RevitUV)  # Turns an element (or a nested list) into a flat list
python_script = Python(IN[0]=turn_into_list)
# ---------- python_script.python (11 lines) ----------
import clr
clr.AddReference('RevitAPI')
from Autodesk.Revit.DB import *

UVs = UnwrapElement(IN[0])
ulist = list()
vlist = list()
for uv in UVs:
	ulist.append(uv.U)
	vlist.append(uv.V)
OUT = (ulist,vlist)
# ----------------------------------------
code_block = CodeBlock(seq=python_script) { useq = Math.RemapRange(seq[0],0,1); vseq = Math.RemapRange(seq[1],0,1); uvseq = UV.ByCoordinates(useq,vseq); }
returnListOrSingleValue = Custom[ReturnListOrSingleValue](unknownItem=RevitUV, seq=code_block.uvseq)  # If the item in input #1 is not a list, only the first item of the list in input #2 will be returned.
DynamoUV = Output(returnListOrSingleValue)
