# Dynamo custom node Roof.CreationMethod.dyf (Dynamo 0.8.3.2580)
# category: Clockwork.Revit.Elements.Roof.Query
# Retrieves the creation method of a given roof

roof = Input()
turn_into_list = Custom[Turn Into List](roof)  # Turns an element (or a nested list) into a flat list
python_script = Python(IN[0]=turn_into_list)
# ---------- python_script.python (21 lines) ----------
import clr
clr.AddReference('RevitAPI')
from Autodesk.Revit.DB import *

roofinstances = UnwrapElement(IN[0])
elementlist = list()
for item in roofinstances:
	try:
		if item.GetType().Name == 'FootPrintRoof':
			elementlist.append('By Footprint')
		elif item.GetType().Name == 'ExtrusionRoof':
			elementlist.append('By Extrusion')
		elif item.GetType().Name == 'RoofBase':
			elementlist.append('By Face')
		elif item.GetType().Name == 'FamilyInstance':
			elementlist.append('In-Place')
		else:
			elementlist.append('No Roof')
	except:
		elementlist.append('No Roof')
OUT = elementlist
# ----------------------------------------
returnListOrSingleValue = Custom[ReturnListOrSingleValue](unknownItem=roof, seq=python_script)  # If the item in input #1 is not a list, only the first item of the list in input #2 will be returned.
creationMethod = Output(returnListOrSingleValue)
