# Dynamo custom node Roof.CreationMethodIsByExtrusion.dyf (Dynamo 0.8.3.2580)
# category: Clockwork.Revit.Elements.Roof.Query
# Checks whether the creation method of a given roof is 'By Extrusion'

roof = Input()
turn_into_list = Custom[Turn Into List](roof)  # Turns an element (or a nested list) into a flat list
python_script = Python(IN[0]=turn_into_list)
# ---------- python_script.python (15 lines) ----------
import clr
clr.AddReference('RevitAPI')
from Autodesk.Revit.DB import *

roofinstances = UnwrapElement(IN[0])
booleans = list()
for item in roofinstances:
	try:
		if item.GetType().Name == 'ExtrusionRoof':
			booleans.append(True)
		else:
			booleans.append(False)
	except:
		booleans.append(False)
OUT = booleans
# ----------------------------------------
returnListOrSingleValue = Custom[ReturnListOrSingleValue](unknownItem=roof, seq=python_script)  # If the item in input #1 is not a list, only the first item of the list in input #2 will be returned.
bool = Output(returnListOrSingleValue)
