# Dynamo custom node Roof.KindIsGlazed.dyf (Dynamo 0.8.3.2580)
# category: Clockwork.Revit.Elements.Roof.Query
# Checks whether a given roof is a Glazed Roof. PLEASE NOTE: Does not work correctly for roofs that were created by face

roof = Input()
turn_into_list = Custom[Turn Into List](roof)  # Turns an element (or a nested list) into a flat list
python_script = Python(IN[0]=turn_into_list)
# ---------- python_script.python (15 lines) ----------
import clr
clr.AddReference('RevitAPI')
from Autodesk.Revit.DB import *

items = UnwrapElement(IN[0])
booleans = list()
for item in items:
	try:
		if item.CurtainGrids:
			booleans.append(True)
		else:
			booleans.append(False)
	except:
		booleans.append(False)
OUT = booleans
# ----------------------------------------
returnListOrSingleValue = Custom[ReturnListOrSingleValue](unknownItem=roof, seq=python_script)  # If the item in input #1 is not a list, only the first item of the list in input #2 will be returned.
bool = Output(returnListOrSingleValue)
