# Dynamo custom node Room.Doors.dyf (Dynamo 0.8.2.2392)
# category: Clockwork.Revit.Elements.Room.Query
# Retrieves all doors that are associated with a room (hosted in walls and roofs).

room = Input()
python_script = Python()
# ---------- python_script.python (17 lines) ----------
import System
import clr
clr.AddReference('RevitAPI')
from Autodesk.Revit.DB import *

clr.AddReference("RevitServices")
import RevitServices
from RevitServices.Persistence import DocumentManager

doc = DocumentManager.Instance.CurrentDBDocument

elementlist = list()
collector = FilteredElementCollector(doc)
collector.OfClass(FamilyInstance)
collector.OfCategory(BuiltInCategory.OST_Doors)

OUT = collector.ToElements()
# ----------------------------------------
phase = Input()
rooms = Custom[Door.Rooms](door=python_script, phase=phase)  # Gets the rooms that are connected by a given door
isEmpty = List.IsEmpty()
map = List.Map(list=rooms.fromRoom, f_x=isEmpty)
map_2 = List.Map(list=rooms.toRoom, f_x=isEmpty)
turnIntoList = Custom[Turn Into List](room)  # Turns an element (or a nested list) into a flat list
code_block = CodeBlock(doors=python_script, mask1=map, mask2=map_2, fromrooms=rooms.fromRoom, torooms=rooms.toRoom, rooms_in=turnIntoList)
# ---------- code_block.designscript (10 lines) ----------
doors_from = List.FilterByBoolMask(doors,mask1)["out"];
doors_to = List.FilterByBoolMask(doors,mask2)["out"];
doors_all = Flatten({doors_from,doors_to});
rooms_from = List.FilterByBoolMask(fromrooms,mask1)["out"];
rooms_to = List.FilterByBoolMask(torooms,mask2)["out"];
rooms_all = Flatten({rooms_from,rooms_to});
matches = rooms_in.UniqueId<1> == rooms_all.UniqueId<2>;
numrooms = List.Count(rooms_in);
doors_rep = List.OfRepeatedItem(doors_all,numrooms);
List.FilterByBoolMask(doors_rep,matches)["in"];
# ----------------------------------------
returnListOrSingleValue = Custom[ReturnListOrSingleValue](unknownItem=room, seq=code_block.out9)  # If the item in input #1 is not a list, only the first item of the list in input #2 will be returned.
doors = Output(returnListOrSingleValue)
