# Dynamo custom node Sheet.Schedules.dyf (Dynamo 0.8.3.2580)
# category: Clockwork.Revit.Views.Sheet.Query
# Returns all schedules placed on a specified sheet

sheet = Input(sheet : Sheet)
turn_into_list = Custom[Turn Into List](sheet)  # Turns an element (or a nested list) into a flat list
python_script = Python(IN[0]=turn_into_list)
# ---------- python_script.python (22 lines) ----------
import clr
clr.AddReference('RevitAPI')
from Autodesk.Revit.DB import *

clr.AddReference("RevitServices")
import RevitServices
from RevitServices.Persistence import DocumentManager

doc = DocumentManager.Instance.CurrentDBDocument
sheets = UnwrapElement(IN[0])
elementlist = list()

for sheet in sheets:
	try:
		viewlist = list()
		collector = FilteredElementCollector(doc, sheet.Id).OfClass(ScheduleSheetInstance)
		for item in collector:
			viewlist.append(doc.GetElement(item.ScheduleId))
		elementlist.append(viewlist)
	except:
		elementlist.append(list())
OUT = elementlist
# ----------------------------------------
returnListOrSingleValue = Custom[ReturnListOrSingleValue](unknownItem=sheet, seq=python_script)  # If the item in input #1 is not a list, only the first item of the list in input #2 will be returned.
schedules = Output(returnListOrSingleValue)
