# Dynamo custom node Side.ByLawOfSines.dyf (Dynamo 0.8.1.1693)
# category: Clockwork.Core.Formulas.Query
# Determines the length of a side based on the law of sines. (Alpha is the angle opposite side A and beta is the angle opposite side B...)

SideB = Input(SideB : double)
Beta = Input(Beta : double)
Alpha = Input(Alpha : double)
code_block = CodeBlock(b=SideB, beta=Beta, alpha=Alpha) { b/Math.Sin(beta)*Math.Sin(alpha); }
SideA = Output(code_block)
