# Dynamo custom node String.AlphanumericToMorse.dyf (Dynamo 0.8.1.1693)
# category: Clockwork.Core.String.Actions
# Converts an alphanumeric string to Morse code

str = Input(str : string)
code_block = CodeBlock(str=str) { " "; String.ToUpper(str); }
split = String.Split(str, code_block.out0)
fromString = Custom[List.FromString](str=code_block.out1)  # Chops up a string into a list of characters
code_block_2 = CodeBlock()
# ---------- code_block_2.designscript (3 lines) ----------
alphastring = "A*B*C*D*E*F*G*H*I*J*K*L*M*N*O*P*Q*R*S*T*U*V*W*X*Y*Z*0*1*2*3*4*5*6*7*8*9";
alphanumeric = String.Split(alphastring,"*");
morse = {".-","-...","-.-.","-..",".","..-.","--.","....","..",".---","-.-",".-..","--","-.","---",".--.","--.-",".-.","...","-","..-","...-",".--","-..-","-.--","--..","-----",".----","..---","...--","....-",".....","-....","--...","---..","----."};
# ----------------------------------------
matchWithKeyValues = Custom[List.MatchWithKeyValues](seq=fromString, Keys=code_block_2.alphanumeric, Values=code_block_2.morse)  # Matches a list with a given set of keys and returns the values corresponding to the keys
code_block_3 = CodeBlock(str=split, seq=matchWithKeyValues) { String.Length(str); Flatten(seq); " "; "   "; }
chopByLengths = Custom[List.ChopByLengths](Lengths=code_block_3.out0, seq=code_block_3.out1)  # Turns a list into a list of lists with sublists of varying lengths.
join = String.Join(code_block_3.out2, chopByLengths)
code_block_4 = CodeBlock(seq=join) { seq[0]; }
join_2 = String.Join(code_block_3.out3, code_block_4)
code_block_5 = CodeBlock(seq=join_2) { seq[0]; }
str_2 = Output(code_block_5)  # "str"
