# Dynamo custom node String.BinaryToDecimal.dyf (Dynamo 0.8.1.1693)
# category: Clockwork.Core.String.Actions
# Converts a string of a binary number into a decimal value

Binary = Input(Binary : string)
turn_into_list = Custom[Turn Into List](Binary)  # Turns an element (or a nested list) into a flat list
python_script = Python(IN[0]=turn_into_list)
# ---------- python_script.python (5 lines) ----------
binstr = IN[0]
elementlist = []
for bin in binstr:
	elementlist.append(int(bin,2))
OUT = elementlist
# ----------------------------------------
returnListOrSingleValue = Custom[ReturnListOrSingleValue](Item_1_unknown=Binary, Item_2_list=python_script)  # If the item in input #1 is not a list, only the first item of the list in input #2 will be returned.
Decimal = Output(returnListOrSingleValue)
