# Dynamo custom node String.FindRegularExpression.dyf (Dynamo 0.8.1.1693)
# category: Clockwork.Core.String.Actions
# Returns all occurences of a regular expression within a string (or list of strings). The syntax for regular expressions is explained at
# http://ironpython-test.readthedocs.org/en/latest/howto/regex.html

str = Input(str : string)
RegEx = Input(RegEx : string)
turn_into_list = Custom[Turn Into List](str)  # Turns an element (or a nested list) into a flat list
python_script = Python(IN[0]=RegEx, IN[1]=turn_into_list)
# ---------- python_script.python (13 lines) ----------
import clr
import re

regexstring = IN[0]
regexlist = IN[1]
elementlist = list()
thisexp = re.compile(regexstring)
for item in regexlist:
	try:
		elementlist.append(thisexp.findall(item))
	except:
		elementlist.append(list())
OUT = elementlist
# ----------------------------------------
returnListOrSingleValue = Custom[ReturnListOrSingleValue](Item_1_unknown=str, Item_2_list=python_script)  # If the item in input #1 is not a list, only the first item of the list in input #2 will be returned.
seq = Output(returnListOrSingleValue)
