# Dynamo custom node String.MorseToAlphanumeric.dyf (Dynamo 0.8.1.1693)
# category: Clockwork.Core.String.Actions
# Converts a string in Morse code to alphanumeric

code_block = CodeBlock { ""; " "; }
str = Input(str : string)
code_block_2 = CodeBlock(inputstring=str)
# ---------- code_block_2.designscript (5 lines) ----------
words = String.Split(inputstring,"   ");
chars = String.Split(words," ");
alphastring = "A*B*C*D*E*F*G*H*I*J*K*L*M*N*O*P*Q*R*S*T*U*V*W*X*Y*Z*0*1*2*3*4*5*6*7*8*9";
alphanumeric = String.Split(alphastring,"*");
morse = {".-","-...","-.-.","-..",".","..-.","--.","....","..",".---","-.-",".-..","--","-.","---",".--.","--.-",".-.","...","-","..-","...-",".--","-..-","-.--","--..","-----",".----","..---","...--","....-",".....","-....","--...","---..","----."};
# ----------------------------------------
sublistLengths = Custom[List.SublistLengths](seq=code_block_2.chars)  # Gets the lengths of all sublists in a given list of lists.
matchWithKeyValues = Custom[List.MatchWithKeyValues](seq=code_block_2.chars, Keys=code_block_2.morse, Values=code_block_2.alphanumeric)  # Matches a list with a given set of keys and returns the values corresponding to the keys
chopByLengths = Custom[List.ChopByLengths](list=sublistLengths, subLengthList=matchWithKeyValues)  # Turns a list into a list of lists with sublists of varying lengths.
join = String.Join(code_block.out0, chopByLengths)
code_block_3 = CodeBlock(seq=join) { seq[0]; }
join_2 = String.Join(code_block.out1, code_block_3)
code_block_4 = CodeBlock(seq=join_2) { seq[0]; }
str_2 = Output(code_block_4)  # "str"
