# Dynamo custom node StructuralFoundation.KindIsIsolated.dyf (Dynamo 0.8.3.2580)
# category: Clockwork.Revit.Elements.StructuralFoundation.Query
# Checks whether a given structural foundation is an isolated foundation

structuralFoundation = Input()
turn_into_list = Custom[Turn Into List](structuralFoundation)  # Turns an element (or a nested list) into a flat list
python_script = Python(IN[0]=turn_into_list)
# ---------- python_script.python (15 lines) ----------
import clr
clr.AddReference('RevitAPI')
from Autodesk.Revit.DB import *

foundinstances = UnwrapElement(IN[0])
booleans = list()
for item in foundinstances:
	try:
		if item.GetType().Name == 'FamilyInstance':
			booleans.append(True)
		else:
			booleans.append(False)
	except:
		booleans.append(False)
OUT = booleans
# ----------------------------------------
returnListOrSingleValue = Custom[ReturnListOrSingleValue](unknownItem=structuralFoundation, seq=python_script)  # If the item in input #1 is not a list, only the first item of the list in input #2 will be returned.
bool = Output(returnListOrSingleValue)
