# Dynamo custom node Surface.IsPlanar.dyf (Dynamo 0.8.1.1693)
# category: Clockwork.Geometry.Surface.Query
# Checks whether a face is planar

surface = Input(surface : Surface)
intersect = Geometry.Intersect()
turn_into_list = Custom[Turn Into List](surface)  # Turns an element (or a nested list) into a flat list
code_block = CodeBlock { 2; }
gridFromFace = Custom[Paneling.GridFromFace](U=code_block, V=code_block)  # Returns UV coordinates, XYZ coordinates and normals for a face with UV subdivision
map = List.Map(list=turn_into_list, f_x=gridFromFace.Points)
byBestFitThroughPoints = Plane.ByBestFitThroughPoints()
map_2 = List.Map(list=map, f_x=byBestFitThroughPoints)
combine = List.Combine(intersect, map_2, map)
isEmpty = List.IsEmpty()
map_3 = List.Map(f_x=isEmpty)
map_4 = List.Map(list=combine, f_x=map_3)
allFalse = AllFalse()
map_5 = List.Map(list=map_4, f_x=allFalse)
returnListOrSingleValue = Custom[ReturnListOrSingleValue](Item_1_unknown=surface, Item_2_list=map_5)  # If the item in input #1 is not a list, only the first item of the list in input #2 will be returned.
bool = Output(returnListOrSingleValue)
