# Dynamo custom node Switch.dyf (Dynamo 0.8.2.2392)
# category: Clockwork.Core.Logic.Actions
# Emulates the Switch/Case statement that is  available in multiple programming languages.

Check = Input()
turnIntoList = Custom[Turn Into List](Check)  # Turns an element (or a nested list) into a flat list
Cases = Input()
Values = Input()
matchWithKeyValues = Custom[Match List With Key Values](seq=turnIntoList, keys=Cases, values=Values)  # "List.MatchWithKeyValues"; Matches a list with a given set of keys and returns the values corresponding to the keys
getKeys = GetKeys(matchWithKeyValues)
isEmpty = List.IsEmpty()
map = List.Map(list=matchWithKeyValues, f_x=isEmpty)
filterByBoolMask = List.FilterByBoolMask(list=getKeys, mask=map)
Default = Input()
replaceItemAtIndex = List.ReplaceItemAtIndex(list=matchWithKeyValues, index=filterByBoolMask.in, item=Default)
Result = Output(replaceItemAtIndex)
