# Dynamo custom node Time.EvaluateLapTimes.dyf (Dynamo 0.8.1.1693)
# category: Clockwork.Core.Time.Query
# Evaluates a list of lap times and returns the overall time

LapTimes = Input(LapTimes : double[])
code_block = CodeBlock(seq=LapTimes) { seq2 = List.TakeItems(seq,List.Count(seq)-1); seq3 = List.RestOfItems(seq)-seq2; Math.Sum(seq3); }
NetLapTimes = Output(code_block.seq3)
OverallTime = Output(code_block.out2)
