# Dynamo custom node TurnIntoList.dyf "Turn Into List" (Dynamo 0.8.1.1823)
# category: Clockwork.Core.List.Create
# Turns an element (or a nested list) into a flat list

Input = Input()
code_block = CodeBlock(item=Input) { Flatten({item}); }
seq = Output(code_block)
