# Dynamo custom node UV.RoundDownToPrecision.dyf (Dynamo 0.8.1.1693)
# category: Clockwork.Geometry.UV.Actions
# Rounds a UV coordinate *down* to a specified precision

uv = Input(uv : UV)
Precision = Input(Precision : double)
code_block = CodeBlock(uc=uv, pr=Precision) { a = {uc.U,uc.V}; ar = Math.Floor(a/pr)*pr; UV.ByCoordinates(ar[0],ar[1]); }
UV_s = Output(code_block.out2)  # "UV(s)"
