# Dynamo custom node UnitType.DisplayUnitType.dyf (Dynamo 0.8.3.2553)
# category: Clockwork.Revit.Elements.UnitType.Query
# Retrieves the display unit type for a given unit type.

unitType = Input()
fromDynamoUnitType = Custom[UnitType.FromDynamoUnitType](DynamoUnitType=unitType)  # Retrieves the corresponding Revit UnitType from a Dynamo UnitType
python_script = Python(IN[0]=fromDynamoUnitType)
# ---------- python_script.python (18 lines) ----------
import clr
clr.AddReference('RevitAPI')
from Autodesk.Revit.DB import *

clr.AddReference("RevitServices")
import RevitServices
from RevitServices.Persistence import DocumentManager

unittype = IN[0]
doc = DocumentManager.Instance.CurrentDBDocument
formatoptions = doc.GetUnits().GetFormatOptions(unittype)
dispunits = formatoptions.DisplayUnits
symtype = formatoptions.UnitSymbol
if symtype == UnitSymbolType.UST_NONE:
	dispsym = 'None'
else:
	dispsym = LabelUtils.GetLabelFor(symtype)
OUT = (dispunits,dispsym)
# ----------------------------------------
code_block = CodeBlock(seq=python_script) { seq[0]; seq[1]; }
displayUnitType = Output(code_block.out0)
unitSymbol = Output(code_block.out1)
