# Dynamo custom node UnitType.FromDynamoUnitType.dyf (Dynamo 0.8.3.2553)
# category: Clockwork.Revit.Elements.UnitType.Create
# Retrieves the corresponding Revit UnitType from a Dynamo UnitType

DynamoUnitType = Input()
python_script = Python(IN[0]=DynamoUnitType)
# ---------- python_script.python (14 lines) ----------
import clr
clr.AddReference('RevitAPI')
from Autodesk.Revit.DB import *

dynunittype = IN[0]
if str(dynunittype) == 'DynamoUnits.Area':
	ut = UnitType.UT_Area
elif str(dynunittype) == 'DynamoUnits.Length':
	ut = UnitType.UT_Length
elif str(dynunittype) == 'DynamoUnits.Volume':
	ut = UnitType.UT_Volume
else:
	ut = null
OUT = ut
# ----------------------------------------
RevitUnitType = Output(python_script)
