# Dynamo custom node Vector.Average.dyf (Dynamo 0.8.1.1693)
# category: Clockwork.Geometry.Vector.Query
# Determines the average vector of a list of vectors

vectors = Input(vectors : Vector[])
code_block = CodeBlock(v=vectors) { vn = v.Normalized(); Vector.ByCoordinates(Math.Average(vn.X),Math.Average(vn.Y),Math.Average(vn.Z),true); }
Vector = Output(code_block.out1)
