# Dynamo custom node Vector.IsParallelToPlane.dyf (Dynamo 0.8.1.1693)
# category: Clockwork.Geometry.Vector.Query
# Checks if a given vector is parallel to a given plane

vector = Input(vector : Vector)
plane = Input(plane : Plane)
code_block = CodeBlock(pl=plane) { pl.Normal; }
isOrthogonalToVector = Custom[Vector.IsOrthogonalToVector](Vector1=vector, Vector2=code_block)  # Checks if two vectors are orthogonal to each other
bool = Output(isOrthogonalToVector)
