# Dynamo custom node View.IsPerspective.dyf (Dynamo 0.8.2.2392)
# category: Clockwork.Revit.Views.View.Query
# Checks whether a given view is a perspective view.

view = Input()
turnIntoList = Custom[Turn Into List](view)  # Turns an element (or a nested list) into a flat list
python_script = Python(IN[0]=turnIntoList)
# ---------- python_script.python (16 lines) ----------
import clr
clr.AddReference('RevitAPI')
from Autodesk.Revit.DB import *

views = UnwrapElement(IN[0])
booleans = list()

for view in views:
	try:
		if view.IsPerspective:
			booleans.append(True)
		else:
			booleans.append(False)
	except:
		booleans.append(False)
OUT = booleans		
# ----------------------------------------
returnListOrSingleValue = Custom[ReturnListOrSingleValue](unknownItem=view, seq=python_script)  # If the item in input #1 is not a list, only the first item of the list in input #2 will be returned.
bool = Output(returnListOrSingleValue)
