# Dynamo custom node View.Plane.dyf (Dynamo 0.8.3.2514)
# category: Clockwork.Revit.Views.View.Query
# Retrieves the plane of a given view

view = Input()
turn_into_list = Custom[Turn Into List](view)  # Turns an element (or a nested list) into a flat list
python_script = Python(IN[0]=turn_into_list)
# ---------- python_script.python (20 lines) ----------
import clr
clr.AddReference('RevitAPI')
from Autodesk.Revit.DB import *

clr.AddReference("RevitNodes")
import Revit
clr.ImportExtensions(Revit.GeometryConversion)

items = UnwrapElement(IN[0])
elementlist = list()
olist = list()
dlist = list()

for item in items:
	try:
		olist.append(item.Origin.ToPoint())
		dlist.append(item.ViewDirection.ToVector())
	except:
		elementlist.append(list())
OUT = (olist,dlist)
# ----------------------------------------
code_block = CodeBlock(seq=python_script) { Plane.ByOriginNormal(seq[0],seq[1]); }
returnListOrSingleValue = Custom[ReturnListOrSingleValue](unknownItem=view, seq=code_block)  # If the item in input #1 is not a list, only the first item of the list in input #2 will be returned.
plane = Output(returnListOrSingleValue)
