# Dynamo custom node View.UsesViewFilters.dyf (Dynamo 0.8.3.2553)
# category: Clockwork.Revit.Views.View.Query
# Checks if a given view has any view filters applied to it.

view = Input()
turn_into_list = Custom[Turn Into List](view)  # Turns an element (or a nested list) into a flat list
python_script = Python(IN[0]=turn_into_list)
# ---------- python_script.python (28 lines) ----------
import clr
clr.AddReference('RevitAPI')
from Autodesk.Revit.DB import *

clr.AddReference("RevitServices")
import RevitServices
from RevitServices.Persistence import DocumentManager

doc = DocumentManager.Instance.CurrentDBDocument
views = UnwrapElement(IN[0])
elementlist = list()

collector = FilteredElementCollector(doc)
filters = collector.OfClass(FilterElement).ToElements()

for view in views:
	try:
		thisfilter = False
		for filter in filters:
			if view.IsFilterApplied(filter.Id):
				thisfilter = True
		if thisfilter:
			elementlist.append(True)
		else:
			elementlist.append(False)
	except:
		elementlist.append(False)
OUT = elementlist
# ----------------------------------------
returnListOrSingleValue = Custom[ReturnListOrSingleValue](unknownItem=view, seq=python_script)  # If the item in input #1 is not a list, only the first item of the list in input #2 will be returned.
bool = Output(returnListOrSingleValue)
