# Dynamo custom node Wall.ByFace.dyf (Dynamo 0.8.3.2580)
# category: Clockwork.Revit.Elements.Wall.Create
# Creates a wall on top of a face. The face typically needs to be the face of a mass surface in Revit.

surface = Input(surface : Surface)
walltype = Input(walltype : WallType)
wallLocationLine = Input()
turn_into_list = Custom[Turn Into List](surface)  # Turns an element (or a nested list) into a flat list
fromDynamoSurface = Custom[RevitFaceReference.FromDynamoSurface](DynamoSurface=turn_into_list)  # Returns the underlying Revit face reference of a given surface
python_script = Python(IN[0]=walltype, IN[1]=wallLocationLine, IN[2]=fromDynamoSurface)
# ---------- python_script.python (28 lines) ----------
import clr
clr.AddReference('RevitAPI')
from Autodesk.Revit.DB import *

clr.AddReference("RevitNodes")
import Revit
clr.ImportExtensions(Revit.Elements)

clr.AddReference("RevitServices")
import RevitServices
from RevitServices.Persistence import DocumentManager
from RevitServices.Transactions import TransactionManager

doc = DocumentManager.Instance.CurrentDBDocument
walltype = UnwrapElement(IN[0])
locline = IN[1]
facerefs = IN[2]
elementlist = list()

TransactionManager.Instance.EnsureInTransaction(doc)
for ref in facerefs:
	try:
		newwall = FaceWall.Create(doc,walltype.Id,locline,ref)
		elementlist.append(newwall)
	except:
		elementlist.append(list())
TransactionManager.Instance.TransactionTaskDone()
OUT = elementlist
# ----------------------------------------
returnListOrSingleValue = Custom[ReturnListOrSingleValue](unknownItem=surface, seq=python_script)  # If the item in input #1 is not a list, only the first item of the list in input #2 will be returned.
wall = Output(returnListOrSingleValue)
