# Dynamo custom node Wall.CreationMethod.dyf (Dynamo 0.8.3.2580)
# category: Clockwork.Revit.Elements.Wall.Query
# Retrieves the creation method of a given wall

wall = Input(wall : Wall)
turn_into_list = Custom[Turn Into List](wall)  # Turns an element (or a nested list) into a flat list
python_script = Python(IN[0]=turn_into_list)
# ---------- python_script.python (23 lines) ----------
import clr
clr.AddReference('RevitAPI')
from Autodesk.Revit.DB import *

clr.AddReference("RevitNodes")
import Revit
clr.ImportExtensions(Revit.Elements)

wallinstances = UnwrapElement(IN[0])
methodlist = list()
for item in wallinstances:
	try:
		if item.GetType().Name == 'Wall':
			methodlist.append('Standard')
		elif item.GetType().Name == 'FaceWall':
			methodlist.append('By Face')
		elif item.GetType().Name == 'FamilyInstance':
			methodlist.append('In-Place')
		else:
			methodlist.append('No Wall')
	except:
		methodlist.append('No Wall')
OUT = methodlist
# ----------------------------------------
returnListOrSingleValue = Custom[ReturnListOrSingleValue](unknownItem=wall, seq=python_script)  # If the item in input #1 is not a list, only the first item of the list in input #2 will be returned.
creationMethod = Output(returnListOrSingleValue)
