# Dynamo custom node WallType.FunctionIsFoundation.dyf (Dynamo 0.8.3.2580)
# category: Clockwork.Revit.Elements.WallType.Query
# Checks if the Function property of a wall type is set to "Foundation"

wallType = Input(wallType : WallType)
turn_into_list = Custom[Turn Into List](wallType)  # Turns an element (or a nested list) into a flat list
python_script = Python(IN[0]=turn_into_list)
# ---------- python_script.python (17 lines) ----------
import clr
clr.AddReference('RevitAPI')
from Autodesk.Revit.DB import *

walltypes = UnwrapElement(IN[0])
booleans = list()

for item in walltypes:
	try:
		wallfunction = item.get_Parameter(BuiltInParameter.FUNCTION_PARAM).AsInteger()
		if wallfunction == 2:
			booleans.append(True)
		else:
			booleans.append(False)
	except:
		booleans.append(False)
OUT = booleans
# ----------------------------------------
returnListOrSingleValue = Custom[ReturnListOrSingleValue](unknownItem=wallType, seq=python_script)  # If the item in input #1 is not a list, only the first item of the list in input #2 will be returned.
bool = Output(returnListOrSingleValue)
