# Dynamo custom node Workset.Kind.dyf (Dynamo 0.8.3.2580)
# category: Clockwork.Revit.Elements.Workset.Query
# Retrieves the kind of a given workset

workset = Input()
turn_into_list = Custom[Turn Into List](workset)  # Turns an element (or a nested list) into a flat list
python_script = Python(IN[0]=turn_into_list)
# ---------- python_script.python (17 lines) ----------
import clr
clr.AddReference('RevitAPI')
from Autodesk.Revit.DB import *

clr.AddReference("RevitServices")
import RevitServices
from RevitServices.Persistence import DocumentManager

doc = DocumentManager.Instance.CurrentDBDocument
worksets = UnwrapElement(IN[0])
elementlist = list()
for workset in worksets:
	try:
		elementlist.append(str(workset.Kind))
	except:
		elementlist.append(list())
OUT = elementlist
# ----------------------------------------
returnListOrSingleValue = Custom[ReturnListOrSingleValue](unknownItem=workset, seq=python_script)  # If the item in input #1 is not a list, only the first item of the list in input #2 will be returned.
kind = Output(returnListOrSingleValue)
