# Dynamo custom node All Family Types Of Category.dyf (Dynamo 0.8.2.2392)
# category: Clockwork.Revit.Selection.ByCollector
# Gets all family types/symbols of a given category in the model  (does *not *work for system families)

category = Input(category : Category)
turnIntoList = Custom[Turn Into List](unknownItem=category)  # Turns an element (or a nested list) into a flat list
toggle = Input(toggle : bool = true)
python_script = Python(IN[0]=turnIntoList, IN[1]=toggle)
# ---------- python_script.python (21 lines) ----------
import System
import clr
clr.AddReference('RevitAPI')
from Autodesk.Revit.DB import *

clr.AddReference("RevitServices")
import RevitServices
from RevitServices.Persistence import DocumentManager

doc = DocumentManager.Instance.CurrentDBDocument
cats = IN[0]

elementlist = list()
# This could be more elegant if only I knew how to implement a Multicategory filter in Python....
for item in cats:
	collector = FilteredElementCollector(doc)
	collector.OfClass(FamilySymbol)
	bic = System.Enum.ToObject(BuiltInCategory, item.Id)
	collector.OfCategory(bic)
	elementlist.append(collector.ToElements())
OUT = elementlist
# ----------------------------------------
returnListOrSingleValue = Custom[ReturnListOrSingleValue](unknownItem=category, seq=python_script)  # If the item in input #1 is not a list, only the first item of the list in input #2 will be returned.
familyTypes = Output(returnListOrSingleValue)
