# Dynamo custom node Angle.ExteriorAngle.dyf (Dynamo 0.8.1.1823)
# category: Clockwork.Core.Formulas.Query
# Computes the exterior angle of a given angle.

angle = Input(angle : double)
code_block = CodeBlock(angle=angle) { 360-angle; 180-angle; }
n360_angle = Output(code_block.out0)  # "360°-angle"
n180_angle = Output(code_block.out1)  # "180°-angle"
