# Dynamo custom node Array.AssociatedFamilyParameter.dyf (Dynamo 0.9.0.3067)
# category: Clockwork.Revit.Elements.Array.Query
# Returns the associated family parameter of an array label (if any). PLEASE NOTE: This node will only work in a family document!

dimension = Input()
turnIntoList = Custom[TurnIntoList](unknownItem=dimension)  # Turns an element (or a nested list) into a flat list
python_script = Python(IN[0]=turnIntoList)
# ---------- python_script.python (20 lines) ----------
import clr
clr.AddReference('RevitAPI')
from Autodesk.Revit.DB import *

clr.AddReference("RevitNodes")
import Revit
clr.ImportExtensions(Revit.Elements)

basearrays = UnwrapElement(IN[0])
paramlist = list()
paramnamelist = list()
for basearray in basearrays:
	try:
		if basearray.Label != None:
			paramlist.append(basearray.Label)
			paramnamelist.append(basearray.Label.Definition.Name)
	except:
		paramlist.append(list())
		paramnamelist.append(list())
OUT = (paramlist,paramnamelist)
# ----------------------------------------
code_block = CodeBlock(seq=python_script) { seq[0]; seq[1]; }
returnListOrSingleValue = Custom[ReturnListOrSingleValue](unknownItem=dimension, seq=code_block.out0)  # If the unknown item is not a list but rather a single item, only the first item of the list (input "seq") will be returned.
familyParameter = Output(returnListOrSingleValue)
returnListOrSingleValue_2 = Custom[ReturnListOrSingleValue](unknownItem=dimension, seq=code_block.out1)
familyParameterName = Output(returnListOrSingleValue_2)
