# Dynamo custom node BoundingBox.PerimeterCurvesByNormal.dyf (Dynamo 0.8.1.1823)
# category: Clockwork.Geometry.BoundingBox.Query
# Returns the perimeter curve of a bounding box on a plane determined by a given normal and the centroid of the bounding box

boundingbox = Input(boundingbox : BoundingBox)
code_block = CodeBlock(bbox=boundingbox) { List.Transpose({bbox.MaxPoint,bbox.MinPoint}); }
average = Custom[Point.Average](points=code_block)  # Determines the average of a list of points
normal = Input(normal : Vector)
code_block_2 = CodeBlock(ori=average, norm=normal, bbox=boundingbox)
# ---------- code_block_2.designscript (4 lines) ----------
pl = Plane.ByOriginNormal(ori,norm);
cub = bbox.ToCuboid();
surf = Flatten(pl.Intersect(cub));
pcur = surf.PerimeterCurves();
# ----------------------------------------
returnListOrSingleValue = Custom[ReturnListOrSingleValue](Item_1_unknown=boundingbox, Item_2_list=code_block_2.pcur)  # If the item in input #1 is not a list, only the first item of the list in input #2 will be returned.
curves = Output(returnListOrSingleValue)
