# Dynamo custom node BoundingBox.PerimeterCurvesOnPlane.dyf (Dynamo 0.8.1.1823)
# category: Clockwork.Geometry.BoundingBox.Query
# Returns the perimeter curve of a bounding box on a given plane (assuming that the bounding box and plane intersect)

boundingbox = Input(boundingbox : BoundingBox)
plane = Input(plane : Plane)
code_block = CodeBlock(bbox=boundingbox, pl=plane) { cub = bbox.ToCuboid(); surf = Flatten(pl.Intersect(cub)); pcur = surf.PerimeterCurves(); }
returnListOrSingleValue = Custom[ReturnListOrSingleValue](Item_1_unknown=boundingbox, Item_2_list=code_block.pcur)  # If the item in input #1 is not a list, only the first item of the list in input #2 will be returned.
curves = Output(returnListOrSingleValue)
