# Dynamo custom node Buckyball.ByOriginAndRadius.dyf (Dynamo 0.8.2.2392)
# category: Clockwork.Geometry.Buckyball.Create
# Returns all the data necessary for modeling a truncated icosahedron (vertices and struts) as well as the surface area and volume.

radius = Input(radius : double = 1)
code_block = CodeBlock()
# ---------- code_block.designscript (11 lines) ----------
// The important thing for creating *all* point coordinates
// is to set the lacing options of all subsequent Point nodes to cross product.
phi = Math.GoldenRatio;
{0};
{1,-1};
{3*phi,-3*phi};
{2,-2};
{1+2*phi,-(1+2*phi)};
{phi,-phi};
{2+phi,-(2+phi)};
{2*phi,-2*phi};
# ----------------------------------------
byCoordinates = Point.ByCoordinates(x=code_block.out1, y=code_block.out2, z=code_block.out3, lacing=CrossProduct)
byCoordinates_2 = Point.ByCoordinates(x=code_block.out2, y=code_block.out3, z=code_block.out1, lacing=CrossProduct)
byCoordinates_3 = Point.ByCoordinates(x=code_block.out3, y=code_block.out1, z=code_block.out2, lacing=CrossProduct)
byCoordinates_4 = Point.ByCoordinates(x=code_block.out4, y=code_block.out5, z=code_block.out6, lacing=CrossProduct)
byCoordinates_5 = Point.ByCoordinates(x=code_block.out5, y=code_block.out6, z=code_block.out4, lacing=CrossProduct)
byCoordinates_6 = Point.ByCoordinates(x=code_block.out6, y=code_block.out4, z=code_block.out5, lacing=CrossProduct)
byCoordinates_7 = Point.ByCoordinates(x=code_block.out2, y=code_block.out7, z=code_block.out8, lacing=CrossProduct)
byCoordinates_8 = Point.ByCoordinates(x=code_block.out7, y=code_block.out8, z=code_block.out2, lacing=CrossProduct)
byCoordinates_9 = Point.ByCoordinates(x=code_block.out8, y=code_block.out2, z=code_block.out7, lacing=CrossProduct)
code_block_2 = CodeBlock(p1=byCoordinates, p2=byCoordinates_2, p3=byCoordinates_3, p4=byCoordinates_4, p5=byCoordinates_5, p6=byCoordinates_6, p7=byCoordinates_7, p8=byCoordinates_8, p9=byCoordinates_9)
# ---------- code_block_2.designscript (2 lines) ----------
// Create point list
Flatten({p1,p2,p3,p4,p5,p6,p7,p8,p9});
# ----------------------------------------
origin = Input(origin : Autodesk.Point)
almostZero = Custom[Math.AlmostZero]()  # Returns a feasable computational tolerance to zero (1.0e-9 or a billionth of 1) for use in calculations. More background info: https://github.com/ikeough/Dynamo/issues/879
python_script_create_struts = Python(IN[0]=code_block_2, IN[1]=almostZero)
# ---------- python_script_create_struts.python (32 lines) ----------
import clr
clr.AddReference('ProtoGeometry')
from Autodesk.DesignScript.Geometry import *

points = IN[0]
almostzero = IN[1]
struts = list()

# this function recursively finds all the pairs of points of the buckyball struts
def BuckyballStruts(points,struts):
	firstpoint = points[0]
	restofpoints = points[1:]
	# measure distance between first point and rest of points
	distances = [firstpoint.DistanceTo(x) for x in restofpoints]
	# filter out all points that do not have a distance of 2 to the first point
	strutpoints = list()
	strutpointpairs = list()
	i = 0
	for dist in distances:
		# use a little tolerance so we catch all struts
		if dist > 2 - almostzero and dist < 2 + almostzero:
			strutpoints.append(restofpoints[i])
			strutpointpairs.append((firstpoint,restofpoints[i]))
		i += 1
	# add strutpointpairs to struts
	if len(strutpointpairs) > 0: struts.extend(strutpointpairs)
	# Continue processing the list recursively until there's only one point left. By always removing the first point from the list, we ensure that no duplicate struts are computed.
	if len(restofpoints) > 1:
		return BuckyballStruts(restofpoints,struts)
	else: return (restofpoints,struts)
	
OUT = BuckyballStruts(points,struts)[1]
# ----------------------------------------
python_script_create_surfaces = Python(IN[0]=python_script_create_struts, IN[1]=code_block_2, IN[2]=almostZero)
# ---------- python_script_create_surfaces.python (70 lines) ----------
import clr
clr.AddReference('ProtoGeometry')
from Autodesk.DesignScript.Geometry import *

struts = IN[0]
points = IN[1]
almostzero = IN[2]

def BuckyballFaces(struts,points,planes,almostzero,vertices):
	firststrut = struts[0]
	struts.pop(0)
	# find the two adjacent struts
	adjacent = list()
	for strut in struts:
		for point in strut:
			if point.IsAlmostEqualTo(firststrut[0]):
				adjacent.append(strut)
				break
		if len(adjacent) == 2:
			break
	# identify planes and find all vertices on planes		
	vlist = list()		
	for item in adjacent:
		triangle = (firststrut[1],item[0],item[1])
		pl = Plane.ByBestFitThroughPoints(triangle)	
		vlist = list()
		for point in points:
			dist = pl.DistanceTo(point)
			if dist < almostzero and dist > -almostzero:
				vlist.append(point)
		newplane = (Plane.ByBestFitThroughPoints(vlist))
		append_vertices = True
		for pl in planes:
			if newplane.IsAlmostEqualTo(pl):
				append_vertices = False
		if append_vertices: 
			vertices.append(vlist)
			planes.append(newplane)
	# let this function recursively call itself until it finds all planes
	if len(planes) < 32:
		return BuckyballFaces(struts,points,planes,almostzero,vertices)
	else:
		return (struts,points,planes,almostzero,vertices)

def OrderFaceIndices(p_ordered,p_unordered,almostzero):
	i = 0;
	for p in p_unordered:
		dist = p_ordered[(len(p_ordered)-1)].DistanceTo(p)
		if dist > 2-almostzero and dist < 2+almostzero:
			p_ordered.append(p)
			p_unordered.pop(i)
			break
		i += 1
	if len(p_unordered) > 0:
		return OrderFaceIndices(p_ordered,p_unordered,almostzero)
	else:
		return (p_ordered,p_unordered,almostzero)

vlist_unordered = BuckyballFaces(struts,points,list(),almostzero,list())[4]

vset_ordered = list()
for vset in vlist_unordered:
	p_ordered = [vset[0]]
	vset.pop(0)
	vset_ordered.append(OrderFaceIndices(p_ordered,vset,almostzero))

vset_out = list()
for vset in vset_ordered:
	vset_out.append(vset[0])
OUT = vset_out
# ----------------------------------------
code_block_3 = CodeBlock(radius=radius, points=code_block_2, ori=origin, struts=python_script_create_struts, surfs=python_script_create_surfaces)
# ---------- code_block_3.designscript (22 lines) ----------
// Determine scale factor based on radius
factor = 1/4*Math.Sqrt(58+18*Math.Sqrt(5));
scaling = radius/2/factor;
// Add scale and origin for vertices
p2 = points.Scale(scaling);
p3 = List.Transpose(ori.Add(p2.AsVector()));
// Add scale and origin for struts
s2 = struts.Scale(scaling);
s3 = ori.Add(s2.AsVector());
s4 = List.Transpose(s3);
// Create lines for the struts
Line.ByStartPointEndPoint(s4[0],s4[1]);
// Add scale and origin for surfaces
f2 = surfs.Scale(scaling);
f3 = ori.Add(f2.AsVector());
6;
// Create surfaces
f4 = Surface.ByPatch(Polygon.ByPoints(f3));
// Compute surface area and volume based on strut length
strutlength = s4[0][0].DistanceTo(s4[1][0]);
buckyarea = (20*3/2*Math.Sqrt(3)+12*5/4*Math.Sqrt(1+2/Math.Sqrt(5)))*Math.Pow(strutlength,2);
buckyvol = 1/4*(125+43*Math.Sqrt(5))*Math.Pow(strutlength,3);
# ----------------------------------------
Vertices = Output(code_block_3.p3)
average = Custom[Point.Average](points=code_block_3.s3)  # Determines the average of a list of points
code_block_4 = CodeBlock(ori=origin, avg=average)
# ---------- code_block_4.designscript (2 lines) ----------
// Determine up vector from buckyball center for possible use in structural framing
Vector.ByTwoPoints(ori,avg).Normalized();
# ----------------------------------------
StrutsUpVectors = Output(code_block_4)
StrutGeometry = Output(code_block_3.out7)
StrutPoints = Output(code_block_3.s3)
filterBySublistLength = Custom[List.FilterSublistsByLength](seq=code_block_3.f3, length=code_block_3.out10)  # "List.FilterBySublistLength"; Filters out all sublists that do not have the specified length
HexagonPoints = Output(filterBySublistLength.in)
PentagonPoints = Output(filterBySublistLength.out)
SurfaceGeometry = Output(code_block_3.f4)
SurfaceArea = Output(code_block_3.buckyarea)
Volume = Output(code_block_3.buckyvol)
