# Dynamo custom node BuiltInCategories.ByName.dyf (Dynamo 0.9.0.3067)
# category: Clockwork.Revit.Selection.Miscellaneous
# Looks up all the built-in categories based on a given name (or part of a name) of the category. Search is case-insensitive.

listBuiltInCategories = Custom[Document.ListBuiltInCategories]()  # List all the available BuiltInCategories
string_from_object = FromObject(listBuiltInCategories.BuiltInCategories)
searchFor = Input(searchFor : string)
ignoreCase = Input(ignoreCase : bool = true)
contains = String.Contains(str=string_from_object, searchFor=searchFor, ignoreCase=ignoreCase)
filterByBoolMask = List.FilterByBoolMask(list=listBuiltInCategories.BuiltInCategories, mask=contains)
BuiltInCategories = Output(filterByBoolMask.in)
filterByBoolMask_2 = List.FilterByBoolMask(list=listBuiltInCategories.ElementIDs, mask=contains)
ElementIDs = Output(filterByBoolMask_2.in)
