# Dynamo custom node Clipboard.GetFrom.dyf (Dynamo 0.8.2.2392)
# category: Clockwork.Core.Clipboard.Query
# Gets the content of the clipboard. ATTENTION: Will only work with strings and on top of Revit (not in sandbox mode).

toggle = Input(toggle : bool = true)
python_script = Python(IN[0]=toggle)
# ---------- python_script.python (21 lines) ----------
import clr
import System
from System.Threading import Thread, ThreadStart
clr.AddReference("System.Windows.Forms")

clipboardcontents = '###'

def GetText():
    def thread_proc():
        global clipboardcontents
        clipboardcontents = System.Windows.Forms.Clipboard.GetText()
    t = Thread(ThreadStart(thread_proc))
    t.ApartmentState = System.Threading.ApartmentState.STA
    t.Start()
    t.Join()

try:
	GetText()
	OUT = clipboardcontents
except:
	OUT = 'Data could not be copied to clipboard'
# ----------------------------------------
str = Output(python_script)
