# Dynamo custom node Curve.ClosedLoopThroughPoints.dyf (Dynamo 0.8.1.1693)
# category: Clockwork.Geometry.Curve.Create
# Creates a *closed* loop of curves based on a given list of points

points = Input(points : Autodesk.Point[])
code_block = CodeBlock(plist=points) { PolyCurve.ByPoints(plist,true).Curves(); }
Curves = Output(code_block)
