# Dynamo custom node CustomNode.Info.dyf (Dynamo 0.9.0.3067)
# category: Clockwork.Core.CustomNode.Query
# Extracts information from a custom node.

string = StringInput("""Version
Name
ID
Description
Category""")
string_2 = StringInput("\n")
split = String.Split(string, string_2)
string_3 = StringInput("=\"")
concat = String.Concat(arg1=string_3)
map = List.Map(list=split, f_x=concat)
path = Input(path : string)
fromPath = FileObject(path)  # "File.FromPath"
readText = File.ReadText(fromPath)
split_2 = String.Split(readText)
map_2 = List.Map(list=map, f_x=split_2)
code_block = CodeBlock { 1; }
getItemAtIndex = List.GetItemAtIndex(index=code_block)
map_3 = List.Map(list=map_2, f_x=getItemAtIndex)
string_4 = StringInput("\"")
split_3 = String.Split(map_3, string_4)
firstItem = List.FirstItem()
map_4 = List.Map(list=split_3, f_x=firstItem)
code_block_2 = CodeBlock(seq=map_4) { seq[0]; seq[1]; seq[2]; seq[3]; seq[4]; }
Version = Output(code_block_2.out0)
Name = Output(code_block_2.out1)
ID = Output(code_block_2.out2)
Description = Output(code_block_2.out3)
Category = Output(code_block_2.out4)
string_5 = StringInput(" nickname=\"Input\"")
split_4 = String.Split(readText, string_5)
restOfItems = List.RestOfItems(split_4)
string_6 = StringInput("Symbol value=\"")
split_5 = String.Split(restOfItems, string_6)
restOfItems_2 = List.RestOfItems()
map_5 = List.Map(list=split_5, f_x=restOfItems_2)
firstItem_2 = List.FirstItem()
map_6 = List.Map(list=map_5, f_x=firstItem_2)
split_6 = String.Split(map_6, string_4)
firstItem_3 = List.FirstItem()
map_7 = List.Map(list=split_6, f_x=firstItem_3)
code_block_3 = CodeBlock { "&quot"; }
string_7 = StringInput(";")
code_block_4 = CodeBlock(a=code_block_3, b=string_7) { a+b; }
replace = String.Replace(str=map_7, searchFor=code_block_4, replaceWith=string_4)
string_8 = StringInput(":")
split_7 = String.Split(replace, string_8)
firstItem_4 = List.FirstItem()
map_8 = List.Map(list=split_7, f_x=firstItem_4)
getItemAtIndex_2 = List.GetItemAtIndex(index=code_block)
map_9 = List.Map(list=split_7, f_x=getItemAtIndex_2)
string_9 = StringInput("=")
split_8 = String.Split(map_9, string_9)
firstItem_5 = List.FirstItem()
map_10 = List.Map(list=split_8, f_x=firstItem_5)
getItemAtIndex_3 = List.GetItemAtIndex(index=code_block)
map_11 = List.Map(list=split_8, f_x=getItemAtIndex_3)
create = List.Create(map_8, map_10, map_11)
trimWhitespace = String.TrimWhitespace(create)
code_block_5 = CodeBlock { ""; }
replaceNull = Custom[List.ReplaceNull](replacement=code_block_5)  # Replaces all null values within a given list with a substitute
map_12 = List.Map(list=trimWhitespace, f_x=replaceNull)
code_block_6 = CodeBlock(seq=map_12) { seq[0]; seq[1]; seq[2]; }
Inputs = Output(code_block_6.out0)
InputDataTypes = Output(code_block_6.out1)
InputDefaultVals = Output(code_block_6.out2)
string_10 = StringInput(" nickname=\"Output\"")
split_9 = String.Split(readText, string_10)
restOfItems_3 = List.RestOfItems(split_9)
string_11 = StringInput("Symbol value=\"")
split_10 = String.Split(restOfItems_3, string_11)
restOfItems_4 = List.RestOfItems()
map_13 = List.Map(list=split_10, f_x=restOfItems_4)
firstItem_6 = List.FirstItem()
map_14 = List.Map(list=map_13, f_x=firstItem_6)
split_11 = String.Split(map_14, string_4)
firstItem_7 = List.FirstItem()
map_15 = List.Map(list=split_11, f_x=firstItem_7)
Outputs = Output(map_15)
string_12 = StringInput("<Script>")
split_12 = String.Split(readText, string_12)
restOfItems_5 = List.RestOfItems(split_12)
string_13 = StringInput("</Script>")
split_13 = String.Split(restOfItems_5, string_13)
firstItem_8 = List.FirstItem()
map_16 = List.Map(list=split_13, f_x=firstItem_8)
string_14 = StringInput("&gt")
string_15 = StringInput(";")
code_block_7 = CodeBlock(a=string_14, b=string_15) { a+b; }
string_16 = StringInput(">")
replace_2 = String.Replace(str=map_16, searchFor=code_block_7, replaceWith=string_16)
string_17 = StringInput("&lt")
code_block_8 = CodeBlock(a=string_17, b=string_15) { a+b; }
string_18 = StringInput("<")
replace_3 = String.Replace(str=replace_2, searchFor=code_block_8, replaceWith=string_18)
PythonScripts = Output(replace_3)
string_19 = StringInput("nickname=\"")
split_14 = String.Split(readText, string_19)
restOfItems_6 = List.RestOfItems(split_14)
string_20 = StringInput("\"")
split_15 = String.Split(restOfItems_6, string_20)
firstItem_9 = List.FirstItem()
map_17 = List.Map(list=split_15, f_x=firstItem_9)
string_21 = StringInput("""DSIronPythonNode.PythonNode
Dynamo.Nodes.Symbol
Dynamo.Nodes.Output""")
string_22 = StringInput("\n")
split_16 = String.Split(string_21, string_22)
string_23 = StringInput("type=\"")
split_17 = String.Split(readText, string_23)
restOfItems_7 = List.RestOfItems(split_17)
string_24 = StringInput("\"")
split_18 = String.Split(restOfItems_7, string_24)
firstItem_10 = List.FirstItem()
map_18 = List.Map(list=split_18, f_x=firstItem_10)
containsItem = List.ContainsItem(list=split_16, item=map_18)
filterByBoolMask = List.FilterByBoolMask(list=map_17, mask=containsItem)
string_25 = StringInput("Dynamo.Nodes.Function")
filterByBoolMask_2 = List.FilterByBoolMask(list=map_18, mask=containsItem)
eq = string_25 == filterByBoolMask_2.out
filterByBoolMask_3 = List.FilterByBoolMask(list=filterByBoolMask.out, mask=eq)
countOccurences = Custom[List.CountOccurences](seq=filterByBoolMask_3.out)  # Counts the number of occurences of each unique element in a given list
NestedBuiltinNodes = Output(countOccurences.uniqueElements)
BuiltinNodesCount = Output(countOccurences.count)
countOccurences_2 = Custom[List.CountOccurences](seq=filterByBoolMask_3.in)
NestedCustomNodes = Output(countOccurences_2.uniqueElements)
CustomNodesCount = Output(countOccurences_2.count)
