# Dynamo custom node DetailLine.FromCurve.dyf (Dynamo 0.9.0.3067)
# category: Clockwork.Revit.Elements.DetailLine.Create
# Creates a detail line based on a given curve

curve = Input(curve : Autodesk.Curve)
turnIntoList = Custom[Turn Into List](unknownItem=curve)  # Turns an element (or a nested list) into a flat list
view = Input(view : View)
python_script = Python(IN[0]=turnIntoList, IN[1]=view)
# ---------- python_script.python (29 lines) ----------
import clr
clr.AddReference('RevitAPI')
from Autodesk.Revit.DB import *

clr.AddReference("RevitNodes")
import Revit
clr.ImportExtensions(Revit.GeometryConversion)

clr.AddReference("RevitServices")
import RevitServices
from RevitServices.Persistence import DocumentManager
from RevitServices.Transactions import TransactionManager

doc = DocumentManager.Instance.CurrentDBDocument
curves = UnwrapElement(IN[0])
view = UnwrapElement(IN[1])
elementlist = []

TransactionManager.Instance.EnsureInTransaction(doc)
if doc.IsFamilyDocument == True:
	for curve in curves:
		detcurve = doc.FamilyCreate.NewDetailCurve(view, curve.ToRevitType())
		elementlist.append(detcurve)
else:
	for curve in curves:
		detcurve = doc.Create.NewDetailCurve(view, curve.ToRevitType())
		elementlist.append(detcurve)
TransactionManager.Instance.TransactionTaskDone()
OUT = elementlist
# ----------------------------------------
returnListOrSingleValue = Custom[ReturnListOrSingleValue](unknownItem=curve, seq=python_script)  # If the item in input #1 is not a list, only the first item of the list in input #2 will be returned.
detailLine = Output(returnListOrSingleValue)
