# Dynamo custom node Dimension.AssociatedFamilyParameter.dyf (Dynamo 0.8.2.2392)
# category: Clockwork.Revit.Elements.Dimension.Query
# Returns the associated family parameter of a dimension label (if any). PLEASE NOTE: This node will only work in a family document!

dimension = Input()
turnIntoList = Custom[TurnIntoList](unknownItem=dimension)  # Turns an element (or a nested list) into a flat list
python_script = Python(IN[0]=turnIntoList)
# ---------- python_script.python (21 lines) ----------
import clr
clr.AddReference('RevitAPI')
from Autodesk.Revit.DB import *

clr.AddReference("RevitNodes")
import Revit
clr.ImportExtensions(Revit.Elements)

dimensions = UnwrapElement(IN[0])
paramlist = list()
paramnamelist = list()
for dimension in dimensions:
	try:
		famlabel = dimension.FamilyLabel
		labelname = famlabel.Definition.Name
	except:
		famlabel = list()
		labelname = list()
	paramlist.append(famlabel)
	paramnamelist.append(labelname)
OUT = (paramlist,paramnamelist)
# ----------------------------------------
code_block = CodeBlock(seq=python_script) { seq[0]; seq[1]; }
returnListOrSingleValue = Custom[ReturnListOrSingleValue](unknownItem=dimension, seq=code_block.out0)  # If the unknown item is not a list but rather a single item, only the first item of the list (input "seq") will be returned.
familyParameter = Output(returnListOrSingleValue)
returnListOrSingleValue_2 = Custom[ReturnListOrSingleValue](unknownItem=dimension, seq=code_block.out1)
familyParameterName = Output(returnListOrSingleValue_2)
