# Dynamo custom node Document.DesignOptions.dyf (Dynamo 0.8.2.2392)
# category: Clockwork.Revit.Document.Query
# Returns all design options in the model, grouped by design option set

toggle = Input(toggle : bool = true)
python_script = Python(IN[0]=toggle)
# ---------- python_script.python (13 lines) ----------
import clr
clr.AddReference('RevitAPI')
from Autodesk.Revit.DB import *
import Autodesk

clr.AddReference("RevitServices")
import RevitServices
from RevitServices.Persistence import DocumentManager

doc = DocumentManager.Instance.CurrentDBDocument
collector = FilteredElementCollector(doc)
desopts = collector.OfClass(DesignOption).ToElements()
OUT = desopts
# ----------------------------------------
designOptionSet = Custom[DesignOption.DesignOptionSet](designOption=python_script)  # Returns the design option set of a given design option
code_block = CodeBlock(options=python_script, dos=designOptionSet, elem=designOptionSet) { {options, List.IsEmpty(options) ? dos : elem.UniqueId}; 1; }
groupListOfListsByKey = Custom[List.GroupListOfListsByKey](seq=code_block.out0, keyIndex=code_block.out1)  # Groups a list of lists by one of its keys
code_block_2 = CodeBlock(seq1=groupListOfListsByKey) { seq2 = List.Transpose(seq1); seq2[0]; List.UniqueItems(Flatten(seq2[1])); }
byID = Custom[Element.ByID](ID_UniqueId=code_block_2.out2)  # Gets the Revit element(s) for a list of IDs (or a single ID)
DesignOptionSets = Output(byID.element)
DesignOptions = Output(code_block_2.out1)
