# Dynamo custom node Document.LoadFamily.dyf (Dynamo 0.8.2.2392)
# category: Clockwork.Revit.Document.Actions
# A very crude implementation of family loading. Will *not* reload an already loaded family of the same name.

path = Input(path : string)
turn_into_list = Custom[Turn Into List](path)  # Turns an element (or a nested list) into a flat list
directoryName = FilePath.DirectoryName(turn_into_list)
code_block = CodeBlock(path=directoryName) { ""; path + "\\"; }
replace = String.Replace(str=turn_into_list, searchFor=code_block.out1, replaceWith=code_block.out0)
code_block_2 = CodeBlock { ".rfa"; ""; }
replace_2 = String.Replace(str=replace, searchFor=code_block_2.out0, replaceWith=code_block_2.out1)
python_script = Python(IN[0]=turn_into_list, IN[1]=replace_2)
# ---------- python_script.python (31 lines) ----------
import clr
clr.AddReference('RevitAPI')
from Autodesk.Revit.DB import *

clr.AddReference("RevitServices")
import RevitServices
from RevitServices.Persistence import DocumentManager
from RevitServices.Transactions import TransactionManager

doc = DocumentManager.Instance.CurrentDBDocument
fampaths = IN[0]
famnames = IN[1]
elementlist = list()

TransactionManager.Instance.EnsureInTransaction(doc)
for fampath in fampaths:
	try:
		doc.LoadFamily(fampath)
	except:
		pass
TransactionManager.Instance.TransactionTaskDone()

collector = FilteredElementCollector(doc)
collector.OfClass(Family)
for item in collector.ToElements():
	if item.Name in famnames:
		typelist = list()
		for famtypeid in item.GetFamilySymbolIds():
			typelist.append(doc.GetElement(famtypeid))
		elementlist.append(typelist)
OUT = elementlist
# ----------------------------------------
returnListOrSingleValue = Custom[ReturnListOrSingleValue](unknownItem=path, seq=python_script)  # If the unknown item is not a list but rather a single item, only the first item of the list (input "seq") will be returned.
familyTypes = Output(returnListOrSingleValue)
