# Dynamo custom node Document.Phases.dyf (Dynamo 0.7.5.3566)
# category: Clockwork.Revit.Document.Query
# Retrieves all phases in the active document in *chronological* order

python_script = Python()
# ---------- python_script.python (18 lines) ----------
import clr
clr.AddReference('RevitAPI')
from Autodesk.Revit.DB import *
import Autodesk

clr.AddReference("RevitNodes")
import Revit
clr.ImportExtensions(Revit.Elements)

clr.AddReference("RevitServices")
import RevitServices
from RevitServices.Persistence import DocumentManager

doc = DocumentManager.Instance.CurrentDBDocument
elementlist = []
for phase in doc.Phases:
	elementlist.append(phase.ToDSType(True))
OUT = elementlist
# ----------------------------------------
Phases = Output(python_script)
