# Dynamo custom node Document.Worksets.dyf (Dynamo 0.8.2.2392)
# category: Clockwork.Revit.Document.Query
# Returns all Worksets in the current document

toggle = Input(toggle : bool = true)
python_script = Python(IN[0]=toggle)
# ---------- python_script.python (12 lines) ----------
import clr
clr.AddReference('RevitAPI')
from Autodesk.Revit.DB import *
import Autodesk

clr.AddReference("RevitServices")
import RevitServices
from RevitServices.Persistence import DocumentManager

doc = DocumentManager.Instance.CurrentDBDocument
collector = FilteredWorksetCollector(doc)
OUT = collector.ToWorksets()
# ----------------------------------------
worksets = Output(python_script)
