# Dynamo custom node Element.ElevationOfHostLevel.dyf (Dynamo 0.8.2.2392)
# category: Clockwork.Revit.Elements.Element.Query
# Returns the elevation of the level a given element is associated with

element = Input()
level = Custom[Element.Level](element=element)  # Gets an element's level
code_block = CodeBlock(lvl=level) { lvl.Elevation; }
double = Output(code_block)
