# Dynamo custom node Element.Group.dyf (Dynamo 0.9.0.3067)
# category: Clockwork.Revit.Elements.Element.Query
# Retrieves the group an element belongs to (if any)

element = Input()
turnIntoList = Custom[Turn Into List](unknownItem=element)  # Turns an element (or a nested list) into a flat list
python_script = Python(IN[0]=turnIntoList)
# ---------- python_script.python (19 lines) ----------
import clr
clr.AddReference('RevitAPI')
from Autodesk.Revit.DB import *

clr.AddReference("RevitNodes")
import Revit
clr.ImportExtensions(Revit.Elements)

items = UnwrapElement(IN[0])
elementlist = list()
for item in items:
	try:
		if item.Document.GetElement(item.GroupId) == None:
			elementlist.append(list())
		else:
			elementlist.append(item.Document.GetElement(item.GroupId))
	except:
		elementlist.append(list())
OUT = elementlist
# ----------------------------------------
returnListOrSingleValue = Custom[ReturnListOrSingleValue](unknownItem=element, seq=python_script)  # If the item in input #1 is not a list, only the first item of the list in input #2 will be returned.
group = Output(returnListOrSingleValue)
