# Dynamo custom node Element.Name (Universal).dyf (Dynamo 0.9.0.3067)
# category: Clockwork.Revit.Elements.Element.Query
# Gets an element's name (Dynamo's built-in Name nodes don't work for all element types, e.g. worksets...)

element = Input()
turnIntoList = Custom[Turn Into List](unknownItem=element)  # Turns an element (or a nested list) into a flat list
python_script = Python(IN[0]=turnIntoList)
# ---------- python_script.python (21 lines) ----------
import clr
clr.AddReference('RevitAPI')
from Autodesk.Revit.DB import *

faminsts = IN[0]
elementlist = list()
for item in faminsts:
	try:
		n = UnwrapElement(item).Name
	except:
		# Use a built-in property of (wrapped) Dynamo elements for family symbols instead
		try:
			n = item.Name
		except:
			# maybe it's a parameter name
			try:
				n = item.Definition.Name
			except:
				n = []
	elementlist.append(n)
OUT = elementlist
# ----------------------------------------
returnListOrSingleValue = Custom[ReturnListOrSingleValue](unknownItem=element, seq=python_script)  # If the item in input #1 is not a list, only the first item of the list in input #2 will be returned.
name = Output(returnListOrSingleValue)
