# Dynamo custom node Element.OwnerView.dyf (Dynamo 0.8.2.2392)
# category: Clockwork.Revit.Elements.Element.Query
# Gets the owner view of a given Revit element (if possible)

element = Input()
turnIntoList = Custom[Turn Into List](element)  # Turns an element (or a nested list) into a flat list
python_script = Python(IN[0]=turnIntoList)
# ---------- python_script.python (21 lines) ----------
import clr
clr.AddReference('RevitAPI')
from Autodesk.Revit.DB import *

clr.AddReference("RevitNodes")
import Revit
clr.ImportExtensions(Revit.Elements)

clr.AddReference("RevitServices")
import RevitServices
from RevitServices.Persistence import DocumentManager

doc = DocumentManager.Instance.CurrentDBDocument
items = UnwrapElement(IN[0])
elementlist = list()
for item in items:
	try:
		elementlist.append(doc.GetElement(item.OwnerViewId).ToDSType(True))
	except:
		elementlist.append(list())
OUT = elementlist
# ----------------------------------------
returnListOrSingleValue = Custom[ReturnListOrSingleValue](unknownItem=element, seq=python_script)  # If the item in input #1 is not a list, only the first item of the list in input #2 will be returned.
view = Output(returnListOrSingleValue)
