# Dynamo custom node Element.PermanentlyIsolateInView.dyf (Dynamo 0.8.2.2392)
# category: Clockwork.Revit.Elements.Element.Actions
# (Permanently) isolates elements in the given view

view = Input(view : View)
element = Input()
turn_into_list = Custom[Turn Into List](element)  # Turns an element (or a nested list) into a flat list
temporarilyIsolateInView = Custom[View.TemporarilyIsolateElement](View=view, Element_s=turn_into_list)  # "Element.TemporarilyIsolateInView"; (Temporarily) isolates elements in the given view
convertTemporaryHideIsolateToPermanent = Custom[View.ConvertTemporaryHideIsolateToPermanent](view=temporarilyIsolateInView.View)  # Convert all temporary hidden elements or categories to permanently hidden in the given view.
view_2 = Output(convertTemporaryHideIsolateToPermanent)  # "view"
returnListOrSingleValue = Custom[ReturnListOrSingleValue](unknownItem=element, seq=temporarilyIsolateInView.Element_s)  # If the item in input #1 is not a list, only the first item of the list in input #2 will be returned.
element_2 = Output(returnListOrSingleValue)  # "element"
