# Dynamo custom node Elements.GroupByHost.dyf (Dynamo 0.8.2.2392)
# category: Clockwork.Revit.Elements.Element.Actions
# Groups a list of Revit elements by their respective hosts (if they have any)

elements = Input()
turnIntoList = Custom[Turn Into List](elements)  # Turns an element (or a nested list) into a flat list
host = Custom[Element.Host](element=turnIntoList)  # Gets an element's host
isEmpty = List.IsEmpty()
map = List.Map(list=host, f_x=isEmpty)
code_block = CodeBlock(elems=turnIntoList, mask=map, hosts=host)
# ---------- code_block.designscript (5 lines) ----------
filter1 = List.FilterByBoolMask(elems,mask);
filter1["in"];
filtered_hosts = List.FilterByBoolMask(hosts,mask)["out"];
{filtered_hosts,filtered_hosts.UniqueId,filter1["out"]};
1;
# ----------------------------------------
groupListOfListsByKey = Custom[List.GroupListOfListsByKey](seq=code_block.out3, keyIndex=code_block.out4)  # Groups a list of lists by one of its keys
code_block_2 = CodeBlock(seq=groupListOfListsByKey) { tseq = List.Transpose(seq); tseq[2]; tseq[0]; }
elementsGroupedByHost = Output(code_block_2.out1)
firstItem = List.FirstItem()
map_2 = List.Map(list=code_block_2.out2, f_x=firstItem)
hosts = Output(map_2)
unhostedElements = Output(code_block.out1)
