# Dynamo custom node Floor.SlabShapeByPoints.dyf (Dynamo 0.8.2.2392)
# category: Clockwork.Revit.Elements.Floor.Actions
# Transform a slab shape based on a list of XYZs. PLEASE NOTE: Will reset any previous edits on the slab shape.

points = Input(points : Autodesk.Point[])
floor = Input()
slabShapeByPoints = Custom[Roof.SlabShapeByPoints](points=points, roof=floor)  # Transform a slab shape based on a list of XYZs. PLEASE NOTE: Will reset any previous edits on the slab shape.
floor_2 = Output(slabShapeByPoints)  # "floor"
