# Dynamo custom node GlobalParameter.GetValue.dyf (Dynamo 0.9.0.3067)
# category: Clockwork.Revit.Elements.GlobalParameter.Query
# Gets the value of a global parameter (only in Revit 2016 R2 or later).

globalParameter = Input()
turnIntoList = Custom[TurnIntoList](unknownItem=globalParameter)  # Turns an element (or a nested list) into a flat list
python_script = Python(IN[0]=turnIntoList)
# ---------- python_script.python (37 lines) ----------
import clr
clr.AddReference('RevitAPI')
from Autodesk.Revit.DB import *

clr.AddReference("RevitNodes")
import Revit
clr.ImportExtensions(Revit.Elements)

clr.AddReference("RevitServices")
import RevitServices
from RevitServices.Persistence import DocumentManager
doc = DocumentManager.Instance.CurrentDBDocument

params = UnwrapElement(IN[0])
elementlist = list()
for param in params:
	# in Revit 2016 R2 or later
	try:
		# any params that do not have a unit
		if str(param.GetDefinition().UnitType) == "UT_Number":
			# booleans
			if str(param.GetDefinition().ParameterType) == "YesNo":
				elementlist.append(param.GetValue().Value == 1)
			# parameter types that contain element ids
			elif str(param.GetDefinition().ParameterType) == "Image" or str(param.GetDefinition().ParameterType) == "Material":
				elementlist.append(param.Document.GetElement(param.GetValue().Value))
			# everything else
			else:
				elementlist.append(param.GetValue().Value)
		# any params with units: convert vals to display unit
		else:
			formatoptions = doc.GetUnits().GetFormatOptions(param.GetDefinition().UnitType)
			elementlist.append(UnitUtils.ConvertFromInternalUnits(param.GetValue().Value,formatoptions.DisplayUnits))
	# any earlier Revit version does not support gloabl params
	except:
		elementlist.append(list())
OUT = elementlist
# ----------------------------------------
returnListOrSingleValue = Custom[ReturnListOrSingleValue](unknownItem=globalParameter, seq=python_script)  # If the unknown item is not a list but rather a single item, only the first item of the list (input "seq") will be returned.
val = Output(returnListOrSingleValue)
