# Dynamo custom node Group.FromElements.dyf (Dynamo 0.8.2.2392)
# category: Clockwork.Revit.Elements.Group.Create
# Creates a group from a list of Revit elements

elements = Input()
turnIntoList = Custom[TurnIntoList](unknownItem=elements)  # Turns an element (or a nested list) into a flat list
groupName = Input()
python_script = Python(IN[0]=turnIntoList, IN[1]=groupName)
# ---------- python_script.python (34 lines) ----------
import clr
clr.AddReference('RevitAPI')
from Autodesk.Revit.DB import *
from System.Collections.Generic import *
"""
clr.AddReference("RevitNodes")
import Revit
clr.ImportExtensions(Revit.Elements)
"""
clr.AddReference("RevitServices")
import RevitServices
from RevitServices.Persistence import DocumentManager
from RevitServices.Transactions import TransactionManager

doc = DocumentManager.Instance.CurrentDBDocument
items = UnwrapElement(IN[0])
ids = list()
rejects = list()
for item in items:
	try:
		ids.append(item.Id)
	except:
		rejects.append(item)
items = List[ElementId](ids)

TransactionManager.Instance.EnsureInTransaction(doc)
try:
	group = doc.Create.NewGroup(items);
	group.GroupType.Name = IN[1]
except:
	group = list()
TransactionManager.Instance.TransactionTaskDone()

OUT = (group,rejects)
# ----------------------------------------
code_block = CodeBlock(seq=python_script) { seq[0]; seq[1]; }
group = Output(code_block.out0)
ungroupableElements = Output(code_block.out1)
