# Dynamo custom node Level.Views.dyf (Dynamo 0.9.0.3067)
# category: Clockwork.Revit.Elements.Level.Query
# Returns all views associated with a given level

toggleToRefresh = Input(toggleToRefresh : bool = true)
views = Custom[Document.Views](toggle=toggleToRefresh)  # Gets all views in the document - except for 3D view templates (as long as this bug is not fixed: https://github.com/DynamoDS/Dynamo/issues/2970)
level = Custom[Element.Level](element=views)  # Gets an element's level
isEmpty = List.IsEmpty()
map = List.Map(list=level, f_x=isEmpty)
filterByBoolMask = List.FilterByBoolMask(list=views, mask=map)
filterByBoolMask_2 = List.FilterByBoolMask(list=level, mask=map)
uniqueId = Element.UniqueId(filterByBoolMask_2.out)
level_2 = Input(level : Level)
uniqueId_2 = Element.UniqueId(level_2)
eq = uniqueId == uniqueId_2
filterByBoolMask_3 = List.FilterByBoolMask(list=filterByBoolMask.out, mask=eq)
firstItem = List.FirstItem(filterByBoolMask_3.in)
firstView = Output(firstItem)
allViews = Output(filterByBoolMask_3.in)
