# Dynamo custom node List.AnyFalse.dyf (Dynamo 0.8.1.1693)
# category: Clockwork.Core.List.Query
# Returns true if any item in a list of booleans is false.

seq = Input(seq : bool[])
formula = Formula("x=0")
code_block = CodeBlock(seq=seq, predicate=formula) { List.IsEmpty(seq) ? false : TrueForAny(seq,predicate); }
any = Output(code_block)  # "any?"
