# Dynamo custom node List.CountOccurences.dyf (Dynamo 0.9.0.3067)
# category: Clockwork.Core.List.Query
# Counts the number of occurences of each unique element in a given list

seq = Input()
turnIntoList = Custom[Turn Into List](seq)  # Turns an element (or a nested list) into a flat list
identity = Object.Identity(turnIntoList)
groupByKey = GroupByKey(turnIntoList, identity)
uniqueElements = Output(groupByKey.out1)
sublistLengths = Custom[List.SublistLengths](seq=groupByKey.out0)  # Gets the lengths of all sublists in a given list of lists.
count = Output(sublistLengths)
