# Dynamo custom node List.RepeatItemsByLengths.dyf (Dynamo 0.8.1.1823)
# category: Clockwork.Core.List.Create
# Repeats a list of items into sublists of given lengths

ofRepeatedItem = List.OfRepeatedItem()
seq = Input()
lengths = Input(lengths : int[])
combine = List.Combine(ofRepeatedItem, seq, lengths)
seq_2 = Output(combine)  # "seq"
