# Dynamo custom node List.ReplaceEmptyLists.dyf (Dynamo 0.8.2.2392)
# category: Clockwork.Core.List.Actions
# Replaces all empty lists within a given list with a substitute

seq = Input()
isNotEmpty = Custom[List.IsNotEmpty]()  # Just the inversion of the built-in Is Empty List node.
map = List.Map(list=seq, f_x=isNotEmpty)
boolean = BoolSelector(true)
replaceNull = Custom[List.ReplaceNull](seq=map, replacement=boolean)  # Replaces all null values within a given list with a substitute
code_block = CodeBlock(seq=replaceNull, mask=replaceNull) { keys = GetKeys(seq); List.FilterByBoolMask(keys, mask)["out"]; }
Replacement = Input()
replaceItemAtIndex = Custom[List.ReplaceItemAtIndex](seq=seq, index=code_block.out1, replacement=Replacement)  # Replaces the item at a given index (or list of indices) of a list by another item
seq_2 = Output(replaceItemAtIndex)  # "seq"
