# Dynamo custom node List.SortListOfLists.dyf (Dynamo 0.9.0.3067)
# category: Clockwork.Core.List.Actions
# Sorts a list of lists by one of its sublists

seq = Input()
code_block = CodeBlock(seq=seq) { List.Transpose(seq); }
sortIndex = Input(sortIndex : int = 0)
caseInsensitive = Input(caseInsensitive : bool = false)
orderDescending = Input(orderDescending : bool = false)
python_script = Python(IN[0]=code_block, IN[1]=sortIndex, IN[2]=caseInsensitive, IN[3]=orderDescending)
# ---------- python_script.python (20 lines) ----------
import clr

lists = IN[0]
sortindex = int(IN[1])
caseinsensitive = IN[2]
sortdescending = IN[3]

# make sure that case-insensitive is turned of if it is not strings we're sorting
if caseinsensitive == True and isinstance(lists[0][sortindex], basestring) == False:
	caseinsensitive = False
if caseinsensitive == True:
	if sortdescending == True:
		OUT = sorted(lists, key=lambda lists:lists[sortindex].lower(), reverse=True)
	else:
		OUT = sorted(lists, key=lambda lists:lists[sortindex].lower())
else:
	if sortdescending == True:
		OUT = sorted(lists, key=lambda lists:lists[sortindex], reverse=True)
	else:
		OUT = sorted(lists, key=lambda lists:lists[sortindex])
# ----------------------------------------
code_block_2 = CodeBlock(seq=python_script) { List.Transpose(seq); }
seq_2 = Output(code_block_2)  # "seq"
