# Dynamo custom node Material.Duplicate.dyf (Dynamo 0.8.2.2392)
# category: Clockwork.Revit.Elements.Material.Actions
# Duplicates a material

material = Input()
name = Input(name: string)
duplicate = Custom[ElementType.Duplicate](elementType=material, name=name)  # Duplicates an element type
duplicate_2 = Output(duplicate)  # "duplicate"
