# Dynamo custom node Math.NormalizeRange.dyf (Dynamo 0.8.1.1693)
# category: Clockwork.Core.Math.Actions
# Normalizes a range of numbers

seq = Input(seq : double[])
code_block = CodeBlock(nums=seq) { Math.RemapRange(nums,0,1); }
seq_2 = Output(code_block)  # "seq"
