# Dynamo custom node Math.RandomIntegerList.dyf (Dynamo 0.8.1.1823)
# category: Clockwork.Core.Math.Create
# Creates a list of random integers between 0 and a given maximum value

amount = Input(amount : int)
max = Input(max : int)
code_block = CodeBlock(amount=amount, max=max) { Math.Round(Math.RemapRange(Math.RandomList(amount),-0.499,max+0.499)); }
list = Output(code_block)
