# Dynamo custom node Math.RoundToPrecision.dyf (Dynamo 0.8.1.1823)
# category: Clockwork.Core.Math.Actions
# Rounds a number to a specified precision

dbl = Input(dbl : double)
precision = Input(precision : double = 1)
code_block = CodeBlock(a=dbl, b=precision) { Math.Round(a/b)*b; }
dbl_2 = Output(code_block)  # "dbl"
