# Dynamo custom node Plane.ByBestFitFromFace.dyf (Dynamo 0.8.2.2392)
# category: Clockwork.Geometry.Plane.Create
# Creates a plane from face

surface = Input(surface : Surface)
code_block = CodeBlock(surf=surface) { Plane.ByBestFitThroughPoints(surf.Vertices.PointGeometry); }
plane = Output(code_block)
