# Dynamo custom node Plane.ByFirst3Points.dyf (Dynamo 0.8.2.2392)
# category: Clockwork.Geometry.Plane.Create
# Returns a plane, its origin and its normal based on the first three XYZs in a given list

points = Input(points : Autodesk.Point[])
code_block = CodeBlock(seq=points) { Plane.ByBestFitThroughPoints(List.TakeItems(seq,3)); }
plane = Output(code_block)
