# Dynamo custom node Point.CentralProjectionOnPlane.dyf (Dynamo 0.8.2.2392)
# category: Clockwork.Geometry.Point.Actions
# Projects a list of points onto a given plane

centralProjectionPoint = Input(centralProjectionPoint : Autodesk.Point)
projectionPoints = Input(projectionPoints : Autodesk.Point[])
code_block = CodeBlock(start=centralProjectionPoint, end=projectionPoints) { Vector.ByTwoPoints(start,end).Normalized(); }
plane = Input(plane : Plane)
intersectionWithPlane = Custom[Vector.IntersectionWithPlane](vectorBasePoint=centralProjectionPoint, vector=code_block, plane=plane)  # Finds the intersection point between a plane and a vector
projectedPoints = Output(intersectionWithPlane)
