# Dynamo custom node Point.RoundToPrecision.dyf (Dynamo 0.8.2.2392)
# category: Clockwork.Geometry.Point.Actions
# Rounds a point coordinate to a specified precision

point = Input()
precision = Input()
code_block = CodeBlock(po=point, pr=precision) { a = {po.X,po.Y,po.Z}; ar = Math.Round(a/pr)*pr; Autodesk.Point.ByCoordinates(ar[0],ar[1],ar[2]); }
point_2 = Output(code_block.out2)  # "point"
