# Dynamo custom node RevisionCloud.FromCurves.dyf (Dynamo 0.8.2.2392)
# category: Clockwork.Revit.Elements.RevisionCloud.Create
# Creates a revision cloud from a list of geometry curves.

curves = Input(curves : Autodesk.Curve[])
revision = Input()
view = Input(view : View)
python_script = Python(IN[0]=curves, IN[1]=revision, IN[2]=view)
# ---------- python_script.python (29 lines) ----------
import clr
clr.AddReference('RevitAPI')
from Autodesk.Revit.DB import *
from System.Collections.Generic import *

clr.AddReference("RevitNodes")
import Revit
clr.ImportExtensions(Revit.GeometryConversion)

clr.AddReference("RevitServices")
import RevitServices
from RevitServices.Persistence import DocumentManager
from RevitServices.Transactions import TransactionManager

doc = DocumentManager.Instance.CurrentDBDocument
curves = IN[0]
revision = UnwrapElement(IN[1])
view = UnwrapElement(IN[2])
elementlist = list()

TransactionManager.Instance.EnsureInTransaction(doc)
Curvelist = list()
for curve in curves:
	Curvelist.append(curve.ToRevitType())
icurves = List[Curve](Curvelist)
revcloud = RevisionCloud.Create(doc, view, revision.Id, icurves);
TransactionManager.Instance.TransactionTaskDone()

OUT = revcloud
# ----------------------------------------
revisionCloud = Output(python_script)
