# Dynamo custom node RevisionCloud.FromElements.dyf (Dynamo 0.8.2.2392)
# category: Clockwork.Revit.Elements.RevisionCloud.Create
# Create a revision cloud for a list of Revit elements

elements = Input()
view = Input(view : View)
byElements = Custom[BoundingBox.ByElements](elements=elements, view=view)  # Retrieves a bounding box for a list of elements
plane = Custom[View.Plane](view=view)  # Retrieves the plane of a given view
code_block = CodeBlock(pl=plane) { pl.Normal; }
perimeterCurvesByNormal = Custom[BoundingBox.PerimeterCurvesByNormal](boundingbox=byElements.DynamoBoundingBox, normal=code_block)  # Returns the perimeter curve of a bounding box on a plane determined by a given normal and the centroid of the bounding box
revision = Input()
fromCurves = Custom[RevisionCloud.FromCurves](curves=perimeterCurvesByNormal, revision=revision, view=view)  # Creates revision clouds from nested lists of geometry curves.
revisionCloud = Output(fromCurves)
