# Dynamo custom node Roof.Kind.dyf (Dynamo 0.8.2.2392)
# category: Clockwork.Revit.Elements.Roof.Query
# Retrieves the roof kind (Basic, Glazed, Other). PLEASE NOTE: Roofs that were created by face will be identified as 'Other'

roof = Input()
turnIntoList = Custom[Turn Into List](roof)  # Turns an element (or a nested list) into a flat list
python_script = Python(IN[0]=turnIntoList)
# ---------- python_script.python (15 lines) ----------
import clr
clr.AddReference('RevitAPI')
from Autodesk.Revit.DB import *

items = UnwrapElement(IN[0])
elementlist = list()
for item in items:
	try:
		if item.CurtainGrids:
			elementlist.append('Glazed')
		else:
			elementlist.append('Basic')
	except:
		elementlist.append('Other / No Roof')
OUT = elementlist
# ----------------------------------------
returnListOrSingleValue = Custom[ReturnListOrSingleValue](unknownItem=roof, seq=python_script)  # If the item in input #1 is not a list, only the first item of the list in input #2 will be returned.
kind = Output(returnListOrSingleValue)
