# Dynamo custom node Roof.SlabShapeHasBeenModified.dyf (Dynamo 0.8.2.2392)
# category: Clockwork.Revit.Elements.Roof.Query
# Checks if the shape of a roof slab has been modified with the shape editing tools

roof = Input()
turn_into_list = Custom[Turn Into List](roof)  # Turns an element (or a nested list) into a flat list
python_script = Python(IN[0]=turn_into_list)
# ---------- python_script.python (16 lines) ----------
import clr
clr.AddReference('RevitAPI')
from Autodesk.Revit.DB import *

items = UnwrapElement(IN[0])
elementlist = list()

for item in items:
	try: 
		if item.SlabShapeEditor.SlabShapeCreases.IsEmpty == True or item.SlabShapeEditor.SlabShapeVertices.IsEmpty == True:
			elementlist.append(False)
		else:
			elementlist.append(True)
	except:
		elementlist.append(False)
OUT = elementlist
# ----------------------------------------
returnListOrSingleValue = Custom[ReturnListOrSingleValue](unknownItem=roof, seq=python_script)  # If the item in input #1 is not a list, only the first item of the list in input #2 will be returned.
bool = Output(returnListOrSingleValue)
