# Dynamo custom node Room.AtPointInPhase.dyf (Dynamo 0.8.2.2392)
# category: Clockwork.Revit.Selection.Miscellaneous
# Tries to retrieve a room element at the given location for the given phase.

point = Input(point : Autodesk.Point)
turnIntoList = Custom[TurnIntoList](unknownItem=point)  # Turns an element (or a nested list) into a flat list
phase = Input()
python_script = Python(IN[0]=turnIntoList, IN[1]=phase)
# ---------- python_script.python (20 lines) ----------
import clr
clr.AddReference('RevitAPI')
from Autodesk.Revit.DB import *

clr.AddReference("RevitNodes")
import Revit
clr.ImportExtensions(Revit.Elements)
clr.ImportExtensions(Revit.GeometryConversion)

clr.AddReference("RevitServices")
import RevitServices
from RevitServices.Persistence import DocumentManager

doc = DocumentManager.Instance.CurrentDBDocument
points = IN[0]
phase = UnwrapElement(IN[1])
roomlist = list()
for pt in points:
    roomlist.append(doc.GetRoomAtPoint(pt.ToXyz(),phase))
OUT = roomlist
# ----------------------------------------
returnListOrSingleValue = Custom[ReturnListOrSingleValue](unknownItem=point, seq=python_script)  # If the unknown item is not a list but rather a single item, only the first item of the list (input "seq") will be returned.
room = Output(returnListOrSingleValue)
