# Dynamo custom node Room.InsertsOfBoundaries.dyf (Dynamo 0.8.2.2392)
# category: Clockwork.Revit.Elements.Room.Query
# Retrieves the inserts of the bounding elements of a given room.

room = Input()
boundaries = Custom[Room.Boundaries](room=room)  # Gets a list of all boundary elements of a given room or area
includeOpenings = Input(includeOpenings : bool = false)
includeShadows = Input(includeShadows : bool = false)
includeEmbeddedWalls = Input(includeEmbeddedWalls : bool = false)
includeSharedEmbeddedInserts = Input(includeSharedEmbeddedInserts : bool = false)
inserts = Custom[Element.Inserts](includeOpenings=includeOpenings, includeShadows=includeShadows, includeEmbeddedWalls=includeEmbeddedWalls, includeSharedEmbeddedInserts=includeSharedEmbeddedInserts)  # Gets all the objects inserted into a given element.
map = List.Map(list=boundaries.elements, f_x=inserts)
flatten = Flatten()
map_2 = List.Map(list=map, f_x=flatten)
inserts_2 = Output(map_2)  # "inserts"
