# Dynamo custom node Room.IsUnbounded.dyf (Dynamo 0.8.2.2392)
# category: Clockwork.Revit.Elements.Room.Query
# Checks whether a room is unbounded.

room = Input()
turn_into_list = Custom[Turn Into List](room)  # Turns an element (or a nested list) into a flat list
boundaries = Custom[Room.Boundaries](room=turn_into_list)  # Gets a list of all boundary elements of a given room
isEmpty = List.IsEmpty()
map = List.Map(list=boundaries.elements, f_x=isEmpty)
returnListOrSingleValue = Custom[ReturnListOrSingleValue](unknownItem=room, seq=map)  # If the item in input #1 is not a list, only the first item of the list in input #2 will be returned.
bool = Output(returnListOrSingleValue)
