# Dynamo custom node RoomTag.Room.dyf (Dynamo 0.9.0.3067)
# category: Clockwork.Revit.Elements.RoomTag.Query
# Returns the room of a given room tag

roomTag = Input()
turnIntoList = Custom[TurnIntoList](unknownItem=roomTag)  # Turns an element (or a nested list) into a flat list
python_script = Python(IN[0]=turnIntoList)
# ---------- python_script.python (18 lines) ----------
import clr
clr.AddReference('RevitAPI')
from Autodesk.Revit.DB import *
import Autodesk

clr.AddReference("RevitNodes")
import Revit
clr.ImportExtensions(Revit.GeometryConversion)

roomtags = UnwrapElement(IN[0])
elementlist = list()

for tag in roomtags:
	try:
		elementlist.append(tag.Room)
	except:
		elementlist.append(list())
OUT = elementlist
# ----------------------------------------
returnListOrSingleValue = Custom[ReturnListOrSingleValue](unknownItem=roomTag, seq=python_script)  # If the unknown item is not a list but rather a single item, only the first item of the list (input "seq") will be returned.
room = Output(returnListOrSingleValue)
