# Dynamo custom node RoomTag.SetType.dyf (Dynamo 0.9.0.3067)
# category: Clockwork.Revit.Elements.RoomTag.Actions
# Changes the family type of a given room tag to the specified type

roomTag = Input()
turnIntoList = Custom[Turn Into List](unknownItem=roomTag)  # Turns an element (or a nested list) into a flat list
roomTagType = Input()
turnIntoList_2 = Custom[Turn Into List](unknownItem=roomTagType)
code_block = CodeBlock(instances=turnIntoList, types=turnIntoList_2) { inst = List.Count(instances); replist = List.OfRepeatedItem(types[0],inst); inst > List.Count(types) ? replist : types; }
python_script = Python(IN[0]=turnIntoList, IN[1]=code_block.out2)
# ---------- python_script.python (30 lines) ----------
import clr
clr.AddReference('RevitAPI')
from Autodesk.Revit.DB import *

clr.AddReference("RevitNodes")
import Revit
clr.ImportExtensions(Revit.Elements)

clr.AddReference("RevitServices")
import RevitServices
from RevitServices.Persistence import DocumentManager
from RevitServices.Transactions import TransactionManager

doc = DocumentManager.Instance.CurrentDBDocument
faminsts = UnwrapElement(IN[0])
famsymb = UnwrapElement(IN[1])
elementlist = list()
counter = 0

TransactionManager.Instance.EnsureInTransaction(doc)
for item in faminsts:
	try:
		item.RoomTagType = famsymb[counter]
		elementlist.append(item)
	except:
		emptylist = list()
	counter += 1
TransactionManager.Instance.TransactionTaskDone()

OUT = elementlist
# ----------------------------------------
returnListOrSingleValue = Custom[ReturnListOrSingleValue](unknownItem=roomTag, seq=python_script)  # If the item in input #1 is not a list, only the first item of the list in input #2 will be returned.
roomTag_2 = Output(returnListOrSingleValue)  # "roomTag"
