# Dynamo custom node String.MatchRegularExpression.dyf (Dynamo 0.8.1.1693)
# category: Clockwork.Core.String.Actions
# Determines if a regular expression matches a string (or a list of strings) and returns a boolean value (or a list, depending on the input). The syntax for regular expressions is explained at
# http://ironpython-test.readthedocs.org/en/latest/howto/regex.html

str = Input(str : string)
RegEx = Input(RegEx : string)
turn_into_list = Custom[Turn Into List](str)  # Turns an element (or a nested list) into a flat list
python_script = Python(IN[0]=RegEx, IN[1]=turn_into_list)
# ---------- python_script.python (13 lines) ----------
import clr
import re

regexstring = IN[0]
regexlist = IN[1]
elementlist = list()
thisexp = re.compile(regexstring)
for item in regexlist:
	if (str(thisexp.search(item)) == 'None'):
		elementlist.append(False)
	else:
		elementlist.append(True)
OUT = elementlist
# ----------------------------------------
returnListOrSingleValue = Custom[ReturnListOrSingleValue](Item_1_unknown=str, Item_2_list=python_script)  # If the item in input #1 is not a list, only the first item of the list in input #2 will be returned.
bool = Output(returnListOrSingleValue)
