# Dynamo custom node Surface.FilterByOrientation.dyf (Dynamo 0.8.2.2392)
# category: Clockwork.Geometry.Surface.Actions
# Sorts surfaces in three lists based on their orientation (vertical, horizontal up & horizontal down) and also returns three corresponding lists of booleans.

surfaces = Input(surfaces : Surface[])
almostZero = Custom[Math.AlmostZero]()  # Returns a feasable computational tolerance to zero (1.0e-9 or a billionth of 1) for use in calculations. More background info: https://github.com/ikeough/Dynamo/issues/879
ZAxisNegative = Custom[Vector.ZAxisNegative]()  # Returns an XYZ of 0,0,-1
code_block = CodeBlock(surf=surfaces, almostzero=almostZero, ZNeg=ZAxisNegative)
# ---------- code_block.designscript (11 lines) ----------
vec = surf.NormalAtParameter(0.5,0.5);
z = vec.Z;
// Vertical
mask1 = z >= (0 - almostzero) && z <= (0 + almostzero);
List.FilterByBoolMask(surf,mask1)["in"];
// Horizontal up
mask2 = vec.IsAlmostEqualTo(Vector.ZAxis());
List.FilterByBoolMask(surf,mask2)["in"];
// Horizontal down
mask3 = vec.IsAlmostEqualTo(ZNeg);
List.FilterByBoolMask(surf,mask3)["in"];
# ----------------------------------------
vertical = Output(code_block.out3)
isVertical = Output(code_block.mask1)
horizontalUp = Output(code_block.out5)
isHorizontalUp = Output(code_block.mask2)
horizontalDown = Output(code_block.out7)
isHorizontalDown = Output(code_block.mask3)
