# Dynamo custom node Vector.IsInPlane.dyf (Dynamo 0.8.2.2392)
# category: Clockwork.Geometry.Vector.Query
# Checks if a given vector is located on a given plane

vector = Input(vector : Vector)
code_block = CodeBlock(vec=vector) { vec.Normalized(); }
plane = Input(plane : Plane)
isParallelToPlane = Custom[Vector.IsParallelToPlane](vector=code_block, plane=plane)  # Checks if a given vector is parallel to a given plane
vectorBasePoint = Input(vectorBasePoint : Autodesk.Point)
isOutOfPlane = Custom[Point.IsOutOfPlane](face_plane=plane, point=vectorBasePoint)  # Checks a list for XYZs that are not located on a given plane
code_block_2 = CodeBlock(a=isParallelToPlane, b=isOutOfPlane.bool) { AllTrue({a,!b}); }
bool = Output(code_block_2)
