# Dynamo custom node VersionNumber.ToInteger.dyf (Dynamo 0.8.2.2392)
# category: Clockwork.Core.String.Actions
# Converts a version number (e.g. a Dynamo version number) to an integer.

str = Input(str : string)
code_block = CodeBlock(str=str) { String.ToNumber(String.Replace(str,".","")); }
int = Output(code_block)
