# Dynamo custom node View.CategoryIsVisible.dyf (Dynamo 0.8.2.2392)
# category: Clockwork.Revit.Views.View.Query
# Checks if a given category is visible in a given view

view = Input()
category = Input()
turnIntoList = Custom[Turn Into List](category)  # Turns an element (or a nested list) into a flat list
turnIntoList_2 = Custom[Turn Into List](view)
python_script = Python(IN[0]=turnIntoList, IN[1]=turnIntoList_2)
# ---------- python_script.python (20 lines) ----------
import clr
clr.AddReference('RevitAPI')
from Autodesk.Revit.DB import *

cats = UnwrapElement(IN[0])
views = UnwrapElement(IN[1])

elementlist = list()
for cat in cats:
	catlist = list()
	for view in views:
		try:
			if view.GetVisibility(cat):
				catlist.append(True)
			else:
				catlist.append(False)	
		except:
			catlist.append(False)
	elementlist.append(catlist)
OUT = elementlist
# ----------------------------------------
returnListOrSingleValue = Custom[ReturnListOrSingleValue](unknownItem=view, seq=python_script)  # If the item in input #1 is not a list, only the first item of the list in input #2 will be returned.
bool = Output(returnListOrSingleValue)
