# Dynamo custom node View.ConvertTemporaryHideIsolateToPermanent.dyf (Dynamo 0.8.2.2392)
# category: Clockwork.Revit.Views.View.Actions
# Convert all temporary hidden elements or categories to permanently hidden in the given view.

view = Input(view : View)
python_script = Python(IN[0]=view)
# ---------- python_script.python (16 lines) ----------
import clr
clr.AddReference('RevitAPI')
from Autodesk.Revit.DB import *

clr.AddReference("RevitServices")
import RevitServices
from RevitServices.Persistence import DocumentManager
from RevitServices.Transactions import TransactionManager

doc = DocumentManager.Instance.CurrentDBDocument
view = UnwrapElement(IN[0])

TransactionManager.Instance.EnsureInTransaction(doc)
view.ConvertTemporaryHideIsolateToPermanent()
TransactionManager.Instance.TransactionTaskDone()
OUT = (view,elements)
# ----------------------------------------
view_2 = Output(python_script)  # "view"
