# Dynamo custom node View.DisableTemporaryHideIsolate.dyf (Dynamo 0.8.2.2392)
# category: Clockwork.Revit.Views.View.Actions
# Disables the temporary hide/isolate for the given view (if set)

view = Input(view : View)
python_script = Python(IN[0]=view)
# ---------- python_script.python (16 lines) ----------
import clr
clr.AddReference('RevitAPI')
from Autodesk.Revit.DB import *

clr.AddReference("RevitServices")
import RevitServices
from RevitServices.Persistence import DocumentManager
from RevitServices.Transactions import TransactionManager

doc = DocumentManager.Instance.CurrentDBDocument
view = UnwrapElement(IN[0])
TransactionManager.Instance.EnsureInTransaction(doc)
if view.IsTemporaryHideIsolateActive() == True:
	view.DisableTemporaryViewMode(TemporaryViewMode.TemporaryHideIsolate)
TransactionManager.Instance.TransactionTaskDone()
OUT = view
# ----------------------------------------
view_2 = Output(python_script)  # "view"
