# Dynamo custom node View.ResizeCropBox.dyf (Dynamo 0.8.2.2392)
# category: Clockwork.Revit.Views.View.Actions
# Resizes the bounding box of a given Revit element by the specified amount in X, Y and Z direction. May need to be used in conjunction with a Transaction node.

view = Input()
turnIntoList = Custom[Turn Into List](unknownItem=view)  # Turns an element (or a nested list) into a flat list
amt = Input(amt : double)
code_block = CodeBlock(margin=amt) { Autodesk.Point.ByCoordinates(margin,margin,margin); }
python_script = Python(IN[0]=turnIntoList, IN[1]=code_block)
# ---------- python_script.python (34 lines) ----------
import clr
clr.AddReference('RevitAPI')
from Autodesk.Revit.DB import *

clr.AddReference("RevitNodes")
import Revit
clr.ImportExtensions(Revit.GeometryConversion)

clr.AddReference("RevitServices")
import RevitServices
from RevitServices.Persistence import DocumentManager
from RevitServices.Transactions import TransactionManager

doc = DocumentManager.Instance.CurrentDBDocument
views = UnwrapElement(IN[0])
margin = IN[1].ToXyz()
elementlist = list()
failedlist = list()

TransactionManager.Instance.EnsureInTransaction(doc)
for item in views:
	try:
		newmax = item.CropBox.Max.Add(margin)
		newmin = item.CropBox.Min.Subtract(margin)
		newbox = BoundingBoxXYZ()
		newbox.Max = newmax
		newbox.Min = newmin
		item.CropBox = newbox
		elementlist.append(item)
	except:
		elementlist.append(list())
TransactionManager.Instance.TransactionTaskDone()

OUT = elementlist
# ----------------------------------------
returnListOrSingleValue = Custom[ReturnListOrSingleValue](unknownItem=view, seq=python_script)  # If the item in input #1 is not a list, only the first item of the list in input #2 will be returned.
view_2 = Output(returnListOrSingleValue)  # "view"
