# Dynamo custom node View.SetPhase.dyf (Dynamo 0.8.2.2392)
# category: Clockwork.Revit.Views.View.Actions
# Sets the phase of a given view

view = Input()
turnIntoList = Custom[Turn Into List](unknownItem=view)  # Turns an element (or a nested list) into a flat list
phase = Input()
python_script = Python(IN[0]=turnIntoList, IN[1]=phase)
# ---------- python_script.python (28 lines) ----------
import clr
clr.AddReference('RevitAPI')
from Autodesk.Revit.DB import *

clr.AddReference("RevitNodes")
import Revit
clr.ImportExtensions(Revit.Elements)

clr.AddReference("RevitServices")
import RevitServices
from RevitServices.Persistence import DocumentManager
from RevitServices.Transactions import TransactionManager

doc = DocumentManager.Instance.CurrentDBDocument
views = UnwrapElement(IN[0])
phase = UnwrapElement(IN[1])
booleans = list()

TransactionManager.Instance.EnsureInTransaction(doc)
for view in views:
	try:
		view.get_Parameter(BuiltInParameter.VIEW_PHASE).Set(phase.Id)
		booleans.append(True)
	except:
		booleans.append(False)
TransactionManager.Instance.TransactionTaskDone()

OUT = (views,booleans)
# ----------------------------------------
code_block = CodeBlock(seq=python_script) { seq[0]; seq[1]; }
returnListOrSingleValue = Custom[ReturnListOrSingleValue](unknownItem=view, seq=code_block.out0)  # If the item in input #1 is not a list, only the first item of the list in input #2 will be returned.
view_2 = Output(returnListOrSingleValue)  # "view"
returnListOrSingleValue_2 = Custom[ReturnListOrSingleValue](unknownItem=view, seq=code_block.out1)
success = Output(returnListOrSingleValue_2)
