# Dynamo custom node Window.Rooms.dyf (Dynamo 0.8.2.2392)
# category: Clockwork.Revit.Elements.Window.Query
# Gets the rooms that are connected by a given window

window = Input(window : FamilyInstance)
phase = Input()
rooms = Custom[Door.FromRoomAndToRoom](door=window, phase=phase)  # "Door.Rooms"; Gets the rooms that are connected by a given door
fromRoom = Output(rooms.fromRoom)
toRoom = Output(rooms.toRoom)
roomCount = Output(rooms.roomCount)
