# Dynamo custom node All Families Of Category.dyf (Dynamo 1.3.4.6666)
# category: Clockwork.Revit.Selection.ByCollector
# Gets all famiies of a given category in the model  (does *not *work for system families)

category = Input(category : var[]..[])  # Works with categories, BuiltInCategories and BuiltInCategories as strings
fromInput = Custom[Category.FromInput](var=category)  # Returns a category from a category, a Dynamo-wrapped category, a BuiltInCategory or a string representing a BuiltInCategory.
ID = Custom[Element.ID+](element=fromInput)  # Gets the ID of a given Revit elements. Unlike the OOTB Element.Id node, this node also works on mixed lists of Revit elements and categories.
toggle = Input(toggle : bool = true)
docOrRevitLinkInstance = Input(docOrRevitLinkInstance : var = null)  # Use only if you want to query a linked model
python_script = Python(IN[0]=ID, IN[1]=toggle, IN[2]=docOrRevitLinkInstance)
# ---------- python_script.python (21 lines) ----------
import System
import clr
clr.AddReference('RevitAPI')
from Autodesk.Revit.DB import *

clr.AddReference("RevitServices")
import RevitServices
from RevitServices.Persistence import DocumentManager

def FamiliesByCategoryId(catId, doc):
	collector = FilteredElementCollector(doc).OfClass(Family)
	return [x for x in collector.ToElements() if x.FamilyCategoryId.IntegerValue == catId]

inputdoc = UnwrapElement(IN[2])
if not inputdoc: doc = DocumentManager.Instance.CurrentDBDocument
elif inputdoc.GetType().ToString() == "Autodesk.Revit.DB.RevitLinkInstance": doc = inputdoc.GetLinkDocument()
elif inputdoc.GetType().ToString() == "Autodesk.Revit.DB.Document": doc = inputdoc
else: doc = DocumentManager.Instance.CurrentDBDocument

if isinstance(IN[0], list): OUT = [FamiliesByCategoryId(x, doc) for x in IN[0]]
else: OUT = FamiliesByCategoryId(IN[0], doc)
# ----------------------------------------
families = Output(python_script)
