# Dynamo custom node All View-Dependent Family Instances Of Category.dyf (Dynamo 1.3.3.4651)
# category: Clockwork.Revit.Selection.ByCollector
# Gets all view-dependent family instances in a given view for a given list of categories - useful for finding annotation elements

category = Input(category : var)
view = Input()
primaryView = Custom[View.PrimaryView](view=view)  # Returns the primary view of a given view (i.e. the master view of a dependent view)
isNull = Object.IsNull(primaryView)
code_block = CodeBlock(isnull=isNull, originalView=view, primaryView=primaryView) { isnull ? originalView : primaryView; }
toggle = Input(toggle : bool = true)
python_script = Python(IN[0]=category, IN[1]=code_block, IN[2]=toggle)
# ---------- python_script.python (32 lines) ----------
import System
import clr
clr.AddReference('RevitAPI')
from Autodesk.Revit.DB import *

clr.AddReference("RevitServices")
import RevitServices
from RevitServices.Persistence import DocumentManager

def CollectByView(bic, view):
	collector = FilteredElementCollector(doc)
	filter = ElementOwnerViewFilter(view.Id)
	return collector.WherePasses(filter).OfCategory(bic).ToElements()

def GetViewDependentElements(cat, views):
	cattype = cat.GetType().ToString()
	bic = None
	if cattype == "Revit.Elements.Category": bic = System.Enum.ToObject(BuiltInCategory, cat.Id)
	elif cattype == "Autodesk.Revit.DB.BuiltInCategory": bic = cat
	elif cattype == "System.String": 
		found = [x for x in bics if x.ToString() == cat]
		if len(found) > 0: bic = found[0]
	if isinstance(views, list): return [CollectByView(bic, x) for x in UnwrapElement(views)]
	else: return CollectByView(bic, UnwrapElement(views))

doc = DocumentManager.Instance.CurrentDBDocument
cats = IN[0]
views = IN[1]
bics = System.Enum.GetValues(BuiltInCategory)

if isinstance(IN[0], list): OUT = [GetViewDependentElements(x, views) for x in cats]
else: OUT = GetViewDependentElements(cats, views)
# ----------------------------------------
elements = Output(python_script)
