# Dynamo custom node AngularDimension.ByElements.dyf (Dynamo 1.3.3.4651)
# category: Clockwork.Revit.Elements.AngularDimension.Create
# Creates angular dimensions between elements. Only works in project environment. ATTENTION: Do NOT use in automatic mode.

element1 = Input(element1 : var[]..[])
turnIntoList = Custom[TurnIntoList](unknownItem=element1)  # Turns an element (or a nested list) into a flat list
element2 = Input(element2 : var[]..[])
turnIntoList_2 = Custom[TurnIntoList](unknownItem=element2)
create = List.Create(turnIntoList, turnIntoList_2)
transpose = List.Transpose(create)
location = Custom[Element.Location+](element=transpose@L2)  # Returns the location of an element as point, curve or curve loop, along with some booleans to help filtering the results. Unlike the OOTB Element.GetLocation node, it also retunrs sketch lines of sketch-based elements like floor slabs as well as the element's rotation property.
transpose_2 = List.Transpose(location.curveEndpoints)
firstItem = List.FirstItem(transpose_2@@L2)
firstItem_2 = List.FirstItem(firstItem)
transpose_3 = List.Transpose(location.curves)
direction = Line.Direction(transpose_3)
firstItem_3 = List.FirstItem(direction)
lastItem = List.LastItem(firstItem)
lastItem_2 = List.LastItem(direction)
intersectionWithVector = Custom[Vector.IntersectionWithVector](basePoint1=firstItem_2, vector1=firstItem_3, basePoint2=lastItem, vector2=lastItem_2)  # Determines if two vectors intersect and returns the closest points of intersection on both vectors.
radius = Input(radius : double)
XAxis = Vector.XAxis()
ZAxis = Vector.ZAxis()
angleAboutAxis = Vector.AngleAboutAxis(XAxis, direction, ZAxis)
firstItem_4 = List.FirstItem(angleAboutAxis)
lastItem_3 = List.LastItem(angleAboutAxis)
byCenterPointRadiusAngle = Arc.ByCenterPointRadiusAngle(center=intersectionWithVector.AveragePoint, radius=radius, startAngle=firstItem_4, endAngle=lastItem_3)
view = Input()
dimensionType = Input()
python_script = Python(IN[0]=transpose, IN[1]=byCenterPointRadiusAngle, IN[2]=view, IN[3]=dimensionType)
# ---------- python_script.python (55 lines) ----------
import clr
from System.Collections.Generic import *

clr.AddReference('RevitAPI')
from Autodesk.Revit.DB import *

clr.AddReference("RevitNodes")
import Revit
clr.ImportExtensions(Revit.GeometryConversion)

clr.AddReference("RevitServices")
import RevitServices
from RevitServices.Persistence import DocumentManager
from RevitServices.Transactions import TransactionManager

doc = DocumentManager.Instance.CurrentDBDocument
opt = Options()
opt.ComputeReferences = True
opt.IncludeNonVisibleObjects = True

items = UnwrapElement(IN[0])
arcs = [x.ToRevitType() for x in IN[1]]
view = UnwrapElement(IN[2])
dimtype = UnwrapElement(IN[3])

def CreateAngularDimension(view, items, arc, dimtype):
	opt.View = view
	refs = []
	for item in items:
		for obj in item.get_Geometry(opt):
			if isinstance (obj, Line):
				curve = obj
				if curve.Reference: refs.append(curve.Reference)
	refList = List[Reference](refs)
	#return refList
	return AngularDimension.Create(doc, view, arc, refList, dimtype)

TransactionManager.Instance.EnsureInTransaction(doc)
OUT = [CreateAngularDimension(view, x, y, dimtype) for x, y in zip(items, arcs)]
TransactionManager.Instance.TransactionTaskDone()

"""
TransactionManager.Instance.EnsureInTransaction(doc)
curvearray = CurveArray()
for curve in curves:
	curvearray.Append(curve.ToRevitType())
doccreation = doc.Create
separatorarray = doccreation.NewRoomBoundaryLines(sketchplane, curvearray, view)
TransactionManager.Instance.TransactionTaskDone()

elementlist = list()
for item in separatorarray:
	elementlist.append(item)
OUT = elementlist
"""
# ----------------------------------------
returnListOrSingleValue = Custom[ReturnListOrSingleValue](unknownItem=element1, seq=python_script)  # If the unknown item is not a list but rather a single item, only the first item of the list (input "seq") will be returned.
dimension = Output(returnListOrSingleValue)
