# Dynamo custom node BoundingBox.ByElement.dyf (Dynamo 1.3.1.1736)
# category: Clockwork.Revit.Elements.BoundingBox.Create
# Gets the bounding box of a Revit element

element = Input()
turnIntoList = Custom[Turn Into List](unknownItem=element)  # Turns an element (or a nested list) into a flat list
view = Input()
python_script = Python(IN[0]=turnIntoList, IN[1]=view)
# ---------- python_script.python (22 lines) ----------
import clr
clr.AddReference('RevitAPI')
from Autodesk.Revit.DB import *

clr.AddReference("RevitNodes")
import Revit
clr.ImportExtensions(Revit.GeometryConversion)

items = UnwrapElement(IN[0])
view = UnwrapElement(IN[1])
elementlist = list()
maxlist = list()
minlist = list()

for item in items:
	try:
		elementlist.append(item.BoundingBox[view])
		maxlist.append(item.BoundingBox[view].Max.ToPoint())
		minlist.append(item.BoundingBox[view].Min.ToPoint())
	except:
		pass
OUT = (elementlist,maxlist,minlist)
# ----------------------------------------
code_block = CodeBlock(seq=python_script) { seq[0]; seq[1]; seq[2]; }
returnListOrSingleValue = Custom[ReturnListOrSingleValue](unknownItem=element, seq=code_block.out0)  # If the item in input #1 is not a list, only the first item of the list in input #2 will be returned.
RevitBoundingBox = Output(returnListOrSingleValue)
byCorners = BoundingBox.ByCorners(min=code_block.out1, max=code_block.out2)
returnListOrSingleValue_2 = Custom[ReturnListOrSingleValue](unknownItem=element, seq=byCorners)
DynamoBoundingBox = Output(returnListOrSingleValue_2)
returnListOrSingleValue_3 = Custom[ReturnListOrSingleValue](unknownItem=element, seq=code_block.out1)
BottomLeftRearCorner = Output(returnListOrSingleValue_3)
returnListOrSingleValue_4 = Custom[ReturnListOrSingleValue](unknownItem=element, seq=code_block.out2)
TopRightFrontCorner = Output(returnListOrSingleValue_4)
