# Dynamo custom node BoundingBox.ByElements.dyf (Dynamo 1.3.1.1736)
# category: Clockwork.Revit.Elements.BoundingBox.Create
# Retrieves a bounding box for a list of elements

elements = Input()
view = Input()
byElement = Custom[BoundingBox.ByElement](element=elements@L2, view=view)  # Gets the bounding box of a Revit element
X = Point.X(byElement.BottomLeftRearCorner)
minimumItem = List.MinimumItem(X)
Y = Point.Y(byElement.BottomLeftRearCorner)
minimumItem_2 = List.MinimumItem(Y)
Z = Point.Z(byElement.BottomLeftRearCorner)
minimumItem_3 = List.MinimumItem(Z)
byCoordinates = Point.ByCoordinates(x=minimumItem, y=minimumItem_2, z=minimumItem_3)
X_2 = Point.X(byElement.TopRightFrontCorner)
maximumItem = List.MaximumItem(X_2)
Y_2 = Point.Y(byElement.TopRightFrontCorner)
maximumItem_2 = List.MaximumItem(Y_2)
Z_2 = Point.Z(byElement.TopRightFrontCorner)
maximumItem_3 = List.MaximumItem(Z_2)
byCoordinates_2 = Point.ByCoordinates(x=maximumItem, y=maximumItem_2, z=maximumItem_3)
byCorners = BoundingBox.ByCorners(min=byCoordinates, max=byCoordinates_2)
fromDynamoBoundingBox = Custom[RevitBoundingBox.FromDynamoBoundingBox](DynamoBoundingBox=byCorners)  # Turns a Dynamo bounding box into a Revit bounding box.
RevitBoundingBox = Output(fromDynamoBoundingBox)
DynamoBoundingBox = Output(byCorners)
BottomLeftRearCorner = Output(byCoordinates)
TopRightFrontCorner = Output(byCoordinates_2)
