# Dynamo custom node BoundingBox.Centroid.dyf (Dynamo 1.0.0.1180)
# category: Clockwork.Geometry.BoundingBox.Query
# Retrieves the centroid of a given bounding box

boundingBox = Input(boundingBox : BoundingBox)
minPoint = BoundingBox.MinPoint(boundingBox)
maxPoint = BoundingBox.MaxPoint(boundingBox)
create = List.Create(minPoint, maxPoint)
transpose = List.Transpose(create)
average = Custom[Point.Average](points=transpose)  # Determines the average of a list of points
Point = Output(average)
