# Dynamo custom node BoundingBox.FromBoundingBoxes.dyf (Dynamo 1.3.2.2480)
# category: Clockwork.Geometry.BoundingBox.Create
# Merges a list of bounding boxes into a single bounding box

boundingBoxes = Input(boundingBoxes: BoundingBox []..[])
minPoint = BoundingBox.MinPoint(boundingBoxes)
X = Point.X(minPoint)
minimumItem = List.MinimumItem(X)
Y = Point.Y(minPoint)
minimumItem_2 = List.MinimumItem(Y)
Z = Point.Z(minPoint)
minimumItem_3 = List.MinimumItem(Z)
byCoordinates = Point.ByCoordinates(x=minimumItem, y=minimumItem_2, z=minimumItem_3)
maxPoint = BoundingBox.MaxPoint(boundingBoxes)
X_2 = Point.X(maxPoint)
maximumItem = List.MaximumItem(X_2)
Y_2 = Point.Y(maxPoint)
maximumItem_2 = List.MaximumItem(Y_2)
Z_2 = Point.Z(maxPoint)
maximumItem_3 = List.MaximumItem(Z_2)
byCoordinates_2 = Point.ByCoordinates(x=maximumItem, y=maximumItem_2, z=maximumItem_3)
byCorners = BoundingBox.ByCorners(min=byCoordinates, max=byCoordinates_2)
BoundingBox = Output(byCorners)
