# Dynamo custom node BoundingBox.PerimeterCurvesByNormal.dyf (Dynamo 1.3.0.875)
# category: Clockwork.Geometry.BoundingBox.Query
# Returns the perimeter curve of a bounding box on a plane determined by a given normal and the centroid of the bounding box

boundingbox = Input(boundingbox : BoundingBox)
maxPoint = BoundingBox.MaxPoint(boundingbox)
minPoint = BoundingBox.MinPoint(boundingbox)
create = List.Create(maxPoint, minPoint)
transpose = List.Transpose(create)
average = Custom[Point.Average](points=transpose)  # Determines the average of a list of points
normal = Input(normal : Vector)
byOriginNormal = Plane.ByOriginNormal(origin=average, normal=normal)
perimeterCurvesOnPlane = Custom[BoundingBox.PerimeterCurvesOnPlane](boundingbox=boundingbox, plane=byOriginNormal)  # Returns the perimeter curve of a bounding box on a given plane (assuming that the bounding box and plane intersect)
curves = Output(perimeterCurvesOnPlane)
