# Dynamo custom node BoundingBox.Properties.dyf (Dynamo 1.3.1.1736)
# category: Clockwork.Geometry.BoundingBox.Query
# Retrieves the centroid, width, depth and height of a given bounding box

boundingBox = Input(boundingBox : BoundingBox)
minPoint = BoundingBox.MinPoint(boundingBox)
maxPoint = BoundingBox.MaxPoint(boundingBox)
create = List.Create(minPoint, maxPoint)
transpose = List.Transpose(create)
average = Custom[Point.Average](points=transpose)  # Determines the average of a list of points
Centroid = Output(average)
X = Point.X(maxPoint)
X_2 = Point.X(minPoint)
Y = Point.Y(maxPoint)
Y_2 = Point.Y(minPoint)
Z = Point.Z(maxPoint)
Z_2 = Point.Z(minPoint)
code_block = CodeBlock(maxX=X, minX=X_2, maxY=Y, minY=Y_2, maxZ=Z, minZ=Z_2)
# ---------- code_block.designscript (6 lines) ----------
// Width
maxX - minX;
// Depth
maxY - minY;
// Height
maxZ - minZ;
# ----------------------------------------
Width = Output(code_block.out0)
Depth = Output(code_block.out1)
Height = Output(code_block.out2)
