# Dynamo custom node BuiltInCategory.ByName.dyf (Dynamo 1.3.4.6666)
# category: Clockwork.Revit.Selection.Miscellaneous
# Looks up all the built-in categories based on a given name (or part of a name) of the category. Search is case-insensitive. Has an option to return categories that are not supported by OOTB Dynamo nodes.

dynamoSupportedCategoriesOnly = Input(dynamoSupportedCategoriesOnly : bool = true)
builtInCategories = Custom[Document.BuiltInCategories](dynamoSupportedCategoriesOnly=dynamoSupportedCategoriesOnly)  # List all the available BuiltInCategories
string_from_object = FromObject(builtInCategories.BuiltInCategories)
searchFor = Input(searchFor : string)
ignoreCase = Input(ignoreCase : bool = true)
contains = String.Contains(str=string_from_object, searchFor=searchFor, ignoreCase=ignoreCase)
filterByBoolMask = List.FilterByBoolMask(list=builtInCategories.BuiltInCategories, mask=contains)
BuiltInCategories = Output(filterByBoolMask.in)
filterByBoolMask_2 = List.FilterByBoolMask(list=builtInCategories.ElementIDs, mask=contains)
ElementIDs = Output(filterByBoolMask_2.in)
filterByBoolMask_3 = List.FilterByBoolMask(list=builtInCategories.Categories, mask=contains)
Categories = Output(filterByBoolMask_3.in)
