# Dynamo custom node BuiltInParameter.ByName.dyf (Dynamo 0.9.0.3067)
# category: Clockwork.Revit.Selection.Miscellaneous
# Looks up all the built-in parameters based on a given name (or part of a name) of the parameters. Search is case-insensitive.

listBuiltInParameters = Custom[Document.ListBuiltInParameters]()  # List all the available BuiltInParameters
string_from_object = FromObject(listBuiltInParameters.BuiltInParameters)
searchFor = Input(searchFor : string)
ignoreCase = Input(ignoreCase : bool = true)
contains = String.Contains(str=string_from_object, searchFor=searchFor, ignoreCase=ignoreCase)
filterByBoolMask = List.FilterByBoolMask(list=listBuiltInParameters.BuiltInParameters, mask=contains)
BuiltInParameters = Output(filterByBoolMask.in)
filterByBoolMask_2 = List.FilterByBoolMask(list=listBuiltInParameters.ElementIDs, mask=contains)
ElementIDs = Output(filterByBoolMask_2.in)
filterByBoolMask_3 = List.FilterByBoolMask(list=listBuiltInParameters.ParameterNames, mask=contains)
ParameterNames = Output(filterByBoolMask_3.in)
