# Dynamo custom node Category.Material.dyf (Dynamo 1.3.4.6666)
# category: Clockwork.Revit.Elements.Category.Query
# Retrieves the material assigned to the given category in the object styles

category = Input(category : var[]..[])  # Works with categories, BuiltInCategories and BuiltInCategories as strings
fromInput = Custom[Category.FromInput](var=category)  # Returns a category from a category, a Dynamo-wrapped category, a BuiltInCategory or a string representing a BuiltInCategory.
python_script = Python(IN[0]=fromInput)
# ---------- python_script.python (18 lines) ----------
import clr
clr.AddReference('RevitAPI')
from Autodesk.Revit.DB import *

clr.AddReference("RevitNodes")
import Revit
clr.ImportExtensions(Revit.Elements)

cats = UnwrapElement(IN[0])

def GetCatMat(cat):
	if hasattr(cat, "Material"): 
		try: return cat.Material.ToDSType(True)
		except: return None
	else: return None

if isinstance(IN[0], list): OUT = [GetCatMat(x) for x in cats]
else: OUT = GetCatMat(cats)
# ----------------------------------------
material = Output(python_script)
