# Dynamo custom node Category.Subcategories.dyf (Dynamo 1.0.0.1180)
# category: Clockwork.Revit.Elements.Category.Query
# Retrieves all the subcategories for a given category

category = Input()
turnIntoList = Custom[Turn Into List](unknownItem=category)  # Turns an element (or a nested list) into a flat list
python_script = Python(IN[0]=turnIntoList)
# ---------- python_script.python (20 lines) ----------
import clr
clr.AddReference('RevitAPI')
from Autodesk.Revit.DB import *

clr.AddReference("RevitNodes")
import Revit
clr.ImportExtensions(Revit.Elements)

cats = UnwrapElement(IN[0])
elementlist = list()

for cat in cats:
	try:
		sublist = []
		for subcat in cat.SubCategories:
			sublist.append(Revit.Elements.Category.ById(subcat.Id.IntegerValue))
		elementlist.append(sublist)
	except:
		elementlist.append(list())
OUT = elementlist
# ----------------------------------------
returnListOrSingleValue = Custom[ReturnListOrSingleValue](unknownItem=category, seq=python_script)  # If the item in input #1 is not a list, only the first item of the list in input #2 will be returned.
subcategories = Output(returnListOrSingleValue)
