# Dynamo custom node Category.Type.dyf (Dynamo 1.3.3.4651)
# category: Clockwork.Revit.Elements.Category.Query
# Returns the type of the category

category = Input(category : var[]..[])
python_script = Python(IN[0]=category)
# ---------- python_script.python (30 lines) ----------
import System
import clr
clr.AddReference('RevitAPI')
from Autodesk.Revit.DB import *

clr.AddReference("RevitNodes")
import Revit
clr.ImportExtensions(Revit.Elements)

clr.AddReference("RevitServices")
import RevitServices
from RevitServices.Persistence import DocumentManager

def GetCategoryType(cat):
	cattype = cat.GetType().ToString()
	if cattype == "Autodesk.Revit.DB.BuiltInCategory": cat = Category.GetCategory(doc, cat)
	elif cattype == "System.String": 
		found = [x for x in bics if x.ToString() == cat]
		if len(found) > 0: cat = Category.GetCategory(doc, found[0])
		else: cat = None
	if cat:	return cat.CategoryType.ToString()
	else: return None

doc = DocumentManager.Instance.CurrentDBDocument
bics = System.Enum.GetValues(BuiltInCategory)
cats = UnwrapElement(IN[0])
elementlist = list()

if isinstance(IN[0], list): OUT = [GetCategoryType(x) for x in cats]
else: OUT = GetCategoryType(cats)
# ----------------------------------------
categoryType = Output(python_script)
