# Dynamo custom node Clipboard.SendTo.dyf (Dynamo 1.0.0.1180)
# category: Clockwork.Core.Clipboard.Actions
# Copies a string to the clipboard.

str = Input(str : string)
python_script = Python(IN[0]=str)
# ---------- python_script.python (20 lines) ----------
import clr
import System
from System.Threading import Thread, ThreadStart
clr.AddReference("System.Windows.Forms")

def SetText(text):
    def thread_proc():
        System.Windows.Forms.Clipboard.SetText(text)
    t = Thread(ThreadStart(thread_proc))
    t.ApartmentState = System.Threading.ApartmentState.STA
    t.Start()
    
try:
	if IN[0] != "":
		SetText(IN[0])
		OUT = IN[0]
	else:
		OUT = "String was empty"
except:
	OUT = 'Data could not be copied to clipboard'
# ----------------------------------------
str_2 = Output(python_script)  # "str"
