# Dynamo custom node CurtainPanel.HostPanel.dyf (Dynamo 1.3.1.1736)
# category: Clockwork.Revit.Elements.CurtainPanel.Query
# Retrieves the host panel of a given curtain panel. This is typcially needed when wanting to access wall elements used as curtain panels. If no host panel is found, the node will return the input panel instead.

curtainPanel = Input()
turnIntoList = Custom[Turn Into List](unknownItem=curtainPanel)  # Turns an element (or a nested list) into a flat list
python_script = Python(IN[0]=turnIntoList)
# ---------- python_script.python (16 lines) ----------
import clr
clr.AddReference('RevitAPI')
from Autodesk.Revit.DB import *

clr.AddReference("RevitNodes")
import Revit
clr.ImportExtensions(Revit.Elements)

faminsts = UnwrapElement(IN[0])
elementlist = list()
for item in faminsts:
	try:
		elementlist.append(item.Document.GetElement(item.FindHostPanel()).ToDSType(True))
	except:
		elementlist.append(item)
OUT = elementlist
# ----------------------------------------
returnListOrSingleValue = Custom[ReturnListOrSingleValue](unknownItem=curtainPanel, seq=python_script)  # If the item in input #1 is not a list, only the first item of the list in input #2 will be returned.
hostPanel = Output(returnListOrSingleValue)
