# Dynamo custom node CurtainPanel.IsPhantomPanel.dyf (Dynamo 1.3.1.1736)
# category: Clockwork.Revit.Elements.CurtainPanel.Query
# Checks whether a given curtain panel is not an actual model element. (These types of objects get generated when curtain grid segments are deleted or in other words when multiple cells of the curtain grid are merged into one panel)

curtainPanel = Input()
python_script = Python(IN[0]=curtainPanel)
# ---------- python_script.python (14 lines) ----------
import clr
clr.AddReference('RevitAPI')
from Autodesk.Revit.DB import *

def IsPhantomPanel(item):
	try: 
		if item.get_Parameter(BuiltInParameter.HOST_AREA_COMPUTED).HasValue: return False
		else: return True
	except: return False

items = UnwrapElement(IN[0])

if isinstance(IN[0], list): OUT = [IsPhantomPanel(x) for x in items]
else: OUT = IsPhantomPanel(items)
# ----------------------------------------
bool = Output(python_script)
