# Dynamo custom node Date.CalendarWeek.dyf (Dynamo 1.0.0.1180)
# category: Clockwork.Core.DateTime.Query
# Retrieves the calendar week for the given date

date = Input()
components = DateTime.Components(date)
python_script = Python(IN[0]=components.out0, IN[1]=components.out1, IN[2]=components.out2)
# ---------- python_script.python (6 lines) ----------
import clr
import datetime
year = IN[0]
month = IN[1]
day = IN[2]
OUT = datetime.date(year, month, day).isocalendar()[1]
# ----------------------------------------
calendarWeek = Output(python_script)
