# Dynamo custom node DesignOption.DesignOptionSet.dyf (Dynamo 1.3.0.875)
# category: Clockwork.Revit.Elements.DesignOption.Query
# Returns the design option set of a given design option

designOption = Input()
turnIntoList = Custom[Turn Into List](unknownItem=designOption)  # Turns an element (or a nested list) into a flat list
python_script = Python(IN[0]=turnIntoList)
# ---------- python_script.python (13 lines) ----------
import clr
clr.AddReference('RevitAPI')
from Autodesk.Revit.DB import *

clr.AddReference("RevitNodes")
import Revit
clr.ImportExtensions(Revit.Elements)

desopts = UnwrapElement(IN[0])
elementlist = list()
for item in desopts:
	elementlist.append(item.Document.GetElement(item.get_Parameter(BuiltInParameter.OPTION_SET_ID).AsElementId()).ToDSType(True))
OUT = elementlist
# ----------------------------------------
returnListOrSingleValue = Custom[ReturnListOrSingleValue](unknownItem=designOption, seq=python_script)  # If the item in input #1 is not a list, only the first item of the list in input #2 will be returned.
designOptionSet = Output(returnListOrSingleValue)
