# Dynamo custom node DesignOption.IsPrimary.dyf (Dynamo 1.0.0.1180)
# category: Clockwork.Revit.Elements.DesignOption.Query
# Determines whether a given design option is the primary option in its set

designOption = Input()
turnIntoList = Custom[TurnIntoList](unknownItem=designOption)  # Turns an element (or a nested list) into a flat list
python_script = Python(IN[0]=turnIntoList)
# ---------- python_script.python (14 lines) ----------
import clr
import System
clr.AddReference('RevitAPI')
from Autodesk.Revit.DB import *

designoptions = UnwrapElement(IN[0])
elementlist = list()

for opt in designoptions:
	try:
		elementlist.append(opt.IsPrimary)
	except:
		elementlist.append(False)
OUT = elementlist
# ----------------------------------------
returnListOrSingleValue = Custom[ReturnListOrSingleValue](unknownItem=designOption, seq=python_script)  # If the item in input #1 is not a list, only the first item of the list in input #2 will be returned.
bool = Output(returnListOrSingleValue)
