# Dynamo custom node DetailLevel.Coarse.dyf (Dynamo 1.0.0.1180)
# category: Clockwork.Revit.Elements.DetailLevel
# Returns the coarse detail level

python_script = Python()
# ---------- python_script.python (4 lines) ----------
import clr
clr.AddReference('RevitAPI')
from Autodesk.Revit.DB import *
OUT = ViewDetailLevel.Coarse
# ----------------------------------------
Coarse = Output(python_script)
