# Dynamo custom node Dimension.ReferencedElements.dyf (Dynamo 1.3.3.4651)
# category: Clockwork.Revit.Elements.Dimension.Query
# Returns all elements that are referenced by a given dimension

dimension = Input()
python_script = Python(IN[0]=dimension)
# ---------- python_script.python (17 lines) ----------
import clr
clr.AddReference('RevitAPI')
from Autodesk.Revit.DB import *

clr.AddReference("RevitNodes")
import Revit
clr.ImportExtensions(Revit.Elements)

def GetDimensionReferences(item):
	if hasattr(item, "References"):
		return [item.Document.GetElement(x.ElementId) for x in item.References]
	else: return None

dimensions = UnwrapElement(IN[0])

if isinstance(IN[0], list): OUT = [GetDimensionReferences(x) for x in dimensions]
else: OUT = GetDimensionReferences(dimensions)
# ----------------------------------------
elements = Output(python_script)
