# Dynamo custom node DividedSurface.HorizontalIntersectsByEndpoints.dyf (Dynamo 0.8.2.2392)
# category: Clockwork.Revit.Elements.DividedSurface.Actions
# Creates a number of equally spaced horizontal intersects for a divided surface based on the path between between two points.

dividedSurface = Input(dividedSurface : DividedSurface)
subdivisions = Input(subdivisions : int)
startPoint = Input(startPoint : Autodesk.Point)
endPoint = Input(endPoint : Autodesk.Point)
code_block = CodeBlock(n=subdivisions, p1=startPoint, p2=endPoint) { n+1; p1.Z; p2.Z; }
normalizedSequence = Custom[Normalized Sequence](n=code_block.out0)  # "List.NormalizedSequence"; Creates a sequence of N values between 0 and 1
scaleNormalized = Custom[Scale Normalized Value](dbl=normalizedSequence, min=code_block.out1, max=code_block.out2)  # "Math.ScaleNormalized"; Scales a normalized value according to a given minimum and maximum
code_block_2 = CodeBlock(seq=scaleNormalized) { seq2 = List.RestOfItems(seq); seq3 = List.TakeItems(seq2,List.Count(seq2)-1); String.FromObject(1..List.Count(seq3)); }
intersectName = Input(intersectName : string = "HorizontalIntersect")
concat = String.Concat(intersectName)
map = List.Map(list=code_block_2.out2, f_x=concat)
byElevationAndName = Level.ByElevationAndName(code_block_2.seq3, map)
addIntersect = Custom[DividedSurface.AddIntersect](dividedSurface=dividedSurface, element=byElevationAndName)  # Adds an intersect to a divided surface
dividedSurface_2 = Output(addIntersect)  # "dividedSurface"
intersects = Output(byElevationAndName)
