# Dynamo custom node DividedSurface.VerticalIntersectsByEndpoints.dyf (Dynamo 1.3.1.1736)
# category: Clockwork.Revit.Elements.DividedSurface.Actions
# Creates a number of equally spaced vertical intersects for a divided surface based on the path between between two points. You may need to switch start point and end point.

dividedSurface = Input(dividedSurface : DividedSurface)
startPoint = Input(startPoint : Autodesk.Point)
X = Point.X(startPoint)
Y = Point.Y(startPoint)
byCoordinates = Point.ByCoordinates(x=X, y=Y)
endPoint = Input(endPoint : Autodesk.Point)
X_2 = Point.X(endPoint)
Y_2 = Point.Y(endPoint)
byCoordinates_2 = Point.ByCoordinates(x=X_2, y=Y_2)
# note: Project the points to the XY plane and create a line between them
byStartPointEndPoint = Line.ByStartPointEndPoint(startPoint=byCoordinates, endPoint=byCoordinates_2)
subdivisions = Input(subdivisions : int)
code_block = CodeBlock(subdiv=subdivisions) { seq = 0..1..#(subdiv+1); }
restOfItems = List.RestOfItems(code_block)
dropLastItem = Custom[List.DropLastItem](list=restOfItems)  # Drops the last item from a given list.
# note: Create points for subdivisions
pointAtParameter = Curve.PointAtParameter(curve=byStartPointEndPoint, param=dropLastItem)
byTwoPoints = Vector.ByTwoPoints(start=byCoordinates, end=byCoordinates_2)
normalized = Vector.Normalized(byTwoPoints)
ZAxis = Vector.ZAxis()
cross = Vector.Cross(vector=normalized, cross=ZAxis)
length = Curve.Length(byStartPointEndPoint)
code_block_2 = CodeBlock(l=length) { l / 10; }
# note: Find vector orthogonal to line
scale = Vector.Scale(vector=cross, scale_factor=code_block_2)
add = Point.Add(point=pointAtParameter, vectorToAdd=scale)
subtract = Point.Subtract(pointAtParameter, scale)
# note: Create a set of orthogonal planes to curve 1
byStartPointEndPoint_2 = ReferencePlane.ByStartPointEndPoint(add, subtract)
addIntersect = Custom[Add Intersect To Divided Surface](dividedSurface=dividedSurface, element=byStartPointEndPoint_2)  # "DividedSurface.AddIntersect"; Adds an intersect to a divided surface
dividedSurface_2 = Output(addIntersect)  # "dividedSurface"
intersects = Output(byStartPointEndPoint_2)
