# Dynamo custom node DividedSurface.VerticalIntersectsByEndpointsAndFunction.dyf (Dynamo 1.3.1.1736)
# category: Clockwork.Revit.Elements.DividedSurface.Actions
# Creates a number of vertical intersects (reference planes) for a divided surface based on the path between between two points. The spacing can be controlled by a function. You may need to switch start point and end point.

dividedSurface = Input(dividedSurface : DividedSurface)
startPoint = Input(startPoint : Autodesk.Point)
X = Point.X(startPoint)
Y = Point.Y(startPoint)
byCoordinates = Point.ByCoordinates(x=X, y=Y)
endPoint = Input(endPoint : Autodesk.Point)
X_2 = Point.X(endPoint)
Y_2 = Point.Y(endPoint)
byCoordinates_2 = Point.ByCoordinates(x=X_2, y=Y_2)
# note: Project the points to the XY plane and create a line between them
byStartPointEndPoint = Line.ByStartPointEndPoint(startPoint=byCoordinates, endPoint=byCoordinates_2)
func = Input()
subdivisions = Input(subdivisions : int)
n1 = Custom[+1](dbl=subdivisions)  # Increments a value by 1
normalizedSequenceByFunction = Custom[Normalized Sequence by Function](func=func, n=n1)  # "List.NormalizedSequenceByFunction"; Creates a sequence of N values between 0 and 1 driven by a function
restOfItems = List.RestOfItems(normalizedSequenceByFunction)
dropLastItem = Custom[List.DropLastItem](list=restOfItems)  # Drops the last item from a given list.
# note: Create points for subdivisions
pointAtParameter = Curve.PointAtParameter(curve=byStartPointEndPoint, param=dropLastItem)
byTwoPoints = Vector.ByTwoPoints(start=byCoordinates, end=byCoordinates_2)
normalized = Vector.Normalized(byTwoPoints)
ZAxis = Vector.ZAxis()
cross = Vector.Cross(vector=normalized, cross=ZAxis)
length = Curve.Length(byStartPointEndPoint)
code_block = CodeBlock(l=length) { l / 10; }
# note: Find vector orthogonal to line
scale = Vector.Scale(vector=cross, scale_factor=code_block)
add = Point.Add(point=pointAtParameter, vectorToAdd=scale)
subtract = Point.Subtract(pointAtParameter, scale)
# note: Create a set of orthogonal planes to curve 1
byStartPointEndPoint_2 = ReferencePlane.ByStartPointEndPoint(add, subtract)
addIntersect = Custom[Add Intersect To Divided Surface](dividedSurface=dividedSurface, element=byStartPointEndPoint_2)  # "DividedSurface.AddIntersect"; Adds an intersect to a divided surface
dividedSurface_2 = Output(addIntersect)  # "dividedSurface"
intersects = Output(byStartPointEndPoint_2)
