# Dynamo custom node Document.AddLink.dyf (Dynamo 0.9.0.3067)
# category: Clockwork.Revit.Document.Actions
# Adds a link to a model to the current document

filePath = Input(filePath : string)
turnIntoList = Custom[TurnIntoList](unknownItem=filePath)  # Turns an element (or a nested list) into a flat list
python_script = Python(IN[0]=turnIntoList)
# ---------- python_script.python (26 lines) ----------
import clr
clr.AddReference('RevitAPI')
from Autodesk.Revit.DB import *

clr.AddReference("RevitServices")
import RevitServices
from RevitServices.Persistence import DocumentManager
from RevitServices.Transactions import TransactionManager

doc = DocumentManager.Instance.CurrentDBDocument
linkpaths = IN[0]
elementlist = list()
booleans = list()

TransactionManager.Instance.EnsureInTransaction(doc)
for path in linkpaths:
	try:
		linkpath = ModelPathUtils.ConvertUserVisiblePathToModelPath(path)
		linkoptions = RevitLinkOptions(False)
		linkloadresult = RevitLinkType.Create(doc, linkpath, linkoptions)
		elementlist.append(RevitLinkInstance.Create(doc, linkloadresult.ElementId))
		booleans.append(True)
	except:
		booleans.append(False)
TransactionManager.Instance.TransactionTaskDone()
OUT = (elementlist, booleans)
# ----------------------------------------
code_block = CodeBlock(seq=python_script) { seq[0]; seq[1]; }
returnListOrSingleValue = Custom[ReturnListOrSingleValue](unknownItem=filePath, seq=code_block.out0)  # If the unknown item is not a list but rather a single item, only the first item of the list (input "seq") will be returned.
RevitLinkInstance = Output(returnListOrSingleValue)
returnListOrSingleValue_2 = Custom[ReturnListOrSingleValue](unknownItem=filePath, seq=code_block.out1)
bool = Output(returnListOrSingleValue_2)
