# Dynamo custom node Document.BuiltInCategories.dyf (Dynamo 1.3.4.6666)
# category: Clockwork.Revit.Document.Query
# List all the available BuiltInCategories. Output can be limited to Dynamo-supported categories only.

dynamoSupportedCategoriesOnly = Input(dynamoSupportedCategoriesOnly : bool = true)
python_script = Python(IN[0]=dynamoSupportedCategoriesOnly)
# ---------- python_script.python (17 lines) ----------
import clr
import System
clr.AddReference('RevitAPI')
clr.AddReference('RevitAPIUI')
from Autodesk.Revit.DB import *
import Autodesk
clr.AddReference("RevitNodes")
import Revit

dynamoCatsOnly = IN[0]
biclist = System.Enum.GetValues(BuiltInCategory)
cdata = []
for bic in biclist:
	try: cdata.append((bic, ElementId(bic), Revit.Elements.Category.ById(ElementId(bic).IntegerValue)))
	except:
		if not dynamoCatsOnly: cdata.append((bic, ElementId(bic), None))
OUT = map(list, zip(*cdata))
# ----------------------------------------
code_block = CodeBlock(seq=python_script) { seq[0]; seq[1]; seq[2]; }
BuiltInCategories = Output(code_block.out0)
ElementIDs = Output(code_block.out1)
Categories = Output(code_block.out2)
