# Dynamo custom node Document.ContainsElementsOfCategory.dyf (Dynamo 1.3.4.6666)
# category: Clockwork.Revit.Document.Query
# Checks if family instances of specified categories are present in the model.

category = Input(category : var[]..[])  # Works with categories, BuiltInCategories and BuiltInCategories as strings
toggle = Input(toggle : bool = true)
docOrRevitLinkInstance = Input(docOrRevitLinkInstance : var = null)  # Use only if you want to query a linked model
all_elements_of_category = Custom[All Elements Of Category+](category=category, toggle=toggle, docOrRevitLinkInstance=docOrRevitLinkInstance)  # Gets all placed elements of a given category in the model.
isNotEmpty = Custom[List.IsNotEmpty](seq=all_elements_of_category@L2)  # Just the inversion of the built-in Is Empty List node.
anyTrue = Custom[List.AnyTrue](seq=isNotEmpty)  # Returns true if any item in a list of booleans is true.
any = Output(anyTrue)  # "any?"
allTrue = AllTrue(isNotEmpty)
all = Output(allTrue)  # "all?"
returnListOrSingleValue = Custom[ReturnListOrSingleValue](unknownItem=category, seq=isNotEmpty)  # If the unknown item is not a list but rather a single item, only the first item of the list (input "seq") will be returned.
per_category = Output(returnListOrSingleValue)
returnListOrSingleValue_2 = Custom[ReturnListOrSingleValue](unknownItem=category, seq=all_elements_of_category)
instances = Output(returnListOrSingleValue_2)
