# Dynamo custom node Document.Default3DView.dyf (Dynamo 1.3.0.875)
# category: Clockwork.Revit.Document.Query
# Returns the default 3D view of the current model (if there is such a view)

toggle = Input(toggle : bool = true)
views = Custom[Document.Views](toggle=toggle)  # Gets all views in the document - except for 3D view templates (as long as this bug is not fixed: https://github.com/DynamoDS/Dynamo/issues/2970)
type = Custom[View.Type](view=views)  # Returns the type of a given view
code_block = CodeBlock(type=type) { type == "ThreeD"; }
filterByBoolMask = List.FilterByBoolMask(list=views, mask=code_block)
name = Custom[Element.Name (Universal)](element=filterByBoolMask.in)  # "Element.Name+"; Gets an element's name (Dynamo's built-in Name nodes don't work for all element types, e.g. worksets...)
string = StringInput("{3d")
boolean = BoolSelector(true)
contains = String.Contains(str=name, searchFor=string, ignoreCase=boolean)
filterByBoolMask_2 = List.FilterByBoolMask(list=filterByBoolMask.in, mask=contains)
isEmpty = List.IsEmpty(filterByBoolMask_2.in)
code_block_2 = CodeBlock { null; }
firstItem = List.FirstItem(filterByBoolMask_2.in)
scopeIf = Custom[ScopeIf+](test=isEmpty, true=code_block_2, false=firstItem)  # A (hopefully) more robust implementation of ScopeIf. Tests a single boolean and returns a value accordingly.
view = Output(scopeIf)
