# Dynamo custom node Document.DesignOptions.dyf (Dynamo 1.3.0.875)
# category: Clockwork.Revit.Document.Query
# Returns all design options in the model, grouped by design option set

toggle = Input(toggle : bool = true)
python_script = Python(IN[0]=toggle)
# ---------- python_script.python (13 lines) ----------
import clr
clr.AddReference('RevitAPI')
from Autodesk.Revit.DB import *
import Autodesk

clr.AddReference("RevitServices")
import RevitServices
from RevitServices.Persistence import DocumentManager

doc = DocumentManager.Instance.CurrentDBDocument
collector = FilteredElementCollector(doc)
desopts = collector.OfClass(DesignOption).ToElements()
OUT = desopts
# ----------------------------------------
designOptionSet = Custom[DesignOption.DesignOptionSet](designOption=python_script)  # Returns the design option set of a given design option
groupByKey = List.GroupByKey(list=python_script, keys=designOptionSet)
DesignOptionSets = Output(groupByKey.unique_keys)
