# Dynamo custom node Document.ElementTypes.dyf (Dynamo 1.3.3.4651)
# category: Clockwork.Revit.Document.Query
# Retrieves a list of all Revit element types

python_script = Python()
# ---------- python_script.python (13 lines) ----------
import clr
clr.AddReference('RevitAPI')
from Autodesk.Revit.DB import *
import Autodesk
clr.AddReference('RevitNodes')
import Revit
clr.ImportExtensions(Revit.Elements)
import System.Reflection
import System.AppDomain

rAssembly = [x for x in System.AppDomain.CurrentDomain.GetAssemblies() if x.GetName().Name == 'RevitAPI'][0]
rElement = [x for x in rAssembly.GetTypes() if x.Name == 'Element' and x.Namespace == 'Autodesk.Revit.DB'][0]
OUT = [x for x in rAssembly.GetTypes() if x.IsClass and x.IsSubclassOf(rElement)]
# ----------------------------------------
name = Custom[Element.Name+](element=python_script)  # Gets an element's name (Dynamo's built-in Name nodes don't work for all element types, e.g. worksets...)
sortByKey = List.SortByKey(list=python_script, keys=name)
elementTypes = Output(sortByKey.sorted_list)
elementTypeNames = Output(sortByKey.sorted_keys)
