# Dynamo custom node Document.IsWorkshared.dyf (Dynamo 0.8.2.2392)
# category: Clockwork.Revit.Document.Query
# Returns true if the current project is workshared

toggle = Input(toggle : bool = true)
python_script = Python(IN[0]=toggle)
# ---------- python_script.python (10 lines) ----------
import clr
clr.AddReference("RevitServices")
import RevitServices
from RevitServices.Persistence import DocumentManager

doc = DocumentManager.Instance.CurrentDBDocument
if doc.IsWorkshared:
	OUT = True
else:
	OUT = False
# ----------------------------------------
bool = Output(python_script)
