# Dynamo custom node Document.PerformanceAdviserRules.dyf (Dynamo 1.3.0.875)
# category: Clockwork.Revit.Document.Query
# Retreives all Performance Adviser Rules from the current document

toggle = Input(toggle : bool = true)
python_script = Python(IN[0]=toggle)
# ---------- python_script.python (18 lines) ----------
import clr
clr.AddReference('RevitAPI')
from Autodesk.Revit.DB import *
import Autodesk

clr.AddReference("RevitNodes")
import Revit
clr.ImportExtensions(Revit.Elements)

clr.AddReference("RevitServices")
import RevitServices
from RevitServices.Persistence import DocumentManager

doc = DocumentManager.Instance.CurrentDBDocument
elementlist = []
for rule in PerformanceAdviser.GetPerformanceAdviser().GetAllRuleIds():
	elementlist.append(rule.Guid.ToString())
OUT = elementlist
# ----------------------------------------
byId = PerformanceAdviserRule.ById(python_script)
performanceAdviserRules = Output(byId)
