# Dynamo custom node Document.StartingView.dyf (Dynamo 1.3.0.875)
# category: Clockwork.Revit.Document.Query
# Retrieves the starting view of a Project file. Returns null if no starting view is set.

toggle = Input(toggle : bool = true)
python_script = Python(IN[0]=toggle)
# ---------- python_script.python (14 lines) ----------
import clr
clr.AddReference('RevitAPI')
from Autodesk.Revit.DB import *

clr.AddReference("RevitNodes")
import Revit
clr.ImportExtensions(Revit.Elements)

clr.AddReference("RevitServices")
import RevitServices
from RevitServices.Persistence import DocumentManager

doc = DocumentManager.Instance.CurrentDBDocument
OUT = doc.GetElement(StartingViewSettings.GetStartingViewSettings(doc).ViewId).ToDSType(True)
# ----------------------------------------
view = Output(python_script)
