# Dynamo custom node Document.UnitTypes.dyf (Dynamo 1.3.3.4651)
# category: Clockwork.Revit.Document.Query
# Retrieves all available unit types of a given document

toggle = Input(toggle : bool = true)
docOrRevitLinkInstance = Input(docOrRevitLinkInstance : var = null)  # Use only if you want to query a linked model
python_script = Python(IN[0]=toggle, IN[1]=docOrRevitLinkInstance)
# ---------- python_script.python (30 lines) ----------
import clr
clr.AddReference('RevitAPI')
from Autodesk.Revit.DB import *
import Autodesk

clr.AddReference("RevitNodes")
import Revit
clr.ImportExtensions(Revit.Elements)

clr.AddReference("RevitServices")
import RevitServices
from RevitServices.Persistence import DocumentManager

inputdoc = UnwrapElement(IN[1])
if inputdoc == None:
	doc = DocumentManager.Instance.CurrentDBDocument
elif inputdoc.GetType().ToString() == "Autodesk.Revit.DB.RevitLinkInstance":
	doc = inputdoc.GetLinkDocument()
elif inputdoc.GetType().ToString() == "Autodesk.Revit.DB.Document":
	doc = inputdoc
else: doc = None

"""
elementlist = []
for phase in doc.Phases:
	elementlist.append(phase.ToDSType(True))
OUT = elementlist
"""

OUT = doc.GetUnits().GetModifiableUnitTypes()
# ----------------------------------------
unitTypes = Output(python_script)
