# Dynamo custom node Door.Rooms.dyf (Dynamo 1.3.1.1736)
# category: Clockwork.Revit.Elements.Door.Query
# Gets the rooms that are connected by a given door

door = Input(door : FamilyInstance[]..[])
turnIntoList = Custom[Turn Into List](unknownItem=door)  # Turns an element (or a nested list) into a flat list
phase = Input(phase : var = null)  # If no phase is specified, the node will use the last phase in the project
isNull = Object.IsNull(phase)
phases = Custom[Document.Phases]()  # Retrieves all phases in the active document in *chronological* order
lastItem = List.LastItem(phases)
scopeIf = Custom[ScopeIf+](test=isNull, true=lastItem, false=phase)  # A (hopefully) more robust implementation of ScopeIf. Tests a single boolean and returns a value accordingly.
python_script = Python(IN[0]=turnIntoList, IN[1]=scopeIf)
# ---------- python_script.python (28 lines) ----------
import clr
clr.AddReference('RevitAPI')
from Autodesk.Revit.DB import *

items = UnwrapElement(IN[0])
phase = UnwrapElement(IN[1])
fromlist = list()
tolist = list()
numexits = list()

for item in items:
	exits = 0
	try:	
		if item.FromRoom[phase]:
			fromlist.append(item.FromRoom[phase])
			exits += 1
		else:
			fromlist.append(None)
		if item.ToRoom[phase]:
			tolist.append(item.ToRoom[phase])
			exits += 1
		else:
			tolist.append(None)
	except:
		fromlist.append(None)
		tolist.append(None)
	numexits.append(exits)
OUT = (fromlist,tolist,numexits)
# ----------------------------------------
code_block = CodeBlock(seq=python_script) { seq[0]; seq[1]; seq[2]; }
returnListOrSingleValue = Custom[ReturnListOrSingleValue](unknownItem=door, seq=code_block.out0)  # If the item in input #1 is not a list, only the first item of the list in input #2 will be returned.
fromRoom = Output(returnListOrSingleValue)
returnListOrSingleValue_2 = Custom[ReturnListOrSingleValue](unknownItem=door, seq=code_block.out1)
toRoom = Output(returnListOrSingleValue_2)
returnListOrSingleValue_3 = Custom[ReturnListOrSingleValue](unknownItem=door, seq=code_block.out2)
roomCount = Output(returnListOrSingleValue_3)
