# Dynamo custom node Element.Area.dyf (Dynamo 1.3.1.1736)
# category: Clockwork.Revit.Elements.Element.Query
# Returns the area property of a given element (if that element has such a property)

element = Input()
turnIntoList = Custom[Turn Into List](unknownItem=element)  # Turns an element (or a nested list) into a flat list
python_script = Python(IN[0]=turnIntoList)
# ---------- python_script.python (12 lines) ----------
import clr
clr.AddReference('RevitAPI')
from Autodesk.Revit.DB import *

faminsts = UnwrapElement(IN[0])
elementlist = list()
for item in faminsts:
	try:
		elementlist.append(item.Area)
	except:
		elementlist.append(None)
OUT = elementlist
# ----------------------------------------
unit_types = UnitTypes("Area")
displayUnitType = Custom[UnitType.DisplayUnitType](unitType=unit_types)  # Retrieves the display unit type for a given unit type.
toDisplayUnit = Custom[InternalUnit.ToDisplayUnit](val=python_script, displayUnitType=displayUnitType.displayUnitType)  # Converts a value from Revit's internal unit to a given display unit
returnListOrSingleValue = Custom[ReturnListOrSingleValue](unknownItem=element, seq=toDisplayUnit)  # If the item in input #1 is not a list, only the first item of the list in input #2 will be returned.
area = Output(returnListOrSingleValue)
