# Dynamo custom node Element.CurtainGridLines.dyf (Dynamo 1.3.4.6666)
# category: Clockwork.Revit.Elements.Element.Query
# Retrieves the grid lines of curtain walls, curtain systems or glazed roofs.

hostElement = Input()
python_script = Python(IN[0]=hostElement)
# ---------- python_script.python (26 lines) ----------
import clr
clr.AddReference('RevitAPI')
from Autodesk.Revit.DB import *

clr.AddReference("RevitNodes")
import Revit
clr.ImportExtensions(Revit.Elements)

def GetCurtainGridLines(host):
	if hasattr(host, "CurtainGrid"):
		return GetCurtainGridLinesByGrid(host.CurtainGrid, host)
	elif hasattr(host, "CurtainGrids"):
		return map(list, zip(*[GetCurtainGridLinesByGrid(x, host) for x in host.CurtainGrids]))	
	else: return []

def GetCurtainGridLinesByGrid(grid, host):
	if grid:
		uGrids = [host.Document.GetElement(x) for x in grid.GetUGridLineIds()]
		vGrids = [host.Document.GetElement(x) for x in grid.GetVGridLineIds()]
		return uGrids, vGrids
	else: return list()

items = UnwrapElement(IN[0])

if isinstance(IN[0], list): OUT = [GetCurtainGridLines(x) for x in items]
else: OUT = GetCurtainGridLines(items)
# ----------------------------------------
firstItem = List.FirstItem(python_script)
uGridLines = Output(firstItem)
lastItem = List.LastItem(python_script)
vGridLines = Output(lastItem)
