# Dynamo custom node Element.ElementType+.dyf "Element.Type+" (Dynamo 0.8.2.2392)
# category: Clockwork.Revit.Elements.Element.Query
# Gets the family type of a given element (if applicable). Unlike the OOTB node, it also works for elements in linked models.

element = Input()
turnIntoList = Custom[Turn Into List](element)  # Turns an element (or a nested list) into a flat list
python_script = Python(IN[0]=turnIntoList)
# ---------- python_script.python (12 lines) ----------
import clr
clr.AddReference('RevitAPI')
from Autodesk.Revit.DB import *

items = UnwrapElement(IN[0])
typelist = list()
for item in items:
	try: 
		typelist.append(item.Document.GetElement(item.GetTypeId()))
	except:
		typelist.append(list())
OUT = typelist
# ----------------------------------------
returnListOrSingleValue = Custom[ReturnListOrSingleValue](unknownItem=element, seq=python_script)  # If the item in input #1 is not a list, only the first item of the list in input #2 will be returned.
type = Output(returnListOrSingleValue)
