# Dynamo custom node Element.Geometry+.dyf (Dynamo 1.0.0.1180)
# category: Clockwork.Revit.Elements.Element.Query
# Returns Dynamo AND native Revit geometry of a given element

element = Input(element : Element)
turnIntoList = Custom[TurnIntoList](unknownItem=element)  # Turns an element (or a nested list) into a flat list
detailLevel = Input()
includeInvisibleObjects = Input(includeInvisibleObjects : bool = false)
view = Input(view : View = null)
python_script = Python(IN[0]=turnIntoList, IN[1]=detailLevel, IN[2]=includeInvisibleObjects, IN[3]=view)
# ---------- python_script.python (46 lines) ----------
import clr
clr.AddReference('RevitAPI')
from Autodesk.Revit.DB import *

clr.AddReference("RevitNodes")
import Revit
clr.ImportExtensions(Revit.Elements)
clr.ImportExtensions(Revit.GeometryConversion)

# this function takes care of exploding 
# GeometryInstance objects. GI objects typically
# represent family instance geometry.
# in order to also catch possible nested families
# the fucntion calls itself recursively.
def convert_geometry_instance(geo, elementlist):
	for g in geo:
		if str(g.GetType()) == 'Autodesk.Revit.DB.GeometryInstance':
			elementlist = convert_geometry_instance(g.GetInstanceGeometry(), elementlist)
		else:
			elementlist.append(g)
	return elementlist

items = UnwrapElement(IN[0])
detail_lvl = IN[1]
inc_invis = IN[2]
view = UnwrapElement(IN[3])
revitlist = list()
dynlist = list()
for item in items:
	geo_options = Options()
	if view == None: geo_options.DetailLevel = detail_lvl
	geo_options.IncludeNonVisibleObjects = inc_invis
	if view != None: geo_options.View = view
	revitGeo = item.Geometry[geo_options]
	try:
		
		revit_geos = convert_geometry_instance(revitGeo, list())
		revitlist.append(revit_geos)
		dyn_geos = list()
		for geo in revit_geos:
			dyn_geos.append(geo.ToProtoType())
		dynlist.append(dyn_geos)	
	except:
		revitlist.append(list())
		dynlist.append(list())
OUT = (dynlist,revitlist)
# ----------------------------------------
code_block = CodeBlock(seq=python_script) { seq[0]; seq[1]; }
returnListOrSingleValue = Custom[ReturnListOrSingleValue](unknownItem=element, seq=code_block.out0)  # If the unknown item is not a list but rather a single item, only the first item of the list (input "seq") will be returned.
dynamoGeometry = Output(returnListOrSingleValue)
returnListOrSingleValue_2 = Custom[ReturnListOrSingleValue](unknownItem=element, seq=code_block.out1)
revitGeometry = Output(returnListOrSingleValue_2)
