# Dynamo custom node Element.Host+.dyf (Dynamo 1.0.0.1180)
# category: Clockwork.Revit.Elements.Element.Query
# Gets an element's host

element = Input()
turnIntoList = Custom[Turn Into List](unknownItem=element)  # Turns an element (or a nested list) into a flat list
python_script = Python(IN[0]=turnIntoList)
# ---------- python_script.python (32 lines) ----------
import clr
clr.AddReference('RevitAPI')
from Autodesk.Revit.DB import *

clr.AddReference("RevitNodes")
import Revit
clr.ImportExtensions(Revit.Elements)

faminsts = UnwrapElement(IN[0])
elementlist = list()
for item in faminsts:
	try:
		elementlist.append(item.Host.ToDSType(True))
	except:
		# if that doesn't work, maybe it's a WallSweep
		try:
			hostidlist = list()
			for host in item.GetHostIds():
				hostidlist.append(item.Document.GetElement(host).ToDSType(True))
			elementlist.append(hostidlist)
		except:
			# if that doesn't work, maybe it's a wall foundation
			try:
				elementlist.append(item.Document.GetElement(item.WallId).ToDSType(True))
			except:
				# if that doesn't work, maybe it's a railing, a building pad or a topo subregion
				try: 
					elementlist.append(item.Document.GetElement(item.HostId).ToDSType(True))
				except:
					elementlist.append(list())
			
OUT = elementlist
# ----------------------------------------
returnListOrSingleValue = Custom[ReturnListOrSingleValue](unknownItem=element, seq=python_script)  # If the item in input #1 is not a list, only the first item of the list in input #2 will be returned.
host = Output(returnListOrSingleValue)
