# Dynamo custom node Element.IsOfCategory.dyf (Dynamo 1.3.4.6666)
# category: Clockwork.Revit.Elements.Element.Query
# Checks whether an element is of a specified category

category = Input(category : var[]..[])  # Works with categories, BuiltInCategories and BuiltInCategories as strings
fromInput = Custom[Category.FromInput](var=category)  # Returns a category from a category, a Dynamo-wrapped category, a BuiltInCategory or a string representing a BuiltInCategory.
ID = Custom[Element.ID+](element=fromInput)  # Gets the ID of a given Revit elements. Unlike the OOTB Element.Id node, this node also works on mixed lists of Revit elements and categories.
element = Input()
category_2 = Custom[Element.Category+](element=element)  # Returns the category of a given element. Unlike the OOTB node Element.GetCategory, it will work for families, schedules and graphics styles as well.
id = Category.Id(category_2)
containsItem = List.ContainsItem(list=ID, item=id)
bool = Output(containsItem)
