# Dynamo custom node Element.Name+.dyf (Dynamo 1.3.1.1736)
# category: Clockwork.Revit.Elements.Element.Query
# Gets an element's name. Unlike the OOTB node, this node should work for all Revit elements that have names.

element = Input()
turnIntoList = Custom[Turn Into List](unknownItem=element)  # Turns an element (or a nested list) into a flat list
python_script = Python(IN[0]=turnIntoList)
# ---------- python_script.python (19 lines) ----------
import clr
clr.AddReference('RevitAPI')
from Autodesk.Revit.DB import *

items = IN[0]
elementlist = list()
for item in items:
	if UnwrapElement(item).GetType().ToString() in ("Autodesk.Revit.DB.BuiltInParameter", "Autodesk.Revit.DB.BuiltInParameterGroup", "Autodesk.Revit.DB.DisplayUnitType", "Autodesk.Revit.DB.ParameterType", "Autodesk.Revit.DB.UnitSymbolType", "Autodesk.Revit.DB.UnitType"):
		n = LabelUtils.GetLabelFor(UnwrapElement(item))
	elif UnwrapElement(item).GetType().ToString() == "Autodesk.Revit.DB.Parameter":
		n = UnwrapElement(item).Definition.Name
	else:
		try: n = UnwrapElement(item).Name
		except:
			# Use a built-in property of (wrapped) Dynamo elements for family symbols instead
			try: n = item.Name
			except: n = None
	elementlist.append(n)
OUT = elementlist
# ----------------------------------------
returnListOrSingleValue = Custom[ReturnListOrSingleValue](unknownItem=element, seq=python_script)  # If the item in input #1 is not a list, only the first item of the list in input #2 will be returned.
name = Output(returnListOrSingleValue)
