# Dynamo custom node Element.ParameterIsReadOnly.dyf (Dynamo 0.8.2.2392)
# category: Clockwork.Revit.Elements.Element.Query
# Checks if a parameter of a given element is read-only

parameter = Input(parameter : string)
element = Input()
turn_into_list = Custom[Turn Into List](parameter)  # Turns an element (or a nested list) into a flat list
python_script = Python(IN[0]=element, IN[1]=turn_into_list)
# ---------- python_script.python (18 lines) ----------
import clr
clr.AddReference('RevitAPI')
from Autodesk.Revit.DB import *

element = UnwrapElement(IN[0])
params = IN[1]
elementlist = list()
for paramname in params:
	try:
		for param in element.Parameters:
			if param.Definition.Name == paramname:
				if param.IsReadOnly:
					elementlist.append(True)
				else:
					elementlist.append(False)
	except:
		elementlist.append(False)
OUT = elementlist
# ----------------------------------------
returnListOrSingleValue = Custom[ReturnListOrSingleValue](unknownItem=parameter, seq=python_script)  # If the item in input #1 is not a list, only the first item of the list in input #2 will be returned.
bool = Output(returnListOrSingleValue)
