# Dynamo custom node Element.PermanentlyIsolateInView.dyf (Dynamo 0.8.2.2392)
# category: Clockwork.Revit.Elements.Element.Actions
# (Permanently) isolates elements in the given view

view = Input()
element = Input()
turnIntoList = Custom[Turn Into List](unknownItem=element)  # Turns an element (or a nested list) into a flat list
temporarilyIsolateInView = Custom[View.TemporarilyIsolateElement](view=view, element=turnIntoList)  # "Element.TemporarilyIsolateInView"; (Temporarily) isolates elements in the given view
convertTemporaryHideIsolateToPermanent = Custom[View.ConvertTemporaryHideIsolateToPermanent](view=temporarilyIsolateInView.view)  # Convert all temporary hidden elements or categories to permanently hidden in the given view.
view_2 = Output(convertTemporaryHideIsolateToPermanent)  # "view"
returnListOrSingleValue = Custom[ReturnListOrSingleValue](unknownItem=element, seq=temporarilyIsolateInView.element)  # If the item in input #1 is not a list, only the first item of the list in input #2 will be returned.
element_2 = Output(returnListOrSingleValue)  # "element"
