# Dynamo custom node Element.Phases.dyf (Dynamo 1.3.1.1736)
# category: Clockwork.Revit.Elements.Element.Query
# Gets the created and demolished phases of an element

element = Input()
turnIntoList = Custom[Turn Into List](unknownItem=element)  # Turns an element (or a nested list) into a flat list
python_script = Python(IN[0]=turnIntoList)
# ---------- python_script.python (22 lines) ----------
import clr
clr.AddReference('RevitAPI')
from Autodesk.Revit.DB import *

items = UnwrapElement(IN[0])
createdlist = list()
demolist = list()

for item in items:
	try:
		if item.CreatedPhaseId.IntegerValue == -1:
			createdlist.append(None)
		else:
			createdlist.append(item.Document.GetElement(item.CreatedPhaseId))
		if item.DemolishedPhaseId.IntegerValue == -1:
			demolist.append(None)
		else:
			demolist.append(item.Document.GetElement(item.DemolishedPhaseId))
	except:
		createdlist.append(None)
		demolist.append(None)
OUT = (createdlist,demolist)
# ----------------------------------------
code_block = CodeBlock(seq=python_script) { seq[0]; seq[1]; }
returnListOrSingleValue = Custom[ReturnListOrSingleValue](unknownItem=element, seq=code_block.out0)  # If the item in input #1 is not a list, only the first item of the list in input #2 will be returned.
Created = Output(returnListOrSingleValue)
returnListOrSingleValue_2 = Custom[ReturnListOrSingleValue](unknownItem=element, seq=code_block.out1)
Demolished = Output(returnListOrSingleValue_2)
