# Dynamo custom node Element.SetMaterialParameterByCategory.dyf (Dynamo 1.3.1.1736)
# category: Clockwork.Revit.Elements.Element.Actions
# Sets a material parameter of a given element to <By Category>

element = Input()
turnIntoList = Custom[Turn Into List](unknownItem=element)  # Turns an element (or a nested list) into a flat list
materialParameterName = Input(materialParameterName : string)
python_script = Python(IN[0]=turnIntoList, IN[1]=materialParameterName)
# ---------- python_script.python (31 lines) ----------
import clr
clr.AddReference('RevitAPI')
from Autodesk.Revit.DB import *

clr.AddReference("RevitServices")
import RevitServices
from RevitServices.Persistence import DocumentManager
from RevitServices.Transactions import TransactionManager

doc = DocumentManager.Instance.CurrentDBDocument
elements = UnwrapElement(IN[0])
paramname = IN[1]
booleans = list()

TransactionManager.Instance.EnsureInTransaction(doc)
for item in elements:
	try:
		paramset = False
		for param in item.Parameters:
			if param.Definition.Name == paramname:
				param.Set(ElementId.InvalidElementId)
				booleans.append(True)
				paramset = True
				break
		if paramset == False:
			booleans.append(False)
	except:
		booleans.append(False)
TransactionManager.Instance.TransactionTaskDone()

OUT = (elements,booleans)
# ----------------------------------------
code_block = CodeBlock(seq=python_script) { seq[0]; seq[1]; }
returnListOrSingleValue = Custom[ReturnListOrSingleValue](unknownItem=element, seq=code_block.out0)  # If the item in input #1 is not a list, only the first item of the list in input #2 will be returned.
elements = Output(returnListOrSingleValue)
returnListOrSingleValue_2 = Custom[ReturnListOrSingleValue](unknownItem=element, seq=code_block.out1)
success = Output(returnListOrSingleValue_2)
