# Dynamo custom node Element.SubComponents.dyf (Dynamo 1.3.3.4651)
# category: Clockwork.Revit.Elements.Element.Query
# Retrieves all (retrievable) subcomponents of a given family instance, beam system, stair (runs, landings and supports) or railing (top rails and hand rails).

element = Input(element: var[]..[])
python_script = Python(IN[0]=element)
# ---------- python_script.python (32 lines) ----------
import clr
clr.AddReference('RevitAPI')
from Autodesk.Revit.DB import *

clr.AddReference("RevitNodes")
import Revit
clr.ImportExtensions(Revit.Elements)

items = UnwrapElement(IN[0])

def GetSubComponents(item):
	# FamilyInstances
	if hasattr(item, "GetSubComponentIds"):
		return [item.Document.GetElement(x) for x in item.GetSubComponentIds()]
	# Stairs
	elif hasattr(item, "GetStairsLandings"):
		stair_comps = [item.Document.GetElement(x) for x in item.GetStairsLandings()]
		stair_comps.extend([item.Document.GetElement(x) for x in item.GetStairsRuns()])
		stair_comps.extend([item.Document.GetElement(x) for x in item.GetStairsSupports()])
		return stair_comps
	# Railings
	elif hasattr(item, "GetHandRails"):
		rail_comps = [item.Document.GetElement(x) for x in item.GetHandRails()]
		rail_comps.append(item.Document.GetElement(item.TopRail))
		return rail_comps
	# Beam systems
	elif hasattr(item, "GetBeamIds"):
		return [item.Document.GetElement(x) for x in item.GetBeamIds()]
	else: return []

if isinstance(IN[0], list): OUT = [GetSubComponents(x) for x in items]
else: OUT = GetSubComponents(items)
# ----------------------------------------
subComponents = Output(python_script)
