# Dynamo custom node ElementType.ByName.dyf (Dynamo 1.3.3.4651)
# category: Clockwork.Revit.Selection.Miscellaneous
# Retrieves an element type by its name  - to be used with the OOTB node "All Elements of Type".

elementTypes = Custom[Document.ElementTypes]()  # Retrieves a list of all Revit element types
name = Input(name : string)
indexOf = IndexOf(elementTypes.elementTypeNames, name)
getItemAtIndex = List.GetItemAtIndex(list=elementTypes.elementTypes, index=indexOf)
elementType = Output(getItemAtIndex)
