# Dynamo custom node Elements.FilterByName.dyf (Dynamo 0.8.2.2392)
# category: Clockwork.Revit.Selection.Filters
# Retrieves those elements from a collection whose names match the search string

elements = Input()
turnIntoList = Custom[Turn Into List](elements)  # Turns an element (or a nested list) into a flat list
element_name_universal = Custom[Element.Name (Universal)](element=turnIntoList)  # Gets an element's name (Dynamo's built-in Name nodes don't work for all element types, e.g. worksets...)
searchString = Input(searchString : string)
ignoreCase = Input(ignoreCase : bool = true)
code_block = CodeBlock(str=element_name_universal, search=searchString, igncase=ignoreCase, list=turnIntoList)
# ---------- code_block.designscript (5 lines) ----------
mask = String.Contains(str,search,igncase);
filter = List.FilterByBoolMask(list,mask);
filter["in"][0];
filter["in"];
filter["out"];
# ----------------------------------------
first = Output(code_block.out2)
in_ = Output(code_block.out3)  # "in"
out = Output(code_block.out4)
