# Dynamo custom node Elements.GroupByHost.dyf (Dynamo 1.3.1.1736)
# category: Clockwork.Revit.Elements.Element.Actions
# Groups a list of Revit elements by their respective hosts (if they have any)

elements = Input()
turnIntoList = Custom[Turn Into List](unknownItem=elements)  # Turns an element (or a nested list) into a flat list
host = Custom[Element.Host](element=turnIntoList)  # Gets an element's host
isNull = Object.IsNull(host)
filterByBoolMask = List.FilterByBoolMask(list=turnIntoList, mask=isNull)
filterByBoolMask_2 = List.FilterByBoolMask(list=host, mask=isNull)
groupByKey = List.GroupByKey(list=filterByBoolMask.out, keys=filterByBoolMask_2.out)
elementsGroupedByHost = Output(groupByKey.groups)
hosts = Output(groupByKey.unique_keys)
unhostedElements = Output(filterByBoolMask.in)
