# Dynamo custom node Enum.Values.dyf (Dynamo 1.3.4.6666)
# category: Clockwork.Revit.Elements.Enum.Query
# Returns the keys and values of a given Revit Enum

enumName = Input(enumName : string[]..[])
python_script = Python(IN[0]=enumName)
# ---------- python_script.python (20 lines) ----------
import clr
import System
clr.AddReference('RevitAPI')
clr.AddReference('RevitAPIUI')
from Autodesk.Revit.DB import *
import Autodesk

def GetEnumValues(typename):
	if hasattr(Autodesk.Revit.DB, typename):
		enumtype = getattr(Autodesk.Revit.DB, typename)
		if hasattr(enumtype, 'GetNames'):
			enumnames = System.Enum.GetNames(enumtype)
			return enumnames, [int(System.Enum.Parse(enumtype, x)) for x in enumnames]
		else: return []
	else: return []

enums = IN[0]

if isinstance(IN[0], list): OUT = map(list, zip(*[GetEnumValues(x) for x in enums]))
else: OUT = GetEnumValues(enums)
# ----------------------------------------
firstItem = List.FirstItem(python_script)
values = Output(firstItem)
lastItem = List.LastItem(python_script)
keys = Output(lastItem)
