# Dynamo custom node Family.PlacementType.dyf (Dynamo 1.3.1.1736)
# category: Clockwork.Revit.Elements.Family.Query
# Returns the expected host class of a family (if any)

family = Input(family : Family)
turnIntoList = Custom[Turn Into List](unknownItem=family)  # Turns an element (or a nested list) into a flat list
python_script = Python(IN[0]=turnIntoList)
# ---------- python_script.python (11 lines) ----------
import clr
clr.AddReference('RevitAPI')
from Autodesk.Revit.DB import *

fams = UnwrapElement(IN[0])
ptypes = list()
for fam in fams:
	if fam.GetType().ToString() == "Autodesk.Revit.DB.Family":
		ptypes.append(fam.FamilyPlacementType)
	else: ptypes.append(None)
OUT = ptypes
# ----------------------------------------
returnListOrSingleValue = Custom[ReturnListOrSingleValue](unknownItem=family, seq=python_script)  # If the item in input #1 is not a list, only the first item of the list in input #2 will be returned.
placementType = Output(returnListOrSingleValue)
