# Dynamo custom node FamilyDocument.FamilyParameters.dyf (Dynamo 1.3.1.1736)
# category: Clockwork.Revit.FamilyDocument.Query
# Retrieves all family parameters from the active family document. PLEASE NOTE: This node will only work in a family document!

toggle = Input(toggle : bool = true)
python_script = Python(IN[0]=toggle)
# ---------- python_script.python (14 lines) ----------
import clr
clr.AddReference('RevitAPI')
from Autodesk.Revit.DB import *

clr.AddReference("RevitServices")
import RevitServices
from RevitServices.Persistence import DocumentManager

doc = DocumentManager.Instance.CurrentDBDocument
elementlist = list()
if doc.IsFamilyDocument:
	for param in doc.FamilyManager.Parameters:
		elementlist.append(param)
OUT = elementlist
# ----------------------------------------
familyParameters = Output(python_script)
