# Dynamo custom node FamilyInstance.FlipFromToRoom.dyf (Dynamo 0.8.2.2392)
# category: Clockwork.Revit.Elements.FamilyInstance.Actions
# Flips the settings of "From Room" and "To Room" for any given door or window instance. PLEASE NOTE: Will not work on door or window families with an activated room calculation point.

familyInstance = Input(familyInstance : FamilyInstance)
turnIntoList = Custom[TurnIntoList](unknownItem=familyInstance)  # Turns an element (or a nested list) into a flat list
python_script = Python(IN[0]=turnIntoList)
# ---------- python_script.python (23 lines) ----------
import clr
clr.AddReference('RevitAPI')
from Autodesk.Revit.DB import *

clr.AddReference("RevitServices")
import RevitServices
from RevitServices.Persistence import DocumentManager
from RevitServices.Transactions import TransactionManager

doc = DocumentManager.Instance.CurrentDBDocument
faminstances = UnwrapElement(IN[0])
elementlist = list()

TransactionManager.Instance.EnsureInTransaction(doc)
for item in faminstances:
    try:
        item.FlipFromToRoom()
        elementlist.append(item)
    except:
        elementlist.append(list())
TransactionManager.Instance.TransactionTaskDone()

OUT = elementlist
# ----------------------------------------
returnListOrSingleValue = Custom[ReturnListOrSingleValue](unknownItem=familyInstance, seq=python_script)  # If the unknown item is not a list but rather a single item, only the first item of the list (input "seq") will be returned.
familyInstance_2 = Output(returnListOrSingleValue)  # "familyInstance"
