# Dynamo custom node FamilyInstance.RemoveCoping.dyf (Dynamo 1.3.1.1736)
# category: Clockwork.Revit.Elements.FamilyInstance.Actions
# Removes a coping (cut) from a steel beam

familyInstance = Input()
turnIntoList = Custom[Turn Into List](unknownItem=familyInstance)  # Turns an element (or a nested list) into a flat list
cuttingElementToBeRemoved = Input()
turnIntoList_2 = Custom[Turn Into List](unknownItem=cuttingElementToBeRemoved)
python_script = Python(IN[0]=turnIntoList, IN[1]=turnIntoList_2)
# ---------- python_script.python (26 lines) ----------
import clr
import System
clr.AddReference('RevitAPI')
from Autodesk.Revit.DB import *

clr.AddReference("RevitServices")
import RevitServices
from RevitServices.Persistence import DocumentManager
from RevitServices.Transactions import TransactionManager

doc = DocumentManager.Instance.CurrentDBDocument
fams = UnwrapElement(IN[0])
cutters = UnwrapElement(IN[1])
booleans = []
counter = 0

TransactionManager.Instance.EnsureInTransaction(doc)
for fam in fams:
	try:
		fam.RemoveCoping(cutters[counter])
		booleans.append(True)
	except:	booleans.append(False)
	counter += 1
TransactionManager.Instance.TransactionTaskDone()

OUT = (fams,booleans)
# ----------------------------------------
code_block = CodeBlock(seq=python_script) { seq[0]; seq[1]; }
returnListOrSingleValue = Custom[ReturnListOrSingleValue](unknownItem=familyInstance, seq=code_block.out0)  # If the item in input #1 is not a list, only the first item of the list in input #2 will be returned.
familyInstance_2 = Output(returnListOrSingleValue)  # "familyInstance"
returnListOrSingleValue_2 = Custom[ReturnListOrSingleValue](unknownItem=familyInstance, seq=code_block.out1)
success = Output(returnListOrSingleValue_2)
