# Dynamo custom node FamilyParameter.MakeType.dyf (Dynamo 1.3.3.4651)
# category: Clockwork.Revit.Elements.FamilyParameter.Actions
# Converts an instance parameter to a type parameter. ATTENTION: Only works in a family document.

familyParameter = Input()
python_script = Python(IN[0]=familyParameter)
# ---------- python_script.python (23 lines) ----------
import clr
clr.AddReference('RevitAPI')
from Autodesk.Revit.DB import *

clr.AddReference("RevitServices")
import RevitServices
from RevitServices.Persistence import DocumentManager
from RevitServices.Transactions import TransactionManager

def MakeTypeParam(doc, param):
	success = False
	if doc.IsFamilyDocument and hasattr(param, "Formula"):
		try:
			doc.FamilyManager.MakeType(param)
			success = True
		except: pass
	return param, success

doc = DocumentManager.Instance.CurrentDBDocument
TransactionManager.Instance.EnsureInTransaction(doc)
if isinstance(IN[0], list): OUT = map(list, zip(*[MakeTypeParam(doc, x) for x in IN[0]]))
else: OUT = MakeTypeParam(doc, IN[0])
TransactionManager.Instance.TransactionTaskDone()
# ----------------------------------------
firstItem = List.FirstItem(python_script)
familyParameter_2 = Output(firstItem)  # "familyParameter"
lastItem = List.LastItem(python_script)
success = Output(lastItem)
