# Dynamo custom node FamilyType.FamilyName.dyf (Dynamo 1.0.0.1180)
# category: Clockwork.Revit.Elements.FamilyType.Query
# Returns the *family* name of a given family *type*

familyType = Input()
turnIntoList = Custom[Turn Into List](unknownItem=familyType)  # Turns an element (or a nested list) into a flat list
python_script = Python(IN[0]=turnIntoList)
# ---------- python_script.python (17 lines) ----------
import clr
clr.AddReference('RevitAPI')
from Autodesk.Revit.DB import *

clr.AddReference("RevitNodes")
import Revit
clr.ImportExtensions(Revit.Elements)

famtypes = UnwrapElement(IN[0])
elementlist = list()
for item in famtypes:
	try: 
		elementlist.append(item.FamilyName)
	except:
		elementlist.append(None)
			
OUT = elementlist
# ----------------------------------------
returnListOrSingleValue = Custom[ReturnListOrSingleValue](unknownItem=familyType, seq=python_script)  # If the item in input #1 is not a list, only the first item of the list in input #2 will be returned.
str = Output(returnListOrSingleValue)
