# Dynamo custom node FamilyType.Function.dyf (Dynamo 1.0.0.1180)
# category: Clockwork.Revit.Elements.FamilyType.Query
# Retrieves the Function property of a given family type (if it has that property)

familyType = Input()
turnIntoList = Custom[Turn Into List](unknownItem=familyType)  # Turns an element (or a nested list) into a flat list
python_script = Python(IN[0]=turnIntoList)
# ---------- python_script.python (17 lines) ----------
import clr
clr.AddReference('RevitAPI')
from Autodesk.Revit.DB import *

clr.AddReference("RevitNodes")
import Revit
clr.ImportExtensions(Revit.Elements)

items = UnwrapElement(IN[0])
functionlist = list()

for item in items:
	try:
		functionlist.append(item.get_Parameter(BuiltInParameter.FUNCTION_PARAM).AsValueString())
	except:
		functionlist.append(None)
OUT = functionlist
# ----------------------------------------
returnListOrSingleValue = Custom[ReturnListOrSingleValue](unknownItem=familyType, seq=python_script)  # If the item in input #1 is not a list, only the first item of the list in input #2 will be returned.
function = Output(returnListOrSingleValue)
