# Dynamo custom node File.Created.dyf (Dynamo 1.3.4.6666)
# category: Clockwork.Core.File.Query
# Returns the date and time a given file was created

file = Input(file : System.IO.FileInfo[]..[])
python_script = Python(IN[0]=file)
# ---------- python_script.python (8 lines) ----------
import clr

def FileCreated(file):
	if hasattr(file,"CreationTime"): return file.CreationTime
	else: return None

if isinstance(IN[0], list): OUT = [FileCreated(x) for x in IN[0]]
else: OUT = FileCreated(IN[0])
# ----------------------------------------
dateTime = Output(python_script)
