# Dynamo custom node FillPatternElement.IsSolidFill.dyf (Dynamo 1.3.1.1736)
# category: Clockwork.Revit.Elements.FillPatternElement.Query
# Checks if the given FillPatternElement is a solid fill

fillPatternElement = Input(fillPatternElement : FillPatternElement)
turnIntoList = Custom[Turn Into List](unknownItem=fillPatternElement)  # Turns an element (or a nested list) into a flat list
python_script = Python(IN[0]=turnIntoList)
# ---------- python_script.python (10 lines) ----------
import clr
clr.AddReference('RevitAPI')
from Autodesk.Revit.DB import *

fillpatterns = UnwrapElement(IN[0])
booleans = list()

for fp in fillpatterns:
	booleans.append(fp.GetFillPattern().IsSolidFill)
OUT = booleans
# ----------------------------------------
returnListOrSingleValue = Custom[ReturnListOrSingleValue](unknownItem=fillPatternElement, seq=python_script)  # If the item in input #1 is not a list, only the first item of the list in input #2 will be returned.
bool = Output(returnListOrSingleValue)
