# Dynamo custom node Floor.SlabShapeHasBeenModified.dyf (Dynamo 0.8.2.2392)
# category: Clockwork.Revit.Elements.Floor.Query
# Checks if the shape of a floor slab has been modified with the shape editing tools

floor = Input()
slabShapeHasBeenModified = Custom[Roof.SlabShapeHasBeenModified](roof=floor)  # Checks if the shape of a roof slab has been modified with the shape editing tools
bool = Output(slabShapeHasBeenModified)
