# Dynamo custom node Geometry.ClosestTo.dyf (Dynamo 0.8.2.2392)
# category: Clockwork.Geometry.Geometry.Query
# Finds the closest entity in a list of geometric entities from another given entity

geometry = Input(geometry : Autodesk.Geometry[])
other = Input(other : Autodesk.Geometry)
code_block = CodeBlock(seq1=geometry, p=other) { seq2 = seq1.DistanceTo(p); mind = List.MinimumItem(seq2); }
formula = Formula("a=b", code_block.seq2, code_block.mind)
code_block_2 = CodeBlock(geom=geometry, mask=formula, other=other) { filtered = List.FilterByBoolMask(geom, mask)["in"]; Flatten(filtered); Flatten(filtered.ClosestPointTo(other)); }
ClosestObject = Output(code_block_2.out1)
ClosestPoint = Output(code_block_2.out2)
