# Dynamo custom node Geometry.FurthestFrom.dyf (Dynamo 0.8.2.2392)
# category: Clockwork.Geometry.Geometry.Query
# Finds the furthest entity in a list of geometric entities from another given entity

geometry = Input(geometry: Autodesk.Geometry[])
other = Input(other : Autodesk.Geometry)
code_block = CodeBlock(seq1=geometry, p=other) { seq2 = seq1.DistanceTo(p); maxd = List.MaximumItem(seq2); }
formula = Formula("a=b", code_block.seq2, code_block.maxd)
code_block_2 = CodeBlock(geom=geometry, mask=formula) { Flatten(List.FilterByBoolMask(geom,mask)["in"]); }
FurthestObject = Output(code_block_2)
