# Dynamo custom node Grid.Plane.dyf (Dynamo 1.3.1.1736)
# category: Clockwork.Revit.Elements.Grid.Query
# Retrieves the plane of a grid. Returns null for curved grid lines.

grid = Input(grid : Grid[]..[])
curve = Grid.Curve(grid)
startPoint = Curve.StartPoint(curve)
endPoint = Curve.EndPoint(curve)
ZAxis = Vector.ZAxis()
X = Point.X(startPoint)
Y = Point.Y(startPoint)
X_2 = Point.X(endPoint)
Y_2 = Point.Y(endPoint)
create = List.Create(X, Y, X_2, Y_2)
transpose = List.Transpose(create)
abs = Math.Abs(transpose)
average = Math.Average(abs)
scale = Vector.Scale(vector=ZAxis, scale_factor=average)
add = Point.Add(point=endPoint, vectorToAdd=scale)
byThreePoints = Plane.ByThreePoints(startPoint, endPoint, add)
type = Object.Type(curve)
string = StringInput("Autodesk.DesignScript.Geometry.Line")
ne = type != string
boolean = BoolSelector(true)
allIndicesOf = List.AllIndicesOf(list=ne, item=boolean)
code_block = CodeBlock { null; }
replaceItemAtIndex = Custom[List.ReplaceItemAtIndex+](seq=byThreePoints, indices=allIndicesOf, replacement=code_block)  # Replaces the item at a given index (or list of indices) of a list by another item
plane = Output(replaceItemAtIndex)
