# Dynamo custom node ImportInstance.IsLinked.dyf (Dynamo 1.3.0.875)
# category: Clockwork.Revit.Elements.ImportInstance.Query
# Determines whether an ImportInstance is linked or not

importInstance = Input(importInstance : ImportInstance)
turnIntoList = Custom[TurnIntoList](unknownItem=importInstance)  # Turns an element (or a nested list) into a flat list
python_script = Python(IN[0]=turnIntoList)
# ---------- python_script.python (18 lines) ----------
import clr
clr.AddReference('RevitAPI')
from Autodesk.Revit.DB import *
import Autodesk

clr.AddReference("RevitServices")
import RevitServices
from RevitServices.Persistence import DocumentManager

doc = DocumentManager.Instance.CurrentDBDocument
impinst = UnwrapElement(IN[0])
booleans = []
for item in impinst:
	if item.GetType().ToString() == "Autodesk.Revit.DB.ImportInstance":
		if item.IsLinked: booleans.append(True)
		else: booleans.append(False)
	else: booleans.append(False)
OUT = (booleans)
# ----------------------------------------
returnListOrSingleValue = Custom[ReturnListOrSingleValue](unknownItem=importInstance, seq=python_script)  # If the unknown item is not a list but rather a single item, only the first item of the list (input "seq") will be returned.
bool = Output(returnListOrSingleValue)
