# Dynamo custom node Level.Views.dyf (Dynamo 1.3.1.1736)
# category: Clockwork.Revit.Elements.Level.Query
# Returns all views associated with a given level

toggleToRefresh = Input(toggleToRefresh : bool = true)
views = Custom[Document.Views](toggle=toggleToRefresh)  # Gets all views in the document - except for 3D view templates (as long as this bug is not fixed: https://github.com/DynamoDS/Dynamo/issues/2970)
level = Custom[Element.Level](element=views)  # Gets an element's level
isNull = Object.IsNull(level)
filterByBoolMask = List.FilterByBoolMask(list=views, mask=isNull)
filterByBoolMask_2 = List.FilterByBoolMask(list=level, mask=isNull)
id = Element.Id(filterByBoolMask_2.out)
level_2 = Input(level : Level)
id_2 = Element.Id(level_2)
eq = id == id_2
filterByBoolMask_3 = List.FilterByBoolMask(list=filterByBoolMask.out, mask=eq)
firstItem = List.FirstItem(filterByBoolMask_3.in)
firstView = Output(firstItem)
allViews = Output(filterByBoolMask_3.in)
