# Dynamo custom node List.AnyFalse.dyf (Dynamo 1.3.0.875)
# category: Clockwork.Core.List.Query
# Returns true if any item in a list of booleans is false.

seq = Input(seq : bool[])
allTrue = AllTrue(seq)
not_ = Not(allTrue)
bool = Output(not_)
