# Dynamo custom node List.AnyTrue.dyf (Dynamo 1.3.0.875)
# category: Clockwork.Core.List.Query
# Returns true if any item in a list of booleans is true.

seq = Input(seq : bool[])
allFalse = AllFalse(seq)
not_ = Not(allFalse)
bool = Output(not_)
