# Dynamo custom node List.ChopByLengths.dyf (Dynamo 1.0.0.1180)
# category: Clockwork.Core.List.Actions
# Turns a list into a list of lists with sublists of varying lengths.

lengths = Input()
seq = Input()
turnIntoList = Custom[Turn Into List](unknownItem=seq)  # Turns an element (or a nested list) into a flat list
turnIntoList_2 = Custom[Turn Into List](unknownItem=lengths)
python_script = Python(IN[0]=turnIntoList, IN[1]=turnIntoList_2)
# ---------- python_script.python (15 lines) ----------
import clr

inputlist = IN[0]
listlengths = IN[1]
rowcounter = 0
elementlist = list()
for item in listlengths:
	itemcounter = 0
	itemlist = list()
	while itemcounter < item:
		itemlist.append(inputlist[rowcounter])
		rowcounter += 1
		itemcounter += 1
	elementlist.append(itemlist)
OUT = elementlist
# ----------------------------------------
returnListOrSingleValue = Custom[ReturnListOrSingleValue](unknownItem=lengths, seq=python_script)  # If the item in input #1 is not a list, only the first item of the list in input #2 will be returned.
seq_2 = Output(returnListOrSingleValue)  # "seq"
