# Dynamo custom node List.CountOccurences.dyf (Dynamo 1.3.0.875)
# category: Clockwork.Core.List.Query
# Counts the number of occurences of each unique element in a given list

seq = Input()
turnIntoList = Custom[Turn Into List](unknownItem=seq)  # Turns an element (or a nested list) into a flat list
identity = Object.Identity(turnIntoList)
groupByKey = List.GroupByKey(list=turnIntoList, keys=identity)
uniqueElements = Output(groupByKey.unique_keys)
count = List.Count(groupByKey.groups@L2)
count_2 = Output(count)  # "count"
