# Dynamo custom node List.DropLastItem.dyf (Dynamo 0.8.2.2392)
# category: Clockwork.Core.List.Actions
# Drops the last item from a given list.

seq = Input()
code_block = CodeBlock(seq=seq) { List.TakeItems(seq,List.Count(seq)-1); }
seq_2 = Output(code_block)  # "seq"
