# Dynamo custom node List.EqualSublistLengths.dyf (Dynamo 0.8.1.1693)
# category: Clockwork.Core.List.Actions
# Trims all given lists to the length of the shortest list

lists = Input()
sublistLengths = Custom[Get Sublist Lengths](list=lists)  # "List.SublistLengths"; Gets the lengths of all sublists in a given list of lists.
code_block = CodeBlock(seq=sublistLengths) { List.MinimumItem(seq); }
takeItems = List.TakeItems(amount=code_block)
map = List.Map(list=lists, f_x=takeItems)
lists_2 = Output(map)  # "lists"
