# Dynamo custom node List.FilterBySublistLength.dyf (Dynamo 0.8.1.1693)
# category: Clockwork.Core.List.Actions
# Filters out all sublists that do not have the specified length

seq = Input()
count = List.Count()
map = List.Map(list=seq, f_x=count)
length = Input(length : int)
code_block = CodeBlock(n=map, x=length, seq=seq) { mask = n == x; filter = List.FilterByBoolMask(seq,mask); filter["in"]; filter["out"]; }
in_ = Output(code_block.out2)  # "in"
out = Output(code_block.out3)
