# Dynamo custom node List.FromCSV.dyf (Dynamo 1.0.0.1180)
# category: Clockwork.Core.List.Create
# Converts the content of a given CSV file to a list

CSVstring = Input(CSVstring : string)
code_block = CodeBlock(csv=CSVstring)
# ---------- code_block.designscript (5 lines) ----------
// Define separator as line break
sep = "
";
// Make a list of lines
String.Split(csv,sep);
# ----------------------------------------
delimiter = Input(delimiter : string = ",")
split = String.Split(arg1=delimiter)
map = List.Map(list=code_block.out1, f_x=split)
ignoreFirstRow = Input(ignoreFirstRow : bool = false)
ignoreLastRow = Input(ignoreLastRow : bool = false)
code_block_2 = CodeBlock(map, ignoreFirstRow, ignoreLastRow)
# ---------- code_block_2.designscript (8 lines) ----------
// Ignore the first row?
i1[0] = List.RestOfItems(seq1);
i1[1] = seq1;
seq2 = i1[ifr ? 0 : 1];
// Ignore the last row?
i2[0] = List.TakeItems(seq2,(List.Count(seq2)-1));
i2[1] = seq2;
String.TrimWhitespace(i2[ilr ? 0 : 1]);
# ----------------------------------------
seq = Output(code_block_2.out5)
