# Dynamo custom node List.FromString.dyf (Dynamo 0.8.1.1693)
# category: Clockwork.Core.List.Create
# Chops up a string into a list of characters

str = Input(str : string)
code_block = CodeBlock(str=str) { startindex = 0..(String.Length(str)-1); String.Substring(str,startindex,1); }
seq = Output(code_block.out1)
