# Dynamo custom node List.GroupListOfListsByKey.dyf (Dynamo 0.8.2.2392)
# category: Clockwork.Core.List.Actions
# Groups a list of lists by one of its keys

seq = Input()
keyIndex = Input(keyIndex : int = 0)
boolean = BoolSelector(false)
sortListOfLists = Custom[List.SortListOfLists](seq=seq, sortIndex=keyIndex, caseInsensitive=boolean, orderDescending=boolean)  # Sorts a list of lists by one of its sublists
code_block = CodeBlock(seq=sortListOfLists) { List.Transpose(seq); }
python_script = Python(IN[0]=code_block, IN[1]=keyIndex)
# ---------- python_script.python (13 lines) ----------
import clr
from itertools import groupby

items = IN[0]
groupindex = int(IN[1])
listlist = list()

for key, group in groupby(items, lambda x: x[groupindex]):
	elementlist = list()
	for thing in group:
		elementlist.append(thing)
	listlist.append(elementlist)
OUT = listlist
# ----------------------------------------
transpose = List.Transpose()
map = List.Map(list=python_script, f_x=transpose)
seq_2 = Output(map)  # "seq"
