# Dynamo custom node List.IsNotEmpty.dyf (Dynamo 0.8.1.1693)
# category: Clockwork.Core.List.Query
# Just the inversion of the built-in Is Empty List node.

seq = Input()
code_block = CodeBlock(seq=seq) { !List.IsEmpty(seq); }
bool = Output(code_block)
