# Dynamo custom node List.RandomElements.dyf (Dynamo 1.0.0.1180)
# category: Clockwork.Core.List.Create
# Creates a list of random elements based on a given list of elements

baseElements = Input()
turnIntoList = Custom[Turn Into List](unknownItem=baseElements)  # Turns an element (or a nested list) into a flat list
count = List.Count(turnIntoList)
n1 = Custom[-1](dbl=count)  # Decrements a value by 1
amount = Input(amount : int)
seed = Input(seed : int = 0)
randomIntegerList = Custom[Math.RandomIntegerList](max=n1, amount=amount, seed=seed)  # Creates a list of random integers between 0 and a given maximum value
getItemAtIndex = List.GetItemAtIndex(list=turnIntoList, index=randomIntegerList)
seq = Output(getItemAtIndex)
