# Dynamo custom node MassFloor.Mass.dyf (Dynamo 1.3.1.1736)
# category: Clockwork.Revit.Elements.MassFloor.Query
# Gets the mass a given mass floor belongs to

massFloor = Input()
turnIntoList = Custom[Turn Into List](unknownItem=massFloor)  # Turns an element (or a nested list) into a flat list
python_script = Python(IN[0]=turnIntoList)
# ---------- python_script.python (16 lines) ----------
import clr
clr.AddReference('RevitAPI')
from Autodesk.Revit.DB import *

clr.AddReference("RevitNodes")
import Revit
clr.ImportExtensions(Revit.Elements)

massfloors = UnwrapElement(IN[0])
elementlist = list()
for item in massfloors:
	try:
		elementlist.append(item.Document.GetElement(item.OwningMassId).ToDSType(True))
	except:
		elementlist.append(None)
OUT = elementlist
# ----------------------------------------
returnListOrSingleValue = Custom[ReturnListOrSingleValue](unknownItem=massFloor, seq=python_script)  # If the item in input #1 is not a list, only the first item of the list in input #2 will be returned.
mass = Output(returnListOrSingleValue)
