# Dynamo custom node Material.Assets.dyf (Dynamo 1.3.2.2480)
# category: Clockwork.Revit.Elements.Material.Query
# Retrieves all assets from a given material

Material = Input()
python_script = Python(IN[0]=Material)
# ---------- python_script.python (12 lines) ----------
import clr
clr.AddReference('RevitAPI')
from Autodesk.Revit.DB import *

mats = UnwrapElement(IN[0])

def GetMaterialAssets(material):
	if hasattr(material, "AppearanceAssetId"): return (material.Document.GetElement(material.AppearanceAssetId), material.Document.GetElement(material.ThermalAssetId), material.Document.GetElement(material.StructuralAssetId))
	else: return (None, None, None)

if isinstance(IN[0], list): OUT = map(list, zip(*[GetMaterialAssets(x) for x in mats]))
else: OUT = GetMaterialAssets(mats)
# ----------------------------------------
code_block = CodeBlock(seq=python_script) { seq[0]; seq[1]; seq[2]; }
AppearanceAsset = Output(code_block.out0)
ThermalAsset = Output(code_block.out1)
StructuralAsset = Output(code_block.out2)
