# Dynamo custom node Math.DecimalToBinary.dyf (Dynamo 1.3.1.1736)
# category: Clockwork.Core.Math.Actions
# Converts a number to a string of its binary value

decimal = Input(decimal : int)
turnIntoList = Custom[TurnIntoList](unknownItem=decimal)  # Turns an element (or a nested list) into a flat list
python_script = Python(IN[0]=turnIntoList)
# ---------- python_script.python (5 lines) ----------
vals = IN[0]
elementlist = []
for val in vals:
	elementlist.append(bin(val))
OUT = elementlist
# ----------------------------------------
returnListOrSingleValue = Custom[ReturnListOrSingleValue](unknownItem=decimal, seq=python_script)  # If the item in input #1 is not a list, only the first item of the list in input #2 will be returned.
binary = Output(returnListOrSingleValue)
