# Dynamo custom node Math.RandomIntegerList.dyf (Dynamo 1.3.0.875)
# category: Clockwork.Core.Math.Create
# Creates a list of random integers between 0 and a given maximum value

amount = Input(amount : int)
randomList = Math.RandomList(amount)
max = Input(max : int)
code_block = CodeBlock(max=max) { -0.499; max + 0.499; }
remapRange = Math.RemapRange(numbers=randomList, newMin=code_block.out0, newMax=code_block.out1)
round = Math.Round(remapRange)
floor = Math.Floor(round)
list = Output(floor)
