# Dynamo custom node Math.Similar.dyf (Dynamo 0.8.1.1823)
# category: Clockwork.Core.Math.Actions
# Computes the difference between two values and whether that difference is within a given tolerance factor

valA = Input(valA : double)
valB = Input(valB : double)
tolerance = Input(tolerance : double)
code_block = CodeBlock(a=valA, b=valB, t=tolerance) { Math.Abs(a-b); Math.Abs(1-a/b) <= t; }
isSimilar = Output(code_block.out1)
difference = Output(code_block.out0)
