# Dynamo custom node Mesh.FaceVertices.dyf (Dynamo 0.8.2.2392)
# category: Clockwork.Geometry.Mesh.Query
# Gets the vertices of each face of a given mesh

mesh = Input(mesh : DesignScript.Mesh)
code_block = CodeBlock(m=mesh)
# ---------- code_block.designscript (6 lines) ----------
vp = m.VertexPositions;
fi = m.FaceIndices;
a = List.GetItemAtIndex(vp,fi.A);
b = List.GetItemAtIndex(vp,fi.B);
c = List.GetItemAtIndex(vp,fi.C);
List.Transpose({a,b,c});
# ----------------------------------------
vertices = Output(code_block.out5)
