# Dynamo custom node Mesh.IntersectionWithPlane.dyf (Dynamo 0.8.2.2392)
# category: Clockwork.Geometry.Mesh.Actions
# Calculates the intersection of a mesh and a plane

plane = Input(plane : Plane)
mesh = Input(mesh : DesignScript.Mesh)
faceVertices = Custom[Mesh.FaceVertices](mesh=mesh)  # Gets the vertices of each face of a given mesh
closedLoopThroughPoints = Custom[Curve.ClosedLoopThroughPoints]()  # Creates a *closed* loop of curves based on a given list of points
# note: From Mesh to Curves
map = List.Map(list=faceVertices, f_x=closedLoopThroughPoints)
code_block = CodeBlock(p=plane, fv=faceVertices, lines=map)
# ---------- code_block.designscript (4 lines) ----------
axis1 = p.Normal;
axis2 = Plane.ByBestFitThroughPoints(Flatten(fv)).Normal;
// Find intersection points with plane
Flatten(lines.Intersect(p));
# ----------------------------------------
# note: Establish sorting direction based on general plane and mesh orientation
byTwoVectors = Custom[ThirdXYZAxis.ByTwoVectors](Axis1=code_block.axis1, Axis2=code_block.axis2)  # Given two main XYZ axes (or vectors pointing more or less in thei general direction), this node will find the third axis.
Y = Point.Y(lacing=Longest)
sortByKey = SortByKey(code_block.out2, Y)
Z = Point.Z(lacing=Longest)
sortByKey_2 = SortByKey(code_block.out2, Z)
X = Point.X(lacing=Longest)
sortByKey_3 = SortByKey(code_block.out2, X)
almostZero = Custom[Math.AlmostZero]()  # Returns a feasable computational tolerance to zero (1.0e-9 or a billionth of 1) for use in calculations. More background info: https://github.com/ikeough/Dynamo/issues/879
code_block_2 = CodeBlock(ax=byTwoVectors.str, ysort=sortByKey, zsort=sortByKey_2, xsort=sortByKey_3, tol=almostZero)
# ---------- code_block_2.designscript (11 lines) ----------
// Sort points according to computed sorting direction
cond1 = ax == "Y";
res = cond1 ? ysort : zsort;
cond2 = ax == "X";
plist1 = cond2 ? xsort : res;
// make a list of unique points
plist2 = plist1.PruneDuplicates(tol);
// output various line types
PolyCurve.ByPoints(plist2,false);
NurbsCurve.ByPoints(plist2);
NurbsCurve.ByControlPoints(plist2);
# ----------------------------------------
points = Output(code_block_2.plist2)
polyCurve = Output(code_block_2.out5)
nurbsCurveByPoints = Output(code_block_2.out6)
nurbsCurveByControlPoints = Output(code_block_2.out7)
