# Dynamo custom node ModelCurve.Type.dyf (Dynamo 1.0.0.1180)
# category: Clockwork.Revit.Elements.ModelCurve.Query
# Gets the type of a given model curve

modelCurve = Input()
turnIntoList = Custom[Turn Into List](unknownItem=modelCurve)  # Turns an element (or a nested list) into a flat list
python_script = Python(IN[0]=turnIntoList)
# ---------- python_script.python (12 lines) ----------
import clr
clr.AddReference('RevitAPI')
from Autodesk.Revit.DB import *

items = UnwrapElement(IN[0])
typelist = list()
for item in items:	
	try: 
		typelist.append(item.CurveElementType)
	except:
		typelist.append(list())
OUT = typelist
# ----------------------------------------
returnListOrSingleValue = Custom[ReturnListOrSingleValue](unknownItem=modelCurve, seq=python_script)  # If the item in input #1 is not a list, only the first item of the list in input #2 will be returned.
type = Output(returnListOrSingleValue)
