# Dynamo custom node Object.MembersByName.dyf (Dynamo 1.3.0.875)
# category: Clockwork.Core.Object.Query
# Looks up all the members of a given element based on a given name (or part of a name) of the property or method. Search is case-insensitive.

element = Input()
turnIntoList = Custom[Turn Into List](unknownItem=element)  # Turns an element (or a nested list) into a flat list
members = Custom[Object.Members](element=turnIntoList)  # Gets a list of all members (properties and methods) of a selected element
searchFor = Input(searchFor : string)
ignoreCase = Input(ignoreCase : bool = true)
contains = String.Contains(str=members, searchFor=searchFor, ignoreCase=ignoreCase)
filterByBoolMask = List.FilterByBoolMask(list=members, mask=contains)
returnListOrSingleValue = Custom[ReturnListOrSingleValue](unknownItem=element, seq=filterByBoolMask.in)  # If the item in input #1 is not a list, only the first item of the list in input #2 will be returned.
elements = Output(returnListOrSingleValue)
