# Dynamo custom node ParameterElement.SetAllowVaryBetweenGroups.dyf (Dynamo 1.3.3.4651)
# category: Clockwork.Revit.Elements.ParameterElement.Actions
# Lets you define whether or not the values of a given project parameter can vary across group members.

parameterElement = Input()
parameterElement_2 = Output(parameterElement)  # "parameterElement"
allow = Input(allow : bool = true)
python_script = Python(IN[0]=parameterElement, IN[1]=allow)
# ---------- python_script.python (27 lines) ----------
import clr
clr.AddReference('RevitAPI')
from Autodesk.Revit.DB import *

clr.AddReference("RevitServices")
import RevitServices
from RevitServices.Persistence import DocumentManager
from RevitServices.Transactions import TransactionManager

doc = DocumentManager.Instance.CurrentDBDocument
params = UnwrapElement(IN[0])

def AllowVaryBetweenGroups(param, bool):
	if hasattr(param, "GetDefinition"):
		intdef = param.GetDefinition()
		if hasattr(intdef, "SetAllowVaryBetweenGroups"):
			try: 
				intdef.SetAllowVaryBetweenGroups(doc, bool)
				return True
			except: return False
		else: return False
	else: return False

TransactionManager.Instance.EnsureInTransaction(doc)
if isinstance(IN[0], list): OUT = [AllowVaryBetweenGroups(x, IN[1]) for x in params]
else: OUT = AllowVaryBetweenGroups(params, IN[1])
TransactionManager.Instance.TransactionTaskDone()
# ----------------------------------------
success = Output(python_script)
