# Dynamo custom node PerspectiveView.OrientToEyeAndTargetPosition.dyf (Dynamo 0.8.2.2392)
# category: Clockwork.Revit.Views.PerspectiveView.Actions
# Sets the orientation of a given perspective view based on a given eye and target position

view = Input(view : PerspectiveView)
isLocked = Custom[View3D.IsLocked](view3d=view)  # Checks if a given view is locked
eyePosition = Input(eyePosition : Autodesk.Point)
targetPosition = Input(targetPosition : Autodesk.Point)
code_block = CodeBlock(epos=eyePosition, tpos=targetPosition)
# ---------- code_block.designscript (5 lines) ----------
v1 = Vector.ByTwoPoints(epos,tpos).Normalized();
zvec = Vector.ZAxis();
p3 = tpos.Add(zvec);
n = Plane.ByThreePoints(epos,tpos,p3).Normal;
v1.Rotate(n,90);
# ----------------------------------------
correctOrientation = Custom[Normal.CorrectOrientation](VectorA=code_block.out4, VectorB=code_block.zvec)  # Inverts normal A if its inversion is closer to normal B
python_script = Python(IN[0]=view, IN[1]=eyePosition, IN[2]=correctOrientation, IN[3]=code_block.v1)
# ---------- python_script.python (27 lines) ----------
import clr
clr.AddReference('RevitAPI')
from Autodesk.Revit.DB import *

clr.AddReference("RevitNodes")
import Revit
clr.ImportExtensions(Revit.Elements)
clr.ImportExtensions(Revit.GeometryConversion)

clr.AddReference("RevitServices")
import RevitServices
from RevitServices.Persistence import DocumentManager
from RevitServices.Transactions import TransactionManager

doc = DocumentManager.Instance.CurrentDBDocument
view = UnwrapElement(IN[0])
eyeposition = IN[1].ToXyz()
updirection = IN[2].ToXyz()
forwarddirection = IN[3].ToXyz()

TransactionManager.Instance.EnsureInTransaction(doc)
newVO = ViewOrientation3D(eyeposition, updirection, forwarddirection)
view.SetOrientation(newVO)
view.SaveOrientation()
TransactionManager.Instance.TransactionTaskDone()

OUT = view
# ----------------------------------------
code_block_2 = CodeBlock(islocked=isLocked, view=python_script) { islocked ? "The view is locked..." : view; }
View = Output(code_block_2)
