# Dynamo custom node PlanView.Underlay.dyf (Dynamo 1.3.1.1736)
# category: Clockwork.Revit.Views.PlanView.Query
# Returns the view template assigned to a given view (if one is assigned)

planView = Input()
turnIntoList = Custom[Turn Into List](unknownItem=planView)  # Turns an element (or a nested list) into a flat list
python_script = Python(IN[0]=turnIntoList)
# ---------- python_script.python (33 lines) ----------
import clr
clr.AddReference('RevitAPI')
from Autodesk.Revit.DB import *

views = UnwrapElement(IN[0])
baselvl = []
toplvl = []
ulOrientation = []

for view in views:
	# Revit 2016 R2 and later
	try:
		if view.GetUnderlayBaseLevel().IntegerValue == -1:
			baselvl.append(None)
		else:
			baselvl.append(view.Document.GetElement(view.GetUnderlayBaseLevel()))
		if view.GetUnderlayTopLevel().IntegerValue == -1:
			toplvl.append(None)
		else:
			toplvl.append(view.Document.GetElement(view.GetUnderlayTopLevel()))
		ulOrientation.append(str(view.GetUnderlayOrientation()))
	# anything before
	except:
		toplvl.append(None)
		ulOrientation.append(None)
		try:
			if view.get_Parameter(BuiltInParameter.VIEW_UNDERLAY_ID).AsElementId().IntegerValue == -1:
				baselvl.append(None)
			else:
				baselvl.append(view.Document.GetElement(view.get_Parameter(BuiltInParameter.VIEW_UNDERLAY_ID).AsElementId()))
		except:
			baselvl.append(None)
OUT = (baselvl,toplvl,ulOrientation)
# ----------------------------------------
code_block = CodeBlock(seq=python_script) { seq[0]; seq[1]; seq[2]; }
returnListOrSingleValue = Custom[ReturnListOrSingleValue](unknownItem=planView, seq=code_block.out0)  # If the item in input #1 is not a list, only the first item of the list in input #2 will be returned.
baseUnderlay = Output(returnListOrSingleValue)
returnListOrSingleValue_2 = Custom[ReturnListOrSingleValue](unknownItem=planView, seq=code_block.out1)
topUnderlay = Output(returnListOrSingleValue_2)
returnListOrSingleValue_3 = Custom[ReturnListOrSingleValue](unknownItem=planView, seq=code_block.out2)
underlayOrientation = Output(returnListOrSingleValue_3)
