# Dynamo custom node Plane.ByBestFitFromFace.dyf (Dynamo 1.3.0.875)
# category: Clockwork.Geometry.Plane.Create
# Creates a plane from face

surface = Input(surface : Surface)
vertices = Face.Vertices(surface)
pointGeometry = Vertex.PointGeometry(vertices)
byBestFitThroughPoints = Plane.ByBestFitThroughPoints(pointGeometry)
plane = Output(byBestFitThroughPoints)
