# Dynamo custom node Plane.IsCoplanarWithPlane.dyf (Dynamo 1.3.2.2480)
# category: Clockwork.Geometry.Plane.Query
# Checks if a given plane is coplanar with another plane

plane1 = Input(plane1 : Plane)
origin = Plane.Origin(plane1)
XAxis = Plane.XAxis(plane1)
plane2 = Input(plane2 : Plane)
isInPlane = Custom[Vector.IsInPlane](vectorBasePoint=origin, vector=XAxis, plane=plane2)  # Checks if a given vector is located on a given plane
bool = Output(isInPlane)
