# Dynamo custom node PointSequence.ContainsOutOfPlanePoints.dyf (Dynamo 0.8.2.2392)
# category: Clockwork.Geometry.PointSequence.Query
# Checks a list for XYZs that are not located on a given plane

seq = Input()
face_plane = Input()  # "face/plane"
isOutOfPlane = Custom[Point.IsOutOfPlane](face_plane=face_plane)  # Checks a list for XYZs that are not located on a given plane
map = List.Map(list=seq, f_x=isOutOfPlane.bool)
anyTrue = Custom[List.AnyTrue](seq=map)  # Returns true if any item in a list of booleans is true.
bool = Output(anyTrue)
map_2 = List.Map(list=seq, f_x=isOutOfPlane.amount)
code_block = CodeBlock(seq=map_2) { List.MaximumItem(seq); }
max = Output(code_block)
