# Dynamo custom node PointSequences.ShortestPath.dyf (Dynamo 0.8.2.2392)
# category: Clockwork.Geometry.PointSequence.Query
# Retrieves the shortest path from a number of point sequences

seq = Input()
accumulatedDistance = Custom[PointSequence.AccumulatedDistance]()  # Retrieves the accumulated distances of a sequence of points
map = List.Map(list=seq, f_x=accumulatedDistance)
code_block = CodeBlock(seq=map) { List.MinimumItem(seq); }
distance = Output(code_block)
formula = Formula("x=y", code_block, map, lacing=Longest)
bool = Output(formula)
