# Dynamo custom node RevisionCloud.FromElements.dyf (Dynamo 1.3.4.6666)
# category: Clockwork.Revit.Elements.RevisionCloud.Create
# Create a revision cloud for a list of Revit elements

view = Input()
elements = Input()
boundingBox = Element.BoundingBox(elements)
fromBoundingBoxes = Custom[BoundingBox.ByElements](boundingBoxes=boundingBox)  # "BoundingBox.FromBoundingBoxes"; Retrieves a bounding box for a list of elements
plane = Custom[View.Plane](view=view)  # Retrieves the plane of a given view
normal = Plane.Normal(plane)
perimeterCurvesByNormal = Custom[BoundingBox.PerimeterCurvesByNormal](boundingbox=fromBoundingBoxes, normal=normal)  # Returns the perimeter curve of a bounding box on a plane determined by a given normal and the centroid of the bounding box
revision = Input()
byCurve = RevisionCloud.ByCurve(view, perimeterCurvesByNormal, revision)
revisionCloud = Output(byCurve)
