# Dynamo custom node RevitBoundingBox.FromDynamoBoundingBox.dyf (Dynamo 1.3.1.1736)
# category: Clockwork.Revit.Elements.BoundingBox.Create
# Turns a Dynamo bounding box into a Revit bounding box.

DynamoBoundingBox = Input(DynamoBoundingBox : BoundingBox)
turnIntoList = Custom[Turn Into List](unknownItem=DynamoBoundingBox)  # Turns an element (or a nested list) into a flat list
minPoint = BoundingBox.MinPoint(turnIntoList)
maxPoint = BoundingBox.MaxPoint(turnIntoList)
python_script = Python(IN[0]=minPoint, IN[1]=maxPoint)
# ---------- python_script.python (33 lines) ----------
import clr
clr.AddReference('RevitAPI')
from Autodesk.Revit.DB import *

clr.AddReference("RevitNodes")
import Revit
clr.ImportExtensions(Revit.GeometryConversion)

clr.AddReference("RevitServices")
import RevitServices
from RevitServices.Persistence import DocumentManager
from RevitServices.Transactions import TransactionManager

doc = DocumentManager.Instance.CurrentDBDocument
minp = [x.ToXyz() for x in IN[0]]
maxp = [x.ToXyz() for x in IN[1]]
counter = 0
elementlist = list()
failedlist = list()

TransactionManager.Instance.EnsureInTransaction(doc)
for newmin in minp:
	try:
		newbox = BoundingBoxXYZ()
		newbox.Max = maxp[counter]
		newbox.Min = newmin
		elementlist.append(newbox)
	except:
		elementlist.append(list())
	counter += 1
TransactionManager.Instance.TransactionTaskDone()

OUT = elementlist
# ----------------------------------------
returnListOrSingleValue = Custom[ReturnListOrSingleValue](unknownItem=DynamoBoundingBox, seq=python_script)  # If the item in input #1 is not a list, only the first item of the list in input #2 will be returned.
RevitBoundingBox = Output(returnListOrSingleValue)
