# Dynamo custom node RevitColor.FromDynamoColor.dyf (Dynamo 1.3.1.1736)
# category: Clockwork.Revit.Elements.Color.Create
# Creates a Revit color from a Dynamo color

DynamoColor = Input(DynamoColor : DSCore.Color)
turnIntoList = Custom[Turn Into List](unknownItem=DynamoColor)  # Turns an element (or a nested list) into a flat list
red = Color.Red(turnIntoList)
green = Color.Green(turnIntoList)
blue = Color.Blue(turnIntoList)
python_script = Python(IN[0]=red, IN[1]=green, IN[2]=blue)
# ---------- python_script.python (29 lines) ----------
import clr
clr.AddReference('RevitAPI')
from Autodesk.Revit.DB import *
from Autodesk.Revit import *

clr.AddReference("RevitServices")
import RevitServices
from RevitServices.Persistence import DocumentManager
from RevitServices.Transactions import TransactionManager

doc = DocumentManager.Instance.CurrentDBDocument
appcreation = Creation.Application
r = IN[0]
g = IN[1]
b = IN[2]
counter = 0
elementlist = list()

TransactionManager.Instance.EnsureInTransaction(doc)
for red in r:
	try:
		newcolor = Color(red,g[counter],b[counter])
		elementlist.append(newcolor)
	except:
		elementlist.append(None)
	counter += 1
TransactionManager.Instance.TransactionTaskDone()

OUT = elementlist
# ----------------------------------------
returnListOrSingleValue = Custom[ReturnListOrSingleValue](unknownItem=DynamoColor, seq=python_script)  # If the item in input #1 is not a list, only the first item of the list in input #2 will be returned.
RevitColor = Output(returnListOrSingleValue)
