# Dynamo custom node RevitColor.ToDynamoColor.dyf (Dynamo 1.3.1.1736)
# category: Clockwork.Revit.Elements.Color.Query
# Converts Revit colors into Dynamo colors

RevitColor = Input()
turnIntoList = Custom[Turn Into List](unknownItem=RevitColor)  # Turns an element (or a nested list) into a flat list
python_script = Python(IN[0]=turnIntoList)
# ---------- python_script.python (14 lines) ----------
import clr
clr.AddReference('RevitAPI')
from Autodesk.Revit.DB import *

colors = UnwrapElement(IN[0])
rlist = list()
glist = list()
blist = list()

for color in colors:
	rlist.append(color.Red)
	glist.append(color.Green)
	blist.append(color.Blue)
OUT = (rlist,glist,blist)
# ----------------------------------------
code_block = CodeBlock(seq=python_script) { 255; seq[0]; seq[1]; seq[2]; }
byARGB = Color.ByARGB(a=code_block.out0, r=code_block.out1, g=code_block.out2, b=code_block.out3)
returnListOrSingleValue = Custom[ReturnListOrSingleValue](unknownItem=RevitColor, seq=byARGB)  # If the item in input #1 is not a list, only the first item of the list in input #2 will be returned.
DynamoColor = Output(returnListOrSingleValue)
