# Dynamo custom node RevitLinkType.AttachmentType.dyf (Dynamo 1.3.4.6666)
# category: Clockwork.Revit.Elements.RevitLinkType.Query
# Returns the attachment type of a RevitLInkType

revitLinkType = Input(revitLinkType: var[]..[])
python_script = Python(IN[0]=revitLinkType)
# ---------- python_script.python (12 lines) ----------
import clr
clr.AddReference('RevitAPI')
from Autodesk.Revit.DB import *

links = UnwrapElement(IN[0])

def GetAttachmentType(link):
	if hasattr(link, "AttachmentType"): return link.AttachmentType.ToString()
	else: return None

if isinstance(IN[0], list): OUT = [GetAttachmentType(x) for x in links]
else: OUT = GetAttachmentType(links)
# ----------------------------------------
str = Output(python_script)
