# Dynamo custom node RevitLinkType.Reload.dyf (Dynamo 1.3.0.875)
# category: Clockwork.Revit.Elements.RevitLinkType.Actions
# Reloads a Revit or IFC link.

revitLinkType = Input()
turnIntoList = Custom[TurnIntoList](unknownItem=revitLinkType)  # Turns an element (or a nested list) into a flat list
python_script = Python(IN[0]=turnIntoList)
# ---------- python_script.python (29 lines) ----------
import clr
clr.AddReference('RevitAPI')
from Autodesk.Revit.DB import *

clr.AddReference("RevitNodes")
import Revit
clr.ImportExtensions(Revit.Elements)

clr.AddReference("RevitServices")
import RevitServices
from RevitServices.Persistence import DocumentManager
from RevitServices.Transactions import TransactionManager

doc = DocumentManager.Instance.CurrentDBDocument
linktypes = UnwrapElement(IN[0])
booleans = list()

TransactionManager.Instance.ForceCloseTransaction()
for link in linktypes:
	if link.LocallyUnloaded:
		link.RevertLocalUnloadStatus()
	else:
		link.Reload()
	try:
		
		booleans.append(True)
	except:
		booleans.append(False)
OUT = (linktypes, booleans)
# ----------------------------------------
code_block = CodeBlock(seq=python_script) { seq[0]; seq[1]; }
returnListOrSingleValue = Custom[ReturnListOrSingleValue](unknownItem=revitLinkType, seq=code_block.out0)  # If the unknown item is not a list but rather a single item, only the first item of the list (input "seq") will be returned.
revitLinkType_2 = Output(returnListOrSingleValue)  # "revitLinkType"
returnListOrSingleValue_2 = Custom[ReturnListOrSingleValue](unknownItem=revitLinkType, seq=code_block.out1)
success = Output(returnListOrSingleValue_2)
