# Dynamo custom node Roof.SlabShapeByPoints.dyf (Dynamo 1.3.1.1736)
# category: Clockwork.Revit.Elements.Roof.Actions
# Transform a slab shape based on a list of Points.

points = Input(points : Autodesk.Point[])
turnIntoList = Custom[Turn Into List](unknownItem=points)  # Turns an element (or a nested list) into a flat list
roof = Input()
python_script = Python(IN[0]=turnIntoList, IN[1]=roof)
# ---------- python_script.python (27 lines) ----------
import clr
clr.AddReference('RevitAPI')
from Autodesk.Revit.DB import *

clr.AddReference("RevitNodes")
import Revit
clr.ImportExtensions(Revit.GeometryConversion)

clr.AddReference("RevitServices")
import RevitServices
from RevitServices.Persistence import DocumentManager
from RevitServices.Transactions import TransactionManager

doc = DocumentManager.Instance.CurrentDBDocument
xyzs = IN[0]
slabshape = UnwrapElement(IN[1])
booleans = []

TransactionManager.Instance.EnsureInTransaction(doc)
for item in xyzs:
	try:
		slabshape.SlabShapeEditor.DrawPoint(item.ToXyz())
		booleans.append(True)
	except: booleans.append(False)
TransactionManager.Instance.TransactionTaskDone()

OUT = (slabshape,booleans)
# ----------------------------------------
firstItem = List.FirstItem(python_script)
roof_2 = Output(firstItem)  # "roof"
lastItem = List.LastItem(python_script)
success = Output(lastItem)
