# Dynamo custom node Room.Boundaries.dyf (Dynamo 1.0.0.1180)
# category: Clockwork.Revit.Elements.Room.Query
# Gets a list of all boundary elements of a given room or area

room = Input()
filterByBoolMask = List.FilterByBoolMask()
turnIntoList = Custom[Turn Into List](unknownItem=room)  # Turns an element (or a nested list) into a flat list
version = Custom[Application.Version]()  # Retrieves the name, version and build of the current Revit application.
python_script = Python(IN[0]=turnIntoList, IN[1]=version.Version_int)
# ---------- python_script.python (50 lines) ----------
import clr
clr.AddReference('RevitAPI')
from Autodesk.Revit.DB import *
import Autodesk

clr.AddReference("RevitNodes")
import Revit
clr.ImportExtensions(Revit.GeometryConversion)

items = UnwrapElement(IN[0])
version = IN[1]
elementlist = []
curvelist = []
facelist = []

for item in items:
	doc = item.Document
	calculator = SpatialElementGeometryCalculator(doc)
	options = Autodesk.Revit.DB.SpatialElementBoundaryOptions()
	# get boundary location from area computation settings
	boundloc = Autodesk.Revit.DB.AreaVolumeSettings.GetAreaVolumeSettings(doc).GetSpatialElementBoundaryLocation(SpatialElementType.Room)
	options.SpatialElementBoundaryLocation = boundloc
	#method #1 - get boundary segments
	blist = []
	clist = []
	try:
		for boundarylist in item.GetBoundarySegments(options):
			for boundary in boundarylist:
				blist.append(doc.GetElement(boundary.ElementId))
				if version > 2016:
					clist.append(boundary.GetCurve().ToProtoType())
				else:
					clist.append(boundary.Curve.ToProtoType())
	except:
		pass
	#method #2 - spatial element geometry calculator
	flist = []
	try:
		results = calculator.CalculateSpatialElementGeometry(item)
		for face in results.GetGeometry().Faces:
			for bface in results.GetBoundaryFaceInfo(face):
				blist.append(doc.GetElement(bface.SpatialBoundaryElement.HostElementId))
				flist.append(bface.GetBoundingElementFace())
	except:
		pass	
	# write results to list
	elementlist.append(blist)
	curvelist.append(clist)
	facelist.append(flist)
OUT = (elementlist,curvelist,facelist)
# ----------------------------------------
code_block = CodeBlock(seq=python_script) { seq[0]; seq[1]; seq[2]; }
isNull = Object.IsNull()
map = List.Map(list=code_block.out0, f_x=isNull)
combine = List.Combine(filterByBoolMask.out, code_block.out0, map)
uniqueItems = List.UniqueItems()
map_2 = List.Map(list=combine, f_x=uniqueItems)
returnListOrSingleValue = Custom[ReturnListOrSingleValue](unknownItem=room, seq=map_2)  # If the item in input #1 is not a list, only the first item of the list in input #2 will be returned.
elements = Output(returnListOrSingleValue)
returnListOrSingleValue_2 = Custom[ReturnListOrSingleValue](unknownItem=room, seq=code_block.out1)
curves = Output(returnListOrSingleValue_2)
returnListOrSingleValue_3 = Custom[ReturnListOrSingleValue](unknownItem=room, seq=code_block.out2)
revitFaces = Output(returnListOrSingleValue_3)
