# Dynamo custom node Room.InsertsOfBoundariesByCategory.dyf (Dynamo 1.3.4.6666)
# category: Clockwork.Revit.Elements.Room.Query
# Retrieves the inserts of the bounding elements of a given room - filtered by a given category.

filterByBoolMask = List.FilterByBoolMask()  # unwired: list, mask
room = Input()
includeOpenings = Input(includeOpenings : bool = false)
includeShadows = Input(includeShadows : bool = false)
includeEmbeddedWalls = Input(includeEmbeddedWalls : bool = false)
includeSharedEmbeddedInserts = Input(includeSharedEmbeddedInserts : bool = false)
insertsOfBoundaries = Custom[Room.InsertsOfBoundaries](room=room, includeOpenings=includeOpenings, includeShadows=includeShadows, includeEmbeddedWalls=includeEmbeddedWalls, includeSharedEmbeddedInserts=includeSharedEmbeddedInserts)  # Retrieves the inserts of the bounding elements of a given room.
category = Input(category : var[]..[])  # Works with categories, BuiltInCategories and BuiltInCategories as strings
isOfCategory = Custom[Element.IsOfCategory](category=category)  # Checks whether an element is of a specified category; unwired: element
map = List.Map(list=insertsOfBoundaries, f_x=isOfCategory)
combine = List.Combine(filterByBoolMask.in, insertsOfBoundaries, map)
inserts = Output(combine)
