# Dynamo custom node Room.IsUnbounded.dyf (Dynamo 1.0.0.1180)
# category: Clockwork.Revit.Elements.Room.Query
# Checks whether a room is unbounded.

room = Input()
turnIntoList = Custom[Turn Into List](unknownItem=room)  # Turns an element (or a nested list) into a flat list
area = Custom[Element.Area](element=turnIntoList)  # Returns the area property of a given element (if that element has such a property)
code_block = CodeBlock(area=area) { area == 0; }
returnListOrSingleValue = Custom[ReturnListOrSingleValue](unknownItem=room, seq=code_block)  # If the item in input #1 is not a list, only the first item of the list in input #2 will be returned.
bool = Output(returnListOrSingleValue)
