# Dynamo custom node Room.State.dyf (Dynamo 1.3.3.4651)
# category: Clockwork.Revit.Elements.Room.Query
# Returns the state of a room, i.e. is it placed, unplaced, redundant or not enclosed.

room = Input()
location = Room.Location(room)
isNull = Object.IsNull(location)
not_ = Not(isNull)
area = Room.Area(room)
code_block = CodeBlock(area=area) { area > 0; }
boundaries = Custom[Room.Boundaries](room=room)  # Gets a list of all boundary elements of a given room or area
isEmpty = List.IsEmpty(boundaries.curves@L2)
not_2 = Not(isEmpty)
create = List.Create(not_, code_block, not_2)
transpose = List.Transpose(create)
binaryFromBooleans = Custom[String.BinaryFromBooleans](booleans=transpose)  # Creates a binary string from a list of booleans
string = StringInput("""111
000
100
110
101""")
string_2 = StringInput("""Placed
Unplaced
Not enclosed
Not enclosed
Redundant""")
create_2 = List.Create(string, string_2)
string_3 = StringInput("\n")
split = String.Split(create_2, string_3)
firstItem = List.FirstItem(split)
lastItem = List.LastItem(split)
matchWithKeyValues = Custom[List.MatchWithKeyValues](seq=binaryFromBooleans, keys=firstItem, values=lastItem)  # Matches a list with a given set of keys and returns the values corresponding to the keys
state = Output(matchWithKeyValues)
