# Dynamo custom node Room.UnplacedByNameAndNumber.dyf (Dynamo 1.3.1.1736)
# category: Clockwork.Revit.Elements.Room.Create
# Creates an unplaced room

name = Input(name : string)
turnIntoList = Custom[Turn Into List](unknownItem=name)  # Turns an element (or a nested list) into a flat list
number = Input(number : string)
turnIntoList_2 = Custom[Turn Into List](unknownItem=number)
phase = Input(phase : var = null)  # If no phase is specified, the node will use the last phase in the project
isNull = Object.IsNull(phase)
phases = Custom[Document.Phases]()  # Retrieves all phases in the active document in *chronological* order
lastItem = List.LastItem(phases)
scopeIf = Custom[ScopeIf+](test=isNull, true=lastItem, false=phase)  # A (hopefully) more robust implementation of ScopeIf. Tests a single boolean and returns a value accordingly.
python_script = Python(IN[0]=turnIntoList, IN[1]=turnIntoList_2, IN[2]=scopeIf)
# ---------- python_script.python (29 lines) ----------
import clr
clr.AddReference('RevitAPI')
from Autodesk.Revit.DB import *

clr.AddReference("RevitServices")
import RevitServices
from RevitServices.Persistence import DocumentManager
from RevitServices.Transactions import TransactionManager

doc = DocumentManager.Instance.CurrentDBDocument
doccreation = doc.Create
names = IN[0]
numbers = IN[1]
phase = UnwrapElement(IN[2])
counter = 0
elementlist = list()

TransactionManager.Instance.EnsureInTransaction(doc)
for name in names:
	try:
		newroom = doccreation.NewRoom(phase)
		newroom.Name = name
		newroom.Number = numbers[counter]
		elementlist.append(newroom)
	except: elementlist.append(None)
	counter += 1
TransactionManager.Instance.TransactionTaskDone()

OUT = elementlist
# ----------------------------------------
returnListOrSingleValue = Custom[ReturnListOrSingleValue](unknownItem=name, seq=python_script)  # If the item in input #1 is not a list, only the first item of the list in input #2 will be returned.
room = Output(returnListOrSingleValue)
