# Dynamo custom node Schedule.KeyScheduleParameterName.dyf (Dynamo 1.0.0.1180)
# category: Clockwork.Revit.Elements.Schedule.Query
# If the schedule is a key schedule, the node returns the name of the key schedule parameter.

schedule = Input()
turnIntoList = Custom[Turn Into List](unknownItem=schedule)  # Turns an element (or a nested list) into a flat list
python_script = Python(IN[0]=turnIntoList)
# ---------- python_script.python (16 lines) ----------
import clr
clr.AddReference('RevitAPI')
from Autodesk.Revit.DB import *

clr.AddReference("RevitNodes")
import Revit
clr.ImportExtensions(Revit.Elements)

scheds = UnwrapElement(IN[0])
elementlist = list()
for item in scheds:
	try:
		elementlist.append(item.KeyScheduleParameterName)
	except:
		elementlist.append(None)	
OUT = elementlist
# ----------------------------------------
returnListOrSingleValue = Custom[ReturnListOrSingleValue](unknownItem=schedule, seq=python_script)  # If the item in input #1 is not a list, only the first item of the list in input #2 will be returned.
parameterName = Output(returnListOrSingleValue)
