# Dynamo custom node ScopeIf+.dyf (Dynamo 1.3.0.875)
# category: Clockwork.Core.Logic.Actions
# A (hopefully) more robust implementation of ScopeIf. Tests a single boolean and returns a value accordingly.

true = Input()
false = Input()
test = Input()
code_block = CodeBlock(true, false, test) { result[0] = trueval; result[1] = falseval; result[test ? 0 : 1]; }
result = Output(code_block.out2)
