# Dynamo custom node SharedParameterElement.GUID.dyf (Dynamo 1.3.4.6666)
# category: Clockwork.Revit.Elements.SharedParameterElement.Query
# Returns the GUID of a shared parameter

sharedParameterElement = Input()
python_script = Python(IN[0]=sharedParameterElement)
# ---------- python_script.python (12 lines) ----------
import clr
clr.AddReference('RevitAPI')
from Autodesk.Revit.DB import *

def GetParamGUID(param):
	if hasattr(param, "GuidValue"): return param.GuidValue.ToString()
	else: return None
	
params = UnwrapElement(IN[0])

if isinstance(IN[0], list): OUT = [GetParamGUID(x) for x in params]
else: OUT = GetParamGUID(params)
# ----------------------------------------
guid = Output(python_script)
