# Dynamo custom node SpotCoordinate.ByPoint.dyf (Dynamo 1.3.3.4651)
# category: Clockwork.Revit.Elements.SpotCoordinate.Create
# Places a spot coordinate at a given point in a given view. May not work in all view types.

view = Input(view : Elements.View)
turnIntoList = Custom[TurnIntoList](unknownItem=view)  # Turns an element (or a nested list) into a flat list
point = Input(point : Point)
turnIntoList_2 = Custom[TurnIntoList](unknownItem=point)
bend = Input(bend : Vector)
end = Input(end : Vector)
hasLeader = Input(hasLeader : bool = false)
default3DView = Custom[Document.Default3DView]()  # Returns the default view of the current model (if there is such a view)
direction = Custom[View.Direction](view=turnIntoList)  # Returns the direction of a view
reverse = Vector.Reverse(direction)
python_script = Python(IN[0]=turnIntoList, IN[1]=turnIntoList_2, IN[2]=bend, IN[3]=end, IN[4]=hasLeader, IN[5]=default3DView, IN[6]=reverse)
# ---------- python_script.python (39 lines) ----------
import clr
clr.AddReference('RevitAPI')
from Autodesk.Revit.DB import *

clr.AddReference("RevitNodes")
import Revit
clr.ImportExtensions(Revit.GeometryConversion)

clr.AddReference("RevitServices")
import RevitServices
from RevitServices.Persistence import DocumentManager
from RevitServices.Transactions import TransactionManager

doc = DocumentManager.Instance.CurrentDBDocument
views = UnwrapElement(IN[0])
pts = UnwrapElement(IN[1])
bend = UnwrapElement(IN[2])
end = UnwrapElement(IN[3])
leader = UnwrapElement(IN[4])
isoview = UnwrapElement(IN[5])
intsecvec = UnwrapElement(IN[6])
elementlist = []

i = 0;
TransactionManager.Instance.EnsureInTransaction(doc)
for pt in pts:
	view = views[i]
	pt = pt.ToXyz()
	refintsec = ReferenceIntersector(isoview)
	refintsec.TargetType = FindReferenceTarget.Face
	try:
		ref = refintsec.FindNearest(pt,intsecvec[i].AsPoint().ToXyz()).GetReference()
		elementlist.append(doc.Create.NewSpotCoordinate(view, ref, pt, pt.Add(bend.AsPoint().ToXyz()), pt.Add(end.AsPoint().ToXyz()), pt, leader))
	except:
		elementlist.append(None)
	i += 1
TransactionManager.Instance.TransactionTaskDone()

OUT = elementlist
# ----------------------------------------
spotCoordinate = Output(python_script)
