# Dynamo custom node String.BinaryToDecimal.dyf (Dynamo 1.3.1.1736)
# category: Clockwork.Core.String.Actions
# Converts a string of a binary number into a decimal value

binary = Input(binary : string)
turnIntoList = Custom[TurnIntoList](unknownItem=binary)  # Turns an element (or a nested list) into a flat list
python_script = Python(IN[0]=turnIntoList)
# ---------- python_script.python (5 lines) ----------
binstr = IN[0]
elementlist = []
for bin in binstr:
	elementlist.append(int(bin,2))
OUT = elementlist
# ----------------------------------------
returnListOrSingleValue = Custom[ReturnListOrSingleValue](unknownItem=binary, seq=python_script)  # If the item in input #1 is not a list, only the first item of the list in input #2 will be returned.
decimal = Output(returnListOrSingleValue)
