# Dynamo custom node String.ContainsRegularExpression.dyf (Dynamo 1.3.1.1736)
# category: Clockwork.Core.String.Actions
# Determines if a regular expression matches a string (or a list of strings), i.e. occurs anywhere in the string, and returns a boolean value (or a list, depending on the input). The syntax for regular expressions is explained at
# http://ironpython-test.readthedocs.org/en/latest/howto/regex.html

str = Input(str : string)
RegEx = Input(RegEx : string)
ignoreCase = Input(ignoreCase : bool = false)  # Perform case-insensitive matching
useLocale = Input(useLocale : bool = false)  # Treat special characters (e.g. 'ü') from the currently set system locale as letters
dotAll = Input(dotAll : bool = false)  # Make . match any character, including newlines
multilineMatching = Input(multilineMatching : bool = false)  # ^ matches at the beginning of each line, $ matches at the end of each line
compileRegularExpression = Custom[String.CompileRegularExpression](regExp=RegEx, ignoreCase=ignoreCase, useLocale=useLocale, dotAll=dotAll, multilineMatching=multilineMatching)  # This is a helper node for setting certain flags for the Regular Expresssion nodes. http://ironpython-test.readthedocs.org/en/latest/howto/regex.html
turnIntoList = Custom[Turn Into List](unknownItem=str)  # Turns an element (or a nested list) into a flat list
python_script = Python(IN[0]=compileRegularExpression, IN[1]=turnIntoList)
# ---------- python_script.python (12 lines) ----------
import clr
import re

thisexp = IN[0]
regexlist = IN[1]
elementlist = list()
for item in regexlist:
	if (str(thisexp.search(item)) == 'None'):
		elementlist.append(False)
	else:
		elementlist.append(True)
OUT = elementlist
# ----------------------------------------
returnListOrSingleValue = Custom[ReturnListOrSingleValue](unknownItem=str, seq=python_script)  # If the item in input #1 is not a list, only the first item of the list in input #2 will be returned.
bool = Output(returnListOrSingleValue)
