# Dynamo custom node StructuralFoundation.Kind.dyf (Dynamo 1.3.1.1736)
# category: Clockwork.Revit.Elements.StructuralFoundation.Query
# Retrieves the kind of a given structural foundation (isolated, wall, slab).

structuralFoundation = Input()
turnIntoList = Custom[Turn Into List](unknownItem=structuralFoundation)  # Turns an element (or a nested list) into a flat list
python_script = Python(IN[0]=turnIntoList)
# ---------- python_script.python (15 lines) ----------
import clr
clr.AddReference('RevitAPI')
from Autodesk.Revit.DB import *

foundinstances = UnwrapElement(IN[0])
kindlist = list()
for item in foundinstances:
	try:
		if item.GetType().Name == 'FamilyInstance': kindlist.append('Isolated')
		elif item.GetType().Name == 'WallFoundation': kindlist.append('Wall Footing')
		elif item.GetType().Name == 'Floor': kindlist.append('Slab')
		else: kindlist.append(None)
	except:
		kindlist.append(None)
OUT = kindlist
# ----------------------------------------
returnListOrSingleValue = Custom[ReturnListOrSingleValue](unknownItem=structuralFoundation, seq=python_script)  # If the item in input #1 is not a list, only the first item of the list in input #2 will be returned.
kind = Output(returnListOrSingleValue)
