# Dynamo custom node System.Version.dyf (Dynamo 1.3.1.1736)
# category: Clockwork.Core.System.Query
# Returns the Windows version

python_script = Python()
# ---------- python_script.python (8 lines) ----------
import clr
from System import Environment, Version
OSnames = ["Windows XP","Windows Vista","Windows 7","Windows 8.1","Windows 10"]
OSversions = [Version(5,1,2600),Version(6,0,6000),Version(6,1,7600),Version(6,3,9600),Version(10,0,10240)]
for OSname, OSversion in zip(OSnames, OSversions):
	if Environment.OSVersion.Version.CompareTo(OSversion) >= 0:
		thisOS = OSname
OUT = (thisOS,Environment.OSVersion.Version.ToString(),Environment.OSVersion.ServicePack)
# ----------------------------------------
code_block = CodeBlock(seq=python_script)
# ---------- code_block.designscript (6 lines) ----------
// Version Name
seq[0];
// Version Number
seq[1];
// Service Pack
seq[2];
# ----------------------------------------
versionName = Output(code_block.out0)
versionNumber = Output(code_block.out1)
servicePack = Output(code_block.out2)
