# Dynamo custom node TextElement.Text.dyf (Dynamo 0.8.2.2392)
# category: Clockwork.Revit.Elements.TextElement.Query
# Gets the text stored in a text element (i.e. text note or model text)

element = Input()
turnIntoList = Custom[Turn Into List](element)  # Turns an element (or a nested list) into a flat list
python_script = Python(IN[0]=turnIntoList)
# ---------- python_script.python (12 lines) ----------
import clr
clr.AddReference('RevitAPI')
from Autodesk.Revit.DB import *

textnotes = UnwrapElement(IN[0])
elementlist = list()
for item in textnotes:
	try:
		elementlist.append(item.Text)
	except:
		elementlist.append(list())
OUT = elementlist
# ----------------------------------------
returnListOrSingleValue = Custom[ReturnListOrSingleValue](unknownItem=element, seq=python_script)  # If the item in input #1 is not a list, only the first item of the list in input #2 will be returned.
str = Output(returnListOrSingleValue)
