# Dynamo custom node ThirdXYZAxis.ByTwoVectors.dyf (Dynamo 0.8.2.2392)
# category: Clockwork.Geometry.Vector.Create
# Given two main XYZ axes (or vectors pointing more or less in thei general direction), this node will find the third axis.

Axis1 = Input(Axis1 : Vector)
fromVector = Custom[XYZAxis.FromVector](vector=Axis1)  # Returns whichever main axis (X, Y or Z) is closest to a given vector
Axis2 = Input(Axis2 : Vector)
fromVector_2 = Custom[XYZAxis.FromVector](vector=Axis2)
best_fit_plane = CodeBlock(axis1=fromVector, axis2=fromVector_2)
# ---------- best_fit_plane.designscript (10 lines) ----------
XYZs = {Autodesk.Point.Origin(),axis1.AsPoint(),axis2.AsPoint()};
// Make a plane based on the given axes and the origin
pl = Plane.ByBestFitThroughPoints(XYZs);
// The normal of that plane is the vector of the third axis
vec = pl.Normal;
Vector.ByCoordinates(1,1,1).Normalized();
// Set up a nested condition and find the main direction of the vector
cond1 = Math.Abs(vec.Y) > Math.Abs(vec.X) && Math.Abs(vec.Y) > Math.Abs(vec.Z);
cond2 = Math.Abs(vec.X) > Math.Abs(vec.Y) && Math.Abs(vec.X) > Math.Abs(vec.Z);
cond2 ? "X" : (cond1 ? "Y" : "Z");
# ----------------------------------------
correctOrientation = Custom[Normal.CorrectOrientation](VectorA=best_fit_plane.vec, VectorB=best_fit_plane.out3)  # Inverts normal A if its inversion is closer to normal B
vector = Output(correctOrientation)
str = Output(best_fit_plane.out6)
