# Dynamo custom node Time.EvaluateLapTimes.dyf (Dynamo 1.3.0.875)
# category: Clockwork.Core.Time.Query
# Evaluates a list of lap times and returns the overall time

LapTimes = Input(LapTimes : double[])
restOfItems = List.RestOfItems(LapTimes)
dropLastItem = Custom[List.DropLastItem](list=LapTimes)  # Drops the last item from a given list.
code_block = CodeBlock(n1=restOfItems, n2=dropLastItem) { n1 - n2; }
NetLapTimes = Output(code_block)
sum = Math.Sum(code_block)
OverallTime = Output(sum)
