# Dynamo custom node Time.LapTime.dyf (Dynamo 1.0.0.1180)
# category: Clockwork.Core.Time.Query
# Records a timestamp and adds it to a given list of lap times. Also passes through an arbitrary variable for integration into a graph.

LapTimes = Input(LapTimes : double[] = List.Empty)
Passthrough = Input()
rerunToggle = Input(rerunToggle : bool = false)
python_script = Python(IN[0]=LapTimes, IN[1]=Passthrough, IN[2]=rerunToggle)
# ---------- python_script.python (8 lines) ----------
import time

times = IN[0]
passthrough = IN[1]

times.append(time.time())

OUT = (times,passthrough)
# ----------------------------------------
code_block = CodeBlock(seq=python_script) { seq[0]; seq[1]; }
LapTimes_2 = Output(code_block.out0)  # "LapTimes"
Passthrough_2 = Output(code_block.out1)  # "Passthrough"
