# Dynamo custom node Topography.IntersectionWithPlane.dyf (Dynamo 0.8.2.2392)
# category: Clockwork.Revit.Elements.Topography.Actions
# Calculates the intersection of a toposurface and a plane

plane = Input(plane : Plane)
topo = Input(topo : Topography)
code_block = CodeBlock(topo=topo) { topo.Mesh; }
intersectionWithPlane = Custom[Mesh.IntersectionWithPlane](plane=plane, mesh=code_block)  # Calculates the intersection of a mesh and a plane
points = Output(intersectionWithPlane.points)
polyCurve = Output(intersectionWithPlane.polyCurve)
nurbsCurveByPoints = Output(intersectionWithPlane.nurbsCurveByPoints)
nurbsCurveByControlPoints = Output(intersectionWithPlane.nurbsCurveByControlPoints)
