# Dynamo custom node UV.ConvexHull2D.dyf (Dynamo 0.8.1.1693)
# category: Clockwork.Geometry.UV.Actions
# Computes the convex hull of a given set of UV coordinates based on the monotone chain algorithm

UVs = Input(UVs : UV[])
code_block = CodeBlock(uvlist1=UVs) { List.Transpose({uvlist1.U,uvlist1.V}); }
python_script = Python(IN[0]=code_block)
# ---------- python_script.python (30 lines) ----------
import clr

# based on a script found here:
# http://en.wikibooks.org/wiki/Algorithm_Implementation/Geometry/Convex_hull/Monotone_chain#Python

points = IN[0]
#reformat points list
newpoints = list()
for pair in points:
	newpoint = (pair[0],pair[1])
	newpoints.append(newpoint)
points = sorted(set(newpoints))

def cross(o, a, b):
	return (a[0] - o[0]) * (b[1] - o[1]) - (a[1] - o[1]) * (b[0] - o[0])
 
if len(points) <= 1:
	OUT = points
else:
	lower = []
	for p in points:
		while len(lower) >= 2 and cross(lower[-2], lower[-1], p) <= 0:
			lower.pop()
		lower.append(p)
	upper = []
	for p in reversed(points):
		while len(upper) >= 2 and cross(upper[-2], upper[-1], p) <= 0:
			upper.pop()
		upper.append(p)
	OUT = lower[:-1] + upper[:-1]
# ----------------------------------------
code_block_2 = CodeBlock(chainpoints=python_script) { chains = List.Transpose(chainpoints); UV.ByCoordinates(chains[0],chains[1]); }
UVs_2 = Output(code_block_2.out1)  # "UVs"
