# Dynamo custom node UV.Swap.dyf (Dynamo 0.8.1.1693)
# category: Clockwork.Geometry.UV.Actions
# Swaps U and V coordinates

uv = Input(uv : UV)
code_block = CodeBlock(seq=uv) { UV.ByCoordinates(seq.V,seq.U); }
uv_2 = Output(code_block)  # "uv"
