# Dynamo custom node View.CategoryIsVisible.dyf (Dynamo 1.0.0.1180)
# category: Clockwork.Revit.Views.View.Query
# Checks if a given category is visible in a given view

view = Input()
category = Input()
turnIntoList = Custom[Turn Into List](unknownItem=category)  # Turns an element (or a nested list) into a flat list
turnIntoList_2 = Custom[Turn Into List](unknownItem=view)
version = Custom[Application.Version]()  # Retrieves the name, version and build of the current Revit application.
python_script = Python(IN[0]=turnIntoList, IN[1]=turnIntoList_2, IN[2]=version.Version_int)
# ---------- python_script.python (27 lines) ----------
import clr
clr.AddReference('RevitAPI')
from Autodesk.Revit.DB import *

cats = UnwrapElement(IN[0])
views = UnwrapElement(IN[1])
version = IN[2]

elementlist = list()
for cat in cats:
	catlist = list()
	for view in views:
		try:
			if version > 2016:
				if view.GetCategoryHidden(cat.Id):
					catlist.append(False)
				else:
					catlist.append(True)
			else:
				if view.GetVisibility(cat):
					catlist.append(True)
				else:
					catlist.append(False)	
		except:
			catlist.append(False)
	elementlist.append(catlist)
OUT = elementlist
# ----------------------------------------
returnListOrSingleValue = Custom[ReturnListOrSingleValue](unknownItem=view, seq=python_script)  # If the item in input #1 is not a list, only the first item of the list in input #2 will be returned.
bool = Output(returnListOrSingleValue)
