# Dynamo custom node View.ConvertTemporaryHideIsolateToPermanent.dyf (Dynamo 1.3.1.1736)
# category: Clockwork.Revit.Views.View.Actions
# Convert all temporary hidden elements or categories to permanently hidden in the given view.

view = Input()
python_script = Python(IN[0]=view)
# ---------- python_script.python (18 lines) ----------
import clr
clr.AddReference('RevitAPI')
from Autodesk.Revit.DB import *

clr.AddReference("RevitServices")
import RevitServices
from RevitServices.Persistence import DocumentManager
from RevitServices.Transactions import TransactionManager

doc = DocumentManager.Instance.CurrentDBDocument
view = UnwrapElement(IN[0])

TransactionManager.Instance.EnsureInTransaction(doc)
try:
	view.ConvertTemporaryHideIsolateToPermanent()
	OUT = (view,True)
except: OUT = (view,False)
TransactionManager.Instance.TransactionTaskDone()
# ----------------------------------------
firstItem = List.FirstItem(python_script)
view_2 = Output(firstItem)  # "view"
lastItem = List.LastItem(python_script)
success = Output(lastItem)
