# Dynamo custom node View.DependentViews.dyf (Dynamo 1.3.4.6666)
# category: Clockwork.Revit.Views.View.Query
# Returns all dependent views of a given view

view = Input(view : var[]..[])
python_script = Python(IN[0]=view)
# ---------- python_script.python (18 lines) ----------
import clr
clr.AddReference('RevitAPI')
from Autodesk.Revit.DB import *

clr.AddReference("RevitNodes")
import Revit

def GetDependentViews(view):
	if hasattr(view, "GetDependentViewIds"):
		return [view.Document.GetElement(x) for x in view.GetDependentViewIds()]
	else: return []

views = UnwrapElement(IN[0])

if isinstance(IN[0], list):
	OUT = [GetDependentViews(x) for x in views]
else:
	OUT = GetDependentViews(views)
# ----------------------------------------
views = Output(python_script)
