# Dynamo custom node View.Direction.dyf (Dynamo 1.0.0.1180)
# category: Clockwork.Revit.Views.View.Query
# Returns the direction of a view

view = Input()
turnIntoList = Custom[Turn Into List](unknownItem=view)  # Turns an element (or a nested list) into a flat list
python_script = Python(IN[0]=turnIntoList)
# ---------- python_script.python (17 lines) ----------
import clr
clr.AddReference('RevitAPI')
from Autodesk.Revit.DB import *

clr.AddReference("RevitNodes")
import Revit
clr.ImportExtensions(Revit.GeometryConversion)

items = UnwrapElement(IN[0])
dlist = list()

for item in items:
	try:
		dlist.append(item.ViewDirection.ToVector())
	except:
		dlist.append(None)
OUT = dlist
# ----------------------------------------
returnListOrSingleValue = Custom[ReturnListOrSingleValue](unknownItem=view, seq=python_script)  # If the item in input #1 is not a list, only the first item of the list in input #2 will be returned.
vector = Output(returnListOrSingleValue)
