# Dynamo custom node View.PermanentlyIsolateCategory.dyf (Dynamo 1.3.1.1736)
# category: Clockwork.Revit.Views.View.Actions
# Permanently isolates categories in the given view

view = Input()
category = Input()
turnIntoList = Custom[Turn Into List](unknownItem=category)  # Turns an element (or a nested list) into a flat list
temporarilyIsolateInView = Custom[Category.TemporarilyIsolateInView](view=view, category=turnIntoList)  # (Temporarily) isolates categories in the given view
convertTemporaryHideIsolateToPermanent = Custom[View.ConvertTemporaryHideIsolateToPermanent](view=temporarilyIsolateInView.view)  # Convert all temporary hidden elements or categories to permanently hidden in the given view.
view_2 = Output(convertTemporaryHideIsolateToPermanent)  # "view"
returnListOrSingleValue = Custom[ReturnListOrSingleValue](unknownItem=category, seq=temporarilyIsolateInView.category)  # If the item in input #1 is not a list, only the first item of the list in input #2 will be returned.
category_2 = Output(returnListOrSingleValue)  # "category"
