# Dynamo custom node View.PermanentlyIsolateElement.dyf (Dynamo 1.3.1.1736)
# category: Clockwork.Revit.Views.View.Actions
# Permanently isolates elements in the given view

view = Input()
element = Input()
turnIntoList = Custom[Turn Into List](unknownItem=element)  # Turns an element (or a nested list) into a flat list
temporarilyIsolateElement = Custom[View.TemporarilyIsolateElement](view=view, element=turnIntoList)  # Temporarily isolates elements in the given view
convertTemporaryHideIsolateToPermanent = Custom[View.ConvertTemporaryHideIsolateToPermanent](view=temporarilyIsolateElement.view)  # Convert all temporary hidden elements or categories to permanently hidden in the given view.
view_2 = Output(convertTemporaryHideIsolateToPermanent.view)  # "view"
returnListOrSingleValue = Custom[ReturnListOrSingleValue](unknownItem=element, seq=temporarilyIsolateElement.element)  # If the item in input #1 is not a list, only the first item of the list in input #2 will be returned.
element_2 = Output(returnListOrSingleValue)  # "element"
success = Output(convertTemporaryHideIsolateToPermanent.success)
