# Dynamo custom node View.Phase.dyf (Dynamo 1.3.1.1736)
# category: Clockwork.Revit.Views.View.Query
# Returns the phase of a given view

view = Input()
turnIntoList = Custom[Turn Into List](unknownItem=view)  # Turns an element (or a nested list) into a flat list
python_script = Python(IN[0]=turnIntoList)
# ---------- python_script.python (16 lines) ----------
import clr
clr.AddReference('RevitAPI')
from Autodesk.Revit.DB import *

clr.AddReference("RevitNodes")
import Revit
clr.ImportExtensions(Revit.Elements)

views = UnwrapElement(IN[0])
elementlist = list()
for view in views:
	try:
		elementlist.append(view.Document.GetElement(view.get_Parameter(BuiltInParameter.VIEW_PHASE).AsElementId()))
	except:
		elementlist.append(None)
OUT = elementlist
# ----------------------------------------
returnListOrSingleValue = Custom[ReturnListOrSingleValue](unknownItem=view, seq=python_script)  # If the item in input #1 is not a list, only the first item of the list in input #2 will be returned.
phase = Output(returnListOrSingleValue)
