# Dynamo custom node View.Plane.dyf (Dynamo 1.3.0.875)
# category: Clockwork.Revit.Views.View.Query
# Retrieves the plane of a given view

view = Input()
turnIntoList = Custom[Turn Into List](unknownItem=view)  # Turns an element (or a nested list) into a flat list
python_script = Python(IN[0]=turnIntoList)
# ---------- python_script.python (20 lines) ----------
import clr
clr.AddReference('RevitAPI')
from Autodesk.Revit.DB import *

clr.AddReference("RevitNodes")
import Revit
clr.ImportExtensions(Revit.GeometryConversion)

items = UnwrapElement(IN[0])
elementlist = list()
olist = list()
dlist = list()

for item in items:
	try:
		olist.append(item.Origin.ToPoint())
		dlist.append(item.ViewDirection.ToVector())
	except:
		elementlist.append(list())
OUT = (olist,dlist)
# ----------------------------------------
code_block = CodeBlock(seq=python_script) { seq[0]; seq[1]; }
byOriginNormal = Plane.ByOriginNormal(origin=code_block.out0, normal=code_block.out1)
returnListOrSingleValue = Custom[ReturnListOrSingleValue](unknownItem=view, seq=byOriginNormal)  # If the item in input #1 is not a list, only the first item of the list in input #2 will be returned.
plane = Output(returnListOrSingleValue)
