# Dynamo custom node View.SetDetailLevel.dyf (Dynamo 1.0.0.1180)
# category: Clockwork.Revit.Views.View.Actions
# Sets the detail level of a given view

view = Input()
turnIntoList = Custom[Turn Into List](unknownItem=view)  # Turns an element (or a nested list) into a flat list
detailLevel = Input()
python_script = Python(IN[0]=turnIntoList, IN[1]=detailLevel)
# ---------- python_script.python (32 lines) ----------
import clr
clr.AddReference('RevitAPI')
from Autodesk.Revit.DB import *

clr.AddReference("RevitNodes")
import Revit
clr.ImportExtensions(Revit.Elements)

clr.AddReference("RevitServices")
import RevitServices
from RevitServices.Persistence import DocumentManager
from RevitServices.Transactions import TransactionManager

doc = DocumentManager.Instance.CurrentDBDocument
views = UnwrapElement(IN[0])
detailLevel = UnwrapElement(IN[1])
if str(detailLevel) == "Fine": dl = 3
elif str(detailLevel) == "Medium": dl = 2
elif str(detailLevel) == "Coarse": dl = 1
else: dl = 0
booleans = list()

TransactionManager.Instance.EnsureInTransaction(doc)
for view in views:
	try:
		view.get_Parameter(BuiltInParameter.VIEW_DETAIL_LEVEL).Set(dl)
		booleans.append(True)
	except:
		booleans.append(False)
TransactionManager.Instance.TransactionTaskDone()

OUT = (views,booleans)
# ----------------------------------------
code_block = CodeBlock(seq=python_script) { seq[0]; seq[1]; }
returnListOrSingleValue = Custom[ReturnListOrSingleValue](unknownItem=view, seq=code_block.out0)  # If the item in input #1 is not a list, only the first item of the list in input #2 will be returned.
view_2 = Output(returnListOrSingleValue)  # "view"
returnListOrSingleValue_2 = Custom[ReturnListOrSingleValue](unknownItem=view, seq=code_block.out1)
success = Output(returnListOrSingleValue_2)
