# Dynamo custom node View.TemporarilyIsolateCategory.dyf (Dynamo 1.3.1.1736)
# category: Clockwork.Revit.Views.View.Actions
# Temporarily isolates categories in the given view

category = Input()
turnIntoList = Custom[Turn Into List](unknownItem=category)  # Turns an element (or a nested list) into a flat list
view = Input()
python_script = Python(IN[0]=turnIntoList, IN[1]=view)
# ---------- python_script.python (23 lines) ----------
import clr
clr.AddReference('RevitAPI')
from Autodesk.Revit.DB import *
from System.Collections.Generic import *

clr.AddReference("RevitServices")
import RevitServices
from RevitServices.Persistence import DocumentManager
from RevitServices.Transactions import TransactionManager

doc = DocumentManager.Instance.CurrentDBDocument
cats = UnwrapElement(IN[0])
view = UnwrapElement(IN[1])
ids = list()
elementlist = list()
for cat in cats:
	ids.append(cat.Id)
icats = List[ElementId](ids)

TransactionManager.Instance.EnsureInTransaction(doc)
view.IsolateCategoriesTemporary(icats)
TransactionManager.Instance.TransactionTaskDone()
OUT = (view,cats)
# ----------------------------------------
code_block = CodeBlock(seq=python_script) { seq[0]; seq[1]; }
view_2 = Output(code_block.out0)  # "view"
returnListOrSingleValue = Custom[ReturnListOrSingleValue](unknownItem=category, seq=code_block.out1)  # If the item in input #1 is not a list, only the first item of the list in input #2 will be returned.
category_2 = Output(returnListOrSingleValue)  # "category"
