# Dynamo custom node View.TemporarilyIsolateElement.dyf (Dynamo 1.3.1.1736)
# category: Clockwork.Revit.Views.View.Actions
# Temporarily isolates elements in the given view

element = Input()
turnIntoList = Custom[Turn Into List](unknownItem=element)  # Turns an element (or a nested list) into a flat list
view = Input()
python_script = Python(IN[0]=turnIntoList, IN[1]=view)
# ---------- python_script.python (26 lines) ----------
import clr
clr.AddReference('RevitAPI')
from Autodesk.Revit.DB import *
from System.Collections.Generic import *

clr.AddReference("RevitServices")
import RevitServices
from RevitServices.Persistence import DocumentManager
from RevitServices.Transactions import TransactionManager

doc = DocumentManager.Instance.CurrentDBDocument
elements = UnwrapElement(IN[0])
view = UnwrapElement(IN[1])
ids = list()
booleans = []
for item in elements:
	ids.append(item.Id)
ielements = List[ElementId](ids)

TransactionManager.Instance.EnsureInTransaction(doc)
try:
	view.IsolateElementsTemporary(ielements)
	booleans.append(True)
except: booleans.append(False)
TransactionManager.Instance.TransactionTaskDone()
OUT = (view,elements,booleans)
# ----------------------------------------
code_block = CodeBlock(seq=python_script) { seq[0]; seq[1]; seq[2]; }
view_2 = Output(code_block.out0)  # "view"
returnListOrSingleValue = Custom[ReturnListOrSingleValue](unknownItem=element, seq=code_block.out1)  # If the item in input #1 is not a list, only the first item of the list in input #2 will be returned.
element_2 = Output(returnListOrSingleValue)  # "element"
returnListOrSingleValue_2 = Custom[ReturnListOrSingleValue](unknownItem=element, seq=code_block.out2)
success = Output(returnListOrSingleValue_2)
