# Dynamo custom node View.Type.dyf (Dynamo 1.3.4.6666)
# category: Clockwork.Revit.Views.View.Query
# Returns the type of a given view

view = Input()
python_script = Python(IN[0]=view)
# ---------- python_script.python (12 lines) ----------
import clr
clr.AddReference('RevitAPI')
from Autodesk.Revit.DB import *

def GetViewType(view):
	if hasattr(view, "ViewType"): return str(view.ViewType)
	else: return None

views = UnwrapElement(IN[0])

if isinstance(IN[0],list): OUT = [GetViewType(x) for x in views]
else: OUT = GetViewType(views)
# ----------------------------------------
type = Output(python_script)
