# Dynamo custom node View.ViewTemplate.dyf (Dynamo 0.8.2.2392)
# category: Clockwork.Revit.Views.View.Query
# Returns the view template assigned to a given view (if one is assigned)

view = Input()
turnIntoList = Custom[Turn Into List](unknownItem=view)  # Turns an element (or a nested list) into a flat list
python_script = Python(IN[0]=turnIntoList)
# ---------- python_script.python (18 lines) ----------
import clr
clr.AddReference('RevitAPI')
from Autodesk.Revit.DB import *

clr.AddReference("RevitServices")
import RevitServices
from RevitServices.Persistence import DocumentManager

doc = DocumentManager.Instance.CurrentDBDocument
views = UnwrapElement(IN[0])
elementlist = list()

for view in views:
	if view.ViewTemplateId.IntegerValue == -1:
		elementlist.append(list())
	else:
		elementlist.append(view.Document.GetElement(view.ViewTemplateId))
OUT = elementlist
# ----------------------------------------
returnListOrSingleValue = Custom[ReturnListOrSingleValue](unknownItem=view, seq=python_script)  # If the item in input #1 is not a list, only the first item of the list in input #2 will be returned.
ViewTemplate = Output(returnListOrSingleValue)
