# Dynamo custom node View3D.IsLocked.dyf (Dynamo 1.3.1.1736)
# category: Clockwork.Revit.Views.View3D.Query
# Checks if a given 3D view is locked. PLEASE NOTE: Due to a bug in DynamoRevit this currently only works for isometric view, not for perspective views.

view3d = Input(view3d : Elements.View3D)
turnIntoList = Custom[Turn Into List](unknownItem=view3d)  # Turns an element (or a nested list) into a flat list
python_script = Python(IN[0]=turnIntoList)
# ---------- python_script.python (16 lines) ----------
import clr
clr.AddReference('RevitAPI')
from Autodesk.Revit.DB import *

views = UnwrapElement(IN[0])
elementlist = list()
notaview = list()
for view in views:
	try:
		if view.IsLocked:
			elementlist.append(True)
		else:
			elementlist.append(False)
	except:
		elementlist.append(False)
OUT = elementlist
# ----------------------------------------
returnListOrSingleValue = Custom[ReturnListOrSingleValue](unknownItem=view3d, seq=python_script)  # If the item in input #1 is not a list, only the first item of the list in input #2 will be returned.
bool = Output(returnListOrSingleValue)
