# Dynamo custom node ViewSheetSet.Views.dyf (Dynamo 1.3.1.1736)
# category: Clockwork.Revit.Elements.ViewSheetSet.Query
# Retrieves all the views/sheets in a given view/sheet set.

viewsSheetSet = Input()
turnIntoList = Custom[TurnIntoList](unknownItem=viewsSheetSet)  # Turns an element (or a nested list) into a flat list
python_script = Python(IN[0]=turnIntoList)
# ---------- python_script.python (16 lines) ----------
import clr
clr.AddReference('RevitAPI')
from Autodesk.Revit.DB import *

clr.AddReference("RevitNodes")
import Revit
clr.ImportExtensions(Revit.Elements)

viewsheetsets = UnwrapElement(IN[0])
elementlist = list()
for set in viewsheetsets:
	views = list()
	for view in set.Views:
		views.append(view.ToDSType(True))
	elementlist.append(views)
OUT = elementlist
# ----------------------------------------
returnListOrSingleValue = Custom[ReturnListOrSingleValue](unknownItem=viewsSheetSet, seq=python_script)  # If the unknown item is not a list but rather a single item, only the first item of the list (input "seq") will be returned.
views = Output(returnListOrSingleValue)
