# Dynamo custom node TextAlignFlags.Right.dyf (Dynamo 0.8.2.2392)
# category: Clockwork.Revit.Elements.TextAlignFlags.Query
# Returns the "Left" text align flag.

python_script = Python()
# ---------- python_script.python (4 lines) ----------
import clr
clr.AddReference('RevitAPI')
from Autodesk.Revit.DB import *
OUT = TextAlignFlags.TEF_ALIGN_RIGHT
# ----------------------------------------
Right = Output(python_script)
