# Dynamo custom node TextNote.ByStringAndPosition.dyf (Dynamo 1.0.0.1180)
# category: Clockwork.Revit.Elements.TextNote.Create
# Creates a text note at a given location

point = Input(point : Autodesk.Point)
view = Input()
turnIntoList = Custom[Turn Into List](unknownItem=point)  # Turns an element (or a nested list) into a flat list
XAxis = Vector.XAxis()
ZAxis = Vector.ZAxis()
rotation = Input(rotation : double = 0)
turnIntoList_2 = Custom[Turn Into List](unknownItem=rotation)
rotate = Vector.Rotate(XAxis, ZAxis, turnIntoList_2)
text = Input(text : string)
turnIntoList_3 = Custom[Turn Into List](unknownItem=text)
code_block = CodeBlock(points=turnIntoList, basevecs=rotate, strings=turnIntoList_3) { {points,basevecs,strings}; }
equalSublistLengths = Custom[List.EqualSublistLengths](lists=code_block)  # Trims all given lists to the length of the shortest list
code_block_2 = CodeBlock(seq=equalSublistLengths) { seq[0]; seq[1]; seq[2]; }
code_block_3 = CodeBlock { -90; }
rotate_2 = Vector.Rotate(rotate, ZAxis, code_block_3)
width = Input(width : double = 1)
unit_types = UnitTypes("Length")
displayUnitType = Custom[UnitType.DisplayUnitType](unitType=unit_types)  # Retrieves the display unit type for a given unit type.
toInternalUnit = Custom[DisplayUnit.ToInternalUnit](val=width, displayUnitType=displayUnitType.displayUnitType)  # Converts a value from a given display unit to Revit's internal unit
textAlignFlag = Input()
version = Custom[Application.Version]()  # Retrieves the name, version and build of the current Revit application.
degreesToRadians = Math.DegreesToRadians(rotation)
textNoteType = Input(textNoteType : Element = null)
python_script = Python(IN[0]=view, IN[1]=code_block_2.out0, IN[2]=code_block_2.out1, IN[3]=rotate_2, IN[4]=code_block_2.out2, IN[5]=toInternalUnit, IN[6]=textAlignFlag, IN[7]=version.Version_int, IN[8]=degreesToRadians, IN[9]=textNoteType)
# ---------- python_script.python (41 lines) ----------
import clr
clr.AddReference('RevitAPI')
from Autodesk.Revit.DB import *

clr.AddReference("RevitNodes")
import Revit
clr.ImportExtensions(Revit.GeometryConversion)

clr.AddReference("RevitServices")
import RevitServices
from RevitServices.Persistence import DocumentManager
from RevitServices.Transactions import TransactionManager

doc = DocumentManager.Instance.CurrentDBDocument
view = UnwrapElement(IN[0])
xyzlist = [x.ToXyz() for x in IN[1]]
basevecs = [x.ToXyz() for x in IN[2]]
upvecs = [x.ToXyz() for x in IN[3]]
text = IN[4]
width = IN[5]
textalign = IN[6]
version = IN[7]
rotation = IN[8]
textnotetype = UnwrapElement(IN[9])
counter = 0
elementlist = list()

TransactionManager.Instance.EnsureInTransaction(doc)
for xyz in xyzlist:
	if version > 2016:
		options = TextNoteOptions(textnotetype.Id)
		options.Rotation = rotation
		newtextnote = TextNote.Create(doc, view.Id, xyz, width, text[counter], options)
	else:
		doccreation = doc.Create
		newtextnote = doccreation.NewTextNote(view,xyz,basevecs[counter],upvecs[counter],width,textalign,text[counter])
	elementlist.append(newtextnote)
	counter += 1
TransactionManager.Instance.TransactionTaskDone()

OUT = elementlist
# ----------------------------------------
returnListOrSingleValue = Custom[ReturnListOrSingleValue](unknownItem=point, seq=python_script)  # If the item in input #1 is not a list, only the first item of the list in input #2 will be returned.
textNote = Output(returnListOrSingleValue)
