# Dynamo custom node Wall.CreationMethod.dyf (Dynamo 1.3.1.1736)
# category: Clockwork.Revit.Elements.Wall.Query
# Retrieves the creation method of a given wall

wall = Input()
turnIntoList = Custom[Turn Into List](unknownItem=wall)  # Turns an element (or a nested list) into a flat list
python_script = Python(IN[0]=turnIntoList)
# ---------- python_script.python (20 lines) ----------
import clr
clr.AddReference('RevitAPI')
from Autodesk.Revit.DB import *

clr.AddReference("RevitNodes")
import Revit
clr.ImportExtensions(Revit.Elements)

wallinstances = UnwrapElement(IN[0])
methodlist = list()
for item in wallinstances:
	typename = item.GetType().Name
	if typename == 'Wall':
		methodlist.append('Standard')
	elif typename == 'FaceWall':
		methodlist.append('By Face')
	elif typename == 'FamilyInstance':
		methodlist.append('In-Place')
	else: methodlist.append(None)
OUT = methodlist
# ----------------------------------------
returnListOrSingleValue = Custom[ReturnListOrSingleValue](unknownItem=wall, seq=python_script)  # If the item in input #1 is not a list, only the first item of the list in input #2 will be returned.
creationMethod = Output(returnListOrSingleValue)
