# Dynamo custom node Wall.Orientation.dyf (Dynamo 1.0.0.1180)
# category: Clockwork.Revit.Elements.Wall.Query
# Gets the orientation of a given wall instance (normal of the exterior face of the wall). Will *not* work for walls hosted on mass faces or in-place walls.

wall = Input(wall : Wall)
turnIntoList = Custom[Turn Into List](unknownItem=wall)  # Turns an element (or a nested list) into a flat list
python_script = Python(IN[0]=turnIntoList)
# ---------- python_script.python (24 lines) ----------
import clr
clr.AddReference('RevitAPI')
from Autodesk.Revit.DB import *

clr.AddReference("RevitNodes")
import Revit
clr.ImportExtensions(Revit.Elements)
clr.ImportExtensions(Revit.GeometryConversion)

wallinstances = UnwrapElement(IN[0])
vectorlist = list()
for item in wallinstances:
	try:
		lcurve = item.Location.Curve
		if str(type(lcurve)) == "Autodesk.Revit.DB.Line":
			vectorlist.append(item.Orientation.ToVector())
			vectorlist.append('#')
		else:
			direction = (lcurve.GetEndPoint(1) - lcurve.GetEndPoint(0)).Normalize()
			vectorlist.append(XYZ.BasisZ.CrossProduct(direction))
			vectorlist.append('*')
	except:
		vectorlist.append(list())
OUT = vectorlist
# ----------------------------------------
returnListOrSingleValue = Custom[ReturnListOrSingleValue](unknownItem=wall, seq=python_script)  # If the item in input #1 is not a list, only the first item of the list in input #2 will be returned.
Normal = Output(returnListOrSingleValue)
