# Dynamo custom node WallLocationLine.CoreCenterline.dyf (Dynamo 0.9.0.3067)
# category: Clockwork.Revit.Elements.WallLocationLine.Query
# Returns the WallLocationLine option for CoreCenterLine

python_script = Python()
# ---------- python_script.python (5 lines) ----------
import clr
clr.AddReference('RevitAPI')
from Autodesk.Revit.DB import *

OUT = WallLocationLine.CoreCenterline
# ----------------------------------------
CoreCenterline = Output(python_script)
code_block = CodeBlock { 1; }
int = Output(code_block)
