# Dynamo custom node WallLocationLine.FinishFaceExterior.dyf (Dynamo 0.9.0.3067)
# category: Clockwork.Revit.Elements.WallLocationLine.Query
# Returns the WallLocationLine option for FinishFaceExterior

python_script = Python()
# ---------- python_script.python (5 lines) ----------
import clr
clr.AddReference('RevitAPI')
from Autodesk.Revit.DB import *

OUT = WallLocationLine.FinishFaceExterior
# ----------------------------------------
FinishFaceExterior = Output(python_script)
code_block = CodeBlock { 2; }
int = Output(code_block)
