# Dynamo custom node Workset.Kind.dyf (Dynamo 1.3.1.1736)
# category: Clockwork.Revit.Elements.Workset.Query
# Retrieves the kind of a given workset

workset = Input()
turnIntoList = Custom[Turn Into List](unknownItem=workset)  # Turns an element (or a nested list) into a flat list
python_script = Python(IN[0]=turnIntoList)
# ---------- python_script.python (18 lines) ----------
import clr
clr.AddReference('RevitAPI')
from Autodesk.Revit.DB import *

clr.AddReference("RevitServices")
import RevitServices
from RevitServices.Persistence import DocumentManager

doc = DocumentManager.Instance.CurrentDBDocument
worksets = UnwrapElement(IN[0])
elementlist = list()
for workset in worksets:
	if workset.GetType().ToString() == "Autodesk.Revit.DB.Workset":
		elementlist.append(str(workset.Kind))
	elif workset.GetType().ToString() == "archilab.Revit.Elements.Workset":
		elementlist.append("Cannot retrieve the workset kind from a workset object generated by archi-lab nodes.")
	else: elementlist.append(None)
OUT = elementlist
# ----------------------------------------
returnListOrSingleValue = Custom[ReturnListOrSingleValue](unknownItem=workset, seq=python_script)  # If the item in input #1 is not a list, only the first item of the list in input #2 will be returned.
kind = Output(returnListOrSingleValue)
