# Dynamo custom node -1.dyf (Dynamo 0.8.1.1823)
# category: Clockwork.Math.Functions.Actions
# Decrements a value by 1

dbl = Input(dbl : double)
code_block = CodeBlock(n=dbl) { n-1; }
dbl_2 = Output(code_block)  # "dbl"
