# Dynamo custom node All Family Types Of Category.dyf (Dynamo 2.0.1.5055)
# category: Clockwork.Revit.Selection.Collectors.Query
# Gets all family types/symbols of a given category in the model.

category = Input(category: Revit.Elements.Category)
toggle = Input(toggle: bool = true)
docOrRevitLinkInstance = Input(docOrRevitLinkInstance: var = null)  # Use only if you want to query a linked model
python_script = Python(IN[0]=category, IN[1]=toggle, IN[2]=docOrRevitLinkInstance)
# ---------- python_script.python (22 lines) ----------
import System
import clr
clr.AddReference('RevitAPI')
from Autodesk.Revit.DB import *

clr.AddReference("RevitServices")
import RevitServices
from RevitServices.Persistence import DocumentManager

def ElementTypesByCategory(cat, doc):
	bic = System.Enum.ToObject(BuiltInCategory, cat.Id)
	collector = FilteredElementCollector(doc).OfCategory(bic).WhereElementIsElementType()
	return collector.ToElements()

inputdoc = UnwrapElement(IN[2])
if not inputdoc: doc = DocumentManager.Instance.CurrentDBDocument
elif inputdoc.GetType().ToString() == "Autodesk.Revit.DB.RevitLinkInstance": doc = inputdoc.GetLinkDocument()
elif inputdoc.GetType().ToString() == "Autodesk.Revit.DB.Document": doc = inputdoc
else: doc = DocumentManager.Instance.CurrentDBDocument

if isinstance(IN[0], list): OUT = [ElementTypesByCategory(x, doc) for x in IN[0]]
else: OUT = ElementTypesByCategory(IN[0], doc)
# ----------------------------------------
familyTypes = Output(python_script)
