# Dynamo custom node All Intersecting Elements Of Category By Vector.dyf (Dynamo 2.0.1.5055)
# category: Clockwork.Revit.Selection.Collectors.Query
# Finds all elements of a specified category that intersect with a list of vectors

startPoint = Input(startPoint: Autodesk.DesignScript.Geometry.Point)
threeDView = Input(threeDView: Revit.Elements.Views.View3D)
category = Input(category: var[]..[])
turn_into_list = Custom[Turn Into List](unknownItem=startPoint)  # Turns an element (or a nested list) into a flat list
endPoint = Input(endPoint: Autodesk.DesignScript.Geometry.Point)
turn_into_list_2 = Custom[Turn Into List](unknownItem=endPoint)
toggle = Input(toggle: bool = true)
python_script = Python(IN[0]=threeDView, IN[1]=category, IN[2]=turn_into_list, IN[3]=turn_into_list_2, IN[4]=toggle)
# ---------- python_script.python (33 lines) ----------
import System
import clr
clr.AddReference('RevitAPI')
from Autodesk.Revit.DB import *

clr.AddReference("RevitNodes")
import Revit
clr.ImportExtensions(Revit.Elements)
clr.ImportExtensions(Revit.GeometryConversion)

clr.AddReference("RevitServices")
import RevitServices
from RevitServices.Persistence import DocumentManager

doc = DocumentManager.Instance.CurrentDBDocument
theview = UnwrapElement(IN[0])
cat = System.Enum.ToObject(BuiltInCategory, IN[1].Id)
vstart = [x.ToXyz() for x in IN[2]]
vend = [x.ToXyz() for x in IN[3]]

intersectorlist = list()
counter = 0
filter = ElementCategoryFilter(cat)

while counter < len(vstart):
	ThisReferenceArr = ReferenceIntersector(filter, FindReferenceTarget.All, theview)
	found = ThisReferenceArr.Find(vstart[counter], vend[counter])
	foundreferences = list()
	for item in found:
		foundreferences.append(doc.GetElement(item.GetReference()))
	intersectorlist.append(foundreferences)
	counter += 1
OUT = intersectorlist
# ----------------------------------------
uniqueItems = List.UniqueItems()  # unwired: list
map = List.Map(list=python_script, f_x=uniqueItems)
returnListOrSingleValue = Custom[ReturnListOrSingleValue](unknownItem=startPoint, seq=map)  # If the unknown item is not a list but rather a single item, only the first item of the list (input "seq") will be returned.
elements = Output(returnListOrSingleValue)
firstItem = List.FirstItem()  # unwired: list
map_2 = List.Map(list=python_script, f_x=firstItem)
returnListOrSingleValue_2 = Custom[ReturnListOrSingleValue](unknownItem=startPoint, seq=map_2)
firstItem_2 = Output(returnListOrSingleValue_2)  # "firstItem"
