# Dynamo custom node All Placed Family Types of Category.dyf (Dynamo 2.0.3.8810)
# category: Clockwork.Revit.Selection.Collectors.Query
# Retrieves all family types of a given category that have *placed* instances

category = Input(category: var[]..[])  # Works with categories, BuiltInCategories and BuiltInCategories as strings
toggle = Input(toggle: bool = true)
docOrRevitLinkInstance = Input(docOrRevitLinkInstance: var = null)  # Use only if you want to query a linked model
all_elements_of_category = Custom[All Elements Of Category+](category=category, toggle=toggle, docOrRevitLinkInstance=docOrRevitLinkInstance)  # Gets all placed elements of a given category in the model.
elementType = Custom[Element.ElementType+](element=all_elements_of_category)  # Gets the family type of a given element (if applicable). Unlike the OOTB node, it also works for elements in linked models.
uniqueItems = List.UniqueItems(list=elementType)
familyTypes = Output(uniqueItems)
