# Dynamo custom node All View-Dependent Family Instances Of Category.dyf (Dynamo 2.0.1.5055)
# category: Clockwork.Revit.Selection.Collectors.Query
# Gets all view-dependent family instances in a given view for a given list of categories - useful for finding annotation elements

category = Input(category: var[]..[])
turn_into_list = Custom[Turn Into List](unknownItem=category)  # Turns an element (or a nested list) into a flat list
view = Input(view: var[]..[])
primaryView = Custom[View.PrimaryView](view=view)  # Returns the primary view of a given view (i.e. the master view of a dependent view)
isNull = Object.IsNull(obj=primaryView)
code_block = CodeBlock(isnull=isNull, originalView=view, primaryView=primaryView) { isnull ? originalView : primaryView; }
turn_into_list_2 = Custom[Turn Into List](unknownItem=code_block)
toggle = Input(toggle: bool = true)
python_script = Python(IN[0]=turn_into_list, IN[1]=turn_into_list_2, IN[2]=toggle)
# ---------- python_script.python (24 lines) ----------
import System
import clr
clr.AddReference('RevitAPI')
from Autodesk.Revit.DB import *

clr.AddReference("RevitServices")
import RevitServices
from RevitServices.Persistence import DocumentManager

doc = DocumentManager.Instance.CurrentDBDocument
cats = IN[0]
views = UnwrapElement(IN[1])

elementlist = list()
# This could be more elegant if only I knew how to implement a Multicategory filter in Python....
for cat in cats:
	catlist = list()
	for view in views:
		collector = FilteredElementCollector(doc)
		filter = ElementOwnerViewFilter(view.Id)
		bic = System.Enum.ToObject(BuiltInCategory, cat.Id)
		catlist.append(collector.WherePasses(filter).OfCategory(bic).ToElements())
	elementlist.append(catlist)
OUT = elementlist
# ----------------------------------------
returnListOrSingleValue = Custom[ReturnListOrSingleValue](unknownItem=category, seq=python_script)  # If the unknown item is not a list but rather a single item, only the first item of the list (input "seq") will be returned.
elements = Output(returnListOrSingleValue)
