# Dynamo custom node AngularDimension.ByElements.dyf (Dynamo 2.0.1.5055)
# category: Clockwork.Revit.Elements.Create
# Creates angular dimensions between elements. Only works in project environment. ATTENTION: Do NOT use in automatic mode.

element1 = Input(element1: var[]..[])
turnIntoList = Custom[TurnIntoList](unknownItem=element1)  # Turns an element (or a nested list) into a flat list
element2 = Input(element2: var[]..[])
turnIntoList_2 = Custom[TurnIntoList](unknownItem=element2)
create = List.Create(item0=turnIntoList, item1=turnIntoList_2)
transpose = List.Transpose(lists=create)
location = Custom[Element.Location+](element=transpose@L2)  # Returns the location of an element as point, curve or curve loop, along with some booleans to help filtering the results. Unlike the OOTB Element.GetLocation node, it also retunrs sketch lines of sketch-based elements like floor slabs as well as the element's rotation property.
transpose_2 = List.Transpose(lists=location.curveEndpoints)
firstItem = List.FirstItem(list=transpose_2@@L2)
firstItem_2 = List.FirstItem(list=firstItem)
transpose_3 = List.Transpose(lists=location.curves)
direction = Line.Direction(line=transpose_3)
firstItem_3 = List.FirstItem(list=direction)
lastItem = List.LastItem(list=firstItem)
lastItem_2 = List.LastItem(list=direction)
intersectionWithVector = Custom[Vector.IntersectionWithVector](basePoint1=firstItem_2, vector1=firstItem_3, basePoint2=lastItem, vector2=lastItem_2)  # Determines if two vectors intersect and returns the closest points of intersection on both vectors.
radius = Input(radius: double)
XAxis = Vector.XAxis()
ZAxis = Vector.ZAxis()
angleAboutAxis = Vector.AngleAboutAxis(vector=XAxis, otherVector=direction, rotationAxis=ZAxis)
firstItem_4 = List.FirstItem(list=angleAboutAxis)
lastItem_3 = List.LastItem(list=angleAboutAxis)
byCenterPointRadiusAngle = Arc.ByCenterPointRadiusAngle(center=intersectionWithVector.AveragePoint, radius=radius, startAngle=firstItem_4, endAngle=lastItem_3)
view = Input(view: var[]..[])
dimensionType = Input(dimensionType: var[]..[])
python_script = Python(IN[0]=transpose, IN[1]=byCenterPointRadiusAngle, IN[2]=view, IN[3]=dimensionType)
# ---------- python_script.python (55 lines) ----------
import clr
from System.Collections.Generic import *

clr.AddReference('RevitAPI')
from Autodesk.Revit.DB import *

clr.AddReference("RevitNodes")
import Revit
clr.ImportExtensions(Revit.GeometryConversion)

clr.AddReference("RevitServices")
import RevitServices
from RevitServices.Persistence import DocumentManager
from RevitServices.Transactions import TransactionManager

doc = DocumentManager.Instance.CurrentDBDocument
opt = Options()
opt.ComputeReferences = True
opt.IncludeNonVisibleObjects = True

items = UnwrapElement(IN[0])
arcs = [x.ToRevitType() for x in IN[1]]
view = UnwrapElement(IN[2])
dimtype = UnwrapElement(IN[3])

def CreateAngularDimension(view, items, arc, dimtype):
	opt.View = view
	refs = []
	for item in items:
		for obj in item.get_Geometry(opt):
			if isinstance (obj, Line):
				curve = obj
				if curve.Reference: refs.append(curve.Reference)
	refList = List[Reference](refs)
	#return refList
	return AngularDimension.Create(doc, view, arc, refList, dimtype)

TransactionManager.Instance.EnsureInTransaction(doc)
OUT = [CreateAngularDimension(view, x, y, dimtype) for x, y in zip(items, arcs)]
TransactionManager.Instance.TransactionTaskDone()

"""
TransactionManager.Instance.EnsureInTransaction(doc)
curvearray = CurveArray()
for curve in curves:
	curvearray.Append(curve.ToRevitType())
doccreation = doc.Create
separatorarray = doccreation.NewRoomBoundaryLines(sketchplane, curvearray, view)
TransactionManager.Instance.TransactionTaskDone()

elementlist = list()
for item in separatorarray:
	elementlist.append(item)
OUT = elementlist
"""
# ----------------------------------------
returnListOrSingleValue = Custom[ReturnListOrSingleValue](unknownItem=element1, seq=python_script)  # If the unknown item is not a list but rather a single item, only the first item of the list (input "seq") will be returned.
dimension = Output(returnListOrSingleValue)
