# Dynamo custom node AreaSeparator.FromCurve.dyf (Dynamo 2.0.0.4654)
# category: Clockwork.Revit.Elements.ModelCurve.Create
# Creates area separation lines from geometry curves.

curve = Input(curve: Autodesk.DesignScript.Geometry.Curve)
turnIntoList = Custom[TurnIntoList](unknownItem=curve)  # Turns an element (or a nested list) into a flat list
sketchPlane = Input(sketchPlane: Revit.Elements.SketchPlane)
areaPlanView = Input(areaPlanView: var[]..[])
python_script = Python(IN[0]=turnIntoList, IN[1]=sketchPlane, IN[2]=areaPlanView)
# ---------- python_script.python (29 lines) ----------
import clr
clr.AddReference('RevitAPI')
from Autodesk.Revit.DB import *

clr.AddReference("RevitNodes")
import Revit
clr.ImportExtensions(Revit.GeometryConversion)

clr.AddReference("RevitServices")
import RevitServices
from RevitServices.Persistence import DocumentManager
from RevitServices.Transactions import TransactionManager

doc = DocumentManager.Instance.CurrentDBDocument
curves = UnwrapElement(IN[0])
sketchplane = UnwrapElement(IN[1])
view = UnwrapElement(IN[2])
elementlist = list()

if str(view.ViewType) == "AreaPlan":
	TransactionManager.Instance.EnsureInTransaction(doc)
	doccreation = doc.Create
	for curve in curves:
		separator = doccreation.NewAreaBoundaryLine(sketchplane, curve.ToRevitType(), view)
		elementlist.append(separator)
	TransactionManager.Instance.TransactionTaskDone()
else:
	elementlist = list("The active view needs to be an area plan...")
OUT = elementlist
# ----------------------------------------
returnListOrSingleValue = Custom[ReturnListOrSingleValue](unknownItem=curve, seq=python_script)  # If the unknown item is not a list but rather a single item, only the first item of the list (input "seq") will be returned.
areaSeparator = Output(returnListOrSingleValue)
