# Dynamo custom node Array.AssociatedFamilyParameter.dyf (Dynamo 2.0.1.5055)
# category: Clockwork.Revit.Elements.Query
# Returns the associated family parameter of an array label (if any). PLEASE NOTE: This node will only work in a family document!

baseArray = Input(baseArray: var[]..[])
turnIntoList = Custom[TurnIntoList](unknownItem=baseArray)  # Turns an element (or a nested list) into a flat list
python_script = Python(IN[0]=turnIntoList)
# ---------- python_script.python (23 lines) ----------
import clr
clr.AddReference('RevitAPI')
from Autodesk.Revit.DB import *

clr.AddReference("RevitNodes")
import Revit
clr.ImportExtensions(Revit.Elements)

basearrays = UnwrapElement(IN[0])
paramlist = list()
paramnamelist = list()
for basearray in basearrays:
	if basearray.GetType().ToString() in ("Autodesk.Revit.DB.LinearArray", "Autodesk.Revit.DB.RadialArray"):
		if basearray.Label != None:
			paramlist.append(basearray.Label)
			paramnamelist.append(basearray.Label.Definition.Name)
		else:
			paramlist.append(None)
			paramnamelist.append(None)
	else:
		paramlist.append(None)
		paramnamelist.append(None)
OUT = (paramlist,paramnamelist)
# ----------------------------------------
code_block = CodeBlock(seq=python_script) { seq[0]; seq[1]; }
returnListOrSingleValue = Custom[ReturnListOrSingleValue](unknownItem=baseArray, seq=code_block.out0)  # If the unknown item is not a list but rather a single item, only the first item of the list (input "seq") will be returned.
familyParameter = Output(returnListOrSingleValue)
returnListOrSingleValue_2 = Custom[ReturnListOrSingleValue](unknownItem=baseArray, seq=code_block.out1)
familyParameterName = Output(returnListOrSingleValue_2)
