# Dynamo custom node Assembly.Disassemble.dyf (Dynamo 2.0.1.5055)
# category: Clockwork.Revit.Elements.Actions
# Disassembles an assembly and returns its members

assembly = Input(assembly: var[]..[])
turnIntoList = Custom[TurnIntoList](unknownItem=assembly)  # Turns an element (or a nested list) into a flat list
python_script = Python(IN[0]=turnIntoList)
# ---------- python_script.python (28 lines) ----------
import clr
clr.AddReference('RevitAPI')
from Autodesk.Revit.DB import *

clr.AddReference("RevitNodes")
import Revit
clr.ImportExtensions(Revit.GeometryConversion)

clr.AddReference("RevitServices")
import RevitServices
from RevitServices.Persistence import DocumentManager
from RevitServices.Transactions import TransactionManager

doc = DocumentManager.Instance.CurrentDBDocument
assemblies = UnwrapElement(IN[0])
elementlist = list()

# disassemble assemblies
TransactionManager.Instance.EnsureInTransaction(doc)
for assinst in assemblies:
	memberslist = assinst.Disassemble()
	members = list()
	for item in memberslist:
		members.append(doc.GetElement(item))
	elementlist.append(members)
TransactionManager.Instance.TransactionTaskDone()

OUT = elementlist
# ----------------------------------------
returnListOrSingleValue = Custom[ReturnListOrSingleValue](unknownItem=assembly, seq=python_script)  # If the unknown item is not a list but rather a single item, only the first item of the list (input "seq") will be returned.
disassembledElements = Output(returnListOrSingleValue)
