# Dynamo custom node Assembly.Members.dyf (Dynamo 2.0.0.4654)
# category: Clockwork.Revit.Elements.Query
# Retrieves the members of an assembly

assembly = Input(assembly: var[]..[])
turnIntoList = Custom[TurnIntoList](unknownItem=assembly)  # Turns an element (or a nested list) into a flat list
python_script = Python(IN[0]=turnIntoList)
# ---------- python_script.python (24 lines) ----------
import clr
clr.AddReference('RevitAPI')
from Autodesk.Revit.DB import *

clr.AddReference("RevitNodes")
import Revit
clr.ImportExtensions(Revit.GeometryConversion)

clr.AddReference("RevitServices")
import RevitServices
from RevitServices.Persistence import DocumentManager

doc = DocumentManager.Instance.CurrentDBDocument
assemblies = UnwrapElement(IN[0])
elementlist = list()

for assinst in assemblies:
	memberslist = assinst.GetMemberIds()
	members = list()
	for item in memberslist:
		members.append(doc.GetElement(item))
	elementlist.append(members)

OUT = elementlist
# ----------------------------------------
returnListOrSingleValue = Custom[ReturnListOrSingleValue](unknownItem=assembly, seq=python_script)  # If the unknown item is not a list but rather a single item, only the first item of the list (input "seq") will be returned.
memberElements = Output(returnListOrSingleValue)
