# Dynamo custom node Binary.FromBooleans.dyf (Dynamo 2.0.0.4654)
# category: Clockwork.Core.String.Generate.Create
# Creates a binary string from a list of booleans

string = StringInput("")  # graph input
booleans = Input(booleans: var[]..[])
code_block = CodeBlock(test=booleans) { test ? "1" : "0"; }
join = String.Join(separator=string, string0=code_block)
firstItem = List.FirstItem(list=join)
binary = Output(firstItem)
