# Dynamo custom node Binary.FromDecimal.dyf (Dynamo 2.12.1.8246)
# category: Clockwork.String.Generate.Create
# Converts a number to a string of its binary value

decimal = Input(decimal: int)
python_script = Python(IN[0]=decimal)  # IronPython2
# ---------- python_script.python (2 lines) ----------
if isinstance(IN[0], list): OUT = [bin(x) for x in IN[0]]
else: OUT = bin(IN[0])[2:]
# ----------------------------------------
binary = Output(python_script)
