# Dynamo custom node Booleans.AnyFalse.dyf (Dynamo 2.0.1.5055)
# category: Clockwork.List.Inspect.Query
# Returns true if any item in a list of booleans is false.

seq = Input(seq: bool[])
countFalse = List.CountFalse(list=seq)
code_block = CodeBlock(n=countFalse) { n > 0; }
bool = Output(code_block)
