# Dynamo custom node Booleans.AnyTrue.dyf (Dynamo 2.0.0.4654)
# category: Clockwork.List.Inspect.Query
# Returns true if any item in a list of booleans is true.

seq = Input(seq: bool[])
countTrue = List.CountTrue(list=seq)
code_block = CodeBlock(n=countTrue) { n > 0; }
bool = Output(code_block)
