# Dynamo custom node Booleans.CountBlocks.dyf (Dynamo 2.0.0.4654)
# category: Clockwork.List.Inspect.Query
# Retrieves the lengths of uninterrupted sequences of booleans (true or false) in a given list.

booleans = Input(booleans: bool[])
python_script = Python(IN[0]=booleans)
# ---------- python_script.python (20 lines) ----------
import clr

booleans = IN[0]
truelist = list()
truelist.append(0)
truecounter = 0
falselist = list()
falselist.append(0)
falsecounter = 0

for item in booleans:
	if item == True:
		truelist[truecounter] += 1
		falsecounter += 1
		falselist.append(0)
	elif item == False:
		falselist[falsecounter] += 1
		truecounter += 1
		truelist.append(0)
OUT = (truelist,falselist)
# ----------------------------------------
code_block = CodeBlock(seq=python_script) { seq[0]; seq[1]; }
formula = Formula("x=0")  # unwired: x
filter = List.Filter(list=code_block.out0, condition=formula)
true = Output(filter.out)
filter_2 = List.Filter(list=code_block.out1, condition=formula)
false = Output(filter_2.out)
