# Dynamo custom node BoundingBox.FromBoundingBoxes.dyf (Dynamo 2.0.3.8810)
# category: Clockwork.Geometry.Abstract.Create
# Merges a list of bounding boxes into a single bounding box

boundingBoxes = Input(boundingBoxes: Autodesk.DesignScript.Geometry.BoundingBox[]..[])
minPoint = BoundingBox.MinPoint(boundingBox=boundingBoxes)
X = Point.X(point=minPoint)
minimumItem = List.MinimumItem(list=X)
Y = Point.Y(point=minPoint)
minimumItem_2 = List.MinimumItem(list=Y)
Z = Point.Z(point=minPoint)
minimumItem_3 = List.MinimumItem(list=Z)
byCoordinates = Point.ByCoordinates(x=minimumItem, y=minimumItem_2, z=minimumItem_3)
maxPoint = BoundingBox.MaxPoint(boundingBox=boundingBoxes)
X_2 = Point.X(point=maxPoint)
maximumItem = List.MaximumItem(list=X_2)
Y_2 = Point.Y(point=maxPoint)
maximumItem_2 = List.MaximumItem(list=Y_2)
Z_2 = Point.Z(point=maxPoint)
maximumItem_3 = List.MaximumItem(list=Z_2)
byCoordinates_2 = Point.ByCoordinates(x=maximumItem, y=maximumItem_2, z=maximumItem_3)
byCorners = BoundingBox.ByCorners(min=byCoordinates, max=byCoordinates_2)
BoundingBox = Output(byCorners)
