# Dynamo custom node BoundingBox.PerimeterCurvesByNormal.dyf (Dynamo 2.0.1.5055)
# category: Clockwork.Geometry.Abstract.Actions
# Returns the perimeter curve of a bounding box on a plane determined by a given normal and the centroid of the bounding box

boundingbox = Input(boundingbox: Autodesk.DesignScript.Geometry.BoundingBox)
maxPoint = BoundingBox.MaxPoint(boundingBox=boundingbox)
minPoint = BoundingBox.MinPoint(boundingBox=boundingbox)
create = List.Create(item0=maxPoint, item1=minPoint)
transpose = List.Transpose(lists=create)
average = Custom[Point.Average](points=transpose)  # Determines the average of a list of points
normal = Input(normal: Autodesk.DesignScript.Geometry.Vector)
byOriginNormal = Plane.ByOriginNormal(origin=average, normal=normal)
perimeterCurvesOnPlane = Custom[BoundingBox.PerimeterCurvesOnPlane](boundingbox=boundingbox, plane=byOriginNormal)  # Returns the perimeter curve of a bounding box on a given plane (assuming that the bounding box and plane intersect)
curves = Output(perimeterCurvesOnPlane)
