# Dynamo custom node BoundingBox.PerimeterCurvesOnPlane.dyf (Dynamo 2.0.0.4654)
# category: Clockwork.Geometry.Abstract.Actions
# Returns the perimeter curve of a bounding box on a given plane (assuming that the bounding box and plane intersect)

plane = Input(plane: Autodesk.DesignScript.Geometry.Plane)
boundingbox = Input(boundingbox: Autodesk.DesignScript.Geometry.BoundingBox)
toCuboid = BoundingBox.ToCuboid(boundingBox=boundingbox)
intersect = Geometry.Intersect(geometry=plane, other=toCuboid)
flatten = List.Flatten(list=intersect)
perimeterCurves = Surface.PerimeterCurves(surface=flatten)
curves = Output(perimeterCurves)
