# Dynamo custom node BuiltInCategory.ByName.dyf (Dynamo 2.0.3.8810)
# category: Clockwork.Revit.Selection.Miscellaneous.Query
# Looks up all the built-in categories based on a given name (or part of a name) of the category. Search is case-insensitive.

dynamoSupportedCategoriesOnly = Input(dynamoSupportedCategoriesOnly: bool = true)
builtInCategories = Custom[Document.BuiltInCategories](dynamoSupportedCategoriesOnly=dynamoSupportedCategoriesOnly)  # List all the available BuiltInCategories
string_from_object = FromObject(obj=builtInCategories.BuiltInCategories)
searchFor = Input(searchFor: string)
ignoreCase = Input(ignoreCase: bool = true)
contains = String.Contains(str=string_from_object, searchFor=searchFor, ignoreCase=ignoreCase)
filterByBoolMask = List.FilterByBoolMask(list=builtInCategories.BuiltInCategories, mask=contains)
BuiltInCategories = Output(filterByBoolMask.in)
filterByBoolMask_2 = List.FilterByBoolMask(list=builtInCategories.ElementIDs, mask=contains)
ElementIDs = Output(filterByBoolMask_2.in)
filterByBoolMask_3 = List.FilterByBoolMask(list=builtInCategories.Categories, mask=contains)
Categories = Output(filterByBoolMask_3.in)
