# Dynamo custom node Category.FromInput.dyf (Dynamo 2.0.4.12684)
# category: Clockwork.Revit.Selection.Miscellaneous.Query
# Returns a category from a category, a Dynamo-wrapped category, a BuiltInCategory or a string representing a BuiltInCategory.

category = Input(category: var[]..[])
python_script = Python(IN[0]=category)
# ---------- python_script.python (30 lines) ----------
import System
import clr
clr.AddReference('RevitAPI')
from Autodesk.Revit.DB import *

clr.AddReference("RevitNodes")
import Revit
clr.ImportExtensions(Revit.Elements)

clr.AddReference("RevitServices")
import RevitServices
from RevitServices.Persistence import DocumentManager

def GetCatFromInput(var):	
	cat = None
	if var:
		cattype = var.GetType().ToString()
		if cattype == "Autodesk.Revit.DB.Category": cat = var
		elif cattype == "Autodesk.Revit.DB.BuiltInCategory": cat = Category.GetCategory(doc, var)
		elif cattype == "System.String": 
			found = [x for x in bics if x.ToString() == var]
			if len(found) > 0: cat = Category.GetCategory(doc, found[0])
	return cat

doc = DocumentManager.Instance.CurrentDBDocument
bics = System.Enum.GetValues(BuiltInCategory)
cats = UnwrapElement(IN[0])

if isinstance(IN[0], list): OUT = [GetCatFromInput(x) for x in cats]
else: OUT = GetCatFromInput(cats)
# ----------------------------------------
RevitCategory = Output(python_script)
