# Dynamo custom node Category.Subcategories.dyf (Dynamo 2.0.0.4654)
# category: Clockwork.Revit.Elements.Query
# Retrieves all the subcategories for a given category

category = Input(category: var[]..[])
python_script = Python(IN[0]=category)
# ---------- python_script.python (17 lines) ----------
import clr
clr.AddReference('RevitAPI')
from Autodesk.Revit.DB import *

clr.AddReference("RevitNodes")
import Revit
clr.ImportExtensions(Revit.Elements)

def GetSubcategories(cat):
	if hasattr(cat, "SubCategories"):
		return [Revit.Elements.Category.ById(x.Id.IntegerValue) for x in cat.SubCategories]
	else: return []

cats = UnwrapElement(IN[0])

if isinstance(IN[0], list): OUT = [GetSubcategories(x) for x in cats]
else: OUT = GetSubcategories(cats)
# ----------------------------------------
subcategories = Output(python_script)
