# Dynamo custom node Category.Type.dyf (Dynamo 2.0.1.5055)
# category: Clockwork.Revit.Elements.Query
# Returns the type of the category

category = Input(category: Revit.Elements.Category[]..[])
turnIntoList = Custom[TurnIntoList](unknownItem=category)  # Turns an element (or a nested list) into a flat list
python_script = Python(IN[0]=turnIntoList)
# ---------- python_script.python (17 lines) ----------
import clr
clr.AddReference('RevitAPI')
from Autodesk.Revit.DB import *

clr.AddReference("RevitNodes")
import Revit
clr.ImportExtensions(Revit.Elements)

cats = UnwrapElement(IN[0])
elementlist = list()

for cat in cats:
	try:
		elementlist.append(cat.CategoryType.ToString())
	except:
		elementlist.append(None)
OUT = elementlist
# ----------------------------------------
returnListOrSingleValue = Custom[ReturnListOrSingleValue](unknownItem=category, seq=python_script)  # If the unknown item is not a list but rather a single item, only the first item of the list (input "seq") will be returned.
categoryType = Output(returnListOrSingleValue)
