# Dynamo custom node Character.FromNumber.dyf (Dynamo 2.0.0.4654)
# category: Clockwork.Core.String.Generate.Create
# Converts a number into a character (where 1 = A, 2 = B, ... , 27 = AA, 28 = AB etc.).

code_block = CodeBlock { ""; "a".."z"; }
join = List.Join(list0=code_block.out0, list1=code_block.out1)
upperCase = Input(upperCase: bool = false)
changeCase = String.ChangeCase(str=join, upper=upperCase)
n = Input(n: int)
code_block_2 = CodeBlock(seq=changeCase, n=n)
# ---------- code_block_2.designscript (7 lines) ----------
// First digit
string1 = seq[Math.Floor((n-1)/26)];
// Second digit
rest = n%26;
string2 = seq[rest > 0 ? rest : 26];
// Entire string
string1 + string2;
# ----------------------------------------
str = Output(code_block_2.out3)
