# Dynamo custom node Color.ByWebColor.dyf (Dynamo 2.0.1.5055)
# category: Clockwork.Display.Create
# Creates a color from a given web color (a hex triplet like #FF9900)

hex = Input(hex: string)
turn_into_list = Custom[Turn Into List](unknownItem=hex)  # Turns an element (or a nested list) into a flat list
code_block = CodeBlock { "#"; ""; [0,2,4]; 2; }
replace = String.Replace(str=turn_into_list, searchFor=code_block.out0, replaceWith=code_block.out1)
substring = String.Substring(str=replace, startIndex=code_block.out2@L1, length=code_block.out3)
code_block_2 = CodeBlock(seq2=substring) { seq2[0]; seq2[1]; seq2[2]; }
hexToDecimal = Custom[String.HexToDecimal](hex=code_block_2.out0)  # Converts a string of a hexadecimal value to a number
hexToDecimal_2 = Custom[String.HexToDecimal](hex=code_block_2.out1)
hexToDecimal_3 = Custom[String.HexToDecimal](hex=code_block_2.out2)
byARGB = Color.ByARGB(r=hexToDecimal, g=hexToDecimal_2, b=hexToDecimal_3)
returnListOrSingleValue = Custom[ReturnListOrSingleValue](unknownItem=hex, seq=byARGB)  # If the item in input #1 is not a list, only the first item of the list in input #2 will be returned.
color = Output(returnListOrSingleValue)
