# Dynamo custom node Color.GreyscaleByNormalizedValue.dyf (Dynamo 2.0.0.4654)
# category: Clockwork.Display.Create
# Creates a greyscale color based on a normalized value (0 = black, 1 = white)

dbl = Input(dbl: double)
code_block = CodeBlock(x=dbl) { DSCore.Color.ByARGB(255,x*255,x*255,x*255); }
color = Output(code_block)
