# Dynamo custom node Color.ToDynamoColor.dyf (Dynamo 2.0.0.4654)
# category: Clockwork.Revit.Conversion.Actions
# Converts Revit colors into Dynamo colors

RevitColor = Input(RevitColor: var[]..[])
python_script = Python(IN[0]=RevitColor)
# ---------- python_script.python (12 lines) ----------
import clr
clr.AddReference('RevitAPI')
from Autodesk.Revit.DB import *

def GetColorComponents(color):
	if hasattr(color, "Red") and hasattr(color, "Blue") and hasattr(color, "Green"): return color.Red, color.Green, color.Blue
	else: return None, None, None

colors = UnwrapElement(IN[0])

if isinstance(IN[0], list): OUT = map(list, zip(*[GetColorComponents(x) for x in colors]))
else: OUT = GetColorComponents(colors)
# ----------------------------------------
code_block = CodeBlock(seq=python_script) { 255; seq[0]; seq[1]; seq[2]; }
byARGB = Color.ByARGB(a=code_block.out0, r=code_block.out1, g=code_block.out2, b=code_block.out3)
DynamoColor = Output(byARGB)
