# Dynamo custom node ConvexHull.2DbyUV.dyf (Dynamo 1.3.0.875)
# category: Clockwork.Geometry.Tesselation.Create
# Computes the convex hull of a given set of UV coordinates based on the monotone chain algorithm

UVs = Input(UVs : UV[])
U = UV.U(UVs)
V = UV.V(UVs)
create = List.Create(U, V)
transpose = List.Transpose(create)
python_script = Python(IN[0]=transpose)
# ---------- python_script.python (30 lines) ----------
import clr

# based on a script found here:
# http://en.wikibooks.org/wiki/Algorithm_Implementation/Geometry/Convex_hull/Monotone_chain#Python

points = IN[0]
#reformat points list
newpoints = list()
for pair in points:
	newpoint = (pair[0],pair[1])
	newpoints.append(newpoint)
points = sorted(set(newpoints))

def cross(o, a, b):
	return (a[0] - o[0]) * (b[1] - o[1]) - (a[1] - o[1]) * (b[0] - o[0])
 
if len(points) <= 1:
	OUT = points
else:
	lower = []
	for p in points:
		while len(lower) >= 2 and cross(lower[-2], lower[-1], p) <= 0:
			lower.pop()
		lower.append(p)
	upper = []
	for p in reversed(points):
		while len(upper) >= 2 and cross(upper[-2], upper[-1], p) <= 0:
			upper.pop()
		upper.append(p)
	OUT = lower[:-1] + upper[:-1]
# ----------------------------------------
transpose_2 = List.Transpose(python_script)
code_block = CodeBlock(seq=transpose_2) { seq[0]; seq[1]; }
byCoordinates = UV.ByCoordinates(code_block.out0, code_block.out1)
UVs_2 = Output(byCoordinates)  # "UVs"
