# Dynamo custom node Curve.ClosedLoopThroughPoints.dyf (Dynamo 1.3.0.875)
# category: Clockwork.Geometry.Curves.Create
# Creates a *closed* loop of curves based on a given list of points

points = Input(points : Autodesk.Point[])
boolean = BoolSelector(true)
byPoints = PolyCurve.ByPoints(points=points, connectLastToFirst=boolean)
curves = PolyCurve.Curves(byPoints)
Curves = Output(curves)
