# Dynamo custom node Data.ExportCSV+.dyf (Dynamo 2.0.1.5055)
# category: Clockwork.ImportExport.Actions
# Writes data to a CSV file with a custom delimiter. Data inputs needs to contain strings only!

path = Input(path: string)
code_block = CodeBlock { ".csv"; ".CSV"; ""; }
replace = String.Replace(str=path, searchFor=code_block.out0, replaceWith=code_block.out2)
replace_2 = String.Replace(str=replace, searchFor=code_block.out1, replaceWith=code_block.out2)
code_block_2 = CodeBlock(path=replace_2, ext=code_block.out0) { path + ext; }
string = StringInput("\n")  # graph input
delimiter = Input(delimiter: string = ",")
data = Input(data: var[]..[])
join = String.Join(separator=delimiter, string0=data)
flatten = List.Flatten(list=join)
join_2 = String.Join(separator=string, string0=flatten)
firstItem = List.FirstItem(list=join_2)
writeText = FileSystem.WriteText(filePath=code_block_2, text=firstItem)
void = Output(writeText)
