# Dynamo custom node DetailCurve.ByCurve+.dyf (Dynamo 2.0.0.4654)
# category: Clockwork.Revit.Elements.Create
# Creates a detail line based on a given curve. Unlike the OOTB node it can also draw circles.

curve = Input(curve: Autodesk.DesignScript.Geometry.Curve)
turn_into_list = Custom[Turn Into List](unknownItem=curve)  # Turns an element (or a nested list) into a flat list
view = Input(view: var[]..[])
python_script = Python(IN[0]=turn_into_list, IN[1]=view)
# ---------- python_script.python (31 lines) ----------
import clr
clr.AddReference('RevitAPI')
from Autodesk.Revit.DB import *

clr.AddReference("RevitNodes")
import Revit
clr.ImportExtensions(Revit.GeometryConversion)

clr.AddReference("RevitServices")
import RevitServices
from RevitServices.Persistence import DocumentManager
from RevitServices.Transactions import TransactionManager

doc = DocumentManager.Instance.CurrentDBDocument
curves = UnwrapElement(IN[0])
view = UnwrapElement(IN[1])
elementlist = []

TransactionManager.Instance.EnsureInTransaction(doc)
if doc.IsFamilyDocument: 
	doc_create = doc.FamilyCreate
else: 
	doc_create = doc.Create
for curve in curves:
	try:
		detcurve = doc_create.NewDetailCurve(view, curve.ToRevitType())
		elementlist.append(detcurve)
	except:
		elementlist.append(None)
TransactionManager.Instance.TransactionTaskDone()
OUT = elementlist
# ----------------------------------------
returnListOrSingleValue = Custom[ReturnListOrSingleValue](unknownItem=curve, seq=python_script)  # If the item in input #1 is not a list, only the first item of the list in input #2 will be returned.
detailCurve = Output(returnListOrSingleValue)
