# Dynamo custom node Dimension.ReferencedElements.dyf (Dynamo 2.12.1.8246)
# category: Clockwork.Revit.Elements.Query
# Returns all elements that are referenced by a given dimension

dimension = Input(dimension: var[]..[])
python_script = Python(IN[0]=dimension)  # IronPython2
# ---------- python_script.python (31 lines) ----------
import clr
clr.AddReference('RevitAPI')
from Autodesk.Revit.DB import *

clr.AddReference("RevitNodes")
import Revit
clr.ImportExtensions(Revit.Elements)

def GetDimensionReferences(item):
	if hasattr(item, "References"):
		refs = []
		linkInstances = []
		for r in item.References:
			if r.LinkedElementId != ElementId.InvalidElementId: 
				if item.Document.GetElement(r.ElementId).GetLinkDocument():
					refs.append(item.Document.GetElement(r.ElementId).GetLinkDocument().GetElement(r.LinkedElementId))
				# if the link isn't loaded, just return the RevitLinkInstance instead of the actual element
				else: refs.append(item.Document.GetElement(r.ElementId))
				linkInstances.append(item.Document.GetElement(r.ElementId))
			else: 
				refs.append(item.Document.GetElement(r.ElementId))
				linkInstances.append(None)
		return refs, linkInstances		
	else: return None

dimensions = UnwrapElement(IN[0])

if isinstance(IN[0], list): 
	if len(IN[0]) > 0: OUT = list(zip(*[GetDimensionReferences(x) for x in dimensions]))
	else: OUT = [[],[]]
else: OUT = GetDimensionReferences(dimensions)
# ----------------------------------------
firstItem = List.FirstItem(list=python_script)
elements = Output(firstItem)
lastItem = List.LastItem(list=python_script)
linkInstance = Output(lastItem)
