# Dynamo custom node DividedSurface.HorizontalIntersectsByEndpointsAndFunction.dyf (Dynamo 2.0.1.5055)
# category: Clockwork.Revit.Elements.Actions
# Creates a number of horizontal intersects (levels)for a divided surface based on the path between two points. The spacing of the intersects can be controlled by a function.

dividedSurface = Input(dividedSurface: Revit.Elements.DividedSurface)
func = Input(func: var[]..[])
subdivisions = Input(subdivisions: int)
n1 = Custom[+1](dbl=subdivisions)  # Increments a value by 1
normalized_sequence_by_function = Custom[Normalized Sequence by Function](func=func, n=n1)  # Creates a sequence of N values between 0 and 1 driven by a function
startPoint = Input(startPoint: Autodesk.DesignScript.Geometry.Point)
Z = Point.Z(point=startPoint)
endPoint = Input(endPoint: Autodesk.DesignScript.Geometry.Point)
Z_2 = Point.Z(point=endPoint)
scale_normalized_value = Custom[Scale Normalized Value](dbl=normalized_sequence_by_function, min=Z, max=Z_2)  # Scales a normalized value according to a given minimum and maximum
restOfItems = List.RestOfItems(list=scale_normalized_value)
dropLastItem = Custom[List.DropLastItem](list=restOfItems)  # Drops the last item from a given list.
intersectName = Input(intersectName: string = "HorizontalIntersect")
count = List.Count(list=dropLastItem)
code_block = CodeBlock(n=count) { 1..n; }
string_from_object = FromObject(obj=code_block)
code_block_2 = CodeBlock(intsecname=intersectName, n=string_from_object) { intsecname + n; }
byElevationAndName = Level.ByElevationAndName(elevation=dropLastItem, name=code_block_2)
addIntersect = Custom[DividedSurface.AddIntersect](dividedSurface=dividedSurface, element=byElevationAndName)  # Adds an intersect to a divided surface
dividedSurface_2 = Output(addIntersect)  # "dividedSurface"
intersects = Output(byElevationAndName)
