# Dynamo custom node Document.AddLink.dyf (Dynamo 1.3.0.875)
# category: Clockwork.Revit.Application.Actions
# Adds a link to a model to the current document

filePath = Input(filePath : string)  # The path to the model to be linked
turnIntoList = Custom[TurnIntoList](unknownItem=filePath)  # Turns an element (or a nested list) into a flat list
relativePath = Input(relativePath : bool = true)  # Set to false if the path type should be absolute.
python_script = Python(IN[0]=turnIntoList, IN[1]=relativePath)
# ---------- python_script.python (31 lines) ----------
import clr
clr.AddReference('RevitAPI')
from Autodesk.Revit.DB import *

clr.AddReference("RevitNodes")
import Revit
clr.ImportExtensions(Revit.Elements)

clr.AddReference("RevitServices")
import RevitServices
from RevitServices.Persistence import DocumentManager
from RevitServices.Transactions import TransactionManager

doc = DocumentManager.Instance.CurrentDBDocument
linkpaths = IN[0]
relative = IN[1]
elementlist = list()
booleans = list()

TransactionManager.Instance.EnsureInTransaction(doc)
for path in linkpaths:
	try:
		linkpath = ModelPathUtils.ConvertUserVisiblePathToModelPath(path)
		linkoptions = RevitLinkOptions(relative)
		linkloadresult = RevitLinkType.Create(doc, linkpath, linkoptions)
		elementlist.append(RevitLinkInstance.Create(doc, linkloadresult.ElementId).ToDSType(False))
		booleans.append(True)
	except:
		booleans.append(False)
TransactionManager.Instance.TransactionTaskDone()
OUT = (elementlist, booleans)
# ----------------------------------------
code_block = CodeBlock(seq=python_script) { seq[0]; seq[1]; }
returnListOrSingleValue = Custom[ReturnListOrSingleValue](unknownItem=filePath, seq=code_block.out0)  # If the unknown item is not a list but rather a single item, only the first item of the list (input "seq") will be returned.
RevitLinkInstance = Output(returnListOrSingleValue)
returnListOrSingleValue_2 = Custom[ReturnListOrSingleValue](unknownItem=filePath, seq=code_block.out1)
success = Output(returnListOrSingleValue_2)
