# Dynamo custom node Document.Default3DView.dyf (Dynamo 2.0.1.5055)
# category: Clockwork.Revit.Application.Query
# Returns the default 3D view of the current model (if there is such a view)

toggle = Input(toggle: bool = true)
docOrRevitLinkInstance = Input(docOrRevitLinkInstance: var = null)  # Use only if you want to query a linked model
views = Custom[Document.Views](toggle=toggle, docOrRevitLinkInstance=docOrRevitLinkInstance)  # Gets all views in the document - except for 3D view templates (as long as this bug is not fixed: https://github.com/DynamoDS/Dynamo/issues/2970)
type = Custom[View.Type](view=views)  # Returns the type of a given view
code_block = CodeBlock(type=type) { type == "ThreeD"; }
filterByBoolMask = List.FilterByBoolMask(list=views, mask=code_block)
name = Element.Name(element=filterByBoolMask.in)
string = StringInput("{3d")  # graph input
boolean = BoolSelector(true)  # graph input
startsWith = String.StartsWith(str=name, searchFor=string, ignoreCase=boolean)
filterByBoolMask_2 = List.FilterByBoolMask(list=filterByBoolMask.in, mask=startsWith)
isEmpty = List.IsEmpty(list=filterByBoolMask_2.in)
code_block_2 = CodeBlock { null; }
firstItem = List.FirstItem(list=filterByBoolMask_2.in)
scopeIf = Custom[ScopeIf+](test=isEmpty, true=code_block_2, false=firstItem)  # A (hopefully) more robust implementation of ScopeIf. Tests a single boolean and returns a value accordingly.
view = Output(scopeIf)
