# Dynamo custom node Document.ElementClasses.dyf (Dynamo 2.12.1.8246)
# category: Clockwork.Revit.Application.Query
# Retrieves a list of all Revit element classes
# packages: Clockwork for Dynamo 2.x 2.12.2

python_script = Python()  # IronPython2; graph input
# ---------- python_script.python (13 lines) ----------
import clr
clr.AddReference('RevitAPI')
from Autodesk.Revit.DB import *
import Autodesk
clr.AddReference('RevitNodes')
import Revit
clr.ImportExtensions(Revit.Elements)
import System.Reflection
import System.AppDomain

rAssembly = [x for x in System.AppDomain.CurrentDomain.GetAssemblies() if x.GetName().Name == 'RevitAPI'][0]
rElement = [x for x in rAssembly.GetTypes() if x.Name == 'Element' and x.Namespace == 'Autodesk.Revit.DB'][0]
OUT = [x for x in rAssembly.GetTypes() if x.IsClass and x.IsSubclassOf(rElement)]
# ----------------------------------------
name = Custom[Element.Name+](element=python_script)  # package Clockwork for Dynamo 2.x; Gets an element's name. Unlike the OOTB node, this node should work for *all* Revit elements that have names and will also return the localized names of system parameters, parameter groups, display unit types, parameter types, unit symbol types, unit types and ForgeTypeIds.
sortByKey = List.SortByKey(list=python_script, keys=name)
elementClasses = Output(sortByKey.sortedList)
elementClassNames = Output(sortByKey.sortedKeys)
