# Dynamo custom node Document.ProjectPosition.dyf (Dynamo 2.0.1.5055)
# category: Clockwork.Revit.Application.Query
# Gets the project's position data relative to the origin. Output coordinates may diverge from the project base point coordinates once the project base point has been moved in an unclipped state. Use the built-in nodes Location.Latitude & Location.Longitude to retrieve latitude and longitude.

toggle = Input(toggle: bool = true)
docOrRevitLinkInstance = Input(docOrRevitLinkInstance: var = null)  # Use only if you want to query a linked model
version = Custom[Application.Version]()  # Retrieves the name, version and build of the current Revit application.
python_script = Python(IN[0]=toggle, IN[1]=docOrRevitLinkInstance, IN[2]=version.Version_int)
# ---------- python_script.python (27 lines) ----------
import clr
clr.AddReference('RevitAPI')
from Autodesk.Revit.DB import *
import Autodesk

clr.AddReference("RevitServices")
import RevitServices
from RevitServices.Persistence import DocumentManager

inputdoc = UnwrapElement(IN[1])
version = IN[2]
if inputdoc == None:
	doc = DocumentManager.Instance.CurrentDBDocument
elif inputdoc.GetType().ToString() == "Autodesk.Revit.DB.RevitLinkInstance":
	doc = inputdoc.GetLinkDocument()
elif inputdoc.GetType().ToString() == "Autodesk.Revit.DB.Document":
	doc = inputdoc
else: doc = None

projloc = doc.ActiveProjectLocation
if version > 2017:
	position_data = projloc.GetProjectPosition(XYZ.Zero)
	location_data = projloc.GetSiteLocation()
else:
	position_data = projloc.ProjectPosition[XYZ.Zero]
	location_data = projloc.SiteLocation
OUT = (position_data.Angle,position_data.Elevation,position_data.EastWest,position_data.NorthSouth)
# ----------------------------------------
code_block = CodeBlock(seq=python_script) { seq[0]; seq[1]; seq[2]; seq[3]; }
radiansToDegrees = Math.RadiansToDegrees(radians=code_block.out0)
Angle_degr = Output(radiansToDegrees)  # "Angle (degr.)"
unit_types = UnitTypes(index=2)  # graph input
displayUnitType = Custom[UnitType.DisplayUnitType](unitType=unit_types)  # Retrieves the display unit type for a given unit type.
toDisplayUnit = Custom[InternalUnit.ToDisplayUnit](val=code_block.out1, displayUnitType=displayUnitType.displayUnitType)  # Converts a value from Revit's internal unit to a given display unit
Elevation = Output(toDisplayUnit)
toDisplayUnit_2 = Custom[InternalUnit.ToDisplayUnit](val=code_block.out2, displayUnitType=displayUnitType.displayUnitType)
EastWest = Output(toDisplayUnit_2)
toDisplayUnit_3 = Custom[InternalUnit.ToDisplayUnit](val=code_block.out3, displayUnitType=displayUnitType.displayUnitType)
NorthSouth = Output(toDisplayUnit_3)
