# Dynamo custom node Document.UnitTypes.dyf (Dynamo 2.12.0.5650)
# category: Clockwork.Revit.Application.Query
# Retrieves all available unit types of a given document (as of Revit 2022: ForgeTypeIds)
# packages: Clockwork for Dynamo 2.x 2.3.0

toggle = Input(toggle: bool = true)
docOrRevitLinkInstance = Input(docOrRevitLinkInstance: var = null)  # Use only if you want to query a linked model
version = Custom[Application.Version]()  # package Clockwork for Dynamo 2.x; Retrieves the name, version and build of the current Revit application.
python_script = Python(IN[0]=toggle, IN[1]=docOrRevitLinkInstance, IN[2]=version.Version)  # IronPython2
# ---------- python_script.python (24 lines) ----------
import clr
clr.AddReference('RevitAPI')
from Autodesk.Revit.DB import *
import Autodesk

clr.AddReference("RevitNodes")
import Revit
clr.ImportExtensions(Revit.Elements)

clr.AddReference("RevitServices")
import RevitServices
from RevitServices.Persistence import DocumentManager

inputdoc = UnwrapElement(IN[1])
if inputdoc == None:
	doc = DocumentManager.Instance.CurrentDBDocument
elif inputdoc.GetType().ToString() == "Autodesk.Revit.DB.RevitLinkInstance":
	doc = inputdoc.GetLinkDocument()
elif inputdoc.GetType().ToString() == "Autodesk.Revit.DB.Document":
	doc = inputdoc
else: doc = None

if IN[2] > 2021: OUT = doc.GetUnits().GetModifiableSpecs()
else: OUT = doc.GetUnits().GetModifiableUnitTypes()
# ----------------------------------------
unitTypes = Output(python_script)
