# Dynamo custom node Document.Worksets.dyf (Dynamo 1.3.1.1736)
# category: Clockwork.Revit.Application.Query
# Returns all Worksets in the current document

toggle = Input(toggle : bool = true)
docOrRevitLinkInstance = Input(docOrRevitLinkInstance : var = null)  # Use only if you want to query a linked model
python_script = Python(IN[0]=toggle, IN[1]=docOrRevitLinkInstance)
# ---------- python_script.python (20 lines) ----------
import clr
clr.AddReference('RevitAPI')
from Autodesk.Revit.DB import *
import Autodesk

clr.AddReference("RevitServices")
import RevitServices
from RevitServices.Persistence import DocumentManager

inputdoc = UnwrapElement(IN[1])
if inputdoc == None:
	doc = DocumentManager.Instance.CurrentDBDocument
elif inputdoc.GetType().ToString() == "Autodesk.Revit.DB.RevitLinkInstance":
	doc = inputdoc.GetLinkDocument()
elif inputdoc.GetType().ToString() == "Autodesk.Revit.DB.Document":
	doc = inputdoc
else: doc = None

collector = FilteredWorksetCollector(doc)
OUT = collector.ToWorksets()
# ----------------------------------------
worksets = Output(python_script)
