# Dynamo custom node Element.Area.dyf (Dynamo 2.12.1.8246)
# category: Clockwork.Revit.Elements.Query
# Returns the area property of a given spatial element (room, area or space)
# packages: Clockwork for Dynamo 2.x 2.6.0

element = Input(element: var[]..[])
version = Custom[Application.Version]()  # package Clockwork for Dynamo 2.x; Retrieves the name, version and build of the current Revit application.
python_script = Python(IN[0]=element, IN[1]=version.Version)  # IronPython2
# ---------- python_script.python (27 lines) ----------
import clr
clr.AddReference('RevitAPI')
from Autodesk.Revit.DB import *

clr.AddReference("RevitServices")
import RevitServices
from RevitServices.Persistence import DocumentManager
doc = DocumentManager.Instance.CurrentDBDocument

spatialElements = UnwrapElement(IN[0])
version = IN[1]
if version > 2021: unittype = ForgeTypeId('autodesk.spec.aec:area-2.0.0')
else: unittype = UnitType.UT_Area

def InternalUnitToDisplayUnit(val, unittype):
	formatoptions = doc.GetUnits().GetFormatOptions(unittype)
	if version > 2021: dispunits = formatoptions.GetUnitTypeId()
	else: dispunits = formatoptions.DisplayUnits
	try: return UnitUtils.ConvertFromInternalUnits(val,dispunits)
	except: return None
	
def GetArea(spatialElement):
	if hasattr(spatialElement, "Area"): return InternalUnitToDisplayUnit(spatialElement.Area, unittype)
	else: return None

if isinstance(IN[0], list): OUT = [GetArea(x) for x in spatialElements]
else: OUT = GetArea(spatialElements)
# ----------------------------------------
area = Output(python_script)
