# Dynamo custom node Element.AssociatedFamilyParameters.dyf (Dynamo 2.0.3.8810)
# category: Clockwork.Revit.Elements.Query
# Returns the associated family parameters of an element in a family (and the respective element parameters). PLEASE NOTE: This node will only work in a family document!

element = Input(element: var[]..[])
turnIntoList = Custom[TurnIntoList](unknownItem=element)  # Turns an element (or a nested list) into a flat list
python_script = Python(IN[0]=turnIntoList)
# ---------- python_script.python (32 lines) ----------
import clr
clr.AddReference('RevitAPI')
from Autodesk.Revit.DB import *

clr.AddReference("RevitNodes")
import Revit
clr.ImportExtensions(Revit.Elements)

clr.AddReference("RevitServices")
import RevitServices
from RevitServices.Persistence import DocumentManager

doc = DocumentManager.Instance.CurrentDBDocument
items = UnwrapElement(IN[0])
elementlist = list()
for item in items:
	paramlist = list()
	assoclist = list()
	paramnamelist = list()
	assocnamelist = list()
	try:
		for param in item.Parameters:
			assoc = doc.FamilyManager.GetAssociatedFamilyParameter(param)
			if assoc != None:
				paramlist.append(param)
				assoclist.append(assoc)
				paramnamelist.append(param.Definition.Name)
				assocnamelist.append(assoc.Definition.Name)
	except:
		pass
	elementlist.append((paramlist,assoclist,paramnamelist,assocnamelist))
OUT = elementlist
# ----------------------------------------
transpose = List.Transpose(lists=python_script)
code_block = CodeBlock(seq=transpose) { seq[0]; seq[1]; seq[2]; seq[3]; }
returnListOrSingleValue = Custom[ReturnListOrSingleValue](unknownItem=element, seq=code_block.out0)  # If the unknown item is not a list but rather a single item, only the first item of the list (input "seq") will be returned.
elementParameters = Output(returnListOrSingleValue)
returnListOrSingleValue_2 = Custom[ReturnListOrSingleValue](unknownItem=element, seq=code_block.out1)
associatedFamilyParameters = Output(returnListOrSingleValue_2)
returnListOrSingleValue_3 = Custom[ReturnListOrSingleValue](unknownItem=element, seq=code_block.out2)
elementParameterNames = Output(returnListOrSingleValue_3)
returnListOrSingleValue_4 = Custom[ReturnListOrSingleValue](unknownItem=element, seq=code_block.out3)
associatedFamilyParameterNames = Output(returnListOrSingleValue_4)
