# Dynamo custom node Element.ContainsTransparentMaterials.dyf (Dynamo 2.0.1.5055)
# category: Clockwork.Revit.Elements.Query
# Checks if a given element contains transparent materials.

element = Input(element: var[]..[])
turn_into_list = Custom[Turn Into List](unknownItem=element)  # Turns an element (or a nested list) into a flat list
boolean = BoolSelector(false)  # graph input
materials = Custom[Element.Materials+](element=turn_into_list, returnPaintMaterials=boolean)  # Retrieves all materials froma given element
properties = Custom[Material.Properties]()  # Retrieves a number of properties froma given material; unwired: material
map = List.Map(list=materials.materials, f_x=properties.Transparency)
minTransparencyPercentage = Input(minTransparencyPercentage: double)
formula = Formula("x>y", y=minTransparencyPercentage)  # unwired: x
map_2 = List.Map(list=map, f_x=formula)
anyTrue = Custom[List.AnyTrue]()  # Returns true if any item in a list of booleans is true.; unwired: seq
map_3 = List.Map(list=map_2, f_x=anyTrue)
returnListOrSingleValue = Custom[ReturnListOrSingleValue](unknownItem=element, seq=map_3)  # If the item in input #1 is not a list, only the first item of the list in input #2 will be returned.
bool = Output(returnListOrSingleValue)
