# Dynamo custom node Element.CopyByVector.dyf (Dynamo 2.0.0.4654)
# category: Clockwork.Revit.Elements.Actions
# Copies an element or a list of elements by a given vector.

element = Input(element: var[]..[])
turnIntoList = Custom[TurnIntoList](unknownItem=element)  # Turns an element (or a nested list) into a flat list
vector = Input(vector: Autodesk.DesignScript.Geometry.Vector)
asPoint = Vector.AsPoint(vector=vector)
rehostToClosestLevel = Input(rehostToClosestLevel: bool = false)
python_script = Python(IN[0]=turnIntoList, IN[1]=asPoint, IN[2]=rehostToClosestLevel)
# ---------- python_script.python (38 lines) ----------
import clr
from System.Collections.Generic import *
clr.AddReference('RevitAPI')
from Autodesk.Revit.DB import *
import Autodesk

clr.AddReference("RevitNodes")
import Revit
clr.ImportExtensions(Revit.Elements)
clr.ImportExtensions(Revit.GeometryConversion)

clr.AddReference("RevitServices")
import RevitServices
from RevitServices.Persistence import DocumentManager
from RevitServices.Transactions import TransactionManager

doc = DocumentManager.Instance.CurrentDBDocument
items = UnwrapElement(IN[0])
xyz = UnwrapElement(IN[1]).ToXyz()
rehost = IN[2]

ids = list()
for item in items:
	ids.append(item.Id)	
itemlist = List[ElementId](ids)

TransactionManager.Instance.EnsureInTransaction(doc)
if rehost:
	newitems = ElementTransformUtils.CopyElements(doc,itemlist,doc,Transform.CreateTranslation(xyz),None)
else:
	newitems = ElementTransformUtils.CopyElements(doc,itemlist,xyz)
TransactionManager.Instance.TransactionTaskDone()

elementlist = list()
for item in newitems:
	elementlist.append(doc.GetElement(item).ToDSType(False))

OUT = elementlist
# ----------------------------------------
newElement = Output(python_script)
