# Dynamo custom node Element.CopyToLevel.dyf (Dynamo 2.0.0.4654)
# category: Clockwork.Revit.Elements.Actions
# Copies an element or a list of elements to a given level. Preserves the element's transform. PLEASE NOTE: This node only works for levels that have at least one view (e.g. floor plan) associated with them.

element = Input(element: var[]..[])
turnIntoList = Custom[TurnIntoList](unknownItem=element)  # Turns an element (or a nested list) into a flat list
firstItem = List.FirstItem(list=turnIntoList)
level = Custom[Element.Level](element=firstItem)  # Gets an element's level
views = Custom[Level.Views](level=level)  # Returns all views associated with a given level
level_2 = Input(level: Revit.Elements.Level)
views_2 = Custom[Level.Views](level=level_2)
python_script = Python(IN[0]=turnIntoList, IN[1]=views.firstView, IN[2]=views_2.firstView)
# ---------- python_script.python (34 lines) ----------
import clr
from System.Collections.Generic import *
clr.AddReference('RevitAPI')
from Autodesk.Revit.DB import *
import Autodesk

clr.AddReference("RevitNodes")
import Revit
clr.ImportExtensions(Revit.Elements)

clr.AddReference("RevitServices")
import RevitServices
from RevitServices.Persistence import DocumentManager
from RevitServices.Transactions import TransactionManager

doc = DocumentManager.Instance.CurrentDBDocument
items = UnwrapElement(IN[0])
source_view = UnwrapElement(IN[1])
target_view = UnwrapElement(IN[2])

ids = list()
for item in items:
	ids.append(item.Id)	
itemlist = List[ElementId](ids)

TransactionManager.Instance.EnsureInTransaction(doc)
newitems = ElementTransformUtils.CopyElements(source_view,itemlist,target_view, None, None)
TransactionManager.Instance.TransactionTaskDone()

elementlist = list()
for item in newitems:
	elementlist.append(doc.GetElement(item).ToDSType(False))

OUT = elementlist
# ----------------------------------------
newElement = Output(python_script)
