# Dynamo custom node Element.CutGeometry.dyf (Dynamo 2.0.0.4654)
# category: Clockwork.Revit.Elements.Actions
# Adds a solid-solid cut for two model elements (if possible).

elementToBeCut = Input(elementToBeCut: var[]..[])
turnIntoList = Custom[TurnIntoList](unknownItem=elementToBeCut)  # Turns an element (or a nested list) into a flat list
cuttingElement = Input(cuttingElement: var[]..[])
turnIntoList_2 = Custom[TurnIntoList](unknownItem=cuttingElement)
python_script = Python(IN[0]=turnIntoList, IN[1]=turnIntoList_2)
# ---------- python_script.python (29 lines) ----------
import clr
clr.AddReference('RevitAPI')
from Autodesk.Revit.DB import *
from System.Collections.Generic import *
clr.AddReference("RevitServices")
import RevitServices
from RevitServices.Persistence import DocumentManager
from RevitServices.Transactions import TransactionManager

doc = DocumentManager.Instance.CurrentDBDocument
items1 = UnwrapElement(IN[0])
items2 = UnwrapElement(IN[1])
i = 0
booleans = list()
TransactionManager.Instance.EnsureInTransaction(doc)
for item1 in items1:
	try:
		SolidSolidCutUtils.AddCutBetweenSolids(doc,item1,items2[i])
		booleans.append(True)
	except:
		try:
			InstanceVoidCutUtils.AddInstanceVoidCut(doc,item1,items2[i])
			booleans.append(True)
		except:
			booleans.append(False)
	i += 1
TransactionManager.Instance.TransactionTaskDone()

OUT = booleans
# ----------------------------------------
returnListOrSingleValue = Custom[ReturnListOrSingleValue](unknownItem=elementToBeCut, seq=python_script)  # If the unknown item is not a list but rather a single item, only the first item of the list (input "seq") will be returned.
success = Output(returnListOrSingleValue)
