# Dynamo custom node Element.ElementType+.dyf (Dynamo 2.0.1.5055)
# category: Clockwork.Revit.Elements.Query
# Gets the family type of a given element (if applicable). Unlike the OOTB node, it also works for elements in linked models.

element = Input(element: var[]..[])
turn_into_list = Custom[Turn Into List](unknownItem=element)  # Turns an element (or a nested list) into a flat list
python_script = Python(IN[0]=turn_into_list)
# ---------- python_script.python (12 lines) ----------
import clr
clr.AddReference('RevitAPI')
from Autodesk.Revit.DB import *

items = UnwrapElement(IN[0])
typelist = list()
for item in items:
	try: 
		typelist.append(item.Document.GetElement(item.GetTypeId()))
	except:
		typelist.append(None)
OUT = typelist
# ----------------------------------------
returnListOrSingleValue = Custom[ReturnListOrSingleValue](unknownItem=element, seq=python_script)  # If the item in input #1 is not a list, only the first item of the list in input #2 will be returned.
type = Output(returnListOrSingleValue)
