# Dynamo custom node Element.ElevationOfHostLevel.dyf (Dynamo 2.0.1.5055)
# category: Clockwork.Revit.Elements.Query
# Returns the elevation of the level a given element is associated with

element = Input(element: var[]..[])
level = Custom[Element.Level](element=element)  # Gets an element's level
code_block = CodeBlock(lvl=level) { lvl.Elevation; }
double = Output(code_block)
