# Dynamo custom node Element.ExtensibleStorageData.dyf (Dynamo 2.3.0.5885)
# category: Clockwork.Revit.Elements.Query
# Reads the extensible storage data of a given schema from an element
# packages: Clockwork for Dynamo 2.x 2.3.0

element = Input(element: var[]..[])
schema = Input(schema: var[]..[])
fields = Custom[Schema.Fields](schema=schema)  # package Clockwork for Dynamo 2.x; Returns the fields of a given ExtensibleStorage Schema
fieldProperties = Custom[FieldProperties](schemaField=fields)  # package Clockwork for Dynamo 2.x; Retrieves the properties of a given ExtensibleStorage schema field
python_script = Python(IN[0]=element, IN[1]=schema, IN[2]=fieldProperties.name, IN[3]=fieldProperties.valueType)
# ---------- python_script.python (18 lines) ----------
import clr
clr.AddReference('RevitAPI')
from Autodesk.Revit.DB import *

clr.AddReference("RevitNodes")
import Revit
clr.ImportExtensions(Revit.Elements)

def ReadESData(item, schema, fields, valtypes):
	if hasattr(item, "GetEntity"):
		ent =  item.GetEntity(schema)
		return [ent.Get[y](x) for x, y in zip(fields,valtypes)]
	else: return None

items = UnwrapElement(IN[0])

if isinstance(IN[0], list): OUT = map(list, zip(*[ReadESData(x, IN[1], IN[2], IN[3]) for x in items]))
else: OUT = ReadESData(items, IN[1], [2], IN[3])
# ----------------------------------------
data = Output(python_script)
fields_2 = Output(fieldProperties.name)  # "fields"
