# Dynamo custom node Element.Host+.dyf (Dynamo 2.0.1.5055)
# category: Clockwork.Revit.Elements.Query
# Gets an element's host. Unlike the OOTB node FamilyInstance.GetHost it not only works for family instances but also for elements like wall sweeps, foundations, railings, builing pads and topo subregions.

element = Input(element: var[]..[])
python_script = Python(IN[0]=element)
# ---------- python_script.python (23 lines) ----------
import clr
clr.AddReference('RevitAPI')
from Autodesk.Revit.DB import *

clr.AddReference("RevitNodes")
import Revit
clr.ImportExtensions(Revit.Elements)

def GetHost(item):
	# standard
	if hasattr(item, "Host"): return item.Host
	# Wall sweeps
	elif hasattr(item, "GetHostIds"): return [item.Document.GetElement(x) for x in item.GetHostIds()]
	# Wall foundations
	elif hasattr(item, "WallId"): return item.Document.GetElement(item.WallId)
	# railings, building pads, topo subregions
	elif hasattr(item, "HostId"): return item.Document.GetElement(item.HostId)
	else: return None

items = UnwrapElement(IN[0])

if isinstance(IN[0], list): OUT = [GetHost(x) for x in items]
else: OUT = GetHost(items)
# ----------------------------------------
host = Output(python_script)
