# Dynamo custom node Element.Inserts.dyf (Dynamo 2.0.1.5055)
# category: Clockwork.Revit.Elements.Query
# Gets all the objects inserted into a given element.

element = Input(element: var[]..[])
turn_into_list = Custom[Turn Into List](unknownItem=element)  # Turns an element (or a nested list) into a flat list
includeOpenings = Input(includeOpenings: bool = false)
includeShadows = Input(includeShadows: bool = false)
includeEmbeddedWalls = Input(includeEmbeddedWalls: bool = false)
includeSharedEmbeddedInserts = Input(includeSharedEmbeddedInserts: bool = false)
python_script = Python(IN[0]=turn_into_list, IN[1]=includeOpenings, IN[2]=includeShadows, IN[3]=includeEmbeddedWalls, IN[4]=includeSharedEmbeddedInserts)
# ---------- python_script.python (24 lines) ----------
import clr
clr.AddReference('RevitAPI')
from Autodesk.Revit.DB import *

clr.AddReference("RevitNodes")
import Revit
clr.ImportExtensions(Revit.Elements)

items = UnwrapElement(IN[0])
incopenings = IN[1]
incshadows = IN[2]
incwalls = IN[3]
incshared = IN[4]
elementlist = list()

for item in items:
	itemlist = list()
	try:
		for insert in item.FindInserts(incopenings,incshadows,incwalls,incshared):
			itemlist.append(item.Document.GetElement(insert).ToDSType(True))
	except:
		pass
	elementlist.append(itemlist)
OUT = elementlist
# ----------------------------------------
returnListOrSingleValue = Custom[ReturnListOrSingleValue](unknownItem=element, seq=python_script)  # If the item in input #1 is not a list, only the first item of the list in input #2 will be returned.
inserts = Output(returnListOrSingleValue)
