# Dynamo custom node Element.IsOfCategory.dyf (Dynamo 2.0.3.8810)
# category: Clockwork.Revit.Elements.Element.Query
# Checks whether an element is of a specified category

category = Input(category: var[]..[])  # Works with categories, BuiltInCategories and BuiltInCategories as strings
fromInput = Custom[BuiltInCategory.FromInput](var_var=category)  # Returns a BuiltInCategory from a category, a Dynamo-wrapped category, a BuiltInCategory or a string representing a BuiltInCategory.
string_from_object = FromObject(obj=fromInput)
element = Input(element: var[]..[])
category_2 = Custom[Element.Category+](element=element)  # Returns the category of a given element. Unlike the OOTB node Element.GetCategory, it will work for families, schedules and graphics styles as well.
string_from_object_2 = FromObject(obj=category_2.builtInCategory)
python_script = Python(IN[0]=string_from_object, IN[1]=string_from_object_2)
# ---------- python_script.python (10 lines) ----------
cats = IN[0]
ecats = IN[1]
if isinstance(IN[1], list):
	if isinstance(IN[0], list):
		if len(cats) == len(ecats): OUT = [x == y for x, y in zip(cats, ecats)]
		else: OUT = [x in cats for x in ecats]
	else: OUT = [x == cats for x in ecats]
else:
	if isinstance(IN[0], list): OUT = ecats in cats
	else: OUT = cats == ecats
# ----------------------------------------
bool = Output(python_script)
