# Dynamo custom node Element.Move.dyf (Dynamo 2.3.0.5885)
# category: Clockwork.Revit.Elements.Actions
# Moves a point-based element to the given location

element = Input(element: var[]..[])
element_2 = Output(element)  # "element"
point = Input(point: Autodesk.DesignScript.Geometry.Point[]..[])
python_script = Python(IN[0]=element, IN[1]=point)
# ---------- python_script.python (36 lines) ----------
import clr
clr.AddReference('RevitAPI')
from Autodesk.Revit.DB import *

clr.AddReference("RevitNodes")
import Revit
clr.ImportExtensions(Revit.Elements)
clr.ImportExtensions(Revit.GeometryConversion)

clr.AddReference("RevitServices")
import RevitServices
from RevitServices.Persistence import DocumentManager
from RevitServices.Transactions import TransactionManager

doc = DocumentManager.Instance.CurrentDBDocument
items = UnwrapElement(IN[0])
points = IN[1]

def MoveElement(item, point):
	success = False
	if hasattr(item, "Location"):
		loc = item.Location
		if loc:
			if loc.ToString() == 'Autodesk.Revit.DB.LocationPoint' and not item.Pinned:
				moved = loc.Move(point.ToXyz() - loc.Point)
				if moved: success = True
	return success

TransactionManager.Instance.EnsureInTransaction(doc)
if isinstance(IN[0], list):
	if isinstance(points, list): OUT = [MoveElement(x, y) for x, y in zip(items, points)]
	else: OUT = [MoveElement(x, points) for x in items]
else:
	if isinstance(points, list): OUT = MoveElement(items, points[0])
	else: OUT = MoveElement(items, points)
TransactionManager.Instance.TransactionTaskDone()
# ----------------------------------------
success = Output(python_script)
