# Dynamo custom node Element.MoveToPoint.dyf (Dynamo 2.12.1.8246)
# category: Clockwork.Revit.Elements.Actions
# Moves a point-based element to the given location
# packages: Clockwork for Dynamo 2.x 2.4.0

element = Input(element: var[]..[])
getLocation = Element.GetLocation(element=element)
point = Input(point: Autodesk.DesignScript.Geometry.Point[]..[])
byTwoPoints = Vector.ByTwoPoints(start=getLocation, end=point)
python_script_element = Python(IN[0]=element, IN[1]=byTwoPoints)  # "Python Script: Element.MoveByVector"; IronPython2
# ---------- python_script_element.python (27 lines) ----------
# Phython-Standard- und DesignScript-Bibliotheken laden
import sys
import clr
clr.AddReference('RevitNodes', 'RevitServices')
from RevitServices.Transactions import TransactionManager
from RevitServices.Persistence import DocumentManager
import Revit
clr.ImportExtensions(Revit.GeometryConversion)

doc = DocumentManager.Instance.CurrentDBDocument

elements = UnwrapElement(IN[0])
points = UnwrapElement(IN[1])

if not hasattr(elements, "__iter__"):
	elements = [element]
if not hasattr(points, "__iter__"):
	elements = [points]
	
TransactionManager.Instance.EnsureInTransaction(doc)
OUT = []
for element, point in zip(elements, points):
    try:
    	res = element.Location.Move(point.ToXyz(True))
    	OUT.append([element, res])
    except: OUT.append([element, False])
TransactionManager.Instance.TransactionTaskDone()
# ----------------------------------------
passthrough = Custom[Passthrough](passThrough=element, waitFor=python_script_element)  # package Clockwork for Dynamo 2.x; Forces a sequential order of execution. The node wired into the output of the Passthrough node will be executed *after* the node wired into the waitFor input (e.g. important for some Revit operations). The value of the passThrough input will be passed on to the node wired into the output port of the Passthrough node.
element_2 = Output(passthrough)  # "element"
getLocation_2 = Element.GetLocation(element=passthrough)
isAlmostEqualTo = Geometry.IsAlmostEqualTo(geometry=getLocation_2, other=point)
success = Output(isAlmostEqualTo)
