# Dynamo custom node Element.Panels.dyf (Dynamo 2.0.1.5055)
# category: Clockwork.Revit.Elements.Query
# Retrieves the panels nested in a curtain wall, curtain system or glazed roof.
# Differences to OOTB node CurtainPanel.ByElement:
# - Returns embedded walls
# - Panels of curtain systems and glazed roofs are returned in a nested list, with one sublist for each face of the curtain system.
# PLEASE NOTE: Will not work for glazed roofs created by RoofByFace method.

hostElement = Input(hostElement: var[]..[])
python_script = Python(IN[0]=hostElement)
# ---------- python_script.python (30 lines) ----------
import clr
clr.AddReference('RevitAPI')
from Autodesk.Revit.DB import *

clr.AddReference("RevitNodes")
import Revit
clr.ImportExtensions(Revit.Elements)

def GetCurtainPanels(host):
	if hasattr(host, "CurtainGrid"):
		return GetCurtainPanelsByGrid(host.CurtainGrid, host)
	elif hasattr(host, "CurtainGrids"):
		return [GetCurtainPanelsByGrid(x, host) for x in host.CurtainGrids]
	else: return []

def GetCurtainPanelsByGrid(grid, host):
	if grid:
		panellist = [host.Document.GetElement(x) for x in grid.GetPanelIds()]
		for panel in panellist:
			if hasattr(panel, "FindHostPanel"):
				hostpanelid = panel.FindHostPanel()
				if hostpanelid.IntegerValue != -1:
					panellist[panellist.index(panel)] = host.Document.GetElement(hostpanelid)
		return [x.ToDSType(True) for x in panellist]
	else: return list()

items = UnwrapElement(IN[0])

if isinstance(IN[0], list): OUT = [GetCurtainPanels(x) for x in items]
else: OUT = GetCurtainPanels(items)
# ----------------------------------------
panels = Output(python_script)
