# Dynamo custom node Element.ParameterExists.dyf (Dynamo 2.0.0.4654)
# category: Clockwork.Revit.Elements.Query
# Checks if an element contains a parameter of a given name

element = Input(element: Revit.Elements.Element)
param = Input(param: string)
parameterByName = Parameter.ParameterByName(element=element, name=param)
isNull = Object.IsNull(obj=parameterByName)
not_ = Not(x=isNull)
bool = Output(not_)
