# Dynamo custom node Element.ResetSlabShape.dyf (Dynamo 2.19.3.6394)
# category: Clockwork.Revit.Elements.Actions
# Resets the slabshape of a roof, floor slab or toposolid

element = Input(element: var[]..[])
python_script = Python(IN[0]=element)  # IronPython2
# ---------- python_script.python (36 lines) ----------
import clr
clr.AddReference('RevitAPI')
from Autodesk.Revit.DB import *

clr.AddReference("RevitNodes")
import Revit
clr.ImportExtensions(Revit.GeometryConversion)

clr.AddReference("RevitServices")
import RevitServices
from RevitServices.Persistence import DocumentManager
from RevitServices.Transactions import TransactionManager

doc = DocumentManager.Instance.CurrentDBDocument
slabs = UnwrapElement(IN[0])
success = []

def SlabShapeReset(slab):
	if hasattr(slab, "SlapShapeEditor"):
		try:
			slab.SlabShapeEditor.ResetSlabShape()
			return slab, True
		except: return slab, False
	if hasattr(slab, "GetSlapShapeEditor"):
		try:
			slab.GetSlabShapeEditor().ResetSlabShape()
			return slab, True
		except: return slab, False
	else: return slab, False

TransactionManager.Instance.EnsureInTransaction(doc)
if isinstance(IN[0], list): 
	results = [SlabShapeReset(x) for x in slabs]
	OUT = list(zip(*results))
else: OUT = SlabShapeReset(slabs)
TransactionManager.Instance.TransactionTaskDone()
# ----------------------------------------
firstItem = List.FirstItem(list=python_script)
element_2 = Output(firstItem)  # "element"
lastItem = List.LastItem(list=python_script)
success = Output(lastItem)
