# Dynamo custom node Element.SetName.dyf (Dynamo 2.6.1.8786)
# category: Clockwork.Revit.Elements.Actions
# Gets the name of a given Revit element
# packages: Clockwork for Dynamo 2.x 2.4.0

element = Input(element: var[]..[])
element_2 = Output(element)  # "element"
name = Input(name: string[]..[])
replacementForIllegalChars = Input(replacementForIllegalChars: string = "_")
replaceIllegalRevitCharacters = Custom[String.ReplaceIllegalRevitCharacters](str=name, replacement=replacementForIllegalChars)  # package Clockwork for Dynamo 2.x; Replaces all characters in a string that are illegal characters for Revit view names etc.
python_script = Python(IN[0]=element, IN[1]=replaceIllegalRevitCharacters)
# ---------- python_script.python (57 lines) ----------
import clr
clr.AddReference('RevitAPI')
from Autodesk.Revit.DB import *

clr.AddReference("RevitNodes")
import Revit
clr.ImportExtensions(Revit.Elements)

clr.AddReference("RevitServices")
import RevitServices
from RevitServices.Persistence import DocumentManager
from RevitServices.Transactions import TransactionManager

doc = DocumentManager.Instance.CurrentDBDocument
items = UnwrapElement(IN[0])
names = IN[1]

def SetElementName(item, name):
	# family parameters
	if item.GetType().ToString() == "Autodesk.Revit.DB.FamilyParameter":
		try: 
			doc.FamilyManager.RenameParameter(item, name)
			return True
		except: return False
	# regular revit worksets
	elif item.GetType().ToString() =="Autodesk.Revit.DB.Workset":
		try: 
			doc.GetWorksetTable().RenameWorkset(doc, item.Id, name)
			return True
		except: return False
	# archilab worksets (dynamo 1.x)
	elif item.GetType().ToString() == "Archilab.Grimshaw.Elements.Workset":
		try: 
			doc.GetWorksetTable().RenameWorkset(doc, WorksetId(item.Id), name)
			return True
		except: return False
	# archilab worksets (dynamo 2.x)
	elif item.GetType().ToString() == "archilab.Revit.Elements.Workset":
		try: 
			doc.GetWorksetTable().RenameWorkset(doc, WorksetId(item.Id), name)
			return True
		except: return False
	# everything else that has a name property
	else:
		try: 
			item.Name = name
			return True
		except: return False

TransactionManager.Instance.EnsureInTransaction(doc)
if isinstance(IN[0], list):
	if isinstance(names, list): OUT = [SetElementName(x, y) for x, y in zip(items, names)]
	else: OUT = [SetElementName(x, names) for x in items]
else:
	if isinstance(names, list): OUT = SetElementName(items, names[0])
	else: OUT = SetElementName(items, names)
TransactionManager.Instance.TransactionTaskDone()
# ----------------------------------------
success = Output(python_script)
