# Dynamo custom node ElementClass.ByName.dyf (Dynamo 2.12.1.8246)
# category: Clockwork.Revit.Selection.Miscellaneous.Query
# Retrieves an element class by its name  - to be used with the OOTB node "All Elements of Class".

name = Input(name: string)
code_block = CodeBlock(str=name) { DSCore.Types.FindTypeByNameInAssembly(str, "RevitAPI"); }
elementClass = Output(code_block)
