# Dynamo custom node ElementType.ByName.dyf (Dynamo 2.0.1.5055)
# category: Clockwork.Revit.Selection.Miscellaneous.Query
# Retrieves an element type by its name  - to be used with the OOTB node "All Elements of Type".

elementTypes = Custom[Document.ElementTypes]()  # Retrieves a list of all Revit element types
name = Input(name: string)
indexOf = List.IndexOf(list=elementTypes.elementTypeNames, element=name)
getItemAtIndex = List.GetItemAtIndex(list=elementTypes.elementTypes, index=indexOf)
elementType = Output(getItemAtIndex)
