# Dynamo custom node Elements.FilterByParameterValueAndCondition.dyf (Dynamo 1.3.1.1736)
# category: Clockwork.Revit.Selection.Filters.Query
# Retrieves those elements from a collection whose parameter value matches the defined condition

elements = Input()
param = Input(param : string)
parameterExists = Custom[Element.ParameterExists](param=param)  # Checks if an element contains a parameter of a given name; unwired: element
filter = List.Filter(elements, parameterExists)
getParameterValueByName = Element.GetParameterValueByName(element=filter.out0, parameterName=param)
func = Input()
map = List.Map(list=getParameterValueByName, f_x=func)
filterByBoolMask = List.FilterByBoolMask(list=filter.out0, mask=map)
in_ = Output(filterByBoolMask.in)  # "in"
join = List.Join(filter.out1, filterByBoolMask.out)
out = Output(join)
