# Dynamo custom node Elements.GroupByHost.dyf (Dynamo 2.0.1.5055)
# category: Clockwork.Revit.Elements.Actions
# Groups a list of Revit elements by their respective hosts (if they have any)

elements = Input(elements: var[]..[])
turnIntoList = Custom[TurnIntoList](unknownItem=elements)  # Turns an element (or a nested list) into a flat list
host = Custom[Element.Host](element=turnIntoList)  # Gets an element's host
isNull = Object.IsNull(obj=host)
filterByBoolMask = List.FilterByBoolMask(list=turnIntoList, mask=isNull)
filterByBoolMask_2 = List.FilterByBoolMask(list=host, mask=isNull)
groupByKey = List.GroupByKey(list=filterByBoolMask.out, keys=filterByBoolMask_2.out)
elementsGroupedByHost = Output(groupByKey.groups)
hosts = Output(groupByKey.unique_keys)
unhostedElements = Output(filterByBoolMask.in)
