# Dynamo custom node Family.HasRoomCalculationPoint.dyf (Dynamo 2.0.1.5055)
# category: Clockwork.Revit.Elements.Query
# Determines whether the given family has the room calculation point activated.

family = Input(family: Revit.Elements.Family[]..[])
turnIntoList = Custom[TurnIntoList](unknownItem=family)  # Turns an element (or a nested list) into a flat list
python_script = Python(IN[0]=turnIntoList)
# ---------- python_script.python (12 lines) ----------
import clr
clr.AddReference('RevitAPI')
from Autodesk.Revit.DB import *

fams = UnwrapElement(IN[0])
booleans = list()
for fam in fams:
	if fam.GetType().ToString() == "Autodesk.Revit.DB.Family":
		booleans.append(fam.get_Parameter(BuiltInParameter.ROOM_CALCULATION_POINT).AsInteger() == 1)
		#booleans.append(fam.get_Parameter(BuiltInParameter.ROOM_CALCULATION_POINT).AsInteger())
	else: booleans.append(False)
OUT = booleans
# ----------------------------------------
returnListOrSingleValue = Custom[ReturnListOrSingleValue](unknownItem=family, seq=python_script)  # If the unknown item is not a list but rather a single item, only the first item of the list (input "seq") will be returned.
bool = Output(returnListOrSingleValue)
