# Dynamo custom node Family.HostingBehavior.dyf (Dynamo 1.3.1.1736)
# category: Clockwork.Revit.Elements.Family.Query
# Returns the expected host class of a family (if any)

family = Input(family : Family)
python_script = Python(IN[0]=family)
# ---------- python_script.python (15 lines) ----------
import clr
clr.AddReference('RevitAPI')
from Autodesk.Revit.DB import *

def GetHostingBehavior(item):
	if item.GetType().ToString() == "Autodesk.Revit.DB.Family":
		hb = item.get_Parameter(BuiltInParameter.FAMILY_HOSTING_BEHAVIOR).AsValueString()
		if hb == "": return None
		else: return hb
	else: return None

items = UnwrapElement(IN[0])

if isinstance(IN[0], list): OUT = [GetHostingBehavior(x) for x in items]
else: OUT = GetHostingBehavior(items)
# ----------------------------------------
hostingBehavior = Output(python_script)
