# Dynamo custom node Family.IsEditable.dyf (Dynamo 2.3.0.5885)
# category: Clockwork.Revit.Elements.Family.Query
# Determines if a family is editable

family = Input(family: Revit.Elements.Family)
python_script = Python(IN[0]=family)
# ---------- python_script.python (13 lines) ----------
import clr
import System
clr.AddReference('RevitAPI')
from Autodesk.Revit.DB import *

def IsEditable(item):
	if hasattr(item, "IsEditable"): return item.IsEditable
	else: return None

items = UnwrapElement(IN[0])

if isinstance(IN[0], list): OUT = [IsEditable(x) for x in items]
else: OUT = IsEditable(items)
# ----------------------------------------
bool = Output(python_script)
