# Dynamo custom node FamilyDocument.Properties.dyf (Dynamo 2.12.1.8246)
# category: Clockwork.Revit.Application.Query
# Retrieves all the properties of the current family document (i.e. parameters on the family level).

toggle = Input(toggle: bool = true)
python_script = Python(IN[0]=toggle)  # IronPython2
# ---------- python_script.python (13 lines) ----------
import clr
clr.AddReference('RevitAPI')
from Autodesk.Revit.DB import *

clr.AddReference("RevitServices")
import RevitServices
from RevitServices.Persistence import DocumentManager

doc = DocumentManager.Instance.CurrentDBDocument
elementlist = list()
if doc.IsFamilyDocument:
	fam = doc.OwnerFamily
OUT = fam
# ----------------------------------------
parameters = Element.Parameters(element=python_script)
familyParameters = Output(parameters)
