# Dynamo custom node FamilyInstance.ByPointInView.dyf (Dynamo 2.0.1.5055)
# category: Clockwork.Revit.Elements.Create
# Places a family instance at a given point in a given view (e.g. a detail component).

point = Input(point: Autodesk.DesignScript.Geometry.Point)
turn_into_list = Custom[Turn Into List](unknownItem=point)  # Turns an element (or a nested list) into a flat list
familyType = Input(familyType: var[]..[])
view = Input(view: var[]..[])
python_script = Python(IN[0]=turn_into_list, IN[1]=familyType, IN[2]=view)
# ---------- python_script.python (31 lines) ----------
import clr
clr.AddReference('RevitAPI')
from Autodesk.Revit.DB import *

clr.AddReference("RevitNodes")
import Revit
clr.ImportExtensions(Revit.Elements)
clr.ImportExtensions(Revit.GeometryConversion)

clr.AddReference("RevitServices")
import RevitServices
from RevitServices.Persistence import DocumentManager
from RevitServices.Transactions import TransactionManager

doc = DocumentManager.Instance.CurrentDBDocument
points = UnwrapElement(IN[0])
famtype = UnwrapElement(IN[1])
lvl = UnwrapElement(IN[2])
elementlist = list()
counter = 0

TransactionManager.Instance.EnsureInTransaction(doc)
# make sure familysymbol is active
if famtype.IsActive == False:
	famtype.Activate()
	doc.Regenerate()
for point in points:
	newobj = doc.Create.NewFamilyInstance(point.ToXyz(),famtype,lvl)
	elementlist.append(newobj.ToDSType(False))
TransactionManager.Instance.TransactionTaskDone()
OUT = elementlist
# ----------------------------------------
returnListOrSingleValue = Custom[ReturnListOrSingleValue](unknownItem=point, seq=python_script)  # If the item in input #1 is not a list, only the first item of the list in input #2 will be returned.
familyInstance = Output(returnListOrSingleValue)
