# Dynamo custom node FamilyInstance.CopingElements.dyf (Dynamo 2.0.1.5055)
# category: Clockwork.Revit.Elements.Query
# Returns all elements used as coping cutters for a given element.

familyInstance = Input(familyInstance: var[]..[])
turn_into_list = Custom[Turn Into List](unknownItem=familyInstance)  # Turns an element (or a nested list) into a flat list
python_script = Python(IN[0]=turn_into_list)
# ---------- python_script.python (17 lines) ----------
import clr
import System
clr.AddReference('RevitAPI')
from Autodesk.Revit.DB import *

fams = UnwrapElement(IN[0])
elementlist = list()

for fam in fams:
	try:
		copinglist = list()
		for id in fam.GetCopingIds():
			copinglist.append(fam.Document.GetElement(id))
		elementlist.append(copinglist)
	except:	elementlist.append(list())

OUT = elementlist
# ----------------------------------------
returnListOrSingleValue = Custom[ReturnListOrSingleValue](unknownItem=familyInstance, seq=python_script)  # If the item in input #1 is not a list, only the first item of the list in input #2 will be returned.
copingElements = Output(returnListOrSingleValue)
