# Dynamo custom node FamilyInstance.HandOrientation.dyf (Dynamo 2.0.1.5055)
# category: Clockwork.Revit.Elements.Query
# Gets the hand orientation of a hosted object (e.g. a window or a door)

familyInstance = Input(familyInstance: var[]..[])
turn_into_list = Custom[Turn Into List](unknownItem=familyInstance)  # Turns an element (or a nested list) into a flat list
python_script = Python(IN[0]=turn_into_list)
# ---------- python_script.python (17 lines) ----------
import clr
clr.AddReference('RevitAPI')
from Autodesk.Revit.DB import *

clr.AddReference("RevitNodes")
import Revit
clr.ImportExtensions(Revit.Elements)
clr.ImportExtensions(Revit.GeometryConversion)

objinstances = UnwrapElement(IN[0])
vectorlist = list()
for item in objinstances:
	try:
		vectorlist.append(item.HandOrientation.ToVector())
	except:
		vectorlist.append(list())
OUT = vectorlist
# ----------------------------------------
returnListOrSingleValue = Custom[ReturnListOrSingleValue](unknownItem=familyInstance, seq=python_script)  # If the item in input #1 is not a list, only the first item of the list in input #2 will be returned.
vector = Output(returnListOrSingleValue)
