# Dynamo custom node FamilyInstance.SetLevel.dyf (Dynamo 2.0.1.5055)
# category: Clockwork.Revit.Elements.Actions
# Sets the level property of a family instance. Family instance will move accordingly.

familyInstance = Input(familyInstance: Revit.Elements.FamilyInstance)
turnIntoList = Custom[TurnIntoList](unknownItem=familyInstance)  # Turns an element (or a nested list) into a flat list
level = Input(level: Revit.Elements.Level)
turnIntoList_2 = Custom[TurnIntoList](unknownItem=level)
create = List.Create(item0=turnIntoList, item1=turnIntoList_2)
equalSublistLengths = Custom[List.EqualSublistLengths](lists=create)  # Trims all given lists to the length of the shortest list
code_block = CodeBlock(seq=equalSublistLengths) { seq[0]; seq[1]; }
python_script = Python(IN[0]=code_block.out0, IN[1]=code_block.out1)
# ---------- python_script.python (30 lines) ----------
import clr
clr.AddReference('RevitAPI')
from Autodesk.Revit.DB import *

clr.AddReference("RevitNodes")
import Revit
clr.ImportExtensions(Revit.Elements)

clr.AddReference("RevitServices")
import RevitServices
from RevitServices.Persistence import DocumentManager
from RevitServices.Transactions import TransactionManager

doc = DocumentManager.Instance.CurrentDBDocument
items = UnwrapElement(IN[0])
lvls = UnwrapElement(IN[1])
booleans = list()
i = 0

TransactionManager.Instance.EnsureInTransaction(doc)
for item in items:
	try:
		item.get_Parameter(BuiltInParameter.FAMILY_LEVEL_PARAM).Set(lvls[i].Id)
		booleans.append(True)
	except:
		booleans.append(False)
	i += 1
TransactionManager.Instance.TransactionTaskDone()

OUT = (items,booleans)
# ----------------------------------------
code_block_2 = CodeBlock(seq=python_script) { seq[0]; seq[1]; }
returnListOrSingleValue = Custom[ReturnListOrSingleValue](unknownItem=familyInstance, seq=code_block_2.out0)  # If the unknown item is not a list but rather a single item, only the first item of the list (input "seq") will be returned.
familyInstance_2 = Output(returnListOrSingleValue)  # "familyInstance"
returnListOrSingleValue_2 = Custom[ReturnListOrSingleValue](unknownItem=familyInstance, seq=code_block_2.out1)
success = Output(returnListOrSingleValue_2)
