# Dynamo custom node FamilyInstance.SetType.dyf (Dynamo 2.0.1.5055)
# category: Clockwork.Revit.Elements.Actions
# Changes the family type of a given family instance to the specified type

familyInstance = Input(familyInstance: var[]..[])
turn_into_list = Custom[Turn Into List](unknownItem=familyInstance)  # Turns an element (or a nested list) into a flat list
familyType = Input(familyType: var[]..[])
turn_into_list_2 = Custom[Turn Into List](unknownItem=familyType)
code_block = CodeBlock(instances=turn_into_list, types=turn_into_list_2)
# ---------- code_block.designscript (4 lines) ----------
inst = List.Count(instances);
ftypes[0] =  List.OfRepeatedItem(types[0],inst);
ftypes[1] =  types;
ftypes[inst > List.Count(types) ? 0 : 1];
# ----------------------------------------
python_script = Python(IN[0]=turn_into_list, IN[1]=code_block.out3)
# ---------- python_script.python (30 lines) ----------
import clr
clr.AddReference('RevitAPI')
from Autodesk.Revit.DB import *

clr.AddReference("RevitNodes")
import Revit
clr.ImportExtensions(Revit.Elements)

clr.AddReference("RevitServices")
import RevitServices
from RevitServices.Persistence import DocumentManager
from RevitServices.Transactions import TransactionManager

doc = DocumentManager.Instance.CurrentDBDocument
faminsts = UnwrapElement(IN[0])
famsymb = UnwrapElement(IN[1])
booleans = []
counter = 0

TransactionManager.Instance.EnsureInTransaction(doc)
for item in faminsts:
	try:
		item.Symbol = famsymb[counter]
		booleans.append(True)
	except:
		booleans.append(False)
	counter += 1
TransactionManager.Instance.TransactionTaskDone()

OUT = (faminsts,booleans)
# ----------------------------------------
code_block_2 = CodeBlock(seq=python_script) { seq[0]; seq[1]; }
returnListOrSingleValue = Custom[ReturnListOrSingleValue](unknownItem=familyInstance, seq=code_block_2.out0)  # If the item in input #1 is not a list, only the first item of the list in input #2 will be returned.
familyInstance_2 = Output(returnListOrSingleValue)  # "familyInstance"
returnListOrSingleValue_2 = Custom[ReturnListOrSingleValue](unknownItem=familyInstance, seq=code_block_2.out1)
success = Output(returnListOrSingleValue_2)
