# Dynamo custom node FamilyInstance.SuperComponent.dyf (Dynamo 2.0.0.4654)
# category: Clockwork.Revit.Elements.Query
# Retrieves the supercomponent of a given family instance

familyInstance = Input(familyInstance: var[]..[])
python_script = Python(IN[0]=familyInstance)
# ---------- python_script.python (12 lines) ----------
import clr
clr.AddReference('RevitAPI')
from Autodesk.Revit.DB import *

def GetSuperComponent(item):
	if hasattr(item, "SuperComponent"): return item.SuperComponent
	else: return None

items = UnwrapElement(IN[0])

if isinstance(IN[0], list): OUT = [GetSuperComponent(x) for x in items]
else: OUT = GetSuperComponent(items)
# ----------------------------------------
superComponent = Output(python_script)
