# Dynamo custom node FamilyType.FamilyName.dyf (Dynamo 2.0.1.5055)
# category: Clockwork.Revit.Elements.Query
# Returns the *family* name of a given family *type*. ATTENTION: This node will be deprecated in 2023. Please switch to the OOTB node ElementType.FamilyName.

familyType = Input(familyType: var[]..[])
python_script = Python(IN[0]=familyType)
# ---------- python_script.python (12 lines) ----------
import clr
clr.AddReference('RevitAPI')
from Autodesk.Revit.DB import *

def GetFamilyName(item):
	if hasattr(item, "FamilyName"): return item.FamilyName
	else: return None

items = UnwrapElement(IN[0])

if isinstance(IN[0], list): OUT = [GetFamilyName(x) for x in items]
else: OUT = GetFamilyName(items)
# ----------------------------------------
str = Output(python_script)
