# Dynamo custom node FamilyType.SetCompoundLayerWidth.dyf (Dynamo 2.0.0.4654)
# category: Clockwork.Revit.Elements.Actions
# Sets the width of a specified compound layer of a given family type (only applies to family types that have a compound structure, e.g. walls, floors etc.).

familyType = Input(familyType: var[]..[])
turn_into_list = Custom[Turn Into List](unknownItem=familyType)  # Turns an element (or a nested list) into a flat list
layerIndex = Input(layerIndex: int)
turn_into_list_2 = Custom[Turn Into List](unknownItem=layerIndex)
width = Input(width: double)
turn_into_list_3 = Custom[Turn Into List](unknownItem=width)
code_block = CodeBlock(famtype=turn_into_list, layerindex=turn_into_list_2, width=turn_into_list_3) { [famtype,layerindex,width]; }
equalSublistLengths = Custom[List.EqualSublistLengths](lists=code_block)  # Trims all given lists to the length of the shortest list
code_block_2 = CodeBlock(seq=equalSublistLengths) { seq[0]; seq[1]; seq[2]; }
unit_types = UnitTypes(index=2)  # graph input
displayUnitType = Custom[UnitType.DisplayUnitType](unitType=unit_types)  # Retrieves the display unit type for a given unit type.
toInternalUnit = Custom[DisplayUnit.ToInternalUnit](val=code_block_2.out2, displayUnitType=displayUnitType.displayUnitType)  # Converts a value from a given display unit to Revit's internal unit
python_script = Python(IN[0]=code_block_2.out0, IN[1]=code_block_2.out1, IN[2]=toInternalUnit)
# ---------- python_script.python (29 lines) ----------
import clr
clr.AddReference('RevitAPI')
from Autodesk.Revit.DB import *

clr.AddReference("RevitServices")
import RevitServices
from RevitServices.Persistence import DocumentManager
from RevitServices.Transactions import TransactionManager

doc = DocumentManager.Instance.CurrentDBDocument
famtypes = UnwrapElement(IN[0])
indices = IN[1]
widths = IN[2]
booleans = list()
counter = 0

TransactionManager.Instance.EnsureInTransaction(doc)
for ft in famtypes:
	try:
		cs = ft.GetCompoundStructure()
		cs.SetLayerWidth(indices[counter],widths[counter])
		ft.SetCompoundStructure(cs)
		booleans.append(True)
	except:
		booleans.append(False)
	counter += 1	
TransactionManager.Instance.TransactionTaskDone()

OUT = (famtypes,booleans)
# ----------------------------------------
code_block_3 = CodeBlock(seq=python_script) { seq[0]; seq[1]; }
returnListOrSingleValue = Custom[ReturnListOrSingleValue](unknownItem=familyType, seq=code_block_3.out0)  # If the item in input #1 is not a list, only the first item of the list in input #2 will be returned.
familyType_2 = Output(returnListOrSingleValue)  # "familyType"
returnListOrSingleValue_2 = Custom[ReturnListOrSingleValue](unknownItem=familyType, seq=code_block_3.out1)
success = Output(returnListOrSingleValue_2)
