# Dynamo custom node FibonacciSequence.FromValues.dyf (Dynamo 2.0.1.5055)
# category: Clockwork.List.Generate.Create
# Creates a Fibonacci row from two starting values of a given length (starting values do *not* count toward length).

A = Input(A: int)
B = Input(B: int)
code_block = CodeBlock(a=A, b=B) { [a,b]; }
length = Input(length: var[]..[])
fibonacciFromList = Custom[List.FibonacciFromList](InitialList=code_block, length=length)  # Creates a Fibonacci row from a starting list (last two values) of a given length (starting values do *not* count toward length).
seq = Output(fibonacciFromList)
