# Dynamo custom node FileSystem.FileLastAccessed.dyf (Dynamo 1.3.4.6666)
# category: Clockwork.ImportExport.Query
# Returns the date and time a given file was last accessed

file = Input(file : System.IO.FileInfo[]..[])
python_script = Python(IN[0]=file)
# ---------- python_script.python (8 lines) ----------
import clr

def FileLastAccessed(file):
	if hasattr(file,"LastAccessTime"): return file.LastAccessTime
	else: return None

if isinstance(IN[0], list): OUT = [FileLastAccessed(x) for x in IN[0]]
else: OUT = FileLastAccessed(IN[0])
# ----------------------------------------
dateTime = Output(python_script)
