# Dynamo custom node FileSystem.FileSize.dyf (Dynamo 1.3.1.1736)
# category: Clockwork.ImportExport.Query
# Returns the file size of a given file.

file = Input(file : System.IO.FileInfo)
turnIntoList = Custom[TurnIntoList](unknownItem=file)  # Turns an element (or a nested list) into a flat list
python_script = Python(IN[0]=turnIntoList)
# ---------- python_script.python (12 lines) ----------
import clr
import System.IO.FileInfo
files = IN[0]
bytes = []
kbytes = []
mbytes = []
for file in files:
	size = file.Length
	bytes.append(size)
	kbytes.append(float(size)/1024)
	mbytes.append(float(size)/1048576)
OUT = (bytes,kbytes,mbytes)
# ----------------------------------------
code_block = CodeBlock(seq=python_script) { seq[0]; seq[1]; seq[2]; }
returnListOrSingleValue = Custom[ReturnListOrSingleValue](unknownItem=file, seq=code_block.out0)  # If the unknown item is not a list but rather a single item, only the first item of the list (input "seq") will be returned.
bytes = Output(returnListOrSingleValue)
returnListOrSingleValue_2 = Custom[ReturnListOrSingleValue](unknownItem=file, seq=code_block.out1)
kilobytes = Output(returnListOrSingleValue_2)
returnListOrSingleValue_3 = Custom[ReturnListOrSingleValue](unknownItem=file, seq=code_block.out2)
megabytes = Output(returnListOrSingleValue_3)
