# Dynamo custom node Floor.ResetSlabShape.dyf (Dynamo 2.0.0.4654)
# category: Clockwork.Revit.Elements.Actions
# Resets the slabshape of a floor

floor = Input(floor: Revit.Elements.Floor[]..[])
resetSlabShape = Custom[Roof.ResetSlabShape](roof=floor)  # Resets the slabshape of a roof
floor_2 = Output(resetSlabShape.roof)  # "floor"
success = Output(resetSlabShape.success)
