# Dynamo custom node Floor.SlabShapeByPoints.dyf (Dynamo 2.0.1.5055)
# category: Clockwork.Revit.Elements.Actions
# Transform a slab shape based on a list of Points

points = Input(points: Autodesk.DesignScript.Geometry.Point[]..[])
floor = Input(floor: var[]..[])
slabShapeByPoints = Custom[Roof.SlabShapeByPoints](points=points, roof=floor)  # Transform a slab shape based on a list of Points.
floor_2 = Output(slabShapeByPoints.roof)  # "floor"
success = Output(slabShapeByPoints.success)
