# Dynamo custom node Floor.SlabShapeHasBeenModified.dyf (Dynamo 2.0.1.5055)
# category: Clockwork.Revit.Elements.Query
# Checks if the shape of a floor slab has been modified with the shape editing tools

floor = Input(floor: var[]..[])
slabShapeHasBeenModified = Custom[Roof.SlabShapeHasBeenModified](roof=floor)  # Checks if the shape of a roof slab has been modified with the shape editing tools
bool = Output(slabShapeHasBeenModified)
