# Dynamo custom node FootingType.BreaksAtInserts.dyf (Dynamo 2.0.1.5055)
# category: Clockwork.Revit.Elements.Query
# Determines whether a list of wall footing types break at inserts in their attached walls

footingType = Input(footingType: var[]..[])
turn_into_list = Custom[Turn Into List](unknownItem=footingType)  # Turns an element (or a nested list) into a flat list
python_script = Python(IN[0]=turn_into_list)
# ---------- python_script.python (14 lines) ----------
import clr
clr.AddReference('RevitAPI')
from Autodesk.Revit.DB import *

footingtypes = UnwrapElement(IN[0])
booleans = list()
for item in footingtypes:
	try:
		footingbreaks = item.get_Parameter(BuiltInParameter.CONTINUOUS_FOOTING_BREAK_AT_INSERTS_DISABLE).AsInteger()
		if footingbreaks == 0: booleans.append(True)
		elif footingbreaks == 1: booleans.append(False)
	except:
		booleans.append(False)
OUT = booleans
# ----------------------------------------
returnListOrSingleValue = Custom[ReturnListOrSingleValue](unknownItem=footingType, seq=python_script)  # If the item in input #1 is not a list, only the first item of the list in input #2 will be returned.
bool = Output(returnListOrSingleValue)
