# Dynamo custom node Geometry.ClosestTo.dyf (Dynamo 2.0.0.4654)
# category: Clockwork.Geometry.Modifiers.Query
# Finds the closest entity in a list of geometric entities from another given entity

geometry = Input(geometry: Autodesk.DesignScript.Geometry.Geometry[])
other = Input(other: Autodesk.DesignScript.Geometry.Geometry)
distanceTo = Geometry.DistanceTo(geometry=geometry, other=other)
minimumItem = List.MinimumItem(list=distanceTo)
code_block = CodeBlock(a=distanceTo, b=minimumItem) { a == b; }
filterByBoolMask = List.FilterByBoolMask(list=geometry, mask=code_block)
flatten = List.Flatten(list=filterByBoolMask.in)
ClosestObject = Output(flatten)
closestPointTo = Geometry.ClosestPointTo(geometry=filterByBoolMask.in, other=other)
flatten_2 = List.Flatten(list=closestPointTo)
ClosestPoint = Output(flatten_2)
