# Dynamo custom node Geometry.FurthestFrom.dyf (Dynamo 1.3.0.875)
# category: Clockwork.Geometry.Modifiers.Query
# Finds the furthest entity in a list of geometric entities from another given entity

geometry = Input(geometry: Autodesk.Geometry[])
other = Input(other : Autodesk.Geometry)
distanceTo = Geometry.DistanceTo(geometry=geometry, other=other)
maximumItem = List.MaximumItem(distanceTo)
code_block = CodeBlock(a=distanceTo, b=maximumItem) { a == b; }
filterByBoolMask = List.FilterByBoolMask(list=geometry, mask=code_block)
FurthestObject = Output(filterByBoolMask.in)
