# Dynamo custom node Grid.DropLastRowAndColumn.dyf (Dynamo 2.0.1.5055)
# category: Clockwork.Geometry.Tesselation.Paneling.Actions
# Drops the last row and column from a UV field

seq = Input(seq: var[]..[])
V = Input(V: int)
code_block = CodeBlock(seq1=seq, V=V)
# ---------- code_block.designscript (5 lines) ----------
amount = Count(seq1)-V;
// Drop the last row
seq2 = List.TakeItems(seq1,amount);
// Drop the last column
List.DropEveryNthItem(seq2,V,0);
# ----------------------------------------
seq_2 = Output(code_block.out2)  # "seq"
