# Dynamo custom node Grid.FromFace.dyf (Dynamo 2.0.3.8810)
# category: Clockwork.Geometry.Tesselation.Paneling.Create
# Returns UV coordinates, XYZ coordinates and normals for a face with UV subdivision

surface = Input(surface: Autodesk.DesignScript.Geometry.Surface)
U = Input(U: int)
V = Input(V: int)
code_block = CodeBlock(unum=U, vnum=V) { uvlist = UV.ByCoordinates((0..1..#unum+1)<1>,(0..1..#vnum+1)<2>); }
flatten = List.Flatten(list=code_block)
U_2 = UV.U(uV=flatten)
V_2 = UV.V(uV=flatten)
pointAtParameter = Surface.PointAtParameter(surface=surface, u=U_2, v=V_2)
Points = Output(pointAtParameter)
normalAtParameter = Surface.NormalAtParameter(surface=surface, u=U_2, v=V_2)
Normals = Output(normalAtParameter)
UVs = Output(flatten)
