# Dynamo custom node Grid.InvertAndMirrorNormalizedValues.dyf (Dynamo 2.0.0.4654)
# category: Clockwork.Geometry.Tesselation.Paneling.Actions
# Inverts and mirrors (horizontally & vertically) a nested list of normalized values.

MirrorHorizontally = Input(MirrorHorizontally: bool = false)
Invert = Input(Invert: bool = false)
seq = Input(seq: double[]..[])
invert_normalized_value = Custom[Invert Normalized Value]()  # Inverts a value between 0 and 1 to its opposite (1-x); unwired: dbl
map = List.Map(list=seq, f_x=invert_normalized_value)
MirrorVertically = Input(MirrorVertically: bool = false)
code_block = CodeBlock(inv=Invert, seq1_inv=map, seq1=seq, mir_ver=MirrorVertically)
# ---------- code_block.designscript (4 lines) ----------
// Invert values (if applicable)
seq2 = inv ? seq1_inv : seq1;
// Mirror values vertically (if applicable)
seq3 = mir_ver ? List.Reverse(seq2) : seq2;
# ----------------------------------------
reverse = List.Reverse()  # unwired: list
map_2 = List.Map(list=code_block.seq3, f_x=reverse)
code_block_2 = CodeBlock(mir_hor=MirrorHorizontally, seq4=map_2, seq3=code_block.seq3)
# ---------- code_block_2.designscript (2 lines) ----------
// Mirror horizontally if applicable
mir_hor ? seq4 : seq3;
# ----------------------------------------
seq_2 = Output(code_block_2)  # "seq"
