# Dynamo custom node Grid.Plane.dyf (Dynamo 2.0.0.4654)
# category: Clockwork.Revit.Elements.Query
# Retrieves the plane of a grid. Returns null for curved grid lines.

grid = Input(grid: Revit.Elements.Grid[]..[])
curve = Grid.Curve(grid=grid)
startPoint = Curve.StartPoint(curve=curve)
endPoint = Curve.EndPoint(curve=curve)
ZAxis = Vector.ZAxis()
X = Point.X(point=startPoint)
Y = Point.Y(point=startPoint)
X_2 = Point.X(point=endPoint)
Y_2 = Point.Y(point=endPoint)
create = List.Create(item0=X, item1=Y, item2=X_2, item3=Y_2)
transpose = List.Transpose(lists=create)
abs = Math.Abs(number=transpose)
average = Math.Average(numbers=abs)
scale = Vector.Scale(vector=ZAxis, scale_factor=average)
add = Point.Add(point=endPoint, vectorToAdd=scale)
byThreePoints = Plane.ByThreePoints(origin=startPoint, planePoint=endPoint, xAxisPoint=add)
type = Object.Type(obj=curve)
string = StringInput("Autodesk.DesignScript.Geometry.Line")  # graph input
ne = type != string
boolean = BoolSelector(true)  # graph input
allIndicesOf = List.AllIndicesOf(list=ne, item=boolean)
code_block = CodeBlock { null; }
replaceItemAtIndex = Custom[List.ReplaceItemAtIndex+](seq=byThreePoints, indices=allIndicesOf, replacement=code_block)  # Replaces the item at a given index (or list of indices) of a list by another item
plane = Output(replaceItemAtIndex)
