# Dynamo custom node Group.FromElements.dyf (Dynamo 2.0.1.5055)
# category: Clockwork.Revit.Elements.Create
# Creates a group from a list of Revit elements. Unlike the OOTB node, it supports naming the created group directly and also indicates which of the input elements (if any) could not be grouped.

elements = Input(elements: var[]..[])
turnIntoList = Custom[TurnIntoList](unknownItem=elements)  # Turns an element (or a nested list) into a flat list
groupName = Input(groupName: var[]..[])
python_script = Python(IN[0]=turnIntoList, IN[1]=groupName)
# ---------- python_script.python (30 lines) ----------
import clr
clr.AddReference('RevitAPI')
from Autodesk.Revit.DB import *
from System.Collections.Generic import *

clr.AddReference("RevitServices")
import RevitServices
from RevitServices.Persistence import DocumentManager
from RevitServices.Transactions import TransactionManager

doc = DocumentManager.Instance.CurrentDBDocument
items = UnwrapElement(IN[0])
ids = list()
rejects = list()
for item in items:
	try:
		ids.append(item.Id)
	except:
		rejects.append(item)
items = List[ElementId](ids)

TransactionManager.Instance.EnsureInTransaction(doc)
try:
	group = doc.Create.NewGroup(items);
	group.GroupType.Name = IN[1]
except:
	group = list()
TransactionManager.Instance.TransactionTaskDone()

OUT = (group,rejects)
# ----------------------------------------
code_block = CodeBlock(seq=python_script) { seq[0]; seq[1]; }
group = Output(code_block.out0)
ungroupableElements = Output(code_block.out1)
