# Dynamo custom node Group.IsMirrored.dyf (Dynamo 2.0.1.5055)
# category: Clockwork.Revit.Elements.Query
# Checks if a list of group instances have been mirrored. The reference group should usually be the first placed instance of the group (since that one has likely not been mirrored).  The node will return null for group instances of other group types than the reference group as well as for group instances with excluded members. Furthermore, it will return null for *all* groups if the reference group itself has excluded members or if it doesn't contain any loadable families (since they are the only way of determining if the group instance has been mirrored).

referenceGroup = Input(referenceGroup: var[]..[])
groupsToCheck = Input(groupsToCheck: var[]..[])
turnIntoList = Custom[TurnIntoList](unknownItem=groupsToCheck)  # Turns an element (or a nested list) into a flat list
python_script = Python(IN[0]=referenceGroup, IN[1]=turnIntoList)
# ---------- python_script.python (54 lines) ----------
import clr
clr.AddReference('RevitAPI')
from Autodesk.Revit.DB import *

clr.AddReference("RevitNodes")
import Revit
clr.ImportExtensions(Revit.Elements)

refgroup = UnwrapElement(IN[0])
groups = UnwrapElement(IN[1])

# Get Mirrored state of first family instance in reference group instance
refGroupMembers = refgroup.GetMemberIds()
numMembers = len(refGroupMembers)
counter = 0
membernum = None
refGroupType = refgroup.GroupType.Id.IntegerValue
for member in refGroupMembers:
	elem = refgroup.Document.GetElement(member)
	if elem.GetType().ToString() == "Autodesk.Revit.DB.FamilyInstance":
		state = elem.Mirrored
		membernum = counter
		break
	counter += 1
	
# Default values for flags
refGroupIntact = True
noFamInsts = False
# Set a flag if the reference group contains no family instances
if membernum == None: noFamInsts = True
else:
	bools = []
	# Compare Mirrored state with corresponding members of other group instances
	for group in groups:
		# Get number of group members
		theseMembers = group.GetMemberIds()
		theseMembersNum = len(theseMembers)
		# Set a flag if any group instance has more members than the reference group instance
		# (only if both are of the same group type)
		if theseMembersNum > numMembers and refGroupType == group.GroupType.Id.IntegerValue:
			refGroupIntact = False
			break
		# Return null if group is of another group type
		elif refGroupType != group.GroupType.Id.IntegerValue: bools.append(None)
		# Return null for group instances with excluded members
		elif theseMembersNum < numMembers: bools.append(None)
		# Otherwise compare Mirrored state
		else: bools.append(group.Document.GetElement(theseMembers[membernum]).Mirrored != state)
			
# Return null for all groups if the first group has excluded members
# or if it does not contain any fanily instances
if not refGroupIntact or noFamInsts: bools = [None] * len(groups)
	
OUT = bools
# ----------------------------------------
bool = Output(python_script)
