# Dynamo custom node Group.Ungroup.dyf (Dynamo 2.0.1.5055)
# category: Clockwork.Revit.Elements.Actions
# Ungroups a group and returns a boolean  and the ungrouped elements. Returning the ungrouped elements can be turned off for two reasons: 1.) better performance when dealing with large numbers of groups. 2.) Circumventing a bug where DynamoRevit will fail to instantiate TextNote elements contained in detail groups when run on top of non-English Revit.

group = Input(group: var[]..[])
showUngroupedElements = Input(showUngroupedElements: bool = true)
python_script = Python(IN[0]=group, IN[1]=showUngroupedElements)
# ---------- python_script.python (29 lines) ----------
import clr
clr.AddReference('RevitAPI')
from Autodesk.Revit.DB import *
from System.Collections.Generic import *

clr.AddReference("RevitServices")
import RevitServices
from RevitServices.Persistence import DocumentManager
from RevitServices.Transactions import TransactionManager

def UngroupGroup(group, extractMembers):
	success = False
	members = []
	if hasattr(group, "UngroupMembers"):
		try:
			ids = group.UngroupMembers()
			if extractMembers: members = [group.Document.GetElement(x) for x in ids]
			success = True
		except: pass
	return members, success

doc = DocumentManager.Instance.CurrentDBDocument
groups = UnwrapElement(IN[0])
TransactionManager.Instance.EnsureInTransaction(doc)
if isinstance(IN[0], list): 
	if len(groups) > 0: OUT = map(list, zip(*[UngroupGroup(x, IN[1]) for x in groups]))
	else: OUT = ([], [])
else: OUT = UngroupGroup(groups, IN[1])
TransactionManager.Instance.TransactionTaskDone()
# ----------------------------------------
code_block = CodeBlock(seq=python_script)
# ---------- code_block.designscript (4 lines) ----------
// ungrouped elements
seq[0];
// booleans
seq[1];
# ----------------------------------------
ungroupedElements = Output(code_block.out0)
success = Output(code_block.out1)
