# Dynamo custom node GroupType.Groups.dyf (Dynamo 2.0.0.4654)
# category: Clockwork.Revit.Elements.Query
# Returns all group instances of a given group type

groupType = Input(groupType: var[]..[])
turnIntoList = Custom[TurnIntoList](unknownItem=groupType)  # Turns an element (or a nested list) into a flat list
python_script = Python(IN[0]=turnIntoList)
# ---------- python_script.python (19 lines) ----------
import clr
clr.AddReference('RevitAPI')
from Autodesk.Revit.DB import *

clr.AddReference("RevitNodes")
import Revit
clr.ImportExtensions(Revit.Elements)

grouptypes = UnwrapElement(IN[0])
elementlist = list()
for gt in grouptypes:
	if gt.GetType().ToString() == "Autodesk.Revit.DB.GroupType":
		groups = gt.Groups
		glist = []
		for group in groups:
			glist.append(group.ToDSType(True))
		elementlist.append(glist)
	else: elementlist.append(List())
OUT = elementlist
# ----------------------------------------
returnListOrSingleValue = Custom[ReturnListOrSingleValue](unknownItem=groupType, seq=python_script)  # If the unknown item is not a list but rather a single item, only the first item of the list (input "seq") will be returned.
groups = Output(returnListOrSingleValue)
