# Dynamo custom node Hex.ToDecimal.dyf (Dynamo 2.0.4.12684)
# category: Clockwork.String.Generate.Actions
# Converts a string of a hexadecimal value to a number

hex = Input(hex: string)
python_script = Python(IN[0]=hex)
# ---------- python_script.python (2 lines) ----------
if isinstance(IN[0], list): OUT = [int(x,16) for x in IN[0]]
else: OUT = int(IN[0].rstrip("L"),16)
# ----------------------------------------
decimal = Output(python_script)
