# Dynamo custom node InternalUnit.ToDisplayUnit.dyf (Dynamo 2.12.0.5650)
# category: Clockwork.Revit.Units.Actions
# Converts a value from Revit's internal unit to a given display unit
# packages: Clockwork for Dynamo 2.x 2.3.0

val = Input(val: double)
displayUnitType = Input(displayUnitType: var[]..[])
version = Custom[Application.Version]()  # package Clockwork for Dynamo 2.x; Retrieves the name, version and build of the current Revit application.
python_script = Python(IN[0]=val, IN[1]=displayUnitType, IN[2]=version.Version)  # IronPython2
# ---------- python_script.python (15 lines) ----------
import clr
clr.AddReference('RevitAPI')
from Autodesk.Revit.DB import *

def FromInternalUnits(val, unittype):
	if (version > 2021 and str(dispunit.GetType()) == "Autodesk.Revit.DB.ForgeTypeId") or (version < 2022 and str(dispunit.GetType()) == "Autodesk.Revit.DB.DisplayUnitType"):
		return UnitUtils.ConvertFromInternalUnits(val,unittype)
	else: return None

vals = IN[0]
dispunit = IN[1]
version = IN[2]

if isinstance(IN[0], list): OUT = [FromInternalUnits(x, dispunit) for x in vals]
else: OUT = FromInternalUnits(vals, dispunit)
# ----------------------------------------
val_2 = Output(python_script)  # "val"
