# Dynamo custom node IsEvenNumber.dyf (Dynamo 2.0.0.4654)
# category: Clockwork.Math.Tests.Query
# Checks if a number is even.

val = Input(val: int)
isOddNumber = Custom[Math.IsOddNumber](val=val)  # Checks if a number is odd.
not_ = Not(x=isOddNumber)
bool = Output(not_)
