# Dynamo custom node IsMultipleOf.dyf (Dynamo 2.0.1.5055)
# category: Clockwork.Math.Tests.Query
# Checks if A is a multiple of B.

A = Input(A: double)
B = Input(B: double)
code_block = CodeBlock(a=A, b=B) { !(a%b > 0); }
bool = Output(code_block)
