# Dynamo custom node IsOddNumber.dyf (Dynamo 2.0.0.4654)
# category: Clockwork.Math.Tests.Query
# Checks if a number is odd.

val = Input(val: int)
code_block = CodeBlock(n=val) { Math.Round(n)/2 != Math.Round(Math.Round(n)/2); }
bool = Output(code_block)
