# Dynamo custom node Level.Plane.dyf (Dynamo 2.0.0.4654)
# category: Clockwork.Revit.Elements.Query
# Retrieves the plane of a given level

code_block = CodeBlock { 0; }
level = Input(level: Revit.Elements.Level)
elevation = Level.Elevation(level=level)
byCoordinates = Point.ByCoordinates(x=code_block, y=code_block, z=elevation)
ZAxis = Vector.ZAxis()
byOriginNormal = Plane.ByOriginNormal(origin=byCoordinates, normal=ZAxis)
plane = Output(byOriginNormal)
