# Dynamo custom node List.CountOccurences.dyf (Dynamo 2.0.0.4654)
# category: Clockwork.List.Inspect.Query
# Counts the number of occurences of each unique element in a given list

seq = Input(seq: var[])
identity = Object.Identity(obj=seq)
groupByKey = List.GroupByKey(list=seq, keys=identity)
uniqueElements = Output(groupByKey.unique_keys)
count = List.Count(list=groupByKey.groups@L2)
count_2 = Output(count)  # "count"
