# Dynamo custom node List.DropLastItem.dyf (Dynamo 1.3.0.875)
# category: Clockwork.List.Modify.Actions
# Drops the last item from a given list.

list = Input()
code_block = CodeBlock { -1; }
dropItems = List.DropItems(list=list, amount=code_block)
list_2 = Output(dropItems)  # "list"
