# Dynamo custom node List.EqualSublistLengths.dyf (Dynamo 1.3.0.875)
# category: Clockwork.List.Match.Actions
# Trims all given lists to the length of the shortest list

lists = Input()
count = List.Count(lists@L2)
minimumItem = List.MinimumItem(count)
takeItems = List.TakeItems(list=lists@L2, amount=minimumItem)
lists_2 = Output(takeItems)  # "lists"
