# Dynamo custom node List.FilterBySublistLength.dyf (Dynamo 2.0.1.5055)
# category: Clockwork.List.Modify.Actions
# Filters out all sublists that do not have the specified length

seq = Input(seq: var[]..[])
count = List.Count(list=seq@L2)
length = Input(length: int)
code_block = CodeBlock(n=count, x=length) { n == x; }
filterByBoolMask = List.FilterByBoolMask(list=seq, mask=code_block)
in_ = Output(filterByBoolMask.in)  # "in"
out = Output(filterByBoolMask.out)
