# Dynamo custom node List.FromString.dyf (Dynamo 1.3.0.875)
# category: Clockwork.Core.String.Modify.Actions
# Chops up a string into a list of characters

str = Input(str : string)
length = String.Length(str)
code_block = CodeBlock(n=length) { 0..(n-1); 1; }
substring = String.Substring(str=str, startIndex=code_block.out0, length=code_block.out1)
seq = Output(substring)
