# Dynamo custom node List.GroupListOfListsByKey.dyf (Dynamo 1.3.0.875)
# category: Clockwork.List.Organize.Actions
# Groups a list of lists by one of its keys

seq = Input()
keyIndex = Input(keyIndex : int = 0)
boolean = BoolSelector(false)
sortListOfLists = Custom[List.SortListOfLists](seq=seq, sortIndex=keyIndex, caseInsensitive=boolean, orderDescending=boolean)  # Sorts a list of lists by one of its sublists
transpose = List.Transpose(sortListOfLists)
python_script = Python(IN[0]=transpose, IN[1]=keyIndex)
# ---------- python_script.python (13 lines) ----------
import clr
from itertools import groupby

items = IN[0]
groupindex = int(IN[1])
listlist = list()

for key, group in groupby(items, lambda x: x[groupindex]):
	elementlist = list()
	for thing in group:
		elementlist.append(thing)
	listlist.append(elementlist)
OUT = listlist
# ----------------------------------------
transpose_2 = List.Transpose()  # unwired: arg0
map = List.Map(list=python_script, f_x=transpose_2)
seq_2 = Output(map)  # "seq"
