# Dynamo custom node List.IsNotEmpty.dyf (Dynamo 2.0.1.5055)
# category: Clockwork.List.Inspect.Query
# Just the inversion of the built-in Is Empty List node.

seq = Input(seq: var[]..[])
isEmpty = List.IsEmpty(list=seq)
not_ = Not(x=isEmpty)
bool = Output(not_)
