# Dynamo custom node List.NormalizedSequenceByFunction.dyf (Dynamo 0.8.1.1693)
# category: Clockwork.List.Generate.Create
# Creates a sequence of N values between 0 and 1 driven by a function

n = Input(n : int)
code_block = CodeBlock(n=n) { 0..1..#n; }
func = Input()
map = List.Map(list=code_block, f_x=func)
seq = Output(map)
