# Dynamo custom node List.ReplaceEmptyLists.dyf (Dynamo 1.3.0.875)
# category: Clockwork.List.Modify.Actions
# Replaces all empty lists within a given list with a substitute

seq = Input()
isNotEmpty = Custom[List.IsNotEmpty](seq=seq@L2)  # Just the inversion of the built-in Is Empty List node.
boolean = BoolSelector(true)
replaceNull = Custom[List.ReplaceNull](seq=isNotEmpty, replacement=boolean)  # Replaces all null values within a given list with a substitute
getKeys = GetKeys(replaceNull)
filterByBoolMask = List.FilterByBoolMask(list=getKeys, mask=replaceNull)
Replacement = Input()
replaceItemAtIndex = Custom[List.ReplaceItemAtIndex](seq=seq, index=filterByBoolMask.out, replacement=Replacement)  # Replaces the item at a given index (or list of indices) of a list by another item
seq_2 = Output(replaceItemAtIndex)  # "seq"
