# Dynamo custom node List.ReplaceItemAtIndex+.dyf (Dynamo 2.12.1.8246)
# category: Clockwork.List.Modify.Actions
# Replaces the item at a given index of a list by another item. Unlike the OOTB node, it can replace items at multiple indeces.

seq = Input(seq: var[]..[])
replacement = Input(replacement: var[]..[])
indices = Input(indices: int[]..[])
python_script = Python(IN[0]=seq, IN[1]=replacement, IN[2]=indices)  # IronPython2
# ---------- python_script.python (10 lines) ----------
_list = IN[0]
rValues = IN[1]
iValues = IN[2]
if iValues:
	if isinstance(iValues, list):
		if not isinstance(rValues, list): rValues = [rValues] * len(iValues)
		for (index, value) in zip(iValues, rValues):
			_list[index] = value
	else: _list[iValues] = rValues
OUT = _list
# ----------------------------------------
seq_2 = Output(python_script)  # "seq"
