# Dynamo custom node List.ReplaceNull.dyf (Dynamo 2.0.0.4654)
# category: Clockwork.List.Modify.Actions
# Replaces all null values within a given list with a substitute

seq = Input(seq: var[]..[])
replacement = Input(replacement: var[]..[])
python_script = Python(IN[0]=seq, IN[1]=replacement)
# ---------- python_script.python (8 lines) ----------
items = IN[0]
rep = IN[1]
elementlist = list()
for item in items:
	if item is None: 
		item = rep
	elementlist.append(item)
OUT = elementlist
# ----------------------------------------
seq_2 = Output(python_script)  # "seq"
