# Dynamo custom node List.WithLeadingZeroes.dyf (Dynamo 2.0.1.5055)
# category: Clockwork.List.Generate.Create
# Adds leading zeros to a sequence of numbers

num = Input(num: int)
string_from_object = FromObject(obj=num)
n = Input(n: int)
code_block = CodeBlock { "0"; }
padLeft = String.PadLeft(str=string_from_object, newWidth=n, padChars=code_block)
str = Output(padLeft)
