# Dynamo custom node Material.Assets.dyf (Dynamo 2.0.1.5055)
# category: Clockwork.Revit.Elements.Query
# Retreives all assets from a given material

Material = Input(Material: var[]..[])
turnIntoList = Custom[TurnIntoList](unknownItem=Material)  # Turns an element (or a nested list) into a flat list
python_script = Python(IN[0]=turnIntoList)
# ---------- python_script.python (11 lines) ----------
import clr
clr.AddReference('RevitAPI')
from Autodesk.Revit.DB import *

mats = UnwrapElement(IN[0])

def GetMaterialAssets(material):
	if material: return (material.Document.GetElement(material.AppearanceAssetId), material.Document.GetElement(material.ThermalAssetId), material.Document.GetElement(material.StructuralAssetId))
	else: return (None, None, None)

OUT = map(list, zip(*[GetMaterialAssets(x) for x in mats]))
# ----------------------------------------
code_block = CodeBlock(seq=python_script) { seq[0]; seq[1]; seq[2]; }
returnListOrSingleValue = Custom[ReturnListOrSingleValue](unknownItem=Material, seq=code_block.out0)  # If the unknown item is not a list but rather a single item, only the first item of the list (input "seq") will be returned.
AppearanceAsset = Output(returnListOrSingleValue)
returnListOrSingleValue_2 = Custom[ReturnListOrSingleValue](unknownItem=Material, seq=code_block.out1)
ThermalAsset = Output(returnListOrSingleValue_2)
returnListOrSingleValue_3 = Custom[ReturnListOrSingleValue](unknownItem=Material, seq=code_block.out2)
StructuralAsset = Output(returnListOrSingleValue_3)
