# Dynamo custom node Material.Duplicate.dyf (Dynamo 2.0.1.5055)
# category: Clockwork.Revit.Elements.Actions
# Duplicates a material

material = Input(material: var[]..[])
turnIntoList = Custom[TurnIntoList](unknownItem=material)  # Turns an element (or a nested list) into a flat list
name = Input(name: var[]..[])
turnIntoList_2 = Custom[TurnIntoList](unknownItem=name)
code_block = CodeBlock(mats=turnIntoList, names=turnIntoList_2) { [mats,names]; }
equalSublistLengths = Custom[List.EqualSublistLengths](lists=code_block)  # Trims all given lists to the length of the shortest list
code_block_2 = CodeBlock(seq=equalSublistLengths) { seq[0]; seq[1]; }
python_script = Python(IN[0]=code_block_2.out0, IN[1]=code_block_2.out1)
# ---------- python_script.python (24 lines) ----------
import clr
clr.AddReference('RevitAPI')
from Autodesk.Revit.DB import *

clr.AddReference('RevitNodes')
import Revit
clr.ImportExtensions(Revit.Elements)

clr.AddReference('RevitServices')
import RevitServices
from RevitServices.Persistence import DocumentManager
from RevitServices.Transactions import TransactionManager

doc = DocumentManager.Instance.CurrentDBDocument
mats = UnwrapElement(IN[0])
newnames = IN[1]
elementlist, fail = [],[] #better to generate a fail list only once

TransactionManager.Instance.EnsureInTransaction(doc)
for i in xrange(len(mats)):
	try: elementlist.append(mats[i].Duplicate(newnames[i]))
	except: elementlist.append(None)
TransactionManager.Instance.TransactionTaskDone()
OUT = elementlist
# ----------------------------------------
returnListOrSingleValue = Custom[ReturnListOrSingleValue](unknownItem=material, seq=python_script)  # If the unknown item is not a list but rather a single item, only the first item of the list (input "seq") will be returned.
duplicate = Output(returnListOrSingleValue)
