# Dynamo custom node Math.CardinalDirectionFromAngle.dyf "CardinalDirectionFromAngle" (Dynamo 2.12.0.5650)
# category: Clockwork.Math.Functions.Actions
# Returns the cardinal direction (N, E, S, W) for a given angle (where N = 0°, E = 90° etc.). The accuracy input has three modes: 0 = cardinal directions only, 1 = additional intercardinal directions (i.e. NE, SE, SW, NW), 2 = additional secondary intercardinal directions (NNE, ENE, ESE, SSE, SSW, WSW, WNW, NNW).

angle = Input(angle: double[]..[])
accuracy = Input(accuracy: int = 0)
python_script = Python(IN[0]=angle, IN[1]=accuracy)  # IronPython2
# ---------- python_script.python (18 lines) ----------
# Based on https://gist.github.com/RobertSudwarts/acf8df23a16afdb5837f#gistcomment-3070256

dirs = []
dirs.append(['N', 'E', 'S', 'W'])
dirs.append(['N', 'NE', 'E', 'SE', 'S', 'SW', 'W', 'NW'])
dirs.append(['N', 'NNE', 'NE', 'ENE', 'E', 'ESE', 'SE', 'SSE', 'S', 'SSW', 'SW', 'WSW', 'W', 'WNW', 'NW', 'NNW'])

def GetCardinalDirection(angle):
	if angle:
		ix = round(angle / (360. / len(cdirs)))
		return cdirs[int(ix % len(cdirs))]
	elif angle == 0: return 'N'
	else: return None

if IN[1] not in (0, 1, 2): IN[1] = 0
cdirs = dirs[IN[1]]
if isinstance(IN[0], list): OUT = [GetCardinalDirection(x) for x in IN[0]]
else: OUT = GetCardinalDirection(IN[0])
# ----------------------------------------
str = Output(python_script)
