# Dynamo custom node Math.DecimalToBinary.dyf (Dynamo 1.3.1.1736)
# category: Clockwork.Core.String.Generate.Create
# Converts a number to a string of its binary value

decimal = Input(decimal : int)
python_script = Python(IN[0]=decimal)
# ---------- python_script.python (2 lines) ----------
if isinstance(IN[0], list): OUT = [bin(x) for x in IN[0]]
else: OUT = bin(IN[0])
# ----------------------------------------
binary = Output(python_script)
