# Dynamo custom node Math.DecimalToHex.dyf (Dynamo 1.3.1.1736)
# category: Clockwork.Core.String.Generate.Create
# Converts a number to a string of its hexadecimal value

decimal = Input(decimal : int)
python_script = Python(IN[0]=decimal)
# ---------- python_script.python (2 lines) ----------
if isinstance(IN[0], list): OUT = [hex(x) for x in IN[0]]
else: OUT = hex(IN[0])
# ----------------------------------------
hex = Output(python_script)
