# Dynamo custom node Math.IsEvenNumber.dyf (Dynamo 0.8.1.1823)
# category: Clockwork.Math.Tests.Query
# Checks if a number is even.

val = Input(val : int)
isOddNumber = Custom[Math.IsOddNumber](Value=val)  # Checks if a number is odd.
not_ = Not(isOddNumber)
bool = Output(not_)
