# Dynamo custom node Math.IsMultipleOf.dyf (Dynamo 0.8.1.1693)
# category: Clockwork.Math.Tests.Query
# Checks if A is a multiple of B.

A = Input(A : double)
B = Input(B : double)
code_block = CodeBlock(a=A, b=B) { !(a%b > 0); }
bool = Output(code_block)
