# Dynamo custom node Math.IsOddNumber.dyf (Dynamo 0.8.1.1823)
# category: Clockwork.Math.Tests.Query
# Checks if a number is odd.

val = Input(val : int)
code_block = CodeBlock(n=val) { Math.Round(n)/2 != Math.Round(Math.Round(n)/2); }
bool = Output(code_block)
