# Dynamo custom node Math.RandomIntegerList.dyf (Dynamo 1.0.0.1180)
# category: Clockwork.List.Generate.Create
# Creates a list of random integers between 0 and a given maximum value

min = Input(min : int = 0)
max = Input(max : int)
amount = Input(amount : int)
seed = Input(seed : int = 0)
python_script = Python(IN[0]=min, IN[1]=max, IN[2]=amount, IN[3]=seed)
# ---------- python_script.python (13 lines) ----------
import clr
import System.Random

min = IN[0]
max = IN[1]
amount = IN[2]
seed = IN[3]

r = System.Random(seed)
randomInts = []
for i in range (0, amount):
	randomInts.append(r.Next(min, max+1))
OUT = randomInts
# ----------------------------------------
list = Output(python_script)
