# Dynamo custom node Mesh.FaceVertices.dyf (Dynamo 1.3.0.875)
# category: Clockwork.Geometry.Meshes.Query
# Gets the vertices of each face of a given mesh

mesh = Input(mesh : DesignScript.Mesh)
vertexPositions = Mesh.VertexPositions(mesh)
faceIndices = Mesh.FaceIndices(mesh)
A = IndexGroup.A(faceIndices)
getItemAtIndex = List.GetItemAtIndex(list=vertexPositions, index=A)
B = IndexGroup.B(faceIndices)
getItemAtIndex_2 = List.GetItemAtIndex(list=vertexPositions, index=B)
C = IndexGroup.C(faceIndices)
getItemAtIndex_3 = List.GetItemAtIndex(list=vertexPositions, index=C)
create = List.Create(getItemAtIndex, getItemAtIndex_2, getItemAtIndex_3)
transpose = List.Transpose(create)
vertices = Output(transpose)
