# Dynamo custom node Mesh.IntersectWithPlane.dyf (Dynamo 2.0.0.4654)
# category: Clockwork.Geometry.Meshes.Actions
# Calculates the intersection of a mesh and a plane

mesh = Input(mesh: Autodesk.DesignScript.Geometry.Mesh)
faceVertices = Custom[Mesh.FaceVertices](mesh=mesh)  # Gets the vertices of each face of a given mesh
# note: From Mesh to Curves
closedLoopThroughPoints = Custom[Curve.ClosedLoopThroughPoints](points=faceVertices@L2)  # Creates a *closed* loop of curves based on a given list of points
plane = Input(plane: Autodesk.DesignScript.Geometry.Plane)
intersect = Geometry.Intersect(geometry=closedLoopThroughPoints, other=plane)
flatten = List.Flatten(list=intersect)
normal = Plane.Normal(plane=plane)
flatten_2 = List.Flatten(list=faceVertices)
byBestFitThroughPoints = Plane.ByBestFitThroughPoints(points=flatten_2)
normal_2 = Plane.Normal(plane=byBestFitThroughPoints)
byTwoVectors = Custom[ThirdXYZAxis.ByTwoVectors](Axis1=normal, Axis2=normal_2)  # Given two main XYZ axes (or vectors pointing more or less in thei general direction), this node will find the third axis.
Y = Point.Y(lacing=Longest)  # unwired: point
Z = Point.Z(lacing=Longest)  # unwired: point
X = Point.X(lacing=Longest)  # unwired: point
code_block = CodeBlock(ax=byTwoVectors.str, ysort=Y, zsort=Z, xsort=X)
# ---------- code_block.designscript (6 lines) ----------
// Establish sorting direction
// based on general plane and mesh orientation
cond1 = ax == "Y";
res = cond1 ? ysort : zsort;
cond2 = ax == "X";
cond2 ? xsort : res;
# ----------------------------------------
sortByFunction = List.SortByFunction(list=flatten, func=code_block.out3)
almostZero = Custom[Math.AlmostZero]()  # Returns a feasable computational tolerance to zero (1.0e-9 or a billionth of 1) for use in calculations. More background info: https://github.com/ikeough/Dynamo/issues/879
pruneDuplicates = Point.PruneDuplicates(points=sortByFunction, tolerance=almostZero)
points = Output(pruneDuplicates)
byPoints = PolyCurve.ByPoints(points=pruneDuplicates)
polyCurve = Output(byPoints)
byPoints_2 = NurbsCurve.ByPoints(points=pruneDuplicates)
nurbsCurveByPoints = Output(byPoints_2)
byControlPoints = NurbsCurve.ByControlPoints(points=pruneDuplicates)
nurbsCurveByControlPoints = Output(byControlPoints)
