# Dynamo custom node Morse.FromAlphanumeric.dyf (Dynamo 2.0.0.4654)
# category: Clockwork.Core.String.Generate.Create
# Converts an alphanumeric string to Morse code

code_block = CodeBlock { " "; "   "; }
str = Input(str: string)
toUpper = String.ToUpper(str=str)
fromString = Custom[List.FromString](str=toUpper)  # Chops up a string into a list of characters
code_block_2 = CodeBlock()
# ---------- code_block_2.designscript (3 lines) ----------
"A".."Z";
0..9;
[".-","-...","-.-.","-..",".","..-.","--.","....","..",".---","-.-",".-..","--","-.","---",".--.","--.-",".-.","...","-","..-","...-",".--","-..-","-.--","--..","-----",".----","..---","...--","....-",".....","-....","--...","---..","----."];
# ----------------------------------------
join = List.Join(list0=code_block_2.out0, list1=code_block_2.out1)
matchWithKeyValues = Custom[List.MatchWithKeyValues](seq=fromString, keys=join, values=code_block_2.out2)  # Matches a list with a given set of keys and returns the values corresponding to the keys
flatten = List.Flatten(list=matchWithKeyValues)
code_block_3 = CodeBlock { " "; }
split = String.Split(str=str, separater0=code_block_3)
length = String.Length(str=split)
chop = List.Chop(list=flatten, lengths=length)
join_2 = String.Join(separator=code_block.out0, string0=chop)
firstItem = List.FirstItem(list=join_2)
join_3 = String.Join(separator=code_block.out1, string0=firstItem)
firstItem_2 = List.FirstItem(list=join_3)
str_2 = Output(firstItem_2)  # "str"
