# Dynamo custom node Morse.ToAlphanumeric.dyf (Dynamo 2.0.0.4654)
# category: Clockwork.Core.String.Generate.Actions
# Converts a string in Morse code to alphanumeric

code_block = CodeBlock { ""; " "; }
str = Input(str: string)
code_block_2 = CodeBlock()
# ---------- code_block_2.designscript (5 lines) ----------
"   ";
" ";
"A".."Z";
0..9;
[".-","-...","-.-.","-..",".","..-.","--.","....","..",".---","-.-",".-..","--","-.","---",".--.","--.-",".-.","...","-","..-","...-",".--","-..-","-.--","--..","-----",".----","..---","...--","....-",".....","-....","--...","---..","----."];
# ----------------------------------------
split = String.Split(str=str, separater0=code_block_2.out0)
split_2 = String.Split(str=split, separater0=code_block_2.out1)
join = List.Join(list0=code_block_2.out2, list1=code_block_2.out3)
matchWithKeyValues = Custom[List.MatchWithKeyValues](seq=split_2, keys=code_block_2.out4, values=join)  # Matches a list with a given set of keys and returns the values corresponding to the keys
count = List.Count(list=split_2@L2)
chop = List.Chop(list=matchWithKeyValues, lengths=count)
join_2 = String.Join(separator=code_block.out0, string0=chop)
firstItem = List.FirstItem(list=join_2)
join_3 = String.Join(separator=code_block.out1, string0=firstItem)
firstItem_2 = List.FirstItem(list=join_3)
str_2 = Output(firstItem_2)  # "str"
