# Dynamo custom node Normalization.InvertNormalized.dyf (Dynamo 0.8.1.1823)
# category: Clockwork.Math.Functions.Actions
# Inverts a value between 0 and 1 to its opposite (1-x)

dbl = Input(dbl : double)
code_block = CodeBlock(x=dbl) { 1-x; }
dbl_2 = Output(code_block)  # "dbl"
