# Dynamo custom node Normalization.ScaleNormalized.dyf (Dynamo 0.8.1.1823)
# category: Clockwork.Math.Functions.Actions
# Scales a normalized value according to a given minimum and maximum

min = Input(min : double)
max = Input(max : double)
dbl = Input(dbl : double)
code_block = CodeBlock(min=min, max=max, value=dbl) { min+(max-min)*value; }
dbl_2 = Output(code_block)  # "dbl"
