# Dynamo custom node NormalizedSequence.ByFunction.dyf (Dynamo 2.0.1.5055)
# category: Clockwork.List.Generate.Create
# Creates a sequence of N values between 0 and 1 driven by a function

n = Input(n: int)
code_block = CodeBlock(n=n) { 0..1..#n; }
func = Input(func: var[]..[])
map = List.Map(list=code_block, f_x=func)
seq = Output(map)
