# Dynamo custom node NormalizedSequence.ByNumber.dyf (Dynamo 2.0.1.5055)
# category: Clockwork.List.Generate.Create
# Creates a sequence of N values between 0 and 1

n = Input(n: int)
code_block = CodeBlock(n=n) { 0..1..#n; }
seq = Output(code_block)
