# Dynamo custom node Object.MembersByName.dyf (Dynamo 2.0.0.4654)
# category: Clockwork.Input.Query
# Looks up all the members of a given element based on a given name (or part of a name) of the property or method. Search is case-insensitive.

element = Input(element: var[]..[])
turnIntoList = Custom[TurnIntoList](unknownItem=element)  # Turns an element (or a nested list) into a flat list
members = Custom[Object.Members](element=turnIntoList)  # Gets a list of all members (properties and methods) of a selected element
searchFor = Input(searchFor: string)
ignoreCase = Input(ignoreCase: bool = true)
contains = String.Contains(str=members, searchFor=searchFor, ignoreCase=ignoreCase)
filterByBoolMask = List.FilterByBoolMask(list=members, mask=contains)
returnListOrSingleValue = Custom[ReturnListOrSingleValue](unknownItem=element, seq=filterByBoolMask.in)  # If the unknown item is not a list but rather a single item, only the first item of the list (input "seq") will be returned.
elements = Output(returnListOrSingleValue)
