# Dynamo custom node Paneling.DropLastRowAndColumn.dyf (Dynamo 0.8.2.2392)
# category: Clockwork.Geometry.Tesselation.Paneling.Actions
# Drops the last row and column from a UV field

seq = Input()
V = Input(V : int)
code_block = CodeBlock(seq1=seq, V=V)
# ---------- code_block.designscript (5 lines) ----------
amount = Count(seq1)-V;
// Drop the last row
seq2 = List.TakeItems(seq1,amount);
// Drop the last column
List.DropEveryNthItem(seq2,V,0);
# ----------------------------------------
seq_2 = Output(code_block.out2)  # "seq"
