# Dynamo custom node Paneling.InvertAndMirrorNormalizedValues.dyf (Dynamo 0.8.2.2392)
# category: Clockwork.Geometry.Tesselation.Paneling.Actions
# Inverts and mirrors (horizontally & vertically) a nested list of normalized values.

MirrorHorizontally = Input(MirrorHorizontally : bool = false)
Invert = Input(Invert : bool = false)
seq = Input(seq : double[]..[])
invertNormalized = Custom[Invert Normalized Value]()  # "Math.InvertNormalized"; Inverts a value between 0 and 1 to its opposite (1-x)
map = List.Map(list=seq, f_x=invertNormalized)
MirrorVertically = Input(MirrorVertically : bool = false)
code_block = CodeBlock(inv=Invert, seq1_inv=map, seq1=seq, mir_ver=MirrorVertically)
# ---------- code_block.designscript (4 lines) ----------
// Invert values (if applicable)
seq2 = inv ? seq1_inv : seq1;
// Mirror values vertically (if applicable)
seq3 = mir_ver ? List.Reverse(seq2) : seq2;
# ----------------------------------------
reverse = List.Reverse()
map_2 = List.Map(list=code_block.seq3, f_x=reverse)
code_block_2 = CodeBlock(mir_hor=MirrorHorizontally, seq4=map_2, seq3=code_block.seq3)
# ---------- code_block_2.designscript (2 lines) ----------
// Mirror horizontally if applicable
mir_hor ? seq4 : seq3;
# ----------------------------------------
seq_2 = Output(code_block_2)  # "seq"
