# Dynamo custom node Paneling.QuadrilateralAlternatingRows.dyf (Dynamo 0.8.2.2392)
# category: Clockwork.Geometry.Tesselation.Paneling.Create
# Creates groups of points from a list of UVs or XYZs for the placement of quadrilateral panels in alternating rows. The placement pattern can be reversed (boolean) and shifted (integer).

rotateGridBy90Degrees = Input(rotateGridBy90Degrees : bool = false)
seq = Input()
swap = Custom[Swap UV](uv=seq)  # "UV.Swap"; Swaps U and V coordinates
code_block = CodeBlock(gridrotation=rotateGridBy90Degrees, UVswapped=swap, UVs=seq) { gridrotation ? UVswapped : UVs; }
V = Input(V : int)
reverse = Input(reverse : bool = false)
shiftPlacement = Input(shiftPlacement : int = 0)
quadrilateral = Custom[Quadrilateral Pattern From Grid](seq=code_block, V=V, reverse=reverse, shiftPlacement=shiftPlacement)  # "Paneling.Quadrilateral"; Creates groups of points from a list of UVs or XYZs for the placement of quadrilateral panels. The placement pattern can be reversed (boolean) and shifted (integer).
code_block_2 = CodeBlock(seq=quadrilateral, V=V)
# ---------- code_block_2.designscript (6 lines) ----------
// Make rows
nested = List.Chop(seq,V);
// Odd rows
List.Flatten(List.DropEveryNthItem(nested,2,0),1);
// Even rows
List.Flatten(List.TakeEveryNthItem(nested,2,0),1);
# ----------------------------------------
oddRows = Output(code_block_2.out1)
evenRows = Output(code_block_2.out2)
