# Dynamo custom node Paneling.ShiftPlacementAndReverse.dyf (Dynamo 0.8.2.2392)
# category: Clockwork.Geometry.Tesselation.Paneling.Actions
# Shifts (integer) and reverses (bool) a given list

reverse = Input(reverse : bool = false)
seq = Input()
shift = Input(shift : int = 0)
code_block = CodeBlock(reverse=reverse, seq1=seq, shift=shift) { seq2 = reverse ? List.Reverse(seq1) : seq1; List.ShiftIndices(seq2,shift); }
seq_2 = Output(code_block.out1)  # "seq"
