# Dynamo custom node Paneling.TriangularSubpattern.dyf (Dynamo 0.8.2.2392)
# category: Clockwork.Geometry.Tesselation.Paneling.Actions
# Subcomponent of the Triangular Pattern From Grid node.

seq = Input()
code_block = CodeBlock { 1; }
shiftPattern = Input(shiftPattern : int = 0)
reversePattern = Input(reversePattern : bool = false)
point1 = Input(point1 : int)
point2 = Input(point2 : int)
point3 = Input(point3 : int)
buildTriangularSublists = Custom[Paneling.BuildTriangularSublists](seq=seq, offset=code_block, shift=shiftPattern, reverse=reversePattern, index0=point1, index1=point2, index2=point3)  # Creates sublists of three items each from a list based on given indices, shift and reverse settings and offset.
V = Input(V : int)
# note: Unclutter
dropLastRowAndColumn = Custom[Drop Last Row & Column From UV Field](seq=buildTriangularSublists, V=V)  # "Paneling.DropLastRowAndColumn"; Drops the last row and column from a UV field
seq_2 = Output(dropLastRowAndColumn)  # "seq"
