# Dynamo custom node Part.SourceElement.dyf (Dynamo 2.0.1.5055)
# category: Clockwork.Revit.Elements.Query
# Retrieves the element a given part was made from

part = Input(part: var[]..[])
turn_into_list = Custom[Turn Into List](unknownItem=part)  # Turns an element (or a nested list) into a flat list
python_script = Python(IN[0]=turn_into_list)
# ---------- python_script.python (19 lines) ----------
import clr
clr.AddReference('RevitAPI')
from Autodesk.Revit.DB import *

clr.AddReference("RevitNodes")
import Revit
clr.ImportExtensions(Revit.Elements)

items = UnwrapElement(IN[0])
elementlist = list()
for item in items:
    sourcelist = list()
    for source in item.GetSourceElementIds():
        sourcelist.append(item.Document.GetElement(source.HostElementId).ToDSType(True))
    if len(sourcelist) < 2:
        elementlist.append(sourcelist[0])
    else:
        elementlist.append(sourcelist)
OUT = elementlist
# ----------------------------------------
returnListOrSingleValue = Custom[ReturnListOrSingleValue](unknownItem=part, seq=python_script)  # If the item in input #1 is not a list, only the first item of the list in input #2 will be returned.
sourceElement = Output(returnListOrSingleValue)
