# Dynamo custom node PathGraph.ByPairs.dyf (Dynamo 0.8.2.2392)
# category: Clockwork.Math.Graphs.Create
# Builds a path graph (Python dictionary) from a list of value pairs.

stringPairs = Input(stringPairs : string[][])
# note: Get a list of distinct indices
flatten = Flatten(stringPairs)
uniqueItems = List.UniqueItems(flatten)
reverse = List.Reverse()
# note: Get a flat list of paths
map = List.Map(list=stringPairs, f_x=reverse)
join = List.Join(stringPairs, map)
python_script = Python(IN[0]=uniqueItems, IN[1]=join)
# ---------- python_script.python (15 lines) ----------
indices = IN[0]
flatlist = IN[1]
pathgraph = dict()

# script found here:
# https://www.python.org/doc/essays/graphs/

for index in indices:
	indexlist = list()
	for item in flatlist:
		if index == item[0]:
			indexlist.append(item[1])
	pathgraph[index] = indexlist	
# convert dictionary to list as Dynamo does not allow Python dictionaries
OUT = pathgraph.items()
# ----------------------------------------
pathGraph = Output(python_script)
