# Dynamo custom node Pattern.BuildTriangularSublists.dyf (Dynamo 2.0.1.5055)
# category: Clockwork.Geometry.Tesselation.Paneling.Actions
# Creates sublists of three items each from a list based on given indices, shift and reverse settings and offset.

seq = Input(seq: var[]..[])
index0 = Input(index0: int)
index1 = Input(index1: int)
index2 = Input(index2: int)
code_block = CodeBlock(a=index0, b=index1, c=index2)
# ---------- code_block.designscript (2 lines) ----------
// Create default placement patterns (counter-clockwise)
[a,b,c];
# ----------------------------------------
shift = Input(shift: int = 0)
reverse = Input(reverse: bool = false)
shiftPlacementAndReverse = Custom[Paneling.ShiftPlacementAndReverse](seq=code_block, shift=shift, reverse=reverse)  # Shifts (integer) and reverses (bool) a given list
offset = Input(offset: int)
code_block_2 = CodeBlock(seq=seq, pat=shiftPlacementAndReverse, offset=offset)
# ---------- code_block_2.designscript (2 lines) ----------
// Create sublists using placement pattern
List.Sublists(seq,[pat[0],pat[1],pat[2]],offset);
# ----------------------------------------
seq_2 = Output(code_block_2)  # "seq"
