# Dynamo custom node Pattern.Quadrilateral.dyf (Dynamo 2.0.0.4654)
# category: Clockwork.Geometry.Tesselation.Paneling.Create
# Creates groups of points from a list of UVs or XYZs for the placement of quadrilateral panels. The placement pattern can be reversed (boolean) and shifted (integer).

seq = Input(seq: var[]..[])
V = Input(V: int)
code_block = CodeBlock(v=V)
# ---------- code_block.designscript (2 lines) ----------
// Default placement pattern (counter-clockwise)
pat = [0,v+1,v+2,1];
# ----------------------------------------
shiftPlacement = Input(shiftPlacement: int = 0)
reverse = Input(reverse: bool = false)
shiftPlacementAndReverse = Custom[Paneling.ShiftPlacementAndReverse](seq=code_block, shift=shiftPlacement, reverse=reverse)  # Shifts (integer) and reverses (bool) a given list
code_block_2 = CodeBlock(seq=seq, pat=shiftPlacementAndReverse)
# ---------- code_block_2.designscript (2 lines) ----------
// Create sublists using placement pattern
List.Sublists(seq,[pat[0],pat[1],pat[2],pat[3]],1);
# ----------------------------------------
n1 = Custom[+1](dbl=V)  # Increments a value by 1
# note: Unclutter
dropLastRowAndColumn = Custom[Paneling.DropLastRowAndColumn](seq=code_block_2, V=n1)  # Drops the last row and column from a UV field
seq_2 = Output(dropLastRowAndColumn)  # "seq"
