# Dynamo custom node Pattern.Quadrilateral2byX.dyf (Dynamo 2.0.3.8810)
# category: Clockwork.Geometry.Tesselation.Paneling.Create
# Creates groups of points from a list of UVs or XYZs for the placement of quadrilateral panels that have more than 4 placement points (e.g. bent panels). The placement pattern can be reversed (boolean), rotated (boolean) and shifted (integer).

reversePattern = Input(reversePattern: bool = false)
rotateGridby90Degrees = Input(rotateGridby90Degrees: bool = false)
seq = Input(seq: var[]..[])
swap = Custom[UV.Swap](uv=seq)  # Swaps U and V coordinates
V = Input(V: int)
n1 = Custom[+1](dbl=V)  # Increments a value by 1
X = Input(X: int)
n1_2 = Custom[-1](dbl=X)  # Decrements a value by 1
code_block = CodeBlock(rotategrid=rotateGridby90Degrees, seq_swapped=swap, seq=seq, V=n1, X=n1_2)
# ---------- code_block.designscript (7 lines) ----------
// rotate grid?
seq2 = rotategrid ? seq_swapped : seq;
// create rows
range1 = 0..V*2-1;
List.Sublists(seq2,range1,V);
// range for patterns
range2 = DSCore.List.Flatten([0..X,V..V+X]);
# ----------------------------------------
sublists = List.Sublists(ranges=code_block.range2, offset=n1_2)  # unwired: list
map = List.Map(list=code_block.out2, f_x=sublists)
code_block_2 = CodeBlock(seq=map, X=X)
# ---------- code_block_2.designscript (3 lines) ----------
// prepare panel coordinate sets for filtering
List.Flatten(seq,1);
X*2;
# ----------------------------------------
filterBySublistLength = Custom[List.FilterBySublistLength](seq=code_block_2.out0, length=code_block_2.out1)  # Filters out all sublists that do not have the specified length
reverse = List.Reverse()  # unwired: list
map_2 = List.Map(list=filterBySublistLength.in, f_x=reverse)
code_block_3 = CodeBlock(reverse=reversePattern, seq=filterBySublistLength.in, seq_reversed=map_2)
# ---------- code_block_3.designscript (2 lines) ----------
// reverse placement point order?
seq2 = reverse ? seq : seq_reversed;
# ----------------------------------------
shiftPattern = Input(shiftPattern: int)
shiftIndices = List.ShiftIndices(amount=shiftPattern)  # unwired: list
map_3 = List.Map(list=code_block_3, f_x=shiftIndices)
seq_2 = Output(map_3)  # "seq"
