# Dynamo custom node Pattern.QuadrilateralCheckerboard.dyf (Dynamo 2.0.1.5055)
# category: Clockwork.Geometry.Tesselation.Paneling.Create
# Creates groups of points from a list of UVs or XYZs for the placement of quadrilateral panels in a checkerboard pattern. The placement pattern can be reversed (boolean) and shifted (integer).

seq = Input(seq: var[]..[])
V = Input(V: int)
reverse = Input(reverse: bool = false)
shiftPlacement = Input(shiftPlacement: int)
quadrilateral_pattern_from_grid = Custom[Quadrilateral Pattern From Grid](seq=seq, V=V, reverse=reverse, shiftPlacement=shiftPlacement)  # Creates groups of points from a list of UVs or XYZs for the placement of quadrilateral panels. The placement pattern can be reversed (boolean) and shifted (integer).
code_block = CodeBlock(seq=quadrilateral_pattern_from_grid, V=V)
# ---------- code_block.designscript (8 lines) ----------
// Make rows
nested = List.Chop(seq,V);
// Odd rows
List.DropEveryNthItem(nested,2,0);
// Even rows
List.TakeEveryNthItem(nested,2,0);
0;
2;
# ----------------------------------------
dropEveryNthItem = List.DropEveryNthItem(n=code_block.out4, offset=code_block.out3)  # unwired: list
map = List.Map(list=code_block.out1, f_x=dropEveryNthItem)
takeEveryNthItem = List.TakeEveryNthItem(n=code_block.out4, offset=code_block.out3)  # unwired: list
map_2 = List.Map(list=code_block.out2, f_x=takeEveryNthItem)
map_3 = List.Map(list=code_block.out1, f_x=takeEveryNthItem)
map_4 = List.Map(list=code_block.out2, f_x=dropEveryNthItem)
code_block_2 = CodeBlock(a1=map, a2=map_2, b1=map_3, b2=map_4) { List.Flatten([a1,a2],2); List.Flatten([b1,b2],2); }
typeA = Output(code_block_2.out0)
typeB = Output(code_block_2.out1)
