# Dynamo custom node Pattern.TriangularFlatDiagonal.dyf (Dynamo 2.0.0.4654)
# category: Clockwork.Geometry.Tesselation.Paneling.Create
# Creates groups of points from a list of UVs or XYZs for the placement of triangular panels. The placement pattern can be reversed (boolean) and shifted (integer).

V = Input(V: int)
shiftOverallPlacement = Input(shiftOverallPlacement: int = 0)
rotateGridBy90Degrees = Input(rotateGridBy90Degrees: bool = false)
seq = Input(seq: var[]..[])
swap_uv = Custom[Swap UV](uv=seq)  # Swaps U and V coordinates
code_block = CodeBlock(V=V, shift=shiftOverallPlacement, rotate=rotateGridBy90Degrees, seq_swapped=swap_uv, seq=seq)
# ---------- code_block.designscript (10 lines) ----------
// Create placement pattern
pat1 = [0,V+1,V+2,1];
// Shift overall placement pattern
pat2 = List.ShiftIndices(pat1,shift);
pat2[0];
pat2[1];
pat2[2];
pat2[3];
// Rotate coordinates (if applicable)
rotate ? seq_swapped : seq;
# ----------------------------------------
n1 = Custom[+1](dbl=V)  # Increments a value by 1
reverseTypeA = Input(reverseTypeA: bool = false)
shiftPlacementTypeA = Input(shiftPlacementTypeA: int = 0)
triangularSubpattern = Custom[Paneling.TriangularSubpattern](seq=code_block.out6, V=n1, reversePattern=reverseTypeA, shiftPattern=shiftPlacementTypeA, point1=code_block.out4, point2=code_block.out5, point3=code_block.out2)  # Subcomponent of the Triangular Pattern From Grid node.
typeA = Output(triangularSubpattern)
reverseTypeB = Input(reverseTypeB: bool = false)
shiftPlacementTypeB = Input(shiftPlacementTypeB: int = 0)
triangularSubpattern_2 = Custom[Paneling.TriangularSubpattern](seq=code_block.out6, V=n1, reversePattern=reverseTypeB, shiftPattern=shiftPlacementTypeB, point1=code_block.out2, point2=code_block.out3, point3=code_block.out4)
typeB = Output(triangularSubpattern_2)
