# Dynamo custom node Pattern.TriangularFlatMirrored.dyf (Dynamo 2.0.1.5055)
# category: Clockwork.Geometry.Tesselation.Paneling.Create
# Creates groups of points from a list of UVs or XYZs for the placement of triangular (diagrid) panels. The placement pattern can be reversed (boolean) and shifted (integer).

code_block = CodeBlock { [0..n]; }  # unwired: n
rotateGridBy90Degrees = Input(rotateGridBy90Degrees: bool = false)
seq = Input(seq: var[]..[])
swap = Custom[UV.Swap](uv=seq)  # Swaps U and V coordinates
V = Input(V: int)
shiftRows = Input(shiftRows: bool = false)
isEvenNumber = Custom[IsEvenNumber](val=V)  # Checks if a number is even.
isOddNumber = Custom[IsOddNumber](val=V)  # Checks if a number is odd.
code_block_2 = CodeBlock(rotate=rotateGridBy90Degrees, seq1_swapped=swap, seq1=seq, V=V, shiftrows=shiftRows, is_even=isEvenNumber, is_odd=isOddNumber)
# ---------- code_block_2.designscript (19 lines) ----------
// DATA
// Rotate entire grid by 90°?
seq2 = rotate ? seq1_swapped : seq1;
// Make rows
rows = List.Sublists(seq2,0..(2*V+1),V+1);
// Odd rows
evenodd[0] = List.DropEveryNthItem(rows,2,0);
// Even rows
evenodd[1] = List.TakeEveryNthItem(rows,2,0);
// Left corners, standing & Rows, standing
evenodd[shiftrows ? 1 : 0];
// Left corners, lying & Rows, lying
evenodd[shiftrows ? 0 : 1];
// Right corners, standing
cond_rcs = (is_even && !(shiftrows)) || (is_odd && shiftrows);
evenodd[cond_rcs ? 0 : 1];
// Right corners, lying
cond_rcl = (is_even && shiftrows) || (is_odd && !(shiftrows));
evenodd[cond_rcl ? 0 : 1];
# ----------------------------------------
code_block_3 = CodeBlock(V=V)
# ---------- code_block_3.designscript (9 lines) ----------
// INDICES
0;
1;
2;
3;
V+1;
V+2;
V+3;
V+4;
# ----------------------------------------
shiftPlacementRowsLying = Input(shiftPlacementRowsLying: int = 0)
reverseRowsLying = Input(reverseRowsLying: bool = false)
buildTriangularSublists = Custom[Pattern.BuildTriangularSublists](seq=code_block_2.out4@L2, offset=code_block_3.out2, shift=shiftPlacementRowsLying, reverse=reverseRowsLying, index0=code_block_3.out6, index1=code_block_3.out1, index2=code_block_3.out4)  # Creates sublists of three items each from a list based on given indices, shift and reverse settings and offset.
buildTriangularSublists_2 = Custom[Pattern.BuildTriangularSublists](seq=code_block_2.out5@L2, offset=code_block_3.out2, shift=shiftPlacementRowsLying, reverse=reverseRowsLying, index0=code_block_3.out7, index1=code_block_3.out2, index2=code_block_3.out5)
join = List.Join(list0=buildTriangularSublists, list1=buildTriangularSublists_2)
code_block_4 = CodeBlock { 1; 3; }
flatten = List.Flatten(list=join, amt=code_block_4.out0)
filterBySublistLength = Custom[List.FilterBySublistLength](seq=flatten, length=code_block_4.out1)  # Filters out all sublists that do not have the specified length
rowsLying = Output(filterBySublistLength.in)
shiftPlacementRowsStanding = Input(shiftPlacementRowsStanding: int = 0)
reverseRowsStanding = Input(reverseRowsStanding: bool = false)
buildTriangularSublists_3 = Custom[Pattern.BuildTriangularSublists](seq=code_block_2.out4@L2, offset=code_block_3.out2, shift=shiftPlacementRowsStanding, reverse=reverseRowsStanding, index0=code_block_3.out1, index1=code_block_3.out6, index2=code_block_3.out3)
filterBySublistLength_2 = Custom[List.FilterBySublistLength](seq=buildTriangularSublists_3@L3, length=code_block_4.out1)
count = List.Count(list=filterBySublistLength_2.in@L3)
code_block_5 = CodeBlock(n=count) { n-1; }
takeItems = List.TakeItems(list=filterBySublistLength_2.in@L3, amount=code_block_5@L1)
buildTriangularSublists_4 = Custom[Pattern.BuildTriangularSublists](seq=code_block_2.out5@L2, offset=code_block_3.out2, shift=shiftPlacementRowsStanding, reverse=reverseRowsStanding, index0=code_block_3.out0, index1=code_block_3.out5, index2=code_block_3.out2)
filterBySublistLength_3 = Custom[List.FilterBySublistLength](seq=buildTriangularSublists_4@L3, length=code_block_4.out1)
join_2 = List.Join(list0=takeItems, list1=filterBySublistLength_3.in)
# note: Necessary cleanup:
# In some cases there are groups of three points that we don't want...
count_2 = List.Count(list=filterBySublistLength_3.in@L3)
code_block_6 = CodeBlock(n=count_2) { n-1; }
takeItems_2 = List.TakeItems(list=filterBySublistLength_3.in@L3, amount=code_block_6@L1)
join_3 = List.Join(list0=filterBySublistLength_2.in, list1=takeItems_2)
code_block_7 = CodeBlock(list1=join_2, list2=join_3, is_even=isEvenNumber) { rows_standing[0] = list1; rows_standing[1] = list2; rows_standing[is_even ? 0 : 1]; }
flatten_2 = List.Flatten(list=code_block_7.out2, amt=code_block_4.out0)
rowsStanding = Output(flatten_2)
code_block_8 = CodeBlock(V=V)
# ---------- code_block_8.designscript (9 lines) ----------
// PATTERNS
// Left corners, standing
[0,V+1,1];
// Left corners, lying
[V+2,0,V+1];
// Right corners, standing
[V-1,2*V+1,V];
// Right corners, flying
[2*V+1,V,2*V];
# ----------------------------------------
code_block_9 = CodeBlock { shiftPlacementLeftCornersLying : int = 0; }
code_block_10 = CodeBlock { reverseLeftCornersLying : bool = false; }
shiftPlacementAndReverse = Custom[Pattern.ShiftPlacementAndReverse](seq=code_block_8.out1, shift=code_block_9, reverse=code_block_10)  # Shifts (integer) and reverses (bool) a given list
makeTriangles = Custom[Pattern.MakeTriangles](seq=code_block_2.out5, pat=shiftPlacementAndReverse)  # Reduces each sublist to a list of three items specified by the indices in the pattern.
filterBySublistLength_4 = Custom[List.FilterBySublistLength](seq=makeTriangles, length=code_block_4.out1)
leftCornersLying = Output(filterBySublistLength_4.in)
code_block_11 = CodeBlock { shiftPlacementLeftCornersStanding : int = 0; }
code_block_12 = CodeBlock { reverseLeftCornersStanding : bool = false; }
shiftPlacementAndReverse_2 = Custom[Pattern.ShiftPlacementAndReverse](seq=code_block_8.out0, shift=code_block_11, reverse=code_block_12)
makeTriangles_2 = Custom[Pattern.MakeTriangles](seq=code_block_2.out4, pat=shiftPlacementAndReverse_2)
filterBySublistLength_5 = Custom[List.FilterBySublistLength](seq=makeTriangles_2, length=code_block_4.out1)
leftCornersStanding = Output(filterBySublistLength_5.in)
code_block_13 = CodeBlock { shiftPlacementRightCornersLying : int = 0; }
code_block_14 = CodeBlock { reverseRightCornersLying : bool = false; }
shiftPlacementAndReverse_3 = Custom[Pattern.ShiftPlacementAndReverse](seq=code_block_8.out3, shift=code_block_13, reverse=code_block_14)
makeTriangles_3 = Custom[Pattern.MakeTriangles](seq=code_block_2.out9, pat=shiftPlacementAndReverse_3)
filterBySublistLength_6 = Custom[List.FilterBySublistLength](seq=makeTriangles_3, length=code_block_4.out1)
rightCornersLying = Output(filterBySublistLength_6.in)
code_block_15 = CodeBlock { shiftPlacementRightCornersStanding : int = 0; }
code_block_16 = CodeBlock { reverseRightCornersStanding : bool = false; }
shiftPlacementAndReverse_4 = Custom[Pattern.ShiftPlacementAndReverse](seq=code_block_8.out2, shift=code_block_15, reverse=code_block_16)
makeTriangles_4 = Custom[Pattern.MakeTriangles](seq=code_block_2.out7, pat=shiftPlacementAndReverse_4)
filterBySublistLength_7 = Custom[List.FilterBySublistLength](seq=makeTriangles_4, length=code_block_4.out1)
rightCornersStanding = Output(filterBySublistLength_7.in)
