# Dynamo custom node PerspectiveView.OrientToEyeAndTargetPosition.dyf (Dynamo 2.0.0.4654)
# category: Clockwork.Revit.Views.Actions
# Sets the orientation of a given perspective view based on a given eye and target position. View needs to be in an unlocked state.

view = Input(view: Revit.Elements.Views.PerspectiveView)
View = Output(view)
eyePosition = Input(eyePosition: Autodesk.DesignScript.Geometry.Point)
targetPosition = Input(targetPosition: Autodesk.DesignScript.Geometry.Point)
byTwoPoints = Vector.ByTwoPoints(start=eyePosition, end=targetPosition)
normalized = Vector.Normalized(vector=byTwoPoints)
ZAxis = Vector.ZAxis()
add = Point.Add(point=targetPosition, vectorToAdd=ZAxis)
byThreePoints = Plane.ByThreePoints(origin=eyePosition, planePoint=targetPosition, xAxisPoint=add)
normal = Plane.Normal(plane=byThreePoints)
code_block = CodeBlock { 90; }
rotate = Vector.Rotate(vector=normalized, axis=normal, degrees=code_block)
correctOrientation = Custom[Normal.CorrectOrientation](VectorA=rotate, VectorB=ZAxis)  # Inverts normal A if its inversion is closer to normal B
python_script = Python(IN[0]=view, IN[1]=eyePosition, IN[2]=correctOrientation, IN[3]=normalized)
# ---------- python_script.python (29 lines) ----------
import clr
clr.AddReference('RevitAPI')
from Autodesk.Revit.DB import *

clr.AddReference("RevitNodes")
import Revit
clr.ImportExtensions(Revit.Elements)
clr.ImportExtensions(Revit.GeometryConversion)

clr.AddReference("RevitServices")
import RevitServices
from RevitServices.Persistence import DocumentManager
from RevitServices.Transactions import TransactionManager

doc = DocumentManager.Instance.CurrentDBDocument
view = UnwrapElement(IN[0])
eyeposition = IN[1].ToXyz()
updirection = IN[2].ToXyz()
forwarddirection = IN[3].ToXyz()

TransactionManager.Instance.EnsureInTransaction(doc)
try:
	newVO = ViewOrientation3D(eyeposition, updirection, forwarddirection)
	view.SetOrientation(newVO)
	view.SaveOrientation()
	OUT = True
except:
	OUT = False
TransactionManager.Instance.TransactionTaskDone()
# ----------------------------------------
success = Output(python_script)
