# Dynamo custom node PlaceholderSheet.ByNumberAndName.dyf (Dynamo 1.3.1.1736)
# category: Clockwork.Revit.Views.Sheet.Create
# Creates placeholder sheets

sheetNumber = Input(sheetNumber : string[]..[])
turnIntoList = Custom[Turn Into List](unknownItem=sheetNumber)  # Turns an element (or a nested list) into a flat list
sheetName = Input(sheetName : string[]..[])
turnIntoList_2 = Custom[Turn Into List](unknownItem=sheetName)
code_block = CodeBlock(nums=turnIntoList, names=turnIntoList_2) { {nums,names}; }
equalSublistLengths = Custom[Equal List Lengths](lists=code_block)  # "List.EqualSublistLengths"; Trims all given lists to the length of the shortest list
code_block_2 = CodeBlock(seq=equalSublistLengths) { seq[0]; seq[1]; }
python_script = Python(IN[0]=code_block_2.out0, IN[1]=code_block_2.out1)
# ---------- python_script.python (31 lines) ----------
import clr
clr.AddReference('RevitAPI')
from Autodesk.Revit.DB import *

clr.AddReference("RevitNodes")
import Revit
clr.ImportExtensions(Revit.Elements)

clr.AddReference("RevitServices")
import RevitServices
from RevitServices.Persistence import DocumentManager
from RevitServices.Transactions import TransactionManager

doc = DocumentManager.Instance.CurrentDBDocument
sheetnums = IN[0]
sheetnames = IN[1]
elementlist = list()
counter = 0

TransactionManager.Instance.EnsureInTransaction(doc)
for num in sheetnums:
	try:
		newsheet = ViewSheet.CreatePlaceholder(doc)
		newsheet.SheetNumber = num
		newsheet.Name = sheetnames[counter]
		elementlist.append(newsheet.ToDSType(False))
	except:
		elementlist.append(None)
	counter += 1
TransactionManager.Instance.TransactionTaskDone()
OUT = elementlist
# ----------------------------------------
returnListOrSingleValue = Custom[ReturnListOrSingleValue](unknownItem=code_block_2.out0, seq=python_script)  # If the item in input #1 is not a list, only the first item of the list in input #2 will be returned.
sheet = Output(returnListOrSingleValue)
