# Dynamo custom node PlanView.Underlay.dyf (Dynamo 2.0.1.5055)
# category: Clockwork.Revit.Views.Query
# Returns the underlay(s) of a given plan view

planView = Input(planView: var[]..[])
python_script = Python(IN[0]=planView)
# ---------- python_script.python (24 lines) ----------
import clr
clr.AddReference('RevitAPI')
from Autodesk.Revit.DB import *

def GetUnderlays(view):
	baselvl = None
	toplvl = None
	ulOrientation = None
	# Revit 2016 R2 and later
	if hasattr(view, "GetUnderlayBaseLevel"):	
		if view.GetUnderlayBaseLevel().IntegerValue > 0: baselvl = view.Document.GetElement(view.GetUnderlayBaseLevel())
		if view.GetUnderlayTopLevel().IntegerValue > 0: toplvl = view.Document.GetElement(view.GetUnderlayTopLevel())
		ulOrientation = str(view.GetUnderlayOrientation())
	# anything before
	else:
		try: 
			if view.get_Parameter(BuiltInParameter.VIEW_UNDERLAY_ID).AsElementId().IntegerValue > 0: baselvl = view.Document.GetElement(view.get_Parameter(BuiltInParameter.VIEW_UNDERLAY_ID).AsElementId())
		except: pass
	return baselvl, toplvl, ulOrientation

views = UnwrapElement(IN[0])

if isinstance(IN[0], list): OUT = map(list, zip(*[GetUnderlays(x) for x in views]))
else: OUT = GetUnderlays(views)
# ----------------------------------------
code_block = CodeBlock(seq=python_script) { seq[0]; seq[1]; seq[2]; }
baseUnderlay = Output(code_block.out0)
topUnderlay = Output(code_block.out1)
underlayOrientation = Output(code_block.out2)
