# Dynamo custom node Plane.ByBestFitFromFace.dyf (Dynamo 2.0.0.4654)
# category: Clockwork.Geometry.Abstract.Create
# Creates a plane from face

surface = Input(surface: Autodesk.DesignScript.Geometry.Surface)
vertices = Topology.Vertices(topology=surface)
pointGeometry = Vertex.PointGeometry(vertex=vertices)
byBestFitThroughPoints = Plane.ByBestFitThroughPoints(points=pointGeometry)
plane = Output(byBestFitThroughPoints)
