# Dynamo custom node Plane.ByFirst3Points.dyf (Dynamo 2.0.0.4654)
# category: Clockwork.Geometry.Abstract.Create
# Returns a plane, its origin and its normal based on the first three XYZs in a given list

points = Input(points: Autodesk.DesignScript.Geometry.Point[])
code_block = CodeBlock { 3; }
takeItems = List.TakeItems(list=points, amount=code_block)
byBestFitThroughPoints = Plane.ByBestFitThroughPoints(points=takeItems)
plane = Output(byBestFitThroughPoints)
