# Dynamo custom node Point.Average.dyf (Dynamo 1.3.0.875)
# category: Clockwork.Geometry.Points.Query
# Determines the average of a list of points

points = Input(points : Autodesk.Point[])
code_block = CodeBlock(pts=points) { pt = Math.Average({pts.X,pts.Y,pts.Z}); pt[0]; pt[1]; pt[2]; }
byCoordinates = Point.ByCoordinates(x=code_block.out1, y=code_block.out2, z=code_block.out3)
Point = Output(byCoordinates)
