# Dynamo custom node Point.CentralProjectionOnFace.dyf (Dynamo 2.0.1.5055)
# category: Clockwork.Geometry.Points.Actions
# Projects a list of points onto a given face

surface = Input(surface: Autodesk.DesignScript.Geometry.Surface)
projectionPoints = Input(projectionPoints: Autodesk.DesignScript.Geometry.Point[])
centralProjectionPoint = Input(centralProjectionPoint: Autodesk.DesignScript.Geometry.Point)
byTwoPoints = Vector.ByTwoPoints(start=centralProjectionPoint, end=projectionPoints)
projectInputOnto = Surface.ProjectInputOnto(surface=surface, geometryToProject=projectionPoints, projectionDirection=byTwoPoints)
projectedPoints = Output(projectInputOnto)
