# Dynamo custom node Point.CentralProjectionOnPlane.dyf (Dynamo 2.0.0.4654)
# category: Clockwork.Geometry.Points.Actions
# Projects a list of points onto a given plane

centralProjectionPoint = Input(centralProjectionPoint: Autodesk.DesignScript.Geometry.Point)
projectionPoints = Input(projectionPoints: Autodesk.DesignScript.Geometry.Point[])
byTwoPoints = Vector.ByTwoPoints(start=centralProjectionPoint, end=projectionPoints)
normalized = Vector.Normalized(vector=byTwoPoints)
plane = Input(plane: Autodesk.DesignScript.Geometry.Plane)
intersectionWithPlane = Custom[Vector.IntersectionWithPlane](vectorBasePoint=centralProjectionPoint, vector=normalized, plane=plane)  # Finds the intersection point between a plane and a vector
projectedPoints = Output(intersectionWithPlane)
