# Dynamo custom node Point.IsOutOfPlane.dyf (Dynamo 2.0.1.5055)
# category: Clockwork.Geometry.Points.Query
# Checks a list for XYZs that are not located on a given plane

face_plane = Input(face/plane: var[]..[])
point = Input(point: Autodesk.DesignScript.Geometry.Point)
closestPointTo = Geometry.ClosestPointTo(geometry=face_plane, other=point)
isAlmostEqualTo = Geometry.IsAlmostEqualTo(geometry=closestPointTo, other=point)
not_ = Not(x=isAlmostEqualTo)
bool = Output(not_)
distanceTo = Geometry.DistanceTo(geometry=closestPointTo, other=point)
amount = Output(distanceTo)
