# Dynamo custom node Point.RoundDownToPrecision.dyf (Dynamo 2.0.0.4654)
# category: Clockwork.Geometry.Points.Actions
# Rounds a point coordinate *down* to a specified precision

point = Input(point: var[]..[])
precision = Input(precision: var[]..[])
code_block = CodeBlock(po=point, pr=precision) { a = [po.X,po.Y,po.Z]; ar = Math.Floor(a/pr)*pr; ar[0]; ar[1]; ar[2]; }
byCoordinates = Point.ByCoordinates(x=code_block.out2, y=code_block.out3, z=code_block.out4)
point_2 = Output(byCoordinates)  # "point"
