# Dynamo custom node Point.RoundUpToPrecision.dyf (Dynamo 2.0.0.4654)
# category: Clockwork.Geometry.Points.Actions
# Rounds a point coordinate *up* to a specified precision

pointp = Input(pointp: var[]..[])
precision = Input(precision: var[]..[])
code_block = CodeBlock(po=pointp, pr=precision) { a = [po.X,po.Y,po.Z]; ar = Math.Ceiling(a/pr)*pr; ar[0]; ar[1]; ar[2]; }
byCoordinates = Point.ByCoordinates(x=code_block.out2, y=code_block.out3, z=code_block.out4)
point = Output(byCoordinates)
