# Dynamo custom node PointSequence.ContainsOutOfPlanePoints.dyf (Dynamo 2.0.0.4654)
# category: Clockwork.Geometry.Points.Query
# Checks a list for XYZs that are not located on a given plane

face_plane = Input(face/plane: var[]..[])
seq = Input(seq: var[]..[])
turnIntoList = Custom[TurnIntoList](unknownItem=seq)  # Turns an element (or a nested list) into a flat list
isOutOfPlane = Custom[Point.IsOutOfPlane](face_plane=face_plane, point=turnIntoList)  # Checks a list for XYZs that are not located on a given plane
anyTrue = Custom[List.AnyTrue](seq=isOutOfPlane.bool)  # Returns true if any item in a list of booleans is true.
bool = Output(anyTrue)
maximumItem = List.MaximumItem(list=isOutOfPlane.amount)
max = Output(maximumItem)
