# Dynamo custom node PointSequence.GreatestDistanceToPoint.dyf (Dynamo 2.0.0.4654)
# category: Clockwork.Geometry.Points.Query
# Retrieves the furthest point in a sequence of points

point = Input(point: Autodesk.DesignScript.Geometry.Point)
seq = Input(seq: var[]..[])
turn_into_list = Custom[Turn Into List](unknownItem=seq)  # Turns an element (or a nested list) into a flat list
distanceTo = Geometry.DistanceTo(geometry=point, other=turn_into_list)
maximumItem = List.MaximumItem(list=distanceTo)
distance = Output(maximumItem)
code_block = CodeBlock(max=maximumItem, distlist=distanceTo) { max == distlist; }
bool = Output(code_block)
