# Dynamo custom node Railing.ByPathRailingTypeAndLevel.dyf (Dynamo 2.3.0.5885)
# category: Clockwork.Revit.Elements
# Creates a railing

curves = Input(curves: Autodesk.DesignScript.Geometry.Curve[])
railingType = Input(railingType: var[]..[])
level = Input(level: Revit.Elements.Level)
python_script = Python(IN[0]=curves, IN[1]=railingType, IN[2]=level)
# ---------- python_script.python (22 lines) ----------
import clr
clr.AddReference('RevitAPI')
from Autodesk.Revit.DB import *

clr.AddReference("RevitNodes")
import Revit
clr.ImportExtensions(Revit.GeometryConversion)

clr.AddReference("RevitServices")
import RevitServices
from RevitServices.Persistence import DocumentManager
from RevitServices.Transactions import TransactionManager

doc = DocumentManager.Instance.CurrentDBDocument
curves = UnwrapElement(IN[0])
railingtype = UnwrapElement(IN[1])
lvl = UnwrapElement(IN[2])

TransactionManager.Instance.EnsureInTransaction(doc)
curveloop = CurveLoop.Create([x.ToRevitType() for x in curves])
OUT = Architecture.Railing.Create(doc, curveloop, railingtype.Id, lvl.Id)
TransactionManager.Instance.TransactionTaskDone()
# ----------------------------------------
railing = Output(python_script)
