# Dynamo custom node RandomList.AsElements.dyf (Dynamo 2.0.1.5055)
# category: Clockwork.List.Generate.Create
# Creates a list of random elements based on a given list of elements

baseElements = Input(baseElements: var[])
count = List.Count(list=baseElements)
n1 = Custom[-1](dbl=count)  # Decrements a value by 1
amount = Input(amount: int)
seed = Input(seed: int = 0)
randomIntegerList = Custom[Math.RandomIntegerList](max=n1, amount=amount, seed=seed)  # Creates a list of random integers between 0 and a given maximum value
getItemAtIndex = List.GetItemAtIndex(list=baseElements, index=randomIntegerList)
seq = Output(getItemAtIndex)
