# Dynamo custom node Regex.ContainsRegularExpression.dyf (Dynamo 2.0.0.4654)
# category: Clockwork.Core.String.Inspect.Actions
# Determines if a regular expression matches a string (or a list of strings), i.e. occurs anywhere in the string, and returns a boolean value (or a list, depending on the input). The syntax for regular expressions is explained at
# http://ironpython-test.readthedocs.org/en/latest/howto/regex.html

RegEx = Input(RegEx: string)
ignoreCase = Input(ignoreCase: bool = false)
useLocale = Input(useLocale: bool = false)
dotAll = Input(dotAll: bool = false)
multilineMatching = Input(multilineMatching: bool = false)
compileRegularExpression = Custom[String.CompileRegularExpression](regExp=RegEx, ignoreCase=ignoreCase, useLocale=useLocale, dotAll=dotAll, multilineMatching=multilineMatching)  # This is a helper node for setting certain flags for the Regular Expresssion nodes. http://ironpython-test.readthedocs.org/en/latest/howto/regex.html
str = Input(str: string)
python_script = Python(IN[0]=compileRegularExpression, IN[1]=str)
# ---------- python_script.python (9 lines) ----------
import clr
import re

def ContainsRegex(regex, str):
	if regex.search(str): return True
	else: return False

if isinstance(IN[1], list): OUT = [ContainsRegex(IN[0], x) for x in IN[1]]
else: OUT = ContainsRegex(IN[0], IN[1])
# ----------------------------------------
bool = Output(python_script)
