# Dynamo custom node Regex.FindRegularExpression.dyf (Dynamo 2.0.0.4654)
# category: Clockwork.Core.String.Inspect.Actions
# Returns all occurences of a regular expression within a string (or list of strings). The syntax for regular expressions is explained at
# http://ironpython-test.readthedocs.org/en/latest/howto/regex.html

RegEx = Input(RegEx: string)
ignoreCase = Input(ignoreCase: bool = false)
useLocale = Input(useLocale: bool = false)
dotAll = Input(dotAll: bool = false)
multilineMatching = Input(multilineMatching: bool = false)
compileRegularExpression = Custom[String.CompileRegularExpression](regExp=RegEx, ignoreCase=ignoreCase, useLocale=useLocale, dotAll=dotAll, multilineMatching=multilineMatching)  # This is a helper node for setting certain flags for the Regular Expresssion nodes. http://ironpython-test.readthedocs.org/en/latest/howto/regex.html
str = Input(str: string)
python_script = Python(IN[0]=compileRegularExpression, IN[1]=str)
# ---------- python_script.python (17 lines) ----------
import clr
import re

if isinstance(IN[1], list): OUT = [IN[0].findall(x) for x in IN[1]]
else: OUT = IN[0].findall(IN[1])

"""
thisexp = IN[0]
regexlist = IN[1]
elementlist = list()
	
for item in regexlist:
	try:
		elementlist.append(thisexp.findall(item))
	except:
		elementlist.append(list())
OUT = elementlist"""
# ----------------------------------------
seq = Output(python_script)
