# Dynamo custom node ReturnListOrSingleValue.dyf (Dynamo 2.0.1.5055)
# category: Clockwork.Script.ControlFlow.Actions
# If the unknown item is not a list but rather a single item, only the first item of the list (input "seq") will be returned.

unknownItem = Input(unknownItem: var[]..[])
seq = Input(seq: var[]..[])
python_script = Python(IN[0]=unknownItem, IN[1]=seq)
# ---------- python_script.python (4 lines) ----------
check = IN[0]
items = IN[1]
if isinstance(check, (list)): OUT = items
else: OUT = items[0]
# ----------------------------------------
Output = Output(python_script)  # ""
