# Dynamo custom node RevisionCloud.FromElements.dyf (Dynamo 2.0.3.8810)
# category: Clockwork.Revit.Elements.Create
# Create a revision cloud for a list of Revit elements

view = Input(view: var[]..[])
elements = Input(elements: var[]..[])
boundingBox = Element.BoundingBox(element=elements)
fromBoundingBoxes = Custom[BoundingBox.FromBoundingBoxes](boundingBoxes=boundingBox)  # Merges a list of bounding boxes into a single bounding box
plane = Custom[View.Plane](view=view)  # Retrieves the plane of a given view
normal = Plane.Normal(plane=plane)
perimeterCurvesByNormal = Custom[BoundingBox.PerimeterCurvesByNormal](boundingbox=fromBoundingBoxes, normal=normal)  # Returns the perimeter curve of a bounding box on a plane determined by a given normal and the centroid of the bounding box
revision = Input(revision: var[]..[])
byCurve = RevisionCloud.ByCurve(view=view, curves=perimeterCurvesByNormal, revision=revision)
revisionCloud = Output(byCurve)
