# Dynamo custom node RevitFace.FromDynamoSurface.dyf (Dynamo 2.0.1.5055)
# category: Clockwork.Revit.Selection.ByFace.Query
# Returns the underlying Revit face of a given surface

DynamoSurface = Input(DynamoSurface: Autodesk.DesignScript.Geometry.Surface)
turn_into_list = Custom[Turn Into List](unknownItem=DynamoSurface)  # Turns an element (or a nested list) into a flat list
python_script = Python(IN[0]=turn_into_list)
# ---------- python_script.python (19 lines) ----------
import clr
clr.AddReference('RevitAPI')
from Autodesk.Revit.DB import *

clr.AddReference("RevitServices")
import RevitServices
from RevitServices.Persistence import DocumentManager

doc = DocumentManager.Instance.CurrentDBDocument
faces = UnwrapElement(IN[0])
elementlist = list()
for face in faces:
	try:
		ref = face.Tags.LookupTag("RevitFaceReference")
		face = doc.GetElement(ref).GetGeometryObjectFromReference(ref)
		elementlist.append(face)
	except:
		elementlist.append(list())
OUT = elementlist
# ----------------------------------------
returnListOrSingleValue = Custom[ReturnListOrSingleValue](unknownItem=DynamoSurface, seq=python_script)  # If the item in input #1 is not a list, only the first item of the list in input #2 will be returned.
RevitFace = Output(returnListOrSingleValue)
