# Dynamo custom node Roof.ResetSlabShape.dyf (Dynamo 2.0.1.5055)
# category: Clockwork.Revit.Elements.Actions
# Resets the slabshape of a roof

roof = Input(roof: var[]..[])
turnIntoList = Custom[TurnIntoList](unknownItem=roof)  # Turns an element (or a nested list) into a flat list
python_script = Python(IN[0]=turnIntoList)
# ---------- python_script.python (29 lines) ----------
import clr
clr.AddReference('RevitAPI')
from Autodesk.Revit.DB import *

clr.AddReference("RevitNodes")
import Revit
clr.ImportExtensions(Revit.GeometryConversion)

clr.AddReference("RevitServices")
import RevitServices
from RevitServices.Persistence import DocumentManager
from RevitServices.Transactions import TransactionManager

doc = DocumentManager.Instance.CurrentDBDocument
slabs = UnwrapElement(IN[0])
success = []

TransactionManager.Instance.EnsureInTransaction(doc)
for slab in slabs:
	objtype = slab.GetType().ToString()
	if objtype == "Autodesk.Revit.DB.FootPrintRoof" or objtype == "Autodesk.Revit.DB.Floor":
		try:
			slab.SlabShapeEditor.ResetSlabShape()
			success.append(True)
		except: success.append(False)
	else: success.append(False)
TransactionManager.Instance.TransactionTaskDone()

OUT = (slabs, success)
# ----------------------------------------
firstItem = List.FirstItem(list=python_script)
returnListOrSingleValue = Custom[ReturnListOrSingleValue](unknownItem=roof, seq=firstItem)  # If the unknown item is not a list but rather a single item, only the first item of the list (input "seq") will be returned.
roof_2 = Output(returnListOrSingleValue)  # "roof"
lastItem = List.LastItem(list=python_script)
returnListOrSingleValue_2 = Custom[ReturnListOrSingleValue](unknownItem=roof, seq=lastItem)
success = Output(returnListOrSingleValue_2)
