# Dynamo custom node Roof.SlabShapeByPoints.dyf (Dynamo 2.0.1.5055)
# category: Clockwork.Revit.Elements.Actions
# Transform a slab shape based on a list of Points.

points = Input(points: Autodesk.DesignScript.Geometry.Point[]..[])
roof = Input(roof: var[]..[])
python_script = Python(IN[0]=points, IN[1]=roof)
# ---------- python_script.python (37 lines) ----------
import clr
clr.AddReference('RevitAPI')
from Autodesk.Revit.DB import *

clr.AddReference("RevitNodes")
import Revit
clr.ImportExtensions(Revit.GeometryConversion)

clr.AddReference("RevitServices")
import RevitServices
from RevitServices.Persistence import DocumentManager
from RevitServices.Transactions import TransactionManager

def AddPointToSlabShape(item, point):
	if hasattr(item, "SlabShapeEditor") and hasattr(point, "ToXyz"):
		try:
			item.SlabShapeEditor.DrawPoint(point.ToXyz())
			return True
		except: return False
	else: return False

doc = DocumentManager.Instance.CurrentDBDocument
items = UnwrapElement(IN[1])

TransactionManager.Instance.EnsureInTransaction(doc)
if isinstance(IN[1], list):
	if isinstance(IN[0], list):
		OUT = []
		for item, points in zip(items, IN[0]):
			if isinstance(points, list): OUT.append((item, [AddPointToSlabShape(item, x) for x in points]))
			else: OUT.append((item, AddPointToSlabShape(item, points)))
	else: OUT = [(x, AddPointToSlabShape(x, IN[0])) for x in items]
	OUT = map(list, zip(*OUT))
else:
	if isinstance(IN[0], list): OUT = items, [AddPointToSlabShape(items, x) for x in IN[0]]
	else: OUT = items, AddPointToSlabShape(items, IN[0])
TransactionManager.Instance.TransactionTaskDone()
# ----------------------------------------
firstItem = List.FirstItem(list=python_script)
roof_2 = Output(firstItem)  # "roof"
lastItem = List.LastItem(list=python_script)
success = Output(lastItem)
