# Dynamo custom node Roof.SlabShapeHasBeenModified.dyf (Dynamo 2.12.1.8246)
# category: Clockwork.Revit.Elements.Query
# Checks if the shape of a roof slab has been modified with the shape editing tools

roof = Input(roof: var[]..[])
python_script = Python(IN[0]=roof)  # IronPython2
# ---------- python_script.python (16 lines) ----------
import clr
clr.AddReference('RevitAPI')
from Autodesk.Revit.DB import *

def SlabShapeHasBeenModified(item):
	if hasattr(item, "SlabShapeEditor"):
		if hasattr(item.SlabShapeEditor, "SlabShapeCreases") and hasattr(item.SlabShapeEditor, "SlabShapeVertices"):
			if item.SlabShapeEditor.SlabShapeCreases.IsEmpty == True or item.SlabShapeEditor.SlabShapeVertices.IsEmpty == True: return False
			else: return True
		else: return False
	else: return False

items = UnwrapElement(IN[0])

if isinstance(IN[0], list): OUT = [SlabShapeHasBeenModified(x) for x in items]
else: OUT = SlabShapeHasBeenModified(items)
# ----------------------------------------
bool = Output(python_script)
