# Dynamo custom node Room.AtPointInPhase.dyf (Dynamo 2.0.1.5055)
# category: Clockwork.Revit.Selection.Miscellaneous.Query
# Tries to retrieve a room element at the given location for the given phase.

point = Input(point: Autodesk.DesignScript.Geometry.Point)
turnIntoList = Custom[TurnIntoList](unknownItem=point)  # Turns an element (or a nested list) into a flat list
phase = Input(phase: var = null)  # If no phase is specified, the node will use the last phase in the project
isNull = Object.IsNull(obj=phase)
phases = Custom[Document.Phases]()  # Retrieves all phases in the active document in *chronological* order
lastItem = List.LastItem(list=phases)
scopeIf = Custom[ScopeIf+](test=isNull, true=lastItem, false=phase)  # A (hopefully) more robust implementation of ScopeIf. Tests a single boolean and returns a value accordingly.
python_script = Python(IN[0]=turnIntoList, IN[1]=scopeIf)
# ---------- python_script.python (20 lines) ----------
import clr
clr.AddReference('RevitAPI')
from Autodesk.Revit.DB import *

clr.AddReference("RevitNodes")
import Revit
clr.ImportExtensions(Revit.Elements)
clr.ImportExtensions(Revit.GeometryConversion)

clr.AddReference("RevitServices")
import RevitServices
from RevitServices.Persistence import DocumentManager

doc = DocumentManager.Instance.CurrentDBDocument
points = IN[0]
phase = UnwrapElement(IN[1])
roomlist = list()
for pt in points:
    roomlist.append(doc.GetRoomAtPoint(pt.ToXyz(),phase))
OUT = roomlist
# ----------------------------------------
returnListOrSingleValue = Custom[ReturnListOrSingleValue](unknownItem=point, seq=python_script)  # If the unknown item is not a list but rather a single item, only the first item of the list (input "seq") will be returned.
room = Output(returnListOrSingleValue)
