# Dynamo custom node Room.Finishes.dyf (Dynamo 2.6.2.15705)
# category: Clockwork.Revit.Elements.Query
# Returns all room bounding faces and their materials
# packages: Clockwork for Dynamo 2.x 2.4.0

room = Input(room: var[]..[])
turnIntoList = Custom[TurnIntoList](unknownItem=room)  # package Clockwork for Dynamo 2.x; Turns an element (or a nested list) into a flat list
python_script = Python(IN[0]=turnIntoList)
# ---------- python_script.python (62 lines) ----------
import clr
clr.AddReference('RevitAPI')
from Autodesk.Revit.DB import *
import Autodesk

clr.AddReference("RevitNodes")
import Revit
clr.ImportExtensions(Revit.GeometryConversion)

items = UnwrapElement(IN[0])
facetypes = []
facemats = []
faceelements = []
faceareas = []
faces = []

for item in items:
	doc = item.Document
	calculator = SpatialElementGeometryCalculator(doc)
	options = Autodesk.Revit.DB.SpatialElementBoundaryOptions()
	# get boundary location from area computation settings
	boundloc = Autodesk.Revit.DB.AreaVolumeSettings.GetAreaVolumeSettings(doc).GetSpatialElementBoundaryLocation(SpatialElementType.Room)
	options.SpatialElementBoundaryLocation = boundloc
	mlist = []
	tlist = []
	elist = []
	alist = []
	flist = []
	try:
		results = calculator.CalculateSpatialElementGeometry(item)
		for face in results.GetGeometry().Faces:
			for bface in results.GetBoundaryFaceInfo(face):
				tlist.append(str(bface.SubfaceType))
				eId = bface.SpatialBoundaryElement.HostElementId
				if eId == ElementId.InvalidElementId:
					liId = bface.SpatialBoundaryElement.LinkInstanceId
					if liId == ElementId.InvalidElementId: 
						elist.append(None)
						mlist.append(None)
					else:
						leId = bface.SpatialBoundaryElement.LinkedElementId
						if leId == ElementId.InvalidElementId: 
							elist.append(None)
							mlist.append(None)
						else: 
							elist.append(doc.GetElement(liId).GetLinkDocument().GetElement(leId))
							if bface.GetBoundingElementFace().MaterialElementId.IntegerValue == -1: mlist.append(None)
							else: mlist.append(doc.GetElement(liId).GetLinkDocument().GetElement(bface.GetBoundingElementFace().MaterialElementId))
				else: 
					elist.append(doc.GetElement(eId))
					if bface.GetBoundingElementFace().MaterialElementId.IntegerValue == -1: mlist.append(None)
					else: mlist.append(doc.GetElement(bface.GetBoundingElementFace().MaterialElementId))
				alist.append(bface.GetSubface().Area)
				flist.append(bface.GetBoundingElementFace())
	except:
		pass	
	facetypes.append(tlist)
	facemats.append(mlist)
	faceelements.append(elist)
	faceareas.append(alist)
	faces.append(flist)
OUT = (facetypes,facemats,faceareas,faces,faceelements)
# ----------------------------------------
code_block = CodeBlock(seq=python_script) { seq[0]; seq[1]; seq[2]; seq[3]; seq[4]; }
finishMaterials = Output(code_block.out1)
unit_types = UnitTypes("Area")  # graph input
displayUnitType = Custom[UnitType.DisplayUnitType](unitType=unit_types)  # package Clockwork for Dynamo 2.x; Retrieves the display unit type for a given unit type.
toDisplayUnit = Custom[InternalUnit.ToDisplayUnit](displayUnitType=displayUnitType.displayUnitType)  # package Clockwork for Dynamo 2.x; Converts a value from Revit's internal unit to a given display unit; unwired: val
map = List.Map(list=code_block.out2, f_x=toDisplayUnit)
areas = Output(map)
faceTypes = Output(code_block.out0)
revitFaces = Output(code_block.out3)
elements = Output(code_block.out4)
