# Dynamo custom node Room.InsertsOfBoundaries.dyf (Dynamo 2.0.3.8810)
# category: Clockwork.Revit.Elements.Query
# Retrieves the inserts of the bounding elements of a given room.

room = Input(room: var[]..[])
boundaries = Custom[Room.Boundaries](room=room)  # Gets a list of all boundaries of a given room or area and a corresponding list of the elements that are generating those boundaries.
includeOpenings = Input(includeOpenings: bool = false)
includeShadows = Input(includeShadows: bool = false)
includeEmbeddedWalls = Input(includeEmbeddedWalls: bool = false)
includeSharedEmbeddedInserts = Input(includeSharedEmbeddedInserts: bool = false)
inserts = Custom[Element.Inserts](includeOpenings=includeOpenings, includeShadows=includeShadows, includeEmbeddedWalls=includeEmbeddedWalls, includeSharedEmbeddedInserts=includeSharedEmbeddedInserts)  # Gets all the objects inserted into a given element.; unwired: element
map = List.Map(list=boundaries.elements, f_x=inserts)
flatten = List.Flatten()  # unwired: list
map_2 = List.Map(list=map, f_x=flatten)
inserts_2 = Output(map_2)  # "inserts"
