# Dynamo custom node Room.State.dyf (Dynamo 2.0.1.5055)
# category: Clockwork.Revit.Elements.Query
# Returns the state of a room, i.e. is it placed, unplaced, redundant or not enclosed.

room = Input(room: var[]..[])
location = Room.Location(room=room)
isNull = Object.IsNull(obj=location)
not_ = Not(x=isNull)
area = Room.Area(room=room)
code_block = CodeBlock(area=area) { area > 0; }
boundaries = Custom[Room.Boundaries](room=room)  # Gets a list of all boundaries of a given room or area and a corresponding list of the elements that are generating those boundaries.
isEmpty = List.IsEmpty(list=boundaries.curves@L2)
not_2 = Not(x=isEmpty)
create = List.Create(item0=not_, item1=code_block, item2=not_2)
transpose = List.Transpose(lists=create)
binaryFromBooleans = Custom[String.BinaryFromBooleans](booleans=transpose)  # Creates a binary string from a list of booleans
string = StringInput("""111
000
100
110
101""")  # graph input
string_2 = StringInput("""Placed
Unplaced
Not enclosed
Not enclosed
Redundant""")  # graph input
create_2 = List.Create(item0=string, item1=string_2)
string_3 = StringInput("\n")  # graph input
split = String.Split(str=create_2, separater0=string_3)
firstItem = List.FirstItem(list=split)
lastItem = List.LastItem(list=split)
matchWithKeyValues = Custom[List.MatchWithKeyValues](seq=binaryFromBooleans, keys=firstItem, values=lastItem)  # Matches a list with a given set of keys and returns the values corresponding to the keys
state = Output(matchWithKeyValues)
