# Dynamo custom node Room.Windows.dyf (Dynamo 2.0.1.5055)
# category: Clockwork.Revit.Elements.Query
# Retrieves all windows that are associated with a room (hosted in walls and roofs).

room = Input(room: var[]..[])
turn_into_list = Custom[Turn Into List](unknownItem=room)  # Turns an element (or a nested list) into a flat list
builtInCategories = Custom[Document.BuiltInCategories]()  # List all the available BuiltInCategories
string_from_object = FromObject(obj=builtInCategories.BuiltInCategories)
string = StringInput("OST_Windows")  # graph input
code_block = CodeBlock(str=string_from_object, cat=string) { str == cat; }
filterByBoolMask = List.FilterByBoolMask(list=builtInCategories.Categories, mask=code_block)
firstItem = List.FirstItem(list=filterByBoolMask.in)
all_elements_of_category = ElementsOfCategory(Category=firstItem)
phase = Input(phase: var = null)  # If no phase is specified, the node will use the last phase in the project
rooms = Custom[Window.Rooms](window=all_elements_of_category, phase=phase)  # Gets the rooms that are connected by a given window
isNull = Object.IsNull(obj=rooms.fromRoom)
# note: Windows From
filterByBoolMask_2 = List.FilterByBoolMask(list=all_elements_of_category, mask=isNull)
isNull_2 = Object.IsNull(obj=rooms.toRoom)
# note: Windows To
filterByBoolMask_3 = List.FilterByBoolMask(list=all_elements_of_category, mask=isNull_2)
create = List.Create(item0=filterByBoolMask_2.out, item1=filterByBoolMask_3.out)
flatten = List.Flatten(list=create)
isNull_3 = Object.IsNull(obj=rooms.fromRoom)
# note: Rooms From
filterByBoolMask_4 = List.FilterByBoolMask(list=rooms.fromRoom, mask=isNull_3)
isNull_4 = Object.IsNull(obj=rooms.toRoom)
# note: Rooms To
filterByBoolMask_5 = List.FilterByBoolMask(list=rooms.toRoom, mask=isNull_4)
create_2 = List.Create(item0=filterByBoolMask_4.out, item1=filterByBoolMask_5.out)
flatten_2 = List.Flatten(list=create_2)
groupByKey = List.GroupByKey(list=flatten, keys=flatten_2)
contains = List.Contains(list=turn_into_list, item=groupByKey.unique_keys@L1)
filterByBoolMask_6 = List.FilterByBoolMask(list=groupByKey.unique_keys, mask=contains)
filterByBoolMask_7 = List.FilterByBoolMask(list=groupByKey.groups, mask=contains)
joinByKey = Custom[List.JoinByKey](keys1=turn_into_list, seq1=turn_into_list, keys2=filterByBoolMask_6.in, seq2=filterByBoolMask_7.in)  # Joins two lists by common keys.
returnListOrSingleValue = Custom[ReturnListOrSingleValue](unknownItem=room, seq=joinByKey.seq2)  # If the item in input #1 is not a list, only the first item of the list in input #2 will be returned.
windows = Output(returnListOrSingleValue)
