# Dynamo custom node RoomSequence.ToDoorSequence.dyf (Dynamo 2.0.1.5055)
# category: Clockwork.Revit.Elements.Query
# Retrieves a sequence of doors connecting a given sequence of rooms (if possible)

rooms = Input(rooms: var[]..[])
turn_into_list = Custom[Turn Into List](unknownItem=rooms)  # Turns an element (or a nested list) into a flat list
python_script = Python()
# ---------- python_script.python (17 lines) ----------
import System
import clr
clr.AddReference('RevitAPI')
from Autodesk.Revit.DB import *

clr.AddReference("RevitServices")
import RevitServices
from RevitServices.Persistence import DocumentManager

doc = DocumentManager.Instance.CurrentDBDocument

elementlist = list()
collector = FilteredElementCollector(doc)
collector.OfClass(FamilyInstance)
collector.OfCategory(BuiltInCategory.OST_Doors)

OUT = collector.ToElements()
# ----------------------------------------
phase = Input(phase: var = null)  # If no phase is specified, the node will use the last phase in the project
rooms_2 = Custom[Door.Rooms](door=python_script, phase=phase)  # Gets the rooms that are connected by a given door or a window
code_block = CodeBlock(a=turn_into_list, b=python_script, c=rooms_2.fromRoom, d=rooms_2.toRoom) { ids = ([a,b,c,d]).UniqueId; ids[0]; ids[1]; ids[2]; ids[3]; }
python_script_2 = Python(IN[0]=code_block.out1, IN[1]=code_block.out2, IN[2]=code_block.out3, IN[3]=code_block.out4)
# ---------- python_script_2.python (17 lines) ----------
import clr

rooms = IN[0]
doors = IN[1]
fromroom = IN[2]
toroom = IN[3]
elementlist = list()

i = 0
while i < (len(rooms)-1):
	j = 0
	while j < len(doors):
		if (rooms[i] == fromroom[j] and rooms[i+1] == toroom[j]) or (rooms[i+1] == fromroom[j] and rooms[i] == toroom[j]):
			elementlist.append(doors[j])
		j += 1
	i += 1
OUT = elementlist
# ----------------------------------------
byID = Custom[Element.ByID](ID_UniqueId_var=python_script_2)  # Gets the Revit element(s) for a list of IDs (or a single ID)
doors = Output(byID.element)
