# Dynamo custom node RoomTag.Room.dyf (Dynamo 2.0.1.5055)
# category: Clockwork.Revit.Elements.Query
# Returns the room of a given room tag

roomTag = Input(roomTag: var[]..[])
turnIntoList = Custom[TurnIntoList](unknownItem=roomTag)  # Turns an element (or a nested list) into a flat list
version = Custom[Application.Version]()  # Retrieves the name, version and build of the current Revit application.
python_script = Python(IN[0]=turnIntoList, IN[1]=version.Version_int)
# ---------- python_script.python (38 lines) ----------
import clr
clr.AddReference('RevitAPI')
from Autodesk.Revit.DB import *
import Autodesk

clr.AddReference("RevitNodes")
import Revit
clr.ImportExtensions(Revit.GeometryConversion)

clr.AddReference("RevitServices")
import RevitServices
from RevitServices.Persistence import DocumentManager

doc = DocumentManager.Instance.CurrentDBDocument

roomtags = UnwrapElement(IN[0])
version = IN[1]
elementlist = list()

for tag in roomtags:
	if version > 2016:
		try:
			trID = tag.TaggedRoomId
			if trID.HostElementId.IntegerValue != -1:
				elementlist.append(doc.GetElement(trID.HostElementId))
			elif trID.LinkedElementId.IntegerValue != -1:
				linkdoc = doc.GetElement(trID.LinkInstanceId).GetLinkDocument()
				elementlist.append(linkdoc.GetElement(trID.LinkedElementId))
			else:
				elementlist.append(None)
		except:
			elementlist.append(None)
	else:
		try:
			elementlist.append(tag.Room)
		except:
			elementlist.append(None)
OUT = elementlist
# ----------------------------------------
returnListOrSingleValue = Custom[ReturnListOrSingleValue](unknownItem=roomTag, seq=python_script)  # If the unknown item is not a list but rather a single item, only the first item of the list (input "seq") will be returned.
room = Output(returnListOrSingleValue)
