# Dynamo custom node RoomTag.SetType.dyf (Dynamo 2.0.0.4654)
# category: Clockwork.Revit.Elements.Actions
# Changes the family type of a given room tag to the specified type

roomTag = Input(roomTag: var[]..[])
turn_into_list = Custom[Turn Into List](unknownItem=roomTag)  # Turns an element (or a nested list) into a flat list
roomTagType = Input(roomTagType: var[]..[])
turn_into_list_2 = Custom[Turn Into List](unknownItem=roomTagType)
code_block = CodeBlock(instances=turn_into_list, types=turn_into_list_2) { inst = List.Count(instances); replist = List.OfRepeatedItem(types[0],inst); inst > List.Count(types) ? replist : types; }
python_script = Python(IN[0]=turn_into_list, IN[1]=code_block.out2)
# ---------- python_script.python (30 lines) ----------
import clr
clr.AddReference('RevitAPI')
from Autodesk.Revit.DB import *

clr.AddReference("RevitNodes")
import Revit
clr.ImportExtensions(Revit.Elements)

clr.AddReference("RevitServices")
import RevitServices
from RevitServices.Persistence import DocumentManager
from RevitServices.Transactions import TransactionManager

doc = DocumentManager.Instance.CurrentDBDocument
faminsts = UnwrapElement(IN[0])
famsymb = UnwrapElement(IN[1])
booleans = list()
counter = 0

TransactionManager.Instance.EnsureInTransaction(doc)
for item in faminsts:
	try:
		item.RoomTagType = famsymb[counter]
		booleans.append(True)
	except:
		booleans.append(False)
	counter += 1
TransactionManager.Instance.TransactionTaskDone()

OUT = (faminsts, booleans)
# ----------------------------------------
code_block_2 = CodeBlock(seq=python_script) { seq[0]; seq[1]; }
returnListOrSingleValue = Custom[ReturnListOrSingleValue](unknownItem=roomTag, seq=code_block_2.out0)  # If the item in input #1 is not a list, only the first item of the list in input #2 will be returned.
roomTag_2 = Output(returnListOrSingleValue)  # "roomTag"
returnListOrSingleValue_2 = Custom[ReturnListOrSingleValue](unknownItem=roomTag, seq=code_block_2.out1)
success = Output(returnListOrSingleValue_2)
