# Dynamo custom node Rounding.Ceiling+.dyf (Dynamo 2.0.0.4654)
# category: Clockwork.Math.Functions.Actions
# Rounds a number *up* to a specified precision

dbl = Input(dbl: double)
precision = Input(precision: double = 1)
code_block = CodeBlock(a=dbl, b=precision) { Math.Ceiling(a/b)*b; }
dbl_2 = Output(code_block)  # "dbl"
