# Dynamo custom node ScheduleView.KeyScheduleParameterName.dyf (Dynamo 2.0.0.4654)
# category: Clockwork.Revit.Views.Query
# If the schedule is a key schedule, the node returns the name of the key schedule parameter.

schedule = Input(schedule: var[]..[])
python_script = Python(IN[0]=schedule)
# ---------- python_script.python (12 lines) ----------
import clr
clr.AddReference('RevitAPI')
from Autodesk.Revit.DB import *

def GetKeyScheduleParamName(schedule):
	if hasattr(schedule, "KeyScheduleParameterName"): return schedule.KeyScheduleParameterName
	else: return None

scheds = UnwrapElement(IN[0])

if isinstance(IN[0], list): OUT = [GetKeyScheduleParamName(x) for x in scheds]
else: OUT = GetKeyScheduleParamName(scheds)
# ----------------------------------------
parameterName = Output(python_script)
