# Dynamo custom node SelectionSet.ByElements.dyf (Dynamo 2.0.1.5055)
# category: Clockwork.Revit.Selection.SelectionSet.Create
# Creates a selection set of the given elements. Note that if a selection set of the given name already exists in the model, its contents will be replaced. Also, if the selection set is already applied as a view filter, the view filter will have to be manually updated in the visibility / graphic overrides. DO ***NOT*** USE IN AUTOMATIC MODE!

elements = Input(elements: var[]..[])
turn_into_list = Custom[Turn Into List](unknownItem=elements)  # Turns an element (or a nested list) into a flat list
Name = Input(Name: string)
python_script = Python(IN[0]=turn_into_list, IN[1]=Name)
# ---------- python_script.python (45 lines) ----------
import clr
clr.AddReference('RevitAPI')
from Autodesk.Revit.DB import *
from System.Collections.Generic import *

clr.AddReference("RevitNodes")
import Revit
clr.ImportExtensions(Revit.Elements)

clr.AddReference("RevitServices")
import RevitServices
from RevitServices.Persistence import DocumentManager
from RevitServices.Transactions import TransactionManager

doc = DocumentManager.Instance.CurrentDBDocument
name = IN[1]

# create itemset
items = UnwrapElement(IN[0])
ids = list()
for item in items:
	ids.append(item.Id)
itemset = List[ElementId](ids)

# collect all existing filters from the model 
names = list()
collector = FilteredElementCollector(doc)
filters = collector.OfClass(FilterElement).ToElements();

selset = False
TransactionManager.Instance.EnsureInTransaction(doc)
# if a filter of that name already exists, delete its content
for filter in filters:
	if str(filter.Name) == name:
		filter.Clear()
		selset = filter
# create a new selection set if it doesn't already exist
if selset == False:
	selset = SelectionFilterElement.Create(doc,name)
# add the items to the selection set
try: 
	selset.AddSet(itemset)
	OUT = selset.ToDSType(False)
except: OUT = None
TransactionManager.Instance.TransactionTaskDone()
# ----------------------------------------
selectionSet = Output(python_script)
