# Dynamo custom node SelectionSet.Elements.dyf (Dynamo 2.0.0.4654)
# category: Clockwork.Revit.Selection.SelectionSet.Query
# Retrieves all elements stored in a selection set

selectionSet = Input(selectionSet: var[]..[])
turn_into_list = Custom[Turn Into List](unknownItem=selectionSet)  # Turns an element (or a nested list) into a flat list
python_script = Python(IN[0]=turn_into_list)
# ---------- python_script.python (12 lines) ----------
import clr
clr.AddReference('RevitAPI')
from Autodesk.Revit.DB import *

items = UnwrapElement(IN[0])
elementlist = list()
for item in items:
	selsetmembers = list()
	for member in item.GetElementIds():
		selsetmembers.append(item.Document.GetElement(member))
	elementlist.append(selsetmembers)
OUT = elementlist
# ----------------------------------------
returnListOrSingleValue = Custom[ReturnListOrSingleValue](unknownItem=selectionSet, seq=python_script)  # If the item in input #1 is not a list, only the first item of the list in input #2 will be returned.
elements = Output(returnListOrSingleValue)
