# Dynamo custom node Sheet.Scale.dyf (Dynamo 2.0.0.4654)
# category: Clockwork.Revit.Views.Query
# Returns the scale of a given sheet

sheet = Input(sheet: Revit.Elements.Views.Sheet)
turn_into_list = Custom[Turn Into List](unknownItem=sheet)  # Turns an element (or a nested list) into a flat list
python_script = Python(IN[0]=turn_into_list)
# ---------- python_script.python (12 lines) ----------
import clr
clr.AddReference('RevitAPI')
from Autodesk.Revit.DB import *

sheets = UnwrapElement(IN[0])
elementlist = list()
for item in sheets:
	try:
		elementlist.append(item.get_Parameter(BuiltInParameter.SHEET_SCALE).AsString())
	except:
		elementlist.append(False)
OUT = elementlist
# ----------------------------------------
returnListOrSingleValue = Custom[ReturnListOrSingleValue](unknownItem=sheet, seq=python_script)  # If the item in input #1 is not a list, only the first item of the list in input #2 will be returned.
scale = Output(returnListOrSingleValue)
