# Dynamo custom node Sheet.Schedules.dyf (Dynamo 2.0.0.4654)
# category: Clockwork.Revit.Views.Query
# Returns all schedules placed on a specified sheet

sheet = Input(sheet: Revit.Elements.Views.Sheet)
turn_into_list = Custom[Turn Into List](unknownItem=sheet)  # Turns an element (or a nested list) into a flat list
python_script = Python(IN[0]=turn_into_list)
# ---------- python_script.python (17 lines) ----------
import clr
clr.AddReference('RevitAPI')
from Autodesk.Revit.DB import *

sheets = UnwrapElement(IN[0])
elementlist = list()

for sheet in sheets:
	try:
		viewlist = list()
		collector = FilteredElementCollector(sheet.Document, sheet.Id).OfClass(ScheduleSheetInstance)
		for item in collector:
			viewlist.append(sheet.Document.GetElement(item.ScheduleId))
		elementlist.append(viewlist)
	except:
		elementlist.append(list())
OUT = elementlist
# ----------------------------------------
returnListOrSingleValue = Custom[ReturnListOrSingleValue](unknownItem=sheet, seq=python_script)  # If the item in input #1 is not a list, only the first item of the list in input #2 will be returned.
schedules = Output(returnListOrSingleValue)
