# Dynamo custom node SpaceSeparator.FromCurve.dyf (Dynamo 2.12.1.8246)
# category: Clockwork.Revit.Elements.ModelCurve.Create
# Creates space separation lines from geometry curves.
# packages: Clockwork for Dynamo 2.x 2.6.0

curve = Input(curve: Autodesk.DesignScript.Geometry.Curve[]..[])
floorPlan = Input(floorPlan: Revit.Elements.Views.FloorPlanView)
plane = Custom[View.Plane](view=floorPlan)  # package Clockwork for Dynamo 2.x; Retrieves the plane of a given view
pullOntoPlane = Curve.PullOntoPlane(curve=curve, plane=plane)
byPlane = SketchPlane.ByPlane(plane=plane)
python_script = Python(IN[0]=pullOntoPlane, IN[1]=byPlane, IN[2]=floorPlan)  # IronPython2
# ---------- python_script.python (31 lines) ----------
import clr
clr.AddReference('RevitAPI')
from Autodesk.Revit.DB import *

clr.AddReference("RevitNodes")
import Revit
clr.ImportExtensions(Revit.GeometryConversion)

clr.AddReference("RevitServices")
import RevitServices
from RevitServices.Persistence import DocumentManager
from RevitServices.Transactions import TransactionManager

doc = DocumentManager.Instance.CurrentDBDocument
curves = UnwrapElement(IN[0])
sketchplane = UnwrapElement(IN[1])
view = UnwrapElement(IN[2])

TransactionManager.Instance.EnsureInTransaction(doc)
curvearray = CurveArray()
for curve in curves:
	curvearray.Append(curve.ToRevitType())
doccreation = doc.Create
separatorarray = doccreation.NewSpaceBoundaryLines(sketchplane, curvearray, view)
TransactionManager.Instance.TransactionTaskDone()

elementlist = list()
for item in separatorarray:
	elementlist.append(item)
if isinstance(IN[0], list): OUT = elementlist
else: OUT = elementlist[0]
# ----------------------------------------
spaceSeparator = Output(python_script)
