# Dynamo custom node String.BinaryFromBooleans.dyf (Dynamo 1.0.0.1180)
# category: Clockwork.Core.String.Generate.Create
# Creates a binary string from a list of booleans

string = StringInput("")
booleans = Input()
code_block = CodeBlock(test=booleans) { test ? "1" : "0"; }
join = String.Join(string, code_block)
firstItem = List.FirstItem(join)
binary = Output(firstItem)
