# Dynamo custom node String.BinaryToBooleans.dyf (Dynamo 1.3.1.1736)
# category: Clockwork.Core.String.Generate.Actions
# Converts a binary string to a list of booleans

str = Input(str : string)
fromString = Custom[List.FromString](str=str)  # Chops up a string into a list of characters
code_block = CodeBlock(val=fromString) { val == "1" ? true : (val == "0" ? false : null); }
bool = Output(code_block)
