# Dynamo custom node String.BinaryToDecimal.dyf (Dynamo 1.3.1.1736)
# category: Clockwork.Core.String.Generate.Actions
# Converts a string of a binary number into a decimal value

binary = Input(binary : string)
python_script = Python(IN[0]=binary)
# ---------- python_script.python (2 lines) ----------
if isinstance(IN[0], list): OUT = [int(x,2) for x in IN[0]]
else: OUT = int(IN[0],2)
# ----------------------------------------
decimal = Output(python_script)
