# Dynamo custom node String.Explode.dyf (Dynamo 2.0.0.4654)
# category: Clockwork.Core.String.Modify.Actions
# Chops up a string into a list of characters

str = Input(str: string)
length = String.Length(str=str)
code_block = CodeBlock(n=length) { 0..(n-1); 1; }
substring = String.Substring(str=str, startIndex=code_block.out0, length=code_block.out1)
seq = Output(substring)
