# Dynamo custom node String.HexToDecimal.dyf (Dynamo 1.3.1.1736)
# category: Clockwork.Core.String.Generate.Actions
# Converts a string of a hexadecimal value to a number

hex = Input(hex : string)
python_script = Python(IN[0]=hex)
# ---------- python_script.python (2 lines) ----------
if isinstance(IN[0], list): OUT = [int(x,16) for x in IN[0]]
else: OUT = int(IN[0],16)
# ----------------------------------------
decimal = Output(python_script)
