# Dynamo custom node String.MorseToAlphanumeric.dyf (Dynamo 1.3.0.875)
# category: Clockwork.Core.String.Generate.Actions
# Converts a string in Morse code to alphanumeric

code_block = CodeBlock { ""; " "; }
str = Input(str : string)
code_block_2 = CodeBlock()
# ---------- code_block_2.designscript (5 lines) ----------
"   ";
" ";
"A".."Z";
0..9;
{".-","-...","-.-.","-..",".","..-.","--.","....","..",".---","-.-",".-..","--","-.","---",".--.","--.-",".-.","...","-","..-","...-",".--","-..-","-.--","--..","-----",".----","..---","...--","....-",".....","-....","--...","---..","----."};
# ----------------------------------------
split = String.Split(str, code_block_2.out0)
split_2 = String.Split(split, code_block_2.out1)
join = List.Join(code_block_2.out2, code_block_2.out3)
matchWithKeyValues = Custom[List.MatchWithKeyValues](seq=split_2, keys=code_block_2.out4, values=join)  # Matches a list with a given set of keys and returns the values corresponding to the keys
count = List.Count(split_2@L2)
chop = List.Chop(list=matchWithKeyValues, lengths=count)
join_2 = String.Join(code_block.out0, chop)
firstItem = List.FirstItem(join_2)
join_3 = String.Join(code_block.out1, firstItem)
firstItem_2 = List.FirstItem(join_3)
str_2 = Output(firstItem_2)  # "str"
