# Dynamo custom node String.ReplaceIllegalRevitCharacters.dyf (Dynamo 1.0.0.1180)
# category: Clockwork.Core.String.Modify.Actions
# Replaces all characters in a string that are illegal characters for Revit view names etc.

str = Input(str : string)
turnIntoList = Custom[TurnIntoList](unknownItem=str)  # Turns an element (or a nested list) into a flat list
replacement = Input(replacement : string = "_")
python_script = Python(IN[0]=turnIntoList, IN[1]=replacement)
# ---------- python_script.python (19 lines) ----------
strings = IN[0]
replace = IN[1]
strlist = []
for str in strings:
	str = str.replace('\\', replace)
	str = str.replace(':', replace)
	str = str.replace('{', replace)
	str = str.replace('}', replace)
	str = str.replace('[', replace)
	str = str.replace(']', replace)
	str = str.replace('|', replace)
	str = str.replace(';', replace)
	str = str.replace('<', replace)
	str = str.replace('>', replace)
	str = str.replace('?', replace)
	str = str.replace('`', replace)
	str = str.replace('~', replace)
	strlist.append(str)
OUT = strlist
# ----------------------------------------
returnListOrSingleValue = Custom[ReturnListOrSingleValue](unknownItem=str, seq=python_script)  # If the unknown item is not a list but rather a single item, only the first item of the list (input "seq") will be returned.
str_2 = Output(returnListOrSingleValue)  # "str"
