# Dynamo custom node String.ReplaceRegularExpression.dyf (Dynamo 1.3.1.1736)
# category: Clockwork.Core.String.Modify.Actions
# Replaces all occurences of a regular expression within a given string (or list of strings) with another string. The syntax for regular expressions is explained at
# http://ironpython-test.readthedocs.org/en/latest/howto/regex.html

RegEx = Input(RegEx : string)
ignoreCase = Input(ignoreCase : bool = false)  # Perform case-insensitive matching
useLocale = Input(useLocale : bool = false)  # Treat special characters (e.g. 'ü') from the currently set system locale as letters
dotAll = Input(dotAll : bool = false)  # Make . match any character, including newlines
multilineMatching = Input(multilineMatching : bool = false)  # ^ matches at the beginning of each line, $ matches at the end of each line
compileRegularExpression = Custom[String.CompileRegularExpression](regExp=RegEx, ignoreCase=ignoreCase, useLocale=useLocale, dotAll=dotAll, multilineMatching=multilineMatching)  # This is a helper node for setting certain flags for the Regular Expresssion nodes. http://ironpython-test.readthedocs.org/en/latest/howto/regex.html
str = Input(str : string)
Replacement = Input(Replacement : string)
python_script = Python(IN[0]=compileRegularExpression, IN[1]=str, IN[2]=Replacement)
# ---------- python_script.python (5 lines) ----------
import clr
import re

if isinstance(IN[1], list): OUT = [IN[0].sub(IN[2],x) for x in IN[1]]
else: OUT = IN[0].sub(IN[2],IN[1])
# ----------------------------------------
str_2 = Output(python_script)  # "str"
