# Dynamo custom node Surface.FilterByOrientation.dyf (Dynamo 2.0.1.5055)
# category: Clockwork.Geometry.Surfaces.Actions
# Sorts surfaces in three lists based on their orientation (vertical, horizontal up & horizontal down) and also returns three corresponding lists of booleans.

surfaces = Input(surfaces: Autodesk.DesignScript.Geometry.Surface[])
code_block = CodeBlock { 0.5; }
normalAtParameter = Surface.NormalAtParameter(surface=surfaces, u=code_block, v=code_block)
Z = Vector.Z(vector=normalAtParameter)
almostZero = Custom[Math.AlmostZero]()  # Returns a feasable computational tolerance to zero (1.0e-9 or a billionth of 1) for use in calculations. More background info: https://github.com/ikeough/Dynamo/issues/879
code_block_2 = CodeBlock(z=Z, almostzero=almostZero)
# ---------- code_block_2.designscript (2 lines) ----------
// Is vertical?
z >= (0 - almostzero) && z <= (0 + almostzero);
# ----------------------------------------
filterByBoolMask = List.FilterByBoolMask(list=surfaces, mask=code_block_2)
vertical = Output(filterByBoolMask.in)
isVertical = Output(code_block_2)
ZAxis = Vector.ZAxis()
isAlmostEqualTo = Vector.IsAlmostEqualTo(vector=normalAtParameter, other=ZAxis)
filterByBoolMask_2 = List.FilterByBoolMask(list=surfaces, mask=isAlmostEqualTo)
horizontalUp = Output(filterByBoolMask_2.in)
isHorizontalUp = Output(isAlmostEqualTo)
ZAxisNegative = Custom[Vector.ZAxisNegative]()  # Returns an XYZ of 0,0,-1
isAlmostEqualTo_2 = Vector.IsAlmostEqualTo(vector=normalAtParameter, other=ZAxisNegative)
filterByBoolMask_3 = List.FilterByBoolMask(list=surfaces, mask=isAlmostEqualTo_2)
horizontalDown = Output(filterByBoolMask_3.in)
isHorizontalDown = Output(isAlmostEqualTo_2)
