# Dynamo custom node Surface.IsPlanar.dyf (Dynamo 2.0.1.5055)
# category: Clockwork.Geometry.Surfaces.Query
# Checks whether a face is planar

surface = Input(surface: Autodesk.DesignScript.Geometry.Surface)
turnIntoList = Custom[TurnIntoList](unknownItem=surface)  # Turns an element (or a nested list) into a flat list
code_block = CodeBlock { 3; }
gridFromFace = Custom[Paneling.GridFromFace](surface=turnIntoList@L1, U=code_block, V=code_block)  # Returns UV coordinates, XYZ coordinates and normals for a face with UV subdivision
byBestFitThroughPoints = Plane.ByBestFitThroughPoints(points=gridFromFace.Points)
intersect = Geometry.Intersect(geometry=gridFromFace.Points, other=byBestFitThroughPoints)
isEmpty = List.IsEmpty(list=intersect@@L2)
allFalse = List.AllFalse(list=isEmpty@L2)
returnListOrSingleValue = Custom[ReturnListOrSingleValue](unknownItem=surface, seq=allFalse)  # If the unknown item is not a list but rather a single item, only the first item of the list (input "seq") will be returned.
bool = Output(returnListOrSingleValue)
