# Dynamo custom node Switch.dyf (Dynamo 2.0.0.4654)
# category: Clockwork.Script.ControlFlow.Actions
# Emulates the Switch/Case statement that is  available in multiple programming languages.

Check = Input(Check: var[]..[])
turnIntoList = Custom[TurnIntoList](unknownItem=Check)  # Turns an element (or a nested list) into a flat list
Cases = Input(Cases: var[]..[])
Values = Input(Values: var[]..[])
matchWithKeyValues = Custom[List.MatchWithKeyValues](seq=turnIntoList, keys=Cases, values=Values)  # Matches a list with a given set of keys and returns the values corresponding to the keys
getKeys = GetKeys(list=matchWithKeyValues)
isEmpty = List.IsEmpty(list=matchWithKeyValues@L2)
filterByBoolMask = List.FilterByBoolMask(list=getKeys, mask=isEmpty)
Default = Input(Default: var[]..[])
replaceItemAtIndex = Custom[List.ReplaceItemAtIndex](seq=matchWithKeyValues, indices=filterByBoolMask.in, replacement=Default)  # Replaces the item at a given index (or list of indices) of a list by another item
Result = Output(replaceItemAtIndex)
