# Dynamo custom node System.Version.dyf (Dynamo 2.0.1.5055)
# category: Clockwork.Environment.Query
# Returns the Windows version

python_script = Python()  # graph input
# ---------- python_script.python (9 lines) ----------
import clr
from System import Environment, Version
OSnames = ["Windows XP","Windows Vista","Windows 7","Windows 8","Windows 8.1","Windows 10"]
OSversions = [Version(5,1,2505),Version(6,0,5112),Version(6,1,7600),Version(6,2,9200),Version(6,3,9200),Version(10,0,10240)]
# source: https://www.gaijin.at/en/lstwinver.php
for OSname, OSversion in zip(OSnames, OSversions):
	if Environment.OSVersion.Version.CompareTo(OSversion) >= 0:
		thisOS = OSname
OUT = (thisOS,Environment.OSVersion.Version.ToString(),Environment.OSVersion.ServicePack)
# ----------------------------------------
code_block = CodeBlock(seq=python_script)
# ---------- code_block.designscript (6 lines) ----------
// Version Name
seq[0];
// Version Number
seq[1];
// Service Pack
seq[2];
# ----------------------------------------
versionName = Output(code_block.out0)
versionNumber = Output(code_block.out1)
servicePack = Output(code_block.out2)
