# Dynamo custom node ThirdXYZAxis.ByTwoVectors.dyf (Dynamo 1.3.1.1736)
# category: Clockwork.Geometry.Abstract.Vector.Create
# Given two main XYZ axes (or vectors pointing more or less in their general direction), this node will find the third axis.

origin = Point.Origin()
Axis1 = Input(Axis1 : Vector)
fromVector = Custom[XYZAxis.FromVector](vector=Axis1)  # Returns whichever main axis (X, Y or Z) is closest to a given vector
asPoint = Vector.AsPoint(fromVector)
Axis2 = Input(Axis2 : Vector)
fromVector_2 = Custom[XYZAxis.FromVector](vector=Axis2)
asPoint_2 = Vector.AsPoint(fromVector_2)
create = List.Create(origin, asPoint, asPoint_2)
# note: Make a plane based on the given axes and the origin
byBestFitThroughPoints = Plane.ByBestFitThroughPoints(create)
# note: The normal of that plane is the vector of the third axis
normal = Plane.Normal(byBestFitThroughPoints)
code_block = CodeBlock { 1; }
byCoordinates = Vector.ByCoordinates(x=code_block, y=code_block, z=code_block)
normalized = Vector.Normalized(byCoordinates)
correctOrientation = Custom[Vector.CorrectOrientation](VectorA=normal, VectorB=normalized)  # Inverts vector A if its inversion is closer to vector B
vector = Output(correctOrientation)
code_block_2 = CodeBlock(vec=normal)
# ---------- code_block_2.designscript (4 lines) ----------
// Set up a nested condition and find the main direction of the vector
cond1 = Math.Abs(vec.Y) > Math.Abs(vec.X) && Math.Abs(vec.Y) > Math.Abs(vec.Z);
cond2 = Math.Abs(vec.X) > Math.Abs(vec.Y) && Math.Abs(vec.X) > Math.Abs(vec.Z);
cond2 ? "X" : (cond1 ? "Y" : "Z");
# ----------------------------------------
str = Output(code_block_2.out2)
