# Dynamo custom node Topography.IsSubregion.dyf (Dynamo 2.0.1.5055)
# category: Clockwork.Revit.Elements.Query
# Filters out everything that is *not* a topo subregion. Needs Revit 2014 or newer to work.

topography = Input(topography: Revit.Elements.Topography)
turn_into_list = Custom[Turn Into List](unknownItem=topography)  # Turns an element (or a nested list) into a flat list
python_script = Python(IN[0]=turn_into_list)
# ---------- python_script.python (15 lines) ----------
import clr
clr.AddReference('RevitAPI')
from Autodesk.Revit.DB import *

topos = UnwrapElement(IN[0])
booleans = list()
for item in topos:
	try:
		if item.IsSiteSubRegion:
			booleans.append(True)
		else:
			booleans.append(False)
	except:
		booleans.append(False)
OUT = booleans
# ----------------------------------------
returnListOrSingleValue = Custom[ReturnListOrSingleValue](unknownItem=topography, seq=python_script)  # If the item in input #1 is not a list, only the first item of the list in input #2 will be returned.
bool = Output(returnListOrSingleValue)
