# Dynamo custom node Triangle.CathetusByPythagoras.dyf (Dynamo 0.8.1.1823)
# category: Clockwork.Math.Formulas.Query
# Computes the length of one of the catheti / legs of a right triangle using the Pythagorean Theorem. B is the other leg / cathetus of the triangle while C is the hypotenuse.

sideC = Input(sideC : double)
sideB = Input(sideB : double)
code_block = CodeBlock(c=sideC, b=sideB) { Math.Sqrt(Math.Pow(c,2)-Math.Pow(b,2)); }
sideA = Output(code_block)
