# Dynamo custom node Triangle.HypotenuseByPythagoras.dyf (Dynamo 2.0.1.5055)
# category: Clockwork.Math.Formulas.Query
# Computes the length of the hypotenuse of a right triangle using the Pythagorean Theorem. A and B are the legs / catheti of the triangle.

sideA = Input(sideA: double)
sideB = Input(sideB: double)
code_block = CodeBlock(a=sideA, b=sideB) { Math.Sqrt(Math.Pow(a,2)+Math.Pow(b,2)); }
sideC = Output(code_block)
