# Dynamo custom node Triangle.OppositeSideByLawOfCosines.dyf (Dynamo 0.8.1.1823)
# category: Clockwork.Math.Formulas.Query
# Computes the length of the missing side of a triangle using the law of cosines. Gamma is the angle between sides A and B.

sideA = Input(sideA : double)
sideB = Input(sideB : double)
gamma = Input(gamma : double)
code_block = CodeBlock(a=sideA, b=sideB, gamma=gamma) { Math.Sqrt(Math.Pow(a,2)+Math.Pow(b,2)-2*a*b*Math.Cos(gamma)); }
sideC = Output(code_block)
