# Dynamo custom node Triangle.SideByLawOfSines.dyf (Dynamo 0.8.1.1823)
# category: Clockwork.Math.Formulas.Query
# Determines the length of a side based on the law of sines. (Alpha is the angle opposite side A and beta is the angle opposite side B...)

sideB = Input(sideB : double)
beta = Input(beta : double)
alpha = Input(alpha : double)
code_block = CodeBlock(b=sideB, beta=beta, alpha=alpha) { b/Math.Sin(beta)*Math.Sin(alpha); }
sideA = Output(code_block)
