# Dynamo custom node Triangle.SolveByPoints.dyf (Dynamo 2.0.0.4654)
# category: Clockwork.Math.Formulas.Query
# Solves a triangle based on the XYZ coordinates of its vertices.

PointB = Input(PointB: Autodesk.DesignScript.Geometry.Point)
PointC = Input(PointC: Autodesk.DesignScript.Geometry.Point)
PointA = Input(PointA: Autodesk.DesignScript.Geometry.Point)
code_block = CodeBlock(pb=PointB, pc=PointC, pa=PointA)
# ---------- code_block.designscript (8 lines) ----------
// Side lengths
a = pb.DistanceTo(pc);
b = pa.DistanceTo(pc);
c = pa.DistanceTo(pb);
// Plane, normal & origin
p = Plane.ByBestFitThroughPoints([pa,pb,pc]);
p.Normal;
p.Origin;
# ----------------------------------------
SideA = Output(code_block.a)
SideB = Output(code_block.b)
SideC = Output(code_block.c)
byLawOfCosines = Custom[Angle.ByLawOfCosines](sideA=code_block.a, sideB=code_block.b, sideC=code_block.c)  # Computes an angle of a triangle using the law of cosines. A is the opposite side of the triangle while B and C are the sides forming the angle.
Alpha = Output(byLawOfCosines)
byLawOfCosines_2 = Custom[Angle.ByLawOfCosines](sideA=code_block.b, sideB=code_block.c, sideC=code_block.a)
Beta = Output(byLawOfCosines_2)
byLawOfCosines_3 = Custom[Angle.ByLawOfCosines](sideA=code_block.c, sideB=code_block.a, sideC=code_block.b)
Gamma = Output(byLawOfCosines_3)
code_block_2 = CodeBlock(b=code_block.b, gamma=byLawOfCosines_3, c=code_block.c, alpha=byLawOfCosines, a=code_block.a, beta=byLawOfCosines_2)
# ---------- code_block_2.designscript (8 lines) ----------
// Heights
b*Math.Sin(gamma);
c*Math.Sin(alpha);
Hc = a*Math.Sin(beta);
// Area
tri_area = c*Hc/2;
// Incircle radius
2*tri_area/(a+b+c);
# ----------------------------------------
HeightA = Output(code_block_2.out0)
HeightB = Output(code_block_2.out1)
HeightC = Output(code_block_2.Hc)
Area = Output(code_block_2.tri_area)
Plane = Output(code_block.p)
Normal = Output(code_block.out4)
Centroid = Output(code_block.out5)
byPoints = Custom[AngleBisector.ByPoints](PointA=PointA, PointB=PointB, PointC=PointC)  # Retrieves the vector of an angle bisector at point B based on three points (A, B, C) that define the angle.
byPoints_2 = Custom[AngleBisector.ByPoints](PointA=PointB, PointB=PointC, PointC=PointA)
intersectionWithVector = Custom[Vector.IntersectionWithVector](basePoint1=PointB, vector1=byPoints, basePoint2=PointC, vector2=byPoints_2)  # Determines if two vectors intersect and returns the closest points of intersection on both vectors.
IncircleCenter = Output(intersectionWithVector.AveragePoint)
IncircleRadius = Output(code_block_2.out4)
