# Dynamo custom node TurnIntoList.dyf (Dynamo 1.3.0.875)
# category: Clockwork.List.Generate.Create
# Turns an element (or a nested list) into a flat list

unknownItem = Input()
create = List.Create(unknownItem)
flatten = Flatten(create)
seq = Output(flatten)
