# Dynamo custom node UV.RoundToPrecision.dyf (Dynamo 2.0.0.4654)
# category: Clockwork.Geometry.Points.Actions
# Rounds a UV coordinate to a specified precision

uv = Input(uv: Autodesk.DesignScript.Geometry.UV)
Precision = Input(Precision: double)
code_block = CodeBlock(uc=uv, pr=Precision) { a = [uc.U,uc.V]; ar = Math.Round(a/pr)*pr; UV.ByCoordinates(ar[0],ar[1]); }
uv_2 = Output(code_block.out2)  # "uv"
