# Dynamo custom node UV.Swap.dyf (Dynamo 2.0.1.5055)
# category: Clockwork.Geometry.Points.Actions
# Swaps U and V coordinates

uv = Input(uv: Autodesk.DesignScript.Geometry.UV)
V = UV.V(uV=uv)
U = UV.U(uV=uv)
byCoordinates = UV.ByCoordinates(u=V, v=U)
uv_2 = Output(byCoordinates)  # "uv"
