# Dynamo custom node UV.ToDynamoUV.dyf (Dynamo 2.0.0.4654)
# category: Clockwork.Revit.Conversion.Actions
# Converts Revit UV coordinates to Dynamo UV coordinates

RevitUV = Input(RevitUV: var[]..[])
turn_into_list = Custom[Turn Into List](unknownItem=RevitUV)  # Turns an element (or a nested list) into a flat list
python_script = Python(IN[0]=turn_into_list)
# ---------- python_script.python (11 lines) ----------
import clr
clr.AddReference('RevitAPI')
from Autodesk.Revit.DB import *

UVs = UnwrapElement(IN[0])
ulist = list()
vlist = list()
for uv in UVs:
	ulist.append(uv.U)
	vlist.append(uv.V)
OUT = (ulist,vlist)
# ----------------------------------------
code_block = CodeBlock(seq=python_script) { seq[0]; seq[1]; 0; 1; }
remapRange = Math.RemapRange(numbers=code_block.out0, newMin=code_block.out2, newMax=code_block.out3)
remapRange_2 = Math.RemapRange(numbers=code_block.out1, newMin=code_block.out2, newMax=code_block.out3)
byCoordinates = UV.ByCoordinates(u=remapRange, v=remapRange_2)
returnListOrSingleValue = Custom[ReturnListOrSingleValue](unknownItem=RevitUV, seq=byCoordinates)  # If the item in input #1 is not a list, only the first item of the list in input #2 will be returned.
DynamoUV = Output(returnListOrSingleValue)
