# Dynamo custom node Vector.AltitudeAndAzimuth.dyf (Dynamo 2.0.1.5055)
# category: Clockwork.Geometry.Abstract.Query
# Computes the altitude and azimuth of a given vector

vector = Input(vector: Autodesk.DesignScript.Geometry.Vector)
normalized = Vector.Normalized(vector=vector)
# note: Turn normalized vector into point
asPoint = Vector.AsPoint(vector=normalized)
Z = Point.Z(point=asPoint)
origin = Point.Origin()
X = Point.X(point=asPoint)
Y = Point.Y(point=asPoint)
# note: Project point to XY plane
byCoordinates = Point.ByCoordinates(x=X, y=Y)
solve_triangle_by_xyzs = Custom[Solve Triangle By XYZs](PointA=asPoint, PointB=origin, PointC=byCoordinates)  # Solves a triangle based on the XYZ coordinates of its vertices.
z_axis_negative = Custom[Z Axis (Negative)]()  # Returns an XYZ of 0,0,-1
asPoint_2 = Vector.AsPoint(vector=z_axis_negative)
isAlmostEqualTo = Geometry.IsAlmostEqualTo(geometry=asPoint_2, other=asPoint)
ZAxis = Vector.ZAxis()
asPoint_3 = Vector.AsPoint(vector=ZAxis)
isAlmostEqualTo_2 = Geometry.IsAlmostEqualTo(geometry=asPoint_3, other=asPoint)
YAxis = Vector.YAxis()
asPoint_4 = Vector.AsPoint(vector=YAxis)
solve_triangle_by_xyzs_2 = Custom[Solve Triangle By XYZs](PointA=byCoordinates, PointB=origin, PointC=asPoint_4)
code_block = CodeBlock(vecZ=Z, x=solve_triangle_by_xyzs.Beta, cond1=isAlmostEqualTo, cond2=isAlmostEqualTo_2, vecx=X, a=solve_triangle_by_xyzs_2.Beta) { zdir = vecZ < 0 ? -x : x; res1 = cond1 ? 90 : zdir; alt = cond2 ? 90 : res1; azi = vecx < 0 ? 360-a : a; }
altitude = Output(code_block.alt)
azimuth = Output(code_block.azi)
