# Dynamo custom node Vector.Average.dyf (Dynamo 2.0.0.4654)
# category: Clockwork.Geometry.Abstract.Query
# Determines the average vector of a list of vectors

vectors = Input(vectors: Autodesk.DesignScript.Geometry.Vector[])
normalized = Vector.Normalized(vector=vectors)
X = Vector.X(vector=normalized)
average = Math.Average(numbers=X)
Y = Vector.Y(vector=normalized)
average_2 = Math.Average(numbers=Y)
Z = Vector.Z(vector=normalized)
average_3 = Math.Average(numbers=Z)
boolean = BoolSelector(true)  # graph input
byCoordinates = Vector.ByCoordinates(x=average, y=average_2, z=average_3, normalized=boolean)
Vector = Output(byCoordinates)
