# Dynamo custom node Vector.CardinalDirection.dyf (Dynamo 2.0.3.8810)
# category: Clockwork.Geometry.Abstract.Actions
# Returns the cardinal direction (N, E, S, W) for a given vector (where N = Y axis, E = X axis etc.). The accuracy input has three modes: 0 = cardinal directions only, 1 = additional intercardinal directions (i.e. NE, SE, SW, NW), 2 = additional secondary intercardinal directions (NNE, ENE, ESE, SSE, SSW, WSW, WNW, NNW).

YAxis = Vector.YAxis()
vector = Input(vector: Autodesk.DesignScript.Geometry.Vector[]..[])
ZAxis = Vector.ZAxis()
angleAboutAxis = Vector.AngleAboutAxis(vector=YAxis, otherVector=vector, rotationAxis=ZAxis)
accuracy = Input(accuracy: int = 0)
cardinalDirectionFromAngle = Custom[Math.CardinalDirectionFromAngle](angle=angleAboutAxis, accuracy=accuracy)  # Returns the cardinal direction (N, E, S, W) for a given angle (where N = 0°, E = 90° etc.). The accuracy input has three modes: 0 = cardinal directions only, 1 = additional intercardinal directions (i.e. NE, SE, SW, NW), 2 = additional secondary intercardinal directions (NNE, ENE, ESE, SSE, SSW, WSW, WNW, NNW).
str = Output(cardinalDirectionFromAngle)
