# Dynamo custom node Vector.CorrectOrientation.dyf (Dynamo 2.0.0.4654)
# category: Clockwork.Geometry.Abstract.Actions
# Inverts vector A if its inversion is closer to vector B

VectorA = Input(VectorA: Autodesk.DesignScript.Geometry.Vector)
VectorB = Input(VectorB: Autodesk.DesignScript.Geometry.Vector)
code_block = CodeBlock(a=VectorA, b=VectorB)
# ---------- code_block.designscript (5 lines) ----------
VecA=a.Normalized();
cond = VecA.Dot(b.Normalized()) > 0;
// If the dot product of the vectors is greater than 0,
// they are pointing in the same general direction.
cond ? VecA : VecA.Scale(-1);
# ----------------------------------------
Vector = Output(code_block.out2)
