# Dynamo custom node Vector.IntersectWithPlane.dyf (Dynamo 2.0.0.4654)
# category: Clockwork.Geometry.Abstract.Actions
# Finds the intersection point between a plane and a vector

vectorBasePoint = Input(vectorBasePoint: Autodesk.DesignScript.Geometry.Point)
vector = Input(vector: Autodesk.DesignScript.Geometry.Vector)
plane = Input(plane: Autodesk.DesignScript.Geometry.Plane)
code_block = CodeBlock(vecn=vector, vecb=vectorBasePoint, plx=plane)
# ---------- code_block.designscript (8 lines) ----------
// Based on: http://stackoverflow.com/questions/5666222/3d-line-plane-intersection
v0 = vecn.Normalized();
v1 = vecb.Subtract(plx.Origin.AsVector()).AsVector();
d1 = plx.Normal.Dot(v1);
d2 = plx.Normal.Dot(v0);
sc1 = -d1/d2;
v2 = v0.Scale(sc1);
p = vecb.Add(v2);
# ----------------------------------------
isInPlane = Custom[Vector.IsInPlane](vectorBasePoint=vectorBasePoint, vector=code_block.v0, plane=plane)  # Checks if a given vector is located on a given plane
isParallelToPlane = Custom[Vector.IsParallelToPlane](vector=code_block.v0, plane=plane)  # Checks if a given vector is parallel to a given plane
code_block_2 = CodeBlock(a=isInPlane, b=isParallelToPlane, p=code_block.p) { a && b ? null : p; }
IntersectionPoint = Output(code_block_2)
