# Dynamo custom node Vector.IntersectWithVector.dyf (Dynamo 2.0.0.4654)
# category: Clockwork.Geometry.Abstract.Actions
# Determines if two vectors intersect and returns the closest points of intersection on both vectors.

vector1 = Input(vector1: Autodesk.DesignScript.Geometry.Vector)
vector2 = Input(vector2: Autodesk.DesignScript.Geometry.Vector)
basePoint2 = Input(basePoint2: Autodesk.DesignScript.Geometry.Point)
basePoint1 = Input(basePoint1: Autodesk.DesignScript.Geometry.Point)
code_block = CodeBlock(v1=vector1, v2=vector2, p2=basePoint2, p1=basePoint1)
# ---------- code_block.designscript (25 lines) ----------
// Based on: http://stackoverflow.com/questions/10551555/need-an-algorithm-for-3d-vectors-intersection;
vec1 = v1.Normalized();
vec2 = v2.Normalized();
// Find the direction projection
u = vec1.Dot(vec2);
// If vectors are parallel, no intersection exists
para = vec1.IsParallel(vec2);
// Find the separation projections
pointvec = p2.Subtract(p1.AsVector()).AsVector();
t1 = pointvec.Dot(vec1);
t2 = pointvec.Dot(vec2);
// Find distance along line1
d1 = (t1-u*t2)/(1-u*u);
// Find distance along line2
d2 = (t2-u*t1)/(u*u-1);
// Find the point on line1
p1_new = p1.Add(vec1.Scale(d1));
para ? null : p1_new;
// Find the point on line2
p2_new = p2.Add(vec2.Scale(d2));
para ? null : p2_new;
// Do vectors intersect?
para ? false : p1_new.IsAlmostEqualTo(p2_new);
// Average XYZ
pts = [p1_new,p2_new];
# ----------------------------------------
VectorsIntersect = Output(code_block.out13)
ClosestPointOnVector1 = Output(code_block.out10)
ClosestPointOnVector2 = Output(code_block.out12)
average = Custom[Point.Average](points=code_block.pts)  # Determines the average of a list of points
AveragePoint = Output(average)
