# Dynamo custom node Vector.IsInPlane.dyf (Dynamo 2.0.0.4654)
# category: Clockwork.Geometry.Abstract.Query
# Checks if a given vector is located on a given plane

vector = Input(vector: Autodesk.DesignScript.Geometry.Vector)
normalized = Vector.Normalized(vector=vector)
plane = Input(plane: Autodesk.DesignScript.Geometry.Plane)
isParallelToPlane = Custom[Vector.IsParallelToPlane](vector=normalized, plane=plane)  # Checks if a given vector is parallel to a given plane
vectorBasePoint = Input(vectorBasePoint: Autodesk.DesignScript.Geometry.Point)
isOutOfPlane = Custom[Point.IsOutOfPlane](face_plane=plane, point=vectorBasePoint)  # Checks a list for XYZs that are not located on a given plane
not_ = Not(x=isOutOfPlane.bool)
create = List.Create(item0=isParallelToPlane, item1=not_)
allTrue = List.AllTrue(list=create)
bool = Output(allTrue)
