# Dynamo custom node Vector.IsOrthogonalToVector.dyf (Dynamo 2.0.0.4654)
# category: Clockwork.Geometry.Abstract.Query
# Checks if two vectors are orthogonal to each other

Vector1 = Input(Vector1: Autodesk.DesignScript.Geometry.Vector)
normalized = Vector.Normalized(vector=Vector1)
Vector2 = Input(Vector2: Autodesk.DesignScript.Geometry.Vector)
normalized_2 = Vector.Normalized(vector=Vector2)
dot = Vector.Dot(vector=normalized, vec=normalized_2)
almost_zero = Custom[Almost Zero]()  # Returns a feasable computational tolerance to zero (1.0e-9 or a billionth of 1) for use in calculations. More background info: https://github.com/ikeough/Dynamo/issues/879
code_block = CodeBlock(dotprod=dot, zero=almost_zero)
# ---------- code_block.designscript (3 lines) ----------
// Orthogonal vectors have a dot product of zero
// We're adding a bit of tolerance, just to be on the safe side...
isortho = !(dotprod>zero) && !(dotprod < -zero);
# ----------------------------------------
bool = Output(code_block)
