# Dynamo custom node Vector.IsParallelToPlane.dyf (Dynamo 2.0.1.5055)
# category: Clockwork.Geometry.Abstract.Query
# Checks if a given vector is parallel to a given plane

vector = Input(vector: Autodesk.DesignScript.Geometry.Vector)
plane = Input(plane: Autodesk.DesignScript.Geometry.Plane)
normal = Plane.Normal(plane=plane)
isOrthogonalToVector = Custom[Vector.IsOrthogonalToVector](Vector1=vector, Vector2=normal)  # Checks if two vectors are orthogonal to each other
bool = Output(isOrthogonalToVector)
