# Dynamo custom node Vector.PruneDuplicates.dyf (Dynamo 2.0.0.4654)
# category: Clockwork.Geometry.Abstract.Actions
# Prune vectors to exclude duplicates within a given tolerance

vectors = Input(vectors: Autodesk.DesignScript.Geometry.Vector[])
asPoint = Vector.AsPoint(vector=vectors)
Tolerance = Input(Tolerance: double)
# note: For some reason this does not work as a code block inside the custom node - hence nodes.
pruneDuplicates = Point.PruneDuplicates(points=asPoint, tolerance=Tolerance)
asVector = Point.AsVector(point=pruneDuplicates)
Vectors = Output(asVector)
