# Dynamo custom node VersionNumber.ToInteger.dyf (Dynamo 2.0.0.4654)
# category: Clockwork.Core.String.Generate.Actions
# Converts a version number (e.g. a Dynamo version number) to an integer.

str = Input(str: string)
code_block = CodeBlock { "."; ""; }
replace = String.Replace(str=str, searchFor=code_block.out0, replaceWith=code_block.out1)
toNumber = String.ToNumber(str=replace)
int = Output(toNumber)
