# Dynamo custom node View.DependentViews.dyf (Dynamo 2.0.1.5055)
# category: Clockwork.Revit.Views.Query
# Returns all dependent views of a given view

view = Input(view: Revit.Elements.Views.View)
python_script = Python(IN[0]=view)
# ---------- python_script.python (16 lines) ----------
import clr
clr.AddReference('RevitAPI')
from Autodesk.Revit.DB import *

clr.AddReference("RevitNodes")
import Revit

def GetDependentViews(view):
	return [view.Document.GetElement(x) for x in view.GetDependentViewIds()]

views = UnwrapElement(IN[0])

if isinstance(IN[0], list):
	OUT = [GetDependentViews(x) for x in views]
else:
	OUT = GetDependentViews(views)
# ----------------------------------------
views = Output(python_script)
