# Dynamo custom node View.DetailLevel.dyf (Dynamo 2.0.1.5055)
# category: Clockwork.Revit.Views.Query
# Retrieves the detail level of a given view

view = Input(view: var[]..[])
python_script = Python(IN[0]=view)
# ---------- python_script.python (12 lines) ----------
import clr
clr.AddReference('RevitAPI')
from Autodesk.Revit.DB import *

def DetailLevel(view):
	if hasattr(view, "DetailLevel"): return str(view.DetailLevel)
	else: return None

views = UnwrapElement(IN[0])

if isinstance(IN[0], list): OUT = [DetailLevel(x) for x in views]
else: OUT = DetailLevel(views)
# ----------------------------------------
detailLevel = Output(python_script)
