# Dynamo custom node View.PermanentlyIsolateElement.dyf (Dynamo 2.0.1.5055)
# category: Clockwork.Revit.Views.Actions
# Permanently isolates elements in the given view

view = Input(view: var[]..[])
view_2 = Output(view)  # "view"
element = Input(element: var[]..[])
element_2 = Output(element)  # "element"
temporarilyIsolateElement = Custom[View.TemporarilyIsolateElement](view=view, element=element)  # Temporarily isolates elements in the given view
convertTemporaryHideIsolateToPermanent = Custom[View.ConvertTemporaryHideIsolateToPermanent](view=temporarilyIsolateElement.view)  # Convert all temporary hidden elements or categories to permanently hidden in the given view.
success = Output(convertTemporaryHideIsolateToPermanent.success)
