# Dynamo custom node View.PrimaryView.dyf (Dynamo 2.0.1.5055)
# category: Clockwork.Revit.Views.Query
# Returns the primary view of a given view (i.e. the master view of a dependent view)

view = Input(view: Revit.Elements.Views.View)
python_script = Python(IN[0]=view)
# ---------- python_script.python (16 lines) ----------
import clr
clr.AddReference('RevitAPI')
from Autodesk.Revit.DB import *

clr.AddReference("RevitNodes")
import Revit

def GetPrimaryView(view):
	return view.Document.GetElement(view.GetPrimaryViewId())

views = UnwrapElement(IN[0])

if isinstance(IN[0], list):
	OUT = [GetPrimaryView(x) for x in views]
else:
	OUT = GetPrimaryView(views)
# ----------------------------------------
view_2 = Output(python_script)  # "view"
