# Dynamo custom node View.ResetElementOverrides.dyf (Dynamo 2.0.0.4654)
# category: Clockwork.Revit.Views.Actions
# Resets all overrides for an element in a given view

element = Input(element: var[]..[])
turn_into_list = Custom[Turn Into List](unknownItem=element)  # Turns an element (or a nested list) into a flat list
view = Input(view: var[]..[])
python_script = Python(IN[0]=turn_into_list, IN[1]=view)
# ---------- python_script.python (28 lines) ----------
import clr
clr.AddReference('RevitAPI')
from Autodesk.Revit.DB import *

clr.AddReference("RevitNodes")
import Revit
clr.ImportExtensions(Revit.Elements)

clr.AddReference("RevitServices")
import RevitServices
from RevitServices.Persistence import DocumentManager
from RevitServices.Transactions import TransactionManager

doc = DocumentManager.Instance.CurrentDBDocument
items = UnwrapElement(IN[0])
view = UnwrapElement(IN[1])
booleans = []

override = OverrideGraphicSettings()

TransactionManager.Instance.EnsureInTransaction(doc)
for item in items:
	try:
		view.SetElementOverrides(item.Id, override)
		booleans.append(True)
	except: booleans.append(False)
TransactionManager.Instance.TransactionTaskDone()
OUT = (items,view,booleans)
# ----------------------------------------
code_block = CodeBlock(seq=python_script) { seq[0]; seq[1]; seq[2]; }
returnListOrSingleValue = Custom[ReturnListOrSingleValue](unknownItem=element, seq=code_block.out0)  # If the item in input #1 is not a list, only the first item of the list in input #2 will be returned.
element_2 = Output(returnListOrSingleValue)  # "element"
view_2 = Output(code_block.out1)  # "view"
returnListOrSingleValue_2 = Custom[ReturnListOrSingleValue](unknownItem=element, seq=code_block.out2)
success = Output(returnListOrSingleValue_2)
