# Dynamo custom node View.SetDesignOption.dyf (Dynamo 2.0.0.4654)
# category: Clockwork.Revit.Views.Actions
# Sets the view to a given design option. PLEASE NOTE: This node is kind of hacky. It does not use the design option settings in the visibility / graphic overrides. Instead it sets the view property "Visible in Option" to *one* specific design option - which also means that the symbolic representation of this view is only visible in views that display the given design options.

view = Input(view: var[]..[])
turn_into_list = Custom[Turn Into List](unknownItem=view)  # Turns an element (or a nested list) into a flat list
designOption = Input(designOption: var[]..[])
turn_into_list_2 = Custom[Turn Into List](unknownItem=designOption)
python_script = Python(IN[0]=turn_into_list, IN[1]=turn_into_list_2)
# ---------- python_script.python (25 lines) ----------
import clr
clr.AddReference('RevitAPI')
from Autodesk.Revit.DB import *

clr.AddReference("RevitServices")
import RevitServices
from RevitServices.Persistence import DocumentManager
from RevitServices.Transactions import TransactionManager

doc = DocumentManager.Instance.CurrentDBDocument
views = UnwrapElement(IN[0])
options = UnwrapElement(IN[1])
booleans = list()
counter = 0
TransactionManager.Instance.EnsureInTransaction(doc)
for item in views:
	try:
		p = item.get_Parameter(BuiltInParameter.VIEWER_OPTION_VISIBILITY)
		p.Set(options[counter].Id)
		booleans.append(True)
	except:
		booleans.append(False)
	counter += 1
TransactionManager.Instance.TransactionTaskDone()
OUT = (views,booleans)
# ----------------------------------------
code_block = CodeBlock(seq=python_script) { seq[0]; seq[1]; }
returnListOrSingleValue = Custom[ReturnListOrSingleValue](unknownItem=view, seq=code_block.out0)  # If the item in input #1 is not a list, only the first item of the list in input #2 will be returned.
view_2 = Output(returnListOrSingleValue)  # "view"
returnListOrSingleValue_2 = Custom[ReturnListOrSingleValue](unknownItem=view, seq=code_block.out1)
success = Output(returnListOrSingleValue_2)
