# Dynamo custom node View.TemporarilyIsolateCategory.dyf (Dynamo 2.0.3.8810)
# category: Clockwork.Revit.Views.Actions
# Temporarily isolates categories in the given view. ATTENTION: This node will be deprecated in 2024. As of Revit 2022, please switch to the OOTB node View.IsolateCategoriesTemporary.

view = Input(view: var[]..[])
view_2 = Output(view)  # "view"
category = Input(category: var[]..[])  # Works with categories, BuiltInCategories and BuiltInCategories as strings
category_2 = Output(category)  # "category"
fromInput = Custom[Category.FromInput](var=category)  # Returns a category from a category, a Dynamo-wrapped category, a BuiltInCategory or a string representing a BuiltInCategory.
python_script = Python(IN[0]=fromInput, IN[1]=view)
# ---------- python_script.python (27 lines) ----------
import clr
clr.AddReference('RevitAPI')
from Autodesk.Revit.DB import *
from System.Collections.Generic import *

clr.AddReference("RevitServices")
import RevitServices
from RevitServices.Persistence import DocumentManager
from RevitServices.Transactions import TransactionManager

def TempIsolateCategories(view, cats):
	if not cats: return False
	elif not isinstance(cats, list): cats = [cats]
	icats = List[ElementId]([x.Id for x in cats])
	try:
		UnwrapElement(view).IsolateCategoriesTemporary(icats)
		return True
	except: return False

doc = DocumentManager.Instance.CurrentDBDocument

TransactionManager.Instance.EnsureInTransaction(doc)
if isinstance(IN[1], list):
	if isinstance(IN[0], list): OUT = [TempIsolateCategories(x, y) for x, y in zip(IN[1], IN[0])]
	else: OUT = [TempIsolateCategories(x, IN[0]) for x in IN[1]]
else: OUT = TempIsolateCategories(IN[1], IN[0])
TransactionManager.Instance.TransactionTaskDone()
# ----------------------------------------
success = Output(python_script)
