# Dynamo custom node View3D.SetSectionBox.dyf (Dynamo 2.3.1.11775)
# category: Clockwork.Revit.Views.Actions
# Sets the section box of a given 3D view to the extents of a given bounding box
# packages: Clockwork for Dynamo 2.x 2.4.0

view3D = Input(view3D: Revit.Elements.Views.View3D[]..[])
boundingBox = Input(boundingBox: Autodesk.DesignScript.Geometry.BoundingBox[]..[])
fromDynamoBoundingBox = Custom[BoundingBox.FromDynamoBoundingBox](DynamoBoundingBox=boundingBox)  # package Clockwork for Dynamo 2.x; Turns a Dynamo bounding box into a Revit bounding box.
python_script = Python(IN[0]=view3D, IN[1]=fromDynamoBoundingBox)
# ---------- python_script.python (30 lines) ----------
import clr
clr.AddReference('ProtoGeometry')
from Autodesk.DesignScript.Geometry import *

# Import ToDSType(bool) extension method
clr.AddReference("RevitNodes")
import Revit
clr.ImportExtensions(Revit.Elements)

# Import DocumentManager and TransactionManager
clr.AddReference("RevitServices")
import RevitServices
from RevitServices.Persistence import DocumentManager
from RevitServices.Transactions import TransactionManager

# Import RevitAPI
clr.AddReference("RevitAPI")
import Autodesk
from Autodesk.Revit.DB import *

doc = DocumentManager.Instance.CurrentDBDocument

view = UnwrapElement(IN[0])
bbox = IN[1]

TransactionManager.Instance.EnsureInTransaction(doc)
view.SetSectionBox(bbox)
TransactionManager.Instance.TransactionTaskDone()

OUT = view, bbox.Max, bbox.Min
# ----------------------------------------
view3D_2 = Output(python_script)  # "view3D"
