# Dynamo custom node ViewSheetSet.Views.dyf (Dynamo 1.3.1.1736)
# category: Clockwork.Revit.Views.ViewSheetSet.Query
# Retrieves all the views/sheets in a given view/sheet set.

viewsSheetSet = Input()
python_script = Python(IN[0]=viewsSheetSet)
# ---------- python_script.python (17 lines) ----------
import clr
clr.AddReference('RevitAPI')
from Autodesk.Revit.DB import *

clr.AddReference("RevitNodes")
import Revit
clr.ImportExtensions(Revit.Elements)

def GetSheetSetViews(set):
	if hasattr(set, 'Views'):
		return [x.ToDSType(True) for x in set.Views]
	else: return []

viewsheetsets = UnwrapElement(IN[0])

if isinstance(IN[0], list): OUT = [GetSheetSetViews(x) for x in viewsheetsets]
else: OUT = GetSheetSetViews(viewsheetsets)
# ----------------------------------------
views = Output(python_script)
