# Dynamo custom node Wall.Orientation.dyf (Dynamo 2.0.1.5055)
# category: Clockwork.Revit.Elements.Query
# Gets the orientation of a given wall instance (normal of the exterior face of the wall). Will *not* work for walls hosted on mass faces or in-place walls.

wall = Input(wall: Revit.Elements.Wall)
python_script = Python(IN[0]=wall)
# ---------- python_script.python (24 lines) ----------
import clr
clr.AddReference('RevitAPI')
from Autodesk.Revit.DB import *

clr.AddReference("RevitNodes")
import Revit
clr.ImportExtensions(Revit.Elements)
clr.ImportExtensions(Revit.GeometryConversion)

def WallOrientation(wall):
	loc = wall.Location
	if hasattr(loc, "Curve"):
		lcurve = loc.Curve
		if str(type(lcurve)) == "Autodesk.Revit.DB.Line":
			return wall.Orientation.ToVector()
		else:
			direction = (lcurve.GetEndPoint(1) - lcurve.GetEndPoint(0)).Normalize()
			return XYZ.BasisZ.CrossProduct(direction).ToVector()
	else: return None

walls = UnwrapElement(IN[0])

if isinstance(IN[0], list): OUT = [WallOrientation(x) for x in walls]
else: OUT = WallOrientation(walls)
# ----------------------------------------
Normal = Output(python_script)
