# Dynamo custom node Window.Rooms.dyf (Dynamo 1.3.1.1736)
# category: Clockwork.Revit.Elements.Window.Query
# Gets the rooms that are connected by a given window

window = Input(window : FamilyInstance[]..[])
phase = Input(phase : var = null)  # If no phase is specified, the node will use the last phase in the project
rooms = Custom[Door.Rooms](door=window, phase=phase)  # Gets the rooms that are connected by a given door
fromRoom = Output(rooms.fromRoom)
toRoom = Output(rooms.toRoom)
roomCount = Output(rooms.roomCount)
