# Dynamo custom node XYZAxis.ByTwoVectors.dyf (Dynamo 2.0.0.4654)
# category: Clockwork.Geometry.Abstract.Vector.Create
# Given two main XYZ axes (or vectors pointing more or less in their general direction), this node will find the third axis.

origin = Point.Origin()
Axis1 = Input(Axis1: Autodesk.DesignScript.Geometry.Vector)
fromVector = Custom[XYZAxis.FromVector](vector=Axis1)  # Returns whichever main axis (X, Y or Z) is closest to a given vector
asPoint = Vector.AsPoint(vector=fromVector)
Axis2 = Input(Axis2: Autodesk.DesignScript.Geometry.Vector)
fromVector_2 = Custom[XYZAxis.FromVector](vector=Axis2)
asPoint_2 = Vector.AsPoint(vector=fromVector_2)
create = List.Create(item0=origin, item1=asPoint, item2=asPoint_2)
# note: Make a plane based on the given axes and the origin
byBestFitThroughPoints = Plane.ByBestFitThroughPoints(points=create)
# note: The normal of that plane is the vector of the third axis
normal = Plane.Normal(plane=byBestFitThroughPoints)
code_block = CodeBlock { 1; }
byCoordinates = Vector.ByCoordinates(x=code_block, y=code_block, z=code_block)
normalized = Vector.Normalized(vector=byCoordinates)
correctOrientation = Custom[Vector.CorrectOrientation](VectorA=normal, VectorB=normalized)  # Inverts vector A if its inversion is closer to vector B
vector = Output(correctOrientation)
code_block_2 = CodeBlock(vec=normal)
# ---------- code_block_2.designscript (4 lines) ----------
// Set up a nested condition and find the main direction of the vector
cond1 = Math.Abs(vec.Y) > Math.Abs(vec.X) && Math.Abs(vec.Y) > Math.Abs(vec.Z);
cond2 = Math.Abs(vec.X) > Math.Abs(vec.Y) && Math.Abs(vec.X) > Math.Abs(vec.Z);
cond2 ? "X" : (cond1 ? "Y" : "Z");
# ----------------------------------------
str = Output(code_block_2.out2)
