# Dynamo custom node XYZAxis.FromVector.dyf (Dynamo 2.0.0.4654)
# category: Clockwork.Geometry.Abstract.Vector.Create
# Returns whichever main axis (X, Y or Z) is closest to a given vector

vector = Input(vector: Autodesk.DesignScript.Geometry.Vector)
YAxis = Vector.YAxis()
ZAxis = Vector.ZAxis()
XAxis = Vector.XAxis()
code_block = CodeBlock(vec=vector, yaxis=YAxis, zaxis=ZAxis, xaxis=XAxis)
# ---------- code_block.designscript (4 lines) ----------
cond1 = Math.Abs(vec.Y) > Math.Abs(vec.X) && Math.Abs(vec.Y) > Math.Abs(vec.Z);
cond2 = Math.Abs(vec.X) > Math.Abs(vec.Y) && Math.Abs(vec.X) > Math.Abs(vec.Z);
cond3 = cond1 ? yaxis : zaxis;
cond2 ? xaxis : cond3;
# ----------------------------------------
XYZ_Axis = Output(code_block.out3)
