# Dynamo custom node Application.BasicFileInfo.dyf (Dynamo 3.6.1.9895)
# category: Clockwork.Revit.Application.Query
# Retrieves basic information about a given Revit file.
# PLEASE NOTE: The SavedInLaterVersion property is only available when running the node in Revit 2017 or later, it will return Null in previous versions of Revit.

filePath = Input(filePath: string)
python_script = Python(IN[0]=filePath)  # PythonNet3
# ---------- python_script.python (25 lines) ----------
import clr
import System
clr.AddReference('RevitAPI')
from Autodesk.Revit.DB import *
from Autodesk.Revit.ApplicationServices import *
import Autodesk

if isinstance(IN[0], list): paths = IN[0]
else: paths = [IN[0]]

bfi = [BasicFileInfo.Extract(x) for x in paths]
username = [x.Username for x in bfi]
language = [System.Enum.GetName(LanguageType, x.LanguageWhenSaved) for x in bfi]
version = [x.Format for x in bfi]
versioncurrent = [x.IsSavedInCurrentVersion for x in bfi]
versionlater = [x.IsSavedInLaterVersion for x in bfi]
workshared = [x.IsWorkshared for x in bfi]
local = [x.IsLocal for x in bfi]
central = [x.IsCentral for x in bfi]
centralpath = [x.CentralPath for x in bfi]

if isinstance(IN[0], list):
	OUT = username, language, version, versioncurrent, versionlater, workshared, local, central, centralpath
else:
	OUT = username[0], language[0], version[0], versioncurrent[0], versionlater[0], workshared[0], local[0], central[0], centralpath[0]
# ----------------------------------------
code_block = CodeBlock(seq=python_script) { seq[0]; seq[1]; seq[2]; seq[3]; seq[4]; seq[5]; seq[6]; seq[7]; seq[8]; }
Username = Output(code_block.out0)
Language = Output(code_block.out1)
Version = Output(code_block.out2)
SavedInCurrentVersion = Output(code_block.out3)
SavedInLaterVersion = Output(code_block.out4)
IsWorkshared = Output(code_block.out5)
IsLocal = Output(code_block.out6)
IsCentral = Output(code_block.out7)
CentralPath = Output(code_block.out8)
