# Dynamo custom node Document.BuiltInCategories.dyf (Dynamo 3.6.1.9895)
# category: Clockwork.Revit.Application.Query
# List all the available BuiltInCategories
# packages: PythonNet3 Engine 1.1.1, Clockwork for Dynamo 2.x 2.12.2

dynamoSupportedCategoriesOnly = Input(dynamoSupportedCategoriesOnly: bool = true)
version = Custom[Application.Version]()  # package Clockwork for Dynamo 2.x; Retrieves the name, version and build of the current Revit application.
python_script = Python(IN[0]=dynamoSupportedCategoriesOnly, IN[1]=version.Version)  # PythonNet3
# ---------- python_script.python (20 lines) ----------
import clr
import System
clr.AddReference('RevitAPI')
clr.AddReference('RevitAPIUI')
from Autodesk.Revit.DB import *
import Autodesk
clr.AddReference("RevitNodes")
import Revit

dynamoCatsOnly = IN[0]
version = IN[1]
biclist = [eval("BuiltInCategory."+x) for x in dir(BuiltInCategory) if x.startswith("OST_")]
cdata = []
for bic in biclist:
    try: 
        if version < 2025: cdata.append((System.Enum.GetName(BuiltInCategory, bic), ElementId(bic), Revit.Elements.Category.ById(ElementId(bic).IntegerValue)))
        else: cdata.append((System.Enum.GetName(BuiltInCategory, bic), ElementId(bic), Revit.Elements.Category.ById(ElementId(bic).Value)))
    except:
        if not dynamoCatsOnly: cdata.append((bic, ElementId(bic), None))
OUT = map(list, zip(*cdata))
# ----------------------------------------
code_block = CodeBlock(seq=python_script) { seq[0]; seq[1]; seq[2]; }
BuiltInCategories = Output(code_block.out0)
ElementIDs = Output(code_block.out1)
Categories = Output(code_block.out2)
