# Dynamo custom node Document.BuiltInParameters.dyf (Dynamo 3.6.1.9895)
# category: Clockwork.Revit.Application.Query
# List all the available BuiltInParameters
# packages: PythonNet3 Engine 1.1.1

python_script = Python()  # PythonNet3; graph input
# ---------- python_script.python (15 lines) ----------
import clr
import System
clr.AddReference('RevitAPI')
clr.AddReference('RevitAPIUI')
from Autodesk.Revit.DB import *
import Autodesk

bips = [eval("BuiltInParameter."+x) for x in dir(BuiltInParameter) if not any(y.islower() for y in x)]
pdata = list()
for bip in bips:
	try:
		pdata.append((System.Enum.GetName(BuiltInParameter, bip),ElementId(bip),LabelUtils.GetLabelFor(bip)))
	except:
		pass
OUT = pdata
# ----------------------------------------
transpose = List.Transpose(lists=python_script)
code_block = CodeBlock(seq=transpose) { seq[0]; seq[1]; seq[2]; }
BuiltInParameters = Output(code_block.out0)
ElementIDs = Output(code_block.out1)
ParameterNames = Output(code_block.out2)
