# Dynamo custom node Document.ProjectPosition.dyf (Dynamo 3.6.1.9895)
# category: Clockwork.Revit.Application.Query
# Gets the project's position data relative to the origin. Output coordinates may diverge from the project base point coordinates once the project base point has been moved in an unclipped state. Use the built-in nodes Location.Latitude & Location.Longitude to retrieve latitude and longitude.
# packages: PythonNet3 Engine 1.1.1

toggle = Input(toggle: bool = true)
docOrRevitLinkInstance = Input(docOrRevitLinkInstance: var = null)  # Use only if you want to query a linked model
python_script = Python(IN[0]=toggle, IN[1]=docOrRevitLinkInstance)  # PythonNet3
# ---------- python_script.python (30 lines) ----------
import clr
clr.AddReference('RevitAPI')
from Autodesk.Revit.DB import *
import Autodesk

clr.AddReference("RevitServices")
import RevitServices
from RevitServices.Persistence import DocumentManager

inputdoc = UnwrapElement(IN[1])
if inputdoc == None:
	doc = DocumentManager.Instance.CurrentDBDocument
elif inputdoc.GetType().ToString() == "Autodesk.Revit.DB.RevitLinkInstance":
	doc = inputdoc.GetLinkDocument()
elif inputdoc.GetType().ToString() == "Autodesk.Revit.DB.Document":
	doc = inputdoc
else: doc = None

projloc = doc.ActiveProjectLocation
position_data = projloc.GetProjectPosition(XYZ.Zero)
location_data = projloc.GetSiteLocation()
unittype = ForgeTypeId('autodesk.spec.aec:length-2.0.0')

def InternalUnitToDisplayUnit(val, unittype):
	formatoptions = doc.GetUnits().GetFormatOptions(unittype)
	dispunits = formatoptions.GetUnitTypeId()
	try: return UnitUtils.ConvertFromInternalUnits(val,dispunits)
	except: return None

OUT = (position_data.Angle, InternalUnitToDisplayUnit(position_data.Elevation, unittype), InternalUnitToDisplayUnit(position_data.EastWest, unittype), InternalUnitToDisplayUnit(position_data.NorthSouth, unittype))
# ----------------------------------------
code_block = CodeBlock(seq=python_script) { seq[0]; seq[1]; seq[2]; seq[3]; }
radiansToDegrees = Math.RadiansToDegrees(radians=code_block.out0)
Angle_degr = Output(radiansToDegrees)  # "Angle (degr.)"
Elevation = Output(code_block.out1)
EastWest = Output(code_block.out2)
NorthSouth = Output(code_block.out3)
