# Dynamo custom node Document.SaveAs.dyf (Dynamo 3.6.1.9895)
# category: Clockwork.Revit.Application.Actions
# Saves the active Revit document under the given name.
# packages: Clockwork for Dynamo 2.x 2.6.0, PythonNet3 Engine 1.1.1

filePath = Input(filePath: string)  # File path to save to. File extension (*.rvt/*.rte/*.rfa/*.rft) will be automatically added.
code_block = CodeBlock(path1=filePath)
# ---------- code_block.designscript (6 lines) ----------
// Delete filetype (if present in string)
// Filetype will automatically be added by Python script
path2 = String.Replace(path1,".rvt","");
path3 = String.Replace(path2,".rte","");
path4 = String.Replace(path3,".rfa","");
String.Replace(path4,".rft","");
# ----------------------------------------
compactFile = Input(compactFile: bool = false)  # Should the file be compacted?
saveAsCentral = Input(saveAsCentral: bool = false)  # Should the file be saved as a new central file? Will be ignored for templates, non-workshared projects and families
isWorkshared = Custom[Document.IsWorkshared]()  # package Clockwork for Dynamo 2.x; Returns true if the current project is workshared
saveAsTemplate = Input(saveAsTemplate: bool = false)  # Should the file be saved as a template?
python_script = Python(IN[0]=code_block.out3, IN[1]=compactFile, IN[2]=saveAsCentral, IN[3]=isWorkshared, IN[4]=saveAsTemplate)  # PythonNet3
# ---------- python_script.python (45 lines) ----------
import clr
clr.AddReference('RevitAPI')
from Autodesk.Revit.DB import *
import System.IO

clr.AddReference("RevitServices")
import RevitServices
from RevitServices.Persistence import DocumentManager
from RevitServices.Transactions import TransactionManager

doc = DocumentManager.Instance.CurrentDBDocument
path = IN[0]
compact = IN[1]
newcentral = IN[2]
isworkshared = IN[3]
astemplate = IN[4]

TransactionManager.Instance.ForceCloseTransaction()
if doc.IsFamilyDocument:
	path += '.rfa'
else:
	if astemplate: path += '.rte'
	else: path += '.rvt'
opt = SaveAsOptions()
opt.OverwriteExistingFile = True
opt.Compact = compact
if isworkshared and newcentral and not astemplate:
	wsopt = WorksharingSaveAsOptions()
	wsopt.ClearTransmitted = True
	wsopt.SaveAsCentral = True
	opt.SetWorksharingOptions(wsopt)
try:
	doc.SaveAs(path, opt)
	if doc.IsFamilyDocument and astemplate: 
		newpath = path.replace(".rfa", ".rft")
		System.IO.File.Move(path, newpath)
	OUT = True
except:
	try:
		wsopt.ClearTransmitted = False
		opt.SetWorksharingOptions(wsopt)
		doc.SaveAs(path, opt)
		OUT = True
	except:
		OUT = False
# ----------------------------------------
success = Output(python_script)
