# Dynamo custom node Document.Views.dyf (Dynamo 3.6.1.9895)
# category: Clockwork.Revit.Application.Query
# Gets all views in the document - except for 3D view templates (as long as this bug is not fixed: https://github.com/DynamoDS/Dynamo/issues/2970)
# packages: PythonNet3 Engine 1.1.1

toggle = Input(toggle: bool = true)
docOrRevitLinkInstance = Input(docOrRevitLinkInstance: var = null)  # Use only if you want to query a linked model
python_script = Python(IN[0]=toggle, IN[1]=docOrRevitLinkInstance)  # PythonNet3
# ---------- python_script.python (28 lines) ----------
import clr
clr.AddReference('RevitAPI')
from Autodesk.Revit.DB import *
import Autodesk

clr.AddReference("RevitServices")
import RevitServices
from RevitServices.Persistence import DocumentManager

inputdoc = UnwrapElement(IN[1])
if inputdoc == None:
	doc = DocumentManager.Instance.CurrentDBDocument
elif inputdoc.GetType().ToString() == "Autodesk.Revit.DB.RevitLinkInstance":
	doc = inputdoc.GetLinkDocument()
elif inputdoc.GetType().ToString() == "Autodesk.Revit.DB.Document":
	doc = inputdoc
else: doc = None

collector = FilteredElementCollector(doc)
views = collector.OfClass(View).ToElements()
viewlist = list()
for view in views:
	if view.ViewType == ViewType.ThreeD:
		if not(view.IsTemplate):
			viewlist.append(view)
	else:
		viewlist.append(view)
OUT = viewlist
# ----------------------------------------
Views = Output(python_script)
