# Dynamo custom node FamilyDocument.CurrentFamilyType.dyf (Dynamo 3.6.1.9895)
# category: Clockwork.Revit.Application.Query
# Retrieves the current family type from the active family document. PLEASE NOTE: This node will only work in a family document!
# packages: PythonNet3 Engine 1.1.1

toggle = Input(toggle: bool = true)
python_script = Python(IN[0]=toggle)  # PythonNet3
# ---------- python_script.python (12 lines) ----------
import clr
clr.AddReference('RevitAPI')
from Autodesk.Revit.DB import *

clr.AddReference("RevitServices")
import RevitServices
from RevitServices.Persistence import DocumentManager

doc = DocumentManager.Instance.CurrentDBDocument
if doc.IsFamilyDocument:
	OUT = doc.FamilyManager.CurrentType
else: OUT = None
# ----------------------------------------
familyType = Output(python_script)
