# Dynamo custom node FamilyDocument.Properties.dyf (Dynamo 3.6.1.9895)
# category: Clockwork.Revit.Application.Query
# Retrieves all the properties of the current family document (i.e. parameters that you would access in the UI via the Family Category & Parameters tool).
# packages: PythonNet3 Engine 1.1.1

toggle = Input(toggle: bool = true)
python_script = Python(IN[0]=toggle)  # PythonNet3
# ---------- python_script.python (11 lines) ----------
import clr
clr.AddReference('RevitAPI')
from Autodesk.Revit.DB import *

clr.AddReference("RevitServices")
import RevitServices
from RevitServices.Persistence import DocumentManager

doc = DocumentManager.Instance.CurrentDBDocument
if doc.IsFamilyDocument: OUT = doc.OwnerFamily
else: OUT = []
# ----------------------------------------
parameters = Element.Parameters(element=python_script)
familyParameters = Output(parameters)
