# Dynamo custom node -1.dyf (Dynamo 2.0.1.5055)
# category: Clockwork.Math.Functions.Actions
# Decrements a value by 1

dbl = Input(dbl: double)
code_block = CodeBlock(n=dbl) { n-1; }
dbl_2 = Output(code_block)  # "dbl"
