# Dynamo custom node Angle.ByAngleSum.dyf (Dynamo 2.0.1.5055)
# category: Clockwork.Math.Formulas.Query
# Computes the missing interior angle of a *planar* polygon based on a given list of all other interior angles.

angles = Input(angles: double[])
count = List.Count(list=angles)
code_block = CodeBlock(n=count, angles=angles) { n > 1; (n-1)*180-Math.Sum(angles); "The list needs to consist of at least two angles."; }
scopeIf = Custom[ScopeIf+](test=code_block.out0, true=code_block.out1, false=code_block.out2)  # A (hopefully) more robust implementation of ScopeIf. Tests a single boolean and returns a value accordingly.
angle = Output(scopeIf)
