# Dynamo custom node Angle.ExteriorAngle.dyf (Dynamo 2.0.1.5055)
# category: Clockwork.Math.Formulas.Query
# Computes the exterior angle of a given angle.

angle = Input(angle: double)
code_block = CodeBlock(angle=angle) { 360-angle; 180-angle; }
n360_angle = Output(code_block.out0)  # "360°-angle"
n180_angle = Output(code_block.out1)  # "180°-angle"
