# Dynamo custom node Array.GroupType.dyf (Dynamo 2.0.1.5055)
# category: Clockwork.Revit.Elements.Query
# Returns the group type of a given array

array = Input(array: var[]..[])
python_script = Python(IN[0]=array)
# ---------- python_script.python (19 lines) ----------
import clr
clr.AddReference('RevitAPI')
from Autodesk.Revit.DB import *

clr.AddReference("RevitNodes")
import Revit
clr.ImportExtensions(Revit.Elements)

arrays = UnwrapElement(IN[0])

def GetArrayMembers(array):
	if hasattr(array, "GetOriginalMemberIds"):
		returnvals = []
		for id in array.GetOriginalMemberIds():
			return array.Document.GetElement(id)
	else: return None

if isinstance(IN[0], list): OUT = [GetArrayMembers(x) for x in arrays]
else: OUT = GetArrayMembers(arrays)
# ----------------------------------------
elementType = Custom[Element.ElementType+](element=python_script)  # Gets the family type of a given element (if applicable). Unlike the OOTB node, it also works for elements in linked models.
groupType = Output(elementType)
