# Dynamo custom node Binary.FromDecimal.dyf (Dynamo 3.4.1.7055)
# category: Clockwork.String.Generate.Create
# Converts a number to a string of its binary value

decimal = Input(decimal: int)
python_script = Python(IN[0]=decimal)  # CPython3
# ---------- python_script.python (2 lines) ----------
if isinstance(IN[0], list): OUT = [bin(x)[2:] for x in IN[0]]
else: OUT = bin(IN[0])[2:]
# ----------------------------------------
binary = Output(python_script)
