# Dynamo custom node Booleans.AnyFalse.dyf (Dynamo 2.0.1.5055)
# category: Clockwork.List.Inspect.Query
# Returns true if any item in a list of booleans is false. ATTENTION: This node will be deprecated in 2024. As of Revit 2022, please switch to the OOTB node AnyFalse.

seq = Input(seq: bool[])
countFalse = List.CountFalse(list=seq)
code_block = CodeBlock(n=countFalse) { n > 0; }
bool = Output(code_block)
