# Dynamo custom node Booleans.AnyTrue.dyf (Dynamo 2.0.1.5055)
# category: Clockwork.List.Inspect.Query
# Returns true if any item in a list of booleans is true. ATTENTION: This node will be deprecated in 2024. As of Revit 2022, please switch to the OOTB node AnyTrue.

seq = Input(seq: bool[])
countTrue = List.CountTrue(list=seq)
code_block = CodeBlock(n=countTrue) { n > 0; }
bool = Output(code_block)
