# Dynamo custom node BuiltInCategory.ByName.dyf (Dynamo 2.12.1.8246)
# category: Clockwork.Revit.Selection.Miscellaneous.Query
# Looks up all the built-in categories based on a given name (or part of a name) of the category. Search is case-insensitive.

dynamoSupportedCategoriesOnly = Input(dynamoSupportedCategoriesOnly: bool = true)
builtInCategories = Custom[Document.BuiltInCategories](dynamoSupportedCategoriesOnly=dynamoSupportedCategoriesOnly)  # List all the available BuiltInCategories
searchFor = Input(searchFor: string)
ignoreCase = Input(ignoreCase: bool = true)
contains = String.Contains(string=builtInCategories.BuiltInCategories, searchFor=searchFor, ignoreCase=ignoreCase)
filterByBoolMask = List.FilterByBoolMask(list=builtInCategories.BuiltInCategories, mask=contains)
BuiltInCategories = Output(filterByBoolMask.in)
filterByBoolMask_2 = List.FilterByBoolMask(list=builtInCategories.ElementIDs, mask=contains)
ElementIDs = Output(filterByBoolMask_2.in)
filterByBoolMask_3 = List.FilterByBoolMask(list=builtInCategories.Categories, mask=contains)
Categories = Output(filterByBoolMask_3.in)
