# Dynamo custom node BuiltInCategory.FromInput.dyf (Dynamo 2.12.1.8246)
# category: Clockwork.Revit.Selection.Miscellaneous.Query
# Returns a BuiltInCategory from a category, a Dynamo-wrapped category, a BuiltInCategory or a string representing a BuiltInCategory.

input = Input(input: var[]..[])
python_script = Python(IN[0]=input)  # IronPython2
# ---------- python_script.python (33 lines) ----------
import System
import clr
clr.AddReference('RevitAPI')
from Autodesk.Revit.DB import *

clr.AddReference("RevitNodes")
import Revit
clr.ImportExtensions(Revit.Elements)

clr.AddReference("RevitServices")
import RevitServices
from RevitServices.Persistence import DocumentManager

def GetBicFromInput(var):	
	if var:
		if isinstance(var, str): 
			try:
				eval("BuiltInCategory." + var)
				return var
			except: return None
		elif isinstance(var, int): return System.Enum.GetName(BuiltInCategory, var)
		else:
			cattype = var.GetType().ToString()
			if cattype == "Revit.Elements.Category": return System.Enum.GetName(BuiltInCategory, var.Id)
			elif cattype == "Autodesk.Revit.DB.BuiltInCategory": return var
			else: return None
	else: return None

doc = DocumentManager.Instance.CurrentDBDocument
bics = System.Enum.GetValues(BuiltInCategory)

if isinstance(IN[0], list): OUT = [GetBicFromInput(x) for x in IN[0]]
else: OUT = GetBicFromInput(IN[0])
# ----------------------------------------
str = Output(python_script)
