# Dynamo custom node Category.Subcategories.dyf (Dynamo 3.4.1.7055)
# category: Clockwork.Revit.Elements.Query
# Retrieves all the subcategories for a given category
# packages: Clockwork for Dynamo 2.x 2.12.1, Clockwork for Dynamo 2.x 2.12.2

category = Input(category: var[]..[])  # Works with categories, BuiltInCategories and BuiltInCategories as strings
fromInput = Custom[Category.FromInput](category=category)  # package Clockwork for Dynamo 2.x; Returns a category from a category, a Dynamo-wrapped category, a BuiltInCategory or a string representing a BuiltInCategory.
version = Custom[Application.Version]()  # package Clockwork for Dynamo 2.x; Retrieves the name, version and build of the current Revit application.
python_script = Python(IN[0]=fromInput, IN[1]=version.Version)  # CPython3
# ---------- python_script.python (19 lines) ----------
import clr
clr.AddReference('RevitAPI')
from Autodesk.Revit.DB import *

clr.AddReference("RevitNodes")
import Revit
clr.ImportExtensions(Revit.Elements)

def GetSubcategories(cat):
    if hasattr(cat, "SubCategories"):
        if version > 2025: return [Revit.Elements.Category.ById(x.Id.Value) for x in cat.SubCategories]
        else: return [Revit.Elements.Category.ById(x.Id.IntegerValue) for x in cat.SubCategories]
    else: return []

cats = UnwrapElement(IN[0])
version = IN[1]

if isinstance(IN[0], list): OUT = [GetSubcategories(x) for x in cats]
else: OUT = GetSubcategories(cats)
# ----------------------------------------
subcategories = Output(python_script)
