# Dynamo custom node Color.ByName.dyf (Dynamo 2.0.3.8810)
# category: Clockwork.Display.Create
# Returns the color that corresponds to the given name (look here for a list of defined colors: https://docs.microsoft.com/en-us/dotnet/api/system.drawing.knowncolor?view=netframework-4.7.2).

code_block = CodeBlock { 255; }
str = Input(str: var[]..[])
python_script = Python(IN[0]=str)
# ---------- python_script.python (11 lines) ----------
import clr
clr.AddReference('System.Drawing')
import System.Drawing

def ColorByName(str):
	syscol = System.Drawing.Color.FromName(str)
	return syscol.R,syscol.G,syscol.B
	

if isinstance(IN[0], list): OUT = map(list, zip(*[ColorByName(x) for x in IN[0]]))
else: OUT = ColorByName(IN[0])
# ----------------------------------------
code_block_2 = CodeBlock(seq=python_script) { seq[0]; seq[1]; seq[2]; }
byARGB = Color.ByARGB(a=code_block, r=code_block_2.out0, g=code_block_2.out1, b=code_block_2.out2)
color = Output(byARGB)
