# Dynamo custom node CurtainPanel.HostPanel.dyf (Dynamo 3.4.1.7055)
# category: Clockwork.Revit.Elements.Query
# Retrieves the host panel of a given curtain panel. This is typcially needed when wanting to access wall elements used as curtain panels. If no host panel is found, the node will return the input panel instead.

curtainPanel = Input(curtainPanel: var[]..[])
version = Custom[Application.Version]()  # Retrieves the name, version and build of the current Revit application.
python_script = Python(IN[0]=curtainPanel, IN[1]=version.Version)  # CPython3
# ---------- python_script.python (22 lines) ----------
import clr
clr.AddReference('RevitAPI')
from Autodesk.Revit.DB import *

clr.AddReference("RevitNodes")
import Revit
clr.ImportExtensions(Revit.Elements)

def GetHostPanel(item):
    if hasattr(item, "FindHostPanel"):
        hpId = item.FindHostPanel()
        if version > 2024: hpIdVal = hpId.Value
        else: hpIdVal = hpId.IntegerValue
        if hpIdVal > 0: return item.Document.GetElement(hpId).ToDSType(True)
        else: return item
    else: return item

items = UnwrapElement(IN[0])
version = IN[1]

if isinstance(IN[0], list): OUT = [GetHostPanel(x) for x in items]
else: OUT = GetHostPanel(items)
# ----------------------------------------
hostPanel = Output(python_script)
