# Dynamo custom node DetailCurve.ByCurve+.dyf (Dynamo 2.12.1.8246)
# category: Clockwork.Revit.Elements.Create
# Creates a detail line based on a given curve. Unlike the OOTB node it can also draw circles.

curve = Input(curve: Autodesk.DesignScript.Geometry.Curve)
turnIntoList = Custom[TurnIntoList](unknownItem=curve)  # Turns an element (or a nested list) into a flat list
view = Input(view: var[]..[])
python_script = Python(IN[0]=turnIntoList, IN[1]=view)  # CPython3
# ---------- python_script.python (31 lines) ----------
import clr
clr.AddReference('RevitAPI')
from Autodesk.Revit.DB import *

clr.AddReference("RevitNodes")
import Revit
clr.ImportExtensions(Revit.GeometryConversion)

clr.AddReference("RevitServices")
import RevitServices
from RevitServices.Persistence import DocumentManager
from RevitServices.Transactions import TransactionManager

doc = DocumentManager.Instance.CurrentDBDocument
curves = UnwrapElement(IN[0])
view = UnwrapElement(IN[1])
elementlist = []

TransactionManager.Instance.EnsureInTransaction(doc)
if doc.IsFamilyDocument: 
	doc_create = doc.FamilyCreate
else: 
	doc_create = doc.Create
for curve in curves:
	try:
		detcurve = doc_create.NewDetailCurve(view, curve.ToRevitType())
		elementlist.append(detcurve)
	except:
		elementlist.append(None)
TransactionManager.Instance.TransactionTaskDone()
OUT = elementlist
# ----------------------------------------
returnListOrSingleValue = Custom[ReturnListOrSingleValue](unknownItem=curve, seq=python_script)  # If the unknown item is not a list but rather a single item, only the first item of the list (input "seq") will be returned.
detailCurve = Output(returnListOrSingleValue)
