# Dynamo custom node Dimension.AssociatedFamilyParameter.dyf (Dynamo 2.12.1.8246)
# category: Clockwork.Revit.Elements.Query
# Returns the associated family parameter of a dimension label (if any). PLEASE NOTE: This node will only work in a family document!

dimension = Input(dimension: var[]..[])
python_script = Python(IN[0]=dimension)  # CPython3
# ---------- python_script.python (18 lines) ----------
import clr
clr.AddReference('RevitAPI')
from Autodesk.Revit.DB import *

clr.AddReference("RevitNodes")
import Revit
clr.ImportExtensions(Revit.Elements)

def GetAssociatedFamilyParameters(dimension):
	if hasattr(dimension, "FamilyLabel"):
		if dimension.FamilyLabel != None: return dimension.FamilyLabel, dimension.FamilyLabel.Definition.Name
		else: return None, None
	else: return None, None

dimensions = UnwrapElement(IN[0])

if isinstance(IN[0], list): OUT = map(list, zip(*[GetAssociatedFamilyParameters(x) for x in dimensions]))
else: OUT = GetAssociatedFamilyParameters(dimensions)
# ----------------------------------------
code_block = CodeBlock(seq=python_script) { seq[0]; seq[1]; }
familyParameter = Output(code_block.out0)
familyParameterName = Output(code_block.out1)
