# Dynamo custom node Document.ProjectParametersByCategory.dyf (Dynamo 2.12.1.8246)
# category: Clockwork.Revit.Application.Query
# Retrieves all project parameters for a given category
# packages: Clockwork for Dynamo 2.x 2.3.0

category = Input(category: var[]..[])  # Works with categories, BuiltInCategories and BuiltInCategories as strings
fromInput = Custom[Category.FromInput](category=category)  # package Clockwork for Dynamo 2.x; Returns a category from a category, a Dynamo-wrapped category, a BuiltInCategory or a string representing a BuiltInCategory.
toggle = Input(toggle: bool = true)
docOrRevitLinkInstance = Input(docOrRevitLinkInstance: var = null)  # Use only if you want to query a linked model
version = Custom[Application.Version]()  # package Clockwork for Dynamo 2.x; Retrieves the name, version and build of the current Revit application.
python_script = Python(IN[0]=fromInput, IN[1]=toggle, IN[2]=docOrRevitLinkInstance, IN[3]=version.Version)  # IronPython2
# ---------- python_script.python (72 lines) ----------
import clr
clr.AddReference('RevitAPI')
from Autodesk.Revit.DB import *
import Autodesk

clr.AddReference("RevitServices")
import RevitServices
from RevitServices.Persistence import DocumentManager

search_cats = UnwrapElement(IN[0])
search_ids = []
names = []
vag = []
pgs = []
pts = []
uts = []
isvis = []
elems = []
guids = []
isinst = []

if not isinstance(IN[0], list): search_cats = [search_cats]
for search_cat in search_cats:
	search_ids.append(search_cat.Id.IntegerValue)
	names.append(list())
	vag.append(list())
	pgs.append(list())
	pts.append(list())
	uts.append(list())
	isvis.append(list())
	elems.append(list())
	guids.append(list())
	isinst.append(list())

inputdoc = UnwrapElement(IN[2])
if inputdoc == None:
	doc = DocumentManager.Instance.CurrentDBDocument
elif inputdoc.GetType().ToString() == "Autodesk.Revit.DB.RevitLinkInstance":
	doc = inputdoc.GetLinkDocument()
elif inputdoc.GetType().ToString() == "Autodesk.Revit.DB.Document":
	doc = inputdoc
else: doc = None
version = IN[3]

iterator = doc.ParameterBindings.ForwardIterator()
while iterator.MoveNext():
	for cat in iterator.Current.Categories:
		i = 0
		for search_id in search_ids:
			if cat.Id.IntegerValue == search_id:
				names[i].append(iterator.Key.Name)
				vag[i].append(iterator.Key.VariesAcrossGroups)
				if version > 2021: 
					pts[i].append(iterator.Key.GetDataType())
					uts[i].append(iterator.Key.GetDataType())
					pgs[i].append(iterator.Key.GetGroupTypeId())
				else: 
					pts[i].append(iterator.Key.ParameterType)
					uts[i].append(iterator.Key.UnitType)
					pgs[i].append(iterator.Key.ParameterGroup)
				isvis[i].append(iterator.Key.Visible)
				elem = doc.GetElement(iterator.Key.Id)
				elems[i].append(elem)
				if elem.GetType().ToString() == 'Autodesk.Revit.DB.SharedParameterElement':
					guids[i].append(elem.GuidValue)
				else: guids[i].append(None)
				if iterator.Current.GetType().ToString() == 'Autodesk.Revit.DB.InstanceBinding':
					isinst[i].append(True)
				else: isinst[i].append(False)
			i += 1
if isinstance(IN[0], list): OUT = (names, vag, pgs, pts, uts, isvis, elems, guids, isinst)
else: OUT = (names[0], vag[0], pgs[0], pts[0], uts[0], isvis[0], elems[0], guids[0], isinst[0])
# ----------------------------------------
code_block = CodeBlock(seq=python_script) { seq[0]; seq[1]; seq[2]; seq[3]; seq[4]; seq[5]; seq[6]; seq[7]; seq[8]; }
paramNames = Output(code_block.out0)
variesAcrossGroups = Output(code_block.out1)
parameterGroups = Output(code_block.out2)
parameterTypes = Output(code_block.out3)  # In Revit 2022+ will return the ForgeTypeId
unitTypes = Output(code_block.out4)  # In Revit 2022+ will return the SpecTypeId
isVisible = Output(code_block.out5)
GUIDs = Output(code_block.out7)
isInstanceParameter = Output(code_block.out8)
parameterElements = Output(code_block.out6)
