# Dynamo custom node Document.Schemas.dyf (Dynamo 2.3.0.5885)
# category: Clockwork.Revit.Application.Query
# Retrieves all ExtensibleStorage Schemas from the current document

toggle = Input(toggle: bool = true)
python_script = Python(IN[0]=toggle)
# ---------- python_script.python (9 lines) ----------
import clr
clr.AddReference('RevitAPI')
from Autodesk.Revit.DB import *

clr.AddReference("RevitNodes")
import Revit
clr.ImportExtensions(Revit.Elements)

OUT = ExtensibleStorage.Schema.ListSchemas()
# ----------------------------------------
schemas = Output(python_script)
