# Dynamo custom node Document.UnitTypes.dyf (Dynamo 2.12.1.8246)
# category: Clockwork.Revit.Application.Query
# Retrieves all available unit types of a given document (as of Revit 2022: ForgeTypeIds)

python_script = Python()  # CPython3
# ---------- python_script.python (6 lines) ----------
import clr
clr.AddReference('RevitAPI')
from Autodesk.Revit.DB import *
import Autodesk

OUT = UnitUtils.GetAllMeasurableSpecs(), [x.TypeId for x in UnitUtils.GetAllMeasurableSpecs()]
# ----------------------------------------
code_block = CodeBlock(seq=python_script) { seq[0]; seq[1]; }
unitTypes = Output(code_block.out0)
str = Output(code_block.out1)
