# Dynamo custom node Dynamo.Version.dyf (Dynamo 2.12.1.8246)
# category: Clockwork.Environment.Query
# Retrieves the version of the active Dynamo application

python_script = Python()  # CPython3; graph input
# ---------- python_script.python (9 lines) ----------
import clr
from System.Reflection import Assembly
from System.Diagnostics import Process
dynamoCore = Assembly.Load("DynamoCore")
version_long = dynamoCore.GetName().Version.ToString()
version_parts = version_long.split(".")
version_short = version_parts[0] + "." + version_parts[1] + "." + version_parts[2]
proc = Process.GetCurrentProcess().ProcessName
OUT = (version_short,version_long,proc)
# ----------------------------------------
code_block = CodeBlock(seq=python_script) { seq[0]; seq[1]; seq[2]; }
versionShort = Output(code_block.out0)
versionLong = Output(code_block.out1)
platform = Output(code_block.out2)
