# Dynamo custom node Element.AllInstancesAtLevel.dyf (Dynamo 2.12.1.8246)
# category: Clockwork.Revit.Elements.Query
# Retrieves all instances of an element on a given level

element = Input(element: var[]..[])
level = Input(level: Revit.Elements.Level)
python_script = Python(IN[0]=element, IN[1]=level)  # CPython3
# ---------- python_script.python (20 lines) ----------
import System
import clr
clr.AddReference('RevitAPI')
from Autodesk.Revit.DB import *

def GetAllInstancesAtLevel(item, lvl):
	collector = FilteredElementCollector(item.Document)
	bic = System.Enum.ToObject(BuiltInCategory, item.Category.Id.IntegerValue)
	lvlfilter = ElementLevelFilter(lvl.Id)
	collector.OfCategory(bic).WherePasses(lvlfilter)
	# This is a workaround
	# because I was too lazy to learn
	# how to implement LINQ in Python
	return [x for x in collector.ToElements() if x.GetTypeId().IntegerValue == item.GetTypeId().IntegerValue]

elements = UnwrapElement(IN[0])
lvl = UnwrapElement(IN[1])

if isinstance(IN[0], list): OUT = [GetAllInstancesAtLevel(x, lvl) for x in elements]
else: OUT = GetAllInstancesAtLevel(elements, lvl)
# ----------------------------------------
elements = Output(python_script)
