# Dynamo custom node Element.AllViewDependentInstances.dyf (Dynamo 2.12.1.8246)
# category: Clockwork.Revit.Elements.Query
# Retrieves all instances of a view-dependent element in a given view

element = Input(element: var[]..[])
view = Input(view: var)
python_script = Python(IN[0]=element, IN[1]=view)  # CPython3
# ---------- python_script.python (20 lines) ----------
import System
import clr
clr.AddReference('RevitAPI')
from Autodesk.Revit.DB import *

def GetAllInstancesInView(item, view):
	collector = FilteredElementCollector(item.Document)
	bic = System.Enum.ToObject(BuiltInCategory, item.Category.Id.IntegerValue)
	viewfilter = ElementOwnerViewFilter(view.Id)
	collector.WherePasses(viewfilter).OfCategory(bic)
	# This is a workaround
	# because I was too lazy to learn
	# how to implement LINQ in Python
	return [x for x in collector.ToElements() if x.GetTypeId().IntegerValue == item.GetTypeId().IntegerValue]

elements = UnwrapElement(IN[0])
view = UnwrapElement(IN[1])

if isinstance(IN[0], list): OUT = [GetAllInstancesInView(x, view) for x in elements]
else: OUT = GetAllInstancesInView(elements, view)
# ----------------------------------------
elements = Output(python_script)
