# Dynamo custom node Element.Assembly.dyf (Dynamo 2.12.1.8246)
# category: Clockwork.Revit.Elements.Query
# Retrieves the assembly an element belongs to (if any)

element = Input(element: var[]..[])
python_script = Python(IN[0]=element)  # IronPython2
# ---------- python_script.python (12 lines) ----------
import clr
clr.AddReference('RevitAPI')
from Autodesk.Revit.DB import *

def GetAssembly(item):
	if hasattr(item, "AssemblyInstanceId"): return item.Document.GetElement(item.AssemblyInstanceId)
	else: return None

items = UnwrapElement(IN[0])

if isinstance(IN[0], list): OUT = [GetAssembly(x) for x in items]
else: OUT = GetAssembly(items)
# ----------------------------------------
assembly = Output(python_script)
