# Dynamo custom node Element.ContainsTransparentMaterials.dyf (Dynamo 2.0.1.5055)
# category: Clockwork.Revit.Elements.Query
# Checks if a given element contains transparent materials.

element = Input(element: var[]..[])
boolean = BoolSelector(false)  # graph input
materials = Custom[Element.Materials+](element=element, returnPaintMaterials=boolean)  # Retrieves all materials froma given element
transparency = Material.Transparency(material=materials.materials)
minTransparencyPercentage = Input(minTransparencyPercentage: double)
code_block = CodeBlock(x=transparency, y=minTransparencyPercentage) { x >= y; }
anyTrue = Custom[Booleans.AnyTrue](seq=code_block)  # Returns true if any item in a list of booleans is true.
returnListOrSingleValue = Custom[ReturnListOrSingleValue](unknownItem=element, seq=anyTrue)  # If the unknown item is not a list but rather a single item, only the first item of the list (input "seq") will be returned.
bool = Output(returnListOrSingleValue)
