# Dynamo custom node Element.IsRelatedToMass.dyf (Dynamo 2.12.1.8246)
# category: Clockwork.Revit.Elements.Query
# Returns true if an object (wall, roof, floor or curtain system) has been modelled by face and the underlying mass still exists in the project.

element = Input(element: var[]..[])
python_script = Python(IN[0]=element)  # CPython3
# ---------- python_script.python (15 lines) ----------
import clr
clr.AddReference('RevitAPI')
from Autodesk.Revit.DB import *

def IsRelatedToMass(item):
	try:
		if item.get_Parameter(BuiltInParameter.RELATED_TO_MASS).AsInteger() == 1:
			return True
		else: return False
	except: return False

items = UnwrapElement(IN[0])

if isinstance(IN[0], list): OUT = [IsRelatedToMass(x) for x in items]
else: OUT = IsRelatedToMass(items)
# ----------------------------------------
bool = Output(python_script)
