# Dynamo custom node Element.Panels.dyf (Dynamo 3.4.1.7055)
# category: Clockwork.Revit.Elements.Query
# Retrieves the panels nested in a curtain wall, curtain system or glazed roof.
# Differences to OOTB node CurtainPanel.ByElement:
# - Will not fail if curtain wall contains doors or windows
# - Returns embedded walls
# - Panels of curtain systems and glazed roofs are returned in a nested list, with one sublist for each face of the curtain system.
# PLEASE NOTE: Will not work for glazed roofs created by RoofByFace method.

hostElement = Input(hostElement: var[]..[])
organizeInRows = Input(organizeInRows: bool = false)
version = Custom[Application.Version]()  # Retrieves the name, version and build of the current Revit application.
python_script = Python(IN[0]=hostElement, IN[1]=organizeInRows, IN[2]=version.Version)  # CPython3
# ---------- python_script.python (53 lines) ----------
import clr
clr.AddReference('RevitAPI')
from Autodesk.Revit.DB import *

clr.AddReference("RevitNodes")
import Revit
clr.ImportExtensions(Revit.Elements)

def GetCurtainPanels(host):
    if hasattr(host, "CurtainGrid"):
        return GetCurtainPanelsByGrid(host.CurtainGrid, host)
    elif hasattr(host, "CurtainGrids"):
        return [GetCurtainPanelsByGrid(x, host) for x in host.CurtainGrids]
    else: return []

def GetCurtainPanelsByGrid(grid, host):
    if grid:
        if organizeInRows:
            uGrids = [ElementId.InvalidElementId]
            [uGrids.append(x) for x in grid.GetUGridLineIds()]
            vGrids = [ElementId.InvalidElementId]
            [vGrids.append(x) for x in grid.GetVGridLineIds()]
            panels = []
            for u in uGrids:
                row = []
                for v in vGrids:
                    panel = grid.GetPanel(u,v)
                    if hasattr(panel, "FindHostPanel"):
                        hostpanelid = panel.FindHostPanel()
                        if version > 2024: hpid = hostpanelid.Value
                        else: hpid = hostpanelid.IntegerValue
                        if hpid != -1: panel = host.Document.GetElement(hostpanelid)
                    row.append(panel)
                panels.append(row)
            return panels
        else:
            panellist = [host.Document.GetElement(x) for x in grid.GetPanelIds()]
            for panel in panellist:
                if hasattr(panel, "FindHostPanel"):
                    hostpanelid = panel.FindHostPanel()
                    if version > 2024: hpid = hostpanelid.Value
                    else: hpid = hostpanelid.IntegerValue
                    if hpid != -1:
                        panellist[panellist.index(panel)] = host.Document.GetElement(hostpanelid)
            return [x.ToDSType(True) for x in panellist]
    else: return list()

items = UnwrapElement(IN[0])
organizeInRows = IN[1]
version = IN[2]

if isinstance(IN[0], list): OUT = [GetCurtainPanels(x) for x in items]
else: OUT = GetCurtainPanels(items)
# ----------------------------------------
panels = Output(python_script)
