# Dynamo custom node Element.Workset.dyf (Dynamo 2.0.1.5055)
# category: Clockwork.Revit.Elements.Query
# Retrieves the workset of a given element

element = Input(element: var[]..[])
python_script = Python(IN[0]=element)
# ---------- python_script.python (12 lines) ----------
import clr
clr.AddReference('RevitAPI')
from Autodesk.Revit.DB import *

def GetWorkset(item):
	if hasattr(item, "WorksetId"): return item.Document.GetWorksetTable().GetWorkset(item.WorksetId)
	else: return None

items = UnwrapElement(IN[0])

if isinstance(IN[0], list): OUT = [GetWorkset(x) for x in items]
else: OUT = GetWorkset(items)
# ----------------------------------------
workset = Output(python_script)
