# Dynamo custom node Elements.FilterByParameterValueAndCondition.dyf (Dynamo 2.0.1.5055)
# category: Clockwork.Revit.Selection.Filters.Actions
# Retrieves those elements from a collection whose parameter value matches the defined condition

elements = Input(elements: var[]..[])
param = Input(param: string)
parameterExists = Custom[Element.ParameterExists](param=param)  # Checks if an element contains a parameter of a given name; unwired: element
filter = List.Filter(list=elements, condition=parameterExists)
getParameterValueByName = Element.GetParameterValueByName(element=filter.in, parameterName=param)
func = Input(func: var[]..[])
map = List.Map(list=getParameterValueByName, f_x=func)
filterByBoolMask = List.FilterByBoolMask(list=filter.in, mask=map)
in_ = Output(filterByBoolMask.in)  # "in"
join = List.Join(list0=filter.out, list1=filterByBoolMask.out)
out = Output(join)
