# Dynamo custom node Family.HasRoomCalculationPoint.dyf (Dynamo 2.12.1.8246)
# category: Clockwork.Revit.Elements.Query
# Determines whether the given family has the room calculation point activated.

family = Input(family: Revit.Elements.Family[]..[])
python_script = Python(IN[0]=family)  # CPython3
# ---------- python_script.python (13 lines) ----------
import clr
clr.AddReference('RevitAPI')
from Autodesk.Revit.DB import *

def HasRCP(fam):
	if fam.GetType().ToString() == "Autodesk.Revit.DB.Family":
		return fam.get_Parameter(BuiltInParameter.ROOM_CALCULATION_POINT).AsInteger() == 1
	else: return False

fams = UnwrapElement(IN[0])

if isinstance(IN[0], list): OUT = [HasRCP(x) for x in fams]
else: OUT = HasRCP(fams)
# ----------------------------------------
bool = Output(python_script)
