# Dynamo custom node Family.Types+.dyf (Dynamo 2.12.1.8246)
# category: Clockwork.Revit.Elements.Query
# Returns all family types of a family. Unlike the OOTB node, it also works with families in linked documents.

family = Input(family: Revit.Elements.Family)
python_script = Python(IN[0]=family)  # CPython3
# ---------- python_script.python (13 lines) ----------
import clr
clr.AddReference('RevitAPI')
from Autodesk.Revit.DB import *

def GetFamilyTypes(fam):
	if hasattr(fam, "IsInPlace"):
		return [fam.Document.GetElement(x) for x in fam.GetFamilySymbolIds()]
	else: return []

items = UnwrapElement(IN[0])

if isinstance(IN[0], list): OUT = [GetFamilyTypes(x) for x in items]
else: OUT = GetFamilyTypes(items)
# ----------------------------------------
familyTypes = Output(python_script)
