# Dynamo custom node FamilyDocument.CurrentFamilyType.dyf (Dynamo 2.12.1.8246)
# category: Clockwork.Revit.Application.Query
# Retrieves the current family type from the active family document. PLEASE NOTE: This node will only work in a family document!

toggle = Input(toggle: bool = true)
python_script = Python(IN[0]=toggle)  # CPython3
# ---------- python_script.python (12 lines) ----------
import clr
clr.AddReference('RevitAPI')
from Autodesk.Revit.DB import *

clr.AddReference("RevitServices")
import RevitServices
from RevitServices.Persistence import DocumentManager

doc = DocumentManager.Instance.CurrentDBDocument
if doc.IsFamilyDocument:
	OUT = doc.FamilyManager.CurrentType
else: OUT = None
# ----------------------------------------
familyType = Output(python_script)
