# Dynamo custom node FamilyDocument.Properties.dyf (Dynamo 2.12.1.8246)
# category: Clockwork.Revit.Application.Query
# Retrieves all the properties of the current family document (i.e. parameters that you would access in the UI via the Family Category & Parameters tool).

toggle = Input(toggle: bool = true)
python_script = Python(IN[0]=toggle)  # CPython3
# ---------- python_script.python (11 lines) ----------
import clr
clr.AddReference('RevitAPI')
from Autodesk.Revit.DB import *

clr.AddReference("RevitServices")
import RevitServices
from RevitServices.Persistence import DocumentManager

doc = DocumentManager.Instance.CurrentDBDocument
if doc.IsFamilyDocument: OUT = doc.OwnerFamily
else: OUT = []
# ----------------------------------------
parameters = Element.Parameters(element=python_script)
familyParameters = Output(parameters)
