# Dynamo custom node FamilyInstance.FlipFromToRoom.dyf (Dynamo 2.12.1.8246)
# category: Clockwork.Revit.Elements.Actions
# Flips the settings of "From Room" and "To Room" for any given door or window instance. PLEASE NOTE: Will not work on door or window families with an activated room calculation point.

familyInstance = Input(familyInstance: Revit.Elements.FamilyInstance)
turnIntoList = Custom[TurnIntoList](unknownItem=familyInstance)  # Turns an element (or a nested list) into a flat list
python_script = Python(IN[0]=turnIntoList)  # CPython3
# ---------- python_script.python (23 lines) ----------
import clr
clr.AddReference('RevitAPI')
from Autodesk.Revit.DB import *

clr.AddReference("RevitServices")
import RevitServices
from RevitServices.Persistence import DocumentManager
from RevitServices.Transactions import TransactionManager

doc = DocumentManager.Instance.CurrentDBDocument
faminstances = UnwrapElement(IN[0])
booleans = []

TransactionManager.Instance.EnsureInTransaction(doc)
for item in faminstances:
    try:
        item.FlipFromToRoom()
        booleans.append(True)
    except:
        booleans.append(False)
TransactionManager.Instance.TransactionTaskDone()

OUT = (faminstances,booleans)
# ----------------------------------------
code_block = CodeBlock(seq=python_script) { seq[0]; seq[1]; }
returnListOrSingleValue = Custom[ReturnListOrSingleValue](unknownItem=familyInstance, seq=code_block.out0)  # If the unknown item is not a list but rather a single item, only the first item of the list (input "seq") will be returned.
familyInstance_2 = Output(returnListOrSingleValue)  # "familyInstance"
returnListOrSingleValue_2 = Custom[ReturnListOrSingleValue](unknownItem=familyInstance, seq=code_block.out1)
success = Output(returnListOrSingleValue_2)
