# Dynamo custom node FamilyInstance.HandOrientation.dyf (Dynamo 2.12.1.8246)
# category: Clockwork.Revit.Elements.Query
# Gets the hand orientation of a hosted object (e.g. a window or a door)

familyInstance = Input(familyInstance: var[]..[])
python_script = Python(IN[0]=familyInstance)  # IronPython2
# ---------- python_script.python (17 lines) ----------
import clr
clr.AddReference('RevitAPI')
from Autodesk.Revit.DB import *

clr.AddReference("RevitNodes")
import Revit
clr.ImportExtensions(Revit.Elements)
clr.ImportExtensions(Revit.GeometryConversion)

def GetHandOrientation(item):
	if hasattr(item, "HandOrientation"): return item.HandOrientation.ToVector()
	else: return None

items = UnwrapElement(IN[0])

if isinstance(IN[0], list): OUT = [GetHandOrientation(x) for x in items]
else: OUT = GetHandOrientation(items)
# ----------------------------------------
vector = Output(python_script)
