# Dynamo custom node FamilyType.CompoundStructureLayers.dyf (Dynamo 2.12.1.8246)
# category: Clockwork.Revit.Elements.Query
# Retrieves the compound layers of any layered family type (wall types, roof types, floor types etc.)

elementType = Input(elementType: var[]..[])
version = Custom[Application.Version]()  # Retrieves the name, version and build of the current Revit application.
python_script = Python(IN[0]=elementType, IN[1]=version.Version)  # IronPython2
# ---------- python_script.python (58 lines) ----------
import clr
clr.AddReference('RevitAPI')
from Autodesk.Revit.DB import *

clr.AddReference("RevitNodes")
import Revit
clr.ImportExtensions(Revit.Elements)

clr.AddReference("RevitServices")
import RevitServices
from RevitServices.Persistence import DocumentManager
doc = DocumentManager.Instance.CurrentDBDocument

items = UnwrapElement(IN[0])
version = IN[1]
if version > 2021: unittype = ForgeTypeId('autodesk.spec.aec:length-2.0.0')
else: unittype = UnitType.UT_Length

def InternalUnitToDisplayUnit(val, unittype):
	formatoptions = doc.GetUnits().GetFormatOptions(unittype)
	if version > 2021: dispunits = formatoptions.GetUnitTypeId()
	else: dispunits = formatoptions.DisplayUnits
	try: return UnitUtils.ConvertFromInternalUnits(val,dispunits)
	except: return None

def GetCompoundStructureLayers(item):
	layers = []
	layermat = []
	layerfunc = []
	layerwidth = []
	layercore = []
	layerwraps = []
	layervar = []
	layerdeck = []	
	try:
		if hasattr(item, "GetCompoundStructure"):
			compstruc = item.GetCompoundStructure()
			vertcomp = compstruc.IsVerticallyCompound
			varlayer = compstruc.VariableLayerIndex
			num = compstruc.LayerCount
			counter = 0
			while counter < num:
				layers.append(compstruc.GetLayers()[counter])
				layermat.append(item.Document.GetElement(compstruc.GetMaterialId(counter)))
				layerfunc.append(compstruc.GetLayerFunction(counter))
				layerwidth.append(InternalUnitToDisplayUnit(compstruc.GetLayerWidth(counter), unittype))
				layercore.append(compstruc.IsCoreLayer(counter))
				if compstruc.IsCoreLayer(counter): layerwraps.append(False)
				else: layerwraps.append(compstruc.ParticipatesInWrapping(counter))
				if varlayer == counter: layervar.append(True)
				else: layervar.append(False)
				layerdeck.append(compstruc.IsStructuralDeck(counter))
				counter += 1
	except: pass
	return layers, layermat, layerfunc, layerwidth, layercore, layerwraps, layervar, layerdeck

if isinstance(IN[0], list): OUT = map(list, zip(*[GetCompoundStructureLayers(x) for x in items]))
else: OUT = GetCompoundStructureLayers(items)
# ----------------------------------------
code_block = CodeBlock(seq=python_script)
# ---------- code_block.designscript (16 lines) ----------
// Layers
seq[0];
// Materials
seq[1];
// Functions
seq[2];
// Widths
seq[3];
// Is core layer
seq[4];
// Wraps
seq[5];
// Is variable
seq[6];
// Is structural deck
seq[7];
# ----------------------------------------
materials = Output(code_block.out1)
functions = Output(code_block.out2)
widths = Output(code_block.out3)
isCore = Output(code_block.out4)
wraps = Output(code_block.out5)
isVariable = Output(code_block.out6)
isStructuralDeck = Output(code_block.out7)
layers = Output(code_block.out0)
