# Dynamo custom node FilledRegionType.FillPatterns.dyf (Dynamo 3.4.1.7055)
# category: Clockwork.Revit.Elements.Query
# Returns the fill pattern(s) of a given filled region type. In Revit versions prior to 2019 the background fill pattern will always return Null.
# packages: Clockwork for Dynamo 2.x 2.12.2

filledRegionType = Input(filledRegionType: Revit.Elements.FilledRegionType[]..[])
version = Custom[Application.Version]()  # package Clockwork for Dynamo 2.x; Retrieves the name, version and build of the current Revit application.
python_script = Python(IN[0]=filledRegionType, IN[1]=version.Version)  # CPython3
# ---------- python_script.python (25 lines) ----------
import clr
clr.AddReference('RevitAPI')
from Autodesk.Revit.DB import *

def GetFillPatterns(frt):
    foreground = None
    background = None
    if hasattr(frt, "ForegroundPatternId"):
        if version > 2024:
            if frt.ForegroundPatternId.Value > 0:
                foreground = frt.Document.GetElement(frt.ForegroundPatternId)
            if frt.BackgroundPatternId.Value > 0:
                background = frt.Document.GetElement(frt.BackgroundPatternId)
        else:
            if frt.ForegroundPatternId.IntegerValue > 0:
                foreground = frt.Document.GetElement(frt.ForegroundPatternId)
            if frt.BackgroundPatternId.IntegerValue > 0:
                background = frt.Document.GetElement(frt.BackgroundPatternId)
    return foreground, background

filledregiontypes = UnwrapElement(IN[0])
version = IN[1]

if isinstance(IN[0], list): OUT = list(map(list, zip(*[GetFillPatterns(x) for x in filledregiontypes])))
else: OUT = GetFillPatterns(filledregiontypes)
# ----------------------------------------
firstItem = List.FirstItem(list=python_script)
foregroundFillPattern = Output(firstItem)
lastItem = List.LastItem(list=python_script)
backgroundFillPattern = Output(lastItem)
