# Dynamo custom node GenericForm.IsSolid.dyf (Dynamo 2.12.1.8246)
# category: Clockwork.Revit.Elements.Query
# Checks if a form element in a family is a solid or a void. Will return Null for any other elements.

GenericForm = Input(GenericForm: var[]..[])
python_script = Python(IN[0]=GenericForm)  # CPython3
# ---------- python_script.python (11 lines) ----------
import clr
clr.AddReference('RevitAPI')
from Autodesk.Revit.DB import *

def CheckIfSolid(item):
	if hasattr(item, "IsSolid"): return item.IsSolid
	else: return None

items = UnwrapElement(IN[0])
if isinstance(IN[0], list): OUT = [CheckIfSolid(x) for x in items]
else: OUT = CheckIfSolid(items)
# ----------------------------------------
bool = Output(python_script)
