# Dynamo custom node Geometry.FurthestFrom.dyf (Dynamo 2.0.1.5055)
# category: Clockwork.Geometry.Modifiers.Query
# Finds the furthest entity in a list of geometric entities from another given entity

geometry = Input(geometry: Autodesk.DesignScript.Geometry.Geometry[])
other = Input(other: Autodesk.DesignScript.Geometry.Geometry)
distanceTo = Geometry.DistanceTo(geometry=geometry, other=other)
maximumItem = List.MaximumItem(list=distanceTo)
code_block = CodeBlock(a=distanceTo, b=maximumItem) { a == b; }
filterByBoolMask = List.FilterByBoolMask(list=geometry, mask=code_block)
FurthestObject = Output(filterByBoolMask.in)
