# Dynamo custom node GlobalParameter.AffectedElements.dyf (Dynamo 2.12.1.8246)
# category: Clockwork.Revit.Elements.Query
# Returns the elements that have a parameter driven by the given global parameter

globalParam = Input(globalParam: Revit.Elements.GlobalParameter[]..[])
python_script = Python(IN[0]=globalParam)  # CPython3
# ---------- python_script.python (22 lines) ----------
import clr
import System
clr.AddReference('RevitAPI')
from Autodesk.Revit.DB import *

clr.AddReference("RevitNodes")
import Revit
clr.ImportExtensions(Revit.Elements)

def GetAffectedElements(gp):
	if hasattr(gp, "GetAffectedElements"): 
		affected = []
		affected.extend([gp.Document.GetElement(x) for x in gp.GetAffectedElements()])
		affected.extend([gp.Document.GetElement(x) for x in gp.GetAffectedGlobalParameters()])
		affected.extend([gp.Document.GetElement(x) for x in gp.GetLabeledDimensions()])
		return affected
	else: return []

items = UnwrapElement(IN[0])

if isinstance(IN[0], list): OUT = [GetAffectedElements(x) for x in items]
else: OUT = GetAffectedElements(items)
# ----------------------------------------
elements = Output(python_script)
