# Dynamo custom node Level.Views.dyf (Dynamo 2.0.1.5055)
# category: Clockwork.Revit.Elements.Query
# Returns all views associated with a given level

version = Custom[Application.Version]()  # Retrieves the name, version and build of the current Revit application.
code_block = CodeBlock(v=version.Version) { v > 2017; }
level = Input(level: Revit.Elements.Level)
turnIntoList = Custom[TurnIntoList](unknownItem=level)  # Turns an element (or a nested list) into a flat list
python_script = Python(IN[0]=turnIntoList, IN[1]=version.Version)
# ---------- python_script.python (23 lines) ----------
import clr
clr.AddReference('RevitAPI')
from Autodesk.Revit.DB import *

clr.AddReference("RevitNodes")
import Revit
clr.ImportExtensions(Revit.Elements)

levels = UnwrapElement(IN[0])
version = IN[1]
elementlist = list()
for lvl in levels:
	if version > 2017:
		try:
			if lvl.Document.GetElement(lvl.FindAssociatedPlanViewId()) == None:
				elementlist.append(None)
			else:
				elementlist.append(lvl.Document.GetElement(lvl.FindAssociatedPlanViewId()))
		except:
			elementlist.append(None)
	else:
		elementlist.append(None)
OUT = elementlist
# ----------------------------------------
returnListOrSingleValue = Custom[ReturnListOrSingleValue](unknownItem=level, seq=python_script)  # If the unknown item is not a list but rather a single item, only the first item of the list (input "seq") will be returned.
toggleToRefresh = Input(toggleToRefresh: bool = true)
views = Custom[Document.Views](toggle=toggleToRefresh)  # Gets all views in the document - except for 3D view templates (as long as this bug is not fixed: https://github.com/DynamoDS/Dynamo/issues/2970)
level_2 = Custom[Element.Level](element=views)  # Gets an element's level
isNull = Object.IsNull(obj=level_2)
filterByBoolMask = List.FilterByBoolMask(list=views, mask=isNull)
filterByBoolMask_2 = List.FilterByBoolMask(list=level_2, mask=isNull)
id = Element.Id(element=filterByBoolMask_2.out)
id_2 = Element.Id(element=level)
eq = id == id_2
filterByBoolMask_3 = List.FilterByBoolMask(list=filterByBoolMask.out, mask=eq)
firstItem = List.FirstItem(list=filterByBoolMask_3.in)
scopeIf = Custom[ScopeIf+](test=code_block, true=returnListOrSingleValue, false=firstItem)  # A (hopefully) more robust implementation of ScopeIf. Tests a single boolean and returns a value accordingly.
firstView = Output(scopeIf)
allViews = Output(filterByBoolMask_3.in)
