# Dynamo custom node List.EqualSublistLengths.dyf (Dynamo 2.0.1.5055)
# category: Clockwork.List.Match.Actions
# Trims all given lists to the length of the shortest list

lists = Input(lists: var[]..[])
count = List.Count(list=lists@L2)
minimumItem = List.MinimumItem(list=count)
takeItems = List.TakeItems(list=lists@L2, amount=minimumItem)
lists_2 = Output(takeItems)  # "lists"
