# Dynamo custom node List.MatchWithKeyValues.dyf (Dynamo 2.12.1.8246)
# category: Clockwork.List.Organize.Actions
# Matches a list with a given set of keys and returns the values corresponding to the keys

seq = Input(seq: var[]..[])
turnIntoList = Custom[TurnIntoList](unknownItem=seq)  # Turns an element (or a nested list) into a flat list
keys = Input(keys: var[]..[])
turnIntoList_2 = Custom[TurnIntoList](unknownItem=keys)
values = Input(values: var[]..[])
turnIntoList_3 = Custom[TurnIntoList](unknownItem=values)
python_script = Python(IN[0]=turnIntoList, IN[1]=turnIntoList_2, IN[2]=turnIntoList_3)  # CPython3
# ---------- python_script.python (17 lines) ----------
import clr

items = IN[0]
keys = IN[1]
values = IN[2]
elementlist = list()
for item in items:
	counter = 0
	hasmatch = False
	for key in keys:
		if (item == key):
			elementlist.append(values[counter])
			hasmatch = True
		counter += 1
	if hasmatch == False:
		elementlist.append(None)
OUT = elementlist
# ----------------------------------------
seq_2 = Output(python_script)  # "seq"
