# Dynamo custom node Mesh.FaceVertices.dyf (Dynamo 2.0.1.5055)
# category: Clockwork.Geometry.Meshes.Query
# Gets the vertices of each face of a given mesh

mesh = Input(mesh: Autodesk.DesignScript.Geometry.Mesh)
vertexPositions = Mesh.VertexPositions(mesh=mesh)
faceIndices = Mesh.FaceIndices(mesh=mesh)
A = IndexGroup.A(indexGroup=faceIndices)
getItemAtIndex = List.GetItemAtIndex(list=vertexPositions, index=A)
B = IndexGroup.B(indexGroup=faceIndices)
getItemAtIndex_2 = List.GetItemAtIndex(list=vertexPositions, index=B)
C = IndexGroup.C(indexGroup=faceIndices)
getItemAtIndex_3 = List.GetItemAtIndex(list=vertexPositions, index=C)
create = List.Create(item0=getItemAtIndex, item1=getItemAtIndex_2, item2=getItemAtIndex_3)
transpose = List.Transpose(lists=create)
vertices = Output(transpose)
