# Dynamo custom node ModelCurve.Type.dyf (Dynamo 2.12.1.8246)
# category: Clockwork.Revit.Elements.Query
# Gets the type of a given model curve

modelCurve = Input(modelCurve: var[]..[])
python_script = Python(IN[0]=modelCurve)  # CPython3
# ---------- python_script.python (13 lines) ----------
import clr
clr.AddReference('RevitAPI')
from Autodesk.Revit.DB import *
import System

def GetCurveType(item):
	if hasattr(item, "CurveElementType"): return System.Enum.GetName(CurveElementType, item.CurveElementType)
	else: return None

items = UnwrapElement(IN[0])

if isinstance(IN[0], list): OUT = [GetCurveType(x) for x in items]
else: OUT = GetCurveType(items)
# ----------------------------------------
type = Output(python_script)
