# Dynamo custom node ParameterFilterElement.Parameters.dyf (Dynamo 3.4.1.7055)
# category: Clockwork.Revit.Elements.Query
# Retrieves the names of all parameters used in a given ParameterFilterElement (aka view filters)

parameterFilterElement = Input(parameterFilterElement: Revit.Filter.ParameterFilterElement[]..[])
version = Custom[Application.Version]()  # Retrieves the name, version and build of the current Revit application.
python_script = Python(IN[0]=parameterFilterElement, IN[1]=version.Version)  # CPython3
# ---------- python_script.python (36 lines) ----------
import clr
import System
clr.AddReference('RevitAPI')
from Autodesk.Revit.DB import *

clr.AddReference("RevitNodes")
import Revit
clr.ImportExtensions(Revit.Elements)

items = UnwrapElement(IN[0])
version = IN[1]
bips = {}
for bip in [eval("BuiltInParameter."+x) for x in dir(BuiltInParameter) if not any(y.islower() for y in x)]:
    try: 
        if version > 2024: bips[ElementId(bip).Value] = LabelUtils.GetLabelFor(bip)
        else: bips[ElementId(bip).IntegerValue] = LabelUtils.GetLabelFor(bip)
    except: pass
        
def GetFilterRuleParams(efilter, doc):
    params = []
    if efilter:
        for filter in efilter.GetFilters():
            if hasattr(filter, "GetRules"):
                for rule in filter.GetRules():
                    paramId = rule.GetRuleParameter()
                    thisparam = doc.GetElement(paramId)
                    if thisparam: thisparam = thisparam.Name
                    elif paramId != ElementId.InvalidElementId: 
                        if version > 2024: thisparam = bips[paramId.Value]
                        else: thisparam = bips[paramId.IntegerValue]
                    params.append(thisparam.strip())
            else: params.append(GetFilterRuleParams(filter, doc))
    return params

if isinstance(IN[0], list): OUT = [GetFilterRuleParams(x.GetElementFilter(), x.Document) for x in items]
else: OUT = GetFilterRuleParams(items.GetElementFilter(), items.Document)
# ----------------------------------------
str = Output(python_script)
