# Dynamo custom node PlanView.Underlay.dyf (Dynamo 2.12.1.8246)
# category: Clockwork.Revit.Views.Query
# Returns the underlay(s) of a given plan view

planView = Input(planView: var[]..[])
python_script = Python(IN[0]=planView)  # CPython3
# ---------- python_script.python (19 lines) ----------
import clr
clr.AddReference('RevitAPI')
from Autodesk.Revit.DB import *
import System

def GetUnderlays(view):
	baselvl = None
	toplvl = None
	ulOrientation = None
	if hasattr(view, "GetUnderlayBaseLevel"):	
		if view.GetUnderlayBaseLevel().IntegerValue > 0: baselvl = view.Document.GetElement(view.GetUnderlayBaseLevel())
		if view.GetUnderlayTopLevel().IntegerValue > 0: toplvl = view.Document.GetElement(view.GetUnderlayTopLevel())
		ulOrientation = System.Enum.GetName(UnderlayOrientation, view.GetUnderlayOrientation())
	return baselvl, toplvl, ulOrientation

views = UnwrapElement(IN[0])

if isinstance(IN[0], list): OUT = map(list, zip(*[GetUnderlays(x) for x in views]))
else: OUT = GetUnderlays(views)
# ----------------------------------------
code_block = CodeBlock(seq=python_script) { seq[0]; seq[1]; seq[2]; }
baseUnderlay = Output(code_block.out0)
topUnderlay = Output(code_block.out1)
underlayOrientation = Output(code_block.out2)
