# Dynamo custom node RevitFace.FromDynamoSurface.dyf (Dynamo 2.12.1.8246)
# category: Clockwork.Revit.Selection.ByFace.Query
# Returns the underlying Revit face of a given surface

DynamoSurface = Input(DynamoSurface: Autodesk.DesignScript.Geometry.Surface[]..[])
python_script = Python(IN[0]=DynamoSurface)  # IronPython2
# ---------- python_script.python (19 lines) ----------
import clr
clr.AddReference('RevitAPI')
from Autodesk.Revit.DB import *

clr.AddReference("RevitServices")
import RevitServices
from RevitServices.Persistence import DocumentManager

def RevitFaceFromDynamoFace(dface):
	try:
		ref = dface.Tags.LookupTag("RevitFaceReference")
		return doc.GetElement(ref).GetGeometryObjectFromReference(ref)
	except: return None

doc = DocumentManager.Instance.CurrentDBDocument
faces = UnwrapElement(IN[0])

if isinstance(IN[0], list): OUT = [RevitFaceFromDynamoFace(x) for x in faces]
else: OUT = RevitFaceFromDynamoFace(faces)
# ----------------------------------------
RevitFace = Output(python_script)
