# Dynamo custom node RevitLinkType.AttachmentType.dyf (Dynamo 2.12.1.8246)
# category: Clockwork.Revit.Elements.Query
# Returns the attachment type of a RevitLInkType

revitLinkType = Input(revitLinkType: var[]..[])
python_script = Python(IN[0]=revitLinkType)  # CPython3
# ---------- python_script.python (13 lines) ----------
import clr
clr.AddReference('RevitAPI')
from Autodesk.Revit.DB import *
import System

links = UnwrapElement(IN[0])

def GetAttachmentType(link):
	if hasattr(link, "AttachmentType"): return System.Enum.GetName(AttachmentType, link.AttachmentType)
	else: return None

if isinstance(IN[0], list): OUT = [GetAttachmentType(x) for x in links]
else: OUT = GetAttachmentType(links)
# ----------------------------------------
str = Output(python_script)
