# Dynamo custom node RevitLinkType.PathType.dyf (Dynamo 2.12.1.8246)
# category: Clockwork.Revit.Elements.Query
# Returns the path type of a RevitLInkType

revitLinkType = Input(revitLinkType: var[]..[])
python_script = Python(IN[0]=revitLinkType)  # CPython3
# ---------- python_script.python (13 lines) ----------
import clr
clr.AddReference('RevitAPI')
from Autodesk.Revit.DB import *
import System

links = UnwrapElement(IN[0])

def GetPathType(link):
	if hasattr(link, "PathType"): return System.Enum.GetName(PathType, link.PathType)
	else: return None

if isinstance(IN[0], list): OUT = [GetPathType(x) for x in links]
else: OUT = GetPathType(links)
# ----------------------------------------
str = Output(python_script)
