# Dynamo custom node Room.UnplacedByNameAndNumber.dyf (Dynamo 2.0.1.5055)
# category: Clockwork.Revit.Elements.Create
# Creates an unplaced room

names = Input(names: string[])
numbers = Input(numbers: string[])
phase = Input(phase: var = null)  # If no phase is specified, the node will use the last phase in the project
isNull = Object.IsNull(obj=phase)
phases = Custom[Document.Phases]()  # Retrieves all phases in the active document in *chronological* order
lastItem = List.LastItem(list=phases)
scopeIf = Custom[ScopeIf+](test=isNull, true=lastItem, false=phase)  # A (hopefully) more robust implementation of ScopeIf. Tests a single boolean and returns a value accordingly.
python_script = Python(IN[0]=names, IN[1]=numbers, IN[2]=scopeIf)
# ---------- python_script.python (24 lines) ----------
import clr
clr.AddReference('RevitAPI')
from Autodesk.Revit.DB import *

clr.AddReference("RevitServices")
import RevitServices
from RevitServices.Persistence import DocumentManager
from RevitServices.Transactions import TransactionManager

def CreateUnplacedRoom(name, number, phase, doc):
	try:
		newroom = doc.Create.NewRoom(phase)
		newroom.Name = name
		newroom.Number = number
		return newroom
	except: return None

doc = DocumentManager.Instance.CurrentDBDocument
phase = UnwrapElement(IN[2])

TransactionManager.Instance.EnsureInTransaction(doc)
if isinstance(IN[0], list) and isinstance(IN[1], list): OUT = [CreateUnplacedRoom(x, y, phase, doc) for x, y in zip(IN[0], IN[1])]
else: OUT = None
TransactionManager.Instance.TransactionTaskDone()
# ----------------------------------------
room = Output(python_script)
