# Dynamo custom node RoomTag.IsInRoom.dyf (Dynamo 2.12.1.8246)
# category: Clockwork.Revit.Elements.Query
# Checks if a room tag is located within the boundaries of the room it is tagging

roomTag = Input(roomTag: var[]..[])
python_script = Python(IN[0]=roomTag)  # IronPython2
# ---------- python_script.python (22 lines) ----------
import clr
clr.AddReference('RevitAPI')
from Autodesk.Revit.DB import *
import Autodesk

clr.AddReference("RevitNodes")
import Revit
clr.ImportExtensions(Revit.GeometryConversion)

clr.AddReference("RevitServices")
import RevitServices
from RevitServices.Persistence import DocumentManager

def TagIsInRoom(tag):
	if hasattr(tag, "IsInRoom"): return tag.IsInRoom
	else: return False

doc = DocumentManager.Instance.CurrentDBDocument
roomtags = UnwrapElement(IN[0])

if isinstance(IN[0], list): OUT = [TagIsInRoom(x) for x in roomtags]
else: OUT = TagIsInRoom(roomtags)
# ----------------------------------------
bool = Output(python_script)
