# Dynamo custom node RoomTag.Room.dyf (Dynamo 3.4.1.7055)
# category: Clockwork.Revit.Elements.Query
# Returns the room of a given room tag

roomTag = Input(roomTag: var[]..[])
python_script = Python(IN[0]=roomTag)  # CPython3
# ---------- python_script.python (29 lines) ----------
import clr
clr.AddReference('RevitAPI')
from Autodesk.Revit.DB import *
import Autodesk

clr.AddReference("RevitNodes")
import Revit
clr.ImportExtensions(Revit.GeometryConversion)

clr.AddReference("RevitServices")
import RevitServices
from RevitServices.Persistence import DocumentManager

def RoomByTag(tag):
    room = None
    if hasattr(tag, "TaggedRoomId"):
        trID = tag.TaggedRoomId
        if trID.HostElementId != ElementId.InvalidElementId:
            room = doc.GetElement(trID.HostElementId)
        elif trID.LinkedElementId != ElementId.InvalidElementId:
            linkdoc = doc.GetElement(trID.LinkInstanceId).GetLinkDocument()
            room = linkdoc.GetElement(trID.LinkedElementId)
    return room

doc = DocumentManager.Instance.CurrentDBDocument
roomtags = UnwrapElement(IN[0])

if isinstance(IN[0], list): OUT = [RoomByTag(x) for x in roomtags]
else: OUT = RoomByTag(roomtags)
# ----------------------------------------
room = Output(python_script)
