# Dynamo custom node Schedule.Fields.dyf (Dynamo 2.12.1.8246)
# category: Clockwork.Revit.Views.Query
# Returns all fields of a schedule in the order in which they appear in the schedule. Unlike the OOTB node, it returns actual ScheduleField objects that can be further queried.

schedule = Input(schedule: Revit.Elements.Views.ScheduleView[]..[])
python_script = Python(IN[0]=schedule)  # CPython3
# ---------- python_script.python (13 lines) ----------
import clr
clr.AddReference('RevitAPI')
from Autodesk.Revit.DB import *

def GetScheduleFields(schedule):
	if hasattr(schedule, "Definition"): 
		return [schedule.Definition.GetField(x) for x in schedule.Definition.GetFieldOrder()]
	else: return []

scheds = UnwrapElement(IN[0])

if isinstance(IN[0], list): OUT = [GetScheduleFields(x) for x in scheds]
else: OUT = GetScheduleFields(scheds)
# ----------------------------------------
fields = Output(python_script)
