# Dynamo custom node Schema.Fields.dyf (Dynamo 2.3.0.5885)
# category: Clockwork.Revit.Elements.Query
# Returns the fields of a given ExtensibleStorage Schema

schema = Input(schema: var[]..[])
python_script = Python(IN[0]=schema)
# ---------- python_script.python (17 lines) ----------
import clr
clr.AddReference('RevitAPI')
from Autodesk.Revit.DB import *

clr.AddReference("RevitNodes")
import Revit
clr.ImportExtensions(Revit.Elements)

def SchemaFields(schema):
	if hasattr(schema, "ListFields"):
		return schema.ListFields()
	else: return []

schemas = IN[0]

if isinstance(IN[0], list): OUT =[SchemaFields(x) for x in schemas]
else: OUT = SchemaFields(schemas)
# ----------------------------------------
fields = Output(python_script)
