# Dynamo custom node ScopeIf+.dyf (Dynamo 2.0.3.8810)
# category: Clockwork.Script.ControlFlow.Actions
# A (hopefully) more robust implementation of ScopeIf. Tests a single boolean and returns a value accordingly. ATTENTION: This node will be deprecated in 2024. As of Revit 2022, please switch to the new OOTB If node.

True_ = Input(True: var[]..[])
False_ = Input(False: var[]..[])
test = Input(test: var[]..[])
code_block = CodeBlock(trueval=True_, falseval=False_, test=test) { result = [trueval, falseval]; result[test ? 0 : 1]; }
result = Output(code_block.out1)
