# Dynamo custom node SharedParameterFile.Parse.dyf (Dynamo 2.12.1.8246)
# category: Clockwork.Revit.Application.Query
# Returns all parameters from a shared parameter file.
# packages: Clockwork for Dynamo 2.x 2.12.0

path = Input(path: string)
fromPath = FileObject(path=path)  # "File.FromPath"
readText = FileSystem.ReadText(file=fromPath)
version = Custom[Application.Version]()  # package Clockwork for Dynamo 2.x; Retrieves the name, version and build of the current Revit application.
python_script = Python(IN[0]=readText, IN[1]=version.Version)  # CPython3
# ---------- python_script.python (31 lines) ----------
import clr
import re
groups = {}
guids = []
names = []
datatypes = []
datacategories = []
groupnames = []
visible = []
description = []
usermodifiable = []
hidewhennovalue = []
for line in IN[0].splitlines():
	line = re.split(r'\t', line)
	if line[0] == "GROUP":
		groups[line[1]] = line[2]
	if line[0] == "PARAM":
		guids.append(line[1])
		names.append(line[2])
		datatypes.append(line[3])
		datacategories.append(line[4])
		groupnames.append(groups[line[5]])
		visible.append(line[6] == "1")
		# optional items (not present in all SP files)
		if len(line) > 7: description.append(line[7])
		else: description.append(None)
		if len(line) > 8: usermodifiable.append(line[8] == "1")
		else: usermodifiable.append(True)
		if len(line) > 9: hidewhennovalue.append(line[9] == "1")
		else: hidewhennovalue.append(False)
OUT = names, guids, datatypes, datacategories, groupnames, description, visible, usermodifiable, hidewhennovalue
# ----------------------------------------
code_block = CodeBlock(seq=python_script)
# ---------- code_block.designscript (18 lines) ----------
// name
seq[0];
// guid
seq[1];
// data type
seq[2];
// data category
seq[3];
// group
seq[4];
// description
seq[5];
// visible
seq[6];
// usermodifiable
seq[7];
// hidewhennovalue
seq[8];
# ----------------------------------------
names = Output(code_block.out0)
guids = Output(code_block.out1)
data_types = Output(code_block.out2)
data_categories = Output(code_block.out3)
groups = Output(code_block.out4)
descriptions = Output(code_block.out5)
visible = Output(code_block.out6)
user_modifiable = Output(code_block.out7)
hide_when_no_value = Output(code_block.out8)
