# Dynamo custom node String.Replace+.dyf (Dynamo 2.12.1.8246)
# category: Clockwork.String.Modify.Actions
# Replaces multiple items in a given string. Items in the string have to be denoted as {0], {1}, ..., {n} - corresponding to the respective list index of the replacement string.

str = Input(str: var[]..[])
replacements = Input(replacements: var[]..[])
turnIntoList = Custom[TurnIntoList](unknownItem=replacements)  # Turns an element (or a nested list) into a flat list
python_script = Python(IN[0]=str, IN[1]=turnIntoList)  # CPython3
# ---------- python_script.python (2 lines) ----------
import clr
OUT = IN[0].format(*IN[1])
# ----------------------------------------
str_2 = Output(python_script)  # "str"
