# Dynamo custom node String.ReplaceIllegalFilenameCharacters.dyf (Dynamo 2.12.1.8246)
# category: Clockwork.String.Modify.Actions
# Replaces all characters in a string that are illegal characters for filenames

str = Input(str: string)
replacement = Input(replacement: string = "_")
python_script = Python(IN[0]=str, IN[1]=replacement)  # CPython3
# ---------- python_script.python (17 lines) ----------
def ReplaceIllegalFilenameChars(str, repl):
	str = str.replace('/', repl)
	str = str.replace('?', repl)
	str = str.replace('<', repl)
	str = str.replace('>', repl)
	str = str.replace('\\', repl)
	str = str.replace(':', repl)
	str = str.replace('*', repl)
	str = str.replace('|', repl)
	str = str.replace('"', repl)
	str = str.replace('^', repl)
	return str

strings = IN[0]

if isinstance(IN[0], list): OUT = [ReplaceIllegalFilenameChars(x, IN[1]) for x in strings]
else: OUT = ReplaceIllegalFilenameChars(strings, IN[1])
# ----------------------------------------
str_2 = Output(python_script)  # "str"
