# Dynamo custom node System.CPUs.dyf (Dynamo 2.0.1.5055)
# category: Clockwork.Environment.Query
# Returns information on number of processors and CPU speed (GHz).

python_script = Python()  # graph input
# ---------- python_script.python (13 lines) ----------
import clr
clr.AddReference("System.Management")
from System.Management import ManagementObject, ManagementObjectSearcher
sysinfo = ManagementObjectSearcher("Select NumberOfProcessors, NumberOfLogicalProcessors from Win32_ComputerSystem").Get()
for sysdata in sysinfo:
	physicalProcessors = sysdata.Item["NumberOfProcessors"]
	logicalProcessors = sysdata.Item["NumberOfLogicalProcessors"]
sysinfo = ManagementObjectSearcher("Select NumberOfCores, MaxClockSpeed from Win32_Processor").Get()
cores = 0
for sysdata in sysinfo:
	cores += sysdata.Item["NumberOfCores"]
	cpuspeed = sysdata.Item["MaxClockSpeed"]
OUT = (physicalProcessors, logicalProcessors, cores, float(cpuspeed)/1000)
# ----------------------------------------
code_block = CodeBlock(seq=python_script)
# ---------- code_block.designscript (8 lines) ----------
// Physical processors
seq[0];
// Logical processors
seq[1];
// Cores
seq[2];
// CPU speed
seq[3];
# ----------------------------------------
physicalProcessors = Output(code_block.out0)
logicalProcesssors = Output(code_block.out1)
cores = Output(code_block.out2)
CPUspeed = Output(code_block.out3)
