# Dynamo custom node TurnIntoList.dyf (Dynamo 2.0.1.5055)
# category: Clockwork.List.Generate.Create
# Turns an element (or a nested list) into a flat list

unknownItem = Input(unknownItem: var[]..[])
create = List.Create(item0=unknownItem)
flatten = List.Flatten(list=create)
seq = Output(flatten)
