# Dynamo custom node UV.ByXY.dyf (Dynamo 2.0.1.5055)
# category: Clockwork.Geometry.Points.Create
# Creates UVs from the XY components of point coordinates

point = Input(point: Autodesk.DesignScript.Geometry.Point)
code_block = CodeBlock(seq=point) { UV.ByCoordinates(seq.X,seq.Y); }
uv = Output(code_block)
