# Dynamo custom node UV.RoundUpToPrecision.dyf (Dynamo 2.0.1.5055)
# category: Clockwork.Geometry.Points.Actions
# Rounds a UV coordinate *up* to a specified precision

uv = Input(uv: Autodesk.DesignScript.Geometry.UV)
Precision = Input(Precision: double)
code_block = CodeBlock(uc=uv, pr=Precision) { a = [uc.U,uc.V]; ar = Math.Ceiling(a/pr)*pr; UV.ByCoordinates(ar[0],ar[1]); }
uv_2 = Output(code_block.out2)  # "uv"
