# Dynamo custom node VersionNumber.Compare.dyf (Dynamo 2.6.2.15705)
# category: Clockwork.String.Inspect.Actions
# Compares two version numbers. Returns 1 if A is higher than B, 0 if they are equal and -1 if A is lower than B.

versionA = Input(versionA: string[]..[])
versionB = Input(versionB: string[]..[])
python_script = Python(IN[0]=versionA, IN[1]=versionB)
# ---------- python_script.python (10 lines) ----------
import sys
import clr
from System import Version

if isinstance(IN[0], list): 
	if isinstance(IN[1], list): OUT = [x.CompareTo(y) for x,y in zip(IN[0], IN[1])]
	else: OUT = [x.CompareTo(IN[1]) for x in IN[0]]
else: 
	if isinstance(IN[1], list): OUT = [IN[0].CompareTo(x) for x in IN[1]]
	else: OUT = IN[0].CompareTo(IN[1])
# ----------------------------------------
result = Output(python_script)
