# Dynamo custom node View.CategoryIsVisible.dyf (Dynamo 2.0.3.8810)
# category: Clockwork.Revit.Views.Query
# Checks if a given category is visible in a given view. ATTENTION: This node will be deprecated in 2025. As of Revit 2023, please switch to the OOTB node View.IsCategoryHidden and combine it with the Not node.

category = Input(category: var[]..[])  # Works with categories, BuiltInCategories and BuiltInCategories as strings
fromInput = Custom[Category.FromInput](var=category)  # Returns a category from a category, a Dynamo-wrapped category, a BuiltInCategory or a string representing a BuiltInCategory.
view = Input(view: var[]..[])
version = Custom[Application.Version]()  # Retrieves the name, version and build of the current Revit application.
python_script = Python(IN[0]=fromInput, IN[1]=view, IN[2]=version.Version)
# ---------- python_script.python (21 lines) ----------
import clr
clr.AddReference('RevitAPI')
from Autodesk.Revit.DB import *

def IsCategoryVisibleInView(cat, view, version):
	if version > 2016:
		if view.GetCategoryHidden(cat.Id): return False
		else: return True
	else:
		if view.GetVisibility(cat): return True
		else: return False

cats = IN[0]
views = UnwrapElement(IN[1])

if isinstance(IN[0], list):
	if isinstance(IN[1], list):  OUT = [[IsCategoryVisibleInView(x, y, IN[2]) for x in cats] for y in views]
	else: OUT = [IsCategoryVisibleInView(x, views, IN[2]) for x in cats]
else:
	if isinstance(IN[1], list): OUT = [IsCategoryVisibleInView(cats, x, IN[2]) for x in views]
	else: OUT = IsCategoryVisibleInView(cats, views, IN[2])
# ----------------------------------------
bool = Output(python_script)
