# Dynamo custom node View.ConvertTemporaryHideIsolateToPermanent.dyf (Dynamo 2.12.1.8246)
# category: Clockwork.Revit.Views.Actions
# Convert all temporary hidden elements or categories to permanently hidden in the given view.

view = Input(view: var[]..[])
view_2 = Output(view)  # "view"
python_script = Python(IN[0]=view)  # CPython3
# ---------- python_script.python (22 lines) ----------
import clr
clr.AddReference('RevitAPI')
from Autodesk.Revit.DB import *

clr.AddReference("RevitServices")
import RevitServices
from RevitServices.Persistence import DocumentManager
from RevitServices.Transactions import TransactionManager

def TempHideIsolateToPerm(view):
	try:
		view.ConvertTemporaryHideIsolateToPermanent()
		return True
	except: return False

doc = DocumentManager.Instance.CurrentDBDocument
views = UnwrapElement(IN[0])

TransactionManager.Instance.EnsureInTransaction(doc)
if isinstance(IN[0], list): OUT = [TempHideIsolateToPerm(x) for x in views]
else: OUT = TempHideIsolateToPerm(views)
TransactionManager.Instance.TransactionTaskDone()
# ----------------------------------------
success = Output(python_script)
