# Dynamo custom node View.Direction.dyf (Dynamo 2.0.1.5055)
# category: Clockwork.Revit.Views.Query
# Returns the direction of a view. ATTENTION: This node will be deprecated in 2024. As of Revit 2022, please switch to the OOTB node of the same name.

view = Input(view: var[]..[])
python_script = Python(IN[0]=view)
# ---------- python_script.python (17 lines) ----------
import clr
clr.AddReference('RevitAPI')
from Autodesk.Revit.DB import *

clr.AddReference("RevitNodes")
import Revit
clr.ImportExtensions(Revit.GeometryConversion)

def ViewDirection(view):
	if hasattr(view, "ViewDirection"):
		return view.ViewDirection.ToVector()
	else: return None

views = UnwrapElement(IN[0])

if isinstance(IN[0], list): OUT = [ViewDirection(x) for x in views]
else: OUT = ViewDirection(views)
# ----------------------------------------
vector = Output(python_script)
