# Dynamo custom node View.IsViewTemplate+.dyf (Dynamo 2.12.1.8246)
# category: Clockwork.Revit.Views.Query
# Checks if a given view is a view template. Unlike the OOTB node it works for all view types.

view = Input(view: var[]..[])
python_script = Python(IN[0]=view)  # CPython3
# ---------- python_script.python (12 lines) ----------
import clr
clr.AddReference('RevitAPI')
from Autodesk.Revit.DB import *

def IsViewTemplate(view):
	if hasattr(view, "IsTemplate"): return view.IsTemplate
	else: return False

views = UnwrapElement(IN[0])

if isinstance(IN[0], list): OUT = [IsViewTemplate(x) for x in views]
else: OUT = IsViewTemplate(views)
# ----------------------------------------
bool = Output(python_script)
