# Dynamo custom node View.PermanentlyIsolateCategory.dyf (Dynamo 3.4.1.7055)
# category: Clockwork.Revit.Views.Actions
# Permanently isolates categories in the given view
# packages: Clockwork for Dynamo 2.x 2.12.1, Clockwork for Dynamo 2.x 2.12.2

view = Input(view: var[]..[])
view_2 = Output(view)  # "view"
category = Input(category: var[]..[])  # Works with categories, BuiltInCategories and BuiltInCategories as strings
fromInput = Custom[BuiltInCategory.FromInput](input=category)  # package Clockwork for Dynamo 2.x; Returns a BuiltInCategory from a category, a Dynamo-wrapped category, a BuiltInCategory or a string representing a BuiltInCategory.
byName = Category.ByName(name=fromInput)
category_2 = Output(byName)  # "category"
isolateCategoriesTemporary = View.IsolateCategoriesTemporary(view=view, categories=byName)
convertTemporaryHideIsolateToPermanent = Custom[View.ConvertTemporaryHideIsolateToPermanent](view=isolateCategoriesTemporary)  # package Clockwork for Dynamo 2.x; Convert all temporary hidden elements or categories to permanently hidden in the given view.
success = Output(convertTemporaryHideIsolateToPermanent.success)
