# Dynamo custom node View.PermanentlyIsolateElement.dyf (Dynamo 2.12.1.8246)
# category: Clockwork.Revit.Views.Actions
# Permanently isolates elements in the given view
# packages: Clockwork for Dynamo 2.x 2.12.0

view = Input(view: var[]..[])
view_2 = Output(view)  # "view"
element = Input(element: var[]..[])
element_2 = Output(element)  # "element"
isolateElementsTemporary = View.IsolateElementsTemporary(view=view, elements=element)
convertTemporaryHideIsolateToPermanent = Custom[View.ConvertTemporaryHideIsolateToPermanent](view=isolateElementsTemporary)  # package Clockwork for Dynamo 2.x; Convert all temporary hidden elements or categories to permanently hidden in the given view.
success = Output(convertTemporaryHideIsolateToPermanent.success)
