# Dynamo custom node View.Plane.dyf (Dynamo 2.12.1.8246)
# category: Clockwork.Revit.Views.Query
# Retrieves the plane of a given view

view = Input(view: var[]..[])
python_script = Python(IN[0]=view)  # CPython3
# ---------- python_script.python (23 lines) ----------
import clr
clr.AddReference('RevitAPI')
from Autodesk.Revit.DB import *

clr.AddReference("RevitNodes")
import Revit
clr.ImportExtensions(Revit.GeometryConversion)

clr.AddReference('ProtoGeometry')
from Autodesk.DesignScript.Geometry import *

def ViewPlane(view):
	if hasattr(view, "ViewDirection") and hasattr(view, "Origin"):
		o = view.Origin
		n = view.ViewDirection
		if o and n: return Plane.ByOriginNormal(o.ToPoint(), n.ToVector())
		else: return None
	else: return None

views = UnwrapElement(IN[0])

if isinstance(IN[0], list): OUT = [ViewPlane(x) for x in views]
else: OUT = ViewPlane(views)
# ----------------------------------------
plane = Output(python_script)
