# Dynamo custom node View.ResizeCropBox.dyf (Dynamo 2.12.1.8246)
# category: Clockwork.Revit.Views.Actions
# Resizes the bounding box of a given Revit element by the specified amount in X, Y and Z direction. May need to be used in conjunction with a Transaction node.

view = Input(view: var[]..[])
turnIntoList = Custom[TurnIntoList](unknownItem=view)  # Turns an element (or a nested list) into a flat list
amt = Input(amt: double)
byCoordinates = Point.ByCoordinates(x=amt, y=amt, z=amt)
python_script = Python(IN[0]=turnIntoList, IN[1]=byCoordinates)  # CPython3
# ---------- python_script.python (33 lines) ----------
import clr
clr.AddReference('RevitAPI')
from Autodesk.Revit.DB import *

clr.AddReference("RevitNodes")
import Revit
clr.ImportExtensions(Revit.GeometryConversion)

clr.AddReference("RevitServices")
import RevitServices
from RevitServices.Persistence import DocumentManager
from RevitServices.Transactions import TransactionManager

doc = DocumentManager.Instance.CurrentDBDocument
views = UnwrapElement(IN[0])
margin = IN[1].ToXyz()
booleans = []

TransactionManager.Instance.EnsureInTransaction(doc)
for item in views:
	try:
		newmax = item.CropBox.Max.Add(margin)
		newmin = item.CropBox.Min.Subtract(margin)
		newbox = BoundingBoxXYZ()
		newbox.Max = newmax
		newbox.Min = newmin
		item.CropBox = newbox
		booleans.append(True)
	except:
		booleans.append(False)
TransactionManager.Instance.TransactionTaskDone()

OUT = (views,booleans)
# ----------------------------------------
firstItem = List.FirstItem(list=python_script)
returnListOrSingleValue = Custom[ReturnListOrSingleValue](unknownItem=view, seq=firstItem)  # If the unknown item is not a list but rather a single item, only the first item of the list (input "seq") will be returned.
view_2 = Output(returnListOrSingleValue)  # "view"
lastItem = List.LastItem(list=python_script)
returnListOrSingleValue_2 = Custom[ReturnListOrSingleValue](unknownItem=view, seq=lastItem)
success = Output(returnListOrSingleValue_2)
