# Dynamo custom node View.Scale.dyf (Dynamo 2.6.1.8786)
# category: Clockwork.Revit.Views.Query
# Returns the scale of a given view. ATTENTION: This node will be deprecated in 2024. As of Revit 2022, please switch to the OOTB node of  the same name.

view = Input(view: var[]..[])
python_script = Python(IN[0]=view)
# ---------- python_script.python (11 lines) ----------
import clr
clr.AddReference('RevitAPI')
from Autodesk.Revit.DB import *

def GetViewScale(view):
	if hasattr(view, "Scale"): return view.Scale
	else: return None

views = UnwrapElement(IN[0])
if isinstance(IN[0], list): OUT = [GetViewScale(x) for x in views]
else: OUT = GetViewScale(views)
# ----------------------------------------
Scale_1 = Output(python_script)  # "Scale 1:X"
