# Dynamo custom node View.TemporarilyIsolateElement.dyf (Dynamo 2.0.1.5055)
# category: Clockwork.Revit.Views.Actions
# Temporarily isolates elements in the given view. ATTENTION: This node will be deprecated in 2024. As of Revit 2022, please switch to the OOTB node View.IsolateElementsTemporary.

view = Input(view: var[]..[])
view_2 = Output(view)  # "view"
element = Input(element: var[]..[])
element_2 = Output(element)  # "element"
python_script = Python(IN[0]=element, IN[1]=view)
# ---------- python_script.python (27 lines) ----------
import clr
clr.AddReference('RevitAPI')
from Autodesk.Revit.DB import *
from System.Collections.Generic import *

clr.AddReference("RevitServices")
import RevitServices
from RevitServices.Persistence import DocumentManager
from RevitServices.Transactions import TransactionManager

def TempIsolateElements(view, items):
	if not items: return False
	elif not isinstance(items, list): items = [items]
	ielements = List[ElementId]([x.Id for x in UnwrapElement(items)])
	try:
		UnwrapElement(view).IsolateElementsTemporary(ielements)
		return True
	except: return False

doc = DocumentManager.Instance.CurrentDBDocument

TransactionManager.Instance.EnsureInTransaction(doc)
if isinstance(IN[1], list):
	if isinstance(IN[0], list): OUT = [TempIsolateElements(x, y) for x, y in zip(IN[1], IN[0])]
	else: OUT = [TempIsolateElements(x, IN[0]) for x in IN[1]]
else: OUT = TempIsolateElements(IN[1], IN[0])
TransactionManager.Instance.TransactionTaskDone()
# ----------------------------------------
success = Output(python_script)
