# Dynamo custom node View.UsesViewFilters.dyf (Dynamo 2.0.1.5055)
# category: Clockwork.Revit.Views.Query
# Checks if a given view has any view filters applied to it.

view = Input(view: var[]..[])
turnIntoList = Custom[TurnIntoList](unknownItem=view)  # Turns an element (or a nested list) into a flat list
filters = View.Filters(view=turnIntoList)
isNotEmpty = Custom[List.IsNotEmpty](seq=filters@L2)  # Just the inversion of the built-in Is Empty List node.
returnListOrSingleValue = Custom[ReturnListOrSingleValue](unknownItem=view, seq=isNotEmpty)  # If the unknown item is not a list but rather a single item, only the first item of the list (input "seq") will be returned.
bool = Output(returnListOrSingleValue)
