# Dynamo custom node Window.Rooms.dyf (Dynamo 2.0.1.5055)
# category: Clockwork.Revit.Elements.Query
# Gets the rooms that are connected by a given window

window = Input(window: Revit.Elements.FamilyInstance[]..[])
phase = Input(phase: var = null)  # If no phase is specified, the node will use the last phase in the project
rooms = Custom[Door.Rooms](door=window, phase=phase)  # Gets the rooms that are connected by a given door
fromRoom = Output(rooms.fromRoom)
toRoom = Output(rooms.toRoom)
roomCount = Output(rooms.roomCount)
