# Dynamo custom node Document.Enums.dyf (Dynamo 2.12.1.8246)
# category: Clockwork.Revit.Application.Query
# Retrieves all Enums from the Revit API

python_script = Python()  # CPython3
# ---------- python_script.python (9 lines) ----------
import clr
import System
clr.AddReference('RevitAPI')
clr.AddReference('RevitAPIUI')
import Autodesk

rAssembly = [x for x in System.AppDomain.CurrentDomain.GetAssemblies() if x.GetName().Name == 'RevitAPI'][0]
OUT = [x.Name for x in rAssembly.GetTypes() if x.Namespace is not None and x.Namespace.startswith("Autodesk.Revit.") and str(x.BaseType) == "System.Enum"]
OUT = sorted(OUT, key=str.lower)
# ----------------------------------------
enumNames = Output(python_script)
