# Dynamo custom node All Elements Of Category+.dyf (Dynamo 3.6.1.9895)
# category: Clockwork.Revit.Selection.Collectors.Query
# Gets all placed elements of a given category in the model. Unlike the OOTB node it also supports linked models and a few more special categories (e.g. Legend Components).
# packages: PythonNet3 Engine 1.1.1, Clockwork for Dynamo 2.x 2.4.0

category = Input(category: var[]..[])  # Works with categories, BuiltInCategories and BuiltInCategories as strings
fromInput = Custom[BuiltInCategory.FromInput](input=category)  # package Clockwork for Dynamo 2.x; Returns a BuiltInCategory from a category, a Dynamo-wrapped category, a BuiltInCategory or a string representing a BuiltInCategory.
toggle = Input(toggle: bool = true)
docOrRevitLinkInstance = Input(docOrRevitLinkInstance: var = null)  # Use only if you want to query a linked model
python_script = Python(IN[0]=fromInput, IN[1]=toggle, IN[2]=docOrRevitLinkInstance)  # PythonNet3
# ---------- python_script.python (23 lines) ----------
import System
import clr
clr.AddReference('RevitAPI')
from Autodesk.Revit.DB import *

clr.AddReference("RevitServices")
import RevitServices
from RevitServices.Persistence import DocumentManager

def ElementsByCategory(bic, doc):
	if bic:
		collector = FilteredElementCollector(doc).OfCategory(eval("BuiltInCategory."+bic)).WhereElementIsNotElementType()
		return collector.ToElements()
	else: return []

inputdoc = UnwrapElement(IN[2])
if not inputdoc: doc = DocumentManager.Instance.CurrentDBDocument
elif inputdoc.GetType().ToString() == "Autodesk.Revit.DB.RevitLinkInstance": doc = inputdoc.GetLinkDocument()
elif inputdoc.GetType().ToString() == "Autodesk.Revit.DB.Document": doc = inputdoc
else: doc = DocumentManager.Instance.CurrentDBDocument

if isinstance(IN[0], list): OUT = [ElementsByCategory(x, doc) for x in IN[0]]
else: OUT = ElementsByCategory(IN[0], doc)
# ----------------------------------------
elements = Output(python_script)
