# Dynamo custom node All Families Of Category.dyf (Dynamo 3.6.1.9895)
# category: Clockwork.Revit.Selection.Collectors.Query
# Gets all famiies of a given category in the model  (does *not *work for system families)
# packages: PythonNet3 Engine 1.1.1, Clockwork for Dynamo 2.x 2.6.0, Clockwork for Dynamo 2.x 2.12.2

docOrRevitLinkInstance = Input(docOrRevitLinkInstance: var = null)  # Use only if you want to query a linked model
toggle = Input(toggle: bool = true)
category = Input(category: var[]..[])  # Works with categories, BuiltInCategories and BuiltInCategories as strings
fromInput = Custom[Category.FromInput](category=category)  # package Clockwork for Dynamo 2.x; Returns a category from a category, a Dynamo-wrapped category, a BuiltInCategory or a string representing a BuiltInCategory.
version = Custom[Application.Version]()  # package Clockwork for Dynamo 2.x; Retrieves the name, version and build of the current Revit application.
python_script = Python(IN[0]=docOrRevitLinkInstance, IN[1]=toggle, IN[2]=fromInput, IN[3]=version.Version)  # PythonNet3
# ---------- python_script.python (28 lines) ----------
import System
import clr
clr.AddReference('RevitAPI')
from Autodesk.Revit.DB import *

clr.AddReference("RevitServices")
import RevitServices
from RevitServices.Persistence import DocumentManager

inputdoc = UnwrapElement(IN[0])
if not inputdoc: doc = DocumentManager.Instance.CurrentDBDocument
elif inputdoc.GetType().ToString() == "Autodesk.Revit.DB.RevitLinkInstance": doc = inputdoc.GetLinkDocument()
elif inputdoc.GetType().ToString() == "Autodesk.Revit.DB.Document": doc = inputdoc
else: doc = DocumentManager.Instance.CurrentDBDocument
cats = IN[2]
version = IN[3]

collector = FilteredElementCollector(doc).OfClass(Family)
items = collector.ToElements()

def ReturnIfCategory(items, cat):
    if cat: 
        if version > 2024: return [x for x in items if x.FamilyCategory.Id.Value == cat.Id.Value]
        else: return [x for x in items if x.FamilyCategory.Id.IntegerValue == cat.Id.IntegerValue]
    else: return []

if isinstance(cats, list): OUT = [ReturnIfCategory(items, x) for x in cats]
else: OUT = ReturnIfCategory(items, cats)
# ----------------------------------------
families = Output(python_script)
