# Dynamo custom node All Intersecting Elements Of Category By BoundingBox.dyf (Dynamo 3.6.1.9895)
# category: Clockwork.Revit.Selection.Collectors.Query
# Finds all elements that intersect the bounding box of a given element
# packages: PythonNet3 Engine 1.1.1, Clockwork for Dynamo 2.x 2.6.0

element = Input(element: var[]..[])
threeDview = Input(threeDview: Revit.Elements.Views.View3D = null)
tolerance = Input(tolerance: double = 0)
category = Input(category: var[]..[])  # Works with categories, BuiltInCategories and BuiltInCategories as strings
fromInput = Custom[Category.FromInput](category=category)  # package Clockwork for Dynamo 2.x; Returns a category from a category, a Dynamo-wrapped category, a BuiltInCategory or a string representing a BuiltInCategory.
turnIntoList = Custom[TurnIntoList](unknownItem=fromInput)  # package Clockwork for Dynamo 2.x; Turns an element (or a nested list) into a flat list
python_script = Python(IN[0]=element, IN[1]=threeDview, IN[2]=tolerance, IN[3]=turnIntoList)  # PythonNet3
# ---------- python_script.python (49 lines) ----------
import clr

import System
from System.Collections.Generic import *

clr.AddReference('RevitAPI')
from Autodesk.Revit.DB import *

clr.AddReference("RevitNodes")
import Revit
clr.ImportExtensions(Revit.Elements)
clr.ImportExtensions(Revit.GeometryConversion)

clr.AddReference("RevitServices")
import RevitServices
from RevitServices.Persistence import DocumentManager

def DisplayUnitToInternalUnit(val, unittype):
	formatoptions = doc.GetUnits().GetFormatOptions(unittype)
	dispunits = formatoptions.GetUnitTypeId()
	try: return UnitUtils.ConvertToInternalUnits(val,dispunits)
	except: return None

def FindIntersects(item):
	if item is None: return []
	else:
		if view:
			bbox = item.get_BoundingBox(view)
			collector = FilteredElementCollector(doc, view.Id)
		else:
			bbox = item.get_BoundingBox(None)
			collector = FilteredElementCollector(doc)
		bboxfilter = BoundingBoxIntersectsFilter(Outline(bbox.Min,bbox.Max),tol)		
		excludelist = []
		excludelist.append(item.Id)
		excludeIDs = List[ElementId](excludelist)
		excfilter = ExclusionFilter(excludeIDs)
		return collector.WherePasses(bboxfilter).WherePasses(excfilter).WherePasses(catfilter).ToElements()

doc = DocumentManager.Instance.CurrentDBDocument
items = UnwrapElement(IN[0])
view = UnwrapElement(IN[1])
filtercats = List[ElementId]([x.Id for x in IN[3]])
catfilter = ElementMulticategoryFilter(filtercats)
unittype = ForgeTypeId('autodesk.spec.aec:length-2.0.0')
tol = DisplayUnitToInternalUnit(IN[2], unittype)

if isinstance(IN[0], list): OUT = [FindIntersects(x) for x in items]
else: OUT = FindIntersects(items)
# ----------------------------------------
intersectingElements = Output(python_script)
