# Dynamo custom node All Intersecting Elements Of Category By Vector.dyf (Dynamo 3.6.1.9895)
# category: Clockwork.Revit.Selection.Collectors.Query
# Finds all elements of a specified category that intersect with a list of vectors
# packages: Clockwork for Dynamo 2.x 2.12.2, PythonNet3 Engine 1.1.1

origin = Input(origin: Autodesk.DesignScript.Geometry.Point)
direction = Input(direction: Autodesk.DesignScript.Geometry.Vector)
maxBounces = Input(maxBounces: int = 1)
threeDView = Input(threeDView: Revit.Elements.Views.View3D = null)
isNull = Object.IsNull(object=threeDView)
code_block = CodeBlock { 1; null; }
if_ = RefactoredIf(test=isNull, true=code_block.out0, false=code_block.out1)
byCoordinates = Point.ByCoordinates(x=if_, y=if_, z=if_)
origin_2 = Point.Origin()
byEyePointAndTarget = AxonometricView.ByEyePointAndTarget(eyePoint=byCoordinates, target=origin_2)
if_2 = RefactoredIf(test=isNull, true=byEyePointAndTarget, false=threeDView)
category = Input(category: var[]..[])  # Works with categories, BuiltInCategories and BuiltInCategories as strings
fromInput = Custom[BuiltInCategory.FromInput](input=category)  # package Clockwork for Dynamo 2.x; Returns a BuiltInCategory from a category, a Dynamo-wrapped category, a BuiltInCategory or a string representing a BuiltInCategory.
byName = Category.ByName(name=fromInput)
toggle = Input(toggle: bool = true)
passthrough = Custom[Passthrough](passThrough=byName, waitFor=toggle)  # package Clockwork for Dynamo 2.x; Forces a sequential order of execution. The node wired into the output of the Passthrough node will be executed *after* the node wired into the waitFor input (e.g. important for some Revit operations). The value of the passThrough input will be passed on to the node wired into the output port of the Passthrough node.
turnIntoList = Custom[TurnIntoList](unknownItem=passthrough)  # package Clockwork for Dynamo 2.x; Turns an element (or a nested list) into a flat list
isolateCategoriesTemporary = View.IsolateCategoriesTemporary(view=if_2, categories=turnIntoList)
end = Revit.Transaction.Transaction.End(input=isolateCategoriesTemporary)
byOriginDirection = Revit.References.RayBounce.ByOriginDirection(origin=origin, direction=direction, maxBounces=maxBounces, view=end)
uniqueItems = List.UniqueItems(list=byOriginDirection.elements)
elements = Output(uniqueItems)
passthrough_2 = Custom[Passthrough](passThrough=end, waitFor=byOriginDirection.elements)
disableTemporaryHideIsolate = Custom[View.DisableTemporaryHideIsolate](view=passthrough_2)  # package Clockwork for Dynamo 2.x; Disables the temporary hide/isolate for the given view (if set)
passthrough_3 = Custom[Passthrough](passThrough=byEyePointAndTarget, waitFor=disableTemporaryHideIsolate.view)
python_script = Python(IN[0]=passthrough_3)  # PythonNet3
# ---------- python_script.python (30 lines) ----------
import clr
from System.Collections.Generic import *

clr.AddReference('RevitAPI')
from Autodesk.Revit.DB import *

clr.AddReference("RevitNodes")
import Revit
clr.ImportExtensions(Revit.GeometryConversion)

clr.AddReference("RevitServices")
import RevitServices
from RevitServices.Persistence import DocumentManager
from RevitServices.Transactions import TransactionManager

doc = DocumentManager.Instance.CurrentDBDocument
items = UnwrapElement(IN[0])

def DeleteElement(item):
	if hasattr(item, "Id"):
		try: 
			doc.Delete(item.Id)
			return True
		except: return False
	else: return False

TransactionManager.Instance.EnsureInTransaction(doc)
if isinstance(IN[0], list): OUT = [DeleteElement(x) for x in items]
else: OUT = DeleteElement(items)
TransactionManager.Instance.TransactionTaskDone()
# ----------------------------------------
