# Dynamo custom node All View-Dependent Family Instances Of Category.dyf (Dynamo 3.6.1.9895)
# category: Clockwork.Revit.Selection.Collectors.Query
# Gets all view-dependent family instances in a given view for a given list of categories - useful for finding annotation elements
# packages: PythonNet3 Engine 1.1.1, Clockwork for Dynamo 2.x 2.12.2

category = Input(category: var[]..[])  # Works with categories, BuiltInCategories and BuiltInCategories as strings
fromInput = Custom[BuiltInCategory.FromInput](input=category)  # package Clockwork for Dynamo 2.x; Returns a BuiltInCategory from a category, a Dynamo-wrapped category, a BuiltInCategory or a string representing a BuiltInCategory.
view = Input(view: var[]..[])
primaryView = Custom[View.PrimaryView](view=view)  # package Clockwork for Dynamo 2.x; Returns the primary view of a given view (i.e. the master view of a dependent view)
isNull = Object.IsNull(object=primaryView)
code_block = CodeBlock(isnull=isNull, originalView=view, primaryView=primaryView) { isnull ? originalView : primaryView; }
toggle = Input(toggle: bool = true)
python_script = Python(IN[0]=fromInput, IN[1]=code_block, IN[2]=toggle)  # PythonNet3
# ---------- python_script.python (24 lines) ----------
import System
import clr
clr.AddReference('RevitAPI')
from Autodesk.Revit.DB import *

clr.AddReference("RevitServices")
import RevitServices
from RevitServices.Persistence import DocumentManager

def CollectByView(bic, view):
	collector = FilteredElementCollector(doc)
	filter = ElementOwnerViewFilter(view.Id)
	return collector.WherePasses(filter).OfCategory(eval("BuiltInCategory."+bic)).ToElements()

def GetViewDependentElements(cat, views):
	if isinstance(views, list): return [CollectByView(cat, x) for x in UnwrapElement(views)]
	else: return CollectByView(cat, UnwrapElement(views))

doc = DocumentManager.Instance.CurrentDBDocument
cats = IN[0]
views = IN[1]

if isinstance(IN[0], list): OUT = [GetViewDependentElements(x, views) for x in cats]
else: OUT = GetViewDependentElements(cats, views)
# ----------------------------------------
elements = Output(python_script)
