# Dynamo custom node Angle.ByLawOfSines.dyf (Dynamo 2.0.1.5055)
# category: Clockwork.Math.Formulas.Query
# Determines the angle of a triangle based on the law of sines. (Alpha is the angle opposite side A and beta is the angle opposite side B...)

sideA = Input(sideA: double)
sideB = Input(sideB: double)
beta = Input(beta: double)
code_block = CodeBlock(a=sideA, b=sideB, beta=beta) { Math.Asin(a/b*Math.Sin(beta)); }
alpha = Output(code_block)
