# Dynamo custom node AngleBisector.ByPoints.dyf (Dynamo 2.0.1.5055)
# category: Clockwork.Geometry.Abstract.Vector.Create
# Retrieves the vector of an angle bisector at point B based on three points (A, B, C) that define the angle.

PointA = Input(PointA: Autodesk.DesignScript.Geometry.Point)
PointC = Input(PointC: Autodesk.DesignScript.Geometry.Point)
PointB = Input(PointB: Autodesk.DesignScript.Geometry.Point)
code_block = CodeBlock(a=PointA, c=PointC, b=PointB)
# ---------- code_block.designscript (8 lines) ----------
plist = [a,c];
px = Math.Average(plist.X);
py = Math.Average(plist.Y);
pz = Math.Average(plist.Z);
// Find midpoint between points A & C
midpoint = Autodesk.Point.ByCoordinates(px,py,pz);
// Create vector between point B & midpoint
vec = Vector.ByTwoPoints(b,midpoint).Normalized();
# ----------------------------------------
Vector = Output(code_block.vec)
