# Dynamo custom node Application.Version.dyf (Dynamo 3.6.1.9895)
# category: Clockwork.Revit.Application.Query
# Retrieves the name, version and build of the current Revit application.
# packages: PythonNet3 Engine 1.1.1

python_script = Python()  # PythonNet3
# ---------- python_script.python (14 lines) ----------
import clr
clr.AddReference("RevitServices")
import RevitServices
from RevitServices.Persistence import DocumentManager
import System
clr.AddReference('RevitAPI')
from Autodesk.Revit.ApplicationServices import *

doc = DocumentManager.Instance.CurrentDBDocument
uiapp = DocumentManager.Instance.CurrentUIApplication
app = uiapp.Application
fullVersion = app.SubVersionNumber

OUT = app.VersionName, int(app.VersionNumber), app.VersionBuild, System.Enum.GetName(LanguageType, app.Language), fullVersion
# ----------------------------------------
code_block = CodeBlock(seq=python_script) { seq[0]; seq[1]; seq[2]; seq[3]; seq[4]; }
Name = Output(code_block.out0)
Version = Output(code_block.out1)
Build = Output(code_block.out2)
Language = Output(code_block.out3)
fullVersion = Output(code_block.out4)
