# Dynamo custom node AreaSeparator.FromCurve.dyf (Dynamo 3.6.1.9895)
# category: Clockwork.Revit.Elements.ModelCurve.Create
# Creates area separation lines from geometry curves.
# packages: PythonNet3 Engine 1.1.1, Clockwork for Dynamo 2.x 2.12.0

curve = Input(curve: Autodesk.DesignScript.Geometry.Curve[]..[])
areaPlan = Input(areaPlan: Revit.Elements.Views.AreaPlanView)
plane = Custom[View.Plane](view=areaPlan)  # package Clockwork for Dynamo 2.x; Retrieves the plane of a given view
pullOntoPlane = Curve.PullOntoPlane(curve=curve, plane=plane)
python_script = Python(IN[0]=pullOntoPlane, IN[1]=areaPlan)  # PythonNet3
# ---------- python_script.python (31 lines) ----------
import clr
clr.AddReference('RevitAPI')
from Autodesk.Revit.DB import *

clr.AddReference("RevitNodes")
import Revit
clr.ImportExtensions(Revit.GeometryConversion)

clr.AddReference("RevitServices")
import RevitServices
from RevitServices.Persistence import DocumentManager
from RevitServices.Transactions import TransactionManager

doc = DocumentManager.Instance.CurrentDBDocument
curves = UnwrapElement(IN[0])
view = UnwrapElement(IN[1])
elementlist = []

TransactionManager.Instance.EnsureInTransaction(doc)
o = view.Origin
n = view.ViewDirection
if o and n: 
	sketchplane = SketchPlane.Create(doc, Plane.CreateByNormalAndOrigin(n, o))
	doccreation = doc.Create
	for curve in curves:
		separator = doccreation.NewAreaBoundaryLine(sketchplane, curve.ToRevitType(), view)
		elementlist.append(separator)
TransactionManager.Instance.TransactionTaskDone()

if isinstance(IN[0], list): OUT = elementlist
else: OUT = elementlist[0]
# ----------------------------------------
areaSeparator = Output(python_script)
