# Dynamo custom node Array.AssociatedFamilyParameter.dyf (Dynamo 3.6.1.9895)
# category: Clockwork.Revit.Elements.Query
# Returns the associated family parameter of an array label (if any). PLEASE NOTE: This node will only work in a family document!
# packages: PythonNet3 Engine 1.1.1

baseArray = Input(baseArray: var[]..[])
python_script = Python(IN[0]=baseArray)  # PythonNet3
# ---------- python_script.python (20 lines) ----------
import clr
clr.AddReference('RevitAPI')
from Autodesk.Revit.DB import *

clr.AddReference("RevitNodes")
import Revit
clr.ImportExtensions(Revit.Elements)

def GetAssociatedFamilyParameters(basearray):
    if basearray.GetType().ToString() in ("Autodesk.Revit.DB.LinearArray", "Autodesk.Revit.DB.RadialArray"):
        if basearray.Label != None: return basearray.Label, basearray.Label.Definition.Name
        else: return None, None
    else: return None, None

basearrays = UnwrapElement(IN[0])

if isinstance(IN[0], list): 
    if len(IN[0]) > 0: OUT = map(list, zip(*[GetAssociatedFamilyParameters(x) for x in basearrays]))
    else: OUT = [[],[]]
else: OUT = GetAssociatedFamilyParameters(basearrays)
# ----------------------------------------
code_block = CodeBlock(seq=python_script) { seq[0]; seq[1]; }
familyParameter = Output(code_block.out0)
familyParameterName = Output(code_block.out1)
