# Dynamo custom node Assembly.AddMembers.dyf (Dynamo 3.6.1.9895)
# category: Clockwork.Revit.Elements.Actions
# Adds any given elements to a given assembly.
# packages: PythonNet3 Engine 1.1.1

assembly = Input(assembly: var[]..[])
elements = Input(elements: var[]..[])
python_script = Python(IN[0]=assembly, IN[1]=elements)  # PythonNet3
# ---------- python_script.python (31 lines) ----------
import clr
from System.Collections.Generic import *
clr.AddReference('RevitAPI')
from Autodesk.Revit.DB import *

clr.AddReference("RevitNodes")
import Revit
clr.ImportExtensions(Revit.GeometryConversion)

clr.AddReference("RevitServices")
import RevitServices
from RevitServices.Persistence import DocumentManager
from RevitServices.Transactions import TransactionManager

doc = DocumentManager.Instance.CurrentDBDocument
assemblies = UnwrapElement(IN[0])
element_array = UnwrapElement(IN[1])

def AddAssemblyMembers(assembly, items):
	if not isinstance(items, list): items = [items]
	ids = [x.Id for x in items]
	idlist = List[ElementId](ids)
	try:
		assembly.AddMemberIds(idlist)
		return assembly
	except: return None

TransactionManager.Instance.EnsureInTransaction(doc)
if isinstance(assemblies, list): OUT = [AddAssemblyMembers(x,y) for x, y in zip(assemblies, element_array)]
else: OUT = AddAssemblyMembers(assemblies, element_array)
TransactionManager.Instance.TransactionTaskDone()
# ----------------------------------------
assembly_2 = Output(python_script)  # "assembly"
