# Dynamo custom node Assembly.Members.dyf (Dynamo 3.6.1.9895)
# category: Clockwork.Revit.Elements.Query
# Retrieves the members of an assembly
# packages: PythonNet3 Engine 1.1.1

assembly = Input(assembly: var[]..[])
python_script = Python(IN[0]=assembly)  # PythonNet3
# ---------- python_script.python (12 lines) ----------
import clr
clr.AddReference('RevitAPI')
from Autodesk.Revit.DB import *

def GetMembers(item):
	if hasattr(item, "GetMemberIds"): return [item.Document.GetElement(x) for x in item.GetMemberIds()]
	else: return list()

items = UnwrapElement(IN[0])

if isinstance(IN[0], list): OUT = [GetMembers(x) for x in items]
else: OUT = GetMembers(items)
# ----------------------------------------
memberElements = Output(python_script)
