# Dynamo custom node Binary.ToBooleans.dyf (Dynamo 2.0.1.5055)
# category: Clockwork.String.Generate.Actions
# Converts a binary string to a list of booleans

str = Input(str: string)
explode = Custom[String.Explode](str=str)  # Chops up a string into a list of characters
code_block = CodeBlock(val=explode) { val == "1" ? true : (val == "0" ? false : null); }
bool = Output(code_block)
