# Dynamo custom node Binary.ToDecimal.dyf (Dynamo 3.6.1.9895)
# category: Clockwork.String.Generate.Actions
# Converts a string of a binary number into a decimal value
# packages: PythonNet3 Engine 1.1.1

binary = Input(binary: string)
python_script = Python(IN[0]=binary)  # PythonNet3
# ---------- python_script.python (2 lines) ----------
if isinstance(IN[0], list): OUT = [int(x,2) for x in IN[0]]
else: OUT = int(IN[0],2)
# ----------------------------------------
decimal = Output(python_script)
