# Dynamo custom node BoundingBox.Properties.dyf (Dynamo 2.0.1.5055)
# category: Clockwork.Geometry.Abstract.Query
# Retrieves the centroid, width, depth and height of a given bounding box

boundingBox = Input(boundingBox: Autodesk.DesignScript.Geometry.BoundingBox)
minPoint = BoundingBox.MinPoint(boundingBox=boundingBox)
maxPoint = BoundingBox.MaxPoint(boundingBox=boundingBox)
create = List.Create(item0=minPoint, item1=maxPoint)
transpose = List.Transpose(lists=create)
average = Custom[Point.Average](points=transpose)  # Determines the average of a list of points
Centroid = Output(average)
X = Point.X(point=maxPoint)
X_2 = Point.X(point=minPoint)
Y = Point.Y(point=maxPoint)
Y_2 = Point.Y(point=minPoint)
Z = Point.Z(point=maxPoint)
Z_2 = Point.Z(point=minPoint)
code_block = CodeBlock(maxX=X, minX=X_2, maxY=Y, minY=Y_2, maxZ=Z, minZ=Z_2)
# ---------- code_block.designscript (6 lines) ----------
// Width
maxX - minX;
// Depth
maxY - minY;
// Height
maxZ - minZ;
# ----------------------------------------
Width = Output(code_block.out0)
Depth = Output(code_block.out1)
Height = Output(code_block.out2)
