# Dynamo custom node Buckyball.ByOriginAndRadius.dyf (Dynamo 3.6.1.9895)
# category: Clockwork.Geometry.Shapes.Create
# Returns all the data necessary for modeling a truncated icosahedron (vertices and struts) as well as the surface area and volume.
# packages: PythonNet3 Engine 1.1.1, Clockwork for Dynamo 2.x 2.12.0

code_block = CodeBlock()
# ---------- code_block.designscript (11 lines) ----------
// The important thing for creating *all* point coordinates
// is to set the lacing options of all subsequent Point nodes to cross product.
phi = Math.GoldenRatio;
[0];
[1,-1];
[3*phi,-3*phi];
[2,-2];
[1+2*phi,-(1+2*phi)];
[phi,-phi];
[2+phi,-(2+phi)];
[2*phi,-2*phi];
# ----------------------------------------
byCoordinates = Point.ByCoordinates(x=code_block.out1, y=code_block.out2, z=code_block.out3, lacing=CrossProduct)
byCoordinates_2 = Point.ByCoordinates(x=code_block.out2, y=code_block.out3, z=code_block.out1, lacing=CrossProduct)
byCoordinates_3 = Point.ByCoordinates(x=code_block.out3, y=code_block.out1, z=code_block.out2, lacing=CrossProduct)
byCoordinates_4 = Point.ByCoordinates(x=code_block.out4, y=code_block.out5, z=code_block.out6, lacing=CrossProduct)
byCoordinates_5 = Point.ByCoordinates(x=code_block.out5, y=code_block.out6, z=code_block.out4, lacing=CrossProduct)
byCoordinates_6 = Point.ByCoordinates(x=code_block.out6, y=code_block.out4, z=code_block.out5, lacing=CrossProduct)
byCoordinates_7 = Point.ByCoordinates(x=code_block.out2, y=code_block.out7, z=code_block.out8, lacing=CrossProduct)
byCoordinates_8 = Point.ByCoordinates(x=code_block.out7, y=code_block.out8, z=code_block.out2, lacing=CrossProduct)
byCoordinates_9 = Point.ByCoordinates(x=code_block.out8, y=code_block.out2, z=code_block.out7, lacing=CrossProduct)
create = List.Create(item0=byCoordinates, item1=byCoordinates_2, item2=byCoordinates_3, item3=byCoordinates_4, item4=byCoordinates_5, item5=byCoordinates_6, item6=byCoordinates_7, item7=byCoordinates_8, item8=byCoordinates_9)
flatten = List.Flatten(list=create)
almostZero = Custom[AlmostZero]()  # package Clockwork for Dynamo 2.x; Returns a feasable computational tolerance to zero (1.0e-9 or a billionth of 1) for use in calculations. More background info: https://github.com/DynamoDS/Dynamo/issues/879
python_script = Python(IN[0]=flatten, IN[1]=almostZero)  # PythonNet3
# ---------- python_script.python (32 lines) ----------
import clr
clr.AddReference('ProtoGeometry')
from Autodesk.DesignScript.Geometry import *

points = IN[0]
almostzero = IN[1]
struts = list()

# this function recursively finds all the pairs of points of the buckyball struts
def BuckyballStruts(points,struts):
	firstpoint = points[0]
	restofpoints = points[1:]
	# measure distance between first point and rest of points
	distances = [firstpoint.DistanceTo(x) for x in restofpoints]
	# filter out all points that do not have a distance of 2 to the first point
	strutpoints = list()
	strutpointpairs = list()
	i = 0
	for dist in distances:
		# use a little tolerance so we catch all struts
		if dist > 2 - almostzero and dist < 2 + almostzero:
			strutpoints.append(restofpoints[i])
			strutpointpairs.append((firstpoint,restofpoints[i]))
		i += 1
	# add strutpointpairs to struts
	if len(strutpointpairs) > 0: struts.extend(strutpointpairs)
	# Continue processing the list recursively until there's only one point left. By always removing the first point from the list, we ensure that no duplicate struts are computed.
	if len(restofpoints) > 1:
		return BuckyballStruts(restofpoints,struts)
	else: return (restofpoints,struts)
	
OUT = BuckyballStruts(points,struts)[1]
# ----------------------------------------
python_script_2 = Python(IN[0]=python_script, IN[1]=flatten, IN[2]=almostZero)  # PythonNet3
# ---------- python_script_2.python (70 lines) ----------
import clr
clr.AddReference('ProtoGeometry')
from Autodesk.DesignScript.Geometry import *

struts = IN[0]
points = IN[1]
almostzero = IN[2]

def BuckyballFaces(struts,points,planes,almostzero,vertices):
	firststrut = struts[0]
	struts.pop(0)
	# find the two adjacent struts
	adjacent = list()
	for strut in struts:
		for point in strut:
			if point.IsAlmostEqualTo(firststrut[0]):
				adjacent.append(strut)
				break
		if len(adjacent) == 2:
			break
	# identify planes and find all vertices on planes		
	vlist = list()		
	for item in adjacent:
		triangle = (firststrut[1],item[0],item[1])
		pl = Plane.ByBestFitThroughPoints(triangle)	
		vlist = list()
		for point in points:
			dist = pl.DistanceTo(point)
			if dist < almostzero and dist > -almostzero:
				vlist.append(point)
		newplane = (Plane.ByBestFitThroughPoints(vlist))
		append_vertices = True
		for pl in planes:
			if newplane.IsAlmostEqualTo(pl):
				append_vertices = False
		if append_vertices: 
			vertices.append(vlist)
			planes.append(newplane)
	# let this function recursively call itself until it finds all planes
	if len(planes) < 32:
		return BuckyballFaces(struts,points,planes,almostzero,vertices)
	else:
		return (struts,points,planes,almostzero,vertices)

def OrderFaceIndices(p_ordered,p_unordered,almostzero):
	i = 0;
	for p in p_unordered:
		dist = p_ordered[(len(p_ordered)-1)].DistanceTo(p)
		if dist > 2-almostzero and dist < 2+almostzero:
			p_ordered.append(p)
			p_unordered.pop(i)
			break
		i += 1
	if len(p_unordered) > 0:
		return OrderFaceIndices(p_ordered,p_unordered,almostzero)
	else:
		return (p_ordered,p_unordered,almostzero)

vlist_unordered = BuckyballFaces(struts,points,list(),almostzero,list())[4]

vset_ordered = list()
for vset in vlist_unordered:
	p_ordered = [vset[0]]
	vset.pop(0)
	vset_ordered.append(OrderFaceIndices(p_ordered,vset,almostzero))

vset_out = list()
for vset in vset_ordered:
	vset_out.append(vset[0])
OUT = vset_out
# ----------------------------------------
create_2 = List.Create(item0=flatten, item1=python_script, item2=python_script_2)
flatten_2 = List.Flatten(list=create_2@L3)
radius = Input(radius: double = 1)
code_block_2 = CodeBlock(radius=radius)
# ---------- code_block_2.designscript (3 lines) ----------
// Determine scale factor based on radius
factor = 1/4*Math.Sqrt(58+18*Math.Sqrt(5));
scaling = radius/2/factor;
# ----------------------------------------
scale = Geometry.Scale(geometry=flatten_2, amount=code_block_2.scaling)
origin = Input(origin: Autodesk.DesignScript.Geometry.Point = Autodesk.DesignScript.Geometry.Point.Origin())
asVector = Point.AsVector(point=origin)
add = Point.Add(point=scale, vectorToAdd=asVector)
code_block_3 = CodeBlock(seq=add) { seq[0]; seq[1]; seq[2]; }
# note: Add scale and origin for:
# [0] vertices
# [1] struts
# [2] surfaces
transpose = List.Transpose(lists=code_block_3.out0)
Vertices = Output(transpose)
code_block_4 = CodeBlock { 2; }
chop = List.Chop(list=code_block_3.out1, lengths=code_block_4)
average = Custom[Point.Average](points=chop)  # package Clockwork for Dynamo 2.x; Determines the average of a list of points
byTwoPoints = Vector.ByTwoPoints(start=origin, end=average)
normalized = Vector.Normalized(vector=byTwoPoints)
StrutsUpVectors = Output(normalized)
transpose_2 = List.Transpose(lists=chop)
code_block_5 = CodeBlock(seq=transpose_2)
# ---------- code_block_5.designscript (6 lines) ----------
seq[0];
seq[1];
// strut 1
seq[0][0];
// strut 2
seq[1][0];
# ----------------------------------------
byStartPointEndPoint = Line.ByStartPointEndPoint(startPoint=code_block_5.out0, endPoint=code_block_5.out1)
StrutGeometry = Output(byStartPointEndPoint)
StrutPoints = Output(transpose_2)
count = List.Count(list=python_script_2@L2)
chop_2 = List.Chop(list=code_block_3.out2, lengths=count)
code_block_6 = CodeBlock { 6; }
filterBySublistLength = Custom[List.FilterBySublistLength](seq=chop_2, length=code_block_6)  # package Clockwork for Dynamo 2.x; Filters out all sublists that do not have the specified length
HexagonPoints = Output(filterBySublistLength.in)
PentagonPoints = Output(filterBySublistLength.out)
byPoints = Polygon.ByPoints(points=chop_2)
byPatch = Surface.ByPatch(closedCurve=byPoints)
SurfaceGeometry = Output(byPatch)
distanceTo = Geometry.DistanceTo(geometry=code_block_5.out2, other=code_block_5.out3)
code_block_7 = CodeBlock(strutlength=distanceTo)
# ---------- code_block_7.designscript (3 lines) ----------
// Compute surface area and volume based on strut length
buckyarea = (20*3/2*Math.Sqrt(3)+12*5/4*Math.Sqrt(1+2/Math.Sqrt(5)))*Math.Pow(strutlength,2);
buckyvol = 1/4*(125+43*Math.Sqrt(5))*Math.Pow(strutlength,3);
# ----------------------------------------
SurfaceArea = Output(code_block_7.buckyarea)
Volume = Output(code_block_7.buckyvol)
