# Dynamo custom node BuiltInCategory.FromInput.dyf (Dynamo 3.6.1.9895)
# category: Clockwork.Revit.Selection.Miscellaneous.Query
# Returns a BuiltInCategory from a category, a Dynamo-wrapped category, a BuiltInCategory or a string representing a BuiltInCategory.
# packages: PythonNet3 Engine 1.1.1

input = Input(input: var[]..[])
python_script = Python(IN[0]=input)  # PythonNet3
# ---------- python_script.python (32 lines) ----------
import System
import clr
clr.AddReference('RevitAPI')
from Autodesk.Revit.DB import *

clr.AddReference("RevitNodes")
import Revit
clr.ImportExtensions(Revit.Elements)

clr.AddReference("RevitServices")
import RevitServices
from RevitServices.Persistence import DocumentManager

def GetBicFromInput(var):	
	if var:
		if isinstance(var, str): 
			try:
				eval("BuiltInCategory." + var)
				return var
			except: return None
		elif isinstance(var, int): return System.Enum.GetName(BuiltInCategory, var)
		else:
			cattype = var.GetType().ToString()
			if cattype == "Revit.Elements.Category": return System.Enum.GetName(BuiltInCategory, var.Id)
			elif cattype == "Autodesk.Revit.DB.BuiltInCategory": return var
			else: return None
	else: return None

doc = DocumentManager.Instance.CurrentDBDocument

if isinstance(IN[0], list): OUT = [GetBicFromInput(x) for x in IN[0]]
else: OUT = GetBicFromInput(IN[0])
# ----------------------------------------
str = Output(python_script)
