# Dynamo custom node BuiltInParameter.ByName.dyf (Dynamo 2.12.1.8246)
# category: Clockwork.Revit.Selection.Miscellaneous.Query
# Looks up all the built-in parameters based on a given name (or part of a name) of the parameters. Search is case-insensitive.

builtInParameters = Custom[Document.BuiltInParameters]()  # List all the available BuiltInParameters
searchFor = Input(searchFor: string)
ignoreCase = Input(ignoreCase: bool = true)
contains = String.Contains(string=builtInParameters.BuiltInParameters, searchFor=searchFor, ignoreCase=ignoreCase)
filterByBoolMask = List.FilterByBoolMask(list=builtInParameters.BuiltInParameters, mask=contains)
BuiltInParameters = Output(filterByBoolMask.in)
filterByBoolMask_2 = List.FilterByBoolMask(list=builtInParameters.ElementIDs, mask=contains)
ElementIDs = Output(filterByBoolMask_2.in)
filterByBoolMask_3 = List.FilterByBoolMask(list=builtInParameters.ParameterNames, mask=contains)
ParameterNames = Output(filterByBoolMask_3.in)
