# Dynamo custom node Category.FromInput.dyf (Dynamo 3.6.1.9895)
# category: Clockwork.Revit.Selection.Miscellaneous.Query
# Returns a category from a category, a Dynamo-wrapped category, a BuiltInCategory or a string representing a BuiltInCategory.
# packages: PythonNet3 Engine 1.1.1

category = Input(category: var[]..[])
python_script = Python(IN[0]=category)  # PythonNet3
# ---------- python_script.python (31 lines) ----------
import System
import clr
clr.AddReference('RevitAPI')
from Autodesk.Revit.DB import *

clr.AddReference("RevitNodes")
import Revit
clr.ImportExtensions(Revit.Elements)

clr.AddReference("RevitServices")
import RevitServices
from RevitServices.Persistence import DocumentManager

def GetCatFromInput(var):	
	if var:
		if isinstance(var, str): 
			try: return Category.GetCategory(doc, eval("BuiltInCategory." + var))
			except: return None
		elif isinstance(var, int): return Category.GetCategory(doc, var)
		else:
			cattype = var.GetType().ToString()
			if cattype == "Autodesk.Revit.DB.Category": return var
			elif cattype == "Autodesk.Revit.DB.BuiltInCategory": return Category.GetCategory(doc, var)
			else: return None
	else: return None

doc = DocumentManager.Instance.CurrentDBDocument
cats = UnwrapElement(IN[0])

if isinstance(IN[0], list): OUT = [GetCatFromInput(x) for x in cats]
else: OUT = GetCatFromInput(cats)
# ----------------------------------------
RevitCategory = Output(python_script)
