# Dynamo custom node Category.Material.dyf (Dynamo 3.6.1.9895)
# category: Clockwork.Revit.Elements.Query
# Retrieves the material assigned to the given category in the object styles
# packages: PythonNet3 Engine 1.1.1, Clockwork for Dynamo 2.x 2.12.1

category = Input(category: var[]..[])  # Works with categories, BuiltInCategories and BuiltInCategories as strings
fromInput = Custom[Category.FromInput](category=category)  # package Clockwork for Dynamo 2.x; Returns a category from a category, a Dynamo-wrapped category, a BuiltInCategory or a string representing a BuiltInCategory.
python_script = Python(IN[0]=fromInput)  # PythonNet3
# ---------- python_script.python (18 lines) ----------
import clr
clr.AddReference('RevitAPI')
from Autodesk.Revit.DB import *

clr.AddReference("RevitNodes")
import Revit
clr.ImportExtensions(Revit.Elements)

cats = UnwrapElement(IN[0])

def GetCatMat(cat):
	if hasattr(cat, "Material"): 
		try: return cat.Material.ToDSType(True)
		except: return None
	else: return None

if isinstance(IN[0], list): OUT = [GetCatMat(x) for x in cats]
else: OUT = GetCatMat(cats)
# ----------------------------------------
Material = Output(python_script)
