# Dynamo custom node Category.ResetMaterial.dyf (Dynamo 3.6.1.9895)
# category: Clockwork.Revit.Elements.Actions
# Resets the material for a given category in the Object Styles.
# packages: PythonNet3 Engine 1.1.1, Clockwork for Dynamo 2.x 2.4.0

category = Input(category: var[]..[])  # Works with categories, BuiltInCategories and BuiltInCategories as strings
fromInput = Custom[Category.FromInput](category=category)  # package Clockwork for Dynamo 2.x; Returns a category from a category, a Dynamo-wrapped category, a BuiltInCategory or a string representing a BuiltInCategory.
python_script = Python(IN[0]=fromInput)  # PythonNet3
# ---------- python_script.python (26 lines) ----------
import clr
clr.AddReference('RevitAPI')
from Autodesk.Revit.DB import *

clr.AddReference("RevitNodes")
import Revit
clr.ImportExtensions(Revit.Elements)

clr.AddReference("RevitServices")
import RevitServices
from RevitServices.Persistence import DocumentManager
from RevitServices.Transactions import TransactionManager

doc = DocumentManager.Instance.CurrentDBDocument
cats = UnwrapElement(IN[0])

def ResetCatMat(cat):
	if hasattr(cat, "Material"): 
		cat.Material = doc.GetElement(ElementId.InvalidElementId)
		return True
	else: return False

TransactionManager.Instance.EnsureInTransaction(doc)
if isinstance(IN[0], list): OUT = [ResetCatMat(x) for x in cats]
else: OUT = ResetCatMat(cats)
TransactionManager.Instance.TransactionTaskDone()
# ----------------------------------------
success = Output(python_script)
