# Dynamo custom node Category.Subcategories.dyf (Dynamo 3.6.1.9895)
# category: Clockwork.Revit.Elements.Query
# Retrieves all the subcategories for a given category
# packages: PythonNet3 Engine 1.1.1, Clockwork for Dynamo 2.x 2.12.1

category = Input(category: var[]..[])  # Works with categories, BuiltInCategories and BuiltInCategories as strings
fromInput = Custom[Category.FromInput](category=category)  # package Clockwork for Dynamo 2.x; Returns a category from a category, a Dynamo-wrapped category, a BuiltInCategory or a string representing a BuiltInCategory.
python_script = Python(IN[0]=fromInput)  # PythonNet3
# ---------- python_script.python (17 lines) ----------
import clr
clr.AddReference('RevitAPI')
from Autodesk.Revit.DB import *

clr.AddReference("RevitNodes")
import Revit
clr.ImportExtensions(Revit.Elements)

def GetSubcategories(cat):
    if hasattr(cat, "SubCategories"):
        return [Revit.Elements.Category.ById(x.Id.Value) for x in cat.SubCategories]
    else: return []

cats = UnwrapElement(IN[0])

if isinstance(IN[0], list): OUT = [GetSubcategories(x) for x in cats]
else: OUT = GetSubcategories(cats)
# ----------------------------------------
subcategories = Output(python_script)
