# Dynamo custom node Clipboard.GetFrom.dyf (Dynamo 3.6.1.9895)
# category: Clockwork.ImportExport.Query
# Gets the content of the clipboard. ATTENTION: Will only work with strings.
# packages: PythonNet3 Engine 1.1.1

toggle = Input(toggle: bool = true)
python_script = Python(IN[0]=toggle)  # PythonNet3
# ---------- python_script.python (21 lines) ----------
import clr
import System
from System.Threading import Thread, ThreadStart
clr.AddReference("System.Windows.Forms")

clipboardcontents = '###'

def GetText():
    def thread_proc():
        global clipboardcontents
        clipboardcontents = System.Windows.Forms.Clipboard.GetText()
    t = Thread(ThreadStart(thread_proc))
    t.ApartmentState = System.Threading.ApartmentState.STA
    t.Start()
    t.Join()

try:
	GetText()
	OUT = clipboardcontents
except:
	OUT = 'Data could not be copied to clipboard'
# ----------------------------------------
str = Output(python_script)
