# Dynamo custom node Clipboard.SendTo.dyf (Dynamo 3.6.1.9895)
# category: Clockwork.ImportExport.Actions
# Copies a string to the clipboard.
# packages: PythonNet3 Engine 1.1.1

str = Input(str: string)
python_script = Python(IN[0]=str)  # PythonNet3
# ---------- python_script.python (20 lines) ----------
import clr
import System
from System.Threading import Thread, ThreadStart
clr.AddReference("System.Windows.Forms")

def SetText(text):
    def thread_proc():
        System.Windows.Forms.Clipboard.SetText(text)
    t = Thread(ThreadStart(thread_proc))
    t.ApartmentState = System.Threading.ApartmentState.STA
    t.Start()

try:
	if IN[0] != "" and IN[0] != None:
		SetText(IN[0])
		OUT = IN[0]
	else:
		OUT = "Invalid input: Empty string or Null value!"
except:
	OUT = 'Data could not be copied to clipboard!'
# ----------------------------------------
str_2 = Output(python_script)  # "str"
