# Dynamo custom node Color.ByName.dyf (Dynamo 3.6.1.9895)
# category: Clockwork.Display.Create
# Returns the color that corresponds to the given name (look here for a list of defined colors: https://docs.microsoft.com/en-us/dotnet/api/system.drawing.knowncolor?view=netframework-4.7.2).
# packages: PythonNet3 Engine 1.1.1

code_block = CodeBlock { 255; }
str = Input(str: var[]..[])
python_script = Python(IN[0]=str)  # PythonNet3
# ---------- python_script.python (11 lines) ----------
import clr
clr.AddReference('System.Drawing')
import System.Drawing

def ColorByName(str):
	syscol = System.Drawing.Color.FromName(str)
	return syscol.R,syscol.G,syscol.B
	

if isinstance(IN[0], list): OUT = map(list, zip(*[ColorByName(x) for x in IN[0]]))
else: OUT = ColorByName(IN[0])
# ----------------------------------------
code_block_2 = CodeBlock(seq=python_script) { seq[0]; seq[1]; seq[2]; }
byARGB = Color.ByARGB(alpha=code_block, red=code_block_2.out0, green=code_block_2.out1, blue=code_block_2.out2)
color = Output(byARGB)
