# Dynamo custom node Color.FromDynamoColor.dyf (Dynamo 3.6.1.9895)
# category: Clockwork.Revit.Conversion.Create
# Creates a Revit color from a Dynamo color
# packages: PythonNet3 Engine 1.1.1

DynamoColor = Input(DynamoColor: DSCore.Color)
red = Color.Red(color=DynamoColor)
green = Color.Green(color=DynamoColor)
blue = Color.Blue(color=DynamoColor)
python_script = Python(IN[0]=red, IN[1]=green, IN[2]=blue)  # PythonNet3
# ---------- python_script.python (19 lines) ----------
import clr
clr.AddReference('RevitAPI')
from Autodesk.Revit.DB import *
from Autodesk.Revit import *

clr.AddReference("RevitServices")
import RevitServices
from RevitServices.Persistence import DocumentManager
from RevitServices.Transactions import TransactionManager

doc = DocumentManager.Instance.CurrentDBDocument
red = IN[0]
green = IN[1]
blue = IN[2]

TransactionManager.Instance.EnsureInTransaction(doc)
if isinstance(IN[0], list): OUT = [Color(r, g, b) for r, g, b in zip(red, green, blue)]
else: OUT = Color(red, green, blue)
TransactionManager.Instance.TransactionTaskDone()
# ----------------------------------------
RevitColor = Output(python_script)
