# Dynamo custom node CurtainPanel.HostPanel.dyf (Dynamo 3.6.1.9895)
# category: Clockwork.Revit.Elements.Query
# Retrieves the host panel of a given curtain panel. This is typcially needed when wanting to access wall elements used as curtain panels. If no host panel is found, the node will return the input panel instead.
# packages: PythonNet3 Engine 1.1.1

curtainPanel = Input(curtainPanel: var[]..[])
python_script = Python(IN[0]=curtainPanel)  # PythonNet3
# ---------- python_script.python (19 lines) ----------
import clr
clr.AddReference('RevitAPI')
from Autodesk.Revit.DB import *

clr.AddReference("RevitNodes")
import Revit
clr.ImportExtensions(Revit.Elements)

def GetHostPanel(item):
    if hasattr(item, "FindHostPanel"):
        hpId = item.FindHostPanel()
        if hpId != ElementId.InvalidElementId: return item.Document.GetElement(hpId).ToDSType(True)
        else: return item
    else: return item

items = UnwrapElement(IN[0])

if isinstance(IN[0], list): OUT = [GetHostPanel(x) for x in items]
else: OUT = GetHostPanel(items)
# ----------------------------------------
hostPanel = Output(python_script)
