# Dynamo custom node Curve.ClosedLoopThroughPoints.dyf (Dynamo 2.0.1.5055)
# category: Clockwork.Geometry.Curves.Create
# Creates a *closed* loop of curves based on a given list of points

points = Input(points: Autodesk.DesignScript.Geometry.Point[])
boolean = BoolSelector(true)  # graph input
byPoints = PolyCurve.ByPoints(points=points, connectLastToFirst=boolean)
curves = PolyCurve.Curves(polyCurve=byPoints)
Curves = Output(curves)
