# Dynamo custom node DesignOption.IsPrimary.dyf (Dynamo 3.6.1.9895)
# category: Clockwork.Revit.Elements.Query
# Determines whether a given design option is the primary option in its set
# packages: PythonNet3 Engine 1.1.1

designOption = Input(designOption: var[]..[])
python_script = Python(IN[0]=designOption)  # PythonNet3
# ---------- python_script.python (13 lines) ----------
import clr
import System
clr.AddReference('RevitAPI')
from Autodesk.Revit.DB import *

def DesignOptionIsPrimary(item):
	if hasattr(item, "IsPrimary"): return item.IsPrimary
	else: return False

items = UnwrapElement(IN[0])

if isinstance(IN[0], list): OUT = [DesignOptionIsPrimary(x) for x in items]
else: OUT = DesignOptionIsPrimary(items)
# ----------------------------------------
bool = Output(python_script)
