# Dynamo custom node Dimension.ReferencedElements.dyf (Dynamo 3.6.1.9895)
# category: Clockwork.Revit.Elements.Query
# Returns all elements that are referenced by a given dimension
# packages: PythonNet3 Engine 1.1.1

dimension = Input(dimension: var[]..[])
python_script = Python(IN[0]=dimension)  # PythonNet3
# ---------- python_script.python (36 lines) ----------
import clr
clr.AddReference('RevitAPI')
from Autodesk.Revit.DB import *

clr.AddReference("RevitNodes")
import Revit
clr.ImportExtensions(Revit.Elements)

def GetDimensionReferences(item):
	if hasattr(item, "References"):
		refs = []
		srefs = []
		linkInstances = []
		for r in item.References:
			if r.LinkedElementId != ElementId.InvalidElementId: 
				if item.Document.GetElement(r.ElementId).GetLinkDocument():
					refs.append(item.Document.GetElement(r.ElementId).GetLinkDocument().GetElement(r.LinkedElementId))
					srefs.append(r.ConvertToStableRepresentation(item.Document.GetElement(r.ElementId).GetLinkDocument()))
				# if the link isn't loaded, just return the RevitLinkInstance instead of the actual element
				else: 
					refs.append(item.Document.GetElement(r.ElementId))
					srefs.append(r.ConvertToStableRepresentation(item.Document))
				linkInstances.append(item.Document.GetElement(r.ElementId))
			else: 
				refs.append(item.Document.GetElement(r.ElementId))
				srefs.append(r.ConvertToStableRepresentation(item.Document))
				linkInstances.append(None)
		return refs, linkInstances, srefs
	else: return [], [], []

dimensions = UnwrapElement(IN[0])

if isinstance(IN[0], list): 
	if len(IN[0]) > 0: OUT = list(zip(*[GetDimensionReferences(x) for x in dimensions]))
	else: OUT = [[],[],[]]
else: OUT = GetDimensionReferences(dimensions)
# ----------------------------------------
code_block = CodeBlock(seq=python_script)
# ---------- code_block.designscript (6 lines) ----------
// elements
seq[0];
// linkinstances
seq[1];
// stable references
seq[2];
# ----------------------------------------
elements = Output(code_block.out0)
linkInstances = Output(code_block.out1)
stableReferences = Output(code_block.out2)
