# Dynamo custom node DisplayUnit.ToInternalUnit.dyf (Dynamo 3.6.1.9895)
# category: Clockwork.Revit.Units.Actions
# Converts a value from a given display unit to Revit's internal unit
# packages: PythonNet3 Engine 1.1.1

val = Input(val: double)
displayUnitType = Input(displayUnitType: var)
python_script = Python(IN[0]=val, IN[1]=displayUnitType)  # PythonNet3
# ---------- python_script.python (14 lines) ----------
import clr
clr.AddReference('RevitAPI')
from Autodesk.Revit.DB import *

def ToInternalUnits(val, unittype):
	if str(dispunit.GetType()) == "Autodesk.Revit.DB.ForgeTypeId":
		return UnitUtils.ConvertToInternalUnits(val,unittype)
	else: return None

vals = IN[0]
dispunit = IN[1]

if isinstance(IN[0], list): OUT = [ToInternalUnits(x, dispunit) for x in vals]
else: OUT = ToInternalUnits(vals, dispunit)
# ----------------------------------------
val_2 = Output(python_script)  # "val"
