# Dynamo custom node DividedSurface.AddIntersect.dyf (Dynamo 3.6.1.9895)
# category: Clockwork.Revit.Elements.Actions
# Adds an intersect to a divided surface
# packages: PythonNet3 Engine 1.1.1, Clockwork for Dynamo 2.x 2.12.0

dividedSurface = Input(dividedSurface: Revit.Elements.DividedSurface)
element = Input(element: var[]..[])
turnIntoList = Custom[TurnIntoList](unknownItem=element)  # package Clockwork for Dynamo 2.x; Turns an element (or a nested list) into a flat list
python_script = Python(IN[0]=dividedSurface, IN[1]=turnIntoList)  # PythonNet3
# ---------- python_script.python (19 lines) ----------
import clr
clr.AddReference('RevitAPI')
from Autodesk.Revit.DB import *

clr.AddReference("RevitServices")
import RevitServices
from RevitServices.Persistence import DocumentManager
from RevitServices.Transactions import TransactionManager

doc = DocumentManager.Instance.CurrentDBDocument
divsurf = UnwrapElement(IN[0])
intersects = UnwrapElement(IN[1])

TransactionManager.Instance.EnsureInTransaction(doc)
for item in intersects:
	divsurf.AddIntersectionElement(item.Id)
TransactionManager.Instance.TransactionTaskDone()

OUT = divsurf
# ----------------------------------------
dividedSurface_2 = Output(python_script)  # "dividedSurface"
