# Dynamo custom node DividedSurface.EvaluateGridNodes.dyf (Dynamo 3.6.1.9895)
# category: Clockwork.Revit.Elements.Query
# Returns UV and XYZ coordinates as well as surface normals for all grid nodes of a given divided surface. Also returns the underlying face.
# packages: PythonNet3 Engine 1.1.1, Clockwork for Dynamo 2.x 2.12.0

dividedSurface = Input(dividedSurface: var[]..[])
includeOverhangingNodes = Input(includeOverhangingNodes: bool = false)
python_script = Python(IN[0]=dividedSurface, IN[1]=includeOverhangingNodes)  # PythonNet3
# ---------- python_script.python (42 lines) ----------
import clr
clr.AddReference('RevitAPI')
from Autodesk.Revit.DB import *

clr.AddReference("RevitNodes")
import Revit
clr.ImportExtensions(Revit.Elements)
clr.ImportExtensions(Revit.GeometryConversion)

ds = UnwrapElement(IN[0])
overhanging = IN[1]
uvlist = list()
uvnormals = list()
uvxyzs = list()

face = ds.Host.GetGeometryObjectFromReference(ds.HostReference)
gn = GridNode()
if overhanging == True:
	i = 0
	j = 1
else:
	i = 1
	j = 3
u = i
while (u < (ds.NumberOfUGridlines-i)):
	gn.UIndex = u
	v = i
	vlist = list()
	vnormals = list()
	vxyzs = list()
	while (v < (ds.NumberOfVGridlines-i)):
		gn.VIndex = v
		uv = ds.GetGridNodeUV(gn)
		vlist.append(uv)
		vnormals.append(face.ComputeNormal(uv).ToVector())
		vxyzs.append(face.Evaluate(uv).ToPoint())
		v += 1
	uvlist.append(vlist)
	uvnormals.append(vnormals)
	uvxyzs.append(vxyzs)
	u += 1
OUT = (uvnormals,uvxyzs,face.ToProtoType(),uvlist)
# ----------------------------------------
code_block = CodeBlock(seq=python_script) { seq[0]; seq[1]; seq[2]; seq[3]; }
toDynamoUV = Custom[UV.ToDynamoUV](RevitUV=code_block.out3)  # package Clockwork for Dynamo 2.x; Converts Revit UV coordinates to Dynamo UV coordinates
count = List.Count(list=code_block.out3@L2)
chop = List.Chop(list=toDynamoUV, lengths=count)
UVs = Output(chop)
points = Output(code_block.out1)
normals = Output(code_block.out0)
surface = Output(code_block.out2)
