# Dynamo custom node Document.AddLink.dyf (Dynamo 3.6.1.9895)
# category: Clockwork.Revit.Application.Actions
# Adds a link to a model to the current document
# packages: PythonNet3 Engine 1.1.1

filePath = Input(filePath: string[]..[])  # The path to the model to be linked
relativePath = Input(relativePath: bool = true)  # Set to false if the path type should be absolute.
python_script = Python(IN[0]=filePath, IN[1]=relativePath)  # PythonNet3
# ---------- python_script.python (29 lines) ----------
import clr
clr.AddReference('RevitAPI')
from Autodesk.Revit.DB import *

clr.AddReference("RevitNodes")
import Revit
clr.ImportExtensions(Revit.Elements)

clr.AddReference("RevitServices")
import RevitServices
from RevitServices.Persistence import DocumentManager
from RevitServices.Transactions import TransactionManager

doc = DocumentManager.Instance.CurrentDBDocument
linkpaths = IN[0]
relative = IN[1]

def AddLink(path):
	try:
		linkpath = ModelPathUtils.ConvertUserVisiblePathToModelPath(path)
		linkoptions = RevitLinkOptions(relative)
		linkloadresult = RevitLinkType.Create(doc, linkpath, linkoptions)
		return RevitLinkInstance.Create(doc, linkloadresult.ElementId).ToDSType(False)
	except: return None

TransactionManager.Instance.EnsureInTransaction(doc)
if isinstance(linkpaths, list): OUT = [AddLink(x) for x in linkpaths]
else: OUT = AddLink(linkpaths)
TransactionManager.Instance.TransactionTaskDone()
# ----------------------------------------
RevitLinkInstance = Output(python_script)
