# Dynamo custom node Document.BuiltInCategories.dyf (Dynamo 3.6.1.9895)
# category: Clockwork.Revit.Application.Query
# List all the available BuiltInCategories
# packages: PythonNet3 Engine 1.1.1

dynamoSupportedCategoriesOnly = Input(dynamoSupportedCategoriesOnly: bool = true)
python_script = Python(IN[0]=dynamoSupportedCategoriesOnly)  # PythonNet3
# ---------- python_script.python (19 lines) ----------
import clr
import System
clr.AddReference('RevitAPI')
clr.AddReference('RevitAPIUI')
from Autodesk.Revit.DB import *
import Autodesk
clr.AddReference("RevitNodes")
import Revit

dynamoCatsOnly = IN[0]
version = IN[1]
biclist = [eval("BuiltInCategory."+x) for x in dir(BuiltInCategory) if x.startswith("OST_")]
cdata = []
for bic in biclist:
    try: 
        cdata.append((System.Enum.GetName(BuiltInCategory, bic), ElementId(bic), Revit.Elements.Category.ById(ElementId(bic).Value)))
    except:
        if not dynamoCatsOnly: cdata.append((bic, ElementId(bic), None))
OUT = map(list, zip(*cdata))
# ----------------------------------------
code_block = CodeBlock(seq=python_script) { seq[0]; seq[1]; seq[2]; }
BuiltInCategories = Output(code_block.out0)
ElementIDs = Output(code_block.out1)
Categories = Output(code_block.out2)
