# Dynamo custom node Document.ContainsElementsOfCategory.dyf (Dynamo 2.12.1.8246)
# category: Clockwork.Revit.Application.Query
# Checks if family instances of specified categories are present in the model.
# packages: Clockwork for Dynamo 2.x 2.12.0

category = Input(category: var[]..[])  # Works with categories, BuiltInCategories and BuiltInCategories as strings
toggle = Input(toggle: bool = true)
docOrRevitLinkInstance = Input(docOrRevitLinkInstance: var = null)  # Use only if you want to query a linked model
all_elements_of_category = Custom[All Elements Of Category+](category=category, toggle=toggle, docOrRevitLinkInstance=docOrRevitLinkInstance)  # package Clockwork for Dynamo 2.x; Gets all placed elements of a given category in the model. Unlike the OOTB node it also supports linked models and a few more special categories (e.g. Legend Components).
isNotEmpty = Custom[List.IsNotEmpty](seq=all_elements_of_category@L2)  # package Clockwork for Dynamo 2.x; Just the inversion of the built-in Is Empty List node.
anyTrue = List.AnyTrue(list=isNotEmpty)
any = Output(anyTrue)  # "any?"
allTrue = List.AllTrue(list=isNotEmpty)
all = Output(allTrue)  # "all?"
returnListOrSingleValue = Custom[ReturnListOrSingleValue](unknownItem=category, seq=isNotEmpty)  # package Clockwork for Dynamo 2.x; If the unknown item is not a list but rather a single item, only the first item of the list (input "seq") will be returned.
per_category = Output(returnListOrSingleValue)
returnListOrSingleValue_2 = Custom[ReturnListOrSingleValue](unknownItem=category, seq=all_elements_of_category)
instances = Output(returnListOrSingleValue_2)
