# Dynamo custom node Document.IsWorkshared.dyf (Dynamo 3.6.1.9895)
# category: Clockwork.Revit.Application.Query
# Returns true if the current project is workshared
# packages: PythonNet3 Engine 1.1.1

toggle = Input(toggle: bool = true)
docOrRevitLinkInstance = Input(docOrRevitLinkInstance: var = null)  # Use only if you want to query a linked model
python_script = Python(IN[0]=toggle, IN[1]=docOrRevitLinkInstance)  # PythonNet3
# ---------- python_script.python (16 lines) ----------
import clr
clr.AddReference("RevitServices")
import RevitServices
from RevitServices.Persistence import DocumentManager

inputdoc = UnwrapElement(IN[1])
if inputdoc == None:
	doc = DocumentManager.Instance.CurrentDBDocument
elif inputdoc.GetType().ToString() == "Autodesk.Revit.DB.RevitLinkInstance":
	doc = inputdoc.GetLinkDocument()
elif inputdoc.GetType().ToString() == "Autodesk.Revit.DB.Document":
	doc = inputdoc
else: doc = None

if doc.IsWorkshared: OUT = True
else: OUT = False
# ----------------------------------------
bool = Output(python_script)
