# Dynamo custom node Document.PerformanceAdviserRules.dyf (Dynamo 3.6.1.9895)
# category: Clockwork.Revit.Application.Query
# Retrieves all Performance Adviser Rules from the current document
# packages: PythonNet3 Engine 1.1.1

docOrRevitLinkInstance = Input(docOrRevitLinkInstance: var = null)  # Use only if you want to query a linked model
python_script = Python(IN[0]=docOrRevitLinkInstance)  # PythonNet3
# ---------- python_script.python (26 lines) ----------
import clr
clr.AddReference('RevitAPI')
from Autodesk.Revit.DB import *
import Autodesk

clr.AddReference("RevitNodes")
import Revit
clr.ImportExtensions(Revit.Elements)

clr.AddReference("RevitServices")
import RevitServices
from RevitServices.Persistence import DocumentManager

inputdoc = UnwrapElement(IN[0])
if inputdoc == None:
	doc = DocumentManager.Instance.CurrentDBDocument
elif inputdoc.GetType().ToString() == "Autodesk.Revit.DB.RevitLinkInstance":
	doc = inputdoc.GetLinkDocument()
elif inputdoc.GetType().ToString() == "Autodesk.Revit.DB.Document":
	doc = inputdoc
else: doc = None

elementlist = []
for rule in PerformanceAdviser.GetPerformanceAdviser().GetAllRuleIds():
	elementlist.append(rule.Guid.ToString())
OUT = elementlist
# ----------------------------------------
byId = PerformanceAdviserRule.ById(guid=python_script)
performanceAdviserRules = Output(byId)
