# Dynamo custom node Document.ProjectParameters.dyf (Dynamo 3.6.1.9895)
# category: Clockwork.Revit.Application.Query
# Retrieves all project parameters and the categories they have been assigned to
# packages: PythonNet3 Engine 1.1.1, Clockwork for Dynamo 2.x 2.12.2

toggle = Input(toggle: bool = true)
docOrRevitLinkInstance = Input(docOrRevitLinkInstance: var = null)  # Use only if you want to query a linked model
version = Custom[Application.Version]()  # package Clockwork for Dynamo 2.x; Retrieves the name, version and build of the current Revit application.
python_script = Python(IN[0]=toggle, IN[1]=docOrRevitLinkInstance, IN[2]=version.Version)  # PythonNet3
# ---------- python_script.python (65 lines) ----------
import System
import clr
clr.AddReference('RevitAPI')
from Autodesk.Revit.DB import *
import Autodesk

clr.AddReference("RevitNodes")
import Revit
clr.ImportExtensions(Revit.Elements)

clr.AddReference("RevitServices")
import RevitServices
from RevitServices.Persistence import DocumentManager

inputdoc = UnwrapElement(IN[1])
if inputdoc == None:
    doc = DocumentManager.Instance.CurrentDBDocument
elif inputdoc.GetType().ToString() == "Autodesk.Revit.DB.RevitLinkInstance":
    doc = inputdoc.GetLinkDocument()
elif inputdoc.GetType().ToString() == "Autodesk.Revit.DB.Document":
    doc = inputdoc
else: doc = None
version = IN[2]

names = []
cats = []
vag = []
pgs = []
pts = []
uts = []
isvis = []
elems = []
guids = []
isinst = []
bics = []
iterator = doc.ParameterBindings.ForwardIterator()
while iterator.MoveNext():
    vag.append(iterator.Key.VariesAcrossGroups)
    names.append(iterator.Key.Name)
    pts.append(iterator.Key.GetDataType())
    pgs.append(iterator.Key.GetGroupTypeId())
    isvis.append(iterator.Key.Visible)
    elem = doc.GetElement(iterator.Key.Id)
    elems.append(elem)
    if elem.GetType().ToString() == 'Autodesk.Revit.DB.SharedParameterElement':
        guids.append(elem.GuidValue)
    else: guids.append(None)
    if iterator.Current.GetType().ToString() == 'Autodesk.Revit.DB.InstanceBinding':
        isinst.append(True)
    else:
        isinst.append(False)
    thesecats = []
    builtincats = []
    for cat in iterator.Current.Categories:
        if version > 2024: catID = cat.Id.Value
        else: catID = cat.Id.IntegerValue
        try: thesecats.append(Revit.Elements.Category.ById(catID))
        except:
            # Return null if category is not supported by Dynamo
            # This way the user knows there are unsupported categories assigned
            thesecats.append(None)
        builtincats.append(System.Enum.GetName(BuiltInCategory, catID))
    cats.append(thesecats)
    bics.append(builtincats)
OUT = (names,cats,vag, pgs, pts, isvis, elems, guids, isinst, bics)
# ----------------------------------------
code_block = CodeBlock(seq=python_script) { seq[0]; seq[1]; seq[2]; seq[3]; seq[4]; seq[5]; seq[6]; seq[7]; seq[8]; seq[9]; }
paramName = Output(code_block.out0)
categories = Output(code_block.out1)
variesAcrossGroups = Output(code_block.out2)
parameterGroup = Output(code_block.out3)
dataType = Output(code_block.out4)
isVisible = Output(code_block.out5)
parameterElement = Output(code_block.out6)
GUID = Output(code_block.out7)
isInstanceParameter = Output(code_block.out8)
builtInCategories = Output(code_block.out9)
