# Dynamo custom node Document.StartingView.dyf (Dynamo 3.6.1.9895)
# category: Clockwork.Revit.Application.Query
# Retrieves the starting view of a Project file. Returns null if no starting view is set.
# packages: PythonNet3 Engine 1.1.1

toggle = Input(toggle: bool = true)
docOrRevitLinkInstance = Input(docOrRevitLinkInstance: var = null)  # Use only if you want to query a linked model
python_script = Python(IN[0]=toggle, IN[1]=docOrRevitLinkInstance)  # PythonNet3
# ---------- python_script.python (26 lines) ----------
import clr
clr.AddReference('RevitAPI')
from Autodesk.Revit.DB import *

clr.AddReference("RevitNodes")
import Revit
clr.ImportExtensions(Revit.Elements)

clr.AddReference("RevitServices")
import RevitServices
from RevitServices.Persistence import DocumentManager

inputdoc = UnwrapElement(IN[1])
if inputdoc == None:
	doc = DocumentManager.Instance.CurrentDBDocument
elif inputdoc.GetType().ToString() == "Autodesk.Revit.DB.RevitLinkInstance":
	doc = inputdoc.GetLinkDocument()
elif inputdoc.GetType().ToString() == "Autodesk.Revit.DB.Document":
	doc = inputdoc
else: doc = None

startingview = doc.GetElement(StartingViewSettings.GetStartingViewSettings(doc).ViewId)
if startingview == None:
	OUT = None
else:
	OUT = startingview.ToDSType(True)
# ----------------------------------------
view = Output(python_script)
