# Dynamo custom node Document.SynchronizeWithCentral.dyf (Dynamo 3.6.1.9895)
# category: Clockwork.Revit.Application.Actions
# Synchronizes a workshared model with the central model.
# packages: PythonNet3 Engine 1.1.1

relinquishProjectStandardWorksets = Input(relinquishProjectStandardWorksets: bool = false)
relinquishViewWorksets = Input(relinquishViewWorksets: bool = false)
relinquishFamilyWorksets = Input(relinquishFamilyWorksets: bool = false)
relinquishUserCreatedWorksets = Input(relinquishUserCreatedWorksets: bool = false)
relinquishBorrowedElements = Input(relinquishBorrowedElements: bool = false)
compactCentralModel = Input(compactCentralModel: bool = false)
saveLocalFileBeforeSync = Input(saveLocalFileBeforeSync: bool = true)
saveLocalFileAfterSync = Input(saveLocalFileAfterSync: bool = true)
comment = Input(comment: string = "")
runMe = Input(runMe: bool = false)
python_script = Python(IN[0]=relinquishProjectStandardWorksets, IN[1]=relinquishViewWorksets, IN[2]=relinquishFamilyWorksets, IN[3]=relinquishUserCreatedWorksets, IN[4]=relinquishBorrowedElements, IN[5]=compactCentralModel, IN[6]=saveLocalFileBeforeSync, IN[7]=saveLocalFileAfterSync, IN[8]=comment, IN[9]=runMe)  # PythonNet3
# ---------- python_script.python (42 lines) ----------
import clr
clr.AddReference('RevitAPI')
from Autodesk.Revit.DB import *

clr.AddReference("RevitServices")
import RevitServices
from RevitServices.Persistence import DocumentManager
from RevitServices.Transactions import TransactionManager

relStandardWS = IN[0]
relViewWS = IN[1]
relFamWS = IN[2]
relUserWS = IN[3]
relCheckedOutElems = IN[4]
compact = IN[5]
saveLocalBefore = IN[6]
saveLocalAfter = IN[7]
comment = IN[8]
runme = IN[9]

if runme:
	doc = DocumentManager.Instance.CurrentDBDocument
	tOptions = TransactWithCentralOptions()
	rOptions = RelinquishOptions(False)
	rOptions.StandardWorksets = relStandardWS
	rOptions.ViewWorksets = relViewWS
	rOptions.FamilyWorksets = relFamWS
	rOptions.UserWorksets = relUserWS
	rOptions.CheckedOutElements = relCheckedOutElems
	sOptions = SynchronizeWithCentralOptions()
	sOptions.SetRelinquishOptions(rOptions)
	sOptions.Compact = compact
	sOptions.SaveLocalBefore = saveLocalBefore
	sOptions.SaveLocalAfter = saveLocalAfter
	sOptions.Comment = comment
	TransactionManager.Instance.ForceCloseTransaction()
	try:
		doc.SynchronizeWithCentral(tOptions, sOptions)
		OUT = True
	except:
		OUT = False
else: OUT = False
# ----------------------------------------
success = Output(python_script)
