# Dynamo custom node Document.UnitTypes.dyf (Dynamo 3.6.1.9895)
# category: Clockwork.Revit.Application.Query
# Retrieves all available unit types of a given document (as of Revit 2022: ForgeTypeIds)
# packages: PythonNet3 Engine 1.1.1

python_script = Python()  # PythonNet3
# ---------- python_script.python (6 lines) ----------
import clr
clr.AddReference('RevitAPI')
from Autodesk.Revit.DB import *
import Autodesk

OUT = UnitUtils.GetAllMeasurableSpecs(), [x.TypeId for x in UnitUtils.GetAllMeasurableSpecs()]
# ----------------------------------------
code_block = CodeBlock(seq=python_script) { seq[0]; seq[1]; }
unitTypes = Output(code_block.out0)
str = Output(code_block.out1)
