# Dynamo custom node Door.Rooms.dyf (Dynamo 3.6.1.9895)
# category: Clockwork.Revit.Elements.Query
# Gets the rooms that are connected by a given door
# packages: Clockwork for Dynamo 3.x 3.3.0, PythonNet3 Engine 1.1.1

door = Input(door: Revit.Elements.FamilyInstance[]..[])
phase = Input(phase: var = null)  # If no phase is specified, the node will use the last phase in the project
isNull = Object.IsNull(object=phase)
phases = Custom[Document.Phases]()  # package Clockwork for Dynamo 3.x; Retrieves all phases in the active document in *chronological* order
lastItem = List.LastItem(list=phases)
scopeIf = ScopedIf(test=isNull, true=lastItem, false=phase)
python_script = Python(IN[0]=door, IN[1]=scopeIf)  # PythonNet3
# ---------- python_script.python (17 lines) ----------
import clr
clr.AddReference('RevitAPI')
from Autodesk.Revit.DB import *

def GetRooms(item, phase):
	if hasattr(item, "FromRoom") and str(phase.GetType()) == "Autodesk.Revit.DB.Phase":
		exits = 0
		if item.get_FromRoom(phase): exits += 1
		if item.get_ToRoom(phase): exits += 1
		return item.get_FromRoom(phase), item.get_ToRoom(phase), exits
	else: return None, None, 0

items = UnwrapElement(IN[0])
phase = UnwrapElement(IN[1])

if isinstance(IN[0], list): OUT = map(list, zip(*[GetRooms(x, phase) for x in items]))
else: OUT = GetRooms(items, phase)
# ----------------------------------------
code_block = CodeBlock(seq=python_script) { seq[0]; seq[1]; seq[2]; }
fromRoom = Output(code_block.out0)
toRoom = Output(code_block.out1)
roomCount = Output(code_block.out2)
