# Dynamo custom node Element.AllInstances.dyf (Dynamo 3.6.1.9895)
# category: Clockwork.Revit.Elements.Query
# Retrieves all instances of a given element
# packages: PythonNet3 Engine 1.1.1, Clockwork for Dynamo 2.x 2.12.2

element = Input(element: var[]..[])
version = Custom[Application.Version]()  # package Clockwork for Dynamo 2.x; Retrieves the name, version and build of the current Revit application.
python_script = Python(IN[0]=element, IN[1]=version.Version)  # PythonNet3
# ---------- python_script.python (22 lines) ----------
import System
import clr
clr.AddReference('RevitAPI')
from Autodesk.Revit.DB import *

def GetAllInstances(item):
    collector = FilteredElementCollector(item.Document)
    if version > 2024: catID = item.Category.Id.Value
    else: catID = item.Category.Id.IntegerValue
    bic = System.Enum.ToObject(BuiltInCategory, catID)
    collector.OfCategory(bic)
    # This is a workaround
    # because I was too lazy to learn
    # how to implement LINQ in Python
    if version > 2024: return [x for x in collector.ToElements() if x.GetTypeId().Value == item.GetTypeId().Value]
    else: return [x for x in collector.ToElements() if x.GetTypeId().IntegerValue == item.GetTypeId().IntegerValue]

elements = UnwrapElement(IN[0])
version = IN[1]

if isinstance(IN[0], list): OUT = [GetAllInstances(x) for x in elements]
else: OUT = GetAllInstances(elements)
# ----------------------------------------
elements = Output(python_script)
