# Dynamo custom node Element.AllInstancesAtLevel.dyf (Dynamo 3.6.1.9895)
# category: Clockwork.Revit.Elements.Query
# Retrieves all instances of an element on a given level
# packages: PythonNet3 Engine 1.1.1, Clockwork for Dynamo 2.x 2.12.2

element = Input(element: var[]..[])
level = Input(level: Revit.Elements.Level)
version = Custom[Application.Version]()  # package Clockwork for Dynamo 2.x; Retrieves the name, version and build of the current Revit application.
python_script = Python(IN[0]=element, IN[1]=level, IN[2]=version.Version)  # PythonNet3
# ---------- python_script.python (24 lines) ----------
import System
import clr
clr.AddReference('RevitAPI')
from Autodesk.Revit.DB import *

def GetAllInstancesAtLevel(item, lvl):
    collector = FilteredElementCollector(item.Document)
    if version > 2024: catID = item.Category.Id.Value
    else: catID = item.Category.Id.IntegerValue
    bic = System.Enum.ToObject(BuiltInCategory, catID)
    lvlfilter = ElementLevelFilter(lvl.Id)
    collector.OfCategory(bic).WherePasses(lvlfilter)
    # This is a workaround
    # because I was too lazy to learn
    # how to implement LINQ in Python
    if version > 2024: return [x for x in collector.ToElements() if x.GetTypeId().Value == item.GetTypeId().Value]
    else: return [x for x in collector.ToElements() if x.GetTypeId().IntegerValue == item.GetTypeId().IntegerValue]

elements = UnwrapElement(IN[0])
lvl = UnwrapElement(IN[1])
version = IN[2]

if isinstance(IN[0], list): OUT = [GetAllInstancesAtLevel(x, lvl) for x in elements]
else: OUT = GetAllInstancesAtLevel(elements, lvl)
# ----------------------------------------
elements = Output(python_script)
