# Dynamo custom node Element.Assembly.dyf (Dynamo 3.6.1.9895)
# category: Clockwork.Revit.Elements.Query
# Retrieves the assembly an element belongs to (if any)
# packages: PythonNet3 Engine 1.1.1

element = Input(element: var[]..[])
python_script = Python(IN[0]=element)  # PythonNet3
# ---------- python_script.python (12 lines) ----------
import clr
clr.AddReference('RevitAPI')
from Autodesk.Revit.DB import *

def GetAssembly(item):
	if hasattr(item, "AssemblyInstanceId"): return item.Document.GetElement(item.AssemblyInstanceId)
	else: return None

items = UnwrapElement(IN[0])

if isinstance(IN[0], list): OUT = [GetAssembly(x) for x in items]
else: OUT = GetAssembly(items)
# ----------------------------------------
assembly = Output(python_script)
