# Dynamo custom node Element.AssociatedFamilyParameters.dyf (Dynamo 3.6.1.9895)
# category: Clockwork.Revit.Elements.Query
# Returns the associated family parameters of an element in a family (and the respective element parameters). PLEASE NOTE: This node will only work in a family document!
# packages: PythonNet3 Engine 1.1.1

element = Input(element: var[]..[])
python_script = Python(IN[0]=element)  # PythonNet3
# ---------- python_script.python (33 lines) ----------
import clr
clr.AddReference('RevitAPI')
from Autodesk.Revit.DB import *

clr.AddReference("RevitNodes")
import Revit
clr.ImportExtensions(Revit.Elements)

clr.AddReference("RevitServices")
import RevitServices
from RevitServices.Persistence import DocumentManager

def GetAssociatedFamilyParameters(element):
	paramlist = list()
	assoclist = list()
	paramnamelist = list()
	assocnamelist = list()
	try:
		for param in element.Parameters:
			assoc = doc.FamilyManager.GetAssociatedFamilyParameter(param)
			if assoc != None:
				paramlist.append(param)
				assoclist.append(assoc)
				paramnamelist.append(param.Definition.Name)
				assocnamelist.append(assoc.Definition.Name)
	except: pass
	return paramlist,assoclist,paramnamelist,assocnamelist

doc = DocumentManager.Instance.CurrentDBDocument
items = UnwrapElement(IN[0])

if isinstance(IN[0], list): OUT = map(list, zip(*[GetAssociatedFamilyParameters(x) for x in items]))
else: OUT = GetAssociatedFamilyParameters(items)
# ----------------------------------------
code_block = CodeBlock(seq=python_script) { seq[0]; seq[1]; seq[2]; seq[3]; }
elementParameters = Output(code_block.out0)
associatedFamilyParameters = Output(code_block.out1)
elementParameterNames = Output(code_block.out2)
associatedFamilyParameterNames = Output(code_block.out3)
