# Dynamo custom node Element.ByID.dyf (Dynamo 3.6.1.9895)
# category: Clockwork.Revit.Selection.Miscellaneous.Query
# Gets the Revit element(s) for a list of IDs (or a single ID). Unlike the OOTB node, it supports elements from linked models as well.
# packages: PythonNet3 Engine 1.1.1

IdOrUniqueId = Input(IdOrUniqueId: var[]..[])
docOrRevitLinkInstance = Input(docOrRevitLinkInstance: var = null)  # Use only if you want to query a linked model
python_script = Python(IN[0]=IdOrUniqueId, IN[1]=docOrRevitLinkInstance)  # PythonNet3
# ---------- python_script.python (30 lines) ----------
import clr
clr.AddReference('RevitAPI')
from Autodesk.Revit.DB import *

clr.AddReference("RevitNodes")
import Revit
clr.ImportExtensions(Revit.Elements)

clr.AddReference("RevitServices")
import RevitServices
from RevitServices.Persistence import DocumentManager

def ElementById(item, doc):
	try: 
		return doc.GetElement(item).ToDSType(True)
	except:
		try:
			return doc.GetElement(ElementId(item)).ToDSType(True)
		except:
			return None

items = UnwrapElement(IN[0])
inputdoc = UnwrapElement(IN[1])
if not inputdoc: doc = DocumentManager.Instance.CurrentDBDocument
elif inputdoc.GetType().ToString() == "Autodesk.Revit.DB.RevitLinkInstance": doc = inputdoc.GetLinkDocument()
elif inputdoc.GetType().ToString() == "Autodesk.Revit.DB.Document": doc = inputdoc
else: doc = DocumentManager.Instance.CurrentDBDocument

if isinstance(IN[0], list): OUT = [ElementById(x, doc) for x in items]
else: OUT = ElementById(items, doc)
# ----------------------------------------
element = Output(python_script)
