# Dynamo custom node Element.Category+.dyf (Dynamo 3.6.1.9895)
# category: Clockwork.Revit.Elements.Query
# Returns the category of a given element. Unlike the OOTB node Element.GetCategory, it will work for subcategories, families, family documents, schedules, graphics styles, color fill schemes and view filters as well.
# packages: PythonNet3 Engine 1.1.1, Clockwork for Dynamo 2.x 2.12.2

element = Input(element: var[]..[])
version = Custom[Application.Version]()  # package Clockwork for Dynamo 2.x; Retrieves the name, version and build of the current Revit application.
python_script = Python(IN[0]=element, IN[1]=version.Version)  # PythonNet3
# ---------- python_script.python (57 lines) ----------
import System
import clr
clr.AddReference('RevitAPI')
from Autodesk.Revit.DB import *

clr.AddReference("RevitNodes")
import Revit
clr.ImportExtensions(Revit.Elements)

def GetCategory(item):
    if not item: return None, None
    objtype = None
    if hasattr(item, "GetType"): objtype = item.GetType().ToString()
    returnID = None
    returnIDs = None
    returnCat = None
    returnBic = None
    if objtype == "Autodesk.Revit.DB.ParameterFilterElement": returnIDs = item.GetCategories()
    elif objtype == "Autodesk.Revit.DB.ViewSchedule": returnID = item.Definition.CategoryId
    elif objtype == "Autodesk.Revit.DB.Family": returnID = item.FamilyCategoryId
    elif objtype == "Autodesk.Revit.DB.ColorFillScheme": returnID = item.CategoryId
    elif objtype == "Autodesk.Revit.DB.GraphicsStyle":  returnID = item.GraphicsStyleCategory.Id
    elif objtype == "Revit.Application.Document":
        if item.IsFamilyDocument: 
            clr.AddReference("RevitServices")
            import RevitServices
            from RevitServices.Persistence import DocumentManager
            returnID = DocumentManager.Instance.CurrentDBDocument.OwnerFamily.FamilyCategoryId
    elif objtype == "Autodesk.Revit.DB.Category": 
        if item.Parent: returnID = item.Parent.Id
    elif hasattr(item, "Category"): 
        if item.Category: returnID = item.Category.Id
    if returnID:
        if version > 2024: returnIDval = returnID.Value
        else: returnIDval = returnID.IntegerValue
        returnBic = System.Enum.GetName(BuiltInCategory, returnIDval)
        try: returnCat =  Revit.Elements.Category.ById(returnIDval)
        except: pass
    elif returnIDs:
        returnCat = []
        returnBic = []
        for returnID in returnIDs:
            if version > 2024: returnIDval = returnID.Value
            else: returnIDval = returnID.IntegerValue
            returnBic.append(System.Enum.GetName(BuiltInCategory, returnIDval))
            try: returnCat.append(Revit.Elements.Category.ById(returnIDval))
            except: returnCat.append(None)
        returnCat.sort()
    return returnCat, returnBic

items = UnwrapElement(IN[0])
version = IN[1]

if isinstance(IN[0], list): 
    if len(IN[0]) > 0: OUT = map(list, zip(*[GetCategory(x) for x in items]))
    else: OUT = [[],[]]
else: OUT = GetCategory(items)
# ----------------------------------------
firstItem = List.FirstItem(list=python_script)
category = Output(firstItem)
lastItem = List.LastItem(list=python_script)
builtInCategory = Output(lastItem)
