# Dynamo custom node Element.ContainsTransparentMaterials.dyf (Dynamo 3.4.1.7055)
# category: Clockwork.Revit.Elements.Query
# Checks if a given element contains transparent materials.
# packages: Clockwork for Dynamo 2.x 2.12.0

element = Input(element: var[]..[])
boolean = BoolSelector(false)  # graph input
materials = Custom[Element.Materials+](element=element, returnPaintMaterials=boolean)  # package Clockwork for Dynamo 2.x; Retrieves all materials from a given element. Unlike the OOTB node Element.GetMaterials, it also retrieves QTO information.
transparency = Material.Transparency(material=materials.materials)
minTransparencyPercentage = Input(minTransparencyPercentage: double)
code_block = CodeBlock(x=transparency, y=minTransparencyPercentage) { x >= y; }
anyTrue = List.AnyTrue(list=code_block@L2)
returnListOrSingleValue = Custom[ReturnListOrSingleValue](unknownItem=element, seq=anyTrue)  # package Clockwork for Dynamo 2.x; If the unknown item is not a list but rather a single item, only the first item of the list (input "seq") will be returned.
bool = Output(returnListOrSingleValue)
