# Dynamo custom node Element.CopyToLevel.dyf (Dynamo 3.6.1.9895)
# category: Clockwork.Revit.Elements.Actions
# Copies an element or a list of elements to a given level. Preserves the element's transform. PLEASE NOTE: This node only works for levels that have at least one view (e.g. floor plan) associated with them.
# packages: PythonNet3 Engine 1.1.1, Clockwork for Dynamo 2.x 2.6.0

element = Input(element: var[]..[])
level = Custom[Element.Level](element=element)  # package Clockwork for Dynamo 2.x; Gets an element's level
views = Custom[Level.Views](level=level)  # package Clockwork for Dynamo 2.x; Returns all views associated with a given level
level_2 = Input(level: Revit.Elements.Level[]..[])
views_2 = Custom[Level.Views](level=level_2)
python_script = Python(IN[0]=element, IN[1]=views.firstView, IN[2]=views_2.firstView)  # PythonNet3
# ---------- python_script.python (40 lines) ----------
import clr
from System.Collections.Generic import *
clr.AddReference('RevitAPI')
from Autodesk.Revit.DB import *
import Autodesk

clr.AddReference("RevitNodes")
import Revit
clr.ImportExtensions(Revit.Elements)

clr.AddReference("RevitServices")
import RevitServices
from RevitServices.Persistence import DocumentManager
from RevitServices.Transactions import TransactionManager

doc = DocumentManager.Instance.CurrentDBDocument
items = UnwrapElement(IN[0])
source_views = UnwrapElement(IN[1])
target_views = UnwrapElement(IN[2])

def CopyToLevel(item, sview, tview):
    if item and sview and tview:
        itemlist = List[ElementId]([item.Id])
        results = ElementTransformUtils.CopyElements(sview, itemlist, tview, None, None)
        result_ids = list(results)  # Convert ICollection to Python list
        if result_ids: return doc.GetElement(result_ids[0]).ToDSType(False)
        else: return None
    else: return None

TransactionManager.Instance.EnsureInTransaction(doc)
if isinstance(IN[0], list):
    if isinstance(IN[2], list): OUT = [CopyToLevel(x,y,z) for x,y,z in zip(items, source_views, target_views)]
    else: OUT = [CopyToLevel(x,y,target_views) for x,y in zip(items, source_views)]
else:
    if isinstance(IN[2], list):
        multiitem = [items] * len(target_views)
        multisource = [source_views] * len(target_views)
        OUT = [CopyToLevel(x,y,z) for x,y,z in zip(multiitem, multisource, target_views)]
    else: OUT = CopyToLevel(items,source_views,target_views)
TransactionManager.Instance.TransactionTaskDone()
# ----------------------------------------
newElement = Output(python_script)
