# Dynamo custom node Element.DependentElements.dyf (Dynamo 3.6.1.9895)
# category: Clockwork.Revit.Elements.Query
# Returns all elements that, from a logical point of view, are the children of this element.
# packages: PythonNet3 Engine 1.1.1

element = Input(element: var[]..[])
python_script = Python(IN[0]=element)  # PythonNet3
# ---------- python_script.python (18 lines) ----------
import clr
clr.AddReference('RevitAPI')
from Autodesk.Revit.DB import *

clr.AddReference("RevitNodes")
import Revit
clr.ImportExtensions(Revit.Elements)
clr.ImportExtensions(Revit.GeometryConversion)

items = UnwrapElement(IN[0])

def GetDependent(item):
	if hasattr(item, "GetDependentElements"): 
		return [item.Document.GetElement(x) for x in item.GetDependentElements(None) if x != item.Id]
	else: return []
	
if isinstance(IN[0], list): OUT = [GetDependent(x) for x in items]
else: OUT = GetDependent(items)
# ----------------------------------------
dependents = Output(python_script)
