# Dynamo custom node Element.DissociateParameterFromGlobalParameter.dyf (Dynamo 3.6.1.9895)
# category: Clockwork.Revit.Elements.Actions
# Dissociates an element parameter from the global parameter that is driving it
# packages: PythonNet3 Engine 1.1.1

element = Input(element: var[]..[])
element_2 = Output(element)  # "element"
elementParam = Input(elementParam: string)
python_script = Python(IN[0]=element, IN[1]=elementParam)  # PythonNet3
# ---------- python_script.python (31 lines) ----------
import clr
import System
clr.AddReference('RevitAPI')
from Autodesk.Revit.DB import *

clr.AddReference("RevitNodes")
import Revit
clr.ImportExtensions(Revit.Elements)

clr.AddReference("RevitServices")
import RevitServices
from RevitServices.Persistence import DocumentManager
from RevitServices.Transactions import TransactionManager

def DissociateFromGlobalParam(item, param):
    rparams = item.GetParameters(param)
    if len(rparams) > 0: 
        try: 
            rparams[0].DissociateFromGlobalParameter()
            return True
        except: return False
    else: return False

doc = DocumentManager.Instance.CurrentDBDocument
items = UnwrapElement(IN[0])
param = IN[1]

TransactionManager.Instance.EnsureInTransaction(doc)
if isinstance(IN[0], list): OUT = [DissociateFromGlobalParam(x, param) for x in items]
else: OUT = DissociateFromGlobalParam(items, param)
TransactionManager.Instance.TransactionTaskDone()
# ----------------------------------------
success = Output(python_script)
