# Dynamo custom node Element.ElementType+.dyf (Dynamo 3.6.1.9895)
# category: Clockwork.Revit.Elements.Query
# Gets the family type of a given element (if applicable). Unlike the OOTB node, it also works for elements in linked models.
# packages: PythonNet3 Engine 1.1.1

element = Input(element: var[]..[])
python_script = Python(IN[0]=element)  # PythonNet3
# ---------- python_script.python (8 lines) ----------
def GetElementType(element):
	try: return element.Document.GetElement(element.GetTypeId())
	except: return None

items = UnwrapElement(IN[0])

if isinstance(IN[0], list): OUT = [GetElementType(x) for x in items]
else: OUT = GetElementType(items)
# ----------------------------------------
type = Output(python_script)
