# Dynamo custom node Element.ExternalFileReferencePath.dyf (Dynamo 3.6.1.9895)
# category: Clockwork.Revit.Elements.Query
# Returns the full path of an element's external file reference as as string
# packages: PythonNet3 Engine 1.1.1

element = Input(element: var[]..[])
python_script = Python(IN[0]=element)  # PythonNet3
# ---------- python_script.python (12 lines) ----------
import clr
clr.AddReference('RevitAPI')
from Autodesk.Revit.DB import *

def GetExtFileRefPath(item):
	try: return ModelPathUtils.ConvertModelPathToUserVisiblePath(item.GetExternalFileReference().GetAbsolutePath())
	except: return None

items = UnwrapElement(IN[0])

if isinstance(IN[0], list): OUT = [GetExtFileRefPath(x) for x in items]
else: OUT = GetExtFileRefPath(items)
# ----------------------------------------
path = Output(python_script)
