# Dynamo custom node Element.FromDynamoSurface.dyf (Dynamo 3.6.1.9895)
# category: Clockwork.Revit.Selection.ByFace.Query
# Returns the underlying Revit element of a given face
# packages: PythonNet3 Engine 1.1.1

DynamoSurface = Input(DynamoSurface: Autodesk.DesignScript.Geometry.Surface)
python_script = Python(IN[0]=DynamoSurface)  # PythonNet3
# ---------- python_script.python (17 lines) ----------
import clr
clr.AddReference('RevitAPI')
from Autodesk.Revit.DB import *

clr.AddReference("RevitServices")
import RevitServices
from RevitServices.Persistence import DocumentManager

def ElementByFace(face, doc):
	try: return doc.GetElement(face.Tags.LookupTag("RevitFaceReference"))
	except: return None

doc = DocumentManager.Instance.CurrentDBDocument
faces = UnwrapElement(IN[0])

if isinstance(IN[0], list): OUT = [ElementByFace(x, doc) for x in faces]
else: OUT = ElementByFace(faces, doc)
# ----------------------------------------
element = Output(python_script)
