# Dynamo custom node Element.Geometry+.dyf (Dynamo 3.6.1.9895)
# category: Clockwork.Revit.Elements.Query
# Returns Dynamo AND native Revit geometry of a given element
# packages: Clockwork for Dynamo 2.x 2.12.2, PythonNet3 Engine 1.1.1

element = Input(element: Revit.Elements.Element)
turnIntoList = Custom[TurnIntoList](unknownItem=element)  # package Clockwork for Dynamo 2.x; Turns an element (or a nested list) into a flat list
detailLevel = Input(detailLevel: string = "Medium")
includeInvisibleObjects = Input(includeInvisibleObjects: bool = false)
view = Input(view: Revit.Elements.Views.View = null)
boolean = BoolSelector(true)  # graph input
inserts = Custom[Element.Inserts](element=turnIntoList, includeOpenings=boolean, includeShadows=boolean, includeEmbeddedWalls=boolean, includeSharedEmbeddedInserts=boolean)  # package Clockwork for Dynamo 2.x; Gets all the objects inserted in / hosted on a given element. Unlike the OOTB mode, it will also return hosted railings.
returnGeometryWithoutInserts = Input(returnGeometryWithoutInserts: bool = false)
version = Custom[Application.Version]()  # package Clockwork for Dynamo 2.x; Retrieves the name, version and build of the current Revit application.
python_script = Python(IN[0]=turnIntoList, IN[1]=detailLevel, IN[2]=includeInvisibleObjects, IN[3]=view, IN[4]=inserts, IN[5]=returnGeometryWithoutInserts, IN[6]=version.Version)  # PythonNet3
# ---------- python_script.python (83 lines) ----------
import clr
clr.AddReference('RevitAPI')
from Autodesk.Revit.DB import *

clr.AddReference("RevitNodes")
import Revit
clr.ImportExtensions(Revit.Elements)
clr.ImportExtensions(Revit.GeometryConversion)

clr.AddReference("RevitServices")
import RevitServices
from RevitServices.Persistence import DocumentManager
from RevitServices.Transactions import TransactionManager

# This function takes care of exploding 
# GeometryInstance objects. GI objects typically
# represent family instance geometry.
# In order to also catch possible nested families
# the function calls itself recursively.
def convert_geometry_instance(geo, elementlist):
    for g in geo:
        if str(g.GetType()) == 'Autodesk.Revit.DB.GeometryInstance':
            elementlist = convert_geometry_instance(g.GetInstanceGeometry(), elementlist)
        else:
            try: 
                if g.Volume != 0: elementlist.append(g)
            except: pass
    return elementlist

doc = DocumentManager.Instance.CurrentDBDocument
items = UnwrapElement(IN[0])
if IN[1] == "Coarse": detail_lvl = ViewDetailLevel.Coarse
elif IN[1] == "Fine": detail_lvl = ViewDetailLevel.Fine
else: detail_lvl = ViewDetailLevel.Medium
inc_invis = IN[2]
view = UnwrapElement(IN[3])
inserts = UnwrapElement(IN[4])
remove_inserts = IN[5]
version = IN[6]
revitlist = list()
dynlist = list()
catlist = list()
# we might need a transaction in order to 
# temporarily delete all inserts and retrieve gross wall areas
TransactionManager.Instance.EnsureInTransaction(doc)
trans = SubTransaction(doc)
trans.Start()
i = 0
for item in items:
    if remove_inserts == True:
        for insert in inserts[i]:
            doc.Delete(insert.Id)
        doc.Regenerate()
    geo_options = Options()
    if view == None: geo_options.DetailLevel = detail_lvl
    geo_options.IncludeNonVisibleObjects = inc_invis
    if view != None: geo_options.View = view
    revitGeo = item.get_Geometry(geo_options)
    try:        
        revit_geos = convert_geometry_instance(revitGeo, list())
        revitlist.append(revit_geos)
        dyn_geos = list()
        cats = list()
        for geo in revit_geos:
            try: dyn_geos.append(geo.ToProtoType())
            except: dyn_geos.append(None)
            try:
                graphstyle = doc.GetElement(geo.GraphicsStyleId)
                if graphstyle != None:
                    if version > 2024: cats.append(Revit.Elements.Category.ById(graphstyle.GraphicsStyleCategory.Id.Value))
                    else: cats.append(Revit.Elements.Category.ById(graphstyle.GraphicsStyleCategory.Id.IntegerValue))
                else: cats.append(None)
            except: cats.append(None)
        dynlist.append(dyn_geos)
        catlist.append(cats)        
    except:
        revitlist.append(list())
        dynlist.append(list())
        catlist.append(list())
    i += 1
trans.RollBack()
TransactionManager.Instance.TransactionTaskDone()
OUT = (dynlist,revitlist,catlist)
# ----------------------------------------
code_block = CodeBlock(seq=python_script) { seq[0]; seq[1]; seq[2]; }
returnListOrSingleValue = Custom[ReturnListOrSingleValue](unknownItem=element, seq=code_block.out0)  # package Clockwork for Dynamo 2.x; If the unknown item is not a list but rather a single item, only the first item of the list (input "seq") will be returned.
dynamoGeometry = Output(returnListOrSingleValue)
returnListOrSingleValue_2 = Custom[ReturnListOrSingleValue](unknownItem=element, seq=code_block.out1)
revitGeometry = Output(returnListOrSingleValue_2)
returnListOrSingleValue_3 = Custom[ReturnListOrSingleValue](unknownItem=element, seq=code_block.out2)
subCategory = Output(returnListOrSingleValue_3)
