# Dynamo custom node Element.ID+.dyf (Dynamo 3.6.1.9895)
# category: Clockwork.Revit.Elements.Query
# Gets the ID of a given Revit elements. Unlike the OOTB Element.Id node, this node also works on mixed lists of Revit elements and categories.
# packages: PythonNet3 Engine 1.1.1, Clockwork for Dynamo 2.x 2.12.2

element = Input(element: var[]..[])
version = Custom[Application.Version]()  # package Clockwork for Dynamo 2.x; Retrieves the name, version and build of the current Revit application.
python_script = Python(IN[0]=element, IN[1]=version.Version)  # PythonNet3
# ---------- python_script.python (19 lines) ----------
import clr
clr.AddReference('RevitAPI')
from Autodesk.Revit.DB import *

clr.AddReference("RevitNodes")
import Revit
clr.ImportExtensions(Revit.Elements)

def GetId(item):
    if hasattr(item, "Id"): 
        if version > 2024: return item.Id.Value
        else: return item.Id.IntegerValue
    else: return None

items = UnwrapElement(IN[0])
version = IN[1]

if isinstance(IN[0], list): OUT = [GetId(x) for x in items]
else: OUT = GetId(items)
# ----------------------------------------
int = Output(python_script)
