# Dynamo custom node Element.Inserts.dyf (Dynamo 3.6.1.9895)
# category: Clockwork.Revit.Elements.Query
# Gets all the objects inserted in / hosted on a given element. Unlike the OOTB mode, it will also return hosted railings.
# packages: PythonNet3 Engine 1.1.1

element = Input(element: var[]..[])
includeOpenings = Input(includeOpenings: bool = false)
includeShadows = Input(includeShadows: bool = false)
includeEmbeddedWalls = Input(includeEmbeddedWalls: bool = false)
includeSharedEmbeddedInserts = Input(includeSharedEmbeddedInserts: bool = false)
python_script = Python(IN[0]=element, IN[1]=includeOpenings, IN[2]=includeShadows, IN[3]=includeEmbeddedWalls, IN[4]=includeSharedEmbeddedInserts)  # PythonNet3
# ---------- python_script.python (25 lines) ----------
import clr
clr.AddReference('RevitAPI')
from Autodesk.Revit.DB import *

clr.AddReference("RevitNodes")
import Revit
clr.ImportExtensions(Revit.Elements)

items = UnwrapElement(IN[0])
incopenings = IN[1]
incshadows = IN[2]
incwalls = IN[3]
incshared = IN[4]

def GetInserts(item,incopenings,incshadows,incwalls,incshared):
	# Regular host objects
	if hasattr(item, "FindInserts"):
		return [item.Document.GetElement(x) for x in item.FindInserts(incopenings,incshadows,incwalls,incshared)]
	# Railings
	elif hasattr(item, "GetAssociatedRailings"):
		return [item.Document.GetElement(x) for x in item.GetAssociatedRailings()]
	else: return []

if isinstance(IN[0], list): OUT = [GetInserts(x,incopenings,incshadows,incwalls,incshared) for x in items]
else: OUT = GetInserts(items,incopenings,incshadows,incwalls,incshared)
# ----------------------------------------
inserts = Output(python_script)
