# Dynamo custom node Element.IsOfCategory.dyf (Dynamo 3.6.1.9895)
# category: Clockwork.Revit.Elements.Query
# Checks whether an element is of a specified category
# packages: Clockwork for Dynamo 3.x 3.3.0, PythonNet3 Engine 1.1.1

category = Input(category: var[]..[])  # Works with categories, BuiltInCategories and BuiltInCategories as strings
fromInput = Custom[BuiltInCategory.FromInput](input=category)  # package Clockwork for Dynamo 3.x; Returns a BuiltInCategory from a category, a Dynamo-wrapped category, a BuiltInCategory or a string representing a BuiltInCategory.
element = Input(element: var[]..[])
category_2 = Custom[Element.Category+](element=element)  # package Clockwork for Dynamo 3.x; Returns the category of a given element. Unlike the OOTB node Element.GetCategory, it will work for subcategories, families, family documents, schedules, graphics styles, color fill schemes and view filters as well.
python_script = Python(IN[0]=fromInput, IN[1]=category_2.builtInCategory)  # PythonNet3
# ---------- python_script.python (10 lines) ----------
cats = IN[0]
ecats = IN[1]
if isinstance(IN[1], list):
	if isinstance(IN[0], list):
		if len(cats) == len(ecats): OUT = [x == y for x, y in zip(cats, ecats)]
		else: OUT = [x in cats for x in ecats]
	else: OUT = [x == cats for x in ecats]
else:
	if isinstance(IN[0], list): OUT = ecats in cats
	else: OUT = cats == ecats
# ----------------------------------------
bool = Output(python_script)
