# Dynamo custom node Element.JoinGeometry.dyf (Dynamo 3.6.1.9895)
# category: Clockwork.Revit.Elements.Actions
# Joins two model elements (if possible). Only works inside the project environment.
# packages: PythonNet3 Engine 1.1.1

element1 = Input(element1: var[]..[])
element2 = Input(element2: var[]..[])
python_script = Python(IN[0]=element1, IN[1]=element2)  # PythonNet3
# ---------- python_script.python (27 lines) ----------
import clr
clr.AddReference('RevitAPI')
from Autodesk.Revit.DB import *
from System.Collections.Generic import *
clr.AddReference("RevitServices")
import RevitServices
from RevitServices.Persistence import DocumentManager
from RevitServices.Transactions import TransactionManager

doc = DocumentManager.Instance.CurrentDBDocument
items1 = UnwrapElement(IN[0])
items2 = UnwrapElement(IN[1])

def JoinGeometry(doc, item1, item2):
	try:
		JoinGeometryUtils.JoinGeometry(doc,item1,item2)
		return True
	except: return False

TransactionManager.Instance.EnsureInTransaction(doc)
if isinstance(IN[0], list):
	if isinstance(IN[1], list): OUT = [JoinGeometry(doc, x, y) for x, y in zip(items1, items2)]
	else: OUT = [JoinGeometry(doc, x, items2) for x in items1]
else:
	if isinstance(IN[1], list): OUT = [JoinGeometry(doc, items1, x) for x in items2]
	else: OUT = JoinGeometry(doc, items1, items2)
TransactionManager.Instance.TransactionTaskDone()
# ----------------------------------------
success = Output(python_script)
element1_2 = Output(element1)  # "element1"
element2_2 = Output(element2)  # "element2"
