# Dynamo custom node Element.Phases.dyf (Dynamo 3.6.1.9895)
# category: Clockwork.Revit.Elements.Query
# Gets the created and demolished phases of an element
# packages: PythonNet3 Engine 1.1.1

element = Input(element: var[]..[])
python_script = Python(IN[0]=element)  # PythonNet3
# ---------- python_script.python (13 lines) ----------
import clr
clr.AddReference('RevitAPI')
from Autodesk.Revit.DB import *

def GetPhases(item):
	if hasattr(item, "CreatedPhaseId"):
		return item.Document.GetElement(item.CreatedPhaseId), item.Document.GetElement(item.DemolishedPhaseId)
	else: return None, None

items = UnwrapElement(IN[0])

if isinstance(IN[0], list): OUT = map(list, zip(*[GetPhases(x) for x in items]))
else: OUT = GetPhases(items)
# ----------------------------------------
code_block = CodeBlock(seq=python_script) { seq[0]; seq[1]; }
Created = Output(code_block.out0)
Demolished = Output(code_block.out1)
