# Dynamo custom node Element.SetSubCategory.dyf (Dynamo 3.6.1.9895)
# category: Clockwork.Revit.Elements.Actions
# Assigns the given element(s) to the specified subcategory. The node should work for all geometry and curve elements. In some cases the GraphicsStyleType (Cut = TRUE, Projection = FALSE) needs to be specified.
# packages: PythonNet3 Engine 1.1.1, Clockwork for Dynamo 2.x 2.3.0

elements = Input(elements: var[]..[])
turnIntoList = Custom[TurnIntoList](unknownItem=elements)  # package Clockwork for Dynamo 2.x; Turns an element (or a nested list) into a flat list
subCategory = Input(subCategory: var[]..[])
cutOrProjection = Input(cutOrProjection: bool = false)
python_script = Python(IN[0]=turnIntoList, IN[1]=subCategory, IN[2]=cutOrProjection)  # PythonNet3
# ---------- python_script.python (43 lines) ----------
import clr
clr.AddReference('RevitAPI')
from Autodesk.Revit.DB import *

clr.AddReference("RevitNodes")
import Revit
clr.ImportExtensions(Revit.Elements)

clr.AddReference("RevitServices")
import RevitServices
from RevitServices.Persistence import DocumentManager
from RevitServices.Transactions import TransactionManager

doc = DocumentManager.Instance.CurrentDBDocument
items = UnwrapElement(IN[0])
# Revit subcategories
if IN[1].GetType().ToString() == 'Autodesk.Revit.DB.Category': subcat = IN[1]
# Dynamo-wrapped subcategories
else: subcat = Category.GetCategory(doc,ElementId(IN[1].Id))
gstyletype = IN[2]
if not gstyletype:
	gstyletype = GraphicsStyleType.Projection
else:
	gstyletype = GraphicsStyleType.Cut
gstyle = subcat.GetGraphicsStyle(gstyletype)
success = list()
TransactionManager.Instance.EnsureInTransaction(doc)
for item in items:
	try:
		item.Subcategory = subcat
		success.append(True)
	except:
		try:
			item.Subcategory = gstyle
			success.append(True)
		except:
			try:
				item.LineStyle = gstyle
				success.append(True)
			except:
				success.append(False)
TransactionManager.Instance.TransactionTaskDone()
OUT = (items,success)
# ----------------------------------------
code_block = CodeBlock(seq=python_script) { seq[0]; seq[1]; }
elements_2 = Output(code_block.out0)  # "elements"
success = Output(code_block.out1)
