# Dynamo custom node Element.SlabShapeHasBeenModified.dyf (Dynamo 3.6.1.9895)
# category: Clockwork.Revit.Elements.Query
# Checks if the shape of a roof, floor slab or toposolid has been modified with the shape editing tools
# packages: PythonNet3 Engine 1.1.1

element = Input(element: var[]..[])
python_script = Python(IN[0]=element)  # PythonNet3
# ---------- python_script.python (18 lines) ----------
import clr
clr.AddReference('RevitAPI')
from Autodesk.Revit.DB import *

def SlabShapeHasBeenModified(item):
	sle = None
	if hasattr(item, "SlabShapeEditor"): sle = item.SlabShapeEditor
	elif hasattr(item, "GetSlabShapeEditor"): sle = item.GetSlabShapeEditor()
	else: return False
	if hasattr(sle, "SlabShapeCreases") and hasattr(sle, "SlabShapeVertices"):
		if sle.SlabShapeCreases.IsEmpty == True or sle.SlabShapeVertices.IsEmpty == True: return False
		else: return True
	else: return False

items = UnwrapElement(IN[0])

if isinstance(IN[0], list): OUT = [SlabShapeHasBeenModified(x) for x in items]
else: OUT = SlabShapeHasBeenModified(items)
# ----------------------------------------
bool = Output(python_script)
