# Dynamo custom node Element.SubComponents.dyf (Dynamo 3.6.1.9895)
# category: Clockwork.Revit.Elements.Query
# Retrieves all subcomponents of a given element. Unlike the OOTB node Element.GetChildElements, it also supports combined geometry elements in family.
# packages: PythonNet3 Engine 1.1.1

element = Input(element: var[]..[])
python_script = Python(IN[0]=element)  # PythonNet3
# ---------- python_script.python (44 lines) ----------
import clr
clr.AddReference('RevitAPI')
from Autodesk.Revit.DB import *

clr.AddReference("RevitNodes")
import Revit
clr.ImportExtensions(Revit.Elements)

items = UnwrapElement(IN[0])

def GetSubComponents(item):
	# FamilyInstances
	if hasattr(item, "GetSubComponentIds"):
		return [item.Document.GetElement(x) for x in item.GetSubComponentIds()]
	# Combined geometry
	elif hasattr(item, "AllMembers"):
		return [x for x in item.AllMembers]
	# Stairs
	elif hasattr(item, "GetStairsLandings"):
		stair_comps = [item.Document.GetElement(x) for x in item.GetStairsLandings()]
		stair_comps.extend([item.Document.GetElement(x) for x in item.GetStairsRuns()])
		stair_comps.extend([item.Document.GetElement(x) for x in item.GetStairsSupports()])
		return stair_comps
	# Railings
	elif hasattr(item, "GetHandRails"):
		rail_comps = [item.Document.GetElement(x) for x in item.GetHandRails()]
		rail_comps.append(item.Document.GetElement(item.TopRail))
		return rail_comps
	# Beam systems
	elif hasattr(item, "GetBeamIds"):
		return [item.Document.GetElement(x) for x in item.GetBeamIds()]
	# Multi segment grids
	elif hasattr(item, "GetGridIds"):
		return [item.Document.GetElement(x) for x in item.GetGridIds()]
	# Toposurfaces
	elif hasattr(item, "GetHostedSubRegionIds"):
		return [item.Document.GetElement(x) for x in item.GetHostedSubRegionIds()]
	# Toposolids
	elif hasattr(item, "GetSubDivisionIds"):
		return [item.Document.GetElement(x) for x in item.GetSubDivisionIds()]
	else: return []

if isinstance(IN[0], list): OUT = [GetSubComponents(x) for x in items]
else: OUT = GetSubComponents(items)
# ----------------------------------------
subComponents = Output(python_script)
