# Dynamo custom node Elements.FilterByName.dyf (Dynamo 2.0.1.5055)
# category: Clockwork.Revit.Selection.Filters.Actions
# Retrieves those elements from a collection whose names match the search string

elements = Input(elements: var[])
name = Custom[Element.Name+](element=elements)  # Gets an element's name. Unlike the OOTB node, this node should work for all Revit elements that have names.
searchString = Input(searchString: string)
ignoreCase = Input(ignoreCase: bool = true)
contains = String.Contains(str=name, searchFor=searchString, ignoreCase=ignoreCase)
filterByBoolMask = List.FilterByBoolMask(list=elements, mask=contains)
firstItem = List.FirstItem(list=filterByBoolMask.in)
first = Output(firstItem)
in_ = Output(filterByBoolMask.in)  # "in"
out = Output(filterByBoolMask.out)
