# Dynamo custom node Enum.Values.dyf (Dynamo 3.6.1.9895)
# category: Clockwork.Revit.Elements.Query
# Returns the keys and values of a given Revit Enum
# packages: PythonNet3 Engine 1.1.1

enumName = Input(enumName: string[]..[])
python_script = Python(IN[0]=enumName)  # PythonNet3
# ---------- python_script.python (20 lines) ----------
import clr
import System
clr.AddReference('RevitAPI')
clr.AddReference('RevitAPIUI')
import Autodesk

rAssembly = [x for x in System.AppDomain.CurrentDomain.GetAssemblies() if x.GetName().Name == 'RevitAPI'][0]

def GetEnumValues(typename):
	foundenums = [x for x in rAssembly.GetTypes() if x.Name == typename and str(x.BaseType) == "System.Enum"]
	try:
		enumnames = foundenums[0].GetEnumNames()
		enumvals = [int(System.Enum.Parse(foundenums[0], x)) for x in enumnames]
		return (enumnames, enumvals)
	except: return ([], [])

enums = IN[0]

if isinstance(IN[0], list): OUT = map(list, zip(*[GetEnumValues(x) for x in enums]))
else: OUT = GetEnumValues(enums)
# ----------------------------------------
firstItem = List.FirstItem(list=python_script)
values = Output(firstItem)
lastItem = List.LastItem(list=python_script)
keys = Output(lastItem)
