# Dynamo custom node Family.PlacementType.dyf (Dynamo 3.6.1.9895)
# category: Clockwork.Revit.Elements.Query
# Returns the expected host class of a family (if any)
# packages: PythonNet3 Engine 1.1.1

family = Input(family: Revit.Elements.Family)
python_script = Python(IN[0]=family)  # PythonNet3
# ---------- python_script.python (13 lines) ----------
import clr
clr.AddReference('RevitAPI')
from Autodesk.Revit.DB import *
import System

def GetPlacementType(item):
	if hasattr(item, "FamilyPlacementType"): return System.Enum.GetName(FamilyPlacementType, item.FamilyPlacementType)
	else: return None

items = UnwrapElement(IN[0])

if isinstance(IN[0], list): OUT = [GetPlacementType(x) for x in items]
else: OUT = GetPlacementType(items)
# ----------------------------------------
placementType = Output(python_script)
