# Dynamo custom node FamilyDocument.FamilyTypes.dyf (Dynamo 3.6.1.9895)
# category: Clockwork.Revit.Application.Query
# Retrieves all family types from the active family document. PLEASE NOTE: This node will only work in a family document!
# packages: PythonNet3 Engine 1.1.1

toggle = Input(toggle: bool = true)
python_script = Python(IN[0]=toggle)  # PythonNet3
# ---------- python_script.python (14 lines) ----------
import clr
clr.AddReference('RevitAPI')
from Autodesk.Revit.DB import *

clr.AddReference("RevitServices")
import RevitServices
from RevitServices.Persistence import DocumentManager

doc = DocumentManager.Instance.CurrentDBDocument
elementlist = list()
if doc.IsFamilyDocument:
	for ftype in doc.FamilyManager.Types:
		elementlist.append(ftype)
OUT = elementlist
# ----------------------------------------
familyTypes = Output(python_script)
