# Dynamo custom node FamilyInstance.AddCoping.dyf (Dynamo 3.6.1.9895)
# category: Clockwork.Revit.Elements.Actions
# Adds a coping (cut) to a steel beam
# packages: PythonNet3 Engine 1.1.1, Clockwork for Dynamo 2.x 2.12.2

familyInstance = Input(familyInstance: var[]..[])
turnIntoList = Custom[TurnIntoList](unknownItem=familyInstance)  # package Clockwork for Dynamo 2.x; Turns an element (or a nested list) into a flat list
cuttingElement = Input(cuttingElement: var[]..[])
turnIntoList_2 = Custom[TurnIntoList](unknownItem=cuttingElement)
python_script = Python(IN[0]=turnIntoList, IN[1]=turnIntoList_2)  # PythonNet3
# ---------- python_script.python (26 lines) ----------
import clr
import System
clr.AddReference('RevitAPI')
from Autodesk.Revit.DB import *

clr.AddReference("RevitServices")
import RevitServices
from RevitServices.Persistence import DocumentManager
from RevitServices.Transactions import TransactionManager

doc = DocumentManager.Instance.CurrentDBDocument
fams = UnwrapElement(IN[0])
cutters = UnwrapElement(IN[1])
booleans = []
counter = 0

TransactionManager.Instance.EnsureInTransaction(doc)
for fam in fams:
	try:
		fam.AddCoping(cutters[counter])
		booleans.append(True)
	except:	booleans.append(False)
	counter += 1
TransactionManager.Instance.TransactionTaskDone()

OUT = (fams,booleans)
# ----------------------------------------
code_block = CodeBlock(seq=python_script) { seq[0]; seq[1]; }
returnListOrSingleValue = Custom[ReturnListOrSingleValue](unknownItem=familyInstance, seq=code_block.out0)  # package Clockwork for Dynamo 2.x; If the unknown item is not a list but rather a single item, only the first item of the list (input "seq") will be returned.
familyInstance_2 = Output(returnListOrSingleValue)  # "familyInstance"
returnListOrSingleValue_2 = Custom[ReturnListOrSingleValue](unknownItem=familyInstance, seq=code_block.out1)
success = Output(returnListOrSingleValue_2)
