# Dynamo custom node FamilyInstance.ByCurve.dyf (Dynamo 3.6.1.9895)
# category: Clockwork.Revit.Elements.Create
# Places a line-based family instance on a given level
# packages: PythonNet3 Engine 1.1.1, Clockwork for Dynamo 3.x 3.3.0

curve = Input(curve: Autodesk.DesignScript.Geometry.Curve)
turnIntoList = Custom[TurnIntoList](unknownItem=curve)  # package Clockwork for Dynamo 3.x; Turns an element (or a nested list) into a flat list
familyType = Input(familyType: var[]..[])
level = Input(level: var[]..[])
python_script = Python(IN[0]=turnIntoList, IN[1]=familyType, IN[2]=level)  # PythonNet3
# ---------- python_script.python (31 lines) ----------
import clr
clr.AddReference('RevitAPI')
from Autodesk.Revit.DB import *

clr.AddReference("RevitNodes")
import Revit
clr.ImportExtensions(Revit.Elements)
clr.ImportExtensions(Revit.GeometryConversion)

clr.AddReference("RevitServices")
import RevitServices
from RevitServices.Persistence import DocumentManager
from RevitServices.Transactions import TransactionManager

doc = DocumentManager.Instance.CurrentDBDocument
curves = UnwrapElement(IN[0])
famtype = UnwrapElement(IN[1])
lvl = UnwrapElement(IN[2])
elementlist = list()
counter = 0

TransactionManager.Instance.EnsureInTransaction(doc)
# make sure familysymbol is active
if famtype.IsActive == False:
	famtype.Activate()
	doc.Regenerate()
for curve in curves:
	newobj = doc.Create.NewFamilyInstance(curve.ToRevitType(),famtype,lvl,Structure.StructuralType.NonStructural)
	elementlist.append(newobj.ToDSType(False))
TransactionManager.Instance.TransactionTaskDone()
OUT = elementlist
# ----------------------------------------
returnListOrSingleValue = Custom[ReturnListOrSingleValue](unknownItem=curve, seq=python_script)  # package Clockwork for Dynamo 3.x; If the unknown item is not a list but rather a single item, only the first item of the list (input "seq") will be returned.
familyInstance = Output(returnListOrSingleValue)
