# Dynamo custom node FamilyInstance.CopingElements.dyf (Dynamo 3.6.1.9895)
# category: Clockwork.Revit.Elements.Query
# Returns all elements used as coping cutters for a given element.
# packages: PythonNet3 Engine 1.1.1

familyInstance = Input(familyInstance: var[]..[])
python_script = Python(IN[0]=familyInstance)  # PythonNet3
# ---------- python_script.python (13 lines) ----------
import clr
import System
clr.AddReference('RevitAPI')
from Autodesk.Revit.DB import *

items = UnwrapElement(IN[0])

def GetCopingElements(item):
	if hasattr(item, "GetCopingIds"): return [item.Document.GetElement(x) for x in item.GetCopingIds()]
	else: return []

if isinstance(IN[0], list): OUT = [GetCopingElements(x) for x in items]
else: OUT = GetCopingElements(items) 
# ----------------------------------------
copingElements = Output(python_script)
