# Dynamo custom node FamilyInstance.FlipFromToRoom.dyf (Dynamo 3.6.1.9895)
# category: Clockwork.Revit.Elements.Actions
# Flips the settings of "From Room" and "To Room" for any given door or window instance. PLEASE NOTE: Will not work on door or window families with an activated room calculation point.
# packages: PythonNet3 Engine 1.1.1

familyInstance = Input(familyInstance: Revit.Elements.FamilyInstance)
familyInstance_2 = Output(familyInstance)  # "familyInstance"
python_script = Python(IN[0]=familyInstance)  # PythonNet3
# ---------- python_script.python (22 lines) ----------
import clr
clr.AddReference('RevitAPI')
from Autodesk.Revit.DB import *

clr.AddReference("RevitServices")
import RevitServices
from RevitServices.Persistence import DocumentManager
from RevitServices.Transactions import TransactionManager

doc = DocumentManager.Instance.CurrentDBDocument
faminstances = UnwrapElement(IN[0])

def FlipRoom(item):
	try:
		item.FlipFromToRoom()
		return True
	except: return False

TransactionManager.Instance.EnsureInTransaction(doc)
if isinstance(IN[0], list): OUT = [FlipRoom(x) for x in faminstances]
else: OUT = FlipRoom(faminstances)
TransactionManager.Instance.TransactionTaskDone()
# ----------------------------------------
success = Output(python_script)
