# Dynamo custom node FamilyInstance.FlipHandOrientation.dyf (Dynamo 3.6.1.9895)
# category: Clockwork.Revit.Elements.Actions
# Flips the hand orientation of a given family instance
# packages: PythonNet3 Engine 1.1.1

familyInstance = Input(familyInstance: var[]..[])
familyInstance_2 = Output(familyInstance)  # "familyInstance"
python_script = Python(IN[0]=familyInstance)  # PythonNet3
# ---------- python_script.python (22 lines) ----------
import clr
clr.AddReference('RevitAPI')
from Autodesk.Revit.DB import *

clr.AddReference("RevitServices")
import RevitServices
from RevitServices.Persistence import DocumentManager
from RevitServices.Transactions import TransactionManager

def FlipHand(item):
	try:
		item.flipHand()
		return True
	except: return False

doc = DocumentManager.Instance.CurrentDBDocument
items = UnwrapElement(IN[0])

TransactionManager.Instance.EnsureInTransaction(doc)
if isinstance(IN[0], list): OUT = [FlipHand(x) for x in items]
else: OUT = FlipHand(items)
TransactionManager.Instance.TransactionTaskDone()
# ----------------------------------------
success = Output(python_script)
