# Dynamo custom node FamilyParameter.GetValueByFamilyType.dyf (Dynamo 3.6.1.9895)
# category: Clockwork.Revit.Elements.Query
# Returns the value of a family parameter for a given family type
# packages: PythonNet3 Engine 1.1.1

familyType = Input(familyType: var[]..[])
familyParameter = Input(familyParameter: var[]..[])
python_script = Python(IN[0]=familyType, IN[1]=familyParameter)  # PythonNet3
# ---------- python_script.python (26 lines) ----------
import clr
clr.AddReference('RevitAPI')
from Autodesk.Revit.DB import *

clr.AddReference("RevitServices")
import RevitServices
from RevitServices.Persistence import DocumentManager
doc = DocumentManager.Instance.CurrentDBDocument

def GetFamParamVal(ft, fp):
	if fp.StorageType == StorageType.Integer: return ft.AsInteger(fp)
	elif fp.StorageType == StorageType.Double: 
		if fp.GetUnitTypeId() and ft.HasValue(fp): return UnitUtils.ConvertFromInternalUnits(ft.AsDouble(fp),fp.GetUnitTypeId())
		else: return ft.AsDouble(fp)
	elif fp.StorageType == StorageType.String: return ft.AsString(fp)
	elif fp.StorageType == StorageType.ElementId: return doc.GetElement(ft.AsElementId(fp))
	else: return None

if isinstance(IN[0], list): 
	if isinstance(IN[1], list): 
		OUT = []
		OUT = [[GetFamParamVal(y, x) for x in IN[1]] for y in IN[0]]
	else: OUT = [GetFamParamVal(x, IN[1]) for x in IN[0]]
else:
	if isinstance(IN[1], list): OUT = [GetFamParamVal(IN[0], x) for x in IN[1]]
	else: OUT = GetFamParamVal(IN[0], IN[1])
# ----------------------------------------
val = Output(python_script)
