# Dynamo custom node FamilyParameter.MakeInstance.dyf (Dynamo 3.6.1.9895)
# category: Clockwork.Revit.Elements.Actions
# Converts a type parameter to an instance parameter. ATTENTION: Only works in a family document.
# packages: PythonNet3 Engine 1.1.1

familyParameter = Input(familyParameter: var[]..[])
python_script = Python(IN[0]=familyParameter)  # PythonNet3
# ---------- python_script.python (23 lines) ----------
import clr
clr.AddReference('RevitAPI')
from Autodesk.Revit.DB import *

clr.AddReference("RevitServices")
import RevitServices
from RevitServices.Persistence import DocumentManager
from RevitServices.Transactions import TransactionManager

def MakeInstanceParam(doc, param):
	success = False
	if doc.IsFamilyDocument and hasattr(param, "Formula"):
		try:
			doc.FamilyManager.MakeInstance(param)
			success = True
		except: pass
	return param, success

doc = DocumentManager.Instance.CurrentDBDocument
TransactionManager.Instance.EnsureInTransaction(doc)
if isinstance(IN[0], list): OUT = map(list, zip(*[MakeInstanceParam(doc, x) for x in IN[0]]))
else: OUT = MakeInstanceParam(doc, IN[0])
TransactionManager.Instance.TransactionTaskDone()
# ----------------------------------------
firstItem = List.FirstItem(list=python_script)
familyParameter_2 = Output(firstItem)  # "familyParameter"
lastItem = List.LastItem(list=python_script)
success = Output(lastItem)
