# Dynamo custom node FamilyParameter.Properties.dyf (Dynamo 3.6.1.9895)
# category: Clockwork.Revit.Elements.Query
# Retrieves all properties of a given family parameter. PLEASE NOTE: This node will only work in a family document!
# packages: PythonNet3 Engine 1.1.1

familyParameter = Input(familyParameter: var[]..[])
python_script = Python(IN[0]=familyParameter)  # PythonNet3
# ---------- python_script.python (23 lines) ----------
import clr
import System
clr.AddReference('RevitAPI')
from Autodesk.Revit.DB import *

clr.AddReference("RevitNodes")
import Revit
clr.ImportExtensions(Revit.Elements)

def GetFamParamProperties(param):
	try: guid = param.GUID.ToString()
	except: guid = None
	try: dutype = param.GetUnitTypeId()
	except: dutype = None
	assocparams = param.AssociatedParameters
	assocelems = list()
	for assoc in assocparams:
		assocelems.append(assoc.Element)
	return param.Definition.Name, guid, param.Definition.GetGroupTypeId(), param.Definition.GetDataType(), dutype, System.Enum.GetName(StorageType, param.StorageType), param.IsInstance, param.IsReporting, param.IsShared, param.IsReadOnly, param.UserModifiable, param.Formula, param.IsDeterminedByFormula, assocparams, param.CanAssignFormula, assocelems

params = UnwrapElement(IN[0])
if isinstance(IN[0], list): OUT = list(zip(*[GetFamParamProperties(x) for x in params]))
else: OUT = GetFamParamProperties(params)
# ----------------------------------------
code_block = CodeBlock(seq=python_script)
# ---------- code_block.designscript (32 lines) ----------
//Name
seq[0];
//GUID
seq[1];
//Parameter group
seq[2];
//Parameter type
seq[3];
//Unit type
seq[4];
//Storage type
seq[5];
//Is instance?
seq[6];
//Is reporting?
seq[7];
//Is shared?
seq[8];
//Is read-only?
seq[9];
//Is user-modifiable?
seq[10];
//Formula
seq[11];
//Is determinded by formula?
seq[12];
//Associated parameters
seq[13];
//Can assign formula?
seq[14];
//Associated elements
seq[15];
# ----------------------------------------
Name = Output(code_block.out0)
GUID = Output(code_block.out1)
ParameterGroup = Output(code_block.out2)
ParameterType = Output(code_block.out3)
UnitType = Output(code_block.out4)
StorageType = Output(code_block.out5)
IsInstanceParameter = Output(code_block.out6)
IsReportingParameter = Output(code_block.out7)
IsSharedParameter = Output(code_block.out8)
IsReadOnly = Output(code_block.out9)
IsUserModfiable = Output(code_block.out10)
CanBeAssignedAFormula = Output(code_block.out14)
IsDeterminedByFormula = Output(code_block.out12)
Formula = Output(code_block.out11)
code_block_2 = CodeBlock()
# ---------- code_block_2.designscript (30 lines) ----------
"not(";
"if(";
"and(";
"or(";
"sin(";
"cos(";
"tan(";
"asin(";
"acos(";
"atan(";
"sqrt(";
"log(";
"exp(";
"abs(";
"round(";
"roundup(";
"rounddown(";
"pi()";
"(";
")";
", ";
" + ";
" - ";
" * ";
" / ";
" ^ ";
" > ";
" < ";
" = ";
"-";
# ----------------------------------------
split = String.Split(string=code_block.out11, separator0=code_block_2.out0, separator1=code_block_2.out1, separator2=code_block_2.out2, separator3=code_block_2.out3, separator4=code_block_2.out4, separator5=code_block_2.out5, separator6=code_block_2.out6, separator7=code_block_2.out7, separator8=code_block_2.out8, separator9=code_block_2.out9, separator10=code_block_2.out10, separator11=code_block_2.out11, separator12=code_block_2.out12, separator13=code_block_2.out13, separator14=code_block_2.out14, separator15=code_block_2.out15, separator16=code_block_2.out16, separator17=code_block_2.out17, separator18=code_block_2.out18, separator19=code_block_2.out19, separator20=code_block_2.out20, separator21=code_block_2.out21, separator22=code_block_2.out22, separator23=code_block_2.out23, separator24=code_block_2.out24, separator25=code_block_2.out25, separator26=code_block_2.out26, separator27=code_block_2.out27, separator28=code_block_2.out28, separator29=code_block_2.out29)
python_script_2 = Python(IN[0]=split, IN[1]=code_block.out0)  # PythonNet3
# ---------- python_script_2.python (7 lines) ----------
import clr
OUT = []
for chunks in IN[0]:
	sublist = []
	if chunks: [sublist.append(x) for x in chunks if x in IN[1]]
	OUT.append(sublist)
	
# ----------------------------------------
ParameterNamesInFormula = Output(python_script_2)
AssociatedElements = Output(code_block.out15)
AssociatedParameters = Output(code_block.out13)
