# Dynamo custom node FamilyParameter.SetFormula.dyf (Dynamo 3.6.1.9895)
# category: Clockwork.Revit.Elements.Actions
# Sets the formula for a given family parameter. ATTENTION: Will only work if family contains at least one family type.
# packages: PythonNet3 Engine 1.1.1

familyParameter = Input(familyParameter: var[]..[])
formula = Input(formula: string[]..[])
python_script = Python(IN[0]=familyParameter, IN[1]=formula)  # PythonNet3
# ---------- python_script.python (24 lines) ----------
import clr
clr.AddReference('RevitAPI')
from Autodesk.Revit.DB import *

clr.AddReference("RevitServices")
import RevitServices
from RevitServices.Persistence import DocumentManager
from RevitServices.Transactions import TransactionManager

def SetFormula(param, formula):
	success = False
	if doc.IsFamilyDocument and hasattr(param, "Formula"):
		try:
			doc.FamilyManager.SetFormula(param, formula)
			success = True
		except: pass
	return param, success

doc = DocumentManager.Instance.CurrentDBDocument
TransactionManager.Instance.EnsureInTransaction(doc)
if isinstance(IN[0], list): 
	OUT = map(list, zip(*[SetFormula(x, y) for x, y in zip(IN[0], IN[1])]))
else: OUT = SetFormula(IN[0], IN[1])
TransactionManager.Instance.TransactionTaskDone()
# ----------------------------------------
firstItem = List.FirstItem(list=python_script)
familyParameter_2 = Output(firstItem)  # "familyParameter"
lastItem = List.LastItem(list=python_script)
success = Output(lastItem)
