# Dynamo custom node FamilyType.CompoundStructureHasVariableLayer.dyf (Dynamo 3.6.1.9895)
# category: Clockwork.Revit.Elements.Query
# Checks if the compound structure of a given floor or roof type contains a variable layer.
# packages: PythonNet3 Engine 1.1.1

familyType = Input(familyType: var[]..[])
python_script = Python(IN[0]=familyType)  # PythonNet3
# ---------- python_script.python (17 lines) ----------
import clr
clr.AddReference('RevitAPI')
from Autodesk.Revit.DB import *

def HasVariableLayer(item):
	if hasattr(item, "GetCompoundStructure"):
		compstruc = item.GetCompoundStructure()
		if hasattr(compstruc, "VariableLayerIndex"):
			if compstruc.VariableLayerIndex == -1: return False
			else: return True
		else: return False
	else: return False

items = UnwrapElement(IN[0])

if isinstance(IN[0], list): OUT = [HasVariableLayer(x) for x in items]
else: OUT = HasVariableLayer(items)
# ----------------------------------------
bool = Output(python_script)
