# Dynamo custom node FamilyType.CompoundStructureLayers.dyf (Dynamo 3.6.1.9895)
# category: Clockwork.Revit.Elements.Query
# Retrieves the compound layers of any layered family type (wall types, roof types, floor types etc.)
# packages: PythonNet3 Engine 1.1.1

elementType = Input(elementType: var[]..[])
python_script = Python(IN[0]=elementType)  # PythonNet3
# ---------- python_script.python (55 lines) ----------
import clr
import System
clr.AddReference('RevitAPI')
from Autodesk.Revit.DB import *

clr.AddReference("RevitNodes")
import Revit
clr.ImportExtensions(Revit.Elements)

clr.AddReference("RevitServices")
import RevitServices
from RevitServices.Persistence import DocumentManager
doc = DocumentManager.Instance.CurrentDBDocument

items = UnwrapElement(IN[0])
unittype = ForgeTypeId('autodesk.spec.aec:length-2.0.0')

def InternalUnitToDisplayUnit(val, unittype):
	formatoptions = doc.GetUnits().GetFormatOptions(unittype)
	dispunits = formatoptions.GetUnitTypeId()
	try: return UnitUtils.ConvertFromInternalUnits(val,dispunits)
	except: return None

def GetCompoundStructureLayers(item):
	layers = []
	layermat = []
	layerfunc = []
	layerwidth = []
	layercore = []
	layerwraps = []
	layervar = []
	layerdeck = []	
	if hasattr(item, "GetCompoundStructure"):
		compstruc = item.GetCompoundStructure()
		if compstruc:
			vertcomp = compstruc.IsVerticallyCompound
			varlayer = compstruc.VariableLayerIndex
			num = compstruc.LayerCount
			counter = 0
			while counter < num:
				layers.append(compstruc.GetLayers()[counter])
				layermat.append(item.Document.GetElement(compstruc.GetMaterialId(counter)))
				layerfunc.append(System.Enum.GetName(MaterialFunctionAssignment, compstruc.GetLayerFunction(counter)))
				layerwidth.append(InternalUnitToDisplayUnit(compstruc.GetLayerWidth(counter), unittype))
				layercore.append(compstruc.IsCoreLayer(counter))
				if compstruc.IsCoreLayer(counter): layerwraps.append(False)
				else: layerwraps.append(compstruc.ParticipatesInWrapping(counter))
				if varlayer == counter: layervar.append(True)
				else: layervar.append(False)
				layerdeck.append(compstruc.IsStructuralDeck(counter))
				counter += 1
	return layers, layermat, layerfunc, layerwidth, layercore, layerwraps, layervar, layerdeck

if isinstance(IN[0], list): OUT = map(list, zip(*[GetCompoundStructureLayers(x) for x in items]))
else: OUT = GetCompoundStructureLayers(items)
# ----------------------------------------
code_block = CodeBlock(seq=python_script)
# ---------- code_block.designscript (16 lines) ----------
// Layers
seq[0];
// Materials
seq[1];
// Functions
seq[2];
// Widths
seq[3];
// Is core layer
seq[4];
// Wraps
seq[5];
// Is variable
seq[6];
// Is structural deck
seq[7];
# ----------------------------------------
materials = Output(code_block.out1)
functions = Output(code_block.out2)
widths = Output(code_block.out3)
isCore = Output(code_block.out4)
wraps = Output(code_block.out5)
isVariable = Output(code_block.out6)
isStructuralDeck = Output(code_block.out7)
layers = Output(code_block.out0)
