# Dynamo custom node FamilyType.Duplicate.dyf (Dynamo 3.6.1.9895)
# category: Clockwork.Revit.Elements.Actions
# Duplicates a family type
# packages: PythonNet3 Engine 1.1.1, Clockwork for Dynamo 2.x 2.12.2

elementType = Input(elementType: var[]..[])
name = Input(name: string[]..[])
replacementForIllegalChars = Input(replacementForIllegalChars: string = "_")
replaceIllegalRevitCharacters = Custom[String.ReplaceIllegalRevitCharacters](str=name, replacement=replacementForIllegalChars)  # package Clockwork for Dynamo 2.x; Replaces all characters in a string that are illegal characters for Revit view names etc.
python_script = Python(IN[0]=elementType, IN[1]=replaceIllegalRevitCharacters)  # PythonNet3
# ---------- python_script.python (35 lines) ----------
import clr
clr.AddReference('RevitAPI')
from Autodesk.Revit.DB import *

clr.AddReference('RevitNodes')
import Revit
clr.ImportExtensions(Revit.Elements)

clr.AddReference('RevitServices')
import RevitServices
from RevitServices.Persistence import DocumentManager
from RevitServices.Transactions import TransactionManager

def DuplicateFamType(famtype, name):
    try:
        return famtype.Duplicate(name)
    except:
        try:
            t1 = famtype.GetType().ToString()
            if t1 in func_enum: return func_enum[t1](name)
            else: return None
        except:
            return None

doc = DocumentManager.Instance.CurrentDBDocument
famtypes = IN[0]
newnames = IN[1]
func_enum = {'Revit.Elements.WallType' : Revit.Elements.WallType.ByName,
             'Revit.Elements.FloorType' : Revit.Elements.FloorType.ByName,
             'Revit.Elements.FamilyType' : Revit.Elements.FamilyType.ByName}

TransactionManager.Instance.EnsureInTransaction(doc)
if isinstance(famtypes, list): OUT = UnwrapElement([DuplicateFamType(x, y) for x, y in zip(famtypes, newnames)])
else: OUT = UnwrapElement(DuplicateFamType(famtypes, newnames))
TransactionManager.Instance.TransactionTaskDone()
# ----------------------------------------
duplicate = Output(python_script)
