# Dynamo custom node FamilyType.SetCompoundLayerMaterial.dyf (Dynamo 3.6.1.9895)
# category: Clockwork.Revit.Elements.Actions
# Sets the material of a specified compound layer of a given family type (only applies to family types that have a compound structure, e.g. walls, floors etc.).
# packages: PythonNet3 Engine 1.1.1

familyType = Input(familyType: var[]..[])
familyType_2 = Output(familyType)  # "familyType"
layerIndex = Input(layerIndex: int)
material = Input(material: var[]..[])
python_script = Python(IN[0]=familyType, IN[1]=layerIndex, IN[2]=material)  # PythonNet3
# ---------- python_script.python (38 lines) ----------
import clr
clr.AddReference('RevitAPI')
from Autodesk.Revit.DB import *

clr.AddReference("RevitServices")
import RevitServices
from RevitServices.Persistence import DocumentManager
from RevitServices.Transactions import TransactionManager

def SetCompoundLayerMaterial(famtype, index, mat):
	try:
		cs = famtype.GetCompoundStructure()
		cs.SetMaterialId(index,mat.Id)
		famtype.SetCompoundStructure(cs)
		return True
	except: return False

doc = DocumentManager.Instance.CurrentDBDocument
famtypes = UnwrapElement(IN[0])
indices = IN[1]
mats = UnwrapElement(IN[2])

TransactionManager.Instance.EnsureInTransaction(doc)
if isinstance(IN[0], list):
	if isinstance(IN[2], list):
		if isinstance(IN[1], list): OUT = [SetCompoundLayerMaterial(x,y,z) for x,y,z in zip(famtypes, indices, mats)]
		else: OUT = [SetCompoundLayerMaterial(x,indices,y) for x,y in zip(famtypes, mats)]
	else:
		if isinstance(IN[1], list): OUT = [SetCompoundLayerMaterial(x,y,mats) for x,y in zip(famtypes, indices)]
		else: OUT = [SetCompoundLayerMaterial(x,indices,mats) for x in famtypes]
else:
	if isinstance(IN[2], list):
		if isinstance(IN[1], list): OUT = [SetCompoundLayerMaterial(famtypes,x,y) for x,y in zip(indices, mats)]
		else: OUT = [SetCompoundLayerMaterial(famtypes,indices,x) for x in mats]
	else:
		if isinstance(IN[1], list): OUT = [SetCompoundLayerMaterial(famtypes,x,mats) for x in indices]
		else: OUT = SetCompoundLayerMaterial(famtypes,indices,mats)
TransactionManager.Instance.TransactionTaskDone()
# ----------------------------------------
success = Output(python_script)
