# Dynamo custom node FileSystem.FileCreated.dyf (Dynamo 3.6.1.9895)
# category: Clockwork.ImportExport.Query
# Returns the date and time a given file was created
# packages: PythonNet3 Engine 1.1.1

file = Input(file: System.IO.FileInfo[]..[])
python_script = Python(IN[0]=file)  # PythonNet3
# ---------- python_script.python (8 lines) ----------
import clr

def FileCreated(file):
	if hasattr(file,"CreationTime"): return file.CreationTime
	else: return None

if isinstance(IN[0], list): OUT = [FileCreated(x) for x in IN[0]]
else: OUT = FileCreated(IN[0])
# ----------------------------------------
dateTime = Output(python_script)
