# Dynamo custom node FileSystem.FileLastModified.dyf (Dynamo 3.6.1.9895)
# category: Clockwork.ImportExport.Query
# Returns the date and time a given file was last modified
# packages: PythonNet3 Engine 1.1.1

file = Input(file: System.IO.FileInfo[]..[])
python_script = Python(IN[0]=file)  # PythonNet3
# ---------- python_script.python (8 lines) ----------
import clr

def FileLastModified(file):
	if hasattr(file,"LastWriteTime"): return file.LastWriteTime
	else: return None

if isinstance(IN[0], list): OUT = [FileLastModified(x) for x in IN[0]]
else: OUT = FileLastModified(IN[0])
# ----------------------------------------
dateTime = Output(python_script)
