# Dynamo custom node FillPatternElement.IsSolidFill.dyf (Dynamo 3.6.1.9895)
# category: Clockwork.Revit.Elements.Query
# Checks if the given FillPatternElement is a solid fill
# packages: PythonNet3 Engine 1.1.1

fillPatternElement = Input(fillPatternElement: Revit.Elements.FillPatternElement)
python_script = Python(IN[0]=fillPatternElement)  # PythonNet3
# ---------- python_script.python (11 lines) ----------
import clr
clr.AddReference('RevitAPI')
from Autodesk.Revit.DB import *

def IsSolidFill(fp):
	return fp.GetFillPattern().IsSolidFill

fillpatterns = UnwrapElement(IN[0])

if isinstance(IN[0], list): OUT = [IsSolidFill(x) for x in fillpatterns]
else: OUT = IsSolidFill(fillpatterns)
# ----------------------------------------
bool = Output(python_script)
