# Dynamo custom node FootingType.BreaksAtInserts.dyf (Dynamo 3.6.1.9895)
# category: Clockwork.Revit.Elements.Query
# Determines whether a list of wall footing types break at inserts in their attached walls
# packages: PythonNet3 Engine 1.1.1

footingType = Input(footingType: var[]..[])
python_script = Python(IN[0]=footingType)  # PythonNet3
# ---------- python_script.python (14 lines) ----------
import clr
clr.AddReference('RevitAPI')
from Autodesk.Revit.DB import *

def FTBreaksAtInsert(ft):
	try:
		footingbreaks = ft.get_Parameter(BuiltInParameter.CONTINUOUS_FOOTING_BREAK_AT_INSERTS_DISABLE).AsInteger()
		if footingbreaks == 0: return True
		else: return False
	except: return False

ftypes = UnwrapElement(IN[0])
if isinstance(IN[0], list): OUT = [FTBreaksAtInsert(x) for x in ftypes]
else: OUT = FTBreaksAtInsert(ftypes)
# ----------------------------------------
bool = Output(python_script)
