# Dynamo custom node GenericForm.IsSolid.dyf (Dynamo 3.6.1.9895)
# category: Clockwork.Revit.Elements.Query
# Checks if a form element in a family is a solid or a void. Will return Null for any other elements.
# packages: PythonNet3 Engine 1.1.1

GenericForm = Input(GenericForm: var[]..[])
python_script = Python(IN[0]=GenericForm)  # PythonNet3
# ---------- python_script.python (11 lines) ----------
import clr
clr.AddReference('RevitAPI')
from Autodesk.Revit.DB import *

def CheckIfSolid(item):
	if hasattr(item, "IsSolid"): return item.IsSolid
	else: return None

items = UnwrapElement(IN[0])
if isinstance(IN[0], list): OUT = [CheckIfSolid(x) for x in items]
else: OUT = CheckIfSolid(items)
# ----------------------------------------
bool = Output(python_script)
