# Dynamo custom node GlobalParameter.Formula.dyf (Dynamo 3.6.1.9895)
# category: Clockwork.Revit.Elements.Query
# Returns the formula of a global parameter (if any)
# packages: PythonNet3 Engine 1.1.1

globalParam = Input(globalParam: Revit.Elements.GlobalParameter[]..[])
python_script = Python(IN[0]=globalParam)  # PythonNet3
# ---------- python_script.python (17 lines) ----------
import clr
import System
clr.AddReference('RevitAPI')
from Autodesk.Revit.DB import *

clr.AddReference("RevitNodes")
import Revit
clr.ImportExtensions(Revit.Elements)

def GetGPFormula(gp):
	if hasattr(gp, "GetFormula"): return gp.GetFormula()
	else: return None

items = UnwrapElement(IN[0])

if isinstance(IN[0], list): OUT = [GetGPFormula(x) for x in items]
else: OUT = GetGPFormula(items)
# ----------------------------------------
str = Output(python_script)
