# Dynamo custom node GlobalParameter.SetFormula.dyf (Dynamo 3.6.1.9895)
# category: Clockwork.Revit.Elements.Actions
# Sets the formula of a global parameter
# packages: PythonNet3 Engine 1.1.1

globalParam = Input(globalParam: Revit.Elements.GlobalParameter[]..[])
globalParam_2 = Output(globalParam)  # "globalParam"
formula = Input(formula: string[]..[])
setFormula = Python(IN[0]=globalParam, IN[1]=formula)  # "GlobalParameter.SetFormula"; PythonNet3
# ---------- setFormula.python (32 lines) ----------
import clr
import System
clr.AddReference('RevitAPI')
from Autodesk.Revit.DB import *

clr.AddReference("RevitNodes")
import Revit
clr.ImportExtensions(Revit.Elements)

clr.AddReference("RevitServices")
import RevitServices
from RevitServices.Persistence import DocumentManager
from RevitServices.Transactions import TransactionManager

def SetGPFormula(gp,formula):
	try: 
		gp.SetFormula(formula)
		return True
	except: return False

doc = DocumentManager.Instance.CurrentDBDocument
items = UnwrapElement(IN[0])
formulas = IN[1]

TransactionManager.Instance.EnsureInTransaction(doc)
if isinstance(IN[0], list): 
	if isinstance(IN[1], list): OUT = [SetGPFormula(x,y) for x,y in zip(items,formulas)]
	else: OUT = [SetGPFormula(x,formulas) for x in items]
else:
	if isinstance(IN[1], list): OUT = SetGPFormula(items,formulas[0])
	else: OUT = SetGPFormula(items,formulas)
TransactionManager.Instance.TransactionTaskDone()
# ----------------------------------------
success = Output(setFormula)
