# Dynamo custom node Group.FromElements.dyf (Dynamo 3.6.1.9895)
# category: Clockwork.Revit.Elements.Create
# Creates a group from a list of Revit elements. Unlike the OOTB node, it supports naming the created group directly and also indicates which of the input elements (if any) could not be grouped.
# packages: PythonNet3 Engine 1.1.1, Clockwork for Dynamo 2.x 2.6.0

elements = Input(elements: var[]..[])
groupName = Input(groupName: var[]..[])
replacementForIllegalChars = Input(replacementForIllegalChars: string = "_")
replaceIllegalRevitCharacters = Custom[String.ReplaceIllegalRevitCharacters](str=groupName, replacement=replacementForIllegalChars)  # package Clockwork for Dynamo 2.x; Replaces all characters in a string that are illegal characters for Revit view names etc.
python_script = Python(IN[0]=elements, IN[1]=replaceIllegalRevitCharacters)  # PythonNet3
# ---------- python_script.python (37 lines) ----------
import clr
clr.AddReference('RevitAPI')
from Autodesk.Revit.DB import *
from System.Collections.Generic import *

clr.AddReference("RevitServices")
import RevitServices
from RevitServices.Persistence import DocumentManager
from RevitServices.Transactions import TransactionManager

def MakeNewGroup(items, name):
    ids = []
    rejects = []
    for item in items:
        if item.Document.GetElement(item.GroupId): rejects.append(item)
        else:
            try: ids.append(item.Id)
            except: rejects.append(item)
    itemsNew = List[ElementId](ids)
    try:
        group = doc.Create.NewGroup(itemsNew)
        group.GroupType.Name = name
    except: 
        group = None
        rejects = items
    return group, rejects

doc = DocumentManager.Instance.CurrentDBDocument
items = UnwrapElement(IN[0])
names = IN[1]

TransactionManager.Instance.EnsureInTransaction(doc)
if isinstance(IN[1], list):
    if isinstance(IN[0], list): OUT = list(zip(*[MakeNewGroup(x, y) for x, y in zip (items, names)]))
    else: OUT = MakeNewGroup(items, names[0])
else: OUT = MakeNewGroup(items, names)
TransactionManager.Instance.TransactionTaskDone()
# ----------------------------------------
code_block = CodeBlock(seq=python_script) { seq[0]; seq[1]; }
group = Output(code_block.out0)
ungroupableElements = Output(code_block.out1)
