# Dynamo custom node Group.IsMirrored.dyf (Dynamo 3.6.1.9895)
# category: Clockwork.Revit.Elements.Query
# Checks if a list of group instances have been mirrored. The reference group should usually be the first placed instance of the group (since that one has likely not been mirrored).  The node will return null for group instances of other group types than the reference group as well as for group instances with excluded members. Furthermore, it will return null for *all* groups if the reference group itself has excluded members or if it doesn't contain any loadable families (since they are the only way of determining if the group instance has been mirrored). The node will likely report null for group instances where members have been excluded but subsequently been restored.
# packages: PythonNet3 Engine 1.1.1, Clockwork for Dynamo 2.x 2.12.2

referenceGroup = Input(referenceGroup: var)
groupsToCheck = Input(groupsToCheck: var[])
version = Custom[Application.Version]()  # package Clockwork for Dynamo 2.x; Retrieves the name, version and build of the current Revit application.
python_script = Python(IN[0]=referenceGroup, IN[1]=groupsToCheck, IN[2]=version.Version)  # PythonNet3
# ---------- python_script.python (67 lines) ----------
import clr
clr.AddReference('RevitAPI')
from Autodesk.Revit.DB import *

clr.AddReference("RevitNodes")
import Revit
clr.ImportExtensions(Revit.Elements)

refgroup = UnwrapElement(IN[0])
groups = UnwrapElement(IN[1])
version = IN[2]

# Get Mirrored state of first family instance in reference group instance
refGroupMembers = refgroup.GetMemberIds()
numMembers = len(refGroupMembers)
counter = 0
membernum = None
if version > 2024: refGroupType = refgroup.GroupType.Id.Value
else: refGroupType = refgroup.GroupType.Id.IntegerValue
for member in refGroupMembers:
    elem = refgroup.Document.GetElement(member)
    if elem.GetType().ToString() == "Autodesk.Revit.DB.FamilyInstance":
        state = elem.Mirrored
        membernum = counter
        if version > 2024: famtype = elem.GetTypeId().Value
        else: famtype = elem.GetTypeId().IntegerValue
        break
    counter += 1
    
# Default values for flags
refGroupIntact = True
noFamInsts = False
# Set a flag if the reference group contains no family instances
if membernum == None: noFamInsts = True
else:
    bools = []
    # Compare Mirrored state with corresponding members of other group instances
    for group in groups:
        # Get number of group members
        theseMembers = group.GetMemberIds()
        theseMembersNum = len(theseMembers)
        # get IDs for comparison
        if version > 2024: 
            gtid = group.GroupType.Id.Value
            ftypeid = group.Document.GetElement(theseMembers[membernum]).GetTypeId().Value
        else: 
            gtid = group.GroupType.Id.IntegerValue
            ftypeid = group.Document.GetElement(theseMembers[membernum]).GetTypeId().IntegerValue
        # Set a flag if any group instance has more members than the reference group instance
        # (only if both are of the same group type)
        if theseMembersNum > numMembers and refGroupType == gtid:
            refGroupIntact = False
            break
        # Return null if group is of another group type
        elif refGroupType != gtid: bools.append(None)
        # Return null for group instances with excluded members
        elif theseMembersNum < numMembers: bools.append(None)
        # Return null if family instance to compare if of a diffent type
        elif ftypeid != famtype: bools.append(None)
        # Otherwise compare Mirrored state
        else: bools.append(group.Document.GetElement(theseMembers[membernum]).Mirrored != state)
            
# Return null for all groups if the first group has excluded members
# or if it does not contain any fanily instances
if not refGroupIntact or noFamInsts: bools = [None] * len(groups)
    
OUT = bools
# ----------------------------------------
bool = Output(python_script)
