# Dynamo custom node GroupType.Groups.dyf (Dynamo 3.6.1.9895)
# category: Clockwork.Revit.Elements.Query
# Returns all group instances of a given group type
# packages: PythonNet3 Engine 1.1.1

groupType = Input(groupType: var[]..[])
python_script = Python(IN[0]=groupType)  # PythonNet3
# ---------- python_script.python (17 lines) ----------
import clr
clr.AddReference('RevitAPI')
from Autodesk.Revit.DB import *

clr.AddReference("RevitNodes")
import Revit
clr.ImportExtensions(Revit.Elements)

grouptypes = UnwrapElement(IN[0])

def GroupTypeInstances(gt):
	if gt.GetType().ToString() == "Autodesk.Revit.DB.GroupType":
		return [x.ToDSType(True) for x in gt.Groups]
	else: return []

if isinstance(IN[0], list): OUT = [GroupTypeInstances(x) for x in grouptypes]
else: OUT = GroupTypeInstances(grouptypes)
# ----------------------------------------
groups = Output(python_script)
