# Dynamo custom node Hex.FromDecimal.dyf (Dynamo 3.6.1.9895)
# category: Clockwork.String.Generate.Create
# Converts a number to a string of its hexadecimal value
# packages: PythonNet3 Engine 1.1.1

decimal = Input(decimal: int)
python_script = Python(IN[0]=decimal)  # PythonNet3
# ---------- python_script.python (2 lines) ----------
if isinstance(IN[0], list): OUT = [hex(x) for x in IN[0]]
else: OUT = hex(IN[0])
# ----------------------------------------
hex = Output(python_script)
