# Dynamo custom node ImportInstance.IsLinked.dyf (Dynamo 3.6.1.9895)
# category: Clockwork.Revit.Elements.Query
# Determines whether an ImportInstance is linked or not
# packages: PythonNet3 Engine 1.1.1

importInstance = Input(importInstance: Revit.Elements.ImportInstance)
python_script = Python(IN[0]=importInstance)  # PythonNet3
# ---------- python_script.python (19 lines) ----------
import clr
clr.AddReference('RevitAPI')
from Autodesk.Revit.DB import *
import Autodesk

clr.AddReference("RevitServices")
import RevitServices
from RevitServices.Persistence import DocumentManager

def IsLinked(item):
	if item.GetType().ToString() == "Autodesk.Revit.DB.ImportInstance":
		if item.IsLinked: return True
		else: return False
	else: return False

doc = DocumentManager.Instance.CurrentDBDocument
impinst = UnwrapElement(IN[0])
if isinstance(IN[0], list): OUT = [IsLinked(x) for x in impinst]
else: OUT = IsLinked(impinst)
# ----------------------------------------
bool = Output(python_script)
