# Dynamo custom node InternalUnit.ToDisplayUnit.dyf (Dynamo 3.6.1.9895)
# category: Clockwork.Revit.Units.Actions
# Converts a value from Revit's internal unit to a given display unit
# packages: PythonNet3 Engine 1.1.1

val = Input(val: double)
displayUnitType = Input(displayUnitType: var)
python_script = Python(IN[0]=val, IN[1]=displayUnitType)  # PythonNet3
# ---------- python_script.python (14 lines) ----------
import clr
clr.AddReference('RevitAPI')
from Autodesk.Revit.DB import *

def FromInternalUnits(val, unittype):
	if str(dispunit.GetType()) == "Autodesk.Revit.DB.ForgeTypeId":
		return UnitUtils.ConvertFromInternalUnits(val,unittype)
	else: return None

vals = IN[0]
dispunit = IN[1]

if isinstance(IN[0], list): OUT = [FromInternalUnits(x, dispunit) for x in vals]
else: OUT = FromInternalUnits(vals, dispunit)
# ----------------------------------------
val_2 = Output(python_script)  # "val"
