# Dynamo custom node Level.Views.dyf (Dynamo 3.6.1.9895)
# category: Clockwork.Revit.Elements.Query
# Returns all views associated with a given level
# packages: Clockwork for Dynamo 2.x 2.12.1, PythonNet3 Engine 1.1.1

level = Input(level: Revit.Elements.Level[]..[])
toggleToRefresh = Input(toggleToRefresh: bool = true)
views = Custom[Document.Views](toggle=toggleToRefresh)  # package Clockwork for Dynamo 2.x; Gets all views in the document - except for 3D view templates (as long as this bug is not fixed: https://github.com/DynamoDS/Dynamo/issues/2970)
level_2 = Custom[Element.Level](element=views)  # package Clockwork for Dynamo 2.x; Gets an element's level
isNull = Object.IsNull(object=level_2)
filterByBoolMask = List.FilterByBoolMask(list=views, mask=isNull)
filterByBoolMask_2 = List.FilterByBoolMask(list=level_2, mask=isNull)
groupByKey = List.GroupByKey(list=filterByBoolMask.out, keys=filterByBoolMask_2.out)
python_script = Python(IN[0]=level, IN[1]=groupByKey.groups, IN[2]=groupByKey.uniqueKeys)  # PythonNet3
# ---------- python_script.python (26 lines) ----------
import clr
clr.AddReference('RevitAPI')
from Autodesk.Revit.DB import *

clr.AddReference("RevitNodes")
import Revit
clr.ImportExtensions(Revit.Elements)

import System
from System.Collections.Generic import *

def GetFirstAndAllViews(lvl):
	firstView = None
	try:
		if lvl.Document.GetElement(lvl.FindAssociatedPlanViewId()): firstView = lvl.Document.GetElement(lvl.FindAssociatedPlanViewId())
	except: pass
	if viewlevels.Contains(lvl.Id): allViews = views[viewlevels.IndexOf(lvl.Id)]
	else: allViews = []
	return firstView, allViews

levels = UnwrapElement(IN[0])
views = UnwrapElement(IN[1])
viewlevels = List[ElementId]([x.Id for x in UnwrapElement(IN[2])])

if isinstance(IN[0], list): OUT = list(zip(*[GetFirstAndAllViews(x) for x in levels]))
else: OUT = GetFirstAndAllViews(levels)
# ----------------------------------------
code_block = CodeBlock(seq=python_script) { seq[0]; seq[1]; }
firstView = Output(code_block.out0)
allViews = Output(code_block.out1)
