# Dynamo custom node List.Chop+.dyf (Dynamo 3.6.1.9895)
# category: Clockwork.List.Modify.Actions
# Turns a list into a list of lists with sublists of varying lengths. Unlike the OOTB node, it only takes the specified amount of items and disregards the rest of the input list.
# packages: PythonNet3 Engine 1.1.1

seq = Input(seq: var[])
lengths = Input(lengths: int[]..[])
python_script = Python(IN[0]=seq, IN[1]=lengths)  # PythonNet3
# ---------- python_script.python (19 lines) ----------
import clr

def ListChopEvenly(l, n):
	# https://stackoverflow.com/questions/312443/how-do-you-split-a-list-into-evenly-sized-chunks
	return [l[i:i + n] for i in xrange(0, len(l), n)]

def ListChopUnevenly(l, n):
	count = 0
	max = len(l)
	chopped = []
	for num in n:
		if count + num > max: end = max
		else: end = count + num
		chopped.append(l[count:end])
		count = end	
	return chopped

if isinstance(IN[1], list): OUT = ListChopUnevenly(IN[0], IN[1])
else: OUT = ListChopEvenly(IN[0], IN[1])
# ----------------------------------------
seq_2 = Output(python_script)  # "seq"
