# Dynamo custom node List.DropLastItem.dyf (Dynamo 2.0.1.5055)
# category: Clockwork.List.Modify.Actions
# Drops the last item from a given list.

list = Input(list: var[]..[])
code_block = CodeBlock { -1; }
dropItems = List.DropItems(list=list, amount=code_block)
list_2 = Output(dropItems)  # "list"
