# Dynamo custom node List.JoinByKey.dyf (Dynamo 3.6.1.9895)
# category: Clockwork.List.Organize.Actions
# Joins two lists by common keys.
# packages: PythonNet3 Engine 1.1.1

keys1 = Input(keys1: var[]..[])
seq1 = Input(seq1: var[]..[])
keys2 = Input(keys2: var[]..[])
seq2 = Input(seq2: var[]..[])
excludeUnmatchedKeys = Input(excludeUnmatchedKeys: bool = false)
python_script = Python(IN[0]=keys1, IN[1]=seq1, IN[2]=keys2, IN[3]=seq2, IN[4]=excludeUnmatchedKeys)  # PythonNet3
# ---------- python_script.python (22 lines) ----------
import clr

keys1 = IN[0]
keys2 = IN[2]
items1 = IN[1]
items2 = IN[3]
exclude = IN[4]

unified, keys_done = [],[]
for i in range(len(keys1)):
	for j in range(len(keys2)):
		if keys1[i] == keys2[j]:
			unified.append((keys1[i],items1[i],items2[j]))
			keys_done.append(keys1[i])
	if keys1[i] not in keys_done and not exclude:
		unified.append((keys1[i],items1[i],[]))
		keys_done.append(keys1[i])
for k in range(len(keys2)):
	if keys2[k] not in keys_done and not exclude:
		unified.append((keys2[k],[],items2[k]))
		keys_done.append(keys2[k])
OUT = unified
# ----------------------------------------
transpose = List.Transpose(lists=python_script)
code_block = CodeBlock(seq=transpose) { seq[0]; seq[1]; seq[2]; }
keys = Output(code_block.out0)
seq1_2 = Output(code_block.out1)  # "seq1"
seq2_2 = Output(code_block.out2)  # "seq2"
