# Dynamo custom node List.ReplaceEmptyLists.dyf (Dynamo 2.0.1.5055)
# category: Clockwork.List.Modify.Actions
# Replaces all empty lists within a given list with a substitute

seq = Input(seq: var[]..[])
isNotEmpty = Custom[List.IsNotEmpty](seq=seq@L2)  # Just the inversion of the built-in Is Empty List node.
boolean = BoolSelector(true)  # graph input
replaceNull = Custom[List.ReplaceNull](seq=isNotEmpty, replacement=boolean)  # Replaces all null values within a given list with a substitute
getKeys = GetKeys(list=replaceNull)
filterByBoolMask = List.FilterByBoolMask(list=getKeys, mask=replaceNull)
Replacement = Input(Replacement: var[]..[])
replaceItemAtIndex = Custom[List.ReplaceItemAtIndex+](seq=seq, indices=filterByBoolMask.out, replacement=Replacement)  # Replaces the item at a given index (or list of indices) of a list by another item
seq_2 = Output(replaceItemAtIndex)  # "seq"
