# Dynamo custom node List.ReplaceItemAtIndex+.dyf (Dynamo 3.6.1.9895)
# category: Clockwork.List.Modify.Actions
# Replaces the item at a given index of a list by another item. Unlike the OOTB node, it can replace items at multiple indeces.
# packages: PythonNet3 Engine 1.1.1

seq = Input(seq: var[]..[])
replacement = Input(replacement: var[]..[])
indices = Input(indices: int[]..[])
python_script = Python(IN[0]=seq, IN[1]=replacement, IN[2]=indices)  # PythonNet3
# ---------- python_script.python (10 lines) ----------
_list = IN[0]
rValues = IN[1]
iValues = IN[2]
if iValues:
	if isinstance(iValues, list):
		if not isinstance(rValues, list): rValues = [rValues] * len(iValues)
		for (index, value) in zip(iValues, rValues):
			_list[index] = value
	else: _list[iValues] = rValues
OUT = _list
# ----------------------------------------
seq_2 = Output(python_script)  # "seq"
