# Dynamo custom node List.ReplaceNull.dyf (Dynamo 3.6.1.9895)
# category: Clockwork.List.Modify.Actions
# Replaces all null values within a given list with a substitute
# packages: PythonNet3 Engine 1.1.1

seq = Input(seq: var[]..[])
replacement = Input(replacement: var[]..[])
python_script = Python(IN[0]=seq, IN[1]=replacement)  # PythonNet3
# ---------- python_script.python (8 lines) ----------
items = IN[0]
rep = IN[1]
elementlist = list()
for item in items:
	if item is None: 
		item = rep
	elementlist.append(item)
OUT = elementlist
# ----------------------------------------
seq_2 = Output(python_script)  # "seq"
