# Dynamo custom node List.SortListOfLists.dyf (Dynamo 3.6.1.9895)
# category: Clockwork.List.Organize.Actions
# Sorts a list of lists by one of its sublists
# packages: PythonNet3 Engine 1.1.1

seq = Input(seq: var[]..[])
transpose = List.Transpose(lists=seq)
sortIndex = Input(sortIndex: int = 0)
caseInsensitive = Input(caseInsensitive: bool = false)
orderDescending = Input(orderDescending: bool = false)
python_script = Python(IN[0]=transpose, IN[1]=sortIndex, IN[2]=caseInsensitive, IN[3]=orderDescending)  # PythonNet3
# ---------- python_script.python (20 lines) ----------
import clr

lists = IN[0]
sortindex = int(IN[1])
caseinsensitive = IN[2]
sortdescending = IN[3]

# make sure that case-insensitive is turned of if it is not strings we're sorting
if caseinsensitive == True and isinstance(lists[0][sortindex], basestring) == False:
	caseinsensitive = False
if caseinsensitive == True:
	if sortdescending == True:
		OUT = sorted(lists, key=lambda lists:lists[sortindex].lower(), reverse=True)
	else:
		OUT = sorted(lists, key=lambda lists:lists[sortindex].lower())
else:
	if sortdescending == True:
		OUT = sorted(lists, key=lambda lists:lists[sortindex], reverse=True)
	else:
		OUT = sorted(lists, key=lambda lists:lists[sortindex])
# ----------------------------------------
transpose_2 = List.Transpose(lists=python_script)
seq_2 = Output(transpose_2)  # "seq"
