# Dynamo custom node MassFloor.Mass.dyf (Dynamo 3.6.1.9895)
# category: Clockwork.Revit.Elements.Query
# Gets the mass a given mass floor belongs to
# packages: PythonNet3 Engine 1.1.1

massFloor = Input(massFloor: var[]..[])
python_script = Python(IN[0]=massFloor)  # PythonNet3
# ---------- python_script.python (16 lines) ----------
import clr
clr.AddReference('RevitAPI')
from Autodesk.Revit.DB import *

clr.AddReference("RevitNodes")
import Revit
clr.ImportExtensions(Revit.Elements)

def GetMass(item):
	if hasattr(item, "OwningMassId"): return item.Document.GetElement(item.OwningMassId).ToDSType(True)
	else: return None

items = UnwrapElement(IN[0])

if isinstance(IN[0], list): OUT = [GetMass(x) for x in items]
else: OUT = GetMass(items)
# ----------------------------------------
mass = Output(python_script)
