# Dynamo custom node Material.Duplicate.dyf (Dynamo 3.6.1.9895)
# category: Clockwork.Revit.Elements.Actions
# Duplicates a material
# packages: Clockwork for Dynamo 2.x 2.12.1, PythonNet3 Engine 1.1.1

material = Input(material: var[]..[])
name = Input(name: string[]..[])
replacementForIllegalChars = Input(replacementForIllegalChars: string = "_")
replaceIllegalRevitCharacters = Custom[String.ReplaceIllegalRevitCharacters](str=name, replacement=replacementForIllegalChars)  # package Clockwork for Dynamo 2.x; Replaces all characters in a string that are illegal characters for Revit view names etc.
python_script = Python(IN[0]=material, IN[1]=replaceIllegalRevitCharacters)  # PythonNet3
# ---------- python_script.python (25 lines) ----------
import clr
clr.AddReference('RevitAPI')
from Autodesk.Revit.DB import *

clr.AddReference('RevitNodes')
import Revit
clr.ImportExtensions(Revit.Elements)

clr.AddReference('RevitServices')
import RevitServices
from RevitServices.Persistence import DocumentManager
from RevitServices.Transactions import TransactionManager

def DuplicateMaterial(mat, name):
	try: return mat.Duplicate(name)
	except: return None

doc = DocumentManager.Instance.CurrentDBDocument
mats = UnwrapElement(IN[0])
newnames = IN[1]

TransactionManager.Instance.EnsureInTransaction(doc)
if isinstance(mats, list): OUT = [DuplicateMaterial(x, y) for x, y in zip(mats, newnames)]
else: OUT = DuplicateMaterial(mats, newnames)
TransactionManager.Instance.TransactionTaskDone()
# ----------------------------------------
duplicate = Output(python_script)
