# Dynamo custom node Normalization.InvertNormalized.dyf (Dynamo 2.0.1.5055)
# category: Clockwork.Math.Functions.Actions
# Inverts a value between 0 and 1 to its opposite (1-x)

dbl = Input(dbl: double)
code_block = CodeBlock(x=dbl) { 1-x; }
dbl_2 = Output(code_block)  # "dbl"
