# Dynamo custom node Object.Members.dyf (Dynamo 3.6.1.9895)
# category: Clockwork.Input.Query
# Gets a list of all members (properties and methods) of a selected element
# packages: PythonNet3 Engine 1.1.1

element = Input(element: var[]..[])
python_script = Python(IN[0]=element)  # PythonNet3
# ---------- python_script.python (8 lines) ----------
import clr
clr.AddReference('RevitAPI')
from Autodesk.Revit.DB import *

items = UnwrapElement(IN[0])

if isinstance(IN[0], list): OUT = [dir(x) for x in items]
else: OUT = dir(items)
# ----------------------------------------
members = Output(python_script)
