# Dynamo custom node Part.SourceElement.dyf (Dynamo 3.6.1.9895)
# category: Clockwork.Revit.Elements.Query
# Retrieves the element a given part was made from
# packages: PythonNet3 Engine 1.1.1

part = Input(part: var[]..[])
python_script = Python(IN[0]=part)  # PythonNet3
# ---------- python_script.python (17 lines) ----------
import clr
clr.AddReference('RevitAPI')
from Autodesk.Revit.DB import *

clr.AddReference("RevitNodes")
import Revit
clr.ImportExtensions(Revit.Elements)

def GetPartSource(part):
	if hasattr(part, "GetSourceElementIds"):
		return [part.Document.GetElement(x.HostElementId).ToDSType(True) for x in part.GetSourceElementIds()]
	else: return list()

parts = UnwrapElement(IN[0])

if isinstance(IN[0], list): OUT = [GetPartSource(x) for x in parts]
else: OUT = GetPartSource(parts)
# ----------------------------------------
sourceElement = Output(python_script)
