# Dynamo custom node PathGraph.ByPairs.dyf (Dynamo 3.6.1.9895)
# category: Clockwork.Math.Graphs.Create
# Builds a path graph (Python dictionary) from a list of value pairs.
# packages: PythonNet3 Engine 1.1.1

stringPairs = Input(stringPairs: string[][])
# note: Get a list of distinct indices
flatten = List.Flatten(list=stringPairs)
uniqueItems = List.UniqueItems(list=flatten)
reverse = List.Reverse()  # unwired: list
# note: Get a flat list of paths
map = List.Map(list=stringPairs, f_x=reverse)
join = List.Join(list0=stringPairs, list1=map)
python_script = Python(IN[0]=uniqueItems, IN[1]=join)  # PythonNet3
# ---------- python_script.python (15 lines) ----------
indices = IN[0]
flatlist = IN[1]
pathgraph = dict()

# script found here:
# https://www.python.org/doc/essays/graphs/

for index in indices:
	indexlist = list()
	for item in flatlist:
		if index == item[0]:
			indexlist.append(item[1])
	pathgraph[index] = indexlist	
# convert dictionary to list as Dynamo does not allow Python dictionaries
OUT = pathgraph.items()
# ----------------------------------------
pathGraph = Output(python_script)
