# Dynamo custom node PathGraph.ShortestPath.dyf (Dynamo 3.6.1.9895)
# category: Clockwork.Math.Graphs.Query
# Finds the shortest path (fewest steps) between two nodes. The connections input expects a list of value pairs.
# packages: PythonNet3 Engine 1.1.1, Clockwork for Dynamo 2.x 2.12.2

stringPairs = Input(stringPairs: string[][])
byPairs = Custom[PathGraph.ByPairs](stringPairs=stringPairs)  # package Clockwork for Dynamo 2.x; Builds a path graph (Python dictionary) from a list of value pairs.
start = Input(start: string)
end = Input(end: string)
python_script = Python(IN[0]=byPairs, IN[1]=start, IN[2]=end)  # PythonNet3
# ---------- python_script.python (27 lines) ----------
pathgraphlist = IN[0]
start = IN[1]
end = IN[2]
pathgraph = dict()

for item in pathgraphlist:
	pathgraph[item[0]] = item[1]

# script found here:
# https://www.python.org/doc/essays/graphs/

def find_shortest_path(graph, start, end, path=[]):
	path = path + [start]
	if start == end:
		return path
	if not start in graph:
		return None
	shortest = None
	for node in graph[start]:
		if node not in path:
			newpath = find_shortest_path(graph, node, end, path)
			if newpath:
				if not shortest or len(newpath) < len(shortest):
					shortest = newpath
	return shortest

OUT = find_shortest_path(pathgraph,start,end)
# ----------------------------------------
paths = Output(python_script)
