# Dynamo custom node PerspectiveView.OrientToEyeAndTargetPosition.dyf (Dynamo 3.6.1.9895)
# category: Clockwork.Revit.Views.Actions
# Sets the orientation of a given perspective view based on a given eye and target position. View needs to be in an unlocked state.
# packages: Clockwork for Dynamo 3.x 3.3.0, PythonNet3 Engine 1.1.1

view = Input(view: var)
view_2 = Output(view)  # "view"
eyePosition = Input(eyePosition: Autodesk.DesignScript.Geometry.Point)
targetPosition = Input(targetPosition: Autodesk.DesignScript.Geometry.Point)
byTwoPoints = Vector.ByTwoPoints(start=eyePosition, end=targetPosition)
normalized = Vector.Normalized(vector=byTwoPoints)
ZAxis = Vector.ZAxis()
add = Point.Add(point=targetPosition, vectorToAdd=ZAxis)
byThreePoints = Plane.ByThreePoints(origin=eyePosition, planePoint=targetPosition, xAxisPoint=add)
normal = Plane.Normal(plane=byThreePoints)
code_block = CodeBlock { 90; }
rotate = Vector.Rotate(vector=normalized, axis=normal, degrees=code_block)
correctOrientation = Custom[Vector.CorrectOrientation](VectorA=rotate, VectorB=ZAxis)  # package Clockwork for Dynamo 3.x; Inverts vector A if its inversion is closer to vector B
python_script = Python(IN[0]=view, IN[1]=eyePosition, IN[2]=correctOrientation, IN[3]=normalized)  # PythonNet3
# ---------- python_script.python (29 lines) ----------
import clr
clr.AddReference('RevitAPI')
from Autodesk.Revit.DB import *

clr.AddReference("RevitNodes")
import Revit
clr.ImportExtensions(Revit.Elements)
clr.ImportExtensions(Revit.GeometryConversion)

clr.AddReference("RevitServices")
import RevitServices
from RevitServices.Persistence import DocumentManager
from RevitServices.Transactions import TransactionManager

doc = DocumentManager.Instance.CurrentDBDocument
view = UnwrapElement(IN[0])
eyeposition = IN[1].ToXyz()
updirection = IN[2].ToXyz()
forwarddirection = IN[3].ToXyz()

TransactionManager.Instance.EnsureInTransaction(doc)
try:
	newVO = ViewOrientation3D(eyeposition, updirection, forwarddirection)
	view.SetOrientation(newVO)
	view.SaveOrientation()
	OUT = True
except:
	OUT = False
TransactionManager.Instance.TransactionTaskDone()
# ----------------------------------------
success = Output(python_script)
