# Dynamo custom node Plane.IsCoplanarWithPlane.dyf (Dynamo 2.0.1.5055)
# category: Clockwork.Geometry.Abstract.Query
# Checks if a given plane is coplanar with another plane

plane1 = Input(plane1: Autodesk.DesignScript.Geometry.Plane)
origin = Plane.Origin(plane=plane1)
XAxis = Plane.XAxis(plane=plane1)
plane2 = Input(plane2: Autodesk.DesignScript.Geometry.Plane)
isInPlane = Custom[Vector.IsInPlane](vectorBasePoint=origin, vector=XAxis, plane=plane2)  # Checks if a given vector is located on a given plane
bool = Output(isInPlane)
