# Dynamo custom node Point.IsOutOfPlane.dyf (Dynamo 2.0.3.8810)
# category: Clockwork.Geometry.Points.Query
# Checks a list for XYZs that are not located on a given plane

faceOrPlane = Input(faceOrPlane: var[]..[])
point = Input(point: Autodesk.DesignScript.Geometry.Point)
closestPointTo = Geometry.ClosestPointTo(geometry=faceOrPlane, other=point)
isAlmostEqualTo = Geometry.IsAlmostEqualTo(geometry=closestPointTo, other=point)
not_ = Not(x=isAlmostEqualTo)
bool = Output(not_)
distanceTo = Geometry.DistanceTo(geometry=closestPointTo, other=point)
amount = Output(distanceTo)
