# Dynamo custom node PointSequence.ContainsOutOfPlanePoints.dyf (Dynamo 2.12.1.8246)
# category: Clockwork.Geometry.Points.Query
# Checks a list for XYZs that are not located on a given plane

faceOrPlane = Input(faceOrPlane: var[]..[])
seq = Input(seq: var[]..[])
turnIntoList = Custom[TurnIntoList](unknownItem=seq)  # Turns an element (or a nested list) into a flat list
isOutOfPlane = Custom[Point.IsOutOfPlane](faceOrPlane=faceOrPlane, point=turnIntoList)  # Checks a list for XYZs that are not located on a given plane
anyTrue = List.AnyTrue(list=isOutOfPlane.bool)
bool = Output(anyTrue)
maximumItem = List.MaximumItem(list=isOutOfPlane.amount)
max = Output(maximumItem)
