# Dynamo custom node PointSequence.GreatestDistanceToPoint.dyf (Dynamo 2.0.1.5055)
# category: Clockwork.Geometry.Points.Query
# Retrieves the furthest point in a sequence of points

point = Input(point: Autodesk.DesignScript.Geometry.Point)
seq = Input(seq: var[]..[])
turnIntoList = Custom[TurnIntoList](unknownItem=seq)  # Turns an element (or a nested list) into a flat list
distanceTo = Geometry.DistanceTo(geometry=point, other=turnIntoList)
maximumItem = List.MaximumItem(list=distanceTo)
distance = Output(maximumItem)
code_block = CodeBlock(max=maximumItem, distlist=distanceTo) { max == distlist; }
bool = Output(code_block)
