# Dynamo custom node PointSequences.ShortestPath.dyf (Dynamo 2.0.1.5055)
# category: Clockwork.Geometry.Points.Query
# Retrieves the shortest path from a number of point sequences

seq = Input(seq: var[]..[])
accumulatedDistance = Custom[PointSequence.AccumulatedDistance](seq=seq@L2)  # Retrieves the accumulated distances of a sequence of points
minimumItem = List.MinimumItem(list=accumulatedDistance)
distance = Output(minimumItem)
code_block = CodeBlock(x=minimumItem, y=accumulatedDistance) { x == y; }
bool = Output(code_block)
