# Dynamo custom node Railing.ByPathTypeAndLevel.dyf (Dynamo 3.6.1.9895)
# category: Clockwork.Revit.Elements.Create
# Creates a railing based on a given path, railing type and level.
# packages: PythonNet3 Engine 1.1.1

curves = Input(curves: Autodesk.DesignScript.Geometry.Curve[])
byJoinedCurves = PolyCurve.ByJoinedCurves(curves=curves)
curves_2 = PolyCurve.Curves(polyCurve=byJoinedCurves)
railingType = Input(railingType: var[]..[])
level = Input(level: Revit.Elements.Level)
python_script = Python(IN[0]=curves_2, IN[1]=railingType, IN[2]=level)  # PythonNet3
# ---------- python_script.python (22 lines) ----------
import clr
clr.AddReference('RevitAPI')
from Autodesk.Revit.DB import *

clr.AddReference("RevitNodes")
import Revit
clr.ImportExtensions(Revit.GeometryConversion)

clr.AddReference("RevitServices")
import RevitServices
from RevitServices.Persistence import DocumentManager
from RevitServices.Transactions import TransactionManager

doc = DocumentManager.Instance.CurrentDBDocument
curves = UnwrapElement(IN[0])
railingtype = UnwrapElement(IN[1])
lvl = UnwrapElement(IN[2])

TransactionManager.Instance.EnsureInTransaction(doc)
curveloop = CurveLoop.Create([x.ToRevitType() for x in curves])
OUT = Architecture.Railing.Create(doc, curveloop, railingtype.Id, lvl.Id)
TransactionManager.Instance.TransactionTaskDone()
# ----------------------------------------
railing = Output(python_script)
