# Dynamo custom node Regex.CompileRegularExpression.dyf (Dynamo 3.6.1.9895)
# category: Clockwork.String.Inspect.Actions
# This is a helper node for setting certain flags for the Regular Expresssion nodes.
# https://docs.python.org/3/howto/regex.html
# packages: PythonNet3 Engine 1.1.1

regExp = Input(regExp: string)  # The regular expression
string = StringInput("")  # graph input
ignoreCase = Input(ignoreCase: bool = false)  # Perform case-insensitive matching
useLocale = Input(useLocale: bool = false)  # Treat special characters (e.g. 'ü') from the currently set system locale as letters
dotAll = Input(dotAll: bool = false)  # Make . match any character, including newlines
multilineMatching = Input(multilineMatching: bool = false)  # ^ matches at the beginning of each line, $ matches at the end of each line
create = List.Create(item0=ignoreCase, item1=useLocale, item2=dotAll, item3=multilineMatching)
code_block = CodeBlock { 1; 0; }
if_ = If(test=create, true=code_block.out0, false=code_block.out1)
string_from_object = FromObject(obj=if_)
join = String.Join(separator=string, string0=string_from_object)
firstItem = List.FirstItem(list=join)
python_script = Python(IN[0]=regExp, IN[1]=firstItem)  # PythonNet3
# ---------- python_script.python (39 lines) ----------
import clr
import re

regexstring = IN[0]
flags = IN[1]
# process flags
if flags == "1111":
	thisexp = re.compile(regexstring, re.IGNORECASE|re.LOCALE|re.DOTALL|re.MULTILINE)
elif flags == "1110":
	thisexp = re.compile(regexstring, re.IGNORECASE|re.LOCALE|re.DOTALL)
elif flags == "1101":
	thisexp = re.compile(regexstring, re.IGNORECASE|re.LOCALE|re.MULTILINE)
elif flags == "1100":
	thisexp = re.compile(regexstring, re.IGNORECASE|re.LOCALE)
elif flags == "1011":
	thisexp = re.compile(regexstring, re.IGNORECASE|re.DOTALL|re.MULTILINE)
elif flags == "1010":
	thisexp = re.compile(regexstring, re.IGNORECASE|re.DOTALL)
elif flags == "1001":
	thisexp = re.compile(regexstring, re.IGNORECASE|re.MULTILINE)
elif flags == "1000":
	thisexp = re.compile(regexstring, re.IGNORECASE)
elif flags == "0111":
	thisexp = re.compile(regexstring, re.LOCALE|re.DOTALL|re.MULTILINE)
elif flags == "0110":
	thisexp = re.compile(regexstring, re.LOCALE|re.DOTALL)
elif flags == "0101":
	thisexp = re.compile(regexstring, re.LOCALE|re.MULTILINE)
elif flags == "0100":
	thisexp = re.compile(regexstring, re.LOCALE)
elif flags == "0011":
	thisexp = re.compile(regexstring, re.DOTALL|re.MULTILINE)
elif flags == "0010":
	thisexp = re.compile(regexstring, re.DOTALL)
elif flags == "0001":
	thisexp = re.compile(regexstring, re.MULTILINE)
else:
	thisexp = re.compile(regexstring)
OUT = thisexp
# ----------------------------------------
compRegExp = Output(python_script)  # Compiled Regular Expression flags
