# Dynamo custom node Regex.SplitByRegularExpression.dyf (Dynamo 3.6.1.9895)
# category: Clockwork.String.Modify.Actions
# Splits a given string by a regular expression. The syntax for regular expressions is explained at
# https://docs.python.org/3/howto/regex.html
# packages: PythonNet3 Engine 1.1.1, Clockwork for Dynamo 2.x 2.12.2

RegEx = Input(RegEx: string)
ignoreCase = Input(ignoreCase: bool = false)  # Perform case-insensitive matching
useLocale = Input(useLocale: bool = false)  # Treat special characters (e.g. 'ü') from the currently set system locale as letters
dotAll = Input(dotAll: bool = false)  # Make . match any character, including newlines
multilineMatching = Input(multilineMatching: bool = false)  # ^ matches at the beginning of each line, $ matches at the end of each line
compileRegularExpression = Custom[Regex.CompileRegularExpression](regExp=RegEx, ignoreCase=ignoreCase, useLocale=useLocale, dotAll=dotAll, multilineMatching=multilineMatching)  # package Clockwork for Dynamo 2.x; This is a helper node for setting certain flags for the Regular Expresssion nodes. https://docs.python.org/3/howto/regex.html
str = Input(str: string)
python_script = Python(IN[0]=compileRegularExpression, IN[1]=str)  # PythonNet3
# ---------- python_script.python (5 lines) ----------
import clr
import re

if isinstance(IN[1], list): OUT = [IN[0].split(x) for x in IN[1]]
else: OUT = IN[0].split(IN[1])
# ----------------------------------------
seq = Output(python_script)
