# Dynamo custom node RevitFaceReference.FromDynamoSurface.dyf (Dynamo 3.6.1.9895)
# category: Clockwork.Revit.Selection.ByFace.Query
# Returns the underlying Revit face reference of a given surface
# packages: PythonNet3 Engine 1.1.1

DynamoSurface = Input(DynamoSurface: Autodesk.DesignScript.Geometry.Surface[]..[])
python_script = Python(IN[0]=DynamoSurface)  # PythonNet3
# ---------- python_script.python (21 lines) ----------
import clr
clr.AddReference('RevitAPI')
from Autodesk.Revit.DB import *

clr.AddReference("RevitServices")
import RevitServices
from RevitServices.Persistence import DocumentManager

def GetRevitFaceRef(face):
	try: 
		ref = face.Tags.LookupTag("RevitFaceReference")
		try: stableref = ref.ConvertToStableRepresentation(doc)
		except: stableref = None
		return ref, stableref
	except: return None, None

doc = DocumentManager.Instance.CurrentDBDocument
faces = UnwrapElement(IN[0])

if isinstance(IN[0], list): OUT = list(zip(*[GetRevitFaceRef(x) for x in faces]))
else: OUT = GetRevitFaceRef(faces)
# ----------------------------------------
firstItem = List.FirstItem(list=python_script)
RevitFaceReference = Output(firstItem)
lastItem = List.LastItem(list=python_script)
StableRepresentation = Output(lastItem)
