# Dynamo custom node RevitLinkType.AttachmentType.dyf (Dynamo 3.6.1.9895)
# category: Clockwork.Revit.Elements.Query
# Returns the attachment type of a RevitLInkType
# packages: PythonNet3 Engine 1.1.1

revitLinkType = Input(revitLinkType: var[]..[])
python_script = Python(IN[0]=revitLinkType)  # PythonNet3
# ---------- python_script.python (13 lines) ----------
import clr
clr.AddReference('RevitAPI')
from Autodesk.Revit.DB import *
import System

links = UnwrapElement(IN[0])

def GetAttachmentType(link):
	if hasattr(link, "AttachmentType"): return System.Enum.GetName(AttachmentType, link.AttachmentType)
	else: return None

if isinstance(IN[0], list): OUT = [GetAttachmentType(x) for x in links]
else: OUT = GetAttachmentType(links)
# ----------------------------------------
str = Output(python_script)
