# Dynamo custom node RevitLinkType.IsNested.dyf (Dynamo 3.6.1.9895)
# category: Clockwork.Revit.Elements.Query
# Returns whether a RevitLinkType is nested or not
# packages: PythonNet3 Engine 1.1.1

revitLinkType = Input(revitLinkType: var[]..[])
python_script = Python(IN[0]=revitLinkType)  # PythonNet3
# ---------- python_script.python (12 lines) ----------
import clr
clr.AddReference('RevitAPI')
from Autodesk.Revit.DB import *

links = UnwrapElement(IN[0])

def IsNested(link):
	if hasattr(link, "IsNestedLink"): return link.IsNestedLink
	else: return None

if isinstance(IN[0], list): OUT = [IsNested(x) for x in links]
else: OUT = IsNested(links)
# ----------------------------------------
bool = Output(python_script)
