# Dynamo custom node RevitLinkType.PathType.dyf (Dynamo 3.6.1.9895)
# category: Clockwork.Revit.Elements.Query
# Returns the path type of a RevitLInkType
# packages: PythonNet3 Engine 1.1.1

revitLinkType = Input(revitLinkType: var[]..[])
python_script = Python(IN[0]=revitLinkType)  # PythonNet3
# ---------- python_script.python (13 lines) ----------
import clr
clr.AddReference('RevitAPI')
from Autodesk.Revit.DB import *
import System

links = UnwrapElement(IN[0])

def GetPathType(link):
	if hasattr(link, "PathType"): return System.Enum.GetName(PathType, link.PathType)
	else: return None

if isinstance(IN[0], list): OUT = [GetPathType(x) for x in links]
else: OUT = GetPathType(links)
# ----------------------------------------
str = Output(python_script)
