# Dynamo custom node RevitLinkType.Reload.dyf (Dynamo 3.6.1.9895)
# category: Clockwork.Revit.Elements.Actions
# Reloads a Revit or IFC link.
# packages: PythonNet3 Engine 1.1.1

revitLinkType = Input(revitLinkType: var[]..[])
revitLinkType_2 = Output(revitLinkType)  # "revitLinkType"
reloadFrom = Input(reloadFrom: string = null)
python_script = Python(IN[0]=revitLinkType, IN[1]=reloadFrom)  # PythonNet3
# ---------- python_script.python (50 lines) ----------
import clr
import sys
import System.IO

clr.AddReference('RevitAPI')
from Autodesk.Revit.DB import *

clr.AddReference("RevitNodes")
import Revit
clr.ImportExtensions(Revit.Elements)

clr.AddReference("RevitServices")
import RevitServices
from RevitServices.Persistence import DocumentManager
from RevitServices.Transactions import TransactionManager

def ReloadLink(doc, link, path):
	try:
		if path:
			if System.IO.Path.Exists(path):
				bfi = BasicFileInfo.Extract(path)
				if not bfi.IsSavedInLaterVersion:
					if path == doc.PathName:
						link.Reload()
					else:
						mpath = ModelPathUtils.ConvertUserVisiblePathToModelPath(path)
						wsconfig = WorksetConfiguration()
						link.LoadFrom(mpath, wsconfig)
					return True
				else: return False
			else: return False
		elif link.LocallyUnloaded: 
			link.RevertLocalUnloadStatus()
			return True
		else: 
			link.Reload()
			return True
	except:
		return False
		
doc = DocumentManager.Instance.CurrentDBDocument
linktypes = UnwrapElement(IN[0])
paths = IN[1]
booleans = list()

TransactionManager.Instance.ForceCloseTransaction()
if isinstance(IN[0], list): 
	if isinstance(IN[1], list): OUT = [ReloadLink(doc, x, y) for x, y in zip(linktypes, paths)]
	else: OUT = [ReloadLink(doc, x, paths) for x in linktypes]
else: OUT = ReloadLink(doc, linktypes, paths)
# ----------------------------------------
success = Output(python_script)
