# Dynamo custom node Roof.Kind.dyf (Dynamo 3.6.1.9895)
# category: Clockwork.Revit.Elements.Query
# Retrieves the roof kind (Basic, Glazed, Other). PLEASE NOTE: Roofs that were created by face will be identified as 'Other'
# packages: PythonNet3 Engine 1.1.1

roof = Input(roof: var[]..[])
python_script = Python(IN[0]=roof)  # PythonNet3
# ---------- python_script.python (20 lines) ----------
import clr
clr.AddReference('RevitAPI')
from Autodesk.Revit.DB import *

def GetRoofKind(item):
	if hasattr(item, "CurtainGrids"):
		if item.CurtainGrids: return "Glazed"
		else: return "Basic"
	else: 
		if not item: return None
		elif item.GetType().Name == 'RoofBase': 
			if item.Document.GetElement(item.GetTypeId()).GetCompoundStructure(): return "Basic"
			else: return "Glazed"
		elif item.GetType().Name == 'FamilyInstance': return 'In-Place'
		else: return None

items = UnwrapElement(IN[0])

if isinstance(IN[0], list): OUT = [GetRoofKind(x) for x in items]
else: OUT = GetRoofKind(items)
# ----------------------------------------
kind = Output(python_script)
