# Dynamo custom node Room.AtPointInPhase.dyf (Dynamo 3.6.1.9895)
# category: Clockwork.Revit.Selection.Miscellaneous.Query
# Tries to retrieve a room element at the given location for the given phase.
# packages: PythonNet3 Engine 1.1.1, Clockwork for Dynamo 2.x 2.12.1

point = Input(point: Autodesk.DesignScript.Geometry.Point)
phase = Input(phase: var = null)  # If no phase is specified, the node will use the last phase in the project
isNull = Object.IsNull(object=phase)
phases = Custom[Document.Phases]()  # package Clockwork for Dynamo 2.x; Retrieves all phases in the active document in *chronological* order
lastItem = List.LastItem(list=phases)
scopeIf = ScopedIf(test=isNull, true=lastItem, false=phase)
docOrRevitLinkInstance = Input(docOrRevitLinkInstance: var = null)  # Use only if you want to query a linked model
python_script = Python(IN[0]=point, IN[1]=scopeIf, IN[2]=docOrRevitLinkInstance)  # PythonNet3
# ---------- python_script.python (26 lines) ----------
import clr
clr.AddReference('RevitAPI')
from Autodesk.Revit.DB import *

clr.AddReference("RevitNodes")
import Revit
clr.ImportExtensions(Revit.Elements)
clr.ImportExtensions(Revit.GeometryConversion)

clr.AddReference("RevitServices")
import RevitServices
from RevitServices.Persistence import DocumentManager

points = IN[0]
phase = UnwrapElement(IN[1])
inputdoc = UnwrapElement(IN[2])
if inputdoc == None:
	doc = DocumentManager.Instance.CurrentDBDocument
elif inputdoc.GetType().ToString() == "Autodesk.Revit.DB.RevitLinkInstance":
	doc = inputdoc.GetLinkDocument()
elif inputdoc.GetType().ToString() == "Autodesk.Revit.DB.Document":
	doc = inputdoc
else: doc = None

if isinstance(IN[0], list): OUT = [doc.GetRoomAtPoint(x.ToXyz(),phase) for x in points]
else: OUT = doc.GetRoomAtPoint(points.ToXyz(),phase)
# ----------------------------------------
room = Output(python_script)
