# Dynamo custom node Room.UnplacedByNameAndNumber.dyf (Dynamo 3.6.1.9895)
# category: Clockwork.Revit.Elements.Create
# Creates an unplaced room
# packages: Clockwork for Dynamo 2.x 2.12.1, PythonNet3 Engine 1.1.1

names = Input(names: string[])
replacementForIllegalChars = Input(replacementForIllegalChars: string = "_")
replaceIllegalRevitCharacters = Custom[String.ReplaceIllegalRevitCharacters](str=names, replacement=replacementForIllegalChars)  # package Clockwork for Dynamo 2.x; Replaces all characters in a string that are illegal characters for Revit view names etc.
numbers = Input(numbers: string[])
replaceIllegalRevitCharacters_2 = Custom[String.ReplaceIllegalRevitCharacters](str=numbers, replacement=replacementForIllegalChars)
phase = Input(phase: var = null)  # If no phase is specified, the node will use the last phase in the project
isNull = Object.IsNull(object=phase)
phases = Custom[Document.Phases]()  # package Clockwork for Dynamo 2.x; Retrieves all phases in the active document in *chronological* order
lastItem = List.LastItem(list=phases)
scopeIf = ScopedIf(test=isNull, true=lastItem, false=phase)
python_script = Python(IN[0]=replaceIllegalRevitCharacters, IN[1]=replaceIllegalRevitCharacters_2, IN[2]=scopeIf)  # PythonNet3
# ---------- python_script.python (24 lines) ----------
import clr
clr.AddReference('RevitAPI')
from Autodesk.Revit.DB import *

clr.AddReference("RevitServices")
import RevitServices
from RevitServices.Persistence import DocumentManager
from RevitServices.Transactions import TransactionManager

def CreateUnplacedRoom(name, number, phase, doc):
	try:
		newroom = doc.Create.NewRoom(phase)
		newroom.Name = name
		newroom.Number = number
		return newroom
	except: return None

doc = DocumentManager.Instance.CurrentDBDocument
phase = UnwrapElement(IN[2])

TransactionManager.Instance.EnsureInTransaction(doc)
if isinstance(IN[0], list) and isinstance(IN[1], list): OUT = [CreateUnplacedRoom(x, y, phase, doc) for x, y in zip(IN[0], IN[1])]
else: OUT = None
TransactionManager.Instance.TransactionTaskDone()
# ----------------------------------------
room = Output(python_script)
