# Dynamo custom node RoomSequence.ToDoorSequence.dyf (Dynamo 3.6.1.9895)
# category: Clockwork.Revit.Elements.Query
# Retrieves a sequence of doors connecting a given sequence of rooms (if possible)
# packages: PythonNet3 Engine 1.1.1, Clockwork for Dynamo 3.x 3.3.0

rooms = Input(rooms: var[]..[])
turnIntoList = Custom[TurnIntoList](unknownItem=rooms)  # package Clockwork for Dynamo 3.x; Turns an element (or a nested list) into a flat list
python_script = Python()  # PythonNet3
# ---------- python_script.python (17 lines) ----------
import System
import clr
clr.AddReference('RevitAPI')
from Autodesk.Revit.DB import *

clr.AddReference("RevitServices")
import RevitServices
from RevitServices.Persistence import DocumentManager

doc = DocumentManager.Instance.CurrentDBDocument

elementlist = list()
collector = FilteredElementCollector(doc)
collector.OfClass(FamilyInstance)
collector.OfCategory(BuiltInCategory.OST_Doors)

OUT = collector.ToElements()
# ----------------------------------------
phase = Input(phase: var = null)  # If no phase is specified, the node will use the last phase in the project
rooms_2 = Custom[Door.Rooms](door=python_script, phase=phase)  # package Clockwork for Dynamo 3.x; Gets the rooms that are connected by a given door
code_block = CodeBlock(a=turnIntoList, b=python_script, c=rooms_2.fromRoom, d=rooms_2.toRoom) { ids = ([a,b,c,d]).UniqueId; ids[0]; ids[1]; ids[2]; ids[3]; }
python_script_2 = Python(IN[0]=code_block.out1, IN[1]=code_block.out2, IN[2]=code_block.out3, IN[3]=code_block.out4)  # PythonNet3
# ---------- python_script_2.python (17 lines) ----------
import clr

rooms = IN[0]
doors = IN[1]
fromroom = IN[2]
toroom = IN[3]
elementlist = list()

i = 0
while i < (len(rooms)-1):
	j = 0
	while j < len(doors):
		if (rooms[i] == fromroom[j] and rooms[i+1] == toroom[j]) or (rooms[i+1] == fromroom[j] and rooms[i] == toroom[j]):
			elementlist.append(doors[j])
		j += 1
	i += 1
OUT = elementlist
# ----------------------------------------
byID = Custom[Element.ByID](IdOrUniqueId=python_script_2)  # package Clockwork for Dynamo 3.x; Gets the Revit element(s) for a list of IDs (or a single ID). Unlike the OOTB node, it supports elements from linked models as well.
doors = Output(byID)
