# Dynamo custom node Schedule.KeyScheduleParameterName.dyf (Dynamo 3.6.1.9895)
# category: Clockwork.Revit.Views.Query
# If the schedule is a key schedule, the node returns the name of the key schedule parameter.
# packages: PythonNet3 Engine 1.1.1

schedule = Input(schedule: Revit.Elements.Views.ScheduleView[]..[])
python_script = Python(IN[0]=schedule)  # PythonNet3
# ---------- python_script.python (12 lines) ----------
import clr
clr.AddReference('RevitAPI')
from Autodesk.Revit.DB import *

def GetKeyScheduleParamName(schedule):
	try: return schedule.KeyScheduleParameterName
	except: return None

scheds = UnwrapElement(IN[0])

if isinstance(IN[0], list): OUT = [GetKeyScheduleParamName(x) for x in scheds]
else: OUT = GetKeyScheduleParamName(scheds)
# ----------------------------------------
parameterName = Output(python_script)
