# Dynamo custom node ScheduleField.Parameter.dyf (Dynamo 3.6.1.9895)
# category: Clockwork.Revit.Views.Query
# Retrieves the parameter associated with a given schedule field
# packages: PythonNet3 Engine 1.1.1, Clockwork for Dynamo 2.x 2.12.2

scheduleField = Input(scheduleField: var[]..[])
version = Custom[Application.Version]()  # package Clockwork for Dynamo 2.x; Retrieves the name, version and build of the current Revit application.
python_script = Python(IN[0]=scheduleField, IN[1]=version.Version)  # PythonNet3
# ---------- python_script.python (25 lines) ----------
import clr
import System
clr.AddReference('RevitAPI')
from Autodesk.Revit.DB import *

def GetScheduleFieldParam(schedulefield):
    if hasattr(schedulefield, "ParameterId"): 
        pId = schedulefield.ParameterId
        if pId != ElementId.InvalidElementId: 
            if version > 2024: pIdVal = pId.Value
            else: pIdVal = pId.IntegerValue
            # BuiltInParameters
            if pIdVal < 0: 
                try: return System.Enum.GetName(BuiltInParameter, pIdVal)
                except: return None
            # Project/Family/Shared Parameters
            else: return schedulefield.Schedule.Document.GetElement(schedulefield.ParameterId)
        else: return None
    else: return None

schedulefields = UnwrapElement(IN[0])
version = IN[1]

if isinstance(IN[0], list): OUT = [GetScheduleFieldParam(x) for x in schedulefields]
else: OUT = GetScheduleFieldParam(schedulefields)
# ----------------------------------------
param = Output(python_script)
