# Dynamo custom node ScheduleField.Type.dyf (Dynamo 3.6.1.9895)
# category: Clockwork.Revit.Views.Query
# Returns the FieldType of a given ScheduleField
# packages: PythonNet3 Engine 1.1.1

scheduleField = Input(scheduleField: var[]..[])
python_script = Python(IN[0]=scheduleField)  # PythonNet3
# ---------- python_script.python (11 lines) ----------
import clr
import System
clr.AddReference('RevitAPI')
from Autodesk.Revit.DB import *

def GetScheduleFieldType(field):
	if hasattr(field, "FieldType"): return System.Enum.GetName(ScheduleFieldType, field.FieldType)
	else: return None

if isinstance(IN[0], list): OUT = [GetScheduleFieldType(x) for x in IN[0]]
else: OUT = GetScheduleFieldType(IN[0])
# ----------------------------------------
str = Output(python_script)
