# Dynamo custom node Schema.Fields.dyf (Dynamo 3.6.1.9895)
# category: Clockwork.Revit.Elements.Query
# Returns the fields of a given ExtensibleStorage Schema
# packages: PythonNet3 Engine 1.1.1

schema = Input(schema: var[]..[])
python_script = Python(IN[0]=schema)  # PythonNet3
# ---------- python_script.python (18 lines) ----------
import clr
clr.AddReference('RevitAPI')
from Autodesk.Revit.DB import *

clr.AddReference("RevitNodes")
import Revit
clr.ImportExtensions(Revit.Elements)

def SchemaFields(schema):
	if hasattr(schema, "ListFields"):
		if schema.ReadAccessGranted(): return schema.ListFields()
		else: return []
	else: return []

schemas = IN[0]

if isinstance(IN[0], list): OUT =[SchemaFields(x) for x in schemas]
else: OUT = SchemaFields(schemas)
# ----------------------------------------
fields = Output(python_script)
