# Dynamo custom node Schema.Properties.dyf (Dynamo 3.6.1.9895)
# category: Clockwork.Revit.Elements.Query
# Retrieves all properties of a given ExtensibleStorage Schema
# packages: PythonNet3 Engine 1.1.1

schema = Input(schema: var[]..[])
python_script = Python(IN[0]=schema)  # PythonNet3
# ---------- python_script.python (19 lines) ----------
import clr
import System
clr.AddReference('RevitAPI')
from Autodesk.Revit.DB import *

clr.AddReference("RevitNodes")
import Revit
clr.ImportExtensions(Revit.Elements)

schemas = IN[0]
OUT = []

def SchemaProperties(schema):
	if hasattr(schema, "SchemaName"): 
		return schema.SchemaName, schema.VendorId, schema.GUID, schema.Documentation, schema.ApplicationGUID, System.Enum.GetName(ExtensibleStorage.AccessLevel, schema.ReadAccessLevel), System.Enum.GetName(ExtensibleStorage.AccessLevel, schema.WriteAccessLevel)
	else: return None, None, None, None, None, None, None

if isinstance(IN[0], list): OUT = map(list, zip(*[SchemaProperties(x) for x in schemas]))
else: OUT = SchemaProperties(schemas)
# ----------------------------------------
code_block = CodeBlock(seq=python_script)
# ---------- code_block.designscript (14 lines) ----------
// Name
seq[0];
// Vendor ID
seq[1];
// GUID
seq[2];
// Documentation
seq[3];
// Application GUID
seq[4];
// Read Access Level
seq[5];
// WriteAccessLevel
seq[6];
# ----------------------------------------
name = Output(code_block.out0)
vendorID = Output(code_block.out1)
GUID = Output(code_block.out2)
documentation = Output(code_block.out3)
applicationGUID = Output(code_block.out4)
readAccessLevel = Output(code_block.out5)
writeAccessLevel = Output(code_block.out6)
