# Dynamo custom node SchemaField.Properties.dyf (Dynamo 3.6.1.9895)
# category: Clockwork.Revit.Elements.Query
# Retrieves the properties of a given ExtensibleStorage schema field
# packages: PythonNet3 Engine 1.1.1

schemaField = Input(schemaField: var[]..[])
python_script = Python(IN[0]=schemaField)  # PythonNet3
# ---------- python_script.python (18 lines) ----------
import clr
import System
clr.AddReference('RevitAPI')
from Autodesk.Revit.DB import *

clr.AddReference("RevitNodes")
import Revit
clr.ImportExtensions(Revit.Elements)

def FieldProperties(field):
	if hasattr(field, "FieldName"):
		return field.FieldName, field.Documentation, System.Enum.GetName(ExtensibleStorage.ContainerType, field.ContainerType), field.GetSpecTypeId(), field.ValueType, field.SubSchema, field.SubSchemaGUID
	else: return None, None, None, None, None, None, None

fields = IN[0]

if isinstance(IN[0], list): OUT = map(list, zip(*[FieldProperties(x) for x in fields]))
else: OUT = FieldProperties(fields)
# ----------------------------------------
code_block = CodeBlock(seq=python_script)
# ---------- code_block.designscript (14 lines) ----------
// Name
seq[0];
// Documentation
seq[1];
// Container Type
seq[2];
// Unit Type
seq[3];
// Value Type
seq[4];
// SubSchema
seq[5];
// SubSchema GUID
seq[6];
# ----------------------------------------
name = Output(code_block.out0)
documentation = Output(code_block.out1)
containerType = Output(code_block.out2)
unitType = Output(code_block.out3)
valueType = Output(code_block.out4)
subSchema = Output(code_block.out5)
subSchemaGUID = Output(code_block.out6)
