# Dynamo custom node Sheet.PlaceholderByNumberAndName.dyf (Dynamo 3.6.1.9895)
# category: Clockwork.Revit.Views.Create
# Creates placeholder sheets
# packages: PythonNet3 Engine 1.1.1, Clockwork for Dynamo 2.x 2.6.0

sheetNumber = Input(sheetNumber: string[]..[])
sheetName = Input(sheetName: string[]..[])
replacementForIllegalChars = Input(replacementForIllegalChars: string = "_")
replaceIllegalRevitCharacters = Custom[String.ReplaceIllegalRevitCharacters](str=sheetName, replacement=replacementForIllegalChars)  # package Clockwork for Dynamo 2.x; Replaces all characters in a string that are illegal characters for Revit view names etc.
python_script = Python(IN[0]=sheetNumber, IN[1]=replaceIllegalRevitCharacters)  # PythonNet3
# ---------- python_script.python (34 lines) ----------
import clr
clr.AddReference('RevitAPI')
from Autodesk.Revit.DB import *

clr.AddReference("RevitNodes")
import Revit
clr.ImportExtensions(Revit.Elements)

clr.AddReference("RevitServices")
import RevitServices
from RevitServices.Persistence import DocumentManager
from RevitServices.Transactions import TransactionManager

doc = DocumentManager.Instance.CurrentDBDocument
sheetnums = IN[0]
sheetnames = IN[1]

def MakePlaceholderSheet(num, name):
	try:
		newsheet = ViewSheet.CreatePlaceholder(doc)
		newsheet.SheetNumber = num
		newsheet.Name = name
		return newsheet.ToDSType(False)
	except:
		return None

TransactionManager.Instance.EnsureInTransaction(doc)
if isinstance(IN[0], list):
	if isinstance(IN[1], list): OUT = [MakePlaceholderSheet(x,y) for x,y in zip(sheetnums, sheetnames)]
	else: OUT = MakePlaceholderSheet(sheetnums[0],sheetnames)
else:
	if isinstance(IN[1], list): OUT = MakePlaceholderSheet(sheetnums,sheetnames[0])
	else: OUT = MakePlaceholderSheet(sheetnums,sheetnames)
TransactionManager.Instance.TransactionTaskDone()
# ----------------------------------------
sheet = Output(python_script)
