# Dynamo custom node Sheet.Scale.dyf (Dynamo 3.6.1.9895)
# category: Clockwork.Revit.Views.Query
# Returns the scale of a given sheet
# packages: PythonNet3 Engine 1.1.1

sheet = Input(sheet: Revit.Elements.Views.Sheet[]..[])
python_script = Python(IN[0]=sheet)  # PythonNet3
# ---------- python_script.python (11 lines) ----------
import clr
clr.AddReference('RevitAPI')
from Autodesk.Revit.DB import *

def GetSheetScale(sheet):
	if hasattr(sheet, "Scale"): return sheet.get_Parameter(BuiltInParameter.SHEET_SCALE).AsValueString()
	else: return None

sheets = UnwrapElement(IN[0])
if isinstance(IN[0], list): OUT = [GetSheetScale(x) for x in sheets]
else: OUT = GetSheetScale(sheets)
# ----------------------------------------
scale = Output(python_script)
