# Dynamo custom node Solid.ByUnion+.dyf (Dynamo 3.6.1.9895)
# category: Clockwork.Geometry.Solids.Create
# The OOTB node Solid.ByUnion occasionally fails when trying to merge solids with almost adjacent faces. This node will return the minimum amount of joined solids possible in such cases instead of returning null.
# packages: PythonNet3 Engine 1.1.1

solids = Input(solids: Autodesk.DesignScript.Geometry.Solid[])
python_script = Python(IN[0]=solids)  # PythonNet3
# ---------- python_script.python (18 lines) ----------
import clr
clr.AddReference('ProtoGeometry')
from Autodesk.DesignScript.Geometry import *

solids = IN[0]
OUT = [solids[0]]
solids = solids[1:]

for s in solids:
	i = 0
	unionDone = False
	while i < len(OUT):
		try:
			OUT[i] = OUT[i].Union(s)
			unionDone = True
			break
		except:	i += 1
	if not unionDone: OUT.append(s)
# ----------------------------------------
solids_2 = Output(python_script)  # "solids"
