# Dynamo custom node SpaceSeparator.FromCurve.dyf (Dynamo 3.6.1.9895)
# category: Clockwork.Revit.Elements.ModelCurve.Create
# Creates space separation lines from geometry curves.
# packages: PythonNet3 Engine 1.1.1, Clockwork for Dynamo 2.x 2.12.0

curve = Input(curve: Autodesk.DesignScript.Geometry.Curve[]..[])
floorPlan = Input(floorPlan: Revit.Elements.Views.FloorPlanView)
plane = Custom[View.Plane](view=floorPlan)  # package Clockwork for Dynamo 2.x; Retrieves the plane of a given view
pullOntoPlane = Curve.PullOntoPlane(curve=curve, plane=plane)
python_script = Python(IN[0]=pullOntoPlane, IN[1]=floorPlan)  # PythonNet3
# ---------- python_script.python (36 lines) ----------
import clr
clr.AddReference('RevitAPI')
from Autodesk.Revit.DB import *

clr.AddReference("RevitNodes")
import Revit
clr.ImportExtensions(Revit.GeometryConversion)

clr.AddReference("RevitServices")
import RevitServices
from RevitServices.Persistence import DocumentManager
from RevitServices.Transactions import TransactionManager

doc = DocumentManager.Instance.CurrentDBDocument
curves = UnwrapElement(IN[0])
view = UnwrapElement(IN[1])


TransactionManager.Instance.EnsureInTransaction(doc)
o = view.Origin
n = view.ViewDirection
if o and n: 
	sketchplane = SketchPlane.Create(doc, Plane.CreateByNormalAndOrigin(n, o))
	curvearray = CurveArray()
	for curve in curves:
		curvearray.Append(curve.ToRevitType())
	doccreation = doc.Create
	separatorarray = doccreation.NewSpaceBoundaryLines(sketchplane, curvearray, view)
else: separatorarray = []
TransactionManager.Instance.TransactionTaskDone()

elementlist = list()
for item in separatorarray:
	elementlist.append(item)
if isinstance(IN[0], list): OUT = elementlist
else: OUT = elementlist[0]
# ----------------------------------------
spaceSeparator = Output(python_script)
