# Dynamo custom node SpotCoordinate.ByPoint.dyf (Dynamo 3.6.1.9895)
# category: Clockwork.Revit.Elements.Create
# Places a spot coordinate at a given point in a given view. May not work in all view types.
# packages: PythonNet3 Engine 1.1.1, Clockwork for Dynamo 3.x 3.3.0

view = Input(view: Revit.Elements.Views.View)
turnIntoList = Custom[TurnIntoList](unknownItem=view)  # package Clockwork for Dynamo 3.x; Turns an element (or a nested list) into a flat list
point = Input(point: Autodesk.DesignScript.Geometry.Point)
turnIntoList_2 = Custom[TurnIntoList](unknownItem=point)
bend = Input(bend: Autodesk.DesignScript.Geometry.Vector)
end = Input(end: Autodesk.DesignScript.Geometry.Vector)
hasLeader = Input(hasLeader: bool = false)
default3DView = Custom[Document.Default3DView]()  # package Clockwork for Dynamo 3.x; Returns the default 3D view of the current model (if there is such a view)
viewDirection = View.ViewDirection(view=turnIntoList)
reverse = Vector.Reverse(vector=viewDirection)
python_script = Python(IN[0]=turnIntoList, IN[1]=turnIntoList_2, IN[2]=bend, IN[3]=end, IN[4]=hasLeader, IN[5]=default3DView, IN[6]=reverse)  # PythonNet3
# ---------- python_script.python (39 lines) ----------
import clr
clr.AddReference('RevitAPI')
from Autodesk.Revit.DB import *

clr.AddReference("RevitNodes")
import Revit
clr.ImportExtensions(Revit.GeometryConversion)

clr.AddReference("RevitServices")
import RevitServices
from RevitServices.Persistence import DocumentManager
from RevitServices.Transactions import TransactionManager

doc = DocumentManager.Instance.CurrentDBDocument
views = UnwrapElement(IN[0])
pts = UnwrapElement(IN[1])
bend = UnwrapElement(IN[2])
end = UnwrapElement(IN[3])
leader = UnwrapElement(IN[4])
isoview = UnwrapElement(IN[5])
intsecvec = UnwrapElement(IN[6])
elementlist = []

i = 0;
TransactionManager.Instance.EnsureInTransaction(doc)
for pt in pts:
	view = views[i]
	pt = pt.ToXyz()
	refintsec = ReferenceIntersector(isoview)
	refintsec.TargetType = FindReferenceTarget.All
	try:
		ref = refintsec.FindNearest(pt,intsecvec[i].AsPoint().ToXyz()).GetReference()
		elementlist.append(doc.Create.NewSpotCoordinate(view, ref, pt, pt.Add(bend.AsPoint().ToXyz()), pt.Add(end.AsPoint().ToXyz()), pt, leader))
	except:
		elementlist.append(None)
	i += 1
TransactionManager.Instance.TransactionTaskDone()

OUT = elementlist
# ----------------------------------------
spotCoordinate = Output(python_script)
