# Dynamo custom node String.Replace+.dyf (Dynamo 3.6.1.9895)
# category: Clockwork.String.Modify.Actions
# Replaces multiple items in a given string. Items in the string have to be denoted as {0], {1}, ..., {n} - corresponding to the respective list index of the replacement string.
# packages: PythonNet3 Engine 1.1.1, Clockwork for Dynamo 3.x 3.3.0

str = Input(str: var[]..[])
replacements = Input(replacements: var[]..[])
turnIntoList = Custom[TurnIntoList](unknownItem=replacements)  # package Clockwork for Dynamo 3.x; Turns an element (or a nested list) into a flat list
python_script = Python(IN[0]=str, IN[1]=turnIntoList)  # PythonNet3
# ---------- python_script.python (2 lines) ----------
import clr
OUT = IN[0].format(*IN[1])
# ----------------------------------------
str_2 = Output(python_script)  # "str"
