# Dynamo custom node String.ReplaceIllegalRevitCharacters.dyf (Dynamo 3.6.1.9895)
# category: Clockwork.String.Modify.Actions
# Replaces all characters in a string that are illegal characters for Revit view names etc.
# packages: PythonNet3 Engine 1.1.1

str = Input(str: string)
replacement = Input(replacement: string = "_")
python_script = Python(IN[0]=str, IN[1]=replacement)  # PythonNet3
# ---------- python_script.python (20 lines) ----------
def ReplaceIllegalRevitChars(str, repl):
	str = str.replace('\\', repl)
	str = str.replace(':', repl)
	str = str.replace('{', repl)
	str = str.replace('}', repl)
	str = str.replace('[', repl)
	str = str.replace(']', repl)
	str = str.replace('|', repl)
	str = str.replace(';', repl)
	str = str.replace('<', repl)
	str = str.replace('>', repl)
	str = str.replace('?', repl)
	str = str.replace('`', repl)
	str = str.replace('~', repl)
	return str

strings = IN[0]

if isinstance(IN[0], list): OUT = [ReplaceIllegalRevitChars(x, IN[1]) for x in strings]
else: OUT = ReplaceIllegalRevitChars(strings, IN[1])
# ----------------------------------------
str_2 = Output(python_script)  # "str"
