# Dynamo custom node String.ReplaceMultiple.dyf (Dynamo 3.6.1.9895)
# category: Clockwork.String.Modify.Actions
# Replaces multiple search terms in a given string with multiple replacements
# packages: PythonNet3 Engine 1.1.1

str = Input(str: string)
searchFor = Input(searchFor: string[])
replaceWith = Input(replaceWith: string[])
sortSearchTermsBySize = Input(sortSearchTermsBySize: bool = false)  # If set to true, longer search terms will be replaced first
python_script = Python(IN[0]=str, IN[1]=searchFor, IN[2]=replaceWith, IN[3]=sortSearchTermsBySize)  # PythonNet3
# ---------- python_script.python (19 lines) ----------
# Based on https://gist.github.com/bgusach/a967e0587d6e01e889fd1d776c5f3729

import clr
import re

def ReplaceMultiple(str, searchstr, replacestr, sort):
	replacements = dict(zip(searchstr, replacestr))
	if sort: substrs = sorted(replacements, key=len, reverse=True)
	else: substrs = searchstr
	regexp = re.compile('|'.join(map(re.escape, substrs)))
	return regexp.sub(lambda match: replacements[match.group(0)], str)
	
if isinstance(IN[1], list): searchstr = IN[1]
else: searchstr = [IN[1]]
if isinstance(IN[2], list): replacestr = IN[2]
else: replacestr = [IN[2]]

if isinstance(IN[0], list): OUT = [ReplaceMultiple(x, searchstr, replacestr, IN[3]) for x in IN[0]]
else: OUT = ReplaceMultiple(IN[0], searchstr, replacestr, IN[3])
# ----------------------------------------
str_2 = Output(python_script)  # "str"
