# Dynamo custom node Subcategory.ByName.dyf (Dynamo 3.6.1.9895)
# category: Clockwork.Revit.Elements.Create
# Creates a new subcategory for a given element category (unless a subcategory of that name already exists - in that case it returns the existing subcategory).
# packages: PythonNet3 Engine 1.1.1

category = Input(category: var[]..[])
name = Input(name: string)
python_script = Python(IN[0]=category, IN[1]=name)  # PythonNet3
# ---------- python_script.python (24 lines) ----------
import clr
clr.AddReference('RevitAPI')
from Autodesk.Revit.DB import *

clr.AddReference("RevitNodes")
import Revit
clr.ImportExtensions(Revit.Elements)

clr.AddReference("RevitServices")
import RevitServices
from RevitServices.Persistence import DocumentManager
from RevitServices.Transactions import TransactionManager

doc = DocumentManager.Instance.CurrentDBDocument
cat = UnwrapElement(IN[0])
subcatname = IN[1]
subcat = [x for x in cat.SubCategories if x.Name == subcatname]
if len(subcat) == 1: subcat = subcat[0]
else:
	TransactionManager.Instance.EnsureInTransaction(doc)
	try: subcat = doc.Settings.Categories.NewSubcategory(cat, subcatname)
	except: subcat = None
	TransactionManager.Instance.TransactionTaskDone()
OUT = subcat
# ----------------------------------------
subCategory = Output(python_script)
