# Dynamo custom node System.Memory.dyf (Dynamo 3.6.1.9895)
# category: Clockwork.Environment.Query
# Returns information on total system memory, free memory and amount of memory used by the application.
# packages: PythonNet3 Engine 1.1.1

python_script = Python()  # PythonNet3; graph input
# ---------- python_script.python (13 lines) ----------
import clr
clr.AddReference("System.Management")
from System.Management import ManagementObject, ManagementObjectSearcher
from System.Diagnostics import Process
sysinfo = ManagementObjectSearcher("Select Capacity from Win32_PhysicalMemory").Get()
installedMem = 0
for sysdata in sysinfo:
	installedMem += sysdata.get_Item("Capacity")
sysinfo = ManagementObjectSearcher("Select FreePhysicalMemory from Win32_OperatingSystem").Get()
for sysdata in sysinfo:
	freeMem = sysdata.get_Item("FreePhysicalMemory")
procMem = Process.GetCurrentProcess().WorkingSet64
OUT = (float(installedMem)/1073741824, float(freeMem)/1048576, float(procMem)/1073741824)
# ----------------------------------------
code_block = CodeBlock(seq=python_script)
# ---------- code_block.designscript (6 lines) ----------
// Installed memory
seq[0];
// Free memory
seq[1];
// App memory
seq[2];
# ----------------------------------------
installedMemory = Output(code_block.out0)
freeMemory = Output(code_block.out1)
appMemory = Output(code_block.out2)
passThrough = Input(passThrough: var[]..[] = null)
passThrough_2 = Output(passThrough)  # "passThrough"
