# Dynamo custom node TextElement.SetText.dyf (Dynamo 3.6.1.9895)
# category: Clockwork.Revit.Elements.Actions
# Sets the text of a given text element. Unlike the OOTB node TextNote.SetText, this one works on ModelText as well.
# packages: PythonNet3 Engine 1.1.1

element = Input(element: var[]..[])
element_2 = Output(element)  # "element"
text = Input(text: string[]..[])
python_script = Python(IN[0]=element, IN[1]=text)  # PythonNet3
# ---------- python_script.python (30 lines) ----------
import clr
clr.AddReference('RevitAPI')
from Autodesk.Revit.DB import *

clr.AddReference("RevitNodes")
import Revit
clr.ImportExtensions(Revit.Elements)

clr.AddReference("RevitServices")
import RevitServices
from RevitServices.Persistence import DocumentManager
from RevitServices.Transactions import TransactionManager

def SetText(item, str):
	if hasattr(item, "Text"):
		item.Text = str
		return True
	else: return False

doc = DocumentManager.Instance.CurrentDBDocument
items = UnwrapElement(IN[0])

TransactionManager.Instance.EnsureInTransaction(doc)
if isinstance(IN[0], list):
	if isinstance(IN[1], list): OUT = [SetText(x, y) for x, y in zip(items, IN[1])]
	else: OUT = [SetText(x, IN[1]) for x in items]
else:
	if isinstance(IN[1], list): OUT = False
	else: OUT = SetText(items, IN[1])
TransactionManager.Instance.TransactionTaskDone()
# ----------------------------------------
success = Output(python_script)
