# Dynamo custom node TimeSpan.LapTime.dyf (Dynamo 3.6.1.9895)
# category: Clockwork.Input.Create
# Records a timestamp and adds it to a given list of lap times. Also passes through an arbitrary variable for integration into a graph.
# packages: PythonNet3 Engine 1.1.1

lapTimes = Input(lapTimes: System.DateTime[] = DSCore.List.Empty)
rerunToggle = Input(rerunToggle: bool = false)
now = DateTime.Now()
python_script = Python(IN[0]=lapTimes, IN[1]=rerunToggle, IN[2]=now)  # PythonNet3
# ---------- python_script.python (4 lines) ----------
import time
times = IN[0]
times.append(IN[2])
OUT = times
# ----------------------------------------
LapTimes = Output(python_script)
Passthrough = Input(Passthrough: var[]..[])
Passthrough_2 = Output(Passthrough)  # "Passthrough"
