# Dynamo custom node UV.Average.dyf (Dynamo 2.0.1.5055)
# category: Clockwork.Geometry.Points.Query
# Determines the average of a list of UVs

UVs = Input(UVs: Autodesk.DesignScript.Geometry.UV[])
code_block = CodeBlock(uvlist=UVs) { UV.ByCoordinates(Math.Average(uvlist.U),Math.Average(uvlist.V)); }
UV = Output(code_block)
