# Dynamo custom node UV.ToDynamoUV.dyf (Dynamo 3.6.1.9895)
# category: Clockwork.Revit.Conversion.Actions
# Converts Revit UV coordinates to Dynamo UV coordinates
# packages: PythonNet3 Engine 1.1.1, Clockwork for Dynamo 2.x 2.12.2

RevitUV = Input(RevitUV: var[]..[])
turnIntoList = Custom[TurnIntoList](unknownItem=RevitUV)  # package Clockwork for Dynamo 2.x; Turns an element (or a nested list) into a flat list
python_script = Python(IN[0]=turnIntoList)  # PythonNet3
# ---------- python_script.python (11 lines) ----------
import clr
clr.AddReference('RevitAPI')
from Autodesk.Revit.DB import *

UVs = UnwrapElement(IN[0])
ulist = list()
vlist = list()
for uv in UVs:
	ulist.append(uv.U)
	vlist.append(uv.V)
OUT = (ulist,vlist)
# ----------------------------------------
code_block = CodeBlock(seq=python_script) { seq[0]; seq[1]; 0; 1; }
remapRange = Math.RemapRange(numbers=code_block.out0, newMin=code_block.out2, newMax=code_block.out3)
remapRange_2 = Math.RemapRange(numbers=code_block.out1, newMin=code_block.out2, newMax=code_block.out3)
byCoordinates = UV.ByCoordinates(u=remapRange, v=remapRange_2)
returnListOrSingleValue = Custom[ReturnListOrSingleValue](unknownItem=RevitUV, seq=byCoordinates)  # package Clockwork for Dynamo 2.x; If the unknown item is not a list but rather a single item, only the first item of the list (input "seq") will be returned.
DynamoUV = Output(returnListOrSingleValue)
