# Dynamo custom node UnitType.DisplayUnitType.dyf (Dynamo 3.6.1.9895)
# category: Clockwork.Revit.Units.Query
# Retrieves the display unit type for a given unit type.
# packages: PythonNet3 Engine 1.1.1

unitType = Input(unitType: var)
python_script = Python(IN[0]=unitType)  # PythonNet3
# ---------- python_script.python (26 lines) ----------
import clr
clr.AddReference('RevitAPI')
from Autodesk.Revit.DB import *

clr.AddReference("RevitServices")
import RevitServices
from RevitServices.Persistence import DocumentManager
doc = DocumentManager.Instance.CurrentDBDocument

dynunittype = IN[0]
if str(dynunittype.GetType()) == "Autodesk.Revit.DB.ForgeTypeId":
	unittype = dynunittype
elif str(dynunittype) == 'DynamoUnits.Area':
	unittype = ForgeTypeId('autodesk.spec.aec:area-2.0.0')
elif str(dynunittype) == 'DynamoUnits.Length':
	unittype = ForgeTypeId('autodesk.spec.aec:length-2.0.0')
elif str(dynunittype) == 'DynamoUnits.Volume':
	unittype = ForgeTypeId('autodesk.spec.aec:volume-2.0.0')
else:
	unittype = None
formatoptions = doc.GetUnits().GetFormatOptions(unittype)
dispunits = formatoptions.GetUnitTypeId()
symtype = formatoptions.GetSymbolTypeId()
if symtype.TypeId == '': dispsym = None
else: dispsym = LabelUtils.GetLabelForSymbol(symtype)
OUT = (dispunits,dispsym)
# ----------------------------------------
code_block = CodeBlock(seq=python_script) { seq[0]; seq[1]; }
displayUnitType = Output(code_block.out0)
unitSymbol = Output(code_block.out1)
