# Dynamo custom node VersionNumber.Compare.dyf (Dynamo 3.6.1.9895)
# category: Clockwork.String.Inspect.Actions
# Compares two version numbers. Returns 1 if A is higher than B, 0 if they are equal and -1 if A is lower than B.
# packages: PythonNet3 Engine 1.1.1

versionA = Input(versionA: string[]..[])
versionB = Input(versionB: string[]..[])
python_script = Python(IN[0]=versionA, IN[1]=versionB)  # PythonNet3
# ---------- python_script.python (10 lines) ----------
import sys
import clr
from System import Version

if isinstance(IN[0], list): 
	if isinstance(IN[1], list): OUT = [Version(x).CompareTo(Version(y)) for x,y in zip(IN[0], IN[1])]
	else: OUT = [Version(x).CompareTo(Version(IN[1])) for x in IN[0]]
else: 
	if isinstance(IN[1], list): OUT = [Version(IN[0]).CompareTo(Version(x)) for x in IN[1]]
	else: OUT = Version(IN[0]).CompareTo(Version(IN[1]))
# ----------------------------------------
result = Output(python_script)
