# Dynamo custom node View.ConvertToIndependent.dyf (Dynamo 3.6.1.9895)
# category: Clockwork.Revit.Views.Actions
# Converts a given dependent view to an independent view
# packages: PythonNet3 Engine 1.1.1

view = Input(view: var[]..[])
view_2 = Output(view)  # "view"
python_script = Python(IN[0]=view)  # PythonNet3
# ---------- python_script.python (22 lines) ----------
import clr
clr.AddReference('RevitAPI')
from Autodesk.Revit.DB import *

clr.AddReference("RevitServices")
import RevitServices
from RevitServices.Persistence import DocumentManager
from RevitServices.Transactions import TransactionManager

def DependentToIndependent(view):
	try:
		view.ConvertToIndependent()
		return True
	except: return False

doc = DocumentManager.Instance.CurrentDBDocument
views = UnwrapElement(IN[0])

TransactionManager.Instance.EnsureInTransaction(doc)
if isinstance(IN[0], list): OUT = [DependentToIndependent(x) for x in views]
else: OUT = DependentToIndependent(views)
TransactionManager.Instance.TransactionTaskDone()
# ----------------------------------------
success = Output(python_script)
