# Dynamo custom node View.DependentViews.dyf (Dynamo 3.6.1.9895)
# category: Clockwork.Revit.Views.Query
# Returns all dependent views of a given view
# packages: PythonNet3 Engine 1.1.1

view = Input(view: var[]..[])
python_script = Python(IN[0]=view)  # PythonNet3
# ---------- python_script.python (18 lines) ----------
import clr
clr.AddReference('RevitAPI')
from Autodesk.Revit.DB import *

clr.AddReference("RevitNodes")
import Revit

def GetDependentViews(view):
	if hasattr(view, "GetDependentViewIds"):
		return [view.Document.GetElement(x) for x in view.GetDependentViewIds()]
	else: return []

views = UnwrapElement(IN[0])

if isinstance(IN[0], list):
	OUT = [GetDependentViews(x) for x in views]
else:
	OUT = GetDependentViews(views)
# ----------------------------------------
views = Output(python_script)
