# Dynamo custom node View.DetailLevel.dyf (Dynamo 3.6.1.9895)
# category: Clockwork.Revit.Views.Query
# Retrieves the detail level of a given view
# packages: PythonNet3 Engine 1.1.1

view = Input(view: var[]..[])
python_script = Python(IN[0]=view)  # PythonNet3
# ---------- python_script.python (13 lines) ----------
import clr
import System
clr.AddReference('RevitAPI')
from Autodesk.Revit.DB import *

def DetailLevel(view):
	if hasattr(view, "DetailLevel"): return System.Enum.GetName(ViewDetailLevel, view.DetailLevel)
	else: return None

views = UnwrapElement(IN[0])

if isinstance(IN[0], list): OUT = [DetailLevel(x) for x in views]
else: OUT = DetailLevel(views)
# ----------------------------------------
detailLevel = Output(python_script)
