# Dynamo custom node View.DisableTemporaryHideIsolate.dyf (Dynamo 3.6.1.9895)
# category: Clockwork.Revit.Views.Actions
# Disables the temporary hide/isolate for the given view (if set)
# packages: PythonNet3 Engine 1.1.1

view = Input(view: var[]..[])
python_script = Python(IN[0]=view)  # PythonNet3
# ---------- python_script.python (19 lines) ----------
import clr
clr.AddReference('RevitAPI')
from Autodesk.Revit.DB import *

clr.AddReference("RevitServices")
import RevitServices
from RevitServices.Persistence import DocumentManager
from RevitServices.Transactions import TransactionManager

doc = DocumentManager.Instance.CurrentDBDocument
view = UnwrapElement(IN[0])
TransactionManager.Instance.EnsureInTransaction(doc)
try:
	if view.IsTemporaryHideIsolateActive() == True:
		view.DisableTemporaryViewMode(TemporaryViewMode.TemporaryHideIsolate)
		OUT = (view,True)
	else: OUT = (view, False)
except: OUT = (view, False)
TransactionManager.Instance.TransactionTaskDone()
# ----------------------------------------
firstItem = List.FirstItem(list=python_script)
view_2 = Output(firstItem)  # "view"
lastItem = List.LastItem(list=python_script)
success = Output(lastItem)
