# Dynamo custom node View.OverrideElementTransparency.dyf (Dynamo 3.6.1.9895)
# category: Clockwork.Revit.Views.Actions
# Overrides the transparency of an element in a given view
# packages: PythonNet3 Engine 1.1.1, Clockwork for Dynamo 3.x 3.3.0

element = Input(element: var[]..[])
turnIntoList = Custom[TurnIntoList](unknownItem=element)  # package Clockwork for Dynamo 3.x; Turns an element (or a nested list) into a flat list
view = Input(view: var[]..[])
transparencyPercentage = Input(transparencyPercentage: var[]..[])
python_script = Python(IN[0]=turnIntoList, IN[1]=view, IN[2]=transparencyPercentage)  # PythonNet3
# ---------- python_script.python (30 lines) ----------
import clr
clr.AddReference('RevitAPI')
from Autodesk.Revit.DB import *

clr.AddReference("RevitNodes")
import Revit
clr.ImportExtensions(Revit.Elements)

clr.AddReference("RevitServices")
import RevitServices
from RevitServices.Persistence import DocumentManager
from RevitServices.Transactions import TransactionManager

doc = DocumentManager.Instance.CurrentDBDocument
items = UnwrapElement(IN[0])
view = UnwrapElement(IN[1])
trans = IN[2]
booleans = []

override = OverrideGraphicSettings()
override.SetSurfaceTransparency(trans)

TransactionManager.Instance.EnsureInTransaction(doc)
for item in items:
	try:
		view.SetElementOverrides(item.Id, override)
		booleans.append(True)
	except: booleans.append(False)
TransactionManager.Instance.TransactionTaskDone()
OUT = (items,view,booleans)
# ----------------------------------------
code_block = CodeBlock(seq=python_script) { seq[0]; seq[1]; seq[2]; }
returnListOrSingleValue = Custom[ReturnListOrSingleValue](unknownItem=element, seq=code_block.out0)  # package Clockwork for Dynamo 3.x; If the unknown item is not a list but rather a single item, only the first item of the list (input "seq") will be returned.
element_2 = Output(returnListOrSingleValue)  # "element"
view_2 = Output(code_block.out1)  # "view"
returnListOrSingleValue_2 = Custom[ReturnListOrSingleValue](unknownItem=element, seq=code_block.out2)
success = Output(returnListOrSingleValue_2)
