# Dynamo custom node View.SetDesignOption.dyf (Dynamo 3.6.1.9895)
# category: Clockwork.Revit.Views.Actions
# Sets the view to a given design option. PLEASE NOTE: This node is kind of hacky. It does not use the design option settings in the visibility / graphic overrides. Instead it sets the view property "Visible in Option" to *one* specific design option - which also means that the symbolic representation of this view is only visible in views that display the given design options.
# packages: PythonNet3 Engine 1.1.1

view = Input(view: var[]..[])
view_2 = Output(view)  # "view"
designOption = Input(designOption: var[]..[])
python_script = Python(IN[0]=view, IN[1]=designOption)  # PythonNet3
# ---------- python_script.python (27 lines) ----------
import clr
clr.AddReference('RevitAPI')
from Autodesk.Revit.DB import *

clr.AddReference("RevitServices")
import RevitServices
from RevitServices.Persistence import DocumentManager
from RevitServices.Transactions import TransactionManager

doc = DocumentManager.Instance.CurrentDBDocument
views = UnwrapElement(IN[0])
options = UnwrapElement(IN[1])

def SetViewDesignOption(view, option):
	try:
		view.get_Parameter(BuiltInParameter.VIEWER_OPTION_VISIBILITY).Set(option.Id)
		return True
	except: return False

TransactionManager.Instance.EnsureInTransaction(doc)
if isinstance(IN[0], list):
	if isinstance(IN[1], list): OUT = [SetViewDesignOption(x, y) for x, y in zip(views, options)]
	else: OUT = [SetViewDesignOption(x, options) for x in views]
else:
	if isinstance(IN[1], list): OUT = [SetViewDesignOption(views, x) for x in options]
	else: OUT = SetViewDesignOption(views, options)
TransactionManager.Instance.TransactionTaskDone()
# ----------------------------------------
success = Output(python_script)
