# Dynamo custom node View.SetPhase.dyf (Dynamo 3.6.1.9895)
# category: Clockwork.Revit.Views.Actions
# Sets the phase of a given view
# packages: PythonNet3 Engine 1.1.1

view = Input(view: var[]..[])
view_2 = Output(view)  # "view"
phase = Input(phase: var[]..[])
python_script = Python(IN[0]=view, IN[1]=phase)  # PythonNet3
# ---------- python_script.python (31 lines) ----------
import clr
clr.AddReference('RevitAPI')
from Autodesk.Revit.DB import *

clr.AddReference("RevitNodes")
import Revit
clr.ImportExtensions(Revit.Elements)

clr.AddReference("RevitServices")
import RevitServices
from RevitServices.Persistence import DocumentManager
from RevitServices.Transactions import TransactionManager

doc = DocumentManager.Instance.CurrentDBDocument
views = UnwrapElement(IN[0])
phases = UnwrapElement(IN[1])

def SetViewPhase(view, phase):
	try:
		view.get_Parameter(BuiltInParameter.VIEW_PHASE).Set(phase.Id)
		return True
	except: return False

TransactionManager.Instance.EnsureInTransaction(doc)
if isinstance(IN[0], list):
	if isinstance(IN[1], list): OUT = [SetViewPhase(x, y) for x, y in zip(views, phases)]
	else: OUT = [SetViewPhase(x, phases) for x in views]
else:
	if isinstance(IN[1], list): OUT = SetViewPhase(views, phases[0])
	else: OUT = SetViewPhase(views, phases)
TransactionManager.Instance.TransactionTaskDone()
# ----------------------------------------
success = Output(python_script)
