# Dynamo custom node View.SetSolarStudyActiveFrameNumber.dyf (Dynamo 3.6.1.9895)
# category: Clockwork.Revit.Views.Actions
# Sets the active frame number of the solar study in a given view
# packages: PythonNet3 Engine 1.1.1

view = Input(view: var[]..[])
frameNumber = Input(frameNumber: int)
python_script = Python(IN[0]=view, IN[1]=frameNumber)  # PythonNet3
# ---------- python_script.python (20 lines) ----------
import clr
clr.AddReference('RevitAPI')
from Autodesk.Revit.DB import *

clr.AddReference("RevitServices")
import RevitServices
from RevitServices.Persistence import DocumentManager
from RevitServices.Transactions import TransactionManager

doc = DocumentManager.Instance.CurrentDBDocument
view = UnwrapElement(IN[0])
frame = IN[1]
TransactionManager.Instance.EnsureInTransaction(doc)
try:
	view.SunAndShadowSettings.ActiveFrame = frame
	success = True
except:
	success = False
TransactionManager.Instance.TransactionTaskDone()
OUT = (view,success)
# ----------------------------------------
code_block = CodeBlock(seq=python_script) { seq[0]; seq[1]; }
view_2 = Output(code_block.out0)  # "view"
success = Output(code_block.out1)
