# Dynamo custom node View.SolarStudyTotalFrames.dyf (Dynamo 3.6.1.9895)
# category: Clockwork.Revit.Views.Query
# Retrieves the number of frames of a solar study for a given view (if the view's sun and shadow settings are indeed set to single or multi day study)
# packages: PythonNet3 Engine 1.1.1

view = Input(view: var[]..[])
python_script = Python(IN[0]=view)  # PythonNet3
# ---------- python_script.python (14 lines) ----------
import clr
clr.AddReference('RevitAPI')
from Autodesk.Revit.DB import *

def GetFrameNum(view):
	if hasattr(view, 'SunAndShadowSettings'):
		if hasattr(view.SunAndShadowSettings, 'NumberOfFrames'): return view.SunAndShadowSettings.NumberOfFrames
		else: return 0
	else: return 0

views = UnwrapElement(IN[0])

if isinstance(IN[0], list): OUT = [GetFrameNum(x) for x in views]
else: OUT = GetFrameNum(views)
# ----------------------------------------
int = Output(python_script)
