# Dynamo custom node View.Type.dyf (Dynamo 3.6.1.9895)
# category: Clockwork.Revit.Views.Query
# Returns the type of a given view
# packages: PythonNet3 Engine 1.1.1

view = Input(view: var[]..[])
python_script = Python(IN[0]=view)  # PythonNet3
# ---------- python_script.python (13 lines) ----------
import clr
import System
clr.AddReference('RevitAPI')
from Autodesk.Revit.DB import *

def GetViewType(view):
	if hasattr(view, "ViewType"): return System.Enum.GetName(ViewType, view.ViewType)
	else: return None

views = UnwrapElement(IN[0])

if isinstance(IN[0],list): OUT = [GetViewType(x) for x in views]
else: OUT = GetViewType(views)
# ----------------------------------------
type = Output(python_script)
