# Dynamo custom node View.ViewTemplate.dyf (Dynamo 3.6.1.9895)
# category: Clockwork.Revit.Views.Query
# Returns the view template assigned to a given view (if one is assigned)
# packages: PythonNet3 Engine 1.1.1

view = Input(view: var[]..[])
python_script = Python(IN[0]=view)  # PythonNet3
# ---------- python_script.python (15 lines) ----------
import clr
clr.AddReference('RevitAPI')
from Autodesk.Revit.DB import *

def GetViewTemplate(view):
    if not view: return None
    elif hasattr(view, "ViewTemplateId"):
        if view.ViewTemplateId == ElementId.InvalidElementId: return None
        else: return view.Document.GetElement(view.ViewTemplateId)
    else: return None

views = UnwrapElement(IN[0])

if isinstance(IN[0], list): OUT = [GetViewTemplate(x) for x in views]
else: OUT = GetViewTemplate(views)
# ----------------------------------------
ViewTemplate = Output(python_script)
