# Dynamo custom node View3D.IsLocked.dyf (Dynamo 3.6.1.9895)
# category: Clockwork.Revit.Views.Query
# Checks if a given 3D view is locked.
# packages: PythonNet3 Engine 1.1.1

view3d = Input(view3d: Revit.Elements.Views.View3D)
python_script = Python(IN[0]=view3d)  # PythonNet3
# ---------- python_script.python (8 lines) ----------
import clr
clr.AddReference('RevitAPI')
from Autodesk.Revit.DB import *

views = UnwrapElement(IN[0])

if isinstance(IN[0], list): OUT = [x.IsLocked for x in views]
else: OUT = views.IsLocked
# ----------------------------------------
bool = Output(python_script)
