# Dynamo custom node View3D.SetSectionBox.dyf (Dynamo 3.6.1.9895)
# category: Clockwork.Revit.Views.Actions
# Sets the section box of a given 3D view to the extents of a given bounding box
# packages: Clockwork for Dynamo 2.x 2.4.0, PythonNet3 Engine 1.1.1

view3D = Input(view3D: Revit.Elements.Views.View3D[]..[])
boundingBox = Input(boundingBox: Autodesk.DesignScript.Geometry.BoundingBox[]..[])
fromDynamoBoundingBox = Custom[BoundingBox.FromDynamoBoundingBox](DynamoBoundingBox=boundingBox)  # package Clockwork for Dynamo 2.x; Turns a Dynamo bounding box into a Revit bounding box.
python_script = Python(IN[0]=view3D, IN[1]=fromDynamoBoundingBox)  # PythonNet3
# ---------- python_script.python (35 lines) ----------
import clr
clr.AddReference('ProtoGeometry')
from Autodesk.DesignScript.Geometry import *

# Import ToDSType(bool) extension method
clr.AddReference("RevitNodes")
import Revit
clr.ImportExtensions(Revit.Elements)

# Import DocumentManager and TransactionManager
clr.AddReference("RevitServices")
import RevitServices
from RevitServices.Persistence import DocumentManager
from RevitServices.Transactions import TransactionManager

# Import RevitAPI
clr.AddReference("RevitAPI")
import Autodesk
from Autodesk.Revit.DB import *

doc = DocumentManager.Instance.CurrentDBDocument

views = UnwrapElement(IN[0])
bboxes = IN[1]

TransactionManager.Instance.EnsureInTransaction(doc)
if isinstance(IN[0], list):
	if isinstance(IN[1], list): OUT = [x.SetSectionBox(y) for x, y in zip(views, bboxes)]
	else: OUT = [x.SetSectionBox(bboxes) for x in views]
else:
	if isinstance(IN[1], list): OUT = views.SetSectionBox(bboxes[0])
	else: OUT = views.SetSectionBox(bboxes)
TransactionManager.Instance.TransactionTaskDone()

OUT = views
# ----------------------------------------
view3D_2 = Output(python_script)  # "view3D"
