# Dynamo custom node ViewSheetSet.Views.dyf (Dynamo 3.6.1.9895)
# category: Clockwork.Revit.Views.Query
# Retrieves all the views/sheets in a given view/sheet set.
# packages: PythonNet3 Engine 1.1.1

viewsSheetSet = Input(viewsSheetSet: var[]..[])
python_script = Python(IN[0]=viewsSheetSet)  # PythonNet3
# ---------- python_script.python (17 lines) ----------
import clr
clr.AddReference('RevitAPI')
from Autodesk.Revit.DB import *

clr.AddReference("RevitNodes")
import Revit
clr.ImportExtensions(Revit.Elements)

def GetSheetSetViews(set):
	if hasattr(set, 'Views'):
		return [x.ToDSType(True) for x in set.Views]
	else: return []

viewsheetsets = UnwrapElement(IN[0])

if isinstance(IN[0], list): OUT = [GetSheetSetViews(x) for x in viewsheetsets]
else: OUT = GetSheetSetViews(viewsheetsets)
# ----------------------------------------
views = Output(python_script)
