# Dynamo custom node Wall.CreationMethod.dyf (Dynamo 3.6.1.9895)
# category: Clockwork.Revit.Elements.Query
# Retrieves the creation method of a given wall
# packages: PythonNet3 Engine 1.1.1

wall = Input(wall: var[]..[])
python_script = Python(IN[0]=wall)  # PythonNet3
# ---------- python_script.python (19 lines) ----------
import clr
clr.AddReference('RevitAPI')
from Autodesk.Revit.DB import *

clr.AddReference("RevitNodes")
import Revit
clr.ImportExtensions(Revit.Elements)

def WallCreationMethod(wall):
	typename = wall.GetType().Name
	if typename == 'Wall': return 'Standard'
	elif typename == 'FaceWall': return 'By Face'
	elif typename == 'FamilyInstance': return 'In-Place'
	else: return None

walls = UnwrapElement(IN[0])

if isinstance(IN[0], list): OUT = [WallCreationMethod(x) for x in walls]
else: OUT = WallCreationMethod(walls)
# ----------------------------------------
creationMethod = Output(python_script)
