# Dynamo custom node Wall.Flip.dyf (Dynamo 3.6.1.9895)
# category: Clockwork.Revit.Elements.Actions
# Flips the  orientation of a given wall - DO ***NOT*** USE IN AUTOMATIC MODE
# packages: PythonNet3 Engine 1.1.1

wall = Input(wall: Revit.Elements.Wall[]..[])
wall_2 = Output(wall)  # "wall"
python_script = Python(IN[0]=wall)  # PythonNet3
# ---------- python_script.python (24 lines) ----------
import clr
clr.AddReference('RevitAPI')
from Autodesk.Revit.DB import *

clr.AddReference("RevitServices")
import RevitServices
from RevitServices.Persistence import DocumentManager
from RevitServices.Transactions import TransactionManager

doc = DocumentManager.Instance.CurrentDBDocument
walls = UnwrapElement(IN[0])

def FlipWall(item):
	if hasattr(item, "Flip"):
		try:
			item.Flip()
			return True
		except: return False
	else: return False

TransactionManager.Instance.EnsureInTransaction(doc)
if isinstance(IN[0], list): OUT = [FlipWall(x) for x in walls]
else: OUT = FlipWall(walls)
TransactionManager.Instance.TransactionTaskDone()
# ----------------------------------------
success = Output(python_script)
