# Dynamo custom node Wall.Orientation.dyf (Dynamo 3.6.1.9895)
# category: Clockwork.Revit.Elements.Query
# Gets the orientation of a given wall instance (normal of the exterior face of the wall). Will *not* work for walls hosted on mass faces or in-place walls.
# packages: PythonNet3 Engine 1.1.1

wall = Input(wall: Revit.Elements.Wall)
python_script = Python(IN[0]=wall)  # PythonNet3
# ---------- python_script.python (28 lines) ----------
import clr
clr.AddReference('RevitAPI')
from Autodesk.Revit.DB import *

clr.AddReference("RevitNodes")
import Revit
clr.ImportExtensions(Revit.Elements)
clr.ImportExtensions(Revit.GeometryConversion)

def WallOrientation(wall):
	loc = wall.Location
	flipped = False
	if hasattr(loc, "Curve"):
		lcurve = loc.Curve
		if hasattr(wall, "Flipped"): flipped = wall.Flipped
		if str(type(lcurve)) == "Autodesk.Revit.DB.Line":
			if flipped: return wall.Orientation.ToVector().Reverse()
			else: return wall.Orientation.ToVector()
		else:
			direction = (lcurve.GetEndPoint(1).Subtract(lcurve.GetEndPoint(0))).Normalize()
			if flipped: return XYZ.BasisZ.CrossProduct(direction).ToVector().Reverse()
			else: return XYZ.BasisZ.CrossProduct(direction).ToVector()
	else: return None

walls = UnwrapElement(IN[0])

if isinstance(IN[0], list): OUT = [WallOrientation(x) for x in walls]
else: OUT = WallOrientation(walls)
# ----------------------------------------
Normal = Output(python_script)
