# Dynamo graph AngleBetweenVectors.dyn (Dynamo 0.6.3.7375)

# note: This sample also needs the Unit Conversion package to be installed.
select_reference_point = PointBySelection()  # 1 picked in the model
xyz_from_reference_point = XyzFromReferencePoint(select_reference_point, lacing=Longest)
select_reference_point_2 = PointBySelection()  # 1 picked in the model
xyz_from_reference_point_2 = XyzFromReferencePoint(select_reference_point_2, lacing=Longest)
direction_to_xyz = XyzStartEndVector(xyz_from_reference_point, xyz_from_reference_point_2, lacing=Longest)
select_reference_point_3 = PointBySelection()  # 1 picked in the model
xyz_from_reference_point_3 = XyzFromReferencePoint(select_reference_point_3, lacing=Longest)
select_reference_point_4 = PointBySelection()  # 1 picked in the model
xyz_from_reference_point_4 = XyzFromReferencePoint(select_reference_point_4, lacing=Longest)
direction_to_xyz_2 = XyzStartEndVector(xyz_from_reference_point_3, xyz_from_reference_point_4, lacing=Longest)
angle_between_vectors = Custom[Angle Between Vectors](Vector_1=direction_to_xyz, Vector_2=direction_to_xyz_2)  # Computes the angle between two vectors
radians_to_degrees = Custom[Radians To Degrees](rad=angle_between_vectors)  # Converts radians into degrees
watch = Watch(radians_to_degrees)
