# Dynamo graph CountSequencesOfTrueOrFalse.dyn (Dynamo 0.6.3.7375)

boolean = BoolSelector(true)
boolean_2 = BoolSelector(false)
list = NewList(index0=boolean, index1=boolean_2, index2=boolean, index3=boolean, index4=boolean, index5=boolean_2, index6=boolean_2, index7=boolean_2, index8=boolean, index9=boolean, index10=boolean_2, index11=boolean_2, index12=boolean, index13=boolean, index14=boolean, index15=boolean, index16=boolean)
watch = Watch(list)
boolean_3 = BoolSelector(true)
count_sequences_of_true_or_false = Custom[Count Sequences Of True Or False](booleans=watch, True_False=boolean_3)  # Retrieves the lengths of uninterrupted sequences of booleans (true or false) in a given list.
watch_2 = Watch(count_sequences_of_true_or_false)
