# Dynamo graph ElementsFromAndToIDs.dyn (Dynamo 0.6.3.7375)

select_elements = MultipleCurvesBySelection()  # 8 picked in the model
watch = Watch(select_elements)
elements_to_ids = Custom[Elements to IDs](Element_s=select_elements)  # Gets the ID(s) for a list of Revit elements (or a single element)
watch_2 = Watch(elements_to_ids.ID_s)
ids_to_elements = Custom[IDs to Elements](ID_s=elements_to_ids.ID_s)  # Gets the Revit element(s) for a list of IDs (or a single ID)
watch_3 = Watch(ids_to_elements.Element_s)
