# Dynamo graph EqualListLengths.dyn (Dynamo 0.6.3.7375)

number = DoubleInput(1..5)
watch = Watch(number)
number_2 = DoubleInput(3..10)
watch_2 = Watch(number_2)
list = NewList(index0=watch, index1=watch_2)
equal_list_lengths = Custom[Equal List Lengths](lists=list)  # Trims all given lists to the length of the shortest list
watch_3 = Watch(equal_list_lengths)
