# Dynamo graph GetAndSetFamilyType.dyn (Dynamo 0.6.3.7375)

select_elements = MultipleCurvesBySelection()  # 7 picked in the model
watch = Watch(select_elements)
select_family_type = FamilyTypeSelector(index=1)
set_family_type = Custom[Set Family Type](Family_Instance_s=watch, Family_Type=select_family_type)  # Changes the family type of a given famiyl instance to the specified type
get_family_type = Custom[Get Family Type](Family_Instance_s=set_family_type)  # Returns the familyt type of a given family instance
watch_2 = Watch(get_family_type)
