# Dynamo graph GetElementLocation.dyn (Dynamo 0.6.3.7375)

select_elements = MultipleCurvesBySelection()  # 6 picked in the model
watch = Watch(select_elements)
get_element_location = Custom[Get Element Location](Element_s=watch)  # Returns the location of an element as an XYZ (or if it's line-based the start and end point of the line), along with some booleans to help filtering the results. Use this for some element types (e.g. walls or lines) that do not work with the built-in Get Family Instance Location node.
watch_2 = Watch(get_element_location.Location_s)
watch_3 = Watch(get_element_location.Curve_s)
watch_4 = Watch(get_element_location.Is_Point_bool)
watch_5 = Watch(get_element_location.Is_Curve_bool)
integer_slider = IntegerSliderInput(0, range=0..5)
get_from_list = GetFromList(integer_slider, watch)
get_family_instance_location = GetFamilyInstanceLocation(get_from_list, lacing=Longest)
watch_6 = Watch(get_family_instance_location)
watch_7 = Watch(get_element_location.Has_Location_bool)
