# Dynamo graph IsRelatedToMass.dyn (Dynamo 0.6.3.7375)

is_related_to_mass = Custom[Is Related To Mass]()  # Returns true if an object (wall, roof, floor or curtain system) has been modelled by face and the underlying mass still exists in the project.
category = Categories(index=877)
get_family_instances_by_category = Custom[Get Family Instances By Category](BuiltInCategories=category)  # Gets all family instances in the model for a given list of categories
flatten_completely = FlattenList(get_family_instances_by_category)
watch = Watch(flatten_completely)
filter = FilterInAndOut(is_related_to_mass, watch)
watch_2 = Watch(filter)
