# Dynamo graph LibGVectorComponents.dyn (Dynamo 0.6.3.7375)

# note: This example also needs the LunchBox package to be installed.
select_face = FormElementBySelection()  # 1 picked in the model
get_surface_domain = SurfaceDomain(select_face, lacing=Longest)
lunchbox_domain_variables = Custom[LunchBox Domain Variables](Domain=get_surface_domain)  # Gets the Min and Max variables of a Domain.
libg_vector_components = Custom[LibG Vector Components](LibG_Vector=lunchbox_domain_variables.Min)  # Gets the X, Y and Z of a LibG vector
watch = Watch(libg_vector_components.X)
watch_2 = Watch(libg_vector_components.Z)
libg_vector_components_2 = Custom[LibG Vector Components](LibG_Vector=lunchbox_domain_variables.Max)
watch_3 = Watch(libg_vector_components_2.X)
watch_4 = Watch(libg_vector_components_2.Y)
watch_5 = Watch(libg_vector_components_2.Z)
watch_6 = Watch(libg_vector_components.Y)
