# Dynamo graph ListNotEmpty.dyn (Dynamo 0.6.3.7375)

empty_list = Empty()
list_not_empty = Custom[List Not Empty](list=empty_list)  # Just the inversion of the built-in Is Empty List node.
watch = Watch(list_not_empty)
number = DoubleInput(1..10)
list_not_empty_2 = Custom[List Not Empty](list=number)
watch_2 = Watch(list_not_empty_2)
