# Dynamo graph MoveXYZsFromPlaneToPlane.dyn (Dynamo 0.6.3.5260)

lines_through_points_closed_loop = Custom[Lines Through Points (Closed Loop)]()  # Works just like the built-in node Lines Through Points (creates a series of lines through a list of points) - except that it creates a *closed* loop of lines.
# note: This example also needs the Sublist Helpers and Lines Through Points (Closed Loop) packages to be installed.
select_elements = MultipleCurvesBySelection()  # 3 picked in the model
get_family_instance_location = GetFamilyInstanceLocation(select_elements, lacing=Longest)
get_sublist_lengths = Custom[Get Sublist Lengths](list=get_family_instance_location)  # Gets the lengths of all sublists in a given list of lists.
watch = Watch(get_sublist_lengths)
move_xyz_from_plane_to_plane = Custom[Move XYZ From Plane To Plane]()  # Moves an XYZ from one plane to another
watch_2 = Watch(get_family_instance_location)
flatten_completely = FlattenList(watch_2)
best_fit_plane = BestFitPlane(lacing=Longest)
map = Map(best_fit_plane.out2, get_family_instance_location)
fill_sublists = Custom[Fill Sublists](list=map, lengths=get_sublist_lengths)  # Repeats a list of items into sublists of given lengths
watch_3 = Watch(fill_sublists)
flatten_completely_2 = FlattenList(watch_3)
best_fit_plane_2 = BestFitPlane(lacing=Longest)
map_2 = Map(best_fit_plane_2.out1, get_family_instance_location)
fill_sublists_2 = Custom[Fill Sublists](list=map_2, lengths=get_sublist_lengths)
watch_4 = Watch(fill_sublists_2)
flatten_completely_3 = FlattenList(watch_4)
xyz_zero = Custom[XYZ Zero]()  # Returns an XYZ of (0 ,0, 0)
list_length = Length(flatten_completely)
repeat = Repeat(xyz_zero, list_length, lacing=Longest)
z_axis = XyzBasisZ(lacing=Longest)
repeat_2 = Repeat(z_axis, list_length, lacing=Longest)
formula = Formula("1/100", lacing=Longest)
repeat_3 = Repeat(formula, list_length, lacing=Longest)
combine = Combine(move_xyz_from_plane_to_plane, flatten_completely, flatten_completely_2, flatten_completely_3, repeat, repeat_2, repeat_3)
build_irregular_sublists = Custom[Build Irregular Sublists](lengths=watch, list=combine)  # Turns a list into a list of lists with sublists of varying lengths.
map_3 = Map(lines_through_points_closed_loop, build_irregular_sublists)
model_curve = ModelCurve(map_3, lacing=Longest)
watch_5 = Watch(model_curve)
watch_6 = Watch(combine)
