# Dynamo graph ParameterExists.dyn (Dynamo 0.6.3.7375)

string = StringInput("Finish")
string_2 = StringInput("Room Bounding")
parameter_exists = Custom[Parameter Exists](param=string_2)  # Checks if an element contains a parameter of a given name
select_elements = MultipleCurvesBySelection()  # 3 picked in the model
watch = Watch(select_elements)
filter = FilterInAndOut(parameter_exists, watch)
watch_2 = Watch(filter)
string_3 = StringInput("Sill Height")
