# Dynamo graph ProjectStuff.dyn (Dynamo 0.6.3.7375)

project_is_workshared = Custom[Project Is Workshared]()  # Returns true if the current project is workshared
watch = Watch(project_is_workshared)
get_project_position = Custom[Get Project Position]()  # Gets the project's position data relative to XYZ.Zero.
watch_2 = Watch(get_project_position.Angle)
watch_3 = Watch(get_project_position.Elevation)
get_links_and_imports = Custom[Get Links And Imports]()  # Gets all linked and imported files in the document
watch_4 = Watch(get_links_and_imports.imports)
watch_5 = Watch(get_links_and_imports.links)
watch_6 = Watch(get_project_position.Longitude)
get_project_info = Custom[Get Project Info]()  # Gets the project information.
watch_7 = Watch(get_project_info.Name)
watch_8 = Watch(get_project_info.Number)
watch_9 = Watch(get_project_position.EastWest)
watch_10 = Watch(get_project_position.NorthSouth)
watch_11 = Watch(get_project_position.Latitude)
watch_12 = Watch(get_project_info.Address)
watch_13 = Watch(get_project_info.IssueDate)
watch_14 = Watch(get_project_info.Author)
watch_15 = Watch(get_project_info.Status)
watch_16 = Watch(get_project_info.ClientName)
watch_17 = Watch(get_project_info.BuildingName)
watch_18 = Watch(get_project_info.OrganizationDescription)
watch_19 = Watch(get_project_info.OrganizationName)
