# Dynamo graph RevitAppVersionInfo.dyn (Dynamo 0.6.3.7375)

revit_app_version_info = Custom[Revit App Version Info]()  # Retrieves the name, version and build of the current Revit application.
watch = Watch(revit_app_version_info.Name)
watch_2 = Watch(revit_app_version_info.Version_int)
watch_3 = Watch(revit_app_version_info.Build)
