# Dynamo graph RoomStuff.dyn (Dynamo 0.6.3.7375)

# note: This sample also requires the Select By Category and Phasing Stuff packages to be installed.
category = Categories(index=892)
category_2 = Categories(index=206)
list = NewList(index0=category, index1=category_2)
get_family_instances_by_category = Custom[Get Family Instances By Category](BuiltInCategories=list)  # Gets all family instances in the model for a given list of categories
watch = Watch(get_family_instances_by_category)
string = StringInput("New Construction")
get_phase_by_name = Custom[Get Phase by Name](str=string)  # Returns the phase of a given name (if it exists)
watch_2 = Watch(get_phase_by_name)
rooms_from_doors_and_windows = Custom[Rooms From Doors And Windows](Door_s_Window_s=watch, Phase=watch_2)  # Gets the rooms that are connected by a given door or a window
watch_3 = Watch(rooms_from_doors_and_windows.From_Room_s)
watch_4 = Watch(rooms_from_doors_and_windows.To_Room_s)
category_3 = Categories(index=709)
get_family_instances_by_category_2 = Custom[Get Family Instances By Category](BuiltInCategories=category_3)
get_room_boundaries = Custom[Get Room Boundaries](Room_s=get_family_instances_by_category_2)  # Gets a list of all boundary elements of a given room
watch_5 = Watch(get_room_boundaries.Elements)
get_area = Custom[Get Area](element_s=get_family_instances_by_category_2)  # Returns the area property of a given element (if that element has such a property)
watch_6 = Watch(get_area)
only_toroom_or_fromroom_is_set = Custom[Only ToRoom OR FromRoom Is Set](Doors_Windows=get_family_instances_by_category, Phase_Name=string)  # Evaluates if a door or window has only set one of the ToRoom / FromRoom properties. This may help to determine whether a door/window is external.
watch_7 = Watch(only_toroom_or_fromroom_is_set)
room_is_unbounded = Custom[Room Is Unbounded](Room_s=get_family_instances_by_category_2)  # Checks whether a room is unbounded.
watch_8 = Watch(room_is_unbounded)
watch_9 = Watch(get_room_boundaries.Curves)
flatten_completely = FlattenList(get_family_instances_by_category_2)
first_of_list = First(flatten_completely)
number = DoubleInput(0..-20)
XYZ = Xyz(number, lacing=Longest)
is_point_in_room = Custom[Is Point In Room](Room=first_of_list, XYZ_s=XYZ)  # Evaluates if an XYZ is located inside a given room.
watch_10 = Watch(is_point_in_room)
get_doors_or_windows_from_room = Custom[Get Doors Or Windows From Room](Doors_Windows_Category=category, Phase=watch_2)  # Retrieves all doors or windows that are associated with a room (hosted in walls and roofs).
flatten_completely_2 = FlattenList(rooms_from_doors_and_windows.From_Room_s)
map = Map(get_doors_or_windows_from_room, flatten_completely_2)
watch_11 = Watch(map)
boolean = BoolSelector(false)
get_inserts_of_room_boundaries = Custom[Get Inserts Of Room Boundaries](Room_s=flatten_completely_2, Include_Openings=boolean, Include_Shadows=boolean, Include_Embedded_Walls=boolean, Include_Shared_Embedded_Inserts=boolean)  # Retrieves the inserts of the bounding elements of a given room.
watch_12 = Watch(get_inserts_of_room_boundaries)
get_inserts_of_room_boundaries_2 = Custom[Get Inserts Of Room Boundaries By Category](Room_s=flatten_completely_2, BuiltInCategory=category_2, Include_Openings=boolean, Include_Shadows=boolean, Include_Embedded_Walls=boolean, Include_Shared_Embedded_Inserts=boolean)  # Retrieves the inserts of the bounding elements of a given room - filtered by a given category.
watch_13 = Watch(get_inserts_of_room_boundaries_2)
