# Dynamo graph QuadrilateralAlternatingRows.dyn (Dynamo 0.6.3.7375)

# note: This example also requires the XYZ Grid From Face package to be installed.
select_face = FormElementBySelection()  # 1 picked in the model
U = IntegerSliderInput(5, range=0..20)
V = IntegerSliderInput(3, range=0..20)
uv_xyz_grid_from_face = Custom[UV/XYZ Grid From Face](face=select_face, U=U, V=V)  # Returns UV coordinates, XYZ coordinates and normals for a face with UV subdivision
reverse_placement_point_order = BoolSelector(false)
shift_placement_point_order = IntegerSliderInput(3, range=0..3)
rotate_grid_by_90 = BoolSelector(true)
quadrilateral_pattern = Custom[Quadrilateral Pattern (Alternating Rows)](list=uv_xyz_grid_from_face.UVs, V=V, reverse=reverse_placement_point_order, shift_placement=shift_placement_point_order, Rotate_grid_by_90=rotate_grid_by_90)  # Creates groups of points from a list of UVs or XYZs for the placement of quadrilateral panels in alternating rows. The placement pattern can be reversed (boolean) and shifted (integer).
select_family_type_for_odd_rows = FamilyTypeSelector(index=2)
adaptive_component_by_uvs_on = AdaptiveComponentByUvsOnFace(quadrilateral_pattern.Odd_rows, select_face, select_family_type_for_odd_rows, lacing=Longest)
select_family_type_for_even_rows = FamilyTypeSelector(index=3)
adaptive_component_by_uvs_on_2 = AdaptiveComponentByUvsOnFace(quadrilateral_pattern.Even_rows, select_face, select_family_type_for_even_rows, lacing=Longest)
