# Dynamo graph SortListOfLists.dyn (Dynamo 0.6.3.7375)

number = DoubleInput(6..1)
watch = Watch(number)
number_2 = DoubleInput(5..7)
list = NewList(index0=number_2, index1=number_2)
flatten_completely = FlattenList(list)
watch_2 = Watch(flatten_completely)
string = StringInput("a,B,e,d,c,A")
string_2 = StringInput(",")
split_string = SplitString(string, string_2)
watch_3 = Watch(split_string)
list_2 = NewList(index0=watch, index1=watch_2, index2=watch_3)
watch_4 = Watch(list_2)
sort_index = DoubleInput(2)
case_insensitive = BoolSelector(false)
descending = BoolSelector(false)
sort_list_of_lists = Custom[Sort List Of Lists](List_of_lists=watch_4, Sort_index=sort_index, Case_insensitive=case_insensitive, Order_Descending=descending)  # Sorts a list of lists by one of its sublists
watch_5 = Watch(sort_list_of_lists)
