# Dynamo graph SublistHelpers.dyn (Dynamo 0.6.3.7375)

number = DoubleInput(1)
number_2 = DoubleInput(2)
number_3 = DoubleInput(3)
number_4 = DoubleInput(4)
list = NewList(index0=number, index1=number_2, index2=number_3, index3=number_4)
list_2 = NewList(index0=number_4, index1=number_2)
list_3 = NewList(index0=list, index1=list_2)
watch = Watch(list_3)
get_sublist_lengths = Custom[Get Sublist Lengths](list=watch)  # Gets the lengths of all sublists in a given list of lists.
watch_2 = Watch(get_sublist_lengths)
flatten_completely = FlattenList(watch)
watch_3 = Watch(flatten_completely)
build_irregular_sublists = Custom[Build Irregular Sublists](lengths=watch_2, list=watch_3)  # Turns a list into a list of lists with sublists of varying lengths.
watch_4 = Watch(build_irregular_sublists)
find_in_sublists = Custom[Find In Sublists](list=list_3, item=number_3)  # Looks for an item in each sublist of a given list and returns true/false for each sublist.
watch_5 = Watch(find_in_sublists)
list_4 = NewList(index0=number_2, index1=number)
watch_6 = Watch(list_4)
fill_sublists = Custom[Fill Sublists](list=watch_6, lengths=watch_2)  # Repeats a list of items into sublists of given lengths
watch_7 = Watch(fill_sublists)
number_5 = DoubleInput(2)
filter_sublists_by_length = Custom[Filter Sublists By Length](list=list_3, length=number_5)  # Filters out all sublists that do not have the specified length
watch_8 = Watch(filter_sublists_by_length.out)
watch_9 = Watch(filter_sublists_by_length.in)
