# Dynamo graph UVOrXYZIsInList.dyn (Dynamo 0.6.3.7375)

number = DoubleInput(1)
number_2 = DoubleInput(0..10)
XYZ = Xyz(number, number_2, lacing=Longest)
first_of_list = First(XYZ)
UV = Uv(number, number_2, lacing=Longest)
first_of_list_2 = First(UV)
XYZ_2 = Xyz(lacing=Longest)
list = NewList(index0=first_of_list, index1=first_of_list_2, index2=XYZ_2)
list_2 = NewList(index0=XYZ, index1=UV)
flatten_completely = FlattenList(list_2)
uv_or_xyz_is_in_list = Custom[UV Or XYZ Is In List](UV_s_XYZ_s=list, list=flatten_completely)  # Checks if a given UV or XYZ coordinate is present in a given list
watch = Watch(uv_or_xyz_is_in_list.in)
watch_2 = Watch(uv_or_xyz_is_in_list.out)
watch_3 = Watch(uv_or_xyz_is_in_list.booleans)
