# Dynamo graph VectorsAreOrthogonal.dyn (Dynamo 0.6.3.22045)

select_reference_point = PointBySelection()  # 1 picked in the model
xyz_from_reference_point = XyzFromReferencePoint(select_reference_point, lacing=Longest)
select_reference_point_2 = PointBySelection()  # 1 picked in the model
xyz_from_reference_point_2 = XyzFromReferencePoint(select_reference_point_2, lacing=Longest)
direction_to_xyz = XyzStartEndVector(xyz_from_reference_point, xyz_from_reference_point_2, lacing=Longest)
watch = Watch(direction_to_xyz)
select_reference_point_3 = PointBySelection()  # 1 picked in the model
xyz_from_reference_point_3 = XyzFromReferencePoint(select_reference_point_3, lacing=Longest)
select_reference_point_4 = PointBySelection()  # 1 picked in the model
xyz_from_reference_point_4 = XyzFromReferencePoint(select_reference_point_4, lacing=Longest)
direction_to_xyz_2 = XyzStartEndVector(xyz_from_reference_point_3, xyz_from_reference_point_4, lacing=Longest)
watch_2 = Watch(direction_to_xyz_2)
vectors_are_orthogonal = Custom[Vectors Are Orthogonal](Vector_1=watch, Vector_2=watch_2)  # Checks if two vectors are orthogonal to each other
watch_3 = Watch(vectors_are_orthogonal)
