# Dynamo graph DuplicateView.dyn (Dynamo 0.6.3.7375)

get_active_view = ActiveRevitView(lacing=Longest)
integer_slider = IntegerSliderInput(0, range=0..2)
duplicate_view = Custom[Duplicate View](view_s=get_active_view, duplication_option=integer_slider)  # Duplicates a given view. Duplication options: 0 = Duplicate, 1 = Duplicate with Detailing, 2 = Duplicate as Dependent View. Probably needs to be used in conjunction with a Transaction node.
transaction = Transaction(duplicate_view)
watch = Watch(transaction)
