# Dynamo graph ViewStuff.dyn (Dynamo 0.6.3.7375)

category = Categories(index=892)
category_2 = Categories(index=206)
list = NewList(index0=category, index1=category_2)
# note: This example also needs the Select By Category package to be installed.
category_3 = Categories(index=733)
get_family_instances_by_category = Custom[Get Family Instances By Category](BuiltInCategories=category_3)  # Gets all family instances in the model for a given list of categories
get_views_on_sheet = Custom[Get Views On Sheet](Sheet_s=get_family_instances_by_category)  # Returns all views placed on a specified sheet
watch = Watch(get_views_on_sheet)
category_is_visible_in_view = Custom[Category Is Visible In View](BuiltInCategories=list, View_s=watch)  # Checks if a given category is visible in a given view
watch_2 = Watch(category_is_visible_in_view)
view_uses_view_filters = Custom[View Uses View Filters](View_s=watch)  # Checks if a given view has any view filters applied to it.
watch_3 = Watch(view_uses_view_filters)
get_view_template_from_view = Custom[Get View Template From View](View_s=watch)  # Returns the view template assigned to a given view (if one is assigned)
watch_4 = Watch(get_view_template_from_view)
flatten_completely = FlattenList(watch_4)
is_view_template = Custom[Is View Template](View_s=flatten_completely)  # Checks if a given view is a view template
watch_5 = Watch(is_view_template)
filter_views_by_type = Custom[Filter Views By Type](View_s=watch)  # Filters a list of views by their respective types.
watch_6 = Watch(filter_views_by_type.Floor_Plans)
get_underlay_from_plan_view = Custom[Get Underlay From Plan View](Plan_s=watch_6)  # Returns the view template assigned to a given view (if one is assigned)
watch_7 = Watch(get_underlay_from_plan_view)
filter_views_by_detail_level = Custom[Filter Views By Detail Level](View_s=watch)  # Filters a list of views by their respective detail levels.
watch_8 = Watch(filter_views_by_detail_level.Coarse)
watch_9 = Watch(filter_views_by_detail_level.Medium)
watch_10 = Watch(filter_views_by_detail_level.Fine)
watch_11 = Watch(filter_views_by_detail_level.Undefined)
get_view_scale = Custom[Get View Scale](View_s=watch)  # Returns the scale of a given view
watch_12 = Watch(get_view_scale)
number_slider = DoubleSliderInput(1, range=1..20)
length_from_number = LengthFromNumber(number_slider)
resize_view_crop_box = Custom[Resize View Crop Box](amt=length_from_number, View_s=watch_6)  # Resizes the bounding box of a given Revit element by the specified amount in X, Y and Z direction. May need to be used in conjunction with a Transaction node.
