# Dynamo graph Binary.ToDecimal.dyn (Dynamo 0.7.5.3566)

boolean = BoolSelector(false)
boolean_2 = BoolSelector(true)
create = List.Create(boolean, boolean, boolean_2, boolean_2, boolean, boolean_2)
watch = Watch(create)
toDecimal = Custom[Binary.ToDecimal](list=watch)  # Converts a list of binary (boolean) values into a decimal value
watch_2 = Watch(toDecimal)
