# Dynamo graph List.BinaryToDecimal.dyn (Dynamo 0.7.5.3566)

boolean = BoolSelector(false)
boolean_2 = BoolSelector(true)
create = List.Create(boolean, boolean, boolean_2, boolean_2, boolean, boolean_2)
watch = Watch(create)
binaryToDecimal = Custom[List.BinaryToDecimal](list=watch)  # Converts a list of binary (boolean) values into a decimal value
watch_2 = Watch(binaryToDecimal)
number = DoubleInput(0)
number_2 = DoubleInput(1)
create_2 = List.Create(number, number, number_2, number_2, number, number_2)
watch_3 = Watch(create_2)
binaryToDecimal_2 = Custom[List.BinaryToDecimal](list=watch_3)
watch_4 = Watch(binaryToDecimal_2)
