# Dynamo graph List.ChopByLengths.dyn (Dynamo 0.7.5.3566)

number = DoubleInput(2)
number_2 = DoubleInput(4)
create = List.Create(number, number_2)
watch = Watch(create)
number_3 = DoubleInput(1)
number_4 = DoubleInput(3)
create_2 = List.Create(number, number_3, number_4, number_2, number_2, number)
watch_2 = Watch(create_2)
chopByLengths = Custom[List.ChopByLengths](lengths=watch, list=watch_2)  # Turns a list into a list of lists with sublists of varying lengths.
watch_3 = Watch(chopByLengths)
