# Dynamo graph List.CountBooleanSequences.dyn (Dynamo 0.7.5.3566)

boolean = BoolSelector(true)
boolean_2 = BoolSelector(false)
create = List.Create(boolean, boolean_2, boolean, boolean, boolean, boolean_2, boolean_2, boolean_2, boolean, boolean, boolean_2, boolean_2, boolean, boolean, boolean, boolean, boolean)
watch = Watch(create)
countBooleanSequences = Custom[List.CountBooleanSequences](Booleans=watch)  # Retrieves the lengths of uninterrupted sequences of booleans (true or false) in a given list.
watch_2 = Watch(countBooleanSequences.true)
watch_3 = Watch(countBooleanSequences.false)
