# Dynamo graph List.EqualSublistLengths.dyn (Dynamo 0.7.5.3566)

number = DoubleInput(1..5)
watch = Watch(number)
number_2 = DoubleInput(3..10)
watch_2 = Watch(number_2)
number_3 = DoubleInput(6..8)
watch_3 = Watch(number_3)
create = List.Create(watch, watch_2, watch_3)
equalSublistLengths = Custom[List.EqualSublistLengths](lists=create)  # Trims all given lists to the length of the shortest list
watch_4 = Watch(equalSublistLengths)
