# Dynamo graph List.FilterBySublistLength.dyn (Dynamo 0.7.5.3566)

number = DoubleInput(1)
number_2 = DoubleInput(2)
number_3 = DoubleInput(3)
number_4 = DoubleInput(4)
create = List.Create(number, number_2, number_3, number_4)
create_2 = List.Create(number_4, number_2)
create_3 = List.Create(create, create_2)
watch = Watch(create_3)
number_5 = DoubleInput(2)
filterBySublistLength = Custom[List.FilterBySublistLength](list=create_3, length=number_5)  # Filters out all sublists that do not have the specified length
watch_2 = Watch(filterBySublistLength.out)
watch_3 = Watch(filterBySublistLength.in)
