# Dynamo graph List.GroupListOfListsByKey.dyn (Dynamo 0.7.5.3566)

string = StringInput("""Animal
Animal
Animal
Fruit
Fruit
Animal
Fruit""")
string_2 = StringInput("\n")
split = String.Split(string, string_2)
string_3 = StringInput("""Elephant
Lion
Eagle
Banana
Strawberry
Zebra
Pineapple""")
split_2 = String.Split(string_3, string_2)
create = List.Create(split, split_2)
watch = Watch(create)
number = DoubleInput(0)
groupListOfListsByKey = Custom[List.GroupListOfListsByKey](list=watch, key_index=number)  # Groups a list of lists by one of its keys
watch_2 = Watch(groupListOfListsByKey)
