# Dynamo graph List.MatchWithKeysValues.dyn (Dynamo 0.7.5.3566)

number = DoubleInput(2)
number_2 = DoubleInput(5)
number_3 = DoubleInput(6)
create = List.Create(number, number_2, number_3)
string = StringInput("""Apples
Pears
Oranges
Peaches
Bananas
Strawberries
Pineapples
Mangos""")
string_2 = StringInput("\n")
split = String.Split(string, string_2)
count = List.Count(split)
number_4 = DoubleInput(1..n, count, lacing=Longest)
matchWithKeyValues = Custom[List.MatchWithKeyValues](list=create, keys=number_4, values=split)  # Matches a list with a given set of keys and returns the values corresponding to the keys
watch = Watch(matchWithKeyValues)
