# Dynamo graph List.ReplaceItemAtIndex.dyn (Dynamo 0.7.5.3566)

number = DoubleInput(1..10)
number_2 = DoubleInput(2)
number_3 = DoubleInput(5)
number_4 = DoubleInput(6)
create = List.Create(number_2, number_3, number_4)
string = StringInput("REPLACED")
replaceItemAtIndex = Custom[List.ReplaceItemAtIndex](list=number, index_indices=create, replacement=string)  # Replaces the item at a given index (or list of indices) of a list by another item
watch = Watch(replaceItemAtIndex)
