# Dynamo graph List.SortListOfLists.dyn (Dynamo 0.7.5.3566)

number = DoubleInput(6..1)
watch = Watch(number)
number_2 = DoubleInput(5..7)
create_list = List.Create(number_2, number_2)
flatten = Flatten(create_list)
watch_2 = Watch(flatten)
string = StringInput("a,B,e,d,c,A")
string_2 = StringInput(",")
split = String.Split(string, string_2)
watch_3 = Watch(split)
create = List.Create(watch, watch_2, watch_3)
watch_4 = Watch(create)
sort_index = DoubleInput(2)
boolean = BoolSelector(false)
boolean_2 = BoolSelector(false)
sortListOfLists = Custom[Sort List Of Lists](List_of_lists=watch_4, Sort_index=sort_index, Case_insensitive=boolean, Order_Descending=boolean_2)  # "List.SortListOfLists"; Sorts a list of lists by one of its sublists
watch_5 = Watch(sortListOfLists)
