# Dynamo graph List.RandomElements.dyn (Dynamo 0.7.5.3566)

string = StringInput("""Apples
Pears
Oranges
Peaches
Bananas
Strawberries
Pineapples
Mangos""")
string_2 = StringInput("\n")
split = String.Split(string, string_2)
number = DoubleInput(16)
randomElements = Custom[List.RandomElements](Base_elements=split, Amount=number)  # Creates a list of random elements based on a given list of elements
watch = Watch(randomElements)
