# Dynamo graph List.RepeatItemsByLengths.dyn (Dynamo 0.7.5.3566)

number = DoubleInput(1)
number_2 = DoubleInput(2)
number_3 = DoubleInput(3)
number_4 = DoubleInput(4)
create = List.Create(number, number_2, number_3, number_4)
watch = Watch(create)
reverse = List.Reverse(watch)
repeatItemsByLengths = Custom[List.RepeatItemsByLengths](list=watch, lengths=reverse)  # Repeats a list of items into sublists of given lengths
watch_2 = Watch(repeatItemsByLengths)
