# Dynamo graph List.AlphabeticalSequence.dyn (Dynamo 0.7.5.3566)

integer_slider = IntegerSlider(79, range=1..500)
boolean = BoolSelector(true)
alphabeticalSequence = Custom[List.AlphabeticalSequence](n=integer_slider, uppercase=boolean)  # Creates a list of the first N letters of the alphabet (where 1 = A, 2 = B, ... , 27 = AA, 28 = AB etc.).
watch = Watch(alphabeticalSequence)
