# Dynamo graph List.FromCSV.dyn (Dynamo 0.7.5.3566)

string = StringInput(",")
string_2 = StringInput(";")
file_path = Filename("C:\Users\adieckmann\Documents\GitHub\ClockworkForDynamo\package_samples\0.7.x\Core\List\Create\Strings\example.csv")
fromPath = FileObject(file_path)  # "File.FromPath"
readText = File.ReadText(fromPath)
boolean = BoolSelector(false)
boolean_2 = BoolSelector(true)
boolean_3 = BoolSelector(false)
fromCSV = Custom[List.FromCSV](delimiter=string_2, CSV_string=readText, ignore_last_column=boolean, ignore_first_row=boolean_2, ignore_last_row=boolean_3)  # Converts the content of a given CSV file to a list
watch = Watch(fromCSV)
