# Dynamo graph List.WithLeadingZeroes.dyn (Dynamo 0.7.5.3566)

number = DoubleInput(1)
number_2 = DoubleInput(18)
number_3 = DoubleInput(start..end, number, number_2, lacing=Longest)
number_4 = DoubleInput(3)
withLeadingZeroes = Custom[List.WithLeadingZeroes](seq=number_3, n=number_4)  # Adds leading zeros to a sequence of numbers
watch = Watch(withLeadingZeroes)
