# Dynamo graph TurnIntoList.dyn (Dynamo 0.7.5.3566)

number = DoubleInput(1)
watch = Watch(number)
turn_into_list = Custom[Turn Into List](item=watch)  # Turns an element (or a nested list) into a flat list
watch_2 = Watch(turn_into_list)
create = List.Create(number)
create_2 = List.Create(create)
watch_3 = Watch(create_2)
turn_into_list_2 = Custom[Turn Into List](item=watch_3)
watch_4 = Watch(turn_into_list_2)
