# Dynamo graph ReturnListOrSingleValue.dyn (Dynamo 0.7.5.3566)

number = DoubleInput(1)
create = List.Create(number)
number_2 = DoubleInput(4)
create_2 = List.Create(number_2)
returnListOrSingleValue = Custom[ReturnListOrSingleValue](item_1_unknown=create, item_2_list=create_2)  # If the item in input #1 is not a list, only the first item of the list in input #2 will be returned.
watch = Watch(returnListOrSingleValue)
create_3 = List.Create(number_2)
returnListOrSingleValue_2 = Custom[ReturnListOrSingleValue](item_1_unknown=number, item_2_list=create_3)
watch_2 = Watch(returnListOrSingleValue_2)
