# Dynamo graph Switch.dyn (Dynamo 0.7.5.3566)

number = DoubleInput(2..6)
number_2 = DoubleInput(1..4)
string = StringInput("A")
string_2 = StringInput("B")
string_3 = StringInput("C")
string_4 = StringInput("D")
create = List.Create(string, string_2, string_3, string_4)
string_5 = StringInput("E")
switch = Custom[Switch](cases=number_2, values=create, default=string_5)  # Emulates the Switch/Case statement that is available in multiple programming languages.
map = List.Map(number, switch)
watch = Watch(map)
