# Dynamo graph Analyze.dyn (Dynamo 0.7.5.3566)

activeViewFromCurrentDocument = Custom[Document.ActiveViewFromCurrentDocument]()  # Gets the active view of the current document
# note: You will also need the package Solar Analysis for Dynamo in order for this sample to work.
select_face_for_analysis = DSFaceSelection()  # 1 picked in the model
firstItem = List.FirstItem(select_face_for_analysis)
resolution_number_of_samples_in = IntegerSlider(12, range=1..30)  # "Resolution (number of samples in U/V direction)"
gridFromFace = Custom[Paneling.GridFromFace](face=firstItem, U=resolution_number_of_samples_in, V=resolution_number_of_samples_in)  # Returns UV coordinates, XYZ coordinates and normals for a face with UV subdivision
siteLocation = SiteLocation()
fromLocation = DynamoSolarAnalysis.Wrappers.Weather.FromLocation(siteLocation)
bySurfaceAndPoints = Analysis.DataTypes.SurfaceAnalysisData.BySurfaceAndPoints(firstItem, gridFromFace.UVs)
select_faces_for_shading = SelectFaces()  # 14 picked in the model
flatten = Flatten(select_faces_for_shading)
current = SunSettings()  # "SunSettings.Current"
analyze = DynamoSolarAnalysis.Wrappers.SolarAnalysis.Analyze(fromLocation, bySurfaceAndPoints, flatten, current)
results = DynamoSolarAnalysis.Wrappers.SolarAnalysis.Results(analyze)
average = Custom[SolarAnalysisType.Average]()  # Returns the key "Average" for use with the SurfaceAnalysisData.GetResultByKey node from package Solar Analysis for Dynamo
getResultByKey = Analysis.DataTypes.SurfaceAnalysisData.GetResultByKey(results, average)
unit_types = UnitTypes("Insolation")
byViewFacePointsAndValues = Revit.AnalysisDisplay.FaceAnalysisDisplay.ByViewFacePointsAndValues(activeViewFromCurrentDocument, firstItem, gridFromFace.UVs, getResultByKey, average, average, unit_types)
cumulative = Custom[SolarAnalysisType.Cumulative]()  # Returns the key "Cumulative" for use with the SurfaceAnalysisData.GetResultByKey node from package Solar Analysis for Dynamo
peak = Custom[SolarAnalysisType.Peak]()  # Returns the key "Peak" for use with the SurfaceAnalysisData.GetResultByKey node from package Solar Analysis for Dynamo
