# Dynamo graph Core.Clipboard.dyn (Dynamo 0.7.5.3566)

code_block = CodeBlock { "Dynamo says Hello!"; }
sendTo = Custom[Clipboard.SendTo](str=code_block)  # Copies a string to the clipboard. ATTENTION: Will only work with strings and on top of Revit (not in sandbox mode).
watch = Watch(sendTo)
getFrom = Custom[Clipboard.GetFrom]()  # Gets the content of the clipboard. ATTENTION: Will only work with strings and on top of Revit (not in sandbox mode).
watch_2 = Watch(getFrom)
