# Dynamo graph Core.Color.dyn (Dynamo 0.7.5.3566)

aqua = Custom[Color.Aqua]()  # Returns the colour aqua.
black = Custom[Color.Black]()  # Returns the colour black.
number = DoubleInput(0)
color_range = ColorRange(aqua, black, number)
blue = Custom[Color.Blue]()  # Returns the colour blue.
fuchsia = Custom[Color.Fuchsia]()  # Returns the colour fuchsia a.k.a. magenta.
color_range_2 = ColorRange(blue, fuchsia, number)
green = Custom[Color.Green]()  # Returns the colour green.
grey = Custom[Color.Grey]()  # Returns the colour grey.
color_range_3 = ColorRange(green, grey, number)
lime = Custom[Color.Lime]()  # Returns the colour lime.
maroon = Custom[Color.Maroon]()  # Returns the colour maroon.
color_range_4 = ColorRange(lime, maroon, number)
navy = Custom[Color.Navy]()  # Returns the colour navy.
olive = Custom[Color.Olive]()  # Returns the colour olive.
color_range_5 = ColorRange(navy, olive, number)
purple = Custom[Color.Purple]()  # Returns the colour purple.
red = Custom[Color.Red]()  # Returns the colour red.
color_range_6 = ColorRange(purple, red, number)
silver = Custom[Color.Silver]()  # Returns the colour silver.
teal = Custom[Color.Teal]()  # Returns the colour teal.
color_range_7 = ColorRange(silver, teal, number)
white = Custom[Color.White]()  # Returns the colour white.
yellow = Custom[Color.Yellow]()  # Returns the colour yellow.
color_range_8 = ColorRange(white, yellow, number)
string = StringInput("#FF9900")
byWebColor = Custom[Color.ByWebColor](Hex=string)  # Creates a color from a given web color (a hex triplet like #FF9900)
double_slider = DoubleSlider(0.732554262, range=0..1)
greyscaleByNormalizedValue = Custom[Color.GreyscaleByNormalizedValue](dbl=double_slider)  # Creates a greyscale color based on a normalized value (0 = black, 1 = white)
color_range_9 = ColorRange(byWebColor, greyscaleByNormalizedValue, number)
