# Dynamo graph Core.Formulas.dyn (Dynamo 0.7.5.3566)

code_block = CodeBlock { 1; }
byCoordinates = Point.ByCoordinates(arg1=code_block)
origin = Point.Origin()
code_block_2 = CodeBlock { 2; }
byCoordinates_2 = Point.ByCoordinates(code_block_2)
solveByPoints = Custom[Triangle.SolveByPoints](XYZ_A=byCoordinates, XYZ_B=origin, XYZ_C=byCoordinates_2)  # Solves a triangle based on the XYZ coordinates of its vertices.
watch = Watch(solveByPoints.Incircle_radius)
watch_2 = Watch(solveByPoints.Incircle_center)
watch_3 = Watch(solveByPoints.Normal)
watch_4 = Watch(solveByPoints.Hc)
watch_5 = Watch(solveByPoints.Origin_Centroid)
watch_6 = Watch(solveByPoints.Plane)
watch_7 = Watch(solveByPoints.Hb)
watch_8 = Watch(solveByPoints.Area)
watch_9 = Watch(solveByPoints.Ha)
watch_10 = Watch(solveByPoints.alpha)
watch_11 = Watch(solveByPoints.b)
watch_12 = Watch(solveByPoints.beta)
byLawOfSines = Custom[Side.ByLawOfSines](alpha_degr=watch_10, B=watch_11, beta_degr=watch_12)  # Determines the length of a side based on the law of sines. (Alpha is the angle opposite side A and beta is the angle opposite side B...)
watch_13 = Watch(byLawOfSines)
watch_14 = Watch(solveByPoints.a)
watch_15 = Watch(solveByPoints.gamma)
byLawOfCosines = Custom[OppositeSide.ByLawOfCosines](A=watch_14, B=watch_11, gamma_degr=watch_15)  # Computes the length of the missing side of a triangle using the law of cosines. Gamma is the angle between sides A and B.
watch_16 = Watch(byLawOfCosines)
watch_17 = Watch(solveByPoints.c)
byPythagoras = Custom[Hypotenuse.ByPythagoras](A=watch_14, B=watch_17)  # Computes the length of the hypotenuse of a right triangle using the Pythagorean Theorem. A and B are the legs / catheti of the triangle.
watch_18 = Watch(byPythagoras)
byPythagoras_2 = Custom[Cathetus.ByPythagoras](C=watch_11, B=watch_14)  # Computes the length of one of the catheti / legs of a right triangle using the Pythagorean Theorem. B is the other leg / cathetus of the triangle while C is the hypotenuse.
watch_19 = Watch(byPythagoras_2)
exteriorAngle = Custom[Angle.ExteriorAngle](angle_degr=watch_10)  # Computes the exterior angle of a given angle.
watch_20 = Watch(exteriorAngle.360_angle)
watch_21 = Watch(exteriorAngle.180_angle)
create = List.Create(watch_15, watch_10)
byAngleSum = Custom[Angle.ByAngleSum](list_of_angles_degr=create)  # Computes the missing interior angle of a *planar* polygon based on a given list of all other interior angles.
watch_22 = Watch(byAngleSum)
byLawOfSines_2 = Custom[Angle.ByLawOfSines](A=watch_14, B=watch_11, beta_degr=watch_12)  # Determines the angle of a triangle based on the law of sines. (Alpha is the angle opposite side A and beta is the angle opposite side B...)
watch_23 = Watch(byLawOfSines_2)
byLawOfCosines_2 = Custom[Angle.ByLawOfCosines](A=watch_14, B=watch_11, C=watch_17)  # Computes an angle of a triangle using the law of cosines. A is the opposite side of the triangle while B and C are the sides forming the angle.
watch_24 = Watch(byLawOfCosines_2)
