# Dynamo graph Core.List.Actions.dyn (Dynamo 0.7.5.3566)

boolean = BoolSelector(false)
boolean_2 = BoolSelector(true)
create = List.Create(boolean, boolean, boolean_2, boolean_2, boolean, boolean_2)
watch = Watch(create)
binaryToDecimal = Custom[List.BinaryToDecimal](list=watch)  # Converts a list of binary (boolean) values into a decimal value
watch_2 = Watch(binaryToDecimal)
code_block = CodeBlock { 0; 1; }
create_2 = List.Create(code_block.out0, code_block.out0, code_block.out1, code_block.out1, code_block.out0, code_block.out1)
watch_3 = Watch(create_2)
binaryToDecimal_2 = Custom[List.BinaryToDecimal](list=watch_3)
watch_4 = Watch(binaryToDecimal_2)
countBooleanSequences = Custom[List.CountBooleanSequences](Booleans=watch)  # Retrieves the lengths of uninterrupted sequences of booleans (true or false) in a given list.
watch_5 = Watch(countBooleanSequences.true)
watch_6 = Watch(countBooleanSequences.false)
code_block_2 = CodeBlock { 1..5; 3..10; 6..8; }
create_3 = List.Create(code_block_2.out0, code_block_2.out1, code_block_2.out2)
watch_7 = Watch(create_3)
equalSublistLengths = Custom[List.EqualSublistLengths](lists=watch_7)  # Trims all given lists to the length of the shortest list
watch_8 = Watch(equalSublistLengths)
code_block_3 = CodeBlock { 1; 2; 3; 4; }
create_4 = List.Create(code_block_3.out1, code_block_3.out3)
watch_9 = Watch(create_4)
create_5 = List.Create(code_block_3.out1, code_block_3.out0, code_block_3.out2, code_block_3.out3, code_block_3.out3, code_block_3.out1)
watch_10 = Watch(create_5)
chopByLengths = Custom[List.ChopByLengths](lengths=watch_9, list=watch_10)  # Turns a list into a list of lists with sublists of varying lengths.
watch_11 = Watch(chopByLengths)
code_block_4 = CodeBlock { 2; }
filterBySublistLength = Custom[List.FilterBySublistLength](list=watch_11, length=code_block_4)  # Filters out all sublists that do not have the specified length
watch_12 = Watch(filterBySublistLength.in)
watch_13 = Watch(filterBySublistLength.out)
string = StringInput("""Animal
Animal
Animal
Fruit
Fruit
Animal
Fruit""")
string_2 = StringInput("\n")
split = String.Split(string, string_2)
string_3 = StringInput("""Elephant
Lion
Eagle
Banana
Strawberry
Zebra
Pineapple""")
split_2 = String.Split(string_3, string_2)
create_6 = List.Create(split, split_2)
watch_14 = Watch(create_6)
code_block_5 = CodeBlock { 0; }
groupListOfListsByKey = Custom[List.GroupListOfListsByKey](list=watch_14, key_index=code_block_5)  # Groups a list of lists by one of its keys
watch_15 = Watch(groupListOfListsByKey)
code_block_6 = CodeBlock { 2; 5; 6; }
create_7 = List.Create(code_block_6.out0, code_block_6.out1, code_block_6.out2)
watch_16 = Watch(create_7)
watch_17 = Watch(split_2)
count = List.Count(watch_17)
code_block_7 = CodeBlock(n=count) { 1..n; }
matchWithKeyValues = Custom[List.MatchWithKeyValues](list=watch_16, keys=code_block_7, values=split_2)  # Matches a list with a given set of keys and returns the values corresponding to the keys
watch_18 = Watch(matchWithKeyValues)
code_block_8 = CodeBlock { 1..10; }
string_4 = StringInput("REPLACED")
replaceItemAtIndex = Custom[List.ReplaceItemAtIndex](list=code_block_8, index_indices=watch_16, replacement=string_4)  # Replaces the item at a given index (or list of indices) of a list by another item
watch_19 = Watch(replaceItemAtIndex)
count_2 = List.Count(split_2)
code_block_9 = CodeBlock(n=count_2) { 1..n; }
create_8 = List.Create(split, split_2, code_block_9)
watch_20 = Watch(create_8)
code_block_10 = CodeBlock { 1; }
boolean_3 = BoolSelector(false)
sortListOfLists = Custom[List.SortListOfLists](List_of_lists=watch_20, Sort_index=code_block_10, Case_insensitive=boolean_3, Order_Descending=boolean_3)  # Sorts a list of lists by one of its sublists
watch_21 = Watch(sortListOfLists)
empty = List.Empty()
code_block_11 = CodeBlock { 3; }
ofRepeatedItem = List.OfRepeatedItem(empty, code_block_11)
join = List.Join(split_2, ofRepeatedItem)
shuffle = List.Shuffle(join)
watch_22 = Watch(shuffle)
string_5 = StringInput("REPLACEMENT")
replaceEmptyLists = Custom[List.ReplaceEmptyLists](list=watch_22, replacement=string_5)  # Replaces all empty lists within a given list with a substitute
watch_23 = Watch(replaceEmptyLists)
code_block_12 = CodeBlock { null; }
ofRepeatedItem_2 = List.OfRepeatedItem(code_block_12, code_block_11)
join_2 = List.Join(split_2, ofRepeatedItem_2)
shuffle_2 = List.Shuffle(join_2)
watch_24 = Watch(shuffle_2)
replaceNull = Custom[List.ReplaceNull](list=watch_24, replacement=string_5)  # Replaces all null values within a given list with a substitute
watch_25 = Watch(replaceNull)
