# Dynamo graph Core.List.Create.Numbers.dyn (Dynamo 0.7.5.3566)

integer_slider = IntegerSlider(10, range=0..20)
normalizedSequence = Custom[Normalized Sequence](N=integer_slider)  # "List.NormalizedSequence"; Creates a sequence of N values between 0 and 1
watch = Watch(normalizedSequence)
formula = Formula("Sin(x*Pi/2)", lacing=Longest)
normalizedSequenceByFunction = Custom[Normalized Sequence by Function](f_x=formula, N=integer_slider)  # "List.NormalizedSequenceByFunction"; Creates a sequence of N values between 0 and 1 driven by a function
watch_2 = Watch(normalizedSequenceByFunction)
