# Dynamo graph Core.List.Query.Booleans.dyn (Dynamo 0.7.5.3566)

boolean = BoolSelector(false)
boolean_2 = BoolSelector(true)
create = List.Create(boolean, boolean_2)
watch = Watch(create)
true_for_any_booleans = Custom[True For Any (Boolean)](seq=watch)  # Returns true if any item in a list of booleans is true.
watch_2 = Watch(true_for_any_booleans)
true_for_all_booleans = Custom[True For All (Boolean)](seq=watch)  # Returns true if all items in a list of booleans are true.
watch_3 = Watch(true_for_all_booleans)
false_for_any_booleans = Custom[False For Any (Boolean)](seq=watch)  # Returns true if any item in a list of booleans is false.
watch_4 = Watch(false_for_any_booleans)
false_for_all_booleans = Custom[False For All (Boolean)](seq=watch)  # Returns true if all items in a list of booleans are false.
watch_5 = Watch(false_for_all_booleans)
