# Dynamo graph Core.Logic.dyn (Dynamo 0.7.5.3566)

number = DoubleInput(2..6)
number_2 = DoubleInput(1..4)
string = StringInput("A")
string_2 = StringInput("B")
string_3 = StringInput("C")
string_4 = StringInput("D")
create = List.Create(string, string_2, string_3, string_4)
string_5 = StringInput("E")
switch = Custom[Switch](cases=number_2, values=create, default=string_5)  # Emulates the Switch/Case statement that is available in multiple programming languages.
map = List.Map(number, switch)
watch = Watch(map)
number_3 = DoubleInput(1)
number_4 = DoubleInput(4)
create_2 = List.Create(number_4)
returnListOrSingleValue = Custom[ReturnListOrSingleValue](item_1_unknown=number_3, item_2_list=create_2)  # If the item in input #1 is not a list, only the first item of the list in input #2 will be returned.
watch_2 = Watch(returnListOrSingleValue)
create_3 = List.Create(number_3)
create_4 = List.Create(number_4)
returnListOrSingleValue_2 = Custom[ReturnListOrSingleValue](item_1_unknown=create_3, item_2_list=create_4)
watch_3 = Watch(returnListOrSingleValue_2)
boolean = BoolSelector(false)
string_6 = StringInput("Example data")
dispatch = Custom[Dispatch](test=boolean, value=string_6)  # Dispatches a value to one of two output ports (true/false) depending on a condition. The other output port will return an empty list.
watch_4 = Watch(dispatch.true)
watch_5 = Watch(dispatch.false)
