# Dynamo graph Core.Math.Actions.Normalization.dyn (Dynamo 0.7.5.3566)

double_slider = DoubleSlider(30.95265861, range=20..50)
code_block = CodeBlock { 20; 50; }
normalize = Custom[Math.Normalize](val=double_slider, Min=code_block.out0, Max=code_block.out1)  # Converts a value into a normalized value according to a value range
watch = Watch(normalize)
invertNormalized = Custom[Math.InvertNormalized](watch)  # Inverts a value between 0 and 1 to its opposite (1-x)
watch_2 = Watch(invertNormalized)
scaleNormalized = Custom[Math.ScaleNormalized](val=normalize, Min=code_block.out0, Max=code_block.out1)  # Scales a normalized value according to a given minimum and maximum
watch_3 = Watch(scaleNormalized)
code_block_2 = CodeBlock { 1..10; }
normalizeRange = Custom[Math.NormalizeRange](numbers=code_block_2)  # Normalizes a range of numbers
watch_4 = Watch(normalizeRange)
