# Dynamo graph Core.Math.Actions.Rounding.dyn (Dynamo 0.7.5.3566)

code_block = CodeBlock { 7677; 5; }
roundToPrecision = Custom[Math.RoundToPrecision](Number=code_block.out0, Precision=code_block.out1)  # Rounds a number to a specified precision
watch = Watch(roundToPrecision)
roundDownToPrecision = Custom[Math.RoundDownToPrecision](Number=code_block.out0, Precision=code_block.out1)  # Rounds a number *down* to a specified precision
watch_2 = Watch(roundDownToPrecision)
roundUpToPrecision = Custom[Math.RoundUpToPrecision](Number=code_block.out0, Precision=code_block.out1)  # Rounds a number *up* to a specified precision
watch_3 = Watch(roundUpToPrecision)
