# Dynamo graph Core.Math.Actions.dyn (Dynamo 0.7.5.3566)

double_slider = DoubleSlider(50, range=0..100)
double_slider_2 = DoubleSlider(46, range=0..100)
double_slider_3 = DoubleSlider(0.1, range=0..1)
similar = Custom[Math.Similar](A=double_slider, B=double_slider_2, Tolerance=double_slider_3)  # Computes the difference between two values and whether that difference is within a given tolerance factor
watch = Watch(similar.IsSimilar)
watch_2 = Watch(similar.Difference)
code_block = CodeBlock { 1; }
n1 = Custom[-1](code_block)  # Decrements a value by 1
watch_3 = Watch(n1)
n1_2 = Custom[+1](code_block)  # Increments a value by 1
watch_4 = Watch(n1_2)
code_block_2 = CodeBlock { 7677; 5; }
roundDownToPrecision = Custom[Math.RoundDownToPrecision](Number=code_block_2.out0, Precision=code_block_2.out1)  # Rounds a number *down* to a specified precision
watch_5 = Watch(roundDownToPrecision)
roundToPrecision = Custom[Math.RoundToPrecision](Number=code_block_2.out0, Precision=code_block_2.out1)  # Rounds a number to a specified precision
watch_6 = Watch(roundToPrecision)
roundUpToPrecision = Custom[Math.RoundUpToPrecision](Number=code_block_2.out0, Precision=code_block_2.out1)  # Rounds a number *up* to a specified precision
watch_7 = Watch(roundUpToPrecision)
code_block_3 = CodeBlock { 1..10; }
normalizeRange = Custom[Math.NormalizeRange](numbers=code_block_3)  # Normalizes a range of numbers
watch_8 = Watch(normalizeRange)
double_slider_4 = DoubleSlider(32.893, range=20..50)
code_block_4 = CodeBlock { 20; 50; }
normalize = Custom[Math.Normalize](val=double_slider_4, Min=code_block_4.out0, Max=code_block_4.out1)  # Converts a value into a normalized value according to a value range
watch_9 = Watch(normalize)
invertNormalized = Custom[Math.InvertNormalized](watch_9)  # Inverts a value between 0 and 1 to its opposite (1-x)
watch_10 = Watch(invertNormalized)
scaleNormalized = Custom[Math.ScaleNormalized](val=normalize, Min=code_block_4.out0, Max=code_block_4.out1)  # Scales a normalized value according to a given minimum and maximum
watch_11 = Watch(scaleNormalized)
decimalToHex = Custom[Math.DecimalToHex](Decimal=code_block_2.out0)  # Converts a number to a string of its hexadecimal value
watch_12 = Watch(decimalToHex)
decimalToBinary = Custom[Math.DecimalToBinary](Decimal=code_block_2.out0)  # Converts a number to a string of its binary value
watch_13 = Watch(decimalToBinary)
