# Dynamo graph Core.Math.Query.dyn (Dynamo 0.7.5.3566)

code_block = CodeBlock { 2; 8; }
isEvenNumber = Custom[Math.IsEvenNumber](val=code_block.out0)  # Checks if a number is even.
watch = Watch(isEvenNumber)
isOddNumber = Custom[Math.IsOddNumber](val=code_block.out0)  # Checks if a number is odd.
watch_2 = Watch(isOddNumber)
isMultipleOf = Custom[Math.IsMultipleOf](A=code_block.out1, B=code_block.out0)  # Checks if A is a multiple of B.
watch_3 = Watch(isMultipleOf)
