# Dynamo graph Core.String.Actions.dyn (Dynamo 0.7.5.3566)

string = StringInput("[a-zA-Z]*berry")
string_2 = StringInput("""Strawberry123
Raspberry456
Banana789""")
string_3 = StringInput("\n")
split = String.Split(string_2, string_3)
watch = Watch(split)
findRegularExpression = Custom[String.FindRegularExpression](regex=string, string_s=watch)  # Returns all occurences of a regular expression within a string (or list of strings). The syntax for regular expressions is explained at http://ironpython-test.readthedocs.org/en/latest/howto/regex.html
watch_2 = Watch(findRegularExpression)
string_4 = StringInput("DYNAMO")
replaceRegularExpression = Custom[String.ReplaceRegularExpression](regex=string, string_s=watch, replacement=string_4)  # Replaces all occurences of a regular expression within a given string (or list of strings) with another string. The syntax for regular expressions is explained at http://ironpython-test.readthedocs.org/en/latest/howto/regex.html
watch_3 = Watch(replaceRegularExpression)
matchRegularExpression = Custom[String.MatchRegularExpression](regex=string, string_s=watch)  # Determines if a regular expression matches a string (or a list of strings) and returns a boolean value (or a list, depending on the input). The syntax for regular expressions is explained at http://ironpython-test.readthedocs.org/en/latest/howto/regex.html
watch_4 = Watch(matchRegularExpression)
splitByRegularExpression = Custom[String.SplitByRegularExpression](regex=string, string_s=watch)  # Splits a given string by a regular expression. The syntax for regular expressions is explained at http://ironpython-test.readthedocs.org/en/latest/howto/regex.html
watch_5 = Watch(splitByRegularExpression)
string_5 = StringInput("1001101")
binaryToDecimal = Custom[String.BinaryToDecimal](Binary=string_5)  # Converts a string of a binary number into a decimal value
watch_6 = Watch(binaryToDecimal)
alphanumericToMorse = Custom[String.AlphanumericToMorse](str=string_4)  # Converts an alphanumeric string to Morse code
watch_7 = Watch(alphanumericToMorse)
string_6 = StringInput("FF9900")
hexToDecimal = Custom[String.HexToDecimal](Hex=string_6)  # Converts a string of a hexadecimal value to a number
watch_8 = Watch(hexToDecimal)
string_7 = StringInput("-.. -.-- -. .- -- ---")
morseToAlphanumeric = Custom[String.MorseToAlphanumeric](str=string_7)  # Converts a string in Morse code to alphanumeric
watch_9 = Watch(morseToAlphanumeric)
