# Dynamo graph Core.String.Create.dyn (Dynamo 0.7.5.3566)

code_block = CodeBlock { 5; }
boolean = BoolSelector(true)
fromNumber = Custom[Character.FromNumber](n=code_block, upper=boolean)  # Converts a number into a character (where 1 = A, 2 = B, ... , 27 = AA, 28 = AB etc.).
watch = Watch(fromNumber)
