# Dynamo graph Geometry.BoundingBox.dyn (Dynamo 0.7.5.3566)

origin = Point.Origin()
code_block = CodeBlock { 5; }
byCenterPointRadius = Sphere.ByCenterPointRadius(origin, code_block)
boundingBox = Geometry.BoundingBox(byCenterPointRadius)
code_block_2 = CodeBlock { 1; }
byCoordinates = Vector.ByCoordinates(code_block_2, code_block_2, code_block_2)
normalized = Vector.Normalized(byCoordinates)
perimeterCurvesByNormal = Custom[BoundingBox.PerimeterCurvesByNormal](Bounding_Box_es=boundingBox, Normal_s=normalized)  # Returns the perimeter curve of a bounding box on a plane determined by a given normal and the centroid of the bounding box
ZAxis = Vector.ZAxis()
byOriginNormal = Plane.ByOriginNormal(origin, ZAxis)
perimeterCurvesOnPlane = Custom[BoundingBox.PerimeterCurvesOnPlane](Bounding_Box_es=boundingBox, Plane_s=byOriginNormal)  # Returns the perimeter curve of a bounding box on a given plane (assuming that the bounding box and plane intersect)
create = List.Create(perimeterCurvesByNormal, byCenterPointRadius, perimeterCurvesOnPlane)
watch_3d = Watch3D(create)
