# Dynamo graph Geometry.Buckyball.dyn (Dynamo 0.7.5.3566)

origin = Point.Origin()
double_slider = DoubleSlider(15, range=0..20)
byOriginAndRadius = Custom[Buckyball.ByOriginAndRadius](Origin=origin, Radius=double_slider)  # Returns all the data necessary for modeling a truncated icosahedron (vertices and struts) as well as the surface area and volume.
watch = Watch(byOriginAndRadius.Volume)
watch_2 = Watch(byOriginAndRadius.Surface_Area)
watch_3 = Watch(byOriginAndRadius.Struts_Up_Vectors)
watch_4 = Watch(byOriginAndRadius.Struts_Points)
watch_5 = Watch(byOriginAndRadius.Surfaces_Geom)
watch_6 = Watch(byOriginAndRadius.Surfaces_Pentagons)
watch_7 = Watch(byOriginAndRadius.Surfaces_Hexagons)
watch_8 = Watch(byOriginAndRadius.Vertices)
watch_9 = Watch(byOriginAndRadius.Struts_Geom)
create = List.Create(byOriginAndRadius.Struts_Geom, byOriginAndRadius.Surfaces_Geom)
watch_3d = Watch3D(create)
