# Dynamo graph Geometry.Curve.dyn (Dynamo 0.7.5.3566)

code_block = CodeBlock { 1; }
byCoordinates = Point.ByCoordinates(code_block)
byCoordinates_2 = Point.ByCoordinates(code_block, code_block)
byCoordinates_3 = Point.ByCoordinates(arg1=code_block)
origin = Point.Origin()
create = List.Create(byCoordinates, byCoordinates_2, byCoordinates_3, origin)
closedLoopThroughPoints = Custom[Curve.ClosedLoopThroughPoints](Points=create)  # Creates a *closed* loop of curves based on a given list of points
watch = Watch(closedLoopThroughPoints)
watch_3d = Watch3D(closedLoopThroughPoints)
