# Dynamo graph Geometry.Geometry.dyn (Dynamo 0.7.5.3566)

origin = Point.Origin()
code_block = CodeBlock { 10; }
byCoordinates = Point.ByCoordinates(code_block)
code_block_2 = CodeBlock { 5; }
byCenterPointRadius = Sphere.ByCenterPointRadius(byCoordinates, code_block_2)
code_block_3 = CodeBlock { 20; }
byCoordinates_2 = Point.ByCoordinates(code_block_3)
byLengths = Cuboid.ByLengths(byCoordinates_2, code_block_2, code_block_2, code_block_2)
create = List.Create(byCenterPointRadius, byLengths)
closestTo = Custom[Geometry.ClosestTo](geometry=create, other=origin)  # Finds the closest entity in a list of geometric entities from another given entity
create_2 = List.Create(origin, create, closestTo.Closest_point)
watch_3d = Watch3D(create_2)
furthestFrom = Custom[Geometry.FurthestFrom](geometry=create, other=origin)  # Finds the furthest entity in a list of geometric entities from another given entity
watch = Watch(furthestFrom)
watch_2 = Watch(closestTo.Closest_object)
