# Dynamo graph Geometry.Mesh.dyn (Dynamo 0.7.5.3566)

origin = Point.Origin()
XAxis = Vector.XAxis()
byOriginNormal = Plane.ByOriginNormal(origin, XAxis)
# note: You'll need to run this graph on top of a Revit file that contains a toposurface, e.g. the basic architectural sample project that ships with Revit.
categories = Categories("Topography")
all_elements_of_category = ElementsOfCategory(categories)
firstItem = List.FirstItem(all_elements_of_category)
mesh = Topography.Mesh(firstItem)
intersectionWithPlane = Custom[Mesh.IntersectionWithPlane](Plane=byOriginNormal, Mesh=mesh)  # Calculates the intersection of a mesh and a plane
watch = Watch(intersectionWithPlane.Points)
watch_2 = Watch(intersectionWithPlane.NurbsCurve_by_control_points)
watch_3 = Watch(intersectionWithPlane.PolyCurve)
watch_4 = Watch(intersectionWithPlane.NurbsCurve_by_points)
create = List.Create(mesh, watch_4)
watch_3d = Watch3D(create)
faceVertices = Custom[Mesh.FaceVertices](Mesh=mesh)  # Gets the vertices of each face of a given mesh
watch_5 = Watch(faceVertices)
byPerimeterPoints = Surface.ByPerimeterPoints(watch_5)
watch_6 = Watch(byPerimeterPoints)
watch_3d_2 = Watch3D(byPerimeterPoints)
