# Dynamo graph Geometry.Plane.dyn (Dynamo 0.7.5.3566)

origin = Point.Origin()
code_block = CodeBlock { 2; 0.5; }
byCoordinates = Point.ByCoordinates(code_block.out0)
byCoordinates_2 = Point.ByCoordinates(code_block.out0, code_block.out0, code_block.out1)
byCoordinates_3 = Point.ByCoordinates(arg1=code_block.out0)
create = List.Create(origin, byCoordinates, byCoordinates_2, byCoordinates_3)
watch = Watch(create)
byFirst3Points = Custom[Plane.ByFirst3Points](list=watch)  # Returns a plane, its origin and its normal based on the first three XYZs in a given list
code_block_2 = CodeBlock { 1; 2; 3; }
shiftIndices = List.ShiftIndices(create, code_block_2.out0)
watch_2 = Watch(shiftIndices)
byFirst3Points_2 = Custom[Plane.ByFirst3Points](list=watch_2)
shiftIndices_2 = List.ShiftIndices(create, code_block_2.out1)
watch_3 = Watch(shiftIndices_2)
byFirst3Points_3 = Custom[Plane.ByFirst3Points](list=watch_3)
shiftIndices_3 = List.ShiftIndices(create, code_block_2.out2)
watch_4 = Watch(shiftIndices_3)
byFirst3Points_4 = Custom[Plane.ByFirst3Points](list=watch_4)
create_2 = List.Create(byFirst3Points, byFirst3Points_2, byFirst3Points_3, byFirst3Points_4)
watch_3d = Watch3D(create_2)
code_block_3 = CodeBlock { 1; }
byLengths = Cuboid.ByLengths(code_block_3, code_block_3, code_block_3)
explode = Geometry.Explode(byLengths)
watch_5 = Watch(explode)
byBestFitFromFace = Custom[Plane.ByBestFitFromFace](Face_s=watch_5)  # Creates a plane from face
watch_6 = Watch(byBestFitFromFace)
watch_3d_2 = Watch3D(byBestFitFromFace)
