# Dynamo graph Geometry.Point.Actions.Rounding.dyn (Dynamo 0.7.5.3566)

code_block = CodeBlock { 1; }
double_slider = DoubleSlider(0.6211461408, range=0..1)
byCoordinates = Point.ByCoordinates(arg1=code_block, arg2=double_slider)
watch = Watch(byCoordinates)
code_block_2 = CodeBlock { 0.1; }
roundToPrecision = Custom[Point.RoundToPrecision](Point_s=watch, Precision=code_block_2)  # Rounds a point coordinate to a specified precision
watch_2 = Watch(roundToPrecision)
roundUpToPrecision = Custom[Point.RoundUpToPrecision](Point_s=watch, Precision=code_block_2)  # Rounds a point coordinate *up* to a specified precision
watch_3 = Watch(roundUpToPrecision)
roundDownToPrecision = Custom[Point.RoundDownToPrecision](Point_s=watch, Precision=code_block_2)  # Rounds a point coordinate *down* to a specified precision
watch_4 = Watch(roundDownToPrecision)
