# Dynamo graph Geometry.Point.Actions.dyn (Dynamo 0.7.5.3566)

double_slider = DoubleSlider(11.898, range=0..20)
double_slider_2 = DoubleSlider(10.308, range=0..20)
code_block = CodeBlock { 50; 25; 5; 0..1..#8; 7; 15; -15; }
byCoordinates = Point.ByCoordinates(double_slider, double_slider_2, code_block.out0)
byCoordinates_2 = Point.ByCoordinates(arg2=code_block.out1)
byCenterPointRadius = Circle.ByCenterPointRadius(byCoordinates_2, code_block.out2)
takeItems = List.TakeItems(code_block.out3, code_block.out4)
pointAtParameter = Curve.PointAtParameter(byCenterPointRadius, takeItems)
origin = Point.Origin()
ZAxis = Vector.ZAxis()
byOriginNormal = Plane.ByOriginNormal(origin, ZAxis)
centralProjectionOnPlane = Custom[Point.CentralProjectionOnPlane](Central_projection_point=byCoordinates, Point_s_to_be_projected=pointAtParameter, Plane=byOriginNormal)  # Projects a list of points onto a given plane
boolean = BoolSelector(true)
byPoints = PolyCurve.ByPoints(centralProjectionOnPlane, boolean)
byPoints_2 = PolyCurve.ByPoints(pointAtParameter, boolean)
create = List.Create(byCoordinates, pointAtParameter, byOriginNormal, centralProjectionOnPlane, byPoints, byPoints_2)
watch_3d = Watch3D(create)
code_block_2 = CodeBlock(a=code_block.out5, b=code_block.out6, c=code_block.out2) { {a,b,b,a}; {a,a,b,b}; {0,0,c,0}; }
byCoordinates_3 = Point.ByCoordinates(code_block_2.out0, code_block_2.out1, code_block_2.out2)
byPerimeterPoints = Surface.ByPerimeterPoints(byCoordinates_3)
centralProjectionOnFace = Custom[Point.CentralProjectionOnFace](Central_Projection_Point=byCoordinates, Points_to_be_projected=pointAtParameter, Face=byPerimeterPoints)  # Projects a list of points onto a given face
byPoints_3 = PolyCurve.ByPoints(centralProjectionOnPlane, boolean)
create_2 = List.Create(byCoordinates, pointAtParameter, byPerimeterPoints, centralProjectionOnFace, byPoints_3, byPoints_2)
watch_3d_2 = Watch3D(create_2)
code_block_3 = CodeBlock { 0.1; 1; }
double_slider_3 = DoubleSlider(0, range=0..1)
byCoordinates_4 = Point.ByCoordinates(arg1=code_block_3.out1, arg2=double_slider_3)
watch = Watch(byCoordinates_4)
roundUpToPrecision = Custom[Point.RoundUpToPrecision](Point_s=watch, Precision=code_block_3.out0)  # Rounds a point coordinate *up* to a specified precision
watch_2 = Watch(roundUpToPrecision)
roundToPrecision = Custom[Point.RoundToPrecision](Point_s=watch, Precision=code_block_3.out0)  # Rounds a point coordinate to a specified precision
watch_3 = Watch(roundToPrecision)
roundDownToPrecision = Custom[Point.RoundDownToPrecision](Point_s=watch, Precision=code_block_3.out0)  # Rounds a point coordinate *down* to a specified precision
watch_4 = Watch(roundDownToPrecision)
