# Dynamo graph Geometry.Point.Query.Sequences.dyn (Dynamo 0.7.5.3566)

code_block = CodeBlock { {1,2,4,8,16}; }
code_block_2 = CodeBlock { 0..4; }
byCoordinates = Point.ByCoordinates(code_block, arg2=code_block_2)
watch = Watch(byCoordinates)
origin = Point.Origin()
greatestDistanceToPoint = Custom[PointSequence.GreatestDistanceToPoint](Point_Sequence=watch, Point=origin)  # Retrieves the furthest point in a sequence of points
watch_2 = Watch(greatestDistanceToPoint.bool)
watch_3 = Watch(greatestDistanceToPoint.distance)
accumulatedDistance = Custom[PointSequence.AccumulatedDistance](Points=watch)  # Retrieves the accumulated distances of a sequence of points
watch_4 = Watch(accumulatedDistance)
code_block_3 = CodeBlock { {3,9,12,16}; }
code_block_4 = CodeBlock { 0..3; }
byCoordinates_2 = Point.ByCoordinates(arg1=code_block_3, arg2=code_block_4)
create = List.Create(byCoordinates, byCoordinates_2)
watch_5 = Watch(create)
shortestPath = Custom[PointSequences.ShortestPath](seq=watch_5)  # Retrieves the shortest path from a number of point sequences
watch_6 = Watch(shortestPath.bool)
watch_7 = Watch(shortestPath.distance)
origin_2 = Point.Origin()
ZAxis = Vector.ZAxis()
byOriginNormal = Plane.ByOriginNormal(origin_2, ZAxis)
containsOutOfPlanePoints = Custom[PointSequence.ContainsOutOfPlanePoints](face_plane=byOriginNormal, list=watch)  # Checks a list for XYZs that are not located on a given plane
watch_8 = Watch(containsOutOfPlanePoints.bool)
watch_9 = Watch(containsOutOfPlanePoints.max)
watch_3d = Watch3D(create)
