# Dynamo graph Geometry.Point.Query.dyn (Dynamo 0.7.5.3566)

code_block = CodeBlock { {1,2,4,8,16}; }
code_block_2 = CodeBlock { 0..4; }
byCoordinates = Point.ByCoordinates(code_block, arg2=code_block_2)
watch = Watch(byCoordinates)
average = Custom[Point.Average](Points=watch)  # Determines the average of a list of points
watch_2 = Watch(average)
watch_3d = Watch3D(watch)
origin = Point.Origin()
ZAxis = Vector.ZAxis()
byOriginNormal = Plane.ByOriginNormal(origin, ZAxis)
isOutOfPlane = Custom[Point.IsOutOfPlane](Face_Plane=byOriginNormal, Point=watch)  # Checks a list for XYZs that are not located on a given plane
watch_3 = Watch(isOutOfPlane.bool)
watch_4 = Watch(isOutOfPlane.amount)
