# Dynamo graph Geometry.Surface.dyn (Dynamo 0.7.5.3566)

origin = Point.Origin()
code_block = CodeBlock { 2; }
byCoordinates = Point.ByCoordinates(code_block)
double_slider = DoubleSlider(0, range=0..2)
byCoordinates_2 = Point.ByCoordinates(code_block, code_block, double_slider)
byCoordinates_3 = Point.ByCoordinates(arg1=code_block)
create = List.Create(origin, byCoordinates, byCoordinates_2, byCoordinates_3)
byPerimeterPoints = Surface.ByPerimeterPoints(create)
isPlanar = Custom[Surface.IsPlanar](Surface=byPerimeterPoints)  # Checks whether a face is planar
watch = Watch(isPlanar)
vertices = Custom[Surface.Vertices](Surface_s=byPerimeterPoints)  # Returns all vertices of a given surface
watch_2 = Watch(vertices)
watch_3d = Watch3D(byPerimeterPoints)
byLengths = Cuboid.ByLengths(code_block, code_block, code_block)
explode = Geometry.Explode(byLengths)
filterByOrientation = Custom[Surface.FilterByOrientation](Face_s=explode)  # Sorts surfaces in three lists based on their orientation (vertical, horizontal up & horizontal down) and also returns three corresponding lists of booleans.
watch_3 = Watch(filterByOrientation.IsHorizontalUp)
watch_4 = Watch(filterByOrientation.IsVertical)
watch_5 = Watch(filterByOrientation.IsHorizontalDown)
watch_6 = Watch(filterByOrientation.Horizontal_Down)
watch_7 = Watch(filterByOrientation.Horizontal_Up)
watch_8 = Watch(filterByOrientation.Vertical)
