# Dynamo graph Geometry.UV.Actions.Rounding.dyn (Dynamo 0.7.5.3566)

code_block = CodeBlock { 1; }
double_slider = DoubleSlider(0.621, range=0..1)
byCoordinates = UV.ByCoordinates(code_block, double_slider)
watch = Watch(byCoordinates)
code_block_2 = CodeBlock { 0.1; }
roundToPrecision = Custom[UV.RoundToPrecision](UV_s=watch, Precision=code_block_2)  # Rounds a UV coordinate to a specified precision
watch_2 = Watch(roundToPrecision)
roundUpToPrecision = Custom[UV.RoundUpToPrecision](UV_s=watch, Precision=code_block_2)  # Rounds a UV coordinate *up* to a specified precision
watch_3 = Watch(roundUpToPrecision)
roundDownToPrecision = Custom[UV.RoundDownToPrecision](UV_s=watch, Precision=code_block_2)  # Rounds a UV coordinate to a specified precision
watch_4 = Watch(roundDownToPrecision)
