# Dynamo graph Geometry.UV.Actions.dyn (Dynamo 0.7.5.3566)

code_block = CodeBlock { 1; }
double_slider = DoubleSlider(0.621, range=0..1)
byCoordinates = UV.ByCoordinates(code_block, double_slider)
watch = Watch(byCoordinates)
code_block_2 = CodeBlock { 0.1; }
roundToPrecision = Custom[UV.RoundToPrecision](UV_s=watch, Precision=code_block_2)  # Rounds a UV coordinate to a specified precision
watch_2 = Watch(roundToPrecision)
roundUpToPrecision = Custom[UV.RoundUpToPrecision](UV_s=watch, Precision=code_block_2)  # Rounds a UV coordinate *up* to a specified precision
watch_3 = Watch(roundUpToPrecision)
roundDownToPrecision = Custom[UV.RoundDownToPrecision](UV_s=watch, Precision=code_block_2)  # Rounds a UV coordinate to a specified precision
watch_4 = Watch(roundDownToPrecision)
swap = Custom[UV.Swap](UV_s=watch)  # Swaps U and V coordinates
watch_5 = Watch(swap)
code_block_3 = CodeBlock { 20; 0.2; 0.8; 5; }
byWidthHeight = Rectangle.ByWidthHeight(code_block_3.out3, code_block_3.out3)
byPatch = Surface.ByPatch(byWidthHeight)
randomList = Math.RandomList(code_block_3.out0)
remapRange = Math.RemapRange(randomList, code_block_3.out1, code_block_3.out2)
byCoordinates_2 = UV.ByCoordinates(remapRange, remapRange, lacing=CrossProduct)
flatten = Flatten(byCoordinates_2)
code_block_4 = CodeBlock { 3; 0; }
takeEveryNthItem = List.TakeEveryNthItem(flatten, code_block_4.out0, code_block_4.out1)
watch_6 = Watch(takeEveryNthItem)
convexHull2D = Custom[UV.ConvexHull2D](UVs=watch_6)  # Computes the convex hull of a given set of UV coordinates based on the monotone chain algorithm
watch_7 = Watch(convexHull2D)
U = UV.U(watch_7)
V = UV.V(watch_7)
pointAtParameter = Surface.PointAtParameter(byPatch, U, V)
boolean = BoolSelector(true)
byPoints = PolyCurve.ByPoints(pointAtParameter, boolean)
U_2 = UV.U(watch_6)
V_2 = UV.V(watch_6)
pointAtParameter_2 = Surface.PointAtParameter(byPatch, U_2, V_2)
create = List.Create(byPoints, pointAtParameter_2)
watch_3d = Watch3D(create)
double_slider_2 = DoubleSlider(0.011, range=0..0.3)
pruneDuplicates = Custom[UV.PruneDuplicates](UVs=watch_6, Tolerance=double_slider_2)  # Prune UVs to exclude duplicates within a given tolerance
count = List.Count(pruneDuplicates)
watch_8 = Watch(count)
count_2 = List.Count(watch_6)
watch_9 = Watch(count_2)
