# Dynamo graph Geometry.UV.Create.dyn (Dynamo 0.7.5.3566)

double_slider = DoubleSlider(18.70503597, range=0..100)
double_slider_2 = DoubleSlider(35.25179856, range=0..100)
byCoordinates = Point.ByCoordinates(double_slider, double_slider_2)
byXY = Custom[UV.ByXY](Point_s=byCoordinates)  # Creates UVs from the XY components of point coordinates
watch = Watch(byXY)
