# Dynamo graph Geometry.Vector.Actions.dyn (Dynamo 0.7.5.3566)

code_block = CodeBlock { 1; }
byCoordinates = Point.ByCoordinates(code_block)
double_slider = DoubleSlider(0.284, range=0..1)
double_slider_2 = DoubleSlider(0.609, range=0..1)
double_slider_3 = DoubleSlider(0, range=0..1)
boolean = BoolSelector(true)
byCoordinates_2 = Vector.ByCoordinates(double_slider, double_slider_2, double_slider_3, boolean)
origin = Point.Origin()
YAxis = Vector.YAxis()
byOriginNormal = Plane.ByOriginNormal(origin, YAxis)
intersectionWithPlane = Custom[Vector.IntersectionWithPlane](Vector_Basepoint_s=byCoordinates, Vector_s=byCoordinates_2, Plane=byOriginNormal)  # Finds the intersection point between a plane and a vector
watch = Watch(intersectionWithPlane)
intersectionWithVector = Custom[Vector.IntersectionWithVector](Basepoint_1=byCoordinates, Vector_1=byCoordinates_2, Basepoint_2=origin, Vector_2=YAxis)  # Determines if two vectors intersect and returns the closest points of intersection on both vectors.
watch_2 = Watch(intersectionWithVector.Vectors_intersect)
watch_3 = Watch(intersectionWithVector.Average_Point)
watch_4 = Watch(intersectionWithVector.Closest_point_on_Vector_2)
watch_5 = Watch(intersectionWithVector.Closest_point_on_Vector_1)
code_block_2 = CodeBlock { 5; }
byStartPointDirectionLength = Line.ByStartPointDirectionLength(byCoordinates, byCoordinates_2, code_block_2)
create = List.Create(byOriginNormal, byStartPointDirectionLength, intersectionWithPlane)
watch_3d = Watch3D(create)
byStartPointDirectionLength_2 = Line.ByStartPointDirectionLength(byCoordinates, byCoordinates_2, code_block_2)
byStartPointDirectionLength_3 = Line.ByStartPointDirectionLength(origin, YAxis, code_block_2)
create_2 = List.Create(byStartPointDirectionLength_2, byStartPointDirectionLength_3, intersectionWithVector.Average_Point)
watch_3d_2 = Watch3D(create_2)
code_block_3 = CodeBlock { 0.9..1.1..#5; }
code_block_4 = CodeBlock { 0.9..1.1..#5; }
byCoordinates_3 = Vector.ByCoordinates(code_block_3, code_block_4, lacing=CrossProduct)
flatten = Flatten(byCoordinates_3)
watch_6 = Watch(flatten)
count = List.Count(watch_6)
watch_7 = Watch(count)
double_slider_4 = DoubleSlider(0.06291571081, range=0..0.25)
pruneDuplicates = Custom[Vector.PruneDuplicates](Vectors=watch_6, Tolerance=double_slider_4)  # Prune vectors to exclude duplicates within a given tolerance
count_2 = List.Count(pruneDuplicates)
watch_8 = Watch(count_2)
double_slider_5 = DoubleSlider(0.4425269165, range=-1..1)
double_slider_6 = DoubleSlider(0.5428332845, range=-1..1)
double_slider_7 = DoubleSlider(-1, range=-1..1)
boolean_2 = BoolSelector(true)
byCoordinates_4 = Vector.ByCoordinates(double_slider_5, double_slider_6, double_slider_7, boolean_2)
watch_9 = Watch(byCoordinates_4)
ZAxis = Vector.ZAxis()
watch_10 = Watch(ZAxis)
correctOrientation = Custom[Normal.CorrectOrientation](a=watch_9, b=watch_10)  # Inverts normal A if its inversion is closer to normal B
watch_11 = Watch(correctOrientation)
origin_2 = Point.Origin()
byStartPointDirectionLength_4 = Line.ByStartPointDirectionLength(origin_2, watch_9, code_block_2)
byStartPointDirectionLength_5 = Line.ByStartPointDirectionLength(origin_2, watch_10, code_block_2)
byStartPointDirectionLength_6 = Line.ByStartPointDirectionLength(origin_2, correctOrientation, code_block_2)
create_3 = List.Create(byStartPointDirectionLength_4, byStartPointDirectionLength_5, byStartPointDirectionLength_6)
watch_3d_3 = Watch3D(create_3)
