# Dynamo graph Geometry.Vector.Create.dyn (Dynamo 0.7.5.3566)

YAxisNegative = Custom[Vector.YAxisNegative]()  # Returns an XYZ of 0,-1,0
watch = Watch(YAxisNegative)
XAxisNegative = Custom[Vector.XAxisNegative]()  # Returns an XYZ of -1,0,0
watch_2 = Watch(XAxisNegative)
ZAxisNegative = Custom[Vector.ZAxisNegative]()  # Returns an XYZ of 0,0,-1
watch_3 = Watch(ZAxisNegative)
double_slider = DoubleSlider(0.884, range=0..1)
double_slider_2 = DoubleSlider(0.474, range=0..1)
double_slider_3 = DoubleSlider(0.59, range=0..1)
boolean = BoolSelector(false)
byCoordinates = Vector.ByCoordinates(double_slider, double_slider_2, double_slider_3, boolean)
watch_4 = Watch(byCoordinates)
fromVector = Custom[XYZAxis.FromVector](Vector=watch_4)  # Returns whichever main axis (X, Y or Z) is closest to a given vector
watch_5 = Watch(fromVector)
double_slider_4 = DoubleSlider(0.47, range=0..1)
double_slider_5 = DoubleSlider(0.782, range=0..1)
double_slider_6 = DoubleSlider(0.59, range=0..1)
boolean_2 = BoolSelector(false)
byCoordinates_2 = Vector.ByCoordinates(double_slider_4, double_slider_5, double_slider_6, boolean_2)
watch_6 = Watch(byCoordinates_2)
byTwoVectors = Custom[ThirdXYZAxis.ByTwoVectors](Axis_1=watch_6, Axis_2=watch_4)  # Given two main XYZ axes (or vectors pointing more or less in thei general direction), this node will find the third axis.
watch_7 = Watch(byTwoVectors.string)
watch_8 = Watch(byTwoVectors.Vector)
double_slider_7 = DoubleSlider(2.283794018, range=0..10)
double_slider_8 = DoubleSlider(4.419, range=0..10)
byCoordinates_3 = Point.ByCoordinates(double_slider_7, double_slider_8)
watch_9 = Watch(byCoordinates_3)
origin = Point.Origin()
double_slider_9 = DoubleSlider(-5.653393753, range=-10..0)
double_slider_10 = DoubleSlider(4.419, range=0..10)
byCoordinates_4 = Point.ByCoordinates(double_slider_9, double_slider_10)
watch_10 = Watch(byCoordinates_4)
byPoints = Custom[AngleBisector.ByPoints](Point_A=watch_9, Point_B=origin, Point_C=watch_10)  # Retrieves the vector of an angle bisector at point B based on three points (A, B, C) that define the angle.
watch_11 = Watch(byPoints)
fromVector_2 = Custom[XYZAxis.FromVector](Vector=watch_6)
watch_12 = Watch(fromVector_2)
code_block = CodeBlock { 5; }
byStartPointDirectionLength = Line.ByStartPointDirectionLength(origin, byPoints, code_block)
create = List.Create(watch_9, origin, watch_10, byStartPointDirectionLength)
watch_3d = Watch3D(create)
