# Dynamo graph Geometry.Vector.Query.dyn (Dynamo 0.7.5.3566)

double_slider = DoubleSlider(1, range=0..1)
double_slider_2 = DoubleSlider(1, range=0..1)
double_slider_3 = DoubleSlider(0, range=0..1)
boolean = BoolSelector(true)
byCoordinates = Vector.ByCoordinates(double_slider, double_slider_2, double_slider_3, boolean)
watch = Watch(byCoordinates)
altitudeAndAzimuth = Custom[Vector.AltitudeAndAzimuth](Vector=watch)  # Computes the altitude and azimuth of a given vector
watch_2 = Watch(altitudeAndAzimuth.Altitude)
watch_3 = Watch(altitudeAndAzimuth.Azimuth)
XAxis = Vector.XAxis()
YAxis = Vector.YAxis()
create = List.Create(XAxis, YAxis)
watch_4 = Watch(create)
average = Custom[Vector.Average](Vectors=watch_4)  # Determines the average vector of a list of vectors
watch_5 = Watch(average)
origin = Point.Origin()
ZAxis = Vector.ZAxis()
byOriginNormal = Plane.ByOriginNormal(origin, ZAxis)
watch_6 = Watch(byOriginNormal)
isInPlane = Custom[Vector.IsInPlane](Vector_Basepoint=origin, Vector=watch, Plane=watch_6)  # Checks if a given vector is located on a given plane
watch_7 = Watch(isInPlane)
isOrthogonalToVector = Custom[Vector.IsOrthogonalToVector](Vector_1=watch, Vector_2=YAxis)  # Checks if two vectors are orthogonal to each other
watch_8 = Watch(isOrthogonalToVector)
isParallelToPlane = Custom[Vector.IsParallelToPlane](Vector=watch, Plane=watch_6)  # Checks if a given vector is parallel to a given plane
watch_9 = Watch(isParallelToPlane)
