# Dynamo graph Paneling.Patterns.Hexagonal.dyn (Dynamo 0.7.5.3566)

# note: Run this graph on the Paneling_Sample model in the extra folder.
select_face = DSFaceSelection()  # 1 picked in the model
firstItem = List.FirstItem(select_face)
integer_slider = IntegerSlider(9, range=0..20)
integer_slider_2 = IntegerSlider(12, range=0..20)
gridFromFace = Custom[Paneling.GridFromFace](face=firstItem, U=integer_slider, V=integer_slider_2)  # Returns UV coordinates, XYZ coordinates and normals for a face with UV subdivision
boolean = BoolSelector(false)
integer_slider_3 = IntegerSlider(1, range=0..5)
boolean_2 = BoolSelector(false)
integer_slider_4 = IntegerSlider(2, range=0..5)
boolean_3 = BoolSelector(false)
hexagonal = Custom[Paneling.Hexagonal](list=gridFromFace.Points, V=integer_slider_2, ReverseOddRows=boolean, ShiftPlacementOddRows=integer_slider_3, ReverseEvenRows=boolean_2, ShiftPlacementEvenRows=integer_slider_4, RotateGridBy90Degrees=boolean_3)
family_types = FamilyTypes("6Point-AC:Type 1")
byPoints = AdaptiveComponent.ByPoints(hexagonal.Odd_Rows, family_types)
family_types_2 = FamilyTypes("6Point-AC:Type 2")
byPoints_2 = AdaptiveComponent.ByPoints(hexagonal.Even_Rows, family_types_2)
