# Dynamo graph Paneling.Patterns.Quadrilateral2byX.dyn (Dynamo 0.7.5.3566)

# note: Run this graph on the Paneling_Sample model in the extra folder.
select_face = DSFaceSelection()  # 1 picked in the model
firstItem = List.FirstItem(select_face)
integer_slider = IntegerSlider(5, range=0..20)
integer_slider_2 = IntegerSlider(9, range=0..20)
gridFromFace = Custom[Paneling.GridFromFace](face=firstItem, U=integer_slider, V=integer_slider_2)  # Returns UV coordinates, XYZ coordinates and normals for a face with UV subdivision
integer_slider_3 = IntegerSlider(3, range=0..20)
boolean = BoolSelector(false)
integer_slider_4 = IntegerSlider(0, range=0..3)
boolean_2 = BoolSelector(true)
quadrilateral2byX = Custom[Paneling.Quadrilateral2byX](seq=gridFromFace.UVs, V=integer_slider_2, X=integer_slider_3, reversePattern=boolean, shiftPattern=integer_slider_4, rotateGridby90Degrees=boolean_2)
watch = Watch(quadrilateral2byX)
family_types = FamilyTypes("6Point-AC_2x3:6Point-AC_2x3")
byParametersOnFace = AdaptiveComponent.ByParametersOnFace(watch, firstItem, family_types)
