# Dynamo graph Paneling.Patterns.TriangularFlatDiagonal.dyn (Dynamo 0.7.5.3566)

# note: Run this graph on the Paneling_Sample model in the extra folder.
select_face = DSFaceSelection()  # 1 picked in the model
firstItem = List.FirstItem(select_face)
integer_slider = IntegerSlider(9, range=0..20)
integer_slider_2 = IntegerSlider(11, range=0..20)
gridFromFace = Custom[Paneling.GridFromFace](face=firstItem, U=integer_slider, V=integer_slider_2)  # Returns UV coordinates, XYZ coordinates and normals for a face with UV subdivision
boolean = BoolSelector(false)
boolean_2 = BoolSelector(false)
integer_slider_3 = IntegerSlider(0, range=0..2)
integer_slider_4 = IntegerSlider(0, range=0..2)
integer_slider_5 = IntegerSlider(0, range=0..2)
boolean_3 = BoolSelector(false)
triangularFlatDiagonal = Custom[Paneling.TriangularFlatDiagonal](list=gridFromFace.UVs, V=integer_slider_2, reverse_triangle_A=boolean, reverse_triangle_B=boolean_2, shift_placement_triangle_A=integer_slider_3, shift_placement_triangle_B=integer_slider_4, shift_overall_placement=integer_slider_5, rotate_grid_by_90=boolean_3)  # Creates groups of points from a list of UVs or XYZs for the placement of triangular panels. The placement pattern can be reversed (boolean) and shifted (integer).
watch = Watch(triangularFlatDiagonal.list_triangle_A)
family_types = FamilyTypes("3PointACByOffset_VarA:Type 1")
byParametersOnFace = AdaptiveComponent.ByParametersOnFace(watch, firstItem, family_types)
watch_2 = Watch(triangularFlatDiagonal.list_triangle_B)
family_types_2 = FamilyTypes("3PointACByOffset_VarA:Type 2")
byParametersOnFace_2 = AdaptiveComponent.ByParametersOnFace(watch_2, firstItem, family_types_2)
