# Dynamo graph Revit.Application.dyn (Dynamo 0.7.5.3566)

# note: You can use the Sample Architecture Project (Basic) that ships with Revit to run this graph.
version = Custom[Application.Version]()  # Retrieves the name, version and build of the current Revit application.
watch = Watch(version.Version_int)
categories = Categories("Walls")
all_elements_of_category = ElementsOfCategory(categories)
firstItem = List.FirstItem(all_elements_of_category)
members = Custom[Object.Members](element_s=firstItem)  # Gets a list of all members (properties and methods) of a selected element
watch_2 = Watch(members)
watch_3 = Watch(version.Build)
string = StringInput("Material")
membersByName = Custom[Object.MembersByName](search_term=string, Element_s=firstItem)  # Looks up all the members of a given element based on a given name (or part of a name) of the property or method. Search is case-insensitive.
watch_4 = Watch(membersByName)
watch_5 = Watch(version.Name)
