# Dynamo graph Revit.Document.Actions.dyn (Dynamo 0.7.5.3566)

# note: You can use the Sample Architecture Project (Basic) that ships with Revit to run this graph.
directory_path = Directory("C:\Users\adieckmann\Desktop")
string = StringInput("\test")
code_block = CodeBlock(dir=directory_path, path=string) { dir + path; }
saveAs = Custom[Document.SaveAs](filename=code_block)  # Saves the active Revit document under the given name.
watch = Watch(saveAs)
