# Dynamo graph Revit.Document.Query.dyn (Dynamo 0.7.5.3566)

categories = Categories("Walls")
categories_2 = Categories("Roofs")
categories_3 = Categories("Fascia")
create = List.Create(categories, categories_2, categories_3)
containsElementsOfCategory = Custom[Document.ContainsElementsOfCategory](Categories=create)  # Checks if family instances of specified categories are present in the model.
watch = Watch(containsElementsOfCategory.any)
watch_2 = Watch(containsElementsOfCategory.all)
watch_3 = Watch(containsElementsOfCategory.per_category)
watch_4 = Watch(containsElementsOfCategory.instances)
# note: You can use the Sample Architecture Project (Basic) that ships with Revit to run this graph.
activeViewFromCurrentDocument = Custom[Document.ActiveViewFromCurrentDocument]()  # Gets the active view of the current document
watch_5 = Watch(activeViewFromCurrentDocument)
dimensionTypes = Custom[Document.DimensionTypes]()  # Retrieves all dimension types from the document
watch_6 = Watch(dimensionTypes)
isWorkshared = Custom[Document.IsWorkshared]()  # Returns true if the current project is workshared
watch_7 = Watch(isWorkshared)
linksAndImports = Custom[Document.LinksAndImports]()  # Gets all linked and imported files in the document. NOTE: Does *not* retrieve linked Revit files.
watch_8 = Watch(linksAndImports.links)
watch_9 = Watch(linksAndImports.imports)
listBuiltInCategories = Custom[Document.ListBuiltInCategories]()  # List all the available BuiltInCategories
watch_10 = Watch(listBuiltInCategories)
listBuiltInParameters = Custom[Document.ListBuiltInParameters]()  # List all the available BuiltInParameters
watch_11 = Watch(listBuiltInParameters)
string = StringInput("Wall")
listBuiltInParametersByName = Custom[Document.ListBuiltInParametersByName](search_term=string)  # Looks up all the built-in parameters based on a given name (or part of a name) of the parameters. Search is case-insensitive.
watch_12 = Watch(listBuiltInParametersByName)
path = Custom[Document.Path]()  # Gets the path and directory of the current Revit document
watch_13 = Watch(path.path)
watch_14 = Watch(path.directory)
listBuiltInCategoriesByName = Custom[Document.ListBuiltInCategoriesByName](search_term=string)  # Looks up all the built-in categories based on a given name (or part of a name) of the category. Search is case-insensitive.
watch_15 = Watch(listBuiltInCategoriesByName)
projectInfo = Custom[Document.ProjectInfo]()  # Gets the project information.
watch_16 = Watch(projectInfo.Author)
watch_17 = Watch(projectInfo.Number)
watch_18 = Watch(projectInfo.Name)
watch_19 = Watch(projectInfo.Address)
watch_20 = Watch(projectInfo.OrganizationDescription)
watch_21 = Watch(projectInfo.BuildingName)
watch_22 = Watch(projectInfo.IssueDate)
watch_23 = Watch(projectInfo.ClientName)
watch_24 = Watch(projectInfo.Status)
watch_25 = Watch(projectInfo.OrganizationName)
projectPosition = Custom[Document.ProjectPosition]()  # Gets the project's position data relative to the origin. Use the built-in nodes Location.Latitude & Location.Longitude to retrieve latitude and longitude.
watch_26 = Watch(projectPosition.Angle_degr)
watch_27 = Watch(projectPosition.Elevation)
watch_28 = Watch(projectPosition.EastWest)
watch_29 = Watch(projectPosition.NorthSouth)
designOptions = Custom[Document.DesignOptions]()  # Returns all design options in the model, grouped by design option set
watch_30 = Watch(designOptions.DesignOptionSets)
watch_31 = Watch(designOptions.DesignOptions)
phases = Custom[Document.Phases]()  # Retrieves all phases in the active document in *chronological* order
watch_32 = Watch(phases)
startingView = Custom[Document.StartingView]()  # Retrieves the starting view of a Project file. Returns null if no starting view is set.
watch_33 = Watch(startingView)
views = Custom[Document.Views]()  # Gets all views in the document - except for 3D view templates (as long as this bug is not fixed: https://github.com/DynamoDS/Dynamo/issues/2970)
watch_34 = Watch(views)
