# Dynamo graph Revit.Elements.BoundingBox.dyn (Dynamo 0.7.5.3566)

# note: You can use the Sample Architecture Project (Basic) that ships with Revit to run this graph.

categories = Categories("Walls")
all_elements_of_category = ElementsOfCategory(categories)
watch = Watch(all_elements_of_category)
firstItem = List.FirstItem(watch)
views = Views("{3D}")
byElement = Custom[BoundingBox.ByElement](Element_s=firstItem, View=views)  # Gets the bounding box of a Revit element
watch_2 = Watch(byElement.Revit_Bounding_Box_es)
watch_3 = Watch(byElement.Bottom_left_rear_corner)
watch_4 = Watch(byElement.Top_right_front_corner)
count = List.Count(watch)
code_block = CodeBlock(n=count) { n/3; }
chop = List.Chop(watch, code_block)
byNestedListOfElements = Custom[BoundingBox.ByNestedListOfElements](Element_s=chop, View=views)  # Retrieves a bounding box for each sublist of elements
watch_5 = Watch(byNestedListOfElements.Top_right_front_corners)
watch_6 = Watch(byNestedListOfElements.Bottom_left_rear_corners)
watch_7 = Watch(byNestedListOfElements.Revit_Bounding_Box_es)
watch_8 = Watch(byNestedListOfElements.Dynamo_Bounding_Box_es)
toCuboid = BoundingBox.ToCuboid(watch_8)
watch_3d = Watch3D(toCuboid)
watch_9 = Watch(byElement.Dynamo_Bounding_Box_es)
toCuboid_2 = BoundingBox.ToCuboid(watch_9)
watch_3d_2 = Watch3D(toCuboid_2)
fromDynamoBoundingBox = Custom[RevitBoundingBox.FromDynamoBoundingBox](Dynamo_Bounding_Box_es=watch_9)  # Turns a Dynamo bounding box into a Revit bounding box.
watch_10 = Watch(fromDynamoBoundingBox)
