# Dynamo graph Revit.Elements.Category.dyn (Dynamo 0.7.5.3566)

categories = Categories("Lines")
subcategories = Custom[Category.Subcategories](Categories=categories)  # Retrieves all the subcategories for a given category
watch = Watch(subcategories)
