# Dynamo graph Revit.Elements.Color.dyn (Dynamo 0.7.5.3566)

integer_slider = IntegerSlider(255, range=0..255)
integer_slider_2 = IntegerSlider(0, range=0..255)
integer_slider_3 = IntegerSlider(0, range=0..255)
byARGB = Color.ByARGB(arg1=integer_slider, arg2=integer_slider_2, arg3=integer_slider_3)
watch = Watch(byARGB)
fromDynamoColor = Custom[RevitColor.FromDynamoColor](Dynamo_Color_s=watch)  # Creates a Revit color from a Dynamo color
watch_2 = Watch(fromDynamoColor)
toDynamoColor = Custom[RevitColor.ToDynamoColor](Color_Revit=watch_2)  # Converts Revit colors into Dynamo colors
watch_3 = Watch(toDynamoColor)
white = Custom[Color.White]()  # Returns the colour white.
code_block = CodeBlock { 0; }
color_range = ColorRange(watch, white, code_block)
color_range_2 = ColorRange(toDynamoColor, white, code_block)
