# Dynamo graph Revit.Elements.CurtainPanel.dyn (Dynamo 0.7.5.3566)

categories = Categories("CurtainWallPanels")
all_elements_of_category = ElementsOfCategory(categories)
watch = Watch(all_elements_of_category)
hostPanel = Custom[CurtainPanel.HostPanel](Curtain_Panel_s=watch)  # Retrieves the host panel of a given curtain panel. This is typcially needed when wanting to access wall elements used as curtain panels.
watch_2 = Watch(hostPanel)
