# Dynamo graph Revit.Elements.DesignOption.dyn (Dynamo 0.7.5.3566)

designOptions = Custom[Document.DesignOptions]()  # Returns all design options in the model, grouped by design option set
watch = Watch(designOptions.DesignOptions)
designOptionSet = Custom[DesignOption.DesignOptionSet](DesignOption_s=watch)  # Returns the design option set of a given design option
watch_2 = Watch(designOptionSet)
