# Dynamo graph Revit.Elements.DetailComponent.dyn (Dynamo 0.7.5.3566)

# note: Run this file on the DetailComponent_Sample model in the extra folder.
code_block = CodeBlock { 5; }
byWidthHeight = Rectangle.ByWidthHeight(code_block, code_block)
explode = Geometry.Explode(byWidthHeight)
family_types = FamilyTypes("M_Protection Board-Section:19mm")
views = Views("Ebene 0")
byCurve = Custom[DetailComponent.ByCurve](Curve_s=explode, Family_Type=family_types, View=views)  # Places a line-based detail component in a given view
watch = Watch(byCurve)
