# Dynamo graph Revit.Elements.DetailCurve.dyn (Dynamo 0.7.5.3566)

code_block = CodeBlock { 5; }
byWidthHeight = Rectangle.ByWidthHeight(code_block, code_block)
explode = Geometry.Explode(byWidthHeight)
views = Views("Level 1")
fromCurve = Custom[DetailCurve.FromCurve](Curve_s=explode, View=views)  # Creates a detail line based on a given curve
watch = Watch(fromCurve)
