# Dynamo graph Revit.Elements.Dimension.dyn (Dynamo 0.7.5.3566)

categories = Categories("Dimensions")
all_elements_of_category = ElementsOfCategory(categories)
dimensionTypes = Custom[Document.DimensionTypes]()  # Retrieves all dimension types from the document
# note: Run this file on the Dimension_Sample model in the extra folder.
name = Element.Name(dimensionTypes)
code_block = CodeBlock { "7.0mm - Arial"; }
eq = name == code_block
filterByBoolMask = List.FilterByBoolMask(dimensionTypes, eq)
firstItem = List.FirstItem(filterByBoolMask)
setType = Custom[Dimension.SetType](Dimension_Instance_s=all_elements_of_category, Dimension_Type=firstItem)  # Changes the dimension type of a given dimension instance to the specified type
watch = Watch(setType.success)
watch_2 = Watch(setType.failed)
