# Dynamo graph Revit.Elements.DimensionType.dyn (Dynamo 0.7.5.3566)

# note: You can use the Sample Architecture Project (Basic) that ships with Revit to run this graph.
categories = Categories("Dimensions")
all_elements_of_category = ElementsOfCategory(categories)
type = Custom[Element.Type](Element_s=all_elements_of_category)  # Gets the family type of a given element (if applicable).
watch = Watch(type)
style = Custom[DimensionType.Style](Dimension_Type_s=watch)  # Gets the style of a given Revit dimension type
watch_2 = Watch(style)
