# Dynamo graph Revit.Elements.DividedSurface.Actions.dyn (Dynamo 0.7.5.3566)

select_face = DSFaceSelection()  # 1 picked in the model
firstItem = List.FirstItem(select_face)
code_block = CodeBlock { 1; }
byFaceAndUVDivisions = DividedSurface.ByFaceAndUVDivisions(firstItem, code_block, code_block)
vertices = Custom[Surface.Vertices](Surface_s=firstItem)  # Returns all vertices of a given surface
Z = Point.Z(vertices)
code_block_2 = CodeBlock(z=Z) { z==0; }
filterByBoolMask = List.FilterByBoolMask(vertices, code_block_2)
code_block_3 = CodeBlock(seq=filterByBoolMask) { seq[0]; seq[1]; }
integer_slider = IntegerSlider(8, range=0..20)
verticalIntersectsByEndpoints = Custom[DividedSurface.VerticalIntersectsByEndpoints](DivSurf=byFaceAndUVDivisions, Start_point=code_block_3.out1, End_point=code_block_3.out0, Subdivisions=integer_slider)  # Creates a number of equally spaced vertical intersects for a divided surface based on the path between between two points. You may need to switch start point and end point.
watch = Watch(verticalIntersectsByEndpoints.DivSurf)
Z_2 = Point.Z()
minimumItemByKey = MinimumItemByKey(vertices, Z_2)
maximumItemByKey = MaximumItemByKey(vertices, Z_2)
# note: Run this graph on the DividedSurface_Sample model in the extra folder.
code_block_4 = CodeBlock { "HorizontalIntersect_0"; }
horizontalIntersectsByEndpoints = Custom[DividedSurface.HorizontalIntersectsByEndpoints](DivSurf=byFaceAndUVDivisions, Startpoint=minimumItemByKey, Endpoint=maximumItemByKey, Subdivisions=integer_slider, Intersect_Name=code_block_4)  # Creates a number of equally spaced horizontal intersects for a divided surface based on the path between between two points.
watch_2 = Watch(horizontalIntersectsByEndpoints.DivSurf)
watch_3 = Watch(horizontalIntersectsByEndpoints.Intersects)
watch_4 = Watch(verticalIntersectsByEndpoints.Intersects)
select_face_2 = DSFaceSelection()  # 1 picked in the model
firstItem_2 = List.FirstItem(select_face_2)
byFaceAndUVDivisions_2 = DividedSurface.ByFaceAndUVDivisions(firstItem_2, code_block, code_block)
vertices_2 = Custom[Surface.Vertices](Surface_s=firstItem_2)
Z_3 = Point.Z(vertices_2)
code_block_5 = CodeBlock(z=Z_3) { z==0; }
filterByBoolMask_2 = List.FilterByBoolMask(vertices_2, code_block_5)
code_block_6 = CodeBlock(seq=filterByBoolMask_2) { seq[0]; seq[1]; }
formula = Formula("Sin(x*Pi/2)")
verticalIntersectsByEndpointsAndFunction = Custom[DividedSurface.VerticalIntersectsByEndpointsAndFunction](DivSurf=byFaceAndUVDivisions_2, Start_point=code_block_6.out1, End_point=code_block_6.out0, Subdivisions=integer_slider, f_x=formula)  # Creates a number of vertical intersects (reference planes) for a divided surface based on the path between between two points. The spacing can be controlled by a function. You may need to switch start point and end point.
watch_5 = Watch(verticalIntersectsByEndpointsAndFunction.Intersects)
watch_6 = Watch(verticalIntersectsByEndpointsAndFunction.DivSurf)
minimumItemByKey_2 = MinimumItemByKey(vertices_2, Z_2)
maximumItemByKey_2 = MaximumItemByKey(vertices_2, Z_2)
code_block_7 = CodeBlock { "HorizontalIntersectBYFunction_0"; }
integer_slider_2 = IntegerSlider(4, range=0..10)
formula_2 = Formula("atan(x*n)/atan(n)", n=integer_slider_2)
horizontalIntersectsByEndpointsAndFuncti = Custom[DividedSurface.HorizontalIntersectsByEndpointsAndFunction](DivSurf=byFaceAndUVDivisions_2, Startpoint=minimumItemByKey_2, Endpoint=maximumItemByKey_2, Subdivisions=integer_slider, Intersect_Name=code_block_7, f_x=formula_2)  # Creates a number of horizontal intersects (levels)for a divided surface based on the path between two points. The spacing of the intersects can be controlled by a function.
watch_7 = Watch(horizontalIntersectsByEndpointsAndFuncti.Intersects)
watch_8 = Watch(horizontalIntersectsByEndpointsAndFuncti.DivSurf)
select_model_element = DSModelElementSelection()  # 1 picked in the model
addIntersect = Custom[DividedSurface.AddIntersect](DivSurf=byFaceAndUVDivisions_2, Element_s=select_model_element)  # Adds an intersect to a divided surface
watch_9 = Watch(addIntersect)
