# Dynamo graph Revit.Elements.DoorOrWindow.dyn (Dynamo 0.7.5.3566)

# note: You can use the Sample Architecture Project (Basic) that ships with Revit to run this graph.
categories = Categories("Doors")
all_elements_of_category = ElementsOfCategory(categories)
watch = Watch(all_elements_of_category)
element_types = ElementTypes("Phase")
all_elements_of_type = ElementsOfType(element_types)
code_block = CodeBlock { "Working Drawings"; }
boolean = BoolSelector(true)
all_elements_of_name = Custom[All Elements Of Name](Elements=all_elements_of_type, Search_string=code_block, Ignore_case=boolean)  # Retrieves those elements from a collection whose names match the search string
watch_2 = Watch(all_elements_of_name.first)
exitsToOneRoomOnly = Custom[DoorOrWindow.ExitsToOneRoomOnly](Doors_Windows=watch, Phase=watch_2)  # Evaluates if a door or window has only set one of the ToRoom / FromRoom properties. This may help to determine whether a door/window is external.
watch_3 = Watch(exitsToOneRoomOnly)
fromRoomAndToRoom = Custom[DoorOrWindow.FromRoomAndToRoom](Door_s_Window_s=watch, Phase=watch_2)  # Gets the rooms that are connected by a given door or a window
watch_4 = Watch(fromRoomAndToRoom.From_Room_s)
watch_5 = Watch(fromRoomAndToRoom.To_Room_s)
