# Dynamo graph Revit.Elements.ElementType.dyn (Dynamo 0.7.5.3566)

family_types = FamilyTypes("4500_Kitchen Island:4500_Kitchen Island")
code_block = CodeBlock { "Dynamo made this family type!"; }
duplicate = Custom[ElementType.Duplicate](Element_Type_s=family_types, Name_s=code_block)  # Duplicates an element type
watch = Watch(duplicate)
