# Dynamo graph Revit.Elements.FamilyType.dyn (Dynamo 0.7.5.3566)

# note: You can use the Sample Architecture Project (Basic) that ships with Revit to run this graph.

element_types = ElementTypes("WallType")
all_elements_of_type = ElementsOfType(element_types)
watch = Watch(all_elements_of_type)
firstItem = List.FirstItem(watch)
compoundStructureLayers = Custom[FamilyType.CompoundStructureLayers](Element_Type_s=firstItem)  # Retrieves the compound layers of any layered family type (wall types, roof types, floor types etc.)
watch_2 = Watch(compoundStructureLayers.Materials)
watch_3 = Watch(compoundStructureLayers.Wraps)
watch_4 = Watch(compoundStructureLayers.Layers)
watch_5 = Watch(compoundStructureLayers.Is_Structural_Deck)
watch_6 = Watch(compoundStructureLayers.Is_Variable)
watch_7 = Watch(compoundStructureLayers.Is_Core)
watch_8 = Watch(compoundStructureLayers.Widths)
watch_9 = Watch(compoundStructureLayers.Functions)
code_block = CodeBlock { 1; }
categories = Categories("Materials")
all_elements_of_category = ElementsOfCategory(categories)
code_block_2 = CodeBlock { "Aluminium"; }
boolean = BoolSelector(true)
filterByName = Custom[Elements.FilterByName](Elements=all_elements_of_category, Search_string=code_block_2, Ignore_case=boolean)  # Retrieves those elements from a collection whose names match the search string
setCompoundLayerMaterial = Custom[FamilyType.SetCompoundLayerMaterial](Family_Type=firstItem, Layer_Index=code_block, Material=filterByName.first)  # Sets the material of a specified compound layer of a given family type (only applies to family types that have a compound structure, e.g. walls, floors etc.).
watch_10 = Watch(setCompoundLayerMaterial.Success)
watch_11 = Watch(setCompoundLayerMaterial.Family_Type)
