# Dynamo graph Revit.Elements.Group.dyn (Dynamo 0.7.5.3566)

# note: You can use the Sample Architecture Project (Basic) that ships with Revit to run this graph.
element_types = ElementTypes("Group")
all_elements_of_type = ElementsOfType(element_types)
watch = Watch(all_elements_of_type)
members = Custom[Group.Members](Group_s=watch)  # Retrieves the members of a group
watch_2 = Watch(members)
