# Dynamo graph Revit.Elements.Level.dyn (Dynamo 0.7.5.3566)

# note: You can use the Sample Architecture Project (Basic) that ships with Revit to run this graph.
categories = Categories("Levels")
all_elements_of_category = ElementsOfCategory(categories)
watch = Watch(all_elements_of_category)
plane = Custom[Level.Plane](Level_s=watch)  # Retrieves the plane of a given level
watch_2 = Watch(plane)
