# Dynamo graph Revit.Elements.ModelCurve.dyn (Dynamo 0.7.5.3566)

code_block = CodeBlock { 4; }
byWidthHeight = Rectangle.ByWidthHeight(code_block, code_block)
curves = PolyCurve.Curves(byWidthHeight)
origin = Point.Origin()
ZAxis = Vector.ZAxis()
byOriginNormal = Plane.ByOriginNormal(origin, ZAxis)
byPlane = SketchPlane.ByPlane(byOriginNormal)
views = Views("Ebene 0")
fromCurve = Custom[RoomSeparator.FromCurve](Curve_s=curves, Sketch_plane=byPlane, View=views)  # Creates room separation lines from geometry curves.
watch = Watch(fromCurve)
# note: Run this graph on the ModelCurve_Sample file in the extra folder.
element_types = ElementTypes("ViewPlan")
all_elements_of_type = ElementsOfType(element_types)
typeIsAreaPlan = Custom[View.TypeIsAreaPlan]()  # Checks whether a given view is an area plan.
filter = List.Filter(all_elements_of_type, typeIsAreaPlan)
firstItem = List.FirstItem(filter)
watch_2 = Watch(firstItem)
fromCurve_2 = Custom[AreaSeparator.FromCurve](Curve_s=curves, Sketch_plane=byPlane, AreaPlan_view=watch_2)  # Creates area separation lines from geometry curves.
watch_3 = Watch(fromCurve_2)
fromCurve_3 = Custom[SpaceSeparator.FromCurve](Curve_s=curves, Sketch_plane=byPlane, View=views)  # Creates space separation lines from geometry curves.
watch_4 = Watch(fromCurve_3)
