# Dynamo graph Revit.Elements.RevisionCloud.dyn (Dynamo 0.7.5.3566)

categories = Categories("Stairs")
all_elements_of_category = ElementsOfCategory(categories)
create = List.Create(all_elements_of_category)
watch = Watch(create)
element_types = ElementTypes("Revision")
all_elements_of_type = ElementsOfType(element_types)
lastItem = List.LastItem(all_elements_of_type)
watch_2 = Watch(lastItem)
views = Views("Level 1")
fromNestedListOfElements = Custom[RevisionCloud.FromNestedListOfElements](Element_s=watch, Revision=watch_2, View=views)  # Create a revision cloud for each nested list of Revit elements
watch_3 = Watch(fromNestedListOfElements)
# note: You can use the Sample Architecture Project (Basic) that ships with Revit to run this graph.
code_block = CodeBlock { {0,2,2,0}; {0,0,2,2}; }
byCoordinates = Point.ByCoordinates(code_block.out0, code_block.out1)
boolean = BoolSelector(true)
byPoints = PolyCurve.ByPoints(byCoordinates, boolean)
curves = PolyCurve.Curves(byPoints)
create_2 = List.Create(curves)
watch_4 = Watch(create_2)
fromCurves = Custom[RevisionCloud.FromCurves](Curves=watch_4, Revision=watch_2, View=views)  # Creates revision clouds from nested lists of geometry curves.
watch_5 = Watch(fromCurves)
