# Dynamo graph Revit.Elements.Roof.dyn (Dynamo 0.7.5.3566)

# note: You can use the Sample Architecture Project (Basic) that ships with Revit to run this graph.
categories = Categories("Roofs")
all_elements_of_category = ElementsOfCategory(categories)
watch = Watch(all_elements_of_category)
kindIsGlazed = Custom[Roof.KindIsGlazed](Roof_Instance_s=watch)  # Checks whether a given roof is a Glazed Roof. PLEASE NOTE: Does not work correctly for roofs that were created by face
watch_2 = Watch(kindIsGlazed)
kindIsBasic = Custom[Roof.KindIsBasic](Roof_Instance_s=watch)  # Checks whether a given roof is a Basic Roof. PLEASE NOTE: Does not work correctly for roofs that were created by face
watch_3 = Watch(kindIsBasic)
creationMethodIsByExtrusion = Custom[Roof.CreationMethodIsByExtrusion](Roof_Instance_s=watch)  # Checks whether the creation method of a given roof is 'By Extrusion'
watch_4 = Watch(creationMethodIsByExtrusion)
creationMethodIsByFace = Custom[Roof.CreationMethodIsByFace](Roof_Instance_s=watch)  # Checks whether the creation method of a given roof is 'By Face'
watch_5 = Watch(creationMethodIsByFace)
creationMethodIsByFootprint = Custom[Roof.CreationMethodIsByFootprint](Roof_Instance_s=watch)  # Checks whether the creation method of a given roof is 'By Footprint'
watch_6 = Watch(creationMethodIsByFootprint)
kind = Custom[Roof.Kind](Roof_Instance_s=watch)  # Retrieves the roof kind (Basic, Glazed, Other). PLEASE NOTE: Roofs that were created by face will be identified as 'Other'
watch_7 = Watch(kind)
creationMethodIsInPlace = Custom[Roof.CreationMethodIsInPlace](Roof_Instance_s=watch)  # Checks whether the creation method of a given roof is 'In-Place'
watch_8 = Watch(creationMethodIsInPlace)
creationMethod = Custom[Roof.CreationMethod](Roof_Instance_s=watch)  # Retrieves the creation method of a given roof
watch_9 = Watch(creationMethod)
