# Dynamo graph Revit.Elements.RoofOrFloor.dyn (Dynamo 0.7.5.3566)

categories = Categories("Roofs")
categories_2 = Categories("Floors")
create = List.Create(categories, categories_2)
all_elements_of_category = ElementsOfCategory(create)
watch = Watch(all_elements_of_category)
slabShapeHasBeenModified = Custom[RoofOrFloor.SlabShapeHasBeenModified](Element_s=watch)  # Checks if the shape of a roof or floor slab has been modified with the shape editing tools
watch_2 = Watch(slabShapeHasBeenModified)
select_face = DSFaceSelection()  # 1 picked in the model
firstItem = List.FirstItem(select_face)
integer_slider = IntegerSlider(11, range=0..20)
gridFromFace = Custom[Paneling.GridFromFace](face=firstItem, U=integer_slider, V=integer_slider)  # Returns UV coordinates, XYZ coordinates and normals for a face with UV subdivision
watch_3 = Watch(gridFromFace.Points)
# note: Run this graph on the RoofOrFloor_Sample file in the extra folder.
select_model_element = DSModelElementSelection()  # 1 picked in the model
watch_4 = Watch(select_model_element)
slabShapeByPoints = Custom[RoofOrFloor.SlabShapeByPoints](Point_s=watch_3, Floor_Roof=watch_4)  # Transform a slab shape based on a list of XYZs. PLEASE NOTE: Will reset any previous edits on the slab shape.
watch_5 = Watch(slabShapeByPoints)
