# Dynamo graph Revit.Elements.Room.dyn (Dynamo 0.7.5.3566)

# note: You can use the Sample Architecture Project (Basic) that ships with Revit to run this graph.

categories = Categories("Rooms")
all_elements_of_category = ElementsOfCategory(categories)
boundaries = Custom[Room.Boundaries](Room_s=all_elements_of_category)  # Gets a list of all boundary elements of a given room or area
watch = Watch(boundaries.Curves)
watch_2 = Watch(boundaries.Elements)
isUnbounded = Custom[Room.IsUnbounded](Room_s=all_elements_of_category)  # Checks whether a room is unbounded.
watch_3 = Watch(isUnbounded)
boolean = BoolSelector(true)
insertsOfBoundaries = Custom[Room.InsertsOfBoundaries](Room_s=all_elements_of_category, Include_Openings=boolean, Include_Shadows=boolean, Include_Embedded_Walls=boolean, Include_Shared_Embedded_Inserts=boolean)  # Retrieves the inserts of the bounding elements of a given room.
watch_4 = Watch(insertsOfBoundaries)
categories_2 = Categories("Doors")
insertsOfBoundariesByCategory = Custom[Room.InsertsOfBoundariesByCategory](Room_s=all_elements_of_category, Category=categories_2, Include_Openings=boolean, Include_Shadows=boolean, Include_Embedded_Walls=boolean, Include_Shared_Embedded_Inserts=boolean)  # Retrieves the inserts of the bounding elements of a given room - filtered by a given category.
watch_5 = Watch(insertsOfBoundariesByCategory)
