# Dynamo graph Revit.Elements.StructuralFoundation.dyn (Dynamo 0.7.5.3566)

# note: You can use the Sample Architecture Project (Basic) that ships with Revit to run this graph.

categories = Categories("StructuralFoundation")
all_elements_of_category = ElementsOfCategory(categories)
watch = Watch(all_elements_of_category)
kindIsWallFooting = Custom[StructuralFoundation.KindIsWallFooting](Struct_Found_Instance_s=watch)  # Checks whether a given structural foundation is a wall footing
watch_2 = Watch(kindIsWallFooting)
kindIsSlab = Custom[StructuralFoundation.KindIsSlab](Struct_Found_Instance_s=watch)  # Checks whether a given structural foundation is a slab
watch_3 = Watch(kindIsSlab)
kind = Custom[StructuralFoundation.Kind](Struct_Found_Instance_s=watch)  # Retrieves the kind of a given structural foundation (isolated, wall, slab).
watch_4 = Watch(kind)
kindIsIsolated = Custom[StructuralFoundation.KindIsIsolated](Struct_Found_Instance_s=watch)  # Checks whether a given structural foundation is an isolated foundation
watch_5 = Watch(kindIsIsolated)
