# Dynamo graph Revit.Elements.Subcategory.dyn (Dynamo 0.7.5.3566)

# note: You can use the Sample Architecture Project (Basic) that ships with Revit to run this graph.
categories = Categories("Lines")
string = StringInput("DynamoMadeThisSubcategory")
byName = Custom[Subcategory.ByName](Category=categories, Name=string)  # Creates a new subcategory for a given element category (unless a subcategory of that name already exists - in that case it returns the existing subcategory)
watch = Watch(byName)
