# Dynamo graph Revit.Elements.TextElement.dyn (Dynamo 0.7.5.3566)

categories = Categories("TextNotes")
all_elements_of_category = ElementsOfCategory(categories)
watch = Watch(all_elements_of_category)
text = Custom[TextElement.Text](Element_s=watch)  # Gets the text stored in a text element (i.e. text node or model text)
watch_2 = Watch(text)
code_block = CodeBlock { "This is the new text for all text nodes... :-)"; }
setText = Custom[TextElement.SetText](Element_s=watch, Text_s=code_block)  # Sets the text of a given text element (i.e. text note or model text)
watch_3 = Watch(setText.Fail)
watch_4 = Watch(setText.Success)
text_2 = Custom[TextElement.Text](Element_s=watch_4)
watch_5 = Watch(text_2)
