# Dynamo graph Revit.Elements.Topography.dyn (Dynamo 0.7.5.3566)

# note: You can use the Sample Architecture Project (Basic) that ships with Revit to run this graph.
categories = Categories("Topography")
all_elements_of_category = ElementsOfCategory(categories)
watch = Watch(all_elements_of_category)
isSubregion = Custom[Topography.IsSubregion](Toposurface_s=watch)  # Filters out everything that is *not* a topo subregion. Needs Revit 2014 or newer to work.
watch_2 = Watch(isSubregion)
origin = Point.Origin()
XAxis = Vector.XAxis()
byOriginNormal = Plane.ByOriginNormal(origin, XAxis)
firstItem = List.FirstItem(watch)
intersectionWithPlane = Custom[Topography.IntersectionWithPlane](Plane=byOriginNormal, Topo=firstItem)  # Calculates the intersection of a toposurface and a plane
watch_3 = Watch(intersectionWithPlane.Points)
watch_4 = Watch(intersectionWithPlane.NurbsCurve_by_points)
byCurve = ModelCurve.ByCurve(watch_4)
watch_5 = Watch(intersectionWithPlane.NurbsCurve_by_control_points)
byCurve_2 = ModelCurve.ByCurve(watch_5)
watch_6 = Watch(intersectionWithPlane.PolyCurve)
