# Dynamo graph Revit.Elements.UnitType.dyn (Dynamo 0.7.5.3566)

unit_types = UnitTypes("Area")
fromDynamoUnitType = Custom[UnitType.FromDynamoUnitType](Dynamo_UnitType=unit_types)  # Retrieves the corresponding Revit UnitType from a Dynamo UnitType
watch = Watch(fromDynamoUnitType)
displayUnitType = Custom[UnitType.DisplayUnitType](UnitType=unit_types)  # Retrieves the display unit type for a given unit type.
watch_2 = Watch(displayUnitType.Unit_Symbol)
watch_3 = Watch(displayUnitType.DisplayUnitType)
