# Dynamo graph Revit.Elements.Wall.Create.dyn (Dynamo 0.7.5.3566)

element_types = ElementTypes("WallType")
# note: Run this graph on the ModelByFace_sample model in the extra folder.
all_elements_of_type = ElementsOfType(element_types)
firstItem = List.FirstItem(all_elements_of_type)
coreCenterline = Custom[WallLocationLine.CoreCenterline]()  # Returns the WallLocationLine option for CoreCenterLine
select_face = DSFaceSelection()  # 1 picked in the model
firstItem_2 = List.FirstItem(select_face)
byFace = Custom[Wall.ByFace](WallType=firstItem, WallLocationLine=coreCenterline, Face_s=firstItem_2)  # Creates a wall on top of a face
watch = Watch(byFace)
coreExterior = Custom[WallLocationLine.CoreExterior]()  # Returns the WallLocationLine option for CoreExterior
coreInterior = Custom[WallLocationLine.CoreInterior]()  # Returns the WallLocationLine option for CoreInterior
finishFaceExterior = Custom[WallLocationLine.FinishFaceExterior]()  # Returns the WallLocationLine option for FinishFaceExterior
finishFaceInterior = Custom[WallLocationLine.FinishFaceInterior]()  # Returns the WallLocationLine option for FinishFaceInterior
wallCenterline = Custom[WallLocationLine.WallCenterline]()  # Returns the WallLocationLine option for WallCenterLine
