# Dynamo graph Revit.Elements.Wall.Query.dyn (Dynamo 0.7.5.3566)

# note: You can use the Sample Architecture Project (Basic) that ships with Revit to run this graph.

categories = Categories("Walls")
all_elements_of_category = ElementsOfCategory(categories)
watch = Watch(all_elements_of_category)
creationMethod = Custom[Wall.CreationMethod](Wall_Instance_s=watch)  # Retrieves the creation method of a given wall
watch_2 = Watch(creationMethod)
creationMethodIsInPlace = Custom[Wall.CreationMethodIsInPlace](Wall_Instance_s=watch)  # Checks if a given wall was created as an in-place family
watch_3 = Watch(creationMethodIsInPlace)
creationMethodIsStandard = Custom[Wall.CreationMethodIsStandard](Wall_Instance_s=watch)  # Checks if a given wall was created using the standard wall tool
watch_4 = Watch(creationMethodIsStandard)
creationMethodIsByFace = Custom[Wall.CreationMethodIsByFace](Wall_Instance_s=watch)  # Checks if a given wall was created by face
watch_5 = Watch(creationMethodIsByFace)
orientation = Custom[Wall.Orientation](Wall_Instance_s=watch)  # Gets the orientation of a given wall instance (normal of the exterior face of the wall). Will *not* work for walls hosted on mass faces or in-place walls.
watch_6 = Watch(orientation)
