# Dynamo graph Revit.Elements.WallLocationLine.dyn (Dynamo 0.7.5.3566)

# note: Have a look at the Revit.Elements.Wall.Create sample to see how to use these nodes...
coreCenterline = Custom[WallLocationLine.CoreCenterline]()  # Returns the WallLocationLine option for CoreCenterLine
watch = Watch(coreCenterline.CoreCenterline)
coreInterior = Custom[WallLocationLine.CoreInterior]()  # Returns the WallLocationLine option for CoreInterior
watch_2 = Watch(coreInterior.CoreInterior)
finishFaceExterior = Custom[WallLocationLine.FinishFaceExterior]()  # Returns the WallLocationLine option for FinishFaceExterior
watch_3 = Watch(finishFaceExterior.FinishFaceExterior)
coreExterior = Custom[WallLocationLine.CoreExterior]()  # Returns the WallLocationLine option for CoreExterior
watch_4 = Watch(coreExterior.CoreExterior)
wallCenterline = Custom[WallLocationLine.WallCenterline]()  # Returns the WallLocationLine option for WallCenterLine
watch_5 = Watch(wallCenterline.WallCenterline)
finishFaceInterior = Custom[WallLocationLine.FinishFaceInterior]()  # Returns the WallLocationLine option for FinishFaceInterior
watch_6 = Watch(finishFaceInterior.FinishFaceInterior)
watch_7 = Watch(coreExterior.int)
watch_8 = Watch(finishFaceInterior.int)
watch_9 = Watch(coreInterior.int)
watch_10 = Watch(finishFaceExterior.int)
watch_11 = Watch(wallCenterline.int)
watch_12 = Watch(coreCenterline.int)
