# Dynamo graph Revit.Elements.WallType.Query.Function.dyn (Dynamo 0.7.5.3566)

# note: You can use the Sample Architecture Project (Basic) that ships with Revit to run this graph.

element_types = ElementTypes("WallType")
all_elements_of_type = ElementsOfType(element_types)
watch = Watch(all_elements_of_type)
function = Custom[WallType.Function](Wall_Type_s=watch)  # Retrieves the Function property of a given wall type
watch_2 = Watch(function)
functionIsExterior = Custom[WallType.FunctionIsExterior](WallType_s=watch)  # Checks if the Function property of a wall type is set to "Exterior"
watch_3 = Watch(functionIsExterior)
functionIsFoundation = Custom[WallType.FunctionIsFoundation](WallType_s=watch)  # Checks if the Function property of a wall type is set to "Foundation"
watch_4 = Watch(functionIsFoundation)
functionIsCoreShaft = Custom[WallType.FunctionIsCoreShaft](WallType_s=watch)  # Checks if the Function property of a wall type is set to "Core Shaft"
watch_5 = Watch(functionIsCoreShaft)
functionIsSoffit = Custom[WallType.FunctionIsSoffit](WallType_s=watch)  # Checks if the Function property of a wall type is set to "Soffit"
watch_6 = Watch(functionIsSoffit)
functionIsRetaining = Custom[WallType.FunctionIsRetaining](WallType_s=watch)  # Checks if the Function property of a wall type is set to "Retaining"
watch_7 = Watch(functionIsRetaining)
functionIsInterior = Custom[WallType.FunctionIsInterior](WallType_s=watch)  # Checks if the Function property of a wall type is set to "Interior"
watch_8 = Watch(functionIsInterior)
