# Dynamo graph Revit.Elements.WallType.Query.Kind.dyn (Dynamo 0.7.5.3566)

# note: You can use the Sample Architecture Project (Basic) that ships with Revit to run this graph.
element_types = ElementTypes("WallType")
all_elements_of_type = ElementsOfType(element_types)
watch = Watch(all_elements_of_type)
kind = Custom[WallType.Kind](Wall_Type_s=watch)  # Retrieves the wall kind of a given wall type
watch_2 = Watch(kind)
kindIsCurtainWall = Custom[WallType.KindIsCurtainWall](Wall_Type_s=watch)  # Checks whether a given walltype is a curtain wall
watch_3 = Watch(kindIsCurtainWall)
kindIsStackedWall = Custom[WallType.KindIsStackedWall](Wall_Type_s=watch)  # Checks whether a given walltype is a stacked wall
watch_4 = Watch(kindIsStackedWall)
kindIsBasicWall = Custom[WallType.KindIsBasicWall](Wall_Type_s=watch)  # Checks whether a given walltype is a basic wall
watch_5 = Watch(kindIsBasicWall)
