# Dynamo graph Revit.Units.dyn (Dynamo 0.7.5.3566)

code_block = CodeBlock { 50; }
unit_types = UnitTypes("Length")
displayUnitType = Custom[UnitType.DisplayUnitType](UnitType=unit_types)  # Retrieves the display unit type for a given unit type.
toInternalUnit = Custom[DisplayUnit.ToInternalUnit](val_s=code_block, DisplayUnitType=displayUnitType.DisplayUnitType)  # Converts a value from a given display unit to Revit's internal unit
watch = Watch(toInternalUnit)
toDisplayUnit = Custom[InternalUnit.ToDisplayUnit](val_s=code_block, DisplayUnitType=displayUnitType.DisplayUnitType)  # Converts a value from Revit's internal unit to a given display unit
watch_2 = Watch(toDisplayUnit)
