# Dynamo graph Revit.Views.PerspectiveView.dyn (Dynamo 0.7.5.3566)

# note: You can use the Sample Architecture Project (Basic) that ships with Revit to run this graph.
views = Views("Section Perspective")
double_slider = DoubleSlider(66.55577629, range=0..100)
double_slider_2 = DoubleSlider(84.97932586, range=0..100)
double_slider_3 = DoubleSlider(49.20263595, range=0..100)
byCoordinates = Point.ByCoordinates(double_slider, double_slider_2, double_slider_3)
origin = Point.Origin()
setOrientationByEyeAndTargetPosition = Custom[PerspectiveView.SetOrientationByEyeAndTargetPosition](View=views, Eye_Position=byCoordinates, Target_Position=origin)  # Sets the orientation of a given perspective view based on a given eye and target position
watch = Watch(setOrientationByEyeAndTargetPosition)
