# Dynamo graph Revit.Views.PlanView.dyn (Dynamo 0.7.5.3566)

# note: You can use the Sample Architecture Project (Basic) that ships with Revit to run this graph.
views = Views("Level 1")
underlay = Custom[PlanView.Underlay](Plan_s=views)  # Returns the view template assigned to a given view (if one is assigned)
watch = Watch(underlay)
