# Dynamo graph Revit.Views.View.Actions.dyn (Dynamo 0.7.5.3566)

views = Views("Solar Analysis")
code_block = CodeBlock { 10; }
setSolarStudyActiveFrameNumber = Custom[View.SetSolarStudyActiveFrameNumber](View=views, Frame_number=code_block)  # Sets the active frame number of the solar study in a given view
watch = Watch(setSolarStudyActiveFrameNumber.Success)
watch_2 = Watch(setSolarStudyActiveFrameNumber.View)
views_2 = Views("{3D}")
phases = Custom[Document.Phases]()  # Retrieves all phases in the active document in *chronological* order
code_block_2 = CodeBlock { "Existing"; }
boolean = BoolSelector(true)
filterByName = Custom[Elements.FilterByName](Elements=phases, Search_string=code_block_2, Ignore_case=boolean)  # Retrieves those elements from a collection whose names match the search string
setPhase = Custom[View.SetPhase](View_s=views_2, Phase=filterByName.first)  # Sets the phase of a given view
watch_3 = Watch(setPhase.Success)
watch_4 = Watch(setPhase.View_s)
views_3 = Views("Level 1")
duplicate = Custom[View.Duplicate](View_s=views_3)  # Duplicates a given view
watch_5 = Watch(duplicate)
duplicateAsDependent = Custom[View.DuplicateAsDependent](View_s=views_3)  # Duplicates a given view as a dependent view
watch_6 = Watch(duplicateAsDependent)
duplicateWithDetailing = Custom[View.DuplicateWithDetailing](View_s=views_3)  # Duplicates a given view with detailing
watch_7 = Watch(duplicateWithDetailing)
