# Dynamo graph Revit.Views.View.Query.DetailLevel.dyn (Dynamo 0.7.5.3566)

# note: You can use the Sample Architecture Project (Basic) that ships with Revit to run this graph.
views = Views("{3D}")
detailLevel = Custom[View.DetailLevel](View_s=views)  # Retrieves the detail level of a given view
watch = Watch(detailLevel)
detailLevelIsMedium = Custom[View.DetailLevelIsMedium](View_s=views)  # Checks whether the detail level of a given view is 'Medium'
watch_2 = Watch(detailLevelIsMedium)
detailLevelIsFine = Custom[View.DetailLevelIsFine](View_s=views)  # Checks whether the detail level of a given view is 'Fine'
watch_3 = Watch(detailLevelIsFine)
detailLevelIsCoarse = Custom[View.DetailLevelIsCoarse](View_s=views)  # Checks whether the detail level of a given view is 'Coarse'
watch_4 = Watch(detailLevelIsCoarse)
