# Dynamo graph Revit.Views.View.Query.Type.dyn (Dynamo 0.7.5.3566)

views = Views("{3D}")
# note: You can use the Sample Architecture Project (Basic) that ships with Revit to run this graph.
type = Custom[View.Type](View_s=views)  # Returns the type of a given view
watch = Watch(type)
typeIsSchedule = Custom[View.TypeIsSchedule](View_s=views)  # Checks whether a given view is a schedule.
watch_2 = Watch(typeIsSchedule)
typeIsCeilingPlan = Custom[View.TypeIsCeilingPlan](View_s=views)  # Checks whether a given view is a ceiling plan.
watch_3 = Watch(typeIsCeilingPlan)
typeIsElevation = Custom[View.TypeIsElevation](View_s=views)  # Checks whether a given view is an elevation.
watch_4 = Watch(typeIsElevation)
typeIsRendering = Custom[View.TypeIsRendering](View_s=views)  # Checks whether a given view is a rendering.
watch_5 = Watch(typeIsRendering)
typeIsAreaPlan = Custom[View.TypeIsAreaPlan](View_s=views)  # Checks whether a given view is an area plan.
watch_6 = Watch(typeIsAreaPlan)
typeIsDraftingView = Custom[View.TypeIsDraftingView](View_s=views)  # Checks whether a given view is a drafting view.
watch_7 = Watch(typeIsDraftingView)
typeIsWalkthrough = Custom[View.TypeIsWalkthrough](View_s=views)  # Checks whether a given view is a walkthrough.
watch_8 = Watch(typeIsWalkthrough)
typeIsLegend = Custom[View.TypeIsLegend](View_s=views)  # Checks whether a given view is a legend.
watch_9 = Watch(typeIsLegend)
typeIs3D = Custom[View.TypeIs3D](View_s=views)  # Checks whether a given view is a 3D view.
watch_10 = Watch(typeIs3D)
typeIsDetail = Custom[View.TypeIsDetail](View_s=views)  # Checks whether a given view is a detail.
watch_11 = Watch(typeIsDetail)
typeIsSection = Custom[View.TypeIsSection](View_s=views)  # Checks whether a given view is a section.
watch_12 = Watch(typeIsSection)
typeIsFloorPlan = Custom[View.TypeIsFloorPlan](View_s=views)  # Checks whether a given view is a floor plan.
watch_13 = Watch(typeIsFloorPlan)
