# Dynamo graph Revit.Views.View.Query.dyn (Dynamo 0.7.5.3566)

categories = Categories("Walls")
views = Views("{3D}")
categoryIsVisible = Custom[View.CategoryIsVisible](Category_ies=categories, View_s=views)  # Checks if a given category is visible in a given view
watch = Watch(categoryIsVisible)
plane = Custom[View.Plane](View_s=views)  # Retrieves the plane of a given view
watch_2 = Watch(plane)
isViewTemplate = Custom[View.IsViewTemplate](View_s=views)  # Checks if a given view is a view template
watch_3 = Watch(isViewTemplate)
isPerspective = Custom[View.IsPerspective](View_s=views)  # Checks whether a given view is a perspective view.
watch_4 = Watch(isPerspective)
usesViewFilters = Custom[View.UsesViewFilters](View_s=views)  # Checks if a given view has any view filters applied to it.
watch_5 = Watch(usesViewFilters)
scale = Custom[View.Scale](View_s=views)  # Returns the scale of a given view
watch_6 = Watch(scale)
viewTemplate = Custom[View.ViewTemplate](View_s=views)  # Returns the view template assigned to a given view (if one is assigned)
watch_7 = Watch(viewTemplate)
views_2 = Views("Solar Analysis")
solarStudyTotalFrames = Custom[View.SolarStudyTotalFrames](View_s=views_2)  # Retrieves the number of frames of a solar study for a given view (if the view's sun and shadow settings are indeed set to single or multi day study)
watch_8 = Watch(solarStudyTotalFrames)
phase = Custom[View.Phase](View_s=views)  # Returns the phase of a given view
watch_9 = Watch(phase)
detailLevelIsMedium = Custom[View.DetailLevelIsMedium](View_s=views)  # Checks whether the detail level of a given view is 'Medium'
watch_10 = Watch(detailLevelIsMedium)
detailLevel = Custom[View.DetailLevel](View_s=views)  # Retrieves the detail level of a given view
watch_11 = Watch(detailLevel)
detailLevelIsCoarse = Custom[View.DetailLevelIsCoarse](View_s=views)  # Checks whether the detail level of a given view is 'Coarse'
watch_12 = Watch(detailLevelIsCoarse)
detailLevelIsFine = Custom[View.DetailLevelIsFine](View_s=views)  # Checks whether the detail level of a given view is 'Fine'
watch_13 = Watch(detailLevelIsFine)
type = Custom[View.Type](View_s=views)  # Returns the type of a given view
watch_14 = Watch(type)
typeIs3D = Custom[View.TypeIs3D](View_s=views)  # Checks whether a given view is a 3D view.
watch_15 = Watch(typeIs3D)
typeIsAreaPlan = Custom[View.TypeIsAreaPlan](View_s=views)  # Checks whether a given view is an area plan.
watch_16 = Watch(typeIsAreaPlan)
typeIsCeilingPlan = Custom[View.TypeIsCeilingPlan](View_s=views)  # Checks whether a given view is a ceiling plan.
watch_17 = Watch(typeIsCeilingPlan)
typeIsDetail = Custom[View.TypeIsDetail](View_s=views)  # Checks whether a given view is a detail.
watch_18 = Watch(typeIsDetail)
typeIsDraftingView = Custom[View.TypeIsDraftingView](View_s=views)  # Checks whether a given view is a drafting view.
watch_19 = Watch(typeIsDraftingView)
typeIsElevation = Custom[View.TypeIsElevation](View_s=views)  # Checks whether a given view is an elevation.
watch_20 = Watch(typeIsElevation)
typeIsFloorPlan = Custom[View.TypeIsFloorPlan](View_s=views)  # Checks whether a given view is a floor plan.
watch_21 = Watch(typeIsFloorPlan)
typeIsLegend = Custom[View.TypeIsLegend](View_s=views)  # Checks whether a given view is a legend.
watch_22 = Watch(typeIsLegend)
typeIsRendering = Custom[View.TypeIsRendering](View_s=views)  # Checks whether a given view is a rendering.
watch_23 = Watch(typeIsRendering)
typeIsSchedule = Custom[View.TypeIsSchedule](View_s=views)  # Checks whether a given view is a schedule.
watch_24 = Watch(typeIsSchedule)
typeIsSection = Custom[View.TypeIsSection](View_s=views)  # Checks whether a given view is a section.
watch_25 = Watch(typeIsSection)
typeIsWalkthrough = Custom[View.TypeIsWalkthrough](View_s=views)  # Checks whether a given view is a walkthrough.
watch_26 = Watch(typeIsWalkthrough)
