# Dynamo graph Revit.Views.View3D.dyn (Dynamo 0.7.5.3566)

# note: You can use the Sample Architecture Project (Basic) that ships with Revit to run this graph.
views = Views("{3D}")
isLocked = Custom[View3D.IsLocked](View_s=views)  # Checks if a given view is locked
watch = Watch(isLocked)
