# Dynamo graph Units.dyn (Dynamo 0.7.5.3566)

integer_slider = IntegerSlider(50, range=0..100)
toFeet = Custom[Millimeters To Feet](mm=integer_slider)  # Converts millimeters into feet
watch = Watch(toFeet)
toMillimeters = Custom[Feet To Millimeters](ft=watch)  # Converts feet into millimeters
watch_2 = Watch(toMillimeters)
integer_slider_2 = IntegerSlider(50, range=0..100)
toFeet_2 = Custom[Centimeters To Feet](cm=integer_slider_2)  # Converts centimeters into feet
watch_3 = Watch(toFeet_2)
toCentimeters = Custom[Feet To Centimeters](ft=watch_3)  # Converts feet into centimeters
watch_4 = Watch(toCentimeters)
double_slider = DoubleSlider(50, range=0..100)
toFeet_3 = Custom[Meters To Feet](m=double_slider)  # Converts meters into feet
watch_5 = Watch(toFeet_3)
toMeters = Custom[Feet To Meters](ft=watch_5)  # Converts feet into meters
watch_6 = Watch(toMeters)
double_slider_2 = DoubleSlider(50, range=0..100)
toSquareFeet = Custom[Square Meters To Square Feet](m2=double_slider_2)  # Converts square meters into square feet
watch_7 = Watch(toSquareFeet)
toSquareMeters = Custom[Square Feet To Square Meters](sq_ft=watch_7)  # Converts square feet into square meters
watch_8 = Watch(toSquareMeters)
double_slider_3 = DoubleSlider(50, range=0..100)
toCubicFeet = Custom[Cubic Meters To Cubic Feet](m3=double_slider_3)  # Converts cubic meters into cubic feet
watch_9 = Watch(toCubicFeet)
toCubicMeters = Custom[Cubic Feet To Cubic Meters](cu_ft=watch_9)  # Converts cubic feet into cubic meters
watch_10 = Watch(toCubicMeters)
