# Dynamo graph Core.Application.dyn (Dynamo 1.3.0.875)

version = Custom[Dynamo.Version]()  # Retrieves the version of the active Dynamo application
watch = Watch(version.versionShort)
watch_2 = Watch(version.versionLong)
watch_3 = Watch(version.platform)
