# Dynamo graph Core.Math.Create.dyn (Dynamo 1.3.0.875)

almostZero = Custom[Math.AlmostZero]()  # Returns a feasable computational tolerance to zero (1.0e-9 or a billionth of 1) for use in calculations. More background info: https://github.com/ikeough/Dynamo/issues/879
watch = Watch(almostZero)
code_block = CodeBlock { 2; 8; 25; }
integer_slider = IntegerSlider(41, range=0..100 step 1)
randomIntegerList = Custom[Math.RandomIntegerList](min=code_block.out0, max=code_block.out1, amount=code_block.out2, seed=integer_slider)  # Creates a list of random integers between 0 and a given maximum value
watch_2 = Watch(randomIntegerList)
