# Dynamo graph Geometry.Point.Query.dyn (Dynamo 1.0.0.1180)

code_block = CodeBlock { {1,2,4,8,16}; }
code_block_2 = CodeBlock { 0..4; }
byCoordinates = Point.ByCoordinates(x=code_block, z=code_block_2)
watch = Watch(byCoordinates)
average = Custom[Point.Average](points=watch)  # Determines the average of a list of points
watch_2 = Watch(average)
watch_3d = Watch3D(watch)
origin = Point.Origin()
ZAxis = Vector.ZAxis()
byOriginNormal = Plane.ByOriginNormal(origin=origin, normal=ZAxis)
isOutOfPlane = Custom[Point.IsOutOfPlane](face_plane=byOriginNormal, point=watch)  # Checks a list for XYZs that are not located on a given plane
watch_3 = Watch(isOutOfPlane.bool)
watch_4 = Watch(isOutOfPlane.amount)
