# Dynamo graph Geometry.UV.Query.dyn (Dynamo 1.0.0.1180)

number_slider = DoubleSlider(0.6328203399, range=0..1 step 0.1)
byCoordinates = UV.ByCoordinates(number_slider, number_slider)
watch = Watch(byCoordinates)
code_block = CodeBlock { {0.2,0.8}; }
byCoordinates_2 = UV.ByCoordinates(code_block, code_block, lacing=CrossProduct)
flatten = Flatten(byCoordinates_2)
watch_2 = Watch(flatten)
convexHull2D = Custom[UV.ConvexHull2D](UVs=watch_2)  # Computes the convex hull of a given set of UV coordinates based on the monotone chain algorithm
isInsidePolygon = Custom[UV.IsInsidePolygon](uv=watch, PolygonUVs=convexHull2D)  # Determines if a point is inside the space enclosed by a polygon
watch_3 = Watch(isInsidePolygon)
average = Custom[UV.Average](UVs=watch_2)  # Determines the average of a list of UVs
watch_4 = Watch(average)
code_block_2 = CodeBlock { 2; }
byWidthLength = Rectangle.ByWidthLength(width=code_block_2, length=code_block_2)
byPatch = Surface.ByPatch(byWidthLength)
U = UV.U(watch)
V = UV.V(watch)
pointAtParameter = Surface.PointAtParameter(surface=byPatch, u=U, v=V)
U_2 = UV.U(convexHull2D)
V_2 = UV.V(convexHull2D)
pointAtParameter_2 = Surface.PointAtParameter(surface=byPatch, u=U_2, v=V_2)
boolean = BoolSelector(true)
byPoints = PolyCurve.ByPoints(points=pointAtParameter_2, connectLastToFirst=boolean)
create = List.Create(pointAtParameter, byPoints)
watch_3d = Watch3D(create)
