# Dynamo graph Paneling.Patterns.Hexagonal.dyn (Dynamo 1.0.0.1180)

# note: Run this graph on the Paneling_Sample model in the extra folder.
select_face = DSFaceSelection()  # 1 picked in the model
firstItem = List.FirstItem(select_face)
integer_slider = IntegerSlider(9, range=0..20 step 1)
integer_slider_2 = IntegerSlider(12, range=0..20 step 1)
gridFromFace = Custom[Paneling.GridFromFace](surface=firstItem, U=integer_slider, V=integer_slider_2)  # Returns UV coordinates, XYZ coordinates and normals for a face with UV subdivision
boolean = BoolSelector(false)
integer_slider_3 = IntegerSlider(1, range=0..5 step 1)
boolean_2 = BoolSelector(false)
integer_slider_4 = IntegerSlider(2, range=0..5 step 1)
boolean_3 = BoolSelector(false)
hexagonal = Custom[Paneling.Hexagonal](seq=gridFromFace.Points, V=integer_slider_2, reverseOddRows=boolean, shiftPlacementOddRows=integer_slider_3, reverseEvenRows=boolean_2, shiftPlacementEvenRows=integer_slider_4, rotateGridBy90Degrees=boolean_3)
family_types = FamilyTypes("6Point-AC_Hexagon:Type 1")
byPoints = AdaptiveComponent.ByPoints(points=hexagonal.oddRows, familyType=family_types)
family_types_2 = FamilyTypes("6Point-AC_Hexagon:Type 2")
byPoints_2 = AdaptiveComponent.ByPoints(points=hexagonal.evenRows, familyType=family_types_2)
