# Dynamo graph Revit.Document.Query.dyn (Dynamo 1.3.0.875)

categories = Categories("Walls")
categories_2 = Categories("Roofs")
create = List.Create(categories, categories_2)
containsElementsOfCategory = Custom[Document.ContainsElementsOfCategory](category=create)  # Checks if family instances of specified categories are present in the model.
watch = Watch(containsElementsOfCategory.any)
watch_2 = Watch(containsElementsOfCategory.all)
watch_3 = Watch(containsElementsOfCategory.per_category)
watch_4 = Watch(containsElementsOfCategory.instances)
# note: You can use the Sample Architecture Project (Basic) that ships with Revit to run this graph.
activeViewFromCurrentDocument = Custom[Document.ActiveViewFromCurrentDocument]()  # Gets the active view of the current document
watch_5 = Watch(activeViewFromCurrentDocument)
isWorkshared = Custom[Document.IsWorkshared]()  # Returns true if the current project is workshared
watch_6 = Watch(isWorkshared)
linksAndImports = Custom[Document.LinksAndImports]()  # Gets all linked and imported files in the document. NOTE: Does *not* retrieve linked Revit files.
watch_7 = Watch(linksAndImports.links)
watch_8 = Watch(linksAndImports.imports)
builtInCategories = Custom[Document.BuiltInCategories]()  # List all the available BuiltInCategories
watch_9 = Watch(builtInCategories.BuiltInCategories)
builtInParameters = Custom[Document.BuiltInParameters]()  # List all the available BuiltInParameters
watch_10 = Watch(builtInParameters.BuiltInParameters)
projectInfo = Custom[Document.ProjectInfo]()  # Gets the project information.
watch_11 = Watch(projectInfo.Author)
watch_12 = Watch(projectInfo.Number)
watch_13 = Watch(projectInfo.Name)
watch_14 = Watch(projectInfo.Address)
watch_15 = Watch(projectInfo.OrganizationDescription)
watch_16 = Watch(projectInfo.BuildingName)
watch_17 = Watch(projectInfo.IssueDate)
watch_18 = Watch(projectInfo.ClientName)
watch_19 = Watch(projectInfo.Status)
watch_20 = Watch(projectInfo.OrganizationName)
projectPosition = Custom[Document.ProjectPosition]()  # Gets the project's position data relative to the origin. Use the built-in nodes Location.Latitude & Location.Longitude to retrieve latitude and longitude.
watch_21 = Watch(projectPosition.Angle_degr)
watch_22 = Watch(projectPosition.Elevation)
watch_23 = Watch(projectPosition.EastWest)
watch_24 = Watch(projectPosition.NorthSouth)
designOptions = Custom[Document.DesignOptions]()  # Returns all design options in the model, grouped by design option set
watch_25 = Watch(designOptions.DesignOptionSets)
watch_26 = Watch(designOptions.DesignOptions)
phases = Custom[Document.Phases]()  # Retrieves all phases in the active document in *chronological* order
watch_27 = Watch(phases)
startingView = Custom[Document.StartingView]()  # Retrieves the starting view of a Project file. Returns null if no starting view is set.
watch_28 = Watch(startingView)
views = Custom[Document.Views]()  # Gets all views in the document - except for 3D view templates (as long as this bug is not fixed: https://github.com/DynamoDS/Dynamo/issues/2970)
watch_29 = Watch(views)
watch_30 = Watch(builtInCategories.ElementIDs)
watch_31 = Watch(builtInParameters.ElementIDs)
watch_32 = Watch(builtInParameters.ParameterNames)
worksets = Custom[Document.Worksets]()  # Returns all Worksets in the current document
watch_33 = Watch(worksets)
default3DView = Custom[Document.Default3DView]()  # Returns the default 3D view of the current model (if there is such a view)
watch_34 = Watch(default3DView)
projectParameters = Custom[Document.ProjectParameters]()  # Retrieves all project parameters and the categories they have been assigned to
watch_35 = Watch(projectParameters.paramName)
watch_36 = Watch(projectParameters.categories)
categories_3 = Categories("Rooms")
projectParametersByCategory = Custom[Document.ProjectParametersByCategory](category=categories_3)  # Retrieves all project parameters for a given category
watch_37 = Watch(projectParametersByCategory)
performanceAdviserRules = Custom[Document.PerformanceAdviserRules]()  # Retreives all Performance Adviser Rules from the current document
watch_38 = Watch(performanceAdviserRules)
