# Dynamo graph Revit.Elements.Assembly.dyn (Dynamo 1.0.0.1180)

select_model_elements = DSModelElementsSelection()  # 3 picked in the model
create = List.Create(select_model_elements)
watch = Watch(create)
string = StringInput("AssemblyByDynamo")
fromElements = Custom[Assembly.FromElements](elements=watch, assemblyName=string)  # Creates an assembly from a list of elements
watch_2 = Watch(fromElements)
members = Custom[Assembly.Members](assembly=watch_2)  # Retrieves the members of an assembly
watch_3 = Watch(members)
select_model_element = DSModelElementSelection()  # 1 picked in the model
removeMembers = Custom[Assembly.RemoveMembers](assembly=watch_2, elements=select_model_element)  # Removes any given elements to a given assembly.
passthrough = Custom[Passthrough](passThrough=removeMembers, waitFor=members)  # Forces a sequential order of execution. The node wired into the output of the Passthrough node will be executed *after* the node wired into the waitFor input (e.g. important for some Revit operations). The value of the passThrough input will be passed on to the node wired into the output port of the Passthrough node.
members_2 = Custom[Assembly.Members](assembly=passthrough)
watch_4 = Watch(members_2)
addMembers = Custom[Assembly.AddMembers](assembly=removeMembers, elements=select_model_element)  # Adds any given elements to a given assembly.
passthrough_2 = Custom[Passthrough](passThrough=addMembers, waitFor=members_2)
members_3 = Custom[Assembly.Members](assembly=passthrough_2)
watch_5 = Watch(members_3)
passthrough_3 = Custom[Passthrough](passThrough=addMembers, waitFor=members_3)
disassemble = Custom[Assembly.Disassemble](assembly=passthrough_3)  # Disassembles an assembly and returns its members
watch_6 = Watch(disassemble)
