# Dynamo graph Revit.Elements.Category.dyn (Dynamo 1.3.1.1736)

categories = Categories("Lines")
subcategories = Custom[Category.Subcategories](category=categories)  # Retrieves all the subcategories for a given category
watch = Watch(subcategories)
type = Custom[Category.Type](category=categories)  # Returns the type of the category
watch_2 = Watch(type)
