# Dynamo graph Revit.Elements.DesignOption.dyn (Dynamo 1.0.0.1180)

boolean = BoolSelector(false)
designOptions = Custom[Document.DesignOptions](toggle=boolean)  # Returns all design options in the model, grouped by design option set
watch = Watch(designOptions.DesignOptions)
designOptionSet = Custom[DesignOption.DesignOptionSet](designOption=watch)  # Returns the design option set of a given design option
watch_2 = Watch(designOptionSet)
watch_3 = Watch(designOptions.DesignOptionSets)
element_name_universal = Custom[Element.Name (Universal)](element=watch_3)  # Gets an element's name (Dynamo's built-in Name nodes don't work for all element types, e.g. worksets...)
watch_4 = Watch(element_name_universal)
element_name_universal_2 = Custom[Element.Name (Universal)](element=watch)
watch_5 = Watch(element_name_universal_2)
