# Dynamo graph Revit.Elements.DirectShape.dyn (Dynamo 1.0.0.1180)

fine = Custom[DetailLevel.Fine]()  # Returns the fine detail level
select_model_elements = DSModelElementsSelection()  # 6 picked in the model
watch = Watch(select_model_elements)
fine_2 = Custom[DetailLevel.Fine]()
geometry = Custom[Element.Geometry+](element=watch, detailLevel=fine_2)  # Returns Dynamo AND native Revit geometry of a given element
watch_2 = Watch(geometry.revitGeometry)
categories = Categories("GenericModel")
element_name_universal = Custom[Element.Name (Universal)](element=watch)  # Gets an element's name (Dynamo's built-in Name nodes don't work for all element types, e.g. worksets...)
count = List.Count(element_name_universal)
code_block = CodeBlock(name=element_name_universal, n=count) { name + "_" + (1..n); }
fromRevitGeometry = Custom[DirectShape.FromRevitGeometry](revitGeometry=watch_2, category=categories, name=code_block)  # Creates a DirectShape from native Revit geometry objects
watch_3 = Watch(fromRevitGeometry)
