# Dynamo graph Revit.Elements.Element.Query.dyn (Dynamo 1.3.0.875)

select_model_elements = DSModelElementsSelection()  # 355 picked in the model
watch = Watch(select_model_elements)
allInstances = Custom[Element.AllInstances](element=watch)  # Retrieves all instances of a given element
watch_2 = Watch(allInstances)
levels = Levels("Level 1")
allInstancesAtLevel = Custom[Element.AllInstancesAtLevel](element=watch, level=levels)  # Retrieves all instances of an element on a given level
watch_3 = Watch(allInstancesAtLevel)
select_model_elements_2 = DSModelElementsSelection()  # 30 picked in the model
empty = List.Empty()
replaceNull = Custom[List.ReplaceNull](seq=select_model_elements_2, replacement=empty)  # Replaces all null values within a given list with a substitute
watch_4 = Watch(replaceNull)
views = Views("Level 1")
# note: Only works for annotation elements
allViewDependentInstances = Custom[Element.AllViewDependentInstances](element=watch_4, view=views)  # Retrieves all instances of a view-dependent element in a given view
watch_5 = Watch(allViewDependentInstances)
categories = Categories("Rooms")
all_elements_of_category = ElementsOfCategory(categories)
watch_6 = Watch(all_elements_of_category)
# note: Only works for rooms, areas and zones
area = Custom[Element.Area](element=watch_6)  # Returns the area property of a given element (if that element has such a property)
watch_7 = Watch(area)
# note: Will only return results when run inside a parametric family
associatedFamilyParameters = Custom[Element.AssociatedFamilyParameters](element=watch)  # Returns the associated family parameters of an element in a family (and the respective element parameters). PLEASE NOTE: This node will only work in a family document!
watch_8 = Watch(associatedFamilyParameters.elementParamaters)
watch_9 = Watch(associatedFamilyParameters.associatedFamilyParameters)
watch_10 = Watch(associatedFamilyParameters.elementParameterNames)
watch_11 = Watch(associatedFamilyParameters.associatedFamilyParameterNames)
number_slider = DoubleSlider(30, range=0..100 step 0.1)
containsTransparentMaterials = Custom[Element.ContainsTransparentMaterials](element=watch, minTransparencyPercentage=number_slider)  # Checks if a given element contains transparent materials.
watch_12 = Watch(containsTransparentMaterials)
elevationOfHostLevel = Custom[Element.ElevationOfHostLevel](element=watch)  # Returns the elevation of the level a given element is associated with
watch_13 = Watch(elevationOfHostLevel)
externalFileReferencePath = Custom[Element.ExternalFileReferencePath](element=watch)  # Returns the full path of an element's external file reference as as string
watch_14 = Watch(externalFileReferencePath)
group = Custom[Element.Group](element=watch)  # Retrieves the group an element belongs to (if any)
watch_15 = Watch(group)
host = Custom[Element.Host](element=watch)  # Gets an element's host
watch_16 = Watch(host)
ID = Custom[Element.ID](element=watch)  # Gets the ID(s) for a list of Revit elements (or a single element) - unlike the built-in Element.Id node, this node returns an actual Revit Element ID and *not* a number
watch_17 = Watch(ID.ID)
watch_18 = Watch(ID.bool)
boolean = BoolSelector(true)
inserts = Custom[Element.Inserts](element=watch, includeOpenings=boolean, includeShadows=boolean, includeEmbeddedWalls=boolean, includeSharedEmbeddedInserts=boolean)  # Gets all the objects inserted into a given element.
watch_19 = Watch(inserts)
categories_2 = Categories("Walls")
isOfCategory = Custom[Element.IsOfCategory](element=watch, category=categories_2)  # Checks whether an element is of a specified category
watch_20 = Watch(isOfCategory)
isRelatedToMass = Custom[Element.IsRelatedToMass](element=watch)  # Returns true if an object (wall, roof, floor or curtain system) has been modelled by face and the underlying mass still exists in the project.
watch_21 = Watch(isRelatedToMass)
level = Custom[Element.Level](element=watch)  # Gets an element's level
watch_22 = Watch(level)
location = Custom[Element.Location](element=watch)  # Returns the location of an element as an XYZ (or if it's line-based the start and end point of the line), along with some booleans to help filtering the results. Use this for some element types (e.g. walls or lines) that do not work with the built-in Get Family Instance Location node.
watch_23 = Watch(location.points)
watch_24 = Watch(location.isPoint)
watch_25 = Watch(location.curves)
watch_26 = Watch(location.isCurve)
watch_27 = Watch(location.hasLocation)
watch_28 = Watch(location.curveEndpoints)
boolean_2 = BoolSelector(false)
materials = Custom[Element.Materials](element=watch, returnPaintMaterials=boolean_2)  # Retrieves all materials froma given element
watch_29 = Watch(materials.materials)
watch_30 = Watch(materials.hasMaterial)
watch_31 = Watch(materials.materialVolumes)
watch_32 = Watch(materials.materialAreas)
name = Custom[Element.Name (Universal)](element=watch)  # "Element.Name+"; Gets an element's name (Dynamo's built-in Name nodes don't work for all element types, e.g. worksets...)
watch_33 = Watch(name)
# note: Only works with annotation elements
ownerView = Custom[Element.OwnerView](element=watch_4)  # Gets the owner view of a given Revit element (if possible)
watch_34 = Watch(ownerView)
panels = Custom[Element.Panels](hostElement=watch)  # Retrieves the panels nested in a curtain wall, curtain system or glazed roof.
watch_35 = Watch(panels)
string = StringInput("Width")
parameterExists = Custom[Element.ParameterExists](param=string, element=watch)  # Checks if an element contains a parameter of a given name
watch_36 = Watch(parameterExists)
parameterIsReadOnly = Custom[Element.ParameterIsReadOnly](element=watch, parameter=string)  # Checks if a parameter of a given element is read-only
watch_37 = Watch(parameterIsReadOnly)
phases = Custom[Element.Phases](element=watch)  # Gets the created and demolished phases of an element
watch_38 = Watch(phases.Created)
watch_39 = Watch(phases.Demolished)
type = Custom[Element.Type](element=watch)  # Gets the family type of a given element (if applicable).
watch_40 = Watch(type)
workset = Custom[Element.Workset](element=watch)  # Retrieves the workset of a given element
watch_41 = Watch(workset)
watch_42 = Watch(location.hasRotation)
watch_43 = Watch(location.angle)
medium = Custom[DetailLevel.Medium]()  # Returns the medium detail level
boolean_3 = BoolSelector(false)
boolean_4 = BoolSelector(false)
geometry = Custom[Element.Geometry+](element=watch, detailLevel=medium, includeInvisibleObjects=boolean_3, returnGeometryWithoutInserts=boolean_4)  # Returns Dynamo AND native Revit geometry of a given element
watch_44 = Watch(geometry.dynamoGeometry)
watch_45 = Watch(geometry.revitGeometry)
category = Custom[Element.Category](element=watch)  # Returns the category of a given element
watch_46 = Watch(category)
