# Dynamo graph Revit.Elements.FillPatternElement.dyn (Dynamo 1.3.1.1736)

element_types = ElementTypes("FillPatternElement")
all_elements_of_type = ElementsOfType(element_types)
isSolidFill = Custom[FillPatternElement.IsSolidFill](fillPatternElement=all_elements_of_type)  # Checks if the given FillPatternElement is a solid fill
filterByBoolMask = List.FilterByBoolMask(list=all_elements_of_type, mask=isSolidFill)
name = Custom[Element.Name+](element=filterByBoolMask.in)  # Gets an element's name (Dynamo's built-in Name nodes don't work for all element types, e.g. worksets...)
