# Dynamo graph Revit.Elements.Floor.dyn (Dynamo 1.3.0.875)

categories = Categories("Floors")
select_model_element = DSModelElementSelection()  # 1 picked in the model
resetSlabShape = Custom[Floor.ResetSlabShape](floor=select_model_element)  # Resets the slabshape of a floor
watch = Watch(resetSlabShape.floor)
select_face = DSFaceSelection()  # 1 picked in the model
firstItem = List.FirstItem(select_face)
integer_slider = IntegerSlider(11, range=0..20 step 1)
gridFromFace = Custom[Paneling.GridFromFace](surface=firstItem, U=integer_slider, V=integer_slider)  # Returns UV coordinates, XYZ coordinates and normals for a face with UV subdivision
watch_2 = Watch(gridFromFace.Points)
# note: Run this graph on the Floor_Sample file in the extra folder.
select_model_element_2 = DSModelElementSelection()  # 1 picked in the model
watch_3 = Watch(select_model_element_2)
slabShapeByPoints = Custom[Floor.SlabShapeByPoints](points=watch_2, floor=watch_3)  # Transform a slab shape based on a list of XYZs. PLEASE NOTE: Will reset any previous edits on the slab shape.
create = List.Create(watch, slabShapeByPoints)
passthrough = Custom[Passthrough](passThrough=categories, waitFor=create)  # Forces a sequential order of execution. The node wired into the output of the Passthrough node will be executed *after* the node wired into the waitFor input (e.g. important for some Revit operations). The value of the passThrough input will be passed on to the node wired into the output port of the Passthrough node.
all_elements_of_category = ElementsOfCategory(passthrough)
watch_4 = Watch(all_elements_of_category)
slabShapeHasBeenModified = Custom[Floor.SlabShapeHasBeenModified](floor=watch_4)  # Checks if the shape of a floor slab has been modified with the shape editing tools
watch_5 = Watch(slabShapeHasBeenModified)
watch_6 = Watch(slabShapeByPoints)
watch_7 = Watch(resetSlabShape.success)
