# Dynamo graph Revit.Elements.FootingType.dyn (Dynamo 1.0.0.1180)

# note: Run this file on the FootingType_Sample model in the extra folder.
categories = Categories("StructuralFoundation")
all_elements_of_category = ElementsOfCategory(categories)
type = Custom[Element.Type](element=all_elements_of_category)  # Gets the family type of a given element (if applicable).
watch = Watch(type)
breaksAtInserts = Custom[FootingType.BreaksAtInserts](footingType=watch)  # Determines whether a list of wall footing types break at inserts in their attached walls
watch_2 = Watch(breaksAtInserts)
