# Dynamo graph Revit.Elements.Grid.dyn (Dynamo 1.3.0.875)

# note: You can use the Sample Architecture Project (Basic) that ships with Revit to run this graph.
categories = Categories("Grids")
all_elements_of_category = ElementsOfCategory(categories)
watch = Watch(all_elements_of_category)
plane = Custom[Grid.Plane](grid=watch)  # Retrieves the plane of a grid
watch_2 = Watch(plane.plane)
watch_3 = Watch(plane.bool)
