# Dynamo graph Revit.Elements.GroupType.dyn (Dynamo 1.3.1.1736)

element_types = ElementTypes("GroupType")
all_elements_of_type = ElementsOfType(element_types)
watch = Watch(all_elements_of_type)
groups = Custom[GroupType.Groups](groupType=watch)  # Returns all group instances of a given group type
watch_2 = Watch(groups)
