# Dynamo graph Revit.Elements.RevisionCloud.dyn (Dynamo 1.3.0.875)

categories = Categories("Stairs")
# note: You can use the Sample Architecture Project (Basic) that ships with Revit to run this graph.
all_elements_of_category = ElementsOfCategory(categories)
create = List.Create(all_elements_of_category)
watch = Watch(create)
element_types = ElementTypes("Revision")
all_elements_of_type = ElementsOfType(element_types)
lastItem = List.LastItem(all_elements_of_type)
watch_2 = Watch(lastItem)
views = Views("Level 1")
fromElements = Custom[RevisionCloud.FromElements](elements=watch, revision=watch_2, view=views)  # Create a revision cloud for a list of Revit elements
watch_3 = Watch(fromElements)
