# Dynamo graph Revit.Elements.Roof.dyn (Dynamo 1.3.0.875)

select_model_element = DSModelElementSelection()  # 1 picked in the model
resetSlabShape = Custom[Roof.ResetSlabShape](roof=select_model_element)  # Resets the slabshape of a roof
watch = Watch(resetSlabShape.roof)
select_face = DSFaceSelection()  # 1 picked in the model
firstItem = List.FirstItem(select_face)
# note: Run this graph on the RoofOrFloor_Sample file in the extra folder.
integer_slider = IntegerSlider(11, range=0..20 step 1)
gridFromFace = Custom[Paneling.GridFromFace](surface=firstItem, U=integer_slider, V=integer_slider)  # Returns UV coordinates, XYZ coordinates and normals for a face with UV subdivision
watch_2 = Watch(gridFromFace.Points)
select_model_element_2 = DSModelElementSelection()  # 1 picked in the model
watch_3 = Watch(select_model_element_2)
slabShapeByPoints = Custom[Roof.SlabShapeByPoints](points=watch_2, roof=watch_3)  # Transform a slab shape based on a list of XYZs. PLEASE NOTE: Will reset any previous edits on the slab shape.
create = List.Create(watch, slabShapeByPoints)
slabShapeHasBeenModified = Custom[Roof.SlabShapeHasBeenModified](roof=create)  # Checks if the shape of a roof slab has been modified with the shape editing tools
watch_4 = Watch(slabShapeHasBeenModified)
watch_5 = Watch(slabShapeByPoints)
categories = Categories("Roofs")
all_elements_of_category = ElementsOfCategory(categories)
watch_6 = Watch(all_elements_of_category)
kind = Custom[Roof.Kind](roof=watch_6)  # Retrieves the roof kind (Basic, Glazed, Other). PLEASE NOTE: Roofs that were created by face will be identified as 'Other'
watch_7 = Watch(kind)
creationMethod = Custom[Roof.CreationMethod](roof=watch_6)  # Retrieves the creation method of a given roof
watch_8 = Watch(creationMethod)
watch_9 = Watch(resetSlabShape.success)
