# Dynamo graph Revit.Elements.Room.dyn (Dynamo 1.3.0.875)

# note: You can use the Sample Architecture Project (Basic) that ships with Revit to run this graph.
categories = Categories("Rooms")
all_elements_of_category = ElementsOfCategory(categories)
boundaries = Custom[Room.Boundaries](room=all_elements_of_category)  # Gets a list of all boundary elements of a given room or area
watch = Watch(boundaries.curves)
watch_2 = Watch(boundaries.elements)
isUnbounded = Custom[Room.IsUnbounded](room=all_elements_of_category)  # Checks whether a room is unbounded.
watch_3 = Watch(isUnbounded)
boolean = BoolSelector(true)
insertsOfBoundaries = Custom[Room.InsertsOfBoundaries](room=all_elements_of_category, includeOpenings=boolean, includeShadows=boolean, includeEmbeddedWalls=boolean, includeSharedEmbeddedInserts=boolean)  # Retrieves the inserts of the bounding elements of a given room.
watch_4 = Watch(insertsOfBoundaries)
categories_2 = Categories("Doors")
insertsOfBoundariesByCategory = Custom[Room.InsertsOfBoundariesByCategory](room=all_elements_of_category, category=categories_2, includeOpenings=boolean, includeShadows=boolean, includeEmbeddedWalls=boolean, includeSharedEmbeddedInserts=boolean)  # Retrieves the inserts of the bounding elements of a given room - filtered by a given category.
watch_5 = Watch(insertsOfBoundariesByCategory)
phases = Custom[Document.Phases]()  # Retrieves all phases in the active document in *chronological* order
string = StringInput("Working Drawings")
filterByName = Custom[Elements.FilterByName](elements=phases, searchString=string)  # Retrieves those elements from a collection whose names match the search string
doors = Custom[Room.Doors](room=all_elements_of_category, phase=filterByName.first)  # Retrieves all doors that are associated with a room (hosted in walls and roofs).
watch_6 = Watch(doors)
code_block = CodeBlock { 5000; }
byCoordinates = Point.ByCoordinates(x=code_block)
isPointInside = Custom[Room.IsPointInside](room=all_elements_of_category, point=byCoordinates)  # Evaluates if a ponti is located inside a given room.
watch_7 = Watch(isPointInside)
windows = Custom[Room.Windows](room=all_elements_of_category, phase=filterByName.first)  # Retrieves all windows that are associated with a room (hosted in walls and roofs).
watch_8 = Watch(windows)
builtInParameters = Custom[Document.BuiltInParameters]()  # List all the available BuiltInParameters
string_2 = StringInput("ROOM_NUMBER")
string_from_object = FromObject(builtInParameters.BuiltInParameters)
eq = string_2 == string_from_object
filterByBoolMask = List.FilterByBoolMask(list=builtInParameters.ParameterNames, mask=eq)
firstItem = List.FirstItem(filterByBoolMask.in)
code_block_2 = CodeBlock()
# ---------- code_block_2.designscript (3 lines) ----------
// A sequence of room numbers
// of connected rooms
{"201","202","203"};
# ----------------------------------------
contains = Contains(code_block_2)  # unwired: arg1
filterByParameterValueAndCondition = Custom[Elements.FilterByParameterValueAndCondition](elements=all_elements_of_category, param=firstItem, func=contains)
toDoorSequence = Custom[RoomSequence.ToDoorSequence](rooms=filterByParameterValueAndCondition.in, phase=filterByName.first)  # Retrieves a sequence of doors connecting a given sequence of rooms (if possible)
watch_9 = Watch(toDoorSequence)
code_block_3 = CodeBlock { {"DummyRoom1","DummyRoom2","DummyRoom3"}; 1001..1003; }
string_from_object_2 = FromObject(code_block_3.out1)
unplacedByNameAndNumber = Custom[Room.UnplacedByNameAndNumber](name=code_block_3.out0, number=string_from_object_2, phase=filterByName.first)  # Creates an unplaced room
watch_10 = Watch(unplacedByNameAndNumber)
