# Dynamo graph Revit.Elements.SpotElevation.dyn (Dynamo 1.3.1.1736)

origin = Point.Origin()
views = Views("Ebene 0")
XAxis = Vector.XAxis()
# note: Run this graph on the CreateStuff_Sample.rvt file
byFloorPlanAndPoint = Custom[SpotElevation.ByFloorPlanAndPoint](point=origin, floorPlan=views, bend=XAxis, end=XAxis)  # Places a spot elevation at a given point in a given floor plan.
watch = Watch(byFloorPlanAndPoint)
