# Dynamo graph Revit.Elements.StructuralFoundation.dyn (Dynamo 1.0.0.1180)

# note: Run this graph on the StructuralFoundation_Sample file in the extra folder.
categories = Categories("StructuralFoundation")
all_elements_of_category = ElementsOfCategory(categories)
watch = Watch(all_elements_of_category)
kind = Custom[StructuralFoundation.Kind](structuralFoundation=watch)  # Retrieves the kind of a given structural foundation (isolated, wall, slab).
watch_2 = Watch(kind)
