# Dynamo graph Revit.Elements.UnitType.dyn (Dynamo 1.0.0.1180)

unit_types = UnitTypes("Area")
displayUnitType = Custom[UnitType.DisplayUnitType](unitType=unit_types)  # Retrieves the display unit type for a given unit type.
watch = Watch(displayUnitType.unitSymbol)
watch_2 = Watch(displayUnitType.displayUnitType)
