# Dynamo graph Revit.Views.PlanView.dyn (Dynamo 1.3.1.1736)

# note: You can use the Sample Architecture Project (Basic) that ships with Revit to run this graph.
views = Views("Level 1")
underlay = Custom[PlanView.Underlay](planView=views)  # Returns the view template assigned to a given view (if one is assigned)
watch = Watch(underlay.baseUnderlay)
watch_2 = Watch(underlay.topUnderlay)
watch_3 = Watch(underlay.underlayOrientation)
