# Dynamo graph Revit.Views.View.Actions.dyn (Dynamo 1.0.0.1180)

views = Views("Solar Analysis")
code_block = CodeBlock { 10; }
setSolarStudyActiveFrameNumber = Custom[View.SetSolarStudyActiveFrameNumber](view=views, frameNumber=code_block)  # Sets the active frame number of the solar study in a given view
watch = Watch(setSolarStudyActiveFrameNumber.success)
watch_2 = Watch(setSolarStudyActiveFrameNumber.view)
views_2 = Views("Kitchen")
phases = Custom[Document.Phases]()  # Retrieves all phases in the active document in *chronological* order
code_block_2 = CodeBlock { "Existing"; }
boolean = BoolSelector(true)
filterByName = Custom[Elements.FilterByName](elements=phases, searchString=code_block_2, ignoreCase=boolean)  # Retrieves those elements from a collection whose names match the search string
setPhase = Custom[View.SetPhase](view=views_2, phase=filterByName.first)  # Sets the phase of a given view
watch_3 = Watch(setPhase.success)
watch_4 = Watch(setPhase.view)
views_3 = Views("Level 1")
duplicate = Custom[View.Duplicate](view=views_3)  # Duplicates a given view
watch_5 = Watch(duplicate)
duplicateAsDependent = Custom[View.DuplicateAsDependent](view=views_3)  # Duplicates a given view as a dependent view
watch_6 = Watch(duplicateAsDependent)
duplicateWithDetailing = Custom[View.DuplicateWithDetailing](view=views_3)  # Duplicates a given view with detailing
watch_7 = Watch(duplicateWithDetailing)
views_4 = Views("Approach")
disableTemporaryHideIsolate = Custom[View.DisableTemporaryHideIsolate](view=views_4)  # Disables the temporary hide/isolate for the given view (if set)
watch_8 = Watch(disableTemporaryHideIsolate)
views_5 = Views("From Yard")
# note: You can run this graph on top of the Basic Architectural Sample Model that ships with Revit. However, make sure that you have two views set up with temporarily hidden/isolated elements and that design options are present in the model.
convertTemporaryHideIsolateToPermanent = Custom[View.ConvertTemporaryHideIsolateToPermanent](view=views_5)  # Convert all temporary hidden elements or categories to permanently hidden in the given view.
watch_9 = Watch(convertTemporaryHideIsolateToPermanent)
views_6 = Views("Level 1")
designOptions = Custom[Document.DesignOptions]()  # Returns all design options in the model, grouped by design option set
flatten = Flatten(designOptions.DesignOptions)
firstItem = List.FirstItem(flatten)
setDesignOption = Custom[View.SetDesignOption](view=views_6, designOption=firstItem)  # Sets the view to a given design option. PLEASE NOTE: This node is kind of hacky. It does not use the design option settings in the visibility / graphic overrides. Instead it sets the view property "Visible in Option" to *one* specific design option - which also means that the symbolic representation of this view is only visible in views that display the given design options.
watch_10 = Watch(setDesignOption.view)
watch_11 = Watch(setDesignOption.success)
number = DoubleInput(500)
resizeCropBox = Custom[View.ResizeCropBox](amt=number, view=views_6)  # Resizes the bounding box of a given Revit element by the specified amount in X, Y and Z direction. May need to be used in conjunction with a Transaction node.
watch_12 = Watch(resizeCropBox)
fine = Custom[DetailLevel.Fine]()  # Returns the fine detail level
setDetailLevel = Custom[View.SetDetailLevel](view=duplicateWithDetailing, detailLevel=fine)  # Sets the detail level of a given view
watch_13 = Watch(setDetailLevel.view)
watch_14 = Watch(setDetailLevel.success)
