# Dynamo graph Revit.Elements.TextNote.dyn (Dynamo 1.0.0.1180)

string = StringInput("Dynamo extends building information modeling with the data and logic environment of a graphical algorithm editor")
views = Views("Ebene 0")
origin = Point.Origin()
number_slider = DoubleSlider(108, range=0..360 step 1)
number_slider_2 = DoubleSlider(0.1, range=0..2 step 0.1)
center = Custom[TextAlignFlags.Center]()  # Returns the "Left" text align flag.
element_types = ElementTypes("TextNoteType")
all_elements_of_type = ElementsOfType(element_types)
watch = Watch(all_elements_of_type)
firstItem = List.FirstItem(watch)
# note: Run this graph on the CreateStuff_Sample file
byStringAndPosition = Custom[TextNote.ByStringAndPosition](text=string, view=views, point=origin, rotation=number_slider, width=number_slider_2, textAlignFlag=center, textNoteType=firstItem)  # Creates a text note at a given location
watch_2 = Watch(byStringAndPosition)
