# Dynamo graph Core.Clipboard.dyn (Dynamo 1.0.0.1180)

code_block = CodeBlock { "This is a test."; }
sendTo = Custom[Clipboard.SendTo](str=code_block)  # Copies a string to the clipboard.
code_block_2 = CodeBlock(clipboard=sendTo)
# ---------- code_block_2.designscript (3 lines) ----------
// Make sure the data is sent to the clipboard
// before trying to retrieve it...
{clipboard,true}[1];
# ----------------------------------------
getFrom = Custom[Clipboard.GetFrom](toggle=code_block_2)  # Gets the content of the clipboard. ATTENTION: Will only work with strings.
watch = Watch(getFrom)
