# Dynamo graph Core.Color.dyn (Dynamo 1.3.0.875)

aqua = Custom[Color.Aqua]()  # Returns the colour aqua.
code_block = CodeBlock { 0; }
color_range = ColorRange(aqua, code_block, code_block)
blue = Custom[Color.Blue]()  # Returns the colour blue.
color_range_2 = ColorRange(blue, code_block, code_block)
green = Custom[Color.Green]()  # Returns the colour green.
color_range_3 = ColorRange(green, code_block, code_block)
lime = Custom[Color.Lime]()  # Returns the colour lime.
color_range_4 = ColorRange(lime, code_block, code_block)
navy = Custom[Color.Navy]()  # Returns the colour navy.
color_range_5 = ColorRange(navy, code_block, code_block)
purple = Custom[Color.Purple]()  # Returns the colour purple.
color_range_6 = ColorRange(purple, code_block, code_block)
silver = Custom[Color.Silver]()  # Returns the colour silver.
color_range_7 = ColorRange(silver, code_block, code_block)
white = Custom[Color.White]()  # Returns the colour white.
color_range_8 = ColorRange(white, code_block, code_block)
string = StringInput("#FF9900")
byWebColor = Custom[Color.ByWebColor](hex=string)  # Creates a color from a given web color (a hex triplet like #FF9900)
color_range_9 = ColorRange(byWebColor, code_block, code_block)
number_slider = DoubleSlider(0.4, range=0..1 step 0.1)
greyscaleByNormalizedValue = Custom[Color.GreyscaleByNormalizedValue](dbl=number_slider)  # Creates a greyscale color based on a normalized value (0 = black, 1 = white)
color_range_10 = ColorRange(greyscaleByNormalizedValue, code_block, code_block)
black = Custom[Color.Black]()  # Returns the colour black.
color_range_11 = ColorRange(black, code_block, code_block)
fuchsia = Custom[Color.Fuchsia]()  # Returns the colour fuchsia a.k.a. magenta.
color_range_12 = ColorRange(fuchsia, code_block, code_block)
grey = Custom[Color.Grey]()  # Returns the colour grey.
color_range_13 = ColorRange(grey, code_block, code_block)
maroon = Custom[Color.Maroon]()  # Returns the colour maroon.
color_range_14 = ColorRange(maroon, code_block, code_block)
olive = Custom[Color.Olive]()  # Returns the colour olive.
color_range_15 = ColorRange(olive, code_block, code_block)
red = Custom[Color.Red]()  # Returns the colour red.
color_range_16 = ColorRange(red, code_block, code_block)
teal = Custom[Color.Teal]()  # Returns the colour teal.
color_range_17 = ColorRange(teal, code_block, code_block)
yellow = Custom[Color.Yellow]()  # Returns the colour yellow.
color_range_18 = ColorRange(yellow, code_block, code_block)
code_block_2 = CodeBlock { hex : string; }  # unwired: hex
turnIntoList = Custom[Turn Into List](unknownItem=string)  # Turns an element (or a nested list) into a flat list
code_block_3 = CodeBlock { "#"; ""; {0,2,4}; 2; }
replace = String.Replace(str=turnIntoList, searchFor=code_block_3.out0, replaceWith=code_block_3.out1)
substring = String.Substring(str=replace, startIndex=code_block_3.out2@L1, length=code_block_3.out3)
transpose = List.Transpose(substring)
code_block_4 = CodeBlock(seq2=substring) { seq2[0]; seq2[1]; seq2[2]; }
hexToDecimal = Custom[String.HexToDecimal](hex=code_block_4.out0)  # Converts a string of a hexadecimal value to a number
hexToDecimal_2 = Custom[String.HexToDecimal](hex=code_block_4.out1)
hexToDecimal_3 = Custom[String.HexToDecimal](hex=code_block_4.out2)
byARGB = Color.ByARGB(r=hexToDecimal, g=hexToDecimal_2, b=hexToDecimal_3)
returnListOrSingleValue = Custom[ReturnListOrSingleValue](unknownItem=string, seq=byARGB)  # If the item in input #1 is not a list, only the first item of the list in input #2 will be returned.
code_block_5 = CodeBlock(color=returnListOrSingleValue) { color; }
