# Dynamo graph Core.CustomNode.dyn (Dynamo 1.0.0.1180)

file_path = Filename("U:\repos\ClockworkForDynamo\nodes\0.9.x\All Intersecting Elements Of Category.dyf")
info = Custom[CustomNode.Info](path=file_path)  # Extracts information from a custom node.
watch = Watch(info.InputDefaultVals)
watch_2 = Watch(info.PythonScripts)
watch_3 = Watch(info.BuiltinNodesCount)
watch_4 = Watch(info.ID)
watch_5 = Watch(info.Category)
watch_6 = Watch(info.Outputs)
watch_7 = Watch(info.NestedBuiltinNodes)
watch_8 = Watch(info.NestedCustomNodes)
watch_9 = Watch(info.Name)
watch_10 = Watch(info.Description)
watch_11 = Watch(info.Inputs)
watch_12 = Watch(info.InputDataTypes)
watch_13 = Watch(info.CustomNodesCount)
watch_14 = Watch(info.Version)
