# Dynamo graph Core.DateTime.dyn (Dynamo 1.3.2.2480)

now = DateTime.Now()
calendarWeek = Custom[Date.CalendarWeek](date=now)  # Retrieves the calendar week for the given date
watch = Watch(calendarWeek)
string = StringInput("05:00")
fromString = TimeSpan.FromString(string)
addTimeSpan = DateTime.AddTimeSpan(now, fromString)
isLater = Custom[DateTime.IsLater](dateTime1=now, dateTime2=addTimeSpan)  # Determines if a given date and time are later than another given date and time.
watch_2 = Watch(isLater)
isEarlier = Custom[DateTime.IsEarlier](dateTime1=now, dateTime2=addTimeSpan)  # Determines if a given date and time are earlier than another given date and time.
watch_3 = Watch(isEarlier)
