# Dynamo graph Core.Directory.dyn (Dynamo 1.0.0.1180)

code_block = CodeBlock()
# ---------- code_block.designscript (2 lines) ----------
// Search string is optional
"*.rvt";
# ----------------------------------------
directory_path = Directory("U:\projekte")
contentsAll = Custom[Directory.ContentsAll](dir=directory_path)  # Unlike the built-in node Directory.Contents, this node browses a directory recursively and returns all relevant files contained in subfolders as well.
watch = Watch(contentsAll)
