# Dynamo graph Core.File.dyn (Dynamo 1.3.4.6666)

string = StringInput("C:\Temp\TestCSV.csv")
string_2 = StringInput(";")
code_block = CodeBlock { 1..100; 10; }
chop = List.Chop(list=code_block.out0, lengths=code_block.out1)
string_from_object = FromObject(chop)
writeToCSV = Custom[File.WriteToCSV](path=string, delimiter=string_2, data=string_from_object)  # Writes data to a CSV file with a custom delimiter. Data inputs needs to contain strings only!
passthrough = Custom[Passthrough](passThrough=string, waitFor=writeToCSV)  # Forces a sequential order of execution. The node wired into the output of the Passthrough node will be executed *after* the node wired into the waitFor input (e.g. important for some Revit operations). The value of the passThrough input will be passed on to the node wired into the output port of the Passthrough node.
fromPath = FileObject(passthrough)  # "File.FromPath"
readText = File.ReadText(fromPath)
watch = Watch(readText)
size = Custom[File.Size](file=fromPath)  # Returns the file size of a given file.
watch_2 = Watch(size.bytes)
watch_3 = Watch(size.kilobytes)
watch_4 = Watch(size.megabytes)
created = Custom[File.Created](file=fromPath)  # Returns the date and time a given file was created
watch_5 = Watch(created)
lastAccessed = Custom[File.LastAccessed](file=fromPath)  # Returns the date and time a given file was last accessed
watch_6 = Watch(lastAccessed)
lastModified = Custom[File.LastModified](file=fromPath)  # Returns the date and time a given file was last modified
watch_7 = Watch(lastModified)
