# Dynamo graph Core.Graphs.dyn (Dynamo 1.0.0.1180)

number = DoubleInput(1)
string_from_object = FromObject(number)
number_2 = DoubleInput(4)
string_from_object_2 = FromObject(number_2)
number_3 = DoubleInput(2)
string_from_object_3 = FromObject(number_3)
create_list = List.Create(string_from_object, string_from_object_3)
number_4 = DoubleInput(3)
string_from_object_4 = FromObject(number_4)
create_list_2 = List.Create(string_from_object_3, string_from_object_4)
create_list_3 = List.Create(string_from_object_4, string_from_object_2)
create_list_4 = List.Create(string_from_object, string_from_object_2)
create_list_5 = List.Create(string_from_object_3, string_from_object_2)
create_list_6 = List.Create(create_list, create_list_2, create_list_3, create_list_4, create_list_5)
allPaths = Custom[PathGraph.AllPaths](start=string_from_object, end=string_from_object_2, stringPairs=create_list_6)  # Finds all possible paths between two nodes. The connections input expects a list of value pairs.
watch = Watch(allPaths)
shortestPath = Custom[PathGraph.ShortestPath](start=string_from_object, end=string_from_object_2, stringPairs=create_list_6)  # Finds the shortest path (fewest steps) between two nodes. The connections input expects a list of value pairs.
watch_2 = Watch(shortestPath)
watch_3 = Watch(create_list_6)
