# Dynamo graph Core.List.Actions.dyn (Dynamo 1.3.1.1736)

code_block = CodeBlock { {false,false,true,false,true,true}; }
countBooleanSequences = Custom[List.CountBooleanSequences](booleans=code_block)  # Retrieves the lengths of uninterrupted sequences of booleans (true or false) in a given list.
watch = Watch(countBooleanSequences.true)
watch_2 = Watch(countBooleanSequences.false)
code_block_2 = CodeBlock { {1..5,3..10,6..8}; }
watch_3 = Watch(code_block_2)
equalSublistLengths = Custom[List.EqualSublistLengths](lists=watch_3)  # Trims all given lists to the length of the shortest list
watch_4 = Watch(equalSublistLengths)
code_block_3 = CodeBlock { 1..6; {2,4}; }
chop = List.Chop(list=code_block_3.out0, lengths=code_block_3.out1)
watch_5 = Watch(chop)
code_block_4 = CodeBlock { 2; }
filterBySublistLength = Custom[List.FilterBySublistLength](seq=watch_5, length=code_block_4)  # Filters out all sublists that do not have the specified length
watch_6 = Watch(filterBySublistLength.in)
watch_7 = Watch(filterBySublistLength.out)
string = StringInput("""Animal
Animal
Animal
Fruit
Fruit
Animal
Fruit""")
string_2 = StringInput("\n")
split = String.Split(string, string_2)
string_3 = StringInput("""Elephant
Lion
Eagle
Banana
Strawberry
Zebra
Pineapple""")
split_2 = String.Split(string_3, string_2)
create = List.Create(split, split_2)
watch_8 = Watch(create)
code_block_5 = CodeBlock { 0; }
groupListOfListsByKey = Custom[List.GroupListOfListsByKey](seq=watch_8, keyIndex=code_block_5)  # Groups a list of lists by one of its keys
watch_9 = Watch(groupListOfListsByKey)
code_block_6 = CodeBlock { {2,5,6}; }
watch_10 = Watch(code_block_6)
watch_11 = Watch(split_2)
getKeys = GetKeys(watch_11)
matchWithKeyValues = Custom[List.MatchWithKeyValues](seq=watch_10, keys=getKeys, values=split_2)  # Matches a list with a given set of keys and returns the values corresponding to the keys
watch_12 = Watch(matchWithKeyValues)
code_block_7 = CodeBlock { 1..10; }
string_4 = StringInput("REPLACEMENT")
replaceItemAtIndex = Custom[List.ReplaceItemAtIndex](seq=code_block_7, indices=watch_10, replacement=string_4)  # Replaces the item at a given index (or list of indices) of a list by another item
watch_13 = Watch(replaceItemAtIndex)
count = List.Count(split_2)
code_block_8 = CodeBlock(n=count) { 1..n; }
create_2 = List.Create(split, split_2, code_block_8)
watch_14 = Watch(create_2)
integer_slider = IntegerSlider(1, range=0..2 step 1)
boolean = BoolSelector(false)
sortListOfLists = Custom[List.SortListOfLists](seq=watch_14, sortIndex=integer_slider, caseInsensitive=boolean, orderDescending=boolean)  # Sorts a list of lists by one of its sublists
watch_15 = Watch(sortListOfLists)
empty = List.Empty()
code_block_9 = CodeBlock { 3; }
ofRepeatedItem = List.OfRepeatedItem(item=empty, amount=code_block_9)
join = List.Join(split_2, ofRepeatedItem)
shuffle = List.Shuffle(join)
watch_16 = Watch(shuffle)
replaceEmptyLists = Custom[List.ReplaceEmptyLists](seq=watch_16, Replacement=string_4)  # Replaces all empty lists within a given list with a substitute
watch_17 = Watch(replaceEmptyLists)
code_block_10 = CodeBlock { null; }
code_block_11 = CodeBlock { 3; }
ofRepeatedItem_2 = List.OfRepeatedItem(item=code_block_10, amount=code_block_11)
join_2 = List.Join(split_2, ofRepeatedItem_2)
shuffle_2 = List.Shuffle(join_2)
watch_18 = Watch(shuffle_2)
replaceNull = Custom[List.ReplaceNull](seq=watch_18, replacement=string_4)  # Replaces all null values within a given list with a substitute
watch_19 = Watch(replaceNull)
code_block_12 = CodeBlock { 1..10; }
dropLastItem = Custom[List.DropLastItem](list=code_block_12)  # Drops the last item from a given list.
watch_20 = Watch(dropLastItem)
code_block_13 = CodeBlock { 1..6; {2,0,4}; }
chop_2 = Custom[List.Chop+](seq=code_block_13.out0, lengths=code_block_13.out1)  # Turns a list into a list of lists with sublists of varying lengths.
watch_21 = Watch(chop_2)
uniqueItems = List.UniqueItems(split)
string_5 = StringInput("Something else")
join_3 = List.Join(uniqueItems, string_5)
getKeys_2 = GetKeys(join_3)
boolean_2 = BoolSelector(false)
joinByKey = Custom[List.JoinByKey](keys1=split, seq1=split_2, keys2=join_3, seq2=getKeys_2, excludeUnmatchedKeys=boolean_2)  # Joins two lists by common keys.
watch_22 = Watch(joinByKey.keys)
watch_23 = Watch(joinByKey.seq1)
watch_24 = Watch(joinByKey.seq2)
