# Dynamo graph Core.List.Create.dyn (Dynamo 1.0.0.1180)

string = StringInput("""Apples
Pears
Oranges
Peaches
Bananas
Strawberries
Pineapples
Mangos""")
string_2 = StringInput("\n")
split = String.Split(string, string_2)
integer_slider = IntegerSlider(13, range=0..25 step 1)
randomElements = Custom[List.RandomElements](baseElements=split, amount=integer_slider)  # Creates a list of random elements based on a given list of elements
watch = Watch(randomElements)
code_block = CodeBlock { 1..4; }
watch_2 = Watch(code_block)
reverse = List.Reverse(watch_2)
repeatItemsByLengths = Custom[List.RepeatItemsByLengths](seq=watch_2, lengths=reverse)  # Repeats a list of items into sublists of given lengths
watch_3 = Watch(repeatItemsByLengths)
code_block_2 = CodeBlock { 1; }
watch_4 = Watch(code_block_2)
turnIntoList = Custom[Turn Into List](unknownItem=watch_4)  # Turns an element (or a nested list) into a flat list
watch_5 = Watch(turnIntoList)
create = List.Create(code_block_2)
create_2 = List.Create(create)
watch_6 = Watch(create_2)
turnIntoList_2 = Custom[Turn Into List](unknownItem=watch_6)
watch_7 = Watch(turnIntoList_2)
integer_slider_2 = IntegerSlider(14, range=0..20 step 1)
normalizedSequence = Custom[List.NormalizedSequence](n=integer_slider_2)  # Creates a sequence of N values between 0 and 1
watch_8 = Watch(normalizedSequence)
formula = Formula("Sin(x*Pi/2)")
normalizedSequenceByFunction = Custom[List.NormalizedSequenceByFunction](func=formula, n=integer_slider_2)  # Creates a sequence of N values between 0 and 1 driven by a function
watch_9 = Watch(normalizedSequenceByFunction)
integer_slider_3 = IntegerSlider(58, range=0..100 step 1)
boolean = BoolSelector(false)
alphabeticalSequence = Custom[List.AlphabeticalSequence](n=integer_slider_3, upperCase=boolean)  # Creates a list of the first N letters of the alphabet (where 1 = A, 2 = B, ... , 27 = AA, 28 = AB etc.).
watch_10 = Watch(alphabeticalSequence)
string_3 = StringInput(",")
boolean_2 = BoolSelector(false)
# note: Make sure to specify the correct delimiter
string_4 = StringInput(";")
# note: You can use any CSV file or the sample file provided in the "extra" folder
file_path = Filename("..\extra\CSV_Sample.csv")
fromPath = FileObject(file_path)  # "File.FromPath"
readText = File.ReadText(fromPath)
boolean_3 = BoolSelector(false)
boolean_4 = BoolSelector(false)
fromCSV = Custom[List.FromCSV](delimiter=string_4, CSVstring=readText, ignoreFirstRow=boolean_3, ignoreLastRow=boolean_4)  # Converts the content of a given CSV file to a list
watch_11 = Watch(fromCSV)
string_5 = StringInput("DYNAMO")
fromString = Custom[List.FromString](str=string_5)  # Chops up a string into a list of characters
watch_12 = Watch(fromString)
integer_slider_4 = IntegerSlider(30, range=0..100 step 1)
code_block_3 = CodeBlock(n=integer_slider_4) { 1..n; 3; }
withLeadingZeroes = Custom[List.WithLeadingZeroes](dbl=code_block_3.out0, n=code_block_3.out1)  # Adds leading zeros to a sequence of numbers
watch_13 = Watch(withLeadingZeroes)
code_block_4 = CodeBlock { 1..2; 1; 2; 5; }
fibonacciFromList = Custom[List.FibonacciFromList](initialList=code_block_4.out0, length=code_block_4.out3)  # Creates a Fibonacci row from a starting list (last two values) of a given length (starting values do *not* count toward length).
watch_14 = Watch(fibonacciFromList)
fibonacciFromValues = Custom[List.FibonacciFromValues](A=code_block_4.out1, B=code_block_4.out2, length=code_block_4.out3)  # Creates a Fibonacci row from two starting values of a given length (starting values do *not* count toward length).
watch_15 = Watch(fibonacciFromValues)
