# Dynamo graph Core.List.Query.dyn (Dynamo 1.0.0.1180)

code_block = CodeBlock { 1..3; 4..8; }
create = List.Create(code_block.out0, code_block.out1, code_block.out0)
watch = Watch(create)
isNotEmpty = Custom[List.IsNotEmpty](seq=watch)  # Just the inversion of the built-in Is Empty List node.
watch_2 = Watch(isNotEmpty)
sublistLengths = Custom[List.SublistLengths](seq=watch)  # Gets the lengths of all sublists in a given list of lists.
watch_3 = Watch(sublistLengths)
code_block_2 = CodeBlock { 3; }
sublistsContain = Custom[List.SublistsContain](seq=watch, item=code_block_2)  # Looks for an item in each sublist of a given list and returns true/false for each sublist.
watch_4 = Watch(sublistsContain)
countOccurences = Custom[List.CountOccurences](seq=watch)  # Counts the number of occurences of each unique element in a given list
watch_5 = Watch(countOccurences.uniqueElements)
watch_6 = Watch(countOccurences.count)
code_block_3 = CodeBlock()
# ---------- code_block_3.designscript (3 lines) ----------
{{true,true},
{false,false},
{true,false}};
# ----------------------------------------
watch_7 = Watch(code_block_3)
anyTrue = Custom[List.AnyTrue]()  # Returns true if any item in a list of booleans is true.
map = List.Map(list=watch_7, f_x=anyTrue)
watch_8 = Watch(map)
anyFalse = Custom[List.AnyFalse]()  # Returns true if any item in a list of booleans is false.
map_2 = List.Map(list=watch_7, f_x=anyFalse)
watch_9 = Watch(map_2)
