# Dynamo graph Core.Math.Actions.dyn (Dynamo 1.3.4.6666)

number_slider = DoubleSlider(50, range=0..100 step 0.1)
number_slider_2 = DoubleSlider(46, range=0..100 step 0.1)
number_slider_3 = DoubleSlider(0.1, range=0..1 step 0.1)
similar = Custom[Math.Similar](valA=number_slider, valB=number_slider_2, tolerance=number_slider_3)  # Computes the difference between two values and whether that difference is within a given tolerance factor
watch = Watch(similar.isSimilar)
watch_2 = Watch(similar.difference)
code_block = CodeBlock { 1; }
n1 = Custom[-1](dbl=code_block)  # Decrements a value by 1
watch_3 = Watch(n1)
n1_2 = Custom[+1](dbl=code_block)  # Increments a value by 1
watch_4 = Watch(n1_2)
code_block_2 = CodeBlock { 7677; 5; }
floor = Custom[Math.RoundDownToPrecision](dbl=code_block_2.out0, precision=code_block_2.out1)  # "Math.Floor+"; Rounds a number *down* to a specified precision
watch_5 = Watch(floor)
round = Custom[Math.RoundToPrecision](dbl=code_block_2.out0, precision=code_block_2.out1)  # "Math.Round+"; Rounds a number to a specified precision
watch_6 = Watch(round)
ceiling = Custom[Math.RoundUpToPrecision](dbl=code_block_2.out0, precision=code_block_2.out1)  # "Math.Ceiling+"; Rounds a number *up* to a specified precision
watch_7 = Watch(ceiling)
code_block_3 = CodeBlock { 1..10; }
normalizeRange = Custom[Math.NormalizeRange](seq=code_block_3)  # Normalizes a range of numbers
watch_8 = Watch(normalizeRange)
number_slider_4 = DoubleSlider(32.893, range=20..50 step 0.1)
code_block_4 = CodeBlock { 20; 50; }
normalize = Custom[Math.Normalize](dbl=number_slider_4, min=code_block_4.out0, max=code_block_4.out1)  # Converts a value into a normalized value according to a value range
watch_9 = Watch(normalize)
invertNormalized = Custom[Math.InvertNormalized](dbl=watch_9)  # Inverts a value between 0 and 1 to its opposite (1-x)
watch_10 = Watch(invertNormalized)
scaleNormalized = Custom[Math.ScaleNormalized](dbl=normalize, min=code_block_4.out0, max=code_block_4.out1)  # Scales a normalized value according to a given minimum and maximum
watch_11 = Watch(scaleNormalized)
decimalToHex = Custom[Math.DecimalToHex](decimal=code_block_2.out0)  # Converts a number to a string of its hexadecimal value
watch_12 = Watch(decimalToHex)
decimalToBinary = Custom[Math.DecimalToBinary](decimal=code_block_2.out0)  # Converts a number to a string of its binary value
watch_13 = Watch(decimalToBinary)
code_block_5 = CodeBlock { 0..360..#17; }
code_block_6 = CodeBlock { 0..2; }
cardinalDirectionFromAngle = Custom[Math.CardinalDirectionFromAngle](angle=code_block_5, accuracy=code_block_6@L1)  # Returns the cardinal direction (N, E, S, W) for a given angle (where N = 0°, E = 90° etc.). The accuracy input has three modes: 0 = cardinal directions only, 1 = additional intercardinal directions (i.e. NE, SE, SW, NW), 2 = additional secondary intercardinal directions (NNE, ENE, ESE, SSE, SSW, WSW, WNW, NNW).
watch_14 = Watch(cardinalDirectionFromAngle)
