# Dynamo graph Core.Math.Create.dyn (Dynamo 1.0.0.1180)

almostZero = Custom[Math.AlmostZero]()  # Returns a feasable computational tolerance to zero (1.0e-9 or a billionth of 1) for use in calculations. More background info: https://github.com/ikeough/Dynamo/issues/879
watch = Watch(almostZero)
code_block = CodeBlock { 8; 25; }
randomIntegerList = Custom[Math.RandomIntegerList](max=code_block.out0, amount=code_block.out1)  # Creates a list of random integers between 0 and a given maximum value
watch_2 = Watch(randomIntegerList)
