# Dynamo graph Core.Object.dyn (Dynamo 1.0.0.1180)

string = StringInput("get")
select_model_element = DSModelElementSelection()  # 1 picked in the model
membersByName = Custom[Object.MembersByName](searchFor=string, element=select_model_element)  # Looks up all the members of a given element based on a given name (or part of a name) of the property or method. Search is case-insensitive.
watch = Watch(membersByName)
members = Custom[Object.Members](element=select_model_element)  # Gets a list of all members (properties and methods) of a selected element
watch_2 = Watch(members)
