# Dynamo graph Core.String.dyn (Dynamo 1.3.1.1736)

string = StringInput("[a-zA-Z]*berry")
string_2 = StringInput("""Strawberry123
Raspberry456
Banana789
123Raspberry456""")
string_3 = StringInput("\n")
split = String.Split(string_2, string_3)
watch = Watch(split)
findRegularExpression = Custom[String.FindRegularExpression](RegEx=string, str=watch)  # Returns all occurences of a regular expression within a string (or list of strings). The syntax for regular expressions is explained at http://ironpython-test.readthedocs.org/en/latest/howto/regex.html
watch_2 = Watch(findRegularExpression)
string_4 = StringInput("DYNAMO")
replaceRegularExpression = Custom[String.ReplaceRegularExpression](RegEx=string, str=watch, Replacement=string_4)  # Replaces all occurences of a regular expression within a given string (or list of strings) with another string. The syntax for regular expressions is explained at http://ironpython-test.readthedocs.org/en/latest/howto/regex.html
watch_3 = Watch(replaceRegularExpression)
matchRegularExpression = Custom[String.ContainsRegularExpression](RegEx=string, str=watch)  # "String.MatchRegularExpression"; Determines if a regular expression matches a string (or a list of strings) and returns a boolean value (or a list, depending on the input). The syntax for regular expressions is explained at http://ironpython-test.readthedocs.org/en/latest/howto/regex.html
watch_4 = Watch(matchRegularExpression)
splitByRegularExpression = Custom[String.SplitByRegularExpression](RegEx=string, str=watch)  # Splits a given string by a regular expression. The syntax for regular expressions is explained at http://ironpython-test.readthedocs.org/en/latest/howto/regex.html
watch_5 = Watch(splitByRegularExpression)
string_5 = StringInput("1001101")
binaryToDecimal = Custom[String.BinaryToDecimal](binary=string_5)  # Converts a string of a binary number into a decimal value
watch_6 = Watch(binaryToDecimal)
string_6 = StringInput("-.. -.-- -. .- -- ---")
morseToAlphanumeric = Custom[String.MorseToAlphanumeric](str=string_6)  # Converts a string in Morse code to alphanumeric
watch_7 = Watch(morseToAlphanumeric)
alphanumericToMorse = Custom[String.AlphanumericToMorse](str=watch_7)  # Converts an alphanumeric string to Morse code
watch_8 = Watch(alphanumericToMorse)
string_7 = StringInput("FF9900")
hexToDecimal = Custom[String.HexToDecimal](hex=string_7)  # Converts a string of a hexadecimal value to a number
watch_9 = Watch(hexToDecimal)
code_block = CodeBlock { "1.0.0.1180"; }
toInteger = Custom[VersionNumber.ToInteger](str=code_block)  # Converts a version number (e.g. a Dynamo version number) to an integer.
watch_10 = Watch(toInteger)
code_block_2 = CodeBlock { 78; }
boolean = BoolSelector(true)
fromNumber = Custom[Character.FromNumber](n=code_block_2, upperCase=boolean)  # Converts a number into a character (where 1 = A, 2 = B, ... , 27 = AA, 28 = AB etc.).
watch_11 = Watch(fromNumber)
toNumber = Custom[Character.ToNumber](str=watch_11)  # Converts an Excel-style character to a number (e.g. A = 1, AA = 27 etc.).
watch_12 = Watch(toNumber)
string_8 = StringInput("Impossible:Filename?01.txt")
replaceIllegalFilenameCharacters = Custom[String.ReplaceIllegalFilenameCharacters](str=string_8)  # Replaces all characters in a string that are illegal characters for filenames
watch_13 = Watch(replaceIllegalFilenameCharacters)
string_9 = StringInput("This is a {0} example for {1} replacing multiple items in a string.")
code_block_3 = CodeBlock { {"small","efficiently"}; }
replace = Custom[String.Replace+](str=string_9, replacements=code_block_3)  # Replaces multiple items in a given string. Items in the string have to be denoted as {0], {1}, ..., {n} - corresponding to the respective list index of the replacement string.
watch_14 = Watch(replace)
string_10 = StringInput("Impossible:Familyname?[01]")
replaceIllegalRevitCharacters = Custom[String.ReplaceIllegalRevitCharacters](str=string_10)  # Replaces all characters in a string that are illegal characters for Revit view names etc.
watch_15 = Watch(replaceIllegalRevitCharacters)
boolean_2 = BoolSelector(false)
create = List.Create(boolean, boolean_2, boolean_2, boolean)
binaryFromBooleans = Custom[String.BinaryFromBooleans](booleans=create)  # Creates a binary string from a list of booleans
watch_16 = Watch(binaryFromBooleans)
binaryToBooleans = Custom[String.BinaryToBooleans](str=binaryFromBooleans)  # Converst a binary string to a list of booleans
watch_17 = Watch(binaryToBooleans)
startsWithRegularExpression = Custom[String.StartsWithRegularExpression](RegEx=string, str=watch)  # Determines if a string starts with the regular expression and returns a boolean value (or a list, depending on the input). The syntax for regular expressions is explained at http://ironpython-test.readthedocs.org/en/latest/howto/regex.html
watch_18 = Watch(startsWithRegularExpression)
code_block_4 = CodeBlock { {"i","in"}; {"U","ON"}; }
boolean_3 = BoolSelector(false)
replaceMultiple = Custom[String.ReplaceMultiple](str=string_9, searchFor=code_block_4.out0, replaceWith=code_block_4.out1, sortSearchTermsBySize=boolean_3)  # Replaces multiple search terms in a given string with multiple replacements
watch_19 = Watch(replaceMultiple)
