# Dynamo graph Core.Time.dyn (Dynamo 1.0.0.1180)

empty = List.Empty()
code_block = CodeBlock { 1..10; }
boolean = BoolSelector(true)
lapTime = Custom[Time.LapTime](LapTimes=empty, Passthrough=code_block, rerunToggle=boolean)  # Records a timestamp and adds it to a given list of lap times. Also passes through an arbitrary variable for integration into a graph.
watch = Watch(lapTime.LapTimes)
code_block_2 = CodeBlock { 2; }
permutations = List.Permutations(lapTime.Passthrough, code_block_2)
lapTime_2 = Custom[Time.LapTime](LapTimes=watch, Passthrough=permutations)
watch_2 = Watch(lapTime_2.LapTimes)
string_from_object = FromObject(lapTime_2.Passthrough)
lapTime_3 = Custom[Time.LapTime](LapTimes=watch_2, Passthrough=string_from_object)
watch_3 = Watch(lapTime_3.LapTimes)
evaluateLapTimes = Custom[Time.EvaluateLapTimes](LapTimes=watch_3)  # Evaluates a list of lap times and returns the overall time
watch_4 = Watch(evaluateLapTimes.NetLapTimes)
watch_5 = Watch(evaluateLapTimes.OverallTime)
