# Dynamo graph Geometry.BoundingBox.dyn (Dynamo 1.3.2.2480)

origin = Point.Origin()
code_block = CodeBlock { 5; }
byCenterPointRadius = Sphere.ByCenterPointRadius(centerPoint=origin, radius=code_block)
boundingBox = Geometry.BoundingBox(byCenterPointRadius)
code_block_2 = CodeBlock { 1; }
byCoordinates = Vector.ByCoordinates(x=code_block_2, y=code_block_2, z=code_block_2)
normalized = Vector.Normalized(byCoordinates)
perimeterCurvesByNormal = Custom[BoundingBox.PerimeterCurvesByNormal](boundingbox=boundingBox, normal=normalized)  # Returns the perimeter curve of a bounding box on a plane determined by a given normal and the centroid of the bounding box
create = List.Create(perimeterCurvesByNormal, byCenterPointRadius)
watch_3d = Watch3D(create)
XAxis = Vector.XAxis()
code_block_3 = CodeBlock { 10; }
scale = Vector.Scale(vector=XAxis, scale_factor=code_block_3)
translate = Geometry.Translate(geometry=byCenterPointRadius, direction=scale)
boundingBox_2 = Geometry.BoundingBox(translate)
create_2 = List.Create(boundingBox, boundingBox_2)
fromBoundingBoxes = Custom[BoundingBox.FromBoundingBoxes](boundingBoxes=create_2)  # Merges a list of bounding boxes into a single bounding box
ZAxis = Vector.ZAxis()
byOriginNormal = Plane.ByOriginNormal(origin=origin, normal=ZAxis)
perimeterCurvesOnPlane = Custom[BoundingBox.PerimeterCurvesOnPlane](boundingbox=fromBoundingBoxes, plane=byOriginNormal)  # Returns the perimeter curve of a bounding box on a given plane (assuming that the bounding box and plane intersect)
create_3 = List.Create(perimeterCurvesOnPlane, byCenterPointRadius)
watch_3d_2 = Watch3D(create_3)
properties = Custom[BoundingBox.Properties](boundingBox=boundingBox)  # Retrieves the centroid, width depth and height of a given bounding box
watch = Watch(properties.Centroid)
watch_2 = Watch(properties.Width)
watch_3 = Watch(properties.Depth)
watch_4 = Watch(properties.Height)
