# Dynamo graph Geometry.Plane.dyn (Dynamo 1.3.2.2480)

origin = Point.Origin()
code_block = CodeBlock { 2; 0.5; }
byCoordinates = Point.ByCoordinates(x=code_block.out0)
byCoordinates_2 = Point.ByCoordinates(x=code_block.out0, y=code_block.out0, z=code_block.out1)
byCoordinates_3 = Point.ByCoordinates(y=code_block.out0)
create = List.Create(origin, byCoordinates, byCoordinates_2, byCoordinates_3)
watch = Watch(create)
byFirst3Points = Custom[Plane.ByFirst3Points](points=watch)  # Returns a plane, its origin and its normal based on the first three XYZs in a given list
code_block_2 = CodeBlock { 1; 2; 3; }
shiftIndices = List.ShiftIndices(list=create, amount=code_block_2.out0)
watch_2 = Watch(shiftIndices)
byFirst3Points_2 = Custom[Plane.ByFirst3Points](points=watch_2)
shiftIndices_2 = List.ShiftIndices(list=create, amount=code_block_2.out1)
watch_3 = Watch(shiftIndices_2)
byFirst3Points_3 = Custom[Plane.ByFirst3Points](points=watch_3)
shiftIndices_3 = List.ShiftIndices(list=create, amount=code_block_2.out2)
watch_4 = Watch(shiftIndices_3)
byFirst3Points_4 = Custom[Plane.ByFirst3Points](points=watch_4)
create_2 = List.Create(byFirst3Points, byFirst3Points_2, byFirst3Points_3, byFirst3Points_4)
watch_3d = Watch3D(create_2)
code_block_3 = CodeBlock { 1; }
byLengths = Cuboid.ByLengths(width=code_block_3, length=code_block_3, height=code_block_3)
explode = Geometry.Explode(byLengths)
watch_5 = Watch(explode)
byBestFitFromFace = Custom[Plane.ByBestFitFromFace](surface=watch_5)  # Creates a plane from face
watch_3d_2 = Watch3D(byBestFitFromFace)
watch_6 = Watch(byBestFitFromFace)
deconstruct = List.Deconstruct(list=watch_6)
isCoplanarWithPlane = Custom[Plane.IsCoplanarWithPlane](plane1=deconstruct.first, plane2=deconstruct.rest)  # Checks if a given plane is coplanar with another plane
watch_7 = Watch(isCoplanarWithPlane)
