# Dynamo graph Geometry.PointSequence.dyn (Dynamo 1.0.0.1180)

code_block = CodeBlock { {1,2,4,8,16}; }
code_block_2 = CodeBlock { 0..4; }
byCoordinates = Point.ByCoordinates(x=code_block, z=code_block_2)
watch = Watch(byCoordinates)
origin = Point.Origin()
greatestDistanceToPoint = Custom[PointSequence.GreatestDistanceToPoint](seq=watch, point=origin)  # Retrieves the furthest point in a sequence of points
watch_2 = Watch(greatestDistanceToPoint.bool)
watch_3 = Watch(greatestDistanceToPoint.distance)
accumulatedDistance = Custom[PointSequence.AccumulatedDistance](seq=watch)  # Retrieves the accumulated distances of a sequence of points
watch_4 = Watch(accumulatedDistance)
code_block_3 = CodeBlock { {3,9,12,16}; }
code_block_4 = CodeBlock { 0..3; }
byCoordinates_2 = Point.ByCoordinates(y=code_block_3, z=code_block_4)
create = List.Create(byCoordinates, byCoordinates_2)
watch_5 = Watch(create)
shortestPath = Custom[PointSequences.ShortestPath](seq=watch_5)  # Retrieves the shortest path from a number of point sequences
watch_6 = Watch(shortestPath.bool)
watch_7 = Watch(shortestPath.distance)
origin_2 = Point.Origin()
ZAxis = Vector.ZAxis()
byOriginNormal = Plane.ByOriginNormal(origin=origin_2, normal=ZAxis)
containsOutOfPlanePoints = Custom[PointSequence.ContainsOutOfPlanePoints](face_plane=byOriginNormal, seq=watch)  # Checks a list for XYZs that are not located on a given plane
watch_8 = Watch(containsOutOfPlanePoints.bool)
watch_9 = Watch(containsOutOfPlanePoints.max)
watch_3d = Watch3D(create)
