# Dynamo graph Geometry.Solid.dyn (Dynamo 1.3.4.6666)

byLengths = Cuboid.ByLengths()
XAxis = Vector.XAxis()
translate = Geometry.Translate(geometry=byLengths, direction=XAxis)
XAxis_2 = Vector.XAxis()
translate_2 = Geometry.Translate(geometry=translate, direction=XAxis_2)
create = List.Create(byLengths, translate, translate_2)
byUnion = Custom[Solid.ByUnion+](solids=create)
