# Dynamo graph Geometry.Surface.dyn (Dynamo 1.0.0.1180)

origin = Point.Origin()
code_block = CodeBlock { 2; }
byCoordinates = Point.ByCoordinates(x=code_block)
number_slider = DoubleSlider(0, range=0..2 step 0.1)
byCoordinates_2 = Point.ByCoordinates(x=code_block, y=code_block, z=number_slider)
byCoordinates_3 = Point.ByCoordinates(y=code_block)
create = List.Create(origin, byCoordinates, byCoordinates_2, byCoordinates_3)
byPerimeterPoints = Surface.ByPerimeterPoints(create)
isPlanar = Custom[Surface.IsPlanar](surface=byPerimeterPoints)  # Checks whether a face is planar
watch = Watch(isPlanar)
watch_3d = Watch3D(byPerimeterPoints)
byLengths = Cuboid.ByLengths(width=code_block, length=code_block, height=code_block)
explode = Geometry.Explode(byLengths)
filterByOrientation = Custom[Surface.FilterByOrientation](surfaces=explode)  # Sorts surfaces in three lists based on their orientation (vertical, horizontal up & horizontal down) and also returns three corresponding lists of booleans.
watch_2 = Watch(filterByOrientation.isHorizontalUp)
watch_3 = Watch(filterByOrientation.isVertical)
watch_4 = Watch(filterByOrientation.isHorizontalDown)
watch_5 = Watch(filterByOrientation.horizontalDown)
watch_6 = Watch(filterByOrientation.horizontalUp)
watch_7 = Watch(filterByOrientation.vertical)
