# Dynamo graph Geometry.UV.Actions.dyn (Dynamo 1.0.0.1180)

code_block = CodeBlock { 1; }
number_slider = DoubleSlider(0.621, range=0..1 step 0.1)
byCoordinates = UV.ByCoordinates(code_block, number_slider)
watch = Watch(byCoordinates)
code_block_2 = CodeBlock { 0.1; }
roundToPrecision = Custom[UV.RoundToPrecision](uv=watch, Precision=code_block_2)  # Rounds a UV coordinate to a specified precision
watch_2 = Watch(roundToPrecision)
roundUpToPrecision = Custom[UV.RoundUpToPrecision](uv=watch, Precision=code_block_2)  # Rounds a UV coordinate *up* to a specified precision
watch_3 = Watch(roundUpToPrecision)
roundDownToPrecision = Custom[UV.RoundDownToPrecision](uv=watch, Precision=code_block_2)  # Rounds a UV coordinate to a specified precision
watch_4 = Watch(roundDownToPrecision)
swap = Custom[UV.Swap](uv=watch)  # Swaps U and V coordinates
watch_5 = Watch(swap)
code_block_3 = CodeBlock { 20; 0.2; 0.8; 5; }
byWidthLength = Rectangle.ByWidthLength(width=code_block_3.out3, length=code_block_3.out3)
byPatch = Surface.ByPatch(byWidthLength)
randomList = Math.RandomList(code_block_3.out0)
remapRange = Math.RemapRange(numbers=randomList, newMin=code_block_3.out1, newMax=code_block_3.out2)
byCoordinates_2 = UV.ByCoordinates(remapRange, remapRange, lacing=CrossProduct)
flatten = Flatten(byCoordinates_2)
code_block_4 = CodeBlock { 3; 0; }
takeEveryNthItem = List.TakeEveryNthItem(flatten, code_block_4.out0, code_block_4.out1)
watch_6 = Watch(takeEveryNthItem)
convexHull2D = Custom[UV.ConvexHull2D](UVs=watch_6)  # Computes the convex hull of a given set of UV coordinates based on the monotone chain algorithm
watch_7 = Watch(convexHull2D)
U = UV.U(watch_7)
V = UV.V(watch_7)
pointAtParameter = Surface.PointAtParameter(surface=byPatch, u=U, v=V)
boolean = BoolSelector(true)
byPoints = PolyCurve.ByPoints(points=pointAtParameter, connectLastToFirst=boolean)
U_2 = UV.U(watch_6)
V_2 = UV.V(watch_6)
pointAtParameter_2 = Surface.PointAtParameter(surface=byPatch, u=U_2, v=V_2)
create = List.Create(byPoints, pointAtParameter_2)
watch_3d = Watch3D(create)
number_slider_2 = DoubleSlider(0.011, range=0..0.3 step 0.1)
pruneDuplicates = Custom[UV.PruneDuplicates](UVs=watch_6, Tolerance=number_slider_2)  # Prune UVs to exclude duplicates within a given tolerance
count = List.Count(pruneDuplicates)
watch_8 = Watch(count)
count_2 = List.Count(watch_6)
watch_9 = Watch(count_2)
