# Dynamo graph Geometry.UV.Create.dyn (Dynamo 1.0.0.1180)

number_slider = DoubleSlider(18.70503597, range=0..100 step 0.1)
number_slider_2 = DoubleSlider(35.25179856, range=0..100 step 0.1)
byCoordinates = Point.ByCoordinates(x=number_slider, y=number_slider_2)
byXY = Custom[UV.ByXY](point=byCoordinates)  # Creates UVs from the XY components of point coordinates
watch = Watch(byXY)
