# Dynamo graph Geometry.UV.Query.dyn (Dynamo 1.3.1.1736)

code_block = CodeBlock { {0.2,0.8}; }
byCoordinates = UV.ByCoordinates(code_block, code_block, lacing=CrossProduct)
flatten = Flatten(byCoordinates)
watch = Watch(flatten)
average = Custom[UV.Average](UVs=watch)  # Determines the average of a list of UVs
watch_2 = Watch(average)
