# Dynamo graph Paneling.DataPreparation.dyn (Dynamo 1.0.0.1180)

origin = Point.Origin()
code_block = CodeBlock { 2; }
byCoordinates = Point.ByCoordinates(x=code_block)
byStartPointEndPoint = Line.ByStartPointEndPoint(startPoint=origin, endPoint=byCoordinates)
byCoordinates_2 = Point.ByCoordinates(y=code_block)
code_block_2 = CodeBlock { 1; }
byCoordinates_3 = Point.ByCoordinates(x=code_block, y=code_block, z=code_block_2)
byStartPointEndPoint_2 = Line.ByStartPointEndPoint(startPoint=byCoordinates_2, endPoint=byCoordinates_3)
create = List.Create(byStartPointEndPoint, byStartPointEndPoint_2)
byRuledLoft = Surface.ByRuledLoft(create)
integer_slider = IntegerSlider(13, range=0..20 step 1)
integer_slider_2 = IntegerSlider(10, range=0..20 step 1)
gridFromFace = Custom[Paneling.GridFromFace](surface=byRuledLoft, U=integer_slider, V=integer_slider_2)  # Returns UV coordinates, XYZ coordinates and normals for a face with UV subdivision
watch_3d = Watch3D(gridFromFace.Points)
watch = Watch(gridFromFace.Points)
watch_2 = Watch(gridFromFace.Normals)
watch_3 = Watch(gridFromFace.UVs)
file_path = Filename("..\..\1.x\extra\Image_Sample.jpg")
fromPath = FileObject(file_path)  # "File.FromPath"
readFromFile = Image.ReadFromFile(fromPath)
watch_image = WatchImageCore(readFromFile)
pixels = Image.Pixels(image=watch_image, xSamples=integer_slider, ySamples=integer_slider_2)
watch_4 = Watch(pixels)
brightness = Color.Brightness(watch_4)
boolean = BoolSelector(true)
boolean_2 = BoolSelector(false)
boolean_3 = BoolSelector(false)
invertAndMirrorNormalizedValues = Custom[Paneling.InvertAndMirrorNormalizedValues](seq=brightness, Invert=boolean, MirrorVertically=boolean_2, MirrorHorizontally=boolean_3)  # Inverts and mirrors (horizontally & vertically) a nested list of normalized values.
greyscaleByNormalizedValue = Custom[Color.GreyscaleByNormalizedValue](dbl=invertAndMirrorNormalizedValues)  # Creates a greyscale color based on a normalized value (0 = black, 1 = white)
fromPixels = Image.FromPixels(greyscaleByNormalizedValue)
watch_image_2 = WatchImageCore(fromPixels)
