# Dynamo graph Paneling.Patterns.QuadrilateralAlternatingRows.dyn (Dynamo 1.0.0.1180)

# note: Run this graph on the Paneling_Sample model in the extra folder.
select_face = DSFaceSelection()  # 1 picked in the model
firstItem = List.FirstItem(select_face)
integer_slider = IntegerSlider(9, range=0..20 step 1)
integer_slider_2 = IntegerSlider(11, range=0..20 step 1)
gridFromFace = Custom[Paneling.GridFromFace](surface=firstItem, U=integer_slider, V=integer_slider_2)  # Returns UV coordinates, XYZ coordinates and normals for a face with UV subdivision
boolean = BoolSelector(false)
integer_slider_3 = IntegerSlider(0, range=0..3 step 1)
boolean_2 = BoolSelector(false)
quadrilateralAlternatingRows = Custom[Paneling.QuadrilateralAlternatingRows](seq=gridFromFace.UVs, V=integer_slider_2, reverse=boolean, shiftPlacement=integer_slider_3, rotateGridBy90Degrees=boolean_2)  # Creates groups of points from a list of UVs or XYZs for the placement of quadrilateral panels in alternating rows. The placement pattern can be reversed (boolean) and shifted (integer).
watch = Watch(quadrilateralAlternatingRows.oddRows)
family_types = FamilyTypes("4PointACByOffset_VarA:Type 1")
byParametersOnFace = AdaptiveComponent.ByParametersOnFace(watch, firstItem, family_types)
watch_2 = Watch(quadrilateralAlternatingRows.evenRows)
family_types_2 = FamilyTypes("4PointACByOffset_VarA:Type 2")
byParametersOnFace_2 = AdaptiveComponent.ByParametersOnFace(watch_2, firstItem, family_types_2)
