# Dynamo graph Paneling.Patterns.TriangularFlatDiagonal.dyn (Dynamo 1.0.0.1180)

# note: Run this graph on the Paneling_Sample model in the extra folder.
select_face = DSFaceSelection()  # 1 picked in the model
firstItem = List.FirstItem(select_face)
integer_slider = IntegerSlider(9, range=0..20 step 1)
integer_slider_2 = IntegerSlider(11, range=0..20 step 1)
gridFromFace = Custom[Paneling.GridFromFace](surface=firstItem, U=integer_slider, V=integer_slider_2)  # Returns UV coordinates, XYZ coordinates and normals for a face with UV subdivision
boolean = BoolSelector(false)
boolean_2 = BoolSelector(false)
integer_slider_3 = IntegerSlider(0, range=0..2 step 1)
integer_slider_4 = IntegerSlider(0, range=0..2 step 1)
integer_slider_5 = IntegerSlider(0, range=0..2 step 1)
boolean_3 = BoolSelector(false)
triangularFlatDiagonal = Custom[Paneling.TriangularFlatDiagonal](seq=gridFromFace.UVs, V=integer_slider_2, reverseTypeA=boolean, reverseTypeB=boolean_2, shiftPlacementTypeA=integer_slider_3, shiftPlacementTypeB=integer_slider_4, shiftOverallPlacement=integer_slider_5, rotateGridBy90Degrees=boolean_3)  # Creates groups of points from a list of UVs or XYZs for the placement of triangular panels. The placement pattern can be reversed (boolean) and shifted (integer).
watch = Watch(triangularFlatDiagonal.typeA)
family_types = FamilyTypes("3PointACByOffset_VarA:Type 1")
byParametersOnFace = AdaptiveComponent.ByParametersOnFace(watch, firstItem, family_types)
watch_2 = Watch(triangularFlatDiagonal.typeB)
family_types_2 = FamilyTypes("3PointACByOffset_VarA:Type 2")
byParametersOnFace_2 = AdaptiveComponent.ByParametersOnFace(watch_2, firstItem, family_types_2)
