# Dynamo graph Paneling.Patterns.TriangularFlatMirrored.dyn (Dynamo 1.3.2.2480)

# note: This example also requires the XYZ Grid From Face package to be installed.
select_face = DSFaceSelection()  # 1 picked in the model
firstItem = List.FirstItem(select_face)
integer_slider = IntegerSlider(7, range=0..20 step 1)
integer_slider_2 = IntegerSlider(6, range=0..20 step 1)
gridFromFace = Custom[Paneling.GridFromFace](surface=firstItem, U=integer_slider, V=integer_slider_2)  # Returns UV coordinates, XYZ coordinates and normals for a face with UV subdivision
shift_rows = BoolSelector(false)
reverse_rows = BoolSelector(true)
reverse_rows_2 = BoolSelector(false)
shift_placement = IntegerSlider(0, range=0..2 step 1)
shift_placement_2 = IntegerSlider(0, range=0..2 step 1)
rotate_grid = BoolSelector(false)
triangularFlatMirrored = Custom[Paneling.TriangularFlatMirrored](seq=gridFromFace.UVs, V=integer_slider_2, shiftRows=shift_rows, reverseRowsLying=reverse_rows, reverseRowsStanding=reverse_rows_2, shiftPlacementRowsLying=shift_placement, shiftPlacementRowsStanding=shift_placement_2, rotateGridBy90Degrees=rotate_grid)  # Creates groups of points from a list of UVs or XYZs for the placement of triangular (diagrid) panels. The placement pattern can be reversed (boolean) and shifted (integer).
# note: Right corners, lying
family_types = FamilyTypes("3PointACByOffset_VarA:Type 2")
byParametersOnFace = AdaptiveComponent.ByParametersOnFace(triangularFlatMirrored.rightCornersLying, firstItem, family_types, lacing=Longest)
# note: Right corners, standing
family_types_2 = FamilyTypes("3PointACByOffset_VarA:Type 2")
byParametersOnFace_2 = AdaptiveComponent.ByParametersOnFace(triangularFlatMirrored.rightCornersStanding, firstItem, family_types_2, lacing=Longest)
# note: Left corners, standing
family_types_3 = FamilyTypes("3PointACByOffset_VarA:Type 2")
byParametersOnFace_3 = AdaptiveComponent.ByParametersOnFace(triangularFlatMirrored.leftCornersStanding, firstItem, family_types_3, lacing=Longest)
# note: Left corners, lying
family_types_4 = FamilyTypes("3PointACByOffset_VarA:Type 2")
byParametersOnFace_4 = AdaptiveComponent.ByParametersOnFace(triangularFlatMirrored.leftCornersLying, firstItem, family_types_4, lacing=Longest)
# note: Rows, standing
family_types_5 = FamilyTypes("3PointACByOffset_VarA:Type 2")
byParametersOnFace_5 = AdaptiveComponent.ByParametersOnFace(triangularFlatMirrored.rowsStanding, firstItem, family_types_5, lacing=Longest)
# note: Rows, lying
family_types_6 = FamilyTypes("3PointACByOffset_VarA:Type 2")
byParametersOnFace_6 = AdaptiveComponent.ByParametersOnFace(triangularFlatMirrored.rowsLying, firstItem, family_types_6, lacing=Longest)
