# Dynamo graph Revit.Application.dyn (Dynamo 1.3.2.2480)

# note: You can use the Sample Architecture Project (Basic) that ships with Revit to run this graph.
version = Custom[Application.Version]()  # Retrieves the name, version and build of the current Revit application.
watch = Watch(version.Version)
watch_2 = Watch(version.Build)
watch_3 = Watch(version.Name)
watch_4 = Watch(version.Language)
file_path = Filename("..\..\..\..\..\..\..\..\Program Files\Autodesk\Revit 2017\Samples\rac_basic_sample_project.rvt")
basicFileInfo = Custom[RevitFile.BasicFileInfo](filePath=file_path)  # Retrieves basic information about a given Revit file. PLEASE NOTE: The SavedInLaterVersion property is only available when running the node in Revit 2017 or later, it will return Null in previous versions of Revit.
watch_5 = Watch(basicFileInfo.Username)
watch_6 = Watch(basicFileInfo.Version)
watch_7 = Watch(basicFileInfo.IsLocal)
watch_8 = Watch(basicFileInfo.IsWorkshared)
watch_9 = Watch(basicFileInfo.SavedInLaterVersion)
watch_10 = Watch(basicFileInfo.SavedInCurrentVersion)
watch_11 = Watch(basicFileInfo.Language)
watch_12 = Watch(basicFileInfo.CentralPath)
watch_13 = Watch(basicFileInfo.IsCentral)
