# Dynamo graph Revit.Document.Actions.dyn (Dynamo 1.3.4.6666)

directory_path = Directory("C:\Users\andreas\Desktop")
string = StringInput("\ws2")
code_block = CodeBlock(dir=directory_path, path=string) { dir + path; }
saveAs = Custom[Document.SaveAs](filePath=code_block)  # Saves the active Revit document under the given name.
watch = Watch(saveAs)
file_path = Filename("..\..\..\..\..\..\..\..\ProgramData\Autodesk\RVT 2017\Libraries\Germany\Möbel\Wohnen\Bücherschrank.rfa")
loadFamily = Custom[Document.LoadFamily](path=file_path)  # A very crude implementation of family loading. Will *not* reload an already loaded family of the same name.
watch_2 = Watch(loadFamily.familyTypes)
boolean = BoolSelector(true)
boolean_2 = BoolSelector(false)
string_2 = StringInput("Synched with Dynamo")
# note: You'll need to run this on a workshared file...
synchronizeWithCentral = Custom[Document.SynchronizeWithCentral](relinquishProjectStandardWorksets=boolean, relinquishViewWorksets=boolean, relinquishFamilyWorksets=boolean, relinquishUserCreatedWorksets=boolean, relinquishBorrowedElements=boolean, compactCentralModel=boolean_2, saveLocalFileBeforeSync=boolean_2, saveLocalFileAfterSync=boolean, comment=string_2, runMe=boolean)  # Synchronizes a workshared model with the central model.
watch_3 = Watch(synchronizeWithCentral)
file_path_2 = Filename("..\..\..\..\..\..\Desktop\ws.rvt")
boolean_3 = BoolSelector(true)
addLink = Custom[Document.AddLink](filePath=file_path_2, relativePath=boolean_3)  # Adds a link to a model to the current document
watch_4 = Watch(addLink.RevitLinkInstance)
watch_5 = Watch(addLink.success)
watch_6 = Watch(loadFamily.success)
boolean_4 = BoolSelector(true)
setComputeVolumes = Custom[Document.SetComputeVolumes](bool=boolean_4)  # Toggle the area and volume setting to compute volumes on (true) or off (false).
watch_7 = Watch(setComputeVolumes)
