# Dynamo graph Revit.Elements.AngularDimension.dyn (Dynamo 1.3.3.4651)

# note: Run this graph on the CreateStuff sample model.
select_model_element = DSModelElementSelection()  # 1 picked in the model
select_model_element_2 = DSModelElementSelection()  # 1 picked in the model
code_block = CodeBlock { 5; }
views = Views("Ebene 0")
element_types = ElementTypes("DimensionType")
all_elements_of_type = ElementsOfType(element_types)
styleType = DimensionType.StyleType(all_elements_of_type)
code_block_2 = CodeBlock(style=styleType) { style == "Angular"; }
filterByBoolMask = List.FilterByBoolMask(list=all_elements_of_type, mask=code_block_2)
firstItem = List.FirstItem(filterByBoolMask.in)
byElements = Custom[Dimension.AngularByElements](element1=select_model_element, element2=select_model_element_2, radius=code_block, view=views, dimensionType=firstItem)  # "AngularDimension.ByElements"; Creates angular dimensions between elements. Only works in project environment. ATTENTION: Do NOT use in automatic mode.
