# Dynamo graph Revit.Elements.BoundingBox.dyn (Dynamo 1.0.0.1180)

# note: You can use the Sample Architecture Project (Basic) that ships with Revit to run this graph.

categories = Categories("Walls")
all_elements_of_category = ElementsOfCategory(categories)
watch = Watch(all_elements_of_category)
firstItem = List.FirstItem(watch)
views = Views("{3D}")
byElement = Custom[BoundingBox.ByElement](element=firstItem, view=views)  # Gets the bounding box of a Revit element
watch_2 = Watch(byElement.RevitBoundingBox)
watch_3 = Watch(byElement.BottomLeftRearCorner)
watch_4 = Watch(byElement.TopRightFrontCorner)
count = List.Count(watch)
code_block = CodeBlock(n=count) { n/3; }
chop = List.Chop(list=watch, lengths=code_block)
byElements = Custom[BoundingBox.ByNestedListOfElements](elements=chop, view=views)  # "BoundingBox.ByElements"; Retrieves a bounding box for each sublist of elements
watch_5 = Watch(byElements.TopRightFrontCorner)
watch_6 = Watch(byElements.BottomLeftRearCorner)
watch_7 = Watch(byElements.RevitBoundingBox)
watch_8 = Watch(byElements.DynamoBoundingBox)
toCuboid = BoundingBox.ToCuboid(watch_8)
watch_3d = Watch3D(toCuboid)
watch_9 = Watch(byElement.DynamoBoundingBox)
toCuboid_2 = BoundingBox.ToCuboid(watch_9)
watch_3d_2 = Watch3D(toCuboid_2)
fromDynamoBoundingBox = Custom[RevitBoundingBox.FromDynamoBoundingBox](DynamoBoundingBox=watch_9)  # Turns a Dynamo bounding box into a Revit bounding box.
watch_10 = Watch(fromDynamoBoundingBox)
