# Dynamo graph Revit.Elements.CurtainPanel.dyn (Dynamo 1.3.2.2480)

# note: Run this script with the CurtainPanel_Sample file in the extra folder.
categories = Categories("CurtainWallPanels")
all_elements_of_category = ElementsOfCategory(categories)
watch = Watch(all_elements_of_category)
hostPanel = Custom[CurtainPanel.HostPanel](curtainPanel=watch)  # Retrieves the host panel of a given curtain panel. This is typcially needed when wanting to access wall elements used as curtain panels. If no host panel is found, the node will return the input panel instead.
watch_2 = Watch(hostPanel)
isPhantomPanel = Custom[CurtainPanel.IsPhantomPanel](curtainPanel=watch)  # Checks whether a given curtain panel is not an actual model element. (These types of objects get generated when curtain grid segments are deleted or in other words when multiple cells of the curtain grid are merged into one panel)
watch_3 = Watch(isPhantomPanel)
