# Dynamo graph Revit.Elements.CurtainSystem.dyn (Dynamo 1.0.0.1180)

# note: Run this graph on the ModelByFace_sample model in the extra folder.
element_types = ElementTypes("CurtainSystemType")
all_elements_of_type = ElementsOfType(element_types)
firstItem = List.FirstItem(all_elements_of_type)
select_face = DSFaceSelection()  # 1 picked in the model
firstItem_2 = List.FirstItem(select_face)
byFace = Custom[CurtainSystem.ByFace](curtainSystemType=firstItem, surface=firstItem_2)  # Creates a curtain system on top of a face
watch = Watch(byFace)
