# Dynamo graph Revit.Elements.DesignOption.dyn (Dynamo 1.3.1.1736)

designOptions = Custom[Document.DesignOptions]()  # Returns all design options in the model, grouped by design option set
watch = Watch(designOptions.DesignOptions)
designOptionSet = Custom[DesignOption.DesignOptionSet](designOption=watch)  # Returns the design option set of a given design option
watch_2 = Watch(designOptionSet)
name = Custom[Element.Name (Universal)](element=watch)  # "Element.Name+"; Gets an element's name (Dynamo's built-in Name nodes don't work for all element types, e.g. worksets...)
watch_3 = Watch(name)
isPrimary = Custom[DesignOption.IsPrimary](designOption=watch)  # Determines whether a given design option is the primary option in its set
watch_4 = Watch(isPrimary)
