# Dynamo graph Revit.Elements.DetailComponent.dyn (Dynamo 1.0.0.1180)

# note: Run this file on the DetailComponent_Sample model in the extra folder.
code_block = CodeBlock { 5; }
byWidthLength = Rectangle.ByWidthLength(width=code_block, length=code_block)
explode = Geometry.Explode(byWidthLength)
family_types = FamilyTypes("M_Protection Board-Section:19mm")
views = Views("Ebene 0")
byCurve = Custom[DetailComponent.ByCurve](curve=explode, familyType=family_types, view=views)  # Places a line-based detail component in a given view
watch = Watch(byCurve)
