# Dynamo graph Revit.Elements.DetailCurve.dyn (Dynamo 1.3.1.1736)

# note: Run this file on the CreateStuff_Sample model in the extra folder.
code_block = CodeBlock { 5; }
byWidthLength = Rectangle.ByWidthLength(width=code_block, length=code_block)
explode = Geometry.Explode(byWidthLength)
views = Views("Ebene 0")
byCurve = Custom[DetailCurve.ByCurve+](curve=explode, view=views)  # Creates a detail line based on a given curve. Unlike the OOTB node it can also draw circles.
watch = Watch(byCurve)
