# Dynamo graph Revit.Elements.DetailLevel.dyn (Dynamo 1.0.0.1180)

coarse = Custom[DetailLevel.Coarse]()  # Returns the coarse detail level
watch = Watch(coarse)
medium = Custom[DetailLevel.Medium]()  # Returns the medium detail level
watch_2 = Watch(medium)
fine = Custom[DetailLevel.Fine]()  # Returns the fine detail level
watch_3 = Watch(fine)
