# Dynamo graph Revit.Elements.Dimension.dyn (Dynamo 1.3.3.4651)

categories = Categories("Dimensions")
all_elements_of_category = ElementsOfCategory(categories)
element_types = ElementTypes("DimensionType")
all_elements_of_type = ElementsOfType(element_types)
# note: Run this file on the Dimension_Sample model in the extra folder.
name = Element.Name(all_elements_of_type)
code_block = CodeBlock { "RED"; }
eq = name == code_block
filterByBoolMask = List.FilterByBoolMask(list=all_elements_of_type, mask=eq)
firstItem = List.FirstItem(filterByBoolMask.in)
setType = Custom[Dimension.SetType](dimensionInstance=all_elements_of_category, dimensionType=firstItem)  # Changes the dimension type of a given dimension instance to the specified type
watch = Watch(setType.dimensionInstance)
watch_2 = Watch(setType.success)
associatedFamilyParameter = Custom[Dimension.AssociatedFamilyParameter](dimension=all_elements_of_category)  # Returns the associated family parameter of a dimension label (if any). PLEASE NOTE: This node will only work in a family document!
watch_3 = Watch(associatedFamilyParameter.familyParameter)
watch_4 = Watch(associatedFamilyParameter.familyParameterName)
watch_5 = Watch(all_elements_of_category)
referencedElements = Custom[Dimension.ReferencedElements](dimension=all_elements_of_category)  # Returns all elements that are referenced by a given dimension
watch_6 = Watch(referencedElements)
