# Dynamo graph Revit.Elements.DimensionType.dyn (Dynamo 1.0.0.1180)

# note: You can use the Sample Architecture Project (Basic) that ships with Revit to run this graph.
categories = Categories("Dimensions")
all_elements_of_category = ElementsOfCategory(categories)
type = Custom[Element.Type](element=all_elements_of_category)  # Gets the family type of a given element (if applicable).
watch = Watch(type)
style = Custom[DimensionType.Style](dimensionType=watch)  # Gets the style of a given Revit dimension type
watch_2 = Watch(style)
