# Dynamo graph Revit.Elements.Element.Actions.dyn (Dynamo 1.0.0.1180)

select_model_element = DSModelElementSelection()  # 1 picked in the model
watch = Watch(select_model_element)
YAxis = Vector.YAxis()
number_slider = DoubleSlider(9.2, range=0..20 step 0.1)
scale = Vector.Scale(vector=YAxis, scale_factor=number_slider)
boolean = BoolSelector(true)
copyByVector = Custom[Element.CopyByVector](element=watch, vector=scale, rehostToClosestLevel=boolean)  # Copies an element or a list of elements by a given vector.
watch_2 = Watch(copyByVector)
levels = Levels("Level 2")
copyToLevel = Custom[Element.CopyToLevel](element=copyByVector, level=levels)  # Copies an element or a list of elements to a given level. Preserves the element's transform. PLEASE NOTE: This node only works for levels that have at least one view (e.g. floor plan) associated with them.
watch_3 = Watch(copyToLevel)
select_model_element_2 = DSModelElementSelection()  # 1 picked in the model
watch_4 = Watch(select_model_element_2)
select_model_element_3 = DSModelElementSelection()  # 1 picked in the model
watch_5 = Watch(select_model_element_3)
cutGeometry = Custom[Element.CutGeometry](elementToBeCut=watch_4, cuttingElement=watch_5)  # Adds a solid-solid cut for two model elements (if possible).
watch_6 = Watch(cutGeometry)
select_model_element_4 = DSModelElementSelection()  # 1 picked in the model
watch_7 = Watch(select_model_element_4)
joinGeometry = Custom[Element.JoinGeometry](element1=watch_4, element2=watch_7)  # Joins two model elements (if possible). Only works inside the project environment.
watch_8 = Watch(joinGeometry)
categories = Categories("Doors")
# note: Run this graph on the Actons_Sample model
all_elements_of_category = ElementsOfCategory(categories)
groupByHost = Custom[Elements.GroupByHost](elements=all_elements_of_category)  # Groups a list of Revit elements by their respective hosts (if they have any)
watch_9 = Watch(groupByHost.elementsGroupedByHost)
watch_10 = Watch(groupByHost.unhostedElements)
watch_11 = Watch(groupByHost.hosts)
string = StringInput("Material")
setMaterialParameterByCategory = Custom[Element.SetMaterialParameterByCategory](element=watch_4, materialParameterName=string)  # Sets a material parameter of a given element to <By Category>
watch_12 = Watch(setMaterialParameterByCategory.changedElements)
watch_13 = Watch(setMaterialParameterByCategory.unchangedElements)
string_2 = StringInput("RenamedByDynamo")
setName = Custom[Element.SetName](element=watch_5, name=string_2)  # Gets the name of a given Revit element
watch_14 = Watch(setName.Success)
watch_15 = Watch(setName.Fail)
worksets = Custom[Document.Worksets]()  # Returns all Worksets in the current document
string_3 = StringInput("Dynamo")
filterByName = Custom[Elements.FilterByName](elements=worksets, searchString=string_3)  # Retrieves those elements from a collection whose names match the search string
watch_16 = Watch(filterByName.first)
setWorkset = Custom[Element.SetWorkset](workset=watch_16, element=watch)  # Sets the workset of a given element
watch_17 = Watch(setWorkset.changedElements)
watch_18 = Watch(setWorkset.unchangedElements)
select_model_element_5 = DSModelElementSelection()  # 1 picked in the model
views = Views("Override")
integer_slider = IntegerSlider(50, range=0..100 step 1)
overrideTransparencyInView = Custom[Element.OverrideTransparencyInView](element=select_model_element_5, view=views, transparencyPercentage=integer_slider)  # Overrides the transparency of an element in a given view
watch_19 = Watch(overrideTransparencyInView)
select_model_element_6 = DSModelElementSelection()  # 1 picked in the model
resetOverridesInView = Custom[Element.ResetOverridesInView](element=select_model_element_6, view=views)  # Resets all overrides for an element in a given view
watch_20 = Watch(resetOverridesInView)
views_2 = Views("Isolate")
select_model_element_7 = DSModelElementSelection()  # 1 picked in the model
permanentlyIsolateInView = Custom[Element.PermanentlyIsolateInView](view=views_2, element=select_model_element_7)  # (Permanently) isolates elements in the given view
watch_21 = Watch(permanentlyIsolateInView.view)
watch_22 = Watch(permanentlyIsolateInView.element)
views_3 = Views("Isolate Temp")
temporarilyIsolateInView = Custom[Element.TemporarilyIsolateInView](view=views_3, element=select_model_element_7)  # (Temporarily) isolates elements in the given view
watch_23 = Watch(temporarilyIsolateInView.view)
watch_24 = Watch(temporarilyIsolateInView.element)
