# Dynamo graph Revit.Elements.Element.Query.dyn (Dynamo 1.3.4.6666)

categories = Categories("Windows")
categories_2 = Categories("Walls")
create = List.Create(categories, categories_2)
all_elements_of_category = ElementsOfCategory(create)
watch = Watch(all_elements_of_category)
allInstances = Custom[Element.AllInstances](element=watch)  # Retrieves all instances of a given element
watch_2 = Watch(allInstances)
levels = Levels("Level 1")
allInstancesAtLevel = Custom[Element.AllInstancesAtLevel](element=watch, level=levels)  # Retrieves all instances of an element on a given level
watch_3 = Watch(allInstancesAtLevel)
element_types = ElementTypes("Dimension")
all_elements_of_type = ElementsOfType(element_types)
watch_4 = Watch(all_elements_of_type)
views = Views("Level 1")
# note: Only works for annotation elements
allViewDependentInstances = Custom[Element.AllViewDependentInstances](element=watch_4, view=views)  # Retrieves all instances of a view-dependent element in a given view
watch_5 = Watch(allViewDependentInstances)
categories_3 = Categories("Rooms")
all_elements_of_category_2 = ElementsOfCategory(categories_3)
watch_6 = Watch(all_elements_of_category_2)
# note: Only works for rooms, areas and zones
area = Custom[Element.Area](element=watch_6)  # Returns the area property of a given element (if that element has such a property)
watch_7 = Watch(area)
# note: Will only return results when run inside a parametric family
associatedFamilyParameters = Custom[Element.AssociatedFamilyParameters](element=watch)  # Returns the associated family parameters of an element in a family (and the respective element parameters). PLEASE NOTE: This node will only work in a family document!
watch_8 = Watch(associatedFamilyParameters.elementParamaters)
watch_9 = Watch(associatedFamilyParameters.associatedFamilyParameters)
watch_10 = Watch(associatedFamilyParameters.elementParameterNames)
watch_11 = Watch(associatedFamilyParameters.associatedFamilyParameterNames)
number_slider = DoubleSlider(30, range=0..100 step 0.1)
containsTransparentMaterials = Custom[Element.ContainsTransparentMaterials](element=watch, minTransparencyPercentage=number_slider)  # Checks if a given element contains transparent materials.
watch_12 = Watch(containsTransparentMaterials)
elevationOfHostLevel = Custom[Element.ElevationOfHostLevel](element=watch@L2)  # Returns the elevation of the level a given element is associated with
watch_13 = Watch(elevationOfHostLevel)
externalFileReferencePath = Custom[Element.ExternalFileReferencePath](element=watch@L2)  # Returns the full path of an element's external file reference as as string
watch_14 = Watch(externalFileReferencePath)
group = Custom[Element.Group](element=watch@L2)  # Retrieves the group an element belongs to (if any)
watch_15 = Watch(group)
host = Custom[Element.Host+](element=watch@L2)  # Gets an element's host
watch_16 = Watch(host)
ID = Custom[Element.ID+](element=watch@L2)  # Gets the ID of a given Revit elements. Unlike the OOTB Element.Id node, this node should also work on mixed lists of Revit elements and categories.
watch_17 = Watch(ID)
boolean = BoolSelector(true)
inserts = Custom[Element.Inserts](element=watch@L2, includeOpenings=boolean, includeShadows=boolean, includeEmbeddedWalls=boolean, includeSharedEmbeddedInserts=boolean)  # Gets all the objects inserted into a given element.
watch_18 = Watch(inserts)
categories_4 = Categories("Walls")
isOfCategory = Custom[Element.IsOfCategory](element=watch@L2, category=categories_4)  # Checks whether an element is of a specified category
watch_19 = Watch(isOfCategory)
isRelatedToMass = Custom[Element.IsRelatedToMass](element=watch)  # Returns true if an object (wall, roof, floor or curtain system) has been modelled by face and the underlying mass still exists in the project.
watch_20 = Watch(isRelatedToMass)
level = Custom[Element.Level](element=watch@L2)  # Gets an element's level
watch_21 = Watch(level)
location = Custom[Element.Location](element=watch)  # Returns the location of an element as an XYZ (or if it's line-based the start and end point of the line), along with some booleans to help filtering the results. Use this for some element types (e.g. walls or lines) that do not work with the built-in Get Family Instance Location node.
watch_22 = Watch(location.points)
watch_23 = Watch(location.isPoint)
watch_24 = Watch(location.curves)
watch_25 = Watch(location.isCurve)
watch_26 = Watch(location.hasLocation)
watch_27 = Watch(location.curveEndpoints)
boolean_2 = BoolSelector(false)
materials = Custom[Element.Materials](element=watch, returnPaintMaterials=boolean_2)  # Retrieves all materials froma given element
watch_28 = Watch(materials.materials)
watch_29 = Watch(materials.hasMaterial)
watch_30 = Watch(materials.materialVolumes)
watch_31 = Watch(materials.materialAreas)
name = Custom[Element.Name+](element=watch@L2)  # Gets an element's name (Dynamo's built-in Name nodes don't work for all element types, e.g. worksets...)
watch_32 = Watch(name)
# note: Only works with annotation elements
ownerView = Custom[Element.OwnerView](element=watch_4)  # Gets the owner view of a given Revit element (if possible)
watch_33 = Watch(ownerView)
boolean_3 = BoolSelector(false)
panels = Custom[Element.Panels](hostElement=watch@L2, organizeInRows=boolean_3)  # Retrieves the panels nested in a curtain wall, curtain system or glazed roof.
watch_34 = Watch(panels)
string = StringInput("Width")
parameterExists = Custom[Element.ParameterExists](param=string, element=watch)  # Checks if an element contains a parameter of a given name
watch_35 = Watch(parameterExists)
phases = Custom[Element.Phases](element=watch@L2)  # Gets the created and demolished phases of an element
watch_36 = Watch(phases.Created)
watch_37 = Watch(phases.Demolished)
elementType = Custom[Element.ElementType+](element=watch)  # Gets the family type of a given element (if applicable). Unlike the OOTB node, it also works for elements in linked models.
watch_38 = Watch(elementType)
workset = Custom[Element.Workset](element=watch@L2)  # Retrieves the workset of a given element
watch_39 = Watch(workset)
watch_40 = Watch(location.hasRotation)
watch_41 = Watch(location.angle)
detail_level = DetailLevel("Medium")
boolean_4 = BoolSelector(false)
boolean_5 = BoolSelector(false)
geometry = Custom[Element.Geometry+](element=watch, detailLevel=detail_level, includeInvisibleObjects=boolean_4, returnGeometryWithoutInserts=boolean_5)  # Returns Dynamo AND native Revit geometry of a given element
watch_42 = Watch(geometry.dynamoGeometry)
watch_43 = Watch(geometry.revitGeometry)
category = Custom[Element.Category+](element=watch@L2)  # Returns the category of a given element. Unlike the OOTB node Element.GetCategory, it will work for subcategories, families, family documents, schedules and graphics styles as well.
watch_44 = Watch(category.category)
watch_45 = Watch(geometry.subCategory)
watch_46 = Watch(location.hasMultipleCurves)
watch_47 = Watch(location.multipleCurves)
categories_5 = Categories("Stairs")
categories_6 = Categories("StairsRailing")
create_2 = List.Create(categories_5, categories_6)
all_elements_of_category_3 = ElementsOfCategory(create_2)
subComponents = Custom[Element.SubComponents](element=all_elements_of_category_3@L2)  # Retrieves all (retrievable) subcomponents of a given family instance, beam system, stair (runs, landings and supports) or railing (top rails and hand rails).
watch_48 = Watch(subComponents)
superComponent = Custom[Element.SuperComponent](element=watch_48@@L2)  # Retrieves the supercomponent of a given family instance, hand rail, top rail, stair component or beam in a beam system.
watch_49 = Watch(superComponent)
watch_50 = Watch(category.builtInCategory)
curtainGridLines = Custom[Element.CurtainGridLines](hostElement=watch@L2)  # Retrieves the grid lines of curtain walls, curtain systems or glazed roofs.
watch_51 = Watch(curtainGridLines.uGridLines)
watch_52 = Watch(curtainGridLines.vGridLines)
dependentElements = Custom[Element.DependentElements](element=watch@L2)  # Returns all elements that, from a logical point of view, are the children of this element.
watch_53 = Watch(dependentElements)
