# Dynamo graph Revit.Elements.ElevationMarker.dyn (Dynamo 1.3.3.4651)

element_types = ElementTypes("ElevationMarker")
all_elements_of_type = ElementsOfType(element_types)
views = Custom[ElevationMarker.Views](elevationMarker=all_elements_of_type)  # Retrieves all views referenced by a given elevation marker
watch = Watch(views)
