# Dynamo graph Revit.Elements.Enum.dyn (Dynamo 1.3.4.6666)

enums = Custom[Document.Enums]()  # Retrieves all Enums from the Revit API
watch = Watch(enums)
values = Custom[Enum.Values](enumName=watch)  # Returns the keys and values of a given Revit Enum
watch_2 = Watch(values.values)
watch_3 = Watch(values.keys)
