# Dynamo graph Revit.Elements.Family.dyn (Dynamo 1.3.1.1736)

element_types = ElementTypes("Family")
all_elements_of_type = ElementsOfType(element_types)
watch = Watch(all_elements_of_type)
isInPlace = Custom[Family.IsInPlace](family=watch)  # Determines if a family is an in-place family
filterByBoolMask = List.FilterByBoolMask(list=watch, mask=isInPlace)
watch_2 = Watch(filterByBoolMask.in)
placementType = Custom[Family.PlacementType](family=watch)  # Returns the expected host class of a family (if any)
watch_3 = Watch(placementType)
hostingBehavior = Custom[Family.HostingBehavior](family=watch)  # Returns the expected host class of a family (if any)
watch_4 = Watch(hostingBehavior)
hasRoomCalculationPoint = Custom[Family.HasRoomCalculationPoint](family=watch)  # Determines whether the given family has the room calculation point activated.
filterByBoolMask_2 = List.FilterByBoolMask(list=watch, mask=hasRoomCalculationPoint)
watch_5 = Watch(filterByBoolMask_2.in)
