# Dynamo graph Revit.Elements.FamilyInstance.Create.dyn (Dynamo 1.0.0.1180)

code_block = CodeBlock { 2; }
byWidthLength = Rectangle.ByWidthLength(width=code_block, length=code_block)
# note: Run this graph on the CreateStuff_Sample model
explode = Geometry.Explode(byWidthLength)
family_types = FamilyTypes("LinebasedGenMod:LinebasedGenMod")
levels = Levels("Ebene 0")
byCurve = Custom[FamilyInstance.ByCurve](curve=explode, familyType=family_types, level=levels)  # Places a line-based family instance on a given level
watch = Watch(byCurve)
origin = Point.Origin()
family_types_2 = FamilyTypes("Schnitt - KS U-Schalen:KS - U 365x240x240")
views = Views("Ebene 0")
byPointInView = Custom[FamilyInstance.ByPointInView](point=origin, familyType=family_types_2, view=views)  # Places a family instance at a given point in a given view (e.g. a detail component).
watch_2 = Watch(byPointInView)
