# Dynamo graph Revit.Elements.FamilyInstance.Query.dyn (Dynamo 1.3.4.6666)

element_types = ElementTypes("FamilyInstance")
all_elements_of_type = ElementsOfType(element_types)
watch = Watch(all_elements_of_type)
handOrientation = Custom[FamilyInstance.HandOrientation](familyInstance=watch)  # Gets the hand orientation of a hosted object (e.g. a window or a door)
watch_2 = Watch(handOrientation)
copingElements = Custom[FamilyInstance.CopingElements](familyInstance=watch)  # Returns all elements used as coping cutters for a given element.
watch_3 = Watch(copingElements)
isMirrored = Custom[FamilyInstance.IsMirrored](familyInstance=watch)  # Checks if a family instance is mirrored
watch_4 = Watch(isMirrored)
