# Dynamo graph Revit.Elements.GlobalParameter.dyn (Dynamo 1.0.0.1180)

element_types = ElementTypes("GlobalParameter")
all_elements_of_type = ElementsOfType(element_types)
watch = Watch(all_elements_of_type)
getValue = Custom[GlobalParameter.GetValue](globalParameter=watch)  # Gets the value of a global parameter (only in Revit 2016 R2 or later).
watch_2 = Watch(getValue)
