# Dynamo graph Revit.Elements.Group.dyn (Dynamo 1.0.0.1180)

# note: You can use the Sample Architecture Project (Basic) that ships with Revit to run this graph.
element_types = ElementTypes("Group")
all_elements_of_type = ElementsOfType(element_types)
watch = Watch(all_elements_of_type)
members = Custom[Group.Members](group=watch)  # Retrieves the members of a group
watch_2 = Watch(members)
select_model_elements = DSModelElementsSelection()  # 5 picked in the model
code_block = CodeBlock { "Trees"; }
fromElements = Custom[Group.FromElements](elements=select_model_elements, groupName=code_block)  # Creates a group from a list of Revit elements
watch_3 = Watch(fromElements.ungroupableElements)
watch_4 = Watch(fromElements.group)
ungroup = Custom[Group.Ungroup](group=watch_4)  # Ungroups a group and returns the ungrouped elements.
watch_5 = Watch(ungroup)
