# Dynamo graph Revit.Elements.MassFloor.dyn (Dynamo 1.0.0.1180)

categories = Categories("MassFloor")
all_elements_of_category = ElementsOfCategory(categories)
# note: You can run this graph on the ModelByFace_Sample file in the extra folder.
watch = Watch(all_elements_of_category)
mass = Custom[MassFloor.Mass](massFloor=watch)  # Gets the mass a given mass floor belongs to
watch_2 = Watch(mass)
