# Dynamo graph Revit.Elements.Material.dyn (Dynamo 1.3.2.2480)

# note: You can use the Sample Architecture Project (Basic) that ships with Revit to run this graph.
categories = Categories("Materials")
all_elements_of_category = ElementsOfCategory(categories)
watch = Watch(all_elements_of_category)
firstItem = List.FirstItem(watch)
string = StringInput("MyNewMaterial")
duplicate = Custom[Material.Duplicate](material=firstItem, name=string)  # Duplicates a material
watch_2 = Watch(duplicate)
properties = Custom[Material.Properties](material=firstItem)  # Retrieves a number of properties froma given material
watch_3 = Watch(properties.Transparency)
watch_4 = Watch(properties.Glow)
watch_5 = Watch(properties.Smoothness)
watch_6 = Watch(properties.Shininess_x_128)
watch_7 = Watch(properties.Class)
watch_8 = Watch(properties.Color)
assets = Custom[Material.Assets](Material=watch)  # Retrieves all assets from a given material
watch_9 = Watch(assets.AppearanceAsset)
watch_10 = Watch(assets.ThermalAsset)
watch_11 = Watch(assets.StructuralAsset)
