# Dynamo graph Revit.Elements.ModelCurve.dyn (Dynamo 1.3.0.875)

code_block = CodeBlock { 4..6; }
byWidthLength = Rectangle.ByWidthLength(width=code_block, length=code_block)
curves = PolyCurve.Curves(byWidthLength)
code_block_2 = CodeBlock(rect=curves) { rect[0]; rect[1]; rect[2]; }
origin = Point.Origin()
ZAxis = Vector.ZAxis()
byOriginNormal = Plane.ByOriginNormal(origin=origin, normal=ZAxis)
byPlane = SketchPlane.ByPlane(byOriginNormal)
element_types = ElementTypes("ViewPlan")
all_elements_of_type = ElementsOfType(element_types)
type = Custom[View.Type](view=all_elements_of_type)  # Returns the type of a given view
code_block_3 = CodeBlock(type=type) { type == "AreaPlan"; }
filterByBoolMask = List.FilterByBoolMask(list=all_elements_of_type, mask=code_block_3)
# note: Run this graph on the CreateStuff_Sample file in the extra folder.
firstItem = List.FirstItem(filterByBoolMask.in)
watch = Watch(firstItem)
fromCurve = Custom[AreaSeparator.FromCurve](curve=code_block_2.out0, sketchPlane=byPlane, areaPlanView=watch)  # Creates area separation lines from geometry curves.
watch_2 = Watch(fromCurve)
views = Views("Ebene 0")
fromCurve_2 = Custom[RoomSeparator.FromCurve](curve=code_block_2.out1, sketchPlane=byPlane, view=views)  # Creates room separation lines from geometry curves.
watch_3 = Watch(fromCurve_2)
fromCurve_3 = Custom[SpaceSeparator.FromCurve](curve=code_block_2.out2, sketchPlane=byPlane, view=views)  # Creates space separation lines from geometry curves.
watch_4 = Watch(fromCurve_3)
create = List.Create(watch_2, watch_3, watch_4)
type_2 = Custom[ModelCurve.Type](modelCurve=create)  # Gets the type of a given model curve
watch_5 = Watch(type_2)
