# Dynamo graph Revit.Elements.ParameterFilterElement.dyn (Dynamo 1.3.4.6666)

element_types = ElementTypes("ParameterFilterElement")
all_elements_of_type = ElementsOfType(element_types)
filterRuleString = Custom[ParameterFilterElement.FilterRuleString](parameterFilterElement=all_elements_of_type)  # Aggregates the filter rules of a given ParameterFilterElement into a human-readable string
watch = Watch(filterRuleString)
