# Dynamo graph Revit.Elements.RevitLinkType.dyn (Dynamo 1.3.4.6666)

file_path = Filename("No file selected.")
string = StringInput("RevitLinkType")
byName = Custom[ElementType.ByName](name=string)  # Retrieves an element type by its name - to be used with the OOTB node "All Elements of Type".
all_elements_of_type = ElementsOfType(byName)
watch = Watch(all_elements_of_type)
attachmentType = Custom[RevitLinkType.AttachmentType](revitLinkType=watch)  # Returns the attachment type of a RevitLInkType
watch_2 = Watch(attachmentType)
pathType = Custom[RevitLinkType.PathType](revitLinkType=watch)  # Returns the path type of a RevitLInkType
watch_3 = Watch(pathType)
unload_reload = BoolSelector(true)
empty = List.Empty()
scopeIf = Custom[ScopeIf+](test=unload_reload, true=watch, false=empty)  # A (hopefully) more robust implementation of ScopeIf. Tests a single boolean and returns a value accordingly.
unload = Custom[RevitLinkType.Unload](revitLinkType=scopeIf)  # Unloads a Revit or IFC link
watch_4 = Watch(unload.revitLinkType)
watch_5 = Watch(unload.success)
scopeIf_2 = Custom[ScopeIf+](test=unload_reload, true=empty, false=watch)
reload = Custom[RevitLinkType.Reload](revitLinkType=scopeIf_2)  # Reloads a Revit or IFC link.
watch_6 = Watch(reload.revitLinkType)
watch_7 = Watch(reload.success)
