# Dynamo graph Revit.Elements.Room.dyn (Dynamo 1.3.2.2480)

# note: You can use the Sample Architecture Project (Basic) that ships with Revit to run this graph.
categories = Categories("Rooms")
all_elements_of_category = ElementsOfCategory(categories)
boundaries = Custom[Room.Boundaries](room=all_elements_of_category)  # Gets a list of all boundary elements of a given room or area
watch = Watch(boundaries.curves)
watch_2 = Watch(boundaries.elements)
state = Custom[Room.State](room=all_elements_of_category)  # Returns the state of a room, i.e. is it placed, unplaced, redundant or not enclosed.
watch_3 = Watch(state)
boolean = BoolSelector(true)
insertsOfBoundaries = Custom[Room.InsertsOfBoundaries](room=all_elements_of_category, includeOpenings=boolean, includeShadows=boolean, includeEmbeddedWalls=boolean, includeSharedEmbeddedInserts=boolean)  # Retrieves the inserts of the bounding elements of a given room.
watch_4 = Watch(insertsOfBoundaries)
categories_2 = Categories("Doors")
insertsOfBoundariesByCategory = Custom[Room.InsertsOfBoundariesByCategory](room=all_elements_of_category, category=categories_2, includeOpenings=boolean, includeShadows=boolean, includeEmbeddedWalls=boolean, includeSharedEmbeddedInserts=boolean)  # Retrieves the inserts of the bounding elements of a given room - filtered by a given category.
watch_5 = Watch(insertsOfBoundariesByCategory)
doors = Custom[Room.Doors](room=all_elements_of_category)  # Retrieves all doors that are associated with a room (hosted in walls and roofs).
watch_6 = Watch(doors)
windows = Custom[Room.Windows](room=all_elements_of_category)  # Retrieves all windows that are associated with a room (hosted in walls and roofs).
watch_7 = Watch(windows)
builtInParameters = Custom[Document.BuiltInParameters]()  # List all the available BuiltInParameters
string = StringInput("ROOM_NUMBER")
string_from_object = FromObject(builtInParameters.BuiltInParameters)
eq = string == string_from_object
filterByBoolMask = List.FilterByBoolMask(list=builtInParameters.ParameterNames, mask=eq)
firstItem = List.FirstItem(filterByBoolMask.in)
code_block = CodeBlock()
# ---------- code_block.designscript (3 lines) ----------
// A sequence of room numbers
// of connected rooms
{"201","202","203"};
# ----------------------------------------
contains = Contains(code_block)  # unwired: arg1
filterByParameterValueAndCondition = Custom[Elements.FilterByParameterValueAndCondition](elements=all_elements_of_category, param=firstItem, func=contains)
phases = Custom[Document.Phases]()  # Retrieves all phases in the active document in *chronological* order
string_2 = StringInput("Working Drawings")
filterByName = Custom[Elements.FilterByName](elements=phases, searchString=string_2)  # Retrieves those elements from a collection whose names match the search string
toDoorSequence = Custom[RoomSequence.ToDoorSequence](rooms=filterByParameterValueAndCondition.in, phase=filterByName.first)  # Retrieves a sequence of doors connecting a given sequence of rooms (if possible)
watch_8 = Watch(toDoorSequence)
code_block_2 = CodeBlock { {"DummyRoom1","DummyRoom2","DummyRoom3"}; 1001..1003; }
string_from_object_2 = FromObject(code_block_2.out1)
unplacedByNameAndNumber = Custom[Room.UnplacedByNameAndNumber](names=code_block_2.out0, numbers=string_from_object_2)  # Creates an unplaced room
watch_9 = Watch(unplacedByNameAndNumber)
finishes = Custom[Room.Finishes](room=all_elements_of_category)  # Returns all room bounding faces and their materials
watch_10 = Watch(finishes.finishMaterials)
watch_11 = Watch(finishes.areas)
watch_12 = Watch(finishes.faceTypes)
watch_13 = Watch(finishes.revitFaces)
watch_14 = Watch(finishes.elements)
