# Dynamo graph Revit.Elements.SelectionSet.dyn (Dynamo 1.0.0.1180)

code_block = CodeBlock { "My awesome SelectionSet generated by Dynamo"; }
select_model_elements = DSModelElementsSelection()  # 127 picked in the model
byElements = Custom[SelectionSet.ByElements](Name=code_block, elements=select_model_elements)  # Creates a selection set of the given elements. Note that if a selection set of the given name already exists in the model, its contents will be replaced. Also, if the selection set is already applied as a view filter, the view filter will have to be manually updated in the visibility / graphic overrides.
watch = Watch(byElements)
elements = Custom[SelectionSet.Elements](selectionSet=watch)  # Retrieves all elements stored in a selection set
watch_2 = Watch(elements)
