# Dynamo graph Revit.Elements.SharedParameterElement.dyn (Dynamo 1.3.4.6666)

element_types = ElementTypes("SharedParameterElement")
all_elements_of_type = ElementsOfType(element_types)
GUID = Custom[SharedParameterElement.GUID](sharedParameterElement=all_elements_of_type)  # Returns the GUID of a shared parameter
watch = Watch(GUID)
