# Dynamo graph Revit.Elements.SpotCoordinate.dyn (Dynamo 1.3.3.4651)

origin = Point.Origin()
views = Views("Ebene 0")
XAxis = Vector.XAxis()
# note: Run this graph on the CreateStuff_Sample.rvt file
byPoint = Custom[SpotCoordinate.ByPoint](point=origin, view=views, bend=XAxis, end=XAxis)  # Places a spot coordinate at a given point in a given view. May not work in all view types.
watch = Watch(byPoint)
