# Dynamo graph Revit.Elements.Subcategory.dyn (Dynamo 1.3.1.1736)

categories = Categories("Mass")
string = StringInput("SubcategoryCreatedByDynamo")
# note: Run this graph in a family or project file and pick the correct category
byName = Custom[Subcategory.ByName](category=categories, name=string)  # Creates a new subcategory for a given element category in a *family document* (unless a subcategory of that name already exists - in that case it returns the existing subcategory)
watch = Watch(byName)
