# Dynamo graph Revit.Elements.TextAlignFlags.dyn (Dynamo 1.0.0.1180)

bottom = Custom[TextAlignFlags.Bottom]()  # Returns the "Left" text align flag.
watch = Watch(bottom)
left = Custom[TextAlignFlags.Left]()  # Returns the "Left" text align flag.
watch_2 = Watch(left)
center = Custom[TextAlignFlags.Center]()  # Returns the "Left" text align flag.
watch_3 = Watch(center)
right = Custom[TextAlignFlags.Right]()  # Returns the "Left" text align flag.
watch_4 = Watch(right)
middle = Custom[TextAlignFlags.Middle]()  # Returns the "Left" text align flag.
watch_5 = Watch(middle)
top = Custom[TextAlignFlags.Top]()  # Returns the "Left" text align flag.
watch_6 = Watch(top)
