# Dynamo graph Revit.Elements.TextElement.dyn (Dynamo 1.0.0.1180)

categories = Categories("TextNotes")
all_elements_of_category = ElementsOfCategory(categories)
watch = Watch(all_elements_of_category)
text = Custom[TextElement.Text](element=watch)  # Gets the text stored in a text element (i.e. text node or model text)
watch_2 = Watch(text)
passthrough = Custom[Passthrough](passThrough=watch, waitFor=watch_2)  # Forces a sequential order of execution. The node wired into the output of the Passthrough node will be executed *after* the node wired into the waitFor input (e.g. important for some Revit operations). The value of the passThrough input will be passed on to the node wired into the output port of the Passthrough node.
code_block = CodeBlock { "This is the new text for all text nodes... :-)"; }
setText = Custom[TextElement.SetText](element=passthrough, text=code_block)  # Sets the text of a given text element (i.e. text note or model text)
watch_3 = Watch(setText.fail)
watch_4 = Watch(setText.success)
text_2 = Custom[TextElement.Text](element=watch_4)
watch_5 = Watch(text_2)
