# Dynamo graph Revit.Elements.Wall.Actions.dyn (Dynamo 1.3.3.4651)

# note: You can use the Sample Architecture Project (Basic) that ships with Revit to run this graph.
categories = Categories("Walls")
all_elements_of_category = ElementsOfCategory(categories)
watch = Watch(all_elements_of_category)
flip = Custom[Wall.Flip](wall=watch)  # Flips the orientation of a given wall - DO ***NOT*** USE IN AUTOMATIC MODE
watch_2 = Watch(flip.wall)
watch_3 = Watch(flip.success)
