# Dynamo graph Revit.Elements.Window.dyn (Dynamo 1.0.0.1180)

# note: You can use the Sample Architecture Project (Basic) that ships with Revit to run this graph.
categories = Categories("Windows")
all_elements_of_category = ElementsOfCategory(categories)
watch = Watch(all_elements_of_category)
element_types = ElementTypes("Phase")
all_elements_of_type = ElementsOfType(element_types)
code_block = CodeBlock { "Working Drawings"; }
boolean = BoolSelector(true)
filterByName = Custom[Elements.FilterByName](elements=all_elements_of_type, searchString=code_block, ignoreCase=boolean)  # Retrieves those elements from a collection whose names match the search string
watch_2 = Watch(filterByName.first)
rooms = Custom[Window.Rooms](window=watch, phase=watch_2)  # Gets the rooms that are connected by a given window
watch_3 = Watch(rooms.roomCount)
watch_4 = Watch(rooms.fromRoom)
watch_5 = Watch(rooms.toRoom)
