# Dynamo graph Revit.Elements.Workset.dyn (Dynamo 1.0.0.1180)

worksets = Custom[Document.Worksets]()  # Returns all Worksets in the current document
kind = Custom[Workset.Kind](workset=worksets)  # Retrieves the kind of a given workset
watch = Watch(kind)
element_name_universal = Custom[Element.Name (Universal)](element=worksets)  # Gets an element's name (Dynamo's built-in Name nodes don't work for all element types, e.g. worksets...)
watch_2 = Watch(element_name_universal)
