# Dynamo graph Revit.Selection.dyn (Dynamo 1.3.4.6666)

categories = Categories("Furniture")
# note: You can use the Sample Architecture Project (Basic) that ships with Revit to run this graph.
boolean = BoolSelector(false)
all_families_of_category = Custom[All Families Of Category](category=categories, toggle=boolean)  # Gets all famiies of a given category in the model (does *not *work for system families)
watch = Watch(all_families_of_category)
all_family_types_of_category = Custom[All Family Types Of Category](category=categories, toggle=boolean)  # Gets all family types/symbols of a given category in the model (does *not *work for system families)
watch_2 = Watch(all_family_types_of_category)
categories_2 = Categories("Dimensions")
views = Views("Level 1")
all_view_dependent_family = Custom[All View-Dependent Family Instances Of Category](category=categories_2, view=views)  # Gets all view-dependent family instances in a given view for a given list of categories - useful for finding annotation elements
watch_3 = Watch(all_view_dependent_family)
select_face = DSFaceSelection()  # 1 picked in the model
watch_4 = Watch(select_face)
fromDynamoSurface = Custom[Element.FromDynamoSurface](DynamoSurface=watch_4)  # Returns the underlying Revit element of a given face
watch_5 = Watch(fromDynamoSurface)
fromDynamoSurface_2 = Custom[RevitFace.FromDynamoSurface](DynamoSurface=watch_4)  # Returns the underlying Revit face of a given surface
watch_6 = Watch(fromDynamoSurface_2)
fromDynamoSurface_3 = Custom[RevitFaceReference.FromDynamoSurface](DynamoSurface=watch_4)  # Returns the underlying Revit face reference of a given surface
watch_7 = Watch(fromDynamoSurface_3)
family_types = FamilyTypes("Bar Chair:Bar Chair")
all_elements_of_family_type = Custom[All Elements of Family Type+](familyType=family_types, toggle=boolean)  # Unlike the built-in node, this node retrieves all placed instances of a given loadable *or* system family type
watch_8 = Watch(all_elements_of_family_type)
categories_3 = Categories("Walls")
all_placed_family_types_of = Custom[All Placed Family Types of Category](category=categories_3, toggle=boolean)  # Retrieves all family types of a given category that have *placed* instances
watch_9 = Watch(all_placed_family_types_of)
categories_4 = Categories("Walls")
code_block = CodeBlock { 1; }
byCoordinates = Point.ByCoordinates(z=code_block)
XAxis = Vector.XAxis()
all_intersecting_elements_of = Custom[All Intersecting Elements Of Category By Vector](category=categories_4, origin=byCoordinates, direction=XAxis, toggle=boolean)  # Finds all elements of a specified category that intersect with a list of vectors. If no 3D view is supplied, the node will create a temporary view and isolate the given categories in that view. After the operation the temporary view is deleted.
watch_10 = Watch(all_intersecting_elements_of)
string = StringInput("Base Offset")
code_block_2 = CodeBlock { -500; }
formula = Formula("x<y", y=code_block_2)  # unwired: x
filterByParameterValueAndCondition = Custom[Elements.FilterByParameterValueAndCondition](elements=watch_10, param=string, func=formula)
watch_11 = Watch(filterByParameterValueAndCondition.out)
watch_12 = Watch(filterByParameterValueAndCondition.in)
code_block_3 = CodeBlock { "Timber"; }
boolean_2 = BoolSelector(true)
filterByName = Custom[Elements.FilterByName](elements=watch_10, searchString=code_block_3, ignoreCase=boolean_2)  # Retrieves those elements from a collection whose names match the search string
watch_13 = Watch(filterByName.out)
watch_14 = Watch(filterByName.in)
watch_15 = Watch(filterByName.first)
uniqueId = Element.UniqueId(watch_10)
watch_16 = Watch(uniqueId)
byID = Custom[Element.ByID](ID_UniqueId=watch_16)  # Gets the Revit element(s) for a list of IDs (or a single ID)
watch_17 = Watch(byID)
string_2 = StringInput("wall")
boolean_3 = BoolSelector(true)
boolean_4 = BoolSelector(false)
byName = Custom[BuiltInCategory.ByName](searchFor=string_2, ignoreCase=boolean_3, dynamoSupportedCategoriesOnly=boolean_4)  # Looks up all the built-in categories based on a given name (or part of a name) of the category. Search is case-insensitive. Has an option to return categories that are not supported by OOTB Dynamo nodes.
watch_18 = Watch(byName.BuiltInCategories)
watch_19 = Watch(byName.ElementIDs)
byName_2 = Custom[BuiltInParameter.ByName](searchFor=string_2, ignoreCase=boolean_3)  # Looks up all the built-in parameters based on a given name (or part of a name) of the parameters. Search is case-insensitive.
watch_20 = Watch(byName_2.BuiltInParameters)
watch_21 = Watch(byName_2.ElementIDs)
watch_22 = Watch(byName_2.ParameterNames)
select_model_element = DSModelElementSelection()  # 1 picked in the model
geometry = Element.Geometry(select_model_element)
centroid = Solid.Centroid(geometry)
phases = Custom[Document.Phases]()  # Retrieves all phases in the active document in *chronological* order
string_3 = StringInput("Working Drawings")
filterByName_2 = Custom[Elements.FilterByName](elements=phases, searchString=string_3)
atPointInPhase = Custom[Room.AtPointInPhase](point=centroid, phase=filterByName_2.first)  # Tries to retrieve a room element at the given location for the given phase.
watch_23 = Watch(atPointInPhase)
all_elements_of_category = Custom[All Elements Of Category+](category=categories_4)  # Gets all placed elements of a given category in the model.
firstItem = List.FirstItem(all_elements_of_category)
all_intersecting_elements_of_2 = Custom[All Intersecting Elements of Category By BoundingBox](element=firstItem, category=categories_4)  # Finds all elements that intersect the bounding box of a given element
watch_24 = Watch(all_intersecting_elements_of_2)
all_elements_of_category_2 = Custom[All Elements Of Category+](category=categories, toggle=boolean)
watch_25 = Watch(all_elements_of_category_2)
watch_26 = Watch(byName.Categories)
string_4 = StringInput("WallType")
byName_3 = Custom[ElementType.ByName](name=string_4)  # Retrieves an element type by its name - to be used with the OOTB node "All Elements of Type".
watch_27 = Watch(byName_3)
all_elements_of_type = Custom[All Elements of Type+](elementType=watch_27)  # Gets all placed elements of a given element type in the model. Unlike the OOTB node, it works for virtually all element types.
watch_28 = Watch(all_elements_of_type)
