# Dynamo graph Revit.Views.PlanView.dyn (Dynamo 1.0.0.1180)

# note: You can use the DetailComponent_Sample project in the extra folder to run this graph.
views = Views("Ebene 1")
underlay = Custom[PlanView.Underlay](planView=views)  # Returns the view template assigned to a given view (if one is assigned)
watch = Watch(underlay)
