# Dynamo graph Revit.Views.Schedule.dyn (Dynamo 1.3.0.875)

element_types = ElementTypes("ViewSchedule")
all_elements_of_type = ElementsOfType(element_types)
keyScheduleParameterName = Custom[Schedule.KeyScheduleParameterName](schedule=all_elements_of_type)  # If the schedule is a key schedule, the node returns the name of the key schedule parameter.
watch = Watch(keyScheduleParameterName)
