# Dynamo graph Revit.Views.View.Actions.dyn (Dynamo 1.3.4.6666)

views = Views("SolarStudy")
code_block = CodeBlock { 10; }
setSolarStudyActiveFrameNumber = Custom[View.SetSolarStudyActiveFrameNumber](view=views, frameNumber=code_block)  # Sets the active frame number of the solar study in a given view
watch = Watch(setSolarStudyActiveFrameNumber.success)
watch_2 = Watch(setSolarStudyActiveFrameNumber.view)
views_2 = Views("Phases")
phases = Custom[Document.Phases]()  # Retrieves all phases in the active document in *chronological* order
firstItem = List.FirstItem(phases)
setPhase = Custom[View.SetPhase](view=views_2, phase=firstItem)  # Sets the phase of a given view
watch_3 = Watch(setPhase.success)
watch_4 = Watch(setPhase.view)
views_3 = Views("Level 1")
name = Custom[Element.Name+](element=views_3)  # Gets an element's name. Unlike the OOTB node, this node should work for all Revit elements that have names and will also return the localized names of system parameters, parameter groups, display unit types, parameter types, unit symbol types and unit types.
code_block_2 = CodeBlock(name=name) { name + "_Duplicated"; }
duplicate = Custom[View.Duplicate](view=views_3, name=code_block_2)  # Duplicates a given view
watch_5 = Watch(duplicate)
code_block_3 = CodeBlock(name=name) { name + "_DuplicatedAsDependent"; }
duplicateAsDependent = Custom[View.DuplicateAsDependent](view=views_3, name=code_block_3)  # Duplicates a given view as a dependent view
watch_6 = Watch(duplicateAsDependent)
code_block_4 = CodeBlock(name=name) { name + "_DuplicatedWithDetailing"; }
duplicateWithDetailing = Custom[View.DuplicateWithDetailing](view=views_3, name=code_block_4)  # Duplicates a given view with detailing
watch_7 = Watch(duplicateWithDetailing)
views_4 = Views()
# note: To test these two nodes, make sure that you have two views set up with temporarily hidden/isolated elements.
disableTemporaryHideIsolate = Custom[View.DisableTemporaryHideIsolate](view=views_4)  # Disables the temporary hide/isolate for the given view (if set)
watch_8 = Watch(disableTemporaryHideIsolate.view)
views_5 = Views()
convertTemporaryHideIsolateToPermanent = Custom[View.ConvertTemporaryHideIsolateToPermanent](view=views_5)  # Convert all temporary hidden elements or categories to permanently hidden in the given view.
watch_9 = Watch(convertTemporaryHideIsolateToPermanent.view)
views_6 = Views("DesignOptions")
designOptions = Custom[Document.DesignOptions]()  # Returns all design options in the model, grouped by design option set
flatten = Flatten(designOptions.DesignOptions)
lastItem = List.LastItem(flatten)
setDesignOption = Custom[View.SetDesignOption](view=views_6, designOption=lastItem)  # Sets the view to a given design option. PLEASE NOTE: This node is kind of hacky. It does not use the design option settings in the visibility / graphic overrides. Instead it sets the view property "Visible in Option" to *one* specific design option - which also means that the symbolic representation of this view is only visible in views that display the given design options.
watch_10 = Watch(setDesignOption.view)
watch_11 = Watch(setDesignOption.success)
number = DoubleInput(500)
resizeCropBox = Custom[View.ResizeCropBox](amt=number, view=views_3)  # Resizes the bounding box of a given Revit element by the specified amount in X, Y and Z direction. May need to be used in conjunction with a Transaction node.
watch_12 = Watch(resizeCropBox.view)
detail_level = DetailLevel("Fine")
setDetailLevel = Custom[View.SetDetailLevel](view=duplicateWithDetailing, detailLevel=detail_level)  # Sets the detail level of a given view
watch_13 = Watch(setDetailLevel.view)
watch_14 = Watch(setDetailLevel.success)
select_model_element = DSModelElementSelection()  # 1 picked in the model
views_7 = Views("Override")
integer_slider = IntegerSlider(50, range=0..100 step 1)
overrideElementTransparency = Custom[View.OverrideElementTransparency](element=select_model_element, view=views_7, transparencyPercentage=integer_slider)  # Overrides the transparency of an element in a given view
watch_15 = Watch(overrideElementTransparency.element)
select_model_element_2 = DSModelElementSelection()  # 1 picked in the model
resetElementOverrides = Custom[View.ResetElementOverrides](element=select_model_element_2, view=views_7)  # Resets all overrides for an element in a given view
watch_16 = Watch(resetElementOverrides.element)
views_8 = Views("Isolate Element")
select_model_element_3 = DSModelElementSelection()  # 1 picked in the model
permanentlyIsolateElement = Custom[View.PermanentlyIsolateElement](view=views_8, element=select_model_element_3)  # Permanently isolates elements in the given view
watch_17 = Watch(permanentlyIsolateElement.view)
watch_18 = Watch(permanentlyIsolateElement.element)
views_9 = Views("Isolate Element Temp")
temporarilyIsolateElement = Custom[View.TemporarilyIsolateElement](view=views_9, element=select_model_element_3)  # Temporarily isolates elements in the given view
watch_19 = Watch(temporarilyIsolateElement.view)
watch_20 = Watch(temporarilyIsolateElement.element)
watch_21 = Watch(convertTemporaryHideIsolateToPermanent.success)
watch_22 = Watch(disableTemporaryHideIsolate.success)
watch_23 = Watch(resizeCropBox.success)
watch_24 = Watch(overrideElementTransparency.view)
watch_25 = Watch(resetElementOverrides.view)
watch_26 = Watch(overrideElementTransparency.success)
watch_27 = Watch(resetElementOverrides.success)
watch_28 = Watch(temporarilyIsolateElement.success)
watch_29 = Watch(permanentlyIsolateElement.success)
views_10 = Views("Isolate Category")
categories = Categories("Walls")
permanentlyIsolateCategory = Custom[View.PermanentlyIsolateCategory](view=views_10, category=categories)  # Permanently isolates categories in the given view
watch_30 = Watch(permanentlyIsolateCategory.category)
watch_31 = Watch(permanentlyIsolateCategory.view)
views_11 = Views("Isolate Category Temp")
temporarilyIsolateCategory = Custom[View.TemporarilyIsolateCategory](view=views_11, category=categories)  # Temporarily isolates categories in the given view
watch_32 = Watch(temporarilyIsolateCategory.category)
watch_33 = Watch(temporarilyIsolateCategory.view)
watch_34 = Watch(permanentlyIsolateCategory.success)
watch_35 = Watch(temporarilyIsolateCategory.success)
views_12 = Custom[Document.Views]()  # Gets all views in the document - except for 3D view templates (as long as this bug is not fixed: https://github.com/DynamoDS/Dynamo/issues/2970)
dependentViews = Custom[View.DependentViews](view=views_12)  # Returns all dependent views of a given view
flatten_2 = Flatten(dependentViews)
# note: Run this graph on top of the Actions_Sample model.
watch_36 = Watch(flatten_2)
convertToIndependent = Custom[View.ConvertToIndependent](view=watch_36)  # Converts a given dependent view to an independent view
watch_37 = Watch(convertToIndependent.view)
watch_38 = Watch(convertToIndependent.success)
