# Dynamo graph Revit.Views.View3D.dyn (Dynamo 1.0.0.1180)

# note: You can use the Sample Architecture Project (Basic) that ships with Revit to run this graph.
views = Views("{3D}")
isLocked = Custom[View3D.IsLocked](view3d=views)  # Checks if a given view is locked
watch = Watch(isLocked)
