# Dynamo graph Revit.Views.ViewSheetSet.dyn (Dynamo 1.0.0.1180)

element_types = ElementTypes("ViewSheetSet")
all_elements_of_type = ElementsOfType(element_types)
watch = Watch(all_elements_of_type)
views = Custom[ViewSheetSet.Views](viewsSheetSet=watch)  # Retrieves all the views/sheets in a given view/sheet set.
watch_2 = Watch(views)
