# Dynamo graph Paneling.Patterns.TriangularFlatMirrored.dyn (Dynamo 0.7.5.3566)

# note: This example also requires the XYZ Grid From Face package to be installed.
select_face = DSFaceSelection()  # 1 picked in the model
integer_slider = IntegerSlider(7, range=0..20)
integer_slider_2 = IntegerSlider(6, range=0..20)
gridFromFace = Custom[Paneling.GridFromFace](face=select_face, U=integer_slider, V=integer_slider_2)  # Returns UV coordinates, XYZ coordinates and normals for a face with UV subdivision
boolean = BoolSelector(false)
boolean_2 = BoolSelector(true)
boolean_3 = BoolSelector(false)
boolean_4 = BoolSelector(false)
boolean_5 = BoolSelector(false)
boolean_6 = BoolSelector(false)
boolean_7 = BoolSelector(false)
integer_slider_3 = IntegerSlider(2, range=0..2)
integer_slider_4 = IntegerSlider(2, range=0..2)
integer_slider_5 = IntegerSlider(0, range=0..2)
integer_slider_6 = IntegerSlider(0, range=0..2)
integer_slider_7 = IntegerSlider(0, range=0..2)
integer_slider_8 = IntegerSlider(0, range=0..2)
boolean_8 = BoolSelector(true)
triangularFlatMirrored = Custom[Triangular Pattern (Flat, Mirrored) From Grid](list=gridFromFace.UVs, V=integer_slider_2, Shift_Rows_bool=boolean, Reverse_rows_lying=boolean_2, Reverse_rows_standing=boolean_3, Reverse_left_corners_lying=boolean_4, Reverse_left_corners_standing=boolean_5, Reverse_right_corners_lying=boolean_6, Reverse_right_corners_standing=boolean_7, Shift_placement_rows_lying=integer_slider_3, Shift_placement_rows_standing=integer_slider_4, Shift_placement_left_corners_lying=integer_slider_5, Shift_placement_left_corners_standing=integer_slider_6, Shift_placement_right_corners_lying=integer_slider_7, Shift_placement_right_corners_standing=integer_slider_8, Rotate_grid_by_90=boolean_8)  # "Paneling.TriangularFlatMirrored"; Creates groups of points from a list of UVs or XYZs for the placement of triangular panels. The placement pattern can be reversed (boolean) and shifted (integer).
# note: Right corners, lying
family_types = FamilyTypes("3PointACByOffset_VarA:Type 2")
byParametersOnFace = AdaptiveComponent.ByParametersOnFace(triangularFlatMirrored.Right_corners_lying, select_face, family_types, lacing=Longest)
# note: Right corners, standing
family_types_2 = FamilyTypes("3PointACByOffset_VarA:Type 2")
byParametersOnFace_2 = AdaptiveComponent.ByParametersOnFace(triangularFlatMirrored.Right_corners_standing, select_face, family_types_2, lacing=Longest)
# note: Left corners, standing
family_types_3 = FamilyTypes("3PointACByOffset_VarA:Type 2")
byParametersOnFace_3 = AdaptiveComponent.ByParametersOnFace(triangularFlatMirrored.Left_corners_standing, select_face, family_types_3, lacing=Longest)
# note: Left corners, lying
family_types_4 = FamilyTypes("3PointACByOffset_VarA:Type 2")
byParametersOnFace_4 = AdaptiveComponent.ByParametersOnFace(triangularFlatMirrored.Left_corners_lying, select_face, family_types_4, lacing=Longest)
# note: Rows, standing
family_types_5 = FamilyTypes("3PointACByOffset_VarA:Type 2")
byParametersOnFace_5 = AdaptiveComponent.ByParametersOnFace(triangularFlatMirrored.Rows_standing, select_face, family_types_5, lacing=Longest)
# note: Rows, lying
family_types_6 = FamilyTypes("3PointACByOffset_VarA:Type 2")
byParametersOnFace_6 = AdaptiveComponent.ByParametersOnFace(triangularFlatMirrored.Rows_lying, select_face, family_types_6, lacing=Longest)
