# Dynamo graph Core.Logic.dyn (Dynamo 1.3.1.1736)

code_block = CodeBlock { 2..6; }
watch = Watch(code_block)
code_block_2 = CodeBlock { 1..4; }
watch_2 = Watch(code_block_2)
code_block_3 = CodeBlock { "A".."D"; }
watch_3 = Watch(code_block_3)
string = StringInput("E")
switch = Custom[Switch](Check=watch, Cases=watch_2, Values=watch_3, Default=string)  # Emulates the Switch/Case statement that is available in multiple programming languages.
watch_4 = Watch(switch)
code_block_4 = CodeBlock { 1; 4; }
watch_5 = Watch(code_block_4.out0)
create = List.Create(code_block_4.out1)
watch_6 = Watch(create)
returnListOrSingleValue = Custom[ReturnListOrSingleValue](unknownItem=watch_5, seq=watch_6)  # If the item in input #1 is not a list, only the first item of the list in input #2 will be returned.
watch_7 = Watch(returnListOrSingleValue)
create_2 = List.Create(code_block_4.out0)
watch_8 = Watch(create_2)
returnListOrSingleValue_2 = Custom[ReturnListOrSingleValue](unknownItem=watch_8, seq=watch_6)
watch_9 = Watch(returnListOrSingleValue_2)
boolean = BoolSelector(false)
code_block_5 = CodeBlock { 1..10; 1..5; }
scopeIf = Custom[ScopeIf+](test=boolean, true=code_block_5.out0, false=code_block_5.out1)  # A (hopefully) more robust implementation of ScopeIf. Tests a single boolean and returns a value accordingly.
watch_10 = Watch(scopeIf)
