# Dynamo graph Environment.dyn (Dynamo 2.0.0.4654)

CPUs = Custom[System.CPUs]()  # Returns information on number of processors and CPU speed (GHz).
watch = Watch(CPUs.physicalProcessors)
watch_2 = Watch(CPUs.logicalProcesssors)
watch_3 = Watch(CPUs.cores)
watch_4 = Watch(CPUs.CPUspeed)
memory = Custom[System.Memory]()  # Returns information on total system memory, free memory and amount of memory used by the application.
watch_5 = Watch(memory.installedMemory)
watch_6 = Watch(memory.freeMemory)
watch_7 = Watch(memory.appMemory)
version = Custom[System.Version]()  # Returns the Windows version
watch_8 = Watch(version.versionName)
watch_9 = Watch(version.servicePack)
watch_10 = Watch(version.versionNumber)
machineName = Custom[System.MachineName]()  # Returns the NetBIOS name of the computer the script is executed on.
watch_11 = Watch(machineName)
userName = Custom[System.UserName]()  # Returns the user name of the person who is currently logged on to Windows on the machine the script is executed on.
watch_12 = Watch(userName)
version_2 = Custom[Dynamo.Version]()  # Retrieves the version of the active Dynamo application
watch_13 = Watch(version_2.versionShort)
watch_14 = Watch(version_2.versionLong)
watch_15 = Watch(version_2.platform)
