# Dynamo graph Geometry.Abstract.BoundingBox.dyn (Dynamo 2.12.0.5650)
# packages: Clockwork for Dynamo 2.x 2.3.0

origin = Point.Origin()
code_block = CodeBlock { 5; }
byCenterPointRadius = Sphere.ByCenterPointRadius(centerPoint=origin, radius=code_block)
boundingBox = Geometry.BoundingBox(geometry=byCenterPointRadius)
code_block_2 = CodeBlock { 1; }
byCoordinates = Vector.ByCoordinates(x=code_block_2, y=code_block_2, z=code_block_2)

# group: BoundingBox.PerimeterCurvesByNormal
normalized = Vector.Normalized(vector=byCoordinates)
perimeterCurvesByNormal = Custom[BoundingBox.PerimeterCurvesByNormal](boundingbox=boundingBox, normal=normalized)  # package Clockwork for Dynamo 2.x; Returns the perimeter curve of a bounding box on a plane determined by a given normal and the centroid of the bounding box
create = List.Create(item0=perimeterCurvesByNormal, item1=byCenterPointRadius)
watch_3d = Watch3D(create)
watch = Watch(perimeterCurvesByNormal)

ZAxis = Vector.ZAxis()

# group: BoundingBox.PerimeterCurvesOnPlane
byOriginNormal = Plane.ByOriginNormal(origin=origin, normal=ZAxis)
perimeterCurvesOnPlane = Custom[BoundingBox.PerimeterCurvesOnPlane](boundingbox=boundingBox, plane=byOriginNormal)  # package Clockwork for Dynamo 2.x; Returns the perimeter curve of a bounding box on a given plane (assuming that the bounding box and plane intersect)
create_2 = List.Create(item0=perimeterCurvesOnPlane, item1=byCenterPointRadius)
watch_3d_2 = Watch3D(create_2)
watch_2 = Watch(perimeterCurvesOnPlane)

# group: BoundingBox.Properties
properties = Custom[BoundingBox.Properties](boundingBox=boundingBox)  # package Clockwork for Dynamo 2.x; Retrieves the centroid, width, depth and height of a given bounding box
watch_3 = Watch(properties.Centroid)
watch_4 = Watch(properties.Width)
watch_5 = Watch(properties.Depth)
watch_6 = Watch(properties.Height)

code_block_3 = CodeBlock { 10; }
byCoordinates_2 = Point.ByCoordinates(x=code_block_3)
code_block_4 = CodeBlock { 3; }
byCenterPointRadius_2 = Sphere.ByCenterPointRadius(centerPoint=byCoordinates_2, radius=code_block_4)
boundingBox_2 = Geometry.BoundingBox(geometry=byCenterPointRadius_2)
list_create = List.Create(item0=boundingBox, item1=boundingBox_2)

# group: BoundingBox.FromBoundingBoxes
fromBoundingBoxes = Custom[BoundingBox.FromBoundingBoxes](boundingBoxes=list_create)  # package Clockwork for Dynamo 2.x; Merges a list of bounding boxes into a single bounding box
toCuboid = BoundingBox.ToCuboid(boundingBox=fromBoundingBoxes)
watch_3d_3 = Watch3D(toCuboid)
watch_7 = Watch(fromBoundingBoxes)

toCuboid_2 = BoundingBox.ToCuboid(boundingBox=list_create)
watch_3d_4 = Watch3D(toCuboid_2)
