# Dynamo graph Geometry.Abstract.Vector.Create.dyn (Dynamo 2.12.0.5650)
# packages: Clockwork for Dynamo 2.x 2.3.0

# group: Vector.YAxisNegative
YAxisNegative = Custom[Vector.YAxisNegative]()  # package Clockwork for Dynamo 2.x; Returns an XYZ of 0,-1,0
watch = Watch(YAxisNegative)

# group: Vector.XAxisNegative
XAxisNegative = Custom[Vector.XAxisNegative]()  # package Clockwork for Dynamo 2.x; Returns an XYZ of -1,0,0
watch_2 = Watch(XAxisNegative)

# group: Vector.ZAxisNegative
ZAxisNegative = Custom[Vector.ZAxisNegative]()  # package Clockwork for Dynamo 2.x; Returns an XYZ of 0,0,-1
watch_3 = Watch(ZAxisNegative)

number_slider = DoubleSlider(0.884, range=0..1 step 0.1)  # graph input
number_slider_2 = DoubleSlider(0.474, range=0..1 step 0.1)  # graph input
number_slider_3 = DoubleSlider(0.59, range=0..1 step 0.1)  # graph input
boolean = BoolSelector(false)  # graph input
byCoordinates = Vector.ByCoordinates(x=number_slider, y=number_slider_2, z=number_slider_3, normalized=boolean)

# group: XYZAxis.FromVector
watch_4 = Watch(byCoordinates)
fromVector = Custom[XYZAxis.FromVector](vector=watch_4)  # package Clockwork for Dynamo 2.x; Returns whichever main axis (X, Y or Z) is closest to a given vector
watch_5 = Watch(fromVector)

number_slider_4 = DoubleSlider(0.47, range=0..1 step 0.1)  # graph input
number_slider_5 = DoubleSlider(0.782, range=0..1 step 0.1)  # graph input
number_slider_6 = DoubleSlider(0.59, range=0..1 step 0.1)  # graph input
boolean_2 = BoolSelector(false)  # graph input
byCoordinates_2 = Vector.ByCoordinates(x=number_slider_4, y=number_slider_5, z=number_slider_6, normalized=boolean_2)

# group: XYZAxis.ByTwoVectors
watch_6 = Watch(byCoordinates_2)
watch_7 = Watch(byCoordinates)
byTwoVectors = Custom[XYZAxis.ByTwoVectors](Axis1=watch_6, Axis2=watch_7)  # package Clockwork for Dynamo 2.x; Given two main XYZ axes (or vectors pointing more or less in their general direction), this node will find the third axis.
watch_8 = Watch(byTwoVectors.str)
watch_9 = Watch(byTwoVectors.vector)

number_slider_7 = DoubleSlider(2.283794018, range=0..10 step 0.1)  # graph input
number_slider_8 = DoubleSlider(4.419, range=0..10 step 0.1)  # graph input
byCoordinates_3 = Point.ByCoordinates(x=number_slider_7, y=number_slider_8)
number_slider_9 = DoubleSlider(-5.653393753, range=-10..0 step 0.1)  # graph input
number_slider_10 = DoubleSlider(4.419, range=0..10 step 0.1)  # graph input
byCoordinates_4 = Point.ByCoordinates(x=number_slider_9, y=number_slider_10)

# group: AngleBisector.ByPoints
watch_10 = Watch(byCoordinates_3)
origin = Point.Origin()
watch_11 = Watch(byCoordinates_4)
byPoints = Custom[AngleBisector.ByPoints](PointA=watch_10, PointB=origin, PointC=watch_11)  # package Clockwork for Dynamo 2.x; Retrieves the vector of an angle bisector at point B based on three points (A, B, C) that define the angle.
watch_12 = Watch(byPoints)

code_block = CodeBlock { 5; }
byStartPointDirectionLength = Line.ByStartPointDirectionLength(startPoint=origin, direction=byPoints, length=code_block)
create = List.Create(item0=watch_10, item1=origin, item2=watch_11, item3=byStartPointDirectionLength)

# group (continued): AngleBisector.ByPoints
watch_3d = Watch3D(create)
