# Dynamo graph Geometry.Curves.dyn (Dynamo 2.0.1.5055)

code_block = CodeBlock { 1; }
byCoordinates = Point.ByCoordinates(x=code_block)
byCoordinates_2 = Point.ByCoordinates(x=code_block, y=code_block)
byCoordinates_3 = Point.ByCoordinates(y=code_block)
origin = Point.Origin()
create = List.Create(item0=byCoordinates, item1=byCoordinates_2, item2=byCoordinates_3, item3=origin)
closedLoopThroughPoints = Custom[Curve.ClosedLoopThroughPoints](points=create)  # Creates a *closed* loop of curves based on a given list of points
watch = Watch(closedLoopThroughPoints)
watch_3d = Watch3D(closedLoopThroughPoints)
