# Dynamo graph Geometry.Geometry.dyn (Dynamo 1.0.0.1180)

origin = Point.Origin()
code_block = CodeBlock { 10; }
byCoordinates = Point.ByCoordinates(x=code_block)
code_block_2 = CodeBlock { 5; }
byCenterPointRadius = Sphere.ByCenterPointRadius(centerPoint=byCoordinates, radius=code_block_2)
code_block_3 = CodeBlock { 20; }
byCoordinates_2 = Point.ByCoordinates(x=code_block_3)
byLengths = Cuboid.ByLengths(origin=byCoordinates_2, width=code_block_2, length=code_block_2, height=code_block_2)
create = List.Create(byCenterPointRadius, byLengths)
closestTo = Custom[Geometry.ClosestTo](geometry=create, other=origin)  # Finds the closest entity in a list of geometric entities from another given entity
create_2 = List.Create(origin, create, closestTo.ClosestPoint)
watch_3d = Watch3D(create_2)
furthestFrom = Custom[Geometry.FurthestFrom](geometry=create, other=origin)  # Finds the furthest entity in a list of geometric entities from another given entity
watch = Watch(furthestFrom)
watch_2 = Watch(closestTo.ClosestObject)
