# Dynamo graph Geometry.Meshes.dyn (Dynamo 2.0.3.8810)

origin = Point.Origin()
XAxis = Vector.XAxis()
byOriginNormal = Plane.ByOriginNormal(origin=origin, normal=XAxis)
# note: You'll need to run this graph on top of a Revit file that contains a toposurface, e.g. the basic architectural sample project that ships with Revit.
string = StringInput("OST_Topography")
all_elements_of_category = Custom[All Elements Of Category+](category=string)  # Gets all placed elements of a given category in the model.
firstItem = List.FirstItem(list=all_elements_of_category)
mesh = Topography.Mesh(topography=firstItem)
intersectionWithPlane = Custom[Mesh.IntersectionWithPlane](plane=byOriginNormal, mesh=mesh)  # Calculates the intersection of a mesh and a plane
watch = Watch(intersectionWithPlane.points)
watch_2 = Watch(intersectionWithPlane.nurbsCurveByControlPoints)
watch_3 = Watch(intersectionWithPlane.polyCurve)
watch_4 = Watch(intersectionWithPlane.nurbsCurveByPoints)
create = List.Create(item0=mesh, item1=watch_4)
watch_3d = Watch3D(create)
faceVertices = Custom[Mesh.FaceVertices](mesh=mesh)  # Gets the vertices of each face of a given mesh
watch_5 = Watch(faceVertices)
byPerimeterPoints = Surface.ByPerimeterPoints(points=watch_5)
watch_6 = Watch(byPerimeterPoints)
watch_3d_2 = Watch3D(byPerimeterPoints)
