# Dynamo graph Geometry.Modifiers.dyn (Dynamo 2.12.0.5650)
# packages: Clockwork for Dynamo 2.x 2.3.0

origin = Point.Origin()
code_block = CodeBlock { 10; }
byCoordinates = Point.ByCoordinates(x=code_block)
code_block_2 = CodeBlock { 5; }
byCenterPointRadius = Sphere.ByCenterPointRadius(centerPoint=byCoordinates, radius=code_block_2)
code_block_3 = CodeBlock { 20; }
byCoordinates_2 = Point.ByCoordinates(x=code_block_3)
byLengths = Cuboid.ByLengths(origin=byCoordinates_2, width=code_block_2, length=code_block_2, height=code_block_2)
list_create = List.Create(item0=byCenterPointRadius, item1=byLengths)
watch = Watch(list_create)

# group: Geometry.ClosestTo
closestTo = Custom[Geometry.ClosestTo](geometry=watch, other=origin)  # package Clockwork for Dynamo 2.x; Finds the closest entity in a list of geometric entities from another given entity
watch_2 = Watch(closestTo.ClosestObject)

create = List.Create(item0=origin, item1=watch, item2=closestTo.ClosestPoint)
watch_3d = Watch3D(create)

# group: Geometry.FurthestFrom
furthestFrom = Custom[Geometry.FurthestFrom](geometry=list_create, other=origin)  # package Clockwork for Dynamo 2.x; Finds the furthest entity in a list of geometric entities from another given entity
watch_3 = Watch(furthestFrom)
