# Dynamo graph Geometry.Points.Point.dyn (Dynamo 2.12.0.5650)
# packages: Clockwork for Dynamo 2.x 2.3.0

number_slider = DoubleSlider(11.898, range=0..20 step 0.1)  # graph input
number_slider_2 = DoubleSlider(10.308, range=0..20 step 0.1)  # graph input
code_block = CodeBlock { 50; 25; 5; 0..1..#8; 7; 15; -15; }
byCoordinates = Point.ByCoordinates(x=number_slider, y=number_slider_2, z=code_block.out0)
byCoordinates_2 = Point.ByCoordinates(z=code_block.out1)
byCenterPointRadius = Circle.ByCenterPointRadius(centerPoint=byCoordinates_2, radius=code_block.out2)
takeItems = List.TakeItems(list=code_block.out3, amount=code_block.out4)
pointAtParameter = Curve.PointAtParameter(curve=byCenterPointRadius, param=takeItems)
origin = Point.Origin()
ZAxis = Vector.ZAxis()
byOriginNormal = Plane.ByOriginNormal(origin=origin, normal=ZAxis)
boolean = BoolSelector(true)  # graph input
byPoints = PolyCurve.ByPoints(points=pointAtParameter, connectLastToFirst=boolean)

# group: Point.CentralProjectionOnPlane
centralProjectionOnPlane = Custom[Point.CentralProjectionOnPlane](centralProjectionPoint=byCoordinates, projectionPoints=pointAtParameter, plane=byOriginNormal)  # package Clockwork for Dynamo 2.x; Projects a list of points onto a given plane
byPoints_2 = PolyCurve.ByPoints(points=centralProjectionOnPlane, connectLastToFirst=boolean)
create = List.Create(item0=byCoordinates, item1=pointAtParameter, item2=byOriginNormal, item3=centralProjectionOnPlane, item4=byPoints_2, item5=byPoints)
watch_3d = Watch3D(create)

code_block_2 = CodeBlock(a=code_block.out5, b=code_block.out6, c=code_block.out2) { [a,b,b,a]; [a,a,b,b]; [0,0,c,0]; }
byCoordinates_3 = Point.ByCoordinates(x=code_block_2.out0, y=code_block_2.out1, z=code_block_2.out2)
byPerimeterPoints = Surface.ByPerimeterPoints(points=byCoordinates_3)

# group: Point.CentralProjectionOnFace
centralProjectionOnFace = Custom[Point.CentralProjectionOnFace](centralProjectionPoint=byCoordinates, projectionPoints=pointAtParameter, surface=byPerimeterPoints)  # package Clockwork for Dynamo 2.x; Projects a list of points onto a given face
flatten = List.Flatten(list=centralProjectionOnFace)
byPoints_3 = PolyCurve.ByPoints(points=flatten, connectLastToFirst=boolean)
create_2 = List.Create(item0=byCoordinates, item1=pointAtParameter, item2=byPerimeterPoints, item3=centralProjectionOnFace, item4=byPoints, item5=byPoints_3)
watch_3d_2 = Watch3D(create_2)

code_block_3 = CodeBlock { 0.1; 1; }
number_slider_3 = DoubleSlider(0.44, range=0..1 step 0.01)  # graph input
byCoordinates_4 = Point.ByCoordinates(y=code_block_3.out1, z=number_slider_3)
watch = Watch(byCoordinates_4)

# group: Point.RoundUpToPrecision
roundUpToPrecision = Custom[Point.RoundUpToPrecision](pointp=watch, precision=code_block_3.out0)  # package Clockwork for Dynamo 2.x; Rounds a point coordinate *up* to a specified precision
watch_2 = Watch(roundUpToPrecision)

# group: Point.RoundToPrecision
roundToPrecision = Custom[Point.RoundToPrecision](point=watch, precision=code_block_3.out0)  # package Clockwork for Dynamo 2.x; Rounds a point coordinate to a specified precision
watch_3 = Watch(roundToPrecision)

# group: Point.RoundDownToPrecision
roundDownToPrecision = Custom[Point.RoundDownToPrecision](point=watch, precision=code_block_3.out0)  # package Clockwork for Dynamo 2.x; Rounds a point coordinate *down* to a specified precision
watch_4 = Watch(roundDownToPrecision)

code_block_4 = CodeBlock { [1,2,4,8,16]; }
code_block_5 = CodeBlock { 0..4; }
byCoordinates_5 = Point.ByCoordinates(x=code_block_4, z=code_block_5)
watch_5 = Watch(byCoordinates_5)

# group: Point.Average
average = Custom[Point.Average](points=watch_5)  # package Clockwork for Dynamo 2.x; Determines the average of a list of points
watch_6 = Watch(average)
watch_3d_3 = Watch3D(watch_5)

origin_2 = Point.Origin()
ZAxis_2 = Vector.ZAxis()
byOriginNormal_2 = Plane.ByOriginNormal(origin=origin_2, normal=ZAxis_2)

# group: Point.IsOutOfPlane
isOutOfPlane = Custom[Point.IsOutOfPlane](faceOrPlane=byOriginNormal_2, point=watch_5)  # package Clockwork for Dynamo 2.x; Checks a list for XYZs that are not located on a given plane
watch_7 = Watch(isOutOfPlane.bool)
watch_8 = Watch(isOutOfPlane.amount)
