# Dynamo graph Geometry.Points.PointSequence.dyn (Dynamo 2.3.1.11775)
# packages: Clockwork for Dynamo 2.x 2.3.0

code_block = CodeBlock { [1,2,4,8,16]; }
code_block_2 = CodeBlock { 0..4; }
byCoordinates = Point.ByCoordinates(x=code_block, z=code_block_2)
watch = Watch(byCoordinates)
origin = Point.Origin()

# group: PointSequence.GreatestDistanceToPoint
greatestDistanceToPoint = Custom[PointSequence.GreatestDistanceToPoint](seq=watch, point=origin)  # package Clockwork for Dynamo 2.x; Retrieves the furthest point in a sequence of points
watch_2 = Watch(greatestDistanceToPoint.bool)
watch_3 = Watch(greatestDistanceToPoint.distance)

# group: PointSequence.AccumulatedDistance
accumulatedDistance = Custom[PointSequence.AccumulatedDistance](seq=watch)  # package Clockwork for Dynamo 2.x; Retrieves the accumulated distances of a sequence of points
watch_4 = Watch(accumulatedDistance)

origin_2 = Point.Origin()
ZAxis = Vector.ZAxis()
byOriginNormal = Plane.ByOriginNormal(origin=origin_2, normal=ZAxis)

# group: PointSequence.ContainsOutOfPlanePoints
containsOutOfPlanePoints = Custom[PointSequence.ContainsOutOfPlanePoints](faceOrPlane=byOriginNormal, seq=watch)  # package Clockwork for Dynamo 2.x; Checks a list for XYZs that are not located on a given plane
watch_5 = Watch(containsOutOfPlanePoints.bool)
watch_6 = Watch(containsOutOfPlanePoints.max)
