# Dynamo graph Geometry.Points.PointSequences.dyn (Dynamo 2.3.1.11775)
# packages: Clockwork for Dynamo 2.x 2.3.0

code_block = CodeBlock { [1,2,4,8,16]; }
code_block_2 = CodeBlock { 0..4; }
byCoordinates = Point.ByCoordinates(x=code_block, z=code_block_2)
code_block_3 = CodeBlock { [3,9,12,16]; }
code_block_4 = CodeBlock { 0..3; }
byCoordinates_2 = Point.ByCoordinates(y=code_block_3, z=code_block_4)
create = List.Create(item0=byCoordinates, item1=byCoordinates_2)

# group: PointSequences.ShortestPath
watch = Watch(create)
shortestPath = Custom[PointSequences.ShortestPath](seq=watch)  # package Clockwork for Dynamo 2.x; Retrieves the shortest path from a number of point sequences
watch_2 = Watch(shortestPath.bool)
watch_3 = Watch(shortestPath.distance)
watch_3d = Watch3D(create)
