# Dynamo graph Geometry.Points.UV.dyn (Dynamo 2.0.1.5055)

code_block = CodeBlock { 1; }
number_slider = DoubleSlider(0.621, range=0..1 step 0.1)  # graph input
byCoordinates = UV.ByCoordinates(u=code_block, v=number_slider)
watch = Watch(byCoordinates)
code_block_2 = CodeBlock { 0.1; }
roundToPrecision = Custom[UV.RoundToPrecision](uv=watch, Precision=code_block_2)  # Rounds a UV coordinate to a specified precision
watch_2 = Watch(roundToPrecision)
roundUpToPrecision = Custom[UV.RoundUpToPrecision](uv=watch, Precision=code_block_2)  # Rounds a UV coordinate *up* to a specified precision
watch_3 = Watch(roundUpToPrecision)
roundDownToPrecision = Custom[UV.RoundDownToPrecision](uv=watch, Precision=code_block_2)  # Rounds a UV coordinate *down* to a specified precision
watch_4 = Watch(roundDownToPrecision)
swap = Custom[UV.Swap](uv=watch)  # Swaps U and V coordinates
watch_5 = Watch(swap)
code_block_3 = CodeBlock { 20; 0.2; 0.8; 5; }
randomList = Math.RandomList(amount=code_block_3.out0)
remapRange = Math.RemapRange(numbers=randomList, newMin=code_block_3.out1, newMax=code_block_3.out2)
byCoordinates_2 = UV.ByCoordinates(u=remapRange, v=remapRange, lacing=CrossProduct)
flatten = List.Flatten(list=byCoordinates_2)
code_block_4 = CodeBlock { 3; 0; }
takeEveryNthItem = List.TakeEveryNthItem(list=flatten, n=code_block_4.out0, offset=code_block_4.out1)
watch_6 = Watch(takeEveryNthItem)
number_slider_2 = DoubleSlider(0.011, range=0..0.3 step 0.1)  # graph input
pruneDuplicates = Custom[UV.PruneDuplicates](UVs=watch_6, Tolerance=number_slider_2)  # Prune UVs to exclude duplicates within a given tolerance
count = List.Count(list=pruneDuplicates)
watch_7 = Watch(count)
count_2 = List.Count(list=watch_6)
watch_8 = Watch(count_2)
number_slider_3 = DoubleSlider(18.70503597, range=0..100 step 0.1)  # graph input
number_slider_4 = DoubleSlider(35.25179856, range=0..100 step 0.1)  # graph input
byCoordinates_3 = Point.ByCoordinates(x=number_slider_3, y=number_slider_4)
byXY = Custom[UV.ByXY](point=byCoordinates_3)  # Creates UVs from the XY components of point coordinates
watch_9 = Watch(byXY)
code_block_5 = CodeBlock { [0.2,0.8]; }
byCoordinates_4 = UV.ByCoordinates(u=code_block_5, v=code_block_5, lacing=CrossProduct)
flatten_2 = List.Flatten(list=byCoordinates_4)
watch_10 = Watch(flatten_2)
average = Custom[UV.Average](UVs=watch_10)  # Determines the average of a list of UVs
watch_11 = Watch(average)
