# Dynamo graph Geometry.Shapes.Buckyball.dyn (Dynamo 2.0.1.5055)

origin = Point.Origin()
number_slider = DoubleSlider(15, range=0..20 step 0.1)  # graph input
byOriginAndRadius = Custom[Buckyball.ByOriginAndRadius](origin=origin, radius=number_slider)  # Returns all the data necessary for modeling a truncated icosahedron (vertices and struts) as well as the surface area and volume.
watch = Watch(byOriginAndRadius.Volume)
watch_2 = Watch(byOriginAndRadius.SurfaceArea)
watch_3 = Watch(byOriginAndRadius.StrutsUpVectors)
watch_4 = Watch(byOriginAndRadius.StrutPoints)
watch_5 = Watch(byOriginAndRadius.SurfaceGeometry)
watch_6 = Watch(byOriginAndRadius.PentagonPoints)
watch_7 = Watch(byOriginAndRadius.HexagonPoints)
watch_8 = Watch(byOriginAndRadius.Vertices)
watch_9 = Watch(byOriginAndRadius.StrutGeometry)
create = List.Create(item0=byOriginAndRadius.StrutGeometry, item1=byOriginAndRadius.SurfaceGeometry)
watch_3d = Watch3D(create)
