# Dynamo graph Geometry.Solids.dyn (Dynamo 2.0.3.8810)

byLengths = Cuboid.ByLengths()
XAxis = Vector.XAxis()
translate = Geometry.Translate(geometry=byLengths, direction=XAxis)
XAxis_2 = Vector.XAxis()
translate_2 = Geometry.Translate(geometry=translate, direction=XAxis_2)
create = List.Create(item0=byLengths, item1=translate, item2=translate_2)
byUnion = Custom[Solid.ByUnion+](solids=create)  # The OOTB node Solid.ByUnion occasionally fails when trying to merge solids with almost adjacent faces. This node will return the minimum amount of joined solids possible in such cases instead of returning null.
