# Dynamo graph Geometry.Tesselation.Paneling.Grid.dyn (Dynamo 2.12.0.5650)
# packages: Clockwork for Dynamo 2.x 2.3.0

origin = Point.Origin()
code_block = CodeBlock { 2; }
byCoordinates = Point.ByCoordinates(x=code_block)
byStartPointEndPoint = Line.ByStartPointEndPoint(startPoint=origin, endPoint=byCoordinates)
byCoordinates_2 = Point.ByCoordinates(y=code_block)
code_block_2 = CodeBlock { 1; }
byCoordinates_3 = Point.ByCoordinates(x=code_block, y=code_block, z=code_block_2)
byStartPointEndPoint_2 = Line.ByStartPointEndPoint(startPoint=byCoordinates_2, endPoint=byCoordinates_3)
list_create = List.Create(item0=byStartPointEndPoint, item1=byStartPointEndPoint_2)
byRuledLoft = Surface.ByRuledLoft(crossSections=list_create)
integer_slider = IntegerSlider(13, range=0..20 step 1)  # graph input
integer_slider_2 = IntegerSlider(10, range=0..20 step 1)  # graph input

# group: Grid.FromFace
fromFace = Custom[Grid.FromFace](surface=byRuledLoft, U=integer_slider, V=integer_slider_2)  # package Clockwork for Dynamo 2.x; Returns UV coordinates, XYZ coordinates and normals for a face with UV subdivision
watch_3d = Watch3D(fromFace.Points)
watch = Watch(fromFace.Points)
watch_2 = Watch(fromFace.Normals)
watch_3 = Watch(fromFace.UVs)

file_path = Filename("..\..\2.x\extra\Image_Sample.jpg")  # graph input
file_from_path = FileObject(path=file_path)
readFromFile = Image.ReadFromFile(file=file_from_path)
watch_image = WatchImageCore(image=readFromFile)
pixels = Image.Pixels(image=watch_image, xSamples=integer_slider, ySamples=integer_slider_2)
watch_4 = Watch(pixels)
brightness = Color.Brightness(color=watch_4)

# group: Grid.InvertAndMirrorNormalizedValues
boolean = BoolSelector(true)  # graph input
boolean_2 = BoolSelector(false)  # graph input
boolean_3 = BoolSelector(true)  # graph input
invertAndMirrorNormalizedValues = Custom[Grid.InvertAndMirrorNormalizedValues](seq=brightness, Invert=boolean, MirrorVertically=boolean_2, MirrorHorizontally=boolean_3)  # package Clockwork for Dynamo 2.x; Inverts and mirrors (horizontally & vertically) a nested list of normalized values.
greyscaleByNormalizedValue = Custom[Color.GreyscaleByNormalizedValue](dbl=invertAndMirrorNormalizedValues)  # package Clockwork for Dynamo 2.x; Creates a greyscale color based on a normalized value (0 = black, 1 = white)
fromPixels = Image.FromPixels(colors=greyscaleByNormalizedValue)
watch_image_2 = WatchImageCore(image=fromPixels)
