# Dynamo graph Geometry.Tesselation.Paneling.Pattern.Hexagonal.dyn (Dynamo 2.12.0.5650)
# packages: Clockwork for Dynamo 2.x 2.3.0

# group: INFO
# note: Run this graph on the Paneling_Sample model in the extra folder.

# group: INPUTS
select_face = DSFaceSelection()  # 1 picked in the model; graph input
u_subdivisions = IntegerSlider(9, range=0..20 step 1)  # graph input
v_subdivisions = IntegerSlider(12, range=0..20 step 1)  # graph input
reverse_odd_rows = BoolSelector(false)  # graph input
shift_placement_of_odd_rows = IntegerSlider(1, range=0..5 step 1)  # graph input
reverse_even_rows = BoolSelector(false)  # graph input
shift_placement_of_even_rows = IntegerSlider(2, range=0..5 step 1)  # graph input
rotate_grid_by_90 = BoolSelector(false)  # graph input
even_rows_panel_type = FamilyTypes("6Point-AC_Hexagon:Type 1")  # graph input
odd_rows_panel_type = FamilyTypes("6Point-AC_Hexagon:Type 2")  # graph input

firstItem = List.FirstItem(list=select_face)
fromFace = Custom[Grid.FromFace](surface=firstItem, U=u_subdivisions, V=v_subdivisions)  # package Clockwork for Dynamo 2.x; Returns UV coordinates, XYZ coordinates and normals for a face with UV subdivision

# group: Pattern.Hexagonal
hexagonal = Custom[Pattern.Hexagonal](seq=fromFace.Points, V=v_subdivisions, reverseOddRows=reverse_odd_rows, shiftPlacementOddRows=shift_placement_of_odd_rows, reverseEvenRows=reverse_even_rows, shiftPlacementEvenRows=shift_placement_of_even_rows, rotateGridBy90Degrees=rotate_grid_by_90)  # package Clockwork for Dynamo 2.x; Creates groups of points from a list of UVs or XYZs for the placement of hexagonal panels. The placement pattern can be reversed (boolean) and shifted (integer).
watch = Watch(hexagonal.oddRows)
watch_2 = Watch(hexagonal.evenRows)

byPoints = AdaptiveComponent.ByPoints(points=hexagonal.oddRows, familyType=even_rows_panel_type)
byPoints_2 = AdaptiveComponent.ByPoints(points=hexagonal.evenRows, familyType=odd_rows_panel_type)
