# Dynamo graph Geometry.Tesselation.Paneling.Pattern.Quadrilateral.dyn (Dynamo 2.12.0.5650)
# packages: Clockwork for Dynamo 2.x 2.3.0

# group: INFO
# note: Run this graph on the Paneling_Sample model in the extra folder.

select_face = DSFaceSelection()  # 1 picked in the model; graph input
firstItem = List.FirstItem(list=select_face)
integer_slider = IntegerSlider(9, range=0..20 step 1)  # graph input
integer_slider_2 = IntegerSlider(11, range=0..20 step 1)  # graph input
fromFace = Custom[Grid.FromFace](surface=firstItem, U=integer_slider, V=integer_slider_2)  # package Clockwork for Dynamo 2.x; Returns UV coordinates, XYZ coordinates and normals for a face with UV subdivision
boolean = BoolSelector(false)  # graph input
integer_slider_3 = IntegerSlider(0, range=0..3 step 1)  # graph input

# group: Pattern.Quadrilateral
quadrilateral = Custom[Pattern.Quadrilateral](seq=fromFace.UVs, V=integer_slider_2, reverse=boolean, shiftPlacement=integer_slider_3)  # package Clockwork for Dynamo 2.x; Creates groups of points from a list of UVs or XYZs for the placement of quadrilateral panels. The placement pattern can be reversed (boolean) and shifted (integer).
watch = Watch(quadrilateral)

family_types = FamilyTypes("4PointACByOffset_VarA:Type 1")  # graph input
byParametersOnFace = AdaptiveComponent.ByParametersOnFace(uvs=quadrilateral, surface=firstItem, familyType=family_types)
