# Dynamo graph Geometry.Tesselation.Paneling.Pattern.Quadrilateral2byX.dyn (Dynamo 2.0.1.5055)

# note: Run this graph on the Paneling_Sample model in the extra folder.
select_face = DSFaceSelection()  # 1 picked in the model; graph input
firstItem = List.FirstItem(list=select_face)
integer_slider = IntegerSlider(5, range=0..20 step 1)  # graph input
integer_slider_2 = IntegerSlider(9, range=0..20 step 1)  # graph input
gridFromFace = Custom[Paneling.GridFromFace](surface=firstItem, U=integer_slider, V=integer_slider_2)  # Returns UV coordinates, XYZ coordinates and normals for a face with UV subdivision
integer_slider_3 = IntegerSlider(3, range=0..20 step 1)  # graph input
boolean = BoolSelector(false)  # graph input
integer_slider_4 = IntegerSlider(0, range=0..3 step 1)  # graph input
boolean_2 = BoolSelector(true)  # graph input
quadrilateral2byX = Custom[Paneling.Quadrilateral2byX](seq=gridFromFace.UVs, V=integer_slider_2, X=integer_slider_3, reversePattern=boolean, shiftPattern=integer_slider_4, rotateGridby90Degrees=boolean_2)
watch = Watch(quadrilateral2byX)
family_types = FamilyTypes(index=4)  # graph input
byParametersOnFace = AdaptiveComponent.ByParametersOnFace(uvs=watch, surface=firstItem, familyType=family_types)
