# Dynamo graph Geometry.Tesselation.Paneling.Pattern.QuadrilateralAlternatingRows.dyn (Dynamo 2.0.1.5055)

# note: Run this graph on the Paneling_Sample model in the extra folder.
select_face = DSFaceSelection()  # 1 picked in the model; graph input
firstItem = List.FirstItem(list=select_face)
integer_slider = IntegerSlider(9, range=0..20 step 1)  # graph input
integer_slider_2 = IntegerSlider(11, range=0..20 step 1)  # graph input
gridFromFace = Custom[Paneling.GridFromFace](surface=firstItem, U=integer_slider, V=integer_slider_2)  # Returns UV coordinates, XYZ coordinates and normals for a face with UV subdivision
boolean = BoolSelector(false)  # graph input
integer_slider_3 = IntegerSlider(0, range=0..3 step 1)  # graph input
boolean_2 = BoolSelector(false)  # graph input
quadrilateralAlternatingRows = Custom[Paneling.QuadrilateralAlternatingRows](seq=gridFromFace.UVs, V=integer_slider_2, reverse=boolean, shiftPlacement=integer_slider_3, rotateGridBy90Degrees=boolean_2)  # Creates groups of points from a list of UVs or XYZs for the placement of quadrilateral panels in alternating rows. The placement pattern can be reversed (boolean) and shifted (integer).
watch = Watch(quadrilateralAlternatingRows.oddRows)
family_types = FamilyTypes(index=2)  # graph input
byParametersOnFace = AdaptiveComponent.ByParametersOnFace(uvs=watch, surface=firstItem, familyType=family_types)
watch_2 = Watch(quadrilateralAlternatingRows.evenRows)
family_types_2 = FamilyTypes(index=3)  # graph input
byParametersOnFace_2 = AdaptiveComponent.ByParametersOnFace(uvs=watch_2, surface=firstItem, familyType=family_types_2)
