# Dynamo graph Geometry.Tesselation.Paneling.Pattern.TriangularFlatDiagonal.dyn (Dynamo 2.0.1.5055)

# note: Run this graph on the Paneling_Sample model in the extra folder.
select_face = DSFaceSelection()  # 1 picked in the model; graph input
firstItem = List.FirstItem(list=select_face)
integer_slider = IntegerSlider(9, range=0..20 step 1)  # graph input
integer_slider_2 = IntegerSlider(11, range=0..20 step 1)  # graph input
gridFromFace = Custom[Paneling.GridFromFace](surface=firstItem, U=integer_slider, V=integer_slider_2)  # Returns UV coordinates, XYZ coordinates and normals for a face with UV subdivision
boolean = BoolSelector(false)  # graph input
boolean_2 = BoolSelector(false)  # graph input
integer_slider_3 = IntegerSlider(0, range=0..2 step 1)  # graph input
integer_slider_4 = IntegerSlider(0, range=0..2 step 1)  # graph input
integer_slider_5 = IntegerSlider(0, range=0..2 step 1)  # graph input
boolean_3 = BoolSelector(false)  # graph input
triangularFlatDiagonal = Custom[Paneling.TriangularFlatDiagonal](seq=gridFromFace.UVs, V=integer_slider_2, reverseTypeA=boolean, reverseTypeB=boolean_2, shiftPlacementTypeA=integer_slider_3, shiftPlacementTypeB=integer_slider_4, shiftOverallPlacement=integer_slider_5, rotateGridBy90Degrees=boolean_3)  # Creates groups of points from a list of UVs or XYZs for the placement of triangular panels. The placement pattern can be reversed (boolean) and shifted (integer).
watch = Watch(triangularFlatDiagonal.typeA)
family_types = FamilyTypes(index=0)  # graph input
byParametersOnFace = AdaptiveComponent.ByParametersOnFace(uvs=watch, surface=firstItem, familyType=family_types)
watch_2 = Watch(triangularFlatDiagonal.typeB)
family_types_2 = FamilyTypes(index=1)  # graph input
byParametersOnFace_2 = AdaptiveComponent.ByParametersOnFace(uvs=watch_2, surface=firstItem, familyType=family_types_2)
