# Dynamo graph Geometry.Tesselation.Paneling.Pattern.TriangularFlatMirrored.dyn (Dynamo 2.12.0.5650)
# packages: Clockwork for Dynamo 2.x 2.3.0

# group: INFO
# note: This example also requires the XYZ Grid From Face package to be installed.

# group: INPUTS
select_face = DSFaceSelection()  # 1 picked in the model; graph input
u_subdivisions = IntegerSlider(7, range=0..20 step 1)  # graph input
v_subdivisions = IntegerSlider(6, range=0..20 step 1)  # graph input
shift_rows = BoolSelector(false)  # graph input
reverse_rows = BoolSelector(true)  # graph input
reverse_rows_2 = BoolSelector(false)  # graph input
shift_placement = IntegerSlider(0, range=0..2 step 1)  # graph input
shift_placement_2 = IntegerSlider(0, range=0..2 step 1)  # graph input
rotate_grid_by_90 = BoolSelector(false)  # graph input
# note: Right corners, lying
panel_type = FamilyTypes("3PointACByOffset_VarA:Type 2")  # graph input
# note: Right corners, standing
panel_type_2 = FamilyTypes("3PointACByOffset_VarA:Type 2")  # graph input
# note: Left corners, standing
panel_type_3 = FamilyTypes("3PointACByOffset_VarA:Type 2")  # graph input
# note: Left corners, lying
panel_type_4 = FamilyTypes("3PointACByOffset_VarA:Type 2")  # graph input
# note: Rows, standing
panel_type_5 = FamilyTypes("3PointACByOffset_VarA:Type 2")  # graph input
# note: Rows, lying
panel_type_6 = FamilyTypes("3PointACByOffset_VarA:Type 2")  # graph input

firstItem = List.FirstItem(list=select_face)
fromFace = Custom[Grid.FromFace](surface=firstItem, U=u_subdivisions, V=v_subdivisions)  # package Clockwork for Dynamo 2.x; Returns UV coordinates, XYZ coordinates and normals for a face with UV subdivision

# group: Pattern.TriangularFlatMirrored
triangularFlatMirrored = Custom[Pattern.TriangularFlatMirrored](seq=fromFace.UVs, V=v_subdivisions, shiftRows=shift_rows, reverseRowsLying=reverse_rows, reverseRowsStanding=reverse_rows_2, shiftPlacementRowsLying=shift_placement, shiftPlacementRowsStanding=shift_placement_2, rotateGridBy90Degrees=rotate_grid_by_90)  # package Clockwork for Dynamo 2.x; Creates groups of points from a list of UVs or XYZs for the placement of triangular (diagrid) panels. The placement pattern can be reversed (boolean) and shifted (integer).
watch = Watch(triangularFlatMirrored.rightCornersLying)
watch_2 = Watch(triangularFlatMirrored.rightCornersStanding)
watch_3 = Watch(triangularFlatMirrored.leftCornersStanding)
watch_4 = Watch(triangularFlatMirrored.leftCornersLying)
watch_5 = Watch(triangularFlatMirrored.rowsStanding)
watch_6 = Watch(triangularFlatMirrored.rowsLying)

byParametersOnFace = AdaptiveComponent.ByParametersOnFace(uvs=watch, faceReference=firstItem, familyType=panel_type, lacing=Longest)
byParametersOnFace_2 = AdaptiveComponent.ByParametersOnFace(uvs=watch_2, faceReference=firstItem, familyType=panel_type_2, lacing=Longest)
byParametersOnFace_3 = AdaptiveComponent.ByParametersOnFace(uvs=watch_3, faceReference=firstItem, familyType=panel_type_3, lacing=Longest)
byParametersOnFace_4 = AdaptiveComponent.ByParametersOnFace(uvs=watch_4, faceReference=firstItem, familyType=panel_type_4, lacing=Longest)
byParametersOnFace_5 = AdaptiveComponent.ByParametersOnFace(uvs=watch_5, faceReference=firstItem, familyType=panel_type_5, lacing=Longest)
byParametersOnFace_6 = AdaptiveComponent.ByParametersOnFace(uvs=watch_6, faceReference=firstItem, familyType=panel_type_6, lacing=Longest)
