# Dynamo graph ImportExport.Clipboard.dyn (Dynamo 2.0.1.5055)

boolean = BoolSelector(false)  # graph input
string = StringInput("Dynamo says Hello...")
sendTo = Custom[Clipboard.SendTo](str=string)  # Copies a string to the clipboard.
passthrough = Custom[Passthrough](passThrough=boolean, waitFor=sendTo)  # Forces a sequential order of execution. The node wired into the output of the Passthrough node will be executed *after* the node wired into the waitFor input (e.g. important for some Revit operations). The value of the passThrough input will be passed on to the node wired into the output port of the Passthrough node.
getFrom = Custom[Clipboard.GetFrom](toggle=passthrough)  # Gets the content of the clipboard. ATTENTION: Will only work with strings.
watch = Watch(getFrom)
