# Dynamo graph ImportExport.CustomNode.dyn (Dynamo 2.0.1.5055)

file_path = Filename("..\..\..\nodes\1.x\Paneling.DropLastRowAndColumn.dyf")  # graph input
info = Custom[CustomNode.Info](path=file_path)  # Extracts information from a custom node.
watch = Watch(info.InputDefaultVals)
watch_2 = Watch(info.PythonScripts)
watch_3 = Watch(info.CustomNodesCount)
watch_4 = Watch(info.ID)
watch_5 = Watch(info.Category)
watch_6 = Watch(info.Outputs)
watch_7 = Watch(info.NestedCustomNodes)
watch_8 = Watch(info.NestedBuiltinNodes)
watch_9 = Watch(info.Name)
watch_10 = Watch(info.Description)
watch_11 = Watch(info.Inputs)
watch_12 = Watch(info.InputDataTypes)
watch_13 = Watch(info.BuiltinNodesCount)
watch_14 = Watch(info.Version)
watch_15 = Watch(info.InputDescriptions)
watch_16 = Watch(info.OutputDescriptions)
watch_17 = Watch(info.IsVisibleInLibrary)
