# Dynamo graph ImportExport.Data.dyn (Dynamo 2.0.1.5055)

string = StringInput(";")  # graph input
string_2 = StringInput("C:\Temp\TestCSV.csv")  # graph input
code_block = CodeBlock { 1..100; 10; }
chop = List.Chop(list=code_block.out0, lengths=code_block.out1)
string_from_object = FromObject(obj=chop)
watch = Watch(string_from_object)
exportCSV = Custom[Data.ExportCSV+](path=string_2, delimiter=string, data=watch)  # Writes data to a CSV file with a custom delimiter. Data inputs needs to contain strings only!
passthrough = Custom[Passthrough](passThrough=string_2, waitFor=exportCSV)  # Forces a sequential order of execution. The node wired into the output of the Passthrough node will be executed *after* the node wired into the waitFor input (e.g. important for some Revit operations). The value of the passThrough input will be passed on to the node wired into the output port of the Passthrough node.
fromPath = FileObject(path=passthrough)  # "File.FromPath"
readText = FileSystem.ReadText(file=fromPath)
watch_2 = Watch(readText)
boolean = BoolSelector(false)  # graph input
boolean_2 = BoolSelector(false)  # graph input
importCSV = Custom[Data.ImportCSV+](delimiter=string, CSVstring=watch_2, ignoreFirstRow=boolean, ignoreLastRow=boolean_2)  # Converts the content of a given CSV file to a list
watch_3 = Watch(importCSV)
