# Dynamo graph ImportExport.FileSystem.dyn (Dynamo 2.0.3.8810)

file_path = Filename("C:\Program Files\Dynamo\Dynamo Core\2\DynamoSandbox.exe")
fromPath = FileObject(path=file_path)  # "File.FromPath"
fileSize = Custom[FileSystem.FileSize](file=fromPath)  # Returns the file size of a given file.
watch = Watch(fileSize.bytes)
watch_2 = Watch(fileSize.kilobytes)
watch_3 = Watch(fileSize.megabytes)
fileCreated = Custom[FileSystem.FileCreated](file=fromPath)  # Returns the date and time a given file was created
watch_4 = Watch(fileCreated)
fileLastAccessed = Custom[FileSystem.FileLastAccessed](file=fromPath)  # Returns the date and time a given file was last accessed
watch_5 = Watch(fileLastAccessed)
fileLastModified = Custom[FileSystem.FileLastModified](file=fromPath)  # Returns the date and time a given file was last modified
watch_6 = Watch(fileLastModified)
