# Dynamo graph Input.Object.dyn (Dynamo 2.0.1.5055)

string = StringInput("get")  # graph input
byLengths = Cuboid.ByLengths()
membersByName = Custom[Object.MembersByName](searchFor=string, element=byLengths)  # Looks up all the members of a given element based on a given name (or part of a name) of the property or method. Search is case-insensitive.
watch = Watch(membersByName)
members = Custom[Object.Members](element=byLengths)  # Gets a list of all members (properties and methods) of a selected element
watch_2 = Watch(members)
