# Dynamo graph List.Generate.dyn (Dynamo 2.0.1.5055)

string = StringInput("""Apples
Pears
Oranges
Peaches
Bananas
Strawberries
Pineapples
Mangos""")  # graph input
string_2 = StringInput("\n")  # graph input
split = String.Split(str=string, separater0=string_2)
integer_slider = IntegerSlider(13, range=0..25 step 1)  # graph input
integer_slider_2 = IntegerSlider(13, range=0..100 step 1)  # graph input
asElements = Custom[RandomList.AsElements](baseElements=split, amount=integer_slider, seed=integer_slider_2)  # Creates a list of random elements based on a given list of elements
watch = Watch(asElements)
code_block = CodeBlock { 1; }
watch_2 = Watch(code_block)
turn_into_list = Custom[Turn Into List](unknownItem=watch_2)  # Turns an element (or a nested list) into a flat list
watch_3 = Watch(turn_into_list)
create = List.Create(item0=code_block)
create_2 = List.Create(item0=create)
watch_4 = Watch(create_2)
turn_into_list_2 = Custom[Turn Into List](unknownItem=watch_4)
watch_5 = Watch(turn_into_list_2)
integer_slider_3 = IntegerSlider(14, range=0..20 step 1)  # graph input
byNumber = Custom[NormalizedSequence.ByNumber](n=integer_slider_3)  # Creates a sequence of N values between 0 and 1
watch_6 = Watch(byNumber)
formula = Formula("Sin(x*Pi/2)")  # unwired: x
byFunction = Custom[NormalizedSequence.ByFunction](func=formula, n=integer_slider_3)  # Creates a sequence of N values between 0 and 1 driven by a function
watch_7 = Watch(byFunction)
integer_slider_4 = IntegerSlider(58, range=0..100 step 1)  # graph input
boolean = BoolSelector(false)  # graph input
byNumber_2 = Custom[AlphabeticalSequence.ByNumber](n=integer_slider_4, upperCase=boolean)  # Creates a list of the first N letters of the alphabet (where 1 = A, 2 = B, ... , 27 = AA, 28 = AB etc.).
watch_8 = Watch(byNumber_2)
integer_slider_5 = IntegerSlider(30, range=0..100 step 1)  # graph input
code_block_2 = CodeBlock(n=integer_slider_5) { 1..n; 3; }
withLeadingZeroes = Custom[List.WithLeadingZeroes](num=code_block_2.out0, n=code_block_2.out1)  # Adds leading zeros to a sequence of numbers
watch_9 = Watch(withLeadingZeroes)
code_block_3 = CodeBlock { 1..2; 1; 2; 5; }
fromList = Custom[FibonacciSequence.FromList](initialList=code_block_3.out0, length=code_block_3.out3)  # Creates a Fibonacci row from a starting list (last two values) of a given length (starting values do *not* count toward length).
watch_10 = Watch(fromList)
fromValues = Custom[FibonacciSequence.FromValues](A=code_block_3.out1, B=code_block_3.out2, length=code_block_3.out3)  # Creates a Fibonacci row from two starting values of a given length (starting values do *not* count toward length).
watch_11 = Watch(fromValues)
integer_slider_6 = IntegerSlider(14, range=0..100 step 1)
integer_slider_7 = IntegerSlider(29, range=0..100 step 1)
integer_slider_8 = IntegerSlider(53, range=0..100 step 1)
integer_slider_9 = IntegerSlider(66, range=0..100 step 1)
asIntegers = Custom[RandomList.AsIntegers](min=integer_slider_6, max=integer_slider_7, amount=integer_slider_8, seed=integer_slider_9)  # Creates a list of random integers between 0 and a given maximum value
watch_12 = Watch(asIntegers)
