# Dynamo graph List.Match.dyn (Dynamo 2.3.1.11775)
# packages: Clockwork for Dynamo 2.x 2.3.0

code_block = CodeBlock { [1..5,3..10,6..8]; }

# group: List.EqualSublistLengths
watch = Watch(code_block)
equalSublistLengths = Custom[List.EqualSublistLengths](lists=watch)  # package Clockwork for Dynamo 2.x; Trims all given lists to the length of the shortest list
watch_2 = Watch(equalSublistLengths)
