# Dynamo graph List.Modify.dyn (Dynamo 2.0.1.5055)

code_block = CodeBlock { 1..6; [2,4]; }
chop = List.Chop(list=code_block.out0, lengths=code_block.out1)
watch = Watch(chop)
code_block_2 = CodeBlock { 2; }
filterBySublistLength = Custom[List.FilterBySublistLength](seq=watch, length=code_block_2)  # Filters out all sublists that do not have the specified length
watch_2 = Watch(filterBySublistLength.in)
watch_3 = Watch(filterBySublistLength.out)
code_block_3 = CodeBlock { 1..10; }
code_block_4 = CodeBlock { [2,5,6]; }
watch_4 = Watch(code_block_4)
string = StringInput("REPLACEMENT")  # graph input
replaceItemAtIndex = Custom[List.ReplaceItemAtIndex+](seq=code_block_3, indices=watch_4, replacement=string)  # Replaces the item at a given index (or list of indices) of a list by another item
watch_5 = Watch(replaceItemAtIndex)
string_2 = StringInput("""Elephant
Lion
Eagle
Banana
Strawberry
Zebra
Pineapple""")  # graph input
string_3 = StringInput("\n")  # graph input
split = String.Split(str=string_2, separater0=string_3)
empty = List.Empty()
code_block_5 = CodeBlock { 3; }
ofRepeatedItem = List.OfRepeatedItem(item=empty, amount=code_block_5)
join = List.Join(list0=split, list1=ofRepeatedItem)
shuffle = List.Shuffle(list=join)
watch_6 = Watch(shuffle)
replaceEmptyLists = Custom[List.ReplaceEmptyLists](seq=watch_6, Replacement=string)  # Replaces all empty lists within a given list with a substitute
watch_7 = Watch(replaceEmptyLists)
code_block_6 = CodeBlock { null; }
code_block_7 = CodeBlock { 3; }
ofRepeatedItem_2 = List.OfRepeatedItem(item=code_block_6, amount=code_block_7)
join_2 = List.Join(list0=split, list1=ofRepeatedItem_2)
shuffle_2 = List.Shuffle(list=join_2)
watch_8 = Watch(shuffle_2)
replaceNull = Custom[List.ReplaceNull](seq=watch_8, replacement=string)  # Replaces all null values within a given list with a substitute
watch_9 = Watch(replaceNull)
code_block_8 = CodeBlock { 1..10; }
dropLastItem = Custom[List.DropLastItem](list=code_block_8)  # Drops the last item from a given list.
watch_10 = Watch(dropLastItem)
code_block_9 = CodeBlock { 1..6; [2,0,4]; }
chop_2 = Custom[List.Chop+](seq=code_block_9.out0, lengths=code_block_9.out1)  # Turns a list into a list of lists with sublists of varying lengths.
watch_11 = Watch(chop_2)
