# Dynamo graph List.Organize.dyn (Dynamo 2.0.1.5055)

string = StringInput("""Animal
Animal
Animal
Fruit
Fruit
Animal
Fruit""")  # graph input
string_2 = StringInput("\n")  # graph input
split = String.Split(str=string, separater0=string_2)
string_3 = StringInput("""Elephant
Lion
Eagle
Banana
Strawberry
Zebra
Pineapple""")  # graph input
split_2 = String.Split(str=string_3, separater0=string_2)
create = List.Create(item0=split, item1=split_2)
watch = Watch(create)
code_block = CodeBlock { 0; }
groupListOfListsByKey = Custom[List.GroupListOfListsByKey](seq=watch, keyIndex=code_block)  # Groups a list of lists by one of its keys
watch_2 = Watch(groupListOfListsByKey)
code_block_2 = CodeBlock { [2,5,6]; }
watch_3 = Watch(code_block_2)
watch_4 = Watch(split_2)
count = List.Count(list=watch_4)
code_block_3 = CodeBlock(n=count) { 0..n-1; }
matchWithKeyValues = Custom[List.MatchWithKeyValues](seq=watch_3, keys=code_block_3, values=split_2)  # Matches a list with a given set of keys and returns the values corresponding to the keys
watch_5 = Watch(matchWithKeyValues)
count_2 = List.Count(list=split_2)
code_block_4 = CodeBlock(n=count_2) { 1..n; }
create_2 = List.Create(item0=split, item1=split_2, item2=code_block_4)
watch_6 = Watch(create_2)
integer_slider = IntegerSlider(1, range=0..2 step 1)  # graph input
boolean = BoolSelector(false)  # graph input
sortListOfLists = Custom[List.SortListOfLists](seq=watch_6, sortIndex=integer_slider, caseInsensitive=boolean, orderDescending=boolean)  # Sorts a list of lists by one of its sublists
watch_7 = Watch(sortListOfLists)
uniqueItems = List.UniqueItems(list=split)
string_4 = StringInput("Something else")  # graph input
join = List.Join(list0=uniqueItems, list1=string_4)
count_3 = List.Count(list=join)
code_block_5 = CodeBlock(n=count_3) { 0..n-1; }
boolean_2 = BoolSelector(false)  # graph input
joinByKey = Custom[List.JoinByKey](keys1=split, seq1=split_2, keys2=join, seq2=code_block_5, excludeUnmatchedKeys=boolean_2)  # Joins two lists by common keys.
watch_8 = Watch(joinByKey.keys)
watch_9 = Watch(joinByKey.seq1)
watch_10 = Watch(joinByKey.seq2)
