# Dynamo graph Math.Formulas.dyn (Dynamo 2.0.1.5055)

code_block = CodeBlock { 1; }
byCoordinates = Point.ByCoordinates(y=code_block)
origin = Point.Origin()
code_block_2 = CodeBlock { 2; }
byCoordinates_2 = Point.ByCoordinates(x=code_block_2)
solveByPoints = Custom[Triangle.SolveByPoints](PointA=byCoordinates, PointB=origin, PointC=byCoordinates_2)  # Solves a triangle based on the XYZ coordinates of its vertices.
watch = Watch(solveByPoints.IncircleRadius)
watch_2 = Watch(solveByPoints.IncircleCenter)
watch_3 = Watch(solveByPoints.Normal)
watch_4 = Watch(solveByPoints.HeightC)
watch_5 = Watch(solveByPoints.Centroid)
watch_6 = Watch(solveByPoints.Plane)
watch_7 = Watch(solveByPoints.HeightB)
watch_8 = Watch(solveByPoints.Area)
watch_9 = Watch(solveByPoints.HeightA)
watch_10 = Watch(solveByPoints.Alpha)
watch_11 = Watch(solveByPoints.SideB)
watch_12 = Watch(solveByPoints.Beta)
sideByLawOfSines = Custom[Triangle.SideByLawOfSines](alpha=watch_10, sideB=watch_11, beta=watch_12)  # Determines the length of a side based on the law of sines. (Alpha is the angle opposite side A and beta is the angle opposite side B...)
watch_13 = Watch(sideByLawOfSines)
watch_14 = Watch(solveByPoints.SideA)
watch_15 = Watch(solveByPoints.Gamma)
oppositeSideByLawOfCosines = Custom[Triangle.OppositeSideByLawOfCosines](sideA=watch_14, sideB=watch_11, gamma=watch_15)  # Computes the length of the missing side of a triangle using the law of cosines. Gamma is the angle between sides A and B.
watch_16 = Watch(oppositeSideByLawOfCosines)
watch_17 = Watch(solveByPoints.SideC)
hypotenuseByPythagoras = Custom[Triangle.HypotenuseByPythagoras](sideA=watch_14, sideB=watch_17)  # Computes the length of the hypotenuse of a right triangle using the Pythagorean Theorem. A and B are the legs / catheti of the triangle.
watch_18 = Watch(hypotenuseByPythagoras)
cathetusByPythagoras = Custom[Triangle.CathetusByPythagoras](sideC=watch_11, sideB=watch_14)  # Computes the length of one of the catheti / legs of a right triangle using the Pythagorean Theorem. B is the other leg / cathetus of the triangle while C is the hypotenuse.
watch_19 = Watch(cathetusByPythagoras)
exteriorAngle = Custom[Angle.ExteriorAngle](angle=watch_10)  # Computes the exterior angle of a given angle.
watch_20 = Watch(exteriorAngle.360_angle)
watch_21 = Watch(exteriorAngle.180_angle)
create = List.Create(item0=watch_15, item1=watch_10)
byAngleSum = Custom[Angle.ByAngleSum](angles=create)  # Computes the missing interior angle of a *planar* polygon based on a given list of all other interior angles.
watch_22 = Watch(byAngleSum)
byLawOfSines = Custom[Angle.ByLawOfSines](sideA=watch_14, sideB=watch_11, beta=watch_12)  # Determines the angle of a triangle based on the law of sines. (Alpha is the angle opposite side A and beta is the angle opposite side B...)
watch_23 = Watch(byLawOfSines)
byLawOfCosines = Custom[Angle.ByLawOfCosines](sideA=watch_14, sideB=watch_11, sideC=watch_17)  # Computes an angle of a triangle using the law of cosines. A is the opposite side of the triangle while B and C are the sides forming the angle.
watch_24 = Watch(byLawOfCosines)
