# Dynamo graph Math.Functions.dyn (Dynamo 2.0.3.8810)

code_block = CodeBlock { 1; }
n1 = Custom[-1](dbl=code_block)  # Decrements a value by 1
watch = Watch(n1)
n1_2 = Custom[+1](dbl=code_block)  # Increments a value by 1
watch_2 = Watch(n1_2)
code_block_2 = CodeBlock { 7677; 5; }
floor = Custom[Rounding.Floor+](dbl=code_block_2.out0, precision=code_block_2.out1)  # Rounds a number *down* to a specified precision
watch_3 = Watch(floor)
round = Custom[Rounding.Round+](dbl=code_block_2.out0, precision=code_block_2.out1)  # Rounds a number to a specified precision
watch_4 = Watch(round)
ceiling = Custom[Rounding.Ceiling+](dbl=code_block_2.out0, precision=code_block_2.out1)  # Rounds a number *up* to a specified precision
watch_5 = Watch(ceiling)
code_block_3 = CodeBlock { 1..10; }
normalizeRange = Custom[Normalization.NormalizeRange](seq=code_block_3)  # Normalizes a range of numbers
watch_6 = Watch(normalizeRange)
number_slider = DoubleSlider(32.893, range=20..50 step 0.1)  # graph input
code_block_4 = CodeBlock { 20; 50; }
normalize = Custom[Normalization.Normalize](dbl=number_slider, min=code_block_4.out0, max=code_block_4.out1)  # Converts a value into a normalized value according to a value range
watch_7 = Watch(normalize)
invertNormalized = Custom[Normalization.InvertNormalized](dbl=watch_7)  # Inverts a value between 0 and 1 to its opposite (1-x)
watch_8 = Watch(invertNormalized)
scaleNormalized = Custom[Normalization.ScaleNormalized](dbl=normalize, min=code_block_4.out0, max=code_block_4.out1)  # Scales a normalized value according to a given minimum and maximum
watch_9 = Watch(scaleNormalized)
almostZero = Custom[AlmostZero]()  # Returns a feasable computational tolerance to zero (1.0e-9 or a billionth of 1) for use in calculations. More background info: https://github.com/DynamoDS/Dynamo/issues/879
watch_10 = Watch(almostZero)
code_block_5 = CodeBlock { 0..360..#17; }
code_block_6 = CodeBlock { 0..2; }
cardinalDirectionFromAngle = Custom[CardinalDirectionFromAngle](angle=code_block_5, accuracy=code_block_6)  # Returns the cardinal direction (N, E, S, W) for a given angle (where N = 0°, E = 90° etc.). The accuracy input has three modes: 0 = cardinal directions only, 1 = additional intercardinal directions (i.e. NE, SE, SW, NW), 2 = additional secondary intercardinal directions (NNE, ENE, ESE, SSE, SSW, WSW, WNW, NNW).
watch_11 = Watch(cardinalDirectionFromAngle)
