# Dynamo graph Math.Tests.dyn (Dynamo 2.0.1.5055)

code_block = CodeBlock { 2; 8; }
isEvenNumber = Custom[IsEvenNumber](val=code_block.out0)  # Checks if a number is even.
watch = Watch(isEvenNumber)
isOddNumber = Custom[IsOddNumber](val=code_block.out0)  # Checks if a number is odd.
watch_2 = Watch(isOddNumber)
isMultipleOf = Custom[IsMultipleOf](A=code_block.out1, B=code_block.out0)  # Checks if A is a multiple of B.
watch_3 = Watch(isMultipleOf)
number_slider = DoubleSlider(50, range=0..100 step 0.1)  # graph input
number_slider_2 = DoubleSlider(46, range=0..100 step 0.1)  # graph input
number_slider_3 = DoubleSlider(0.1, range=0..1 step 0.1)  # graph input
isSimilar = Custom[IsSimilar](valA=number_slider, valB=number_slider_2, tolerance=number_slider_3)  # Computes the difference between two values and whether that difference is within a given tolerance factor
watch_4 = Watch(isSimilar.isSimilar)
watch_5 = Watch(isSimilar.difference)
