# Dynamo graph Revit.Application.Application.dyn "Revit.Application" (Dynamo 2.0.1.5055)

version = Custom[Application.Version]()  # Retrieves the name, version and build of the current Revit application.
watch = Watch(version.Version)
watch_2 = Watch(version.Build)
watch_3 = Watch(version.Name)
watch_4 = Watch(version.Language)
watch_5 = Watch(version.fullVersion)
file_path = Filename("..\..\..\..\..\..\..\..\Program Files\Autodesk\Revit 2018\Samples\rac_basic_sample_project.rvt")
# note: You can use the Sample Architecture Project (Basic) that ships with Revit to run this graph.
basicFileInfo = Custom[Application.BasicFileInfo](filePath=file_path)  # Retrieves basic information about a given Revit file. PLEASE NOTE: The SavedInLaterVersion property is only available when running the node in Revit 2017 or later, it will return Null in previous versions of Revit.
watch_6 = Watch(basicFileInfo.Username)
watch_7 = Watch(basicFileInfo.IsWorkshared)
watch_8 = Watch(basicFileInfo.SavedInLaterVersion)
watch_9 = Watch(basicFileInfo.CentralPath)
watch_10 = Watch(basicFileInfo.IsCentral)
watch_11 = Watch(basicFileInfo.IsLocal)
watch_12 = Watch(basicFileInfo.Language)
watch_13 = Watch(basicFileInfo.SavedInCurrentVersion)
watch_14 = Watch(basicFileInfo.Version)
