# Dynamo graph Revit.Application.Document.Query.dyn (Dynamo 2.12.0.5650)
# packages: Clockwork for Dynamo 2.x 2.3.0

# group: INFO
# note: You can use the Sample STRUCTURAL Project (Basic) that ships with Revit to run this graph.

# group: INPUTS
select_category_of_elements = Categories("OST_StructuralColumns")  # "Select Category of Elements Present in Model"
select_category_of_elements_not = Categories("OST_Furniture")  # "Select Category of Elements NOT Present in Model"
toggle_to_refresh = BoolSelector(false)  # graph input
list_dynamo_supported_categories = BoolSelector(true)  # "List Dynamo Supported Categories Only"

list_create = List.Create(item0=select_category_of_elements, item1=select_category_of_elements_not)

# group: Document.ContainsElementsOfCategory
watch = Watch(list_create)
containsElementsOfCategory = Custom[Document.ContainsElementsOfCategory](category=watch)  # package Clockwork for Dynamo 2.x; Checks if family instances of specified categories are present in the model.
watch_2 = Watch(containsElementsOfCategory.any)
watch_3 = Watch(containsElementsOfCategory.all)
watch_4 = Watch(containsElementsOfCategory.per_category)
watch_5 = Watch(containsElementsOfCategory.instances)

# group: Document.ActiveViewFromCurrentDocument
activeViewFromCurrentDocument = Custom[Document.ActiveViewFromCurrentDocument]()  # package Clockwork for Dynamo 2.x; Gets the active view of the current document
watch_6 = Watch(activeViewFromCurrentDocument)

# group: Document.IsWorkshared
isWorkshared = Custom[Document.IsWorkshared](toggle=toggle_to_refresh)  # package Clockwork for Dynamo 2.x; Returns true if the current project is workshared
watch_7 = Watch(isWorkshared)

# group: Document.BuiltInCategories
builtInCategories = Custom[Document.BuiltInCategories](dynamoSupportedCategoriesOnly=list_dynamo_supported_categories)  # package Clockwork for Dynamo 2.x; List all the available BuiltInCategories
watch_8 = Watch(builtInCategories.BuiltInCategories)
watch_9 = Watch(builtInCategories.ElementIDs)
watch_10 = Watch(builtInCategories.Categories)

# group: Document.BuiltInParameters
builtInParameters = Custom[Document.BuiltInParameters]()  # package Clockwork for Dynamo 2.x; List all the available BuiltInParameters
watch_11 = Watch(builtInParameters.BuiltInParameters)
watch_12 = Watch(builtInParameters.ElementIDs)
watch_13 = Watch(builtInParameters.ParameterNames)

# group: Document.ProjectInfo
projectInfo = Custom[Document.ProjectInfo](toggle=toggle_to_refresh)  # package Clockwork for Dynamo 2.x; Gets the project information.
watch_14 = Watch(projectInfo.Author)
watch_15 = Watch(projectInfo.Number)
watch_16 = Watch(projectInfo.Name)
watch_17 = Watch(projectInfo.Address)
watch_18 = Watch(projectInfo.OrganizationDescription)
watch_19 = Watch(projectInfo.BuildingName)
watch_20 = Watch(projectInfo.IssueDate)
watch_21 = Watch(projectInfo.ClientName)
watch_22 = Watch(projectInfo.Status)
watch_23 = Watch(projectInfo.OrganizationName)

# group: Document.ProjectPosition
projectPosition = Custom[Document.ProjectPosition](toggle=toggle_to_refresh)  # package Clockwork for Dynamo 2.x; Gets the project's position data relative to the origin. Output coordinates may diverge from the project base point coordinates once the project base point has been moved in an unclipped state. Use the built-in nodes Location.Latitude & Location.Longitude to retrieve latitude and longitude.
watch_24 = Watch(projectPosition.Angle_degr)
watch_25 = Watch(projectPosition.Elevation)
watch_26 = Watch(projectPosition.EastWest)
watch_27 = Watch(projectPosition.NorthSouth)

# group: Document.Phases
phases = Custom[Document.Phases](toggle=toggle_to_refresh)  # package Clockwork for Dynamo 2.x; Retrieves all phases in the active document in *chronological* order
watch_28 = Watch(phases)

# group: Document.StartingView
startingView = Custom[Document.StartingView](toggle=toggle_to_refresh)  # package Clockwork for Dynamo 2.x; Retrieves the starting view of a Project file. Returns null if no starting view is set.
watch_29 = Watch(startingView)

# group: Document.Views
views = Custom[Document.Views](toggle=toggle_to_refresh)  # package Clockwork for Dynamo 2.x; Gets all views in the document - except for 3D view templates (as long as this bug is not fixed: https://github.com/DynamoDS/Dynamo/issues/2970)
watch_30 = Watch(views)

# group: Document.Default3DView
default3DView = Custom[Document.Default3DView](toggle=toggle_to_refresh)  # package Clockwork for Dynamo 2.x; Returns the default 3D view of the current model (if there is such a view)
watch_31 = Watch(default3DView)

# group: Document.ProjectParameters
projectParameters = Custom[Document.ProjectParameters](toggle=toggle_to_refresh)  # package Clockwork for Dynamo 2.x; Retrieves all project parameters and the categories they have been assigned to
watch_32 = Watch(projectParameters.paramName)
watch_33 = Watch(projectParameters.categories)
watch_34 = Watch(projectParameters.variesAcrossGroups)
watch_35 = Watch(projectParameters.parameterGroup)
watch_36 = Watch(projectParameters.parameterType)
watch_37 = Watch(projectParameters.unitType)
watch_38 = Watch(projectParameters.isVisible)
watch_39 = Watch(projectParameters.parameterElement)
watch_40 = Watch(projectParameters.GUID)
watch_41 = Watch(projectParameters.isInstanceParameter)

string = StringInput("OST_ProjectInformation")

# group: Document.ProjectParametersByCategory
projectParametersByCategory = Custom[Document.ProjectParametersByCategory](category=string, toggle=toggle_to_refresh)  # package Clockwork for Dynamo 2.x; Retrieves all project parameters for a given category
watch_42 = Watch(projectParametersByCategory.paramNames)
watch_43 = Watch(projectParametersByCategory.parameterGroups)
watch_44 = Watch(projectParametersByCategory.variesAcrossGroups)
watch_45 = Watch(projectParametersByCategory.parameterTypes)
watch_46 = Watch(projectParametersByCategory.unitTypes)
watch_47 = Watch(projectParametersByCategory.isVisible)
watch_48 = Watch(projectParametersByCategory.GUIDs)
watch_49 = Watch(projectParametersByCategory.isInstanceParameter)
watch_50 = Watch(projectParametersByCategory.parameterElements)

# group: Document.PerformanceAdviserRules
performanceAdviserRules = Custom[Document.PerformanceAdviserRules]()  # package Clockwork for Dynamo 2.x; Retrieves all Performance Adviser Rules from the current document
watch_51 = Watch(performanceAdviserRules)

# group: Document.ElementTypes
elementTypes = Custom[Document.ElementTypes]()  # package Clockwork for Dynamo 2.x; Retrieves a list of all Revit element types
watch_52 = Watch(elementTypes.elementTypes)
watch_53 = Watch(elementTypes.elementTypeNames)

# group: Document.UnitTypes
unitTypes = Custom[Document.UnitTypes](toggle=toggle_to_refresh)  # package Clockwork for Dynamo 2.x; Retrieves all available unit types of a given document (as of Revit 2022: ForgeTypeIds)
watch_54 = Watch(unitTypes)

# group: Document.Enums
enums = Custom[Document.Enums]()  # package Clockwork for Dynamo 2.x; Retrieves all Enums from the Revit API
watch_55 = Watch(enums)

# group: Document.ComputeVolumes
computeVolumes = Custom[Document.ComputeVolumes](toggle=toggle_to_refresh)  # package Clockwork for Dynamo 2.x; Returns whether or not the area and volume settings are set to compute volumes.
watch_56 = Watch(computeVolumes)
