# Dynamo graph Revit.Conversion.dyn (Dynamo 2.12.0.5650)
# packages: Clockwork for Dynamo 2.x 2.3.0

integer_slider = IntegerSlider(255, range=0..255 step 1)  # graph input
integer_slider_2 = IntegerSlider(0, range=0..255 step 1)  # graph input
integer_slider_3 = IntegerSlider(0, range=0..255 step 1)  # graph input
byARGB = Color.ByARGB(red=integer_slider, green=integer_slider_2, blue=integer_slider_3)
watch = Watch(byARGB)

# group: Color.FromDynamoColor
fromDynamoColor = Custom[Color.FromDynamoColor](DynamoColor=watch)  # package Clockwork for Dynamo 2.x; Creates a Revit color from a Dynamo color
watch_2 = Watch(fromDynamoColor)

code_block = CodeBlock { 0; }

# group: Color.ToDynamoColor
toDynamoColor = Custom[Color.ToDynamoColor](RevitColor=watch_2)  # package Clockwork for Dynamo 2.x; Converts Revit colors into Dynamo colors
watch_3 = Watch(toDynamoColor)
color_range = ColorRange(colors=toDynamoColor, indices=code_block, value=code_block)

color_range_2 = ColorRange(colors=watch, indices=code_block, value=code_block)
byLengths = Cuboid.ByLengths()
boundingBox = Geometry.BoundingBox(geometry=byLengths)
watch_4 = Watch(boundingBox)

# group: BoundingBox.FromDynamoBoundingBox
fromDynamoBoundingBox = Custom[BoundingBox.FromDynamoBoundingBox](DynamoBoundingBox=watch_4)  # package Clockwork for Dynamo 2.x; Turns a Dynamo bounding box into a Revit bounding box.
watch_5 = Watch(fromDynamoBoundingBox)
