# Dynamo graph Revit.Elements.Array.dyn (Dynamo 2.0.3.8810)

string = StringInput("BaseArray")
# note: Run this script on the Array_Sample family
byName = Custom[ElementType.ByName](name=string)  # Retrieves an element type by its name - to be used with the OOTB node "All Elements of Type".
all_elements_of_type = ElementsOfType(element_type=byName)
watch = Watch(all_elements_of_type)
associatedFamilyParameter = Custom[Array.AssociatedFamilyParameter](baseArray=watch)  # Returns the associated family parameter of an array label (if any). PLEASE NOTE: This node will only work in a family document!
watch_2 = Watch(associatedFamilyParameter.familyParameter)
watch_3 = Watch(associatedFamilyParameter.familyParameterName)
groupType = Custom[Array.GroupType](array=watch)  # Returns the group type of a given array
watch_4 = Watch(groupType)
