# Dynamo graph Revit.Elements.Category.dyn (Dynamo 2.12.0.5650)
# packages: Clockwork for Dynamo 2.x 2.3.0

boolean = BoolSelector(true)
builtInCategories = Custom[Document.BuiltInCategories](dynamoSupportedCategoriesOnly=boolean)  # package Clockwork for Dynamo 2.x; List all the available BuiltInCategories

# group: Category.Subcategories
subcategories = Custom[Category.Subcategories](category=builtInCategories.Categories)  # package Clockwork for Dynamo 2.x; Retrieves all the subcategories for a given category
watch = Watch(subcategories)

# group: Category.Type
type = Custom[Category.Type](category=builtInCategories.Categories)  # package Clockwork for Dynamo 2.x; Returns the type of the category
watch_2 = Watch(type)

# group: Category.Material
material = Custom[Category.Material](category=builtInCategories.Categories)  # package Clockwork for Dynamo 2.x; Retrieves the material assigned to the given category in the object styles
watch_3 = Watch(material)
