# Dynamo graph Revit.Elements.Color.dyn (Dynamo 1.0.0.1180)

integer_slider = IntegerSlider(255, range=0..255 step 1)
integer_slider_2 = IntegerSlider(0, range=0..255 step 1)
integer_slider_3 = IntegerSlider(0, range=0..255 step 1)
byARGB = Color.ByARGB(r=integer_slider, g=integer_slider_2, b=integer_slider_3)
watch = Watch(byARGB)
fromDynamoColor = Custom[RevitColor.FromDynamoColor](DynamoColor=watch)  # Creates a Revit color from a Dynamo color
watch_2 = Watch(fromDynamoColor)
toDynamoColor = Custom[RevitColor.ToDynamoColor](RevitColor=watch_2)  # Converts Revit colors into Dynamo colors
watch_3 = Watch(toDynamoColor)
code_block = CodeBlock { 0; }
color_range = ColorRange(watch, code_block, code_block)
color_range_2 = ColorRange(toDynamoColor, code_block, code_block)
