# Dynamo graph Revit.Elements.CurtainPanel.dyn (Dynamo 2.12.0.5650)
# packages: Clockwork for Dynamo 2.x 2.3.0

# group: INFO
# note: Run this script with the CurtainPanel_Sample file in the extra folder.

string = StringInput("OST_CurtainWallPanels")
all_elements_of_category = Custom[All Elements Of Category+](category=string)  # package Clockwork for Dynamo 2.x; Gets all placed elements of a given category in the model.
watch = Watch(all_elements_of_category)

# group: CurtainPanel.HostPanel
hostPanel = Custom[CurtainPanel.HostPanel](curtainPanel=watch)  # package Clockwork for Dynamo 2.x; Retrieves the host panel of a given curtain panel. This is typcially needed when wanting to access wall elements used as curtain panels. If no host panel is found, the node will return the input panel instead.
watch_2 = Watch(hostPanel)

# group: CurtainPanel.IsPhantomPanel
isPhantomPanel = Custom[CurtainPanel.IsPhantomPanel](curtainPanel=watch)  # package Clockwork for Dynamo 2.x; Checks whether a given curtain panel is not an actual model element. (These types of objects get generated when curtain grid segments are deleted or in other words when multiple cells of the curtain grid are merged into one panel)
watch_3 = Watch(isPhantomPanel)
