# Dynamo graph Revit.Elements.DetailComponent.dyn (Dynamo 2.12.0.5650)
# packages: Clockwork for Dynamo 2.x 2.3.0

# group: INFO
# note: Run this file on the CreateStuff_Sample model in the extra folder.

code_block = CodeBlock { 7; }
byWidthLength = Rectangle.ByWidthLength(width=code_block, length=code_block)
explode = Geometry.Explode(geometry=byWidthLength)

# group: INPUTS
detail_component_type = FamilyTypes("M_Protection Board-Section:19mm")  # graph input
select_view = Views("Ebene 0")  # graph input

# group: DetailComponent.ByCurve
byCurve = Custom[DetailComponent.ByCurve](curve=explode, familyType=detail_component_type, view=select_view)  # package Clockwork for Dynamo 2.x; Places a line-based detail component in a given view
watch = Watch(byCurve)
