# Dynamo graph Revit.Elements.Dimension.dyn (Dynamo 2.12.0.5650)
# packages: Clockwork for Dynamo 2.x 2.3.0

# group: INFO
# note: Run this file on the Dimension_Sample model in the extra folder.

string = StringInput("OST_Dimensions")
all_elements_of_category = Custom[All Elements Of Category+](category=string)  # package Clockwork for Dynamo 2.x; Gets all placed elements of a given category in the model.
watch = Watch(all_elements_of_category)
string_2 = StringInput("DimensionType")
byName = Custom[ElementType.ByName](name=string_2)  # package Clockwork for Dynamo 2.x; Retrieves an element type by its name - to be used with the OOTB node "All Elements of Type".
all_elements_of_type = ElementsOfType(element_type=byName)
name = Element.Name(element=all_elements_of_type)
code_block = CodeBlock { "RED"; }
eq = name == code_block
filterByBoolMask = List.FilterByBoolMask(list=all_elements_of_type, mask=eq)
firstItem = List.FirstItem(list=filterByBoolMask.in)

# group: Dimension.SetType
setType = Custom[Dimension.SetType](dimensionInstance=watch, dimensionType=firstItem)  # package Clockwork for Dynamo 2.x; Changes the dimension type of a given dimension instance to the specified type
watch_2 = Watch(setType.dimensionInstance)
watch_3 = Watch(setType.success)

# group: Dimension.AssociatedFamilyParameter
associatedFamilyParameter = Custom[Dimension.AssociatedFamilyParameter](dimension=watch)  # package Clockwork for Dynamo 2.x; Returns the associated family parameter of a dimension label (if any). PLEASE NOTE: This node will only work in a family document!
watch_4 = Watch(associatedFamilyParameter.familyParameter)
watch_5 = Watch(associatedFamilyParameter.familyParameterName)

# group: Dimension.ReferencedElements
referencedElements = Custom[Dimension.ReferencedElements](dimension=watch)  # package Clockwork for Dynamo 2.x; Returns all elements that are referenced by a given dimension
watch_6 = Watch(referencedElements)
