# Dynamo graph Revit.Elements.DirectShape.dyn (Dynamo 2.12.0.5650)
# packages: Clockwork for Dynamo 2.x 2.3.0

# group: INPUTS
select_model_elements = DSModelElementsSelection()  # 13 picked in the model; graph input
detail_level = DetailLevel("Fine")  # graph input

watch = Watch(select_model_elements)
geometry = Custom[Element.Geometry+](element=watch, detailLevel=detail_level)  # package Clockwork for Dynamo 2.x; Returns Dynamo AND native Revit geometry of a given element
string = StringInput("OST_GenericModel")
byName = Category.ByName(name=string)
name = Custom[Element.Name+](element=watch)  # package Clockwork for Dynamo 2.x; Gets an element's name. Unlike the OOTB node, this node should work for all Revit elements that have names and will also return the localized names of system parameters, parameter groups, display unit types, parameter types, unit symbol types and unit types.
count = List.Count(list=name)
code_block = CodeBlock(name=name, n=count) { name + "_" + (1..n); }

# group: DirectShape.FromRevitGeometry
watch_2 = Watch(geometry.revitGeometry)
fromRevitGeometry = Custom[DirectShape.FromRevitGeometry](revitGeometry=watch_2, category=byName, name=code_block)  # package Clockwork for Dynamo 2.x; Creates a DirectShape from native Revit geometry objects
watch_3 = Watch(fromRevitGeometry)
