# Dynamo graph Revit.Elements.DividedSurface.Actions.dyn (Dynamo 2.0.1.5055)

select_face = DSFaceSelection()  # 1 picked in the model; graph input
firstItem = List.FirstItem(list=select_face)
code_block = CodeBlock { 1; }
byFaceAndUVDivisions = DividedSurface.ByFaceAndUVDivisions(elementFace=firstItem, uDivs=code_block, vDivs=code_block)
vertices = Topology.Vertices(topology=firstItem)
# note: Run this graph on the DividedSurface_Sample model in the extra folder.
pointGeometry = Vertex.PointGeometry(vertex=vertices)
Z = Point.Z(point=pointGeometry)
code_block_2 = CodeBlock(z=Z) { z==0; }
filterByBoolMask = List.FilterByBoolMask(list=pointGeometry, mask=code_block_2)
code_block_3 = CodeBlock(seq=filterByBoolMask.in) { seq[0]; seq[1]; }
integer_slider = IntegerSlider(8, range=0..20 step 1)  # graph input
verticalIntersectsByEndpoints = Custom[DividedSurface.VerticalIntersectsByEndpoints](dividedSurface=byFaceAndUVDivisions, startPoint=code_block_3.out0, endPoint=code_block_3.out1, subdivisions=integer_slider)  # Creates a number of equally spaced vertical intersects for a divided surface based on the path between between two points. You may need to switch start point and end point.
watch = Watch(verticalIntersectsByEndpoints.dividedSurface)
Z_2 = Point.Z()  # unwired: point
minimumItemByKey = List.MinimumItemByKey(list=pointGeometry, keyProjector=Z_2)
maximumItemByKey = List.MaximumItemByKey(list=pointGeometry, keyProjector=Z_2)
code_block_4 = CodeBlock { "HorizontalIntersect_0"; }
horizontalIntersectsByEndpoints = Custom[DividedSurface.HorizontalIntersectsByEndpoints](dividedSurface=byFaceAndUVDivisions, startPoint=minimumItemByKey, endPoint=maximumItemByKey, subdivisions=integer_slider, intersectName=code_block_4)  # Creates a number of equally spaced horizontal intersects for a divided surface based on the path between between two points.
watch_2 = Watch(horizontalIntersectsByEndpoints.dividedSurface)
watch_3 = Watch(horizontalIntersectsByEndpoints.intersects)
watch_4 = Watch(verticalIntersectsByEndpoints.intersects)
select_face_2 = DSFaceSelection()  # 1 picked in the model; graph input
firstItem_2 = List.FirstItem(list=select_face_2)
byFaceAndUVDivisions_2 = DividedSurface.ByFaceAndUVDivisions(elementFace=firstItem_2, uDivs=code_block, vDivs=code_block)
vertices_2 = Topology.Vertices(topology=firstItem_2)
pointGeometry_2 = Vertex.PointGeometry(vertex=vertices_2)
Z_3 = Point.Z(point=pointGeometry_2)
code_block_5 = CodeBlock(z=Z_3) { z==0; }
filterByBoolMask_2 = List.FilterByBoolMask(list=pointGeometry_2, mask=code_block_5)
code_block_6 = CodeBlock(seq=filterByBoolMask_2.in) { seq[0]; seq[1]; }
formula = Formula("Sin(x*Pi/2)")  # unwired: x
verticalIntersectsByEndpointsAndFunction = Custom[DividedSurface.VerticalIntersectsByEndpointsAndFunction](dividedSurface=byFaceAndUVDivisions_2, startPoint=code_block_6.out1, endPoint=code_block_6.out0, subdivisions=integer_slider, func=formula)  # Creates a number of vertical intersects (reference planes) for a divided surface based on the path between between two points. The spacing can be controlled by a function. You may need to switch start point and end point.
watch_5 = Watch(verticalIntersectsByEndpointsAndFunction.intersects)
watch_6 = Watch(verticalIntersectsByEndpointsAndFunction.dividedSurface)
minimumItemByKey_2 = List.MinimumItemByKey(list=pointGeometry_2, keyProjector=Z_2)
maximumItemByKey_2 = List.MaximumItemByKey(list=pointGeometry_2, keyProjector=Z_2)
code_block_7 = CodeBlock { "HorizontalIntersectByFunction_0"; }
integer_slider_2 = IntegerSlider(4, range=0..10 step 1)  # graph input
formula_2 = Formula("atan(x*n)/atan(n)", n=integer_slider_2)  # unwired: x
horizontalIntersectsByEndpointsAndFuncti = Custom[DividedSurface.HorizontalIntersectsByEndpointsAndFunction](dividedSurface=byFaceAndUVDivisions_2, startPoint=minimumItemByKey_2, endPoint=maximumItemByKey_2, subdivisions=integer_slider, intersectName=code_block_7, func=formula_2)  # Creates a number of horizontal intersects (levels)for a divided surface based on the path between two points. The spacing of the intersects can be controlled by a function.
watch_7 = Watch(horizontalIntersectsByEndpointsAndFuncti.intersects)
watch_8 = Watch(horizontalIntersectsByEndpointsAndFuncti.dividedSurface)
select_model_element = DSModelElementSelection()  # 1 picked in the model; graph input
addIntersect = Custom[DividedSurface.AddIntersect](dividedSurface=byFaceAndUVDivisions_2, element=select_model_element)  # Adds an intersect to a divided surface
watch_9 = Watch(addIntersect)
