# Dynamo graph Revit.Elements.DividedSurface.Query.dyn (Dynamo 2.0.1.5055)

# note: Run this graph on the DividedSurface_Sample model in the extra folder.
select_face = DSFaceSelection()  # 1 picked in the model; graph input
firstItem = List.FirstItem(list=select_face)
integer_slider = IntegerSlider(6, range=0..20 step 1)  # graph input
byFaceAndUVDivisions = DividedSurface.ByFaceAndUVDivisions(elementFace=firstItem, uDivs=integer_slider, vDivs=integer_slider)
end = Revit.Transaction.Transaction.End(input=byFaceAndUVDivisions)
boolean = BoolSelector(false)  # graph input
evaluateGridNodes = Custom[DividedSurface.EvaluateGridNodes](dividedSurface=end, includeOverhangingNodes=boolean)  # Returns UV and XYZ coordinates as well as surface normals for all grid nodes of a given divided surface. Also returns the underlying face.
watch = Watch(evaluateGridNodes.UVs)
watch_2 = Watch(evaluateGridNodes.points)
watch_3 = Watch(evaluateGridNodes.normals)
watch_4 = Watch(evaluateGridNodes.surface)
