# Dynamo graph Revit.Elements.Door.dyn (Dynamo 2.3.1.11775)
# packages: Clockwork for Dynamo 2.x 2.3.0

# group: INFO
# note: You can use the Sample Architecture Project (Basic) that ships with Revit to run this graph.

string = StringInput("OST_Doors")
all_elements_of_category = Custom[All Elements Of Category+](category=string)  # package Clockwork for Dynamo 2.x; Gets all placed elements of a given category in the model.
phases = Custom[Document.Phases]()  # package Clockwork for Dynamo 2.x; Retrieves all phases in the active document in *chronological* order
code_block = CodeBlock { "Working Drawings"; }
boolean = BoolSelector(true)  # graph input
filterByName = Custom[Elements.FilterByName](elements=phases, searchString=code_block, ignoreCase=boolean)  # package Clockwork for Dynamo 2.x; Retrieves those elements from a collection whose names match the search string

# group: Door.Rooms
watch = Watch(all_elements_of_category)
watch_2 = Watch(filterByName.first)
rooms = Custom[Door.Rooms](door=watch, phase=watch_2)  # package Clockwork for Dynamo 2.x; Gets the rooms that are connected by a given door
watch_3 = Watch(rooms.roomCount)
watch_4 = Watch(rooms.fromRoom)
watch_5 = Watch(rooms.toRoom)
