# Dynamo graph Revit.Elements.Element.Actions.dyn (Dynamo 2.0.4.12684)

select_model_element = DSModelElementSelection()  # 1 picked in the model; graph input
watch = Watch(select_model_element)
YAxis = Vector.YAxis()
number_slider = DoubleSlider(9.2, range=0..20 step 0.1)  # graph input
scale = Vector.Scale(vector=YAxis, scale_factor=number_slider)
boolean = BoolSelector(true)  # graph input
copyByVector = Custom[Element.CopyByVector](element=watch, vector=scale, rehostToClosestLevel=boolean)  # Copies an element or a list of elements by a given vector.
watch_2 = Watch(copyByVector)
levels = Levels(index=1)  # graph input
copyToLevel = Custom[Element.CopyToLevel](element=copyByVector, level=levels)  # Copies an element or a list of elements to a given level. Preserves the element's transform. PLEASE NOTE: This node only works for levels that have at least one view (e.g. floor plan) associated with them.
watch_3 = Watch(copyToLevel)
select_model_element_2 = DSModelElementSelection()  # 1 picked in the model; graph input
watch_4 = Watch(select_model_element_2)
select_model_element_3 = DSModelElementSelection()  # 1 picked in the model; graph input
watch_5 = Watch(select_model_element_3)
cutGeometry = Custom[Element.CutGeometry](elementToBeCut=watch_4, cuttingElement=watch_5)  # Adds a solid-solid cut for two model elements (if possible).
watch_6 = Watch(cutGeometry.success)
select_model_element_4 = DSModelElementSelection()  # 1 picked in the model; graph input
watch_7 = Watch(select_model_element_4)
joinGeometry = Custom[Element.JoinGeometry](element1=watch_4, element2=watch_7)  # Joins two model elements (if possible). Only works inside the project environment.
watch_8 = Watch(joinGeometry.success)
string = StringInput("Material")  # graph input
setMaterialParameterByCategory = Custom[Element.SetMaterialParameterByCategory](element=watch_4, materialParameterName=string)  # Sets a material parameter of a given element to <By Category>
watch_9 = Watch(setMaterialParameterByCategory.elements)
watch_10 = Watch(setMaterialParameterByCategory.success)
string_2 = StringInput("RenamedByDynamo")  # graph input
setName = Custom[Element.SetName](element=watch_5, name=string_2)  # Gets the name of a given Revit element
watch_11 = Watch(setName.element)
watch_12 = Watch(setName.success)
worksets = Custom[Document.Worksets]()  # Returns all Worksets in the current document
firstItem = List.FirstItem(list=worksets)
setWorkset = Custom[Element.SetWorkset](workset=firstItem, element=watch)  # Sets the workset of a given element
watch_13 = Watch(setWorkset.elements)
watch_14 = Watch(setWorkset.success)
# note: Run this graph on the Actions_Sample model
name = Custom[Element.Name+](element=firstItem)  # Gets an element's name. Unlike the OOTB node, this node should work for all Revit elements that have names and will also return the localized names of system parameters, parameter groups, display unit types, parameter types, unit symbol types and unit types.
watch_15 = Watch(name)
string_3 = StringInput("OST_Lines")
byName = Category.ByName(name=string_3)
all_elements_of_category = ElementsOfCategory(Category=byName)
string_4 = StringInput("OST_OverheadLines")
byName_2 = Category.ByName(name=string_4)
setSubCategory = Custom[Element.SetSubCategory](elements=all_elements_of_category, subCategory=byName_2)  # Assigns the given element(s) to the specified subcategory. The node should work for all geometry and curve elements. In some cases the GraphicsStyleType (Cut = TRUE, Projection = FALSE) needs to be specified.
watch_16 = Watch(setSubCategory.elements)
watch_17 = Watch(setSubCategory.success)
watch_18 = Watch(cutGeometry.elementToBeCut)
watch_19 = Watch(cutGeometry.cuttingElement)
watch_20 = Watch(joinGeometry.element2)
watch_21 = Watch(joinGeometry.element1)
select_model_element_5 = DSModelElementSelection()  # 1 picked in the model
XZ = Plane.XZ()
boolean_2 = BoolSelector(true)
mirror = Custom[Element.Mirror](element=select_model_element_5, plane=XZ, copy=boolean_2)  # Mirrors an element about a given plane.
watch_22 = Watch(mirror)
select_model_element_6 = DSModelElementSelection()  # 1 picked in the model
code_block = CodeBlock { 2; }
byCoordinates = Point.ByCoordinates(z=code_block)
moveToPoint = Custom[Element.MoveToPoint](element=select_model_element_6, point=byCoordinates)  # Moves a point-based element to the given location
watch_23 = Watch(moveToPoint.element)
watch_24 = Watch(moveToPoint.success)
