# Dynamo graph Revit.Elements.ElevationMarker.dyn (Dynamo 2.3.1.11775)
# packages: Clockwork for Dynamo 2.x 2.3.0

string = StringInput("ElevationMarker")
byName = Custom[ElementType.ByName](name=string)  # package Clockwork for Dynamo 2.x; Retrieves an element type by its name - to be used with the OOTB node "All Elements of Type".
all_elements_of_type = ElementsOfType(element_type=byName)

# group: ElevationMarker.Views
views = Custom[ElevationMarker.Views](elevationMarker=all_elements_of_type)  # package Clockwork for Dynamo 2.x; Retrieves all views referenced by a given elevation marker
watch = Watch(views)
