# Dynamo graph Revit.Elements.Family.dyn (Dynamo 2.0.4.12684)

string = StringInput("Family")
byName = Custom[ElementType.ByName](name=string)  # Retrieves an element type by its name - to be used with the OOTB node "All Elements of Type".
all_elements_of_type = ElementsOfType(element_type=byName)
watch = Watch(all_elements_of_type)
isInPlace = Custom[Family.IsInPlace](family=watch)  # Determines if a family is an in-place family
filterByBoolMask = List.FilterByBoolMask(list=watch, mask=isInPlace)
watch_2 = Watch(filterByBoolMask.in)
placementType = Custom[Family.PlacementType](family=watch)  # Returns the expected host class of a family (if any)
watch_3 = Watch(placementType)
hostingBehavior = Custom[Family.HostingBehavior](family=watch)  # Returns the expected host class of a family (if any)
watch_4 = Watch(hostingBehavior)
hasRoomCalculationPoint = Custom[Family.HasRoomCalculationPoint](family=watch)  # Determines whether the given family has the room calculation point activated.
filterByBoolMask_2 = List.FilterByBoolMask(list=watch, mask=hasRoomCalculationPoint)
watch_5 = Watch(filterByBoolMask_2.in)
isEditable = Custom[Family.IsEditable](family=watch)  # Determines if a family is editable
filterByBoolMask_3 = List.FilterByBoolMask(list=watch, mask=isEditable)
watch_6 = Watch(filterByBoolMask_3.in)
