# Dynamo graph Revit.Elements.FamilyParameter.dyn (Dynamo 2.12.0.5650)
# packages: Clockwork for Dynamo 2.x 2.3.0

boolean = BoolSelector(false)
familyParameters = Custom[FamilyDocument.FamilyParameters](toggle=boolean)  # package Clockwork for Dynamo 2.x; Retrieves all family parameters from the active family document. PLEASE NOTE: This node will only work in a family document!
watch = Watch(familyParameters)

# group: FamilyParameter.Properties
properties = Custom[FamilyParameter.Properties](familyParameter=watch)  # package Clockwork for Dynamo 2.x; Retrieves all properties of a given family parameter. PLEASE NOTE: This node will only work in a family document!
watch_2 = Watch(properties.Name)
watch_3 = Watch(properties.CanBeAssignedAFormula)
watch_4 = Watch(properties.IsUserModfiable)
watch_5 = Watch(properties.AssociatedParameters)
watch_6 = Watch(properties.AssociatedElements)
watch_7 = Watch(properties.ParameterNamesInFormula)
watch_8 = Watch(properties.IsInstanceParameter)
watch_9 = Watch(properties.IsSharedParameter)
watch_10 = Watch(properties.IsReportingParameter)
watch_11 = Watch(properties.IsDeterminedByFormula)
watch_12 = Watch(properties.IsReadOnly)
watch_13 = Watch(properties.Formula)
watch_14 = Watch(properties.Type)
watch_15 = Watch(properties.StorageType)
watch_16 = Watch(properties.DisplayUnitType)
watch_17 = Watch(properties.UnitType)
watch_18 = Watch(properties.Group)
watch_19 = Watch(properties.GUID)

filterByBoolMask = List.FilterByBoolMask(list=watch, mask=properties.IsInstanceParameter)

# group: FamilyParameter.MakeType
watch_20 = Watch(filterByBoolMask.in)
makeType = Custom[FamilyParameter.MakeType](familyParameter=watch_20)  # package Clockwork for Dynamo 2.x; Converts an instance parameter to a type parameter. ATTENTION: Only works in a family document.
watch_21 = Watch(makeType.success)

# group: FamilyParameter.MakeInstance
watch_22 = Watch(filterByBoolMask.out)
makeInstance = Custom[FamilyParameter.MakeInstance](familyParameter=watch_22)  # package Clockwork for Dynamo 2.x; Converts a type parameter to an instance parameter. ATTENTION: Only works in a family document.
watch_23 = Watch(makeInstance.success)

string_from_object = FromObject(obj=properties.StorageType)
code_block = CodeBlock(storagetype=string_from_object) { storagetype == "String"; }
filterByBoolMask_2 = List.FilterByBoolMask(list=watch, mask=code_block)
firstItem = List.FirstItem(list=filterByBoolMask_2.in)

# group: INPUTS
formula_value = StringInput("\"Formula set by Dynamo\"")  # graph input

# group: FamilyParameter.SetFormula
setFormula = Custom[FamilyParameter.SetFormula](familyParameter=firstItem, formula=formula_value)  # package Clockwork for Dynamo 2.x; Sets the formula for a given family parameter. ATTENTION: Will only work if family contains at least one family type.
watch_24 = Watch(setFormula.familyParameter)
watch_25 = Watch(setFormula.success)

familyTypes = Custom[FamilyDocument.FamilyTypes](toggle=boolean)  # package Clockwork for Dynamo 2.x; Retrieves all family types from the active family document. PLEASE NOTE: This node will only work in a family document!

# group: FamilyParameter.GetValueByFamilyType
watch_26 = Watch(familyTypes)
getValueByFamilyType = Custom[FamilyParameter.GetValueByFamilyType](familyParameter=watch@L1, familyType=watch_26)  # package Clockwork for Dynamo 2.x; Returns the value of a family parameter for a given family type
watch_27 = Watch(getValueByFamilyType)
