# Dynamo graph Revit.Elements.FamilyType.dyn (Dynamo 2.12.0.5650)
# packages: Clockwork for Dynamo 2.x 2.3.0

string = StringInput("WallType")
byName = Custom[ElementType.ByName](name=string)  # package Clockwork for Dynamo 2.x; Retrieves an element type by its name - to be used with the OOTB node "All Elements of Type".
all_elements_of_type = ElementsOfType(element_type=byName)
firstItem = List.FirstItem(list=all_elements_of_type)
watch = Watch(firstItem)

# group: FamilyType.CompoundStructureLayers
compoundStructureLayers = Custom[FamilyType.CompoundStructureLayers](elementType=watch)  # package Clockwork for Dynamo 2.x; Retrieves the compound layers of any layered family type (wall types, roof types, floor types etc.)
watch_2 = Watch(compoundStructureLayers.materials)
watch_3 = Watch(compoundStructureLayers.wraps)
watch_4 = Watch(compoundStructureLayers.layers)
watch_5 = Watch(compoundStructureLayers.isStructuralDeck)
watch_6 = Watch(compoundStructureLayers.isVariable)
watch_7 = Watch(compoundStructureLayers.isCore)
watch_8 = Watch(compoundStructureLayers.widths)
watch_9 = Watch(compoundStructureLayers.functions)

# group: INPUTS
duplicate_name = StringInput("Duplicated by Dynamo")
material_search_string = StringInput("Aluminium")
layer_width = IntegerSlider(10, range=0..50 step 1)

# group: FamilyType.Duplicate
duplicate = Custom[FamilyType.Duplicate](elementType=watch, name=duplicate_name)  # package Clockwork for Dynamo 2.x; Duplicates a family type
watch_10 = Watch(duplicate)

code_block = CodeBlock { 1; }
string_2 = StringInput("OST_Materials")
all_elements_of_category = Custom[All Elements Of Category+](category=string_2)  # package Clockwork for Dynamo 2.x; Gets all placed elements of a given category in the model.
boolean = BoolSelector(true)  # graph input
filterByName = Custom[Elements.FilterByName](elements=all_elements_of_category, searchString=material_search_string, ignoreCase=boolean)  # package Clockwork for Dynamo 2.x; Retrieves those elements from a collection whose names match the search string

# group: FamilyType.SetCompoundLayerMaterial
setCompoundLayerMaterial = Custom[FamilyType.SetCompoundLayerMaterial](familyType=watch_10, layerIndex=code_block, material=filterByName.first)  # package Clockwork for Dynamo 2.x; Sets the material of a specified compound layer of a given family type (only applies to family types that have a compound structure, e.g. walls, floors etc.).
watch_11 = Watch(setCompoundLayerMaterial.success)
watch_12 = Watch(setCompoundLayerMaterial.familyType)

# group: FamilyType.CompoundStructureHasVariableLayer
compoundStructureHasVariableLayer = Custom[FamilyType.CompoundStructureHasVariableLayer](familyType=watch)  # package Clockwork for Dynamo 2.x; Checks if the compound structure of a given floor or roof type contains a variable layer.
watch_13 = Watch(compoundStructureHasVariableLayer)

# group: FamilyType.SetCompoundLayerWidth
setCompoundLayerWidth = Custom[FamilyType.SetCompoundLayerWidth](familyType=watch_10, layerIndex=code_block, width=layer_width)  # package Clockwork for Dynamo 2.x; Sets the width of a specified compound layer of a given family type (only applies to family types that have a compound structure, e.g. walls, floors etc.).
watch_14 = Watch(setCompoundLayerWidth.familyType)
watch_15 = Watch(setCompoundLayerWidth.success)

watch_16 = Watch(all_elements_of_type)

# group: FamilyType.FamilyName
familyName = Custom[FamilyType.FamilyName](familyType=watch_16)  # package Clockwork for Dynamo 2.x; Returns the *family* name of a given family *type*
watch_17 = Watch(familyName)

# group: FamilyType.Function
function = Custom[FamilyType.Function](familyType=watch_16)  # package Clockwork for Dynamo 2.x; Retrieves the Function property of a given family type (if it has that property)
watch_18 = Watch(function)
