# Dynamo graph Revit.Elements.Floor.dyn (Dynamo 2.0.3.8810)

string = StringInput("OST_Floors")
select_model_element = DSModelElementSelection()  # 1 picked in the model; graph input
resetSlabShape = Custom[Floor.ResetSlabShape](floor=select_model_element)  # Resets the slabshape of a floor
watch = Watch(resetSlabShape.floor)
select_face = DSFaceSelection()  # 1 picked in the model; graph input
firstItem = List.FirstItem(list=select_face)
integer_slider = IntegerSlider(11, range=0..20 step 1)  # graph input
gridFromFace = Custom[Paneling.GridFromFace](surface=firstItem, U=integer_slider, V=integer_slider)  # Returns UV coordinates, XYZ coordinates and normals for a face with UV subdivision
watch_2 = Watch(gridFromFace.Points)
# note: Run this graph on the Floor_Sample file in the extra folder.
select_model_element_2 = DSModelElementSelection()  # 1 picked in the model; graph input
watch_3 = Watch(select_model_element_2)
slabShapeByPoints = Custom[Floor.SlabShapeByPoints](points=watch_2, floor=watch_3)  # Transform a slab shape based on a list of Points
create = List.Create(item0=watch, item1=slabShapeByPoints.floor)
passthrough = Custom[Passthrough](passThrough=string, waitFor=create)  # Forces a sequential order of execution. The node wired into the output of the Passthrough node will be executed *after* the node wired into the waitFor input (e.g. important for some Revit operations). The value of the passThrough input will be passed on to the node wired into the output port of the Passthrough node.
all_elements_of_category = Custom[All Elements Of Category+](category=passthrough)  # Gets all placed elements of a given category in the model.
watch_4 = Watch(all_elements_of_category)
slabShapeHasBeenModified = Custom[Floor.SlabShapeHasBeenModified](floor=watch_4)  # Checks if the shape of a floor slab has been modified with the shape editing tools
watch_5 = Watch(slabShapeHasBeenModified)
watch_6 = Watch(slabShapeByPoints.floor)
watch_7 = Watch(resetSlabShape.success)
watch_8 = Watch(slabShapeByPoints.success)
