# Dynamo graph Revit.Elements.FootingType.dyn (Dynamo 2.0.3.8810)

# note: Run this file on the FootingType_Sample model in the extra folder.
string = StringInput("OST_StructuralFoundation")
all_elements_of_category = Custom[All Elements Of Category+](category=string)  # Gets all placed elements of a given category in the model.
elementType = Element.ElementType(element=all_elements_of_category)
watch = Watch(elementType)
breaksAtInserts = Custom[FootingType.BreaksAtInserts](footingType=watch)  # Determines whether a list of wall footing types break at inserts in their attached walls
watch_2 = Watch(breaksAtInserts)
