# Dynamo graph Revit.Elements.GenericForm.dyn (Dynamo 2.6.2.15705)
# packages: Clockwork for Dynamo 2.x 2.4.0

string = StringInput("GenericForm")
# note: Run this graph in a family file
byName = Custom[ElementType.ByName](name=string)  # package Clockwork for Dynamo 2.x; Retrieves an element type by its name - to be used with the OOTB node "All Elements of Type".
all_elements_of_type = ElementsOfType(element_type=byName)
watch = Watch(all_elements_of_type)

# group: GenericForm.IsSolid
isSolid = Custom[GenericForm.IsSolid](GenericForm=watch)  # package Clockwork for Dynamo 2.x; Checks if a form element in a family is a solid or a void. Will return Null for any other elements.
watch_2 = Watch(isSolid)
