# Dynamo graph Revit.Elements.Grid.dyn (Dynamo 2.3.1.11775)
# packages: Clockwork for Dynamo 2.x 2.3.0

string = StringInput("OST_Grids")
all_elements_of_category = Custom[All Elements Of Category+](category=string)  # package Clockwork for Dynamo 2.x; Gets all placed elements of a given category in the model.

# group: Grid.Plane
watch = Watch(all_elements_of_category)
plane = Custom[Grid.Plane](grid=watch)  # package Clockwork for Dynamo 2.x; Retrieves the plane of a grid. Returns null for curved grid lines.
watch_2 = Watch(plane)
