# Dynamo graph Revit.Elements.GroupType.dyn (Dynamo 2.0.3.8810)

string = StringInput("GroupType")
byName = Custom[ElementType.ByName](name=string)  # Retrieves an element type by its name - to be used with the OOTB node "All Elements of Type".
all_elements_of_type = ElementsOfType(element_type=byName)
watch = Watch(all_elements_of_type)
groups = Custom[GroupType.Groups](groupType=watch)  # Returns all group instances of a given group type
watch_2 = Watch(groups)
