# Dynamo graph Revit.Elements.Level.dyn (Dynamo 2.3.1.11775)
# packages: Clockwork for Dynamo 2.x 2.3.0

string = StringInput("OST_Levels")
all_elements_of_category = Custom[All Elements Of Category+](category=string)  # package Clockwork for Dynamo 2.x; Gets all placed elements of a given category in the model.
watch = Watch(all_elements_of_category)

# group: Level.Plane
plane = Custom[Level.Plane](level=watch)  # package Clockwork for Dynamo 2.x; Retrieves the plane of a given level
watch_2 = Watch(plane)

boolean = BoolSelector(false)  # graph input

# group: Level.Views
views = Custom[Level.Views](level=watch, toggleToRefresh=boolean)  # package Clockwork for Dynamo 2.x; Returns all views associated with a given level
watch_3 = Watch(views.firstView)
watch_4 = Watch(views.allViews)
