# Dynamo graph Revit.Elements.MassFloor.dyn (Dynamo 2.12.0.5650)
# packages: Clockwork for Dynamo 2.x 2.3.0

# group: INFO
# note: You can run this graph on the ModelByFace_Sample file in the extra folder.

string = StringInput("OST_MassFloor")
all_elements_of_category = Custom[All Elements Of Category+](category=string)  # package Clockwork for Dynamo 2.x; Gets all placed elements of a given category in the model.

# group: MassFloor.Mass
watch = Watch(all_elements_of_category)
mass = Custom[MassFloor.Mass](massFloor=watch)  # package Clockwork for Dynamo 2.x; Gets the mass a given mass floor belongs to
watch_2 = Watch(mass)
