# Dynamo graph Revit.Elements.ModelCurve.dyn (Dynamo 2.12.0.5650)
# packages: Clockwork for Dynamo 2.x 2.3.0

# group: INFO
# note: Run this graph on the CreateStuff_Sample file in the extra folder.

code_block = CodeBlock { 4..6; }
byWidthLength = Rectangle.ByWidthLength(width=code_block, length=code_block)
curves = PolyCurve.Curves(polyCurve=byWidthLength)
code_block_2 = CodeBlock(rect=curves) { rect[0]; rect[1]; rect[2]; }
origin = Point.Origin()
ZAxis = Vector.ZAxis()
byOriginNormal = Plane.ByOriginNormal(origin=origin, normal=ZAxis)
byPlane = SketchPlane.ByPlane(plane=byOriginNormal)
views = Custom[Document.Views]()  # package Clockwork for Dynamo 2.x; Gets all views in the document - except for 3D view templates (as long as this bug is not fixed: https://github.com/DynamoDS/Dynamo/issues/2970)
type = Custom[View.Type](view=views)  # package Clockwork for Dynamo 2.x; Returns the type of a given view
code_block_3 = CodeBlock(type=type) { type == "AreaPlan"; }
filterByBoolMask = List.FilterByBoolMask(list=views, mask=code_block_3)
firstItem = List.FirstItem(list=filterByBoolMask.in)

# group: AreaSeparator.FromCurve
fromCurve = Custom[AreaSeparator.FromCurve](curve=code_block_2.out0, sketchPlane=byPlane, areaPlanView=firstItem)  # package Clockwork for Dynamo 2.x; Creates area separation lines from geometry curves.
watch = Watch(fromCurve)

# group: INPUTS
pick_floor_plan = Views("Ebene 0")  # graph input

# group: RoomSeparator.FromCurve
fromCurve_2 = Custom[RoomSeparator.FromCurve](curve=code_block_2.out1, sketchPlane=byPlane, view=pick_floor_plan)  # package Clockwork for Dynamo 2.x; Creates room separation lines from geometry curves.
watch_2 = Watch(fromCurve_2)

# group: SpaceSeparator.FromCurve
fromCurve_3 = Custom[SpaceSeparator.FromCurve](curve=code_block_2.out2, sketchPlane=byPlane, view=pick_floor_plan)  # package Clockwork for Dynamo 2.x; Creates space separation lines from geometry curves.
watch_3 = Watch(fromCurve_3)

create = List.Create(item0=watch, item1=watch_2, item2=watch_3)

# group: ModelCurve.Type
type_2 = Custom[ModelCurve.Type](modelCurve=create@L2)  # package Clockwork for Dynamo 2.x; Gets the type of a given model curve
watch_4 = Watch(type_2)
