# Dynamo graph Revit.Elements.ParameterElement.dyn (Dynamo 2.0.3.8810)

projectParameters = Custom[Document.ProjectParameters]()  # Retrieves all project parameters and the categories they have been assigned to

# group: Enter a parameter name here
string = StringInput("")  # graph input

indexOf = List.IndexOf(list=projectParameters.paramName, element=string)
getItemAtIndex = List.GetItemAtIndex(list=projectParameters.parameterElement, index=indexOf)
setAllowVaryBetweenGroups = Custom[ParameterElement.SetAllowVaryBetweenGroups](parameterElement=getItemAtIndex)  # Lets you define whether or not the values of a given project parameter can vary across group members.
watch = Watch(setAllowVaryBetweenGroups.parameterElement)
watch_2 = Watch(setAllowVaryBetweenGroups.success)
