# Dynamo graph Revit.Elements.ParameterFilterElement.dyn (Dynamo 2.6.2.15705)
# packages: Clockwork for Dynamo 2.x 2.4.0

string = StringInput("ParameterFilterElement")
byName = Custom[ElementType.ByName](name=string)  # package Clockwork for Dynamo 2.x; Retrieves an element type by its name - to be used with the OOTB node "All Elements of Type".
all_elements_of_type = ElementsOfType(element_type=byName)

# group: ParameterFilterElement.FilterRuleString
filterRuleString = Custom[ParameterFilterElement.FilterRuleString](parameterFilterElement=all_elements_of_type)  # package Clockwork for Dynamo 2.x; Aggregates the filter rules of a given ParameterFilterElement into a human-readable string
watch = Watch(filterRuleString)

# group: ParameterFilterElement.Parameters
parameters = Custom[ParameterFilterElement.Parameters](parameterFilterElement=all_elements_of_type)  # package Clockwork for Dynamo 2.x; Retrieves the names of all parameters used in a given ParameterFilterElement
watch_2 = Watch(parameters)
