# Dynamo graph Revit.Elements.Part.dyn (Dynamo 2.3.1.11775)
# packages: Clockwork for Dynamo 2.x 2.3.0

# group: INFO
# note: Run this graph on the Parts_Sample file in the extra folder.

string = StringInput("OST_Parts")
all_elements_of_category = Custom[All Elements Of Category+](category=string)  # package Clockwork for Dynamo 2.x; Gets all placed elements of a given category in the model.

# group: Part.SourceElement
watch = Watch(all_elements_of_category)
sourceElement = Custom[Part.SourceElement](part=watch)  # package Clockwork for Dynamo 2.x; Retrieves the element a given part was made from
watch_2 = Watch(sourceElement)
