# Dynamo graph Revit.Elements.Railing.dyn (Dynamo 2.12.0.5650)
# packages: Clockwork for Dynamo 2.x 2.3.0

# group: INFO
# note: Run this group with the CreateStuff sample model

# group: INPUTS
select_model_elements = DSModelElementsSelection()  # 2 picked in the model

getLocation = Element.GetLocation(element=select_model_elements)
string = StringInput("RailingType")
byName = Custom[ElementType.ByName](name=string)  # package Clockwork for Dynamo 2.x; Retrieves an element type by its name - to be used with the OOTB node "All Elements of Type".
all_elements_of_type = ElementsOfType(element_type=byName)
firstItem = List.FirstItem(list=all_elements_of_type)
levels = Levels("Ebene 0")

# group: Railing.ByPathTypeAndLevel
byPathTypeAndLevel = Custom[Railing.ByPathTypeAndLevel](curves=getLocation, railingType=firstItem, level=levels)  # package Clockwork for Dynamo 2.x; Creates a railing based on a given path, railing type and level.
watch = Watch(byPathTypeAndLevel)
