# Dynamo graph Revit.Elements.RevisionCloud.dyn (Dynamo 2.12.0.5650)
# packages: Clockwork for Dynamo 2.x 2.3.0

string = StringInput("OST_StructuralColumns")
byName = Category.ByName(name=string)
all_elements_of_category = ElementsOfCategory(Category=byName)
list_create = List.Create(item0=all_elements_of_category)
string_2 = StringInput("Revision")
byName_2 = Custom[ElementType.ByName](name=string_2)  # package Clockwork for Dynamo 2.x; Retrieves an element type by its name - to be used with the OOTB node "All Elements of Type".
all_elements_of_type = ElementsOfType(element_type=byName_2)
lastItem = List.LastItem(list=all_elements_of_type)

# group: INPUTS
select_view = Views("Level 1")  # graph input

# group: RevisionCloud.FromElements
watch = Watch(list_create)
watch_2 = Watch(lastItem)
fromElements = Custom[RevisionCloud.FromElements](elements=watch, revision=watch_2, view=select_view)  # package Clockwork for Dynamo 2.x; Create a revision cloud for a list of Revit elements
watch_3 = Watch(fromElements)
