# Dynamo graph Revit.Elements.RevitLinkType.dyn (Dynamo 2.0.4.12684)

# note: Alternatively, to reload from a different source connect this to the relaodFrom input of the RevitLinkType.Reload node.
file_path = Filename("No file selected.")  # graph input
# note: Run this graph on the RevitLinkType_Sample model.
string = StringInput("RevitLinkType")
byName = Custom[ElementType.ByName](name=string)  # Retrieves an element type by its name - to be used with the OOTB node "All Elements of Type".
all_elements_of_type = ElementsOfType(element_type=byName)
watch = Watch(all_elements_of_type)
attachmentType = Custom[RevitLinkType.AttachmentType](revitLinkType=watch)  # Returns the attachment type of a RevitLInkType
watch_2 = Watch(attachmentType)
pathType = Custom[RevitLinkType.PathType](revitLinkType=watch)  # Returns the path type of a RevitLInkType
watch_3 = Watch(pathType)
# note: True = Unload
# False = Reload
unload_reload = BoolSelector(true)  # graph input
empty = List.Empty()
scopeIf = Custom[ScopeIf+](test=unload_reload, True=watch, False=empty)  # A (hopefully) more robust implementation of ScopeIf. Tests a single boolean and returns a value accordingly.
unload = Custom[RevitLinkType.Unload](revitLinkType=scopeIf)  # Unloads a Revit or IFC link
watch_4 = Watch(unload.revitLinkType)
watch_5 = Watch(unload.success)
scopeIf_2 = Custom[ScopeIf+](test=unload_reload, True=empty, False=watch)
reload = Custom[RevitLinkType.Reload](revitLinkType=scopeIf_2)  # Reloads a Revit or IFC link.
watch_6 = Watch(reload.revitLinkType)
watch_7 = Watch(reload.success)
isNested = Custom[RevitLinkType.IsNested](revitLinkType=watch)  # Returns whether a RevitLinkType is nested or not
watch_8 = Watch(isNested)
