# Dynamo graph Revit.Elements.Room.dyn (Dynamo 2.0.3.8810)

string = StringInput("OST_Rooms")
# note: You can use the Sample Architecture Project (Basic) that ships with Revit to run this graph.
all_elements_of_category = Custom[All Elements Of Category+](category=string)  # Gets all placed elements of a given category in the model.
boundaries = Custom[Room.Boundaries](room=all_elements_of_category)  # Gets a list of all boundaries of a given room or area and a corresponding list of the elements that are generating those boundaries.
watch = Watch(boundaries.curves)
watch_2 = Watch(boundaries.elements)
state = Custom[Room.State](room=all_elements_of_category)  # Returns the state of a room, i.e. is it placed, unplaced, redundant or not enclosed.
watch_3 = Watch(state)
boolean = BoolSelector(true)  # graph input
insertsOfBoundaries = Custom[Room.InsertsOfBoundaries](room=all_elements_of_category, includeOpenings=boolean, includeShadows=boolean, includeEmbeddedWalls=boolean, includeSharedEmbeddedInserts=boolean)  # Retrieves the inserts of the bounding elements of a given room.
watch_4 = Watch(insertsOfBoundaries)
string_2 = StringInput("OST_Doors")
byName = Category.ByName(name=string_2)
insertsOfBoundariesByCategory = Custom[Room.InsertsOfBoundariesByCategory](room=all_elements_of_category, category=byName, includeOpenings=boolean, includeShadows=boolean, includeEmbeddedWalls=boolean, includeSharedEmbeddedInserts=boolean)  # Retrieves the inserts of the bounding elements of a given room - filtered by a given category.
watch_5 = Watch(insertsOfBoundariesByCategory)
phases = Custom[Document.Phases]()  # Retrieves all phases in the active document in *chronological* order
string_3 = StringInput("Working Drawings")
filterByName = Custom[Elements.FilterByName](elements=phases, searchString=string_3)  # Retrieves those elements from a collection whose names match the search string
doors = Custom[Room.Doors](room=all_elements_of_category, phase=filterByName.first)  # Retrieves all doors that are associated with a room (hosted in walls and roofs).
watch_6 = Watch(doors)
windows = Custom[Room.Windows](room=all_elements_of_category, phase=filterByName.first)  # Retrieves all windows that are associated with a room (hosted in walls and roofs).
watch_7 = Watch(windows)
code_block = CodeBlock { ["DummyRoom1","DummyRoom2","DummyRoom3"]; 1001..1003; }
string_from_object = FromObject(obj=code_block.out1)
unplacedByNameAndNumber = Custom[Room.UnplacedByNameAndNumber](names=code_block.out0, numbers=string_from_object)  # Creates an unplaced room
watch_8 = Watch(unplacedByNameAndNumber)
finishes = Custom[Room.Finishes](room=all_elements_of_category)  # Returns all room bounding faces and their materials
watch_9 = Watch(finishes.finishMaterials)
watch_10 = Watch(finishes.areas)
watch_11 = Watch(finishes.faceTypes)
watch_12 = Watch(finishes.revitFaces)
watch_13 = Watch(finishes.elements)
