# Dynamo graph Revit.Elements.RoomTag.dyn (Dynamo 2.12.0.5650)
# packages: Clockwork for Dynamo 2.x 2.3.0

string = StringInput("OST_RoomTags")
byName = Category.ByName(name=string)
all_elements_of_category = ElementsOfCategory(Category=byName)

# group: RoomTag.Room
watch = Watch(all_elements_of_category)
room = Custom[RoomTag.Room](roomTag=watch)  # package Clockwork for Dynamo 2.x; Returns the room of a given room tag
watch_2 = Watch(room)

string_2 = StringInput("FamilySymbol")
byName_2 = Custom[ElementType.ByName](name=string_2)  # package Clockwork for Dynamo 2.x; Retrieves an element type by its name - to be used with the OOTB node "All Elements of Type".
all_elements_of_type = ElementsOfType(element_type=byName_2)
category = Custom[Element.Category+](element=all_elements_of_type)  # package Clockwork for Dynamo 2.x; Returns the category of a given element. Unlike the OOTB node Element.GetCategory, it will work for subcategories, families, family documents, schedules, graphics styles and view filters as well.
equals = List.Equals(object=category.category@L1, otherObject=byName)
filterByBoolMask = List.FilterByBoolMask(list=all_elements_of_type, mask=equals)
firstItem = List.FirstItem(list=filterByBoolMask.in)

# group: RoomTag.SetType
watch_3 = Watch(firstItem)
setType = Custom[RoomTag.SetType](roomTag=all_elements_of_category, roomTagType=watch_3)  # package Clockwork for Dynamo 2.x; Changes the family type of a given room tag to the specified type
watch_4 = Watch(setType.roomTag)
watch_5 = Watch(setType.success)
