# Dynamo graph Revit.Elements.Schema.dyn (Dynamo 2.3.1.11775)
# packages: Clockwork for Dynamo 2.x 2.3.0

schemas = Custom[Document.Schemas]()  # package Clockwork for Dynamo 2.x; Retrieves all ExtensibleStorage Schemas from the current document

# group: Schema.Properties
properties = Custom[Schema.Properties](schema=schemas)  # package Clockwork for Dynamo 2.x; Retrieves all properties of a given ExtensibleStorage Schema
watch = Watch(properties.name)
watch_2 = Watch(properties.vendorID)
watch_3 = Watch(properties.writeAccessLevel)
watch_4 = Watch(properties.documentation)
watch_5 = Watch(properties.applicationGUID)
watch_6 = Watch(properties.readAccessLevel)
watch_7 = Watch(properties.GUID)

# group: Schema.Fields
fields = Custom[Schema.Fields](schema=schemas@L1)  # package Clockwork for Dynamo 2.x; Returns the fields of a given ExtensibleStorage Schema
watch_8 = Watch(fields)

# group: SchemaField.Properties
properties_2 = Custom[SchemaField.Properties](schemaField=watch_8@L2)  # package Clockwork for Dynamo 2.x; Retrieves the properties of a given ExtensibleStorage schema field
watch_9 = Watch(properties_2.name)
watch_10 = Watch(properties_2.documentation)
watch_11 = Watch(properties_2.containerType)
watch_12 = Watch(properties_2.subSchema)
watch_13 = Watch(properties_2.subSchemaGUID)
watch_14 = Watch(properties_2.valueType)
watch_15 = Watch(properties_2.unitType)

# group: INPUTS
pick_element_type_for = ElementTypes("WallType")  # "Pick Element Type for ExtensibleStorage Investigation"

lastItem = List.LastItem(list=properties.GUID)
all_elements_of_type = Custom[All Elements of Type+](elementType=pick_element_type_for, schemaGUID=lastItem)  # package Clockwork for Dynamo 2.x; Gets all placed elements of a given element type in the model. Unlike the OOTB node, it works for virtually all element types.
lastItem_2 = List.LastItem(list=schemas)

# group: Element.ExtensibleStorageData
extensibleStorageData = Custom[Element.ExtensibleStorageData](element=all_elements_of_type, schema=lastItem_2)  # package Clockwork for Dynamo 2.x; Reads the extensible storage data of a given schema from an element
watch_16 = Watch(extensibleStorageData.data)
watch_17 = Watch(extensibleStorageData.fields)
