# Dynamo graph Revit.Elements.SharedParameterElement.dyn (Dynamo 2.3.1.11775)
# packages: Clockwork for Dynamo 2.x 2.3.0

string = StringInput("SharedParameterElement")
byName = Custom[ElementType.ByName](name=string)  # package Clockwork for Dynamo 2.x; Retrieves an element type by its name - to be used with the OOTB node "All Elements of Type".
all_elements_of_type = ElementsOfType(element_type=byName)

# group: SharedParameterElement.GUID
watch = Watch(all_elements_of_type)
GUID = Custom[SharedParameterElement.GUID](sharedParameterElement=watch)  # package Clockwork for Dynamo 2.x; Returns the GUID of a shared parameter
watch_2 = Watch(GUID)
