# Dynamo graph Revit.Elements.StructuralFoundation.dyn (Dynamo 2.12.0.5650)
# packages: Clockwork for Dynamo 2.x 2.3.0

# group: INFO
# note: Run this graph on the StructuralFoundation_Sample file in the extra folder.

string = StringInput("OST_StructuralFoundation")
all_elements_of_category = Custom[All Elements Of Category+](category=string)  # package Clockwork for Dynamo 2.x; Gets all placed elements of a given category in the model.

# group: StructuralFoundation.Kind
watch = Watch(all_elements_of_category)
kind = Custom[StructuralFoundation.Kind](structuralFoundation=watch)  # package Clockwork for Dynamo 2.x; Retrieves the kind of a given structural foundation (isolated, wall, slab).
watch_2 = Watch(kind)
