# Dynamo graph Revit.Elements.TextElement.dyn (Dynamo 2.3.1.11775)
# packages: Clockwork for Dynamo 2.x 2.3.0

# group: INFO
# note: Run this graph on the TextElement_Sample model.

string = StringInput("ModelText")
byName = Custom[ElementType.ByName](name=string)  # package Clockwork for Dynamo 2.x; Retrieves an element type by its name - to be used with the OOTB node "All Elements of Type".
all_elements_of_type = ElementsOfType(element_type=byName)

# group: TextElement.Text
text = Custom[TextElement.Text](element=all_elements_of_type)  # package Clockwork for Dynamo 2.x; Gets the text stored in a text element. Unlike the OOTB node TextNote.Text, this one works on ModelText as well.
watch = Watch(text)

passthrough = Custom[Passthrough](passThrough=all_elements_of_type, waitFor=watch)  # package Clockwork for Dynamo 2.x; Forces a sequential order of execution. The node wired into the output of the Passthrough node will be executed *after* the node wired into the waitFor input (e.g. important for some Revit operations). The value of the passThrough input will be passed on to the node wired into the output port of the Passthrough node.

# group: INPUTS
input_string = StringInput("This is the new text for all text nodes... :-)")

# group: TextElement.SetText
setText = Custom[TextElement.SetText](element=passthrough, text=input_string)  # package Clockwork for Dynamo 2.x; Sets the text of a given text element. Unlike the OOTB node TextNote.SetText, this one works on ModelText as well.
watch_2 = Watch(setText.element)
