# Dynamo graph Revit.Elements.Topography.dyn (Dynamo 2.3.1.11775)
# packages: Clockwork for Dynamo 2.x 2.3.0

string = StringInput("OST_Topography")
all_elements_of_category = Custom[All Elements Of Category+](category=string)  # package Clockwork for Dynamo 2.x; Gets all placed elements of a given category in the model.
watch = Watch(all_elements_of_category)

# group: Topography.IsSubregion
isSubregion = Custom[Topography.IsSubregion](topography=watch)  # package Clockwork for Dynamo 2.x; Filters out everything that is *not* a topo subregion. Needs Revit 2014 or newer to work.
watch_2 = Watch(isSubregion)

origin = Point.Origin()
XAxis = Vector.XAxis()
byOriginNormal = Plane.ByOriginNormal(origin=origin, normal=XAxis)
firstItem = List.FirstItem(list=watch)

# group: Topography.IntersectionWithPlane
intersectionWithPlane = Custom[Topography.IntersectionWithPlane](plane=byOriginNormal, topo=firstItem)  # package Clockwork for Dynamo 2.x; Calculates the intersection of a toposurface and a plane
watch_3 = Watch(intersectionWithPlane.points)
watch_4 = Watch(intersectionWithPlane.nurbsCurveByPoints)
watch_5 = Watch(intersectionWithPlane.nurbsCurveByControlPoints)
watch_6 = Watch(intersectionWithPlane.polyCurve)

byCurve = ModelCurve.ByCurve(curve=watch_4)
byCurve_2 = ModelCurve.ByCurve(curve=watch_5)
