# Dynamo graph Revit.Elements.Wall.Actions.dyn (Dynamo 2.12.0.5650)
# packages: Clockwork for Dynamo 2.x 2.3.0

string = StringInput("OST_Walls")
all_elements_of_category = Custom[All Elements Of Category+](category=string)  # package Clockwork for Dynamo 2.x; Gets all placed elements of a given category in the model.

# group: Wall.Flip
flip = Custom[Wall.Flip](wall=all_elements_of_category)  # package Clockwork for Dynamo 2.x; Flips the orientation of a given wall - DO ***NOT*** USE IN AUTOMATIC MODE
watch = Watch(flip.wall)
watch_2 = Watch(flip.success)
