# Dynamo graph Revit.Elements.WallType.dyn (Dynamo 2.3.1.11775)
# packages: Clockwork for Dynamo 2.x 2.3.0

string = StringInput("WallType")
byName = Custom[ElementType.ByName](name=string)  # package Clockwork for Dynamo 2.x; Retrieves an element type by its name - to be used with the OOTB node "All Elements of Type".
all_elements_of_type = ElementsOfType(element_type=byName)

# group: WallType.Kind
watch = Watch(all_elements_of_type)
kind = Custom[WallType.Kind](wallType=watch)  # package Clockwork for Dynamo 2.x; Retrieves the wall kind of a given wall type
watch_2 = Watch(kind)
