# Dynamo graph Revit.Elements.Workset.dyn (Dynamo 2.12.0.5650)
# packages: Clockwork for Dynamo 2.x 2.3.0

# group: INFO
# note: You'll need to run this on a workshared file...

# group: Document.Worksets
worksets = Custom[Document.Worksets]()  # package Clockwork for Dynamo 2.x; Returns all Worksets in the current document
watch = Watch(worksets)

# group: Workset.Kind
kind = Custom[Workset.Kind](workset=watch)  # package Clockwork for Dynamo 2.x; Retrieves the kind of a given workset
watch_2 = Watch(kind)

# group: INPUTS
relinquish_project_standard = BoolSelector(true)  # "Relinquish Project Standard Worksets"; graph input
relinquish_view_worksets = BoolSelector(true)  # graph input
relinquish_family_worksets = BoolSelector(true)  # graph input
relinquish_user_created_worksets = BoolSelector(true)  # graph input
relinquish_borrowed_elements = BoolSelector(true)  # graph input
compact_central_model = BoolSelector(false)  # graph input
save_local_file_before_sync = BoolSelector(false)  # graph input
save_local_file_after_sync = BoolSelector(true)  # graph input
sync_comment = StringInput("Synched with Dynamo")  # graph input
sync_with_central = BoolSelector(true)  # graph input

# group: Document.SynchronizeWithCentral
synchronizeWithCentral = Custom[Document.SynchronizeWithCentral](relinquishProjectStandardWorksets=relinquish_project_standard, relinquishViewWorksets=relinquish_view_worksets, relinquishFamilyWorksets=relinquish_family_worksets, relinquishUserCreatedWorksets=relinquish_user_created_worksets, relinquishBorrowedElements=relinquish_borrowed_elements, compactCentralModel=compact_central_model, saveLocalFileBeforeSync=save_local_file_before_sync, saveLocalFileAfterSync=save_local_file_after_sync, comment=sync_comment, runMe=sync_with_central)  # package Clockwork for Dynamo 2.x; Synchronizes a workshared model with the central model.
watch_3 = Watch(synchronizeWithCentral)
