# Dynamo graph Revit.Views.PerspectiveView.dyn (Dynamo 2.0.1.5055)

# note: You can use the Sample Architecture Project (Basic) that ships with Revit to run this graph.
views = Views(index=36)  # graph input
number_slider = DoubleSlider(66.55577629, range=0..100 step 0.1)  # graph input
number_slider_2 = DoubleSlider(84.97932586, range=0..100 step 0.1)  # graph input
number_slider_3 = DoubleSlider(49.20263595, range=0..100 step 0.1)  # graph input
byCoordinates = Point.ByCoordinates(x=number_slider, y=number_slider_2, z=number_slider_3)
origin = Point.Origin()
orientToEyeAndTargetPosition = Custom[PerspectiveView.OrientToEyeAndTargetPosition](view=views, eyePosition=byCoordinates, targetPosition=origin)  # Sets the orientation of a given perspective view based on a given eye and target position. View needs to be in an unlocked state.
watch = Watch(orientToEyeAndTargetPosition.View)
watch_2 = Watch(orientToEyeAndTargetPosition.success)
