# Dynamo graph Revit.Views.Schedule.dyn (Dynamo 2.6.2.15705)
# packages: Clockwork for Dynamo 2.x 2.3.0, Clockwork for Dynamo 2.x 2.4.0

string = StringInput("ViewSchedule")
byName = Custom[ElementType.ByName](name=string)  # package Clockwork for Dynamo 2.x; Retrieves an element type by its name - to be used with the OOTB node "All Elements of Type".
all_elements_of_type = ElementsOfType(element_type=byName)
watch = Watch(all_elements_of_type)

# group: Schedule.KeyScheduleParameterName
keyScheduleParameterName = Custom[Schedule.KeyScheduleParameterName](schedule=watch)  # package Clockwork for Dynamo 2.x; If the schedule is a key schedule, the node returns the name of the key schedule parameter.
watch_2 = Watch(keyScheduleParameterName)

# group: Schedule.Fields
fields = Custom[Schedule.Fields](schedule=watch)  # package Clockwork for Dynamo 2.x; Returns all fields of a schedule in the order in which they appear in the schedule. Unlike the OOTB node, it returns actual ScheduleField objects that can be further queried.
watch_3 = Watch(fields)

# group: ScheduleField.Type
type = Custom[ScheduleField.Type](scheduleField=watch_3@L2)  # package Clockwork for Dynamo 2.x; Returns the FieldType of a given ScheduleField
watch_4 = Watch(type)

# group: ScheduleField.Parameter
parameter = Custom[ScheduleField.Parameter](scheduleField=watch_3@L2)  # package Clockwork for Dynamo 2.x; Retrieves the parameter associated with a given schedule field
watch_5 = Watch(parameter)
