# Dynamo graph Revit.Views.View.Query.dyn (Dynamo 2.0.1.5055)

categories = Categories(index=572)  # graph input
views = Views(index=0)  # graph input
categoryIsVisible = Custom[View.CategoryIsVisible](category=categories, view=views)  # Checks if a given category is visible in a given view
watch = Watch(categoryIsVisible)
plane = Custom[View.Plane](view=views)  # Retrieves the plane of a given view
watch_2 = Watch(plane)
views_2 = Views(index=3)  # graph input
isPerspective = Custom[View.IsPerspective](view=views_2)  # Checks whether a given view is a perspective view.
watch_3 = Watch(isPerspective)
usesViewFilters = Custom[View.UsesViewFilters](view=views)  # Checks if a given view has any view filters applied to it.
watch_4 = Watch(usesViewFilters)
scale = Custom[View.Scale](view=views)  # Returns the scale of a given view
watch_5 = Watch(scale)
viewTemplate = Custom[View.ViewTemplate](view=views)  # Returns the view template assigned to a given view (if one is assigned)
watch_6 = Watch(viewTemplate)
views_3 = Views(index=40)  # graph input
solarStudyTotalFrames = Custom[View.SolarStudyTotalFrames](view=views_3)  # Retrieves the number of frames of a solar study for a given view (if the view's sun and shadow settings are indeed set to single or multi day study)
watch_7 = Watch(solarStudyTotalFrames)
phase = Custom[View.Phase](view=views)  # Returns the phase of a given view
watch_8 = Watch(phase)
detailLevel = Custom[View.DetailLevel](view=views)  # Retrieves the detail level of a given view
watch_9 = Watch(detailLevel)
type = Custom[View.Type](view=views)  # Returns the type of a given view
watch_10 = Watch(type)
direction = Custom[View.Direction](view=views)  # Returns the direction of a view
watch_11 = Watch(direction)
views_4 = Views(index=5)  # graph input
isViewTemplate = Custom[View.IsViewTemplate+](view=views_4)  # Checks if a given view is a view template. Unlike the OOTB node it works for all view types.
watch_12 = Watch(isViewTemplate)
dependentViews = Custom[View.DependentViews](view=views)  # Returns all dependent views of a given view
watch_13 = Watch(dependentViews)
primaryView = Custom[View.PrimaryView](view=views)  # Returns the primary view of a given view (i.e. the master view of a dependent view)
watch_14 = Watch(primaryView)
