# Dynamo graph Revit.Views.View3D.dyn (Dynamo 2.12.0.5650)
# packages: Clockwork for Dynamo 2.x 2.3.0

# group: INPUTS
pick_3d_view = Views("Approach")  # graph input

# group: View3D.IsLocked
isLocked = Custom[View3D.IsLocked](view3d=pick_3d_view)  # package Clockwork for Dynamo 2.x; Checks if a given 3D view is locked.
watch = Watch(isLocked)
