# Dynamo graph Script.ControlFlow.dyn (Dynamo 2.0.1.5055)

code_block = CodeBlock { 1; 4; }
watch = Watch(code_block.out0)
create = List.Create(item0=code_block.out1)
watch_2 = Watch(create)
returnListOrSingleValue = Custom[ReturnListOrSingleValue](unknownItem=watch, seq=watch_2)  # If the unknown item is not a list but rather a single item, only the first item of the list (input "seq") will be returned.
watch_3 = Watch(returnListOrSingleValue)
create_2 = List.Create(item0=code_block.out0)
watch_4 = Watch(create_2)
returnListOrSingleValue_2 = Custom[ReturnListOrSingleValue](unknownItem=watch_4, seq=watch_2)
watch_5 = Watch(returnListOrSingleValue_2)
boolean = BoolSelector(false)  # graph input
code_block_2 = CodeBlock { 1..10; 1..5; }
scopeIf = Custom[ScopeIf+](test=boolean, true_var=code_block_2.out0, false_var=code_block_2.out1)  # A (hopefully) more robust implementation of ScopeIf. Tests a single boolean and returns a value accordingly.
watch_6 = Watch(scopeIf)
boolean_2 = BoolSelector(false)  # graph input
code_block_3 = CodeBlock { "This is a test."; }
sendTo = Custom[Clipboard.SendTo](str=code_block_3)  # Copies a string to the clipboard.
passthrough = Custom[Passthrough](passThrough=boolean_2, waitFor=sendTo)  # Forces a sequential order of execution. The node wired into the output of the Passthrough node will be executed *after* the node wired into the waitFor input (e.g. important for some Revit operations). The value of the passThrough input will be passed on to the node wired into the output port of the Passthrough node.
getFrom = Custom[Clipboard.GetFrom](toggle=passthrough)  # Gets the content of the clipboard. ATTENTION: Will only work with strings.
watch_7 = Watch(getFrom)
code_block_4 = CodeBlock { 2..6; 1..4; "A".."D"; "E"; }
switch = Custom[Switch](Check=code_block_4.out0, Cases=code_block_4.out1, Values=code_block_4.out2, Default=code_block_4.out3)  # Emulates the Switch/Case statement that is available in multiple programming languages.
watch_8 = Watch(switch)
