# Dynamo graph String.Generate.dyn (Dynamo 2.12.0.5650)
# packages: Clockwork for Dynamo 2.x 2.3.0

# group: INPUTS
decimal = IntegerSlider(78, range=0..100 step 1)
input_string = StringInput("DYNAMO")
uppercase = BoolSelector(false)  # graph input
version_number = StringInput("1.32.4.342")

# group: Binary.FromDecimal
fromDecimal = Custom[Binary.FromDecimal](decimal=decimal)  # package Clockwork for Dynamo 2.x; Converts a number to a string of its binary value
watch = Watch(fromDecimal)

# group: Binary.ToDecimal
toDecimal = Custom[Binary.ToDecimal](binary=watch)  # package Clockwork for Dynamo 2.x; Converts a string of a binary number into a decimal value
watch_2 = Watch(toDecimal)

# group: Hex.FromDecimal
fromDecimal_2 = Custom[Hex.FromDecimal](decimal=decimal)  # package Clockwork for Dynamo 2.x; Converts a number to a string of its hexadecimal value
watch_3 = Watch(fromDecimal_2)

# group: Hex.ToDecimal
toDecimal_2 = Custom[Hex.ToDecimal](hex=watch_3)  # package Clockwork for Dynamo 2.x; Converts a string of a hexadecimal value to a number
watch_4 = Watch(toDecimal_2)

# group: Morse.FromAlphanumeric
fromAlphanumeric = Custom[Morse.FromAlphanumeric](str=input_string)  # package Clockwork for Dynamo 2.x; Converts an alphanumeric string to Morse code
watch_5 = Watch(fromAlphanumeric)

# group: Morse.ToAlphanumeric
toAlphanumeric = Custom[Morse.ToAlphanumeric](str=watch_5)  # package Clockwork for Dynamo 2.x; Converts a string in Morse code to alphanumeric
watch_6 = Watch(toAlphanumeric)

# group: Character.FromNumber
fromNumber = Custom[Character.FromNumber](n=decimal, upperCase=uppercase)  # package Clockwork for Dynamo 2.x; Converts a number into a character (where 1 = A, 2 = B, ... , 27 = AA, 28 = AB etc.).
watch_7 = Watch(fromNumber)

# group: Character.ToNumber
toNumber = Custom[Character.ToNumber](str=watch_7)  # package Clockwork for Dynamo 2.x; Converts an Excel-style character to a number (e.g. A = 1, AA = 27 etc.).
watch_8 = Watch(toNumber)

boolean = BoolSelector(true)  # graph input
boolean_2 = BoolSelector(false)  # graph input
list_create = List.Create(item0=boolean, item1=boolean_2, item2=boolean_2, item3=boolean)

# group: Binary.FromBooleans
watch_9 = Watch(list_create)
fromBooleans = Custom[Binary.FromBooleans](booleans=watch_9)  # package Clockwork for Dynamo 2.x; Creates a binary string from a list of booleans
watch_10 = Watch(fromBooleans)

# group: Binary.ToBooleans
toBooleans = Custom[Binary.ToBooleans](str=watch_10)  # package Clockwork for Dynamo 2.x; Converts a binary string to a list of booleans
watch_11 = Watch(toBooleans)

# group: VersionNumber.ToInteger
toInteger = Custom[VersionNumber.ToInteger](str=version_number)  # package Clockwork for Dynamo 2.x; Converts a version number (e.g. a Dynamo version number) to an integer.
watch_12 = Watch(toInteger)
