# Dynamo graph String.Modify.dyn (Dynamo 2.0.1.5055)

string = StringInput("[a-zA-Z]*berry")  # graph input
string_2 = StringInput("""Strawberry123
Raspberry456
Banana789
123Raspberry456""")  # graph input
string_3 = StringInput("\n")  # graph input
split = String.Split(str=string_2, separater0=string_3)
watch = Watch(split)
string_4 = StringInput("DYNAMO")  # graph input
replaceRegularExpression = Custom[Regex.ReplaceRegularExpression](RegEx=string, str=watch, Replacement=string_4)  # Replaces all occurences of a regular expression within a given string (or list of strings) with another string. The syntax for regular expressions is explained at http://ironpython-test.readthedocs.org/en/latest/howto/regex.html
watch_2 = Watch(replaceRegularExpression)
splitByRegularExpression = Custom[Regex.SplitByRegularExpression](RegEx=string, str=watch)  # Splits a given string by a regular expression. The syntax for regular expressions is explained at http://ironpython-test.readthedocs.org/en/latest/howto/regex.html
watch_3 = Watch(splitByRegularExpression)
string_5 = StringInput("Impossible:Filename?01.txt")  # graph input
replaceIllegalFilenameCharacters = Custom[String.ReplaceIllegalFilenameCharacters](str=string_5)  # Replaces all characters in a string that are illegal characters for filenames
watch_4 = Watch(replaceIllegalFilenameCharacters)
string_6 = StringInput("This is a {0} example for {1} replacing multiple items in a string.")  # graph input
code_block = CodeBlock { ["small","efficiently"]; }
replace = Custom[String.Replace+](str=string_6, replacements=code_block)  # Replaces multiple items in a given string. Items in the string have to be denoted as {0], {1}, ..., {n} - corresponding to the respective list index of the replacement string.
watch_5 = Watch(replace)
string_7 = StringInput("Impossible:Familyname?[01]")  # graph input
replaceIllegalRevitCharacters = Custom[String.ReplaceIllegalRevitCharacters](str=string_7)  # Replaces all characters in a string that are illegal characters for Revit view names etc.
watch_6 = Watch(replaceIllegalRevitCharacters)
code_block_2 = CodeBlock { ["i","in"]; ["U","ON"]; }
boolean = BoolSelector(true)  # graph input
replaceMultiple = Custom[String.ReplaceMultiple](str=string_6, searchFor=code_block_2.out0, replaceWith=code_block_2.out1, sortSearchTermsBySize=boolean)  # Replaces multiple search terms in a given string with multiple replacements
watch_7 = Watch(replaceMultiple)
string_8 = StringInput("Dynamo")
explode = Custom[String.Explode](str=string_8)  # Chops up a string into a list of characters
watch_8 = Watch(explode)
