# Dynamo graph Display.dyn (Dynamo 2.12.1.8246)
# author: Andreas Dieckmann
# Display nodes sample graph
# packages: Clockwork for Dynamo 2.x 2.12.0

code_block = CodeBlock { 0; }

# group: Color.Blue
blue = Custom[Color.Blue]()  # package Clockwork for Dynamo 2.x; Returns the colour blue.
color_range = ColorRange(colors=blue, indices=code_block, value=code_block)

# group: Color.Green
green = Custom[Color.Green]()  # package Clockwork for Dynamo 2.x; Returns the colour green.
color_range_2 = ColorRange(colors=green, indices=code_block, value=code_block)

# group: Color.Lime
lime = Custom[Color.Lime]()  # package Clockwork for Dynamo 2.x; Returns the colour lime.
color_range_3 = ColorRange(colors=lime, indices=code_block, value=code_block)

# group: Color.Navy
navy = Custom[Color.Navy]()  # package Clockwork for Dynamo 2.x; Returns the colour navy.
color_range_4 = ColorRange(colors=navy, indices=code_block, value=code_block)

# group: Color.Purple
purple = Custom[Color.Purple]()  # package Clockwork for Dynamo 2.x; Returns the colour purple.
color_range_5 = ColorRange(colors=purple, indices=code_block, value=code_block)

# group: Color.Silver
silver = Custom[Color.Silver]()  # package Clockwork for Dynamo 2.x; Returns the colour silver.
color_range_6 = ColorRange(colors=silver, indices=code_block, value=code_block)

# group: Color.White
white = Custom[Color.White]()  # package Clockwork for Dynamo 2.x; Returns the colour white.
color_range_7 = ColorRange(colors=white, indices=code_block, value=code_block)

# group: INPUTS
hex_color = StringInput("#FF9900")  # graph input
normalized_value = DoubleSlider(0.4, range=0..1 step 0.1)  # graph input

# group: Color.ByWebColor
byWebColor = Custom[Color.ByWebColor](hex=hex_color)  # package Clockwork for Dynamo 2.x; Creates a color from a given web color (a hex triplet like #FF9900)
color_range_8 = ColorRange(colors=byWebColor, indices=code_block, value=code_block)

# group: Color.GreyscaleByNormalizedValue
greyscaleByNormalizedValue = Custom[Color.GreyscaleByNormalizedValue](dbl=normalized_value)  # package Clockwork for Dynamo 2.x; Creates a greyscale color based on a normalized value (0 = black, 1 = white)
color_range_9 = ColorRange(colors=greyscaleByNormalizedValue, indices=code_block, value=code_block)

# group: Color.Black
black = Custom[Color.Black]()  # package Clockwork for Dynamo 2.x; Returns the colour black.
color_range_10 = ColorRange(colors=black, indices=code_block, value=code_block)

# group: Color.Fuchsia
fuchsia = Custom[Color.Fuchsia]()  # package Clockwork for Dynamo 2.x; Returns the colour fuchsia a.k.a. magenta.
color_range_11 = ColorRange(colors=fuchsia, indices=code_block, value=code_block)

# group: Color.Grey
grey = Custom[Color.Grey]()  # package Clockwork for Dynamo 2.x; Returns the colour grey.
color_range_12 = ColorRange(colors=grey, indices=code_block, value=code_block)

# group: Color.Maroon
maroon = Custom[Color.Maroon]()  # package Clockwork for Dynamo 2.x; Returns the colour maroon.
color_range_13 = ColorRange(colors=maroon, indices=code_block, value=code_block)

# group: Color.Olive
olive = Custom[Color.Olive]()  # package Clockwork for Dynamo 2.x; Returns the colour olive.
color_range_14 = ColorRange(colors=olive, indices=code_block, value=code_block)

# group: Color.Red
red = Custom[Color.Red]()  # package Clockwork for Dynamo 2.x; Returns the colour red.
color_range_15 = ColorRange(colors=red, indices=code_block, value=code_block)

# group: Color.Teal
teal = Custom[Color.Teal]()  # package Clockwork for Dynamo 2.x; Returns the colour teal.
color_range_16 = ColorRange(colors=teal, indices=code_block, value=code_block)

# group: Color.Yellow
yellow = Custom[Color.Yellow]()  # package Clockwork for Dynamo 2.x; Returns the colour yellow.
color_range_17 = ColorRange(colors=yellow, indices=code_block, value=code_block)

# group: Color.Aqua
aqua = Custom[Color.Aqua]()  # package Clockwork for Dynamo 2.x; Returns the colour aqua.
color_range_18 = ColorRange(colors=aqua, indices=code_block, value=code_block)

# group: Color.Name
name = Custom[Color.Name](color=color_range_18)  # package Clockwork for Dynamo 2.x; Retrieves the name of a color (if it has a name).
watch = Watch(name)

# group: Color.ByName
byName = Custom[Color.ByName](str=watch)  # package Clockwork for Dynamo 2.x; Returns the color that corresponds to the given name (look here for a list of defined colors: https://docs.microsoft.com/en-us/dotnet/api/system.drawing.knowncolor?view=netframework-4.7.2).
color_range_19 = ColorRange(colors=byName, indices=code_block, value=code_block)
