# Dynamo graph Environment.dyn (Dynamo 2.12.1.8246)
# author: Andreas Dieckmann
# Einvironment nodes sample graph
# packages: Clockwork for Dynamo 2.x 2.12.0

# group: System.CPUs
CPUs = Custom[System.CPUs]()  # package Clockwork for Dynamo 2.x; Returns information on number of processors and CPU speed (GHz).
watch = Watch(CPUs.physicalProcessors)
watch_2 = Watch(CPUs.logicalProcesssors)
watch_3 = Watch(CPUs.cores)
watch_4 = Watch(CPUs.CPUspeed)

# group: System.Memory
memory = Custom[System.Memory]()  # package Clockwork for Dynamo 2.x; Returns information on total system memory, free memory and amount of memory used by the application.
watch_5 = Watch(memory.installedMemory)
watch_6 = Watch(memory.freeMemory)
watch_7 = Watch(memory.appMemory)

# group: System.Version
version = Custom[System.Version]()  # package Clockwork for Dynamo 2.x; Returns the Windows version
watch_8 = Watch(version.versionName)
watch_9 = Watch(version.servicePack)
watch_10 = Watch(version.versionNumber)

# group: System.MachineName
machineName = Custom[System.MachineName]()  # package Clockwork for Dynamo 2.x; Returns the NetBIOS name of the computer the script is executed on.
watch_11 = Watch(machineName)

# group: System.UserName
userName = Custom[System.UserName]()  # package Clockwork for Dynamo 2.x; Returns the user name of the person who is currently logged on to Windows on the machine the script is executed on.
watch_12 = Watch(userName)

# group: Dynamo.Version
version_2 = Custom[Dynamo.Version]()  # package Clockwork for Dynamo 2.x; Retrieves the version of the active Dynamo application
watch_13 = Watch(version_2.versionShort)
watch_14 = Watch(version_2.versionLong)
watch_15 = Watch(version_2.platform)
