# Dynamo graph Geometry.Abstract.BoundingBox.dyn (Dynamo 3.0.3.7597)
# author: Andreas Dieckmann
# BoundingBox nodes sample graph
# packages: Clockwork for Dynamo 2.x 2.6.0

origin = Point.Origin()

# group: INPUTS
sphere_1_radius = DoubleSlider(5, range=0..10 step 0.5)
vector_x = DoubleSlider(1, range=0..1 step 0.05)
vector_y = DoubleSlider(1, range=0..1 step 0.05)
vector_z = DoubleSlider(1, range=0..1 step 0.05)
sphere_2_coordinate = DoubleSlider(10, range=0..20 step 0.5)
sphere_2_radius = DoubleSlider(3, range=0..10 step 0.5)

byCenterPointRadius = Sphere.ByCenterPointRadius(centerPoint=origin, radius=sphere_1_radius)
boundingBox = Geometry.BoundingBox(geometry=byCenterPointRadius)
byCoordinates = Vector.ByCoordinates(x=vector_x, y=vector_y, z=vector_z)

# group: BoundingBox.PerimeterCurvesByNormal
normalized = Vector.Normalized(vector=byCoordinates)
perimeterCurvesByNormal = Custom[BoundingBox.PerimeterCurvesByNormal](boundingbox=boundingBox, normal=normalized)  # package Clockwork for Dynamo 2.x; Returns the perimeter curve of a bounding box on a plane determined by a given normal and the centroid of the bounding box
list_create = List.Create(item0=perimeterCurvesByNormal, item1=byCenterPointRadius)
watch_3d = Watch3D(list_create)
watch = Watch(perimeterCurvesByNormal)

ZAxis = Vector.ZAxis()

# group: BoundingBox.PerimeterCurvesOnPlane
byOriginNormal = Plane.ByOriginNormal(origin=origin, normal=ZAxis)
perimeterCurvesOnPlane = Custom[BoundingBox.PerimeterCurvesOnPlane](boundingbox=boundingBox, plane=byOriginNormal)  # package Clockwork for Dynamo 2.x; Returns the perimeter curve of a bounding box on a given plane (assuming that the bounding box and plane intersect)
list_create_2 = List.Create(item0=perimeterCurvesOnPlane, item1=byCenterPointRadius)
watch_3d_2 = Watch3D(list_create_2)
watch_2 = Watch(perimeterCurvesOnPlane)

# group: BoundingBox.Properties
properties = Custom[BoundingBox.Properties](boundingBox=boundingBox)  # package Clockwork for Dynamo 2.x; Retrieves the centroid, width, depth and height of a given bounding box
watch_3 = Watch(properties.Centroid)
watch_4 = Watch(properties.Width)
watch_5 = Watch(properties.Depth)
watch_6 = Watch(properties.Height)

byCoordinates_2 = Point.ByCoordinates(x=sphere_2_coordinate)
byCenterPointRadius_2 = Sphere.ByCenterPointRadius(centerPoint=byCoordinates_2, radius=sphere_2_radius)
boundingBox_2 = Geometry.BoundingBox(geometry=byCenterPointRadius_2)
list_create_3 = List.Create(item0=boundingBox, item1=boundingBox_2)

# group: BoundingBox.FromBoundingBoxes
fromBoundingBoxes = Custom[BoundingBox.FromBoundingBoxes](boundingBoxes=list_create_3)  # package Clockwork for Dynamo 2.x; Merges a list of bounding boxes into a single bounding box
toCuboid = BoundingBox.ToCuboid(boundingBox=fromBoundingBoxes)
watch_3d_3 = Watch3D(toCuboid)
watch_7 = Watch(fromBoundingBoxes)

toCuboid_2 = BoundingBox.ToCuboid(boundingBox=list_create_3)
watch_3d_4 = Watch3D(toCuboid_2)
