# Dynamo graph Geometry.Abstract.Plane.dyn (Dynamo 3.0.3.7597)
# author: Andreas Dieckmann
# Plane nodes sample graph
# packages: Clockwork for Dynamo 2.x 2.6.0

origin = Point.Origin()
code_block = CodeBlock { 2; 0.5; }
byCoordinates = Point.ByCoordinates(x=code_block.out0)
byCoordinates_2 = Point.ByCoordinates(x=code_block.out0, y=code_block.out0, z=code_block.out1)
byCoordinates_3 = Point.ByCoordinates(y=code_block.out0)
list_create = List.Create(item0=origin, item1=byCoordinates, item2=byCoordinates_2, item3=byCoordinates_3)
code_block_2 = CodeBlock { 1; 2; 3; }
shiftIndices = List.ShiftIndices(list=list_create, amount=code_block_2.out0)
shiftIndices_2 = List.ShiftIndices(list=list_create, amount=code_block_2.out1)
shiftIndices_3 = List.ShiftIndices(list=list_create, amount=code_block_2.out2)

# group: Plane.ByFirst3Points
watch = Watch(list_create)
byFirst3Points = Custom[Plane.ByFirst3Points](points=watch)  # package Clockwork for Dynamo 2.x; Returns a plane, its origin and its normal based on the first three XYZs in a given list
watch_2 = Watch(shiftIndices)
byFirst3Points_2 = Custom[Plane.ByFirst3Points](points=watch_2)
watch_3 = Watch(shiftIndices_2)
byFirst3Points_3 = Custom[Plane.ByFirst3Points](points=watch_3)
watch_4 = Watch(shiftIndices_3)
byFirst3Points_4 = Custom[Plane.ByFirst3Points](points=watch_4)
list_create_2 = List.Create(item0=byFirst3Points, item1=byFirst3Points_2, item2=byFirst3Points_3, item3=byFirst3Points_4)
watch_3d = Watch3D(list_create_2)

code_block_3 = CodeBlock { 1; }
byLengths = Cuboid.ByLengths(width=code_block_3, length=code_block_3, height=code_block_3)
explode = Geometry.Explode(geometry=byLengths)
watch_5 = Watch(explode)

# group: Plane.ByBestFitFromFace
byBestFitFromFace = Custom[Plane.ByBestFitFromFace](surface=watch_5)  # package Clockwork for Dynamo 2.x; Creates a plane from face
watch_3d_2 = Watch3D(byBestFitFromFace)
watch_6 = Watch(byBestFitFromFace)

firstItem = List.FirstItem(list=watch_6)

# group: Plane.IsCoplanarWithPlane
isCoplanarWithPlane = Custom[Plane.IsCoplanarWithPlane](plane1=firstItem, plane2=watch_6)  # package Clockwork for Dynamo 2.x; Checks if a given plane is coplanar with another plane
watch_7 = Watch(isCoplanarWithPlane)
