# Dynamo graph Geometry.Abstract.Vector.Actions.dyn (Dynamo 3.0.3.7597)
# author: Andreas Dieckmann
# Vector.Actions nodes sample graph
# packages: Clockwork for Dynamo 2.x 2.6.0

code_block = CodeBlock { 1; }
byCoordinates = Point.ByCoordinates(x=code_block)

# group: INPUTS
vector_2_x = DoubleSlider(0.284, range=0..1 step 0.1)  # graph input
vector_2_y = DoubleSlider(0.609, range=0..1 step 0.1)  # graph input
vector_2_z = DoubleSlider(0, range=0..1 step 0.1)  # graph input
vector_1_x = DoubleSlider(0.4425269165, range=-1..1 step 0.1)  # graph input
vector_1_y = DoubleSlider(0.5428332845, range=-1..1 step 0.1)  # graph input
vector_1_z = DoubleSlider(-1, range=-1..1 step 0.1)  # graph input

boolean = BoolSelector(true)  # graph input
byCoordinates_2 = Vector.ByCoordinates(x=vector_2_x, y=vector_2_y, z=vector_2_z, normalized=boolean)
origin = Point.Origin()
YAxis = Vector.YAxis()
byOriginNormal = Plane.ByOriginNormal(origin=origin, normal=YAxis)
code_block_2 = CodeBlock { 5; }
byStartPointDirectionLength = Line.ByStartPointDirectionLength(startPoint=byCoordinates, direction=byCoordinates_2, length=code_block_2)

# group: Vector.IntersectWithPlane
intersectWithPlane = Custom[Vector.IntersectWithPlane](vectorBasePoint=byCoordinates, vector=byCoordinates_2, plane=byOriginNormal)  # package Clockwork for Dynamo 2.x; Finds the intersection point between a plane and a vector
watch = Watch(intersectWithPlane)
list_create = List.Create(item0=byOriginNormal, item1=byStartPointDirectionLength, item2=intersectWithPlane)
watch_3d = Watch3D(list_create)

byStartPointDirectionLength_2 = Line.ByStartPointDirectionLength(startPoint=byCoordinates, direction=byCoordinates_2, length=code_block_2)
byStartPointDirectionLength_3 = Line.ByStartPointDirectionLength(startPoint=origin, direction=YAxis, length=code_block_2)

# group: Vector.IntersectWithVector
intersectWithVector = Custom[Vector.IntersectWithVector](basePoint1=byCoordinates, vector1=byCoordinates_2, basePoint2=origin, vector2=YAxis)  # package Clockwork for Dynamo 2.x; Determines if two vectors intersect and returns the closest points of intersection on both vectors.
watch_2 = Watch(intersectWithVector.VectorsIntersect)
watch_3 = Watch(intersectWithVector.AveragePoint)
watch_4 = Watch(intersectWithVector.ClosestPointOnVector2)
watch_5 = Watch(intersectWithVector.ClosestPointOnVector1)
list_create_2 = List.Create(item0=byStartPointDirectionLength_2, item1=byStartPointDirectionLength_3, item2=intersectWithVector.AveragePoint)
watch_3d_2 = Watch3D(list_create_2)

code_block_3 = CodeBlock { 0.9..1.1..#5; }
code_block_4 = CodeBlock { 0.9..1.1..#5; }
byCoordinates_3 = Vector.ByCoordinates(x=code_block_3, y=code_block_4, lacing=CrossProduct)
flatten = List.Flatten(list=byCoordinates_3)

# group: Vector.PruneDuplicates
watch_6 = Watch(flatten)
count = List.Count(list=watch_6)
watch_7 = Watch(count)
number_slider = DoubleSlider(0.06291571081, range=0..0.25 step 0.1)  # graph input
pruneDuplicates = Custom[Vector.PruneDuplicates](vectors=watch_6, Tolerance=number_slider)  # package Clockwork for Dynamo 2.x; Prune vectors to exclude duplicates within a given tolerance
count_2 = List.Count(list=pruneDuplicates)
watch_8 = Watch(count_2)

boolean_2 = BoolSelector(true)  # graph input
byCoordinates_4 = Vector.ByCoordinates(x=vector_1_x, y=vector_1_y, z=vector_1_z, normalized=boolean_2)
ZAxis = Vector.ZAxis()
origin_2 = Point.Origin()
byStartPointDirectionLength_4 = Line.ByStartPointDirectionLength(startPoint=origin_2, direction=byCoordinates_4, length=code_block_2)
byStartPointDirectionLength_5 = Line.ByStartPointDirectionLength(startPoint=origin_2, direction=ZAxis, length=code_block_2)

# group: Vector.CorrectOrientation
watch_9 = Watch(byCoordinates_4)
watch_10 = Watch(ZAxis)
correctOrientation = Custom[Vector.CorrectOrientation](VectorA=watch_9, VectorB=watch_10)  # package Clockwork for Dynamo 2.x; Inverts vector A if its inversion is closer to vector B
watch_11 = Watch(correctOrientation)

byStartPointDirectionLength_6 = Line.ByStartPointDirectionLength(startPoint=origin_2, direction=correctOrientation, length=code_block_2)

# group (continued): Vector.CorrectOrientation
list_create_3 = List.Create(item0=byStartPointDirectionLength_4, item1=byStartPointDirectionLength_5, item2=byStartPointDirectionLength_6)
watch_3d_3 = Watch3D(list_create_3)

YAxis_2 = Vector.YAxis()
ZAxis_2 = Vector.ZAxis()
code_block_5 = CodeBlock { 0..360..#17; }
rotate = Vector.Rotate(vector=YAxis_2, axis=ZAxis_2, degrees=code_block_5)

# group: Vector.CardinalDirection
watch_12 = Watch(rotate)
code_block_6 = CodeBlock { 0..2; }
cardinalDirection = Custom[Vector.CardinalDirection](vector=watch_12, accuracy=code_block_6)  # package Clockwork for Dynamo 2.x; Returns the cardinal direction (N, E, S, W) for a given vector (where N = Y axis, E = X axis etc.). The accuracy input has three modes: 0 = cardinal directions only, 1 = additional intercardinal directions (i.e. NE, SE, SW, NW), 2 = additional secondary intercardinal directions (NNE, ENE, ESE, SSE, SSW, WSW, WNW, NNW).
watch_13 = Watch(cardinalDirection)
