# Dynamo graph Geometry.Abstract.Vector.Create.dyn (Dynamo 3.0.3.7597)
# author: Andreas Dieckmann
# Vector.Create nodes sample graph
# packages: Clockwork for Dynamo 2.x 2.6.0

# group: Vector.YAxisNegative
YAxisNegative = Custom[Vector.YAxisNegative]()  # package Clockwork for Dynamo 2.x; Returns an XYZ of 0,-1,0
watch = Watch(YAxisNegative)

# group: Vector.XAxisNegative
XAxisNegative = Custom[Vector.XAxisNegative]()  # package Clockwork for Dynamo 2.x; Returns an XYZ of -1,0,0
watch_2 = Watch(XAxisNegative)

# group: Vector.ZAxisNegative
ZAxisNegative = Custom[Vector.ZAxisNegative]()  # package Clockwork for Dynamo 2.x; Returns an XYZ of 0,0,-1
watch_3 = Watch(ZAxisNegative)

# group: INPUTS
vector_2_x = DoubleSlider(0.884, range=0..1 step 0.1)  # graph input
vector_2_y = DoubleSlider(0.474, range=0..1 step 0.1)  # graph input
vector_2_z = DoubleSlider(0.59, range=0..1 step 0.1)  # graph input
vector_1_x = DoubleSlider(0.47, range=0..1 step 0.1)  # graph input
vector_1_y = DoubleSlider(0.782, range=0..1 step 0.1)  # graph input
vector_1_z = DoubleSlider(0.59, range=0..1 step 0.1)  # graph input
point_1_x = DoubleSlider(2.283794018, range=0..10 step 0.1)  # graph input
point_1_y = DoubleSlider(4.419, range=0..10 step 0.1)  # graph input
point_2_x = DoubleSlider(-5.653393753, range=-10..0 step 0.1)  # graph input
point_2_y = DoubleSlider(4.419, range=0..10 step 0.1)  # graph input

boolean = BoolSelector(false)  # graph input
byCoordinates = Vector.ByCoordinates(x=vector_2_x, y=vector_2_y, z=vector_2_z, normalized=boolean)

# group: XYZAxis.FromVector
watch_4 = Watch(byCoordinates)
fromVector = Custom[XYZAxis.FromVector](vector=watch_4)  # package Clockwork for Dynamo 2.x; Returns whichever main axis (X, Y or Z) is closest to a given vector
watch_5 = Watch(fromVector)

byCoordinates_2 = Vector.ByCoordinates(x=vector_1_x, y=vector_1_y, z=vector_1_z, normalized=boolean)

# group: XYZAxis.ByTwoVectors
watch_6 = Watch(byCoordinates_2)
watch_7 = Watch(byCoordinates)
byTwoVectors = Custom[XYZAxis.ByTwoVectors](Axis1=watch_6, Axis2=watch_7)  # package Clockwork for Dynamo 2.x; Given two main XYZ axes (or vectors pointing more or less in their general direction), this node will find the third axis.
watch_8 = Watch(byTwoVectors.str)
watch_9 = Watch(byTwoVectors.vector)

byCoordinates_3 = Point.ByCoordinates(x=point_1_x, y=point_1_y)
byCoordinates_4 = Point.ByCoordinates(x=point_2_x, y=point_2_y)

# group: AngleBisector.ByPoints
watch_10 = Watch(byCoordinates_3)
origin = Point.Origin()
watch_11 = Watch(byCoordinates_4)
byPoints = Custom[AngleBisector.ByPoints](PointA=watch_10, PointB=origin, PointC=watch_11)  # package Clockwork for Dynamo 2.x; Retrieves the vector of an angle bisector at point B based on three points (A, B, C) that define the angle.
watch_12 = Watch(byPoints)

code_block = CodeBlock { 5; }
byStartPointDirectionLength = Line.ByStartPointDirectionLength(startPoint=origin, direction=byPoints, length=code_block)
list_create = List.Create(item0=watch_10, item1=origin, item2=watch_11, item3=byStartPointDirectionLength)

# group (continued): AngleBisector.ByPoints
watch_3d = Watch3D(list_create)
