# Dynamo graph Geometry.Abstract.Vector.Query.dyn (Dynamo 3.0.3.7597)
# author: Andreas Dieckmann
# Vector.Query nodes sample graph
# packages: Clockwork for Dynamo 2.x 2.6.0

# group: INPUTS
vector_x = DoubleSlider(1, range=0..1 step 0.1)  # graph input
vector_y = DoubleSlider(1, range=0..1 step 0.1)  # graph input
vector_z = DoubleSlider(0, range=0..1 step 0.1)  # graph input

boolean = BoolSelector(true)  # graph input
byCoordinates = Vector.ByCoordinates(x=vector_x, y=vector_y, z=vector_z, normalized=boolean)

# group: Vector.AltitudeAndAzimuth
watch = Watch(byCoordinates)
altitudeAndAzimuth = Custom[Vector.AltitudeAndAzimuth](vector=watch)  # package Clockwork for Dynamo 2.x; Computes the altitude and azimuth of a given vector
watch_2 = Watch(altitudeAndAzimuth.altitude)
watch_3 = Watch(altitudeAndAzimuth.azimuth)

XAxis = Vector.XAxis()
YAxis = Vector.YAxis()
list_create = List.Create(item0=XAxis, item1=YAxis)

# group: Vector.Average
watch_4 = Watch(list_create)
average = Custom[Vector.Average](vectors=watch_4)  # package Clockwork for Dynamo 2.x; Determines the average vector of a list of vectors
watch_5 = Watch(average)

origin = Point.Origin()
ZAxis = Vector.ZAxis()
byOriginNormal = Plane.ByOriginNormal(origin=origin, normal=ZAxis)

# group: Vector.IsInPlane
watch_6 = Watch(origin)
watch_7 = Watch(byCoordinates)
watch_8 = Watch(byOriginNormal)
isInPlane = Custom[Vector.IsInPlane](vectorBasePoint=watch_6, vector=watch_7, plane=watch_8)  # package Clockwork for Dynamo 2.x; Checks if a given vector is located on a given plane
watch_9 = Watch(isInPlane)

# group: Vector.IsOrthogonalToVector
watch_10 = Watch(byCoordinates)
watch_11 = Watch(YAxis)
isOrthogonalToVector = Custom[Vector.IsOrthogonalToVector](Vector1=watch_10, Vector2=watch_11)  # package Clockwork for Dynamo 2.x; Checks if two vectors are orthogonal to each other
watch_12 = Watch(isOrthogonalToVector)

# group: Vector.IsParallelToPlane
watch_13 = Watch(byCoordinates)
watch_14 = Watch(byOriginNormal)
isParallelToPlane = Custom[Vector.IsParallelToPlane](vector=watch_13, plane=watch_14)  # package Clockwork for Dynamo 2.x; Checks if a given vector is parallel to a given plane
watch_15 = Watch(isParallelToPlane)
