# Dynamo graph Geometry.Curves.dyn (Dynamo 3.0.3.7597)
# author: Andreas Dieckmann
# Curve nodes sample graph
# packages: Clockwork for Dynamo 2.x 2.6.0

code_block = CodeBlock { 1; }
byCoordinates = Point.ByCoordinates(x=code_block)
byCoordinates_2 = Point.ByCoordinates(x=code_block, y=code_block)
byCoordinates_3 = Point.ByCoordinates(y=code_block)
origin = Point.Origin()
list_create = List.Create(item0=byCoordinates, item1=byCoordinates_2, item2=byCoordinates_3, item3=origin)

# group: Curve.ClosedLoopThroughPoints
watch = Watch(list_create)
closedLoopThroughPoints = Custom[Curve.ClosedLoopThroughPoints](points=watch)  # package Clockwork for Dynamo 2.x; Creates a *closed* loop of curves based on a given list of points
watch_2 = Watch(closedLoopThroughPoints)
watch_3d = Watch3D(closedLoopThroughPoints)
