# Dynamo graph Geometry.Meshes.dyn (Dynamo 3.0.3.7597)
# author: Andreas Dieckmann
# Meshes nodes sample graph
# packages: Clockwork for Dynamo 2.x 2.6.0

# group: INFO
# note: You'll need to run this graph on top of a Revit file that contains a toposurface, e.g. the basic architectural sample project that ships with Revit.

origin = Point.Origin()
XAxis = Vector.XAxis()
byOriginNormal = Plane.ByOriginNormal(origin=origin, normal=XAxis)
string = StringInput("OST_Topography")
all_elements_of_category = Custom[All Elements Of Category+](category=string)  # package Clockwork for Dynamo 2.x; Gets all placed elements of a given category in the model. Unlike the OOTB node it also supports linked models and a few more special categories (e.g. Legend Components).
firstItem = List.FirstItem(list=all_elements_of_category)
mesh = Topography.Mesh(topography=firstItem)

# group: Mesh.IntersectWithPlane
intersectWithPlane = Custom[Mesh.IntersectWithPlane](plane=byOriginNormal, mesh=mesh)  # package Clockwork for Dynamo 2.x; Calculates the intersection of a mesh and a plane
watch = Watch(intersectWithPlane.points)
watch_2 = Watch(intersectWithPlane.nurbsCurveByControlPoints)
watch_3 = Watch(intersectWithPlane.polyCurve)
watch_4 = Watch(intersectWithPlane.nurbsCurveByPoints)
list_create = List.Create(item0=mesh, item1=watch_4)
watch_3d = Watch3D(list_create)

# group: Mesh.FaceVertices
faceVertices = Custom[Mesh.FaceVertices](mesh=mesh)  # package Clockwork for Dynamo 2.x; Gets the vertices of each face of a given mesh
watch_5 = Watch(faceVertices)
byPerimeterPoints = Surface.ByPerimeterPoints(points=watch_5)
watch_6 = Watch(byPerimeterPoints)
watch_3d_2 = Watch3D(byPerimeterPoints)
