# Dynamo graph Geometry.Modifiers.dyn (Dynamo 3.0.3.7597)
# author: Andreas Dieckmann
# Geometry.Modifiers nodes sample graph
# packages: Clockwork for Dynamo 2.x 2.6.0

origin = Point.Origin()

# group: INPUTS
sphere_x = DoubleSlider(10, range=0..20 step 0.5)
sphere_radius = DoubleSlider(5, range=0..10 step 0.5)
cuboid_x = DoubleSlider(20, range=0..30 step 0.5)
cuboid_size = DoubleSlider(5, range=0..10 step 0.5)

byCoordinates = Point.ByCoordinates(x=sphere_x)
byCenterPointRadius = Sphere.ByCenterPointRadius(centerPoint=byCoordinates, radius=sphere_radius)
byCoordinates_2 = Point.ByCoordinates(x=cuboid_x)
byLengths = Cuboid.ByLengths(origin=byCoordinates_2, width=cuboid_size, length=cuboid_size, height=cuboid_size)
list_create = List.Create(item0=byCenterPointRadius, item1=byLengths)
watch = Watch(list_create)

# group: Geometry.ClosestTo
closestTo = Custom[Geometry.ClosestTo](geometry=watch, other=origin)  # package Clockwork for Dynamo 2.x; Finds the closest entity in a list of geometric entities from another given entity
watch_2 = Watch(closestTo.ClosestObject)

create = List.Create(item0=origin, item1=watch, item2=closestTo.ClosestPoint)
watch_3d = Watch3D(create)

# group: Geometry.FurthestFrom
furthestFrom = Custom[Geometry.FurthestFrom](geometry=list_create, other=origin)  # package Clockwork for Dynamo 2.x; Finds the furthest entity in a list of geometric entities from another given entity
watch_3 = Watch(furthestFrom)
