# Dynamo graph Geometry.Points.UV.dyn (Dynamo 3.0.3.7597)
# author: Andreas Dieckmann
# UV nodes sample graph
# packages: Clockwork for Dynamo 2.x 2.6.0

# group: INPUTS
rounding_point_x = DoubleSlider(0.78, range=0..1 step 0.1)  # graph input
rounding_point_y = DoubleSlider(0.621, range=0..1 step 0.1)  # graph input
uv_point_x = DoubleSlider(18.70503597, range=0..100 step 0.1)  # graph input
uv_point_y = DoubleSlider(35.25179856, range=0..100 step 0.1)  # graph input

byCoordinates = UV.ByCoordinates(u=rounding_point_x, v=rounding_point_y)
watch = Watch(byCoordinates)
code_block = CodeBlock { 0.1; }

# group: UV.RoundToPrecision
roundToPrecision = Custom[UV.RoundToPrecision](uv=watch, Precision=code_block)  # package Clockwork for Dynamo 2.x; Rounds a UV coordinate to a specified precision
watch_2 = Watch(roundToPrecision)

# group: UV.RoundUpToPrecision
roundUpToPrecision = Custom[UV.RoundUpToPrecision](uv=watch, Precision=code_block)  # package Clockwork for Dynamo 2.x; Rounds a UV coordinate *up* to a specified precision
watch_3 = Watch(roundUpToPrecision)

# group: UV.RoundDownToPrecision
roundDownToPrecision = Custom[UV.RoundDownToPrecision](uv=watch, Precision=code_block)  # package Clockwork for Dynamo 2.x; Rounds a UV coordinate *down* to a specified precision
watch_4 = Watch(roundDownToPrecision)

# group: UV.Swap
swap = Custom[UV.Swap](uv=watch)  # package Clockwork for Dynamo 2.x; Swaps U and V coordinates
watch_5 = Watch(swap)

code_block_2 = CodeBlock { 20; 0.2; 0.8; 5; }
randomList = Math.RandomList(amount=code_block_2.out0)
remapRange = Math.RemapRange(numbers=randomList, newMin=code_block_2.out1, newMax=code_block_2.out2)
byCoordinates_2 = UV.ByCoordinates(u=remapRange, v=remapRange, lacing=CrossProduct)
flatten = List.Flatten(list=byCoordinates_2)
code_block_3 = CodeBlock { 3; 0; }
takeEveryNthItem = List.TakeEveryNthItem(list=flatten, n=code_block_3.out0, offset=code_block_3.out1)

# group: UV.PruneDuplicates
watch_6 = Watch(takeEveryNthItem)
number_slider = DoubleSlider(0.011, range=0..0.3 step 0.1)  # graph input
pruneDuplicates = Custom[UV.PruneDuplicates](UVs=watch_6, Tolerance=number_slider)  # package Clockwork for Dynamo 2.x; Prune UVs to exclude duplicates within a given tolerance
count = List.Count(list=pruneDuplicates)
watch_7 = Watch(count)
count_2 = List.Count(list=watch_6)
watch_8 = Watch(count_2)

byCoordinates_3 = Point.ByCoordinates(x=uv_point_x, y=uv_point_y)

# group: UV.ByXY
byXY = Custom[UV.ByXY](point=byCoordinates_3)  # package Clockwork for Dynamo 2.x; Creates UVs from the XY components of point coordinates
watch_9 = Watch(byXY)

code_block_4 = CodeBlock { [0.2,0.8]; }
byCoordinates_4 = UV.ByCoordinates(u=code_block_4, v=code_block_4, lacing=CrossProduct)
flatten_2 = List.Flatten(list=byCoordinates_4)

# group: UV.Average
watch_10 = Watch(flatten_2)
average = Custom[UV.Average](UVs=watch_10)  # package Clockwork for Dynamo 2.x; Determines the average of a list of UVs
watch_11 = Watch(average)
