# Dynamo graph Geometry.Shapes.Buckyball.dyn (Dynamo 2.12.1.8246)
# author: Andreas Dieckmann
# Buckyball node sample graph
# packages: Clockwork for Dynamo 2.x 2.12.0

origin = Point.Origin()

# group: INPUTS
radius = DoubleSlider(15, range=0..20 step 0.1)  # graph input

# group: Buckyball.ByOriginAndRadius
byOriginAndRadius = Custom[Buckyball.ByOriginAndRadius](origin=origin, radius=radius)  # package Clockwork for Dynamo 2.x; Returns all the data necessary for modeling a truncated icosahedron (vertices and struts) as well as the surface area and volume.
watch = Watch(byOriginAndRadius.Volume)
watch_2 = Watch(byOriginAndRadius.SurfaceArea)
watch_3 = Watch(byOriginAndRadius.StrutsUpVectors)
watch_4 = Watch(byOriginAndRadius.StrutPoints)
watch_5 = Watch(byOriginAndRadius.SurfaceGeometry)
watch_6 = Watch(byOriginAndRadius.PentagonPoints)
watch_7 = Watch(byOriginAndRadius.HexagonPoints)
watch_8 = Watch(byOriginAndRadius.Vertices)
watch_9 = Watch(byOriginAndRadius.StrutGeometry)
list_create = List.Create(item0=byOriginAndRadius.StrutGeometry, item1=byOriginAndRadius.SurfaceGeometry)
watch_3d = Watch3D(list_create)
