# Dynamo graph Geometry.Solids.dyn (Dynamo 2.12.1.8246)
# author: Andreas Dieckmann
# Solids nodes sample graph
# packages: Clockwork for Dynamo 2.x 2.12.2

byLengths = Cuboid.ByLengths()
XAxis = Vector.XAxis()
translate = Geometry.Translate(geometry=byLengths, direction=XAxis)
XAxis_2 = Vector.XAxis()
translate_2 = Geometry.Translate(geometry=translate, direction=XAxis_2)
list_create = List.Create(item0=byLengths, item1=translate, item2=translate_2)

# group: Solid.ByUnion+
watch = Watch(list_create)
byUnion = Custom[Solid.ByUnion+](solids=watch)  # package Clockwork for Dynamo 2.x; The OOTB node Solid.ByUnion occasionally fails when trying to merge solids with almost adjacent faces. This node will return the minimum amount of joined solids possible in such cases instead of returning null.
watch_2 = Watch(byUnion)
