# Dynamo graph Geometry.Surfaces.dyn (Dynamo 3.0.3.7597)
# author: Andreas Dieckmann
# Surfaces nodes sample graph
# packages: Clockwork for Dynamo 2.x 2.6.0

origin = Point.Origin()
code_block = CodeBlock { 2; }
byCoordinates = Point.ByCoordinates(x=code_block)

# group: INPUTS
point_z = DoubleSlider(0, range=0..2 step 0.1)  # graph input

byCoordinates_2 = Point.ByCoordinates(x=code_block, y=code_block, z=point_z)
byCoordinates_3 = Point.ByCoordinates(y=code_block)
list_create = List.Create(item0=origin, item1=byCoordinates, item2=byCoordinates_2, item3=byCoordinates_3)
byPerimeterPoints = Surface.ByPerimeterPoints(points=list_create)

# group: Surface.IsPlanar
watch = Watch(byPerimeterPoints)
isPlanar = Custom[Surface.IsPlanar](surface=watch)  # package Clockwork for Dynamo 2.x; Checks whether a face is planar
watch_2 = Watch(isPlanar)
watch_3d = Watch3D(byPerimeterPoints)

byLengths = Cuboid.ByLengths(width=code_block, length=code_block, height=code_block)
explode = Geometry.Explode(geometry=byLengths)

# group: Surface.FilterByOrientation
filterByOrientation = Custom[Surface.FilterByOrientation](surfaces=explode)  # package Clockwork for Dynamo 2.x; Sorts surfaces in three lists based on their orientation (vertical, horizontal up & horizontal down) and also returns three corresponding lists of booleans.
watch_3 = Watch(filterByOrientation.isHorizontalUp)
watch_4 = Watch(filterByOrientation.isVertical)
watch_5 = Watch(filterByOrientation.isHorizontalDown)
watch_6 = Watch(filterByOrientation.horizontalDown)
watch_7 = Watch(filterByOrientation.horizontalUp)
watch_8 = Watch(filterByOrientation.vertical)
