# Dynamo graph Geometry.Tesselation.ConvexHull.dyn (Dynamo 2.12.1.8246)
# author: Andreas Dieckmann
# ConvexHull node sample graph
# packages: Clockwork for Dynamo 2.x 2.12.0

code_block = CodeBlock { 20; 0.2; 0.8; 5; }
byWidthLength = Rectangle.ByWidthLength(width=code_block.out3, length=code_block.out3)
byPatch = Surface.ByPatch(closedCurve=byWidthLength)
randomList = Math.RandomList(amount=code_block.out0)
remapRange = Math.RemapRange(numbers=randomList, newMin=code_block.out1, newMax=code_block.out2)
byCoordinates = UV.ByCoordinates(u=remapRange, v=remapRange, lacing=CrossProduct)
flatten = List.Flatten(list=byCoordinates)
code_block_2 = CodeBlock { 3; 0; }
takeEveryNthItem = List.TakeEveryNthItem(list=flatten, n=code_block_2.out0, offset=code_block_2.out1)

# group: ConvexHull.2DbyUV
watch = Watch(takeEveryNthItem)
n2DbyUV = Custom[ConvexHull.2DbyUV](UVs=watch)  # package Clockwork for Dynamo 2.x; Computes the convex hull of a given set of UV coordinates based on the monotone chain algorithm
watch_2 = Watch(n2DbyUV)

U = UV.U(uV=watch_2)
V = UV.V(uV=watch_2)
pointAtParameter = Surface.PointAtParameter(surface=byPatch, u=U, v=V)
boolean = BoolSelector(true)  # graph input
byPoints = PolyCurve.ByPoints(points=pointAtParameter, connectLastToFirst=boolean)
U_2 = UV.U(uV=takeEveryNthItem)
V_2 = UV.V(uV=takeEveryNthItem)
pointAtParameter_2 = Surface.PointAtParameter(surface=byPatch, u=U_2, v=V_2)
list_create = List.Create(item0=byPoints, item1=pointAtParameter_2)
watch_3d = Watch3D(list_create)
