# Dynamo graph Geometry.Tesselation.Paneling.Grid.dyn (Dynamo 3.0.3.7597)
# author: Andreas Dieckmann
# Paneling.Grid nodes sample graph
# packages: Clockwork for Dynamo 2.x 2.6.0

origin = Point.Origin()
code_block = CodeBlock { 2; }
byCoordinates = Point.ByCoordinates(x=code_block)
byStartPointEndPoint = Line.ByStartPointEndPoint(startPoint=origin, endPoint=byCoordinates)
byCoordinates_2 = Point.ByCoordinates(y=code_block)
code_block_2 = CodeBlock { 1; }
byCoordinates_3 = Point.ByCoordinates(x=code_block, y=code_block, z=code_block_2)
byStartPointEndPoint_2 = Line.ByStartPointEndPoint(startPoint=byCoordinates_2, endPoint=byCoordinates_3)
list_create = List.Create(item0=byStartPointEndPoint, item1=byStartPointEndPoint_2)
byRuledLoft = Surface.ByRuledLoft(crossSections=list_create)

# group: INPUTS
of_x_subdivisions = IntegerSlider(13, range=0..20 step 1)  # graph input
of_y_subdivisions = IntegerSlider(10, range=0..20 step 1)  # graph input
image_file_path = Filename("..\..\2.x\extra\Image_Sample.jpg")  # graph input
invert_image = BoolSelector(true)  # graph input
mirror_image_vertically = BoolSelector(false)  # graph input
mirror_image_horizontally = BoolSelector(true)  # graph input

# group: Grid.FromFace
fromFace = Custom[Grid.FromFace](surface=byRuledLoft, U=of_x_subdivisions, V=of_y_subdivisions)  # package Clockwork for Dynamo 2.x; Returns UV coordinates, XYZ coordinates and normals for a face with UV subdivision
watch_3d = Watch3D(fromFace.Points)
watch = Watch(fromFace.Points)
watch_2 = Watch(fromFace.Normals)
watch_3 = Watch(fromFace.UVs)

file_from_path = FileObject(path=image_file_path)
readFromFile = Image.ReadFromFile(file=file_from_path)
watch_image = WatchImageCore(image=readFromFile)
pixels = Image.Pixels(image=watch_image, xSamples=of_x_subdivisions, ySamples=of_y_subdivisions)
watch_4 = Watch(pixels)
brightness = Color.Brightness(color=watch_4)

# group: Grid.InvertAndMirrorNormalizedValues
invertAndMirrorNormalizedValues = Custom[Grid.InvertAndMirrorNormalizedValues](seq=brightness, Invert=invert_image, MirrorVertically=mirror_image_vertically, MirrorHorizontally=mirror_image_horizontally)  # package Clockwork for Dynamo 2.x; Inverts and mirrors (horizontally & vertically) a nested list of normalized values.
greyscaleByNormalizedValue = Custom[Color.GreyscaleByNormalizedValue](dbl=invertAndMirrorNormalizedValues)  # package Clockwork for Dynamo 2.x; Creates a greyscale color based on a normalized value (0 = black, 1 = white)
fromPixels = Image.FromPixels(colors=greyscaleByNormalizedValue)
watch_image_2 = WatchImageCore(image=fromPixels)
