# Dynamo graph Geometry.Tesselation.Paneling.Pattern.Quadrilateral.dyn (Dynamo 3.0.3.7597)
# author: Andreas Dieckmann
# Paneling.Pattern.Quadrilateral node sample graph
# packages: Clockwork for Dynamo 2.x 2.6.0

# group: INFO
# note: Run this graph on the Paneling_Sample model in the extra folder.

# group: INPUTS
select_face = DSFaceSelection()  # 1 picked in the model
u_subdivision = IntegerSlider(9, range=0..20 step 1)  # graph input
v_subdivision = IntegerSlider(11, range=0..20 step 1)  # graph input
reverse = BoolSelector(false)  # graph input
shift_placement = IntegerSlider(0, range=0..3 step 1)  # graph input
panel_type = FamilyTypes("4PointACByOffset_VarA:Type 1")

firstItem = List.FirstItem(list=select_face)
fromFace = Custom[Grid.FromFace](surface=firstItem, U=u_subdivision, V=v_subdivision)  # package Clockwork for Dynamo 2.x; Returns UV coordinates, XYZ coordinates and normals for a face with UV subdivision

# group: Pattern.Quadrilateral
quadrilateral = Custom[Pattern.Quadrilateral](seq=fromFace.UVs, V=v_subdivision, reverse=reverse, shiftPlacement=shift_placement)  # package Clockwork for Dynamo 2.x; Creates groups of points from a list of UVs or XYZs for the placement of quadrilateral panels. The placement pattern can be reversed (boolean) and shifted (integer).
watch = Watch(quadrilateral)

byParametersOnFace = AdaptiveComponent.ByParametersOnFace(uvs=quadrilateral, surface=firstItem, familyType=panel_type)
