# Dynamo graph Geometry.Tesselation.Paneling.Pattern.Quadrilateral2byX.dyn (Dynamo 3.0.3.7597)
# author: Andreas Dieckmann
# Paneling.Pattern.Quadrilateral2ByX node sample graph
# packages: Clockwork for Dynamo 2.x 2.6.0

# group: INFO
# note: Run this graph on the Paneling_Sample model in the extra folder.

# group: INPUTS
select_face = DSFaceSelection()  # 1 picked in the model
u_subdivisions = IntegerSlider(5, range=0..20 step 1)  # graph input
v_subdivisions = IntegerSlider(9, range=0..20 step 1)  # graph input
X = IntegerSlider(3, range=0..20 step 1)  # graph input
reverse_pattern = BoolSelector(false)  # graph input
shift_pattern = IntegerSlider(0, range=0..3 step 1)  # graph input
rotate_grid_by_90 = BoolSelector(true)  # graph input
panel_type = FamilyTypes("6Point-AC_2x3:6Point-AC_2x3")

firstItem = List.FirstItem(list=select_face)
fromFace = Custom[Grid.FromFace](surface=firstItem, U=u_subdivisions, V=v_subdivisions)  # package Clockwork for Dynamo 2.x; Returns UV coordinates, XYZ coordinates and normals for a face with UV subdivision

# group: Pattern.Quadrilateral2byX
quadrilateral2byX = Custom[Pattern.Quadrilateral2byX](seq=fromFace.UVs, V=v_subdivisions, X=X, reversePattern=reverse_pattern, shiftPattern=shift_pattern, rotateGridby90Degrees=rotate_grid_by_90)  # package Clockwork for Dynamo 2.x; Creates groups of points from a list of UVs or XYZs for the placement of quadrilateral panels that have more than 4 placement points (e.g. bent panels). The placement pattern can be reversed (boolean), rotated (boolean) and shifted (integer).
watch = Watch(quadrilateral2byX)

byParametersOnFace = AdaptiveComponent.ByParametersOnFace(uvs=watch, surface=firstItem, familyType=panel_type)
