# Dynamo graph Geometry.Tesselation.Paneling.Pattern.QuadrilateralCheckerboard.dyn (Dynamo 3.0.3.7597)
# author: Andreas Dieckmann
# Paneling.Pattern.QuadrilateralCheckerboard node sample graph
# packages: Clockwork for Dynamo 2.x 2.6.0

# group: INFO
# note: Run this graph on the Paneling_Sample model in the extra folder.

# group: INPUTS
select_face = DSFaceSelection()  # 1 picked in the model
u_subdivisions = IntegerSlider(9, range=0..20 step 1)  # graph input
v_subdivisions = IntegerSlider(11, range=0..20 step 1)  # graph input
reverse = BoolSelector(false)  # graph input
shift_placement = IntegerSlider(0, range=0..3 step 1)  # graph input
panel_type_a = FamilyTypes("4PointACByOffset_VarA:Type 1")
panel_type_b = FamilyTypes("4PointACByOffset_VarA:Type 2")

firstItem = List.FirstItem(list=select_face)
fromFace = Custom[Grid.FromFace](surface=firstItem, U=u_subdivisions, V=v_subdivisions)  # package Clockwork for Dynamo 2.x; Returns UV coordinates, XYZ coordinates and normals for a face with UV subdivision

# group: Pattern.QuadrilateralCheckerboard
quadrilateralCheckerboard = Custom[Pattern.QuadrilateralCheckerboard](seq=fromFace.UVs, V=v_subdivisions, reverse=reverse, shiftPlacement=shift_placement)  # package Clockwork for Dynamo 2.x; Creates groups of points from a list of UVs or XYZs for the placement of quadrilateral panels in a checkerboard pattern. The placement pattern can be reversed (boolean) and shifted (integer).
watch = Watch(quadrilateralCheckerboard.typeA)
watch_2 = Watch(quadrilateralCheckerboard.typeB)

byParametersOnFace = AdaptiveComponent.ByParametersOnFace(uvs=watch, surface=firstItem, familyType=panel_type_a)
byParametersOnFace_2 = AdaptiveComponent.ByParametersOnFace(uvs=watch_2, surface=firstItem, familyType=panel_type_b)
