# Dynamo graph Geometry.Tesselation.Paneling.Pattern.TriangularFlatDiagonal.dyn (Dynamo 3.0.3.7597)
# author: Andreas Dieckmann
# Paneling.Pattern.TriangularFlatDiagonal node sample graph
# packages: Clockwork for Dynamo 2.x 2.6.0

# group: INFO
# note: Run this graph on the Paneling_Sample model in the extra folder.

# group: INPUTS
select_face = DSFaceSelection()  # 1 picked in the model
u_subdivisions = IntegerSlider(9, range=0..20 step 1)  # graph input
v_subdivisions = IntegerSlider(11, range=0..20 step 1)  # graph input
reverse_type_a = BoolSelector(false)  # graph input
reverse_type_b = BoolSelector(false)  # graph input
shift_placement_type_a = IntegerSlider(0, range=0..2 step 1)  # graph input
shift_placement_type_b = IntegerSlider(0, range=0..2 step 1)  # graph input
shift_overall_placement = IntegerSlider(0, range=0..2 step 1)  # graph input
rotate_grid_by_90 = BoolSelector(false)  # graph input
panel_type_a = FamilyTypes("3PointACByOffset_VarA:Type 1")
panel_type_b = FamilyTypes("3PointACByOffset_VarA:Type 2")

firstItem = List.FirstItem(list=select_face)
fromFace = Custom[Grid.FromFace](surface=firstItem, U=u_subdivisions, V=v_subdivisions)  # package Clockwork for Dynamo 2.x; Returns UV coordinates, XYZ coordinates and normals for a face with UV subdivision

# group: Pattern.TriangularFlatDiagonal
triangularFlatDiagonal = Custom[Pattern.TriangularFlatDiagonal](seq=fromFace.UVs, V=v_subdivisions, reverseTypeA=reverse_type_a, reverseTypeB=reverse_type_b, shiftPlacementTypeA=shift_placement_type_a, shiftPlacementTypeB=shift_placement_type_b, shiftOverallPlacement=shift_overall_placement, rotateGridBy90Degrees=rotate_grid_by_90)  # package Clockwork for Dynamo 2.x; Creates groups of points from a list of UVs or XYZs for the placement of triangular panels. The placement pattern can be reversed (boolean) and shifted (integer).
watch = Watch(triangularFlatDiagonal.typeA)
watch_2 = Watch(triangularFlatDiagonal.typeB)

byParametersOnFace = AdaptiveComponent.ByParametersOnFace(uvs=watch, surface=firstItem, familyType=panel_type_a)
byParametersOnFace_2 = AdaptiveComponent.ByParametersOnFace(uvs=watch_2, surface=firstItem, familyType=panel_type_b)
