# Dynamo graph ImportExport.Clipboard.dyn (Dynamo 2.12.1.8246)
# author: Andreas Dieckmann
# Clipboard nodes sample graph
# packages: Clockwork for Dynamo 2.x 2.12.0

# group: INPUTS
toggle = BoolSelector(false)  # graph input
input_string = StringInput("Dynamo says Hello...")

# group: Clipboard.SendTo
sendTo = Custom[Clipboard.SendTo](str=input_string)  # package Clockwork for Dynamo 2.x; Copies a string to the clipboard.
watch = Watch(sendTo)

passthrough = Custom[Passthrough](passThrough=toggle, waitFor=watch)  # package Clockwork for Dynamo 2.x; Forces a sequential order of execution. The node wired into the output of the Passthrough node will be executed *after* the node wired into the waitFor input (e.g. important for some Revit operations). The value of the passThrough input will be passed on to the node wired into the output port of the Passthrough node.

# group: Clipboard.GetFrom
getFrom = Custom[Clipboard.GetFrom](toggle=passthrough)  # package Clockwork for Dynamo 2.x; Gets the content of the clipboard. ATTENTION: Will only work with strings.
watch_2 = Watch(getFrom)
