# Dynamo graph ImportExport.CustomNode.dyn (Dynamo 3.2.1.5366)
# author: Andreas Dieckmann
# CustomNode node sample graph
# packages: Clockwork for Dynamo 2.x 2.6.0

# group: INPUTS
dyf_file_path = Filename("..\..\..\nodes\1.x\Paneling.DropLastRowAndColumn.dyf")  # graph input

# group: CustomNode.Properties
properties = Custom[CustomNode.Properties](path=dyf_file_path)  # package Clockwork for Dynamo 2.x; Extracts information from a custom node.
watch = Watch(properties.InputDefaultVals)
watch_2 = Watch(properties.PythonScripts)
watch_3 = Watch(properties.CustomNodesCount)
watch_4 = Watch(properties.ID)
watch_5 = Watch(properties.Category)
watch_6 = Watch(properties.Outputs)
watch_7 = Watch(properties.NestedCustomNodes)
watch_8 = Watch(properties.NestedBuiltinNodes)
watch_9 = Watch(properties.Name)
watch_10 = Watch(properties.Description)
watch_11 = Watch(properties.Inputs)
watch_12 = Watch(properties.InputDataTypes)
watch_13 = Watch(properties.BuiltinNodesCount)
watch_14 = Watch(properties.Version)
watch_15 = Watch(properties.InputDescriptions)
watch_16 = Watch(properties.OutputDescriptions)
watch_17 = Watch(properties.IsVisibleInLibrary)
