# Dynamo graph ImportExport.FileSystem.dyn (Dynamo 3.3.0.6316)
# author: Andreas Dieckmann
# FileSystem nodes sample graph
# packages: Clockwork for Dynamo 2.x 2.12.2

# group: INPUTS
file_path = Filename("..\..\..\..\..\..\..\..\..\Windows\regedit.exe")

file_from_path = FileObject(path=file_path)

# group: FileSystem.FileSize
fileSize = Custom[FileSystem.FileSize](file=file_from_path)  # package Clockwork for Dynamo 2.x; Returns the file size of a given file.
watch = Watch(fileSize.bytes)
watch_2 = Watch(fileSize.kilobytes)
watch_3 = Watch(fileSize.megabytes)

# group: FileSystem.FileCreated
fileCreated = Custom[FileSystem.FileCreated](file=file_from_path)  # package Clockwork for Dynamo 2.x; Returns the date and time a given file was created
watch_4 = Watch(fileCreated)

# group: FileSystem.FileLastAccessed
fileLastAccessed = Custom[FileSystem.FileLastAccessed](file=file_from_path)  # package Clockwork for Dynamo 2.x; Returns the date and time a given file was last accessed
watch_5 = Watch(fileLastAccessed)

# group: FileSystem.FileLastModified
fileLastModified = Custom[FileSystem.FileLastModified](file=file_from_path)  # package Clockwork for Dynamo 2.x; Returns the date and time a given file was last modified
watch_6 = Watch(fileLastModified)
