# Dynamo graph Input.DateTime.dyn (Dynamo 2.12.1.8246)
# author: Andreas Dieckmann
# DateTime nodes sample graph
# packages: Clockwork for Dynamo 2.x 2.12.0

now = DateTime.Now()
watch = Watch(now)

# group: DateTime.CalendarWeek
calendarWeek = Custom[DateTime.CalendarWeek](date=watch)  # package Clockwork for Dynamo 2.x; Retrieves the calendar week for the given date
watch_2 = Watch(calendarWeek)

string = StringInput("05:00")  # graph input
fromString = TimeSpan.FromString(string=string)
addTimeSpan = DateTime.AddTimeSpan(dateTime=now, timeSpan=fromString)
watch_3 = Watch(addTimeSpan)

# group: DateTime.IsLater
isLater = Custom[DateTime.IsLater](dateTime1=watch, dateTime2=watch_3)  # package Clockwork for Dynamo 2.x; Determines if a given date and time are later than another given date and time.
watch_4 = Watch(isLater)

# group: DateTime.IsEarlier
isEarlier = Custom[DateTime.IsEarlier](dateTime1=watch, dateTime2=watch_3)  # package Clockwork for Dynamo 2.x; Determines if a given date and time are earlier than another given date and time.
watch_5 = Watch(isEarlier)
