# Dynamo graph Input.Object.dyn (Dynamo 2.12.1.8246)
# author: Andreas Dieckmann
# Object nodes sample graph
# packages: Clockwork for Dynamo 2.x 2.12.0

# group: INPUTS
search_string = StringInput("get")  # graph input

byLengths = Cuboid.ByLengths()

# group: Object.MembersByName
membersByName = Custom[Object.MembersByName](searchFor=search_string, element=byLengths)  # package Clockwork for Dynamo 2.x; Looks up all the members of a given element based on a given name (or part of a name) of the property or method. Search is case-insensitive.
watch = Watch(membersByName)

# group: Object.Members
members = Custom[Object.Members](element=byLengths)  # package Clockwork for Dynamo 2.x; Gets a list of all members (properties and methods) of a selected element
watch_2 = Watch(members)
