# Dynamo graph Input.TimeSpan.dyn (Dynamo 2.12.1.8246)
# author: Andreas Dieckmann
# TimeSpan nodes sample graph
# packages: Clockwork for Dynamo 2.x 2.12.0

empty = List.Empty()
code_block = CodeBlock { 1..10; }
boolean = BoolSelector(true)  # graph input
lapTime = Custom[TimeSpan.LapTime](lapTimes=empty, Passthrough=code_block, rerunToggle=boolean)  # package Clockwork for Dynamo 2.x; Records a timestamp and adds it to a given list of lap times. Also passes through an arbitrary variable for integration into a graph.
code_block_2 = CodeBlock { 2; }
permutations = List.Permutations(list=lapTime.Passthrough, length=code_block_2)

# group: TimeSpan.LapTime
watch = Watch(lapTime.LapTimes)
lapTime_2 = Custom[TimeSpan.LapTime](lapTimes=watch, Passthrough=permutations)
watch_2 = Watch(lapTime_2.LapTimes)

string_from_object = FromObject(obj=lapTime_2.Passthrough)
lapTime_3 = Custom[TimeSpan.LapTime](lapTimes=watch_2, Passthrough=string_from_object)

# group: TimeSpan.EvaluateLapTimes
watch_3 = Watch(lapTime_3.LapTimes)
evaluateLapTimes = Custom[TimeSpan.EvaluateLapTimes](LapTimes=watch_3)  # package Clockwork for Dynamo 2.x; Evaluates a list of lap times and returns the overall time
watch_4 = Watch(evaluateLapTimes.NetLapTimes)
watch_5 = Watch(evaluateLapTimes.OverallTime)
