# Dynamo graph List.Generate.dyn (Dynamo 2.12.1.8246)
# author: Andreas Dieckmann
# List.Generate nodes sample graph
# packages: Clockwork for Dynamo 2.x 2.12.0

string = StringInput("""Apples
Pears
Oranges
Peaches
Bananas
Strawberries
Pineapples
Mangos""")  # graph input
string_2 = StringInput("\n")  # graph input
split = String.Split(string=string, separator0=string_2)

# group: INPUTS
amount = IntegerSlider(53, range=0..100 step 1)
randomlist_seed = IntegerSlider(66, range=0..100 step 1)
alphabeticalsequence_uppercase = BoolSelector(false)  # graph input
leadingzeroes_of_digits = IntegerSlider(3, range=0..4 step 1)
randomlist_min_value = IntegerSlider(14, range=0..100 step 1)
randomlist_max_value = IntegerSlider(29, range=0..100 step 1)

# group: RandomList.AsElements
asElements = Custom[RandomList.AsElements](baseElements=split, amount=amount, seed=randomlist_seed)  # package Clockwork for Dynamo 2.x; Creates a list of random elements based on a given list of elements
watch = Watch(asElements)

code_block = CodeBlock { 1; }
list_create = List.Create(item0=code_block)
list_create_2 = List.Create(item0=list_create)

# group: TurnIntoList
watch_2 = Watch(code_block)
turnIntoList = Custom[TurnIntoList](unknownItem=watch_2)  # package Clockwork for Dynamo 2.x; Turns an element (or a nested list) into a flat list
watch_3 = Watch(turnIntoList)
watch_4 = Watch(list_create_2)
turnIntoList_2 = Custom[TurnIntoList](unknownItem=watch_4)
watch_5 = Watch(turnIntoList_2)

# group: NormalizedSequence.ByNumber
byNumber = Custom[NormalizedSequence.ByNumber](n=amount)  # package Clockwork for Dynamo 2.x; Creates a sequence of N values between 0 and 1
watch_6 = Watch(byNumber)

PI = Math.PI()
mul = _ * PI  # unwired: x
code_block_2 = CodeBlock { 2; }
div = _ / code_block_2  # unwired: x
radiansToDegrees = Math.RadiansToDegrees()  # unwired: radians
sin = Math.Sin()  # unwired: angle
function_compose = ComposeFunctions(function0=mul, function1=div, function2=radiansToDegrees, function3=sin)

# group: NormalizedSequence.ByFunction
byFunction = Custom[NormalizedSequence.ByFunction](func=function_compose, n=amount)  # package Clockwork for Dynamo 2.x; Creates a sequence of N values between 0 and 1 driven by a function
watch_7 = Watch(byFunction)

# group: AlphabeticalSequence.ByNumber
byNumber_2 = Custom[AlphabeticalSequence.ByNumber](n=amount, upperCase=alphabeticalsequence_uppercase)  # package Clockwork for Dynamo 2.x; Creates a list of the first N letters of the alphabet (where 1 = A, 2 = B, ... , 27 = AA, 28 = AB etc.).
watch_8 = Watch(byNumber_2)

code_block_3 = CodeBlock(n=amount) { 1..n; }

# group: List.WithLeadingZeroes
withLeadingZeroes = Custom[List.WithLeadingZeroes](num=code_block_3, n=leadingzeroes_of_digits)  # package Clockwork for Dynamo 2.x; Adds leading zeros to a sequence of numbers
watch_9 = Watch(withLeadingZeroes)

code_block_4 = CodeBlock { 1..2; 3; 5; }

# group: FibonacciSequence.FromList
fromList = Custom[FibonacciSequence.FromList](initialList=code_block_4.out0, length=amount)  # package Clockwork for Dynamo 2.x; Creates a Fibonacci row from a starting list (last two values) of a given length (starting values do *not* count toward length).
watch_10 = Watch(fromList)

# group: FibonacciSequence.FromValues
fromValues = Custom[FibonacciSequence.FromValues](A=code_block_4.out1, B=code_block_4.out2, length=amount)  # package Clockwork for Dynamo 2.x; Creates a Fibonacci row from two starting values of a given length (starting values do *not* count toward length).
watch_11 = Watch(fromValues)

# group: RandomList.AsIntegers
asIntegers = Custom[RandomList.AsIntegers](min=randomlist_min_value, max=randomlist_max_value, amount=amount, seed=randomlist_seed)  # package Clockwork for Dynamo 2.x; Creates a list of random integers between 0 and a given maximum value
watch_12 = Watch(asIntegers)
