# Dynamo graph List.Inspect.dyn (Dynamo 2.12.1.8246)
# author: Andreas Dieckmann
# List.Inspect nodes sample graph
# packages: Clockwork for Dynamo 2.x 2.12.0

code_block = CodeBlock { 1..3; 4..8; }
list_create = List.Create(item0=code_block.out0, item1=code_block.out1, item2=code_block.out0)
flatten = List.Flatten(list=list_create)

# group: List.CountOccurences
watch = Watch(flatten)
countOccurences = Custom[List.CountOccurences](seq=watch)  # package Clockwork for Dynamo 2.x; Counts the number of occurences of each unique element in a given list
watch_2 = Watch(countOccurences.uniqueElements)
watch_3 = Watch(countOccurences.count)

# group: List.IsNotEmpty
isNotEmpty = Custom[List.IsNotEmpty](seq=watch)  # package Clockwork for Dynamo 2.x; Just the inversion of the built-in Is Empty List node.
watch_4 = Watch(isNotEmpty)

code_block_2 = CodeBlock()
# ---------- code_block_2.designscript (3 lines) ----------
[[true,true],
[false,false],
[true,false]];
# ----------------------------------------
watch_5 = Watch(code_block_2)

# group: Booleans.AnyTrue
anyTrue = Custom[Booleans.AnyTrue](seq=watch_5@L2)  # package Clockwork for Dynamo 2.x; Returns true if any item in a list of booleans is true. ATTENTION: This node will be deprecated in 2024. As of Revit 2022, please switch to the OOTB node AnyTrue.
watch_6 = Watch(anyTrue)

# group: Booleans.AnyFalse
anyFalse = Custom[Booleans.AnyFalse](seq=watch_5@L2)  # package Clockwork for Dynamo 2.x; Returns true if any item in a list of booleans is false. ATTENTION: This node will be deprecated in 2024. As of Revit 2022, please switch to the OOTB node AnyFalse.
watch_7 = Watch(anyFalse)

flatten_2 = List.Flatten(list=code_block_2)

# group: Booleans.CountBlocks
watch_8 = Watch(flatten_2)
countBlocks = Custom[Booleans.CountBlocks](booleans=watch_8)  # package Clockwork for Dynamo 2.x; Retrieves the lengths of uninterrupted sequences of booleans (true or false) in a given list.
watch_9 = Watch(countBlocks.true)
watch_10 = Watch(countBlocks.false)
