# Dynamo graph List.Modify.dyn (Dynamo 2.12.1.8246)
# author: Andreas Dieckmann
# List.Modify nodes sample graph
# packages: Clockwork for Dynamo 2.x 2.12.0

code_block = CodeBlock { 1..6; [2,4]; }
chop = List.Chop(list=code_block.out0, lengths=code_block.out1)

# group: List.FilterBySublistLength
watch = Watch(chop)
code_block_2 = CodeBlock { 2; }
filterBySublistLength = Custom[List.FilterBySublistLength](seq=watch, length=code_block_2)  # package Clockwork for Dynamo 2.x; Filters out all sublists that do not have the specified length
watch_2 = Watch(filterBySublistLength.in)
watch_3 = Watch(filterBySublistLength.out)

code_block_3 = CodeBlock { 1..10; }
code_block_4 = CodeBlock { [2,5,6]; }
string = StringInput("REPLACEMENT")  # graph input

# group: List.ReplaceItemAtIndex+
watch_4 = Watch(code_block_3)
watch_5 = Watch(code_block_4)
replaceItemAtIndex = Custom[List.ReplaceItemAtIndex+](seq=watch_4, indices=watch_5, replacement=string)  # package Clockwork for Dynamo 2.x; Replaces the item at a given index of a list by another item. Unlike the OOTB node, it can replace items at multiple indeces.
watch_6 = Watch(replaceItemAtIndex)

string_2 = StringInput("""Elephant
Lion
Eagle
Banana
Strawberry
Zebra
Pineapple""")  # graph input
string_3 = StringInput("\n")  # graph input
split = String.Split(string=string_2, separator0=string_3)
empty = List.Empty()
code_block_5 = CodeBlock { 3; }
ofRepeatedItem = List.OfRepeatedItem(item=empty, amount=code_block_5)
join = List.Join(list0=split, list1=ofRepeatedItem)
shuffle = List.Shuffle(list=join)

# group: List.ReplaceEmptyLists
watch_7 = Watch(shuffle)
replaceEmptyLists = Custom[List.ReplaceEmptyLists](seq=watch_7, Replacement=string)  # package Clockwork for Dynamo 2.x; Replaces all empty lists within a given list with a substitute
watch_8 = Watch(replaceEmptyLists)

code_block_6 = CodeBlock { null; }
code_block_7 = CodeBlock { 3; }
ofRepeatedItem_2 = List.OfRepeatedItem(item=code_block_6, amount=code_block_7)
join_2 = List.Join(list0=split, list1=ofRepeatedItem_2)
shuffle_2 = List.Shuffle(list=join_2)

# group: List.ReplaceNull
watch_9 = Watch(shuffle_2)
replaceNull = Custom[List.ReplaceNull](seq=watch_9, replacement=string)  # package Clockwork for Dynamo 2.x; Replaces all null values within a given list with a substitute
watch_10 = Watch(replaceNull)

code_block_8 = CodeBlock { 1..10; }

# group: List.DropLastItem
dropLastItem = Custom[List.DropLastItem](list=code_block_8)  # package Clockwork for Dynamo 2.x; Drops the last item from a given list.
watch_11 = Watch(dropLastItem)

code_block_9 = CodeBlock { 1..6; [2,0,4]; }

# group: List.Chop+
chop_2 = Custom[List.Chop+](seq=code_block_9.out0, lengths=code_block_9.out1)  # package Clockwork for Dynamo 2.x; Turns a list into a list of lists with sublists of varying lengths. Unlike the OOTB node, it only takes the specified amount of items and disregards the rest of the input list.
watch_12 = Watch(chop_2)
