# Dynamo graph List.Organize.dyn (Dynamo 2.12.1.8246)
# author: Andreas Dieckmann
# List.Organize nodes sample graph
# packages: Clockwork for Dynamo 2.x 2.12.0

string = StringInput("""Animal
Animal
Animal
Fruit
Fruit
Animal
Fruit""")  # graph input
string_2 = StringInput("\n")  # graph input
split = String.Split(string=string, separator0=string_2)
string_3 = StringInput("""Elephant
Lion
Eagle
Banana
Strawberry
Zebra
Pineapple""")  # graph input
split_2 = String.Split(string=string_3, separator0=string_2)
code_block = CodeBlock { 1..7; }
list_create = List.Create(item0=split, item1=split_2, item2=code_block)

# group: List.GroupListOfListsByKey
watch = Watch(list_create)
code_block_2 = CodeBlock { 0; }
groupListOfListsByKey = Custom[List.GroupListOfListsByKey](seq=watch, keyIndex=code_block_2)  # package Clockwork for Dynamo 2.x; Groups a list of lists by one of its keys
watch_2 = Watch(groupListOfListsByKey)

code_block_3 = CodeBlock { [2,5,6]; }
count = List.Count(list=split_2)
code_block_4 = CodeBlock(n=count) { 0..n-1; }

# group: List.MatchWithKeyValues
watch_3 = Watch(code_block_3)
watch_4 = Watch(code_block_4)
watch_5 = Watch(split_2)
matchWithKeyValues = Custom[List.MatchWithKeyValues](seq=watch_3, keys=watch_4, values=watch_5)  # package Clockwork for Dynamo 2.x; Matches a list with a given set of keys and returns the values corresponding to the keys
watch_6 = Watch(matchWithKeyValues)

count_2 = List.Count(list=split_2)
code_block_5 = CodeBlock(n=count_2) { 1..n; }
list_create_2 = List.Create(item0=split, item1=split_2, item2=code_block_5)

# group: INPUTS
sort_sort_index = IntegerSlider(1, range=0..2 step 1)  # graph input
sort_case_insensitive = BoolSelector(false)  # graph input
sort_order_descending = BoolSelector(false)  # graph input
join_exclude_unmatched_keys = BoolSelector(false)  # graph input

# group: List.SortListOfLists
watch_7 = Watch(list_create_2)
sortListOfLists = Custom[List.SortListOfLists](seq=watch_7, sortIndex=sort_sort_index, caseInsensitive=sort_case_insensitive, orderDescending=sort_order_descending)  # package Clockwork for Dynamo 2.x; Sorts a list of lists by one of its sublists
watch_8 = Watch(sortListOfLists)

uniqueItems = List.UniqueItems(list=split)
string_4 = StringInput("Something else")  # graph input
join = List.Join(list0=uniqueItems, list1=string_4)
count_3 = List.Count(list=join)
code_block_6 = CodeBlock(n=count_3) { 0..n-1; }

# group: List.JoinByKey
watch_9 = Watch(split)
watch_10 = Watch(split_2)
watch_11 = Watch(join)
watch_12 = Watch(code_block_6)
joinByKey = Custom[List.JoinByKey](keys1=watch_9, seq1=watch_10, keys2=watch_11, seq2=watch_12, excludeUnmatchedKeys=join_exclude_unmatched_keys)  # package Clockwork for Dynamo 2.x; Joins two lists by common keys.
watch_13 = Watch(joinByKey.keys)
watch_14 = Watch(joinByKey.seq1)
watch_15 = Watch(joinByKey.seq2)
