# Dynamo graph Math.Formulas.dyn (Dynamo 3.0.3.7597)
# author: Andreas Dieckmann
# Math.Formulas nodes sample graph
# packages: Clockwork for Dynamo 2.x 2.6.0

code_block = CodeBlock { 1; }
byCoordinates = Point.ByCoordinates(y=code_block)
origin = Point.Origin()
code_block_2 = CodeBlock { 2; }
byCoordinates_2 = Point.ByCoordinates(x=code_block_2)

# group: Triangle.SolveByPoints
watch = Watch(byCoordinates)
watch_2 = Watch(origin)
watch_3 = Watch(byCoordinates_2)
solveByPoints = Custom[Triangle.SolveByPoints](PointA=watch, PointB=watch_2, PointC=watch_3)  # package Clockwork for Dynamo 2.x; Solves a triangle based on the XYZ coordinates of its vertices.
watch_4 = Watch(solveByPoints.IncircleRadius)
watch_5 = Watch(solveByPoints.IncircleCenter)
watch_6 = Watch(solveByPoints.Normal)
watch_7 = Watch(solveByPoints.HeightC)
watch_8 = Watch(solveByPoints.Centroid)
watch_9 = Watch(solveByPoints.Plane)
watch_10 = Watch(solveByPoints.HeightB)
watch_11 = Watch(solveByPoints.Area)
watch_12 = Watch(solveByPoints.HeightA)
watch_13 = Watch(solveByPoints.Alpha)
watch_14 = Watch(solveByPoints.SideB)
watch_15 = Watch(solveByPoints.Beta)
watch_16 = Watch(solveByPoints.SideA)
watch_17 = Watch(solveByPoints.Gamma)
watch_18 = Watch(solveByPoints.SideC)

# group: Triangle.SideByLawOfSines
sideByLawOfSines = Custom[Triangle.SideByLawOfSines](alpha=watch_13, sideB=watch_14, beta=watch_15)  # package Clockwork for Dynamo 2.x; Determines the length of a side based on the law of sines. (Alpha is the angle opposite side A and beta is the angle opposite side B...)
watch_19 = Watch(sideByLawOfSines)

# group: Triangle.OppositeSideByLawOfCosines
oppositeSideByLawOfCosines = Custom[Triangle.OppositeSideByLawOfCosines](sideA=watch_16, sideB=watch_14, gamma=watch_17)  # package Clockwork for Dynamo 2.x; Computes the length of the missing side of a triangle using the law of cosines. Gamma is the angle between sides A and B.
watch_20 = Watch(oppositeSideByLawOfCosines)

# group: Triangle.HypotenuseByPythagoras
hypotenuseByPythagoras = Custom[Triangle.HypotenuseByPythagoras](sideA=watch_16, sideB=watch_18)  # package Clockwork for Dynamo 2.x; Computes the length of the hypotenuse of a right triangle using the Pythagorean Theorem. A and B are the legs / catheti of the triangle.
watch_21 = Watch(hypotenuseByPythagoras)

# group: Triangle.CathetusByPythagoras
cathetusByPythagoras = Custom[Triangle.CathetusByPythagoras](sideC=watch_14, sideB=watch_16)  # package Clockwork for Dynamo 2.x; Computes the length of one of the catheti / legs of a right triangle using the Pythagorean Theorem. B is the other leg / cathetus of the triangle while C is the hypotenuse.
watch_22 = Watch(cathetusByPythagoras)

# group: Angle.ExteriorAngle
exteriorAngle = Custom[Angle.ExteriorAngle](angle=watch_13)  # package Clockwork for Dynamo 2.x; Computes the exterior angle of a given angle.
watch_23 = Watch(exteriorAngle.360_angle)
watch_24 = Watch(exteriorAngle.180_angle)

list_create = List.Create(item0=watch_17, item1=watch_13)

# group: Angle.ByAngleSum
watch_25 = Watch(list_create)
byAngleSum = Custom[Angle.ByAngleSum](angles=watch_25)  # package Clockwork for Dynamo 2.x; Computes the missing interior angle of a *planar* polygon based on a given list of all other interior angles.
watch_26 = Watch(byAngleSum)

# group: Angle.ByLawOfSines
byLawOfSines = Custom[Angle.ByLawOfSines](sideA=watch_16, sideB=watch_14, beta=watch_15)  # package Clockwork for Dynamo 2.x; Determines the angle of a triangle based on the law of sines. (Alpha is the angle opposite side A and beta is the angle opposite side B...)
watch_27 = Watch(byLawOfSines)

# group: Angle.ByLawOfCosines
byLawOfCosines = Custom[Angle.ByLawOfCosines](sideA=watch_16, sideB=watch_14, sideC=watch_18)  # package Clockwork for Dynamo 2.x; Computes an angle of a triangle using the law of cosines. A is the opposite side of the triangle while B and C are the sides forming the angle.
watch_28 = Watch(byLawOfCosines)
