# Dynamo graph Math.Graphs.dyn (Dynamo 3.3.0.6316)
# author: Andreas Dieckmann
# Math.Graphs nodes sample graph
# packages: Clockwork for Dynamo 2.x 2.12.2

number = DoubleInput(1)  # graph input
string_from_object = FromObject(obj=number)
watch = Watch(string_from_object)
number_2 = DoubleInput(4)  # graph input
string_from_object_2 = FromObject(obj=number_2)
watch_2 = Watch(string_from_object_2)
number_3 = DoubleInput(2)  # graph input
string_from_object_3 = FromObject(obj=number_3)
create_list = List.Create(item0=string_from_object, item1=string_from_object_3)
number_4 = DoubleInput(3)  # graph input
string_from_object_4 = FromObject(obj=number_4)
create_list_2 = List.Create(item0=string_from_object_3, item1=string_from_object_4)
create_list_3 = List.Create(item0=string_from_object_4, item1=string_from_object_2)
create_list_4 = List.Create(item0=string_from_object, item1=string_from_object_2)
create_list_5 = List.Create(item0=string_from_object_3, item1=string_from_object_2)
create_list_6 = List.Create(item0=create_list, item1=create_list_2, item2=create_list_3, item3=create_list_4, item4=create_list_5)
watch_3 = Watch(create_list_6)

# group: PathGraph.AllPaths
allPaths = Custom[PathGraph.AllPaths](start=watch, end=watch_2, stringPairs=watch_3)  # package Clockwork for Dynamo 2.x; Finds all possible paths between two nodes. The connections input expects a list of value pairs.
watch_4 = Watch(allPaths)

# group: PathGraph.ShortestPath
shortestPath = Custom[PathGraph.ShortestPath](start=watch, end=watch_2, stringPairs=watch_3)  # package Clockwork for Dynamo 2.x; Finds the shortest path (fewest steps) between two nodes. The connections input expects a list of value pairs.
watch_5 = Watch(shortestPath)
