# Dynamo graph Math.Tests.dyn (Dynamo 3.0.3.7597)
# author: Andreas Dieckmann
# Math.Tests nodes sample graph
# packages: Clockwork for Dynamo 2.x 2.6.0

code_block = CodeBlock { 2; 8; }

# group: IsEvenNumber
isEvenNumber = Custom[IsEvenNumber](val=code_block.out0)  # package Clockwork for Dynamo 2.x; Checks if a number is even.
watch = Watch(isEvenNumber)

# group: IsOddNumber
isOddNumber = Custom[IsOddNumber](val=code_block.out0)  # package Clockwork for Dynamo 2.x; Checks if a number is odd.
watch_2 = Watch(isOddNumber)

# group: IsMultipleOf
isMultipleOf = Custom[IsMultipleOf](A=code_block.out1, B=code_block.out0)  # package Clockwork for Dynamo 2.x; Checks if A is a multiple of B.
watch_3 = Watch(isMultipleOf)

# group: INPUTS
value_a = DoubleSlider(50, range=0..100 step 0.1)  # graph input
value_b = DoubleSlider(46, range=0..100 step 0.1)  # graph input
tolerance = DoubleSlider(0.1, range=0..1 step 0.1)  # graph input

# group: IsSimilar
isSimilar = Custom[IsSimilar](valA=value_a, valB=value_b, tolerance=tolerance)  # package Clockwork for Dynamo 2.x; Computes the difference between two values and whether that difference is within a given tolerance factor
watch_4 = Watch(isSimilar.isSimilar)
watch_5 = Watch(isSimilar.difference)
