# Dynamo graph Revit.Application.Application.dyn (Dynamo 2.12.1.8246)
# author: Andreas Dieckmann
# Revit Application nodes sample graph
# packages: Clockwork for Dynamo 2.x 2.12.0

# group: Application.Version
version = Custom[Application.Version]()  # package Clockwork for Dynamo 2.x; Retrieves the name, version and build of the current Revit application.
watch = Watch(version.Version)
watch_2 = Watch(version.Build)
watch_3 = Watch(version.Name)
watch_4 = Watch(version.Language)
watch_5 = Watch(version.fullVersion)

# group: INPUTS
file_path = Filename("..\..\..\..\..\..\..\..\..\Program Files\Autodesk\Revit 2025\Samples\BIM_Projekt_Golden_Nugget-Architektur_und_Ingenieurbau.rvt")

# group: Application.BasicFileInfo
basicFileInfo = Custom[Application.BasicFileInfo](filePath=file_path)  # package Clockwork for Dynamo 2.x; Retrieves basic information about a given Revit file. PLEASE NOTE: The SavedInLaterVersion property is only available when running the node in Revit 2017 or later, it will return Null in previous versions of Revit.
watch_6 = Watch(basicFileInfo.Username)
watch_7 = Watch(basicFileInfo.IsWorkshared)
watch_8 = Watch(basicFileInfo.SavedInLaterVersion)
watch_9 = Watch(basicFileInfo.CentralPath)
watch_10 = Watch(basicFileInfo.IsCentral)
watch_11 = Watch(basicFileInfo.IsLocal)
watch_12 = Watch(basicFileInfo.Language)
watch_13 = Watch(basicFileInfo.SavedInCurrentVersion)
watch_14 = Watch(basicFileInfo.Version)
