# Dynamo graph Revit.Application.Document.Actions.dyn (Dynamo 3.3.0.6316)
# author: Andreas Dieckmann
# Document.Actions nodes sample graph
# packages: Clockwork for Dynamo 2.x 2.12.2

# group: INPUTS
temp_directory_path = Directory("C:\temp")  # graph input
temp_file_name = StringInput("NewFileName")  # graph input
compact_file = BoolSelector(false)  # graph input
save_as_central = BoolSelector(false)  # graph input
save_as_template = BoolSelector(false)  # graph input
family_path = Filename("..\..\..\..\..\..\..\..\..\Program Files\Autodesk\Revit 2022\Samples\rac_advanced_sample_family.rfa")  # graph input
link_path = Filename("..\..\..\..\..\..\..\..\..\Program Files\Autodesk\Revit 2022\Samples\rst_basic_sample_project.rvt")  # graph input
link_with_relative_path = BoolSelector(true)  # graph input
compute_volumes = BoolSelector(true)  # graph input

combinePath = FileSystem.CombinePath(string0=temp_directory_path, string1=temp_file_name)

# group: Document.SaveAs
saveAs = Custom[Document.SaveAs](filePath=combinePath, compactFile=compact_file, saveAsCentral=save_as_central, saveAsTemplate=save_as_template)  # package Clockwork for Dynamo 2.x; Saves the active Revit document under the given name.
watch = Watch(saveAs)

# group: Document.LoadFamily
loadFamily = Custom[Document.LoadFamily](path=family_path)  # package Clockwork for Dynamo 2.x; A very crude implementation of family loading. Will *not* reload an already loaded family of the same name.
watch_2 = Watch(loadFamily.familyTypes)
watch_3 = Watch(loadFamily.success)

# group: Document.AddLink
addLink = Custom[Document.AddLink](filePath=link_path, relativePath=link_with_relative_path)  # package Clockwork for Dynamo 2.x; Adds a link to a model to the current document
watch_4 = Watch(addLink)

# group: Document.SetComputeVolumes
setComputeVolumes = Custom[Document.SetComputeVolumes](computeVolumes=compute_volumes)  # package Clockwork for Dynamo 2.x; Toggle the area and volume setting to compute volumes on (true) or off (false).
watch_5 = Watch(setComputeVolumes)
