# Dynamo graph Revit.Application.FamilyDocument.dyn (Dynamo 2.12.1.8246)
# author: Andreas Dieckmann
# FamilyDocument nodes sample graph
# packages: Clockwork for Dynamo 2.x 2.12.1

boolean = BoolSelector(true)  # graph input

# group: FamilyDocument.CurrentFamilyType
currentFamilyType = Custom[FamilyDocument.CurrentFamilyType](toggle=boolean)  # package Clockwork for Dynamo 2.x; Retrieves the current family type from the active family document. PLEASE NOTE: This node will only work in a family document!
watch = Watch(currentFamilyType)

# group: FamilyDocument.FamilyParameters
familyParameters = Custom[FamilyDocument.FamilyParameters](toggle=boolean)  # package Clockwork for Dynamo 2.x; Retrieves all family parameters from the active family document. PLEASE NOTE: This node will only work in a family document!
watch_2 = Watch(familyParameters)

# group: FamilyDocument.FamilyTypes
familyTypes = Custom[FamilyDocument.FamilyTypes](toggle=boolean)  # package Clockwork for Dynamo 2.x; Retrieves all family types from the active family document. PLEASE NOTE: This node will only work in a family document!
watch_3 = Watch(familyTypes)

# group: FamilyDocument.Properties
properties = Custom[FamilyDocument.Properties](toggle=boolean)  # package Clockwork for Dynamo 2.x; Retrieves all the properties of the current family document (i.e. parameters that you would access in the UI via the Family Category & Parameters tool).
watch_4 = Watch(properties)
