# Dynamo graph Revit.Application.SharedParameterFile.dyn (Dynamo 2.12.1.8246)
# author: Andreas Dieckmann
# Revit SharedParameterFile node sample
# packages: Clockwork for Dynamo 2.x 2.12.0

# group: INPUTS
file_path = Filename("..\..\..\..\..\..\..\..\..\Program Files\Autodesk\Revit 2025\IFC Shared Parameters-RevitIFCBuiltIn_ALL.txt")  # graph input

# group: SharedParameterFile.Parse
parse = Custom[SharedParameterFile.Parse](path=file_path)  # package Clockwork for Dynamo 2.x; Returns all parameters from a shared parameter file.
watch = Watch(parse.names)
watch_2 = Watch(parse.groups)
watch_3 = Watch(parse.data_categories)
watch_4 = Watch(parse.descriptions)
watch_5 = Watch(parse.user_modifiable)
watch_6 = Watch(parse.visible)
watch_7 = Watch(parse.data_types)
watch_8 = Watch(parse.guids)
watch_9 = Watch(parse.hide_when_no_value)
