# Dynamo graph Revit.Elements.AngularDimension.dyn (Dynamo 2.12.1.8246)
# author: Andreas Dieckmann
# Revit AngularDimension nodes sample graph
# packages: Clockwork for Dynamo 2.x 2.6.0

# group: INFO
# note: Run this graph on the CreateStuff sample model.

# group: INPUTS
select_line_a = DSModelElementSelection()  # 1 picked in the model
select_line_b = DSModelElementSelection()  # 1 picked in the model
radius = DoubleSlider(5, range=0..10 step 0.5)
select_view = Views("Ebene 0")

string = StringInput("DimensionType")
byName = Custom[ElementType.ByName](name=string)  # package Clockwork for Dynamo 2.x; Retrieves an element class by its name - to be used with the OOTB node "All Elements of Class".
all_elements_of_type = ElementsOfType(element_type=byName)
styleType = DimensionType.StyleType(dimensionType=all_elements_of_type)
code_block = CodeBlock(style=styleType) { style == "Angular"; }
filterByBoolMask = List.FilterByBoolMask(list=all_elements_of_type, mask=code_block)
firstItem = List.FirstItem(list=filterByBoolMask.in)

# group: AngularDimension.ByElements
byElements = Custom[AngularDimension.ByElements](element1=select_line_a, element2=select_line_b, radius=radius, view=select_view, dimensionType=firstItem)  # package Clockwork for Dynamo 2.x; Creates angular dimensions between elements. Only works in project environment. ATTENTION: Do NOT use in automatic mode.
watch = Watch(byElements)
