# Dynamo graph Revit.Elements.Array.dyn (Dynamo 2.12.1.8246)
# author: Andreas Dieckmann
# Revit Array nodes sample graph
# packages: Clockwork for Dynamo 2.x 2.12.0

# group: INFO
# note: Run this script on the Array_Sample family

string = StringInput("BaseArray")
byName = Custom[ElementType.ByName](name=string)  # package Clockwork for Dynamo 2.x; Retrieves an element class by its name - to be used with the OOTB node "All Elements of Class".
all_elements_of_type = ElementsOfType(element_type=byName)
watch = Watch(all_elements_of_type)

# group: Array.AssociatedFamilyParameter
associatedFamilyParameter = Custom[Array.AssociatedFamilyParameter](baseArray=watch)  # package Clockwork for Dynamo 2.x; Returns the associated family parameter of an array label (if any). PLEASE NOTE: This node will only work in a family document!
watch_2 = Watch(associatedFamilyParameter.familyParameter)
watch_3 = Watch(associatedFamilyParameter.familyParameterName)

# group: Array.GroupType
groupType = Custom[Array.GroupType](array=watch)  # package Clockwork for Dynamo 2.x; Returns the group type of a given array
watch_4 = Watch(groupType)
