# Dynamo graph Revit.Elements.Assembly.dyn (Dynamo 2.12.1.8246)
# author: Andreas Dieckmann
# Revit Assembly nodes sample graph
# packages: Clockwork for Dynamo 2.x 2.12.0

# group: INFO
# note: Run this script on the Assembly_Sample model

# group: INPUTS
select_model_elements = DSModelElementsSelection()  # 3 picked in the model
assembly_name = StringInput("AssemblyByDynamo")  # graph input

# group: Assembly.FromElements
watch = Watch(select_model_elements)
fromElements = Custom[Assembly.FromElements](elements=watch, assemblyName=assembly_name)  # package Clockwork for Dynamo 2.x; Creates an assembly from a list of elements
watch_2 = Watch(fromElements)

# group: Assembly.Members
members = Custom[Assembly.Members](assembly=watch_2)  # package Clockwork for Dynamo 2.x; Retrieves the members of an assembly
watch_3 = Watch(members)

# group: Assembly.RemoveMembers
firstItem = List.FirstItem(list=members)
removeMembers = Custom[Assembly.RemoveMembers](assembly=watch_2, elements=firstItem)  # package Clockwork for Dynamo 2.x; Removes any given elements to a given assembly.
members_2 = Custom[Assembly.Members](assembly=removeMembers.assembly)
watch_4 = Watch(members_2)
watch_5 = Watch(removeMembers.success)

passthrough = Custom[Passthrough](passThrough=removeMembers.assembly, waitFor=members_2)  # package Clockwork for Dynamo 2.x; Forces a sequential order of execution. The node wired into the output of the Passthrough node will be executed *after* the node wired into the waitFor input (e.g. important for some Revit operations). The value of the passThrough input will be passed on to the node wired into the output port of the Passthrough node.
end = Revit.Transaction.Transaction.End(input=passthrough)

# group: Assembly.AddMembers
addMembers = Custom[Assembly.AddMembers](assembly=end, elements=firstItem)  # package Clockwork for Dynamo 2.x; Adds any given elements to a given assembly.
members_3 = Custom[Assembly.Members](assembly=addMembers)
watch_6 = Watch(members_3)

# group: Element.Assembly
assembly = Custom[Element.Assembly](element=watch_6)  # package Clockwork for Dynamo 2.x; Retrieves the assembly an element belongs to (if any)
watch_7 = Watch(assembly)

passthrough_2 = Custom[Passthrough](passThrough=addMembers, waitFor=assembly)

# group: Assembly.Disassemble
disassemble = Custom[Assembly.Disassemble](assembly=passthrough_2)  # package Clockwork for Dynamo 2.x; Disassembles an assembly and returns its members
watch_8 = Watch(disassemble)
