# Dynamo graph Revit.Elements.Category.dyn (Dynamo 2.12.1.8246)
# author: Andreas Dieckmann
# Revit Category nodes sample graph
# packages: Clockwork for Dynamo 2.x 2.12.1

boolean = BoolSelector(true)
builtInCategories = Custom[Document.BuiltInCategories](dynamoSupportedCategoriesOnly=boolean)  # package Clockwork for Dynamo 2.x; List all the available BuiltInCategories

# group: Category.Subcategories
subcategories = Custom[Category.Subcategories](category=builtInCategories.Categories)  # package Clockwork for Dynamo 2.x; Retrieves all the subcategories for a given category
watch = Watch(subcategories)

# group: Category.Type
type = Custom[Category.Type](category=builtInCategories.Categories)  # package Clockwork for Dynamo 2.x; Returns the type of the category
watch_2 = Watch(type)

# group: Category.Material
material = Custom[Category.Material](category=builtInCategories.Categories)  # package Clockwork for Dynamo 2.x; Retrieves the material assigned to the given category in the object styles
watch_3 = Watch(material)

# group: INPUTS
category_name_for_setting = StringInput("OST_Windows")  # "Category Name for setting material"
material_name = StringInput("Dynamo")
category_name_for_resetting = StringInput("OST_Mass")  # "Category Name for resetting material"

byName = Material.ByName(name=material_name)

# group: Category.SetMaterial
setMaterial = Custom[Category.SetMaterial](category=category_name_for_setting, material=byName)  # package Clockwork for Dynamo 2.x; Sets the material for a given category in the Object Styles
watch_4 = Watch(setMaterial)

# group: Category.ResetMaterial
resetMaterial = Custom[Category.ResetMaterial](category=category_name_for_resetting)  # package Clockwork for Dynamo 2.x; Resets the material for a given category in the Object Styles.
watch_5 = Watch(resetMaterial)
