# Dynamo graph Revit.Elements.CurtainPanel.dyn (Dynamo 3.0.3.7597)
# author: Andreas Dieckmann
# Revit CurtainPanel nodes sample graph
# packages: Clockwork for Dynamo 2.x 2.6.0

# group: INFO
# note: Run this script with the CurtainPanel_Sample file in the extra folder.

string = StringInput("OST_CurtainWallPanels")
all_elements_of_category = Custom[All Elements Of Category+](category=string)  # package Clockwork for Dynamo 2.x; Gets all placed elements of a given category in the model. Unlike the OOTB node it also supports linked models and a few more special categories (e.g. Legend Components).
watch = Watch(all_elements_of_category)

# group: CurtainPanel.HostPanel
hostPanel = Custom[CurtainPanel.HostPanel](curtainPanel=watch)  # package Clockwork for Dynamo 2.x; Retrieves the host panel of a given curtain panel. This is typcially needed when wanting to access wall elements used as curtain panels. If no host panel is found, the node will return the input panel instead.
watch_2 = Watch(hostPanel)

# group: CurtainPanel.IsPhantomPanel
isPhantomPanel = Custom[CurtainPanel.IsPhantomPanel](curtainPanel=watch)  # package Clockwork for Dynamo 2.x; Checks whether a given curtain panel is not an actual model element. (These types of objects get generated when curtain grid segments are deleted or in other words when multiple cells of the curtain grid are merged into one panel)
watch_3 = Watch(isPhantomPanel)

host = Custom[Element.Host+](element=watch)  # package Clockwork for Dynamo 2.x; Gets an element's host. Unlike the OOTB node FamilyInstance.GetHost it not only works for family instances but also for elements like wall sweeps, foundations, railings, builing pads, toposolid subdivisions and toposurface subregions.
uniqueItems = List.UniqueItems(list=host)
boolean = BoolSelector(false)
clean = List.Clean(list=uniqueItems, preserveIndices=boolean)
watch_4 = Watch(clean)
boolean_2 = BoolSelector(true)

# group: Element.Panels
panels = Custom[Element.Panels](hostElement=watch_4@L2, organizeInRows=boolean_2)  # package Clockwork for Dynamo 2.x; Retrieves the panels nested in a curtain wall, curtain system or glazed roof. Differences to OOTB node CurtainPanel.ByElement: - Will not fail if curtain wall contains doors or windows - Returns embedded walls - Panels of curtain systems and glazed roofs are returned in a nested list, with one sublist for each face of the curtain system. PLEASE NOTE: Will not work for glazed roofs created by RoofByFace method.
watch_5 = Watch(panels)

# group: Element.CurtainGridLines
curtainGridLines = Custom[Element.CurtainGridLines](hostElement=watch_4@L2)  # package Clockwork for Dynamo 2.x; Retrieves the grid lines of curtain walls, curtain systems or glazed roofs.
watch_6 = Watch(curtainGridLines.uGridLines)
watch_7 = Watch(curtainGridLines.vGridLines)
