# Dynamo graph Revit.Elements.DetailCurve.dyn (Dynamo 2.12.1.8246)
# author: Andreas Dieckmann
# Revit DetailCurve nodes sample graph
# packages: Clockwork for Dynamo 2.x 2.12.0

# group: INFO
# note: Run this file on the CreateStuff_Sample model in the extra folder.

code_block = CodeBlock { 5; }
byWidthLength = Rectangle.ByWidthLength(width=code_block, length=code_block)
explode = Geometry.Explode(geometry=byWidthLength)

# group: INPUTS
select_view = Views("Ebene 0")

# group: DetailCurve.ByCurve+
byCurve = Custom[DetailCurve.ByCurve+](curve=explode, view=select_view)  # package Clockwork for Dynamo 2.x; Creates a detail line based on a given curve. Unlike the OOTB node it can also draw circles.
watch = Watch(byCurve)
