# Dynamo graph Revit.Elements.Dimension.dyn (Dynamo 2.12.1.8246)
# author: Andreas Dieckmann
# Revit Dimension nodes sample graph
# packages: Clockwork for Dynamo 2.x 2.12.0

# group: INFO
# note: Run this file on the Dimension_Sample model in the extra folder.

string = StringInput("OST_Dimensions")
all_elements_of_category = Custom[All Elements Of Category+](category=string)  # package Clockwork for Dynamo 2.x; Gets all placed elements of a given category in the model. Unlike the OOTB node it also supports linked models and a few more special categories (e.g. Legend Components).
watch = Watch(all_elements_of_category)

# group: Dimension.AssociatedFamilyParameter
associatedFamilyParameter = Custom[Dimension.AssociatedFamilyParameter](dimension=watch)  # package Clockwork for Dynamo 2.x; Returns the associated family parameter of a dimension label (if any). PLEASE NOTE: This node will only work in a family document!
watch_2 = Watch(associatedFamilyParameter.familyParameter)
watch_3 = Watch(associatedFamilyParameter.familyParameterName)

# group: Dimension.ReferencedElements
referencedElements = Custom[Dimension.ReferencedElements](dimension=watch)  # package Clockwork for Dynamo 2.x; Returns all elements that are referenced by a given dimension
watch_4 = Watch(referencedElements.elements)
watch_5 = Watch(referencedElements.linkInstances)
watch_6 = Watch(referencedElements.stableReferences)
