# Dynamo graph Revit.Elements.DividedSurface.Query.dyn (Dynamo 2.12.1.8246)
# author: Andreas Dieckmann
# DividedSurface.Query nodes sample graph
# packages: Clockwork for Dynamo 2.x 2.12.0

# group: INFO
# note: Run this graph on the DividedSurface_Sample model in the extra folder.

# group: INPUTS
select_face = DSFaceSelection()  # 1 picked in the model
subdivisions = IntegerSlider(6, range=0..20 step 1)  # graph input
include_overhanging_nodes = BoolSelector(false)  # graph input

firstItem = List.FirstItem(list=select_face)
byFaceAndUVDivisions = DividedSurface.ByFaceAndUVDivisions(elementFace=firstItem, uDivs=subdivisions, vDivs=subdivisions)
end = Revit.Transaction.Transaction.End(input=byFaceAndUVDivisions)

# group: DividedSurface.EvaluateGridNodes
evaluateGridNodes = Custom[DividedSurface.EvaluateGridNodes](dividedSurface=end, includeOverhangingNodes=include_overhanging_nodes)  # package Clockwork for Dynamo 2.x; Returns UV and XYZ coordinates as well as surface normals for all grid nodes of a given divided surface. Also returns the underlying face.
watch = Watch(evaluateGridNodes.UVs)
watch_2 = Watch(evaluateGridNodes.points)
watch_3 = Watch(evaluateGridNodes.normals)
watch_4 = Watch(evaluateGridNodes.surface)
