# Dynamo graph Revit.Elements.Element.Actions.dyn (Dynamo 2.12.1.8246)
# author: Andreas Dieckmann
# Element.Actions nodes sample graph
# packages: Clockwork for Dynamo 2.x 2.12.2

# group: INFO
# note: Run this graph on the Actions_Sample model

# group: INPUTS
copy_select_model_element = DSModelElementSelection()  # 1 picked in the model
copy_y = DoubleSlider(9.2, range=0..20 step 0.1)  # graph input
copy_rehost_to_closet_level = BoolSelector(true)  # graph input
copy_select_level = Levels("Level 2")
cut_join_select_model_element_1 = DSModelElementSelection()  # 1 picked in the model
cut_select_model_element_2 = DSModelElementSelection()  # 1 picked in the model
join_select_model_element_2 = DSModelElementSelection()  # 1 picked in the model
set_material_select_model = DSModelElementSelection()  # "Set Material: Select Model Element"; 1 picked in the model
set_material_material_parameter = StringInput("Material")  # "Set Material: Material Parameter Name"; graph input
rename_select_model_element = DSModelElementSelection()  # 1 picked in the model
rename_new_name = StringInput("RenamedByDynamo")  # graph input
mirror_select_model_element = DSModelElementSelection()  # 1 picked in the model
mirror_copy = BoolSelector(true)
move_select_model_element = DSModelElementSelection()  # 1 picked in the model
move_z = DoubleSlider(2, range=0..10 step 0.1)
settype_select_model_elements = DSModelElementsSelection()  # 2 picked in the model
settype_select_new_family_type = FamilyTypes("Eingangstür 1-flg - Glasband:1.01 x 2.135")

YAxis = Vector.YAxis()
scale = Vector.Scale(vector=YAxis, scale_factor=copy_y)

# group: Element.CopyByVector
copyByVector = Custom[Element.CopyByVector](element=copy_select_model_element, vector=scale, rehostToClosestLevel=copy_rehost_to_closet_level)  # package Clockwork for Dynamo 2.x; Copies an element or a list of elements by a given vector.
watch = Watch(copyByVector)

# group: Element.CopyToLevel
copyToLevel = Custom[Element.CopyToLevel](element=copy_select_model_element, level=copy_select_level)  # package Clockwork for Dynamo 2.x; Copies an element or a list of elements to a given level. Preserves the element's transform. PLEASE NOTE: This node only works for levels that have at least one view (e.g. floor plan) associated with them.
watch_2 = Watch(copyToLevel)

# group: Element.CutGeometry
cutGeometry = Custom[Element.CutGeometry](elementToBeCut=cut_join_select_model_element_1, cuttingElement=cut_select_model_element_2)  # package Clockwork for Dynamo 2.x; Adds a solid-solid cut for two model elements (if possible).
watch_3 = Watch(cutGeometry.success)
watch_4 = Watch(cutGeometry.elementToBeCut)
watch_5 = Watch(cutGeometry.cuttingElement)

# group: Element.JoinGeometry
joinGeometry = Custom[Element.JoinGeometry](element1=cut_join_select_model_element_1, element2=join_select_model_element_2)  # package Clockwork for Dynamo 2.x; Joins two model elements (if possible). Only works inside the project environment.
watch_6 = Watch(joinGeometry.success)
watch_7 = Watch(joinGeometry.element2)
watch_8 = Watch(joinGeometry.element1)

# group: Element.SetMaterialParameterByCategory
setMaterialParameterByCategory = Custom[Element.SetMaterialParameterByCategory](element=set_material_select_model, materialParameterName=set_material_material_parameter)  # package Clockwork for Dynamo 2.x; Sets a material parameter of a given element to <By Category>
watch_9 = Watch(setMaterialParameterByCategory.elements)
watch_10 = Watch(setMaterialParameterByCategory.success)

# group: Element.SetName
setName = Custom[Element.SetName](element=rename_select_model_element, name=rename_new_name)  # package Clockwork for Dynamo 2.x; Gets the name of a given Revit element
watch_11 = Watch(setName.element)
watch_12 = Watch(setName.success)

string = StringInput("OST_Lines")
byName = Category.ByName(name=string)
all_elements_of_category = ElementsOfCategory(Category=byName)
string_2 = StringInput("OST_OverheadLines")
byName_2 = Category.ByName(name=string_2)

# group: Element.SetSubCategory
setSubCategory = Custom[Element.SetSubCategory](elements=all_elements_of_category, subCategory=byName_2)  # package Clockwork for Dynamo 2.x; Assigns the given element(s) to the specified subcategory. The node should work for all geometry and curve elements. In some cases the GraphicsStyleType (Cut = TRUE, Projection = FALSE) needs to be specified.
watch_13 = Watch(setSubCategory.elements)
watch_14 = Watch(setSubCategory.success)

XZ = Plane.XZ()

# group: Element.Mirror
mirror = Custom[Element.Mirror](element=mirror_select_model_element, plane=XZ, copy=mirror_copy)  # package Clockwork for Dynamo 2.x; Mirrors an element about a given plane.
watch_15 = Watch(mirror)

byCoordinates = Point.ByCoordinates(z=move_z)

# group: Element.MoveToPoint
start = Revit.Transaction.Transaction.Start(input=move_select_model_element)
moveToPoint = Custom[Element.MoveToPoint](element=start, point=byCoordinates)  # package Clockwork for Dynamo 2.x; Moves a point-based element to the given location
watch_16 = Watch(moveToPoint.element)
watch_17 = Watch(moveToPoint.success)

# group: Element.SetType
setType = Custom[Element.SetType](element=settype_select_model_elements, elementType=settype_select_new_family_type)  # package Clockwork for Dynamo 2.x; Changes the type of a given element to the specified type
watch_18 = Watch(setType.element)
watch_19 = Watch(setType.success)
