# Dynamo graph Revit.Elements.Element.Query.dyn (Dynamo 2.12.1.8246)
# author: Andreas Dieckmann
# Element.Query nodes sample graph
# packages: Clockwork for Dynamo 2.x 2.12.2

string = StringInput("OST_Windows")
string_2 = StringInput("OST_Walls")
list_create = List.Create(item0=string, item1=string_2)
all_elements_of_category = Custom[All Elements Of Category+](category=list_create)  # package Clockwork for Dynamo 2.x; Gets all placed elements of a given category in the model. Unlike the OOTB node it also supports linked models and a few more special categories (e.g. Legend Components).
watch = Watch(all_elements_of_category)

# group: Element.AllInstances
allInstances = Custom[Element.AllInstances](element=watch@L2)  # package Clockwork for Dynamo 2.x; Retrieves all instances of a given element
watch_2 = Watch(allInstances)

# group: INPUTS
pick_level_for_selection = Levels("Level 1")
select_view_of_annotation = Views("Level 1")  # "Select View of Annotation Elements"
min_transparency_percentage = DoubleSlider(30, range=0..100 step 0.1)  # graph input
inserts_include_openings = BoolSelector(true)  # graph input
inserts_include_shadows = BoolSelector(true)  # graph input
inserts_include_embedded_walls = BoolSelector(true)  # graph input
inserts_include_shared_embedded = BoolSelector(true)  # "Inserts: Include Shared Embedded Inserts"; graph input
materials_return_paint_materials = BoolSelector(false)  # graph input
parameter_name = StringInput("Width")  # graph input
element_geometry_detail_level = DetailLevel("Coarse")
element_geometry_include = BoolSelector(false)  # "Element Geometry: Include Invisible Objects"; graph input
element_geometry_return_geometry = BoolSelector(false)  # "Element Geometry: Return Geometry Without Inserts"; graph input

# group: Element.AllInstancesAtLevel
allInstancesAtLevel = Custom[Element.AllInstancesAtLevel](element=watch@L2, level=pick_level_for_selection)  # package Clockwork for Dynamo 2.x; Retrieves all instances of an element on a given level
watch_3 = Watch(allInstancesAtLevel)

string_3 = StringInput("Dimension")
byName = Custom[ElementType.ByName](name=string_3)  # package Clockwork for Dynamo 2.x; Retrieves an element class by its name - to be used with the OOTB node "All Elements of Class".
all_elements_of_type = ElementsOfType(element_type=byName)
watch_4 = Watch(all_elements_of_type)

# group: Element.AllViewDependentInstances
allViewDependentInstances = Custom[Element.AllViewDependentInstances](element=watch_4, view=select_view_of_annotation)  # package Clockwork for Dynamo 2.x; Retrieves all instances of a view-dependent element in a given view
watch_5 = Watch(allViewDependentInstances)

# group: Element.ContainsTransparentMaterials
containsTransparentMaterials = Custom[Element.ContainsTransparentMaterials](element=watch@L2, minTransparencyPercentage=min_transparency_percentage)  # package Clockwork for Dynamo 2.x; Checks if a given element contains transparent materials.
watch_6 = Watch(containsTransparentMaterials)

# group: Element.ElevationOfHostLevel
elevationOfHostLevel = Custom[Element.ElevationOfHostLevel](element=watch@L2)  # package Clockwork for Dynamo 2.x; Returns the elevation of the level a given element is associated with
watch_7 = Watch(elevationOfHostLevel)

string_4 = StringInput("AssemblyCodeTable")
byName_2 = Custom[ElementType.ByName](name=string_4)
all_elements_of_type_2 = ElementsOfType(element_type=byName_2)

# group: Element.ExternalFileReferencePath
externalFileReferencePath = Custom[Element.ExternalFileReferencePath](element=all_elements_of_type_2)  # package Clockwork for Dynamo 2.x; Returns the full path of an element's external file reference as as string
watch_8 = Watch(externalFileReferencePath)

# group: Element.Host+
host = Custom[Element.Host+](element=watch@L2)  # package Clockwork for Dynamo 2.x; Gets an element's host. Unlike the OOTB node FamilyInstance.GetHost it not only works for family instances but also for elements like wall sweeps, foundations, railings, builing pads, toposolid subdivisions and toposurface subregions.
watch_9 = Watch(host)

# group: Element.ID+
ID = Custom[Element.ID+](element=watch@L2)  # package Clockwork for Dynamo 2.x; Gets the ID of a given Revit elements. Unlike the OOTB Element.Id node, this node also works on mixed lists of Revit elements and categories.
watch_10 = Watch(ID)

# group: Element.Inserts
inserts = Custom[Element.Inserts](element=watch@L2, includeOpenings=inserts_include_openings, includeShadows=inserts_include_shadows, includeEmbeddedWalls=inserts_include_embedded_walls, includeSharedEmbeddedInserts=inserts_include_shared_embedded)  # package Clockwork for Dynamo 2.x; Gets all the objects inserted in / hosted on a given element. Unlike the OOTB mode, it will also return hosted railings.
watch_11 = Watch(inserts)

# group: Element.IsRelatedToMass
isRelatedToMass = Custom[Element.IsRelatedToMass](element=watch@L2)  # package Clockwork for Dynamo 2.x; Returns true if an object (wall, roof, floor or curtain system) has been modelled by face and the underlying mass still exists in the project.
watch_12 = Watch(isRelatedToMass)

# group: Element.Level
level = Custom[Element.Level](element=watch@L2)  # package Clockwork for Dynamo 2.x; Gets an element's level
watch_13 = Watch(level)

# group: Element.Location+
location = Custom[Element.Location+](element=watch@L2)  # package Clockwork for Dynamo 2.x; Returns the location of an element as point, curve or curve loop, along with some booleans to help filtering the results. Unlike the OOTB Element.GetLocation node, it also returns sketch lines of sketch-based elements like floor slabs as well as the element's rotation property. Additionally, it supports quite a few more element types (e.g. railings, stairs etc.).
watch_14 = Watch(location.points)
watch_15 = Watch(location.isPoint)
watch_16 = Watch(location.curves)
watch_17 = Watch(location.isCurve)
watch_18 = Watch(location.hasLocation)
watch_19 = Watch(location.curveEndpoints)
watch_20 = Watch(location.hasRotation)
watch_21 = Watch(location.angle)
watch_22 = Watch(location.hasMulipleCurves)
watch_23 = Watch(location.mulipleCurves)

# group: Element.Materials+
materials = Custom[Element.Materials+](element=watch@L2, returnPaintMaterials=materials_return_paint_materials)  # package Clockwork for Dynamo 2.x; Retrieves all materials from a given element. Unlike the OOTB node Element.GetMaterials, it also retrieves QTO information.
watch_24 = Watch(materials.materials)
watch_25 = Watch(materials.hasMaterial)
watch_26 = Watch(materials.materialVolumes)
watch_27 = Watch(materials.materialAreas)

# group: Element.Name+
name = Custom[Element.Name+](element=watch@L2)  # package Clockwork for Dynamo 2.x; Gets an element's name. Unlike the OOTB node, this node should work for *all* Revit elements that have names and will also return the localized names of system parameters, parameter groups, display unit types, parameter types, unit symbol types, unit types and ForgeTypeIds.
watch_28 = Watch(name)

# group: Element.OwnerView
ownerView = Custom[Element.OwnerView](element=watch_4)  # package Clockwork for Dynamo 2.x; Gets the owner view of a given Revit element (if possible)
watch_29 = Watch(ownerView)

# group: Element.ParameterExists
parameterExists = Custom[Element.ParameterExists](param=parameter_name, element=watch@L2)  # package Clockwork for Dynamo 2.x; Checks if an element contains a parameter of a given name
watch_30 = Watch(parameterExists)

# group: Element.Phases
phases = Custom[Element.Phases](element=watch@L2)  # package Clockwork for Dynamo 2.x; Gets the created and demolished phases of an element
watch_31 = Watch(phases.Created)
watch_32 = Watch(phases.Demolished)

# group: Element.ElementType+
elementType = Custom[Element.ElementType+](element=watch@L2)  # package Clockwork for Dynamo 2.x; Gets the family type of a given element (if applicable). Unlike the OOTB node, it also works for elements in linked models.
watch_33 = Watch(elementType)

# group: Element.Geometry+
geometry = Custom[Element.Geometry+](element=watch@L2, detailLevel=element_geometry_detail_level, includeInvisibleObjects=element_geometry_include, returnGeometryWithoutInserts=element_geometry_return_geometry)  # package Clockwork for Dynamo 2.x; Returns Dynamo AND native Revit geometry of a given element
watch_34 = Watch(geometry.dynamoGeometry)
watch_35 = Watch(geometry.revitGeometry)
watch_36 = Watch(geometry.subCategory)

# group: Element.Category+
category = Custom[Element.Category+](element=watch@L2)  # package Clockwork for Dynamo 2.x; Returns the category of a given element. Unlike the OOTB node Element.GetCategory, it will work for subcategories, families, family documents, schedules, graphics styles, color fill schemes and view filters as well.
watch_37 = Watch(category.category)
watch_38 = Watch(category.builtInCategory)

string_5 = StringInput("OST_Stairs")
all_elements_of_category_2 = Custom[All Elements Of Category+](category=string_5)

# group: Element.SubComponents
watch_39 = Watch(all_elements_of_category_2)
subComponents = Custom[Element.SubComponents](element=watch_39)  # package Clockwork for Dynamo 2.x; Retrieves all subcomponents of a given element. Unlike the OOTB node Element.GetChildElements, it also supports combined geometry elements in family.
watch_40 = Watch(subComponents)

# group: Element.SuperComponent
superComponent = Custom[Element.SuperComponent](element=watch_40@@L2)  # package Clockwork for Dynamo 2.x; Retrieves the supercomponent of a given family instance, hand rail, top rail, stair component, toposurface subregion, toposolid subdivision or beam in a beam system.
watch_41 = Watch(superComponent)

byName_3 = Category.ByName(name=string_2)

# group: Element.IsOfCategory
isOfCategory = Custom[Element.IsOfCategory](element=watch@L2, category=byName_3)  # package Clockwork for Dynamo 2.x; Checks whether an element is of a specified category
watch_42 = Watch(isOfCategory)

# group: Element.DependentElements
dependentElements = Custom[Element.DependentElements](element=watch@L2)  # package Clockwork for Dynamo 2.x; Returns all elements that, from a logical point of view, are the children of this element.
watch_43 = Watch(dependentElements)
