# Dynamo graph Revit.Elements.Family.dyn (Dynamo 2.12.1.8246)
# author: Andreas Dieckmann
# Revit Family nodes sample graph
# packages: Clockwork for Dynamo 2.x 2.12.1

string = StringInput("Family")
byName = Custom[ElementType.ByName](name=string)  # package Clockwork for Dynamo 2.x; Retrieves an element class by its name - to be used with the OOTB node "All Elements of Class".
all_elements_of_type = ElementsOfType(element_type=byName)
watch = Watch(all_elements_of_type)

# group: Family.IsInPlace
isInPlace = Custom[Family.IsInPlace](family=watch)  # package Clockwork for Dynamo 2.x; Determines if a family is an in-place family
watch_2 = Watch(isInPlace)

# group: Family.PlacementType
placementType = Custom[Family.PlacementType](family=watch)  # package Clockwork for Dynamo 2.x; Returns the expected host class of a family (if any)
watch_3 = Watch(placementType)

# group: Family.HostingBehavior
hostingBehavior = Custom[Family.HostingBehavior](family=watch)  # package Clockwork for Dynamo 2.x; Returns the expected host class of a family (if any)
watch_4 = Watch(hostingBehavior)

# group: Family.HasRoomCalculationPoint
hasRoomCalculationPoint = Custom[Family.HasRoomCalculationPoint](family=watch)  # package Clockwork for Dynamo 2.x; Determines whether the given family has the room calculation point activated.
watch_5 = Watch(hasRoomCalculationPoint)

# group: Family.IsEditable
isEditable = Custom[Family.IsEditable](family=watch)  # package Clockwork for Dynamo 2.x; Determines if a family is editable
watch_6 = Watch(isEditable)

# group: Family.Types+
types = Custom[Family.Types+](family=watch)  # package Clockwork for Dynamo 2.x; Returns all family types of a family. Unlike the OOTB node, it also works with families in linked documents.
watch_7 = Watch(types)
