# Dynamo graph Revit.Elements.FamilyInstance.Actions.dyn (Dynamo 2.12.1.8246)
# author: Andreas Dieckmann
# FamilyInstance.Actions nodes sample graph
# packages: Clockwork for Dynamo 2.x 2.12.2

# group: INFO
# note: Run this graph on the Actions_Sample model

# group: INPUTS
flipfacingorientation_select = DSModelElementsSelection()  # "FlipFacingOrientation: Select Model Elements"; 2 picked in the model
fliphandorientation_select_model = DSModelElementsSelection()  # "FlipHandOrientation: Select Model Elements"; 3 picked in the model
setlevel_select_model_elements = DSModelElementsSelection()  # 2 picked in the model
setlevel_select_new_level = Levels("Level 2")
flipfromroomtoroom_select_model = DSModelElementsSelection()  # "FlipFromRoomToRoom: Select Model Elements"; 3 picked in the model
coping_select_element_for_coping = DSModelElementSelection()  # 1 picked in the model
coping_select_cutting_element = DSModelElementSelection()  # 1 picked in the model
coping_select_element_to_remove = DSModelElementSelection()  # "Coping: Select Element to Remove Coping"; 1 picked in the model

# group: FamilyInstance.FlipFacingOrientation
flipFacingOrientation = Custom[FamilyInstance.FlipFacingOrientation](familyInstance=flipfacingorientation_select)  # package Clockwork for Dynamo 2.x; Flips the facing orientation of a given family instance
watch = Watch(flipFacingOrientation.familyInstance)
watch_2 = Watch(flipFacingOrientation.success)

# group: FamilyInstance.FlipHandOrientation
flipHandOrientation = Custom[FamilyInstance.FlipHandOrientation](familyInstance=fliphandorientation_select_model)  # package Clockwork for Dynamo 2.x; Flips the hand orientation of a given family instance
watch_3 = Watch(flipHandOrientation.familyInstance)
watch_4 = Watch(flipHandOrientation.success)

# group: FamilyInstance.SetLevel
setLevel = Custom[FamilyInstance.SetLevel](familyInstance=setlevel_select_model_elements, level=setlevel_select_new_level)  # package Clockwork for Dynamo 2.x; Sets the level property of a family instance. Family instance will move accordingly.
watch_5 = Watch(setLevel.familyInstance)
watch_6 = Watch(setLevel.success)

phases = Custom[Document.Phases]()  # package Clockwork for Dynamo 2.x; Retrieves all phases in the active document in *chronological* order
lastItem = List.LastItem(list=phases)
rooms = Custom[Door.Rooms](door=flipfromroomtoroom_select_model, phase=lastItem)  # package Clockwork for Dynamo 2.x; Gets the rooms that are connected by a given door
watch_7 = Watch(rooms.fromRoom)
passthrough = Custom[Passthrough](passThrough=flipfromroomtoroom_select_model, waitFor=rooms.toRoom)  # package Clockwork for Dynamo 2.x; Forces a sequential order of execution. The node wired into the output of the Passthrough node will be executed *after* the node wired into the waitFor input (e.g. important for some Revit operations). The value of the passThrough input will be passed on to the node wired into the output port of the Passthrough node.

# group: FamilyInstance.FlipFromToRoom
watch_8 = Watch(rooms.toRoom)
flipFromToRoom = Custom[FamilyInstance.FlipFromToRoom](familyInstance=passthrough)  # package Clockwork for Dynamo 2.x; Flips the settings of "From Room" and "To Room" for any given door or window instance. PLEASE NOTE: Will not work on door or window families with an activated room calculation point.
rooms_2 = Custom[Door.Rooms](door=flipFromToRoom.familyInstance, phase=lastItem)
watch_9 = Watch(rooms_2.fromRoom)
watch_10 = Watch(rooms_2.toRoom)
watch_11 = Watch(flipFromToRoom.success)

# group: FamilyInstance.AddCoping
addCoping = Custom[FamilyInstance.AddCoping](familyInstance=coping_select_element_for_coping, cuttingElement=coping_select_cutting_element)  # package Clockwork for Dynamo 2.x; Adds a coping (cut) to a steel beam
watch_12 = Watch(addCoping.familyInstance)
watch_13 = Watch(addCoping.success)

# group: FamilyInstance.RemoveCoping
removeCoping = Custom[FamilyInstance.RemoveCoping](familyInstance=coping_select_element_to_remove, cuttingElementToBeRemoved=coping_select_cutting_element)  # package Clockwork for Dynamo 2.x; Removes a coping (cut) from a steel beam
watch_14 = Watch(removeCoping.familyInstance)
watch_15 = Watch(removeCoping.success)
