# Dynamo graph Revit.Elements.FamilyInstance.Create.dyn (Dynamo 2.12.1.8246)
# author: Andreas Dieckmann
# FamilyInstance.Create nodes sample graph
# packages: Clockwork for Dynamo 2.x 2.12.0

# group: INFO
# note: Run this graph on the CreateStuff_Sample model

# group: INPUTS
rectangle_size = DoubleSlider(2, range=0..10 step 0.1)
pick_line_based_family_type = FamilyTypes("LinebasedGenMod:LinebasedGenMod")
pick_level = Levels("Ebene 0")
pick_point_based_detail = FamilyTypes("Schnitt - KS U-Schalen:KS - U 365x240x240")  # "Pick Point-based Detail Component Type"
pick_view = Views("Ebene 0")

byWidthLength = Rectangle.ByWidthLength(width=rectangle_size, length=rectangle_size)
explode = Geometry.Explode(geometry=byWidthLength)

# group: FamilyInstance.ByCurve
byCurve = Custom[FamilyInstance.ByCurve](curve=explode, familyType=pick_line_based_family_type, level=pick_level)  # package Clockwork for Dynamo 2.x; Places a line-based family instance on a given level
watch = Watch(byCurve)

origin = Point.Origin()

# group: FamilyInstance.ByPointInView
byPointInView = Custom[FamilyInstance.ByPointInView](point=origin, familyType=pick_point_based_detail, view=pick_view)  # package Clockwork for Dynamo 2.x; Places a family instance at a given point in a given view (e.g. a detail component).
watch_2 = Watch(byPointInView)
