# Dynamo graph Revit.Elements.FamilyInstance.Query.dyn (Dynamo 2.12.1.8246)
# author: Andreas Dieckmann
# FamilyInstance.Query nodes sample graph
# packages: Clockwork for Dynamo 2.x 2.12.2

string = StringInput("FamilyInstance")
byName = Custom[ElementType.ByName](name=string)  # package Clockwork for Dynamo 2.x; Retrieves an element class by its name - to be used with the OOTB node "All Elements of Class".
all_elements_of_type = ElementsOfType(element_type=byName)
watch = Watch(all_elements_of_type)

# group: FamilyInstance.HandOrientation
handOrientation = Custom[FamilyInstance.HandOrientation](familyInstance=watch)  # package Clockwork for Dynamo 2.x; Gets the hand orientation of a hosted object (e.g. a window or a door)
watch_2 = Watch(handOrientation)

# group: FamilyInstance.CopingElements
copingElements = Custom[FamilyInstance.CopingElements](familyInstance=watch)  # package Clockwork for Dynamo 2.x; Returns all elements used as coping cutters for a given element.
watch_3 = Watch(copingElements)

# group: FamilyInstance.IsMirrored
isMirrored = Custom[FamilyInstance.IsMirrored](familyInstance=watch)  # package Clockwork for Dynamo 2.x; Checks if a family instance is mirrored
watch_4 = Watch(isMirrored)
