# Dynamo graph Revit.Elements.FillPatternElement.dyn (Dynamo 2.12.1.8246)
# author: Andreas Dieckmann
# Revit FillPatternElement nodes sample graph
# packages: Clockwork for Dynamo 2.x 2.12.0

string = StringInput("FillPatternElement")
byName = Custom[ElementType.ByName](name=string)  # package Clockwork for Dynamo 2.x; Retrieves an element class by its name - to be used with the OOTB node "All Elements of Class".
all_elements_of_type = ElementsOfType(element_type=byName)

# group: FillPatternElement.IsSolidFill
watch = Watch(all_elements_of_type)
isSolidFill = Custom[FillPatternElement.IsSolidFill](fillPatternElement=watch)  # package Clockwork for Dynamo 2.x; Checks if the given FillPatternElement is a solid fill
watch_2 = Watch(isSolidFill)
