# Dynamo graph Revit.Elements.FilledRegionType.dyn (Dynamo 2.12.1.8246)
# author: Andreas Dieckmann
# Revit FilledRegionType nodes sample graph
# packages: Clockwork for Dynamo 2.x 2.12.0

string = StringInput("FilledRegionType")
byName = Custom[ElementType.ByName](name=string)  # package Clockwork for Dynamo 2.x; Retrieves an element class by its name - to be used with the OOTB node "All Elements of Class".
all_elements_of_type = ElementsOfType(element_type=byName)

# group: FilledRegionType.FillPatterns
watch = Watch(all_elements_of_type)
fillPatterns = Custom[FilledRegionType.FillPatterns](filledRegionType=watch)  # package Clockwork for Dynamo 2.x; Returns the fill pattern(s) of a given filled region type. In Revit versions prior to 2019 the background fill pattern will always return Null.
watch_2 = Watch(fillPatterns.foregroundFillPattern)
watch_3 = Watch(fillPatterns.backgroundFillPattern)
