# Dynamo graph Revit.Elements.FootingType.dyn (Dynamo 2.12.1.8246)
# author: Andreas Dieckmann
# FootingType nodes sample graph
# packages: Clockwork for Dynamo 2.x 2.12.0

# group: INFO
# note: Run this file on the FootingType_Sample model in the extra folder.

string = StringInput("OST_StructuralFoundation")
all_family_types_of_category = Custom[All Family Types Of Category](category=string)  # package Clockwork for Dynamo 2.x; Gets all family types/symbols of a given category in the model.

# group: FootingType.BreaksAtInserts
watch = Watch(all_family_types_of_category)
breaksAtInserts = Custom[FootingType.BreaksAtInserts](footingType=watch)  # package Clockwork for Dynamo 2.x; Determines whether a list of wall footing types break at inserts in their attached walls
watch_2 = Watch(breaksAtInserts)
