# Dynamo graph Revit.Elements.Grid.dyn (Dynamo 3.0.3.7597)
# author: Andreas Dieckmann
# Revit Grid nodes sample graph
# packages: Clockwork for Dynamo 2.x 2.6.0

string = StringInput("OST_Grids")
all_elements_of_category = Custom[All Elements Of Category+](category=string)  # package Clockwork for Dynamo 2.x; Gets all placed elements of a given category in the model. Unlike the OOTB node it also supports linked models and a few more special categories (e.g. Legend Components).

# group: Grid.Plane
watch = Watch(all_elements_of_category)
plane = Custom[Grid.Plane](grid=watch)  # package Clockwork for Dynamo 2.x; Retrieves the plane of a grid. Returns null for curved grid lines.
watch_2 = Watch(plane)
