# Dynamo graph Revit.Elements.ImportInstance.dyn (Dynamo 2.12.1.8246)
# author: Andreas Dieckmann
# ImportInstance nodes sample graph
# packages: Clockwork for Dynamo 2.x 2.12.0

# group: INFO
# note: Run this graph on the RevitLinkType_Sample model

string = StringInput("ImportInstance")
byName = Custom[ElementType.ByName](name=string)  # package Clockwork for Dynamo 2.x; Retrieves an element class by its name - to be used with the OOTB node "All Elements of Class".
all_elements_of_type = ElementsOfType(element_type=byName)

# group: ImportInstance.IsLinked
watch = Watch(all_elements_of_type)
isLinked = Custom[ImportInstance.IsLinked](importInstance=watch)  # package Clockwork for Dynamo 2.x; Determines whether an ImportInstance is linked or not
watch_2 = Watch(isLinked)
