# Dynamo graph Revit.Elements.MassFloor.dyn (Dynamo 2.12.1.8246)
# author: Andreas Dieckmann
# MassFloor nodes sample graph
# packages: Clockwork for Dynamo 2.x 2.12.0

# group: INFO
# note: You can run this graph on the MassFloor_Sample file in the extra folder.

string = StringInput("OST_MassFloor")
all_elements_of_category = Custom[All Elements Of Category+](category=string)  # package Clockwork for Dynamo 2.x; Gets all placed elements of a given category in the model. Unlike the OOTB node it also supports linked models and a few more special categories (e.g. Legend Components).

# group: MassFloor.Mass
watch = Watch(all_elements_of_category)
mass = Custom[MassFloor.Mass](massFloor=watch)  # package Clockwork for Dynamo 2.x; Gets the mass a given mass floor belongs to
watch_2 = Watch(mass)
