# Dynamo graph Revit.Elements.Material.dyn (Dynamo 2.12.1.8246)
# author: Andreas Dieckmann
# Revit Material nodes sample graph
# packages: Clockwork for Dynamo 2.x 2.12.1

string = StringInput("OST_Materials")
all_elements_of_category = Custom[All Elements Of Category+](category=string)  # package Clockwork for Dynamo 2.x; Gets all placed elements of a given category in the model. Unlike the OOTB node it also supports linked models and a few more special categories (e.g. Legend Components).
firstItem = List.FirstItem(list=all_elements_of_category)

# group: INPUTS
material_name = StringInput("MyNewMaterial")  # graph input

# group: Material.Duplicate
duplicate = Custom[Material.Duplicate](material=firstItem, name=material_name)  # package Clockwork for Dynamo 2.x; Duplicates a material
watch = Watch(duplicate)

# group: Material.Assets
watch_2 = Watch(all_elements_of_category)
assets = Custom[Material.Assets](material=watch_2)  # package Clockwork for Dynamo 2.x; Retreives all assets from a given material
watch_3 = Watch(assets.AppearanceAsset)
watch_4 = Watch(assets.ThermalAsset)
watch_5 = Watch(assets.StructuralAsset)
