# Dynamo graph Revit.Elements.ParameterElement.dyn (Dynamo 2.12.1.8246)
# author: Andreas Dieckmann
# ParameterElement nodes sample graph
# packages: Clockwork for Dynamo 2.x 2.12.1

projectParameters = Custom[Document.ProjectParameters]()  # package Clockwork for Dynamo 2.x; Retrieves all project parameters and the categories they have been assigned to

# group: INPUTS
project_parameter_name = StringInput("Occupant")  # graph input

indexOf = List.IndexOf(list=projectParameters.paramName, element=project_parameter_name)
getItemAtIndex = List.GetItemAtIndex(list=projectParameters.parameterElement, index=indexOf)

# group: ParameterElement.SetAllowVaryBetweenGroups
setAllowVaryBetweenGroups = Custom[ParameterElement.SetAllowVaryBetweenGroups](parameterElement=getItemAtIndex)  # package Clockwork for Dynamo 2.x; Lets you define whether or not the values of a given project parameter can vary across group members.
watch = Watch(setAllowVaryBetweenGroups.parameterElement)
watch_2 = Watch(setAllowVaryBetweenGroups.success)
