# Dynamo graph Revit.Elements.Part.dyn (Dynamo 2.12.1.8246)
# author: Andreas Dieckmann
# Part nodes sample graph
# packages: Clockwork for Dynamo 2.x 2.12.0

# group: INFO
# note: Run this graph on the Parts_Sample file in the extra folder.

string = StringInput("OST_Parts")
all_elements_of_category = Custom[All Elements Of Category+](category=string)  # package Clockwork for Dynamo 2.x; Gets all placed elements of a given category in the model. Unlike the OOTB node it also supports linked models and a few more special categories (e.g. Legend Components).

# group: Part.SourceElement
watch = Watch(all_elements_of_category)
sourceElement = Custom[Part.SourceElement](part=watch)  # package Clockwork for Dynamo 2.x; Retrieves the element a given part was made from
watch_2 = Watch(sourceElement)
