# Dynamo graph Revit.Elements.Roof.dyn (Dynamo 3.3.0.6316)
# author: Andreas Dieckmann
# Roof nodes sample graph
# packages: Clockwork for Dynamo 2.x 2.12.2

# group: INFO
# note: Run this graph on the RoofSample file in the extra folder.

# group: INPUTS
select_roof_to_reset = DSModelElementSelection()  # 1 picked in the model
select_face_for_subdivisions = DSFaceSelection()  # 1 picked in the model
subdivisions = IntegerSlider(11, range=0..20 step 1)  # graph input
select_roof_to_modify = DSModelElementSelection()  # 1 picked in the model

# group: Element.ResetSlabShape
resetSlabShape = Custom[Element.ResetSlabShape](element=select_roof_to_reset)  # package Clockwork for Dynamo 2.x; Resets the slabshape of a roof, floor slab or toposolid
watch = Watch(resetSlabShape.element)
watch_2 = Watch(resetSlabShape.success)

firstItem = List.FirstItem(list=select_face_for_subdivisions)
fromFace = Custom[Grid.FromFace](surface=firstItem, U=subdivisions, V=subdivisions)  # package Clockwork for Dynamo 2.x; Returns UV coordinates, XYZ coordinates and normals for a face with UV subdivision

# group: Element.SlabShapeByPoints
watch_3 = Watch(fromFace.Points)
slabShapeByPoints = Custom[Element.SlabShapeByPoints](points=watch_3, element=select_roof_to_modify)  # package Clockwork for Dynamo 2.x; Transform the slab shape of a roof, floor slab or toposolid based on a list of Points.
watch_4 = Watch(slabShapeByPoints.roof)
watch_5 = Watch(slabShapeByPoints.success)

join = List.Join(list0=watch, list1=slabShapeByPoints.roof)

# group: Element.SlabShapeHasBeenModified
watch_6 = Watch(join)
slabShapeHasBeenModified = Custom[Element.SlabShapeHasBeenModified](element=watch_6)  # package Clockwork for Dynamo 2.x; Checks if the shape of a roof, floor slab or toposolid has been modified with the shape editing tools
watch_7 = Watch(slabShapeHasBeenModified)

string = StringInput("OST_Roofs")
all_elements_of_category = Custom[All Elements Of Category+](category=string)  # package Clockwork for Dynamo 2.x; Gets all placed elements of a given category in the model. Unlike the OOTB node it also supports linked models and a few more special categories (e.g. Legend Components).
watch_8 = Watch(all_elements_of_category)

# group: Roof.Kind
kind = Custom[Roof.Kind](roof=watch_8)  # package Clockwork for Dynamo 2.x; Retrieves the roof kind (Basic, Glazed, Other). PLEASE NOTE: Roofs that were created by face will be identified as 'Other'
watch_9 = Watch(kind)

# group: Roof.CreationMethod
creationMethod = Custom[Roof.CreationMethod](roof=watch_8)  # package Clockwork for Dynamo 2.x; Retrieves the creation method of a given roof
watch_10 = Watch(creationMethod)
