# Dynamo graph Revit.Elements.RoomTag.dyn (Dynamo 3.3.0.6316)
# author: Andreas Dieckmann
# RoomTag nodes sample graph
# packages: Clockwork for Dynamo 2.x 2.12.2

string = StringInput("OST_RoomTags")
byName = Category.ByName(name=string)
all_elements_of_category = ElementsOfCategory(Category=byName)
watch = Watch(all_elements_of_category)

# group: RoomTag.Room
room = Custom[RoomTag.Room](roomTag=watch)  # package Clockwork for Dynamo 2.x; Returns the room of a given room tag
watch_2 = Watch(room)

# group: RoomTag.IsInRoom
isInRoom = Custom[RoomTag.IsInRoom](roomTag=watch)  # package Clockwork for Dynamo 2.x; Checks if a room tag is located within the boundaries of the room it is tagging
watch_3 = Watch(isInRoom)
