# Dynamo graph Revit.Elements.Schema.dyn (Dynamo 2.12.1.8246)
# author: Andreas Dieckmann
# Schema nodes sample graph
# packages: Clockwork for Dynamo 2.x 2.12.1

# group: Document.Schemas
schemas = Custom[Document.Schemas]()  # package Clockwork for Dynamo 2.x; Retrieves all ExtensibleStorage Schemas from the current document
watch = Watch(schemas)

# group: Schema.Properties
properties = Custom[Schema.Properties](schema=watch)  # package Clockwork for Dynamo 2.x; Retrieves all properties of a given ExtensibleStorage Schema
watch_2 = Watch(properties.name)
watch_3 = Watch(properties.vendorID)
watch_4 = Watch(properties.writeAccessLevel)
watch_5 = Watch(properties.documentation)
watch_6 = Watch(properties.applicationGUID)
watch_7 = Watch(properties.readAccessLevel)
watch_8 = Watch(properties.GUID)

# group: Schema.Fields
fields = Custom[Schema.Fields](schema=watch)  # package Clockwork for Dynamo 2.x; Returns the fields of a given ExtensibleStorage Schema
watch_9 = Watch(fields)

# group: SchemaField.Properties
properties_2 = Custom[SchemaField.Properties](schemaField=watch_9@L2)  # package Clockwork for Dynamo 2.x; Retrieves the properties of a given ExtensibleStorage schema field
watch_10 = Watch(properties_2.name)
watch_11 = Watch(properties_2.documentation)
watch_12 = Watch(properties_2.containerType)
watch_13 = Watch(properties_2.subSchema)
watch_14 = Watch(properties_2.subSchemaGUID)
watch_15 = Watch(properties_2.valueType)
watch_16 = Watch(properties_2.unitType)

# group: INPUTS
pick_element_type_for = ElementTypes("ProjectInfo")  # "Pick Element Type for ExtensibleStorage Investigation"

lastItem = List.LastItem(list=properties.GUID)
all_elements_of_type = Custom[All Elements of Type+](elementType=pick_element_type_for, schemaGUID=lastItem)  # package Clockwork for Dynamo 2.x; Gets all placed elements of a given element class in the model. Unlike the OOTB node, it supports collecting from linked models and has a (optional) SchemaGUID filter.
lastItem_2 = List.LastItem(list=watch)

# group: Element.ExtensibleStorageData
extensibleStorageData = Custom[Element.ExtensibleStorageData](element=all_elements_of_type, schema=lastItem_2)  # package Clockwork for Dynamo 2.x; Reads the extensible storage data of a given schema from an element
watch_17 = Watch(extensibleStorageData.data)
watch_18 = Watch(extensibleStorageData.fields)
