# Dynamo graph Revit.Elements.SpotElevation.dyn (Dynamo 2.12.1.8246)
# author: Andreas Dieckmann
# SpotElevation nodes sample graph
# packages: Clockwork for Dynamo 2.x 2.12.0

# group: INFO
# note: Run this graph on the CreateStuff_Sample.rvt file

origin = Point.Origin()
views = Views("Ebene 0")
XAxis = Vector.XAxis()

# group: SpotElevation.ByPoint
byPoint = Custom[SpotElevation.ByPoint](point=origin, view=views, bend=XAxis, end=XAxis)  # package Clockwork for Dynamo 2.x; Places a spot elevation at a given point in a given view. May not work in all view types.
watch = Watch(byPoint)
