# Dynamo graph Revit.Elements.Topography.dyn (Dynamo 3.2.1.5366)
# author: Andreas Dieckmann
# Topoography nodes sample graph
# packages: Clockwork for Dynamo 2.x 2.6.0

origin = Point.Origin()
XAxis = Vector.XAxis()
byOriginNormal = Plane.ByOriginNormal(origin=origin, normal=XAxis)
string = StringInput("OST_Topography")
all_elements_of_category = Custom[All Elements Of Category+](category=string)  # package Clockwork for Dynamo 2.x; Gets all placed elements of a given category in the model. Unlike the OOTB node it also supports linked models and a few more special categories (e.g. Legend Components).
watch = Watch(all_elements_of_category)
firstItem = List.FirstItem(list=watch)

# group: Topography.IntersectionWithPlane
intersectionWithPlane = Custom[Topography.IntersectionWithPlane](plane=byOriginNormal, topo=firstItem)  # package Clockwork for Dynamo 2.x; Calculates the intersection of a toposurface and a plane
watch_2 = Watch(intersectionWithPlane.points)
watch_3 = Watch(intersectionWithPlane.nurbsCurveByPoints)
watch_4 = Watch(intersectionWithPlane.nurbsCurveByControlPoints)
watch_5 = Watch(intersectionWithPlane.polyCurve)

byCurve = ModelCurve.ByCurve(curve=watch_3)
byCurve_2 = ModelCurve.ByCurve(curve=watch_4)
