# Dynamo graph Revit.Elements.Wall.Query.dyn (Dynamo 2.12.1.8246)
# author: Andreas Dieckmann
# Wall.Query nodes sample graph
# packages: Clockwork for Dynamo 2.x 2.12.1

string = StringInput("OST_Walls")
all_elements_of_category = Custom[All Elements Of Category+](category=string)  # package Clockwork for Dynamo 2.x; Gets all placed elements of a given category in the model. Unlike the OOTB node it also supports linked models and a few more special categories (e.g. Legend Components).
watch = Watch(all_elements_of_category)

# group: Wall.CreationMethod
creationMethod = Custom[Wall.CreationMethod](wall=watch)  # package Clockwork for Dynamo 2.x; Retrieves the creation method of a given wall
watch_2 = Watch(creationMethod)

# group: Wall.Orientation
orientation = Custom[Wall.Orientation](wall=watch)  # package Clockwork for Dynamo 2.x; Gets the orientation of a given wall instance (normal of the exterior face of the wall). Will *not* work for walls hosted on mass faces or in-place walls.
watch_3 = Watch(orientation)
