# Dynamo graph Revit.Selection.dyn (Dynamo 3.3.0.6316)
# author: Andreas Dieckmann
# Selection nodes sample graph
# packages: Clockwork for Dynamo 2.x 2.12.2

string = StringInput("OST_Doors")
code_block = CodeBlock { 1; }
byCoordinates = Point.ByCoordinates(z=code_block)
XAxis = Vector.XAxis()

# group: INPUTS
toggle = BoolSelector(false)  # graph input
select_view_for_annotation = Views("Level 1")  # "Select View for Annotation Elements"
select_face = DSFaceSelection()  # 1 picked in the model
select_family_type = FamilyTypes("Bar Chair:Bar Chair")
parameter_name = StringInput("Base Offset")  # graph input
filter_condition = DoubleInput(-500)
element_name_search_term = StringInput("Entrance")
ignore_case = BoolSelector(true)  # graph input
category_parameter_search_term = StringInput("wall")  # graph input
select_element_in_room = DSModelElementSelection()  # 1 picked in the model
phase_name = StringInput("Working Drawings")  # graph input
selectionset_name = StringInput("My awesome SelectionSet generated by Dynamo")
select_model_elements_for = DSModelElementsSelection()  # "Select Model Elements for SelectionSet"; 127 picked in the model
elementType = StringInput("WallType")

# group: All Intersecting Elements Of Category By Vector
all_intersecting_elements_of = Custom[All Intersecting Elements Of Category By Vector](category=string, origin=byCoordinates, direction=XAxis, toggle=toggle)  # package Clockwork for Dynamo 2.x; Finds all elements of a specified category that intersect with a list of vectors
watch = Watch(all_intersecting_elements_of)

string_2 = StringInput("OST_Furniture")

# group: All Families Of Category
all_families_of_category = Custom[All Families Of Category](category=string_2, toggle=toggle)  # package Clockwork for Dynamo 2.x; Gets all famiies of a given category in the model (does *not *work for system families)
watch_2 = Watch(all_families_of_category)

# group: All Family Types Of Category
all_family_types_of_category = Custom[All Family Types Of Category](category=string_2, toggle=toggle)  # package Clockwork for Dynamo 2.x; Gets all family types/symbols of a given category in the model.
watch_3 = Watch(all_family_types_of_category)

string_3 = StringInput("OST_Dimensions")

# group: All View-Dependent Family Instances Of Category
all_view_dependent_family = Custom[All View-Dependent Family Instances Of Category](category=string_3, view=select_view_for_annotation)  # package Clockwork for Dynamo 2.x; Gets all view-dependent family instances in a given view for a given list of categories - useful for finding annotation elements
watch_4 = Watch(all_view_dependent_family)

watch_5 = Watch(select_face)

# group: Element.FromDynamoSurface
fromDynamoSurface = Custom[Element.FromDynamoSurface](DynamoSurface=watch_5)  # package Clockwork for Dynamo 2.x; Returns the underlying Revit element of a given face
watch_6 = Watch(fromDynamoSurface)

# group: RevitFace.FromDynamoSurface
fromDynamoSurface_2 = Custom[RevitFace.FromDynamoSurface](DynamoSurface=watch_5)  # package Clockwork for Dynamo 2.x; Returns the underlying Revit face of a given surface
watch_7 = Watch(fromDynamoSurface_2)

# group: RevitFaceReference.FromDynamoSurface
fromDynamoSurface_3 = Custom[RevitFaceReference.FromDynamoSurface](DynamoSurface=watch_5)  # package Clockwork for Dynamo 2.x; Returns the underlying Revit face reference of a given surface
watch_8 = Watch(fromDynamoSurface_3.RevitFaceReference)
watch_9 = Watch(fromDynamoSurface_3.StableRepresentation)

# group: All Elements of Family Type+
all_elements_of_family_type = Custom[All Elements of Family Type+](familyType=select_family_type, toggle=toggle)  # package Clockwork for Dynamo 2.x; Retrieves all placed instances of a given family type. Unlike the OOTB node, this node also supports family types of system families, group types, assembly types and collecting from linked models.
watch_10 = Watch(all_elements_of_family_type)

# group: All Placed Family Types of Category
all_placed_family_types_of = Custom[All Placed Family Types of Category](category=string)  # package Clockwork for Dynamo 2.x; Retrieves all family types of a given category that have *placed* instances
watch_11 = Watch(all_placed_family_types_of)

# group: All Elements Of Category+
all_elements_of_category = Custom[All Elements Of Category+](category=string)  # package Clockwork for Dynamo 2.x; Gets all placed elements of a given category in the model. Unlike the OOTB node it also supports linked models and a few more special categories (e.g. Legend Components).
watch_12 = Watch(all_elements_of_category)

lt = _ < filter_condition  # unwired: x

# group: Elements.FilterByParameterValueAndCondition
filterByParameterValueAndCondition = Custom[Elements.FilterByParameterValueAndCondition](elements=watch_12, param=parameter_name, func=lt)  # package Clockwork for Dynamo 2.x; Retrieves those elements from a collection whose parameter value matches the defined condition
watch_13 = Watch(filterByParameterValueAndCondition.out)
watch_14 = Watch(filterByParameterValueAndCondition.in)

# group: Elements.FilterByName
filterByName = Custom[Elements.FilterByName](elements=watch_12, searchString=element_name_search_term, ignoreCase=ignore_case)  # package Clockwork for Dynamo 2.x; Retrieves those elements from a collection whose names match the search string
watch_15 = Watch(filterByName.out)
watch_16 = Watch(filterByName.in)
watch_17 = Watch(filterByName.first)

uniqueId = Element.UniqueId(element=watch_12)
id = Element.Id(element=watch_12)
list_create = List.Create(item0=uniqueId, item1=id)

# group: Element.ByID
watch_18 = Watch(list_create)
byID = Custom[Element.ByID](IdOrUniqueId=watch_18@L2)  # package Clockwork for Dynamo 2.x; Gets the Revit element(s) for a list of IDs (or a single ID). Unlike the OOTB node, it supports elements from linked models as well.
watch_19 = Watch(byID)

# group: BuiltInCategory.ByName
byName = Custom[BuiltInCategory.ByName](searchFor=category_parameter_search_term, ignoreCase=ignore_case)  # package Clockwork for Dynamo 2.x; Looks up all the built-in categories based on a given name (or part of a name) of the category. Search is case-insensitive.
watch_20 = Watch(byName.BuiltInCategories)
watch_21 = Watch(byName.ElementIDs)
watch_22 = Watch(byName.Categories)

# group: BuiltInParameter.ByName
byName_2 = Custom[BuiltInParameter.ByName](searchFor=category_parameter_search_term, ignoreCase=ignore_case)  # package Clockwork for Dynamo 2.x; Looks up all the built-in parameters based on a given name (or part of a name) of the parameters. Search is case-insensitive.
watch_23 = Watch(byName_2.BuiltInParameters)
watch_24 = Watch(byName_2.ElementIDs)
watch_25 = Watch(byName_2.ParameterNames)

geometry = Element.Geometry(element=select_element_in_room)
centroid = Solid.Centroid(solid=geometry)
phases = Custom[Document.Phases]()  # package Clockwork for Dynamo 2.x; Retrieves all phases in the active document in *chronological* order
filterByName_2 = Custom[Elements.FilterByName](elements=phases, searchString=phase_name)

# group: Room.AtPointInPhase
atPointInPhase = Custom[Room.AtPointInPhase](point=centroid, phase=filterByName_2.first)  # package Clockwork for Dynamo 2.x; Tries to retrieve a room element at the given location for the given phase.
watch_26 = Watch(atPointInPhase)

# group: SelectionSet.ByElements
byElements = Custom[SelectionSet.ByElements](name=selectionset_name, elements=select_model_elements_for)  # package Clockwork for Dynamo 2.x; Creates a selection set of the given elements. Note that if a selection set of the given name already exists in the model, its contents will be replaced. Also, if the selection set is already applied as a view filter, the view filter will have to be manually updated in the visibility / graphic overrides. DO ***NOT*** USE IN AUTOMATIC MODE!
watch_27 = Watch(byElements)

# group: SelectionSet.Elements
elements = Custom[SelectionSet.Elements](selectionSet=watch_27)  # package Clockwork for Dynamo 2.x; Retrieves all elements stored in a selection set
watch_28 = Watch(elements)

# group: ElementType.ByName
byName_3 = Custom[ElementType.ByName](name=elementType)  # package Clockwork for Dynamo 2.x; Retrieves an element class by its name - to be used with the OOTB node "All Elements of Class".
watch_29 = Watch(byName_3)

# group: All Elements of Class+
all_elements_of_class = Custom[All Elements of Class+](elementType=watch_29)  # package Clockwork for Dynamo 2.x; Gets all placed elements of a given element class in the model. Unlike the OOTB node, it supports collecting from linked models and has a (optional) SchemaGUID filter.
watch_30 = Watch(all_elements_of_class)

string_4 = StringInput("OST_Walls")
byName_4 = Category.ByName(name=string_4)

# group: All Intersecting Elements Of Category By BoundingBox
all_intersecting_elements_of_2 = Custom[All Intersecting Elements Of Category By BoundingBox](element=watch_12, category=byName_4)  # package Clockwork for Dynamo 2.x; Finds all elements that intersect the bounding box of a given element
watch_31 = Watch(all_intersecting_elements_of_2)
