# Dynamo graph Revit.Units.dyn (Dynamo 2.12.1.8246)
# author: Andreas Dieckmann
# Units nodes sample graph
# packages: Clockwork for Dynamo 2.x 2.12.2

# group: INPUTS
value = DoubleSlider(35.9, range=0..100 step 0.1)  # graph input

# group: Document.UnitTypes
unitTypes = Custom[Document.UnitTypes]()  # package Clockwork for Dynamo 2.x; Retrieves all available unit types of a given document (as of Revit 2022: ForgeTypeIds)
watch = Watch(unitTypes.unitTypes)
name = Custom[Element.Name+](element=watch)  # package Clockwork for Dynamo 2.x; Gets an element's name. Unlike the OOTB node, this node should work for *all* Revit elements that have names and will also return the localized names of system parameters, parameter groups, display unit types, parameter types, unit symbol types, unit types and ForgeTypeIds.
watch_2 = Watch(name)
watch_3 = Watch(unitTypes.str)

# group: UnitType.DisplayUnitType
displayUnitType = Custom[UnitType.DisplayUnitType](unitType=watch)  # package Clockwork for Dynamo 2.x; Retrieves the display unit type for a given unit type.
watch_4 = Watch(displayUnitType.displayUnitType)
watch_5 = Watch(displayUnitType.unitSymbol)

# group: DisplayUnit.ToInternalUnit
toInternalUnit = Custom[DisplayUnit.ToInternalUnit](val=value, displayUnitType=watch_4)  # package Clockwork for Dynamo 2.x; Converts a value from a given display unit to Revit's internal unit
watch_6 = Watch(toInternalUnit)

# group: InternalUnit.ToDisplayUnit
toDisplayUnit = Custom[InternalUnit.ToDisplayUnit](val=value, displayUnitType=watch_4)  # package Clockwork for Dynamo 2.x; Converts a value from Revit's internal unit to a given display unit
watch_7 = Watch(toDisplayUnit)
