# Dynamo graph Revit.Views.PerspectiveView.dyn (Dynamo 2.12.1.8246)
# author: Andreas Dieckmann
# PerspectiveView nodes sample graph
# packages: Clockwork for Dynamo 2.x 2.12.1

# group: INFO
# note: You can use the Sample Architecture Project (Basic) that ships with Revit to run this graph.

# group: INPUTS
pick_perspective_view = Views("Solar Analysis")
eye_x = DoubleSlider(66.55577629, range=0..100 step 0.1)  # graph input
eye_y = DoubleSlider(84.97932586, range=0..100 step 0.1)  # graph input
eye_z = DoubleSlider(49.20263595, range=0..100 step 0.1)  # graph input

byCoordinates = Point.ByCoordinates(x=eye_x, y=eye_y, z=eye_z)
origin = Point.Origin()

# group: PerspectiveView.OrientToEyeAndTargetPosition
orientToEyeAndTargetPosition = Custom[PerspectiveView.OrientToEyeAndTargetPosition](view=pick_perspective_view, eyePosition=byCoordinates, targetPosition=origin)  # package Clockwork for Dynamo 2.x; Sets the orientation of a given perspective view based on a given eye and target position. View needs to be in an unlocked state.
watch = Watch(orientToEyeAndTargetPosition.view)
watch_2 = Watch(orientToEyeAndTargetPosition.success)
