# Dynamo graph Revit.Views.Schedule.dyn (Dynamo 2.12.1.8246)
# author: Andreas Dieckmann
# Schedule nodes sample graph
# packages: Clockwork for Dynamo 2.x 2.12.2

string = StringInput("ViewSchedule")
byName = Custom[ElementType.ByName](name=string)  # package Clockwork for Dynamo 2.x; Retrieves an element class by its name - to be used with the OOTB node "All Elements of Class".
all_elements_of_type = ElementsOfType(element_type=byName)
watch = Watch(all_elements_of_type)

# group: Schedule.KeyScheduleParameterName
keyScheduleParameterName = Custom[Schedule.KeyScheduleParameterName](schedule=watch)  # package Clockwork for Dynamo 2.x; If the schedule is a key schedule, the node returns the name of the key schedule parameter.
watch_2 = Watch(keyScheduleParameterName)

# group: Schedule.Fields
fields = Custom[Schedule.Fields](schedule=watch)  # package Clockwork for Dynamo 2.x; Returns all fields of a schedule in the order in which they appear in the schedule. Unlike the OOTB node, it returns actual ScheduleField objects that can be further queried.
watch_3 = Watch(fields)

# group: ScheduleField.Type
type = Custom[ScheduleField.Type](scheduleField=watch_3@L2)  # package Clockwork for Dynamo 2.x; Returns the FieldType of a given ScheduleField
watch_4 = Watch(type)

# group: ScheduleField.Parameter
parameter = Custom[ScheduleField.Parameter](scheduleField=watch_3@L2)  # package Clockwork for Dynamo 2.x; Retrieves the parameter associated with a given schedule field
watch_5 = Watch(parameter)
