# Dynamo graph Revit.Views.Sheet.dyn (Dynamo 3.2.1.5366)
# author: Andreas Dieckmann
# Sheet nodes sample graph
# packages: Clockwork for Dynamo 2.x 2.6.0

string = StringInput("OST_Sheets")
all_elements_of_category = Custom[All Elements Of Category+](category=string)  # package Clockwork for Dynamo 2.x; Gets all placed elements of a given category in the model. Unlike the OOTB node it also supports linked models and a few more special categories (e.g. Legend Components).
watch = Watch(all_elements_of_category)

# group: Sheet.Schedules
schedules = Custom[Sheet.Schedules](sheet=watch)  # package Clockwork for Dynamo 2.x; Returns all schedules placed on a specified sheet ATTENTION: This node will be deprecated in 2024. As of Revit 2022, please switch to the OOTB node of the same name.
watch_2 = Watch(schedules)

code_block = CodeBlock { 1..3; }
string_from_object = FromObject(obj=code_block)
string_2 = StringInput("""A
B
C""")  # graph input
string_3 = StringInput("\n")  # graph input
split = String.Split(string=string_2, separator0=string_3)

# group: Sheet.PlaceholderByNumberAndName
placeholderByNumberAndName = Custom[Sheet.PlaceholderByNumberAndName](sheetNumber=string_from_object, sheetName=split)  # package Clockwork for Dynamo 2.x; Creates placeholder sheets
watch_3 = Watch(placeholderByNumberAndName)

# group: Sheet.Scale
scale = Custom[Sheet.Scale](sheet=watch)  # package Clockwork for Dynamo 2.x; Returns the scale of a given sheet
watch_4 = Watch(scale)
