# Dynamo graph Revit.Views.View.Actions.dyn (Dynamo 3.2.1.5366)
# author: Andreas Dieckmann
# View.Actions nodes sample graph
# packages: Clockwork for Dynamo 2.x 2.6.0

# group: INFO
# note: Run this graph on top of the Actions_Sample model.

# group: INPUTS
select_view_for_solar_study = Views("Site Section")
frame_number_for_solar_study = IntegerSlider(10, range=5..30 step 1)
select_view_for_phases = Views("Override")
select_view_for_duplication_etc = Views("Level 1")
select_view_2_with_temporarily = Views()  # "Select View 2 with Temporarily Hidden/Isolated Elements"; nothing selected
select_view_1_with_temporarily = Views()  # "Select View 1 with Temporarily Hidden/Isolated Elements"; nothing selected
select_view_for_design_options = Views("DesignOptions")
cropbox_size = IntegerSlider(500, range=100..1000 step 5)
detail_level_for_duplication = DetailLevel("Fine")
select_model_element_for = DSModelElementSelection()  # "Select Model Element for Transparency Override"; 1 picked in the model
select_view_for_element = Views("Level 2")  # "Select View for Element Overrides"
transparency = IntegerSlider(50, range=0..100 step 1)  # graph input
select_model_element_for_2 = DSModelElementSelection()  # "Select Model Element for Override Reset"; 1 picked in the model
select_view_for_permanently = Views("Isolate Element")  # "Select View for Permanently Isolating Element"
select_model_element_for_3 = DSModelElementSelection()  # "Select Model Element for Isolation"; 1 picked in the model
select_view_for_temporarily = Views("Isolate Element Temp")  # "Select View for Temporarily Isolating Element"
select_view_for_permanently_2 = Views("Isolate Category")  # "Select View for Permanently Isolating Category"
select_view_for_temporarily_2 = Views("Isolate Category Temp")  # "Select View for Temporarily Isolating Category"

# group: View.SetSolarStudyActiveFrameNumber
setSolarStudyActiveFrameNumber = Custom[View.SetSolarStudyActiveFrameNumber](view=select_view_for_solar_study, frameNumber=frame_number_for_solar_study)  # package Clockwork for Dynamo 2.x; Sets the active frame number of the solar study in a given view
watch = Watch(setSolarStudyActiveFrameNumber.success)
watch_2 = Watch(setSolarStudyActiveFrameNumber.view)

phases = Custom[Document.Phases]()  # package Clockwork for Dynamo 2.x; Retrieves all phases in the active document in *chronological* order
firstItem = List.FirstItem(list=phases)

# group: View.SetPhase
setPhase = Custom[View.SetPhase](view=select_view_for_phases, phase=firstItem)  # package Clockwork for Dynamo 2.x; Sets the phase of a given view
watch_3 = Watch(setPhase.success)
watch_4 = Watch(setPhase.view)

name = Custom[Element.Name+](element=select_view_for_duplication_etc)  # package Clockwork for Dynamo 2.x; Gets an element's name. Unlike the OOTB node, this node should work for *all* Revit elements that have names and will also return the localized names of system parameters, parameter groups, display unit types, parameter types, unit symbol types, unit types and ForgeTypeIds.
code_block = CodeBlock(name=name) { name + "_Duplicated"; name + "_DuplicatedAsDependent"; name + "_DuplicatedWithDetailing"; }

# group: View.Duplicate
duplicate = Custom[View.Duplicate](view=select_view_for_duplication_etc, name=code_block.out0)  # package Clockwork for Dynamo 2.x; Duplicates a given view
watch_5 = Watch(duplicate)

# group: View.DuplicateAsDependent
duplicateAsDependent = Custom[View.DuplicateAsDependent](view=select_view_for_duplication_etc, name=code_block.out1)  # package Clockwork for Dynamo 2.x; Duplicates a given view as a dependent view
watch_6 = Watch(duplicateAsDependent)

# group: View.DisableTemporaryHideIsolate
disableTemporaryHideIsolate = Custom[View.DisableTemporaryHideIsolate](view=select_view_2_with_temporarily)  # package Clockwork for Dynamo 2.x; Disables the temporary hide/isolate for the given view (if set)
watch_7 = Watch(disableTemporaryHideIsolate.view)
watch_8 = Watch(disableTemporaryHideIsolate.success)

# group: View.ConvertTemporaryHideIsolateToPermanent
convertTemporaryHideIsolateToPermanent = Custom[View.ConvertTemporaryHideIsolateToPermanent](view=select_view_1_with_temporarily)  # package Clockwork for Dynamo 2.x; Convert all temporary hidden elements or categories to permanently hidden in the given view.
watch_9 = Watch(convertTemporaryHideIsolateToPermanent.view)
watch_10 = Watch(convertTemporaryHideIsolateToPermanent.success)

designOptions = Custom[Document.DesignOptions]()  # package Clockwork for Dynamo 2.x; Returns all design options in the model, grouped by design option set
flatten = List.Flatten(list=designOptions.DesignOptions)
lastItem = List.LastItem(list=flatten)

# group: View.SetDesignOption
setDesignOption = Custom[View.SetDesignOption](view=select_view_for_design_options, designOption=lastItem)  # package Clockwork for Dynamo 2.x; Sets the view to a given design option. PLEASE NOTE: This node is kind of hacky. It does not use the design option settings in the visibility / graphic overrides. Instead it sets the view property "Visible in Option" to *one* specific design option - which also means that the symbolic representation of this view is only visible in views that display the given design options.
watch_11 = Watch(setDesignOption.view)
watch_12 = Watch(setDesignOption.success)

# group: View.ResizeCropBox
resizeCropBox = Custom[View.ResizeCropBox](amt=cropbox_size, view=select_view_for_duplication_etc)  # package Clockwork for Dynamo 2.x; Resizes the bounding box of a given Revit element by the specified amount in X, Y and Z direction. May need to be used in conjunction with a Transaction node.
watch_13 = Watch(resizeCropBox.view)
watch_14 = Watch(resizeCropBox.success)

# group: View.DuplicateWithDetailing
duplicateWithDetailing = Custom[View.DuplicateWithDetailing](view=select_view_for_duplication_etc, name=code_block.out2)  # package Clockwork for Dynamo 2.x; Duplicates a given view with detailing
watch_15 = Watch(duplicateWithDetailing)

# group: View.SetDetailLevel
setDetailLevel = Custom[View.SetDetailLevel](view=watch_15, detailLevel=detail_level_for_duplication)  # package Clockwork for Dynamo 2.x; Sets the detail level of a given view
watch_16 = Watch(setDetailLevel.view)
watch_17 = Watch(setDetailLevel.success)

# group: View.OverrideElementTransparency
overrideElementTransparency = Custom[View.OverrideElementTransparency](element=select_model_element_for, view=select_view_for_element, transparencyPercentage=transparency)  # package Clockwork for Dynamo 2.x; Overrides the transparency of an element in a given view
watch_18 = Watch(overrideElementTransparency.element)
watch_19 = Watch(overrideElementTransparency.view)
watch_20 = Watch(overrideElementTransparency.success)

# group: View.ResetElementOverrides
resetElementOverrides = Custom[View.ResetElementOverrides](element=select_model_element_for_2, view=select_view_for_element)  # package Clockwork for Dynamo 2.x; Resets all overrides for an element in a given view
watch_21 = Watch(resetElementOverrides.element)
watch_22 = Watch(resetElementOverrides.view)
watch_23 = Watch(resetElementOverrides.success)

# group: View.PermanentlyIsolateElement
permanentlyIsolateElement = Custom[View.PermanentlyIsolateElement](view=select_view_for_permanently, element=select_model_element_for_3)  # package Clockwork for Dynamo 2.x; Permanently isolates elements in the given view
watch_24 = Watch(permanentlyIsolateElement.view)
watch_25 = Watch(permanentlyIsolateElement.element)
watch_26 = Watch(permanentlyIsolateElement.success)

# group: View.TemporarilyIsolateElement
temporarilyIsolateElement = Custom[View.TemporarilyIsolateElement](view=select_view_for_temporarily, element=select_model_element_for_3)  # package Clockwork for Dynamo 2.x; Temporarily isolates elements in the given view. ATTENTION: This node will be deprecated in 2024. As of Revit 2022, please switch to the OOTB node View.IsolateElementsTemporary.
watch_27 = Watch(temporarilyIsolateElement.view)
watch_28 = Watch(temporarilyIsolateElement.element)
watch_29 = Watch(temporarilyIsolateElement.success)

string = StringInput("OST_Walls")

# group: View.PermanentlyIsolateCategory
permanentlyIsolateCategory = Custom[View.PermanentlyIsolateCategory](view=select_view_for_permanently_2, category=string)  # package Clockwork for Dynamo 2.x; Permanently isolates categories in the given view
watch_30 = Watch(permanentlyIsolateCategory.category)
watch_31 = Watch(permanentlyIsolateCategory.view)
watch_32 = Watch(permanentlyIsolateCategory.success)

# group: View.TemporarilyIsolateCategory
temporarilyIsolateCategory = Custom[View.TemporarilyIsolateCategory](view=select_view_for_temporarily_2, category=string)  # package Clockwork for Dynamo 2.x; Temporarily isolates categories in the given view. ATTENTION: This node will be deprecated in 2024. As of Revit 2022, please switch to the OOTB node View.IsolateCategoriesTemporary.
watch_33 = Watch(temporarilyIsolateCategory.category)
watch_34 = Watch(temporarilyIsolateCategory.view)
watch_35 = Watch(temporarilyIsolateCategory.success)

views = Custom[Document.Views]()  # package Clockwork for Dynamo 2.x; Gets all views in the document - except for 3D view templates (as long as this bug is not fixed: https://github.com/DynamoDS/Dynamo/issues/2970)
dependentViews = Custom[View.DependentViews](view=views)  # package Clockwork for Dynamo 2.x; Returns all dependent views of a given view
flatten_2 = List.Flatten(list=dependentViews)

# group: View.ConvertToIndependent
watch_36 = Watch(flatten_2)
convertToIndependent = Custom[View.ConvertToIndependent](view=watch_36)  # package Clockwork for Dynamo 2.x; Converts a given dependent view to an independent view
watch_37 = Watch(convertToIndependent.view)
watch_38 = Watch(convertToIndependent.success)
