# Dynamo graph Revit.Views.View.Query.dyn (Dynamo 3.2.1.5366)
# author: Andreas Dieckmann
# View.Query nodes sample graph
# packages: Clockwork for Dynamo 2.x 2.6.0

# group: INPUTS
pick_category = Categories("OST_Levels")

views = Custom[Document.Views]()  # package Clockwork for Dynamo 2.x; Gets all views in the document - except for 3D view templates (as long as this bug is not fixed: https://github.com/DynamoDS/Dynamo/issues/2970)
watch = Watch(views)

# group: View.CategoryIsVisible
categoryIsVisible = Custom[View.CategoryIsVisible](category=pick_category, view=watch)  # package Clockwork for Dynamo 2.x; Checks if a given category is visible in a given view. ATTENTION: This node will be deprecated in 2025. As of Revit 2023, please switch to the OOTB node View.IsCategoryHidden and combine it with the Not node.
watch_2 = Watch(categoryIsVisible)

# group: View.Plane
plane = Custom[View.Plane](view=watch)  # package Clockwork for Dynamo 2.x; Retrieves the plane of a given view
watch_3 = Watch(plane)

# group: View.IsPerspective
isPerspective = Custom[View.IsPerspective](view=watch)  # package Clockwork for Dynamo 2.x; Checks whether a given view is a perspective view.
watch_4 = Watch(isPerspective)

# group: View.UsesViewFilters
usesViewFilters = Custom[View.UsesViewFilters](view=watch)  # package Clockwork for Dynamo 2.x; Checks if a given view has any view filters applied to it.
watch_5 = Watch(usesViewFilters)

# group: View.Scale
scale = Custom[View.Scale](view=watch)  # package Clockwork for Dynamo 2.x; Returns the scale of a given view. ATTENTION: This node will be deprecated in 2024. As of Revit 2022, please switch to the OOTB node of the same name.
watch_6 = Watch(scale)

# group: View.ViewTemplate
viewTemplate = Custom[View.ViewTemplate](view=watch)  # package Clockwork for Dynamo 2.x; Returns the view template assigned to a given view (if one is assigned)
watch_7 = Watch(viewTemplate)

# group: View.SolarStudyTotalFrames
solarStudyTotalFrames = Custom[View.SolarStudyTotalFrames](view=watch)  # package Clockwork for Dynamo 2.x; Retrieves the number of frames of a solar study for a given view (if the view's sun and shadow settings are indeed set to single or multi day study)
watch_8 = Watch(solarStudyTotalFrames)

# group: View.Phase
phase = Custom[View.Phase](view=watch)  # package Clockwork for Dynamo 2.x; Returns the phase of a given view
watch_9 = Watch(phase)

# group: View.DetailLevel
detailLevel = Custom[View.DetailLevel](view=watch)  # package Clockwork for Dynamo 2.x; Retrieves the detail level of a given view
watch_10 = Watch(detailLevel)

# group: View.Type
type = Custom[View.Type](view=watch)  # package Clockwork for Dynamo 2.x; Returns the type of a given view
watch_11 = Watch(type)

# group: View.Direction
direction = Custom[View.Direction](view=watch)  # package Clockwork for Dynamo 2.x; Returns the direction of a view. ATTENTION: This node will be deprecated in 2024. As of Revit 2022, please switch to the OOTB node of the same name.
watch_12 = Watch(direction)

# group: View.IsViewTemplate+
isViewTemplate = Custom[View.IsViewTemplate+](view=watch)  # package Clockwork for Dynamo 2.x; Checks if a given view is a view template. Unlike the OOTB node it works for all view types.
watch_13 = Watch(isViewTemplate)

# group: View.DependentViews
dependentViews = Custom[View.DependentViews](view=watch)  # package Clockwork for Dynamo 2.x; Returns all dependent views of a given view
watch_14 = Watch(dependentViews)

# group: View.PrimaryView
primaryView = Custom[View.PrimaryView](view=watch)  # package Clockwork for Dynamo 2.x; Returns the primary view of a given view (i.e. the master view of a dependent view)
watch_15 = Watch(primaryView)
