# Dynamo graph Revit.Views.View3D.dyn (Dynamo 2.12.1.8246)
# author: Andreas Dieckmann
# View3D nodes sample graph
# packages: Clockwork for Dynamo 2.x 2.12.1

# group: INPUTS
pick_3d_view = Views("{3D}")
select_model_element = DSModelElementSelection()  # 1 picked in the model

# group: View3D.IsLocked
isLocked = Custom[View3D.IsLocked](view3d=pick_3d_view)  # package Clockwork for Dynamo 2.x; Checks if a given 3D view is locked.
watch = Watch(isLocked)

boundingBox = Element.BoundingBox(element=select_model_element)

# group: View3D.SetSectionBox
setSectionBox = Custom[View3D.SetSectionBox](view3D=pick_3d_view, boundingBox=boundingBox)  # package Clockwork for Dynamo 2.x; Sets the section box of a given 3D view to the extents of a given bounding box
watch_2 = Watch(setSectionBox)
