# Dynamo graph String.Inspect.dyn (Dynamo 2.12.1.8246)
# author: Andreas Dieckmann
# String.Inspect nodes sample graph
# packages: Clockwork for Dynamo 2.x 2.12.0

string = StringInput("[a-zA-Z]*berry")  # graph input
string_2 = StringInput("""Strawberry123
Raspberry456
Banana789
123Raspberry456""")  # graph input
string_3 = StringInput("\n")  # graph input
split = String.Split(string=string_2, separator0=string_3)
watch = Watch(split)

# group: Regex.FindRegularExpression
findRegularExpression = Custom[Regex.FindRegularExpression](RegEx=string, str=watch)  # package Clockwork for Dynamo 2.x; Returns all occurences of a regular expression within a string (or list of strings). The syntax for regular expressions is explained at http://ironpython-test.readthedocs.org/en/latest/howto/regex.html
watch_2 = Watch(findRegularExpression)

# group: Regex.ContainsRegularExpression
containsRegularExpression = Custom[Regex.ContainsRegularExpression](RegEx=string, str=watch)  # package Clockwork for Dynamo 2.x; Determines if a regular expression matches a string (or a list of strings), i.e. occurs anywhere in the string, and returns a boolean value (or a list, depending on the input). The syntax for regular expressions is explained at http://ironpython-test.readthedocs.org/en/latest/howto/regex.html
watch_3 = Watch(containsRegularExpression)

# group: Regex.StartsWithRegularExpression
startsWithRegularExpression = Custom[Regex.StartsWithRegularExpression](RegEx=string, str=watch)  # package Clockwork for Dynamo 2.x; Determines if a string starts with the regular expression and returns a boolean value (or a list, depending on the input). The syntax for regular expressions is explained at http://ironpython-test.readthedocs.org/en/latest/howto/regex.html
watch_4 = Watch(startsWithRegularExpression)

string_4 = StringInput("2.4.0")  # graph input
string_5 = StringInput("""2.3.9
2.4.0
2.4.1""")  # graph input
string_6 = StringInput("\n")  # graph input
split_2 = String.Split(string=string_5, separator0=string_6)
watch_5 = Watch(split_2)

# group: VersionNumber.Compare
compare = Custom[VersionNumber.Compare](versionA=string_4, versionB=watch_5)  # package Clockwork for Dynamo 2.x; Compares two version numbers. Returns 1 if A is higher than B, 0 if they are equal and -1 if A is lower than B.
watch_6 = Watch(compare)
