# Dynamo graph String.Modify.dyn (Dynamo 2.12.1.8246)
# author: Andreas Dieckmann
# String.Modify nodes sample graph
# packages: Clockwork for Dynamo 2.x 2.12.0

string = StringInput("[a-zA-Z]*berry")  # graph input
string_2 = StringInput("""Strawberry123
Raspberry456
Banana789
123Raspberry456""")  # graph input
string_3 = StringInput("\n")  # graph input
split = String.Split(string=string_2, separator0=string_3)
watch = Watch(split)

# group: INPUTS
input_text = StringInput("DYNAMO")  # graph input
sort_search_terms_by_size = BoolSelector(true)  # graph input

# group: Regex.ReplaceRegularExpression
replaceRegularExpression = Custom[Regex.ReplaceRegularExpression](RegEx=string, str=watch, Replacement=input_text)  # package Clockwork for Dynamo 2.x; Replaces all occurences of a regular expression within a given string (or list of strings) with another string. The syntax for regular expressions is explained at http://ironpython-test.readthedocs.org/en/latest/howto/regex.html
watch_2 = Watch(replaceRegularExpression)

# group: Regex.SplitByRegularExpression
splitByRegularExpression = Custom[Regex.SplitByRegularExpression](RegEx=string, str=watch)  # package Clockwork for Dynamo 2.x; Splits a given string by a regular expression. The syntax for regular expressions is explained at http://ironpython-test.readthedocs.org/en/latest/howto/regex.html
watch_3 = Watch(splitByRegularExpression)

string_4 = StringInput("Impossible:Filename?01.txt")  # graph input

# group: String.ReplaceIllegalFilenameCharacters
replaceIllegalFilenameCharacters = Custom[String.ReplaceIllegalFilenameCharacters](str=string_4)  # package Clockwork for Dynamo 2.x; Replaces all characters in a string that are illegal characters for filenames
watch_4 = Watch(replaceIllegalFilenameCharacters)

string_5 = StringInput("This is a {0} example for {1} replacing multiple items in a string.")  # graph input
code_block = CodeBlock { ["small","efficiently"]; }

# group: String.Replace+
replace = Custom[String.Replace+](str=string_5, replacements=code_block)  # package Clockwork for Dynamo 2.x; Replaces multiple items in a given string. Items in the string have to be denoted as {0], {1}, ..., {n} - corresponding to the respective list index of the replacement string.
watch_5 = Watch(replace)

string_6 = StringInput("Impossible:Familyname?[01]")  # graph input

# group: String.ReplaceIllegalRevitCharacters
replaceIllegalRevitCharacters = Custom[String.ReplaceIllegalRevitCharacters](str=string_6)  # package Clockwork for Dynamo 2.x; Replaces all characters in a string that are illegal characters for Revit view names etc.
watch_6 = Watch(replaceIllegalRevitCharacters)

code_block_2 = CodeBlock { ["i","in"]; ["U","ON"]; }

# group: String.ReplaceMultiple
replaceMultiple = Custom[String.ReplaceMultiple](str=string_5, searchFor=code_block_2.out0, replaceWith=code_block_2.out1, sortSearchTermsBySize=sort_search_terms_by_size)  # package Clockwork for Dynamo 2.x; Replaces multiple search terms in a given string with multiple replacements
watch_7 = Watch(replaceMultiple)

# group: String.Explode
explode = Custom[String.Explode](str=input_text)  # package Clockwork for Dynamo 2.x; Chops up a string into a list of characters
watch_8 = Watch(explode)
