# Dynamo graph AccumulateList.dyn (Dynamo 0.7.1.29946)

number = DoubleInput(1..10)
watch = Watch(number)
accumulate_list = Custom[Accumulate List](list=watch)  # Accumulates the values of a given list and returns a list of the accumulated values
watch_2 = Watch(accumulate_list)
