# Dynamo graph AlmostZero.dyn (Dynamo 0.6.3.22045)

xyz_distance = XyzDistance(lacing=Longest)
category = Categories(index=892)
# note: This example needs the Select By Category, Hoste Object Stuff and Wall Stuff packages to be installed.
get_family_instances_by_category = Custom[Get Family Instances By Category](BuiltInCategories=category)  # Gets all family instances in the model for a given list of categories
get_hosted_object_orientation = Custom[Get Hosted Object Orientation](element_s=get_family_instances_by_category)  # Gets the orientation of a hosted object (e.g. a window or a door - orientation always facing towards exterior)
get_host = Custom[Get Host](element_s=get_family_instances_by_category)  # Gets an element's host
get_wall_orientation = Custom[Get Wall Orientation](Wall_Instance_s=get_host)  # Gets the orientation of a given wall instance (normal of the exterior face of the wall). Will *not* work for walls hosted on mass faces or in-place walls.
combine = Combine(xyz_distance, get_hosted_object_orientation, get_wall_orientation)
watch = Watch(combine)
watch_2 = Watch(get_wall_orientation)
watch_3 = Watch(get_hosted_object_orientation)
formula = Formula("x*1", x=combine, lacing=Longest)
almost_zero = Custom[Almost Zero]()  # Returns a feasable computational tolerance to zero (1.0e-9 or a billionth of 1) for use in calculations. More background info: https://github.com/ikeough/Dynamo/issues/879
formula_2 = Formula("x<t AND x>-t", x=formula, t=almost_zero, lacing=Longest)
watch_4 = Watch(formula_2)
watch_5 = Watch(formula)
first_of_list = First(get_hosted_object_orientation)
equal = Equal(first_of_list)
map = Map(equal, get_wall_orientation)
watch_6 = Watch(map)
xyzs_almost_equal = Custom[XYZs Almost Equal](XYZ=first_of_list, list=get_wall_orientation)  # Checks if any XYzs in a given list are almost equal (within a reasonable computational tolerance) to a specified XYZ.
watch_7 = Watch(xyzs_almost_equal)
