# Dynamo graph AlphabeticalSequence.dyn (Dynamo 0.6.3.31051)

integer_slider = IntegerSliderInput(79, range=1..500)
boolean = BoolSelector(true)
alphabetical_sequence = Custom[Alphabetical Sequence](n=integer_slider, uppercase=boolean)  # Creates a list of the first N letters of the alphabet (where 1 = A, 2 = B, ... , 27 = AA, 28 = AB etc.).
watch = Watch(alphabetical_sequence)
number_to_character = Custom[Number To Character](n=integer_slider, upper=boolean)  # Converts a number into a character (where 1 = A, 2 = B, ... , 27 = AA, 28 = AB etc.).
watch_2 = Watch(number_to_character)
