# Dynamo graph AltitudeAndAzimuthFromVector.dyn (Dynamo 0.6.3.22045)

sunpath_direction = SunPathDirection()  # 1 picked in the model
watch = Watch(sunpath_direction)
boolean = BoolSelector(true)
altitude_and_azimuth_from_vector = Custom[Altitude And Azimuth From Vector](XYZ=watch, Deg_Rad=boolean)  # Computes the altitude and azimuth of a given vector
watch_2 = Watch(altitude_and_azimuth_from_vector.Altitude)
watch_3 = Watch(altitude_and_azimuth_from_vector.Azimuth)
