# Dynamo graph AngleBisector.dyn (Dynamo 0.6.3.7375)

select_reference_point = PointBySelection()  # 1 picked in the model
xyz_from_reference_point = XyzFromReferencePoint(select_reference_point, lacing=Longest)
select_reference_point_2 = PointBySelection()  # 1 picked in the model
xyz_from_reference_point_2 = XyzFromReferencePoint(select_reference_point_2, lacing=Longest)
select_reference_point_3 = PointBySelection()  # 1 picked in the model
xyz_from_reference_point_3 = XyzFromReferencePoint(select_reference_point_3, lacing=Longest)
angle_bisector = Custom[Angle Bisector](XYZ_A=xyz_from_reference_point, XYZ_B=xyz_from_reference_point_2, XYZ_C=xyz_from_reference_point_3)  # Retrieves the vector of an angle bisector at point B based on three points (A, B, C) that define the angle.
watch = Watch(angle_bisector)
y_axis = XyzBasisY(lacing=Longest)
number = DoubleInput(0)
XYZ = Xyz(number, number, number, lacing=Longest)
x_axis = XyzBasisX(lacing=Longest)
angle_bisector_2 = Custom[Angle Bisector](XYZ_A=y_axis, XYZ_B=XYZ, XYZ_C=x_axis)
watch_2 = Watch(angle_bisector_2)
