# Dynamo graph Buckyball_ConceptualMassFamily.dyn (Dynamo 0.6.3.22045)

# note: Filter out all points that do not have a distnace of 2 to the first point.
# note: Measure distance between first point in list and all other points

xyz_zero = Custom[XYZ Zero]()  # Returns an XYZ of (0 ,0, 0)
number_slider = DoubleSliderInput(1, range=0..5)
buckyball = Custom[Buckyball](Origin=xyz_zero, Radius=number_slider)  # Returns all the data necessary for modeling a truncated icosahedron (vertices and struts) as well as the surface area and volume. Radius and origin of the object can be specified.
watch = Watch(buckyball.Struts_Up_Vector)
watch_2 = Watch(buckyball.Struts_Lines)
model_curve = ModelCurve(watch_2, lacing=Longest)
watch_3 = Watch(buckyball.Surface_Area)
watch_4 = Watch(buckyball.Volume)
watch_5 = Watch(buckyball.Struts_XYZs)
watch_6 = Watch(buckyball.Vertices)
reference_point = ReferencePointByXyz(watch_6, lacing=Longest)
