# Dynamo graph Buckyball_ProjectEnvironment.dyn (Dynamo 0.6.3.22045)

# note: Filter out all points that do not have a distnace of 2 to the first point.
# note: Measure distance between first point in list and all other points

xyz_zero = Custom[XYZ Zero]()  # Returns an XYZ of (0 ,0, 0)
number_slider = DoubleSliderInput(25, range=0..50)
buckyball = Custom[Buckyball](Origin=xyz_zero, Radius=number_slider)  # Returns all the data necessary for modeling a truncated icosahedron (vertices and struts) as well as the surface area and volume. Radius and origin of the object can be specified.
watch = Watch(buckyball.Vertices)
watch_2 = Watch(buckyball.Surface_Area)
watch_3 = Watch(buckyball.Volume)
watch_4 = Watch(buckyball.Struts_XYZs)
select_structural_framing_type = StructuralFramingSelector(index=0)
watch_5 = Watch(buckyball.Struts_Lines)
watch_6 = Watch(buckyball.Struts_Up_Vector)
structural_framing = StructuralFraming(select_structural_framing_type, watch_5, watch_6)
