# Dynamo graph CSVToList.dyn (Dynamo 0.6.3.7375)

string = StringInput(",")
string_2 = StringInput(";")
file_path = StringFilename("C:\Users\adieckmann\Documents\GitHub\DynamoSamples\package_samples\CSV To List\example.csv")
read_text_file = FileReader(file_path)
boolean = BoolSelector(false)
boolean_2 = BoolSelector(true)
boolean_3 = BoolSelector(false)
csv_to_list = Custom[CSV To List](delimiter=string_2, CSV_string=read_text_file, ignore_last_column=boolean, ignore_first_row=boolean_2, ignore_last_row=boolean_3)  # Converts the content of a given CSV file to a list
watch = Watch(csv_to_list)
