# Dynamo graph CentralProjectionOnFace.dyn (Dynamo 0.6.3.22045)

select_reference_point = PointBySelection()  # 1 picked in the model
xyz_from_reference_point = XyzFromReferencePoint(select_reference_point, lacing=Longest)
select_reference_point_2 = PointBySelection()  # 1 picked in the model
xyz_from_reference_point_2 = XyzFromReferencePoint(select_reference_point_2, lacing=Longest)
select_reference_point_3 = PointBySelection()  # 1 picked in the model
xyz_from_reference_point_3 = XyzFromReferencePoint(select_reference_point_3, lacing=Longest)
select_reference_point_4 = PointBySelection()  # 1 picked in the model
xyz_from_reference_point_4 = XyzFromReferencePoint(select_reference_point_4, lacing=Longest)
select_reference_point_5 = PointBySelection()  # 1 picked in the model
xyz_from_reference_point_5 = XyzFromReferencePoint(select_reference_point_5, lacing=Longest)
list = NewList(index0=xyz_from_reference_point_2, index1=xyz_from_reference_point_3, index2=xyz_from_reference_point_4, index3=xyz_from_reference_point_5)
select_face = FormElementBySelection()  # 1 picked in the model
central_projection_on_face = Custom[Central Projection On Face](Central_Projection_Point=xyz_from_reference_point, Points_to_be_projected=list, Face=select_face)  # Projects a list of points onto a given face
reference_point = ReferencePointByXyz(central_projection_on_face, lacing=Longest)
