# Dynamo graph CentralProjectionOnPlane.dyn (Dynamo 0.6.3.22045)

# note: Pick central projection point
# note: This sample also needs the Lines Through Points (Closed Loop) package to be installed.
select_reference_point = PointBySelection()  # 1 picked in the model
xyz_from_reference_point = XyzFromReferencePoint(select_reference_point, lacing=Longest)
# note: Pick points to be projected
select_reference_point_2 = PointBySelection()  # 1 picked in the model
xyz_from_reference_point_2 = XyzFromReferencePoint(select_reference_point_2, lacing=Longest)
select_reference_point_3 = PointBySelection()  # 1 picked in the model
xyz_from_reference_point_3 = XyzFromReferencePoint(select_reference_point_3, lacing=Longest)
select_reference_point_4 = PointBySelection()  # 1 picked in the model
xyz_from_reference_point_4 = XyzFromReferencePoint(select_reference_point_4, lacing=Longest)
select_reference_point_5 = PointBySelection()  # 1 picked in the model
xyz_from_reference_point_5 = XyzFromReferencePoint(select_reference_point_5, lacing=Longest)
list = NewList(index0=xyz_from_reference_point_2, index1=xyz_from_reference_point_3, index2=xyz_from_reference_point_4, index3=xyz_from_reference_point_5)
# note: Pick 3 points on a plane
select_reference_point_6 = PointBySelection()  # 1 picked in the model
xyz_from_reference_point_6 = XyzFromReferencePoint(select_reference_point_6, lacing=Longest)
select_reference_point_7 = PointBySelection()  # 1 picked in the model
xyz_from_reference_point_7 = XyzFromReferencePoint(select_reference_point_7, lacing=Longest)
select_reference_point_8 = PointBySelection()  # 1 picked in the model
xyz_from_reference_point_8 = XyzFromReferencePoint(select_reference_point_8, lacing=Longest)
list_2 = NewList(index0=xyz_from_reference_point_6, index1=xyz_from_reference_point_7, index2=xyz_from_reference_point_8)
best_fit_plane = BestFitPlane(list_2, lacing=Longest)
central_projection_on_plane = Custom[Central Projection On Plane](Central_Projection_Point=xyz_from_reference_point, Points_to_be_projected=list, Plane_Origin=best_fit_plane.out2, Plane_Normal=best_fit_plane.out1)  # Projects a list of points onto a given plane
reference_point = ReferencePointByXyz(central_projection_on_plane, lacing=Longest)
lines_through_points_closed_loop = Custom[Lines Through Points (Closed Loop)](list=central_projection_on_plane)  # Works just like the built-in node Lines Through Points (creates a series of lines through a list of points) - except that it creates a *closed* loop of lines.
model_curve = ModelCurve(lines_through_points_closed_loop, lacing=Longest)
