# Dynamo graph ConvexHull2D.dyn (Dynamo 0.7.1.29946)

code_block = CodeBlock { 1..40; 2; 1; }
random = Math.Random(code_block.out0)
shuffle = List.Shuffle(random)
takeEveryNthItem = List.TakeEveryNthItem(shuffle, code_block.out1, code_block.out2)
dropEveryNthItem = List.DropEveryNthItem(shuffle, code_block.out1, code_block.out2)
byCoordinates = UV.ByCoordinates(takeEveryNthItem, dropEveryNthItem, lacing=Longest)
watch = Watch(byCoordinates)
convex_hull_2d = Custom[Convex Hull 2D](UVs=byCoordinates)  # Computes the convex hull of a given set of UV coordinates based on the monotone chain algorithm
watch_2 = Watch(convex_hull_2d)
U = UV.U(byCoordinates)
V = UV.V(byCoordinates)
byCoordinates_2 = Point.ByCoordinates(U, V)
watch_3d = Watch3D(byCoordinates_2)
U_2 = UV.U(convex_hull_2d)
V_2 = UV.V(convex_hull_2d)
byCoordinates_3 = Point.ByCoordinates(U_2, V_2, lacing=Longest)
byPoints = Polygon.ByPoints(byCoordinates_3)
watch_3d_2 = Watch3D(byPoints)
