# Dynamo graph CorrectNormalOrientation.dyn (Dynamo 0.6.3.7375)

y_axis = XyzBasisY(lacing=Longest)
x_axis = XyzBasisX(lacing=Longest)
add_xyzs = XyzAdd(y_axis, x_axis, lacing=Longest)
unitize_xyz = XyzNormalize(add_xyzs, lacing=Longest)
watch = Watch(unitize_xyz)
negate_xyz = XyzNegate(x_axis, lacing=Longest)
watch_2 = Watch(negate_xyz)
correct_normal_orientation = Custom[Correct Normal Orientation](a=watch, b=watch_2)  # Inverts normal A if its inversion is closer to normal B
watch_3 = Watch(correct_normal_orientation)
