# Dynamo graph CountTrueAndFalse.dyn (Dynamo 0.6.3.7375)

boolean = BoolSelector(false)
boolean_2 = BoolSelector(true)
list = NewList(index0=boolean, index1=boolean_2, index2=boolean, index3=boolean_2, index4=boolean_2)
watch = Watch(list)
count_true_and_false = Custom[Count True And False](booleans=watch)  # Counts the occurences of True and False in a list of booleans
watch_2 = Watch(count_true_and_false.true)
watch_3 = Watch(count_true_and_false.false)
