# Dynamo graph CountTrueAndFalse.dyn (Dynamo 0.7.1.29946)

boolean = BoolSelector(false)
boolean_2 = BoolSelector(true)
create_list = List.Create(boolean, boolean_2, boolean, boolean_2, boolean_2)
watch = Watch(create_list)
count_true_and_false = Custom[Count True And False](booleans=watch)  # Counts the occurences of True and False in a list of booleans
watch_2 = Watch(count_true_and_false.true)
watch_3 = Watch(count_true_and_false.false)
