# Dynamo graph CreatePlaceholderSheets.dyn (Dynamo 0.6.3.7375)

string = StringInput("""E01
E02
E03""")
string_2 = StringInput("\n")
split_string = SplitString(string, string_2)
string_3 = StringInput("""Test 1
Test 2
Test 3""")
split_string_2 = SplitString(string_3, string_2)
create_placeholder_sheets = Custom[Create Placeholder Sheets](Sheet_Number_s=split_string, Sheet_Name_s=split_string_2)  # Creates placeholder sheets
watch = Watch(create_placeholder_sheets)
