# Dynamo graph CurveArray.dyn (Dynamo 0.6.3.7375)

number = DoubleInput(1)
number_2 = DoubleInput(0)
list = NewList(index0=number, index1=number_2)
XYZ = Xyz(list, list, number_2, lacing=CrossProduct)
flatten_completely = FlattenList(XYZ)
lines_through_points = CurvesThroughPoints(flatten_completely, lacing=Longest)
watch = Watch(lines_through_points)
curve_array = Custom[Curve Array](Curve_s=watch)  # Creates a curve array from a list of curves
watch_2 = Watch(curve_array)
