# Dynamo graph CustomRounding.dyn (Dynamo 0.6.3.5256)

number = DoubleInput(7677)
precision = DoubleInput(5)
customRound = Custom[CustomRound](Number=number, Precision=precision)  # Rounds a number to a specified precision
watch = Watch(customRound)
customFloor = Custom[CustomFloor](Number=number, Precision=precision)  # Rounds a number *down* to a specified precision
watch_2 = Watch(customFloor)
customCeiling = Custom[CustomCeiling](Number=number, Precision=precision)  # Rounds a number *up* to a specified precision
watch_3 = Watch(customCeiling)
