# Dynamo graph CustomRounding.dyn (Dynamo 0.7.1.29946)

number = DoubleInput(7677)
precision = DoubleInput(5)
round_to_precision = Custom[Round To Precision](Number=number, Precision=precision)  # Rounds a number to a specified precision
watch = Watch(round_to_precision)
round_down_to_precision = Custom[Round Down To Precision](Number=number, Precision=precision)  # Rounds a number *down* to a specified precision
watch_2 = Watch(round_down_to_precision)
round_up_to_precision = Custom[Round Up To Precision](Number=number, Precision=precision)  # Rounds a number *up* to a specified precision
watch_3 = Watch(round_up_to_precision)
