# Dynamo graph Dispatch.dyn (Dynamo 0.7.1.29946)

boolean = BoolSelector(false)
number = DoubleInput(5000)
dispatch = Custom[Dispatch](test=boolean, value=number)  # Dispatches a value to one of two output ports (true/false) depending on a condition. The other output port will return an empty list.
watch = Watch(dispatch.true)
watch_2 = Watch(dispatch.false)
