# Dynamo graph DropLastRowAndColumnFromUVField.dyn (Dynamo 0.6.3.5256)

U = IntegerSliderInput(6, range=0..20)
V = IntegerSliderInput(5, range=0..20)
multiply = Multiplication(U, V, lacing=Longest)
number = DoubleInput(1..n, multiply, lacing=Longest)
watch = Watch(number)
drop_last_row_and_column_from_uv = Custom[Drop Last Row And Column From UV Field](list=watch, V=V)  # Drops the last row and column from a UV field
watch_2 = Watch(drop_last_row_and_column_from_uv)
