# Dynamo graph EvaluateDividedSurfaceGridNodes.dyn (Dynamo 0.6.3.22045)

integer_slider = IntegerSliderInput(4, range=0..4)
element_types = ElementTypes(index=70)
all_elements_of_type = AllElementsOfType(element_types)
get_from_list = GetFromList(integer_slider, all_elements_of_type)
boolean = BoolSelector(false)
evaluate_divided_surface_grid = Custom[Evaluate Divided Surface Grid Nodes](DS=get_from_list, include_overhanging_nodes=boolean)  # Returns UV and XYZ coordinates as well as surface normals for all grid nodes of a given divided surface. Also returns the underlying face and the UV count.
watch = Watch(evaluate_divided_surface_grid.UVs)
watch_2 = Watch(evaluate_divided_surface_grid.V)
watch_3 = Watch(evaluate_divided_surface_grid.U)
watch_4 = Watch(evaluate_divided_surface_grid.Face)
watch_5 = Watch(evaluate_divided_surface_grid.Normals)
watch_6 = Watch(evaluate_divided_surface_grid.XYZs)
reference_point = ReferencePointByXyz(watch_6, lacing=Longest)
