# Dynamo graph ExteriorAngle.dyn (Dynamo 0.6.3.7375)

# note: This example also requires the Unit Conversion package to be installed.
angle = DoubleSliderInput(45, range=0..180)
degrees_to_radians = Custom[Degrees To Radians](deg=angle)  # Converts degrees into radians
exterior_angle = Custom[Exterior Angle](angle=degrees_to_radians)  # Computes the exterior angle of a given angle.
radians_to_degrees = Custom[Radians To Degrees](rad=exterior_angle.360_angle)  # Converts radians into degrees
watch = Watch(radians_to_degrees)
radians_to_degrees_2 = Custom[Radians To Degrees](rad=exterior_angle.180_angle)
watch_2 = Watch(radians_to_degrees_2)
