# Dynamo graph FamilyToTypeAndBack.dyn (Dynamo 0.6.3.7375)

# note: This sample also needs the Select By category package to be installed.
category = Categories(index=597)
get_families_by_category = Custom[Get Families By Category](BuiltInCategories=category)  # Gets all famiies of a given category in the model (does *not *work for system families)
get_family_symbols_from_family = Custom[Get Family Symbols From Family](Family_ies=get_families_by_category)  # Gets all family symbols of a given category in the model (does *not *work for system families)
get_family_from_family_type = Custom[Get Family From Family Type](Family_Type_s=get_family_symbols_from_family)  # Retrieves the family of a given family type
watch = Watch(get_family_from_family_type)
watch_2 = Watch(get_family_symbols_from_family)
watch_3 = Watch(get_families_by_category)
