# Dynamo graph FilterListByBooleans.dyn (Dynamo 0.6.3.5256)

number = DoubleInput(1..5)
boolean = BoolSelector(false)
boolean_2 = BoolSelector(true)
list = NewList(index0=boolean, index1=boolean_2, index2=boolean, index3=boolean_2, index4=boolean_2)
filter_list_by_booleans = Custom[Filter List By Booleans](list=number, booleans=list)  # Filters a list by a list of booleans and filters out those elements that correspond to a boolean False.
watch = Watch(filter_list_by_booleans)
