# Dynamo graph FoundationStuff.dyn (Dynamo 0.6.3.5256)

select_elements = MultipleCurvesBySelection()
# note: This example also requires the Select By Category package to be installed.
builtincategory_structuctural = Custom[BuiltInCategory Structuctural Foundations]()  # Returns the BuiltInCategory Structural Foundations
get_family_instances_by_category = Custom[Get Family Instances By Category](BuiltInCategories=builtincategory_structuctural)  # Gets all family instances in the model for a given list of categories
filter_structural_foundations_by = Custom[Filter Structural Foundations By Kind](Struct_Found_Instance_s=get_family_instances_by_category)  # Filters a list of structural foundations by their kind (isolated, wall, slab).
watch = Watch(filter_structural_foundations_by.Isolated)
watch_2 = Watch(filter_structural_foundations_by.Slab)
watch_3 = Watch(filter_structural_foundations_by.No_Foundations)
watch_4 = Watch(filter_structural_foundations_by.Wall)
get_footing_type = Custom[Get Footing Type](Footing_Instance_s=watch_4)  # Retrieves the footing type for a given wall footing instance
watch_5 = Watch(get_footing_type)
footing_type_breaks_at_inserts = Custom[Footing Type Breaks At Inserts](Footing_Type_s=watch_5)  # Determines whether a list of wall footing types break at inserts in their attached walls
watch_6 = Watch(footing_type_breaks_at_inserts.booleans)
watch_7 = Watch(footing_type_breaks_at_inserts.true)
watch_8 = Watch(footing_type_breaks_at_inserts.false)
