# Dynamo graph GetAndSetFamilyType.dyn (Dynamo 0.6.3.5256)

select_elements = MultipleCurvesBySelection()  # 8 picked in the model
select_family_type = FamilyTypeSelector(index=13)
set_family_type = Custom[Set Family Type](Family_Instance_s=select_elements, Family_Type=select_family_type)  # Changes the family type of a given famiyl instance to the specified type
get_family_type = Custom[Get Family Type](Family_Instance_s=set_family_type)  # Returns the familyt type of a given family instance
watch = Watch(get_family_type)
