# Dynamo graph GetAndSetName.dyn (Dynamo 0.6.3.7375)

select_model_element = ModelElementSelection()  # 1 picked in the model
watch = Watch(select_model_element)
string = StringInput("MyNewName")
set_name = Custom[Set Name](element_s=watch, name=string)  # Gets the name of a given Revit element
watch_2 = Watch(set_name.Fail)
watch_3 = Watch(set_name.Success)
get_name = Custom[Get Name](element_s=watch_3)  # Gets the name of a given Revit element (if possible)
watch_4 = Watch(get_name)
