# Dynamo graph GetBoundingBox.dyn (Dynamo 0.6.3.22045)

select_elements = MultipleCurvesBySelection()  # 7 picked in the model
get_bounding_box = Custom[Get Bounding Box](Element_s=select_elements)  # Gets the bounding box of a Revit element
watch = Watch(get_bounding_box.bbox)
watch_2 = Watch(get_bounding_box.top_right_front_corner)
watch_3 = Watch(get_bounding_box.bottom_left_rear_corner)
