# Dynamo graph GetCurrentRevitDocumentPath.dyn (Dynamo 0.6.3.7375)

get_current_revit_document_path = Custom[Get Current Revit Document Path]()  # Gets the path and directory of the current Revit document
watch = Watch(get_current_revit_document_path.path)
watch_2 = Watch(get_current_revit_document_path.directory)
