# Dynamo graph GetDirectoryFromFilePath.dyn (Dynamo 0.6.3.7375)

file_path = StringFilename("C:\Users\adieckmann\Desktop\AlwaysVertical.rfa")
get_directory_from_file_path = Custom[Get Directory From File Path](path=file_path)  # Gets the directory from a given file path
watch = Watch(get_directory_from_file_path)
