# Dynamo graph GetElementByFace.dyn (Dynamo 0.6.3.22045)

select_face = FormElementBySelection()  # 1 picked in the model
get_element_by_face = Custom[Get Element By Face](Face_s=select_face)  # Returns the underlying Revit element of a given face
watch = Watch(get_element_by_face)
