# Dynamo graph GetElementLocation.dyn (Dynamo 0.6.3.22045)

select_elements = MultipleCurvesBySelection()  # 5 picked in the model
watch = Watch(select_elements)
get_element_location = Custom[Get Element Location](Element_s=watch)  # Returns the location of an element as an XYZ (or if it's line-based the start and end point of the line). Use this for elements that do not work with the built-in Get Family Instance Location node.
watch_2 = Watch(get_element_location.Location_s)
watch_3 = Watch(get_element_location.Curve_s)
watch_4 = Watch(get_element_location.Is_Point_bool)
watch_5 = Watch(get_element_location.Is_Curve_bool)
