# Dynamo graph GetFacesFromSolid.dyn (Dynamo 0.6.3.22045)

number = DoubleInput(0)
XYZ = Xyz(number, number, number, lacing=Longest)
number_2 = DoubleInput(5)
XYZ_2 = Xyz(number_2, number_2, number_2, lacing=Longest)
box_by_two_corners = SolidBoxByTwoCorners(XYZ, XYZ_2, lacing=Longest)
get_faces_from_solid = Custom[Get Faces From Solid](Solid_s=box_by_two_corners)  # Retrieves a list of faces from a given solid
watch = Watch(get_faces_from_solid)
