# Dynamo graph GetHighestAndLowestFromList.dyn (Dynamo 0.6.3.7375)

number = DoubleInput(2..8)
get_highest_and_lowest_from_list = Custom[Get Highest And Lowest From List](list=number)  # Gets the highest and lowest value from a given list
watch = Watch(get_highest_and_lowest_from_list.highest)
watch_2 = Watch(get_highest_and_lowest_from_list.lowest)
