# Dynamo graph GetNormalByUAndVVectors.dyn (Dynamo 0.6.3.5256)

x_axis = XyzBasisX(lacing=Longest)
y_axis = XyzBasisY(lacing=Longest)
get_normal_by_u_and_v_vectors = Custom[Get Normal By U And V Vectors](U=x_axis, V=y_axis)  # Derives a plane's normal based on its U and V vectors
watch = Watch(get_normal_by_u_and_v_vectors)
