# Dynamo graph GetPlaneUAndVVectors.dyn (Dynamo 0.6.3.5256)

z_axis = XyzBasisZ(lacing=Longest)
get_plane_u_and_v_vectors = Custom[Get Plane U And V Vectors](normal=z_axis)  # Derives U and V vectors for a plane based on the plane's normal
watch = Watch(get_plane_u_and_v_vectors.PlaneU)
watch_2 = Watch(get_plane_u_and_v_vectors.PlaneV)
