# Dynamo graph GetThirdXYZAxis.dyn (Dynamo 0.6.3.7375)

x_axis = XyzBasisX(lacing=Longest)
y_axis = XyzBasisY(lacing=Longest)
get_third_xyz_axis = Custom[Get Third XYZ Axis](xyz_axis_1=x_axis, xyz_axis_2=y_axis)  # Given two main XYZ axes (or vectors pointing more or less in thei general direction), this node will find the third axis.
watch = Watch(get_third_xyz_axis.string)
watch_2 = Watch(get_third_xyz_axis.xyz)
z_axis = XyzBasisZ(lacing=Longest)
