# Dynamo graph GroupListOfListsByKey.dyn (Dynamo 0.6.3.7375)

string = StringInput("""Animal
Animal
Animal
Fruit
Fruit""")
string_2 = StringInput("\n")
split_string = SplitString(string, string_2)
string_3 = StringInput("""Elephant
Lion
Eagle
Banana
Strawberry""")
split_string_2 = SplitString(string_3, string_2)
list = NewList(index0=split_string, index1=split_string_2)
watch = Watch(list)
number = DoubleInput(0)
group_list_of_lists_by_key = Custom[Group List of Lists By Key](list=watch, key_index=number)  # Groups a list of lists by one of its keys
watch_2 = Watch(group_list_of_lists_by_key)
