# Dynamo graph HasOutOfPlaneXYZs.dyn (Dynamo 0.6.3.5256)

z_axis = XyzBasisZ(lacing=Longest)
number = DoubleInput(0)
XYZ = Xyz(number, number, number, lacing=Longest)
plane_by_normal_origin = Plane(z_axis, XYZ, lacing=Longest)
X = DoubleSliderInput(50, range=0..100)
Y = DoubleSliderInput(50, range=0..100)
Z = DoubleSliderInput(1, range=0..10)
XYZ_2 = Xyz(X, Y, Z, lacing=Longest)
tolerance = DoubleSliderInput(0.01, range=0..100)
xyz_is_out_of_plane = Custom[XYZ Is Out-Of-Plane](face_plane=plane_by_normal_origin, XYZ=XYZ_2, tolerance=tolerance)  # Checks a list for XYZs that are not located on a given plane
watch = Watch(xyz_is_out_of_plane)
y_axis = XyzBasisY(lacing=Longest)
x_axis = XyzBasisX(lacing=Longest)
list = NewList(index0=XYZ_2, index1=y_axis, index2=x_axis)
has_out_of_plane_xyzs = Custom[Has Out-Of-Plane XYZs](face_plane=plane_by_normal_origin, list=list, tolerance=tolerance)  # Checks a list for XYZs that are not located on a given plane
watch_2 = Watch(has_out_of_plane_xyzs)
