# Dynamo graph HostedObjectStuff.dyn (Dynamo 0.6.3.22045)

category = Categories(index=206)
category_2 = Categories(index=892)
# note: This example also requires the Select By Category package to be installed.
list = NewList(index0=category, index1=category_2)
get_family_instances_by_category = Custom[Get Family Instances By Category](BuiltInCategories=list)  # Gets all family instances in the model for a given list of categories
get_hosted_object_orientation = Custom[Get Hosted Object Orientation](element_s=get_family_instances_by_category)  # Gets the orientation of a hosted object (e.g. a window or a door - orientation always facing towards exterior)
watch = Watch(get_hosted_object_orientation)
get_host = Custom[Get Host](element_s=get_family_instances_by_category)  # Gets an element's host
watch_2 = Watch(get_host)
group_elements_by_host = Custom[Group Elements By Host](Element_s=get_family_instances_by_category)  # Groups a list of Revit elements by their respective hosts (if they have any)
watch_3 = Watch(group_elements_by_host.Unhosted)
watch_4 = Watch(group_elements_by_host.Hosted)
watch_5 = Watch(group_elements_by_host.Host_s)
boolean = BoolSelector(true)
get_inserts = Custom[Get Inserts](Element_s=watch_5, Include_Openings=boolean, Include_Shadows=boolean, Include_Embedded_Walls=boolean, Include_Shared_Embedded_Inserts=boolean)  # Gets all the objects inserted into a given element.
watch_6 = Watch(get_inserts)
