# Dynamo graph IncrementOrDecrementByOne.dyn (Dynamo 0.7.1.29946)

number = DoubleInput(2)
n1 = Custom[-1](number)  # Decrements a value by 1
watch = Watch(n1)
n1_2 = Custom[+1](number)  # Increments a value by 1
watch_2 = Watch(n1_2)
