# Dynamo graph IntersectsForDividedSurfacesByFunction.dyn (Dynamo 0.6.3.5256)

select_face = FormElementBySelection()  # 1 picked in the model
formula = Formula("1", lacing=Longest)
divided_surface = DividedSurface(select_face, formula, formula, lacing=Longest)
# note: This example will also need the Unit Conversion package to be installed.
# note: Settings for Vertical Intersects
scale = DoubleSliderInput(15.285, range=0..20)
meters_to_feet = Custom[Meters To Feet](m=scale)  # Converts meters into feet
select_reference_point = PointBySelection()  # 1 picked in the model
xyz_from_reference_point = XyzFromReferencePoint(select_reference_point, lacing=Longest)
select_reference_point_2 = PointBySelection()  # 1 picked in the model
xyz_from_reference_point_2 = XyzFromReferencePoint(select_reference_point_2, lacing=Longest)
subdivisions = IntegerSliderInput(13, range=2..30)
name_prefix = StringInput("dynamo_intersect_V")
number_slider = DoubleSliderInput(2, range=0..10)
function = Formula("atan(x * n) / atan(n)", n=number_slider, lacing=Longest)
vertical_intersects_for_divided = Custom[Vertical Intersects for Divided Surface by Endpoints and Function](DivSurf=divided_surface, Scale=meters_to_feet, XYZ_Start=xyz_from_reference_point, XYZ_End=xyz_from_reference_point_2, Subdivisions=subdivisions, Intersect_Name=name_prefix, f_x=function)  # Creates a number of vertical intersects (reference planes) for a divided surface based on the path between between two points. The spacing can be controlled by a function.
watch = Watch(vertical_intersects_for_divided.DivSurf)
watch_2 = Watch(vertical_intersects_for_divided.Intersects)
# note: Settings for Horizontal Intersects
select_reference_point_3 = PointBySelection()  # 1 picked in the model
xyz_from_reference_point_3 = XyzFromReferencePoint(select_reference_point_3, lacing=Longest)
select_reference_point_4 = PointBySelection()  # 1 picked in the model
xyz_from_reference_point_4 = XyzFromReferencePoint(select_reference_point_4, lacing=Longest)
subdivisions_horizontal_levels = IntegerSliderInput(12, range=0..30)
level_name_prefix = StringInput("dynamo_intersect_H")
function_horizontal_levels = Formula("Sin(x*Pi/2)", lacing=Longest)
horizontal_intersects_for = Custom[Horizontal Intersects For Divided Surface by Endpoints and Function](DivSurf=divided_surface, XYZ_Start=xyz_from_reference_point_3, XYZ_End=xyz_from_reference_point_4, Subdivisions=subdivisions_horizontal_levels, Intersect_Name=level_name_prefix, f_x=function_horizontal_levels)  # Creates a number of horizontal intersects (levels)for a divided surface based on the path between two points. The spacing of the intersects can be controlled by a function.
watch_3 = Watch(horizontal_intersects_for.DivSurf)
watch_4 = Watch(horizontal_intersects_for.Intersects)
