# Dynamo graph IsMultiple.dyn (Dynamo 0.6.3.5256)

number_1 = IntegerSliderInput(51, range=0..100)
number_2 = IntegerSliderInput(2, range=0..10)
is_multiple = Custom[Is Multiple](A=number_1, B=number_2)  # Checks if A is a multiple of B.
watch = Watch(is_multiple)
