# Dynamo graph IsOddNumber.dyn (Dynamo 0.6.3.5256)

number = IntegerSliderInput(7, range=0..10)
is_odd_number = Custom[Is Odd Number](val=number)  # Checks if a number is odd or even.
watch = Watch(is_odd_number)
is_even_number = Custom[Is Even Number](val=number)  # Checks if a number is even.
watch_2 = Watch(is_even_number)
