# Dynamo graph IsPointInsidePolygon.dyn (Dynamo 0.6.3.7375)

# note: This example also needs the package Get Element Location to be installed.
select_reference_points = MultipleCurvesBySelection()  # 6 picked in the model
xyz_from_reference_point = XyzFromReferencePoint(select_reference_points, lacing=Longest)
xyz_components = XyzComponents(xyz_from_reference_point, lacing=Longest)
UV = Uv(xyz_components.out0, xyz_components.out1, lacing=Longest)
select_polygon_edges = MultipleCurvesBySelection()  # 6 picked in the model
get_element_location = Custom[Get Element Location](Element_s=select_polygon_edges)  # Returns the location of an element as an XYZ (or if it's line-based the start and end point of the line), along with some booleans to help filtering the results. Use this for some element types (e.g. walls or lines) that do not work with the built-in Get Family Instance Location node.
transpose_lists = Transpose(get_element_location.Location_s)
first_of_list = First(transpose_lists)
xyz_components_2 = XyzComponents(first_of_list, lacing=Longest)
UV_2 = Uv(xyz_components_2.out0, xyz_components_2.out1, lacing=Longest)
is_point_inside_polygon = Custom[Is Point Inside Polygon](Point_UV_s=UV, Polygon_UVs=UV_2)  # Determines if a point is inside the space enclosed by a polygon
filter_by_boolean_mask = FilterMask(select_reference_points, is_point_inside_polygon)
watch = Watch(filter_by_boolean_mask.out0)
watch_2 = Watch(filter_by_boolean_mask.out1)
