# Dynamo graph IsRelatedToMass.dyn (Dynamo 0.6.3.35252)

category = Categories(index=877)
get_family_instances_by_category = Custom[Get Family Instances By Category](BuiltInCategories=category)  # Gets all family instances in the model for a given list of categories
watch = Watch(get_family_instances_by_category)
is_related_to_mass = Custom[Is Related To Mass](Element_s=watch)  # Returns true if an object (wall, roof, floor or curtain system) has been modelled by face and the underlying mass still exists.
watch_2 = Watch(is_related_to_mass)
