# Dynamo graph LawOfCosines.dyn (Dynamo 0.6.3.5256)

C = DoubleSliderInput(2.5, range=0..5)
B = DoubleSliderInput(3, range=0..5)
A = DoubleSliderInput(1.5, range=0..5)
# note: This example also requires the package Unit Conversion to be installed.
angle_by_law_of_cosines = Custom[Angle By Law Of Cosines](A=A, B=B, C=C)  # Computes an angle of a triangle using the law of cosines. A is the opposite side of the triangle while B and C are the sides forming the angle.
opposite_side_by_law_of_cosines = Custom[Opposite Side By Law Of Cosines](A=C, B=B, gamma=angle_by_law_of_cosines)  # Computes the length of the missing side of a triangle using the law of cosines. Gamma is the angle between sides A and B.
watch = Watch(opposite_side_by_law_of_cosines)
radians_to_degrees = Custom[Radians To Degrees](rad=angle_by_law_of_cosines)  # Converts radians into degrees
watch_2 = Watch(radians_to_degrees)
