# Dynamo graph LawOfSines.dyn (Dynamo 0.6.3.5256)

alpha = IntegerSliderInput(60, range=0..90)
degrees_to_radians = Custom[Degrees To Radians](deg=alpha)  # Converts degrees into radians
side_b = DoubleSliderInput(3.057553957, range=0..5)
beta = IntegerSliderInput(45, range=0..90)
degrees_to_radians_2 = Custom[Degrees To Radians](deg=beta)
# note: This example also requires the package Unit Conversion to be installed.
side_by_law_of_sines = Custom[Side By Law Of Sines](alpha=degrees_to_radians, B=side_b, beta=degrees_to_radians_2)  # Determines the length of a side based on the law of sines. (Alpha is the angle opposite side A and beta is the angle opposite side B...)
angle_by_law_of_sines = Custom[Angle By Law Of Sines](A=side_by_law_of_sines, B=side_b, beta=degrees_to_radians_2)  # Determines the angle of a triangle based on the law of sines. (Alpha is the angle opposite side A and beta is the angle opposite side B...)
radians_to_degrees = Custom[Radians To Degrees](rad=angle_by_law_of_sines)  # Converts radians into degrees
watch = Watch(radians_to_degrees)
watch_2 = Watch(side_by_law_of_sines)
