# Dynamo graph LinesThroughPointsClosedLoop.dyn (Dynamo 0.6.3.7375)

number = DoubleInput(0)
XYZ = Xyz(number, number, number, lacing=Longest)
number_2 = DoubleInput(7)
XYZ_2 = Xyz(number_2, number, number, lacing=Longest)
XYZ_3 = Xyz(number_2, number_2, number, lacing=Longest)
XYZ_4 = Xyz(number, number_2, number, lacing=Longest)
list = NewList(index0=XYZ, index1=XYZ_2, index2=XYZ_3, index3=XYZ_4)
lines_through_points_closed_loop = Custom[Lines Through Points (Closed Loop)](list=list)  # Works just like the built-in node Lines Through Points (creates a series of lines through a list of points) - except that it creates a *closed* loop of lines.
watch_3d = Watch3D(lines_through_points_closed_loop)
lines_through_points = CurvesThroughPoints(list, lacing=Longest)
watch_3d_2 = Watch3D(lines_through_points)
