# Dynamo graph MaterialStuff.dyn (Dynamo 0.6.3.22045)

select_elements = MultipleCurvesBySelection()  # 15 picked in the model
boolean = BoolSelector(false)
get_materials_from_element = Custom[Get Materials From Element](Element_s=select_elements, Include_paint_materials=boolean)  # Retrieves all materials froma given element
watch = Watch(get_materials_from_element.Material_Areas_sqft)
watch_2 = Watch(get_materials_from_element.Material_Volumes_cbft)
watch_3 = Watch(get_materials_from_element.Materials)
get_material_properties = Custom[Get Material Properties](Material_s=watch_3)  # Retrieves a number of properties froma given material
watch_4 = Watch(get_material_properties.Transparency)
watch_5 = Watch(get_material_properties.Smoothness)
watch_6 = Watch(get_material_properties.Class)
watch_7 = Watch(get_material_properties.Color)
watch_8 = Watch(get_material_properties.Glow_bool)
watch_9 = Watch(get_material_properties.Shininess)
