# Dynamo graph Normalization.dyn (Dynamo 0.6.3.5256)

number_of_values = IntegerSliderInput(10, range=0..20)
normalized_sequence = Custom[Normalized Sequence](N=number_of_values)  # Creates a sequence of N values between 0 and 1
watch = Watch(normalized_sequence)
formula = Formula("Sin(x*Pi/2)", lacing=Longest)
normalized_sequence_by_function = Custom[Normalized Sequence by Function](f_x=formula, N=number_of_values)  # Creates a sequence of N values between 0 and 1 driven by a function
watch_2 = Watch(normalized_sequence_by_function)
invert_normalized_value = Custom[Invert Normalized Value](normalized_sequence)  # Inverts a value between 0 and 1 or a boolean to its opposite (1-x)
watch_3 = Watch(invert_normalized_value)
min_scale = DoubleSliderInput(26.57873701, range=0..100)
max_scale = DoubleSliderInput(56.7490008, range=0..100)
scale_normalized_value = Custom[Scale Normalized Value](val=normalized_sequence, Min=min_scale, Max=max_scale)  # Scales a normalized value according to a given minimum and maximum
watch_4 = Watch(scale_normalized_value)
normalize_value = Custom[Normalize Value](val=scale_normalized_value, Min=min_scale, Max=max_scale)  # Converts a value into a normalized value according to a value range
watch_5 = Watch(normalize_value)
