# Dynamo graph ParameterExists.dyn (Dynamo 0.6.3.5260)

string = StringInput("Finish")
string_2 = StringInput("Room Bounding")
select_elements = MultipleCurvesBySelection()  # 3 picked in the model
watch = Watch(select_elements)
parameter_exists = Custom[Parameter Exists](param=string_2, Element_s=watch)  # Checks if an element contains a parameter of a given name
watch_2 = Watch(parameter_exists)
string_3 = StringInput("Sill Height")
