# Dynamo graph ParseSolarRadiationCSV.dyn (Dynamo 0.6.3.5256)

file_path = StringFilename("C:\Users\adieckmann\Desktop\BIM2P\_dynamo\DynamoSamples\_PackageSamples\Parse Solar Radiation CSV\SolarRadiationData.csv")
parse_solar_radiation_csv = Custom[Parse Solar Radiation CSV](path=file_path)  # Parses a Vasari solar radiation analysis CSV file and returns lists of absolute and normalized radiation values, their XYZ coordinates and their normals as well as the highest and lowest radiation value and a the total of all radiation samples
watch = Watch(parse_solar_radiation_csv.RadiationTotal)
watch_2 = Watch(parse_solar_radiation_csv.RadiationMin)
watch_3 = Watch(parse_solar_radiation_csv.Radiation)
watch_4 = Watch(parse_solar_radiation_csv.RadiationNormalized)
watch_5 = Watch(parse_solar_radiation_csv.Normals)
watch_6 = Watch(parse_solar_radiation_csv.RadiationMax)
watch_7 = Watch(parse_solar_radiation_csv.XYZs)
