# Dynamo graph PartStuff.dyn (Dynamo 0.6.3.7375)

category = Categories(index=563)
get_family_instances_by_category = Custom[Get Family Instances By Category](BuiltInCategories=category)  # Gets all family instances in the model for a given list of categories
watch = Watch(get_family_instances_by_category)
get_source_element_from_part = Custom[Get Source Element From Part](Part_s=watch)  # Retrieves the element a given part was made from
watch_2 = Watch(get_source_element_from_part)
