# Dynamo graph PathStuff.dyn (Dynamo 0.6.3.7375)

number = DoubleInput(1)
to_string = ToString(number)
number_2 = DoubleInput(4)
to_string_2 = ToString(number_2)
number_3 = DoubleInput(2)
to_string_3 = ToString(number_3)
list = NewList(index0=to_string, index1=to_string_3)
number_4 = DoubleInput(3)
to_string_4 = ToString(number_4)
list_2 = NewList(index0=to_string_3, index1=to_string_4)
list_3 = NewList(index0=to_string_4, index1=to_string_2)
list_4 = NewList(index0=to_string, index1=to_string_2)
list_5 = NewList(index0=to_string_3, index1=to_string_2)
list_6 = NewList(index0=list, index1=list_2, index2=list_3, index3=list_4, index4=list_5)
find_all_paths = Custom[Find All Paths](start_str=to_string, end_str=to_string_2, connections_str=list_6)  # Finds all possible paths between two nodes. Connections need to be input as a list of value pairs.
watch = Watch(find_all_paths)
find_shortest_path = Custom[Find Shortest Path](start_str=to_string, end_str=to_string_2, connections_str=list_6)  # Finds the shortest path (fewest steps) between two nodes. Connections need to input as a list of value pairs.
watch_2 = Watch(find_shortest_path)
