# Dynamo graph PhasingStuff.dyn (Dynamo 0.6.3.5291)

string = StringInput("Existing")
get_phase_by_name = Custom[Get Phase by Name](str=string)  # Returns the phase of a given name (if it exists)
watch = Watch(get_phase_by_name)
select_elements = MultipleCurvesBySelection()  # 5 picked in the model
watch_2 = Watch(select_elements)
get_phases = Custom[Get Phases](Element_s=watch_2)  # Gets the created and demolished phases of an element
watch_3 = Watch(get_phases.Created)
watch_4 = Watch(get_phases.Demolished)
# note: This sample also needs the Get And Set Name package to be installed.
list_phases = Custom[List Phases]()  # Lists all phases in the active document
watch_5 = Watch(list_phases)
get_name = Custom[Get Name](element_s=watch_5)  # Gets the name of a given Revit element (if possible)
watch_6 = Watch(get_name)
