# Dynamo graph PlaneByReferenceOrSketchPlane.dyn (Dynamo 0.6.3.7375)

new_sketch_plane = Custom[New Sketch Plane]()
watch = Watch(new_sketch_plane)
plane_by_reference_or_sketch = Custom[Plane By Reference Or Sketch Plane](Ref_Sketch_Plane_s=watch)  # Retrieves the plane of a reference or sketch plane.
watch_2 = Watch(plane_by_reference_or_sketch)
select_elements = MultipleCurvesBySelection()
