# Dynamo graph PlaneFromFirst3XYZs.dyn (Dynamo 0.6.3.5256)

x_axis = XyzBasisX(lacing=Longest)
y_axis = XyzBasisY(lacing=Longest)
z_axis = XyzBasisZ(lacing=Longest)
number = DoubleInput(0)
XYZ = Xyz(number, number, number, lacing=Longest)
list = NewList(index0=x_axis, index1=y_axis, index2=z_axis, index3=XYZ)
plane_from_first_3_xyzs = Custom[Plane From First 3 XYZs](list=list)  # Returns a plane, its origin and its normal based on the first three XYZs in a given list
watch = Watch(plane_from_first_3_xyzs.normal)
watch_2 = Watch(plane_from_first_3_xyzs.plane)
watch_3 = Watch(plane_from_first_3_xyzs.origin)
