# Dynamo graph PlaneFromPlanarFace.dyn (Dynamo 0.6.3.22045)

# note: This sample also needs the package Get Faces From Solid to be installed.
number = DoubleInput(0)
XYZ = Xyz(number, number, number, lacing=Longest)
number_2 = DoubleInput(5)
XYZ_2 = Xyz(number_2, number_2, number_2, lacing=Longest)
box_by_two_corners = SolidBoxByTwoCorners(XYZ, XYZ_2, lacing=Longest)
get_faces_from_solid = Custom[Get Faces From Solid](Solid_s=box_by_two_corners)  # Retrieves a list of faces from a given solid
plane_from_planar_face = Custom[Plane From Planar Face](Planar_face_s=get_faces_from_solid)  # Creates a plane from a planar face
watch = Watch(plane_from_planar_face.Plane_s)
watch_2 = Watch(plane_from_planar_face.Normal_s)
watch_3 = Watch(plane_from_planar_face.Origin_s)
