# Dynamo graph PlaneProperties.dyn (Dynamo 0.6.3.7375)

xy_plane = XyPlane(lacing=Longest)
plane_properties = Custom[Plane Properties](Plane_s=xy_plane)  # Returns the normal and origin of a given plane as well as its X and Y vectors.
watch = Watch(plane_properties.Normal_s)
watch_2 = Watch(plane_properties.Origin_s)
watch_3 = Watch(plane_properties.X_Vector_s)
watch_4 = Watch(plane_properties.Y_Vector_s)
