# Dynamo graph PlaneVectorIntersection.dyn (Dynamo 0.6.3.22045)

select_reference_point = PointBySelection()  # 1 picked in the model
xyz_from_reference_point = XyzFromReferencePoint(select_reference_point, lacing=Longest)
select_reference_point_2 = PointBySelection()  # 1 picked in the model
xyz_from_reference_point_2 = XyzFromReferencePoint(select_reference_point_2, lacing=Longest)
direction_to_xyz = XyzStartEndVector(xyz_from_reference_point, xyz_from_reference_point_2, lacing=Longest)
select_reference_point_3 = PointBySelection()  # 1 picked in the model
xyz_from_reference_point_3 = XyzFromReferencePoint(select_reference_point_3, lacing=Longest)
select_reference_point_4 = PointBySelection()  # 1 picked in the model
xyz_from_reference_point_4 = XyzFromReferencePoint(select_reference_point_4, lacing=Longest)
select_reference_point_5 = PointBySelection()  # 1 picked in the model
xyz_from_reference_point_5 = XyzFromReferencePoint(select_reference_point_5, lacing=Longest)
list = NewList(index0=xyz_from_reference_point_3, index1=xyz_from_reference_point_4, index2=xyz_from_reference_point_5)
best_fit_plane = BestFitPlane(list, lacing=Longest)
plane_vector_intersection = Custom[Plane-Vector Intersection](Vector_Basepoint=xyz_from_reference_point, Vector_Normalized=direction_to_xyz, Plane=best_fit_plane.out0, Plane_Origin=best_fit_plane.out2, Plane_Normal=best_fit_plane.out1)  # Finds the intersection point between a plane and a vector
reference_point = ReferencePointByXyz(plane_vector_intersection.XYZ, lacing=Longest)
watch = Watch(plane_vector_intersection.Vector_Is_Parallel)
watch_2 = Watch(plane_vector_intersection.Vector_In_Plane)
