# Dynamo graph PointSequences.dyn (Dynamo 0.6.3.7375)

XYZ = Xyz(lacing=Longest)
number = DoubleInput(1)
XYZ_2 = Xyz(number, lacing=Longest)
XYZ_3 = Xyz(number, number, lacing=Longest)
list = NewList(index0=XYZ, index1=XYZ_2, index2=XYZ_3)
XYZ_4 = Xyz(arg1=number, lacing=Longest)
list_2 = NewList(index0=XYZ, index1=XYZ_3, index2=XYZ_4)
list_3 = NewList(index0=XYZ, index1=XYZ_4, index2=XYZ_4)
list_4 = NewList(index0=list, index1=list_2, index2=list_3)
watch = Watch(list_4)
shortest_path_from_point = Custom[Shortest Path From Point Sequences](seq=watch)  # Retrieves the shortest path from a number of point sequences
watch_2 = Watch(shortest_path_from_point.distance)
watch_3 = Watch(shortest_path_from_point.bool)
distance_from_point_sequence = Custom[Distance From Point Sequence]()  # Retrieves the accumulated distances of a sequence of points
map = Map(distance_from_point_sequence, watch)
watch_4 = Watch(map)
greatest_distance_in_point = Custom[Greatest Distance in Point Sequence](XYZs=list, XYZ=XYZ)  # Retrieves the furthest point in a sequence of points
watch_5 = Watch(greatest_distance_in_point.distance)
watch_6 = Watch(greatest_distance_in_point.bool)
