# Dynamo graph PythagoreanTheorem.dyn (Dynamo 0.7.1.29946)

double_slider = DoubleSlider(4, range=0..10)
double_slider_2 = DoubleSlider(5, range=0..10)
hypotenuse_by_pythagoras = Custom[Hypotenuse By Pythagoras](A=double_slider, B=double_slider_2)  # Computes the length of the hypotenuse of a right triangle using the Pythagorean Theorem. A and B are the legs / catheti of the triangle.
watch = Watch(hypotenuse_by_pythagoras)
cathetus_by_pythagoras = Custom[Cathetus By Pythagoras](C=hypotenuse_by_pythagoras, B=double_slider_2)  # Computes the length of one of the catheti / legs of a right triangle using the Pythagorean Theorem. B is the other leg / cathetus of the triangle while C is the hypotenuse.
watch_2 = Watch(cathetus_by_pythagoras)
