# Dynamo graph RecursiveBooleanDifference.dyn (Dynamo 0.6.3.7375)

XYZ = Xyz(lacing=Longest)
number_slider = DoubleSliderInput(20, range=0..20)
number = DoubleInput(1)
XYZ_2 = Xyz(number_slider, number_slider, number, lacing=Longest)
box_by_two_corners = SolidBoxByTwoCorners(XYZ, XYZ_2, lacing=Longest)
formula = Formula("n-1", n=number_slider, lacing=Longest)
number_2 = DoubleInput(0..n..#4, formula, lacing=Longest)
XYZ_3 = Xyz(number_2, number_2, lacing=Longest)
number_3 = DoubleInput(1..n..#4, number_slider, lacing=Longest)
XYZ_4 = Xyz(number_3, number_3, number, lacing=Longest)
box_by_two_corners_2 = SolidBoxByTwoCorners(XYZ_3, XYZ_4, lacing=Longest)
recursive_boolean_difference = Custom[Recursive Boolean Difference](First_Solid=box_by_two_corners, List_of_Solids=box_by_two_corners_2)  # This node recursively applies the boolean difference node to a solid for each item in a given list of solids.
watch_3d = Watch3D(recursive_boolean_difference)
