# Dynamo graph RegularExpressions.dyn (Dynamo 0.6.3.31052)

string = StringInput("[a-zA-Z]*berry")
string_2 = StringInput("Strawberry")
string_3 = StringInput("Raspberry")
string_4 = StringInput("Banana")
list = NewList(index0=string_2, index1=string_3, index2=string_4)
filter_list_by_regular = Custom[Filter List by Regular Expression Matches](regex=string, list=list)  # Filters out all items from a list of strings that don't begin with the regular expression. The syntax for regular expressions is explained at http://ironpython-test.readthedocs.org/en/latest/howto/regex.html
watch = Watch(filter_list_by_regular.in)
match_regular_expression = Custom[Match Regular Expression](regex=string, string_s=list)  # Determines if a regular expression matches a string (or a list of strings) and returns a boolean value (or a list, depending on the input). The syntax for regular expressions is explained at http://ironpython-test.readthedocs.org/en/latest/howto/regex.html
watch_2 = Watch(match_regular_expression)
watch_3 = Watch(filter_list_by_regular.out)
