# Dynamo graph RemoveDuplicatesFromList.dyn (Dynamo 0.6.3.7375)

number = DoubleInput(1..10)
number_2 = DoubleInput(2)
repeat = Repeat(number, number_2)
flatten_completely = FlattenList(repeat)
watch = Watch(flatten_completely)
remove_duplicates_from_list = Custom[Remove Duplicates From List](list=watch)  # Removes duplicate items from a given list. Will *not* work for Revit elements!
watch_2 = Watch(remove_duplicates_from_list)
# note: This example also requires the Get Element Location package to be installed.
select_elements = MultipleCurvesBySelection()  # 10 picked in the model
repeat_2 = Repeat(select_elements, number_2)
list = NewList(index0=repeat_2, index1=repeat)
flatten_completely_2 = FlattenList(list)
watch_3 = Watch(flatten_completely_2)
remove_duplicate_revit_elements = Custom[Remove Duplicate Revit Elements From List](list=watch_3)  # Removes all duplicates of Revit elements from a given list. (Will also remove any other duplicates from a list...)
watch_4 = Watch(remove_duplicate_revit_elements.elements)
watch_5 = Watch(remove_duplicate_revit_elements.other)
get_element_location = Custom[Get Element Location](Element_s=list)  # Returns the location of an element as an XYZ (or if it's line-based the start and end point of the line), along with some booleans to help filtering the results. Use this for some element types (e.g. walls or lines) that do not work with the built-in Get Family Instance Location node.
flatten_completely_3 = FlattenList(get_element_location.Location_s)
watch_6 = Watch(flatten_completely_3)
remove_duplicates_uvs_or_xyzs = Custom[Remove Duplicates UVs Or XYZs From List](UVs_XYZs=watch_6)  # Removes duplicate UVs or XYZs from a given list. May work for Revit Elements as well.
watch_7 = Watch(remove_duplicates_uvs_or_xyzs)
