# Dynamo graph ReplaceSubstring.dyn (Dynamo 0.6.3.5259)

string = StringInput("There are no windows in this wall.")
string_2 = StringInput("window")
string_3 = StringInput("wall")
replace_substring = Custom[Replace Substring](string_s=string, search=string_2, replace=string_3)  # Replaces a specified part (substring) of a string by another string
watch = Watch(replace_substring)
