# Dynamo graph ReturnListOrSingleValue.dyn (Dynamo 0.6.3.5256)

number = DoubleInput(1)
list = NewList(index0=number)
number_2 = DoubleInput(4)
list_2 = NewList(index0=number_2)
return_list_or_single_value = Custom[Return List Or Single Value](list_1=list, list_2=list_2)  # If the list in input #1 has only one item, only the first item of the list in input #2 will be returned.
watch = Watch(return_list_or_single_value)
number_3 = DoubleInput(1)
number_4 = DoubleInput(3)
list_3 = NewList(index0=number_3, index1=number_4)
number_5 = DoubleInput(4)
number_6 = DoubleInput(2)
list_4 = NewList(index0=number_5, index1=number_6)
return_list_or_single_value_2 = Custom[Return List Or Single Value](list_1=list_3, list_2=list_4)
watch_2 = Watch(return_list_or_single_value_2)
