# Dynamo graph RevitAPIHelpers.dyn (Dynamo 0.6.3.31052)

string = StringInput("*WALL*")
search_in_builtinparameters = Custom[Search In BuiltInParameters](search_term=string)  # Lets you search in Revit's built-in parameters. Search is case-sensitive. Use * as a wildcard.
watch = Watch(search_in_builtinparameters)
string_2 = StringInput("*Wall*")
search_in_builtincategories = Custom[Search In BuiltInCategories](search_term=string_2)  # Lets you search in Revit's built-in categories. Search is case-sensitive. Use * as a wildcard.
watch_2 = Watch(search_in_builtincategories)
list_builtinparameters = Custom[List BuiltInParameters]()  # List all the BuiltInCategories available
watch_3 = Watch(list_builtinparameters)
list_builtincategories = Custom[List BuiltInCategories]()  # List all the BuiltInCategories available
watch_4 = Watch(list_builtincategories)
select_elements = MultipleCurvesBySelection()  # 1 picked in the model
watch_5 = Watch(select_elements)
get_members = Custom[Get Members](element_s=watch_5)  # Gets a list of all members (properties and methods) of a selected element
watch_6 = Watch(get_members)
string_3 = StringInput("*Get*")
flatten_completely = FlattenList(watch_5)
first_of_list = First(flatten_completely)
search_in_members = Custom[Search In Members](search_term=string_3, Element=first_of_list)  # Lets you search in an element's members. Search is case-sensitive. Use * as a wildcard.
watch_7 = Watch(search_in_members)
