# Dynamo graph RoofAndFloorStuff.dyn (Dynamo 0.6.3.5256)

select_elements = MultipleCurvesBySelection()
builtincategory_roofs = Custom[BuiltInCategory Roofs]()  # Returns the BuiltInCategory Roofs
# note: This example also requires the Select By Category package to be installed.
get_family_instances_by_category = Custom[Get Family Instances By Category](BuiltInCategories=builtincategory_roofs)  # Gets all family instances in the model for a given list of categories
filter_roofs_by_creation_method = Custom[Filter Roofs By Creation Method](Roof_Instance_s=get_family_instances_by_category)  # Filters a list of roofs by their method of creation.
watch = Watch(filter_roofs_by_creation_method.In_Place)
watch_2 = Watch(filter_roofs_by_creation_method.No_Roofs)
watch_3 = Watch(filter_roofs_by_creation_method.By_Footprint)
watch_4 = Watch(filter_roofs_by_creation_method.By_Extrusion)
watch_5 = Watch(filter_roofs_by_creation_method.By_Face)
list = NewList(index0=watch_3, index1=watch_4, index2=watch_5)
get_roof_type = Custom[Get Roof Type](Roof_Instance_s=list)  # Retrieves the roof type for a given roof instance
watch_6 = Watch(get_roof_type)
builtincategory_floors = Custom[BuiltInCategory Floors]()  # Returns the BuiltInCategory Floors
get_family_instances_by_category_2 = Custom[Get Family Instances By Category](BuiltInCategories=builtincategory_floors)
watch_7 = Watch(get_family_instances_by_category_2)
get_floor_type = Custom[Get Floor Type](Floor_Instance_s=watch_7)  # Retrieves the floor type for a given floor instance
watch_8 = Watch(get_floor_type)
list_2 = NewList(index0=watch_6, index1=watch_8)
flatten_completely = FlattenList(list_2)
compound_structure_has_variable = Custom[Compound Structure Has Variable Layer](Element_Type_s=flatten_completely)  # Checks if the compound structure of a given floor or roof instance contains a variable layer.
watch_9 = Watch(compound_structure_has_variable)
slab_shape_has_been_modified = Custom[Slab Shape Has Been Modified](Element_s=watch_7)  # Checks if the shape of a roof or floor slab has been modified with the shape editing tools
watch_10 = Watch(slab_shape_has_been_modified)
filter_roofs_by_kind = Custom[Filter Roofs By Kind](Roof_Instance_s=watch_3)  # Filters a list of roofs by their kind (basic or glazed).
watch_11 = Watch(filter_roofs_by_kind.Basic)
watch_12 = Watch(filter_roofs_by_kind.Glazed)
