# Dynamo graph SlabShapeByXYZs.dyn (Dynamo 0.6.3.22045)

select_face = FormElementBySelection()  # 1 picked in the model
integer_slider = IntegerSliderInput(3, range=0..10)
uv_and_xyz_grid_from_face = Custom[UV And XYZ Grid From Face](face=select_face, U=integer_slider, V=integer_slider)  # Returns UV coordinates, XYZ coordinates and normals for a face with UV subdivision
# note: This example also requires the XYZ Grid From Face package to be installed.
select_elements = MultipleCurvesBySelection()  # 1 picked in the model
first_of_list = First(select_elements)
watch = Watch(first_of_list)
slab_shape_by_xyzs = Custom[Slab Shape By XYZs](XYZs=uv_and_xyz_grid_from_face.XYZs, Floor_Roof=watch)  # Transform a slab shape based on a list of XYZs. PLEASE NOTE: Will reset any previous edits on the slab shape. May likely need to be used in conjunction with a Transaction node.
transaction = Transaction(slab_shape_by_xyzs)
watch_2 = Watch(transaction)
