# Dynamo graph RoofStuff.dyn (Dynamo 0.6.3.5256)

select_elements = MultipleCurvesBySelection()
builtincategory_roofs = Custom[BuiltInCategory Roofs]()  # Returns the BuiltInCategory Roofs
# note: This example also requires the Select By Category package to be installed.
get_family_instances_by_category = Custom[Get Family Instances By Category](BuiltInCategories=builtincategory_roofs)  # Gets all family instances in the model for a given list of categories
filter_roofs_by_creation_method = Custom[Filter Roofs By Creation Method](Roof_Instance_s=get_family_instances_by_category)  # Filters a list of roofs by their method of creation.
watch = Watch(filter_roofs_by_creation_method.In_Place)
watch_2 = Watch(filter_roofs_by_creation_method.No_Roofs)
watch_3 = Watch(filter_roofs_by_creation_method.By_Footprint)
watch_4 = Watch(filter_roofs_by_creation_method.By_Extrusion)
watch_5 = Watch(filter_roofs_by_creation_method.By_Face)
list = NewList(index0=watch_3, index1=watch_4, index2=watch_5)
get_roof_type = Custom[Get Roof Type](Roof_Instance_s=list)  # Retrieves the roof type for a given roof instance
watch_6 = Watch(get_roof_type)
