# Dynamo graph CreateRoomSeparators.dyn (Dynamo 0.6.3.22045)

select_elements = MultipleCurvesBySelection()  # 2 picked in the model
geometry_curve_from_model_curve = CurveFromModelCurve(select_elements, lacing=Longest)
new_sketch_plane = Custom[New Sketch Plane]()
get_active_view = ActiveRevitView(lacing=Longest)
room_separators_from_curves = Custom[Room Separators From Curves](Curve_s=geometry_curve_from_model_curve, Sketch_plane=new_sketch_plane, View=get_active_view)  # Creates room separation lines from geometry curves. PLEASE NOTE: Might need a transaction node to work.
watch = Watch(room_separators_from_curves)
