# Dynamo graph DoorSequenceFromRoomSequence.dyn (Dynamo 0.6.3.7375)

category = Categories(index=709)
get_family_instances_by_category = Custom[Get Family Instances By Category](BuiltInCategories=category)  # Gets all family instances in the model for a given list of categories
flatten_completely = FlattenList(get_family_instances_by_category)
category_2 = Categories(index=206)
get_family_instances_by_category_2 = Custom[Get Family Instances By Category](BuiltInCategories=category_2)
flatten_completely_2 = FlattenList(get_family_instances_by_category_2)
string = StringInput("New Construction")
get_phase_by_name = Custom[Get Phase by Name](str=string)  # Returns the phase of a given name (if it exists)
only_toroom_or_fromroom_is_set = Custom[Only ToRoom OR FromRoom Is Set](Doors_Windows=flatten_completely_2, Phase=get_phase_by_name)  # Evaluates if a door or window has only set one of the ToRoom / FromRoom properties. This may help to determine whether a door/window is external.
filter_by_boolean_mask = FilterMask(flatten_completely_2, only_toroom_or_fromroom_is_set)
door_sequence_from_room_sequence = Custom[Door Sequence From Room Sequence](Rooms=flatten_completely, Doors=filter_by_boolean_mask.out1, Phase=get_phase_by_name)  # Retrieves a sequence of doors connecting a given sequence of rooms (if possible)
watch = Watch(door_sequence_from_room_sequence)
