# Dynamo graph RoomStuff.dyn (Dynamo 0.6.3.22045)

# note: This sample also requires the Select By Category and Phasing Stuff packages to be installed.
category = Categories(index=892)
category_2 = Categories(index=206)
list = NewList(index0=category, index1=category_2)
get_family_instances_by_category = Custom[Get Family Instances By Category](BuiltInCategories=list)  # Gets all family instances in the model for a given list of categories
watch = Watch(get_family_instances_by_category)
string = StringInput("New Construction")
get_phase_by_name = Custom[Get Phase by Name](str=string)  # Returns the phase of a given name (if it exists)
watch_2 = Watch(get_phase_by_name)
rooms_from_doors_and_windows = Custom[Rooms From Doors And Windows](Door_s_Window_s=watch, Phase=watch_2)  # Gets the rooms that are connected by a given door or a window
watch_3 = Watch(rooms_from_doors_and_windows.From_Room_s)
watch_4 = Watch(rooms_from_doors_and_windows.To_Room_s)
category_3 = Categories(index=709)
get_family_instances_by_category_2 = Custom[Get Family Instances By Category](BuiltInCategories=category_3)
get_room_boundaries = Custom[Get Room Boundaries](Room_s=get_family_instances_by_category_2)  # Gets a list of all boundary elements of a given room
watch_5 = Watch(get_room_boundaries)
get_area = Custom[Get Area](element_s=get_family_instances_by_category_2)  # Returns the area property of a given element (if that element has such a property)
watch_6 = Watch(get_area)
only_toroom_or_fromroom_is_set = Custom[Only ToRoom OR FromRoom Is Set](Doors_Windows=get_family_instances_by_category, Phase_Name=string)  # Evaluates if a door or window has only set one of the ToRoom / FromRoom properties. This may help to determine whether a door/window is external.
watch_7 = Watch(only_toroom_or_fromroom_is_set)
