# Dynamo graph SelectByCategory.dyn (Dynamo 0.6.3.5291)

builtincategory_walls = Custom[BuiltInCategory Walls]()  # Returns the BuiltInCategory Walls
builtincategory_doors = Custom[BuiltInCategory Doors]()  # Returns the BuiltInCategory Doors
builtincategory_windows = Custom[BuiltInCategory Windows]()  # Returns the BuiltInCategory Windows
list = NewList(index0=builtincategory_walls, index1=builtincategory_doors, index2=builtincategory_windows)
get_family_symbols_by_category = Custom[Get Family Symbols By Category](BuiltInCategories=list)  # Gets all family symbols in the model (does *not *work for system families)
watch = Watch(get_family_symbols_by_category)
get_family_instances_by_category = Custom[Get Family Instances By Category](BuiltInCategories=list)  # Gets all family instances in the model for a given list of categories
watch_2 = Watch(get_family_instances_by_category)
filter_list_by_category = Custom[Filter List By Category](element_s=watch_2, BuiltInCategory=builtincategory_walls)  # Filters out all elements that are not of a specified category
watch_3 = Watch(filter_list_by_category)
builtincategory_floors = Custom[BuiltInCategory Floors]()  # Returns the BuiltInCategory Floors
list_2 = NewList(index0=builtincategory_windows, index1=builtincategory_floors)
has_instances_of_categories = Custom[Has Instances of Categories](BuiltInCategories=list_2)  # Checks if family instances of specified categories are present in the model.
watch_4 = Watch(has_instances_of_categories.any)
watch_5 = Watch(has_instances_of_categories.all)
watch_6 = Watch(has_instances_of_categories.per_category)
watch_7 = Watch(has_instances_of_categories.instances)
is_of_category = Custom[Is Of Category](element_s=get_family_instances_by_category, BuiltInCategory=builtincategory_walls)  # Checks whether an element is of a specified category
watch_8 = Watch(is_of_category)
builtincategory_casework = Custom[BuiltInCategory Casework]()  # Returns the BuiltInCategory Casework
builtincategory_ceiling_openings = Custom[BuiltInCategory Ceiling Openings]()  # Returns the BuiltInCategory Ceiling Openings
builtincategory_ceilings = Custom[BuiltInCategory Ceilings]()  # Returns the BuiltInCategory Ceilings
builtincategory_column_openings = Custom[BuiltInCategory Column Openings]()  # Returns the BuiltInCategory Column Openings
builtincategory_columns = Custom[BuiltInCategory Columns]()  # Returns the BuiltInCategory (Architectural) Columns
builtincategory_curtain_systems = Custom[BuiltInCategory Curtain Systems]()  # Returns the BuiltInCategory Curtain Systems
builtincategory_curtain_wall = Custom[BuiltInCategory Curtain Wall Mullions]()  # Returns the BuiltInCategory Curtain Wall Mullions
builtincategory_curtain_wall_2 = Custom[BuiltInCategory Curtain Wall Panels]()  # Returns the BuiltInCategory Curtain Wall Panels
builtincategory_entourage = Custom[BuiltInCategory Entourage]()  # Returns the BuiltInCategory Entourage
builtincategory_fascias = Custom[BuiltInCategory Fascias]()  # Returns the BuiltInCategory Fascias
builtincategory_floor_openings = Custom[BuiltInCategory Floor Openings]()  # Returns the BuiltInCategory Floor Openings
builtincategory_floor_slab_edges = Custom[BuiltInCategory Floor Slab Edges]()  # Returns the BuiltInCategory Floor Slab Edges
builtincategory_furniture = Custom[BuiltInCategory Furniture]()  # Returns the BuiltInCategory Furniture
builtincategory_furniture_2 = Custom[BuiltInCategory Furniture Systems]()  # Returns the BuiltInCategory Furniture Systems
builtincategory_generic_models = Custom[BuiltInCategory Generic Models]()  # Returns the BuiltInCategory Generic Models
builtincategory_grids = Custom[BuiltInCategory Grids]()  # Returns the BuiltInCategory Grids
builtincategory_gutters = Custom[BuiltInCategory Gutters]()  # Returns the BuiltInCategory Gutters
builtincategory_levels = Custom[BuiltInCategory Levels]()  # Returns the BuiltInCategory Levels
builtincategory_lighting = Custom[BuiltInCategory Lighting Fixtures]()  # Returns the BuiltInCategory Lighting Fixtures
builtincategory_lines = Custom[BuiltInCategory Lines]()  # Returns the BuiltInCategory Lines
builtincategory_mass_floors = Custom[BuiltInCategory Mass Floors]()  # Returns the BuiltInCategory Mass Floors
builtincategory_masses = Custom[BuiltInCategory Masses]()  # Returns the BuiltInCategory Masses
builtincategory_pads = Custom[BuiltInCategory Pads]()  # Returns the BuiltInCategory Pads
builtincategory_parking = Custom[BuiltInCategory Parking]()  # Returns the BuiltInCategory Parking
builtincategory_planting = Custom[BuiltInCategory Planting]()  # Returns the BuiltInCategory Planting
builtincategory_plumbing = Custom[BuiltInCategory Plumbing Fixtures]()  # Returns the BuiltInCategory Plumbing Fixtures
builtincategory_property_lines = Custom[BuiltInCategory Property Lines]()  # Returns the BuiltInCategory Property Lines
builtincategory_railings = Custom[BuiltInCategory Railings]()  # Returns the BuiltInCategory Railings
builtincategory_ramps = Custom[BuiltInCategory Ramps]()  # Returns the BuiltInCategory Ramps
builtincategory_roof_openings = Custom[BuiltInCategory Roof Openings]()  # Returns the BuiltInCategory Roof Openings
builtincategory_roof_soffits = Custom[BuiltInCategory Roof Soffits]()  # Returns the BuiltInCategory Roof Soffits
builtincategory_roofs = Custom[BuiltInCategory Roofs]()  # Returns the BuiltInCategory Roofs
builtincategory_rooms = Custom[BuiltInCategory Rooms]()  # Returns the BuiltInCategory Rooms
builtincategory_shaft_openings = Custom[BuiltInCategory Shaft Openings]()  # Returns the BuiltInCategory Shaft Openings
builtincategory_speciality = Custom[BuiltInCategory Speciality Equipment]()  # Returns the BuiltInCategory Speciality Equipment
builtincategory_stacked_walls = Custom[BuiltInCategory Stacked Walls]()  # Returns the BuiltInCategory Stacked Walls
builtincategory_stairs = Custom[BuiltInCategory Stairs]()  # Returns the BuiltInCategory Stairs
builtincategory_structural = Custom[BuiltInCategory Structural Columns]()  # Returns the BuiltInCategory Structural Columns
builtincategory_structural_2 = Custom[BuiltInCategory Structural Framing]()  # Returns the BuiltInCategory Structural Framing
builtincategory_structural_3 = Custom[BuiltInCategory Structural Framing Openings]()  # Returns the BuiltInCategory Structural Framing Openings
builtincategory_structural_4 = Custom[BuiltInCategory Structural Trusses]()  # Returns the BuiltInCategory Structural Trusses
builtincategory_topography = Custom[BuiltInCategory Topography]()  # Returns the BuiltInCategory Topography
builtincategory_wall_openings = Custom[BuiltInCategory Wall Openings (Arc)]()  # Returns the BuiltInCategory Wall Openings (Arc)
builtincategory_wall_openings_2 = Custom[BuiltInCategory Wall Openings (Straight)]()  # Returns the BuiltInCategory Wall Openings (Straight)
builtincategory_wall_reveals = Custom[BuiltInCategory Wall Reveals]()  # Returns the BuiltInCategory Wall Reveals
builtincategory_wall_sweeps = Custom[BuiltInCategory Wall Sweeps]()  # Returns the BuiltInCategory Wall Sweeps
builtincategory_structural_5 = Custom[BuiltInCategory Structural Foundations]()  # Returns the BuiltInCategory Structural Foundations
get_active_view = ActiveRevitView(lacing=Longest)
boolean = BoolSelector(false)
select_curve = CurvesBySelection()
evaluate_curve = XyzOnCurveOrEdge(boolean, select_curve, lacing=Longest)
boolean_2 = BoolSelector(true)
evaluate_curve_2 = XyzOnCurveOrEdge(boolean_2, select_curve, lacing=Longest)
direction_to_xyz = XyzStartEndVector(evaluate_curve, evaluate_curve_2, lacing=Longest)
reference_intersector_by = Custom[Reference Intersector By Category](View=get_active_view, BuiltInCategory=builtincategory_walls, VectorStart=evaluate_curve, VectorEnd=direction_to_xyz)  # Finds all elements of a specified category that intersect with a list of vectors
watch_9 = Watch(reference_intersector_by)
builtincategory_sheets = Custom[BuiltInCategory Sheets]()  # Returns the BuiltInCategory Sheets
builtincategory_detail = Custom[BuiltInCategory Detail Components]()  # Returns the BuiltInCategory Detail Components
builtincategory_legend = Custom[BuiltInCategory Legend Components]()  # Returns the BuiltInCategory Legend Components
builtincategory_plan_regions = Custom[BuiltInCategory Plan Regions]()  # Returns the BuiltInCategory Plan Regions
builtincategory_room_separation = Custom[BuiltInCategory Room Separation Lines]()  # Returns the BuiltInCategory Room Separation Lines
builtincategory_elevations = Custom[BuiltInCategory Elevations]()  # Returns the BuiltInCategory Elevations
builtincategory_views = Custom[BuiltInCategory Views]()  # Returns the BuiltInCategory Views
builtincategory_dimensions = Custom[BuiltInCategory Dimensions]()  # Returns the BuiltInCategory Dimensions
builtincategory_text_notes = Custom[BuiltInCategory Text Notes]()  # Returns the BuiltInCategory Text Notes
list_3 = NewList(index0=builtincategory_dimensions, index1=builtincategory_text_notes)
get_active_view_2 = ActiveRevitView(lacing=Longest)
get_view_dependent_family = Custom[Get View-Dependent Family Instances By Category](BuiltInCategories=list_3, View_s=get_active_view_2)  # Gets all view-dependent family instances in a given view for a given list of categories - useful for finding annotation elements
watch_10 = Watch(get_view_dependent_family)
builtincategory_casework_tags = Custom[BuiltInCategory Casework Tags]()  # Returns the BuiltInCategory Casework Tags
builtincategory_ceiling_tags = Custom[BuiltInCategory Ceiling Tags]()  # Returns the BuiltInCategory Ceiling Tags
builtincategory_curtain_wall_3 = Custom[BuiltInCategory Curtain Wall Panel Tags]()  # Returns the BuiltInCategory Curtain Wall Panel Tags
builtincategory_detail_component = Custom[BuiltInCategory Detail Component Tags]()  # Returns the BuiltInCategory Detail Component Tags
builtincategory_door_tags = Custom[BuiltInCategory Door Tags]()  # Returns the BuiltInCategory Door Tags
builtincategory_floor_tags = Custom[BuiltInCategory Floor Tags]()  # Returns the BuiltInCategory Floor Tags
builtincategory_furniture_system = Custom[BuiltInCategory Furniture System Tags]()  # Returns the BuiltInCategory Furniture System Tags
builtincategory_furniture_tags = Custom[BuiltInCategory Furniture Tags]()  # Returns the BuiltInCategory Furniture Tags
builtincategory_generic_model = Custom[BuiltInCategory Generic Model Tags]()  # Returns the BuiltInCategory Generic Model Tags
builtincategory_keynote_tags = Custom[BuiltInCategory Keynote Tags]()  # Returns the BuiltInCategory Keynote Tags
builtincategory_lighting_fixture = Custom[BuiltInCategory Lighting Fixture Tags]()  # Returns the BuiltInCategory Lighting Fixture Tags
builtincategory_material_tags = Custom[BuiltInCategory Material Tags]()  # Returns the BuiltInCategory Material Tags
builtincategory_multi_category = Custom[BuiltInCategory Multi Category Tags]()  # Returns the BuiltInCategory Multi Category Tags
builtincategory_parking_tags = Custom[BuiltInCategory Parking Tags]()  # Returns the BuiltInCategory Parking Tags
builtincategory_planting_tags = Custom[BuiltInCategory Planting Tags]()  # Returns the BuiltInCategory Planting Tags
builtincategory_plumbing_fixture = Custom[BuiltInCategory Plumbing Fixture Tags]()  # Returns the BuiltInCategory Plumbing Fixture Tags
builtincategory_roof_tags = Custom[BuiltInCategory Roof Tags]()  # Returns the BuiltInCategory Roof Tags
builtincategory_room_tags = Custom[BuiltInCategory Room Tags]()  # Returns the BuiltInCategory Room Tags
builtincategory_stairs_tags = Custom[BuiltInCategory Stairs Tags]()  # Returns the BuiltInCategory Stairs Tags
builtincategory_structural_6 = Custom[BuiltInCategory Structural Column Tags]()  # Returns the BuiltInCategory Structural Column Tags
builtincategory_structural_7 = Custom[BuiltInCategory Structural Foundation Tags]()  # Returns the BuiltInCategory Structural Foundation Tags
builtincategory_structural_8 = Custom[BuiltInCategory Structural Framing Tags]()  # Returns the BuiltInCategory Structural Framing Tags
builtincategory_tags = Custom[BuiltInCategory Tags]()  # Returns the BuiltInCategory Tags
builtincategory_wall_tags = Custom[BuiltInCategory Wall Tags]()  # Returns the BuiltInCategory Wall Tags
builtincategory_window_tags = Custom[BuiltInCategory Window Tags]()  # Returns the BuiltInCategory Window Tags
builtincategory_displacement = Custom[BuiltInCategory Displacement Elements]()  # Returns the BuiltInCategory Displacement Elements
builtincategory_spot_coordinates = Custom[BuiltInCategory Spot Coordinates]()  # Returns the BuiltInCategory Spot Coordinates
builtincategory_spot_elevations = Custom[BuiltInCategory Spot Elevations]()  # Returns the BuiltInCategory Spot Elevations
builtincategory_spot_slopes = Custom[BuiltInCategory Spot Slopes]()  # Returns the BuiltInCategory Spot Slopes
builtincategory_insulation_lines = Custom[BuiltInCategory Insulation Lines]()  # Returns the BuiltInCategory Insulation Lines
builtincategory_generic = Custom[BuiltInCategory Generic Annotation]()  # Returns the BuiltInCategory Generic Annotation
builtincategory_parts = Custom[BuiltInCategory Parts]()  # Returns the BuiltInCategory Parts
