# Dynamo graph SequenceWithLeadingZeros.dyn (Dynamo 0.6.3.5262)

number = DoubleInput(1)
number_2 = DoubleInput(18)
number_3 = DoubleInput(start..end, number, number_2, lacing=Longest)
number_4 = DoubleInput(3)
sequence_with_leading_zeros = Custom[Sequence With Leading Zeros](seq=number_3, n=number_4)  # Adds leading zeros to a sequence of numbers
watch = Watch(sequence_with_leading_zeros)
