# Dynamo graph Similar.dyn (Dynamo 0.7.1.29946)

double_slider = DoubleSlider(50, range=0..100)
double_slider_2 = DoubleSlider(46, range=0..100)
double_slider_3 = DoubleSlider(0.038, range=0..1)
similar = Custom[Similar](A=double_slider, B=double_slider_2, Tolerance=double_slider_3)  # Computes the difference between two values and whether that difference is within a given tolerance percentage
watch = Watch(similar.IsSimilar)
watch_2 = Watch(similar.Difference)
