# Dynamo graph Quadrilateral.dyn (Dynamo 0.7.0.25040)

# note: This example also requires the XYZ Grid From Face package to be installed.
select_face = FormElementBySelection()  # 1 picked in the model
U = IntegerSliderInput(5, range=0..20)
V = IntegerSliderInput(3, range=0..20)
uv_xyz_grid_from_face = Custom[UV/XYZ Grid From Face](face=select_face, U=U, V=V)  # Returns UV coordinates, XYZ coordinates and normals for a face with UV subdivision
reverse = BoolSelector(false)
shift = IntegerSliderInput(0, range=0..3)
quadrilateral_pattern_from_grid = Custom[Quadrilateral Pattern From Grid](list=uv_xyz_grid_from_face.UVs, V=V, reverse=reverse, shift_placement=shift)  # Creates groups of points from a list of UVs or XYZs for the placement of quadrilateral panels. The placement pattern can be reversed (boolean) and shifted (integer).
select_family_type = FamilyTypeSelector(index=3)
adaptive_component_by_uvs_on = AdaptiveComponentByUvsOnFace(quadrilateral_pattern_from_grid, select_face, select_family_type, lacing=Longest)
