# Dynamo graph QuadrilateralCheckerboard.dyn (Dynamo 0.7.0.25040)

# note: This example also requires the XYZ Grid From Face package to be installed.
select_face = FormElementBySelection()  # 1 picked in the model
U = IntegerSliderInput(10, range=0..20)
V = IntegerSliderInput(5, range=0..20)
uv_xyz_grid_from_face = Custom[UV/XYZ Grid From Face](face=select_face, U=U, V=V)  # Returns UV coordinates, XYZ coordinates and normals for a face with UV subdivision
reverse_placement_point_order = BoolSelector(false)
shift_placement_point_order = IntegerSliderInput(0, range=0..3)
quadrilateral_pattern = Custom[Quadrilateral Pattern (Checkerboard)](list=uv_xyz_grid_from_face.UVs, V=V, reverse=reverse_placement_point_order, shift_placement=shift_placement_point_order)  # Creates groups of points from a list of UVs or XYZs for the placement of quadrilateral panels in a checkerboard pattern. The placement pattern can be reversed (boolean) and shifted (integer).
select_family_type_for_odd_rows = FamilyTypeSelector(index=3)
adaptive_component_by_uvs_on = AdaptiveComponentByUvsOnFace(quadrilateral_pattern.list_type_A, select_face, select_family_type_for_odd_rows, lacing=Longest)
select_family_type_for_even_rows = FamilyTypeSelector(index=2)
adaptive_component_by_uvs_on_2 = AdaptiveComponentByUvsOnFace(quadrilateral_pattern.list_type_B, select_face, select_family_type_for_even_rows, lacing=Longest)
