# Dynamo graph TriangularFlatMirrored.dyn (Dynamo 0.6.3.7375)

# note: This example also requires the XYZ Grid From Face package to be installed.
select_face = FormElementBySelection()  # 1 picked in the model
U = IntegerSliderInput(7, range=0..20)
V = IntegerSliderInput(6, range=0..20)
uv_xyz_grid_from_face = Custom[UV/XYZ Grid From Face](face=select_face, U=U, V=V)  # Returns UV coordinates, XYZ coordinates and normals for a face with UV subdivision
shift_rows = BoolSelector(false)
reverse_a = BoolSelector(true)
reverse_b = BoolSelector(false)
boolean = BoolSelector(false)
boolean_2 = BoolSelector(false)
boolean_3 = BoolSelector(false)
boolean_4 = BoolSelector(false)
shift_placement_a = IntegerSliderInput(2, range=0..2)
shift_placement_b = IntegerSliderInput(2, range=0..2)
integer_slider = IntegerSliderInput(0, range=0..2)
integer_slider_2 = IntegerSliderInput(0, range=0..2)
integer_slider_3 = IntegerSliderInput(0, range=0..2)
integer_slider_4 = IntegerSliderInput(0, range=0..2)
rotate_grid_by_90 = BoolSelector(true)
triangular_pattern_flat_mirrored = Custom[Triangular Pattern (Flat, Mirrored) From Grid](list=uv_xyz_grid_from_face.UVs, V=V, Shift_Rows_bool=shift_rows, Reverse_rows_lying=reverse_a, Reverse_rows_standing=reverse_b, Reverse_left_corners_lying=boolean, Reverse_left_corners_standing=boolean_2, Reverse_right_corners_lying=boolean_3, Reverse_right_corners_standing=boolean_4, Shift_placement_rows_lying=shift_placement_a, Shift_placement_rows_standing=shift_placement_b, Shift_placement_left_corners_lying=integer_slider, Shift_placement_left_corners_standing=integer_slider_2, Shift_placement_right_corners_lying=integer_slider_3, Shift_placement_right_corners_standing=integer_slider_4, Rotate_grid_by_90=rotate_grid_by_90)  # Creates groups of points from a list of UVs or XYZs for the placement of triangular panels. The placement pattern can be reversed (boolean) and shifted (integer).
# note: Right corners, lying
select_family_type = FamilyTypeSelector(index=1)
adaptive_component_by_uvs_on = AdaptiveComponentByUvsOnFace(triangular_pattern_flat_mirrored.Right_corners_lying, select_face, select_family_type, lacing=Longest)
# note: Right corners, standing
select_family_type_2 = FamilyTypeSelector(index=1)
adaptive_component_by_uvs_on_2 = AdaptiveComponentByUvsOnFace(triangular_pattern_flat_mirrored.Right_corners_standing, select_face, select_family_type_2, lacing=Longest)
# note: Left corners, standing
select_family_type_3 = FamilyTypeSelector(index=1)
adaptive_component_by_uvs_on_3 = AdaptiveComponentByUvsOnFace(triangular_pattern_flat_mirrored.Left_corners_standing, select_face, select_family_type_3, lacing=Longest)
# note: Left corners, lying
select_family_type_4 = FamilyTypeSelector(index=1)
adaptive_component_by_uvs_on_4 = AdaptiveComponentByUvsOnFace(triangular_pattern_flat_mirrored.Left_corners_lying, select_face, select_family_type_4, lacing=Longest)
# note: Rows, standing
select_family_type_5 = FamilyTypeSelector(index=1)
adaptive_component_by_uvs_on_5 = AdaptiveComponentByUvsOnFace(triangular_pattern_flat_mirrored.Rows_standing, select_face, select_family_type_5, lacing=Longest)
# note: Rows, lying
select_family_type_6 = FamilyTypeSelector(index=1)
adaptive_component_by_uvs_on_6 = AdaptiveComponentByUvsOnFace(triangular_pattern_flat_mirrored.Rows_lying, select_face, select_family_type_6, lacing=Longest)
