# Dynamo graph SolveTriangleByXYZs.dyn (Dynamo 0.6.3.35252)

select_reference_point = PointBySelection()  # 1 picked in the model
xyz_from_reference_point = XyzFromReferencePoint(select_reference_point, lacing=Longest)
select_reference_point_2 = PointBySelection()  # 1 picked in the model
xyz_from_reference_point_2 = XyzFromReferencePoint(select_reference_point_2, lacing=Longest)
select_reference_point_3 = PointBySelection()  # 1 picked in the model
xyz_from_reference_point_3 = XyzFromReferencePoint(select_reference_point_3, lacing=Longest)
solve_triangle_by_xyzs = Custom[Solve Triangle By XYZs](XYZ_A=xyz_from_reference_point, XYZ_B=xyz_from_reference_point_2, XYZ_C=xyz_from_reference_point_3)  # Solves a triangle based on the XYZ coordinates of its vertices.
watch = Watch(solve_triangle_by_xyzs.c)
watch_2 = Watch(solve_triangle_by_xyzs.a)
watch_3 = Watch(solve_triangle_by_xyzs.b)
watch_4 = Watch(solve_triangle_by_xyzs.gamma)
watch_5 = Watch(solve_triangle_by_xyzs.beta)
watch_6 = Watch(solve_triangle_by_xyzs.alpha)
watch_7 = Watch(solve_triangle_by_xyzs.Hc)
watch_8 = Watch(solve_triangle_by_xyzs.Hb)
watch_9 = Watch(solve_triangle_by_xyzs.Ha)
watch_10 = Watch(solve_triangle_by_xyzs.Area)
watch_11 = Watch(solve_triangle_by_xyzs.Plane)
watch_12 = Watch(solve_triangle_by_xyzs.Normal)
watch_13 = Watch(solve_triangle_by_xyzs.Origin_Centroid)
watch_14 = Watch(solve_triangle_by_xyzs.Incircle_radius)
watch_15 = Watch(solve_triangle_by_xyzs.Incircle_center)
