# Dynamo graph StandardColours.dyn (Dynamo 0.6.3.7375)

green = Custom[Green]()  # Returns the colour green.
red = Custom[Red]()  # Returns the colour red.
number = DoubleInput(0)
color_range = ColorRange(green, red, number, lacing=Longest)
white = Custom[White]()  # Returns the colour white.
black = Custom[Black]()  # Returns the colour black.
color_range_2 = ColorRange(white, black, number, lacing=Longest)
blue = Custom[Blue]()  # Returns the colour blue.
lime = Custom[Lime]()  # Returns the colour lime.
color_range_3 = ColorRange(blue, lime, number, lacing=Longest)
purple = Custom[Purple]()  # Returns the colour purple.
yellow = Custom[Yellow]()  # Returns the colour yellow.
color_range_4 = ColorRange(purple, yellow, number, lacing=Longest)
teal = Custom[Teal]()  # Returns the colour teal.
silver = Custom[Silver]()  # Returns the colour silver.
color_range_5 = ColorRange(teal, silver, number, lacing=Longest)
olive = Custom[Olive]()  # Returns the colour olive.
navy = Custom[Navy]()  # Returns the colour navy.
color_range_6 = ColorRange(olive, navy, number, lacing=Longest)
maroon = Custom[Maroon]()  # Returns the colour maroon.
grey = Custom[Grey]()  # Returns the colour grey.
color_range_7 = ColorRange(maroon, grey, number, lacing=Longest)
fuchsia = Custom[Fuchsia]()  # Returns the colour fuchsia a.k.a. magenta.
aqua = Custom[Aqua]()  # Returns the colour aqua.
color_range_8 = ColorRange(fuchsia, aqua, number, lacing=Longest)
