# Dynamo graph StandardColours.dyn (Dynamo 0.6.3.5262)

black = Custom[Black]()  # Returns the colour black.
aqua = Custom[Aqua]()  # Returns the colour aqua.
fuchsia = Custom[Fuchsia]()  # Returns the colour fuchsia a.k.a. magenta.
number = DoubleInput(0)
color_range = ColorRange(aqua, fuchsia, number, lacing=Longest)
white = Custom[White]()  # Returns the colour white.
red = Custom[Red]()  # Returns the colour red.
green = Custom[Green]()  # Returns the colour green.
blue = Custom[Blue]()  # Returns the colour blue.
grey = Custom[Grey]()  # Returns the colour grey.
lime = Custom[Lime]()  # Returns the colour lime.
maroon = Custom[Maroon]()  # Returns the colour maroon.
navy = Custom[Navy]()  # Returns the colour navy.
olive = Custom[Olive]()  # Returns the colour olive.
purple = Custom[Purple]()  # Returns the colour purple.
silver = Custom[Silver]()  # Returns the colour silver.
teal = Custom[Teal]()  # Returns the colour teal.
yellow = Custom[Yellow]()  # Returns the colour yellow.
