# Dynamo graph SubcategoryStuff.dyn (Dynamo 0.6.3.5260)

builtincategory_masses = Custom[BuiltInCategory Masses]()  # Returns the BuiltInCategory Masses
string = StringInput("MyNewSubcategory")
create_new_subcategory = Custom[Create New Subcategory](BuiltInCategory=builtincategory_masses, Name=string)  # Creates a new subcategory for a given element category (unless a subcategory of that name already exists - in that case it returns the existing subcategory)
watch = Watch(create_new_subcategory)
boolean = BoolSelector(false)
# note: This example also needs the Select By Category  package to be installed.
select_elements = MultipleCurvesBySelection()  # 4 picked in the model
set_element_subcategory = Custom[Set Element Subcategory](Subcategory=watch, Cut_Projection=boolean, Element_s=select_elements)  # Assigns the given element(s) to the specified subcategory (0 for Cut, 1 for Projection).
watch_2 = Watch(set_element_subcategory.Success)
watch_3 = Watch(set_element_subcategory.Fail)
string_2 = StringInput("MyExistingSubcategory")
select_subcategory_by_name = Custom[Select Subcategory By Name](BuiltInCategory=builtincategory_masses, Name=string_2)  # Selects a subcategory for a given element category by name
watch_4 = Watch(select_subcategory_by_name)
boolean_2 = BoolSelector(false)
select_elements_2 = MultipleCurvesBySelection()  # 4 picked in the model
set_element_subcategory_2 = Custom[Set Element Subcategory](Subcategory=watch_4, Cut_Projection=boolean_2, Element_s=select_elements_2)
watch_5 = Watch(set_element_subcategory_2.Fail)
watch_6 = Watch(set_element_subcategory_2.Success)
