# Dynamo graph SwapUV.dyn (Dynamo 0.6.3.7375)

# note: This example also requires the XYZ Grid From Face package to be installed.
select_face = FormElementBySelection()  # 1 picked in the model
integer_slider = IntegerSliderInput(4, range=0..20)
integer_slider_2 = IntegerSliderInput(10, range=0..20)
uv_and_xyz_grid_from_face = Custom[UV And XYZ Grid From Face](face=select_face, U=integer_slider, V=integer_slider_2)  # Returns UV coordinates, XYZ coordinates and normals for a face with UV subdivision
watch_3d = Watch3D(uv_and_xyz_grid_from_face.XYZs)
swap_uv = Custom[Swap UV](UV_s=uv_and_xyz_grid_from_face.UVs)  # Swaps U and V coordinates
evaluate_surface = XyzEvaluate(swap_uv, select_face, lacing=Longest)
watch_3d_2 = Watch3D(evaluate_surface)
