# Dynamo graph Switch.dyn (Dynamo 0.6.3.31052)

number = DoubleInput(1..4)
string = StringInput("A")
string_2 = StringInput("B")
string_3 = StringInput("C")
string_4 = StringInput("D")
list = NewList(index0=string, index1=string_2, index2=string_3, index3=string_4)
string_5 = StringInput("E")
switch = Custom[Switch](cases=number, values=list, default=string_5)  # Emulates the Switch/Case statement that is available in multiple programming languages.
number_2 = DoubleInput(2..6)
map = Map(switch, number_2)
watch = Watch(map)
