# Dynamo graph TopoStuff.dyn (Dynamo 0.6.3.5256)

# note: Ths example also requires the package Select By Category to be installed.
select_elements = MultipleCurvesBySelection()  # 1 picked in the model
builtincategory_topography = Custom[BuiltInCategory Topography]()  # Returns the BuiltInCategory Topography
get_family_instances_by_category = Custom[Get Family Instances By Category](BuiltInCategories=builtincategory_topography)  # Gets all family instances in the model for a given list of categories
filter_for_topo_subregions = Custom[Filter For Topo Subregions](Toposurface_s=get_family_instances_by_category)  # Filters out everything that is *not* a topo subregion. Needs Revit 2014 or newer to work.
watch = Watch(filter_for_topo_subregions.Subregions)
get_topo_points = Custom[Get Topo Points](Toposurface_s=get_family_instances_by_category)  # Gets the coordinates of the points that define one or multiple topo surface(s). Needs Revit 2014 or newer to work.
watch_2 = Watch(get_topo_points)
watch_3 = Watch(get_family_instances_by_category)
watch_4 = Watch(filter_for_topo_subregions.No_Subregions)
watch_5 = Watch(filter_for_topo_subregions.bool)
