# Dynamo graph TransformCurveLoop.dyn (Dynamo 0.6.3.22045)

number = DoubleInput(0..5)
number_2 = DoubleInput(10)
number_3 = DoubleInput(-10)
list = NewList(index0=number_2, index1=number_3, index2=number_2, index3=number_3, index4=number_2, index5=number_3)
XYZ = Xyz(number, list, lacing=Longest)
lines_through_points = CurvesThroughPoints(XYZ, lacing=Longest)
watch_3d = Watch3D(lines_through_points)
XYZ_2 = Xyz(lacing=Longest)
z_axis = XyzBasisZ(lacing=Longest)
formula = Formula("pi/2", lacing=Longest)
rotate_transform = TransformRotation(XYZ_2, z_axis, formula, lacing=Longest)
curve_loop = CurveLoop(lines_through_points, lacing=Longest)
transform_curve_loop = Custom[Transform Curve Loop](Transform=rotate_transform, CurveLoop=curve_loop)  # Returns the curve loop transformed by the transform
watch_3d_2 = Watch3D(transform_curve_loop)
