# Dynamo graph TurnIntoList.dyn (Dynamo 0.6.3.7375)

number = DoubleInput(1)
watch = Watch(number)
turn_into_list = Custom[Turn Into List](item=watch)  # Turns an element into a (flat) list
watch_2 = Watch(turn_into_list)
list = NewList(index0=number)
list_2 = NewList(index0=list)
watch_3 = Watch(list_2)
turn_into_list_2 = Custom[Turn Into List](item=watch_3)
watch_4 = Watch(turn_into_list_2)
