# Dynamo graph TurnIntoList.dyn (Dynamo 0.7.1.29946)

number = DoubleInput(1)
watch = Watch(number)
turn_into_list = Custom[Turn Into List](item=watch)  # Turns an element (or a nested list) into a flat list
watch_2 = Watch(turn_into_list)
create_list = List.Create(number)
create_list_2 = List.Create(create_list)
watch_3 = Watch(create_list_2)
turn_into_list_2 = Custom[Turn Into List](item=watch_3)
watch_4 = Watch(turn_into_list_2)
