# Dynamo graph UnitConversion.dyn (Dynamo 0.6.3.5256)

integer_slider = IntegerSliderInput(50, range=0..360)
degrees_to_radians = Custom[Degrees To Radians](deg=integer_slider)  # Converts degrees into radians
watch = Watch(degrees_to_radians)
radians_to_degrees = Custom[Radians To Degrees](rad=watch)  # Converts radians into degrees
watch_2 = Watch(radians_to_degrees)
integer_slider_2 = IntegerSliderInput(50, range=0..5000)
millimeters_to_feet = Custom[Millimeters To Feet](mm=integer_slider_2)  # Converts millimeters into feet
watch_3 = Watch(millimeters_to_feet)
feet_to_millimeters = Custom[Feet To Millimeters](ft=watch_3)  # Converts feet into millimeters
watch_4 = Watch(feet_to_millimeters)
integer_slider_3 = IntegerSliderInput(239, range=0..500)
centimeters_to_feet = Custom[Centimeters To Feet](cm=integer_slider_3)  # Converts centimeters into feet
watch_5 = Watch(centimeters_to_feet)
feet_to_centimeters = Custom[Feet To Centimeters](ft=watch_5)  # Converts feet into centimeters
watch_6 = Watch(feet_to_centimeters)
number_slider = DoubleSliderInput(30.29496403, range=0..50)
watch_7 = Watch(number_slider)
meters_to_feet = Custom[Meters To Feet](m=watch_7)  # Converts meters into feet
watch_8 = Watch(meters_to_feet)
feet_to_meters = Custom[Feet To Meters](ft=watch_8)  # Converts feet into meters
watch_9 = Watch(feet_to_meters)
