# Dynamo graph ViewStuff.dyn (Dynamo 0.6.3.5260)

builtincategory_doors = Custom[BuiltInCategory Doors]()  # Returns the BuiltInCategory Doors
builtincategory_windows = Custom[BuiltInCategory Windows]()  # Returns the BuiltInCategory Windows
list = NewList(index0=builtincategory_doors, index1=builtincategory_windows)
# note: This example also needs the Select By Category package to be installed.
builtincategory_sheets = Custom[BuiltInCategory Sheets]()  # Returns the BuiltInCategory Sheets
get_family_instances_by_category = Custom[Get Family Instances By Category](BuiltInCategories=builtincategory_sheets)  # Gets all family instances in the model for a given list of categories
get_views_on_sheet = Custom[Get Views On Sheet](Sheet_s=get_family_instances_by_category)  # Returns all views placed on a specified sheet
watch = Watch(get_views_on_sheet)
category_is_visible_in_view = Custom[Category Is Visible In View](BuiltInCategories=list, View_s=watch)  # Checks if a given category is visible in a given view
watch_2 = Watch(category_is_visible_in_view)
view_uses_view_filters = Custom[View Uses View Filters](View_s=watch)  # Checks if a given view has any view filters applied to it.
watch_3 = Watch(view_uses_view_filters)
get_view_template_from_view = Custom[Get View Template From View](View_s=watch)  # Returns the view template assigned to a given view (if one is assigned)
watch_4 = Watch(get_view_template_from_view)
flatten_completely = FlattenList(watch_4)
is_view_template = Custom[Is View Template](View_s=flatten_completely)  # Checks if a given view is a view template
watch_5 = Watch(is_view_template)
filter_views_by_type = Custom[Filter Views By Type](View_s=watch)  # Filters a list of views by their respective types.
watch_6 = Watch(filter_views_by_type.Floor_Plans)
get_underlay_from_plan_view = Custom[Get Underlay From Plan View](Plan_s=watch_6)  # Returns the view template assigned to a given view (if one is assigned)
watch_7 = Watch(get_underlay_from_plan_view)
filter_views_by_detail_level = Custom[Filter Views By Detail Level](View_s=watch)  # Filters a list of views by their respective detail levels.
watch_8 = Watch(filter_views_by_detail_level.Coarse)
watch_9 = Watch(filter_views_by_detail_level.Medium)
watch_10 = Watch(filter_views_by_detail_level.Fine)
watch_11 = Watch(filter_views_by_detail_level.Undefined)
get_view_scale = Custom[Get View Scale](View_s=watch)  # Returns the scale of a given view
watch_12 = Watch(get_view_scale)
