# Dynamo graph WallStuff.dyn (Dynamo 0.6.3.5256)

builtincategory_stacked_walls = Custom[BuiltInCategory Stacked Walls]()  # Returns the BuiltInCategory Stacked Walls
builtincategory_walls = Custom[BuiltInCategory Walls]()  # Returns the BuiltInCategory Walls
# note: This example also requires the package Select By Category to be installed.
list = NewList(index0=builtincategory_stacked_walls, index1=builtincategory_walls)
get_family_instances_by_category = Custom[Get Family Instances By Category](BuiltInCategories=list)  # Gets all family instances in the model for a given list of categories
filter_walls_by_creation_method = Custom[Filter Walls By Creation Method](Wall_Instance_s=get_family_instances_by_category)  # Filters a list of walls by their method of creation.
watch = Watch(filter_walls_by_creation_method.No_Wall_s)
watch_2 = Watch(filter_walls_by_creation_method.Standard)
watch_3 = Watch(filter_walls_by_creation_method.By_Face)
watch_4 = Watch(filter_walls_by_creation_method.In_Place)
list_2 = NewList(index0=watch_2, index1=watch_3, index2=watch_4)
get_wall_orientation = Custom[Get Wall Orientation](Wall_Instance_s=list_2)  # Gets the orientation of a given wall instance (normal of the exterior face of the wall). Will *not* work for walls hosted on mass faces or in-place walls.
watch_5 = Watch(get_wall_orientation)
get_wall_type = Custom[Get Wall Type](Wall_Instance_s=get_family_instances_by_category)  # Gets the wall type of a given wall instance.
filter_wall_types_by_function = Custom[Filter Wall Types By Function](Wall_Type_s=get_wall_type)  # Separates a list of wall types into several lists according to wall function
watch_6 = Watch(filter_wall_types_by_function.Exterior)
watch_7 = Watch(filter_wall_types_by_function.Foundation)
watch_8 = Watch(filter_wall_types_by_function.Retaining)
watch_9 = Watch(filter_wall_types_by_function.Interior)
watch_10 = Watch(filter_wall_types_by_function.No_Wall_s)
watch_11 = Watch(filter_wall_types_by_function.Core_Shaft)
watch_12 = Watch(filter_wall_types_by_function.Soffit)
builtincategory_curtain_systems = Custom[BuiltInCategory Curtain Systems]()  # Returns the BuiltInCategory Curtain Systems
get_family_instances_by_category_2 = Custom[Get Family Instances By Category](BuiltInCategories=builtincategory_curtain_systems)
get_curtain_system_type = Custom[Get Curtain System Type](Curtain_System_Instance_s=get_family_instances_by_category_2)  # Retrieves the family type for a given curtain system instance.
watch_13 = Watch(get_curtain_system_type)
filter_wall_type_by_kind = Custom[Filter Wall Type By Kind](Wall_Type_s=get_wall_type)  # Separates a list of wall types into several lists according to wall kind
watch_14 = Watch(filter_wall_type_by_kind.No_Wall_s)
watch_15 = Watch(filter_wall_type_by_kind.Basic_Walls)
watch_16 = Watch(filter_wall_type_by_kind.Curtain_Walls)
watch_17 = Watch(filter_wall_type_by_kind.Stacked_Walls)
watch_18 = Watch(filter_wall_type_by_kind.Unknown)
