# Dynamo graph XYZAxisFromVector.dyn (Dynamo 0.6.3.7375)

number_slider = DoubleSliderInput(52.87769784, range=0..100)
number_slider_2 = DoubleSliderInput(75.89928058, range=0..100)
number_slider_3 = DoubleSliderInput(33.45323741, range=0..100)
XYZ = Xyz(number_slider, number_slider_2, number_slider_3, lacing=Longest)
xyz_axis_from_vector = Custom[XYZ Axis From Vector](xyz=XYZ)  # Returns whichever main axis (X, Y or Z) is closest to a given vector
watch = Watch(xyz_axis_from_vector.string)
watch_2 = Watch(xyz_axis_from_vector.xyz)
