# Dynamo graph UVComponents.dyn (Dynamo 0.6.3.7375)

boolean = BoolSelector(false)
UV = Uv(boolean, boolean, lacing=Longest)
boolean_2 = BoolSelector(true)
UV_2 = Uv(boolean_2, boolean_2, lacing=Longest)
uv_domain = Domain2D(UV, UV_2)
integer_slider = IntegerSliderInput(3, range=0..10)
uv_grid = UvGrid(uv_domain, integer_slider, integer_slider)
watch = Watch(uv_grid)
uv_components = Custom[UV Components](UV_s=watch)  # Get the components of a UV
watch_2 = Watch(uv_components.V)
watch_3 = Watch(uv_components.U)
