# Dynamo graph VectorVectorIntersection.dyn (Dynamo 0.6.3.35252)

select_reference_point = PointBySelection()  # 1 picked in the model
xyz_from_reference_point = XyzFromReferencePoint(select_reference_point, lacing=Longest)
select_reference_point_2 = PointBySelection()  # 1 picked in the model
xyz_from_reference_point_2 = XyzFromReferencePoint(select_reference_point_2, lacing=Longest)
direction_to_xyz = XyzStartEndVector(xyz_from_reference_point, xyz_from_reference_point_2, lacing=Longest)
select_reference_point_3 = PointBySelection()  # 1 picked in the model
xyz_from_reference_point_3 = XyzFromReferencePoint(select_reference_point_3, lacing=Longest)
select_reference_point_4 = PointBySelection()  # 1 picked in the model
xyz_from_reference_point_4 = XyzFromReferencePoint(select_reference_point_4, lacing=Longest)
direction_to_xyz_2 = XyzStartEndVector(xyz_from_reference_point_3, xyz_from_reference_point_4, lacing=Longest)
vector_vector_intersection = Custom[Vector-Vector Intersection](Basepoint_1=xyz_from_reference_point, Vector_1=direction_to_xyz, Basepoint_2=xyz_from_reference_point_3, Vector_2=direction_to_xyz_2)  # Determines if two vectors intersect and returns the closest points of intersection on both vectors.
reference_point = ReferencePointByXyz(vector_vector_intersection.Closest_point_on_Vector_1, lacing=Longest)
reference_point_2 = ReferencePointByXyz(vector_vector_intersection.Closest_point_on_Vector_2, lacing=Longest)
reference_point_3 = ReferencePointByXyz(vector_vector_intersection.Average_XYZ, lacing=Longest)
watch = Watch(vector_vector_intersection.Vectors_parallel)
watch_2 = Watch(vector_vector_intersection.Vectors_intersect)
