# Dynamo graph ComponentLayoutForCNC.dyn (Dynamo 0.6.3.31052)

sheet_name = StringInput("CNC_Panels")
sheet_number = StringInput("A-1")
select_family_type_for_view = FamilyTypeSelector(index=0)  # "Select Family Type for View Sheet"
margin_between_parts = DoubleSliderInput(0.1, range=0..1)
length_from_number = LengthFromNumber(margin_between_parts)
planar_panels_only = BoolSelector(true)
# note: This definition is based on a workflow first published by Zach Kron here: http://buildz.blogspot.com/2013/09/making-revit-views-and-sheet-layouts-in.html
# It creates isolated othogonal views of curtain wall panels or adaptive components and packs them on a sheet. In addition to the original workflow it can also filter out all non-planar elements.
# For questions email me at dieckmann@caad.arch.rwth-aachen.de
# This was modified as learning material for the BIM to Production class at the chair of CAAD, RWTH Aachen University in the winter semester of 2013/14.
category = Categories(index=163)
# note: REQUIRED PACKAGES:
# - Has Out-Of-Plane XYZs
# - Plane From First 3 XYZs
# - Select By Category
# - View Stuff
get_family_instances_by_category = Custom[Get Family Instances By Category](BuiltInCategories=category)  # Gets all family instances in the model for a given list of categories
flatten_completely = FlattenList(get_family_instances_by_category)
get_family_instance_location = GetFamilyInstanceLocation(flatten_completely, lacing=Longest)
# note: Find each panel's center
average_xyzs = XyzAverage(get_family_instance_location, lacing=Longest)
has_out_of_plane_xyzs = Custom[Has Out-Of-Plane XYZs]()  # Checks a list for XYZs that are not located on a given plane
plane_from_first_3_xyzs = Custom[Plane From First 3 XYZs]()  # Returns a plane, its origin and its normal based on the first three XYZs in a given list
# note: Get a plane from each panel
map = Map(plane_from_first_3_xyzs.plane, get_family_instance_location)
tolerance = DoubleInput(0.01)
length_from_number_2 = LengthFromNumber(tolerance)
list_length = Length(flatten_completely)
repeat = Repeat(length_from_number_2, list_length, lacing=Longest)
# note: Identify non-planar panels
combine = Combine(has_out_of_plane_xyzs.bool, map, get_family_instance_location, repeat)
# note: Get lists for planar panels only
filter_by_boolean_mask = FilterMask(average_xyzs, combine)
# note: Either use planar panels only or all of them...
# note: The panel centers will be the views' target positions
if_ = Conditional(planar_panels_only, filter_by_boolean_mask.out1, average_xyzs)
plane_from_first_3_xyzs_2 = Custom[Plane From First 3 XYZs]()
# note: Get a normal from each panel
map_2 = Map(plane_from_first_3_xyzs_2.normal, get_family_instance_location)
filter_by_boolean_mask_2 = FilterMask(map_2, combine)
if_2 = Conditional(planar_panels_only, filter_by_boolean_mask_2.out1, map_2)
eye_position = DoubleInput(0.01)
length_from_number_3 = LengthFromNumber(eye_position)
scale_xyz = XyzScale(if_2, length_from_number_3, lacing=Longest)
# note: Determine the eye positions by adding the normals to the panel centers
add_xyzs = XyzAdd(if_, scale_xyz, lacing=Longest)
view_name = StringInput("Panel_")
concat_strings = ConcatStrings(view_name)
list_length_2 = Length(if_2)
number = DoubleInput(1..N, list_length_2, lacing=Longest)
number_of_digits_for_leading = IntegerSliderInput(4, range=0..5)  # "Number of Digits (for leading zeros)"
sequence_with_leading_zeros = Custom[Sequence With Leading Zeros](seq=number, n=number_of_digits_for_leading)  # Adds leading zeros to a sequence of numbers
# note: Create view names
map_3 = Map(concat_strings, sequence_with_leading_zeros)
filter_by_boolean_mask_3 = FilterMask(flatten_completely, combine)
# note: The element list will be used to define the bounding box of each view
if_3 = Conditional(planar_panels_only, filter_by_boolean_mask_3.out1, flatten_completely)
boolean = BoolSelector(true)
# note: Create isolated views of each component and name them consecutively.
axonometric_view = IsometricView(add_xyzs, if_, map_3, if_3, boolean, lacing=Longest)
# note: Slightly resize all views so there's a small margin between the laid out parts.
resize_view_crop_box = Custom[Resize View Crop Box](amt=length_from_number, View_s=axonometric_view)  # Resizes the bounding box of a given Revit element by the specified amount in X, Y and Z direction. May need to be used in conjunction with a Transaction node.
list = NewList(index0=resize_view_crop_box)
# note: Pack all views onto a sheet
view_sheet = ViewSheet(sheet_name, sheet_number, select_family_type_for_view, list)
category_2 = Categories(index=367)
