# Dynamo graph CustomSurfaceSubdivision.dyn (Dynamo 0.6.3.7375)

number = DoubleInput(1)
build_sublists = Sublists("0,a,b,1", arg1=number, lacing=Longest)
flatten_completely = FlattenList()
UV = Uv(lacing=CrossProduct)
# note: Creates custom U subdivsions for all V subdivisions on a given surface and poulates the surface with quadrilateral panels.
# First published at http://dynamobim.org/forums/topic/subdivisions-revisited-thoughts-much-appreciated/
v_subdivisions = IntegerSliderInput(10, range=0..10)
normalized_sequence = Custom[Normalized Sequence](N=v_subdivisions)  # Creates a sequence of N values between 0 and 1
select_face = FormElementBySelection()
# note: REQUIRED PACKAGES:
# - Increment/Decrement By 1
# - LibG Vector Components
# - LunchBox
# - Normalization
get_surface_domain = SurfaceDomain(select_face, lacing=Longest)
lunchbox_domain_variables = Custom[LunchBox Domain Variables](Domain=get_surface_domain)  # Gets the Min and Max variables of a Domain.
libg_vector_components = Custom[LibG Vector Components](LibG_Vector=lunchbox_domain_variables.Min)  # Gets the X, Y and Z of a LibG vector
# note: Get Min and Max values for U and V
libg_vector_components_2 = Custom[LibG Vector Components](LibG_Vector=lunchbox_domain_variables.Max)
scale_normalized_value = Custom[Scale Normalized Value](val=normalized_sequence, Min=libg_vector_components.X, Max=libg_vector_components_2.X)  # Scales a normalized value according to a given minimum and maximum
number_2 = DoubleInput(1)
build_sublists_2 = Sublists("0,1", scale_normalized_value, number_2, lacing=Longest)
list_length = Length(build_sublists_2)
formula = Formula("n-1", n=list_length, lacing=Longest)
# note: Build V subdivisions
remove_from_list = RemoveFromList(formula, build_sublists_2)
scale_normalized_value_2 = Custom[Scale Normalized Value](Min=libg_vector_components.Y, Max=libg_vector_components_2.Y)
normalized_sequence_2 = Custom[Normalized Sequence]()
formula_2 = Formula("n-1", n=v_subdivisions, lacing=Longest)
number_3 = DoubleInput(1..n, formula_2, lacing=Longest)
# note: Here, the number of U subdivisions for each V subdivision is generated randomly. Alternatively, you could just pass a list of numbers.
shuffle_list = Shuffle(number_3)
random_number_by_seed = RandomSeed(shuffle_list, lacing=Longest)
max_u_subdivisions = IntegerSliderInput(12, range=0..12)
formula_3 = Formula("round(rand*max,0)", rand=random_number_by_seed, max=max_u_subdivisions, lacing=Longest)
map = Map(normalized_sequence_2, formula_3)
# note: Build U subdivisions
map_2 = Map(scale_normalized_value_2, map)
combine = Combine(UV, remove_from_list, map_2)
# note: Build UV coordinates
map_3 = Map(flatten_completely, combine)
n1 = Custom[+1](formula_3)  # Increments a value by 1
# note: Build coordinate groups for quadrilaterals
combine_2 = Combine(build_sublists, map_3, formula_3, n1)
number_4 = DoubleInput(1)
flatten = FlattenListAmt(combine_2, number_4)
list_length_2 = Length()
map_4 = Map(list_length_2, flatten)
formula_4 = Formula("n=4", map_4, lacing=Longest)
# note: Discard all groups that don't contain four coordinates
filter_by_boolean_mask = FilterMask(flatten, formula_4)
select_family_type = FamilyTypeSelector(index=0)
adaptive_component_by_uvs_on = AdaptiveComponentByUvsOnFace(filter_by_boolean_mask, select_face, select_family_type, lacing=Longest)
