# Dynamo graph HarvestDome.dyn (Dynamo 0.6.3.7375)

# note: Required packages:
# - Increment/Decrement by 1
# - Normalization
# - Simple Rotations
# - Pythagorean Theorem
number_of_elements = IntegerSliderInput(16, range=0..20)
n1 = Custom[+1](number_of_elements)  # Increments a value by 1
normalized_sequence = Custom[Normalized Sequence](N=n1)  # Creates a sequence of N values between 0 and 1
formula = Formula("2*pi*n", n=normalized_sequence, lacing=Longest)
# note: Create a rotation transform around the Z axis for each element
rest_of_list = Rest(formula)
rotate_z_origin = Custom[Rotate Z Origin](dn=rest_of_list)  # Creates a rotation transform around the z-axis at (0,0,0)
XYZ = Xyz(lacing=Longest)
dome_radius = DoubleSliderInput(10, range=1..10)
cutoff_percentage = DoubleSliderInput(0.35, range=0..1)
# note: Compute the height of the center of the sphere (given that the flattened base is resting on the ground plane at 0,0,0)
formula_2 = Formula("r*(1-2*f)", r=dome_radius, f=cutoff_percentage, lacing=Longest)
# note: Determine sphere radius on ground level (dome footprint)
cathetus_by_pythagoras = Custom[Cathetus By Pythagoras](C=dome_radius, B=formula_2)  # Computes the length of one of the catheti / legs of a right triangle using the Pythagorean Theorem. B is the other leg / cathetus of the triangle while C is the hypotenuse.
circle = Circle(XYZ, cathetus_by_pythagoras, lacing=Longest)
XYZ_2 = Xyz(arg2=formula_2, lacing=Longest)
top_oculus_radius_percentage = DoubleSliderInput(0.1, range=0..1)
formula_3 = Formula("-r*f", r=dome_radius, f=top_oculus_radius_percentage, lacing=Longest)
# note: Find the intersection between the top oculus and the XZ plane.
cathetus_by_pythagoras_2 = Custom[Cathetus By Pythagoras](C=dome_radius, B=formula_3)
formula_4 = Formula("h1+h2", h1=formula_2, h2=cathetus_by_pythagoras_2, lacing=Longest)
XYZ_3 = Xyz(formula_3, arg2=formula_4, lacing=Longest)
bottom_oculus_radius_percentage = DoubleSliderInput(0.75, range=0..1)
formula_5 = Formula("r*f", r=dome_radius, f=bottom_oculus_radius_percentage, lacing=Longest)
# note: Find the intersection between the bottom oculus and the XZ plane.
cathetus_by_pythagoras_3 = Custom[Cathetus By Pythagoras](C=dome_radius, B=formula_5)
formula_6 = Formula("h1-h2", h1=formula_2, h2=cathetus_by_pythagoras_3, lacing=Longest)
XYZ_4 = Xyz(formula_5, arg2=formula_6, lacing=Longest)
# note: Find midpoint between the two intersection points
list = NewList(index0=XYZ_3, index1=XYZ_4)
average_xyzs = XyzAverage(list, lacing=Longest)
direction_to_xyz = XyzStartEndVector(XYZ_2, average_xyzs, lacing=Longest)
# note: Create a tilted plane that hosts the two intersection points
plane_by_normal_origin = Plane(direction_to_xyz, average_xyzs, lacing=Longest)
# note: Find intersections of dome footprint and tilted plane
curve_plane_intersection = CurvePlaneIntersection(circle, plane_by_normal_origin, lacing=Longest)
first_of_list = First(curve_plane_intersection)
transform_xyz = TransformPoint(rotate_z_origin, first_of_list, lacing=Longest)
transform_xyz_2 = TransformPoint(rotate_z_origin, XYZ_3, lacing=Longest)
number = DoubleInput(1)
get_from_list = GetFromList(number, curve_plane_intersection)
transform_xyz_3 = TransformPoint(rotate_z_origin, get_from_list, lacing=Longest)
# note: Apply the rotation transforms to all three points in order to generate a series of arcs
arc_by_start_middle_end = ArcStartMiddleEnd(transform_xyz, transform_xyz_2, transform_xyz_3, lacing=Longest)
# note: Harvest Dome
# My take on the basic structure of SLO Architecture's Harvest Dome. First published at http://autodeskvasari.com/forum/topics/dynamo-modeling-challenge
watch_3d = Watch3D(arc_by_start_middle_end)
model_curve = ModelCurve(arc_by_start_middle_end, lacing=Longest)
model_curve_2 = ModelCurve(circle, lacing=Longest)
