# Dynamo graph ParameterValuesFromImage_AC.dyn (Dynamo 0.7.0.28161)

# note: 1 = Distribute UV field by formula (only non-planar non-revolved surfaces)
# 0 = Distribute a regularly spaced UV field (all surfaces)
distribution_method = BoolSelector(false)
UV = Uv(lacing=Longest)
formula = Formula("Sin(u*Pi/2)", lacing=Longest)
# note: This definition was a first try at emulating the behaviour of the Parameter Values From Image plugin that used to be available for Vasari.
# It will let you pick a face, specify the number of UV divisions and populate it with adaptive components. You can either create linear subdivisions (all types of surfaces) or have the subdivisions driven by a formula using the NormalizedSequenceByFunction node (currently only non-planar non revolved surfaces). Use an image file to drive a parameter value for each placed instance of the adaptive component.
# For questions email me at dieckmann@caad.arch.rwth-aachen.de
# First published here: http://autodeskvasari.com/forum/topics/parameter-values-from-image-for-dynamo
U = IntegerSliderInput(12, range=0..20)
# note: REQUIRED PACKAGES:
# - Invert And Mirror Normalized Values
# - Simple Patterning
# - XYZ Grid From Face
n1 = Custom[+1](U)  # Increments a value by 1
normalized_sequence_by_function = Custom[Normalized Sequence by Function](f_x=formula, N=n1)  # Creates a sequence of N values between 0 and 1 driven by a function
formula_2 = Formula("Sin(v*Pi/2)", lacing=Longest)
# note: This formula drives the subdivision for the U values. You can substitute this with any formula that will return results in the range of 0 to 1 for inputs in the range of 0 to 1. For a linear sequence simply shorten the formula to just "u".
V = IntegerSliderInput(12, range=0..20)
n1_2 = Custom[+1](V)
normalized_sequence_by_function_2 = Custom[Normalized Sequence by Function](f_x=formula_2, N=n1_2)
# note: Distribution of UV grid by formula
cartesian_product = CartProd(UV, normalized_sequence_by_function, normalized_sequence_by_function_2)
# note: For information on formula see above
select_face = FormElementBySelection()
# note: Regular distribution of UV grid
uv_and_xyz_grid_from_face = Custom[UV And XYZ Grid From Face](face=select_face, U=U, V=V)  # Returns UV coordinates, XYZ coordinates and normals for a face with UV subdivision
if_ = Conditional(distribution_method, cartesian_product, uv_and_xyz_grid_from_face.UVs)
reverse_placement = BoolSelector(false)
shift_placement = IntegerSliderInput(0, range=0..3)
quadrilateral_pattern_from_grid = Custom[Quadrilateral Pattern From Grid](list=if_, V=V, reverse=reverse_placement, shift_placement=shift_placement)  # Creates groups of points from a list of UVs or XYZs for the placement of quadrilateral panels. The placement pattern can be reversed (boolean) and shifted (integer).
# note: This can be any 4-point Adaptive Component loaded in the family. You could also use AC's with more or fewer placement points, but then you'd have to change the placement pattern in the Build Sublists node in the center of the workspace and change the number of placement points below.
select_adaptive_component = FamilyTypeSelector(index=0)
adaptive_component_by_uvs_on = AdaptiveComponentByUvsOnFace(quadrilateral_pattern_from_grid, select_face, select_adaptive_component, lacing=Longest)
# note: The name of the instance parameter of the AC family you want to drive
instance_parameter_name = StringInput("controller")
path_to_image_file = StringFilename("No file selected.")
# note: Get an appropriate number of samples from the image file
read_image_file = ImageFileReader(path_to_image_file, V, U)
# note: Replace this with a Color Saturation or Color Hue node for different effects
color_brightness = ColorBrightness(read_image_file, lacing=Longest)
# note: Some image-related settings
invert_image_data = BoolSelector(false)
mirror_vertically = BoolSelector(false)
mirror_horizontally = BoolSelector(true)
invert_and_mirror_normalized = Custom[Invert And Mirror Normalized Values](list=color_brightness, Invert=invert_image_data, Mirror_Vertically=mirror_vertically, Mirror_Horizontally=mirror_horizontally, X=V)  # Inverts and mirrors (horizontally & vertically) a list of normalized values.
# note: Create Adaptive Components from list and set parameter values according to image brightness
set_family_instance_parameter = FamilyInstanceParameterSetter(adaptive_component_by_uvs_on, instance_parameter_name, invert_and_mirror_normalized, lacing=Longest)
