# Dynamo graph SolarRadiationToTriangularPanels.dyn (Dynamo 0.6.3.7375)

# note: This definition populates the surface of a mass with triangular curtain wall panels and matches the samples of a solar radiation analysis run in Vasari for that mass surface to the aforementioned panels. It then attempts to write a normalized value of the respective solar radiation gain into each panel. The only difference to the Solar Radiation to Quadrilateral Panels sample is that in this definition we're using multiple lists of panels (and coordinate sets) that have to be aggregated into one flat list in order for the matching process to work.
# Basic steps:
# - This definition needs a project file to run.
# - Run a solar radiation analysis on a face in Vasari and export it to a CSV file. In some cases the default analysis accuracy (medium) will not be sufficient in order to avoid some panels returning no matches for radiation samples. Start off with a medium accuracy setting and if Dynamo shows some unmatched panels (see node on the right of these notes), gradually start increasing the accuracy and re-run this definition.
# - In this definition, specify the location of the CSV file as well as the face that you have analyzed and would now like to populate.
# - Also, specify three-point pattern-based curtain wall family types that you want to use - obviously these families have to be loaded in your project file.
# - This example computes a normalized (0-1) radiation value for each panel. Therefore your family geometry needs to be driven by a number parameter that can assume values in the range of 0-1. Enter the name of that parameter in the Parameter Name input below.
# - Use the other inputs to tweak the resulting array of panels.
# For questions email me at dieckmann@caad.arch.rwth-aachen.de

select_face = FormElementBySelection()  # 1 picked in the model
U = IntegerSliderInput(9, range=0..20)
V = IntegerSliderInput(6, range=0..20)
uv_xyz_grid_from_face = Custom[UV/XYZ Grid From Face](face=select_face, U=U, V=V)  # Returns UV coordinates, XYZ coordinates and normals for a face with UV subdivision
shift_rows = BoolSelector(false)
reverse = BoolSelector(true)
reverse_2 = BoolSelector(true)
reverse_3 = BoolSelector(true)
reverse_4 = BoolSelector(true)
reverse_5 = BoolSelector(true)
reverse_6 = BoolSelector(true)
shift_placement = IntegerSliderInput(0, range=0..2)
shift_placement_2 = IntegerSliderInput(2, range=0..2)
shift_placement_3 = IntegerSliderInput(0, range=0..2)
shift_placement_4 = IntegerSliderInput(2, range=0..2)
shift_placement_5 = IntegerSliderInput(0, range=0..2)
shift_placement_6 = IntegerSliderInput(2, range=0..2)
rotate_grid_by_90 = BoolSelector(true)
triangular_pattern_flat_mirrored = Custom[Triangular Pattern (Flat, Mirrored) From Grid](list=uv_xyz_grid_from_face.UVs, V=V, Shift_Rows_bool=shift_rows, Reverse_rows_lying=reverse, Reverse_rows_standing=reverse_2, Reverse_left_corners_lying=reverse_3, Reverse_left_corners_standing=reverse_4, Reverse_right_corners_lying=reverse_5, Reverse_right_corners_standing=reverse_6, Shift_placement_rows_lying=shift_placement, Shift_placement_rows_standing=shift_placement_2, Shift_placement_left_corners_lying=shift_placement_3, Shift_placement_left_corners_standing=shift_placement_4, Shift_placement_right_corners_lying=shift_placement_5, Shift_placement_right_corners_standing=shift_placement_6, Rotate_grid_by_90=rotate_grid_by_90)  # Creates groups of points from a list of UVs or XYZs for the placement of triangular panels. The placement pattern can be reversed (boolean) and shifted (integer).
# note: Rows, lying
select_family_type = FamilyTypeSelector(index=0)
adaptive_component_by_uvs_on = AdaptiveComponentByUvsOnFace(triangular_pattern_flat_mirrored.Rows_lying, select_face, select_family_type, lacing=Longest)
# note: Rows, standing
select_family_type_2 = FamilyTypeSelector(index=0)
adaptive_component_by_uvs_on_2 = AdaptiveComponentByUvsOnFace(triangular_pattern_flat_mirrored.Rows_standing, select_face, select_family_type_2, lacing=Longest)
# note: Left corners, lying
select_family_type_3 = FamilyTypeSelector(index=0)
adaptive_component_by_uvs_on_3 = AdaptiveComponentByUvsOnFace(triangular_pattern_flat_mirrored.Left_corners_lying, select_face, select_family_type_3, lacing=Longest)
# note: Left corners, standing
select_family_type_4 = FamilyTypeSelector(index=0)
adaptive_component_by_uvs_on_4 = AdaptiveComponentByUvsOnFace(triangular_pattern_flat_mirrored.Left_corners_standing, select_face, select_family_type_4, lacing=Longest)
# note: Right corners, lying
select_family_type_5 = FamilyTypeSelector(index=0)
adaptive_component_by_uvs_on_5 = AdaptiveComponentByUvsOnFace(triangular_pattern_flat_mirrored.Right_corners_lying, select_face, select_family_type_5, lacing=Longest)
# note: Right corners, standing
select_family_type_6 = FamilyTypeSelector(index=0)
adaptive_component_by_uvs_on_6 = AdaptiveComponentByUvsOnFace(triangular_pattern_flat_mirrored.Right_corners_standing, select_face, select_family_type_6, lacing=Longest)
# note: Get a flattened list of all panels
list = NewList(index0=adaptive_component_by_uvs_on, index1=adaptive_component_by_uvs_on_2, index2=adaptive_component_by_uvs_on_3, index3=adaptive_component_by_uvs_on_4, index4=adaptive_component_by_uvs_on_5, index5=adaptive_component_by_uvs_on_6)
flatten_completely = FlattenList(list)
# note: Create filtered lists of radiation samples for each panel and find their respective average
average = Average(lacing=Longest)
file_path = StringFilename("C:\Users\adieckmann\Documents\GitHub\DynamoWIP\workflow_samples\Solar Radiation To Panels\DE_SingleDay_Average_kWh_MediumRes.csv")
parse_solar_radiation_csv = Custom[Parse Solar Radiation CSV](path=file_path)  # Parses a Vasari solar radiation analysis CSV file and returns lists of absolute and normalized radiation values, their XYZ coordinates and their normals as well as the highest and lowest radiation value and a the total of all radiation samples
filter_by_boolean_mask = FilterMask(parse_solar_radiation_csv.Radiation)
# note: Project analysis points on surface
project_point_on_face_or_plane = ProjectPointOnFace(parse_solar_radiation_csv.XYZs, select_face, lacing=Longest)
is_point_inside_polygon = Custom[Is Point Inside Polygon](Point_UV_s=project_point_on_face_or_plane.out1)  # Determines if a point is inside the space enclosed by a polygon
list_2 = NewList(index0=triangular_pattern_flat_mirrored.Rows_lying, index1=triangular_pattern_flat_mirrored.Rows_standing, index2=triangular_pattern_flat_mirrored.Left_corners_lying, index3=triangular_pattern_flat_mirrored.Left_corners_standing, index4=triangular_pattern_flat_mirrored.Right_corners_lying, index5=triangular_pattern_flat_mirrored.Right_corners_standing)
# note: Get panel placement points as a flattened list of UV coordinates
number = DoubleInput(1)
flatten = FlattenListAmt(list_2, number)
# note: Find matching panels through UV coordinates
map = Map(is_point_inside_polygon, flatten)
map_2 = Map(filter_by_boolean_mask, map)
map_3 = Map(average, map_2)
# note: Create a list of booleans for filtering out panels that have returned no matches.
is_empty = Custom[Is Empty](item_s=map_3)  # Checks if the input items are <empty>
filter_by_boolean_mask_2 = FilterMask(flatten_completely, is_empty)
# note: REQUIRED PACKAGES:
# - Is Empty
# - Is Point Inside Polygon
# - Normalization
# - Parse Solar Radiation CSV
# - Simple Patterning
# - XYZ Grid From Face
unmatched_panels = Watch(filter_by_boolean_mask_2.out0)
parameter_name = StringInput("controller")
filter_by_boolean_mask_3 = FilterMask(map_3, is_empty)
normalize_value = Custom[Normalize Value](val=filter_by_boolean_mask_3.out1, Min=parse_solar_radiation_csv.RadiationMin, Max=parse_solar_radiation_csv.RadiationMax)  # Converts a value into a normalized value according to a value range
# note: Normalize radiation values and write to specified family parameter
set_element_parameter = FamilyInstanceParameterSetter(filter_by_boolean_mask_2.out1, parameter_name, normalize_value, lacing=Longest)
