# Dynamo graph SunDirectionToPanels.dyn (Dynamo 0.6.3.7375)

select_face = FormElementBySelection()  # 1 picked in the model
U = IntegerSliderInput(16, range=0..20)
V = IntegerSliderInput(4, range=0..20)
# note: REQUIRED PACKAGES:
# - Altitude And Azimuth From Vector
# - Simple Patterning
# - XYZ Grid From Face
uv_xyz_grid_from_face = Custom[UV/XYZ Grid From Face](face=select_face, U=U, V=V)  # Returns UV coordinates, XYZ coordinates and normals for a face with UV subdivision
reverse = BoolSelector(false)
shift = IntegerSliderInput(0, range=0..3)
quadrilateral_pattern_from_grid = Custom[Quadrilateral Pattern From Grid](list=uv_xyz_grid_from_face.UVs, V=V, reverse=reverse, shift_placement=shift)  # Creates groups of points from a list of UVs or XYZs for the placement of quadrilateral panels. The placement pattern can be reversed (boolean) and shifted (integer).
select_family_type = FamilyTypeSelector(index=4)
adaptive_component_by_uvs_on = AdaptiveComponentByUvsOnFace(quadrilateral_pattern_from_grid, select_face, select_family_type, lacing=Longest)
parameter_name = StringInput("azimuth_delta")
# note: This definition populates the surface of a mass with quadrilateral curtain wall panels and computes the average surface normal of each panel. It then writes the delta between the sun's altitude and azimuth and the repective panel normals into each respective panel. This workflow could be used to animate panels that keep rotating in order to stay perpendicular to the sun rays.
# For questions email me at dieckmann@caad.arch.rwth-aachen.de
sunpath_direction = SunPathDirection()  # 1 picked in the model
boolean = BoolSelector(false)
# note: Compute altitude and azimuth for the sun's current position and for each panel's average surface normal.
# This example is made for vertical louvers - if you are designing horizontal shading devices, use the altitude outputs instead.
altitude_and_azimuth_from_vector = Custom[Altitude And Azimuth From Vector](XYZ=sunpath_direction, Deg_Rad=boolean)  # Computes the altitude and azimuth of a given vector
altitude_and_azimuth_from_vector_2 = Custom[Altitude And Azimuth From Vector](Deg_Rad=boolean)
average_xyzs = XyzAverage(lacing=Longest)
# note: Find average surface normal for each panel
quadrilateral_pattern_from_grid_2 = Custom[Quadrilateral Pattern From Grid](list=uv_xyz_grid_from_face.Normals, V=V, reverse=reverse, shift_placement=shift)
map = Map(average_xyzs, quadrilateral_pattern_from_grid_2)
map_2 = Map(altitude_and_azimuth_from_vector_2.Azimuth, map)
subtract = Subtraction(altitude_and_azimuth_from_vector.Azimuth, map_2, lacing=Longest)
# note: For each panel, find the delta to the sun's altitude and azimuth and write it to the chosen family parameter.
set_element_parameter = FamilyInstanceParameterSetter(adaptive_component_by_uvs_on, parameter_name, subtract, lacing=Longest)
