# Dynamo graph SurfaceRemixer.dyn (Dynamo 0.7.0.28161)

# note: REQUIRED PACKAGES:
# - Invert And Mirror Normalized Values
# - Sequential Loft
# - Simple Patterning
# - XYZ Grid From Face

# note: This definition will combine the XYZ values of the UV coordinates of two selected faces and create adaptive components at the resultig location. It was inspired by one one of the case studies (#6) that Zach showed in our AU2012 class "Echo Chamber - Complex Parametric Arrays in Autodesk Revit".
# There are several methods available:
# - #1: Measure distance between Face #1 XYZs and Face #2 XYZs and make it drive the offset of new XYZs over normals of Face #2 - a.k.a. TurdMaker (TM) ;-)
# - #2: Cross Product of Face #1 XYZs and Face #2 XYZs
# - #3: Add Face #2 XYZs to Face #1 XYZs
# - #4: Subtract Face #2 XYZs from Face #1 XYZs
# This definition is merely intended for form exploration. Apart from that, for me it was mainly a good exercise to familiarize myself with some of the XYZ manipulation nodes available in Dynamo.
# For questions email me at dieckmann@caad.arch.rwth-aachen.de
# First published here: http://buildz.blogspot.com/2013/09/surface-remixing-with-dynamo.html
u_v_resolution = IntegerSliderInput(20, range=0..20)
invert_placement_point_position = BoolSelector(false)
shift_placement_point_positon = IntegerSliderInput(0, range=0..3)
quadrilateral_pattern_from_grid = Custom[Quadrilateral Pattern From Grid](V=u_v_resolution, reverse=invert_placement_point_position, shift_placement=shift_placement_point_positon)  # Creates groups of points from a list of UVs or XYZs for the placement of quadrilateral panels. The placement pattern can be reversed (boolean) and shifted (integer).
# note: This can be any 4-point Adaptive Component loaded in the family.
select_adaptive_component = FamilyTypeSelector()
# note: Create Adaptive Components from list
adaptive_component_by_points = AdaptiveComponentByPoints(quadrilateral_pattern_from_grid, select_adaptive_component, lacing=Longest)
boolean = BoolSelector(true)
reference_point = ReferencePointByXyz(lacing=Longest)
# note: Use this to loft the resulting form in U or V direction
change_lofting_direction_u_vs_v = BoolSelector(false)
n1 = Custom[+1](u_v_resolution)  # Increments a value by 1
# note: Create rows of points
partition_list = Slice(arg1=n1)
transpose_lists = Transpose(partition_list)
# note: Switch columns/rows if applicable
if_ = Conditional(change_lofting_direction_u_vs_v, transpose_lists, partition_list)
# note: Create some ref points & splines
map = Map(reference_point, if_)
curve_by_points = CurveByPoints(map, boolean, lacing=Longest)
# note: If the form can't be lofted, feed the list into the Sequential Loft node instead - that should always work.
loft_form = LoftForm(boolean, curve_by_points, boolean, FormId=48800, PreferSurfaceForOneLoop=true, FormCurveToReferenceCurveMap="45488=48800;45489=48800;45490=48800;45491=48800;45492=48800;45493=48800;45494=48800;45495=48800;45496=48800;45497=48800;45498=48800;45499=48800;45500=48800;45501=48800;45502=48800;45503=48800;45504=48800;45505=48800;45506=48800;45507=48800;45508=48800;", lacing=Longest)
# note: Use an image file to further deform the resulting form?
boolean_2 = BoolSelector(false)
scale_xyz = XyzScale(lacing=Longest)
# note: Choose mapping method (there are four methods available in this definition, so you'll have to use these nested boolean switches to make a choice):
# 1 = XYZ Cross Product or Distance on Normals
# 0 = Add or Subtract XYZs
mapping_methods_switch_1 = BoolSelector(false)
# note: Choose mapping method:
# 1 = Distance on Normals a.k.a. Zach's AU2012 TurdMaker (TM) ;-)
# 0 = XYZ Cross Product
mapping_methods_1_2 = BoolSelector(true)
select_face_2 = FormElementBySelection()
# note: Turn the UV coordinates into XYZs
uv_and_xyz_grid_from_face = Custom[UV And XYZ Grid From Face](face=select_face_2, U=u_v_resolution, V=u_v_resolution)  # Returns UV coordinates, XYZ coordinates and normals for a face with UV subdivision
# note: Only for Distance on Normals method:
invert_projection_direction = BoolSelector(true)
# note: Invert Normals (if applicable)
negate_xyz = XyzNegate(uv_and_xyz_grid_from_face.Normals, lacing=Longest)
if_2 = Conditional(invert_projection_direction, negate_xyz, uv_and_xyz_grid_from_face.Normals)
invert_face_1_xyzs = BoolSelector(false)
# note: Pick faces, invert their XYZs and use the slider to control which for should dominate. Use a setting closer to 1 to emphasize face #1 (and of course closer to 0 for face #2).
# Please note:
# - The slider has NO effect on the Distance on Normals method.
# - Neither has the inversion of face #2.
select_face_1 = FormElementBySelection()
uv_and_xyz_grid_from_face_2 = Custom[UV And XYZ Grid From Face](face=select_face_1, U=u_v_resolution, V=u_v_resolution)
negate_xyz_2 = XyzNegate(uv_and_xyz_grid_from_face_2.XYZs, lacing=Longest)
if_3 = Conditional(invert_face_1_xyzs, negate_xyz_2, uv_and_xyz_grid_from_face_2.XYZs)
# note: Method #1: Measure distance between Face #1 XYZs and Face #2 XYZs and make it drive the offset of new XYZs over normals of Face #2
xyz_distance = XyzDistance(if_3, uv_and_xyz_grid_from_face.XYZs, lacing=Longest)
scale_projection = DoubleSliderInput(5, range=0..5)
formula = Formula("x*y", x=xyz_distance, y=scale_projection, lacing=Longest)
scale_xyz_2 = XyzScale(if_2, formula, lacing=Longest)
add_xyz = XyzAdd(uv_and_xyz_grid_from_face.XYZs, scale_xyz_2, lacing=Longest)
surface_mixer = DoubleSliderInput(0.5, range=0..1)
scale_xyz_3 = XyzScale(if_3, surface_mixer, lacing=Longest)
invert_face_2_xyzs = BoolSelector(false)
# note: Invert Surfaces (if applicable)
negate_xyz_3 = XyzNegate(uv_and_xyz_grid_from_face.XYZs, lacing=Longest)
if_4 = Conditional(invert_face_2_xyzs, negate_xyz_3, uv_and_xyz_grid_from_face.XYZs)
invert_normalized_value = Custom[Invert Normalized Value](surface_mixer)  # Inverts a value between 0 and 1 or a boolean to its opposite (1-x)
# note: Scale surfaces according to slider value
scale_xyz_4 = XyzScale(if_4, invert_normalized_value, lacing=Longest)
# note: Method #2: Cross Product of Face #1 XYZs and Face #2 XYZs
xyz_cross_product = XyzCrossProduct(scale_xyz_3, scale_xyz_4, lacing=Longest)
# note: Pick XYZ data according to chosen method
if_5 = Conditional(mapping_methods_1_2, add_xyz, xyz_cross_product)
# note: Choose mapping method:
# 1 = Add XYZs
# 0 = Subtract XYZs
mapping_methods_3_4 = BoolSelector(true)
# note: Method #3: Add Face #2 XYZs to Face #1 XYZs
add_xyz_2 = XyzAdd(scale_xyz_3, scale_xyz_4, lacing=Longest)
# note: Method #4: Subtract Face #2 XYZs from Face #1 XYZs
subtract_xyz = XyzSubtract(scale_xyz_3, scale_xyz_4, lacing=Longest)
if_6 = Conditional(mapping_methods_3_4, add_xyz_2, subtract_xyz)
if_7 = Conditional(mapping_methods_switch_1, if_5, if_6)
# note: Use this slider to scale the overall size of the resulting form.
# Note that when using the XYZ Cross Product method, you will probably have to scale the form down quite severely.
scale = DoubleSliderInput(1, range=0..5)
# note: Scale resulting form
scale_xyz_5 = XyzScale(if_7, scale, lacing=Longest)
path_to_image_file = StringFilename("No file selected.")
read_image_file = ImageFileReader(path_to_image_file, n1, n1)
# note: Replace this with a Color Hue or Color Saturation node for different effects.
color_brightness = ColorBrightness(read_image_file, lacing=Longest)
# note: Some image-related settings
invert_image_data = BoolSelector(true)
mirror_vertically = BoolSelector(false)
mirror_horizontally = BoolSelector(false)
invert_and_mirror_normalized = Custom[Invert And Mirror Normalized Values](list=color_brightness, Invert=invert_image_data, Mirror_Vertically=mirror_vertically, Mirror_Horizontally=mirror_horizontally, X=n1)  # Inverts and mirrors (horizontally & vertically) a list of normalized values.
# note: Use image data for further deformation (if applicable)
combine = Combine(scale_xyz, scale_xyz_5, invert_and_mirror_normalized)
if_8 = Conditional(boolean_2, combine, scale_xyz_5)
# note: Use these sliders to shift the origin of the new surface.
X = DoubleSliderInput(0, range=-500..500)
Y = DoubleSliderInput(0, range=-500..500)
Z = DoubleSliderInput(0, range=-500..500)
XYZ = Xyz(X, Y, Z, lacing=Longest)
# note: Shift origin of resulting form
# note: For lofting the resulting form, connect this output to the list input of the Partition List node below.
# Alternatively, connect it to the list input of the Quadrilateral Pattern From Grid node above to create adaptive components.
add_xyz_3 = XyzAdd(if_8, XYZ, lacing=Longest)
watch_3d = Watch3D(add_xyz_3)
sequential_loft = Custom[Sequential Loft]()  # Sequence of lofts generated considering a pair of reference curves at a time. Could be used when loft geometry isn't automatically generated from a list of reference curves.
