# Dynamo graph 1PointReactor_AC_Hexagonal.dyn (Dynamo 0.7.5.3566)

select_face = DSFaceSelection()  # 1 picked in the model
firstItem = List.FirstItem(select_face)
# note: This graph populates a face with hexagonal adaptive components and applies a reactor pattern to one of the components' parameters. In this example (based on a conceptual mass) the reactor point is being represented by a reference point. In a project file it could be represented by the location of a family instance instead.
# REQUIRED PACKAGES:
# - Clockwork for Dynamo 0.7.x
# ISSUES:
# Post issues here: https://github.com/CAAD-RWTH/ClockworkForDynamo/issues
# note: Face-related Settings
U = IntegerSlider(13, range=0..20)
V = IntegerSlider(13, range=0..20)
gridFromFace = Custom[Paneling.GridFromFace](face=firstItem, U=U, V=V)  # Returns UV coordinates, XYZ coordinates and normals for a face with UV subdivision
# note: Component-related Settings
odd_rows_reverse_placement_order = BoolSelector(false)
odd_rows_shift_placement_point = IntegerSlider(0, range=0..5)  # "Odd Rows: Shift Placement Point Order"
even_rows_reverse_placement = BoolSelector(false)  # "Even Rows: Reverse Placement Order?"
even_rows_shift_placement_point = IntegerSlider(0, range=0..5)  # "Even Rows: Shift Placement Point Order"
rotae_grid_by_90_degrees = BoolSelector(false)
# note: Create placement pattern for adaptive components
hexagonal = Custom[Paneling.Hexagonal](list=gridFromFace.UVs, V=V, ReverseOddRows=odd_rows_reverse_placement_order, ShiftPlacementOddRows=odd_rows_shift_placement_point, ReverseEvenRows=even_rows_reverse_placement, ShiftPlacementEvenRows=even_rows_shift_placement_point, RotateGridBy90Degrees=rotae_grid_by_90_degrees)
join = List.Join(hexagonal.Odd_Rows, hexagonal.Even_Rows)
select_quadrilateral_adaptive = FamilyTypes("Hex:Hex")  # "Select Quadrilateral Adaptive Component Type"
# note: Create ACs at specified locations
byParametersOnFace = AdaptiveComponent.ByParametersOnFace(join, firstItem, select_quadrilateral_adaptive, lacing=Longest)
instance_parameter_name = StringInput("controller")
invert_reactor = BoolSelector(false)
# note: Reactor-related Settings
select_reactor_point = DSModelElementSelection()  # 1 picked in the model
point = ReferencePoint.Point(select_reactor_point, lacing=Longest)
hexagonal_2 = Custom[Paneling.Hexagonal](list=gridFromFace.Points, V=V, ReverseOddRows=odd_rows_reverse_placement_order, ShiftPlacementOddRows=odd_rows_shift_placement_point, ReverseEvenRows=even_rows_reverse_placement, ShiftPlacementEvenRows=even_rows_shift_placement_point, RotateGridBy90Degrees=rotae_grid_by_90_degrees)
join_2 = List.Join(hexagonal_2.Odd_Rows, hexagonal_2.Even_Rows)
# note: Find component centers
average = Custom[Point.Average](Points=join_2)  # Determines the average of a list of points
# note: Measure distance between component center and reactor point
distanceTo = Geometry.DistanceTo(point, average, lacing=Longest)
# note: Convert distances to normalized values
normalizeRange = Custom[Math.NormalizeRange](numbers=distanceTo)  # Normalizes a range of numbers
invertNormalized = Custom[Invert Normalized Value](normalizeRange)  # "Math.InvertNormalized"; Inverts a value between 0 and 1 to its opposite (1-x)
# note: Invert values (if applicable)
if_ = If(invert_reactor, invertNormalized, normalizeRange)
# note: Write reactor value to instance parameters
setParameterByName = Element.SetParameterByName(byParametersOnFace, instance_parameter_name, if_, lacing=Longest)
