# Dynamo graph 1PointReactor_AC_Quadrilateral.dyn (Dynamo 0.7.5.3566)

select_face = DSFaceSelection()  # 1 picked in the model
firstItem = List.FirstItem(select_face)
# note: This graph populates a face with quadrilateral adaptive components and applies a reactor pattern to one of the components' parameters. In this example (based on a conceptual mass) the reactor point is being represented by a reference point. In a project file it could be represented by the location of a family instance instead.
# REQUIRED PACKAGES:
# - Clockwork for Dynamo 0.7.x
# ISSUES:
# Post issues here: https://github.com/CAAD-RWTH/ClockworkForDynamo/issues
# note: Face-related Settings
U = IntegerSlider(12, range=0..20)
V = IntegerSlider(12, range=0..20)
gridFromFace = Custom[Paneling.GridFromFace](face=firstItem, U=U, V=V)  # Returns UV coordinates, XYZ coordinates and normals for a face with UV subdivision
# note: Component-related Settings
reverse_placement_order = BoolSelector(false)
shift_placement_point_order = IntegerSlider(0, range=0..3)
# note: Create placement pattern for adaptive components
quadrilateral = Custom[Quadrilateral Pattern From Grid](list=gridFromFace.UVs, V=V, reverse=reverse_placement_order, shift_placement=shift_placement_point_order)  # "Paneling.Quadrilateral"; Creates groups of points from a list of UVs or XYZs for the placement of quadrilateral panels. The placement pattern can be reversed (boolean) and shifted (integer).
select_quadrilateral_adaptive = FamilyTypes("Quad:Quad")  # "Select Quadrilateral Adaptive Component Type"
# note: Create ACs at specified locations
byParametersOnFace = AdaptiveComponent.ByParametersOnFace(quadrilateral, firstItem, select_quadrilateral_adaptive, lacing=Longest)
instance_parameter_name = StringInput("controller")
invert_reactor = BoolSelector(false)
# note: Reactor-related Settings
select_reactor_point = DSModelElementSelection()  # 1 picked in the model
point = ReferencePoint.Point(select_reactor_point, lacing=Longest)
quadrilateral_2 = Custom[Quadrilateral Pattern From Grid](list=gridFromFace.Points, V=V, reverse=reverse_placement_order, shift_placement=shift_placement_point_order)  # "Paneling.Quadrilateral"
# note: Find component centers
average = Custom[Point.Average](Points=quadrilateral_2)  # Determines the average of a list of points
# note: Measure distance between component center and reactor point
distanceTo = Geometry.DistanceTo(point, average, lacing=Longest)
# note: Convert distances to normalized values
normalizeRange = Custom[Math.NormalizeRange](numbers=distanceTo)  # Normalizes a range of numbers
invertNormalized = Custom[Invert Normalized Value](normalizeRange)  # "Math.InvertNormalized"; Inverts a value between 0 and 1 to its opposite (1-x)
# note: Invert values (if applicable)
if_ = If(invert_reactor, invertNormalized, normalizeRange)
# note: Write reactor value to instance parameters
setParameterByName = Element.SetParameterByName(byParametersOnFace, instance_parameter_name, if_, lacing=Longest)
