# Dynamo graph 1PointReactor_AC_Triangular.dyn (Dynamo 0.7.5.3566)

select_face = DSFaceSelection()  # 1 picked in the model
firstItem = List.FirstItem(select_face)
# note: This graph populates a face with triangular adaptive components and applies a reactor pattern to one of the components' parameters. In this example (based on a conceptual mass) the reactor point is being represented by a reference point. In a project file it could be represented by the location of a family instance instead.
# REQUIRED PACKAGES:
# - Clockwork for Dynamo 0.7.x
# ISSUES:
# Post issues here: https://github.com/CAAD-RWTH/ClockworkForDynamo/issues
# note: Face-related Settings
U = IntegerSlider(12, range=0..20)
V = IntegerSlider(12, range=0..20)
gridFromFace = Custom[Paneling.GridFromFace](face=firstItem, U=U, V=V)  # Returns UV coordinates, XYZ coordinates and normals for a face with UV subdivision
# note: Component-related Settings
shift_rows = BoolSelector(false)
reverse_placement_order = BoolSelector(false)
shift_placement_point_order = IntegerSlider(0, range=0..2)
rotate_grid_by_90_degrees = BoolSelector(false)
# note: Create placement pattern for adaptive components
triangularFlatMirrored = Custom[Paneling.TriangularFlatMirrored](seq=gridFromFace.UVs, V=V, ShiftRows=shift_rows, ReverseRowsLying=reverse_placement_order, ReverseRowsStanding=reverse_placement_order, ReverseLeftCornersLying=reverse_placement_order, ReverseLeftCornersStanding=reverse_placement_order, ReverseRightCornersLying=reverse_placement_order, ReverseRightCornersStanding=reverse_placement_order, ShiftPlacementRowsLying=shift_placement_point_order, ShiftPlacementRowsStanding=shift_placement_point_order, ShiftPlacementLeftCornersLying=shift_placement_point_order, ShiftPlacementLeftCornersStanding=shift_placement_point_order, ShiftPlacementRightCornersLying=shift_placement_point_order, ShiftPlacementRightCornersStanding=shift_placement_point_order, RotateGridBy90Deg=rotate_grid_by_90_degrees)  # Creates groups of points from a list of UVs or XYZs for the placement of triangular panels. The placement pattern can be reversed (boolean) and shifted (integer).
join = List.Join(triangularFlatMirrored.RowsLying, triangularFlatMirrored.RowsStanding, triangularFlatMirrored.LeftCornersLying, triangularFlatMirrored.LeftCornersStanding, triangularFlatMirrored.RightCornersLying, triangularFlatMirrored.RightCornersStanding)
select_quadrilateral_adaptive = FamilyTypes("Triangle:Triangle")  # "Select Quadrilateral Adaptive Component Type"
# note: Create ACs at specified locations
byParametersOnFace = AdaptiveComponent.ByParametersOnFace(join, firstItem, select_quadrilateral_adaptive, lacing=Longest)
instance_parameter_name = StringInput("controller")
invert_reactor = BoolSelector(false)
# note: Reactor-related Settings
select_reactor_point = DSModelElementSelection()  # 1 picked in the model
point = ReferencePoint.Point(select_reactor_point, lacing=Longest)
triangularFlatMirrored_2 = Custom[Paneling.TriangularFlatMirrored](seq=gridFromFace.Points, V=V, ShiftRows=shift_rows, ReverseRowsLying=reverse_placement_order, ReverseRowsStanding=reverse_placement_order, ReverseLeftCornersLying=reverse_placement_order, ReverseLeftCornersStanding=reverse_placement_order, ReverseRightCornersLying=reverse_placement_order, ReverseRightCornersStanding=reverse_placement_order, ShiftPlacementRowsLying=shift_placement_point_order, ShiftPlacementRowsStanding=shift_placement_point_order, ShiftPlacementLeftCornersLying=shift_placement_point_order, ShiftPlacementLeftCornersStanding=shift_placement_point_order, ShiftPlacementRightCornersLying=shift_placement_point_order, ShiftPlacementRightCornersStanding=shift_placement_point_order, RotateGridBy90Deg=rotate_grid_by_90_degrees)
join_2 = List.Join(triangularFlatMirrored_2.RowsLying, triangularFlatMirrored_2.RowsStanding, triangularFlatMirrored_2.LeftCornersLying, triangularFlatMirrored_2.LeftCornersStanding, triangularFlatMirrored_2.RightCornersLying, triangularFlatMirrored_2.RightCornersStanding)
# note: Find component centers
average = Custom[Point.Average](Points=join_2)  # Determines the average of a list of points
# note: Measure distance between component center and reactor point
distanceTo = Geometry.DistanceTo(point, average, lacing=Longest)
# note: Convert distances to normalized values
normalizeRange = Custom[Math.NormalizeRange](numbers=distanceTo)  # Normalizes a range of numbers
invertNormalized = Custom[Invert Normalized Value](normalizeRange)  # "Math.InvertNormalized"; Inverts a value between 0 and 1 to its opposite (1-x)
# note: Invert values (if applicable)
if_ = If(invert_reactor, invertNormalized, normalizeRange)
# note: Write reactor value to instance parameters
setParameterByName = Element.SetParameterByName(byParametersOnFace, instance_parameter_name, if_, lacing=Longest)
