# Dynamo graph 2PointReactor_DS.dyn (Dynamo 0.7.5.3566)

# note: This graph applies a reactor pattern to an instance parameter of pattern-based elements hosted on a divided surface. In this example (based on a conceptual mass) the reactor points are being represented by reference points. In a project file they could be represented by the locations of family instances instead.
# REQUIRED PACKAGES:
# - Clockwork for Dynamo 0.7.x
# ISSUES:
# - https://github.com/DynamoDS/Dynamo/issues/3106 (Circumvented by use of Formula node)
# Post issues here: https://github.com/CAAD-RWTH/ClockworkForDynamo/issues
# note: Component-related Settings
select_divided_surface_families = DSDividedSurfaceFamiliesSelection()  # 1 picked in the model
flatten = Flatten(select_divided_surface_families)
instance_parameter_name = StringInput("controller")
invert_reactor = BoolSelector(false)
# note: Reactor-related Settings
select_reactor_point_1 = DSModelElementSelection()  # 1 picked in the model
point = ReferencePoint.Point(select_reactor_point_1, lacing=Longest)
# note: Find component center
location = FamilyInstance.Location(flatten, lacing=Longest)
distanceTo = Geometry.DistanceTo(point, location, lacing=Longest)
select_reactor_point_2 = DSModelElementSelection()  # 1 picked in the model
point_2 = ReferencePoint.Point(select_reactor_point_2, lacing=Longest)
# note: Measure distance between component center and reactor points
distanceTo_2 = Geometry.DistanceTo(point_2, location, lacing=Longest)
# note: Always take the greater value of both reactors
formula = Formula("if(a>b,a,b)", a=distanceTo, b=distanceTo_2)
# note: Convert distances to normalized values
normalizeRange = Custom[Math.NormalizeRange](numbers=formula)  # Normalizes a range of numbers
# note: Invert values (if applicable)
invertNormalized = Custom[Math.InvertNormalized](normalizeRange)  # Inverts a value between 0 and 1 to its opposite (1-x)
if_ = If(invert_reactor, invertNormalized, normalizeRange)
# note: Write reactor value to instance parameters
setParameterByName = Element.SetParameterByName(flatten, instance_parameter_name, if_, lacing=Longest)
