# Dynamo graph ComponentLayoutForCNC.dyn (Dynamo 0.7.5.3437)

sheet_name = StringInput("CNC_Panels")
sheet_number = StringInput("A-1")
view_sheet_family_type = FamilyTypes("A2 metric:A2 metric")
view_cropbox_resize = DoubleSlider(0.1, range=0..1)
planar_panels_only = BoolSelector(true)
# note: This definition is based on a workflow first published by Zach Kron here: http://buildz.blogspot.com/2013/09/making-revit-views-and-sheet-layouts-in.html
# It creates isolated orthogonal views of curtain wall panels or adaptive components and packs them on a sheet. In addition to the original workflow it can also filter out all non-planar elements.
# This was modified as learning material for the BIM to Production class at the chair of CAAD, RWTH Aachen University in the winter semester of 2013/14.
# REQUIRED PACKAGES:
# - Clockwork for Dynamo 0.7.x
# ISSUES:
# Post issues here: https://github.com/CAAD-RWTH/ClockworkForDynamo/issues
categories = Categories("CurtainWallPanels")
all_elements_of_category = ElementsOfCategory(categories)
flatten = Flatten(all_elements_of_category)
locations = AdaptiveComponent.Locations(flatten)
# note: Find each panel's center
average = Custom[Point.Average](Points=locations)  # Determines the average of a list of points
# note: Identify non-planar panels
containsOutOfPlanePoints = Custom[List.ContainsOutOfPlanePoints]()  # Checks a list for XYZs that are not located on a given plane
# note: Get a plane from each panel
byFirst3Points = Custom[Plane.ByFirst3Points]()  # Returns a plane, its origin and its normal based on the first three XYZs in a given list
map = List.Map(locations, byFirst3Points)
combine = List.Combine(containsOutOfPlanePoints.bool, map, locations)
# note: Get lists for planar panels only
filterByBoolMask = List.FilterByBoolMask(average, combine)
# note: Either use planar panels only or all of them...
# note: The panel centers will be the views' target positions
if_ = If(planar_panels_only, filterByBoolMask.out1, average)
# note: Get a normal from each panel
normal = Plane.Normal(map)
filterByBoolMask_2 = List.FilterByBoolMask(normal, combine)
if_2 = If(planar_panels_only, filterByBoolMask_2.out1, normal)
eye_position_scale = DoubleSlider(0.1, range=0..1)
scale = Geometry.Scale(if_2, eye_position_scale, lacing=Longest)
# note: Determine the eye positions by adding the normals to the panel centers
add = Point.Add(if_, scale, lacing=Longest)
count = List.Count(if_2)
code_block = CodeBlock(n=count) { 1..n; }
number_of_digits_for_numbering = IntegerSlider(4, range=0..5)
withLeadingZeroes = Custom[Sequence With Leading Zeros](seq=code_block, n=number_of_digits_for_numbering)  # "List.WithLeadingZeroes"; Adds leading zeros to a sequence of numbers
view_name = StringInput("Panel_")
concat = String.Concat(view_name)
# note: Create view names
map_2 = List.Map(withLeadingZeroes, concat)
filterByBoolMask_3 = List.FilterByBoolMask(flatten, combine)
# note: The element list will be used to define the bounding box of each view
if_3 = If(planar_panels_only, filterByBoolMask_3.out1, flatten)
boolean = BoolSelector(true)
# note: Create isolated views of each component and name them consecutively.
byEyePointTargetAndElement = AxonometricView.ByEyePointTargetAndElement(add, if_, map_2, if_3, boolean)
# note: Slightly resize all views so there's a small margin between the laid out parts.
resizeCropBox = Custom[Resize View Crop Box](amt=view_cropbox_resize, View_s=byEyePointTargetAndElement)  # "View.ResizeCropBox"; Resizes the bounding box of a given Revit element by the specified amount in X, Y and Z direction. May need to be used in conjunction with a Transaction node.
# note: Pack all views onto a sheet
byNameNumberTitleBlockAndViews = Sheet.ByNameNumberTitleBlockAndViews(sheet_name, sheet_number, view_sheet_family_type, resizeCropBox)
