# Dynamo graph CustomSurfaceSubdivision.dyn (Dynamo 0.7.5.3437)

reverse_placement_point_order = BoolSelector(false)
shift_placement_point_order = IntegerSlider(0, range=0..3)
# note: Create quad coordinates based on UV coordinates and number of V subdivisions per row
quadrilateral = Custom[Paneling.Quadrilateral](reverse=reverse_placement_point_order, shift_placement=shift_placement_point_order)  # Creates groups of points from a list of UVs or XYZs for the placement of quadrilateral panels. The placement pattern can be reversed (boolean) and shifted (integer).
byCoordinates = UV.ByCoordinates()
# note: Creates custom V subdivsions for all U subdivisions on a given surface and populates the surface with quadrilateral panels.
# First published at http://dynamobim.org/forums/topic/subdivisions-revisited-thoughts-much-appreciated/
# REQUIRED PACKAGES:
# - Clockwork for Dynamo 0.7.x
# ISSUES:
# Post issues here: https://github.com/CAAD-RWTH/ClockworkForDynamo/issues
u_subdivisions = IntegerSlider(10, range=0..20)
n1 = Custom[+1](u_subdivisions)  # Increments a value by 1
normalizedSequence = Custom[Normalized Sequence](N=n1)  # "List.NormalizedSequence"; Creates a sequence of N values between 0 and 1
takeItems = List.TakeItems(normalizedSequence, u_subdivisions)
max_v_subdivisions = IntegerSlider(12, range=10..12)
min_v_subdivisions = IntegerSlider(6, range=6..8)
code_block = CodeBlock(max=max_v_subdivisions, min=min_v_subdivisions) { max - min; }
randomIntegerList = Custom[Math.RandomIntegerList](Max=code_block, Amount=u_subdivisions)  # Creates a list of random integers between 0 and a given maximum value
code_block_2 = CodeBlock(rand=randomIntegerList, min=min_v_subdivisions) { rand + min + 1; }
# note: Create sequences of V subdivisions of random lengths
normalizedSequence_2 = Custom[Normalized Sequence](N=code_block_2)  # "List.NormalizedSequence"
combine = List.Combine(byCoordinates, takeItems, normalizedSequence_2)
restOfItems = List.RestOfItems(normalizedSequence)
combine_2 = List.Combine(byCoordinates, restOfItems, normalizedSequence_2)
# note: Combine each pair of U rows with a corrsponding sequence of V subdivisions to craete UV coordinates, then transpose and flatten to a single list for each U subdivision
create = List.Create(combine, combine_2)
transpose = List.Transpose(create)
flatten = Flatten()
map = List.Map(transpose, flatten)
n1_2 = Custom[-1](code_block_2)  # Decrements a value by 1
combine_3 = List.Combine(quadrilateral, map, n1_2)
code_block_3 = CodeBlock { 1; }
flatten_2 = List.Flatten(combine_3, code_block_3)
select_face = DSFaceSelection()  # 1 picked in the model
firstItem = List.FirstItem(select_face)
select_adaptive_component_type = FamilyTypes("Family2:Family2")
byParametersOnFace = AdaptiveComponent.ByParametersOnFace(flatten_2, firstItem, select_adaptive_component_type)
