# Dynamo graph ExtractNodeDependencies.dyn (Dynamo 0.7.5.3566)

# note: This graph parses each *.dyf file in a given directory and extracts all references to other custom nodes within that file resulting in a list of all dependencies for each node in the folder.
# I am using this in order to track which of my custom nodes depend on other custom nodes. Please note that the script does *not* provide a recursive mapping of dependencies at this point.
directory_path = Directory("C:\Users\adieckmann\Documents\GitHub\ClockworkForDynamo\nodes\0.7.x")
fromPath = DirectoryObject(directory_path)  # "Directory.FromPath"
code_block = CodeBlock { "*.dyf"; }
contents = Directory.Contents(fromPath, code_block)
fromPath_2 = FileObject(contents)  # "File.FromPath"
readText = File.ReadText(fromPath_2)
code_block_2 = CodeBlock { "<Dynamo.Nodes.Function"; }
split = String.Split(readText, code_block_2)
count = List.Count()
map = List.Map(split, count)
# note: Filter out all files that do not contain custom nodes
code_block_3 = CodeBlock(n=map) { n>1; }
filterByBoolMask = List.FilterByBoolMask(split, code_block_3)
firstItem = List.FirstItem()
map_2 = List.Map(filterByBoolMask, firstItem)
string = StringInput("Name=\"")
split_2 = String.Split(map_2, string)
code_block_4 = CodeBlock { 1; }
getItemAtIndex = List.GetItemAtIndex(arg1=code_block_4)
map_3 = List.Map(split_2, getItemAtIndex)
string_2 = StringInput("\"")
split_3 = String.Split(map_3, string_2)
firstItem_2 = List.FirstItem()
map_4 = List.Map(split_3, firstItem_2)
restOfItems = List.RestOfItems()
# note: Get rid of the part before the first custom node
map_5 = List.Map(filterByBoolMask, restOfItems)
string_3 = StringInput("nickname=\"[\\w\\s.()\\+\\-]+\" x=")
findRegularExpression = Custom[String.FindRegularExpression](regex=string_3)  # Returns all occurences of a regular expression within a string (or list of strings). The syntax for regular expressions is explained at http://ironpython-test.readthedocs.org/en/latest/howto/regex.html
# note: Retrieve the nicknames of the custom nodes
map_6 = List.Map(map_5, findRegularExpression)
firstItem_3 = List.FirstItem()
map_7 = List.Map(arg1=firstItem_3)
# note: Get rid of nicknames of subsequent nodes
map_8 = List.Map(map_6, map_7)
string_4 = StringInput("nickname=\"")
string_5 = StringInput("")
replace = String.Replace(map_8, string_4, string_5)
string_6 = StringInput("\" x=")
# note: Trim some fat away
replace_2 = String.Replace(replace, string_6, string_5)
sublistLengths = Custom[List.SublistLengths](list=replace_2)  # Gets the lengths of all sublists in a given list of lists.
repeatItemsByLengths = Custom[List.RepeatItemsByLengths](list=map_4, lengths=sublistLengths)  # Repeats a list of items into sublists of given lengths
flatten = Flatten(repeatItemsByLengths)
flatten_2 = Flatten(replace_2)
create = List.Create(flatten, flatten_2)
code_block_5 = CodeBlock { 0; 1; }
groupListOfListsByKey = Custom[List.GroupListOfListsByKey](list=create, key_index=code_block_5.out1)  # Groups a list of lists by one of its keys
firstItem_4 = List.FirstItem()
map_9 = List.Map(groupListOfListsByKey, firstItem_4)
uniqueItems = List.UniqueItems()
map_10 = List.Map(map_9, uniqueItems)
host_nodes = Watch(map_10)
code_block_6 = CodeBlock { 1; }
getItemAtIndex_2 = List.GetItemAtIndex(arg1=code_block_6)
map_11 = List.Map(groupListOfListsByKey, getItemAtIndex_2)
flatten_3 = Flatten(map_11)
uniqueItems_2 = List.UniqueItems(flatten_3)
nested_nodes = Watch(uniqueItems_2)
groupListOfListsByKey_2 = Custom[List.GroupListOfListsByKey](list=create, key_index=code_block_5.out0)
firstItem_5 = List.FirstItem()
map_12 = List.Map(groupListOfListsByKey_2, firstItem_5)
flatten_4 = Flatten(map_12)
uniqueItems_3 = List.UniqueItems(flatten_4)
host_nodes_2 = Watch(uniqueItems_3)
code_block_7 = CodeBlock { 1; }
getItemAtIndex_3 = List.GetItemAtIndex(arg1=code_block_7)
map_13 = List.Map(groupListOfListsByKey_2, getItemAtIndex_3)
uniqueItems_4 = List.UniqueItems()
map_14 = List.Map(map_13, uniqueItems_4)
nested_nodes_2 = Watch(map_14)
sublistLengths_2 = Custom[List.SublistLengths](list=map_10)
host_nodes_count = Watch(sublistLengths_2)
sublistLengths_3 = Custom[List.SublistLengths](list=map_14)
nested_nodes_count = Watch(sublistLengths_3)
directory_path_2 = Directory("C:\Users\adieckmann\Desktop")
string_7 = StringInput("\dependencies.CSV")
code_block_8 = CodeBlock(dir=directory_path_2, file=string_7) { dir + file; }
transpose = List.Transpose()
map_15 = List.Map(groupListOfListsByKey, transpose)
code_block_9 = CodeBlock { 1; }
flatten_5 = List.Flatten(map_15, code_block_9)
writeToFile = CSV.WriteToFile(code_block_8, flatten_5)
