# Dynamo graph ExtractNodeIDs.dyn (Dynamo 0.7.5.3566)

# note: This graph parses each *.dyf file in a given directory, extracts the ID of the custom node and writes the information to a CSV file.
# This could be useful for creating a custom iconset as described here:
# https://github.com/DynamoDS/Dynamo/wiki/HowTo:-Add-icon-for-custom-node
target_file_path_csv = Filename("C:\Users\adieckmann\Desktop\Test.CSV")
directory_path_custom_nodes = Directory("C:\Users\adieckmann\Documents\GitHub\ClockworkForDynamo\nodes\0.7.x")
fromPath = DirectoryObject(directory_path_custom_nodes)  # "Directory.FromPath"
code_block = CodeBlock { "*.dyf"; }
contents = Directory.Contents(fromPath, code_block)
boolean = BoolSelector(false)
fileName = FilePath.FileName(contents, boolean)
fromPath_2 = FileObject(contents)  # "File.FromPath"
readText = File.ReadText(fromPath_2)
string = StringInput("ID=\"")
split = String.Split(readText, string)
code_block_2 = CodeBlock { 1; }
getItemAtIndex = List.GetItemAtIndex(arg1=code_block_2)
map = List.Map(split, getItemAtIndex)
string_2 = StringInput("\"")
split_2 = String.Split(map, string_2)
firstItem = List.FirstItem()
map_2 = List.Map(split_2, firstItem)
create = List.Create(fileName, map_2)
transpose = List.Transpose(create)
writeToFile = CSV.WriteToFile(target_file_path_csv, transpose)
