# Dynamo graph ExtractPythonScripts.dyn (Dynamo 0.7.5.3566)

# note: This graph parses each *.dyf file in a given directory and extracts all Python scripts within that file into a subdirectory.
# I am using this in order to keep the Python documentation of my custom nodes more accessible.
directory_path = Directory("C:\Users\adieckmann\Documents\GitHub\ClockworkForDynamo\nodes\0.7.x")
string = StringInput("\python\")
fromPath = DirectoryObject(directory_path)  # "Directory.FromPath"
code_block = CodeBlock { "*.dyf"; }
contents = Directory.Contents(fromPath, code_block)
fromPath_2 = FileObject(contents)  # "File.FromPath"
readText = File.ReadText(fromPath_2)
code_block_2 = CodeBlock { "<Script>"; }
split = String.Split(readText, code_block_2)
count = List.Count()
map = List.Map(split, count)
# note: Filter out all files that do not contain Python scripts
code_block_3 = CodeBlock(n=map) { n>1; }
filterByBoolMask = List.FilterByBoolMask(contents, code_block_3)
boolean = BoolSelector(false)
fileName = FilePath.FileName(filterByBoolMask, boolean)
code_block_4 = CodeBlock(dir=directory_path, subdir=string, filename=fileName) { newpath = dir + subdir + filename + ".py"; }
filterByBoolMask_2 = List.FilterByBoolMask(split, code_block_3)
restOfItems = List.RestOfItems()
# note: Get rid of everything before the Python script
map_2 = List.Map(filterByBoolMask_2, restOfItems)
code_block_5 = CodeBlock { "</Script>"; }
split_2 = String.Split(arg1=code_block_5)
map_3 = List.Map(map_2, split_2)
firstItem = List.FirstItem()
map_4 = List.Map(arg1=firstItem)
# note: Get rid of everything after the Python script
map_5 = List.Map(map_3, map_4)
string_from_array = FromArray()
map_6 = List.Map(map_5, string_from_array)
code_block_6 = CodeBlock { 0; 1; }
remove = String.Remove(map_6, code_block_6.out0, code_block_6.out1)
length = String.Length(remove)
code_block_7 = CodeBlock(n=length) { n-1; 1; }
remove_2 = String.Remove(remove, code_block_7.out0, code_block_7.out1)
# note: This needs to be manually replaced with:
# &gt;
string_2 = StringInput(">")
string_3 = StringInput(">")
replace = String.Replace(remove_2, string_2, string_3)
# note: This needs to be manually replaced with:
# &lt;
string_4 = StringInput("<")
string_5 = StringInput("<")
replace_2 = String.Replace(replace, string_4, string_5)
writeText = File.WriteText(code_block_4, replace_2)
