# Dynamo graph FamilyTypeFromImage_AC.dyn (Dynamo 0.7.5.3437)

select_face = DSFaceSelection()  # 1 picked in the model
firstItem = List.FirstItem(select_face)
# note: This graph works more or less like the Parameter Values From Image graph, except that it will distribute adaptive components across a surface and set their family type according to an image.
# The definition will let you pick a face, specify the number of UV divisions and populate it with adaptive components. Use an image file to drive the family type of each placed component.
# First published here:
# http://autodeskvasari.com/forum/topics/parameter-values-from-image-for-dynamo
# REQUIRED PACKAGES:
# - Clockwork for Dynamo 0.7.x
# ISSUES:
# Post issues here: https://github.com/CAAD-RWTH/ClockworkForDynamo/issues
# note: Face-related settings
U = IntegerSlider(20, range=0..20)
V = IntegerSlider(20, range=0..20)
gridFromFace = Custom[Paneling.GridFromFace](face=firstItem, U=U, V=V)  # Returns UV coordinates, XYZ coordinates and normals for a face with UV subdivision
reverse_placement_point_order = BoolSelector(false)
shift_placement_point_order = IntegerSlider(3, range=0..3)
# note: Create placement patterns for quadrilateral panels
quadrilateral = Custom[Quadrilateral Pattern From Grid](list=gridFromFace.UVs, V=V, reverse=reverse_placement_point_order, shift_placement=shift_placement_point_order)  # "Paneling.Quadrilateral"; Creates groups of points from a list of UVs or XYZs for the placement of quadrilateral panels. The placement pattern can be reversed (boolean) and shifted (integer).
# note: Image-related settings
path_to_image_file = Filename("C:\Users\adieckmann\Documents\GitHub\ClockworkForDynamo\workflow_samples\0.7.x\_unmigrated\FamilyTypeFromImage_AC\sample_image.png")
fromPath = FileObject(path_to_image_file)  # "File.FromPath"
readFromFile = Image.ReadFromFile(fromPath)
# note: Get an appropriate number of samples from the image file
pixels = Image.Pixels(readFromFile, V, U)
# note: Replace this with a Color Saturation or Color Hue node for different effects
brightness = Color.Brightness(pixels, lacing=Longest)
invert_image_data = BoolSelector(false)
mirror_image_vertically = BoolSelector(true)
mirror_image_horizontally = BoolSelector(true)
invertAndMirrorNormalizedValues = Custom[Paneling.InvertAndMirrorNormalizedValues](list=brightness, Invert=invert_image_data, Mirror_Vertically=mirror_image_vertically, Mirror_Horizontally=mirror_image_horizontally, X=V)  # Inverts and mirrors (horizontally & vertically) a list of normalized values.
# note: Threshold value that determines which pixels are counted as black and which pixels are counted as white
black_white_threshold = DoubleSlider(0.5, range=0..1)
# note: Component-related settings
# You can use any 4-point Adaptive Component loaded in the family.
light_pixels_select_adaptive = FamilyTypes("4PointACByOffset_VarA:Type 1")  # "Light Pixels - Select Adaptive Component"
dark_pixels_select_adaptive = FamilyTypes("4PointACByOffset_VarA:Type 2")  # "Dark Pixels - Select Adaptive Component"
# note: Set component type according to pixel and threshold values
formula = Formula("If(pixel>threshold,[trueval],[falseval])", pixel=invertAndMirrorNormalizedValues, threshold=black_white_threshold, trueval=light_pixels_select_adaptive, falseval=dark_pixels_select_adaptive)
# note: Create Adaptive Components from list and set type according to image pattern.
byParametersOnFace = AdaptiveComponent.ByParametersOnFace(quadrilateral, firstItem, formula, lacing=Longest)
watch_image = WatchImageCore(readFromFile)
