# Dynamo graph NodeUsageMetrics.dyn (Dynamo 0.7.5.3566)

# note: This graph reads a *.dyn or *.dyf file and reports which nodes have been used in that file (and how often).
file_path = Filename("C:\Users\adieckmann\Documents\GitHub\ClockworkForDynamo\workflow_samples\0.7.x\CustomSurfaceSubdivision\CustomSurfaceSubdivision.dyn")
fromPath = FileObject(file_path)  # "File.FromPath"
readText = File.ReadText(fromPath)
string = StringInput("nickname=\"")
split = String.Split(readText, string)
restOfItems = List.RestOfItems(split)
string_2 = StringInput("\"")
split_2 = String.Split(restOfItems, string_2)
firstItem = List.FirstItem()
map = List.Map(split_2, firstItem)
sort = List.Sort(map)
countOccurences = Custom[List.CountOccurences](list=sort)  # Counts the number of occurences of each unique element in a given list
watch = Watch(countOccurences.Unique_elements)
watch_2 = Watch(countOccurences.Count)
