# Dynamo graph NumberingStuffByDistance.dyn (Dynamo 0.7.5.3437)

select_component_category = Categories("CurtainWallPanels")
all_elements_of_category = ElementsOfCategory(select_component_category)
X = DoubleSlider(0, range=0..100)
Y = DoubleSlider(0, range=0..100)
Z = DoubleSlider(0, range=0..100)
byCoordinates = Point.ByCoordinates(X, Y, Z)
locations = AdaptiveComponent.Locations(all_elements_of_category)
# note: Determine panel center point
average = Custom[Point.Average](Points=locations)  # Determines the average of a list of points
# note: Measure distance to given point coordinate
distanceTo = Geometry.DistanceTo(byCoordinates, average, lacing=Longest)
# note: Add leading zeros to number sequence
create_list = List.Create(all_elements_of_category, distanceTo)
# note: Combine panels and measured distances into a list of lists, sort by measured distance and extract newly sorted list of panels
code_block = CodeBlock { 1; false; }
sortListOfLists = Custom[Sort List Of Lists](List_of_lists=create_list, Sort_index=code_block.out0, Case_insensitive=code_block.out1, Order_Descending=code_block.out1)  # "List.SortListOfLists"; Sorts a list of lists by one of its sublists
firstItem = List.FirstItem(sortListOfLists)
parameter_name = StringInput("Mark")
start_number = DoubleInput(1)
count = List.Count(all_elements_of_category)
code_block_2 = CodeBlock(start=start_number, n=count)
# ---------- code_block_2.designscript (3 lines) ----------
// Determine last number of the sequence
end = start + n - 1;
start..end;
# ----------------------------------------
number_of_digits = DoubleInput(3)
withLeadingZeroes = Custom[Sequence With Leading Zeros](seq=code_block_2.out1, n=number_of_digits)  # "List.WithLeadingZeroes"; Adds leading zeros to a sequence of numbers
# note: This example shows how to number freely placed elements by evaluating their distance from a given point in the project.
# This was created as learning materal for the BIM to Production class at the chair of CAAD, RWTH Aachen University in the winter semester of 2013/14.
# REQUIRED PACKAGES:
# - Clockwork for Dynamo 0.7.x
# ISSUES:
# Post issues here: https://github.com/CAAD-RWTH/ClockworkForDynamo/issues
prefix = StringInput("Panel")
suffix = StringInput("")
# note: Add prefix and suffix to sequence
concat = String.Concat(prefix, arg2=suffix)
map = List.Map(withLeadingZeroes, concat)
# note: Write generated numbers to specified instance parameter
setParameterByName = Element.SetParameterByName(firstItem, parameter_name, map, lacing=Longest)
