# Dynamo graph NumberingStuffByPosition.dyn (Dynamo 0.7.5.3437)

categories = Categories("Doors")
all_elements_of_category = ElementsOfCategory(categories)
location = FamilyInstance.Location(all_elements_of_category, lacing=Longest)
X = Point.X(location, lacing=Longest)
rounding_precision = DoubleSlider(0.5, range=0..1)
roundToPrecision = Custom[Round To Precision](Number=X, Precision=rounding_precision)  # "Math.RoundToPrecision"; Rounds a number to a specified precision
normalizeRange = Custom[Math.NormalizeRange](numbers=roundToPrecision)  # Normalizes a range of numbers
# note: Get X and Y coordinates for every door
Y = Point.Y(location, lacing=Longest)
roundToPrecision_2 = Custom[Round To Precision](Number=Y, Precision=rounding_precision)  # "Math.RoundToPrecision"
# note: Round X and Y to a meaningful precision and make an ordered list for each. The values are normalized in order to ignore negative vs. positive values relative to the project XYZ Zero.
normalizeRange_2 = Custom[Math.NormalizeRange](numbers=roundToPrecision_2)
# note: Combine panels and their X and Y sort order into a list of lists
create_list = List.Create(all_elements_of_category, normalizeRange, normalizeRange_2)
code_block = CodeBlock { 1; 2; false; true; }
# note: First sort by position on X axis
sortListOfLists = Custom[Sort List Of Lists](List_of_lists=create_list, Sort_index=code_block.out0, Case_insensitive=code_block.out2, Order_Descending=code_block.out2)  # "List.SortListOfLists"; Sorts a list of lists by one of its sublists
# note: Next sort by position on Y axis
# note: Note that you need to reverse your sort order if you want to sort by multiple criteria (i.e. sort by your most important key last).
sortListOfLists_2 = Custom[Sort List Of Lists](List_of_lists=sortListOfLists, Sort_index=code_block.out1, Case_insensitive=code_block.out2, Order_Descending=code_block.out3)  # "List.SortListOfLists"
firstItem = List.FirstItem(sortListOfLists_2)
parameter_name = StringInput("Mark")
start_number = DoubleInput(1)
count = List.Count(all_elements_of_category)
code_block_2 = CodeBlock(start=start_number, n=count)
# ---------- code_block_2.designscript (3 lines) ----------
// Determine last number of the sequence
end = start + n - 1;
start..end;
# ----------------------------------------
number_of_digits = DoubleInput(3)
# note: Add leading zeros to number sequence
withLeadingZeroes = Custom[Sequence With Leading Zeros](seq=code_block_2.out1, n=number_of_digits)  # "List.WithLeadingZeroes"; Adds leading zeros to a sequence of numbers
# note: This example shows how to number freely placed elements by evaluating their position in the project.
# This was created as learning materal for the BIM to Production class at the chair of CAAD, RWTH Aachen University in the winter semester of 2013/14.
# REQUIRED PACKAGES:
# - Clockwork for Dynamo 0.7.x
# ISSUES:
# Post issues here: https://github.com/CAAD-RWTH/ClockworkForDynamo/issues
prefix = StringInput("Door")
suffix = StringInput("")
# note: Add prefix and suffix to sequence
concat = String.Concat(prefix, arg2=suffix)
map = List.Map(withLeadingZeroes, concat)
# note: Write generated numbers to specified instance parameter
setParameterByName = Element.SetParameterByName(firstItem, parameter_name, map, lacing=Longest)
