# Dynamo graph NumberingStuff_DS.dyn (Dynamo 0.7.5.3437)

select_divided_surface_families = DSDividedSurfaceFamiliesSelection()  # 1 picked in the model
parameter_name = StringInput("Object_Identifier")
start_number_of_sequence = DoubleInput(1)
count = List.Count(select_divided_surface_families)
code_block = CodeBlock(start=start_number_of_sequence, n=count)
# ---------- code_block.designscript (3 lines) ----------
// Determine last number in sequence
end = start + n - 1;
start..end;
# ----------------------------------------
number_of_digits = DoubleInput(3)
# note: Add leading zeros to number sequence
withLeadingZeroes = Custom[Sequence With Leading Zeros](seq=code_block.out1, n=number_of_digits)  # "List.WithLeadingZeroes"; Adds leading zeros to a sequence of numbers
# note: This example shows how to number curtain panels that are hosted on a divided surface.
# It was created as learning material for the BIM to Production class at the chair of CAAD, RWTH Aachen University in the winter semester of 2013/14.
# REQUIRED PACKAGES:
# - Clockwork for Dynamo 0.7.x
# ISSUES:
# Post issues here: https://github.com/CAAD-RWTH/ClockworkForDynamo/issues
prefix = StringInput("DS01_")
suffix = StringInput("")
# note: Add prefix and suffix to sequence
concat = String.Concat(prefix, arg2=suffix)
map = List.Map(withLeadingZeroes, concat)
# note: Write generated numbers to specified instance parameter
setParameterByName = Element.SetParameterByName(select_divided_surface_families, parameter_name, map, lacing=Longest)
