# Dynamo graph OutOfPlaneAnalysis.dyn (Dynamo 0.7.5.3437)

# note: This graph analyzes if a given pattern-based panel or adaptive component is out of plane - and if so, by which amount. The information is then visualized in the current view by means of overriding the element surface colour. Will *only* work in the project environment.
# This was created as learning material for the BIM to Production class at the chair of CAAD, RWTH Aachen University in the winter semester of 2013/14.
# REQUIRED PACKAGES:
# - Clockwork for Dynamo 0.7.x
# ISSUES:
# - https://github.com/ikeough/Dynamo/issues/880 (issue with the element colour override in non-English Revit versions)
# Post issues here: https://github.com/CAAD-RWTH/ClockworkForDynamo/issues
categories = Categories("CurtainWallPanels")
all_elements_of_category = ElementsOfCategory(categories)
white = Custom[White]()  # "Color.White"; Returns the colour white.
red = Custom[Red]()  # "Color.Red"; Returns the colour red.
containsOutOfPlanePoints = Custom[List.ContainsOutOfPlanePoints]()  # Checks a list for XYZs that are not located on a given plane
locations = AdaptiveComponent.Locations(all_elements_of_category)
byFirst3Points = Custom[Plane.ByFirst3Points]()  # Returns a plane, its origin and its normal based on the first three XYZs in a given list
# note: Get a plane for each panel
map = List.Map(locations, byFirst3Points)
# note: Determine by how much (if so) each panel is out of plane
combine = List.Combine(containsOutOfPlanePoints.max, map, locations)
normalizeRange = Custom[Math.NormalizeRange](numbers=combine)  # Normalizes a range of numbers
color_range = ColorRange(white, red, normalizeRange)
# note: Override each element's colour based on how much it is out of plane
overrideColorInView = Element.OverrideColorInView(all_elements_of_category, color_range, lacing=Longest)
tolerance = DoubleSlider(0, range=0..0.1)
