# Dynamo graph PanelsByPanelRatio.dyn (Dynamo 0.7.5.3437)

byCoordinates = UV.ByCoordinates(lacing=Longest)
code_block = CodeBlock { {0}; }
# note: This graph populates a surface with panels based on panel ratios.
# First published here:
# http://dynamobim.org/forums/topic/panels-by-formula/
# REQUIRED PACKAGES:
# - Clockwork for Dynamo 0.7.x
# - LunchBox for Dynamo
# ISSUES:
# Post issues here: https://github.com/CAAD-RWTH/ClockworkForDynamo/issues
code_block_2 = CodeBlock { 1..2..#8; }
lunchbox_mass_addition = Custom[LunchBox Mass Addition](Numbers=code_block_2)  # Returns the total value of a list of numbers.
join = List.Join(code_block, lunchbox_mass_addition.Partials)
normalizeRange = Custom[Math.NormalizeRange](numbers=join)  # Normalizes a range of numbers
# note: V Subdivision:
# And here's how you could achieve an irregular subdivision pattern using arbitrary panel ratios.
# note: U Subdivision:
# Here's how you could achieve a linear increase in the panel ratios.
code_block_3 = CodeBlock { {3,2,4,1,2,1,2}; }
lunchbox_mass_addition_2 = Custom[LunchBox Mass Addition](Numbers=code_block_3)
# note: Normalize the sequence of panel ratios
join_2 = List.Join(code_block, lunchbox_mass_addition_2.Partials)
normalizeRange_2 = Custom[Math.NormalizeRange](numbers=join_2)
# note: Create grid of UVs based on normalized ratio sequences
cartesianProduct = List.CartesianProduct(byCoordinates, normalizeRange, normalizeRange_2)
flatten = Flatten(cartesianProduct)
count = List.Count(lunchbox_mass_addition_2.Partials)
# note: Panel-related settings
triangle_a_reverse_placement = BoolSelector(false)  # "Triangle A - Reverse Placement Point Order?"
triangle_b_reverse_placement = BoolSelector(false)  # "Triangle B - Reverse Placement Point Order?"
triangle_a_shift_placement_point = IntegerSlider(0, range=0..2)  # "Triangle A - Shift Placement Point Order"
triangle_b_shift_placement_point = IntegerSlider(0, range=0..2)  # "Triangle B - Shift Placement Point Order"
shift_overall_placement_point = IntegerSlider(0, range=0..2)  # "Shift Overall Placement Point Order"
rotate_grid_by_90 = BoolSelector(false)
triangularFlatDiagonal = Custom[Paneling.TriangularFlatDiagonal](list=flatten, V=count, reverse_triangle_A=triangle_a_reverse_placement, reverse_triangle_B=triangle_b_reverse_placement, shift_placement_triangle_A=triangle_a_shift_placement_point, shift_placement_triangle_B=triangle_b_shift_placement_point, shift_overall_placement=shift_overall_placement_point, rotate_grid_by_90=rotate_grid_by_90)  # Creates groups of points from a list of UVs or XYZs for the placement of triangular panels. The placement pattern can be reversed (boolean) and shifted (integer).
select_face = DSFaceSelection()  # 1 picked in the model
triangle_a_select_adaptive = FamilyTypes("3PointACByOffset_VarA:Type 1")  # "Triangle A - Select Adaptive Component Type"
byParametersOnFace = AdaptiveComponent.ByParametersOnFace(triangularFlatDiagonal.list_triangle_A, select_face, triangle_a_select_adaptive, lacing=Longest)
triangle_b_select_adaptive = FamilyTypes("3PointACByOffset_VarA:Type 2")  # "Triangle B - Select Adaptive Component Type"
byParametersOnFace_2 = AdaptiveComponent.ByParametersOnFace(triangularFlatDiagonal.list_triangle_B, select_face, triangle_b_select_adaptive, lacing=Longest)
