# Dynamo graph ParameterValuesFromImage_AC.dyn (Dynamo 0.7.5.3437)

select_face = DSFaceSelection()  # 1 picked in the model
firstItem = List.FirstItem(select_face)
# note: This graph was a first try at emulating the behaviour of the Parameter Values From Image plugin that used to be available for Vasari.
# It will let you pick a face, specify the number of UV divisions and populate it with adaptive components. Use an image file to drive a parameter value for each placed instance of the adaptive component.
# First published here: http://autodeskvasari.com/forum/topics/parameter-values-from-image-for-dynamo
# REQUIRED PACKAGES:
# - Clockwork for Dynamo 0.7.x
# ISSUES:
# Post issues here: https://github.com/CAAD-RWTH/ClockworkForDynamo/issues
# note: Face-related settings
U = IntegerSlider(12, range=0..20)
V = IntegerSlider(12, range=0..20)
gridFromFace = Custom[Paneling.GridFromFace](face=firstItem, U=U, V=V)  # Returns UV coordinates, XYZ coordinates and normals for a face with UV subdivision
reverse_placement_point_order = BoolSelector(false)
shift_placement_point_order = IntegerSlider(0, range=0..3)
quadrilateral = Custom[Paneling.Quadrilateral](list=gridFromFace.UVs, V=V, reverse=reverse_placement_point_order, shift_placement=shift_placement_point_order)  # Creates groups of points from a list of UVs or XYZs for the placement of quadrilateral panels. The placement pattern can be reversed (boolean) and shifted (integer).
# note: Component-related settings
# This can be any 4-point Adaptive Component loaded in the family.
family_types = FamilyTypes("4PointACByOffset:4PointACByOffset")
byParametersOnFace = AdaptiveComponent.ByParametersOnFace(quadrilateral, firstItem, family_types, lacing=Longest)
instance_parameter_name = StringInput("controller")
# note: Image-related settings
path_to_image_file = Filename("C:\Users\adieckmann\Documents\GitHub\ClockworkForDynamo\workflow_samples\0.7.x\_unmigrated\ParameterValuesFromImage_AC\sample_image.jpg")
fromPath = FileObject(path_to_image_file)  # "File.FromPath"
readFromFile = Image.ReadFromFile(fromPath)
# note: Get an appropriate number of samples from the image file
pixels = Image.Pixels(readFromFile, V, U)
# note: Replace this with a Color Saturation or Color Hue node for different effects
brightness = Color.Brightness(pixels, lacing=Longest)
invert_image_data = BoolSelector(false)
mirror_image_vertically = BoolSelector(false)
mirror_image_horizontally = BoolSelector(true)
invertAndMirrorNormalizedValues = Custom[Paneling.InvertAndMirrorNormalizedValues](list=brightness, Invert=invert_image_data, Mirror_Vertically=mirror_image_vertically, Mirror_Horizontally=mirror_image_horizontally, X=V)  # Inverts and mirrors (horizontally & vertically) a list of normalized values.
# note: Set parameter values according to image brightness
setParameterByName = Element.SetParameterByName(byParametersOnFace, instance_parameter_name, invertAndMirrorNormalizedValues, lacing=Longest)
