# Dynamo graph ParameterValuesFromImage_DS.dyn (Dynamo 0.7.5.3437)

select_divided_surface_families = DSDividedSurfaceFamiliesSelection()  # 1 picked in the model
# note: The name of the instance parameter that is to be driven by the image data
parameter_name = StringInput("controller")
# note: Image-related settings
path_to_image_file = Filename("C:\Users\adieckmann\Documents\GitHub\ClockworkForDynamo\workflow_samples\0.7.x\_unmigrated\ParameterValuesFromImage_DS\sample_image.png")
fromPath = FileObject(path_to_image_file)  # "File.FromPath"
readFromFile = Image.ReadFromFile(fromPath)
# note: This graph works like the Parameter Values From Image plugin that used to be available for Vasari. Additionally you can invert and mirror (vertically and horizontally) the image data.
# First published here: http://autodeskvasari.com/forum/topics/parameter-values-from-image-for-dynamo
# REQUIRED PACKAGES:
# - Clockwork for Dynamo 0.7.x
# ISSUES:
# - https://github.com/DynamoDS/Dynamo/issues/1897 (panel list not nested)
# Post issues here: https://github.com/CAAD-RWTH/ClockworkForDynamo/issues
select_divided_surface = DSModelElementSelection()  # 1 picked in the model
UDivisions = DividedSurface.UDivisions(select_divided_surface)
VDivisions = DividedSurface.VDivisions(select_divided_surface)
pixels = Image.Pixels(readFromFile, UDivisions, VDivisions)
# note: Replace this with Color Hue or Color Saturation for different effects
brightness = Color.Brightness(pixels, lacing=Longest)
invert_image_data = BoolSelector(false)
mirror_image_vertically = BoolSelector(false)
mirror_image_horizontally = BoolSelector(true)
invertAndMirrorNormalizedValues = Custom[Paneling.InvertAndMirrorNormalizedValues](list=brightness, Invert=invert_image_data, Mirror_Vertically=mirror_image_vertically, Mirror_Horizontally=mirror_image_horizontally, X=UDivisions)  # Inverts and mirrors (horizontally & vertically) a list of normalized values.
setParameterByName = Element.SetParameterByName(select_divided_surface_families, parameter_name, invertAndMirrorNormalizedValues, lacing=Longest)
