# Dynamo graph SolarRadiationToQuadrilateralPanels.dyn (Dynamo 0.7.5.3437)

activeViewFromCurrentDocument = Custom[Document.ActiveViewFromCurrentDocument]()  # Gets the active view of the current document
# note: This graph performs a solar radiation analysis on any selected surface in a Revit project. It then populates the surface with quadrilateral panels and sets the respective values of a given instance parameter value to the computed analysis results.
# This script was originally based on parsing CSV files generated by the solar radiation analysis tool of Autodesk Vasari. It started as a Python script for use with the RevitPythonShell which I created for a workshop as part of the ars 2012 Berlin summer academy. I ported it to Dynamo 0.6.3 for the 2014 summer academy. The current version makes use of the package Solar Analysis for Dynamo.
# REQUIRED PACKAGES:
# - Clockwork for Dynamo 0.7.x
# - Solar Analysis for Dynamo
# ISSUES:
# Post issues here: https://github.com/CAAD-RWTH/ClockworkForDynamo/issues
select_face_for_analysis = DSFaceSelection()  # 1 picked in the model
firstItem = List.FirstItem(select_face_for_analysis)
resolution_number_of_samples_in = IntegerSlider(24, range=1..30)  # "Resolution (number of samples in U/V direction)"
U = IntegerSlider(8, range=0..20)
V = IntegerSlider(5, range=0..20)
create = List.Create(U, V)
maximumItem = List.MaximumItem(create)
code_block = CodeBlock(samples=resolution_number_of_samples_in, max_panels=maximumItem)
# ---------- code_block.designscript (3 lines) ----------
// Make sure that we have enough samples
cond = samples >= 1.5 * max_panels;
cond ? samples : 1.5 * max_panels;
# ----------------------------------------
# note: Create coordinates for analysis points
gridFromFace = Custom[Paneling.GridFromFace](face=firstItem, U=code_block.out1, V=code_block.out1)  # Returns UV coordinates, XYZ coordinates and normals for a face with UV subdivision
siteLocation = SiteLocation()
fromLocation = DynamoSolarAnalysis.Wrappers.Weather.FromLocation(siteLocation)
bySurfaceAndPoints = Analysis.DataTypes.SurfaceAnalysisData.BySurfaceAndPoints(firstItem, gridFromFace.UVs)
select_faces_for_shading = SelectFaces()  # 14 picked in the model
flatten = Flatten(select_faces_for_shading)
current = SunSettings()  # "SunSettings.Current"
# note: Perform solar radiation analysis
analyze = DynamoSolarAnalysis.Wrappers.SolarAnalysis.Analyze(fromLocation, bySurfaceAndPoints, flatten, current)
results = DynamoSolarAnalysis.Wrappers.SolarAnalysis.Results(analyze)
average = Custom[SolarAnalysisType.Average]()  # Returns the key "Average" for use with the SurfaceAnalysisData.GetResultByKey node from package Solar Analysis for Dynamo
# note: Retrieve desired analysis results
getResultByKey = Analysis.DataTypes.SurfaceAnalysisData.GetResultByKey(results, average)
unit_types = UnitTypes("Insolation")
# note: Optional: Display analysis results in model
byViewFacePointsAndValues = Revit.AnalysisDisplay.FaceAnalysisDisplay.ByViewFacePointsAndValues(activeViewFromCurrentDocument, firstItem, gridFromFace.UVs, getResultByKey, average, average, unit_types)
# note: Create coordinates for panels
gridFromFace_2 = Custom[Paneling.GridFromFace](face=firstItem, U=U, V=V)
reverse_placement_point_order = BoolSelector(false)
shift_placement_point_order = IntegerSlider(0, range=0..3)
# note: Compute panel coordinates
quadrilateral = Custom[Paneling.Quadrilateral](list=gridFromFace_2.UVs, V=V, reverse=reverse_placement_point_order, shift_placement=shift_placement_point_order)  # Creates groups of points from a list of UVs or XYZs for the placement of quadrilateral panels. The placement pattern can be reversed (boolean) and shifted (integer).
select_adaptive_component_type = FamilyTypes("4Point-Panel:4Point-Panel")
# note: Create panels
byParametersOnFace = AdaptiveComponent.ByParametersOnFace(quadrilateral, firstItem, select_adaptive_component_type)
parameter_name = StringInput("controller")
isInsidePolygon = Custom[UV.IsInsidePolygon](Point_UV_s=gridFromFace.UVs)  # Determines if a point is inside the space enclosed by a polygon
# note: Match analysis points to panels
map = List.Map(quadrilateral, isInsidePolygon)
flatten_2 = Flatten(getResultByKey)
filterByBoolMask = List.FilterByBoolMask(flatten_2)
# note: Filter out analysis results per panel
map_2 = List.Map(map, filterByBoolMask)
average_2 = Math.Average()
# note: Compute average result per panel
map_3 = List.Map(map_2, average_2)
min_opening = DoubleSlider(0, range=0..1)
max_opening = DoubleSlider(1, range=0..1)
# note: Remap results to desired value range
remapRange = Math.RemapRange(map_3, min_opening, max_opening)
# note: Write results to panels
setParameterByName = Element.SetParameterByName(byParametersOnFace, parameter_name, remapRange)
