# Dynamo graph SunDirectionToPanels.dyn (Dynamo 0.7.5.3437)

# note: This graph populates the surface of a mass with quadrilateral curtain wall panels and computes the average surface normal of each panel. It then writes the delta between the sun's altitude and azimuth and the repective panel normals into each respective panel. This workflow could be used to animate panels that keep rotating in order to stay perpendicular to the sun rays.
# REQUIRED PACKAGES:
# - Clockwork for Dynamo 0.7.x
# ISSUES:
# - https://github.com/CAAD-RWTH/ClockworkForDynamo/issues/10 (Azimuth is not evaluated for every panel)
# Post issues here: https://github.com/CAAD-RWTH/ClockworkForDynamo/issues
# note: Face-related settings
select_face = DSFaceSelection()  # 1 picked in the model
firstItem = List.FirstItem(select_face)
U = IntegerSlider(16, range=0..20)
V = IntegerSlider(4, range=0..20)
gridFromFace = Custom[Paneling.GridFromFace](face=firstItem, U=U, V=V)  # Returns UV coordinates, XYZ coordinates and normals for a face with UV subdivision
boolean = BoolSelector(false)
integer_slider = IntegerSlider(0, range=0..3)
quadrilateral = Custom[Paneling.Quadrilateral](list=gridFromFace.UVs, V=V, reverse=boolean, shift_placement=integer_slider)  # Creates groups of points from a list of UVs or XYZs for the placement of quadrilateral panels. The placement pattern can be reversed (boolean) and shifted (integer).
# note: Panel-related settings
family_types = FamilyTypes("Family2:Family2")
byParametersOnFace = AdaptiveComponent.ByParametersOnFace(quadrilateral, firstItem, family_types, lacing=Longest)
parameter_name = StringInput("azimuth_delta")
current = SunSettings()  # "SunSettings.Current"
sunDirection = SunSettings.SunDirection(current)
# note: Compute altitude and azimuth for the sun's current position and for each panel's average surface normal.
# This example is made for vertical louvers - if you are designing horizontal shading devices, use the altitude outputs instead.
altitudeAndAzimuth = Custom[Vector.AltitudeAndAzimuth](Vector=sunDirection)  # Computes the altitude and azimuth of a given vector
# note: Find average surface normal for each panel
quadrilateral_2 = Custom[Paneling.Quadrilateral](list=gridFromFace.Normals, V=V, reverse=boolean, shift_placement=integer_slider)
average = Custom[Vector.Average](Vectors=quadrilateral_2)  # Determines the average vector of a list of vectors
altitudeAndAzimuth_2 = Custom[Vector.AltitudeAndAzimuth]()
map = List.Map(average, altitudeAndAzimuth_2.Azimuth)
# note: For each panel, find the delta to the sun's altitude or azimuth
code_block = CodeBlock(sun_vector=altitudeAndAzimuth.Azimuth, panel_normal=map) { sun_vector - panel_normal; }
setParameterByName = Element.SetParameterByName(byParametersOnFace, parameter_name, code_block, lacing=Longest)
