# Dynamo graph ToAutomateOrNotToAutomate.dyn (Dynamo 0.7.5.3437)

number_of_years_in_which_the = Formula("3", lacing=Longest)  # "Number of years in which the task will not change significantly"
how_often_per_year_do_you_have = Formula("2*100*4", lacing=Longest)  # "How often per year do you have to perform this task?"
how_much_time_secs_per_iteration = Formula("7.5*60", lacing=Longest)  # "How much time (secs) per iteration would you save by automating the task?"
# note: HOW LONG CAN YOU WORK ON MAKING A ROUTINE TASK MORE EFFICIENT BEFORE YOU'RE SPENDING MORE TIME THAN YOU SAVE?
# http://xkcd.com/1205/
total_time_saved_secs = Formula("years*iterations*time_saved/60/60/8", years=number_of_years_in_which_the, iterations=how_often_per_year_do_you_have, time_saved=how_much_time_secs_per_iteration, lacing=Longest)
work_days_you_can_spend_on = Watch(total_time_saved_secs)  # "Work days you can spend on automating the task"
