# Dynamo graph ImageToCNC.dyn (Dynamo 0.7.5.3437)

categories = Categories("LoadCasesRoofLive")
# note: Revit-related Settings
subcategory_name_for_boundary = StringInput("CNC_Boundary")
# note: Create separate subcategories for boundaries, verticals and horizontals (important for DWG export)
byName = Custom[Subcategory.ByName](Category=categories, Name=subcategory_name_for_boundary)  # Creates a new subcategory for a given element category (unless a subcategory of that name already exists - in that case it returns the existing subcategory)
boolean = BoolSelector(false)
number = DoubleInput(0)
x_overall_panel_width = DoubleInput(1.2)
create_list = List.Create(number, x_overall_panel_width, x_overall_panel_width, number)
y_overall_panel_width = DoubleInput(0.8)
create_list_2 = List.Create(number, number, y_overall_panel_width, y_overall_panel_width)
byCoordinates = Point.ByCoordinates(create_list, create_list_2, number, lacing=Longest)
closedLoopThroughPoints = Custom[Lines Through Points (Closed Loop)](list=byCoordinates)  # "Line.ClosedLoopThroughPoints"; Works just like the built-in node Lines Through Points (creates a series of lines through a list of points) - except that it creates a *closed* loop of lines.
# note: Create boundary and set it to the appropriate subcategory
byCurve = ModelCurve.ByCurve(closedLoopThroughPoints, lacing=Longest)
setSubcategory = Custom[Element.SetSubcategory](Subcategory=byName, Cut_Projection=boolean, Element_s=byCurve)  # Assigns the given element(s) to the specified subcategory.
subcategory_name_for_vertical = StringInput("CNC_Vertical")  # "Subcategory Name for Vertical Lines"
byName_2 = Custom[Subcategory.ByName](Category=categories, Name=subcategory_name_for_vertical)
# note: This definition allows the creation of CNC paths (for milling reliefs) in a mass family file out of image data. There are two methods available:
# a) Create parallel lines with varying depths
# b) Create a grid of points with varying depths
# You can also choose if a (scaled) 3D preview of the milled panel should be generated.
# For questions email me at dieckmann@caad.arch.rwth-aachen.de
# This was created as learning material for the BIM to Production class (winter semester 2013/14) and modified/extended for the Maker House project (summer semester 2014) at the chair of CAAD, RWTH Aachen University.
# note: CNC-related Settings
# note: REQUIRED PACKAGES:
# - Count Sequences Of True Or False
# - Dispatch
# - Invert And Mirror Normalized Values
# - Law Of Sines
# - Lines Through Points (Closed Loop)
# - Project To XY Plane
# - Recursive Boolean Difference
# - Select By Category
# - Standard Normals
# - Subcategory Stuff
# - Sublist Helpers
x_count = IntegerSlider(25, range=0..50)
y_count = IntegerSlider(25, range=0..50)
formula = Formula("1", lacing=Longest)
x_margin = DoubleInput(0.05)
y_margin = DoubleInput(0.05)
formula_2 = Formula("(width-2*margin)/(elements-1)", width=x_overall_panel_width, margin=x_margin, elements=x_count, lacing=Longest)
formula_3 = Formula("(width-2*margin)/(elements-1)", width=y_overall_panel_width, margin=y_margin, elements=y_count, lacing=Longest)
# note: Create a point grid based on the settings
xyzGrid = Custom[XyzGrid](x_count=x_count, y_count=y_count, z_count=formula, x0=x_margin, y0=y_margin, z0=number, x_space=formula_2, y_space=formula_3, z_space=number)  # This node represents an upgrade of the 0.6.3 XyzGrid node to 0.7.x
# note: Image-related Settings
path_to_image_file = Filename("C:\Users\adieckmann\Documents\GitHub\DynamoSamples\workflow_samples\ImageToCNC\sample_image.jpg")
fromPath = FileObject(path_to_image_file)  # "File.FromPath"
readFromFile = Image.ReadFromFile(fromPath)
pixels = Image.Pixels(readFromFile, x_count, y_count)
# note: Replace this with a Color Saturation or Color Hue node for different effects.
brightness = Color.Brightness(pixels, lacing=Longest)
invert_image_data = BoolSelector(false)
mirror_image_vertically = BoolSelector(false)
mirror_image_horizontally = BoolSelector(true)
invertAndMirrorNormalizedValues = Custom[Paneling.InvertAndMirrorNormalizedValues](list=brightness, Invert=invert_image_data, Mirror_Vertically=mirror_image_vertically, Mirror_Horizontally=mirror_image_horizontally, X=x_count)  # Inverts and mirrors (horizontally & vertically) a list of normalized values.
bottom_greyscale_thrshold = DoubleSlider(0, range=0..0.5)  # "Bottom Greyscale Thrshold (Maximum Black)"
# note: Create filter for white threshold
formula_4 = Formula("pixel<min", pixel=invertAndMirrorNormalizedValues, min=bottom_greyscale_thrshold, lacing=Longest)
# note: List of top points, filtered by white threshold
filterByBoolMask = List.FilterByBoolMask(xyzGrid, formula_4)
top_greyscale_threshold_minimum = DoubleSlider(1, range=0.5..1)  # "Top Greyscale Threshold (Minimum White)"
# note: If applicable set pixels that are too dark to the maximum threshold value
formula_5 = Formula("if(pixel>max,max,pixel)", pixel=invertAndMirrorNormalizedValues, max=top_greyscale_threshold_minimum, lacing=Longest)
minimum_drill_depth = DoubleInput(0.005)
maximum_drill_depth = DoubleInput(0.02)
# note: Translate normalized values to min and max values from sliders and turn that into a height value
scaleNormalized = Custom[Math.ScaleNormalized](val=formula_5, Min=minimum_drill_depth, Max=maximum_drill_depth)  # Scales a normalized value according to a given minimum and maximum
# note: Unfiltered list of bottom points
byCoordinates_2 = Point.ByCoordinates(number, number, scaleNormalized, lacing=Longest)
asVector = Point.AsVector(byCoordinates_2)
subtract = Point.Subtract(xyzGrid, asVector, lacing=Longest)
# note: List of bottom points, filtered by white threshold
filterByBoolMask_2 = List.FilterByBoolMask(subtract, formula_4)
byStartPointEndPoint = Line.ByStartPointEndPoint(filterByBoolMask.out1, filterByBoolMask_2.out1, lacing=Longest)
# note: Create vertical lines and set them to the appropriate subcategory
byCurve_2 = ModelCurve.ByCurve(byStartPointEndPoint, lacing=Longest)
setSubcategory_2 = Custom[Element.SetSubcategory](Subcategory=byName_2, Cut_Projection=boolean, Element_s=byCurve_2)
subcategory_name_for_horizontal = StringInput("CNC_Horizontal")  # "Subcategory Name for Horizontal Lines"
byName_3 = Custom[Subcategory.ByName](Category=categories, Name=subcategory_name_for_horizontal)
swap_stripe_path_direction = BoolSelector(false)
chop = List.Chop(formula_4, x_count)
transpose = List.Transpose(chop)
# note: Depending on the chosen stripe direction, the list of booleans for the white threshold filter may need to be transposed.
if_ = If(swap_stripe_path_direction, transpose, chop)
boolean_2 = BoolSelector(false)
# note: Due to the white threshold, the lines will not run continuously in each row in some cases. So we need to count how many points will form each line.
countBooleanSequences = Custom[List.CountBooleanSequences](True_False=boolean_2)  # Retrieves the lengths of uninterrupted sequences of booleans (true or false) in a given list.
map = List.Map(if_, countBooleanSequences)
flatten = Flatten(map)
chop_2 = List.Chop(subtract, x_count)
# note: Depending on the chosen stripe direction, the point list may first need to be transposed before filtering it with the (also transposed)booleans of the white threshold filter.
transpose_2 = List.Transpose(chop_2)
flatten_2 = Flatten(transpose_2)
flatten_3 = Flatten(transpose)
filterByBoolMask_3 = List.FilterByBoolMask(flatten_2, flatten_3)
if_2 = If(swap_stripe_path_direction, filterByBoolMask_3.out1, filterByBoolMask_2.out1)
# note: Build a sublist for each continuous set of points
sublistByLengths = Custom[Build Irregular Sublists](lengths=flatten, list=if_2)  # "List.SublistByLengths"; Turns a list into a list of lists with sublists of varying lengths.
# note: Ignore sequences with just one point
formula_6 = Formula("n>1", n=flatten, lacing=Longest)
filterByBoolMask_4 = List.FilterByBoolMask(sublistByLengths, formula_6)
byPoints = NurbsCurve.ByPoints(lacing=Longest)
map_2 = List.Map(filterByBoolMask_4, byPoints)
# note: Create (more or less) horizontal (sp)lines and set them to the appropriate subcategory
byCurve_3 = ModelCurve.ByCurve(map_2, lacing=Longest)
setSubcategory_3 = Custom[Element.SetSubcategory](Subcategory=byName_3, Cut_Projection=boolean, Element_s=byCurve_3)
generate_3d_preview = BoolSelector(true)
n3d_preview_scaling = DoubleSlider(100, range=0..1000)  # "3D Preview Scaling"
scale = Geometry.Scale(byCoordinates, n3d_preview_scaling, lacing=Longest)
dispatch = Custom[Dispatch](test=generate_3d_preview, value=scale)  # Dispatches a value to one of two output ports (true/false) depending on a condition. The other output port will return an empty list.
closedLoopThroughPoints_2 = Custom[Lines Through Points (Closed Loop)](list=dispatch.true)  # "Line.ClosedLoopThroughPoints"
byJoinedCurves = PolyCurve.ByJoinedCurves(closedLoopThroughPoints_2, lacing=Longest)
vector_zaxis_negative = Custom[Z Axis (Negative)]()  # Returns an XYZ of 0,0,-1
asVector_2 = Point.AsVector(vector_zaxis_negative)
panel_thickness = DoubleInput(0.008)
# note: If applicable, generate a (scaled) 3D preview for panel material
formula_7 = Formula("thickness * scale", thickness=panel_thickness, scale=n3d_preview_scaling, lacing=Longest)
fromDouble = DynamoUnits.Length.FromDouble(formula_7, lacing=Longest)
extrudeAsSolid = Curve.ExtrudeAsSolid(byJoinedCurves, asVector_2, fromDouble, lacing=Longest)
generate_holes_stripes_for_3d = BoolSelector(true)  # "Generate Holes/Stripes for 3D Preview?"
# note: List of drill depths, filtered by white threshold
filterByBoolMask_5 = List.FilterByBoolMask(scaleNormalized, formula_4)
byCoordinates_3 = Point.ByCoordinates(arg2=filterByBoolMask_5.out1, lacing=Longest)
asVector_3 = Point.AsVector(byCoordinates_3)
# note: Drill depths
# (as XYZ relative to drill point)
subtract_2 = Point.Subtract(filterByBoolMask.out1, asVector_3, lacing=Longest)
number_2 = DoubleInput(45)
degreesToRadians = Math.DegreesToRadians(number_2)
# note: Compute the top radius of the drill hole based on drill depth and milling head angle
formula_8 = Formula("mill_angle/2", mill_angle=degreesToRadians, lacing=Longest)
formula_9 = Formula("pi/2-alpha", alpha=formula_8, lacing=Longest)
byLawOfSines = Custom[Side.ByLawOfSines](alpha_degr=formula_8, B=filterByBoolMask_5.out1, beta_degr=formula_9)  # Determines the length of a side based on the law of sines. (Alpha is the angle opposite side A and beta is the angle opposite side B...)
byCoordinates_4 = Point.ByCoordinates(byLawOfSines, lacing=Longest)
asVector_4 = Point.AsVector(byCoordinates_4)
# note: Top radii
# (as XYZ relative to drill point)
add = Point.Add(filterByBoolMask.out1, asVector_4, lacing=Longest)
create_list_3 = List.Create(filterByBoolMask.out1, subtract_2, add)
# note: If applicable, generate a (scaled) 3D preview for drill holes
dispatch_2 = Custom[Dispatch](test=generate_3d_preview, value=create_list_3)
scale_2 = Geometry.Scale(dispatch_2.true, n3d_preview_scaling, lacing=Longest)
# note: Organize list in separate
# sublists for each triangle
transpose_3 = List.Transpose(scale_2)
number_3 = DoubleInput(1)
shiftIndices = List.ShiftIndices(arg1=number_3)
map_3 = List.Map(transpose_3, shiftIndices)
# note: Create lines for each triangle and turn triangles into curve loops
byStartPointEndPoint_2 = Line.ByStartPointEndPoint(map_3, transpose_3, lacing=Longest)
byJoinedCurves_2 = PolyCurve.ByJoinedCurves(byStartPointEndPoint_2, lacing=Longest)
# note: Extract drill points as origins for revolves
firstItem = List.FirstItem(scale_2)
ZAxis = Vector.ZAxis()
asPoint = Vector.AsPoint(ZAxis, lacing=Longest)
YAxis = Vector.YAxis()
asPoint_2 = Vector.AsPoint(YAxis, lacing=Longest)
# note: Create transforms for revolving around the Z axis
transformOriginVectors = Custom[TransformOriginVectors](up=firstItem, forward=asPoint, origin=asPoint_2)  # This node represents an upgrade of 0.6.3 TransformOriginVectors to 0.7.0
number_4 = DoubleInput(0)
piTimes2 = Math.PiTimes2()
# note: Create a revolve for each drill hole
revolve = CreateRevolvedGeometry(byJoinedCurves_2, transformOriginVectors, number_4, piTimes2, lacing=Longest)
formula_10 = Formula("mill_angle/2", mill_angle=degreesToRadians, lacing=Longest)
Z = Point.Z(if_2, lacing=Longest)
formula_11 = Formula("Abs(x)", x=Z, lacing=Longest)
formula_12 = Formula("pi/2-alpha", alpha=formula_10, lacing=Longest)
byLawOfSines_2 = Custom[Side.ByLawOfSines](alpha_degr=formula_10, B=formula_11, beta_degr=formula_12)
byCoordinates_5 = Point.ByCoordinates(byLawOfSines_2, lacing=Longest)
# note: Set triangle orientation relative to spline direction
byCoordinates_6 = Point.ByCoordinates(arg1=byLawOfSines_2, lacing=Longest)
if_3 = If(swap_stripe_path_direction, byCoordinates_5, byCoordinates_6)
asVector_5 = Point.AsVector(if_3)
add_2 = Point.Add(if_2, asVector_5, lacing=Longest)
# note: Project triangle top points to XY plane
project_xyz_to_xy_plane = Custom[Project XYZ To XY Plane](xyz=add_2)
asVector_6 = Point.AsVector(if_3)
subtract_3 = Point.Subtract(if_2, asVector_6, lacing=Longest)
project_xyz_to_xy_plane_2 = Custom[Project XYZ To XY Plane](xyz=subtract_3)
# note: If applicable, generate a (scaled) 3D preview for drill stripes
create_list_4 = List.Create(project_xyz_to_xy_plane, if_2, project_xyz_to_xy_plane_2)
dispatch_3 = Custom[Dispatch](test=generate_3d_preview, value=create_list_4)
scale_3 = Geometry.Scale(dispatch_3.true, n3d_preview_scaling, lacing=Longest)
transpose_4 = List.Transpose(scale_3)
number_5 = DoubleInput(1)
shiftIndices_2 = List.ShiftIndices(arg1=number_5)
map_4 = List.Map(transpose_4, shiftIndices_2)
# note: Create lines for each triangle
byStartPointEndPoint_3 = Line.ByStartPointEndPoint(transpose_4, map_4, lacing=Longest)
# note: Build a sublist for each
# continuous set of points
sublistByLengths_2 = Custom[Build Irregular Sublists](lengths=flatten, list=byStartPointEndPoint_3)  # "List.SublistByLengths"
formula_13 = Formula("n>1", n=flatten, lacing=Longest)
filterByBoolMask_6 = List.FilterByBoolMask(sublistByLengths_2, formula_13)
byJoinedCurves_3 = PolyCurve.ByJoinedCurves(lacing=Longest)
map_5 = List.Map(filterByBoolMask_6, byJoinedCurves_3)
number_6 = DoubleInput(1)
shiftIndices_3 = List.ShiftIndices(arg1=number_6)
map_6 = List.Map(map_5, shiftIndices_3)
# note: Make two sets of curve loops for creating blends and remove the first item for each sequence
restOfItems = List.RestOfItems()
map_7 = List.Map(map_6, restOfItems)
map_8 = List.Map(map_5, restOfItems)
create_list_5 = List.Create(map_7, map_8)
# note: Create a blend between two points for all points in all sequences
byLoft = Solid.ByLoft(create_list_5, lacing=Longest)
flatten_4 = Flatten(byLoft)
if_4 = If(generate_holes_stripes_for_3d, revolve, flatten_4)
# note: Cut holes (or stripes) into 3D preview object and bake
recursive_boolean_difference = Custom[Recursive Boolean Difference](First_Solid=extrudeAsSolid, List_of_Solids=if_4)
byGeometries = ImportInstance.ByGeometries(recursive_boolean_difference, lacing=Longest)
