# Dynamo graph 1PointReactor_AC_Hexagonal.dyn (Dynamo 0.9.0.3067)

select_face = DSFaceSelection()  # 1 picked in the model
firstItem = List.FirstItem(select_face)
# note: This graph populates a face with hexagonal adaptive components and applies a reactor pattern to one of the components' parameters. In this example (based on a conceptual mass) the reactor point is being represented by a reference point. In a project file it could be represented by the location of a family instance instead.
# REQUIRED PACKAGES:
# - Clockwork for Dynamo 0.9.x
# ISSUES:
# Post issues here: https://github.com/CAAD-RWTH/ClockworkForDynamo/issues
# note: Face-related Settings
integer_slider = IntegerSlider(13, range=0..20 step 1)
integer_slider_2 = IntegerSlider(13, range=0..20 step 1)
gridFromFace = Custom[Paneling.GridFromFace](surface=firstItem, U=integer_slider, V=integer_slider_2)  # Returns UV coordinates, XYZ coordinates and normals for a face with UV subdivision
# note: Component-related Settings
odd_rows_reverse_placement_order = BoolSelector(false)
integer_slider_3 = IntegerSlider(0, range=0..5 step 1)
even_rows_reverse_placement = BoolSelector(false)  # "Even Rows: Reverse Placement Order?"
integer_slider_4 = IntegerSlider(0, range=0..5 step 1)
rotae_grid_by_90_degrees = BoolSelector(false)
# note: Create placement pattern for adaptive components
hexagonal = Custom[Paneling.Hexagonal](seq=gridFromFace.UVs, V=integer_slider_2, reverseOddRows=odd_rows_reverse_placement_order, shiftPlacementOddRows=integer_slider_3, reverseEvenRows=even_rows_reverse_placement, shiftPlacementEvenRows=integer_slider_4, rotateGridBy90Degrees=rotae_grid_by_90_degrees)
join = List.Join(hexagonal.oddRows, hexagonal.evenRows)
select_quadrilateral_adaptive = FamilyTypes("Hex:Hex")  # "Select Quadrilateral Adaptive Component Type"
# note: Create ACs at specified locations
byParametersOnFace = AdaptiveComponent.ByParametersOnFace(join, firstItem, select_quadrilateral_adaptive, lacing=Longest)
instance_parameter_name = StringInput("controller")
invert_reactor = BoolSelector(false)
# note: Reactor-related Settings
select_reactor_point = DSModelElementSelection()  # 1 picked in the model
point = ReferencePoint.Point(select_reactor_point, lacing=Longest)
hexagonal_2 = Custom[Paneling.Hexagonal](seq=gridFromFace.Points, V=integer_slider_2, reverseOddRows=odd_rows_reverse_placement_order, shiftPlacementOddRows=integer_slider_3, reverseEvenRows=even_rows_reverse_placement, shiftPlacementEvenRows=integer_slider_4, rotateGridBy90Degrees=rotae_grid_by_90_degrees)
join_2 = List.Join(hexagonal_2.oddRows, hexagonal_2.evenRows)
# note: Find component centers
average = Custom[Point.Average](points=join_2)  # Determines the average of a list of points
# note: Measure distance between component center and reactor point
distanceTo = Geometry.DistanceTo(geometry=point, other=average, lacing=Longest)
# note: Convert distances to normalized values
normalizeRange = Custom[Math.NormalizeRange](seq=distanceTo)  # Normalizes a range of numbers
invertNormalized = Custom[Invert Normalized Value](dbl=normalizeRange)  # "Math.InvertNormalized"; Inverts a value between 0 and 1 to its opposite (1-x)
# note: Invert values (if applicable)
if_ = If(test=invert_reactor, true=invertNormalized, false=normalizeRange)
# note: Write reactor value to instance parameters
setParameterByName = Element.SetParameterByName(element=byParametersOnFace, parameterName=instance_parameter_name, value=if_, lacing=Longest)
