# Dynamo graph 1PointReactor_AC_Quadrilateral.dyn (Dynamo 0.9.0.3067)

select_face = DSFaceSelection()  # 1 picked in the model
firstItem = List.FirstItem(select_face)
# note: This graph populates a face with quadrilateral adaptive components and applies a reactor pattern to one of the components' parameters. In this example (based on a conceptual mass) the reactor point is being represented by a reference point. In a project file it could be represented by the location of a family instance instead.
# REQUIRED PACKAGES:
# - Clockwork for Dynamo 0.9.x
# ISSUES:
# Post issues here: https://github.com/CAAD-RWTH/ClockworkForDynamo/issues
# note: Face-related Settings
U = IntegerSlider(12, range=0..20 step 1)
V = IntegerSlider(12, range=0..20 step 1)
gridFromFace = Custom[Paneling.GridFromFace](surface=firstItem, U=U, V=V)  # Returns UV coordinates, XYZ coordinates and normals for a face with UV subdivision
# note: Component-related Settings
reverse_placement_order = BoolSelector(false)
shift_point_placement = IntegerSlider(0, range=0..3 step 1)
# note: Create placement pattern for adaptive components
quadrilateral = Custom[Paneling.Quadrilateral](seq=gridFromFace.UVs, V=V, reverse=reverse_placement_order, shiftPlacement=shift_point_placement)  # Creates groups of points from a list of UVs or XYZs for the placement of quadrilateral panels. The placement pattern can be reversed (boolean) and shifted (integer).
select_quadrilateral_adaptive = FamilyTypes("Quad:Quad")  # "Select Quadrilateral Adaptive Component Type"
# note: Create ACs at specified locations
byParametersOnFace = AdaptiveComponent.ByParametersOnFace(quadrilateral, firstItem, select_quadrilateral_adaptive, lacing=Longest)
instance_parameter_name = StringInput("controller")
invert_reactor = BoolSelector(false)
# note: Reactor-related Settings
select_reactor_point = DSModelElementSelection()  # 1 picked in the model
point = ReferencePoint.Point(select_reactor_point, lacing=Longest)
quadrilateral_2 = Custom[Paneling.Quadrilateral](seq=gridFromFace.Points, V=V, reverse=reverse_placement_order, shiftPlacement=shift_point_placement)
# note: Find component centers
average = Custom[Point.Average](points=quadrilateral_2)  # Determines the average of a list of points
# note: Measure distance between component center and reactor point
distanceTo = Geometry.DistanceTo(geometry=point, other=average, lacing=Longest)
# note: Convert distances to normalized values
normalizeRange = Custom[Math.NormalizeRange](seq=distanceTo)  # Normalizes a range of numbers
invertNormalized = Custom[Invert Normalized Value](dbl=normalizeRange)  # "Math.InvertNormalized"; Inverts a value between 0 and 1 to its opposite (1-x)
# note: Invert values (if applicable)
if_ = If(test=invert_reactor, true=invertNormalized, false=normalizeRange)
# note: Write reactor value to instance parameters
setParameterByName = Element.SetParameterByName(element=byParametersOnFace, parameterName=instance_parameter_name, value=if_, lacing=Longest)
