# Dynamo graph 1PointReactor_AC_Triangular.dyn (Dynamo 0.9.0.3067)

select_face = DSFaceSelection()  # 1 picked in the model
firstItem = List.FirstItem(select_face)
# note: This graph populates a face with triangular adaptive components and applies a reactor pattern to one of the components' parameters. In this example (based on a conceptual mass) the reactor point is being represented by a reference point. In a project file it could be represented by the location of a family instance instead.
# REQUIRED PACKAGES:
# - Clockwork for Dynamo 0.9.x
# ISSUES:
# Post issues here: https://github.com/CAAD-RWTH/ClockworkForDynamo/issues
# note: Face-related Settings
integer_slider = IntegerSlider(12, range=0..20 step 1)
integer_slider_2 = IntegerSlider(12, range=0..20 step 1)
gridFromFace = Custom[Paneling.GridFromFace](surface=firstItem, U=integer_slider, V=integer_slider_2)  # Returns UV coordinates, XYZ coordinates and normals for a face with UV subdivision
# note: Component-related Settings
shift_rows = BoolSelector(false)
reverse_placement_order = BoolSelector(false)
integer_slider_3 = IntegerSlider(0, range=0..2 step 1)
rotate_grid_by_90_degrees = BoolSelector(false)
# note: Create placement pattern for adaptive components
triangularFlatMirrored = Custom[Paneling.TriangularFlatMirrored](seq=gridFromFace.UVs, V=integer_slider_2, shiftRows=shift_rows, reverseRowsLying=reverse_placement_order, reverseRowsStanding=reverse_placement_order, reverseLeftCornersLying=reverse_placement_order, reverseLeftCornersStanding=reverse_placement_order, reverseRightCornersLying=reverse_placement_order, reverseRightCornersStanding=reverse_placement_order, shiftPlacementRowsLying=integer_slider_3, shiftPlacementRowsStanding=integer_slider_3, shiftPlacementLeftCornersLying=integer_slider_3, shiftPlacementLeftCornersStanding=integer_slider_3, shiftPlacementRightCornersLying=integer_slider_3, shiftPlacementRightCornersStanding=integer_slider_3, rotateGridBy90Degrees=rotate_grid_by_90_degrees)  # Creates groups of points from a list of UVs or XYZs for the placement of triangular panels. The placement pattern can be reversed (boolean) and shifted (integer).
join = List.Join(triangularFlatMirrored.rowsLying, triangularFlatMirrored.rowsStanding, triangularFlatMirrored.leftCornersLying, triangularFlatMirrored.leftCornersStanding, triangularFlatMirrored.rightCornersLying, triangularFlatMirrored.rightCornersStanding)
select_quadrilateral_adaptive = FamilyTypes("Triangle:Triangle")  # "Select Quadrilateral Adaptive Component Type"
# note: Create ACs at specified locations
byParametersOnFace = AdaptiveComponent.ByParametersOnFace(join, firstItem, select_quadrilateral_adaptive, lacing=Longest)
instance_parameter_name = StringInput("controller")
invert_reactor = BoolSelector(false)
# note: Reactor-related Settings
select_reactor_point = DSModelElementSelection()  # 1 picked in the model
point = ReferencePoint.Point(select_reactor_point, lacing=Longest)
triangularFlatMirrored_2 = Custom[Paneling.TriangularFlatMirrored](seq=gridFromFace.Points, V=integer_slider_2, shiftRows=shift_rows, reverseRowsLying=reverse_placement_order, reverseRowsStanding=reverse_placement_order, reverseLeftCornersLying=reverse_placement_order, reverseLeftCornersStanding=reverse_placement_order, reverseRightCornersLying=reverse_placement_order, reverseRightCornersStanding=reverse_placement_order, shiftPlacementRowsLying=integer_slider_3, shiftPlacementRowsStanding=integer_slider_3, shiftPlacementLeftCornersLying=integer_slider_3, shiftPlacementLeftCornersStanding=integer_slider_3, shiftPlacementRightCornersLying=integer_slider_3, shiftPlacementRightCornersStanding=integer_slider_3, rotateGridBy90Degrees=rotate_grid_by_90_degrees)
join_2 = List.Join(triangularFlatMirrored_2.rowsLying, triangularFlatMirrored_2.rowsStanding, triangularFlatMirrored_2.leftCornersLying, triangularFlatMirrored_2.leftCornersStanding, triangularFlatMirrored_2.rightCornersLying, triangularFlatMirrored_2.rightCornersStanding)
# note: Find component centers
average = Custom[Point.Average](points=join_2)  # Determines the average of a list of points
# note: Measure distance between component center and reactor point
distanceTo = Geometry.DistanceTo(geometry=point, other=average, lacing=Longest)
# note: Convert distances to normalized values
normalizeRange = Custom[Math.NormalizeRange](seq=distanceTo)  # Normalizes a range of numbers
invertNormalized = Custom[Invert Normalized Value](dbl=normalizeRange)  # "Math.InvertNormalized"; Inverts a value between 0 and 1 to its opposite (1-x)
# note: Invert values (if applicable)
if_ = If(test=invert_reactor, true=invertNormalized, false=normalizeRange)
# note: Write reactor value to instance parameters
setParameterByName = Element.SetParameterByName(element=byParametersOnFace, parameterName=instance_parameter_name, value=if_, lacing=Longest)
