# Dynamo graph ParameterValuesFromImage_AC.dyn (Dynamo 0.9.0.3067)

select_face = DSFaceSelection()  # 1 picked in the model
firstItem = List.FirstItem(select_face)
# note: This graph was a first try at emulating the behaviour of the Parameter Values From Image plugin that used to be available for Vasari.
# It will let you pick a face, specify the number of UV divisions and populate it with adaptive components. Use an image file to drive a parameter value for each placed instance of the adaptive component.
# First published here: http://autodeskvasari.com/forum/topics/parameter-values-from-image-for-dynamo
# REQUIRED PACKAGES:
# - Clockwork for Dynamo 0.9.x
# ISSUES:
# Post issues here: https://github.com/CAAD-RWTH/ClockworkForDynamo/issues
# note: Face-related settings
integer_slider = IntegerSlider(12, range=0..20 step 1)
integer_slider_2 = IntegerSlider(12, range=0..20 step 1)
gridFromFace = Custom[Paneling.GridFromFace](surface=firstItem, U=integer_slider, V=integer_slider_2)  # Returns UV coordinates, XYZ coordinates and normals for a face with UV subdivision
reverse_placement_point_order = BoolSelector(false)
integer_slider_3 = IntegerSlider(0, range=0..3 step 1)
quadrilateral = Custom[Paneling.Quadrilateral](seq=gridFromFace.UVs, V=integer_slider_2, reverse=reverse_placement_point_order, shiftPlacement=integer_slider_3)  # Creates groups of points from a list of UVs or XYZs for the placement of quadrilateral panels. The placement pattern can be reversed (boolean) and shifted (integer).
# note: Component-related settings
# This can be any 4-point Adaptive Component loaded in the family.
family_types = FamilyTypes("4PointACByOffset:4PointACByOffset")
byParametersOnFace = AdaptiveComponent.ByParametersOnFace(quadrilateral, firstItem, family_types, lacing=Longest)
instance_parameter_name = StringInput("controller")
# note: Image-related settings
path_to_image_file = Filename("C:\Users\adieckmann\Documents\GitHub\ClockworkForDynamo\workflow_samples\0.9.x\ParameterValuesFromImage_AC\sample_image.jpg")
fromPath = FileObject(path_to_image_file)  # "File.FromPath"
readFromFile = Image.ReadFromFile(fromPath)
# note: Get an appropriate number of samples from the image file
pixels = Image.Pixels(image=readFromFile, xSamples=integer_slider_2, ySamples=integer_slider)
# note: Replace this with a Color Saturation or Color Hue node for different effects
brightness = Color.Brightness(pixels, lacing=Longest)
invert_image_data = BoolSelector(false)
mirror_image_vertically = BoolSelector(false)
mirror_image_horizontally = BoolSelector(true)
invertAndMirrorNormalizedValues = Custom[Paneling.InvertAndMirrorNormalizedValues](seq=brightness, Invert=invert_image_data, MirrorVertically=mirror_image_vertically, MirrorHorizontally=mirror_image_horizontally)  # Inverts and mirrors (horizontally & vertically) a list of normalized values.
flatten = Flatten(invertAndMirrorNormalizedValues)
# note: Set parameter values according to image brightness
setParameterByName = Element.SetParameterByName(element=byParametersOnFace, parameterName=instance_parameter_name, value=flatten, lacing=Longest)
