# Dynamo graph SunDirectionToPanels.dyn (Dynamo 0.9.0.3067)

# note: This graph populates the surface of a mass with quadrilateral curtain wall panels and computes the average surface normal of each panel. It then writes the delta between the sun's altitude and azimuth and the repective panel normals into each respective panel. This workflow could be used to animate panels that keep rotating in order to stay perpendicular to the sun rays.
# REQUIRED PACKAGES:
# - Clockwork for Dynamo 0.9.x
# ISSUES:
# Post issues here: https://github.com/CAAD-RWTH/ClockworkForDynamo/issues
# note: Face-related settings
select_face = DSFaceSelection()  # 1 picked in the model
firstItem = List.FirstItem(select_face)
integer_slider = IntegerSlider(16, range=0..20 step 1)
integer_slider_2 = IntegerSlider(4, range=0..20 step 1)
gridFromFace = Custom[Paneling.GridFromFace](surface=firstItem, U=integer_slider, V=integer_slider_2)  # Returns UV coordinates, XYZ coordinates and normals for a face with UV subdivision
boolean = BoolSelector(false)
integer_slider_3 = IntegerSlider(0, range=0..3 step 1)
quadrilateral = Custom[Paneling.Quadrilateral](seq=gridFromFace.UVs, V=integer_slider_2, reverse=boolean, shiftPlacement=integer_slider_3)  # Creates groups of points from a list of UVs or XYZs for the placement of quadrilateral panels. The placement pattern can be reversed (boolean) and shifted (integer).
# note: Panel-related settings
family_types = FamilyTypes("Family2:Family2")
byParametersOnFace = AdaptiveComponent.ByParametersOnFace(quadrilateral, firstItem, family_types, lacing=Longest)
parameter_name = StringInput("azimuth_delta")
current = SunSettings()  # "SunSettings.Current"
sunDirection = SunSettings.SunDirection(current)
# note: Compute altitude and azimuth for the sun's current position and for each panel's average surface normal.
# This example is made for vertical louvers - if you are designing horizontal shading devices, use the altitude outputs instead.
altitudeAndAzimuth = Custom[Vector.AltitudeAndAzimuth](vector=sunDirection)  # Computes the altitude and azimuth of a given vector
# note: Find average surface normal for each panel
quadrilateral_2 = Custom[Paneling.Quadrilateral](seq=gridFromFace.Normals, V=integer_slider_2, reverse=boolean, shiftPlacement=integer_slider_3)
average = Custom[Vector.Average](vectors=quadrilateral_2)  # Determines the average vector of a list of vectors
altitudeAndAzimuth_2 = Custom[Vector.AltitudeAndAzimuth]()
map = List.Map(list=average, f_x=altitudeAndAzimuth_2.azimuth)
# note: For each panel, find the delta to the sun's altitude or azimuth
code_block = CodeBlock(sun_vector=altitudeAndAzimuth.azimuth, panel_normal=map) { sun_vector - panel_normal; }
setParameterByName = Element.SetParameterByName(element=byParametersOnFace, parameterName=parameter_name, value=code_block, lacing=Longest)
