# Dynamo graph 1PointReactor_AC.dyn (Dynamo 0.7.0.28161)

select_face = FormElementBySelection()  # 1 picked in the model
# note: This definition populates a face with quadrilateral adaptive components and applies a reactor pattern to one of the components' parameters.
# For questions email me at dieckmann@caad.arch.rwth-aachen.de
# First presented as a proof of concept at eCAADe 2014 in a slightly different version. More info here: http://prezi.com/zxw90kdgdsag/building-your-own-urban-tool-kit/
# note: Face-related Settings
U = IntegerSliderInput(12, range=0..20)
V = IntegerSliderInput(12, range=0..20)
# note: REQUIRED PACKAGES:
# - Get Highest And Lowest
# - Normalization
# - Simple Patterning
# - XYZ Grid From Face
uv_and_xyz_grid_from_face = Custom[UV And XYZ Grid From Face](face=select_face, U=U, V=V)  # Returns UV coordinates, XYZ coordinates and normals for a face with UV subdivision
reverse_placement_point_order = BoolSelector(false)
shift_placement_point_order = IntegerSliderInput(0, range=0..3)
# note: Create placement pattern for adaptive components
quadrilateral_pattern_from_grid = Custom[Quadrilateral Pattern From Grid](list=uv_and_xyz_grid_from_face.UVs, V=V, reverse=reverse_placement_point_order, shift_placement=shift_placement_point_order)  # Creates groups of points from a list of UVs or XYZs for the placement of quadrilateral panels. The placement pattern can be reversed (boolean) and shifted (integer).
# note: Component-related Settings
select_quadrilateral_adaptive = FamilyTypeSelector(index=0)  # "Select Quadrilateral Adaptive Component"
# note: Create ACs at specified locations
adaptive_component_by_uvs_on = AdaptiveComponentByUvsOnFace(quadrilateral_pattern_from_grid, select_face, select_quadrilateral_adaptive, lacing=Longest)
instance_parameter_name = StringInput("controller")
invert_reactor = BoolSelector(false)
# note: Reactor-related Settings
select_reactor_point = PointBySelection()  # 1 picked in the model
xyz_from_reference_point = XyzFromReferencePoint(select_reactor_point, lacing=Longest)
average_xyzs = XyzAverage(lacing=Longest)
evaluate_surface = XyzEvaluate(arg1=select_face, lacing=Longest)
# note: Collect placement point XYZs for each panel
map = Map(evaluate_surface, quadrilateral_pattern_from_grid)
# note: Find component center
map_2 = Map(average_xyzs, map)
# note: Measure distance between component center and reactor point
xyz_distance = XyzDistance(xyz_from_reference_point, map_2, lacing=Longest)
get_highest_and_lowest_from_list = Custom[Get Highest And Lowest From List](list=xyz_distance)  # Gets the highest and lowest value from a given list
# note: Convert distances to normalized values
normalize_value = Custom[Normalize Value](Value=xyz_distance, MinRange=get_highest_and_lowest_from_list.lowest, MaxRange=get_highest_and_lowest_from_list.highest)  # Converts a value into a normalized value according to a value range
invert_normalized_value = Custom[Invert Normalized Value](normalize_value)  # Inverts a value between 0 and 1 or a boolean to its opposite (1-x)
# note: Invert values (if applicable)
if_ = Conditional(invert_reactor, invert_normalized_value, normalize_value)
# note: Write reactor value to instance parameters
set_family_instance_parameter = FamilyInstanceParameterSetter(adaptive_component_by_uvs_on, instance_parameter_name, if_, lacing=Longest)
