# Dynamo graph 2PointReactor_DS.dyn (Dynamo 0.7.0.28161)

# note: This definition applies a reactor pattern to an instance parameter of pattern-based elements hosted on a divided surface.
# For questions email me at dieckmann@caad.arch.rwth-aachen.de
# First presented as a proof of concept at eCAADe 2014 in a slightly different version. More info here: http://prezi.com/zxw90kdgdsag/building-your-own-urban-tool-kit/
# note: Component-related Settings
select_divided_surface_families = DividedSurfaceBySelection()  # 1 picked in the model
flatten_completely = FlattenList(select_divided_surface_families)
instance_parameter_name = StringInput("controller")
invert_reactor = BoolSelector(false)
if_x_greater_than = Custom[If X Greater Than]()  # If X > Y as a mappable function
# note: Reactor-related Settings
select_reactor_point_1 = PointBySelection()  # 1 picked in the model
xyz_from_reference_point = XyzFromReferencePoint(select_reactor_point_1, lacing=Longest)
# note: REQUIRED PACKAGES:
# - Get Highest And Lowest
# - Mappable Conditions
# - Normalization
average_xyzs = XyzAverage(lacing=Longest)
get_family_instance_location = GetFamilyInstanceLocation(flatten_completely, lacing=Longest)
# note: Find component center
map = Map(average_xyzs, get_family_instance_location)
# note: Measure distance between component center and reactor points
xyz_distance = XyzDistance(xyz_from_reference_point, map, lacing=Longest)
select_reference_point_2 = PointBySelection()  # 1 picked in the model
xyz_from_reference_point_2 = XyzFromReferencePoint(select_reference_point_2, lacing=Longest)
# note: Always take the greater value of both reactors
xyz_distance_2 = XyzDistance(xyz_from_reference_point_2, map, lacing=Longest)
combine = Combine(if_x_greater_than, xyz_distance, xyz_distance_2, xyz_distance, xyz_distance_2)
get_highest_and_lowest_from_list = Custom[Get Highest And Lowest From List](list=combine)  # Gets the highest and lowest value from a given list
# note: Convert distances to normalized values
normalize_value = Custom[Normalize Value](Value=combine, MinRange=get_highest_and_lowest_from_list.lowest, MaxRange=get_highest_and_lowest_from_list.highest)  # Converts a value into a normalized value according to a value range
invert_normalized_value = Custom[Invert Normalized Value](normalize_value)  # Inverts a value between 0 and 1 or a boolean to its opposite (1-x)
# note: Invert values (if applicable)
if_ = Conditional(invert_reactor, invert_normalized_value, normalize_value)
# note: Write reactor value to instance parameters
set_family_instance_parameter = FamilyInstanceParameterSetter(flatten_completely, instance_parameter_name, if_, lacing=Longest)
