# Dynamo graph AUGermany2014_Beispielworkflow.dyn (Dynamo 0.7.2.2921)

# note: Alle Fenster im Modell auswählen
# note: Beispiel aus dem Vortrag "Make Your Own Tools - Besser BIMmen mit Dynamo" auf der AU Germany 2012.
# Dieses Beispiel zeigt, wie sich vorhandene Dynamo-Funktionalität mit nutzergenerierten Komponenten (Custom Nodes) kombinieren lässt, um Dynamo's Funktionsumfang zu erweitern.
# ACHTUNG: Sie benötigen hierfür das Package "Clockwork for Dynamo 0.7.x", das sie über den Package Manager beziehen können (Menü "Packages" > "Search for a package".
# Fragen richten Sie bitte an dieckmann@caad.arch.rwth-aachen.de
categories = Categories("Windows")
all_elements_of_category = ElementsOfCategory(categories)
host = Custom[Element.Host](element_s=all_elements_of_category)  # Gets an element's host
orientation = Custom[Wall.Orientation](Wall_Instance_s=host)  # Gets the orientation of a given wall instance (normal of the exterior face of the wall). Will *not* work for walls hosted on mass faces or in-place walls.
watch = Watch(orientation)
# note: Fensterausrichtung (innen/außen)ermitteln
# note: Basisbauteile (d.h. Wände) der Fenster und deren Ausrichtung (innen/außen) ermitteln
facingOrientation = Custom[HostedObject.FacingOrientation](element_s=all_elements_of_category)  # Gets the facing orientation of a hosted object (e.g. a window or a door)
# note: Vektoren von einander abziehen und Länge des resultierenden Vektors messen.
subtract = Vector.Subtract(facingOrientation, orientation)
length = Vector.Length(subtract)
watch_2 = Watch(length)
watch_3 = Watch(facingOrientation)
# note: Resultierende Vektoren per Bedingung prüfen. Ist der Vektor = 0, weisen Wand und Fenster die gleiche Ausrichtung auf.
code_block = CodeBlock(len=length) { len > 0; }
watch_4 = Watch(code_block)
# note: Liste aller Fenster mittels der Prüfergebnisse filtern - dies ergibt die Liste der falsch ausgerichteten Fenster.
# note: Verbinden Sie den Output "in" von List.FilterByBoolMask entweder mit dem Input "element" von Element.OverrideColorInView oder mit dem Input "Element(s)" von FamilyInstance.FlipFacingOrientation
filterByBoolMask = List.FilterByBoolMask(all_elements_of_category, code_block)
watch_5 = Watch(filterByBoolMask)
# note: Orientierung der herausgefilterten Fenster ändern
flipFacingOrientation = Custom[FamilyInstance.FlipFacingOrientation]()  # Flips the facing orientation of a given family instance
code_block_2 = CodeBlock { 255; }
byARGB = Color.ByARGB(arg1=code_block_2)
# note: Die herausgefilterten Fenster in der aktuellen Revit-Ansicht rot markieren
overrideColorInView = Element.OverrideColorInView(arg1=byARGB)
