# Dynamo graph AUGermany_01_Linien_auswaehlen.dyn (Dynamo 0.7.2.2114)

# note: Beispiel-Workflow für das Lab "Einführung in Dynamo - Grafisches Programmieren für Revit" auf der AU Germany 2014. Die Übung basiert in wesentlichen Teilen auf einigen der mit Dynamo ausgelieferten Beispiele.
# - Erstellen einer Reihung von Skelettbauteilen entlang eines durch Modelllinien definierten Dachprofils
# - Auslesen der Trägerlängen
# - Filtern der Träger nach Trägerlänge
# - Elementweises Überschreiben der gefilterten Träger im Modell
# Fragen können Sie gerne an dieckmann@caad.arch.rwth-aachen.de richten.
# note: Auswahl der Modellinien für das Dachprofil
select_model_element = DSModelElementSelection()  # 1 picked in the model
# note: Dynamo Linien aus Revit Linien
curve = CurveElement.Curve(select_model_element)
select_model_element_2 = DSModelElementSelection()  # 1 picked in the model
curve_2 = CurveElement.Curve(select_model_element_2)
select_model_element_3 = DSModelElementSelection()  # 1 picked in the model
curve_3 = CurveElement.Curve(select_model_element_3)
create = List.Create(curve, curve_2, curve_3)
watch_3d = Watch3D(create)
