# Dynamo graph AUGermany_12_Filterergebnisse_markieren.dyn (Dynamo 0.7.2.2921)

# note: Beispiel-Workflow für das Lab "Einführung in Dynamo - Grafisches Programmieren für Revit" auf der AU Germany 2014. Die Übung basiert in wesentlichen Teilen auf einigen der mit Dynamo ausgelieferten Beispiele.
# - Erstellen einer Reihung von Skelettbauteilen entlang eines durch Modelllinien definierten Dachprofils
# - Auslesen der Trägerlängen
# - Filtern der Träger nach Trägerlänge
# - Elementweises Überschreiben der gefilterten Träger im Modell
# Fragen können Sie gerne an dieckmann@caad.arch.rwth-aachen.de richten.
# note: Auswahl der Modellinien für das Dachprofil
select_model_element = DSModelElementSelection()  # 1 picked in the model
# note: Dynamo Linien aus Revit Linien
curve = CurveElement.Curve(select_model_element)
# note: Anzahl Träger
integer_slider = IntegerSlider(12, range=0..20)
# note: Erstellen einer Liste von normalisierten Kurvenparametern zum Aufteilen der Linien
code_block = CodeBlock(y=integer_slider) { 0..1..#y; }
pointAtParameter = Curve.PointAtParameter(curve, code_block)
select_model_element_2 = DSModelElementSelection()  # 1 picked in the model
curve_2 = CurveElement.Curve(select_model_element_2)
# note: Erzeugen von Schnittebenen an den Kurvenparametern entlang einer der Linien
planeAtParameter = Curve.PlaneAtParameter(curve, code_block)
# note: Schnittpunkte zwischen Ebenen und mittlerer Linie (Spline) erzeugen - als flache Liste
intersect = Geometry.Intersect(curve_2, planeAtParameter)
flatten = Flatten(intersect)
select_model_element_3 = DSModelElementSelection()  # 1 picked in the model
curve_3 = CurveElement.Curve(select_model_element_3)
# note: Erstellen einer Reihe von Punkten auf den beiden äußeren Linien
pointAtParameter_2 = Curve.PointAtParameter(curve_3, code_block)
# note: Punktliste für alle drei Linien bilden  - und dann Spalten und Reihen vertauschen
create = List.Create(pointAtParameter, flatten, pointAtParameter_2)
transpose = List.Transpose(create)
# note: Erzeugen einer Spline für jeden Träger
byPoints = NurbsCurve.ByPoints(transpose)
# note: Platzierungsebene der Träger
levels = Levels("Roof Line")
ZAxis = Vector.ZAxis()
beam = StructuralType.Beam()
# note: Familientyp der Träger
structural_framing_types = StructuralFramingTypes("1 3/4x14")
# note: Erzeugen der Träger auf Basis der Splines, der gewünschten Basisebene, Trägerausrichtung, Tragwerksverwendung und natürlich des gewünschten Familientyps.
byCurveLevelUpVectorAndType = StructuralFraming.ByCurveLevelUpVectorAndType(byPoints, levels, ZAxis, beam, structural_framing_types)
code_block_2 = CodeBlock { 0; 1; }
# note: Ermitteln der jeweiligen gesamten Linienlänge (zwischen normalisierten Kurvenparametern 0 und 1)
lengthBetweenParameters = Curve.LengthBetweenParameters(byPoints, code_block_2.out0, code_block_2.out1)
# note: Maximal gewünschte Trägerlänge
double_slider = DoubleSlider(7, range=0..20)
# note: Prüfen der Trägerlänge
gt = lengthBetweenParameters > double_slider
# note: Filtern der Trägerliste mittels der Prüfergebnisse
filterByBoolMask = List.FilterByBoolMask(byCurveLevelUpVectorAndType, gt)
code_block_3 = CodeBlock { 255; }
byARGB = Color.ByARGB(arg1=code_block_3)
# note: Markieren der Träger mit Überlänge
# WICHTIG: Funktioniert aktuell nur in Projekten, die mit englischen Vorlagedateien erstellt worden sind
overrideColorInView = Element.OverrideColorInView(filterByBoolMask, byARGB)
