# Dynamo graph ComponentLayoutForCNC.dyn (Dynamo 0.6.3.5262)

builtincategory_generic_models = Custom[BuiltInCategory Generic Models]()  # Returns the BuiltInCategory Generic Models
sheet_name = StringInput("CNC_Panels")
sheet_number = StringInput("0001")
select_family_type_for_view = FamilyTypeSelector(index=0)  # "Select Family Type for View Sheet"
planar_panels_only = BoolSelector(true)
# note: This definition is based on a workflow first published by Zach Kron here: http://buildz.blogspot.com/2013/09/making-revit-views-and-sheet-layouts-in.html
# It creates isolated othogonal views of curtain wall panels or adaptive components and packs them on a sheet. In addition to the original workflow it can also filter out all non-planar elements.
# For questions email me at dieckmann@caad.arch.rwth-aachen.de
# This was modified as learning material for the BIM to Production class at the chair of CAAD, RWTH Aachen University in the winter semester of 2013/14.
builtincategory_curtain_wall = Custom[BuiltInCategory Curtain Wall Panels]()  # Returns the BuiltInCategory Curtain Wall Panels
get_family_instances_by_category = Custom[Get Family Instances By Category](BuiltInCategories=builtincategory_curtain_wall)  # Gets all family instances in the model for a given list of categories
flatten_completely = FlattenList(get_family_instances_by_category)
get_family_instance_location = GetFamilyInstanceLocation(flatten_completely, lacing=Longest)
# note: Find each panel's center
average_xyzs = XyzAverage(get_family_instance_location, lacing=Longest)
has_out_of_plane_xyzs = Custom[Has Out-Of-Plane XYZs]()  # Checks a list for XYZs that are not located on a given plane
plane_from_first_3_xyzs = Custom[Plane From First 3 XYZs]()  # Returns a plane, its origin and its normal based on the first three XYZs in a given list
# note: Get a plane from each panel
map = Map(plane_from_first_3_xyzs.plane, get_family_instance_location)
tolerance_mm = IntegerSliderInput(1, range=0..200)
millimeters_to_feet = Custom[Millimeters To Feet](mm=tolerance_mm)  # Converts millimeters into feet
list_length = Length(flatten_completely)
repeat = Repeat(millimeters_to_feet, list_length, lacing=Longest)
# note: Identify non-planar panels
combine = Combine(has_out_of_plane_xyzs.bool, map, get_family_instance_location, repeat)
invert_normalized_value = Custom[Invert Normalized Value](combine)  # Inverts a value between 0 and 1 or a boolean to its opposite (1-x)
# note: Get lists for planar panels only
filter_list_by_booleans = Custom[Filter List By Booleans](list=average_xyzs, booleans=invert_normalized_value)  # Filters a list by a list of booleans and filters out those elements that correspond to a boolean False.
# note: Either use planar panels only or all of them...
# note: The panel centers will be the views' target positions
if_ = Conditional(planar_panels_only, filter_list_by_booleans, average_xyzs)
# note: REQUIRED PACKAGES:
# - Has Out-Of-Plane XYZs
# - Plane From First 3 XYZs
# - Select By Category
# - Unit Conversion
plane_from_first_3_xyzs_2 = Custom[Plane From First 3 XYZs]()
# note: Get a normal from each panel
map_2 = Map(plane_from_first_3_xyzs_2.normal, get_family_instance_location)
filter_list_by_booleans_2 = Custom[Filter List By Booleans](list=map_2, booleans=invert_normalized_value)
if_2 = Conditional(planar_panels_only, filter_list_by_booleans_2, map_2)
eye_position_scale_mm = IntegerSliderInput(1, range=0..200)
millimeters_to_feet_2 = Custom[Millimeters To Feet](mm=eye_position_scale_mm)
scale_xyz = XyzScale(if_2, millimeters_to_feet_2, lacing=Longest)
# note: Determine the eye positions by adding the normals to the panel centers
add_xyzs = XyzAdd(if_, scale_xyz, lacing=Longest)
view_name = StringInput("Panel_")
concat_strings = ConcatStrings(view_name)
list_length_2 = Length(if_2)
number = DoubleInput(1..N, list_length_2, lacing=Longest)
leading_zeros = IntegerSliderInput(5, range=0..5)
sequence_with_leading_zeros = Custom[Sequence With Leading Zeros](seq=number, n=leading_zeros)  # Adds leading zeros to a sequence of numbers
# note: Create view names
map_3 = Map(concat_strings, sequence_with_leading_zeros)
filter_list_by_booleans_3 = Custom[Filter List By Booleans](list=flatten_completely, booleans=invert_normalized_value)
# note: The element list will be used to define the bounding box of each view
if_3 = Conditional(planar_panels_only, filter_list_by_booleans_3, flatten_completely)
boolean = BoolSelector(true)
# note: Create isolated views of each component and name them consecutively.
axonometric_view = IsometricView(add_xyzs, if_, map_3, if_3, boolean, lacing=Longest)
list = NewList(index0=axonometric_view)
# note: Pack all views onto a sheet
view_sheet = ViewSheet(sheet_name, sheet_number, select_family_type_for_view, list)
