# Dynamo graph ImageToCNC.dyn (Dynamo 0.6.3.7375)

category = Categories(index=498)
# note: Revit-related Settings
subcategory_name_for_boundary = StringInput("CNC_Boundary")
# note: Create separate subcategories for boundaries, verticals and horizontals (important for DWG export)
create_new_subcategory = Custom[Create New Subcategory](BuiltInCategory=category, Name=subcategory_name_for_boundary)  # Creates a new subcategory for a given element category (unless a subcategory of that name already exists - in that case it returns the existing subcategory)
boolean = BoolSelector(false)
number = DoubleInput(0)
x_overall_panel_width = DoubleInput(1.2)
length_from_number = LengthFromNumber(x_overall_panel_width)
list = NewList(index0=number, index1=length_from_number, index2=length_from_number, index3=number)
y_overall_panel_width = DoubleInput(0.8)
length_from_number_2 = LengthFromNumber(y_overall_panel_width)
list_2 = NewList(index0=number, index1=number, index2=length_from_number_2, index3=length_from_number_2)
XYZ = Xyz(list, list_2, number, lacing=Longest)
lines_through_points_closed_loop = Custom[Lines Through Points (Closed Loop)](list=XYZ)  # Works just like the built-in node Lines Through Points (creates a series of lines through a list of points) - except that it creates a *closed* loop of lines.
# note: Create boundary and set it to the appropriate subcategory
model_curve = ModelCurve(lines_through_points_closed_loop, lacing=Longest)
transaction = Transaction(model_curve)
set_element_subcategory = Custom[Set Element Subcategory](Subcategory=create_new_subcategory, Cut_Projection=boolean, Element_s=transaction)  # Assigns the given element(s) to the specified subcategory (0 for Cut, 1 for Projection).
subcategory_name_for_vertical = StringInput("CNC_Vertical")  # "Subcategory Name for Vertical Lines"
create_new_subcategory_2 = Custom[Create New Subcategory](BuiltInCategory=category, Name=subcategory_name_for_vertical)
boolean_2 = BoolSelector(false)
# note: This definition allows the creation of CNC paths (for milling reliefs) in a mass family file out of image data. There are two methods available:
# a) Create parallel lines with varying depths
# b) Create a grid of points with varying depths
# You can also choose if a (scaled) 3D preview of the milled panel should be generated.
# For questions email me at dieckmann@caad.arch.rwth-aachen.de
# This was created as learning material for the BIM to Production class (winter semester 2013/14) and modified/extended for the Maker House project (summer semester 2014) at the chair of CAAD, RWTH Aachen University.
# note: CNC-related Settings
# note: REQUIRED PACKAGES:
# - Count Sequences Of True Or False
# - Dispatch
# - Invert And Mirror Normalized Values
# - Law Of Sines
# - Lines Through Points (Closed Loop)
# - Project To XY Plane
# - Recursive Boolean Difference
# - Select By Category
# - Standard Normals
# - Subcategory Stuff
# - Sublist Helpers
x_count = IntegerSliderInput(25, range=0..50)
y_slider = IntegerSliderInput(25, range=0..50)
formula = Formula("1", lacing=Longest)
x_margin = DoubleInput(0.05)
length_from_number_3 = LengthFromNumber(x_margin)
y_margin = DoubleInput(0.05)
length_from_number_4 = LengthFromNumber(y_margin)
formula_2 = Formula("(width-2*margin)/(elements-1)", width=length_from_number, margin=length_from_number_3, elements=x_count, lacing=Longest)
length_from_number_5 = LengthFromNumber(formula_2, lacing=Longest)
formula_3 = Formula("(width-2*margin)/(elements-1)", width=length_from_number_2, margin=length_from_number_4, elements=y_slider, lacing=Longest)
length_from_number_6 = LengthFromNumber(formula_3, lacing=Longest)
# note: Create a point grid based on the settings
xyz_grid = ReferencePtGrid(x_count, y_slider, formula, length_from_number_3, length_from_number_4, number, length_from_number_5, length_from_number_6, number, lacing=Longest)
# note: Image-related Settings
path_to_image_file = StringFilename("C:\Users\adieckmann\Documents\GitHub\DynamoSamples\workflow_samples\ImageToCNC\sample_image.jpg")
read_image_file = ImageFileReader(path_to_image_file, x_count, y_slider)
# note: Replace this with a Color Saturation or Color Hue node for different effects.
color_brightness = ColorBrightness(read_image_file, lacing=Longest)
invert_image_data = BoolSelector(false)
mirror_image_vertically = BoolSelector(false)
mirror_image_horizontally = BoolSelector(true)
invert_and_mirror_normalized = Custom[Invert And Mirror Normalized Values](list=color_brightness, Invert=invert_image_data, Mirror_Vertically=mirror_image_vertically, Mirror_Horizontally=mirror_image_horizontally, X=x_count)  # Inverts and mirrors (horizontally & vertically) a list of normalized values.
bottom_greyscale_threshold = DoubleSliderInput(0, range=0..0.5)  # "Bottom Greyscale Threshold (Maximum Black)"
# note: Create filter for white threshold
formula_4 = Formula("pixel<min", pixel=invert_and_mirror_normalized, min=bottom_greyscale_threshold, lacing=Longest)
# note: List of top points, filtered by white threshold
filter_by_boolean_mask = FilterMask(xyz_grid, formula_4)
top_greyscale_threshold_minimum = DoubleSliderInput(1, range=0.5..1)  # "Top Greyscale Threshold (Minimum White)"
# note: If applicable set pixels that are too dark to the maximum threshold value
formula_5 = Formula("if(pixel>max,max,pixel)", pixel=invert_and_mirror_normalized, max=top_greyscale_threshold_minimum, lacing=Longest)
minimum_drill_depth = DoubleInput(0.005)
length_from_number_7 = LengthFromNumber(minimum_drill_depth)
maximum_drill_depth = DoubleInput(0.02)
length_from_number_8 = LengthFromNumber(maximum_drill_depth)
# note: Translate normalized values to min and max values from sliders and turn that into a height value
scale_normalized_value = Custom[Scale Normalized Value](value=formula_5, Min=length_from_number_7, Max=length_from_number_8)  # Scales a normalized value according to a given minimum and maximum
length_from_number_9 = LengthFromNumber(scale_normalized_value, lacing=Longest)
# note: Unfiltered list of bottom points
XYZ_2 = Xyz(number, number, length_from_number_9, lacing=Longest)
subtract_xyz = XyzSubtract(xyz_grid, XYZ_2, lacing=Longest)
# note: List of bottom points, filtered by white threshold
filter_by_boolean_mask_2 = FilterMask(subtract_xyz, formula_4)
line_by_endpoints = LineBound(filter_by_boolean_mask.out1, filter_by_boolean_mask_2.out1, lacing=Longest)
# note: Create vertical lines and set them to the appropriate subcategory
model_curve_2 = ModelCurve(line_by_endpoints, lacing=Longest)
transaction_2 = Transaction(model_curve_2)
set_element_subcategory_2 = Custom[Set Element Subcategory](Subcategory=create_new_subcategory_2, Cut_Projection=boolean_2, Element_s=transaction_2)
subcategory_name_for_horizontal = StringInput("CNC_Horizontal")  # "Subcategory Name for Horizontal Lines"
create_new_subcategory_3 = Custom[Create New Subcategory](BuiltInCategory=category, Name=subcategory_name_for_horizontal)
boolean_3 = BoolSelector(false)
hermite_spline = HermiteSpline(lacing=Longest)
# note: Due to the white threshold, the lines will not run continuously in each row in some cases. So we need to count how many points will form each line.
boolean_4 = BoolSelector(false)
count_sequences_of_true_or_false = Custom[Count Sequences Of True Or False](True_False=boolean_4)  # Retrieves the lengths of uninterrupted sequences of booleans (true or false) in a given list.
swap_stripe_path_direction = BoolSelector(false)
# note: Depending on the chosen stripe direction, the list of booleans for the white threshold filter may need to be transposed.
partition_list = Slice(formula_4, x_count)
transpose_lists = Transpose(partition_list)
if_ = Conditional(swap_stripe_path_direction, transpose_lists, partition_list)
map = Map(count_sequences_of_true_or_false, if_)
flatten_completely = FlattenList(map)
partition_list_2 = Slice(subtract_xyz, x_count)
# note: Depending on the chosen stripe direction, the point list may first need to be transposed before filtering it with the (also transposed)booleans of the white threshold filter.
transpose_lists_2 = Transpose(partition_list_2)
flatten_completely_2 = FlattenList(transpose_lists_2)
flatten_completely_3 = FlattenList(transpose_lists)
filter_by_boolean_mask_3 = FilterMask(flatten_completely_2, flatten_completely_3)
if_2 = Conditional(swap_stripe_path_direction, filter_by_boolean_mask_3.out1, filter_by_boolean_mask_2.out1)
# note: Build a sublist for each continuous set of points
build_irregular_sublists = Custom[Build Irregular Sublists](lengths=flatten_completely, list=if_2)  # Turns a list into a list of lists with sublists of varying lengths.
# note: Ignore sequences with just one point
formula_6 = Formula("n>1", n=flatten_completely, lacing=Longest)
filter_by_boolean_mask_4 = FilterMask(build_irregular_sublists, formula_6)
map_2 = Map(hermite_spline, filter_by_boolean_mask_4)
# note: Create (more or less) horizontal (sp)lines and set them to the appropriate subcategory
model_curve_3 = ModelCurve(map_2, lacing=Longest)
transaction_3 = Transaction(model_curve_3)
set_element_subcategory_3 = Custom[Set Element Subcategory](Subcategory=create_new_subcategory_3, Cut_Projection=boolean_3, Element_s=transaction_3)
generate_3d_preview = BoolSelector(true)
n3d_preview_scaling = DoubleSliderInput(100, range=0..1000)  # "3D Preview Scaling"
scale_xyz = XyzScale(XYZ, n3d_preview_scaling, lacing=Longest)
dispatch = Custom[Dispatch](test=generate_3d_preview, value=scale_xyz)  # Dispatches a value to one of two output ports (true/false) depending on a condition. The other output port will return an empty list.
lines_through_points_closed_loop_2 = Custom[Lines Through Points (Closed Loop)](list=dispatch.true)
curve_loop = CurveLoop(lines_through_points_closed_loop_2, lacing=Longest)
z_axis_negative = Custom[Z Axis (Negative)]()  # Returns an XYZ of 0,0,-1
panel_thickness = DoubleInput(0.008)
length_from_number_10 = LengthFromNumber(panel_thickness, lacing=Longest)
# note: If applicable, generate a (scaled) 3D preview for panel material
formula_7 = Formula("thickness * scale", thickness=length_from_number_10, scale=n3d_preview_scaling, lacing=Longest)
length_from_number_11 = LengthFromNumber(formula_7, lacing=Longest)
extrude = CreateExtrusionGeometry(curve_loop, z_axis_negative, length_from_number_11, lacing=Longest)
generate_holes_stripes_for_3d = BoolSelector(true)  # "Generate Holes / Stripes for 3D Preview"
number_2 = DoubleInput(1)
shift_list_indices = ShiftList(number_2)
# note: List of drill depths, filtered by white threshold
filter_by_boolean_mask_5 = FilterMask(length_from_number_9, formula_4)
XYZ_3 = Xyz(arg2=filter_by_boolean_mask_5.out1, lacing=Longest)
# note: Drill depths
# (as XYZ relative to drill point)
subtract_xyzs = XyzSubtract(filter_by_boolean_mask.out1, XYZ_3, lacing=Longest)
milling_head_angle = AngleInput(45)
# note: Compute the top radius of the drill hole based on drill depth and milling head angle
formula_8 = Formula("mill_angle/2", mill_angle=milling_head_angle, lacing=Longest)
formula_9 = Formula("pi/2-alpha", alpha=formula_8, lacing=Longest)
side_by_law_of_sines = Custom[Side By Law Of Sines](alpha=formula_8, B=filter_by_boolean_mask_5.out1, beta=formula_9)  # Determines the length of a side based on the law of sines. (Alpha is the angle opposite side A and beta is the angle opposite side B...)
length_from_number_12 = LengthFromNumber(side_by_law_of_sines, lacing=Longest)
XYZ_4 = Xyz(length_from_number_12, lacing=Longest)
# note: Top radii
# (as XYZ relative to drill point)
add_xyzs = XyzAdd(filter_by_boolean_mask.out1, XYZ_4, lacing=Longest)
list_3 = NewList(index0=filter_by_boolean_mask.out1, index1=subtract_xyzs, index2=add_xyzs)
# note: If applicable, generate a (scaled) 3D preview for drill holes
dispatch_2 = Custom[Dispatch](test=generate_3d_preview, value=list_3)
scale_xyz_2 = XyzScale(dispatch_2.true, n3d_preview_scaling, lacing=Longest)
# note: Organize list in separate
# sublists for each triangle
transpose_lists_3 = Transpose(scale_xyz_2)
map_3 = Map(shift_list_indices, transpose_lists_3)
# note: Create lines for each triangle and turn triangles into curve loops
line_by_endpoints_2 = LineBound(map_3, transpose_lists_3, lacing=Longest)
curve_loop_2 = CurveLoop(line_by_endpoints_2, lacing=Longest)
# note: Extract drill points as origins for revolves
first_of_list = First(scale_xyz_2)
z_axis = XyzBasisZ(lacing=Longest)
y_axis = XyzBasisY(lacing=Longest)
# note: Create transforms for revolving around the Z axis
transform_from_origin_and = TransformOriginAndVectors(first_of_list, z_axis, y_axis, lacing=Longest)  # "Transform from Origin and Vectors"
number_3 = DoubleInput(0)
n2_pi = PiTimes2()  # "2*Pi"
# note: Create a revolve for each drill hole
revolve = CreateRevolvedGeometry(curve_loop_2, transform_from_origin_and, number_3, n2_pi, lacing=Longest)
# note: Make two sets of curve loops for creating blends and remove the first item for each sequence
rest_of_list = Rest()
number_4 = DoubleInput(1)
shift_list_indices_2 = ShiftList(number_4)
curve_loop_3 = CurveLoop(lacing=Longest)
formula_10 = Formula("mill_angle/2", mill_angle=milling_head_angle, lacing=Longest)
xyz_z = XyzGetZ(if_2, lacing=Longest)
formula_11 = Formula("Abs(x)", x=xyz_z, lacing=Longest)
formula_12 = Formula("pi/2-alpha", alpha=formula_10, lacing=Longest)
side_by_law_of_sines_2 = Custom[Side By Law Of Sines](alpha=formula_10, B=formula_11, beta=formula_12)
length_from_number_13 = LengthFromNumber(side_by_law_of_sines_2, lacing=Longest)
XYZ_5 = Xyz(length_from_number_13, lacing=Longest)
# note: Set triangle orientation relative to spline direction
XYZ_6 = Xyz(arg1=length_from_number_13, lacing=Longest)
if_3 = Conditional(swap_stripe_path_direction, XYZ_5, XYZ_6)
add_xyzs_2 = XyzAdd(if_2, if_3, lacing=Longest)
# note: Project triangle top points to XY plane
project_xyz_to_xy_plane = Custom[Project XYZ To XY Plane](xyz=add_xyzs_2)  # Given an XYZ, make the Z value 0 - effectively projecting the XYZ to the XY plane.
subtract_xyzs_2 = XyzSubtract(if_2, if_3, lacing=Longest)
project_xyz_to_xy_plane_2 = Custom[Project XYZ To XY Plane](xyz=subtract_xyzs_2)
# note: If applicable, generate a (scaled) 3D preview for drill stripes
list_4 = NewList(index0=project_xyz_to_xy_plane, index1=if_2, index2=project_xyz_to_xy_plane_2)
dispatch_3 = Custom[Dispatch](test=generate_3d_preview, value=list_4)
scale_xyz_3 = XyzScale(dispatch_3.true, n3d_preview_scaling, lacing=Longest)
transpose_lists_4 = Transpose(scale_xyz_3)
number_5 = DoubleInput(1)
shift_list_indices_3 = ShiftList(number_5)
map_4 = Map(shift_list_indices_3, transpose_lists_4)
# note: Create lines for each triangle
line_by_endpoints_3 = LineBound(transpose_lists_4, map_4, lacing=Longest)
# note: Build a sublist for each
# continuous set of points
build_irregular_sublists_2 = Custom[Build Irregular Sublists](lengths=flatten_completely, list=line_by_endpoints_3)
formula_13 = Formula("n>1", n=flatten_completely, lacing=Longest)
filter_by_boolean_mask_6 = FilterMask(build_irregular_sublists_2, formula_13)
map_5 = Map(curve_loop_3, filter_by_boolean_mask_6)
map_6 = Map(shift_list_indices_2, map_5)
map_7 = Map(rest_of_list, map_6)
map_8 = Map(rest_of_list, map_5)
# note: Create a blend between two points for all points in all sequences
blend = CreateBlendGeometry(map_7, map_8, lacing=Longest)
flatten_completely_4 = FlattenList(blend)
if_4 = Conditional(generate_holes_stripes_for_3d, revolve, flatten_completely_4)
# note: Cut holes (or stripes) into 3D preview object and bake
recursive_boolean_difference = Custom[Recursive Boolean Difference](First_Solid=extrude, List_of_Solids=if_4)  # This node recursively applies the boolean difference node to a solid for each item in a given list of solids.
bake_solid_as_revit_element = FreeForm(recursive_boolean_difference, lacing=Longest)
transaction_4 = Transaction(bake_solid_as_revit_element)
