# Dynamo graph NumberingStuffByDistance.dyn (Dynamo 0.6.3.5256)

builtincategory_generic_model = Custom[BuiltInCategory Generic Model]()  # Returns the BuiltInCategory Generic Models
builtincategory_curtain_wall = Custom[BuiltInCategory Curtain Wall Panels]()  # Returns the BuiltInCategory Curtain Wall Panels
get_family_instances_by_category = Custom[Get Family Instances By Category](BuiltInCategories=builtincategory_curtain_wall)  # Gets all family instances in the model for a given list of categories
flatten_completely = FlattenList(get_family_instances_by_category)
# note: Measure distance to (0,0,0)
xyz_zero = Custom[XYZ Zero]()  # Returns an XYZ of (0 ,0, 0)
average_xyzs = XyzAverage(lacing=Longest)
get_family_instance_location = GetFamilyInstanceLocation(flatten_completely, lacing=Longest)
# note: Determine panel center point
map = Map(average_xyzs, get_family_instance_location)
xyz_distance = XyzDistance(xyz_zero, map, lacing=Longest)
list = NewList(index0=flatten_completely, index1=xyz_distance)
number = DoubleInput(1)
boolean = BoolSelector(false)
# note: Combine panels and measured distances into a list of lists, sort by measured distance and extract newly sorted list of panels
sort_list_of_lists = Custom[Sort List Of Lists](List_of_lists=list, Sort_index=number, Case_insensitive=boolean, Order_Descending=boolean)  # Sorts a list of lists by one of its sublists
first_of_list = First(sort_list_of_lists)
parameter_name = StringInput("Mark")
# note: This example shows how to number freely placed elements by evaluating their distance from a given point in the project.
# For questions email me at dieckmann@caad.arch.rwth-aachen.de
# This was created as learning materal for the BIM to Production class at the chair of CAAD, RWTH Aachen University in the winter semester of 2013/14.
# note: REQUIRED PACKAGES:
# - Select By Category
# - Sequence With Leading Zeros
# - Sort List Of Lists
# - Standard Normals
prefix = StringInput("Panel")
suffix = StringInput("")
concat_strings = ConcatStrings(s3=prefix, arg2=suffix)
start_number = DoubleInput(1)
# note: Deteremine last number of the sequence
list_length = Length(flatten_completely)
formula = Formula("Start+N-1", Start=start_number, N=list_length, lacing=Longest)
# note: Add leading zeros to number sequence
number_2 = DoubleInput(Start..N, start_number, formula, lacing=Longest)
number_of_digits = DoubleInput(3)
sequence_with_leading_zeros = Custom[Sequence With Leading Zeros](seq=number_2, n=number_of_digits)  # Adds leading zeros to a sequence of numbers
# note: Add prefix and suffix to sequence
map_2 = Map(concat_strings, sequence_with_leading_zeros)
# note: Write generated numbers to specified instance parameter
set_family_instance_parameter = FamilyInstanceParameterSetter(first_of_list, parameter_name, map_2, lacing=Longest)
select_elements = MultipleCurvesBySelection()
select_family_type = FamilyTypeSelector(index=0)
get_family_instances_by_type = GetFamilyInstancesByType(select_family_type)
