# Dynamo graph NumberingStuffByPosition.dyn (Dynamo 0.6.3.5256)

# note: This example shows how to number freely placed elements by evaluating their position in the project.
# For questions email me at dieckmann@caad.arch.rwth-aachen.de
# This was created as learning materal for the BIM to Production class at the chair of CAAD, RWTH Aachen University in the winter semester of 2013/14.

builtincategory_doors = Custom[BuiltInCategory Doors]()  # Returns the BuiltInCategory Doors
get_family_instances_by_category = Custom[Get Family Instances By Category](BuiltInCategories=builtincategory_doors)  # Gets all family instances in the model for a given list of categories
flatten_completely = FlattenList(get_family_instances_by_category)
get_family_instance_location = GetFamilyInstanceLocation(flatten_completely, lacing=Longest)
xyz_x = XyzGetX(get_family_instance_location, lacing=Longest)
rounding_precision = DoubleSliderInput(0.5, range=0..1)
round_to_precision = Custom[Round To Precision](Number=xyz_x, Precision=rounding_precision)  # Rounds a number to a specified precision
get_highest_and_lowest_from_list = Custom[Get Highest And Lowest From List](list=round_to_precision)  # Gets the highest and lowest value from a given list
normalize_value = Custom[Normalize Value](val=round_to_precision, Min=get_highest_and_lowest_from_list.lowest, Max=get_highest_and_lowest_from_list.highest)  # Converts a value into a normalized value according to a value range
# note: Get X and Y coordinates for every door
xyz_y = XyzGetY(get_family_instance_location, lacing=Longest)
round_to_precision_2 = Custom[Round To Precision](Number=xyz_y, Precision=rounding_precision)
# note: Round X and Y to a meaningful precision and make an ordered list for each. The values are normalized in order to ignore negative vs. positive values relative to the project XYZ Zero.
get_highest_and_lowest_from_list_2 = Custom[Get Highest And Lowest From List](list=round_to_precision_2)
normalize_value_2 = Custom[Normalize Value](val=round_to_precision_2, Min=get_highest_and_lowest_from_list_2.lowest, Max=get_highest_and_lowest_from_list_2.highest)
# note: Combine panels and their X and Y sort order into a list of lists
list = NewList(index0=flatten_completely, index1=normalize_value, index2=normalize_value_2)
number = DoubleInput(1)
boolean = BoolSelector(false)
# note: First sort by position on X axis
sort_list_of_lists = Custom[Sort List Of Lists](List_of_lists=list, Sort_index=number, Case_insensitive=boolean, Order_Descending=boolean)  # Sorts a list of lists by one of its sublists
number_2 = DoubleInput(2)
boolean_2 = BoolSelector(true)
# note: Next sort by position on Y axis
# note: Note that you need to reverse your sort order if you want to sort by multiple criteria (i.e. sort by your most important key last).
sort_list_of_lists_2 = Custom[Sort List Of Lists](List_of_lists=sort_list_of_lists, Sort_index=number_2, Case_insensitive=boolean, Order_Descending=boolean_2)
first_of_list = First(sort_list_of_lists_2)
parameter_name = StringInput("Mark")
# note: REQUIRED PACKAGES:
# - Custom Rounding
# - Select By Category
# - Sequence With Leading Zeros
# - Sort List Of Lists
# - Standard Normals
prefix = StringInput("Door")
suffix = StringInput("")
concat_strings = ConcatStrings(s3=prefix, arg2=suffix)
start_number = DoubleInput(1)
# note: Deteremine last number of the sequence
list_length = Length(flatten_completely)
formula = Formula("Start+N-1", Start=start_number, N=list_length, lacing=Longest)
# note: Add leading zeros to number sequence
number_3 = DoubleInput(Start..N, start_number, formula, lacing=Longest)
number_of_digits = DoubleInput(3)
sequence_with_leading_zeros = Custom[Sequence With Leading Zeros](seq=number_3, n=number_of_digits)  # Adds leading zeros to a sequence of numbers
# note: Add prefix and suffix to sequence
map = Map(concat_strings, sequence_with_leading_zeros)
# note: Write generated numbers to specified instance parameter
set_family_instance_parameter = FamilyInstanceParameterSetter(first_of_list, parameter_name, map, lacing=Longest)
select_elements = MultipleCurvesBySelection()
select_family_type = FamilyTypeSelector(index=0)
get_family_instances_by_type = GetFamilyInstancesByType(select_family_type)
