# Dynamo graph NumberingStuff_DS.dyn (Dynamo 0.6.3.5256)

select_divided_surface_families = DividedSurfaceBySelection()  # 1 picked in the model
flatten_completely = FlattenList(select_divided_surface_families)
parameter_name = StringInput("Object_Identifier")
# note: This example shows how to number curtain panels that are hosted on a divided surface.
# For questions email me at dieckmann@caad.arch.rwth-aachen.de
# This was created as learning material for the BIM to Production class at the chair of CAAD, RWTH Aachen University in the winter semester of 2013/14.
# note: REQUIRED PACKAGES:
# - Sequence With Leading Zeros
prefix = StringInput("DS01_")
suffix = StringInput("")
concat_strings = ConcatStrings(s3=prefix, arg2=suffix)
start_number_of_sequence = DoubleInput(1)
# note: Determine last number of the sequence
list_length = Length(flatten_completely)
formula = Formula("Start+N-1", Start=start_number_of_sequence, N=list_length, lacing=Longest)
# note: Add leading zeros to number sequence
number = DoubleInput(Start..N, start_number_of_sequence, formula, lacing=Longest)
number_of_digits = DoubleInput(3)
sequence_with_leading_zeros = Custom[Sequence With Leading Zeros](seq=number, n=number_of_digits)  # Adds leading zeros to a sequence of numbers
# note: Add prefix and suffix to sequence
map = Map(concat_strings, sequence_with_leading_zeros)
# note: Write generated numbers to specified instance parameter
set_family_instance_parameter = FamilyInstanceParameterSetter(flatten_completely, parameter_name, map, lacing=Longest)
