# Dynamo graph OutOfPlaneAnalysis.dyn (Dynamo 0.6.3.5262)

number = DoubleInput(0)
number_2 = DoubleInput(255)
color = Color(number, number_2, number_2, number_2, lacing=Longest)
color_2 = Color(number, number_2, number, number, lacing=Longest)
has_out_of_plane_xyzs = Custom[Has Out-Of-Plane XYZs]()  # Checks a list for XYZs that are not located on a given plane
plane_from_first_3_xyzs = Custom[Plane From First 3 XYZs]()  # Returns a plane, its origin and its normal based on the first three XYZs in a given list
# note: This definition analyzes if a given pattern-based panel or adaptive component is out of plane - and if so, by which amount. The information is then visualized in the current view by means of overriding the element surface colour. Will *only* work in the project environment.
# For questions email me at dieckmann@caad.arch.rwth-aachen.de
# Please be aware that there is currently an unresolved issue with the element colour override in non-English Revit versions:
# https://github.com/ikeough/Dynamo/issues/880
# This was created as learning material for the BIM to Production class at the chair of CAAD, RWTH Aachen University in the winter semester of 2013/14.
builtincategory_curtain_wall = Custom[BuiltInCategory Curtain Wall Panels]()  # Returns the BuiltInCategory Curtain Wall Panels
# note: REQUIRED PACKAGES:
# - Has Out-Of-Plane XYZs
# - Plane From First 3 XYZs
# - Select By Category
# - Standard Colours
# - Unit Conversion
get_family_instances_by_category = Custom[Get Family Instances By Category](BuiltInCategories=builtincategory_curtain_wall)  # Gets all family instances in the model for a given list of categories
flatten_completely = FlattenList(get_family_instances_by_category)
get_family_instance_location = GetFamilyInstanceLocation(flatten_completely, lacing=Longest)
# note: Get a plane for each panel
map = Map(plane_from_first_3_xyzs.plane, get_family_instance_location)
tolerance = IntegerSliderInput(50, range=0..100)
millimeters_to_feet = Custom[Millimeters To Feet](mm=tolerance)  # Converts millimeters into feet
list_length = Length(get_family_instance_location)
repeat = Repeat(millimeters_to_feet, list_length, lacing=Longest)
# note: Determine by how much (if so) each panel is out of plane
combine = Combine(has_out_of_plane_xyzs.max, map, get_family_instance_location, repeat)
get_highest_and_lowest_from_list = Custom[Get Highest And Lowest From List](list=combine)  # Gets the highest and lowest value from a given list
normalize_value = Custom[Normalize Value](val=combine, Min=get_highest_and_lowest_from_list.lowest, Max=get_highest_and_lowest_from_list.highest)  # Converts a value into a normalized value according to a value range
color_range = ColorRange(color, color_2, normalize_value, lacing=Longest)
# note: Override each element's colour based on how much it is out of plane
override_element_color_in_view = OverrideColorInView(color_range, flatten_completely, lacing=Longest)
# note: Take the minimum and maximum from the list to drive the colour range. Alternatively, it might make sense to use 0 as the minimum.
number_3 = DoubleInput(0)
