# Dynamo graph PanelsByPanelRatio.dyn (Dynamo 0.6.3.7375)

UV = Uv(lacing=Longest)
number = DoubleInput(0)
list = NewList(index0=number)
# note: U Subdivision:
# Here's how you could achieve a linear increase in the panel ratios.
# note: Thsi definition populates a surface with panels based on panel ratios.
# First published here:
# http://dynamobim.org/forums/topic/panels-by-formula/
# note: REQUIRED PACKAGES:
# - Accumulate List
# - Normalization
# - Simple Patterning
number_2 = DoubleInput(1..2..#8)
accumulate_list = Custom[Accumulate List](list=number_2)  # Accumulates the values of a given list and returns a list of the accumulated values
join_lists = Append(list, accumulate_list)
last_of_list = Last(accumulate_list)
normalize_value = Custom[Normalize Value](val=join_lists, Min=number, Max=last_of_list)  # Converts a value into a normalized value according to a value range
# note: V Subdivision:
# And here's how you could achieve an irregular subdivision pattern using arbitrary panel ratios.
string = StringInput("""3
2
4
1
2
1
2""")
string_2 = StringInput("\n")
split_string = SplitString(string, string_2)
string_to_number = String2Num(split_string, lacing=Longest)
accumulate_list_2 = Custom[Accumulate List](list=string_to_number)
join_lists_2 = Append(list, accumulate_list_2)
last_of_list_2 = Last(accumulate_list_2)
normalize_value_2 = Custom[Normalize Value](val=join_lists_2, Min=number, Max=last_of_list_2)
cartesian_product = CartProd(UV, normalize_value, normalize_value_2)
list_length = Length(accumulate_list_2)
reverse_a = BoolSelector(false)
reverse_b = BoolSelector(false)
shift_placement_a = IntegerSliderInput(0, range=0..2)
shift_placement_b = IntegerSliderInput(0, range=0..2)
shift_overall_placement = IntegerSliderInput(0, range=0..2)
triangular_pattern_flat_diagonal = Custom[Triangular Pattern (Flat, Diagonal) From Grid](list=cartesian_product, V=list_length, reverse_triangle_A=reverse_a, reverse_triangle_B=reverse_b, shift_placement_triangle_A=shift_placement_a, shift_placement_triangle_B=shift_placement_b, shift_overall_placement=shift_overall_placement)  # Creates groups of points from a list of UVs or XYZs for the placement of triangular panels. The placement pattern can be reversed (boolean) and shifted (integer).
select_face = FormElementBySelection()  # 1 picked in the model
select_family_type = FamilyTypeSelector(index=0)
adaptive_component_by_uvs_on = AdaptiveComponentByUvsOnFace(triangular_pattern_flat_diagonal.list_triangle_A, select_face, select_family_type, lacing=Longest)
select_family_type_2 = FamilyTypeSelector(index=1)
adaptive_component_by_uvs_on_2 = AdaptiveComponentByUvsOnFace(triangular_pattern_flat_diagonal.list_triangle_B, select_face, select_family_type_2, lacing=Longest)
