# Dynamo graph AUGermany_02_Kurvenparametersequenz_erzeugen.dyn (Dynamo 0.7.2.2114)

# note: Anzahl Träger
integer_slider = IntegerSlider(12, range=0..20)
# note: Erstellen einer Liste von normalisierten Kurvenparametern zum Aufteilen der Linien
code_block = CodeBlock(y=integer_slider) { 0..1..#y; }
# note: Beispiel-Workflow für das Lab "Einführung in Dynamo - Grafisches Programmieren für Revit" auf der AU Germany 2014. Die Übung basiert in wesentlichen Teilen auf einigen der mit Dynamo ausgelieferten Beispiele.
# - Erstellen einer Reihung von Skelettbauteilen entlang eines durch Modelllinien definierten Dachprofils
# - Auslesen der Trägerlängen
# - Filtern der Träger nach Trägerlänge
# - Elementweises Überschreiben der gefilterten Träger im Modell
# Fragen können Sie gerne an dieckmann@caad.arch.rwth-aachen.de richten.
# note: Auswahl der Modellinien für das Dachprofil
select_model_element = DSModelElementSelection()  # 1 picked in the model
# note: Dynamo Linien aus Revit Linien
curve = CurveElement.Curve(select_model_element)
select_model_element_2 = DSModelElementSelection()  # 1 picked in the model
curve_2 = CurveElement.Curve(select_model_element_2)
select_model_element_3 = DSModelElementSelection()  # 1 picked in the model
curve_3 = CurveElement.Curve(select_model_element_3)
create = List.Create(curve, curve_2, curve_3)
watch_3d = Watch3D(create)
code_block_2 = CodeBlock(n=integer_slider) { 0; 1; 1/(n-1); }
number_range = NumberRange(code_block_2.out0, code_block_2.out1, code_block_2.out2, lacing=Longest)
number_sequence = NumberSeq(code_block_2.out0, integer_slider, code_block_2.out2, lacing=Longest)
number = DoubleInput(0..1..#y, integer_slider, lacing=Longest)
watch = Watch(number)
