# Dynamo graph AUGermany_06_Schnittebenen_erzeugen.dyn (Dynamo 0.7.2.2114)

# note: Beispiel-Workflow für das Lab "Einführung in Dynamo - Grafisches Programmieren für Revit" auf der AU Germany 2014. Die Übung basiert in wesentlichen Teilen auf einigen der mit Dynamo ausgelieferten Beispiele.
# - Erstellen einer Reihung von Skelettbauteilen entlang eines durch Modelllinien definierten Dachprofils
# - Auslesen der Trägerlängen
# - Filtern der Träger nach Trägerlänge
# - Elementweises Überschreiben der gefilterten Träger im Modell
# Fragen können Sie gerne an dieckmann@caad.arch.rwth-aachen.de richten.
# note: Auswahl der Modellinien für das Dachprofil
select_model_element = DSModelElementSelection()  # 1 picked in the model
# note: Dynamo Linien aus Revit Linien
curve = CurveElement.Curve(select_model_element)
# note: Anzahl Träger
integer_slider = IntegerSlider(12, range=0..20)
# note: Erstellen einer Liste von normalisierten Kurvenparametern zum Aufteilen der Linien
code_block = CodeBlock(y=integer_slider) { 0..1..#y; }
# note: Erstellen einer Reihe von Punkten auf allen Linien
pointAtParameter = Curve.PointAtParameter(curve, code_block)
select_model_element_2 = DSModelElementSelection()  # 1 picked in the model
curve_2 = CurveElement.Curve(select_model_element_2)
pointAtParameter_2 = Curve.PointAtParameter(curve_2, code_block)
select_model_element_3 = DSModelElementSelection()  # 1 picked in the model
curve_3 = CurveElement.Curve(select_model_element_3)
pointAtParameter_3 = Curve.PointAtParameter(curve_3, code_block)
# note: Punktliste für alle drei Linien bilden - und dann Spalten und Reihen vertauschen
create = List.Create(pointAtParameter, pointAtParameter_2, pointAtParameter_3)
transpose = List.Transpose(create)
# note: Erzeugen einer Spline für jeden Träger
byPoints = NurbsCurve.ByPoints(transpose)
watch_3d = Watch3D(byPoints)
# note: Erzeugen von Schnittebenen an den Kurvenparametern entlang einer der Linien
planeAtParameter = Curve.PlaneAtParameter(curve, code_block)
watch_3d_2 = Watch3D(planeAtParameter)
