# Dynamo graph CompareWallDoorFireRating.dyn (Dynamo 0.7.5.3566)

categories = Categories("Doors")
# note: Get all doors in the model
all_elements_of_category = ElementsOfCategory(categories)
# note: Find the walls the doors are hosted in (from package Clockwork)
host = Custom[Element.Host](Element_s=all_elements_of_category)  # Gets an element's host
string = StringInput("")
# note: Fire ratings for walls
string_fire_ratings_of_wall = StringInput("""F30
F60
F90""")  # "String (Fire Ratings of Wall Types)"
string_2 = StringInput("\n")
split = String.Split(string_fire_ratings_of_wall, string_2)
# note: Corresponding fire ratings for doors
string_fire_ratings_of_door = StringInput("""T30
T60
T90""")  # "String (Fire Ratings of Door Types)"
# note: Create lists of possible fire ratings for walls and doors
# note: Create strings of value pairs
split_2 = String.Split(string_fire_ratings_of_door, string_2)
code_block = CodeBlock(str1=split, str2=split_2) { str1 + str2; }
# note: Add an entry for unrated walls/doors
# note: Check value pairs in project against list of allowed value pairs
join = List.Join(string, code_block)
type = Custom[Element.Type](Element_s=host)  # Gets the family type of a given element (if applicable).
code_block_2 = CodeBlock { "Fire Rating"; }
getParameterValueByName = Element.GetParameterValueByName(type, code_block_2)
# note: Parameter name for fire rating
type_2 = Custom[Element.Type](Element_s=all_elements_of_category)
# note: Get type parameter values for fire rating
getParameterValueByName_2 = Element.GetParameterValueByName(type_2, code_block_2)
code_block_3 = CodeBlock(str1=getParameterValueByName, str2=getParameterValueByName_2) { str1 + str2; }
containsItem = List.ContainsItem(join, code_block_3)
filterByBoolMask = List.FilterByBoolMask(host, containsItem)
watch = Watch(filterByBoolMask.out1)
# note: Filter out those walls and doors that do not comply
filterByBoolMask_2 = List.FilterByBoolMask(all_elements_of_category, containsItem)
# note: Cases where wall type and door type fire ratings do *not* match
watch_2 = Watch(filterByBoolMask_2.out1)
