# Dynamo graph 01_Collections_01_OOTB-Categories-vs-Types.dyn (Dynamo 0.7.3.3034)

categories = Categories("Floors")
all_elements_of_category = ElementsOfCategory(categories)
watch = Watch(all_elements_of_category)
element_types = ElementTypes("Floor")
all_elements_of_type = ElementsOfType(element_types)
watch_2 = Watch(all_elements_of_type)
