# Dynamo graph 01_Collections_02_OOTB-Additional-Methods.dyn (Dynamo 0.7.3.3034)

family_types = FamilyTypes("Dining Chair (3):Dining Chair (3)")
all_elements_of_family_type = ElementsOfFamilyType(family_types)
watch = Watch(all_elements_of_family_type)
levels = Levels("Level 1")
all_elements_at_level = ElementsAtLevel(levels)
watch_2 = Watch(all_elements_at_level)
