# Dynamo graph 01_Collections_03_Custom-FilteredElementCollectors.dyn (Dynamo 0.7.3.3034)

categories = Categories("Furniture")
all_family_types_of_category = Custom[All Family Types Of Category](Categories=categories)  # Gets all family types/symbols of a given category in the model (does *not *work for system families)
watch = Watch(all_family_types_of_category)
categories_2 = Categories("Furniture")
all_families_of_category = Custom[All Families Of Category](Categories=categories_2)  # Gets all famiies of a given category in the model (does *not *work for system families)
watch_2 = Watch(all_families_of_category)
categories_3 = Categories("Dimensions")
activeViewFromCurrentDocument = Custom[Document.ActiveViewFromCurrentDocument]()  # Gets the active view of the current document
all_view_dependent_family = Custom[All View-Dependent Family Instances Of Category](Categories=categories_3, View_s=activeViewFromCurrentDocument)  # Gets all view-dependent family instances in a given view for a given list of categories - useful for finding annotation elements
watch_3 = Watch(all_view_dependent_family)
