# Dynamo graph 02_Relationships_02_Formal-Hosts.dyn (Dynamo 0.7.3.3034)

categories = Categories("Windows")
all_elements_of_category = ElementsOfCategory(categories)
host = Custom[Element.Host](element_s=all_elements_of_category)  # Gets an element's host
watch = Watch(host)
