# Dynamo graph 02_Relationships_03_Formal-Room-Boundaries.dyn (Dynamo 0.7.3.3034)

categories = Categories("Rooms")
all_elements_of_category = ElementsOfCategory(categories)
boundaries = Custom[Room.Boundaries](Room_s=all_elements_of_category)  # Gets a list of all boundary elements of a given room
watch = Watch(boundaries.Elements)
