# Dynamo graph 02_Relationships_04_Formal-Rooms-From-Openings.dyn (Dynamo 0.7.3.3034)

categories = Categories("Doors")
all_elements_of_category = ElementsOfCategory(categories)
phases = Custom[Document.Phases]()  # Lists all phases in the active document
string = StringInput("Working Drawing")
boolean = BoolSelector(false)
all_elements_of_name = Custom[All Elements Of Name](Elements=phases, Search_string=string, Ignore_case=boolean)  # Retrieves those elements from a collection whose names match the search string
firstItem = List.FirstItem(all_elements_of_name.in)
fromDoorOrWindow = Custom[Room.FromDoorOrWindow](Door_s_Window_s=all_elements_of_category, Phase=firstItem)  # Gets the rooms that are connected by a given door or a window
watch = Watch(fromDoorOrWindow.From_Room_s)
watch_2 = Watch(fromDoorOrWindow.To_Room_s)
