# Dynamo graph 02_Relationships_05a_Informal-ReferenceIntersector_063.dyn (Dynamo 0.6.3.7375)

get_active_view = ActiveRevitView(lacing=Longest)
category = Categories(index=313)
XYZ = Xyz(lacing=Longest)
z_axis = XyzBasisZ(lacing=Longest)
number_slider = DoubleSliderInput(50, range=0..100)
scale_xyz = XyzScale(z_axis, number_slider, lacing=Longest)
reference_intersector_by = Custom[Reference Intersector By Category](3D_View=get_active_view, BuiltInCategory=category, VectorStart=XYZ, VectorEnd=scale_xyz)  # Finds all elements of a specified category that intersect with a list of vectors
watch = Watch(reference_intersector_by)
