# Dynamo graph 02_Relationships_05b_Informal-ReferenceIntersector_063.dyn (Dynamo 0.6.3.7375)

get_active_view = ActiveRevitView(lacing=Longest)
category = Categories(index=877)
number = DoubleInput(0)
select_curve = CurvesBySelection()  # 1 picked in the model
evaluate_curve = XyzOnCurveOrEdge(number, select_curve, lacing=Longest)
number_2 = DoubleInput(1)
evaluate_curve_2 = XyzOnCurveOrEdge(number_2, select_curve, lacing=Longest)
reference_intersector_by = Custom[Reference Intersector By Category](3D_View=get_active_view, BuiltInCategory=category, VectorStart=evaluate_curve, VectorEnd=evaluate_curve_2)  # Finds all elements of a specified category that intersect with a list of vectors
watch = Watch(reference_intersector_by)
