# Dynamo graph 03_Management_01_Properties-OOTB.dyn (Dynamo 0.7.3.3034)

categories = Categories("Windows")
all_elements_of_category = ElementsOfCategory(categories)
code_block = CodeBlock { "Sill Height"; }
getParameterValueByName = Element.GetParameterValueByName(all_elements_of_category, code_block)
watch = Watch(getParameterValueByName)
