# Dynamo graph 03_Management_02_Properties-Custom.dyn (Dynamo 0.7.3.3034)

element_types = ElementTypes("ViewSection")
all_elements_of_type = ElementsOfType(element_types)
scale = Custom[View.Scale](View_s=all_elements_of_type)  # Returns the scale of a given view
watch = Watch(scale)
