# Dynamo graph 03_Management_04_Sorting-Custom-Nested-Lists.dyn (Dynamo 0.7.3.3034)

categories = Categories("Walls")
all_elements_of_category = ElementsOfCategory(categories)
level = Custom[Element.Level](element_s=all_elements_of_category)  # Gets an element's level
elevation = Level.Elevation(level)
create = List.Create(elevation, all_elements_of_category)
code_block = CodeBlock { 0; }
boolean = BoolSelector(false)
sortListOfLists = Custom[List.SortListOfLists](List_of_lists=create, Sort_index=code_block, Case_insensitive=boolean, Order_Descending=boolean)  # Sorts a list of lists by one of its sublists
lastItem = List.LastItem(sortListOfLists)
watch = Watch(lastItem)
watch_2 = Watch(elevation)
watch_3 = Watch(all_elements_of_category)
firstItem = List.FirstItem(sortListOfLists)
watch_4 = Watch(firstItem)
