# Dynamo graph 03_Management_05_Sort-Order.dyn (Dynamo 0.7.3.3034)

code_block = CodeBlock { 1..3; }
byCoordinates = Point.ByCoordinates(code_block, code_block, lacing=CrossProduct)
flatten = Flatten(byCoordinates)
shuffle = List.Shuffle(flatten)
Y = Point.Y()
sortByKey = SortByKey(shuffle, Y)
X = Point.X()
sortByKey_2 = SortByKey(sortByKey, X)
watch = Watch(sortByKey_2)
watch_2 = Watch(shuffle)
