# Dynamo graph 03_Management_06_Grouping-OOTB.dyn (Dynamo 0.7.3.3034)

# note: Apparently the GroupByKey node is buggy in Dynamo 0.7.3 - you may want to try this example with Dynamo 0.7.2 instead...
categories = Categories("Walls")
all_elements_of_category = ElementsOfCategory(categories)
watch = Watch(all_elements_of_category)
name = Element.Name()
groupByKey = GroupByKey(all_elements_of_category, name)
watch_2 = Watch(groupByKey)
name_2 = Element.Name(all_elements_of_category)
watch_3 = Watch(name_2)
name_3 = Element.Name(groupByKey)
watch_4 = Watch(name_3)
