# Dynamo graph 03_Management_08_Conditions-OOTB.dyn (Dynamo 0.7.3.3034)

categories = Categories("Walls")
all_elements_of_category = ElementsOfCategory(categories)
geometry = Element.Geometry(all_elements_of_category)
flatten = Flatten(geometry)
explode = Geometry.Explode(flatten)
area = Surface.Area(explode)
maximumItem = List.MaximumItem()
map = List.Map(area, maximumItem)
code_block = CodeBlock(area=map) { area > 50; }
watch = Watch(code_block)
formula = Formula("area > 50", area=map)
watch_2 = Watch(formula)
