# Dynamo graph 03_Management_09_Conditions-Custom.dyn (Dynamo 0.7.3.3034)

element_types = ElementTypes("WallType")
all_elements_of_type = ElementsOfType(element_types)
watch = Watch(all_elements_of_type)
kindIsCurtainWall = Custom[WallType.KindIsCurtainWall](Wall_Type_s=watch)  # Checks whether a given walltype is a curtain wall
watch_2 = Watch(kindIsCurtainWall)
