# Dynamo graph 03_Management_10_Filtering-by-Property.dyn (Dynamo 0.7.3.3034)

element_types = ElementTypes("WallType")
all_elements_of_type = ElementsOfType(element_types)
watch = Watch(all_elements_of_type)
kindIsCurtainWall = Custom[WallType.KindIsCurtainWall]()  # Checks whether a given walltype is a curtain wall
filter = List.Filter(all_elements_of_type, kindIsCurtainWall)
watch_2 = Watch(filter)
