# Dynamo graph 03_Management_11_Filtering-by-Booleans.dyn (Dynamo 0.7.3.3034)

categories = Categories("Walls")
all_elements_of_category = ElementsOfCategory(categories)
watch = Watch(all_elements_of_category)
level = Custom[Element.Level](element_s=all_elements_of_category)  # Gets an element's level
elevation = Level.Elevation(level)
code_block = CodeBlock(elevation=elevation) { elevation > 0; }
filterByBoolMask = List.FilterByBoolMask(all_elements_of_category, code_block)
watch_2 = Watch(filterByBoolMask.out0)
watch_3 = Watch(filterByBoolMask.out1)
watch_4 = Watch(level)
watch_5 = Watch(code_block)
watch_6 = Watch(elevation)
