# Dynamo graph 03_Management_12_Filtering-Nested Lists.dyn (Dynamo 0.7.3.3034)

filterByBoolMask = List.FilterByBoolMask()
categories = Categories("Walls")
all_elements_of_category = ElementsOfCategory(categories)
geometry = Element.Geometry(all_elements_of_category)
flatten = Flatten(geometry)
explode = Geometry.Explode(flatten)
area = Surface.Area(explode)
formula = Formula("area > 50", area=area)
combine = List.Combine(filterByBoolMask, explode, formula)
watch = Watch(combine)
watch_2 = Watch(explode)
watch_3 = Watch(formula)
