# Dynamo graph 04_Results_01_Overwrite-In-View.dyn (Dynamo 0.7.3.3034)

categories = Categories("Walls")
all_elements_of_category = ElementsOfCategory(categories)
code_block = CodeBlock { "Unconnected Height"; }
getParameterValueByName = Element.GetParameterValueByName(all_elements_of_category, code_block)
formula = Formula("height > 3", height=getParameterValueByName)
filterByBoolMask = List.FilterByBoolMask(all_elements_of_category, formula)
code_block_2 = CodeBlock { 255; }
byARGB = Color.ByARGB(arg1=code_block_2)
overrideColorInView = Element.OverrideColorInView(filterByBoolMask, byARGB)
