# Dynamo graph 04_Results_02_Write-To-Selection-Set.dyn (Dynamo 0.7.3.3034)

code_block = CodeBlock { "WallsWithWoodStudLayer"; }
categories = Categories("Walls")
all_elements_of_category = ElementsOfCategory(categories)
boolean = BoolSelector(false)
materials = Custom[Element.Materials](Element_s=all_elements_of_category, Include_paint_materials=boolean)  # Retrieves all materials froma given element
filterByBoolMask = List.FilterByBoolMask(all_elements_of_category, materials.Has_Material)
uniqueId = Element.UniqueId(materials.Materials)
code_block_2 = CodeBlock { "Wood - Stud Layer"; }
byName = Material.ByName(code_block_2)
uniqueId_2 = Element.UniqueId(byName)
containsItem = List.ContainsItem(arg1=uniqueId_2)
map = List.Map(uniqueId, containsItem)
filterByBoolMask_2 = List.FilterByBoolMask(filterByBoolMask, map)
byElements = Custom[SelectionSet.ByElements](Name=code_block, Element_s=filterByBoolMask_2)  # Creates a selections set of the given elements. Note that if a selection set of the given name already exists in the model, its contents will be replaced. Also, if the selection set is already applied as a view filter, the view filter will have to be manually updated in the visibility / graphic overrides.
