# Dynamo graph 04_Results_03_Manipulate-Model-Elements.dyn (Dynamo 0.7.3.3034)

# note: Use with file Fix_Orientation.rvt
select_model_element = DSModelElementSelection()  # 1 picked in the model
boolean = BoolSelector(false)
inserts = Custom[Element.Inserts](Element_s=select_model_element, Include_Openings=boolean, Include_Shadows=boolean, Include_Embedded_Walls=boolean, Include_Shared_Embedded_Inserts=boolean)  # Gets all the objects inserted into a given element.
orientation = Custom[Wall.Orientation](Wall_Instance_s=select_model_element)  # Gets the orientation of a given wall instance (normal of the exterior face of the wall). Will *not* work for walls hosted on mass faces or in-place walls.
facingOrientation = Custom[HostedObject.FacingOrientation](element_s=inserts)  # Gets the facing orientation of a hosted object (e.g. a window or a door)
subtract = Vector.Subtract(orientation, facingOrientation)
length = Vector.Length(subtract)
code_block = CodeBlock(len=length) { len > 0; }
filterByBoolMask = List.FilterByBoolMask(inserts, code_block)
flipFacingOrientation = Custom[FamilyInstance.FlipFacingOrientation](Element_s=filterByBoolMask)  # Flips the facing orientation of a given family instance
