# Dynamo graph Glazing-Ratio-per-Room_063.dyn (Dynamo 0.6.3.7375)

# note: #########
# # ROOMS  #
# #########
category = Categories(index=709)
get_family_instances_by_category = Custom[Get Family Instances By Category](BuiltInCategories=category)  # Gets all family instances in the model for a given list of categories
flatten_completely = FlattenList(get_family_instances_by_category)
is_empty_list = IsEmpty(flatten_completely)
string = StringInput("There are no rooms in the model.")
parameter_name_occupied_space = StringInput("IsOccupiedSpace")  # "Parameter Name "Occupied Space" (For Rooms)"
# note: First check if the parameter exists, then retrieve its boolean value.
parameter_exists = Custom[Parameter Exists](param=parameter_name_occupied_space)  # Checks if an element contains a parameter of a given name
filter = FilterInAndOut(parameter_exists, flatten_completely)
is_empty_list_2 = IsEmpty(filter)
string_2 = StringInput("All or some rooms in the model do not have the project/shared parameter \"Occupied Space\" assigned.")
get_parameters = GetParameters(element=filter, parameter1=parameter_name_occupied_space, lacing=Longest)
# note: Filter out all rooms that have not been classified as "Occupied Space"
filter_by_boolean_mask = FilterMask(filter, get_parameters)
room_is_unbounded = Custom[Room Is Unbounded](Room_s=filter_by_boolean_mask)  # Checks whether a room is unbounded.
# note: Filter out unbounded/unplaced rooms
filter_by_boolean_mask_2 = FilterMask(filter_by_boolean_mask, room_is_unbounded)
is_empty_list_3 = IsEmpty(filter_by_boolean_mask_2.out1)
string_3 = StringInput("The parameter \"Occupied Space\" is set to False for all rooms in the model.")
string_4 = StringInput("The following rooms do not have enough natural lighting:")
sum_list = Custom[Sum List]()
sum_list_2 = Custom[Sum List]()
filter_by_boolean_mask_3 = FilterMask()
filter_by_boolean_mask_4 = FilterMask()
turn_into_list = Custom[Turn Into List]()  # Turns an element into a (flat) list
# note: ###################
# # WINDOWS IN WALLS  #
# ###################
category_2 = Categories(index=892)
# note: ##########
# # SETTINGS #
# ##########
# note: This graph checks if the glazing area for all occupied spaces in the model is sufficient compared to the floor area of the respective rooms.
# First presented at RTC Europe 2014.
# REQUIRED PACKAGES:
# - Clockwork
# - Compute Centroid
# (and their respective dependencies)
# MODEL PREPARATION:
# - Place all relevant rooms in project.
# - Assign project/shared parameter "Occupied Space" to Rooms category (instance parameter) and set to Yes for all relevant rooms.
# - Set Area and Volume Computation to "Areas and Volumes".
# - Set Upper Limit / Limit Offset of all rooms in such a way that rooms extend to roofs and/or floor slabs (only necessary for rooms that have skylights, glazed roofs or curtan walls/systems).
# - Window, door and curtain wall panel families need to be assigned to their respective categories (e.g. Generic Model category will be ignored)
# - Doors and curtain wall panels need to have a transparent material assigned to them if they are to be taken into account.
# - It is assumed that widths and heights of doors and windows are type-based, not instance-based.
# LIMITATIONS:
# This graph currently doesn't do any of the following:
# - Exclude curtain panels that project points into rooms on both sides - these are clearly part of interior curtain walls. This could be done in the same fashion as with doors and windows.
# - Get the area of the transparent material in relation to the entire door area in order to make the calculation more precise - currently a door with transparent materials always counts as completely transparent.
# - Include curtain wall panels hosted on divided surfaces or in repeaters (or placed freely by hand/Dynamo).
# - Filter roof inserts down to window category only.
# note: Parameter & phase names
phase_name_new_construction = StringInput("New Construction")
get_phase_by_name = Custom[Get Phase by Name](str=phase_name_new_construction)  # Returns the phase of a given name (if it exists)
# note: Create list of all room-bounding windows.
get_doors_or_windows_from_room = Custom[Get Doors Or Windows From Room](Doors_Windows_Category=category_2, Phase=get_phase_by_name)  # Retrieves all doors or windows that are associated with a room (hosted in walls and roofs).
map = Map(get_doors_or_windows_from_room, filter_by_boolean_mask_2.out1)
map_2 = Map(turn_into_list, map)
only_toroom_or_fromroom_is_set = Custom[Only ToRoom OR FromRoom Is Set](Phase=get_phase_by_name)  # Evaluates if a door or window has only set one of the ToRoom / FromRoom properties. This may help to determine whether a door/window is external.
# note: Filter down to exterior windows
map_3 = Map(only_toroom_or_fromroom_is_set, map)
combine_two_nested_list = Custom[Combine Two Nested List](f_x_y=filter_by_boolean_mask_4, nested_list_1=map_2, nested_list_2=map_3)  # In some cases I have found the built-in Combine node to struggle with nested lists. In cases like these, this node should do the trick.
turn_into_list_2 = Custom[Turn Into List]()
parameter_name_width_for_doors = StringInput("Width")  # "Parameter Name "Width" (For Doors/Windows)"
parameter_exists_2 = Custom[Parameter Exists](param=parameter_name_width_for_doors)
map_4 = Map(parameter_exists_2, combine_two_nested_list)
# note: Filter out elements using instance parameters
map_5 = Map(turn_into_list_2, map_4)
combine = Combine(filter_by_boolean_mask_3.out1, combine_two_nested_list, map_5)
get_sublist_lengths = Custom[Get Sublist Lengths](list=combine)  # Gets the lengths of all sublists in a given list of lists.
flatten_completely_2 = FlattenList(combine)
get_family_type = Custom[Get Family Type](Family_Instance_s=flatten_completely_2)  # Returns the familyt type of a given family instance
get_element_parameter_value = FamilyInstanceParameterGetter(get_family_type, parameter_name_width_for_doors, lacing=Longest)
# note: Get window areas
turn_into_list_3 = Custom[Turn Into List](item=get_element_parameter_value)
parameter_name_height_for_doors = StringInput("Height")  # "Parameter Name "Height" For Doors/Windows"
get_element_parameter_value_2 = FamilyInstanceParameterGetter(get_family_type, parameter_name_height_for_doors, lacing=Longest)
turn_into_list_4 = Custom[Turn Into List](item=get_element_parameter_value_2)
formula = Formula("width * height", width=turn_into_list_3, height=turn_into_list_4, lacing=Longest)
build_irregular_sublists = Custom[Build Irregular Sublists](lengths=get_sublist_lengths, list=formula)  # Turns a list into a list of lists with sublists of varying lengths.
map_6 = Map(sum_list_2, build_irregular_sublists)
# note: Controls for including/excluding certain classes of objects in/from the calculation
include_glass_doors = BoolSelector(true)
sum_list_3 = Custom[Sum List]()
filter_by_boolean_mask_5 = FilterMask()
filter_by_boolean_mask_6 = FilterMask()
filter_by_boolean_mask_7 = FilterMask()
turn_into_list_5 = Custom[Turn Into List]()
# note: ################
# #DOORS IN WALLS  #
# ################
category_3 = Categories(index=206)
# note: Create list of all room-bounding doors.
get_doors_or_windows_from_room_2 = Custom[Get Doors Or Windows From Room](Doors_Windows_Category=category_3, Phase=get_phase_by_name)
map_7 = Map(get_doors_or_windows_from_room_2, filter_by_boolean_mask_2.out1)
map_8 = Map(turn_into_list_5, map_7)
only_toroom_or_fromroom_is_set_2 = Custom[Only ToRoom OR FromRoom Is Set](Phase=get_phase_by_name)
# note: Filter down to exterior doors
map_9 = Map(only_toroom_or_fromroom_is_set_2, map_7)
combine_two_nested_list_2 = Custom[Combine Two Nested List](f_x_y=filter_by_boolean_mask_7, nested_list_1=map_8, nested_list_2=map_9)
# note: Only materials that have a higher transparency percentage than thi svalue will be counted as transparent materials
minimum_element_transparency = IntegerSliderInput(70, range=0..100)
element_has_transparent = Custom[Element Has Transparent Materials](Min_Transparency=minimum_element_transparency)  # Checks if a given element contains transparent materials.
map_10 = Map(element_has_transparent, combine_two_nested_list_2)
# note: Filter down to transparent doors in exterior walls
combine_two_nested_list_3 = Custom[Combine Two Nested List](f_x_y=filter_by_boolean_mask_6, nested_list_1=combine_two_nested_list_2, nested_list_2=map_10)
turn_into_list_6 = Custom[Turn Into List]()
parameter_exists_3 = Custom[Parameter Exists](param=parameter_name_width_for_doors)
map_11 = Map(parameter_exists_3, combine_two_nested_list_3)
map_12 = Map(turn_into_list_6, map_11)
combine_2 = Combine(filter_by_boolean_mask_5.out1, combine_two_nested_list_3, map_12)
get_sublist_lengths_2 = Custom[Get Sublist Lengths](list=combine_2)
flatten_completely_3 = FlattenList(combine_2)
get_family_type_2 = Custom[Get Family Type](Family_Instance_s=flatten_completely_3)
# note: Get door areas
get_element_parameter_value_3 = FamilyInstanceParameterGetter(get_family_type_2, parameter_name_width_for_doors, lacing=Longest)
turn_into_list_7 = Custom[Turn Into List](item=get_element_parameter_value_3)
get_element_parameter_value_4 = FamilyInstanceParameterGetter(get_family_type_2, parameter_name_height_for_doors, lacing=Longest)
turn_into_list_8 = Custom[Turn Into List](item=get_element_parameter_value_4)
formula_2 = Formula("width * height", width=turn_into_list_7, height=turn_into_list_8, lacing=Longest)
build_irregular_sublists_2 = Custom[Build Irregular Sublists](lengths=get_sublist_lengths_2, list=formula_2)
map_13 = Map(sum_list_3, build_irregular_sublists_2)
empty_list = Empty()
# note: Aggregate list of areas depending on ignore settings
if_ = Conditional(include_glass_doors, map_13, empty_list)
include_roof_windows = BoolSelector(true)
sum_list_4 = Custom[Sum List]()
filter_by_boolean_mask_8 = FilterMask()
flatten_completely_4 = FlattenList()
boolean = BoolSelector(false)
get_inserts = Custom[Get Inserts](Include_Openings=boolean, Include_Shadows=boolean, Include_Embedded_Walls=boolean, Include_Shared_Embedded_Inserts=boolean)  # Gets all the objects inserted into a given element.
filter_by_boolean_mask_9 = FilterMask()
# note: Get all room boundaries
get_room_boundaries = Custom[Get Room Boundaries](Room_s=filter_by_boolean_mask_2.out1)  # Gets a list of all boundary elements of a given room
# note: ###################
# # WINDOWS IN ROOFS  #
# ###################
category_4 = Categories(index=687)
is_of_category = Custom[Is Of Category](BuiltInCategory=category_4)  # Checks whether an element is of a specified category
# note: Create list of all room-bounding roofs.
map_14 = Map(is_of_category, get_room_boundaries.Elements)
combine_two_nested_list_4 = Custom[Combine Two Nested List](f_x_y=filter_by_boolean_mask_9, nested_list_1=get_room_boundaries.Elements, nested_list_2=map_14)
# note: Get inserts of roofs
map_15 = Map(get_inserts, combine_two_nested_list_4)
map_16 = Map(flatten_completely_4, map_15)
number = DoubleInput(0)
if_empty_replace_with_new_value = Custom[If Empty Replace With New Value](replacement=number)  # Replaces an <empty> item with a specified value. Use with Map for lists
z_axis = XyzBasisZ(lacing=Longest)
# note: Since curtain wall panels do not know which rooms they border, we will have to project their coordinates along their face orientation and check if those points are inside any rooms. This value describes the distance of that projection (in meters).
room_threshold = DoubleSliderInput(0.25, range=0..1)
scale_xyz = XyzScale(z_axis, room_threshold, lacing=Longest)
subtract_xyzs = XyzSubtract(arg1=scale_xyz, lacing=Longest)
get_element_location = Custom[Get Element Location]()  # Returns the location of an element as an XYZ (or if it's line-based the start and end point of the line), along with some booleans to help filtering the results. Use this for some element types (e.g. walls or lines) that do not work with the built-in Get Family Instance Location node.
# note: Create an XYZ below the window
map_17 = Map(get_element_location.Location_s, map_16)
map_18 = Map(subtract_xyzs, map_17)
get_sublist_lengths_3 = Custom[Get Sublist Lengths](list=map_18)
map_19 = Map(if_empty_replace_with_new_value, get_sublist_lengths_3)
is_point_in_room = Custom[Is Point In Room]()  # Evaluates if an XYZ is located inside a given room.
is_empty = Custom[Is Empty](item_s=get_sublist_lengths_3)  # Checks if the input items are <empty>
filter_by_boolean_mask_10 = FilterMask(filter_by_boolean_mask_2.out1, is_empty)
filter_by_boolean_mask_11 = FilterMask(map_18, is_empty)
# note: Check for each window if it is located above the relevant rooms (depending on which rooms the respective roof is bounding)
combine_list_with_nested_list = Custom[Combine List With Nested List](f_x_y=is_point_in_room, list=filter_by_boolean_mask_10.out1, nested_list=filter_by_boolean_mask_11.out1)  # Works like the built-in Combine node, but for functions that would expect a single element as the first input and a list as the second input.
flatten_completely_5 = FlattenList(combine_list_with_nested_list)
build_irregular_sublists_3 = Custom[Build Irregular Sublists](lengths=map_19, list=flatten_completely_5)
combine_two_nested_list_5 = Custom[Combine Two Nested List](f_x_y=filter_by_boolean_mask_8, nested_list_1=map_16, nested_list_2=build_irregular_sublists_3)
get_sublist_lengths_4 = Custom[Get Sublist Lengths](list=combine_two_nested_list_5)
flatten_completely_6 = FlattenList(combine_two_nested_list_5)
get_family_type_3 = Custom[Get Family Type](Family_Instance_s=flatten_completely_6)
get_element_parameter_value_5 = FamilyInstanceParameterGetter(get_family_type_3, parameter_name_width_for_doors, lacing=Longest)
# note: Get roof window areas
turn_into_list_9 = Custom[Turn Into List](item=get_element_parameter_value_5)
get_element_parameter_value_6 = FamilyInstanceParameterGetter(get_family_type_3, parameter_name_height_for_doors, lacing=Longest)
turn_into_list_10 = Custom[Turn Into List](item=get_element_parameter_value_6)
formula_3 = Formula("width * height", width=turn_into_list_9, height=turn_into_list_10, lacing=Longest)
build_irregular_sublists_4 = Custom[Build Irregular Sublists](lengths=get_sublist_lengths_4, list=formula_3)
map_20 = Map(sum_list_4, build_irregular_sublists_4)
if_2 = Conditional(include_roof_windows, map_20, empty_list)
sum_list_5 = Custom[Sum List]()
filter_by_boolean_mask_12 = FilterMask()
# note: #####################
# # WINDOWS IN SYSTEMS  #
# #####################
category_5 = Categories(index=892)
get_family_instances_by_category_2 = Custom[Get Family Instances By Category](BuiltInCategories=category_5)
turn_into_list_11 = Custom[Turn Into List](item=get_family_instances_by_category_2)
only_toroom_or_fromroom_is_set_3 = Custom[Only ToRoom OR FromRoom Is Set](Doors_Windows=get_family_instances_by_category_2, Phase=get_phase_by_name)
filter_by_boolean_mask_13 = FilterMask(turn_into_list_11, only_toroom_or_fromroom_is_set_3)
include_curtain_walls = BoolSelector(true)
filter_by_boolean_mask_14 = FilterMask()
join_lists = Append()
# note: ###############################
# # CURTAIN WALLS, CURTAIN SYSTEMS #
# # AND GLAZED ROOFS                          #
# ##############################
category_6 = Categories(index=877)
filter_list_by_category = Custom[Filter List By Category](BuiltInCategory=category_6)  # Filters out all elements that are not of a specified category
# note: Room-bounding walls
map_21 = Map(filter_list_by_category.in, get_room_boundaries.Elements)
# note: Room boundaries that are walls or embedded walls.
category_7 = Categories(index=877)
boolean_2 = BoolSelector(true)
get_inserts_of_room_boundaries = Custom[Get Inserts Of Room Boundaries By Category](Room_s=filter_by_boolean_mask_2.out1, BuiltInCategory=category_7, Include_Openings=boolean_2, Include_Shadows=boolean_2, Include_Embedded_Walls=boolean_2, Include_Shared_Embedded_Inserts=boolean_2)  # Retrieves the inserts of the bounding elements of a given room - filtered by a given category.
combine_3 = Combine(join_lists, map_21, get_inserts_of_room_boundaries)
wall_type_is_curtain_wall = Custom[Wall Type Is Curtain Wall]()  # Checks whether a given wall type is a curtain wall
get_wall_type = Custom[Get Wall Type]()  # Gets the wall type of a given wall instance.
# note: Get the type of each wall
map_22 = Map(get_wall_type, combine_3)
map_23 = Map(wall_type_is_curtain_wall, map_22)
# note: Filter out walls that are not a curtain wall type
combine_4 = Combine(filter_by_boolean_mask_14, combine_3, map_23)
empty_list_2 = Empty()
if_3 = Conditional(include_curtain_walls, combine_4, empty_list_2)
include_glazed_roofs = BoolSelector(true)
filter_roofs_by_kind = Custom[Filter Roofs By Kind]()  # Filters a list of roofs by their kind (basic or glazed).
# note: Room boundaries that are glazed roofs.
category_8 = Categories(index=687)
filter_list_by_category_2 = Custom[Filter List By Category](BuiltInCategory=category_8)
# note: Room-bounding roofs
map_24 = Map(filter_list_by_category_2.in, get_room_boundaries.Elements)
# note: Eliminate all non-glazed roofs
map_25 = Map(filter_roofs_by_kind.Glazed, map_24)
if_4 = Conditional(include_glazed_roofs, map_25, empty_list_2)
include_curtain_systems = BoolSelector(true)
# note: Room boundaries that are curtain systems.
category_9 = Categories(index=166)
filter_list_by_category_3 = Custom[Filter List By Category](BuiltInCategory=category_9)
map_26 = Map(filter_list_by_category_3.in, get_room_boundaries.Elements)
if_5 = Conditional(include_curtain_systems, map_26, empty_list_2)
list = NewList(index0=if_3, index1=if_4, index2=if_5)
# note: Create a flat list of unique curtain walls, curtain systems and glazed roofs using their Unique IDs
flatten_completely_7 = FlattenList(list)
elements_to_ids = Custom[Elements to IDs](Element_s=flatten_completely_7)  # Gets the ID(s) for a list of Revit elements (or a single element)
turn_into_list_12 = Custom[Turn Into List](item=elements_to_ids.UniqueID)
list_contains = Custom[List Contains](list=turn_into_list_12)  # Returns true if the given item is found in the given list, and false otherwise.
get_host = Custom[Get Host](element_s=filter_by_boolean_mask_13)  # Gets an element's host
elements_to_ids_2 = Custom[Elements to IDs](Element_s=get_host)
# note: Filter out all windows not hosted in systems
map_27 = Map(list_contains, elements_to_ids_2.UniqueID)
filter_by_boolean_mask_15 = FilterMask(filter_by_boolean_mask_13, map_27)
# note: Get number of rooms
list_length = Length(filter_by_boolean_mask_2.out1)
repeat = Repeat(filter_by_boolean_mask_15, list_length)
equal = Equal()
# note: Get Unique IDs of rooms for matching in componentized walls/roofs
elements_to_ids_3 = Custom[Elements to IDs](Element_s=filter_by_boolean_mask_2.out1)
rooms_from_doors_and_windows = Custom[Rooms From Doors And Windows](Door_s_Window_s=filter_by_boolean_mask_15, Phase=get_phase_by_name)  # Gets the rooms that are connected by a given door or a window
list_2 = NewList(index0=rooms_from_doors_and_windows.From_Room_s, index1=rooms_from_doors_and_windows.To_Room_s)
# note: Find corresponding rooms
transpose_lists = Transpose(list_2)
flatten_completely_8 = FlattenList(transpose_lists)
elements_to_ids_4 = Custom[Elements to IDs](Element_s=flatten_completely_8)
turn_into_list_13 = Custom[Turn Into List](item=elements_to_ids_4.UniqueID)
# note: Match to room list
cartesian_product = CartProd(equal, elements_to_ids_3.UniqueID, turn_into_list_13)
list_length_2 = Length(turn_into_list_13)
partition_list = Slice(cartesian_product, list_length_2)
combine_two_nested_list_6 = Custom[Combine Two Nested List](f_x_y=filter_by_boolean_mask_12, nested_list_1=repeat, nested_list_2=partition_list)
get_sublist_lengths_5 = Custom[Get Sublist Lengths](list=combine_two_nested_list_6)
flatten_completely_9 = FlattenList(combine_two_nested_list_6)
get_element_parameter_value_7 = FamilyInstanceParameterGetter(flatten_completely_9, parameter_name_width_for_doors, lacing=Longest)
turn_into_list_14 = Custom[Turn Into List](item=get_element_parameter_value_7)
get_element_parameter_value_8 = FamilyInstanceParameterGetter(flatten_completely_9, parameter_name_height_for_doors, lacing=Longest)
turn_into_list_15 = Custom[Turn Into List](item=get_element_parameter_value_8)
formula_4 = Formula("width * height", width=turn_into_list_14, height=turn_into_list_15, lacing=Longest)
build_irregular_sublists_5 = Custom[Build Irregular Sublists](lengths=get_sublist_lengths_5, list=formula_4)
map_28 = Map(sum_list_5, build_irregular_sublists_5)
sum_list_6 = Custom[Sum List]()
filter_by_boolean_mask_16 = FilterMask()
# note: ###################
# # DOORS IN SYSTEMS  #
# ###################
category_10 = Categories(index=206)
get_family_instances_by_category_3 = Custom[Get Family Instances By Category](BuiltInCategories=category_10)
turn_into_list_16 = Custom[Turn Into List](item=get_family_instances_by_category_3)
only_toroom_or_fromroom_is_set_4 = Custom[Only ToRoom OR FromRoom Is Set](Doors_Windows=get_family_instances_by_category_3, Phase=get_phase_by_name)
filter_by_boolean_mask_17 = FilterMask(turn_into_list_16, only_toroom_or_fromroom_is_set_4)
list_contains_2 = Custom[List Contains](list=turn_into_list_12)
get_host_2 = Custom[Get Host](element_s=filter_by_boolean_mask_17)
elements_to_ids_5 = Custom[Elements to IDs](Element_s=get_host_2)
# note: Filter out all doors not hosted in systems
map_29 = Map(list_contains_2, elements_to_ids_5.UniqueID)
filter_by_boolean_mask_18 = FilterMask(filter_by_boolean_mask_17, map_29)
# note: Filter out all non-transparent doors
element_has_transparent_2 = Custom[Element Has Transparent Materials](Element_s=filter_by_boolean_mask_18, Min_Transparency=minimum_element_transparency)
turn_into_list_17 = Custom[Turn Into List](item=element_has_transparent_2)
filter_by_boolean_mask_19 = FilterMask(filter_by_boolean_mask_18, turn_into_list_17)
repeat_2 = Repeat(filter_by_boolean_mask_19, list_length)
equal_2 = Equal()
rooms_from_doors_and_windows_2 = Custom[Rooms From Doors And Windows](Door_s_Window_s=filter_by_boolean_mask_19, Phase=get_phase_by_name)
list_3 = NewList(index0=rooms_from_doors_and_windows_2.From_Room_s, index1=rooms_from_doors_and_windows_2.To_Room_s)
transpose_lists_2 = Transpose(list_3)
flatten_completely_10 = FlattenList(transpose_lists_2)
elements_to_ids_6 = Custom[Elements to IDs](Element_s=flatten_completely_10)
turn_into_list_18 = Custom[Turn Into List](item=elements_to_ids_6.UniqueID)
cartesian_product_2 = CartProd(equal_2, elements_to_ids_3.UniqueID, turn_into_list_18)
list_length_3 = Length(turn_into_list_18)
partition_list_2 = Slice(cartesian_product_2, list_length_3)
combine_two_nested_list_7 = Custom[Combine Two Nested List](f_x_y=filter_by_boolean_mask_16, nested_list_1=repeat_2, nested_list_2=partition_list_2)
get_sublist_lengths_6 = Custom[Get Sublist Lengths](list=combine_two_nested_list_7)
flatten_completely_11 = FlattenList(combine_two_nested_list_7)
get_element_parameter_value_9 = FamilyInstanceParameterGetter(flatten_completely_11, parameter_name_width_for_doors, lacing=Longest)
turn_into_list_19 = Custom[Turn Into List](item=get_element_parameter_value_9)
get_element_parameter_value_10 = FamilyInstanceParameterGetter(flatten_completely_11, parameter_name_height_for_doors, lacing=Longest)
turn_into_list_20 = Custom[Turn Into List](item=get_element_parameter_value_10)
formula_5 = Formula("width * height", width=turn_into_list_19, height=turn_into_list_20, lacing=Longest)
build_irregular_sublists_6 = Custom[Build Irregular Sublists](lengths=get_sublist_lengths_6, list=formula_5)
map_30 = Map(sum_list_6, build_irregular_sublists_6)
if_6 = Conditional(include_glass_doors, map_30, empty_list)
sum_list_7 = Custom[Sum List]()
flatten_completely_12 = FlattenList()
filter_by_boolean_mask_20 = FilterMask()
# note: #################
# # CURTAIN PANELS  #
# #################
category_11 = Categories(index=163)
get_family_instances_by_category_4 = Custom[Get Family Instances By Category](BuiltInCategories=category_11)
turn_into_list_21 = Custom[Turn Into List](item=get_family_instances_by_category_4)
# note: Filter out all curtain panels not hosted in room-bounding systems
list_contains_3 = Custom[List Contains](list=turn_into_list_12)
get_host_3 = Custom[Get Host](element_s=get_family_instances_by_category_4)
elements_to_ids_7 = Custom[Elements to IDs](Element_s=get_host_3)
map_31 = Map(list_contains_3, elements_to_ids_7.UniqueID)
filter_by_boolean_mask_21 = FilterMask(turn_into_list_21, map_31)
# note: Filter out all non-transparent panels
element_has_transparent_3 = Custom[Element Has Transparent Materials](Element_s=filter_by_boolean_mask_21, Min_Transparency=minimum_element_transparency)
turn_into_list_22 = Custom[Turn Into List](item=element_has_transparent_3)
filter_by_boolean_mask_22 = FilterMask(filter_by_boolean_mask_21, turn_into_list_22)
repeat_3 = Repeat(filter_by_boolean_mask_22, list_length)
compute_centroid = Custom[Compute Centroid](Element_s=filter_by_boolean_mask_22)  # Compute the centroid of an element - alpha version for single material element
get_hosted_object_orientation = Custom[Get Hosted Object Orientation](element_s=filter_by_boolean_mask_22)  # Gets the orientation of a hosted object (e.g. a window or a door - orientation always facing towards exterior)
# note: Project points to both sides of each panel
scale_xyz_2 = XyzScale(get_hosted_object_orientation, room_threshold, lacing=Longest)
add_xyzs = XyzAdd(compute_centroid, scale_xyz_2, lacing=Longest)
is_point_in_room_2 = Custom[Is Point In Room](Point_s=add_xyzs)
# note: Find matching rooms and filter out the rest
map_32 = Map(is_point_in_room_2, filter_by_boolean_mask_2.out1)
combine_two_nested_list_8 = Custom[Combine Two Nested List](f_x_y=filter_by_boolean_mask_20, nested_list_1=repeat_3, nested_list_2=map_32)
subtract_xyzs_2 = XyzSubtract(compute_centroid, scale_xyz_2, lacing=Longest)
is_point_in_room_3 = Custom[Is Point In Room](Point_s=subtract_xyzs_2)
map_33 = Map(is_point_in_room_3, filter_by_boolean_mask_2.out1)
combine_two_nested_list_9 = Custom[Combine Two Nested List](f_x_y=filter_by_boolean_mask_20, nested_list_1=repeat_3, nested_list_2=map_33)
list_4 = NewList(index0=combine_two_nested_list_8, index1=combine_two_nested_list_9)
transpose_lists_3 = Transpose(list_4)
map_34 = Map(flatten_completely_12, transpose_lists_3)
get_sublist_lengths_7 = Custom[Get Sublist Lengths](list=map_34)
flatten_completely_13 = FlattenList(map_34)
parameter_name_area_for_curtain = StringInput("Area")  # "Parameter Name "Area" (For Curtain Wall Panels)"
get_element_parameter_value_11 = FamilyInstanceParameterGetter(flatten_completely_13, parameter_name_area_for_curtain, lacing=Longest)
# note: Get CW panel areas
turn_into_list_23 = Custom[Turn Into List](item=get_element_parameter_value_11)
build_irregular_sublists_7 = Custom[Build Irregular Sublists](lengths=get_sublist_lengths_7, list=turn_into_list_23)
map_35 = Map(sum_list_7, build_irregular_sublists_7)
list_5 = NewList(index0=map_6, index1=if_, index2=if_2, index3=map_28, index4=if_6, index5=map_35)
transpose_lists_4 = Transpose(list_5)
# note: Create summed up glazing areas for each room and compare to required areas
map_36 = Map(sum_list, transpose_lists_4)
# note: This is a Formula node, so you can either use a formula or a just a number to describe the minimal area ratio
min_glazing_area_floor_area = Formula("1/8", lacing=Longest)  # "Min. Glazing Area / Floor Area Ratio"
get_area = Custom[Get Area](element_s=filter_by_boolean_mask_2.out1)  # Returns the area property of a given element (if that element has such a property)
# note: Get all room areas
square_feet_to_square_meters = Custom[Square Feet To Square Meters](sq_ft=get_area)  # Converts square feet into square meters
# note: Get all required glazing areas
formula_6 = Formula("factor * area", factor=min_glazing_area_floor_area, area=square_feet_to_square_meters, lacing=Longest)
formula_7 = Formula("existing >= required", existing=map_36, required=formula_6, lacing=Longest)
filter_by_boolean_mask_23 = FilterMask(filter_by_boolean_mask_2.out1, formula_7)
list_6 = NewList(index0=string_4, index1=filter_by_boolean_mask_23.out1)
if_7 = Conditional(is_empty_list_3, string_3, list_6)
if_8 = Conditional(is_empty_list_2, string_2, if_7)
if_9 = Conditional(is_empty_list, string, if_8)
report = Watch(if_9)
glazing_per_room = Watch(map_36)
