# Dynamo graph Egress-Paths_063.dyn (Dynamo 0.6.3.7375)

room_name_fire_escape = StringInput("Fire Escape")
equal = Equal(arg1=room_name_fire_escape)
category = Categories(index=709)
# note: Get all rooms in the model
get_family_instances_by_category = Custom[Get Family Instances By Category](BuiltInCategories=category)  # Gets all family instances in the model for a given list of categories
flatten_completely = FlattenList(get_family_instances_by_category)
string = StringInput("Name")
get_element_parameter_value = FamilyInstanceParameterGetter(flatten_completely, string, lacing=Longest)
map = Map(equal, get_element_parameter_value)
count_true_and_false = Custom[Count True And False](booleans=map)  # Counts the occurences of True and False in a list of booleans
formula = Formula("n < 1", n=count_true_and_false.true, lacing=Longest)
string_2 = StringInput("There is no room marked as a fire escape in the model.")
formula_2 = Formula("n > 1", n=count_true_and_false.true, lacing=Longest)
string_3 = StringInput("There is more than one room marked as a fire escape in the model.")
string_4 = StringInput("The following rooms exceed the maximum egress path length:")
remove_duplicates = Custom[remove duplicates]()  # removes duplicate data from a list
first_of_list = First()
map_2 = Map(first_of_list)
# note: Filter down to fire escape
filter_by_boolean_mask = FilterMask(flatten_completely, map)
first_of_list_2 = First(filter_by_boolean_mask)
# note: Identify that room by its Unique ID
elements_to_ids = Custom[Elements to IDs](Element_s=first_of_list_2)  # Gets the ID(s) for a list of Revit elements (or a single element)
category_2 = Categories(index=206)
# note: Get all doors in the model
get_family_instances_by_category_2 = Custom[Get Family Instances By Category](BuiltInCategories=category_2)
phase_name = StringInput("New Construction")
get_phase_by_name = Custom[Get Phase by Name](str=phase_name)  # Returns the phase of a given name (if it exists)
# note: Get rooms for all doors and retrieve Unique IDs
rooms_from_doors_and_windows = Custom[Rooms From Doors And Windows](Door_s_Window_s=get_family_instances_by_category_2, Phase=get_phase_by_name)  # Gets the rooms that are connected by a given door or a window
elements_to_ids_2 = Custom[Elements to IDs](Element_s=rooms_from_doors_and_windows.From_Room_s)
elements_to_ids_3 = Custom[Elements to IDs](Element_s=rooms_from_doors_and_windows.To_Room_s)
list = NewList(index0=elements_to_ids_2.UniqueID, index1=elements_to_ids_3.UniqueID)
transpose_lists = Transpose(list)
# note: Create a graph of possible paths for each room
find_all_paths = Custom[Find All Paths](end_str=elements_to_ids.UniqueID, connections_str=transpose_lists)  # Finds all possible paths between two nodes. The connections input expects a list of value pairs.
flatten_completely_2 = FlattenList(list)
remove_duplicates_2 = Custom[remove duplicates](list=flatten_completely_2)
# note: Build a list of unique rooms
equal_2 = Equal(arg1=elements_to_ids.UniqueID)
map_3 = Map(equal_2, remove_duplicates_2)
filter_by_boolean_mask_2 = FilterMask(remove_duplicates_2, map_3)
map_4 = Map(find_all_paths, filter_by_boolean_mask_2.out1)
map_5 = Map(map_2, map_4)
map_6 = Map(remove_duplicates, map_5)
ids_to_elements = Custom[IDs to Elements](ID_s=map_6)  # Gets the Revit element(s) for a list of IDs (or a single ID)
greatest_distance_in_point = Custom[Greatest Distance in Point Sequence]()  # Retrieves the furthest point in a sequence of points
number = DoubleInput(0)
evaluate_curve = XyzOnCurveOrEdge(number, lacing=Longest)
# note: Find longest path for each room
get_room_boundaries = Custom[Get Room Boundaries](Room_s=ids_to_elements.Element_s)  # Gets a list of all boundary elements of a given room
map_7 = Map(evaluate_curve, get_room_boundaries.Curves)
first_of_list_3 = First()
get_element_location = Custom[Get Element Location]()  # Returns the location of an element as an XYZ (or if it's line-based the start and end point of the line), along with some booleans to help filtering the results. Use this for some element types (e.g. walls or lines) that do not work with the built-in Get Family Instance Location node.
# note: Find a sequence of points based on each sequence of doors
map_8 = Map(get_element_location.Location_s)
door_sequence_from_room_sequence = Custom[Door Sequence From Room Sequence](Doors=get_family_instances_by_category_2, Phase=get_phase_by_name)  # Retrieves a sequence of doors connecting a given sequence of rooms (if possible)
# note: Find a sequence of rooms for each sequence of rooms
map_9 = Map(door_sequence_from_room_sequence)
ids_to_elements_2 = Custom[IDs to Elements]()
map_10 = Map(ids_to_elements_2.Element_s)
# note: Convert paths graphs back to actual rooms
map_11 = Map(map_10, map_4)
map_12 = Map(map_9, map_11)
map_13 = Map(map_8, map_12)
number_2 = DoubleInput(1)
flatten = FlattenListAmt(map_13, number_2)
shortest_path_from_point = Custom[Shortest Path From Point Sequences]()  # Retrieves the shortest path from a number of point sequences
map_14 = Map(shortest_path_from_point.bool, map_13)
flatten_2 = FlattenListAmt(map_14, number_2)
filter_by_boolean_mask_3 = FilterMask(flatten, flatten_2)
map_15 = Map(first_of_list_3, filter_by_boolean_mask_3)
combine = Combine(greatest_distance_in_point.distance, map_7, map_15)
shortest_path_from_point_2 = Custom[Shortest Path From Point Sequences]()
# note: Find shortest paths based on point sequences.
map_16 = Map(shortest_path_from_point_2.distance, map_13)
# note: Compute total path lengths
formula_3 = Formula("dist_in_room + dist_room_to_escape", dist_in_room=combine, dist_room_to_escape=map_16, lacing=Longest)
max_egress_path_length_in_m = DoubleSliderInput(30, range=0..50)
# note: Filter down to rooms with excessive path lengths
formula_4 = Formula("len > max", len=formula_3, max=max_egress_path_length_in_m, lacing=Longest)
filter_by_boolean_mask_4 = FilterMask(ids_to_elements.Element_s, formula_4)
list_2 = NewList(index0=string_4, index1=filter_by_boolean_mask_4)
if_ = Conditional(formula_2, string_3, list_2)
if_2 = Conditional(formula, string_2, if_)
report = Watch(if_2)
# note: This graph calculates the shortest possible egress path to a given fire escape and identifies those rooms that have a path length that exceeds the required maximum path length.
# First presented at RTC Europe 2014.
# REQUIRED PACKAGES:
# - Clockwork
# MODEL PREPARATION:
# - Rooms and connecting doors need to be present in the model
# - Set a unique name for the room housing the fire escape
# - Rooms should have a shared parameter (type: length) to describe their distance to the nearest fire escape.
# - Set Dynamo units to meters!
# LIMITATIONS:
# This graph currently doesn't do any of the following:
# - Identify exits by door/window rather than by room. This would allow for ground level exits as well as secondary escape routes through windows. Obviously, these doors/windows should be identified by a property, most likely a shared parameter.
# - Use a mechanism to ignore certain doors for egress paths (like connecting doors between rooms). This could be done using a shared instance Yes/No parameter for doors (e.g. "IsEscapeRoute").
# - Check against multiple exits. This would allow for finding the two best paths for any given room. Also, it would then work on multiple levels at once.
# - Reformat paths so they don't go straight through a door's center, but rather project the center into both rooms and connect to those points. This would eliminate paths that coincide with e.g. corridor walls.
# - Use a better algorithm for finding shortest paths in rooms. Current algorithm only works well in boxes. Rooms with protruding elements (e.g. L-shaped rooms) will likely have paths that pass through walls.
# - Use a real Dijkstra algorithm for finding shortest paths. Current algorithm is brute force - not good for bigger models.
# note: SETTINGS
create_model_curves_for_egress = BoolSelector(true)  # "Create Model Curves for Egress Paths?"
lines_through_points = CurvesThroughPoints(lacing=Longest)
add_to_list = List()
number_3 = DoubleInput(1)
flatten_3 = FlattenListAmt(map_7, number_3)
greatest_distance_in_point_2 = Custom[Greatest Distance in Point Sequence]()
combine_2 = Combine(greatest_distance_in_point_2.bool, map_7, map_15)
flatten_4 = FlattenListAmt(combine_2, number_3)
filter_by_boolean_mask_5 = FilterMask(flatten_3, flatten_4)
combine_3 = Combine(add_to_list, filter_by_boolean_mask_5, filter_by_boolean_mask_3)
map_17 = Map(lines_through_points, combine_3)
# note: Create paths as line sequences
empty_list = Empty()
if_3 = Conditional(create_model_curves_for_egress, map_17, empty_list)
model_curve = ModelCurve(if_3, lacing=Longest)
write_egress_path_lengths_to = BoolSelector(true)  # "Write egress path lengths to rooms?"
empty_list_2 = Empty()
if_4 = Conditional(write_egress_path_lengths_to, ids_to_elements.Element_s, empty_list_2)
parameter_name_distance_to_fire = StringInput("DistanceToFireEscape")  # "Parameter Name: Distance To Fire Escape"
meters_to_feet = Custom[Meters To Feet](m=formula_3)  # Converts meters into feet
set_element_parameter = FamilyInstanceParameterSetter(if_4, parameter_name_distance_to_fire, meters_to_feet, lacing=Longest)
