# Dynamo graph Enforcing-Dimension-Styles.dyn (Dynamo 0.7.3.3034)

# note: Select dimensions category here
categories = Categories("Dimensions")
# note: Get all dimensions in project
all_elements_of_category = ElementsOfCategory(categories)
flatten = Flatten(all_elements_of_category)
type = Custom[Dimension.Type](Dimension_s=all_elements_of_category)  # Gets the type of a given Revit dimension
# note: Get dimension style types
style = Custom[DimensionType.Style](Dimension_Type_s=type)  # Gets the style of a given Revit dimension type
dimension_style_type = StringInput("Linear")
eq = _ == dimension_style_type
map = List.Map(style, eq)
# note: Filter out all undesired dimensions based on dimension style type
filterByBoolMask = List.FilterByBoolMask(flatten, map)
ownerView = Custom[Element.OwnerView](element_s=filterByBoolMask)  # Gets the owner view of a given Revit element (if possible)
# note: Get scales of respective views
scale = Custom[View.Scale](View_s=ownerView)  # Returns the scale of a given view
maximum_scale = DoubleInput(50)
# note: Filter out undesired dimensions based on view scale
formula = Formula("scale < maxscale", scale=scale, maxscale=maximum_scale, lacing=Longest)
filterByBoolMask_2 = List.FilterByBoolMask(flatten, formula)
# note: Get dimension type names
name = Element.Name(filterByBoolMask_2)
# note: This graph will enforce a particular dimension style based on view scale. The same concept can, of course, be applied to other annotation elements (think room tags, for example).
# First presented at RTC Europe 2014.
# REQUIRED PACKAGES:
# - Clockwork
# note: SETTINGS
correct_dimension_type_name = StringInput("LINEAR - DETAILING")
eq_2 = correct_dimension_type_name == _
map_2 = List.Map(name, eq_2)
# note: Filter out all undesired dimensions based on dimension type names
filterByBoolMask_3 = List.FilterByBoolMask(filterByBoolMask_2, map_2)
dimensionTypes = Custom[Document.DimensionTypes]()  # Retrieves all dimension types from the document
boolean = BoolSelector(true)
# note: Get the correct dimension type
all_elements_of_name = Custom[All Elements Of Name](Elements=dimensionTypes, Search_string=correct_dimension_type_name, Ignore_case=boolean)  # Retrieves those elements from a collection whose names match the search string
firstItem = List.FirstItem(all_elements_of_name.in)
# note: Set all collected dimensions to the desired dimension type
setType = Custom[Dimension.SetType](Dimension_Instance_s=filterByBoolMask_3.out1, Dimension_Type=firstItem)  # Changes the dimension type of a given dimension instance to the specified type
watch = Watch(type)
